# Grasshopper definition heathUI_0.9.3.gh (Grasshopper 1.0.8)
# plug-ins: Heteroptera, Human UI, Pufferfish, Human, LadybugGrasshopper, MetaHopper, eleFront5, Wombat, Telepathy, Cyclops

bldgvintages = HBBuildingVintages({"ASHRAE 90.1 2019  |  IECC 2021": "2019", "ASHRAE 90.1 2016  |  IECC 2018": "2016", "ASHRAE 90.1 2013  |  IECC 2015": "2013", "ASHRAE 90.1 2010  |  IECC 2012": "2010", "ASHRAE 90.1 2007  |  IECC 2009": "2007", "ASHRAE 90.1 2004  |  IECC 2006": "2004", "1980-2004 (CBECS)": "1980_2004", "Pre-1980 (CBECS)": "pre_1980"}, selected="ASHRAE 90.1 2019  |  IECC 2021")
int = Integer("0")

# ----
# Heath UI global settings
accent_colors = ValueList({"Amber", "Blue", "Brown", "Cobalt", "Crimson", "Cyan", "Emerald", "Green", "Indigo", "Lime", "Magenta", "Mauve", "Olive", "Orange", "Pink", "Purple", "Red", "Sienna", "Steel", "Taupe", "Teal", "Violet", "Yellow"}, selected="Brown")
heath_accent_color = RemoteSender(accent_colors)

# ----
# LICENSE/SUPPORT
# Copyright (c) 2026, Heath.
# 
# You should have received a copy of the GNU Affero General Public License along with Heath; If not, see <http://www.gnu.org/licenses/>.
# 
# @license AGPL-3.0-or-later <https://spdx.org/licenses/AGPL-3.0-or-later>
# Contact
# Github: github.com/sawenchalmers/heath
# 
# Author: Toivo Säwén, sawen@chalmers.se
# 
# Contributors: Isac Mjörnell, misac@chalmers.se, Jieming Yan, jieming@chalmers.se, Lina Eriksson
# Configuration
enable_cyclops = BooleanToggle(False)
allowed_python_versions = RemoteSender("0.9.3")
enable_cyclops_2 = RemoteSender(enable_cyclops)

# ----
# Pop-up window dimensions
number_slider = Slider(525, range=0..1000)
number_slider_2 = Slider(1000, range=0..1200)
subtraction = Subtraction(A=number_slider_2, B=Slider(220, range=0..1000))
subtraction_2 = Subtraction(A=number_slider, B=Slider(100, range=0..100))
bar_chart_popup_win_width = RemoteSender(number_slider_2)
bar_chart_popup_win_height = RemoteSender(number_slider)
bar_chart_img_width = RemoteSender(subtraction)
bar_chart_img_height = RemoteSender(subtraction_2)

checkbox = CreateCheckbox(Label="No geometry selected", StartingValue=False)
checkbox_2 = CreateCheckbox(Label="No geometry selected", StartingValue=False)
button = CreateButton(ButtonName="Select target geometry", ButtonStyle=0)
button_2 = CreateButton(ButtonName="Select shading geometry", ButtonStyle=0)
values = ValueListener(Elements=checkbox_2, SomeProperty=True)  # -> Values, Indices
values_2 = ValueListener(Elements=checkbox, SomeProperty=True)  # -> Values, Indices
values_3 = ValueListener(Elements=button, SomeProperty=True)  # -> Values, Indices
freeze_gate = StreamFreezeGate(Data=values_3.Values, PassingSwitch=invert(values_3.Values))
bool = Boolean(invert(freeze_gate))
tap = TapBuffer(Reset=False, Incremental=True, Valve=bool, Hold=True)
dam = DataDam(DataA=tap, BufferDelay=2500000, BufferMode=2)
equals = Equality(FirstNumber=tap, SecondNumber=dam)  # -> Equality, Inequality
values_4 = ValueListener(Elements=button_2, SomeProperty=True)  # -> Values, Indices
freeze_gate_2 = StreamFreezeGate(Data=values_4.Values, PassingSwitch=invert(values_4.Values))
bool_2 = Boolean(invert(freeze_gate_2))
tap_2 = TapBuffer(Reset=False, Incremental=True, Valve=bool_2, Hold=True)
dam_2 = DataDam(DataA=tap_2, BufferDelay=2500000, BufferMode=2)
equals_2 = Equality(FirstNumber=tap_2, SecondNumber=dam_2)  # -> Equality, Inequality
entwine = Entwine(Branch00=button, Branch01=checkbox_2, FlattenInputs=True)  # -> flatten(Result)
entwine_2 = Entwine(Branch00=button_2, Branch01=checkbox, FlattenInputs=True)  # -> flatten(Result)
adjustpos = AdjustElementPositioning(ElementsToAdjust=[button, button_2], AbsolutePositioning=False, Width=Slider(150, range=0..1000), VerticalAlignment=1)
toggle = CreateToggle(Default=invert(False), OnLabel="Total GWP", OffLabel="GWP/m2")
stack = CreateStack(UIElements=entwine_2, Horizontal=True)
stack_2 = CreateStack(UIElements=entwine, Horizontal=True)
values_5 = ValueListener(Elements=toggle, SomeProperty=True)  # -> Values, Indices
bool_3 = Boolean(invert(values_5.Values))

panel = Panel("""This tab sets up the geometry and settings for the model
1. Name the model
2. Import geometry 
3. Select program
4. Select construction
5. Set location
6. Press "Construct model!" to create the analysis model""")
true_button = CreateTrueOnlyButton(ButtonName="?", ButtonStyle=2)
values_6 = ValueListener(Elements=true_button, SomeProperty=True)  # -> Values, Indices
rec = DataRecorder(values_6.Values, DataLimit=-10, RecordData=True)
ma = MassAddition(Input=rec)  # -> Result, PartialResults
tb = CreateTextBlock(Text=panel, TextSize=12, Justification=0)
mod = Modulus(A=ma.Result, B=2)
hideshow = HideShowElement(ElementToHideShow=tb, Show=mod, Collapse=True, Disable=False)
label = CreateLabel(LabelText="Create new model", LabelSize=18, Justification=0)
entwine_3 = Entwine(Branch00=label, Branch01=true_button, FlattenInputs=True)  # -> flatten(Result)
stack_3 = CreateStack(UIElements=entwine_3, Horizontal=True)

# ----
# Click here to restart Heath
button_3 = Button()
restart_heath = RemoteSender(button_3)

# ----
# Sends signal when recompute
panel_2 = Panel("recompute")
button_4 = CreateButton(ButtonName=panel_2, ButtonStyle=0)
values_7 = ValueListener(Elements=button_4, SomeProperty=True)  # -> Values, Indices
freeze_gate_3 = StreamFreezeGate(Data=values_7.Values, PassingSwitch=invert(values_7.Values))
bool_4 = Boolean(invert(freeze_gate_3))
tap_3 = TapBuffer(Reset=False, Incremental=True, Valve=bool_4, Hold=True)
dam_3 = DataDam(DataA=tap_3, BufferDelay=2500000, BufferMode=2)
equals_3 = Equality(FirstNumber=tap_3, SecondNumber=dam_3)  # -> Equality, Inequality
event = EventGate(Data=equals_3.Inequality)  # -> Data, IsNew
recompute = RemoteSender(event.Data)

bar_chart_popup_win_width_2 = RemoteReceiver(bar_chart_popup_win_width)
bar_chart_popup_win_height_2 = RemoteReceiver(bar_chart_popup_win_height)
bar_chart_img_height_2 = RemoteReceiver(bar_chart_img_height)
bar_chart_img_width_2 = RemoteReceiver(bar_chart_img_width)
bar_chart_popup_win_height_3 = RemoteReceiver(bar_chart_popup_win_height)
bar_chart_popup_win_width_3 = RemoteReceiver(bar_chart_popup_win_width)
bar_chart_img_height_3 = RemoteReceiver(bar_chart_img_height)
bar_chart_img_width_3 = RemoteReceiver(bar_chart_img_width)
bar_chart_popup_win_height_4 = RemoteReceiver(bar_chart_popup_win_height)
bar_chart_popup_win_width_4 = RemoteReceiver(bar_chart_popup_win_width)
bar_chart_img_height_4 = RemoteReceiver(bar_chart_img_height)
bar_chart_img_width_4 = RemoteReceiver(bar_chart_img_width)

# ----
# CLICK BUTTON
# TO RESTART
# HEATH
number_slider_3 = Slider(500, range=0..1000)
selobj = GetSelectedObjects()  # -> ComponentObjects, ParamObjects, OtherObjects
# Color codes
# UI module elements
# UI launch windows
# Front-end database
# Back-end database
setscribble = SetScribbleProperties(Scribble=selobj.OtherObjects, ScribbleSize=number_slider_3)

roomenergyattr = HBRoomEnergyAttributes({"Program": "properties.energy.program_type.display_name", "Construction Set": "properties.energy.construction_set.display_name", "Is Conditioned": "properties.energy.is_conditioned", "People per Area [ppl/m2]": "properties.energy.people.people_per_area", "Area per Person [m2/ppl]": "properties.energy.people.area_per_person", "Lighting per Area [W/m2]": "properties.energy.lighting.watts_per_area"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}, selected="Program")
faceenergyattr = HBFaceEnergyAttributes({"Construction": "properties.energy.construction.display_name", "Materials": "properties.energy.construction.layers", "Thickness [m]": "properties.energy.construction.thickness", "Density [kg/m2]": "properties.energy.construction.mass_area_density", "Heat Capacity [J/K-m2]": "properties.energy.construction.area_heat_capacity", "Construction R-Value [m2-K/W]": "properties.energy.construction.r_value", "Construction U-Value [W/m2-K]": "properties.energy.construction.u_value", "Construction U-Factor [W/m2-K]": "properties.energy.construction.u_factor", "Construction SHGC [Unshaded]": "properties.energy.construction.shgc", "R-Factor [m2-K/W]": "properties.energy.r_factor", "U-Factor [W/m2-K]": "properties.energy.u_factor", "SHGC [Unshaded]": "properties.energy.shgc", "Solar Transmitance [Unshaded]": "properties.energy.construction.solar_transmittance", "Visible Transmitance [Unshaded]": "properties.energy.construction.visible_transmittance", "Solar Reflectance [Outside]": "properties.energy.construction.outside_solar_reflectance", "Solar Reflectance [Inside]": "properties.energy.construction.inside_solar_reflectance", "Fraction Area Operable": "properties.energy.vent_opening.fraction_area_operable", "Fraction Height Operable": "properties.energy.vent_opening.fraction_height_operable", "Discharge Coefficient": "properties.energy.vent_opening.discharge_coefficient"}, selected="Construction SHGC [Unshaded]")
faceattr = HBFaceAttributes({"Display Name": "display_name", "Simulation Name (Identifier)": "identifier", "Boundary Condition": "boundary_condition", "Has Parent": "has_parent", "Parent": "parent", "Azimuth": "azimuth", "Altitude": "altitude", "Area": "area", "Perimeter": "perimeter", "Face Type": "type", "Aperture Is Operable": "is_operable", "Door Is Glass": "is_glass"}, selected="Face Type")
roomattr = HBRoomAttributes({"Display Name": "display_name", "Simulation Name (Identifier)": "identifier", "Multiplier": "multiplier", "Floor Area Excluded": "exclude_floor_area", "Story": "story", "Volume": "volume", "Gross Floor Area": "floor_area", "Exposed Area": "exposed_area", "Exterior Wall Area": "exterior_wall_area", "Exterior Aperture Area": "exterior_aperture_area", "Average Floor Elevation": "average_floor_height"}, selected="Exterior Aperture Area")
panel_3 = Panel("Model constructed, but there were warnings. Double check your geometry.")
label_2 = CreateLabel(LabelText="Currently selected location: ", LabelSize=12, Justification=0)
pulldown = CreatePulldownMenu(Label="Compare with", showLabel=True)
button_5 = CreateButton(ButtonName="Calculate GWP", ButtonStyle=0)
label_3 = CreateLabel(LabelText="Compare simulations", LabelSize=18, Justification=0)
true_button_2 = CreateTrueOnlyButton(ButtonName="Compare simulations bar chart", ButtonStyle=0)
button_6 = CreateButton(ButtonName="Set north vector", ButtonStyle=0)
pulldown_2 = CreatePulldownMenu(Label="Select model", showLabel=True)
tb_2 = CreateTextBlock(TextSize=16, Justification=0)
panel_4 = Panel("""Current simulation: 
{0}""")
relay = Relay()
tb_3 = CreateTextBlock(TextSize=16, Justification=0)
button_7 = CreateButton(ButtonName="Bake", ButtonStyle=0)
panel_5 = Panel("""Current simulation: 
{0}""")
values_8 = ValueListener(Elements=pulldown, SomeProperty=True)  # -> Values, Indices
values_9 = ValueListener(Elements=button_5, SomeProperty=True)  # -> Values, Indices
txt = Text("""Model constructed, but there were warnings. Double check your geometry.
The following sub-faces were not matched with any parent Face:Aperture_8f7920f3_0""")
tb_4 = CreateTextBlock(Text="Loading models. This may take a moment.", TextSize=12, Justification=0)
values_10 = ValueListener(Elements=true_button_2, SomeProperty=True)  # -> Values, Indices
values_11 = ValueListener(Elements=pulldown_2, SomeProperty=True)  # -> Values, Indices
format = Format(Culture=127)
values_12 = ValueListener(Elements=button_7, SomeProperty=True)  # -> Values, Indices
tb_5 = CreateTextBlock(Text="Currently constructing model. This can take a moment.", TextSize=12, Justification=1)
tb_6 = CreateTextBlock(TextSize=16, Justification=0)
tb_7 = CreateTextBlock(Text=flatten(panel_3), TextSize=12, Justification=1)
panel_6 = Panel("""Selected model: 
{0}""")
button_8 = CreateButton(ButtonName="?", ButtonStyle=2)
tb_8 = CreateTextBlock(Text="Model constructed!", TextSize=12, Justification=1)
true_button_3 = CreateTrueOnlyButton(ButtonName="?", ButtonStyle=2)
event_2 = EventGate(Data=values_11.Indices)  # -> Data, IsNew
subtraction_3 = Subtraction(A=values_8.Indices, B="1")
label_4 = CreateLabel(LabelText="Heat recovery efficiency [%]", LabelSize=12, Justification=0)
slider = CreateSlider(Slider=Slider(43, range=0..100), ShowBounds=False, ShowTicks=True, ShowTooltip=True, ShowValLabel=True, showLabel=False)
simple_energy_simulation_compare_pop_up = RemoteSender(values_10.Values)
current_selected_model_analysis_module_n = RemoteSender(values_11.Values)  # "current_selected_model_analysis_module_name"
current_selected_model_analysis_module_n_2 = RemoteReceiver(current_selected_model_analysis_module_n)  # "current_selected_model_analysis_module_name"
current_selected_model_analysis_module_n_3 = RemoteReceiver(current_selected_model_analysis_module_n)  # "current_selected_model_analysis_module_name"
current_selected_model_analysis_module_n_4 = RemoteReceiver(current_selected_model_analysis_module_n)  # "current_selected_model_analysis_module_name"
format_2 = Format(Format=panel_4, Culture=127, Data0=current_selected_model_analysis_module_n_2)
format_3 = Format(Format=panel_5, Culture=127, Data0=current_selected_model_analysis_module_n_3)
pre_calculate_lca = RemoteSender(values_9.Values)
bake_daylight_simulation = RemoteSender(values_12.Values)
values_13 = ValueListener(Elements=button_8, SomeProperty=True)  # -> Values, Indices
current_selected_model_analysis_module = RemoteSender(event_2.Data)
settextblock = SetTextBlockContents(TextBlockToModify=tb_2, NewTextBlockContents=format_2)
current_selected_simulation_simple_energ = RemoteSender(subtraction_3)  # "current_selected_simulation_simple_energy_compare"
merge = Merge(Data1=tb_8, Data2=tb_7)
format_4 = Format(Format=panel_6, Culture=127, Data0=current_selected_model_analysis_module_n_4)
settextblock_2 = SetTextBlockContents(TextBlockToModify=tb_3, NewTextBlockContents=format_3)
values_14 = ValueListener(Elements=slider, SomeProperty=True)  # -> Values, Indices
tooltip = AttachTooltipToElement(ElementsToAttachTo=slider, TooltipContent="Doubleclick to input value", ShowDelay=500, Duration=2000)
freeze_gate_4 = StreamFreezeGate(Data=values_13.Values, PassingSwitch=invert(values_13.Values))
tb_9 = CreateTextBlock(Text="Loading models. This may take a moment.", TextSize=12, Justification=0)
settextblock_3 = SetTextBlockContents(TextBlockToModify=tb_6, NewTextBlockContents=format_4)
bool_5 = Boolean(invert(freeze_gate_4))
division = Division(A=values_14.Values, B="100")
and = GateAnd()
rec_2 = DataRecorder(bool_5, DataLimit=-10, RecordData=True)
format_5 = Format(Format="{0}, {1}, 0, 0", Culture=127, Data0=Slider(5, range=-25..25), Data1=Slider(8, range=0..100))
heat_recovery_efficiency = RemoteSender(division)
entwine_4 = Entwine(Branch00=label_4, Branch01=slider, FlattenInputs=True)  # -> flatten(Result)
current_selected_model_analysis_module_n_5 = RemoteReceiver(current_selected_model_analysis_module_n)  # "current_selected_model_analysis_module_name"
panel_7 = Panel("Currently running energy simulation. This can take several minutes for large models.")
int_2 = Integer(rec_2)
panel_8 = Panel("Currently running daylight simulation. This can take several minutes for large models.")
number_slider_4 = Slider(29, range=0..300)
adjustpos_2 = AdjustElementPositioning(
    ElementsToAdjust=pulldown_2,
    Margin=format_5,
    AbsolutePositioning=False,
    Width=Slider(300, range=0..400),
    HorizontalAlignment=0,
    VerticalAlignment=2)
format_6 = Format(
    Format="{0}, {1}, 0, {2}",
    Culture=127,
    Data0=Slider(5, range=-25..25),
    Data1=Slider(10, range=0..100),
    Data2=Slider(5, range=0..100))
ma_2 = MassAddition(Input=int_2)  # -> Result, PartialResults
format_7 = Format(
    Format="{0}, {1}, 0, {2}",
    Culture=127,
    Data0=Slider(5, range=-25..25),
    Data1=Slider(10, range=0..100),
    Data2=Slider(5, range=0..100))
format_8 = Format(
    Format="{0}, {1}, 0, {2}",
    Culture=127,
    Data0=Slider(5, range=-25..25),
    Data1=Slider(5, range=-15..15),
    Data2=Slider(5, range=0..100))
format_9 = Format(
    Format="{0}, {1}, 0, {2}",
    Culture=127,
    Data0=Slider(10, range=-25..25),
    Data1=Slider(5, range=-15..15),
    Data2=Slider(5, range=0..100))
adjustelem = AdjustElementAppearance(
    ElementsToAdjust=button_8,
    Foreground=ColourSwatch(SwatchColor=RGB(0, 0, 0)),
    Background=ColourSwatch(SwatchColor=RGB(230, 230, 230)),
    FontSize=Slider(12, range=0..300))
event_3 = EventGate(Data=ma_2.Result)  # -> Data, IsNew
adjustpos_3 = AdjustElementPositioning(
    ElementsToAdjust=tb_3,
    Margin=format_6,
    AbsolutePositioning=False,
    Width=Slider(245, range=0..300),
    HorizontalAlignment=0,
    VerticalAlignment=2)
format_10 = Format(
    Format="{0}, {1}, {2}, {3}",
    Culture=127,
    Data0=Slider(0, range=-10..10),
    Data1=Slider(0, range=-10..10),
    Data2=Slider(0, range=-10..10),
    Data3=Slider(4.5, range=-10..10))
format_11 = Format(
    Format="{0}, {1}, {2}, {3}",
    Culture=127,
    Data0=Slider(0, range=-10..10),
    Data1=Slider(0, range=-10..10),
    Data2=Slider(4.5, range=-10..10),
    Data3=Slider(0, range=-10..10))
adjustpos_4 = AdjustElementPositioning(
    ElementsToAdjust=tb_2,
    Margin=format_7,
    AbsolutePositioning=False,
    Width=Slider(245, range=0..300),
    HorizontalAlignment=0,
    VerticalAlignment=2)
col = Colour(RGB(103, 191, 235))
hasdata = DataExists(Data=current_selected_model_analysis_module_n_5)
dam_4 = DataDam(DataA=event_3.Data, BufferDelay=2500000, BufferMode=2)
tb_10 = CreateTextBlock(Text=panel_7, TextSize=12, Justification=0)
col_2 = Colour(RGB(103, 191, 235))
adjustpos_5 = AdjustElementPositioning(ElementsToAdjust=button_8, AbsolutePositioning=False, Width=number_slider_4, Height=number_slider_4)
stack_4 = CreateStack(UIElements=entwine_4, Horizontal=invert(True))
tb_11 = CreateTextBlock(Text=panel_8, TextSize=12, Justification=0)
entwine_5 = Entwine(Branch00=label_3, Branch01=true_button_2, Branch02=pulldown, FlattenInputs=True)  # -> flatten(Result)
adjustpos_6 = AdjustElementPositioning(
    ElementsToAdjust=pulldown,
    Margin=format_8,
    AbsolutePositioning=False,
    Width=Slider(245, range=0..300),
    HorizontalAlignment=0,
    VerticalAlignment=2)
adjustpos_7 = AdjustElementPositioning(ElementsToAdjust=true_button_2, Margin=format_9, AbsolutePositioning=False, HorizontalAlignment=0, VerticalAlignment=2)
adjustpos_8 = AdjustElementPositioning(ElementsToAdjust=button_5, AbsolutePositioning=False, HorizontalAlignment=0)
adjustelem_2 = AdjustElementAppearance(ElementsToAdjust=tb_10, Foreground=col)
hideshow_2 = HideShowElement(ElementToHideShow=tb_6, Show=hasdata, Collapse=True, Disable=False)
equals_4 = Equality(FirstNumber=event_3.Data, SecondNumber=dam_4)  # -> Equality, Inequality
adjustelem_3 = AdjustElementAppearance(ElementsToAdjust=tb_11, Foreground=col_2)
stack_5 = CreateStack(UIElements=entwine_5, Horizontal=invert(True))
adjustpos_9 = AdjustElementPositioning(ElementsToAdjust=label_2, Margin="0, 0, 0, 0", AbsolutePositioning=False, HorizontalAlignment=0)

# ----
# LCA info
panel_9 = Panel("?")
true_button_4 = CreateTrueOnlyButton(ButtonName=panel_9, ButtonStyle=2)  # disabled
values_15 = ValueListener(Elements=true_button_4, SomeProperty=True)  # -> Values, Indices
lca_info = RemoteSender(values_15.Values)
number_slider_5 = Slider(29, range=0..300)
adjustpos_10 = AdjustElementPositioning(
    ElementsToAdjust=true_button_4,
    Margin="5, 0, 0, 0",
    AbsolutePositioning=False,
    Width=number_slider_5,
    Height=number_slider_5)
adjustelem_4 = AdjustElementAppearance(
    ElementsToAdjust=true_button_4,
    Foreground=ColourSwatch(SwatchColor=RGB(0, 0, 0)),
    Background=ColourSwatch(SwatchColor=RGB(230, 230, 230)),
    FontSize=Slider(12, range=0..300))

adjustpos_11 = AdjustElementPositioning(
    ElementsToAdjust=tb_7,
    Margin="0, 10, 0, 0",
    AbsolutePositioning=False,
    Width=Slider(250, range=0..300),
    HorizontalAlignment=1)

# ----
# Daylight simulations info
panel_10 = Panel("?")
true_button_5 = CreateTrueOnlyButton(ButtonName=panel_10, ButtonStyle=2)  # disabled
values_16 = ValueListener(Elements=true_button_5, SomeProperty=True)  # -> Values, Indices
daylight_info = RemoteSender(values_16.Values)
number_slider_6 = Slider(29, range=0..300)
adjustpos_12 = AdjustElementPositioning(
    ElementsToAdjust=true_button_5,
    Margin="5, 0, 0, 0",
    AbsolutePositioning=False,
    Width=number_slider_6,
    Height=number_slider_6)
adjustelem_5 = AdjustElementAppearance(
    ElementsToAdjust=true_button_5,
    Foreground=ColourSwatch(SwatchColor=RGB(0, 0, 0)),
    Background=ColourSwatch(SwatchColor=RGB(230, 230, 230)),
    FontSize=Slider(12, range=0..300))

# ----
# Energy simulations info
panel_11 = Panel("?")
true_button_6 = CreateTrueOnlyButton(ButtonName=panel_11, ButtonStyle=2)  # disabled
values_17 = ValueListener(Elements=true_button_6, SomeProperty=True)  # -> Values, Indices
simple_energy_info = RemoteSender(values_17.Values)
number_slider_7 = Slider(29, range=0..300)
adjustpos_13 = AdjustElementPositioning(
    ElementsToAdjust=true_button_6,
    Margin="5, 0, 0, 0",
    AbsolutePositioning=False,
    Width=number_slider_7,
    Height=number_slider_7)
adjustelem_6 = AdjustElementAppearance(
    ElementsToAdjust=true_button_6,
    Foreground=ColourSwatch(SwatchColor=RGB(0, 0, 0)),
    Background=ColourSwatch(SwatchColor=RGB(230, 230, 230)),
    FontSize=Slider(12, range=0..300))

# ----
# Launch  LCA info
panel_12 = Panel("https://en.wikipedia.org/wiki/Life-cycle_assessment")
lca_info_2 = RemoteReceiver(lca_info)
py3 = Python3Script(url=panel_12, launch=lca_info_2)
# ---------- py3: Python ----------
"""Grasshopper Script"""
import webbrowser as wb
if launch == True:
    wb.open(url, 2, True)
# ---------- end py3 ----------

# ----
# Launch  daylight simulations info
panel_13 = Panel("https://www.ladybug.tools/honeybee.html#illuminance")
daylight_info_2 = RemoteReceiver(daylight_info)
py3_2 = Python3Script(url=panel_13, launch=daylight_info_2)  # same code as py3

# ----
# Launch energy simulations info
panel_14 = Panel("https://www.ladybug.tools/honeybee.html#energyBal")
simple_energy_info_2 = RemoteReceiver(simple_energy_info)
py3_3 = Python3Script(url=panel_14, launch=simple_energy_info_2)  # same code as py3

allowed_python_versions_2 = RemoteReceiver(allowed_python_versions)
path = DataPath("0;0;0")
panel_15 = Panel("Materials with an invalid category exists in the Rhino file")
enable_cyclops_3 = RemoteReceiver(enable_cyclops_2)
button_9 = CreateButton(ButtonName="Sync database", ButtonStyle=0)
label_5 = CreateLabel(LabelText=panel_15, LabelSize=12, Justification=0)
values_18 = ValueListener(Elements=button_9, SomeProperty=True)  # -> Values, Indices
sync_window_database = RemoteSender(values_18.Values)
adjustelem_7 = AdjustElementAppearance(ElementsToAdjust=label_5, Foreground=ColourSwatch(SwatchColor=RGB(255, 0, 0)))
panel_16 = Panel("No models have been created, please create one in the \"Create model\" tab.")
tb_12 = CreateTextBlock(Text=panel_16, TextSize=12, Justification=0)
tb_13 = CreateTextBlock(Text=panel_16, TextSize=12, Justification=0)
panel_17 = Panel("""Create model
Select model
Simulate!""")
item = ListItem(List=panel_17, Index=0, Wrap=True)  # -> Item, Item1, Item2

# ----
# Heath window
panel_18 = Panel(item.Item1)
panel_19 = Panel(item.Item)
panel_20 = Panel(item.Item2)
tab_simulate = RemoteSender(panel_20)
tab_create_model = RemoteSender(panel_19)
tab_load_inspect_model = RemoteSender(panel_18)

tab_simulate_2 = RemoteReceiver(tab_simulate)
tab_simulate_3 = RemoteReceiver(tab_simulate)
tab_load_inspect_model_2 = RemoteReceiver(tab_load_inspect_model)
tab_simulate_4 = RemoteReceiver(tab_simulate)
tab_create_model_2 = RemoteReceiver(tab_create_model)
tab_load_inspect_model_3 = RemoteReceiver(tab_load_inspect_model)
tab_load_inspect_model_4 = RemoteReceiver(tab_load_inspect_model)
tab_load_inspect_model_5 = RemoteReceiver(tab_load_inspect_model)
tab_simulate_5 = RemoteReceiver(tab_simulate)
tab_create_model_3 = RemoteReceiver(tab_create_model)
tab_simulate_6 = RemoteReceiver(tab_simulate)
tab_load_inspect_model_6 = RemoteReceiver(tab_load_inspect_model)
tab_simulate_7 = RemoteReceiver(tab_simulate)
tab_simulate_8 = RemoteReceiver(tab_simulate)
tab_simulate_9 = RemoteReceiver(tab_simulate)
tab_simulate_10 = RemoteReceiver(tab_simulate)
tab_simulate_11 = RemoteReceiver(tab_simulate)
heath_accent_color_2 = RemoteReceiver(heath_accent_color)
heath_accent_color_3 = RemoteReceiver(heath_accent_color)
heath_accent_color_4 = RemoteReceiver(heath_accent_color)
heath_accent_color_5 = RemoteReceiver(heath_accent_color)
panel_21 = Panel("?")
true_button_7 = CreateTrueOnlyButton(ButtonName="?", ButtonStyle=2)  # disabled
values_19 = ValueListener(Elements=true_button_7, SomeProperty=True)  # -> Values, Indices
info_save_geometry = RemoteSender(values_19.Values)
number_slider_8 = Slider(29, range=0..300)
format_12 = Format(Format="{0}, {1}, {2}, {3}", Culture=127, Data0=Slider(225, range=100..300))
adjustelem_8 = AdjustElementAppearance(
    ElementsToAdjust=true_button_7,
    Foreground=ColourSwatch(SwatchColor=RGB(0, 0, 0)),
    Background=ColourSwatch(SwatchColor=RGB(230, 230, 230)),
    FontSize=Slider(12, range=0..300))
adjustpos_14 = AdjustElementPositioning(
    ElementsToAdjust=true_button_7,
    Margin=format_12,
    AbsolutePositioning=invert(False),
    HorizontalAlignment=2,
    VerticalAlignment=2)
adjustpos_15 = AdjustElementPositioning(ElementsToAdjust=true_button_7, AbsolutePositioning=False, Width=number_slider_8, Height=number_slider_8)

# ----
# Modal UI locations
number_slider_9 = Slider(180, range=0..1000)
pt = ConstructPoint(XCoordinate=Slider(460, range=0..1000), YCoordinate=number_slider_9, ZCoordinate=0)
pt_2 = ConstructPoint(XCoordinate=Slider(65, range=0..1000), YCoordinate=number_slider_9, ZCoordinate=0)
pt_3 = ConstructPoint(XCoordinate=Slider(845, range=0..1000), YCoordinate=number_slider_9, ZCoordinate=0)
heath_window_location = RemoteSender(pt_2)
database_modal_location = RemoteSender(pt)
create_modal_location = RemoteSender(pt_3)

textbox = CreateTextBox(DefaultText=Slider(0.05, range=0..10), UpdateButton=invert(True), showLabel=False)
textbox_2 = CreateTextBox(DefaultText=Slider(0.02, range=0..10), UpdateButton=invert(True), showLabel=False)
textbox_3 = CreateTextBox(DefaultText=Slider(0.35, range=0..10), UpdateButton=invert(True), showLabel=False)
true_button_8 = CreateTrueOnlyButton(ButtonName="?", ButtonStyle=2)
label_6 = CreateLabel(LabelText="A4 [kg CO2eq/kg]", LabelSize=12, Justification=0)
label_7 = CreateLabel(LabelText="A5.1 [kg CO2eq/kg]", LabelSize=12, Justification=0)
textbox_4 = CreateTextBox(DefaultText=Slider(0.05, range=0..10), UpdateButton=invert(True), showLabel=False)
textbox_5 = CreateTextBox(DefaultText=Slider(0.35, range=0..10), UpdateButton=invert(True), showLabel=False)
textbox_6 = CreateTextBox(DefaultText=Slider(28, range=0..100), UpdateButton=invert(True), showLabel=False)
label_8 = CreateLabel(LabelText="A4 [kg CO2eq/kg]", LabelSize=12, Justification=0)
label_9 = CreateLabel(LabelText="Conversion value [kg/m2]", LabelSize=12, Justification=0)
label_10 = CreateLabel(LabelText="A1-A3 [kg CO2eq/kg]", LabelSize=12, Justification=0)
objbynn = GetObjectByNickname(NickName="Load models ping")
values_20 = ValueListener(Elements=true_button_8, SomeProperty=True)  # -> Values, Indices
values_21 = ValueListener(Elements=textbox_6, SomeProperty=True)  # -> Values, Indices
values_22 = ValueListener(Elements=textbox_3, SomeProperty=True)  # -> Values, Indices
values_23 = ValueListener(Elements=textbox_2, SomeProperty=True)  # -> Values, Indices
values_24 = ValueListener(Elements=textbox, SomeProperty=True)  # -> Values, Indices
values_25 = ValueListener(Elements=textbox_5, SomeProperty=True)  # -> Values, Indices
values_26 = ValueListener(Elements=textbox_4, SomeProperty=True)  # -> Values, Indices

# ----
# No link at the moment
info_create_window = RemoteSender(values_20.Values)

num = Number(values_22.Values)
num_2 = Number(values_23.Values)
num_3 = Number(values_24.Values)
num_4 = Number(values_21.Values)
num_5 = Number(values_25.Values)
num_6 = Number(values_26.Values)
recompute_2 = RemoteReceiver(recompute)
panel_22 = Panel("""False
True""")
entwine_6 = Entwine(Branch00=label_9, Branch01=textbox_6, FlattenInputs=True)  # -> flatten(Result)
null = NullItem(Item=num)  # -> NullFlags, InvalidFlags, Description
null_2 = NullItem(Item=num_2)  # -> NullFlags, InvalidFlags, Description
null_3 = NullItem(Item=num_3)  # -> NullFlags, InvalidFlags, Description
null_4 = NullItem(Item=num_4)  # -> NullFlags, InvalidFlags, Description
null_5 = NullItem(Item=num_5)  # -> NullFlags, InvalidFlags, Description
null_6 = NullItem(Item=num_6)  # -> NullFlags, InvalidFlags, Description
entwine_7 = Entwine(Branch00=label_6, Branch01=textbox, FlattenInputs=True)  # -> flatten(Result)
entwine_8 = Entwine(Branch00=label_7, Branch01=textbox_2, FlattenInputs=True)  # -> flatten(Result)
entwine_9 = Entwine(Branch00=label_10, Branch01=textbox_5, FlattenInputs=True)  # -> flatten(Result)
entwine_10 = Entwine(Branch00=label_8, Branch01=textbox_4, FlattenInputs=True)  # -> flatten(Result)
filter = StreamFilter(Gate=null_2.NullFlags, Stream0=num_2, Stream1="0")
filter_2 = StreamFilter(Gate=null_3.NullFlags, Stream0=num_3, Stream1="0")
filter_3 = StreamFilter(Gate=null.NullFlags, Stream0=num, Stream1="0")
filter_4 = StreamFilter(Gate=null_4.NullFlags, Stream0=num_4, Stream1="0")
filter_5 = StreamFilter(Gate=null_6.NullFlags, Stream0=num_6, Stream1="0")
filter_6 = StreamFilter(Gate=null_5.NullFlags, Stream0=num_5, Stream1="0")
stack_6 = CreateStack(UIElements=entwine_6, Horizontal=True)
create_material_a4_kg = RemoteSender(filter_2)
create_material_a5_1_kg = RemoteSender(filter)
create_material_a1_a3_kg = RemoteSender(filter_3)
create_window_conversion_value = RemoteSender(filter_4)
adjustelem_9 = AdjustElementAppearance(
    ElementsToAdjust=true_button_8,
    Foreground=ColourSwatch(SwatchColor=RGB(0, 0, 0)),
    Background=ColourSwatch(SwatchColor=RGB(230, 230, 230)),
    FontSize=Slider(12, range=0..300))
create_window_a4_kg = RemoteSender(filter_5)
create_window_a1_a3_kg = RemoteSender(filter_6)
number_slider_10 = Slider(29, range=0..300)

# ----
# A4
stack_7 = CreateStack(UIElements=entwine_10, Horizontal=True)
a4 = Data(stack_7)

number_slider_11 = Slider(35, range=25..50)

# ----
# A1-A3
stack_8 = CreateStack(UIElements=entwine_9, Horizontal=True)
data = Data(stack_8)  # "A1-A3"

# ----
# A4
stack_9 = CreateStack(UIElements=entwine_7, Horizontal=True)
a4_2 = Data(stack_9)

# ----
# A5.1
stack_10 = CreateStack(UIElements=entwine_8, Horizontal=True)
data_2 = Data(stack_10)

adjustpos_16 = AdjustElementPositioning(
    ElementsToAdjust=true_button_8,
    Margin="5, -5, 0, 0",
    AbsolutePositioning=False,
    Width=number_slider_10,
    Height=number_slider_10)
heath_accent_color_6 = RemoteReceiver(heath_accent_color)
heath_accent_color_7 = RemoteReceiver(heath_accent_color)
heath_accent_color_8 = RemoteReceiver(heath_accent_color)
swatch = ColourSwatch(SwatchColor=RGB(136, 86, 33))  # disabled
number_slider_12 = Slider(31, range=1..31)  # disabled
number_slider_13 = Slider(10, range=0..23)  # disabled
number_slider_14 = Slider(1, range=1..12)  # disabled
number_slider_15 = Slider(12, range=1..12)  # disabled
number_slider_16 = Slider(8, range=0..23)  # disabled
number_slider_17 = Slider(1, range=1..31)  # disabled
panel_23 = Panel("Daylight metrics")  # disabled
panel_24 = Panel("Useful daylight illuminance")  # disabled
panel_25 = Panel("Daylight autonomy")  # disabled
panel_26 = Panel("Daylight factor")  # disabled
panel_27 = Panel("Culmulative radiation")  # disabled
number_slider_18 = Slider(100, range=0..10000)  # disabled
do = DirectOnly(Samples=number_slider_18, version="1.2.0.60000")  # disabled
panel_28 = Panel("Daylight factor")  # disabled
panel_29 = Panel("Sunlight hour analysis")  # disabled
panel_30 = Panel("Daylight autonomy")  # disabled
panel_31 = Panel("Daylight metrics")  # disabled
panel_32 = Panel("Useful daylight illuminance")  # disabled
panel_33 = Panel("Sky component analysis")  # disabled
tab_simulate_12 = RemoteReceiver(tab_simulate)
panel_34 = Panel("100")  # disabled
panel_35 = Panel("100")  # disabled
panel_36 = Panel("100")  # disabled
panel_37 = Panel("100")  # disabled
analysisperiod = LBAnalysisPeriod(
    start_month=Slider(1, range=1..12),
    start_day=Slider(1, range=1..31),
    start_hour=Slider(0, range=0..23),
    end_month=Slider(12, range=1..12),
    end_day=Slider(31, range=1..31),
    end_hour=Slider(23, range=0..23))  # -> period, hoys, dates; plug-in component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
panel_38 = Panel("1")  # disabled
panel_39 = Panel("1")  # disabled
panel_40 = Panel("True")  # disabled
panel_41 = Panel("True")  # disabled
panel_42 = Panel("True")  # disabled

roomenergyattr_2 = HBRoomEnergyAttributes({"Program": "properties.energy.program_type.display_name", "Construction Set": "properties.energy.construction_set.display_name", "Is Conditioned": "properties.energy.is_conditioned", "People per Area [ppl/m2]": "properties.energy.people.people_per_area", "Area per Person [m2/ppl]": "properties.energy.people.area_per_person", "Lighting per Area [W/m2]": "properties.energy.lighting.watts_per_area"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}, selected="Program")
roomattr_2 = HBRoomAttributes({"Display Name": "display_name", "Simulation Name (Identifier)": "identifier", "Multiplier": "multiplier", "Floor Area Excluded": "exclude_floor_area", "Story": "story", "Volume": "volume", "Gross Floor Area": "floor_area", "Exposed Area": "exposed_area", "Exterior Wall Area": "exterior_wall_area", "Exterior Aperture Area": "exterior_aperture_area", "Average Floor Elevation": "average_floor_height"}, selected="Exterior Aperture Area")

faceenergyattr_2 = HBFaceEnergyAttributes({"Construction": "properties.energy.construction.display_name", "Materials": "properties.energy.construction.layers", "Thickness [m]": "properties.energy.construction.thickness", "Density [kg/m2]": "properties.energy.construction.mass_area_density", "Heat Capacity [J/K-m2]": "properties.energy.construction.area_heat_capacity", "Construction R-Value [m2-K/W]": "properties.energy.construction.r_value", "Construction U-Value [W/m2-K]": "properties.energy.construction.u_value", "Construction U-Factor [W/m2-K]": "properties.energy.construction.u_factor", "Construction SHGC [Unshaded]": "properties.energy.construction.shgc", "R-Factor [m2-K/W]": "properties.energy.r_factor", "U-Factor [W/m2-K]": "properties.energy.u_factor", "SHGC [Unshaded]": "properties.energy.shgc", "Solar Transmitance [Unshaded]": "properties.energy.construction.solar_transmittance", "Visible Transmitance [Unshaded]": "properties.energy.construction.visible_transmittance", "Solar Reflectance [Outside]": "properties.energy.construction.outside_solar_reflectance", "Solar Reflectance [Inside]": "properties.energy.construction.inside_solar_reflectance", "Fraction Area Operable": "properties.energy.vent_opening.fraction_area_operable", "Fraction Height Operable": "properties.energy.vent_opening.fraction_height_operable", "Discharge Coefficient": "properties.energy.vent_opening.discharge_coefficient"}, selected="Construction SHGC [Unshaded]")
faceattr_2 = HBFaceAttributes({"Display Name": "display_name", "Simulation Name (Identifier)": "identifier", "Boundary Condition": "boundary_condition", "Has Parent": "has_parent", "Parent": "parent", "Azimuth": "azimuth", "Altitude": "altitude", "Area": "area", "Perimeter": "perimeter", "Face Type": "type", "Aperture Is Operable": "is_operable", "Door Is Glass": "is_glass"}, selected="Face Type")

toggle_2 = BooleanToggle(True)  # disabled
button_10 = Button()  # disabled
swatch_2 = ColourSwatch(SwatchColor=RGB(84, 84, 84))
number_slider_19 = Slider(2, range=0..10)  # disabled
number_slider_20 = Slider(0.6, range=0..10)  # disabled
pre_calculate_lca_2 = RemoteReceiver(pre_calculate_lca)

# ----
# Get Klimatdatabas data
list = ValueList({"Swedish": "sv", "English": "en"}, selected="English")
list_2 = ValueList({"File": "file", "API": "api"}, selected="API")
get_categories = BrimstoneGetCategories(mode=list_2, language=list)  # -> out, json_data, categories, klimatdatabas_version
# ---------- get_categories: Python ----------
"""Gets Klimatdatabas from the Boverket API or a file, extracts json data, and resource category names
    Inputs:
        mode: api or file mode
        language: language of database to retrieve
        json_path: path to json file if file mode
    Output:
        json_data: json file as dictionary
        categories: Categories present in the database
        klimatdatabas_version: String representing the version of Klimatdatabas used"""

import scriptcontext
import brimstone
import Grasshopper
import os, io

ghenv.Component.Name = 'Brimstone - Get Categories'
ghenv.Component.NickName = 'Get Categories'
ver = brimstone.globals.version
ghenv.Component.Message = ver

import json

from System.Net import WebRequest
from System.IO import StreamReader
from System.Text import Encoding

def main(mode):    
    if mode == "file":
        json_file = brimstone.globals.kdb_json_path
        json_path = os.path.join(Grasshopper.Folders.UserObjectFolders[0], json_file)
        if not os.path.exists(json_path):
            raise Exception("Failed to open json file, it should reside in [UserComponents folder]/brimstone_data/")
        json_data = get_json_data_from_file(json_path)
    elif mode == "api":
        json_data = get_json_data_from_api()
    else:
        raise Exception("Mode {mode} not supported".format(mode = mode))
    
    categories = get_categories(json_data)
    version = json_data.get("Version") 
    
    return categories, json_data, version

def get_json_data_from_file(json_path):
    f = io.open(json_path, encoding='utf-8')
    json_data = json.load(f)
    return json_data
    
def get_json_data_from_api():
    version = "02.04.000"
    lng = language if language else "en"
    format = "json"

    url = "https://api.boverket.se/klimatdatabas/api/Klimat/v2/GetAllResources/{version}/{language}/{format}".format(
        version=version, language=lng, format=format)
    
    request = WebRequest.Create(url)
    
    request.Method = "GET"
    request.Timeout = 5000
    #request.ContentType = "application/json"
    response = request.GetResponse()
    
    stream_reader = StreamReader(response.GetResponseStream())
    json_data = json.loads(stream_reader.ReadToEnd())
    return json_data
    
def get_categories(json_data):
    categories = []
    try:
        for metaCategory in json_data['Categories']:
            for cat in metaCategory["Children"]:
                categories.append(cat["Title"])
    except KeyError:
        raise Exception("Format of JSON data is not supported.")
    return categories

if __name__ == "__main__":
    if not scriptcontext.sticky["brimstone_flying"]:
        raise Exception("The 'Brimstone - Fly' component needs to exist on the canvas")
    categories, json_data, klimatdatabas_version = main(mode)
    json_data = [json_data] # need to put it in an array so GH understands it as a dictionary
# ---------- end get_categories ----------
list_3 = ItemSelector(
    get_categories.categories,
    {"Mineral materials", "Windows, doors and glass", "Paints and sealants", "Concrete", "Insulation", "Steel and other metals", "Blocks and tiles", "Building boards", "Waterproofing", "Solid woods", "Energy and fuel"}, selected="Mineral materials")
panel_43 = Panel(get_categories.klimatdatabas_version)

current_selected_model_analysis_module_n_6 = RemoteReceiver(current_selected_model_analysis_module_n)  # "current_selected_model_analysis_module_name"
objbynn_2 = GetObjectByNickname(NickName="AnnualDaylight")

# ---- group: Analyse performance
pt_4 = ConstructPoint(XCoordinate=Slider(80, range=0..100), YCoordinate=Slider(10, range=0..100), ZCoordinate=0)
simple_energy_simulation_base_point = RemoteSender(pt_4)

# ----
colrange = LBColorRange(index=Slider(9, range=0..100))  # -> colors; plug-in component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
tab_simulate_13 = RemoteReceiver(tab_simulate)
button_11 = Button()
tab_simulate_14 = RemoteReceiver(tab_simulate)
tab_simulate_15 = RemoteReceiver(tab_simulate)

current_selected_model_analysis_module_n_7 = RemoteReceiver(current_selected_model_analysis_module_n)  # "current_selected_model_analysis_module_name"
pre_calculate_lca_3 = RemoteReceiver(pre_calculate_lca)

# ----
# Database constructions
panel_44 = Panel("Generic")

# ----
# Geometry module interface
# Attribute modification
# Preview geometry
# Geometry visibility settings
panel_45 = Panel("Sky component analysis")
tab_simulate_16 = RemoteReceiver(tab_simulate)
constructiontype = RemoteReceiver()
heath_geometry_type_key = RemoteSender("Heath geometry type")
heath_geometry_type_key_2 = RemoteReceiver(heath_geometry_type_key)
heath_geometry_type_key_3 = RemoteReceiver(heath_geometry_type_key)
heath_geometry_type_key_4 = RemoteReceiver(heath_geometry_type_key)
heath_geometry_type_key_5 = RemoteReceiver(heath_geometry_type_key)
heath_geometry_type_key_6 = RemoteReceiver(heath_geometry_type_key)
saveconstruction = RemoteReceiver()
panel_46 = Panel("1")  # disabled

# ----
# Database windows
generic_u_value = Data(1.687787378)
generic_shgc = Data(0.4240807069)

# ----
# Database materials
panel_47 = Panel("{0} (conductivity: {1}, density: {2}, specific heat: {3})")

# ----
# EUI pop-up window
panel_48 = Panel("Update")
button_12 = CreateButton(ButtonName=panel_48, ButtonStyle=0)
adjustpos_17 = AdjustElementPositioning(ElementsToAdjust=button_12, AbsolutePositioning=False, Height=Slider(30, range=0..100), HorizontalAlignment=1)
categories = Panel("""Cooling
Heating
Lightning
Electrical equipment
Domestic hot water""")
checklist = CreateChecklist(Selected=invert(False))
values_27 = ValueListener(Elements=button_12, SomeProperty=True)  # -> Values, Indices
event_4 = EventGate(Data=values_27.Values)  # -> Data, IsNew
simple_energy_simulation_compare_pop_up_2 = RemoteReceiver(simple_energy_simulation_compare_pop_up)
rev = ReverseList(List=categories)
simple_energy_simulation_compare_pop_up_3 = RemoteReceiver(simple_energy_simulation_compare_pop_up)
adjustpos_18 = AdjustElementPositioning(ElementsToAdjust=checklist, Margin="0, 40, -5, 0", AbsolutePositioning=False, Width=Slider(215, range=0..1000))
panel_49 = Panel("""80, 140, 220
245, 75, 65
254, 244, 1
255, 121, 0
166, 249, 86""")
rec_3 = DataRecorder(simple_energy_simulation_compare_pop_up_2, DataLimit=-2, RecordData=True)
txt_2 = Text(panel_49)
values_28 = ValueListener(Elements=checklist, SomeProperty=True)  # -> Values, Indices
ma_3 = MassAddition(Input=rec_3)  # -> Result, PartialResults
pt_5 = Point(txt_2)
and_2 = GateAnd(A=simple_energy_simulation_compare_pop_up_3, B=event_4.Data)
division_2 = Division(A=pt_5, B="255")
py3_4 = Python3Script(get=and_2)  # -> mpl_folder
# ---------- py3_4: Python ----------
"""Grasshopper Script"""
import heath

if __name__ == "__main__":
    if get:
        print(ghdoc)
        mpl_folder = heath.get_results_folder(ghdoc)
# ---------- end py3_4 ----------
len = TextLength(Text=division_2)
subtraction_4 = Subtraction(A=len, B="2")
nextfile = NextAvailableFilename(Format="EUI{000}.png", FolderPath=py3_4, Trigger=and_2)
fragment = TextFragment(Text=division_2, Start="1", Count=subtraction_4)
database_modal_location_2 = RemoteReceiver(database_modal_location)
pdecon = Deconstruct(Point=database_modal_location_2)  # -> XComponent, YComponent, ZComponent
subtraction_5 = Subtraction(A=pdecon.XComponent, B=Slider(0, range=0..100))
heath_accent_color_9 = RemoteReceiver(heath_accent_color)
simple_energy_simulation_compare_pop_up_4 = RemoteReceiver(simple_energy_simulation_compare_pop_up)
pt_6 = ConstructPoint(XCoordinate=subtraction_5, YCoordinate=pdecon.YComponent, ZCoordinate=0)

# ----
# LCA pop-up window
panel_50 = Panel("Update")
button_13 = CreateButton(ButtonName=panel_50, ButtonStyle=0)
values_29 = ValueListener(Elements=button_13, SomeProperty=True)  # -> Values, Indices
adjustpos_19 = AdjustElementPositioning(ElementsToAdjust=button_13, AbsolutePositioning=False, Height=Slider(30, range=0..100), HorizontalAlignment=1)
event_5 = EventGate(Data=values_29.Values)  # -> Data, IsNew
checklist_2 = CreateChecklist(Selected=invert(False))
panel_51 = Panel("""166, 249, 86
255, 121, 0
254, 244, 1
80, 140, 220
97, 209, 246
255, 58, 49""")
values_30 = ValueListener(Elements=checklist_2, SomeProperty=True)  # -> Values, Indices
txt_3 = Text(panel_51)
pt_7 = Point(txt_3)
division_3 = Division(A=pt_7, B="255")
len_2 = TextLength(Text=division_3)
subtraction_6 = Subtraction(A=len_2, B="2")
format_13 = Format(Format="{0}, {1}, {2}, {3}", Culture=127, Data1=Slider(20, range=0..100), Data2=Slider(-5, range=-10..10))
fragment_2 = TextFragment(Text=division_3, Start="1", Count=subtraction_6)
adjustpos_20 = AdjustElementPositioning(ElementsToAdjust=checklist_2, Margin=format_13, AbsolutePositioning=False, Width=Slider(215, range=0..1000))
database_modal_location_3 = RemoteReceiver(database_modal_location)
pdecon_2 = Deconstruct(Point=database_modal_location_3)  # -> XComponent, YComponent, ZComponent
subtraction_7 = Subtraction(A=pdecon_2.XComponent, B=Slider(0, range=0..100))
heath_accent_color_10 = RemoteReceiver(heath_accent_color)
pt_8 = ConstructPoint(XCoordinate=subtraction_7, YCoordinate=pdecon_2.YComponent, ZCoordinate=0)

entwine_11 = Entwine(Branch00=toggle, Branch01=button_13, FlattenInputs=True)  # -> flatten(Result)
filter_7 = StreamFilter(Gate=bool_3, Stream0="GWP (kg CO2eq)", Stream1="GWP (kg CO2eq/m2)")
filter_8 = StreamFilter(Gate=bool_3, Stream0="GWP by model (kg CO2eq)", Stream1="GWP by model (kg CO2eq/m2)")
stack_11 = CreateStack(UIElements=entwine_11, Horizontal=True)
adjustpos_21 = AdjustElementPositioning(ElementsToAdjust=stack_11, AbsolutePositioning=False, HorizontalAlignment=1)

# ----
# Recursion
panel_52 = Panel("LCA window status")
objbynn_3 = GetObjectByNickname(NickName=panel_52)
lca_window_status = Python3Script()  # -> status
# ---------- lca_window_status: Python ----------
status = False
# ---------- end lca_window_status ----------

# ----
# Recursion
panel_53 = Panel("LCA window status")
objbynn_4 = GetObjectByNickname(NickName=panel_53)
lca_window_status_2 = Python3Script()  # -> status; same code as lca_window_status

# ----
# Recursion
panel_54 = Panel("SDA window status")
objbynn_5 = GetObjectByNickname(NickName=panel_54)
sda_window_status = Python3Script()  # -> status; same code as lca_window_status

# ----
# Spatial daylight autonomy pop-up window
panel_55 = Panel("Update")
button_14 = CreateButton(ButtonName=panel_55, ButtonStyle=0)
values_31 = ValueListener(Elements=button_14, SomeProperty=True)  # -> Values, Indices
adjustpos_22 = AdjustElementPositioning(ElementsToAdjust=button_14, AbsolutePositioning=False, Height=Slider(30, range=0..100), HorizontalAlignment=1)
event_6 = EventGate(Data=values_31.Values)  # -> Data, IsNew
panel_56 = Panel(values_31.Values)
checklist_3 = CreateChecklist(Selected=invert(False))
colrange_2 = LBColorRange(index=Slider(3, range=0..100))  # -> colors; plug-in component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
shuffle = Python3Script(x=colrange_2)  # -> x; inputs x: list of Color
# ---------- shuffle: Python ----------
import random

random.shuffle(x)
# ---------- end shuffle ----------
txt_4 = Text(shuffle)
pt_9 = Point(txt_4)
values_32 = ValueListener(Elements=checklist_3, SomeProperty=True)  # -> Values, Indices
division_4 = Division(A=pt_9, B="255")
len_3 = TextLength(Text=division_4)
panel_57 = Panel("Spatial daylight autonomy (%)")
subtraction_8 = Subtraction(A=len_3, B=Slider(2, range=0..10))
fragment_3 = TextFragment(Text=division_4, Start="1", Count=subtraction_8)
database_modal_location_4 = RemoteReceiver(database_modal_location)
pdecon_3 = Deconstruct(Point=database_modal_location_4)  # -> XComponent, YComponent, ZComponent
subtraction_9 = Subtraction(A=pdecon_3.XComponent, B=Slider(0, range=0..100))
heath_accent_color_11 = RemoteReceiver(heath_accent_color)
adjustpos_23 = AdjustElementPositioning(ElementsToAdjust=checklist_3, Margin="0, 40, -5, 0", AbsolutePositioning=False, Width=Slider(215, range=0..1000))
pt_10 = ConstructPoint(XCoordinate=subtraction_9, YCoordinate=pdecon_3.YComponent, ZCoordinate=0)

panel_58 = Panel("""This tab carries out simulations and allows visualising results
1. Select model for analysis using the dropdown
2. Perform energy analysis
3. Perform daylight analysis
4. Perform life cycle assessment""")
true_button_9 = CreateTrueOnlyButton(ButtonName="?", ButtonStyle=2)
values_33 = ValueListener(Elements=true_button_9, SomeProperty=True)  # -> Values, Indices
rec_4 = DataRecorder(values_33.Values, DataLimit=-10, RecordData=True)
ma_4 = MassAddition(Input=rec_4)  # -> Result, PartialResults
tb_14 = CreateTextBlock(Text=panel_58, TextSize=12, Justification=0)
mod_2 = Modulus(A=ma_4.Result, B=2)
col_3 = Colour(RGB(103, 191, 235))
adjustelem_10 = AdjustElementAppearance(ElementsToAdjust=tb_14, Foreground=col_3)
hideshow_3 = HideShowElement(ElementToHideShow=tb_14, Show=mod_2, Collapse=True, Disable=False)
label_11 = CreateLabel(LabelText="Simulate!", LabelSize=18, Justification=0)
entwine_12 = Entwine(Branch00=label_11, Branch01=true_button_9, FlattenInputs=True)  # -> flatten(Result)
stack_12 = CreateStack(UIElements=entwine_12, Horizontal=True)

entwine_13 = Entwine(Branch00=stack_12, Branch01=tb_9, Branch02=tb_14, Branch03=pulldown_2, FlattenInputs=True)  # -> flatten(Result)

# ----
# Select model
select_model = Data(entwine_13)

select_model_2 = Data(select_model)

panel_59 = Panel("""Carry out an annual irradiance study. (Note that the analysis geometry is separate from the selected analysis model).
1. Select target geometry in the Rhino viewport, and click "Select target geometry"
2. Optionally, select shading geometry in the Rhino viewport, and click "Select shading geometry"
3. Click the checkbox to activate irradiance study
4. Zoom and bake the output as needed.""")
true_button_10 = CreateTrueOnlyButton(ButtonName="?", ButtonStyle=2)
values_34 = ValueListener(Elements=true_button_10, SomeProperty=True)  # -> Values, Indices
rec_5 = DataRecorder(values_34.Values, DataLimit=-10, RecordData=True)
ma_5 = MassAddition(Input=rec_5)  # -> Result, PartialResults
tb_15 = CreateTextBlock(Text=panel_59, TextSize=12, Justification=0)
mod_3 = Modulus(A=ma_5.Result, B=2)
col_4 = Colour(RGB(103, 191, 235))
adjustelem_11 = AdjustElementAppearance(ElementsToAdjust=tb_15, Foreground=col_4)
hideshow_4 = HideShowElement(ElementToHideShow=tb_15, Show=mod_3, Collapse=True, Disable=False)
label_12 = CreateLabel(LabelText="Context analysis", LabelSize=18, Justification=0)
entwine_14 = Entwine(Branch00=label_12, Branch01=true_button_10, FlattenInputs=True)  # -> flatten(Result)
stack_13 = CreateStack(UIElements=entwine_14, Horizontal=True)

panel_60 = Panel("""1. Make sure a model is selected in the dropdown above
2. Click "calculate GWP" (global warming potential) to calculate GHG (greenhouse gas) emissions
3. If multiple models have been simulated, the compare simulations option is available
- Use the "visualise GWP by model" to show an overview of all simulations
Further information about LCA is available here: https://www.github.com/sawenchalmers/brimstone""")
true_button_11 = CreateTrueOnlyButton(ButtonName="?", ButtonStyle=2)
values_35 = ValueListener(Elements=true_button_11, SomeProperty=True)  # -> Values, Indices
rec_6 = DataRecorder(values_35.Values, DataLimit=-10, RecordData=True)
ma_6 = MassAddition(Input=rec_6)  # -> Result, PartialResults
tb_16 = CreateTextBlock(Text=panel_60, TextSize=12, Justification=0)
mod_4 = Modulus(A=ma_6.Result, B=2)
col_5 = Colour(RGB(103, 191, 235))
adjustelem_12 = AdjustElementAppearance(ElementsToAdjust=tb_16, Foreground=col_5)
hideshow_5 = HideShowElement(ElementToHideShow=tb_16, Show=mod_4, Collapse=True, Disable=False)
label_13 = CreateLabel(LabelText="Life cycle assessment", LabelSize=18, Justification=0)
entwine_15 = Entwine(Branch00=label_13, Branch01=true_button_11, FlattenInputs=True)  # -> flatten(Result)
stack_14 = CreateStack(UIElements=entwine_15, Horizontal=True)

panel_61 = Panel("""1. Make sure a model is selected in the dropdown above
2. Click "run energy simulation" to calculate annual energy consumption
3. "Total load EUI" represents the annual energy use per square metre
4. Set the display type in the Rhino viewport using the dropdown menu
5. If multiple models have been simulated, the compare simulations option is available
- Use the "compare simulations bar chart" to show an overview of all simulations
- Two simulation results can be shown in the Rhino viewport using the "compare with" dropdown
Details about the energy simulation are available here: https://www.ladybug.tools/honeybee.html#energyBal """)
true_button_12 = CreateTrueOnlyButton(ButtonName="?", ButtonStyle=2)
values_36 = ValueListener(Elements=true_button_12, SomeProperty=True)  # -> Values, Indices
rec_7 = DataRecorder(values_36.Values, DataLimit=-10, RecordData=True)
ma_7 = MassAddition(Input=rec_7)  # -> Result, PartialResults
tb_17 = CreateTextBlock(Text=panel_61, TextSize=12, Justification=0)
mod_5 = Modulus(A=ma_7.Result, B=2)
col_6 = Colour(RGB(103, 191, 235))
adjustelem_13 = AdjustElementAppearance(ElementsToAdjust=tb_17, Foreground=col_6)
hideshow_6 = HideShowElement(ElementToHideShow=tb_17, Show=mod_5, Collapse=True, Disable=False)
label_14 = CreateLabel(LabelText="Energy simulation", LabelSize=18, Justification=0)
entwine_16 = Entwine(Branch00=label_14, Branch01=true_button_12, FlattenInputs=True)  # -> flatten(Result)
stack_15 = CreateStack(UIElements=entwine_16, Horizontal=True)

panel_62 = Panel("""This panel sets the construction and materials for the model
1. Set a base construction set based on the local climate and type of construction
2. For each subset of the construction, use the generic construction set by the base set or select another construction
3. To add constructions, click the hammer and wrench icon
- In the pop-up dialog, create windows using the "create window" button
- In the pop-up window, create constructions using the "create construction" button by selecting materials and layer thicknesses
- Create new materials using the hammer and wrench button""")
panel_63 = Panel("Create new model")
true_button_13 = CreateTrueOnlyButton(ButtonName="?", ButtonStyle=2)
values_37 = ValueListener(Elements=true_button_13, SomeProperty=True)  # -> Values, Indices
rec_8 = DataRecorder(values_37.Values, DataLimit=-10, RecordData=True)
ma_8 = MassAddition(Input=rec_8)  # -> Result, PartialResults
col_7 = Colour(RGB(103, 191, 235))
tb_18 = CreateTextBlock(Text=panel_62, TextSize=12, Justification=0)
mod_6 = Modulus(A=ma_8.Result, B=2)
adjustelem_14 = AdjustElementAppearance(ElementsToAdjust=tb_18, Foreground=col_7)
hideshow_7 = HideShowElement(ElementToHideShow=tb_18, Show=mod_6, Collapse=True, Disable=False)
label_15 = CreateLabel(LabelText="Select base construction", LabelSize=18, Justification=0)
entwine_17 = Entwine(Branch00=label_15, Branch01=true_button_13, FlattenInputs=True)  # -> flatten(Result)
stack_16 = CreateStack(UIElements=entwine_17, Horizontal=True)

entwine_18 = Entwine(Branch00=ma_3.Result, Branch01=lca_window_status_2, FlattenInputs=True)
rec_9 = DataRecorder(entwine_18, DataLimit=2, RecordData=True)
item_2 = ListItem(List=rec_9, Index=0, Wrap=True)  # -> Item2, Item1, Item
equals_5 = Equality(FirstNumber=item_2.Item2, SecondNumber=item_2.Item1)  # -> Equality, Inequality
bang = ExplodeTree(Data=equals_5.Inequality)  # -> Branch0, Branch1
py3_5 = Python3Script(x=bang.Branch0, y=bang.Branch1)  # -> a
# ---------- py3_5: Python ----------
if x:
    a = True
elif y:
    a = False
else:
    a = False
# ---------- end py3_5 ----------
event_7 = EventGate(Data=py3_5)  # -> Data, IsNew
freeze_gate_5 = StreamFreezeGate(Data=py3_5, PassingSwitch=event_7.IsNew)
event_8 = EventGate(Data=freeze_gate_5)  # -> Data, IsNew
panel_64 = Panel(event_8.Data)
launchwin = LaunchWindow(
    Show=event_8.Data,
    Name="EUI visualisations",
    Width=bar_chart_popup_win_width_3,
    Height=bar_chart_popup_win_height_3,
    ChildStatus=1,
    EnableHorizScroll=False)
winprops = SetWindowProperties(
    Window=launchwin,
    StartingLocation=pt_6,
    Theme=0,
    AccentColor=heath_accent_color_9,
    ShowTitleBar=True,
    BackgroundColor=RGB(255, 255, 255),
    ScaleFactor=1)
winstat = WindowStatus(Window=launchwin)
eui_status = RemoteSender(winstat)
py3_6 = Python3Script(window=launchwin, activate=simple_energy_simulation_compare_pop_up_4)
# ---------- py3_6: Python ----------
import System

if activate and (str(window.WindowState) == "Minimized"):
    window.set_WindowState(System.Windows.WindowState(0))
# ---------- end py3_6 ----------

eui_status_2 = RemoteReceiver(eui_status)
expression = Expression(x="Hidden", y=eui_status_2, Expression="x=y")
expire = ExpireObject(ObjectToExpire=objbynn_4, Expire=expression)

button_15 = CreateButton(ButtonName="Run irradiance study", ButtonStyle=0)  # disabled
pulldown_3 = CreatePulldownMenu(ListItems="Incident radiation", SelectedIndex="0", showLabel=False)
button_16 = CreateButton(ButtonName="Zoom", ButtonStyle=0)
button_17 = CreateButton(ButtonName="Bake", ButtonStyle=0)
values_38 = ValueListener(Elements=button_15, SomeProperty=True)  # -> Values, Indices
values_39 = ValueListener(Elements=pulldown_3, SomeProperty=True)  # -> Values, Indices
freeze_gate_6 = StreamFreezeGate(Data=values_38.Values, PassingSwitch=invert(values_38.Values))
values_40 = ValueListener(Elements=button_16, SomeProperty=True)  # -> Values, Indices
values_41 = ValueListener(Elements=button_17, SomeProperty=True)  # -> Values, Indices
pre_run_context_analysis = RemoteSender(values_38.Values)
bool_6 = Boolean(invert(freeze_gate_6))
context_analysis_type = RemoteSender(values_39.Indices)
freeze_gate_7 = StreamFreezeGate(Data=values_41.Values, PassingSwitch=invert(values_41.Values))
zoom_context_analysis = RemoteSender(values_40.Values)
tap_4 = TapBuffer(Reset=False, Incremental=True, Valve=bool_6, Hold=True)
tab_simulate_17 = RemoteReceiver(tab_simulate)
bool_7 = Boolean(invert(freeze_gate_7))
dam_5 = DataDam(DataA=tap_4, BufferDelay=2500000, BufferMode=2)
rec_10 = DataRecorder(bool_7, DataLimit=-10, RecordData=True)
equals_6 = Equality(FirstNumber=tap_4, SecondNumber=dam_5)  # -> Equality, Inequality
int_3 = Integer(rec_10)
ma_9 = MassAddition(Input=int_3)  # -> Result, PartialResults
event_9 = EventGate(Data=ma_9.Result)  # -> Data, IsNew
tab_simulate_18 = RemoteReceiver(tab_simulate)
dam_6 = DataDam(DataA=event_9.Data, BufferDelay=2500000, BufferMode=2)
equals_7 = Equality(FirstNumber=event_9.Data, SecondNumber=dam_6)  # -> Equality, Inequality
event_10 = EventGate(Data=equals_7.Inequality)  # -> Data, IsNew
adjustpos_24 = AdjustElementPositioning(ElementsToAdjust=pulldown_3, Margin="0, 0, 0, 0", AbsolutePositioning=False, Width=Slider(200, range=0..400))
hideshow_8 = HideShowElement(ElementToHideShow=[button_16, button_17], Show=True, Collapse=True, Disable=False)

checkbox_3 = CreateCheckbox(Label="Run irradiance study", StartingValue=False)
toggle_3 = CreateToggle(Default=False, Label="Run irradiance study")
values_42 = ValueListener(Elements=checkbox_3, SomeProperty=True)  # -> Values, Indices
zoom_context_analysis_2 = RemoteReceiver(zoom_context_analysis)
context_analysis_type_2 = RemoteReceiver(context_analysis_type)

panel_65 = Panel("""1. Use the checkboxes to visualise specific model elements in the Rhino viewport
2. Display model attributes related to program and construction
- Select the attribute to visualise in the dropdown menu
- Click "show" to visualise data""")
true_button_14 = CreateTrueOnlyButton(ButtonName="?", ButtonStyle=2)
values_43 = ValueListener(Elements=true_button_14, SomeProperty=True)  # -> Values, Indices
rec_11 = DataRecorder(values_43.Values, DataLimit=-10, RecordData=True)
ma_10 = MassAddition(Input=rec_11)  # -> Result, PartialResults
tb_19 = CreateTextBlock(Text=panel_65, TextSize=12, Justification=0)
mod_7 = Modulus(A=ma_10.Result, B=2)
col_8 = Colour(RGB(103, 191, 235))
adjustelem_15 = AdjustElementAppearance(ElementsToAdjust=tb_19, Foreground=col_8)
hideshow_9 = HideShowElement(ElementToHideShow=tb_19, Show=mod_7, Collapse=True, Disable=False)
label_16 = CreateLabel(LabelText="Display model components", LabelSize=18, Justification=0)
entwine_19 = Entwine(Branch00=label_16, Branch01=true_button_14, FlattenInputs=True)  # -> flatten(Result)
stack_17 = CreateStack(UIElements=entwine_19, Horizontal=True)

panel_66 = Panel("""Cyclops - this is an experimental feature providing quick daylight simulation
Instructions TBD""")
true_button_15 = CreateTrueOnlyButton(ButtonName="?", ButtonStyle=2)
values_44 = ValueListener(Elements=true_button_15, SomeProperty=True)  # -> Values, Indices
rec_12 = DataRecorder(values_44.Values, DataLimit=-10, RecordData=True)
ma_11 = MassAddition(Input=rec_12)  # -> Result, PartialResults
tb_20 = CreateTextBlock(Text=panel_66, TextSize=12, Justification=0)
mod_8 = Modulus(A=ma_11.Result, B=2)
col_9 = Colour(RGB(103, 191, 235))
adjustelem_16 = AdjustElementAppearance(ElementsToAdjust=tb_20, Foreground=col_9)
hideshow_10 = HideShowElement(ElementToHideShow=tb_20, Show=mod_8, Collapse=True, Disable=False)
label_17 = CreateLabel(LabelText="Cyclops - daylight simulation", LabelSize=18, Justification=0)
entwine_20 = Entwine(Branch00=label_17, Branch01=true_button_15, FlattenInputs=True)  # -> flatten(Result)
stack_18 = CreateStack(UIElements=entwine_20, Horizontal=True)

panel_67 = Panel("""This panel sets the program which represents the use of the building and affects the energy performance calculation
1. Select building type
- This represents the overarching building category
2. Select room type
- Choose the type of room that most closely represents the use of the spaces in the building
3. Optionally set indoor climate parameters
- Set point temperature is the temperature at which cooling/heating activates
- Occupancy is the average number of people per 100 square metres""")
true_button_16 = CreateTrueOnlyButton(ButtonName="?", ButtonStyle=2)
values_45 = ValueListener(Elements=true_button_16, SomeProperty=True)  # -> Values, Indices
rec_13 = DataRecorder(values_45.Values, DataLimit=-10, RecordData=True)
ma_12 = MassAddition(Input=rec_13)  # -> Result, PartialResults
col_10 = Colour(RGB(103, 191, 235))
tb_21 = CreateTextBlock(Text=panel_67, TextSize=12, Justification=0)
mod_9 = Modulus(A=ma_12.Result, B=2)
adjustelem_17 = AdjustElementAppearance(ElementsToAdjust=tb_21, Foreground=col_10)
hideshow_11 = HideShowElement(ElementToHideShow=tb_21, Show=mod_9, Collapse=True, Disable=False)
label_18 = CreateLabel(LabelText="Select building/room type", LabelSize=18, Justification=0)
entwine_21 = Entwine(Branch00=label_18, Branch01=true_button_16, FlattenInputs=True)  # -> flatten(Result)
stack_19 = CreateStack(UIElements=entwine_21, Horizontal=True)

panel_69 = Panel("""This panel sets the location using a weather file with climate data
1. Click the "Get weather file URL" button to open a webpage with a map of weather files
2. In the map, identify the location most representative of the current project
3. Click the location and copy the URL to the .zip file with climate data
4. In Heath, paste the URL in the "URL for weather file (.zip)" field""")
true_button_17 = CreateTrueOnlyButton(ButtonName="?", ButtonStyle=2)
values_46 = ValueListener(Elements=true_button_17, SomeProperty=True)  # -> Values, Indices
rec_14 = DataRecorder(values_46.Values, DataLimit=-10, RecordData=True)
ma_13 = MassAddition(Input=rec_14)  # -> Result, PartialResults
col_11 = Colour(RGB(103, 191, 235))
tb_22 = CreateTextBlock(Text=panel_69, TextSize=12, Justification=0)
mod_10 = Modulus(A=ma_13.Result, B=2)
adjustelem_18 = AdjustElementAppearance(ElementsToAdjust=tb_22, Foreground=col_11)
hideshow_12 = HideShowElement(ElementToHideShow=tb_22, Show=mod_10, Collapse=True, Disable=False)
label_19 = CreateLabel(LabelText="Location", LabelSize=18, Justification=0)
entwine_22 = Entwine(Branch00=label_19, Branch01=true_button_17, FlattenInputs=True)  # -> flatten(Result)
stack_20 = CreateStack(UIElements=entwine_22, Horizontal=True)

# ----
# SELECT LOCATION
panel_71 = Panel("https://energyplus-weather.s3.amazonaws.com/europe_wmo_region_6/SWE/SWE_Goteborg.Landvetter.025260_IWEC/SWE_Goteborg.Landvetter.025260_IWEC.zip")
label_20 = CreateLabel(LabelText="Currently selected location: ", LabelSize=12, Justification=0)
label_21 = CreateLabel(LabelText="Location", LabelSize=18, Justification=0)
label_22 = CreateLabel(LabelText="Change location using weather file", LabelSize=18, Justification=0)
textbox_7 = CreateTextBox(Label="URL for weather file (.zip)", DefaultText=panel_71, UpdateButton=Toggle(False), showLabel=True)
button_18 = CreateButton(ButtonName="Get weather file URL", ButtonStyle=0)
values_47 = ValueListener(Elements=button_18, SomeProperty=True)  # -> Values, Indices
panel_72 = Panel("https://energyplus-weather.s3.amazonaws.com/europe_wmo_region_6/SWE/SWE_Goteborg.Landvetter.025260_IWEC/SWE_Goteborg.Landvetter.025260_IWEC.zip")
values_48 = ValueListener(Elements=textbox_7, SomeProperty=True)  # -> Values, Indices
downloadepw = LBDownloadWeather(weather_URL=values_48.Values)  # -> epw_file, stat_file, ddy_file; plug-in component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
importloc = LBImportLocation(epw_file=downloadepw.epw_file)  # -> location; plug-in component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
decnstrloc = LBDeconstructLocation(location=importloc)  # -> name, latitude, longitude, time_zone, elevation; plug-in component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
getclimatedata = RemoteSender(values_47.Values)
null_7 = NullItem(Item=decnstrloc.name)  # -> NullFlags, InvalidFlags, Description
filter_9 = StreamFilter(Gate=null_7.NullFlags, Stream0=decnstrloc.name, Stream1="COULD NOT FIND LOCATION")
filter_10 = StreamFilter(Gate=null_7.NullFlags, Stream0=ColourSwatch(SwatchColor=RGB(0, 0, 0)), Stream1=ColourSwatch(SwatchColor=RGB(255, 0, 0)))
filter_11 = StreamFilter(Gate=null_7.NullFlags, Stream0=values_48.Values, Stream1=panel_72)
entwine_23 = Entwine(Branch00=button_18, Branch01=textbox_7, FlattenInputs=True)  # -> flatten(Result)
format_14 = Format(Format="Currently selected location: {0}", Culture=127, Data0=filter_9)
location_weather_url = RemoteSender(filter_11)
adjustpos_25 = AdjustElementPositioning(
    ElementsToAdjust=textbox_7,
    Margin="0, 5, 0, 0",
    AbsolutePositioning=False,
    Width=Slider(325, range=0..1000),
    HorizontalAlignment=0)
adjustpos_26 = AdjustElementPositioning(
    ElementsToAdjust=button_18,
    Margin="0, 10, 0, 5",
    AbsolutePositioning=False,
    Width=Slider(200, range=0..1000),
    HorizontalAlignment=1)
stack_21 = CreateStack(UIElements=entwine_23, Horizontal=invert(True))
adjustelem_19 = AdjustElementAppearance(ElementsToAdjust=label_20, Foreground=filter_10)
setlabel = SetLabelContents(LabelToModify=label_20, NewLabelContents=format_14)
entwine_24 = Entwine(Branch00=stack_20, Branch01=tb_22, Branch02=label_20, Branch03=label_22, Branch04=stack_21, FlattenInputs=True)  # -> flatten(Result)
adjustpos_27 = AdjustElementPositioning(ElementsToAdjust=label_20, Margin="0, 0, 0, 0", AbsolutePositioning=False, HorizontalAlignment=0)

location_weather_url_2 = RemoteReceiver(location_weather_url)
downloadepw_2 = LBDownloadWeather(weather_URL=location_weather_url_2)  # -> epw_file, stat_file, ddy_file; plug-in component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
importloc_2 = LBImportLocation(epw_file=downloadepw_2.epw_file)  # -> location; plug-in component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
decnstrloc_2 = LBDeconstructLocation(location=importloc_2)  # -> name, latitude, longitude, time_zone, elevation; plug-in component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
null_8 = NullItem(Item=decnstrloc_2.name)  # -> NullFlags, InvalidFlags, Description
filter_12 = StreamFilter(Gate=null_8.NullFlags, Stream0=decnstrloc_2.name, Stream1="COULD NOT FIND LOCATION")
filter_13 = StreamFilter(Gate=null_8.NullFlags, Stream0=ColourSwatch(SwatchColor=RGB(0, 0, 0)), Stream1=ColourSwatch(SwatchColor=RGB(255, 0, 0)))
format_15 = Format(Format="Currently selected location: {0}", Culture=127, Data0=filter_12)

# ----
# Location
location = Data(entwine_24)

adjustelem_20 = AdjustElementAppearance(ElementsToAdjust=label_2, Foreground=filter_13)
setlabel_2 = SetLabelContents(LabelToModify=label_2, NewLabelContents=format_15)

# ----
# Get climate data
# https://energyplus-weather.s3.amazonaws.com/europe_wmo_region_6/SWE/SWE_Goteborg.Landvetter.025260_IWEC/SWE_Goteborg.Landvetter.025260_IWEC.zip
getclimatedata_2 = RemoteReceiver(getclimatedata)
panel_73 = Panel(getclimatedata_2)
epwmap = LBEPWmap(epw_map=getclimatedata_2)  # -> report; plug-in component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

expander = CreateExpander(UIElements=location, Header="Set location", Open=invert(True))
location_weather_url_3 = RemoteReceiver(location_weather_url)

panel_74 = Panel("""This tab allows selecting a model and visualising the selected model
1. Select model
- Remove selected model using the button (this is irreversible)
- Rename model using text field and button
2. Inspect selected model
3. Inspect model environment
4. Quickly simulate daylight using Cyclops (experimental feature)""")
true_button_18 = CreateTrueOnlyButton(ButtonName="?", ButtonStyle=2)
values_49 = ValueListener(Elements=true_button_18, SomeProperty=True)  # -> Values, Indices
rec_15 = DataRecorder(values_49.Values, DataLimit=-10, RecordData=True)
ma_14 = MassAddition(Input=rec_15)  # -> Result, PartialResults
tb_23 = CreateTextBlock(Text=panel_74, TextSize=12, Justification=0)
col_12 = Colour(RGB(103, 191, 235))
mod_11 = Modulus(A=ma_14.Result, B=2)
adjustelem_21 = AdjustElementAppearance(ElementsToAdjust=tb_23, Foreground=col_12)
hideshow_13 = HideShowElement(ElementToHideShow=tb_23, Show=mod_11, Collapse=True, Disable=False)
label_23 = CreateLabel(LabelText="Model overview", LabelSize=18, Justification=0)
entwine_25 = Entwine(Branch00=label_23, Branch01=true_button_18, FlattenInputs=True)  # -> flatten(Result)
stack_22 = CreateStack(UIElements=entwine_25, Horizontal=True)

panel_75 = Panel("""1. Use the dropdown to select the environmental parameter to visualise
- Hemisphere visualisation shows the amount of solar radiation from each sector of the sky throughout the year
- Wind rose shows the prevalent wind direction and wind strength over the year
- Temperature line chart and 2D chart show the temperature over the year
2. Use the "zoom" button to identify the visualisation in the Rhino viewport
3. Bake the visualisation as Rhino geometry using the "bake" button""")
true_button_19 = CreateTrueOnlyButton(ButtonName="?", ButtonStyle=2)
values_50 = ValueListener(Elements=true_button_19, SomeProperty=True)  # -> Values, Indices
rec_16 = DataRecorder(values_50.Values, DataLimit=-10, RecordData=True)
ma_15 = MassAddition(Input=rec_16)  # -> Result, PartialResults
tb_24 = CreateTextBlock(Text=panel_75, TextSize=12, Justification=0)
mod_12 = Modulus(A=ma_15.Result, B=2)
col_13 = Colour(RGB(103, 191, 235))
adjustelem_22 = AdjustElementAppearance(ElementsToAdjust=tb_24, Foreground=col_13)
hideshow_14 = HideShowElement(ElementToHideShow=tb_24, Show=mod_12, Collapse=True, Disable=False)
label_24 = CreateLabel(LabelText="Select environment visualisation", LabelSize=18, Justification=0)
entwine_26 = Entwine(Branch00=label_24, Branch01=true_button_19, FlattenInputs=True)  # -> flatten(Result)
stack_23 = CreateStack(UIElements=entwine_26, Horizontal=True)

panel_76 = Panel("""1. Make sure a model is selected in the dropdown above
2. Click "run daylight simulation" to calculate daylight performance
3. "Spatial daylight autonomy" represents the portion of the simulated space which achieves acceptable daylight conditions 
4. Set the display type in the Rhino viewport using the dropdown menu
5. If multiple models have been simulated, the compare simulations option is available
- Use the "compare simulations bar chart" to show an overview of all simulations
- Two simulation results can be shown in the Rhino viewport using the "compare with" dropdown
Further information about daylight simulation is available here: https://www.ladybug.tools/honeybee.html#illuminance""")
true_button_20 = CreateTrueOnlyButton(ButtonName="?", ButtonStyle=2)
values_51 = ValueListener(Elements=true_button_20, SomeProperty=True)  # -> Values, Indices
rec_17 = DataRecorder(values_51.Values, DataLimit=-10, RecordData=True)
ma_16 = MassAddition(Input=rec_17)  # -> Result, PartialResults
tb_25 = CreateTextBlock(Text=panel_76, TextSize=12, Justification=0)
mod_13 = Modulus(A=ma_16.Result, B=2)
col_14 = Colour(RGB(103, 191, 235))
adjustelem_23 = AdjustElementAppearance(ElementsToAdjust=tb_25, Foreground=col_14)
hideshow_15 = HideShowElement(ElementToHideShow=tb_25, Show=mod_13, Collapse=True, Disable=False)
label_25 = CreateLabel(LabelText="Daylight simulation", LabelSize=18, Justification=0)
entwine_27 = Entwine(Branch00=label_25, Branch01=true_button_20, FlattenInputs=True)  # -> flatten(Result)
stack_24 = CreateStack(UIElements=entwine_27, Horizontal=True)

panel_77 = Panel("""Provide settings for the analysis
1. Set north vector for energt and daylight analysis by selecting a line in the Rhino window and pressing "Set north vector"
2. Set the grid size for daylight simulations""")
true_button_21 = CreateTrueOnlyButton(ButtonName="?", ButtonStyle=2)
values_52 = ValueListener(Elements=true_button_21, SomeProperty=True)  # -> Values, Indices
rec_18 = DataRecorder(values_52.Values, DataLimit=-10, RecordData=True)
ma_17 = MassAddition(Input=rec_18)  # -> Result, PartialResults
tb_26 = CreateTextBlock(Text=panel_77, TextSize=12, Justification=0)
mod_14 = Modulus(A=ma_17.Result, B=2)
col_15 = Colour(RGB(103, 191, 235))
adjustelem_24 = AdjustElementAppearance(ElementsToAdjust=tb_26, Foreground=col_15)
hideshow_16 = HideShowElement(ElementToHideShow=tb_26, Show=mod_14, Collapse=True, Disable=False)
label_26 = CreateLabel(LabelText="Analysis settings", LabelSize=18, Justification=0)
entwine_28 = Entwine(Branch00=label_26, Branch01=true_button_21, FlattenInputs=True)  # -> flatten(Result)
stack_25 = CreateStack(UIElements=entwine_28, Horizontal=True)

panel_78 = Panel("""This panel allows selecting the geometry to be included in the analysis model
1. Select geometry in Rhino viewport
2. Set the geometry type using the dropdown below
- Room: conditioned space (3D brep)
- Window: aperture in surface (2D surface)
- Adjacent: neighbouring building (2D surface)
- Context: shading geometry (2D/3D brep)
- None:  setting this geometry type removes object from model
3. Optionally generate windows using window-wall-ratio
- To activate, click the checkbox and dragging the slider
- This will override any manually created windows
4. Preview geometry
- To see the currently selected geometry of different types, click the appropriate coloured button
- The colour of the preview geometry represents the geometry type""")
true_button_22 = CreateTrueOnlyButton(ButtonName="?", ButtonStyle=2)
values_53 = ValueListener(Elements=true_button_22, SomeProperty=True)  # -> Values, Indices
rec_19 = DataRecorder(values_53.Values, DataLimit=-10, RecordData=True)
ma_18 = MassAddition(Input=rec_19)  # -> Result, PartialResults
col_16 = Colour(RGB(103, 191, 235))
tb_27 = CreateTextBlock(Text=panel_78, TextSize=12, Justification=0)
mod_15 = Modulus(A=ma_18.Result, B=2)
adjustelem_25 = AdjustElementAppearance(ElementsToAdjust=tb_27, Foreground=col_16)
hideshow_17 = HideShowElement(ElementToHideShow=tb_27, Show=mod_15, Collapse=True, Disable=False)
label_27 = CreateLabel(LabelText="Import geometry", LabelSize=18, Justification=0)
entwine_29 = Entwine(Branch00=label_27, Branch01=true_button_22, FlattenInputs=True)  # -> flatten(Result)
stack_26 = CreateStack(UIElements=entwine_29, Horizontal=True)

entwine_30 = Entwine(Branch00=checkbox_3, Branch01=button_16, Branch02=button_17, FlattenInputs=True)  # -> flatten(Result)
stack_27 = CreateStack(UIElements=entwine_30, Horizontal=True)
run_context_analysis = RemoteSender(values_42.Values)

entwine_31 = Entwine(Branch00=stack_2, Branch01=stack, Branch02=stack_27, FlattenInputs=True)  # -> flatten(Result)
stack_28 = CreateStack(UIElements=entwine_31, Horizontal=invert(True))
entwine_32 = Entwine(Branch00=stack_13, Branch01=tb_15, Branch02=stack_28, FlattenInputs=True)  # -> flatten(Result)
stack_29 = CreateStack(UIElements=entwine_32, Horizontal=invert(True))
expander_2 = CreateExpander(UIElements=stack_29, Header="Context analysis", Open=invert(True))
values_54 = ValueListener(Elements=expander_2, SomeProperty=True)  # -> Values, Indices
context_analysis_expander_is_open = RemoteSender(values_54.Values)
context_analysis_expander_is_open_2 = RemoteReceiver(context_analysis_expander_is_open)
context_analysis_expander_is_open_3 = RemoteReceiver(context_analysis_expander_is_open)
and_3 = GateAnd(A=values_2.Values, B=context_analysis_expander_is_open_3)
and_4 = GateAnd(A=values.Values, B=context_analysis_expander_is_open_2)
data_3 = Data(expander_2)
context_analysis_expander_is_open_4 = RemoteReceiver(context_analysis_expander_is_open)
run_context_analysis_2 = RemoteReceiver(run_context_analysis)
run_context_analysis_3 = RemoteReceiver(run_context_analysis)  # disabled
freeze_gate_8 = StreamFreezeGate(Data=run_context_analysis_3, PassingSwitch=run_context_analysis_3)  # disabled
and_5 = GateAnd(A=freeze_gate_8)  # disabled
context_analysis_expander_is_open_5 = RemoteReceiver(context_analysis_expander_is_open)

# ---- group: Analysis settings
values_55 = ValueListener(Elements=button_6, SomeProperty=True)  # -> Values, Indices
freeze_gate_9 = StreamFreezeGate(Data=values_55.Values, PassingSwitch=invert(values_55.Values))
slider_2 = CreateSlider(
    Slider=Slider(1, range=0.1..2),
    SnapValue=Slider(0.1, range=0..0.1),
    ShowBounds=False,
    ShowTicks=True,
    ShowTooltip=False,
    ShowValLabel=True,
    showLabel=False)
label_28 = CreateLabel(LabelText="Grid size (daylight simulation, [m])", LabelSize=12, Justification=0)
bool_8 = Boolean(invert(freeze_gate_9))
selobj_2 = ObjectsBySelection(Reset=Toggle(True), LiveMode=True)
tap_5 = TapBuffer(Reset=False, Incremental=True, Valve=bool_8, Hold=True)
tab_simulate_19 = RemoteReceiver(tab_simulate)
values_56 = ValueListener(Elements=slider_2, SomeProperty=True)  # -> Values, Indices
tooltip_2 = AttachTooltipToElement(ElementsToAttachTo=slider_2, TooltipContent="Doubleclick to input value", ShowDelay=500, Duration=2000)
dam_7 = DataDam(DataA=tap_5, BufferDelay=2500000, BufferMode=2)
selectednorthvector = RemoteSender(selobj_2)
equals_8 = Equality(FirstNumber=tap_5, SecondNumber=dam_7)  # -> Equality, Inequality
daylight_grid_size = RemoteSender(values_56.Values)
py3_7 = Python3Script(selected_geometry=selectednorthvector)  # -> out, north_vector; inputs selected_geometry: list of GeometryBase
# ---------- py3_7: Python ----------
import Rhino.Geometry as rg
line_types = [rg.PolylineCurve, rg.LineCurve,]
vector_types = [rg.Vector2d, rg.Vector3d]
try:
    north_vector = selected_geometry if\
        selected_geometry\
        and len(selected_geometry) == 1\
        and (type(selected_geometry[0]) in vector_types
        or (type(selected_geometry[0]) in line_types and selected_geometry[0].IsLinear()))\
        else None
except:
    north_vector = None

print(north_vector)
# ---------- end py3_7 ----------
entwine_33 = Entwine(Branch00=label_28, Branch01=slider_2, FlattenInputs=True)  # -> flatten(Result)

# ----
devec = DeconstructVector(Vector=py3_7.north_vector)  # -> XComponent, YComponent, ZComponent
null_9 = NullItem(Item=py3_7.north_vector)  # -> NullFlags, InvalidFlags, Description
merge_2 = Merge(Data1=devec.XComponent, Data2=devec.YComponent, Data3=devec.ZComponent)
join = TextJoin(Text=merge_2, Join=",")
entwine_34 = Entwine(Branch00=stack_25, Branch01=tb_26, Branch02=button_6, Branch03=entwine_33, FlattenInputs=True)  # -> flatten(Result)
stack_30 = CreateStack(UIElements=entwine_34, Horizontal=invert(True))
expander_3 = CreateExpander(UIElements=stack_30, Header="Analysis settings", Open=invert(True))
data_4 = Data(expander_3)
daylight_grid_size_2 = RemoteReceiver(daylight_grid_size)
daylight_grid_size_3 = RemoteReceiver(daylight_grid_size)

# ----
# Reports
detailed_energy_simulations_report = RemoteReceiver()
glare_report = RemoteReceiver()

# ----
# Inspect model
# Model attributes
tab_load_inspect_model_7 = RemoteReceiver(tab_load_inspect_model)
panel_80 = Panel("""All
Walls
Roof
Floors
Ground
Windows
Context""")
button_19 = CreateButton(ButtonName="Zoom", ButtonStyle=0)
checklist_4 = CreateChecklist(ChecklistItems=panel_80, Selected=False)
button_20 = CreateButton(ButtonName="Bake model", ButtonStyle=0)
label_29 = CreateLabel(LabelText="Display model components", LabelSize=18, Justification=0)
label_30 = CreateLabel(LabelText="Load and select a model", LabelSize=18, Justification=1)
panel_81 = Panel("""properties.energy.construction.display_name
properties.energy.construction.layers
properties.energy.construction.thickness
area
properties.energy.construction.mass_area_density
properties.energy.construction.area_heat_capacity
properties.energy.construction.r_value
properties.energy.construction.u_value
properties.energy.construction.u_factor
properties.energy.construction.shgc
properties.energy.r_factor
properties.energy.u_factor""")
panel_82 = Panel("""properties.energy.program_type.display_name
properties.energy.people.area_per_person
properties.energy.lighting.watts_per_area
properties.energy.electric_equipment.watts_per_area
properties.energy.gas_equipment.watts_per_area
properties.energy.service_hot_water.flow_per_area
properties.energy.ventilation.air_changes_per_hour
volume
floor_area
exposed_area
exterior_wall_area
exterior_aperture_area
average_floor_height""")
values_57 = ValueListener(Elements=button_19, SomeProperty=True)  # -> Values, Indices
values_58 = ValueListener(Elements=checklist_4, SomeProperty=True)  # -> Values, Indices
panel_83 = Panel("""Program
Area per Person [m2/ppl]
Lighting per Area [W/m2]
Electric Equipment per Area [W/m2]
Gas Equipment per Area [W/m2]
Hot Water per Area [L/h-m2]
Ventilation per volume [ACH]
Volume [m3]
Gross Floor Area [m2]
Exposed Area [m2]
Exterior Wall Area [m2]
Exterior Aperture Area [m2]
Average Floor Elevation [m]""")
values_59 = ValueListener(Elements=button_20, SomeProperty=True)  # -> Values, Indices
panel_84 = Panel("""Construction
Materials
Thickness [m]
Area [m2]
Density [kg/m2]
Heat Capacity [J/K-m2]
Construction R-Value [m2-K/W]
Construction U-Value [W/m2-K]
Construction U-Factor [W/m2-K]
Construction SHGC [Unshaded]
R-Factor [m2-K/W]
U-Factor [W/m2-K]""")
zoom_honeybee_model = RemoteSender(values_57.Values)
item_3 = ListItem(List=values_58.Values, Index=0, Wrap=invert(True))  # -> Item, Item1, Item2, Item3, Item4, Item5, Item6
cull = CullPattern(List=values_58.Values, CullPattern=values_58.Values)
rec_20 = DataRecorder(values_59.Values, DataLimit=-10, RecordData=True)
ma_19 = MassAddition(Input=cull)  # -> Result, PartialResults
int_4 = Integer(rec_20)
null_10 = NullItem(Item=ma_19.Result)  # -> NullFlags, InvalidFlags, Description
ma_20 = MassAddition(Input=int_4)  # -> Result, PartialResults
event_11 = EventGate(Data=ma_20.Result)  # -> Data, IsNew
filter_14 = StreamFilter(Gate=null_10.NullFlags, Stream0=cull, Stream1="False")
tab_load_inspect_model_8 = RemoteReceiver(tab_load_inspect_model)
pulldown_4 = CreatePulldownMenu(Label="Program", ListItems=panel_83, showLabel=True)
checkbox_4 = CreateCheckbox(Label="Show", StartingValue=False)
label_31 = CreateLabel(LabelText="Display model attributes", LabelSize=18, Justification=0)
tab_load_inspect_model_9 = RemoteReceiver(tab_load_inspect_model)
pulldown_5 = CreatePulldownMenu(Label="Constructions", ListItems=panel_84, showLabel=True)
checkbox_5 = CreateCheckbox(Label="Show", StartingValue=False)
event_12 = EventGate(Data=filter_14)  # -> Data, IsNew
dam_8 = DataDam(DataA=event_11.Data, BufferDelay=2500000, BufferMode=2)
equals_9 = Equality(FirstNumber=event_11.Data, SecondNumber=dam_8)  # -> Equality, Inequality
entwine_35 = Entwine(Branch00=pulldown_4, Branch01=checkbox_4, FlattenInputs=True)  # -> flatten(Result)
values_60 = ValueListener(Elements=pulldown_4, SomeProperty=True)  # -> Values, Indices
values_61 = ValueListener(Elements=checkbox_4, SomeProperty=True)  # -> Values, Indices
values_62 = ValueListener(Elements=pulldown_5, SomeProperty=True)  # -> Values, Indices
values_63 = ValueListener(Elements=checkbox_5, SomeProperty=True)  # -> Values, Indices
event_13 = EventGate(Data=equals_9.Inequality)  # -> Data, IsNew
item_4 = ListItem(List=panel_82, Index=values_60.Indices, Wrap=invert(True))
stack_31 = CreateStack(UIElements=entwine_35, Horizontal=True)
item_5 = ListItem(List=panel_81, Index=values_62.Indices, Wrap=invert(True))
format_16 = Format(
    Format="{0}, {1}, {2}, {3}",
    Culture=127,
    Data0=Slider(0, range=-25..25),
    Data1=Slider(5, range=0..100),
    Data2=Slider(5, range=0..100),
    Data3=Slider(0, range=-25..25))
entwine_36 = Entwine(Branch00=pulldown_5, Branch01=checkbox_5, FlattenInputs=True)  # -> flatten(Result)
face_attribute = RemoteSender(item_5)
room_attribute = RemoteSender(item_4)
entwine_37 = Entwine(Branch00=button_19, Branch01=button_20, FlattenInputs=True)  # -> flatten(Result)
stack_32 = CreateStack(UIElements=entwine_36, Horizontal=True)
adjustpos_28 = AdjustElementPositioning(
    ElementsToAdjust=[button_19, button_20],
    Margin=format_16,
    AbsolutePositioning=False,
    HorizontalAlignment=1,
    VerticalAlignment=1)
stack_33 = CreateStack(UIElements=entwine_37, Horizontal=True)
entwine_38 = Entwine(Branch00=label_31, Branch01=stack_31, Branch02=stack_32, FlattenInputs=True)  # -> flatten(Result)
stack_34 = CreateStack(UIElements=entwine_38, Horizontal=invert(True))
entwine_39 = Entwine(Branch00=label_31, Branch01=stack_34, FlattenInputs=True)  # -> flatten(Result)
entwine_40 = Entwine(Branch00=stack_17, Branch01=tb_19, Branch02=checklist_4, Branch03=stack_33, Branch04=entwine_39, FlattenInputs=True)  # -> flatten(Result)
entwine_41 = Entwine(Branch02=entwine_40, FlattenInputs=True)  # -> flatten(Result)
adjustpos_29 = AdjustElementPositioning(ElementsToAdjust=[checkbox_4, checkbox_5], Margin="0, 0, 10, 0", AbsolutePositioning=False)
adjustpos_30 = AdjustElementPositioning(
    ElementsToAdjust=[pulldown_4, pulldown_5],
    AbsolutePositioning=False,
    Width=Slider(239, range=0..400),
    HorizontalAlignment=0)

or = GateOr(A=item_3.Item, B=item_3.Item2)
or_2 = GateOr(A=item_3.Item, B=item_3.Item3)
or_3 = GateOr(A=item_3.Item, B=item_3.Item1)
or_4 = GateOr(A=item_3.Item, B=item_3.Item4)
or_5 = GateOr(A=item_3.Item, B=item_3.Item5)
or_6 = GateOr(A=item_3.Item, B=item_3.Item6)
expander_4 = CreateExpander(UIElements=entwine_41, Header="Inspect model", Open=invert(True))
values_64 = ValueListener(Elements=expander_4, SomeProperty=True)  # -> Values, Indices
expander_inspect_model = RemoteSender(values_64.Values)
expander_inspect_model_2 = RemoteReceiver(expander_inspect_model)
and_6 = GateAnd(A=event_12.Data, B=expander_inspect_model_2)

# ----
# Inspect context environment
panel_85 = Panel("""Hemisphere visualisation
Wind rose
Temperature line chart
Temperature 2D chart""")
pulldown_6 = CreatePulldownMenu(ListItems=panel_85, SelectedIndex="0", showLabel=False)
button_21 = CreateButton(ButtonName="Zoom", ButtonStyle=0)
button_22 = CreateButton(ButtonName="Bake", ButtonStyle=0)
values_65 = ValueListener(Elements=button_22, SomeProperty=True)  # -> Values, Indices
label_32 = CreateLabel(LabelText="Select environment visualisation", LabelSize=18, Justification=0)
freeze_gate_10 = StreamFreezeGate(Data=values_65.Values, PassingSwitch=invert(values_65.Values))
values_66 = ValueListener(Elements=pulldown_6, SomeProperty=True)  # -> Values, Indices
values_67 = ValueListener(Elements=button_21, SomeProperty=True)  # -> Values, Indices
bool_9 = Boolean(invert(freeze_gate_10))
weather_visualization_type = RemoteSender(values_66.Indices)
rec_21 = DataRecorder(bool_9, DataLimit=-10, RecordData=True)
zoom_weather_visualization = RemoteSender(values_67.Values)
int_5 = Integer(rec_21)
ma_21 = MassAddition(Input=int_5)  # -> Result, PartialResults
event_14 = EventGate(Data=ma_21.Result)  # -> Data, IsNew
entwine_42 = Entwine(Branch00=pulldown_6, Branch01=button_21, Branch02=button_22, FlattenInputs=True)  # -> flatten(Result)
dam_9 = DataDam(DataA=event_14.Data, BufferDelay=2500000, BufferMode=2)
stack_35 = CreateStack(UIElements=entwine_42, Horizontal=True)
equals_10 = Equality(FirstNumber=event_14.Data, SecondNumber=dam_9)  # -> Equality, Inequality
event_15 = EventGate(Data=equals_10.Inequality)  # -> Data, IsNew
adjustpos_31 = AdjustElementPositioning(ElementsToAdjust=pulldown_6, Margin="0, 0, 0, 0", AbsolutePositioning=False, Width=Slider(200, range=0..400))
entwine_43 = Entwine(Branch00=label_2, Branch01=stack_23, Branch02=tb_24, Branch03=stack_35, FlattenInputs=True)  # -> flatten(Result)

expander_5 = CreateExpander(UIElements=entwine_43, Header="Inspect location environment", Open=invert(True))
values_68 = ValueListener(Elements=expander_5, SomeProperty=True)  # -> Values, Indices
expander_inspect_location_environment = RemoteSender(values_68.Values)

# ---- group: Visualize module
# Load/Inspect model
panel_86 = Panel("Rename model")
label_33 = CreateLabel(LabelText="Model overview", LabelSize=18, Justification=0)
button_23 = CreateButton(ButtonName="Load models", ButtonStyle=0)  # disabled
values_69 = ValueListener(Elements=button_23, SomeProperty=True)  # -> Values, Indices
textbox_8 = CreateTextBox(Label=panel_86, DefaultText="Renamed model", UpdateButton=invert(True), showLabel=True)
pulldown_7 = CreatePulldownMenu(Label="Select model", showLabel=True)
button_24 = CreateButton(ButtonName="Rename", ButtonStyle=0)
button_25 = CreateButton(ButtonName="Remove", ButtonStyle=0)
values_70 = ValueListener(Elements=button_25, SomeProperty=True)  # -> Values, Indices
freeze_gate_11 = StreamFreezeGate(Data=values_70.Values, PassingSwitch=invert(values_70.Values))
pre_remove_current_model = RemoteSender(values_70.Values)
bool_10 = Boolean(invert(freeze_gate_11))
values_71 = ValueListener(Elements=button_24, SomeProperty=True)  # -> Values, Indices
freeze_gate_12 = StreamFreezeGate(Data=values_71.Values, PassingSwitch=invert(values_71.Values))
values_72 = ValueListener(Elements=textbox_8, SomeProperty=True)  # -> Values, Indices
values_73 = ValueListener(Elements=pulldown_7, SomeProperty=True)  # -> Values, Indices
bool_11 = Boolean(invert(freeze_gate_12))
rec_22 = DataRecorder(bool_10, DataLimit=-10, RecordData=True)
event_16 = EventGate(Data=values_73.Indices)  # -> Data, IsNew
pre_rename_current_model = RemoteSender(values_71.Values)
rec_23 = DataRecorder(bool_11, DataLimit=-10, RecordData=True)
panel_87 = Panel(values_72.Values)
current_selected_model_visualise_module = RemoteSender(values_73.Values)  # "current_selected_model_visualise_module_name"
current_selected_model_visualise_module_2 = RemoteReceiver(current_selected_model_visualise_module)  # "current_selected_model_visualise_module_name"
rename_current_model_name = RemoteSender(values_72.Values)
rename_current_model_name_2 = RemoteReceiver(rename_current_model_name)
int_6 = Integer(rec_22)
current_selected_model_visualise_module_3 = RemoteSender(event_16.Data)
ma_22 = MassAddition(Input=int_6)  # -> Result, PartialResults
int_7 = Integer(rec_23)
ma_23 = MassAddition(Input=int_7)  # -> Result, PartialResults
event_17 = EventGate(Data=ma_22.Result)  # -> Data, IsNew
settextbox = SetTextBoxContents(TextBoxToModify=textbox_8, NewTextBoxContents=current_selected_model_visualise_module_2)
event_18 = EventGate(Data=ma_23.Result)  # -> Data, IsNew
dam_10 = DataDam(DataA=event_17.Data, BufferDelay=2500000, BufferMode=2)
dam_11 = DataDam(DataA=event_18.Data, BufferDelay=2500000, BufferMode=2)
equals_11 = Equality(FirstNumber=event_17.Data, SecondNumber=dam_10)  # -> Equality, Inequality
equals_12 = Equality(FirstNumber=event_18.Data, SecondNumber=dam_11)  # -> Equality, Inequality
entwine_44 = Entwine(Branch00=pulldown_7, Branch01=button_25, FlattenInputs=True)  # -> flatten(Result)
adjustpos_32 = AdjustElementPositioning(
    ElementsToAdjust=button_23,
    AbsolutePositioning=False,
    Width=Slider(125, range=50..250),
    Height=Slider(30, range=20..50),
    HorizontalAlignment=1)
entwine_45 = Entwine(Branch00=textbox_8, Branch01=button_24, FlattenInputs=True)  # -> flatten(Result)
stack_36 = CreateStack(UIElements=entwine_44, Horizontal=True)
stack_37 = CreateStack(UIElements=entwine_45, Horizontal=True)
format_17 = Format(Format="{0}, {1}, 0, 0", Culture=127, Data0=Slider(0, range=-25..25), Data1=Slider(0, range=0..100))
select_model_3 = Data(stack_36)
format_18 = Format(Format="{0}, {1}, 0, 0", Culture=127, Data0=Slider(0, range=-25..25), Data1=Slider(5, range=0..100))
format_19 = Format(Format="{0}, {1}, 0, 0", Culture=127, Data0=Slider(8, range=-25..25), Data1=Slider(4, range=0..100))
adjustpos_33 = AdjustElementPositioning(ElementsToAdjust=button_25, AbsolutePositioning=False, Height=Slider(28, range=0..100))
adjustpos_34 = AdjustElementPositioning(
    ElementsToAdjust=pulldown_7,
    Margin=format_17,
    AbsolutePositioning=False,
    Width=Slider(280, range=0..400),
    Height=Slider(35, range=0..100),
    HorizontalAlignment=0,
    VerticalAlignment=2)
adjustpos_35 = AdjustElementPositioning(
    ElementsToAdjust=button_24,
    Margin=format_19,
    AbsolutePositioning=False,
    Height=Slider(29, range=0..100),
    HorizontalAlignment=0)
adjustpos_36 = AdjustElementPositioning(
    ElementsToAdjust=textbox_8,
    Margin=format_18,
    AbsolutePositioning=False,
    Width=Slider(276, range=0..350),
    Height=Slider(28, range=0..100),
    HorizontalAlignment=0)

# ----
adjustpos_37 = AdjustElementPositioning(ElementsToAdjust=stack_37, Margin="0,0,0,10", AbsolutePositioning=False)
entwine_46 = Entwine(
    Branch00=stack_22,
    Branch01=tb_23,
    Branch02=tb_4,
    Branch03=button_23,
    Branch04=select_model_3,
    Branch05=stack_37,
    FlattenInputs=True)  # -> flatten(Result)
current_selected_model_visualise_module_4 = RemoteReceiver(current_selected_model_visualise_module_3)

rename_current_model_name_3 = RemoteReceiver(rename_current_model_name)
pre_rename_current_model_2 = RemoteReceiver(pre_rename_current_model)
pre_remove_current_model_2 = RemoteReceiver(pre_remove_current_model)

# ---- group: Program module
# SELECT PROGRAM
panel_88 = Panel("""LargeOffice
MediumOffice
SmallOffice
MidriseApartment
HighriseApartment
Retail
StripMall
PrimarySchool
SecondarySchool
SmallHotel
LargeHotel
Hospital
Outpatient
Laboratory
Warehouse
SuperMarket
FullServiceRestaurant
QuickServiceRestaurant
Courthouse
LargeDataCenterHighITE
LargeDataCenterLowITE
SmallDataCenterHighITE
SmallDataCenterLowITE""")
cooling_setpoint_ºc = Slider(27, range=10..40)
heating_setpoint_ºc = Slider(21, range=10..40)
empty = EmptyObjectToEmptyBranch()
pulldown_8 = CreatePulldownMenu(Label="Room type", ListItems=empty, showLabel=True)
label_34 = CreateLabel(LabelText="Indoor conditions", LabelSize=18, Justification=0)
pulldown_9 = CreatePulldownMenu(Label="Building type", ListItems=panel_88, SelectedIndex="3", showLabel=True)
slider_3 = CreateSlider(Slider=cooling_setpoint_ºc, ShowBounds=False, ShowTicks=True, ShowTooltip=True, ShowValLabel=True, showLabel=False)
label_35 = CreateLabel(LabelText="Cooling setpoint [ºC]", LabelSize=12, Justification=0)
slider_4 = CreateSlider(Slider=heating_setpoint_ºc, ShowBounds=False, ShowTicks=True, ShowTooltip=False, ShowValLabel=True, showLabel=False)
label_36 = CreateLabel(LabelText="Heating setpoint [ºC]", LabelSize=12, Justification=0)
label_37 = CreateLabel(LabelText="Occupancy [persons/100 m2]", LabelSize=12, Justification=0)
slider_5 = CreateSlider(Slider=Slider(3, range=0..20), ShowBounds=False, ShowTicks=True, ShowTooltip=True, ShowValLabel=True, showLabel=False)
values_74 = ValueListener(Elements=pulldown_9, SomeProperty=True)  # -> Values, Indices
values_75 = ValueListener(Elements=pulldown_8, SomeProperty=True)  # -> Values, Indices
values_76 = ValueListener(Elements=slider_4, SomeProperty=True)  # -> Values, Indices
values_77 = ValueListener(Elements=slider_3, SomeProperty=True)  # -> Values, Indices
tooltip_3 = AttachTooltipToElement(ElementsToAttachTo=slider_4, TooltipContent="Doubleclick to input value", ShowDelay=500, Duration=2000)
values_78 = ValueListener(Elements=slider_5, SomeProperty=True)  # -> Values, Indices
tooltip_4 = AttachTooltipToElement(ElementsToAttachTo=slider_3, TooltipContent="Doubleclick to input value", ShowDelay=500, Duration=2000)
tooltip_5 = AttachTooltipToElement(ElementsToAttachTo=slider_5, TooltipContent="Doubleclick to input value", ShowDelay=500, Duration=2000)
selected_building = RemoteSender(values_74.Values)
selected_room = RemoteSender(values_75.Values)
cooling_setpoint = RemoteSender(values_77.Values)
cooling_setpoint_2 = RemoteReceiver(cooling_setpoint)
subtraction_10 = Subtraction(A=cooling_setpoint_2, B="1")
dom = ConstructDomain(DomainStart=Slider(10, range=0..100), DomainEnd=subtraction_10)
setslider = SetSlider(UISlider=slider_4, Range=dom)
heating_setpoint = RemoteSender(values_76.Values)
heating_setpoint_2 = RemoteReceiver(heating_setpoint)
addition = Addition(A=heating_setpoint_2, B="1")
dom_2 = ConstructDomain(DomainStart=addition, DomainEnd=Slider(40, range=0..100))
setslider_2 = SetSlider(UISlider=slider_3, Range=dom_2)
entwine_47 = Entwine(Branch00=label_35, Branch01=slider_3, FlattenInputs=True)  # -> flatten(Result)
entwine_48 = Entwine(Branch00=label_36, Branch01=slider_4, FlattenInputs=True)  # -> flatten(Result)
entwine_49 = Entwine(Branch00=label_37, Branch01=slider_5, FlattenInputs=True)  # -> flatten(Result)
number_slider_21 = Slider(255, range=0..350)
stack_38 = CreateStack(UIElements=entwine_48, Horizontal=invert(True))
stack_39 = CreateStack(UIElements=entwine_47, Horizontal=invert(True))
stack_40 = CreateStack(UIElements=entwine_49, Horizontal=invert(True))
format_20 = Format(Format="{0}, {1}, 0, 0", Culture=127, Data0=Slider(10, range=0..25), Data1=Slider(0, range=0..50))
entwine_50 = Entwine(Branch00=stack_19, Branch01=tb_21, Branch02=pulldown_9, Branch03=pulldown_8, FlattenInputs=True)  # -> flatten(Result)
entwine_51 = Entwine(Branch00=label_34, Branch01=stack_39, Branch02=stack_38, Branch03=stack_40, Branch04=stack_4, FlattenInputs=True)  # -> flatten(Result)
adjustpos_38 = AdjustElementPositioning(ElementsToAdjust=pulldown_9, AbsolutePositioning=False, Width=number_slider_21, HorizontalAlignment=0)
adjustpos_39 = AdjustElementPositioning(ElementsToAdjust=pulldown_8, AbsolutePositioning=False, Width=number_slider_21, HorizontalAlignment=0)
adjustpos_40 = AdjustElementPositioning(
    ElementsToAdjust=[slider_5, slider_4, slider_3, slider],
    Margin=format_20,
    AbsolutePositioning=False,
    Width=Slider(200, range=0..300),
    HorizontalAlignment=0)

# ----
division_5 = Division(A=values_78.Values, B="100")
location_2 = Data(entwine_50)
location_3 = Data(entwine_51)
selected_room_2 = RemoteReceiver(selected_room)
cooling_setpoint_3 = RemoteReceiver(cooling_setpoint)
heating_setpoint_3 = RemoteReceiver(heating_setpoint)
# ---- group: Construction module
# SELECT CONSTRUCTION
number_slider_22 = Slider(5, range=0..7)
panel_89 = Panel("🛠")
panel_90 = Panel("""Very Hot
Hot
Warm
Mixed
Cool
Cold
Very Cold
Subarctic""")
panel_91 = Panel("""SteelFramed
WoodFramed
Mass
Metal Building""")
panel_92 = Panel("Skylights")  # disabled
empty_2 = EmptyObjectToEmptyBranch()
empty_3 = EmptyObjectToEmptyBranch()  # disabled
empty_4 = EmptyObjectToEmptyBranch()
panel_93 = Panel("Exterior floor")  # disabled
panel_94 = Panel("Interior walls")  # disabled
empty_5 = EmptyObjectToEmptyBranch()
empty_6 = EmptyObjectToEmptyBranch()
empty_7 = EmptyObjectToEmptyBranch()  # disabled
empty_8 = EmptyObjectToEmptyBranch()
empty_9 = EmptyObjectToEmptyBranch()  # disabled
pulldown_10 = CreatePulldownMenu(Label=panel_92, ListItems=empty_3, showLabel=True)  # disabled
pulldown_11 = CreatePulldownMenu(Label="Windows", ListItems=empty_2, showLabel=True)
pulldown_12 = CreatePulldownMenu(Label="Walls", ListItems=empty_5, showLabel=True)
pulldown_13 = CreatePulldownMenu(Label="Ground", ListItems=empty_4, showLabel=True)
pulldown_14 = CreatePulldownMenu(Label="Floors", ListItems=empty_8, showLabel=True)
pulldown_15 = CreatePulldownMenu(Label=panel_93, ListItems=empty_7, showLabel=True)  # disabled
true_button_23 = CreateTrueOnlyButton(ButtonName="🛠", ButtonStyle=0)
pulldown_16 = CreatePulldownMenu(Label="Roof", ListItems=empty_6, showLabel=True)
pulldown_17 = CreatePulldownMenu(Label=panel_94, ListItems=empty_9, showLabel=True)  # disabled
label_38 = CreateLabel(LabelText="Select subset construction", LabelSize=18, Justification=0)
pulldown_18 = CreatePulldownMenu(Label="By climate", ListItems=panel_90, SelectedIndex=number_slider_22, showLabel=True)
pulldown_19 = CreatePulldownMenu(Label="By type", ListItems=panel_91, SelectedIndex=Slider(1, range=0..3), showLabel=True)
values_79 = ValueListener(Elements=pulldown_10, SomeProperty=True)  # -> Values, Indices; disabled
values_80 = ValueListener(Elements=pulldown_11, SomeProperty=True)  # -> Values, Indices
values_81 = ValueListener(Elements=pulldown_17, SomeProperty=True)  # -> Values, Indices; disabled
values_82 = ValueListener(Elements=pulldown_14, SomeProperty=True)  # -> Values, Indices
values_83 = ValueListener(Elements=pulldown_15, SomeProperty=True)  # -> Values, Indices; disabled
values_84 = ValueListener(Elements=pulldown_13, SomeProperty=True)  # -> Values, Indices
values_85 = ValueListener(Elements=true_button_23, SomeProperty=True)  # -> Values, Indices
values_86 = ValueListener(Elements=pulldown_16, SomeProperty=True)  # -> Values, Indices
values_87 = ValueListener(Elements=pulldown_12, SomeProperty=True)  # -> Values, Indices
values_88 = ValueListener(Elements=pulldown_19, SomeProperty=True)  # -> Values, Indices
panel_95 = Panel("0")  # disabled
panel_96 = Panel("0")  # disabled
subset_interior_wall = RemoteSender(values_81.Indices)  # disabled
subset_interior_floor = RemoteSender(values_82.Indices)
panel_97 = Panel("0")  # disabled
subset_exterior_floor = RemoteSender(values_83.Indices)  # disabled
subset_ground_floor = RemoteSender(values_84.Indices)
values_89 = ValueListener(Elements=pulldown_18, SomeProperty=True)  # -> Values, Indices
subset_subface_skylight = RemoteSender(values_79.Indices)  # disabled
subset_subface_window = RemoteSender(values_80.Indices)
subset_exterior_roof = RemoteSender(values_86.Indices)
subset_exterior_wall = RemoteSender(values_87.Indices)
panel_98 = Panel(values_85.Values)
open_window_database = RemoteSender(values_85.Values)
base_type = RemoteSender(values_88.Values)
addition_2 = Addition(A=values_89.Indices, B="1")
recompute_3 = RemoteReceiver(recompute)
panel_99 = Panel("""False
True""")
entwine_52 = Entwine(Branch00=pulldown_18, Branch01=pulldown_19, FlattenInputs=True)  # -> flatten(Result)
base_climate = RemoteSender(addition_2)
entwine_53 = Entwine(Branch00=pulldown_11, Branch01=true_button_23, FlattenInputs=True)  # -> flatten(Result)
stack_41 = CreateStack(UIElements=entwine_52, Horizontal=invert(True))
stack_42 = CreateStack(UIElements=entwine_53, Horizontal=True)
entwine_54 = Entwine(Branch00=stack_16, Branch01=tb_18, Branch02=stack_41, FlattenInputs=True)  # -> flatten(Result)
number_slider_23 = Slider(35, range=25..50)
stack_43 = CreateStack(UIElements=entwine_54, Horizontal=invert(True))
tooltip_6 = AttachTooltipToElement(ElementsToAttachTo=pulldown_19, TooltipContent="Select type of construction", ShowDelay=500, Duration=2000)
adjustpos_41 = AdjustElementPositioning(ElementsToAdjust=pulldown_19, AbsolutePositioning=False, Width=Slider(170, range=0..300), HorizontalAlignment=0)
adjustpos_42 = AdjustElementPositioning(ElementsToAdjust=pulldown_18, AbsolutePositioning=False, Width=Slider(160, range=0..300), HorizontalAlignment=0)
tooltip_7 = AttachTooltipToElement(ElementsToAttachTo=pulldown_18, TooltipContent="Select climate", ShowDelay=500, Duration=2000)
adjustpos_43 = AdjustElementPositioning(
    ElementsToAdjust=[pulldown_14, pulldown_13, pulldown_15, pulldown_16, pulldown_17, pulldown_12, pulldown_10, pulldown_11],
    AbsolutePositioning=False,
    Width=Slider(290, range=0..300),
    HorizontalAlignment=0)

# ----
base_climate_2 = RemoteReceiver(base_climate)
base_type_2 = RemoteReceiver(base_type)
constrsetclimate = HBConstructionSetByClimate(climate_zone=base_climate_2, vintage=bldgvintages, constr_type=base_type_2)  # -> constr_set; plug-in component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
panel_100 = Panel(constrsetclimate)
constructionset = HBConstructionSet(base_constr_set=panel_100)  # -> constr_set; plug-in component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
decnstrconstrset = HBDeconstructConstructionSet(constr_set=constructionset)  # -> exterior_wall, exterior_roof, exposed_floor, ground_wall, ground_roof, ground_floor, window, skylight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; plug-in component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
decnstrconstrsetint = HBDeconstructConstructionSetInterior(constr_set=constructionset)  # -> interior_wall, ceiling, interior_floor, interior_window, interior_door, int_glass_door; plug-in component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
entwine_55 = Entwine(
    Branch00=decnstrconstrset.exterior_wall,
    Branch01=decnstrconstrsetint.interior_wall,
    Branch02=decnstrconstrset.exterior_roof,
    Branch03=decnstrconstrsetint.interior_floor,
    Branch04=decnstrconstrset.exposed_floor,
    Branch05=decnstrconstrset.ground_floor,
    FlattenInputs=True)
decnstrconstr = HBDeconstructConstruction(constr=entwine_55)  # -> materials, layers, r_val_si, r_val_ip, u_fac_si, u_fac_ip, shgc, t_sol, t_vis; plug-in component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
bang_2 = ExplodeTree(Data=decnstrconstr.u_fac_si)  # -> Branch0, Branch1, Branch2, Branch3, Branch4, Branch5
repeat = RepeatData(Data=panel_89, Length="4")

# ----
# Construction by climate and type
location_4 = Data(stack_43)

# ----
# Select subset construction
location_5 = Data(label_38)

subset_interior_floor_2 = RemoteReceiver(subset_interior_floor)
subset_exterior_wall_2 = RemoteReceiver(subset_exterior_wall)

bldgvintages_2 = HBBuildingVintages({"ASHRAE 90.1 2019  |  IECC 2021": "2019", "ASHRAE 90.1 2016  |  IECC 2018": "2016", "ASHRAE 90.1 2013  |  IECC 2015": "2013", "ASHRAE 90.1 2010  |  IECC 2012": "2010", "ASHRAE 90.1 2007  |  IECC 2009": "2007", "ASHRAE 90.1 2004  |  IECC 2006": "2004", "1980-2004 (CBECS)": "1980_2004", "Pre-1980 (CBECS)": "pre_1980"}, selected="ASHRAE 90.1 2019  |  IECC 2021")
base_climate_3 = RemoteReceiver(base_climate)
base_type_3 = RemoteReceiver(base_type)
constrsetclimate_2 = HBConstructionSetByClimate(climate_zone=base_climate_3, vintage=bldgvintages_2, constr_type=base_type_3)  # -> constr_set; plug-in component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
panel_101 = Panel(constrsetclimate_2)

exterior_wall = Data(bang_2.Branch0)
interior_wall = Data(bang_2.Branch1)
exterior_roof = Data(bang_2.Branch2)
interior_floor = Data(bang_2.Branch3)
exterior_floor = Data(bang_2.Branch4)
ground = Data(bang_2.Branch5)
expression_2 = Expression(x=ground, Expression="Round(x, 2)")
expression_3 = Expression(x=exterior_floor, Expression="Round(x, 2)")
expression_4 = Expression(x=exterior_roof, Expression="Round(x, 2)")
expression_5 = Expression(x=interior_floor, Expression="Round(x, 2)")
expression_6 = Expression(x=interior_wall, Expression="Round(x, 2)")
expression_7 = Expression(x=exterior_wall, Expression="Round(x, 2)")
format_21 = Format(Format="{0} (U-factor: {1})", Culture=127, Data0=panel_44, Data1=expression_2)
format_22 = Format(Format="{0} (U-factor: {1})", Culture=127, Data0=panel_44, Data1=expression_3)
format_23 = Format(Format="{0} (U-factor: {1})", Culture=127, Data0=panel_44, Data1=expression_4)
format_24 = Format(Format="{0} (U-factor: {1})", Culture=127, Data0=panel_44, Data1=expression_5)
format_25 = Format(Format="{0} (U-factor: {1})", Culture=127, Data0=panel_44, Data1=expression_6)
format_26 = Format(Format="{0} (U-factor: {1})", Culture=127, Data0=panel_44, Data1=expression_7)

# ---- group: Prepare model
button_26 = CreateButton(ButtonName="Construct model!", ButtonStyle=0)
values_90 = ValueListener(Elements=button_26, SomeProperty=True)  # -> Values, Indices
textbox_9 = CreateTextBox(Label="Model name", DefaultText="My model", UpdateButton=invert(True), showLabel=True)
event_19 = EventGate(Data=values_90.Values)  # -> Data, IsNew
freeze_gate_13 = StreamFreezeGate(Data=event_19.Data, PassingSwitch=invert(event_19.Data))
bool_12 = Boolean(invert(freeze_gate_13))
pre_create_model = RemoteSender(event_19.Data)
values_91 = ValueListener(Elements=textbox_9, SomeProperty=True)  # -> Values, Indices
rec_24 = DataRecorder(bool_12, DataLimit=-10, RecordData=True)
panel_102 = Panel(values_91.Values)
model_name = RemoteSender(values_91.Values)
int_8 = Integer(rec_24)
ma_24 = MassAddition(Input=int_8)  # -> Result, PartialResults
event_20 = EventGate(Data=ma_24.Result)  # -> Data, IsNew
dam_12 = DataDam(DataA=event_20.Data, BufferDelay=2500000, BufferMode=2)
equals_13 = Equality(FirstNumber=event_20.Data, SecondNumber=dam_12)  # -> Equality, Inequality
number_slider_24 = Slider(210, range=0..300)
entwine_56 = Entwine(Branch00=stack_3, Branch01=tb, Branch02=textbox_9, FlattenInputs=True)  # -> flatten(Result)
stack_44 = CreateStack(UIElements=entwine_56, Horizontal=invert(True))
adjustpos_44 = AdjustElementPositioning(ElementsToAdjust=textbox_9, AbsolutePositioning=False, HorizontalAlignment=0)
setbtn = SetButton(ButtonToModify=button_26, ButtonName="Construct model!")
adjustpos_45 = AdjustElementPositioning(
    ElementsToAdjust=button_26,
    Margin="0, 10, 0, 0",
    AbsolutePositioning=False,
    Width=Slider(125, range=0..300),
    Height=Slider(30, range=0..100),
    HorizontalAlignment=1)

# ----
hideshow_18 = HideShowElement(ElementToHideShow=tb_5, Show=pre_create_model, Collapse=True, Disable=False)
model_name_2 = RemoteReceiver(model_name)

# ----
# Create model
create_model = Data(button_26)

# ----
# Model name
model_name_3 = Data(stack_44)

# ---- group: Analysis module
# Energy simulation
# Daylight simulation
# LCA calculations
panel_103 = Panel("Compare with")
panel_104 = Panel("""Illuminance [Lux]
Daylight autonomy [%]
UDI [%]
UDI <50 [%]
UDI >3000 [%]
None""")
panel_105 = Panel("""Annual energy balance
Daily cooling profile
Daily heating profile
Cooling balance
Heating balance
Energy end use
None""")
panel_106 = Panel("Spatial daylight autonomy: {0}%")
height = Slider(40, range=1..100)
width = Slider(5, range=1..100)
panel_107 = Panel("Energy use intensity (EUI): {0} (kWh/m2,a)")
panel_108 = Panel("Total embodied GWP per area: {0} kg CO2eq/m2")
panel_109 = Panel("Total embodied GWP: {0} kg CO2eq")
panel_110 = Panel("Operational GWP per area: {0} kg CO2eq/m2,year")
pulldown_20 = CreatePulldownMenu(Label=panel_103, showLabel=True)
panel_111 = Panel("Operational GWP total: {0} kg CO2eq/year")
panel_112 = Panel("Op. GWP total ({0} years): {1} kg CO2eq")
label_39 = CreateLabel(LabelText="Compare simulations", LabelSize=18, Justification=0)
true_button_24 = CreateTrueOnlyButton(ButtonName="Compare simulations bar chart", ButtonStyle=0)
button_27 = CreateButton(ButtonName="Bake", ButtonStyle=0)
button_28 = CreateButton(ButtonName="Zoom", ButtonStyle=0)
button_29 = CreateButton(ButtonName="Run energy simulation", ButtonStyle=0)
tb_28 = CreateTextBlock(TextSize=16, Justification=0)
label_40 = CreateLabel(LabelText="Display settings", LabelSize=18, Justification=0)
tb_29 = CreateTextBlock(Text="Simulations can take a few minutes...", TextSize=12, Justification=0)
values_92 = ValueListener(Elements=pulldown_20, SomeProperty=True)  # -> Values, Indices
pulldown_21 = CreatePulldownMenu(Label="Display type", ListItems=panel_105, showLabel=True)
slider_6 = CreateSlider(
    Slider=width,
    SnapValue=Slider(2, range=0..10),
    ShowBounds=False,
    ShowTicks=True,
    ShowTooltip=False,
    ShowValLabel=False,
    showLabel=True)
slider_7 = CreateSlider(
    Slider=height,
    SnapValue=Slider(2, range=0..10),
    ShowBounds=False,
    ShowTicks=True,
    ShowTooltip=False,
    ShowValLabel=False,
    showLabel=True)
button_30 = CreateButton(ButtonName="Run daylight simulation", ButtonStyle=0)
pulldown_22 = CreatePulldownMenu(Label="Display type", ListItems=panel_104, SelectedIndex="0", showLabel=True)
tb_30 = CreateTextBlock(Text=panel_106, TextSize=16, Justification=0)
tb_31 = CreateTextBlock(Text="Simulations can take a few minutes...", TextSize=12, Justification=0)
label_41 = CreateLabel(LabelText="Display settings", LabelSize=18, Justification=0)
values_93 = ValueListener(Elements=true_button_24, SomeProperty=True)  # -> Values, Indices
tb_32 = CreateTextBlock(Text=panel_107, TextSize=16, Justification=0)
button_31 = CreateButton(ButtonName="Zoom", ButtonStyle=0)
tb_33 = CreateTextBlock(TextSize=16, Justification=0)
true_button_25 = CreateTrueOnlyButton(ButtonName="Visualize GWP by model", ButtonStyle=0)
tb_34 = CreateTextBlock(TextSize=16, Justification=0)
values_94 = ValueListener(Elements=button_28, SomeProperty=True)  # -> Values, Indices
values_95 = ValueListener(Elements=button_27, SomeProperty=True)  # -> Values, Indices
hasdata_2 = DataExists(Data=relay)
values_96 = ValueListener(Elements=button_29, SomeProperty=True)  # -> Values, Indices
values_97 = ValueListener(Elements=button_30, SomeProperty=True)  # -> Values, Indices
values_98 = ValueListener(Elements=pulldown_21, SomeProperty=True)  # -> Values, Indices
values_99 = ValueListener(Elements=pulldown_22, SomeProperty=True)  # -> Values, Indices
values_100 = ValueListener(Elements=slider_7, SomeProperty=True)  # -> Values, Indices
label_42 = CreateLabel(LabelText=panel_108, LabelSize=12, Justification=0)
label_43 = CreateLabel(LabelText="Create a model in the assembly module to get a LCA", LabelSize=12, Justification=0)
label_44 = CreateLabel(LabelText=panel_109, LabelSize=12, Justification=0)
values_101 = ValueListener(Elements=slider_6, SomeProperty=True)  # -> Values, Indices
subtraction_11 = Subtraction(A=values_92.Indices, B="1")
daylight_simulation_compare_pop_up = RemoteSender(values_93.Values)
filter_15 = StreamFilter(Gate=hasdata_2, Stream0="0", Stream1=relay)
values_102 = ValueListener(Elements=button_31, SomeProperty=True)  # -> Values, Indices
values_103 = ValueListener(Elements=true_button_25, SomeProperty=True)  # -> Values, Indices
label_45 = CreateLabel(LabelText=panel_110, LabelSize=12, Justification=0)
label_46 = CreateLabel(LabelText=panel_111, LabelSize=12, Justification=0)
freeze_gate_14 = StreamFreezeGate(Data=values_96.Values, PassingSwitch=invert(values_96.Values))
zoom_simple_energy_simulation = RemoteSender(values_94.Values)
label_47 = CreateLabel(LabelText=panel_112, LabelSize=12, Justification=0)
bake_simple_energy_simulation = RemoteSender(values_95.Values)
freeze_gate_15 = StreamFreezeGate(Data=values_97.Values, PassingSwitch=invert(values_97.Values))
pre_run_simple_energy_simulations = RemoteSender(values_96.Values)
pre_run_simple_energy_simulations_2 = RemoteReceiver(pre_run_simple_energy_simulations)
freeze_gate_16 = StreamFreezeGate(Data=pre_run_simple_energy_simulations_2, PassingSwitch=pre_run_simple_energy_simulations_2)
simple_energy_simulation_type = RemoteSender(values_98.Indices)
daylight_simulation_type = RemoteSender(values_99.Indices)
simple_energy_simulation_height = RemoteSender(values_100.Values)
simple_energy_simulation_width = RemoteSender(values_101.Values)
or_7 = GateOr(B=filter_15)
visualize_lca_gwp_by_element = RemoteSender(values_103.Values)
current_selected_simulation_daylight_com = RemoteSender(subtraction_11)  # "current_selected_simulation_daylight_compare"
zoom_daylight_simulation = RemoteSender(values_102.Values)
bool_13 = Boolean(invert(freeze_gate_14))
bool_14 = Boolean(invert(freeze_gate_15))
pre_run_daylight_simulations = RemoteSender(values_97.Values)
pre_run_daylight_simulations_2 = RemoteReceiver(pre_run_daylight_simulations)
freeze_gate_17 = StreamFreezeGate(Data=pre_run_daylight_simulations_2, PassingSwitch=pre_run_daylight_simulations_2)
hasdata_3 = DataExists(Data=freeze_gate_17)
filter_16 = StreamFilter(Gate=hasdata_3, Stream0="0", Stream1=freeze_gate_17)
entwine_57 = Entwine(Branch00=slider_7, Branch01=slider_6, FlattenInputs=True)  # -> flatten(Result)
entwine_58 = Entwine(Branch02=button_29, Branch03=button_28, Branch04=button_27, FlattenInputs=True)  # -> flatten(Result)
rec_25 = DataRecorder(or_7, DataLimit=-10, RecordData=True)
tap_6 = TapBuffer(Reset=False, Incremental=True, Valve=bool_13, Hold=True)
tap_7 = TapBuffer(Reset=False, Incremental=True, Valve=bool_14, Hold=True)
ma_25 = MassAddition(Input=flatten(rec_25))  # -> Result, PartialResults
dam_13 = DataDam(DataA=tap_6, BufferDelay=2500000, BufferMode=2)
dam_14 = DataDam(DataA=tap_7, BufferDelay=2500000, BufferMode=2)
entwine_59 = Entwine(Branch00=pulldown_21, Branch01=entwine_57, FlattenInputs=True)  # -> flatten(Result)
mod_16 = Modulus(A=ma_25.Result, B=Slider(2, range=0..10))
equals_14 = Equality(FirstNumber=tap_6, SecondNumber=dam_13)  # -> Equality, Inequality
equals_15 = Equality(FirstNumber=tap_7, SecondNumber=dam_14)  # -> Equality, Inequality
stack_45 = CreateStack(UIElements=entwine_58, Horizontal=True)
bool_15 = Boolean(mod_16)
entwine_60 = Entwine(Branch00=label_41, Branch01=pulldown_22, FlattenInputs=True)  # -> flatten(Result)
stack_46 = CreateStack(UIElements=entwine_59, Horizontal=invert(True))
adjustelem_26 = AdjustElementAppearance(ElementsToAdjust=tb_30, Foreground=ColourSwatch(SwatchColor=RGB(0, 0, 0)), FontSize=Slider(14, range=0..100))
adjustelem_27 = AdjustElementAppearance(ElementsToAdjust=tb_32, Foreground=ColourSwatch(SwatchColor=RGB(0, 0, 0)), FontSize=Slider(14, range=0..100))
filter_17 = StreamFilter(Gate=bool_15, Stream0="Simulation failed...", Stream1="Energy simulation is running...")
format_27 = Format(
    Format="{0}, {1}, 0, {2}",
    Culture=127,
    Data0=Slider(5, range=-25..25),
    Data1=Slider(5, range=-15..15),
    Data2=Slider(5, range=0..100))
stack_47 = CreateStack(UIElements=entwine_60, Horizontal=invert(True))
format_28 = Format(
    Format="{0}, {1}, 0, {2}",
    Culture=127,
    Data0=Slider(10, range=-25..25),
    Data1=Slider(5, range=-15..15),
    Data2=Slider(5, range=0..100))
entwine_61 = Entwine(Branch00=button_30, Branch01=button_31, Branch02=button_7, FlattenInputs=True)  # -> flatten(Result)
entwine_62 = Entwine(Branch00=label_40, Branch01=stack_46, FlattenInputs=True)  # -> flatten(Result)
gate = StreamGate(Stream=filter_17, Gate=freeze_gate_16)  # -> Target0, Target1
format_29 = Format(
    Format="{0}, {1}, 0, {2}",
    Culture=127,
    Data0=Slider(5, range=-25..25),
    Data1=Slider(10, range=0..100),
    Data2=Slider(5, range=0..100))
adjustpos_46 = AdjustElementPositioning(ElementsToAdjust=tb_28, Margin="10, 0, 0, 5", AbsolutePositioning=False, HorizontalAlignment=0)
adjustpos_47 = AdjustElementPositioning(
    ElementsToAdjust=pulldown_21,
    AbsolutePositioning=False,
    Width=Slider(245, range=0..1000),
    Height=Slider(35, range=0..100),
    HorizontalAlignment=0)
adjustpos_48 = AdjustElementPositioning(
    ElementsToAdjust=[slider_7, slider_6],
    Margin="5, 5, 10, 0",
    AbsolutePositioning=False,
    Width=Slider(240, range=0..1000),
    HorizontalAlignment=0)
stack_48 = CreateStack(UIElements=entwine_61, Horizontal=True)
adjustpos_49 = AdjustElementPositioning(
    ElementsToAdjust=[button_30, button_31, button_7, button_6],
    Margin="5, 5, 0, 0",
    AbsolutePositioning=False,
    HorizontalAlignment=0)
entwine_63 = Entwine(Branch00=tb_30, Branch01=stack_47, FlattenInputs=True)  # -> flatten(Result)
entwine_64 = Entwine(Branch00=label_39, Branch01=true_button_24, Branch02=pulldown_20, FlattenInputs=True)  # -> flatten(Result)
adjustpos_50 = AdjustElementPositioning(ElementsToAdjust=tb_30, Margin="5, 10, 0, 5", AbsolutePositioning=False, HorizontalAlignment=0)
adjustpos_51 = AdjustElementPositioning(ElementsToAdjust=tb_32, Margin="10, 5, 0, 10", AbsolutePositioning=False, HorizontalAlignment=0)
adjustpos_52 = AdjustElementPositioning(
    ElementsToAdjust=pulldown_20,
    Margin=format_27,
    AbsolutePositioning=False,
    Width=Slider(245, range=0..300),
    HorizontalAlignment=0,
    VerticalAlignment=2)
adjustpos_53 = AdjustElementPositioning(
    ElementsToAdjust=pulldown_22,
    AbsolutePositioning=False,
    Width=Slider(245, range=0..1000),
    Height=Slider(35, range=0..100),
    HorizontalAlignment=0)
adjustpos_54 = AdjustElementPositioning(ElementsToAdjust=tb_33, Margin="10, 0, 0, 5", AbsolutePositioning=False, HorizontalAlignment=0)
adjustpos_55 = AdjustElementPositioning(ElementsToAdjust=true_button_24, Margin=format_28, AbsolutePositioning=False, HorizontalAlignment=0, VerticalAlignment=2)
adjustpos_56 = AdjustElementPositioning(ElementsToAdjust=tb_34, Margin="10, 0, 0, 5", AbsolutePositioning=False, HorizontalAlignment=0)
adjustpos_57 = AdjustElementPositioning(
    ElementsToAdjust=[button_27, button_28, button_29],
    Margin="5, 5, 0, 0",
    AbsolutePositioning=False,
    HorizontalAlignment=0)
adjustpos_58 = AdjustElementPositioning(ElementsToAdjust=tb_31, Margin="5, 0, 0, 5", AbsolutePositioning=False, HorizontalAlignment=0)
adjustpos_59 = AdjustElementPositioning(
    ElementsToAdjust=tb_6,
    Margin=format_29,
    AbsolutePositioning=False,
    Width=Slider(245, range=0..300),
    HorizontalAlignment=0,
    VerticalAlignment=2)
stack_49 = CreateStack(UIElements=entwine_64, Horizontal=invert(True))
adjustpos_60 = AdjustElementPositioning(ElementsToAdjust=true_button_25, AbsolutePositioning=False, HorizontalAlignment=0)

# ----
gate_2 = StreamGate(Stream="No available simulation for this model.", Gate=freeze_gate_17)  # -> Target0, Target1
gate_3 = StreamGate(Stream="No available simulation for this model.", Gate=freeze_gate_16)  # -> Target0, Target1
adjustpos_61 = AdjustElementPositioning(ElementsToAdjust=tb_29, Margin="5, 0, 0, 5", AbsolutePositioning=False, HorizontalAlignment=0)
hideshow_19 = HideShowElement(ElementToHideShow=tb_10, Show=pre_run_simple_energy_simulations, Collapse=True, Disable=False)

daylight_simulation_type_2 = RemoteReceiver(daylight_simulation_type)
equals_16 = Equality(FirstNumber="5", SecondNumber=daylight_simulation_type_2)  # -> Equality, Inequality

visualize_lca_gwp_by_element_2 = RemoteReceiver(visualize_lca_gwp_by_element)
rec_26 = DataRecorder(visualize_lca_gwp_by_element_2, DataLimit=-2, RecordData=True)
ma_26 = MassAddition(Input=rec_26)  # -> Result, PartialResults
visualize_lca_gwp_by_element_3 = RemoteReceiver(visualize_lca_gwp_by_element)
entwine_65 = Entwine(Branch00=ma_26.Result, Branch01=lca_window_status, FlattenInputs=True)
rec_27 = DataRecorder(entwine_65, DataLimit=2, RecordData=True)
or_8 = GateOr(A=visualize_lca_gwp_by_element_3, B=event_5.Data)
item_6 = ListItem(List=rec_27, Index=0, Wrap=True)  # -> Item2, Item1, Item
py3_8 = Python3Script(get=or_8)  # -> mpl_folder; same code as py3_4
equals_17 = Equality(FirstNumber=item_6.Item2, SecondNumber=item_6.Item1)  # -> Equality, Inequality
bang_3 = ExplodeTree(Data=equals_17.Inequality)  # -> Branch0, Branch1
nextfile_2 = NextAvailableFilename(Format="LCA{000}.png", FolderPath=py3_8, Trigger=or_8)
py3_9 = Python3Script(x=bang_3.Branch0, y=bang_3.Branch1)  # -> a; same code as py3_5
event_21 = EventGate(Data=py3_9)  # -> Data, IsNew
freeze_gate_18 = StreamFreezeGate(Data=py3_9, PassingSwitch=event_21.IsNew)
event_22 = EventGate(Data=freeze_gate_18)  # -> Data, IsNew
launchwin_2 = LaunchWindow(
    Show=event_22.Data,
    Name="LCA visualisations",
    Width=bar_chart_popup_win_width_2,
    Height=bar_chart_popup_win_height_2,
    ChildStatus=1,
    EnableHorizScroll=False)
panel_113 = Panel(event_22.Data)
visualize_lca_gwp_by_element_4 = RemoteReceiver(visualize_lca_gwp_by_element)
winstat_2 = WindowStatus(Window=launchwin_2)
lca_status = RemoteSender(winstat_2)
py3_10 = Python3Script(window=launchwin_2, activate=visualize_lca_gwp_by_element_4)  # same code as py3_6
winprops_2 = SetWindowProperties(
    Window=launchwin_2,
    StartingLocation=pt_8,
    Theme=0,
    AccentColor=heath_accent_color_10,
    ShowTitleBar=True,
    BackgroundColor=RGB(255, 255, 255),
    ScaleFactor=1)

lca_status_2 = RemoteReceiver(lca_status)
expression_8 = Expression(x="Hidden", y=lca_status_2, Expression="x=y")
expire_2 = ExpireObject(ObjectToExpire=objbynn_3, Expire=expression_8)

daylight_simulation_compare_pop_up_2 = RemoteReceiver(daylight_simulation_compare_pop_up)
rec_28 = DataRecorder(daylight_simulation_compare_pop_up_2, DataLimit=-2, RecordData=True)
ma_27 = MassAddition(Input=rec_28)  # -> Result, PartialResults
daylight_simulation_compare_pop_up_3 = RemoteReceiver(daylight_simulation_compare_pop_up)
entwine_66 = Entwine(Branch00=ma_27.Result, Branch01=sda_window_status, FlattenInputs=True)
rec_29 = DataRecorder(entwine_66, DataLimit=2, RecordData=True)
item_7 = ListItem(List=rec_29, Index=0, Wrap=True)  # -> Item2, Item1, Item
and_7 = GateAnd(A=daylight_simulation_compare_pop_up_3, B=event_6.Data)
equals_18 = Equality(FirstNumber=item_7.Item2, SecondNumber=item_7.Item1)  # -> Equality, Inequality
py3_11 = Python3Script(get=and_7)  # -> mpl_folder; same code as py3_4
bang_4 = ExplodeTree(Data=equals_18.Inequality)  # -> Branch0, Branch1
py3_12 = Python3Script(x=bang_4.Branch0, y=bang_4.Branch1)  # -> a; same code as py3_5
nextfile_3 = NextAvailableFilename(Format="SDA{000}.png", FolderPath=py3_11, Trigger=and_7)
event_23 = EventGate(Data=py3_12)  # -> Data, IsNew
freeze_gate_19 = StreamFreezeGate(Data=py3_12, PassingSwitch=event_23.IsNew)
event_24 = EventGate(Data=freeze_gate_19)  # -> Data, IsNew
panel_114 = Panel(event_24.Data)
launchwin_3 = LaunchWindow(
    Show=event_24.Data,
    Name="Spatial daylight autonomy",
    Width=bar_chart_popup_win_width_4,
    Height=bar_chart_popup_win_height_4,
    ChildStatus=1,
    EnableHorizScroll=False)
daylight_simulation_compare_pop_up_4 = RemoteReceiver(daylight_simulation_compare_pop_up)
winstat_3 = WindowStatus(Window=launchwin_3)
winprops_3 = SetWindowProperties(
    Window=launchwin_3,
    StartingLocation=pt_10,
    Theme=0,
    AccentColor=heath_accent_color_11,
    ShowTitleBar=True,
    BackgroundColor=RGB(255, 255, 255),
    ScaleFactor=1)
spacial_daylight_autonomy_status = RemoteSender(winstat_3)
py3_13 = Python3Script(window=launchwin_3, activate=daylight_simulation_compare_pop_up_4)  # same code as py3_6

spacial_daylight_autonomy_status_2 = RemoteReceiver(spacial_daylight_autonomy_status)
expression_9 = Expression(x="Hidden", y=spacial_daylight_autonomy_status_2, Expression="x=y")
expire_3 = ExpireObject(ObjectToExpire=objbynn_5, Expire=expression_9)

# ---- group: Geometry module
# IMPORT GEOMETRY
panel_115 = Panel("""This document is currently in {0}.
Honeybee models require models in meters.""")
panel_116 = Panel("""Room
Window
Adjacent
Context
None""")
panel_117 = Panel("""None
Room
Window
Adjacent
Context
All""")
panel_118 = Panel("""Could not save geometry. 
It was not of the correct type.""")  # disabled
number_slider_25 = Slider(10, range=0..10)
number_slider_26 = Slider(30, range=5..95)
button_32 = CreateButton(ButtonName="Change document units", ButtonStyle=0)
tb_35 = CreateTextBlock(TextSize=12, Justification=0)
listbox = CreateListBox(ListItems=panel_117, SelectedIndex=0, Height=100)
pulldown_23 = CreatePulldownMenu(Label="Geometry type", ListItems=panel_116, showLabel=True)
button_33 = CreateButton(ButtonName="Save geometry", ButtonStyle=0)
values_104 = ValueListener(Elements=button_33, SomeProperty=True)  # -> Values, Indices
label_48 = CreateLabel(LabelText=panel_118, LabelSize=12, Justification=0)  # disabled
presavegeometry = RemoteSender(values_104.Values)
label_49 = CreateLabel(LabelText="Preview geometry", LabelSize=18, Justification=0)
rectangle = Rectangle(Plane=PlaneXY(0, 0, 0), XSize=number_slider_25, YSize=number_slider_25, Radius=0)  # -> Rectangle, Length
checkbox_6 = CreateCheckbox(Label="Window generation from window-wall-ratio [%]", StartingValue=False)
label_50 = CreateLabel(LabelText="Automatically generate windows", LabelSize=18, Justification=0)
number_slider_27 = Slider(15, range=0..20)
slider_8 = CreateSlider(
    Slider=number_slider_26,
    SnapValue=Slider(5, range=0..10),
    ShowBounds=True,
    ShowTicks=True,
    ShowTooltip=True,
    ShowValLabel=True,
    showLabel=True)
values_105 = ValueListener(Elements=listbox, SomeProperty=True)  # -> Values, Indices
values_106 = ValueListener(Elements=pulldown_23, SomeProperty=True)  # -> Values, Indices
values_107 = ValueListener(Elements=button_32, SomeProperty=True)  # -> Values, Indices
pt_11 = ConstructPoint(XCoordinate=Slider(10, range=0..10), YCoordinate=Slider(-20, range=-100..0), ZCoordinate=0)
bool_16 = Boolean(values_105.Indices)
previewtype = RemoteSender(values_105.Values)
change_document_units = RemoteSender(values_107.Values)
adjustelem_28 = AdjustElementAppearance(ElementsToAdjust=tb_35, Foreground=ColourSwatch(SwatchColor=RGB(0, 0, 0)))
geometrytype = RemoteSender(values_106.Values)
geometrytype_validate = RemoteSender(values_106.Indices)
shapes = CreateShapes(Shapes=rectangle.Rectangle, StrokeColor=RGB(0, 0, 0), Scale=1, ClickMode=3)  # -> flatten(Shape)
values_108 = ValueListener(Elements=slider_8, SomeProperty=True)  # -> Values, Indices
rectangle_2 = Rectangle(Plane=pt_11, XSize=number_slider_27, YSize=number_slider_27, Radius=0)  # -> Rectangle, Length
tooltip_8 = AttachTooltipToElement(ElementsToAttachTo=slider_8, TooltipContent="Doubleclick to input value", ShowDelay=500, Duration=2000)
setlist = SetListContents(ListToModify=pulldown_23, NewListContents=panel_116)
values_109 = ValueListener(Elements=checkbox_6, SomeProperty=True)  # -> Values, Indices
entwine_67 = Entwine(Branch00=checkbox_6, Branch01=slider_8, FlattenInputs=True)  # -> flatten(Result)
filter_18 = StreamFilter(Gate=values_109.Values, Stream0="0", Stream1=values_108.Values)
entwine_68 = Entwine(Branch00=tb_35, Branch01=button_32, FlattenInputs=True)  # -> flatten(Result)
division_6 = Division(A=filter_18, B="100")
stack_50 = CreateStack(UIElements=entwine_67, Horizontal=invert(True))
stack_51 = CreateStack(UIElements=entwine_68, Horizontal=invert(True))
generate_wwr = RemoteSender(division_6)
hideshow_20 = HideShowElement(ElementToHideShow=slider_8, Show=values_109.Values, Collapse=True, Disable=False)
entwine_69 = Entwine(Branch00=label_50, Branch01=stack_50, FlattenInputs=True)  # -> flatten(Result)
adjustpos_62 = AdjustElementPositioning(
    ElementsToAdjust=listbox,
    AbsolutePositioning=False,
    Width=Slider(150, range=0..300),
    Height=Slider(150, range=0..300),
    HorizontalAlignment=0)
# FLY!
# Simulations
# Metahopper recursions
# Launch website
entwine_70 = Entwine(Branch00=stack_26, Branch01=tb_27, Branch02=pulldown_23, Branch03=button_33, FlattenInputs=True)  # -> flatten(Result)
adjustpos_63 = AdjustElementPositioning(
    ElementsToAdjust=stack_51,
    Margin="0, 5, 0, 5",
    AbsolutePositioning=False,
    Width=Slider(250, range=0..800),
    HorizontalAlignment=1)
swatch_3 = ColourSwatch(SwatchColor=RGB(255, 0, 0))  # disabled
swatch_4 = ColourSwatch(SwatchColor=RGBA(128, 0, 102, 100))
stack_52 = CreateStack(UIElements=entwine_69, Horizontal=invert(True))
swatch_5 = ColourSwatch(SwatchColor=RGBA(4, 128, 0, 100))
swatch_6 = ColourSwatch(SwatchColor=RGBA(0, 17, 128, 100))
swatch_7 = ColourSwatch(SwatchColor=RGBA(128, 125, 0, 100))
border = CreateBorder(
    UIElement=stack_51,
    BorderThickness=Slider(1, range=0..10),
    BorderColor=ColourSwatch(SwatchColor=RGB(255, 0, 0)),
    CornerRadius=Slider(0, range=0..10))
adjustpos_64 = AdjustElementPositioning(ElementsToAdjust=slider_8, Margin="0, 10, 0, 0", AbsolutePositioning=False, HorizontalAlignment=0, VerticalAlignment=2)
stack_53 = CreateStack(UIElements=entwine_70, Horizontal=invert(True))
adjustpos_65 = AdjustElementPositioning(
    ElementsToAdjust=[button_33, pulldown_23],
    AbsolutePositioning=False,
    Width=Slider(180, range=0..300),
    HorizontalAlignment=0)
adjustelem_29 = AdjustElementAppearance(ElementsToAdjust=label_48, Foreground=swatch_3)  # disabled
setshapes = SetShapes(
    ShapeToModify=shapes,
    ShapeCurves=rectangle_2.Rectangle,
    FillColors=ColourSwatch(SwatchColor=RGB(180, 180, 180)),
    StrokeColors=ColourSwatch(SwatchColor=RGB(255, 255, 255)),
    Scale=1)

# ----
shapes_2 = CreateShapes(Shapes=rectangle.Rectangle, StrokeColor=RGB(0, 0, 0), Scale=1, ClickMode=3)  # -> flatten(Shape)
shapes_3 = CreateShapes(Shapes=rectangle.Rectangle, StrokeColor=RGB(0, 0, 0), Scale=1, ClickMode=3)  # -> flatten(Shape)
shapes_4 = CreateShapes(Shapes=rectangle.Rectangle, StrokeColor=RGB(0, 0, 0), Scale=1, ClickMode=3)  # -> flatten(Shape)
shapes_5 = CreateShapes(Shapes=rectangle.Rectangle, StrokeColor=RGB(0, 0, 0), Scale=1, ClickMode=3)  # -> flatten(Shape)
shapes_6 = CreateShapes(Shapes=rectangle.Rectangle, StrokeColor=RGB(0, 0, 0), Scale=1, ClickMode=3)  # -> flatten(Shape)

# ---- group: Geometry module
# Document units
doc_units = DocumentUnits()
change_document_units_2 = RemoteReceiver(change_document_units)
document_units = RemoteSender(doc_units)
gate_4 = StreamGate(Stream="4", Gate=change_document_units_2)  # -> Target0, Target1
unit_warning = UnitWarning(UnitSystem=gate_4.Target1)

# ----
entwine_71 = Entwine(
    Branch00=shapes,
    Branch01=shapes_2,
    Branch02=shapes_3,
    Branch03=shapes_6,
    Branch04=shapes_4,
    Branch05=shapes_5,
    FlattenInputs=True)  # -> flatten(Result)
adjustpos_66 = AdjustElementPositioning(ElementsToAdjust=button_32, AbsolutePositioning=False, HorizontalAlignment=1)
setshapes_2 = SetShapes(
    ShapeToModify=shapes_2,
    ShapeCurves=rectangle_2.Rectangle,
    FillColors=swatch_5,
    StrokeColors=ColourSwatch(SwatchColor=RGB(255, 255, 255)),
    Scale=1)
setshapes_3 = SetShapes(
    ShapeToModify=shapes_3,
    ShapeCurves=rectangle_2.Rectangle,
    FillColors=swatch_4,
    StrokeColors=ColourSwatch(SwatchColor=RGB(255, 255, 255)),
    Scale=1)
setshapes_4 = SetShapes(
    ShapeToModify=shapes_6,
    ShapeCurves=rectangle_2.Rectangle,
    FillColors=swatch_6,
    StrokeColors=ColourSwatch(SwatchColor=RGB(255, 255, 255)),
    Scale=1)
setshapes_5 = SetShapes(
    ShapeToModify=shapes_4,
    ShapeCurves=rectangle_2.Rectangle,
    FillColors=swatch_7,
    StrokeColors=ColourSwatch(SwatchColor=RGB(255, 255, 255)),
    Scale=1)
setshapes_6 = SetShapes(
    ShapeToModify=shapes_5,
    ShapeCurves=rectangle_2.Rectangle,
    FillColors=ColourSwatch(SwatchColor=RGB(230, 230, 230)),
    StrokeColors=ColourSwatch(SwatchColor=RGB(255, 255, 255)),
    Scale=1)

# ----
# Document unit warning text
location_6 = Data(border)

# ----
# Generate using WWR
location_7 = Data(stack_52)

# ----
# Assign type
assign_type = Data(stack_53)

entwine_72 = Entwine(Branch00=location_6, Branch01=assign_type, FlattenInputs=True)  # -> flatten(Result)
stack_54 = CreateStack(UIElements=entwine_72, Horizontal=invert(True))

presavegeometry_2 = RemoteReceiver(presavegeometry)
document_units_2 = RemoteReceiver(document_units)
previewtype_2 = RemoteReceiver(previewtype)
document_units_3 = RemoteReceiver(document_units)
document_units_4 = RemoteReceiver(document_units)
document_units_5 = RemoteReceiver(document_units)
previewtype_3 = RemoteReceiver(previewtype)
previewtype_4 = RemoteReceiver(previewtype)
previewtype_5 = RemoteReceiver(previewtype)
expression_10 = Expression(x="Room", y=previewtype_2, Expression="x=y")
expression_11 = Expression(x=document_units_2, y="Meters", Expression="x=y")
expression_12 = Expression(x=previewtype_2, y="All", Expression="x=y")
expression_13 = Expression(x=document_units_3, y="Meters", Expression="x=y")
expression_14 = Expression(x=document_units_4, y="Meters", Expression="x=y")
expression_15 = Expression(x=document_units_5, y="Meters", Expression="x=y")
expression_16 = Expression(x="Window", y=previewtype_5, Expression="x=y")
expression_17 = Expression(x=previewtype_5, y="All", Expression="x=y")
expression_18 = Expression(x="Adjacent", y=previewtype_3, Expression="x=y")
expression_19 = Expression(x=previewtype_3, y="All", Expression="x=y")
expression_20 = Expression(x=previewtype_4, y="All", Expression="x=y")
expression_21 = Expression(x="Context", y=previewtype_4, Expression="x=y")
geometrytype_2 = RemoteReceiver(geometrytype)
or_9 = GateOr(A=expression_10, B=expression_12)
or_10 = GateOr(A=expression_16, B=expression_17)
or_11 = GateOr(A=expression_21, B=expression_20)
or_12 = GateOr(A=expression_18, B=expression_19)
gate_5 = StreamGate(Stream="Room", Gate=or_9)  # -> Target0, Target1
gate_6 = StreamGate(Stream="Adjacent", Gate=or_12)  # -> Target0, Target1
gate_7 = StreamGate(Stream="Window", Gate=or_10)  # -> Target0, Target1
gate_8 = StreamGate(Stream="Context", Gate=or_11)  # -> Target0, Target1
geometrytype_validate_2 = RemoteReceiver(geometrytype_validate)

# ----
# Cyclops
panel_119 = Panel("""Sunlight hour analysis
Sky component analysis
Culmulative radiation
Daylight factor
Useful daylight illuminance
Daylight autonomy
Daylight metrics""")
panel_120 = Panel("""10000
500
60000""")
panel_121 = Panel("""From selected model
Live from Rhino import""")
opacity = Slider(30, range=0..255)
number_slider_28 = Slider(30, range=5..95)
dom_3 = ConstructDomain(DomainStart=0, DomainEnd="1200")
dom_4 = ConstructDomain(DomainStart=0, DomainEnd="20")
dom_5 = ConstructDomain(DomainStart=0, DomainEnd="100")
dom_6 = ConstructDomain(DomainStart=0, DomainEnd="10")
panel_122 = Panel("""Average
Minimum
Maximum""")
radiobtn = CreateRadioButton(RadioButtonName=panel_121, RadioButtonGroup="0", InitiallySelected=invert(False))
checkbox_7 = CreateCheckbox(Label="Window generation from window-wall-ratio [%]", StartingValue=False)
label_51 = CreateLabel(LabelText="Automatically generate windows", LabelSize=18, Justification=0)
button_34 = CreateButton(ButtonName="Zoom", ButtonStyle=0)
pulldown_24 = CreatePulldownMenu(Label="Select simulation", ListItems=panel_119, SelectedIndex="0", showLabel=False)
button_35 = CreateButton(ButtonName="Bake", ButtonStyle=0)
values_110 = ValueListener(Elements=button_35, SomeProperty=True)  # -> Values, Indices
label_52 = CreateLabel(LabelText="Select input geometry", LabelSize=18, Justification=0)
label_53 = CreateLabel(LabelText="No model selected...", LabelSize=12, Justification=1)
label_54 = CreateLabel(LabelText="Select daylight simulation", LabelSize=18, Justification=0)
label_55 = CreateLabel(LabelText="Preview geometry", LabelSize=18, Justification=0)
slider_9 = CreateSlider(
    Slider=opacity,
    SnapValue=Slider(5, range=0..10),
    ShowBounds=False,
    ShowTicks=False,
    ShowTooltip=True,
    ShowValLabel=False,
    showLabel=True)
slider_10 = CreateSlider(
    Slider=number_slider_28,
    SnapValue=Slider(5, range=0..10),
    ShowBounds=True,
    ShowTicks=True,
    ShowTooltip=True,
    ShowValLabel=True,
    showLabel=True)
freeze_gate_20 = StreamFreezeGate(Data=values_110.Values, PassingSwitch=invert(values_110.Values))
checkbox_8 = CreateCheckbox(Label="Filter results below a certain threshold", StartingValue=False)
slider_11 = CreateSlider(Slider=Slider(0, range=0..2000), ShowBounds=False, ShowTicks=False, ShowTooltip=True, ShowValLabel=True, showLabel=False)
pulldown_25 = CreatePulldownMenu(Label="Illuminance", ListItems=panel_122, showLabel=True)
label_56 = CreateLabel(LabelText="Amount of geometry above the threshold: %", LabelSize=12, Justification=0)
values_111 = ValueListener(Elements=button_34, SomeProperty=True)  # -> Values, Indices
bool_17 = Boolean(invert(freeze_gate_20))
values_112 = ValueListener(Elements=pulldown_24, SomeProperty=True)  # -> Values, Indices
stack_55 = CreateStack(UIElements=radiobtn, Horizontal=invert(True))
values_113 = ValueListener(Elements=radiobtn, SomeProperty=True)  # -> flatten(Values), Indices
values_114 = ValueListener(Elements=slider_9, SomeProperty=True)  # -> Values, Indices
values_115 = ValueListener(Elements=slider_10, SomeProperty=True)  # -> Values, Indices
tooltip_9 = AttachTooltipToElement(ElementsToAttachTo=slider_9, TooltipContent="Doubleclick to input value", ShowDelay=500, Duration=2000)
rec_30 = DataRecorder(bool_17, DataLimit=-10, RecordData=True)
tooltip_10 = AttachTooltipToElement(ElementsToAttachTo=slider_10, TooltipContent="Doubleclick to input value", ShowDelay=500, Duration=2000)
values_116 = ValueListener(Elements=pulldown_25, SomeProperty=True)  # -> Values, Indices
zoom_cyclops_visualization = RemoteSender(values_111.Values)
values_117 = ValueListener(Elements=checkbox_8, SomeProperty=True)  # -> Values, Indices
cyclops_select_simulation = RemoteSender(values_112.Values)
cyclops_select_simulation_index = RemoteSender(values_112.Indices)
cyclops_select_simulation_index_2 = RemoteReceiver(cyclops_select_simulation_index)
cyclops_select_simulation_index_3 = RemoteReceiver(cyclops_select_simulation_index)
larger = LargerThan(FirstNumber=cyclops_select_simulation_index_3, SecondNumber="2")  # -> LargerThan, OrEqualTo
filter_19 = StreamFilter(
    Gate=cyclops_select_simulation_index_2,
    Stream0=Slider(6, range=0..10),
    Stream1="27",
    Stream2=Slider(700, range=0..1000),
    Stream3="1",
    Stream4="0",
    Stream5="0",
    Stream6="0")
values_118 = ValueListener(Elements=checkbox_7, SomeProperty=True)  # -> Values, Indices
cull_2 = CullPattern(List=values_113.Values, CullPattern=values_113.Values)
cyclops_preview_opacity = RemoteSender(values_114.Values)
entwine_73 = Entwine(Branch00=stack_55, Branch01=label_53, FlattenInputs=True)  # -> flatten(Result)
int_9 = Integer(rec_30)
cyclops_filter_checkbox = RemoteSender(values_117.Values)
cyclops_select_simulation_2 = RemoteReceiver(cyclops_select_simulation)
cyclops_metric_option = RemoteSender(values_116.Indices)
cyclops_metric_option_2 = RemoteReceiver(cyclops_metric_option)
item_8 = ListItem(List=panel_120, Index=cyclops_metric_option_2, Wrap=True)
dom_7 = ConstructDomain(DomainStart=0, DomainEnd=item_8)
filter_20 = StreamFilter(
    Gate=cyclops_select_simulation_index_2,
    Stream0=dom_6,
    Stream1=dom_5,
    Stream2=dom_3,
    Stream3=dom_4,
    Stream4=dom_5,
    Stream5=dom_5,
    Stream6=dom_7)
setslider_3 = SetSlider(UISlider=slider_11, Value=filter_19, Range=filter_20)
entwine_74 = Entwine(Branch00=checkbox_7, Branch01=slider_10, FlattenInputs=True)  # -> flatten(Result)
filter_21 = StreamFilter(Gate=values_118.Values, Stream0="0", Stream1=values_115.Values)
entwine_75 = Entwine(Branch00=pulldown_24, Branch01=button_34, Branch02=button_35, FlattenInputs=True)  # -> flatten(Result)
index = ItemIndex(List=values_113.Values, Item=cull_2)
ma_28 = MassAddition(Input=int_9)  # -> Result, PartialResults
values_119 = ValueListener(Elements=slider_11, SomeProperty=True)  # -> Values, Indices
cyclops_filter_checkbox_2 = RemoteReceiver(cyclops_filter_checkbox)
adjustelem_30 = AdjustElementAppearance(ElementsToAdjust=label_53, Foreground=ColourSwatch(SwatchColor=RGB(255, 0, 0)), FontSize=Slider(10, range=5..25))
stack_56 = CreateStack(UIElements=entwine_73, Horizontal=True)
division_7 = Division(A=filter_21, B="100")
stack_57 = CreateStack(UIElements=entwine_74, Horizontal=invert(True))
event_25 = EventGate(Data=ma_28.Result)  # -> Data, IsNew
cyclops_select_geometry = RemoteSender(index)
stack_58 = CreateStack(UIElements=entwine_75, Horizontal=True)
cyclops_slider_value = RemoteSender(values_119.Values)
expression_22 = Expression(x="Daylight metrics", y=cyclops_select_simulation_2, Expression="x=y")
cyclops_generate_wwr = RemoteSender(division_7)
tab_load_inspect_model_10 = RemoteReceiver(tab_load_inspect_model)
dam_15 = DataDam(DataA=event_25.Data, BufferDelay=2500000, BufferMode=2)
hideshow_21 = HideShowElement(ElementToHideShow=[label_56, slider_11], Show=cyclops_filter_checkbox_2, Collapse=True, Disable=False)
tooltip_11 = AttachTooltipToElement(ElementsToAttachTo=slider_11, TooltipContent="Doubleclick to input value", ShowDelay=500, Duration=2000)
hideshow_22 = HideShowElement(ElementToHideShow=pulldown_25, Show=expression_22, Collapse=True, Disable=False)
equals_19 = Equality(FirstNumber=event_25.Data, SecondNumber=dam_15)  # -> Equality, Inequality
entwine_76 = Entwine(Branch00=label_55, Branch01=slider_9, FlattenInputs=True)  # -> flatten(Result)
entwine_77 = Entwine(Branch00=label_51, Branch01=stack_57, FlattenInputs=True)  # -> flatten(Result)
entwine_78 = Entwine(Branch00=pulldown_25, Branch01=checkbox_8, Branch02=slider_11, Branch03=label_56, FlattenInputs=True)  # -> flatten(Result)
adjustpos_67 = AdjustElementPositioning(ElementsToAdjust=slider_9, Margin="0, 10, 0, 0", AbsolutePositioning=False, HorizontalAlignment=0, VerticalAlignment=2)
adjustpos_68 = AdjustElementPositioning(ElementsToAdjust=slider_10, Margin="0, 10, 0, 0", AbsolutePositioning=False, HorizontalAlignment=0, VerticalAlignment=2)
hideshow_23 = HideShowElement(ElementToHideShow=slider_10, Show=values_118.Values, Collapse=True, Disable=False)
event_26 = EventGate(Data=equals_19.Inequality)  # -> Data, IsNew
adjustpos_69 = AdjustElementPositioning(
    ElementsToAdjust=pulldown_24,
    Margin="0, 0, 0, 0",
    AbsolutePositioning=False,
    Width=Slider(200, range=0..350),
    Height=Slider(38, range=0..100),
    HorizontalAlignment=0)
stack_59 = CreateStack(UIElements=entwine_76, Horizontal=invert(True))
stack_60 = CreateStack(UIElements=entwine_77, Horizontal=invert(True))
adjustpos_70 = AdjustElementPositioning(
    ElementsToAdjust=pulldown_25,
    Margin="0, 0, 0, 0",
    AbsolutePositioning=False,
    Width=Slider(200, range=0..1000),
    HorizontalAlignment=0)
stack_61 = CreateStack(UIElements=entwine_78, Horizontal=invert(True))
adjustpos_71 = AdjustElementPositioning(
    ElementsToAdjust=slider_11,
    Margin="0, 5, 0, -5",
    AbsolutePositioning=False,
    Width=Slider(300, range=0..1000),
    HorizontalAlignment=0)

entwine_79 = Entwine(Branch00=label_54, Branch01=button_8, FlattenInputs=True)  # -> flatten(Result)
stack_62 = CreateStack(UIElements=entwine_79, Horizontal=True)

# ----
# Live from Rhino
windows = Curve([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])  # disabled
windows_2 = Curve([<curve referenced from the Rhino model> x3])  # disabled
context = Geometry(<extrusion referenced from the Rhino model>)  # disabled
cyclops_select_geometry_2 = RemoteReceiver(cyclops_select_geometry)  # disabled
rooms = Geometry(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)  # disabled
rooms_2 = Geometry(<extrusion referenced from the Rhino model>)  # disabled
merge_3 = Merge(Data1=rooms, Data2=rooms_2)  # disabled
merge_4 = Merge(Data1=windows, Data2=windows_2)  # disabled

cyclops_metric_option_3 = RemoteReceiver(cyclops_metric_option)  # disabled
cyclops_slider_value_2 = RemoteReceiver(cyclops_slider_value)  # disabled
cyclops_slider_value_3 = RemoteReceiver(cyclops_slider_value)  # disabled
cyclops_slider_value_4 = RemoteReceiver(cyclops_slider_value)  # disabled
cyclops_slider_value_5 = RemoteReceiver(cyclops_slider_value)  # disabled
division_8 = Division(A=cyclops_slider_value_2, B=panel_35)  # disabled
cyclops_filter_checkbox_3 = RemoteReceiver(cyclops_filter_checkbox)  # disabled
division_9 = Division(A=cyclops_slider_value_3, B=panel_36)  # disabled
cyclops_filter_checkbox_4 = RemoteReceiver(cyclops_filter_checkbox)  # disabled
division_10 = Division(A=cyclops_slider_value_4, B=panel_37)  # disabled
cyclops_filter_checkbox_5 = RemoteReceiver(cyclops_filter_checkbox)  # disabled
cyclops_select_simulation_index_4 = RemoteReceiver(cyclops_select_simulation_index)  # disabled

cyclops_select_simulation_3 = RemoteReceiver(cyclops_select_simulation)
expression_23 = Expression(x=panel_45, y=cyclops_select_simulation_3, Expression="x=y")
expression_24 = Expression(x=cyclops_select_simulation_3, y="Sunlight hour analysis", Expression="x=y")
expression_25 = Expression(x=cyclops_select_simulation_3, y="Culmulative radiation", Expression="x=y")
or_13 = GateOr(A=expression_23, B=expression_24, C=expression_25)
not = GateNot(A=or_13)

# ---- group: Geometry module (continued)
document_units_6 = RemoteReceiver(document_units)
case = TextCase(Text=document_units_6, Culture=127)  # -> UpperCase, LowerCase
format_30 = Format(Format=panel_115, Culture=127, Data0=case.LowerCase)
settextblock_4 = SetTextBlockContents(TextBlockToModify=tb_35, NewTextBlockContents=format_30)
stack_63 = CreateStack(UIElements=entwine_71, Horizontal=invert(True))
document_units_7 = RemoteReceiver(document_units)
entwine_80 = Entwine(Branch00=stack_63, Branch01=listbox, FlattenInputs=True)  # -> flatten(Result)
stack_64 = CreateStack(UIElements=entwine_80, Horizontal=True)
expression_26 = Expression(x=document_units_7, y="Meters", Expression="x=y")
entwine_81 = Entwine(Branch00=label_49, Branch01=stack_64, FlattenInputs=True)  # -> flatten(Result)
adjustpos_72 = AdjustElementPositioning(
    ElementsToAdjust=[shapes_5, shapes_4, shapes_6, shapes_3, shapes_2, shapes],
    Margin=format_10,
    AbsolutePositioning=False,
    HorizontalAlignment=0)
hideshow_24 = HideShowElement(ElementToHideShow=border, Show=invert(expression_26), Collapse=True, Disable=False)
adjustpos_73 = AdjustElementPositioning(ElementsToAdjust=stack_63, Margin=format_11, AbsolutePositioning=False, HorizontalAlignment=0)

# ----
# Preview
preview = Data(entwine_81)

freeze_gate_21 = StreamFreezeGate(Data=values_104.Values, PassingSwitch=invert(values_104.Values))
bool_18 = Boolean(invert(freeze_gate_21))
tap_8 = TapBuffer(Reset=False, Incremental=True, Valve=bool_18, Hold=True)
tab_create_model_4 = RemoteReceiver(tab_create_model)
dam_16 = DataDam(DataA=tap_8, BufferDelay=2500000, BufferMode=2)
equals_20 = Equality(FirstNumber=tap_8, SecondNumber=dam_16)  # -> Equality, Inequality

# ---- group: Construction module (continued)
button_36 = CreateButton(ButtonName=repeat, ButtonStyle=0)
values_120 = ValueListener(Elements=button_36, SomeProperty=True)  # -> flatten(Values), Indices
adjustelem_31 = AdjustElementAppearance(
    ElementsToAdjust=[true_button_23, button_36],
    Foreground=ColourSwatch(SwatchColor=RGB(102, 51, 0)),
    FontSize=Slider(14, range=10..25))
adjustpos_74 = AdjustElementPositioning(
    ElementsToAdjust=[true_button_23, button_36],
    Margin="-5, 0, 0, 0",
    AbsolutePositioning=False,
    Width=number_slider_23,
    Height=number_slider_23,
    HorizontalAlignment=0)

# ----
ma_29 = MassAddition(Input=values_120.Values)  # -> Result, PartialResults
bool_19 = Boolean(ma_29.Result)
item_9 = ListItem(List=button_36, Index=0, Wrap=True)  # -> Item, Item1, Item2, Item3
entwine_82 = Entwine(Branch00=pulldown_12, Branch01=item_9.Item, FlattenInputs=True)  # -> flatten(Result)
entwine_83 = Entwine(Branch00=pulldown_16, Branch01=item_9.Item1, FlattenInputs=True)  # -> flatten(Result)
entwine_84 = Entwine(Branch00=pulldown_14, Branch01=item_9.Item2, FlattenInputs=True)  # -> flatten(Result)
entwine_85 = Entwine(Branch00=pulldown_13, Branch01=item_9.Item3, FlattenInputs=True)  # -> flatten(Result)
stack_65 = CreateStack(UIElements=entwine_82, Horizontal=True)
stack_66 = CreateStack(UIElements=entwine_83, Horizontal=True)
stack_67 = CreateStack(UIElements=entwine_84, Horizontal=True)
stack_68 = CreateStack(UIElements=entwine_85, Horizontal=True)

# ---- group: Construction module (continued)
freeze_gate_22 = StreamFreezeGate(Data=bool_19, PassingSwitch=bool_19)
load_construction_database = RemoteSender(bool_19)
bool_20 = Boolean(invert(freeze_gate_22))
oilcan = OilCan(DataList=panel_99, Reset=recompute_3, Drop=bool_19, DropMode=3)
event_27 = EventGate(Data=oilcan)  # -> Data, IsNew
ping_open_construction_database = RemoteSender(bool_20)
open_construction_database = RemoteSender(event_27.Data)

# ---- group: Program module (continued)
occupancy = RemoteSender(division_5)

# ----
occupancy_2 = RemoteReceiver(occupancy)

show_honeybee_element = RemoteSender(and_6)

show_honeybee_element_2 = RemoteReceiver(show_honeybee_element)

# ---- group: Analysis module (continued)
settextblock_5 = SetTextBlockContents(TextBlockToModify=tb_29, NewTextBlockContents=gate_2.Target1)
settextblock_6 = SetTextBlockContents(TextBlockToModify=tb_31, NewTextBlockContents=gate_3.Target1)

# ----
# Select subset construction
data_5 = Data(pulldown_10)
data_6 = Data(stack_65)
data_7 = Data(stack_42)
data_8 = Data(pulldown_17)
data_9 = Data(stack_67)
data_10 = Data(pulldown_15)
data_11 = Data(stack_66)
data_12 = Data(stack_68)
entwine_86 = Entwine(Branch00=data_7, Branch02=data_6, Branch04=data_11, Branch05=data_9, Branch07=data_12, FlattenInputs=True)  # -> flatten(Result)

stack_69 = CreateStack(UIElements=entwine_86, Horizontal=invert(True))

location_8 = Data(stack_69)

# ----
# Calculare LCA
entwine_87 = Entwine(
    Branch00=stack_14,
    Branch01=tb_16,
    Branch02=button_5,
    Branch03=tb_6,
    Branch04=label_43,
    Branch05=label_44,
    Branch06=label_42,
    Branch07=label_46,
    Branch08=label_45,
    Branch09=label_47,
    Branch010=true_button_25,
    Branch011=tb_34,
    FlattenInputs=True)  # -> flatten(Result)
stack_70 = CreateStack(UIElements=entwine_87, Horizontal=invert(True))
expander_6 = CreateExpander(UIElements=stack_70, Header="LCA calculation", Open=invert(True))
adjustpos_75 = AdjustElementPositioning(ElementsToAdjust=expander_6, AbsolutePositioning=False, Width=Slider(300, range=100..500), HorizontalAlignment=0)

entwine_88 = Entwine(Branch00=expander_6, Branch01=true_button_4, FlattenInputs=True)  # -> flatten(Result)
stack_71 = CreateStack(UIElements=entwine_88, Horizontal=True)
daylight_simulations = Data(stack_71)

# ----
# Run daylight simulations
entwine_89 = Entwine(
    Branch00=stack_24,
    Branch01=tb_25,
    Branch02=stack_48,
    Branch03=tb_2,
    Branch04=tb_11,
    Branch05=tb_29,
    Branch06=entwine_63,
    Branch07=tb_33,
    Branch08=stack_49,
    FlattenInputs=True)  # -> flatten(Result)
stack_72 = CreateStack(UIElements=entwine_89, Horizontal=invert(True))
expander_7 = CreateExpander(UIElements=stack_72, Header="Daylight simulation", Open=invert(True))
values_121 = ValueListener(Elements=expander_7, SomeProperty=True)  # -> Values, Indices
daylight_expander_is_open = RemoteSender(values_121.Values)

entwine_90 = Entwine(Branch00=expander_7, Branch01=true_button_5, FlattenInputs=True)  # -> flatten(Result)
stack_73 = CreateStack(UIElements=entwine_90, Horizontal=True)
daylight_simulations_2 = Data(stack_73)

daylight_expander_is_open_2 = RemoteReceiver(daylight_expander_is_open)
daylight_expander_is_open_3 = RemoteReceiver(daylight_expander_is_open)

entwine_91 = Entwine(
    Branch00=stack_18,
    Branch01=tb_20,
    Branch02=label_52,
    Branch03=stack_56,
    Branch04=label_55,
    Branch05=stack_59,
    Branch06=stack_60,
    Branch07=stack_62,
    Branch08=stack_58,
    Branch09=stack_61,
    FlattenInputs=True)  # -> flatten(Result)
stack_74 = CreateStack(UIElements=entwine_91, Horizontal=invert(True))

expander_8 = CreateExpander(UIElements=stack_74, Header="Cyclops - experimental daylight simulation", Open=invert(True))
gate_9 = StreamGate(Stream=expander_8, Gate=enable_cyclops_3)  # -> Target0, Target1
values_122 = ValueListener(Elements=gate_9.Target1, SomeProperty=True)  # -> Values, Indices
expander_cyclops_daylight_approximation = RemoteSender(values_122.Values)
expander_cyclops_daylight_approximation_2 = RemoteReceiver(expander_cyclops_daylight_approximation)  # disabled

# ----
# Run energy simulations
entwine_92 = Entwine(
    Branch00=stack_15,
    Branch01=tb_17,
    Branch02=stack_45,
    Branch03=tb_10,
    Branch04=tb_31,
    Branch05=tb_3,
    Branch06=tb_32,
    Branch07=entwine_62,
    Branch08=tb_28,
    Branch09=stack_5,
    FlattenInputs=True)  # -> flatten(Result)
stack_75 = CreateStack(UIElements=entwine_92, Horizontal=invert(True))
expander_9 = CreateExpander(UIElements=stack_75, Header="Energy simulation", Open=invert(True))
values_123 = ValueListener(Elements=expander_9, SomeProperty=True)  # -> Values, Indices
simple_energy_expander_is_open = RemoteSender(values_123.Values)

entwine_93 = Entwine(Branch00=expander_9, Branch01=true_button_6, FlattenInputs=True)  # -> flatten(Result)
stack_76 = CreateStack(UIElements=entwine_93, Horizontal=True)
energy_simulations = Data(stack_76)

# ----
# Launch cyclops info
panel_123 = Panel("""https://docs.cyclops.fosterandpartners.com/Analyse/Environment/SunlightHour
https://docs.cyclops.fosterandpartners.com/Analyse/Environment/SkyComponent
https://docs.cyclops.fosterandpartners.com/Analyse/Environment/Radiation/#cumulative-radiation
https://docs.cyclops.fosterandpartners.com/Analyse/Environment/Daylight/#daylight-factor
https://docs.cyclops.fosterandpartners.com/Analyse/Environment/Daylight/#useful-daylight-illuminance
https://docs.cyclops.fosterandpartners.com/Analyse/Environment/Daylight/#daylight-autonomy
https://docs.cyclops.fosterandpartners.com/Analyse/Environment/Daylight/#daylight-metrics""")
cyclops_select_simulation_index_5 = RemoteReceiver(cyclops_select_simulation_index)
item_10 = ListItem(List=panel_123, Index=cyclops_select_simulation_index_5, Wrap=True)

# ----
# Heath launch window
number_slider_29 = Slider(142, range=0..1000)
heath_accent_color_12 = RemoteReceiver(heath_accent_color)
pt_12 = ConstructPoint(XCoordinate=number_slider_29, YCoordinate=Slider(193, range=0..1000), ZCoordinate=0)
restart_heath_2 = RemoteReceiver(restart_heath)
panel_124 = Panel("Heath provides a user interface for life cycle building performance assessment in the Rhino environment.")
gate_10 = StreamGate(Stream="Start", Gate=restart_heath_2)  # -> Target0, Target1
true_button_26 = CreateTrueOnlyButton(ButtonName="Github Heath", ButtonStyle=0)
true_button_27 = CreateTrueOnlyButton(ButtonName=[gate_10.Target0, gate_10.Target1], ButtonStyle=0)
tb_36 = CreateTextBlock(TextSize=16, Justification=1)
tb_37 = CreateTextBlock(TextSize=12, Justification=0)
values_124 = ValueListener(Elements=true_button_26, SomeProperty=True)  # -> Values, Indices
values_125 = ValueListener(Elements=true_button_27, SomeProperty=True)  # -> Values, Indices
or_14 = GateOr(A=values_125.Values, B=restart_heath_2)
settextblock_7 = SetTextBlockContents(TextBlockToModify=tb_36, NewTextBlockContents="Email: sawen@chalmers.se")
settextblock_8 = SetTextBlockContents(TextBlockToModify=tb_37, NewTextBlockContents=panel_124)
trigger_launch_heath = RemoteSender(or_14)
github_heath = RemoteSender(values_124.Values)
adjustpos_76 = AdjustElementPositioning(ElementsToAdjust=tb_37, AbsolutePositioning=False, Height=Slider(60, range=0..100))
adjustpos_77 = AdjustElementPositioning(ElementsToAdjust=tb_36, Margin="0, 8, 0, 0", AbsolutePositioning=False, Height=Slider(20, range=0..100))

# ----
# Model visualization
# Model creation
# Zoom and bake geometry
# Geometry handling
trigger_launch_heath_2 = RemoteReceiver(trigger_launch_heath)

# ----
# Heath github
panel_125 = Panel("https://github.com/sawenchalmers/heath")
github_heath_2 = RemoteReceiver(github_heath)
py3_14 = Python3Script(url=panel_125, launch=github_heath_2)  # same code as py3

check_if_heath_can_be_launched = Python3Script(trigger_launch_heath=trigger_launch_heath_2)  # -> out, launch_heath, e
# ---------- check_if_heath_can_be_launched: Python ----------
import Rhino

def check_launch_possible():
    e = []
    if not Rhino.RhinoDoc.ActiveDoc.Path:
        e.append("Please save the Rhino file before launching Heath.")
    return e

if __name__ == "__main__":
    e = check_launch_possible()
    launch_heath = trigger_launch_heath and not e
# ---------- end check_if_heath_can_be_launched ----------

launch_heath = RemoteSender(check_if_heath_can_be_launched.launch_heath)

# ----
# Heath FLY!
launch_heath_2 = RemoteReceiver(launch_heath)
fly = HeathFly(launch_heath=launch_heath_2, current_gh_versions=allowed_python_versions_2)  # -> flying, errors; inputs current_gh_versions: list
# ---------- fly: Python ----------
# Copyright (c) 2024, Heath.
# You should have received a copy of the GNU Affero General Public License
# along with Heath; If not, see <http://www.gnu.org/licenses/>.
# 
# @license AGPL-3.0-or-later <https://spdx.org/licenses/AGPL-3.0-or-later>

import Grasshopper, scriptcontext, Rhino
import os, sys, importlib

def main(gh_version):
    sys.path.append(Grasshopper.Folders.UserObjectFolders[0])
    heath_path = os.path.join(Grasshopper.Folders.UserObjectFolders[0], "heath")
    sys.path.append(heath_path)

    # make sure we can import ladybug tools
    ladybug_tools_path = "ladybug_tools\\python\\Lib\\site-packages\\"
    program_files_dir = os.path.dirname(f"{os.environ['ProgramFiles']}\\{ladybug_tools_path}")
    if os.path.isdir(program_files_dir):
        sys.path.append(program_files_dir)
    else:
        user_folder_dir = os.path.dirname(f"{os.path.expanduser('~')}\\{ladybug_tools_path}")
        if os.path.isdir(user_folder_dir):
            sys.path.append(user_folder_dir)
        else:
            raise Exception("Couldn't find Ladybug tools python module path")
    try:
        import heath
        import heath_ui
        importlib.reload(heath)
        importlib.reload(heath_ui)
        if not heath.__file__:
            raise Exception("Wrong module version imported")
    except Exception as e:
        # hack to allow the module to reside in the repo
        sys.path.append(os.path.join(os.path.dirname(ghdoc.Path), '..\src'))
        import heath
        import heath_ui
        importlib.reload(heath)
        importlib.reload(heath_ui)
    version = heath.heath_globals.version
    if not check_version(gh_version, version):
        raise Exception(f"Version mismatch: {gh_version} (gh), {version} (py)")

    ghenv.Component.Name = 'Heath - Fly!'
    ghenv.Component.NickName = 'Fly!'

    scriptcontext.sticky["heath_flying"] = 'true'
    ghenv.Component.Message = heath.heath_globals.version
    return True

def check_version(gh_ver, py_ver):
    return py_ver in gh_ver

if __name__ == "__main__":
    if not Rhino.RhinoDoc.ActiveDoc.Path:
        flying = False
    else:
        try:
            flying = main(current_gh_versions) if launch_heath else False
        except Exception as e:
            errors = e
            print(e)
            elvl = Grasshopper.Kernel.GH_RuntimeMessageLevel.Error
            ghenv.Component.AddRuntimeMessage(elvl, str(e))
            flying = False
# ---------- end fly ----------
py3_15 = Python3Script(get=fly.flying)  # -> results_folder, heath_folder
# ---------- py3_15: Python ----------
"""Grasshopper Script"""
import heath
import Grasshopper

if __name__ == "__main__":
    if get:
        print(ghdoc)
        results_folder = heath.get_results_folder(ghdoc)
        heath_folder = Grasshopper.Folders.UserObjectFolders[0]
        print(results_folder)
        print(heath_folder)
# ---------- end py3_15 ----------
panel_126 = Panel(fly.flying)
results_folder = RemoteSender(py3_15.results_folder)
heath_folder = RemoteSender(py3_15.heath_folder)

null_11 = NullItem(Item=fly.errors)  # -> NullFlags, InvalidFlags, Description
cull_3 = CullPattern(List=fly.errors, CullPattern=invert(null_11.NullFlags))
merge_5 = Merge(Data1=flatten(cull_3), Data2=flatten(check_if_heath_can_be_launched.e))

merge_6 = Merge(Data1=flatten("Could not launch Heath:"), Data2=flatten(merge_5))
join_2 = TextJoin(Text=merge_6, Join=" ")
lng = ListLength(List=merge_5)
tb_38 = CreateTextBlock(Text=join_2, TextSize=12, Justification=1)
and_8 = GateAnd(A=values_125.Values, B=lng)
settextblock_9 = SetTextBlockContents(TextBlockToModify=tb_38, NewTextBlockContents=join_2)
hideshow_25 = HideShowElement(ElementToHideShow=tb_38, Show=and_8, Collapse=True, Disable=False)

# ----
# Brimstone FLY!
launch_heath_3 = RemoteReceiver([launch_heath_2, launch_heath])
fly_2 = BrimstoneFly(x=launch_heath_3)
# ---------- fly_2: Python ----------
"""This component sets up global information for Brimstone
    Inputs:
    Output:
        """

import Grasshopper
import sys
import os

sys.path.append(Grasshopper.Folders.UserObjectFolders[0])

import brimstone
reload(brimstone)

import scriptcontext

ghenv.Component.Name = 'Brimstone - Fly!'
ghenv.Component.NickName = 'Fly!'

scriptcontext.sticky["brimstone_flying"] = 'true'
scriptcontext.sticky["brimstone_kdb_hb_json"] = 'brimstone_data/230721klimatdatabas_hb_materials.json' # json which adds honeybee material info to klimatdatabas materials
scriptcontext.sticky["brimstone_hb_kdb_csv"] = 'brimstone_data/230728_HBKlimatdatabas.csv' # csv file which translates honeybee material names to klimatdatabas material names
ghenv.Component.Message = brimstone.globals.version
# ---------- end fly_2 ----------

invbool = InvertBoolean(Boolean=lng)  # -> Inverted, Number
and_9 = GateAnd(A=fly.flying, B=invbool.Inverted)

heath_flying = RemoteSender(and_9)

heath_flying_2 = RemoteReceiver(heath_flying)
# For user to interact with
# Needs work...
# Under development
# Global parameters
merge_7 = Merge(Data1=trigger_launch_heath_2, Data2=launch_heath, Data3=fly.flying, Data4=heath_flying)
results_folder_2 = RemoteReceiver(results_folder)
results_folder_3 = RemoteReceiver(results_folder)
results_folder_4 = RemoteReceiver(results_folder)
heath_flying_3 = RemoteReceiver(heath_flying)
results_folder_5 = RemoteReceiver(results_folder)
results_folder_6 = RemoteReceiver(results_folder)
results_folder_7 = RemoteReceiver(results_folder)
heath_folder_2 = RemoteReceiver(heath_folder)
concat = Concatenate(FragmentA=heath_folder_2, FragmentB="heath/butterfly_heath.png")
heath_folder_3 = RemoteReceiver(heath_folder)
heath_flying_4 = RemoteReceiver(heath_flying)

heath_folder_4 = RemoteReceiver(heath_folder)
concat_2 = Concatenate(FragmentA=heath_folder_4, FragmentB="heath/butterfly_heath.png")
image = CreateImage(ImageSource=concat_2, ImageWidth=bar_chart_img_width_2, ImageHeight=bar_chart_img_height_2)
entwine_94 = Entwine(Branch00=checklist_2, Branch01=image, FlattenInputs=True)  # -> flatten(Result)
stack_77 = CreateStack(UIElements=entwine_94, Horizontal=True)
entwine_95 = Entwine(Branch00=stack_11, Branch01=stack_77, FlattenInputs=True)  # -> flatten(Result)

stack_78 = CreateStack(UIElements=entwine_95, Horizontal=invert(True))

heath_folder_5 = RemoteReceiver(heath_folder)
concat_3 = Concatenate(FragmentA=heath_folder_5, FragmentB="heath/butterfly_heath.png")
image_2 = CreateImage(ImageSource=concat_3, ImageWidth=bar_chart_img_width_3, ImageHeight=bar_chart_img_height_3)
entwine_96 = Entwine(Branch00=checklist, Branch01=image_2, FlattenInputs=True)  # -> flatten(Result)
stack_79 = CreateStack(UIElements=entwine_96, Horizontal=True)
entwine_97 = Entwine(Branch00=button_12, Branch01=stack_79, FlattenInputs=True)  # -> flatten(Result)
stack_80 = CreateStack(UIElements=entwine_97, Horizontal=invert(True))
addelems = AddElements(Window=launchwin, Elements=flatten(stack_80), DoVLChecking=True)  # -> AddedElements, ElementNames

heath_folder_6 = RemoteReceiver(heath_folder)
concat_4 = Concatenate(FragmentA=heath_folder_6, FragmentB="heath/butterfly_heath.png")
image_3 = CreateImage(ImageSource=concat_4, ImageWidth=bar_chart_img_width_4, ImageHeight=bar_chart_img_height_4)
entwine_98 = Entwine(Branch00=checklist_3, Branch01=image_3, FlattenInputs=True)  # -> flatten(Result)
stack_81 = CreateStack(UIElements=entwine_98, Horizontal=True)
entwine_99 = Entwine(Branch00=button_14, Branch01=stack_81, FlattenInputs=True)  # -> flatten(Result)
stack_82 = CreateStack(UIElements=entwine_99, Horizontal=invert(True))
addelems_2 = AddElements(Window=launchwin_3, Elements=flatten(stack_82), DoVLChecking=True)  # -> AddedElements, ElementNames

addelems_3 = AddElements(Window=launchwin_2, Elements=flatten(stack_78), DoVLChecking=True)  # -> AddedElements, ElementNames

entwine_100 = Entwine(Branch00=tb_37, Branch01=true_button_26, Branch02=true_button_27, Branch03=tb_38, Branch04=tb_36, FlattenInputs=True)  # -> flatten(Result)

# ----
# Material database categories
material_database_categories = Panel("""Blocks and tiles
Building boards
Concrete
Insulation
Mineral materials
Paints and sealants
Solid woods
Steel and other metals
Waterproofing
Other""")
material_database_categories_2 = RemoteSender(material_database_categories)
material_database_categories_3 = RemoteReceiver(material_database_categories_2)

material_database_categories_4 = RemoteReceiver(material_database_categories_2)

# ----
# Basic material database
number_slider_30 = Slider(0.035, range=0.001..1)
basic_material_database_does_not_allow_c = Panel("""Expanded polystyrene
Mineral wool
Timber
Solid brick
Gypsum plasterboard
Medium density concrete
Ceramic and porcelain
Steel
Crystalline stone
Soil/sand/gravel""")  # "Basic material database, (does not allow comma)"
entwine_101 = Entwine(
    Branch00=Slider(0.035, range=0.001..1),
    Branch01=number_slider_30,
    Branch02=Slider(0.13, range=0.001..1),
    Branch03=Slider(0.8, range=0.001..1),
    Branch04=Slider(0.21, range=0.001..1),
    Branch05=Slider(1.65, range=0.001..5),
    Branch06=Slider(1.3, range=0.001..5),
    Branch07=Slider(50, range=0.001..100),
    Branch08=Slider(3.5, range=0.001..5),
    Branch09=Slider(2, range=0.001..5),
    FlattenInputs=True)  # -> flatten(Result)
entwine_102 = Entwine(
    Branch00=Slider(30, range=1..10000),
    Branch01=Slider(100, range=1..10000),
    Branch02=Slider(500, range=1..10000),
    Branch03=Slider(1800, range=1..10000),
    Branch04=Slider(700, range=1..10000),
    Branch05=Slider(2200, range=1..10000),
    Branch06=Slider(2300, range=1..10000),
    Branch07=Slider(7800, range=1..10000),
    Branch08=Slider(2800, range=1..10000),
    Branch09=Slider(1950, range=1..10000),
    FlattenInputs=True)  # -> flatten(Result)
entwine_103 = Entwine(
    Branch00=Slider(1450, range=1..10000),
    Branch01=Slider(1030, range=1..10000),
    Branch02=Slider(1600, range=1..10000),
    Branch03=Slider(1000, range=1..10000),
    Branch04=Slider(1000, range=1..10000),
    Branch05=Slider(1000, range=1..10000),
    Branch06=Slider(840, range=1..10000),
    Branch07=Slider(450, range=1..10000),
    Branch08=Slider(1000, range=1..10000),
    Branch09=Slider(1050, range=1..10000),
    FlattenInputs=True)  # -> flatten(Result)
entwine_104 = Entwine(
    Branch00=Slider(3, range=1..9),
    Branch01=Slider(3, range=1..9),
    Branch02=Slider(6, range=1..9),
    Branch03=Slider(0, range=0..9),
    Branch04=Slider(1, range=1..9),
    Branch05=Slider(2, range=1..9),
    Branch06=Slider(0, range=0..9),
    Branch07=Slider(7, range=1..9),
    Branch08=Slider(4, range=1..9),
    Branch09=Slider(9, range=1..9),
    FlattenInputs=True)  # -> flatten(Result)
material_database_categories_5 = RemoteReceiver(material_database_categories_2)
lng_2 = ListLength(List=basic_material_database_does_not_allow_c)
item_11 = ListItem(List=material_database_categories_5, Index=entwine_104, Wrap=True)
repeat_2 = RepeatData(Data="inf", Length=lng_2)
opaquemat = HBOpaqueMaterial(
    name=basic_material_database_does_not_allow_c,
    thickness=repeat_2,
    conductivity=entwine_101,
    density=entwine_102,
    spec_heat=entwine_103,
    category=item_11)  # -> mat; plug-in component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
objtostr = HBObjectToString(hb_obj=opaquemat)  # -> hb_str; plug-in component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
lng_3 = ListLength(List=objtostr)
bool_21 = Boolean(lng_3)
getdocumentusertext = Python3Script(run=bool_21, key="Heath materials")  # -> json_string
# ---------- getdocumentusertext: Python ----------
import Rhino
import rhinoscriptsyntax as rs
import scriptcontext as sc

if run:
    sc.doc = Rhino.RhinoDoc.ActiveDoc

    json_string = rs.GetDocumentUserText(key)

    sc.doc = ghdoc
# ---------- end getdocumentusertext ----------
split = TextSplit(Text=getdocumentusertext, Separators="|")
strtoobj = HBStringToObject(hb_str=split)  # -> flatten(hb_obj); plug-in component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
decnstrmat = HBDeconstructMaterial(mat=strtoobj)  # -> values, attr_names, r_val_si, r_val_ip; plug-in component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
item_12 = ListItem(List=decnstrmat.values, Index=0, Wrap=True)  # -> flatten(Item)
mindex = MemberIndex(Set=item_12, Member=basic_material_database_does_not_allow_c)  # -> Index, Count
cull_4 = CullPattern(List=objtostr, CullPattern=invert(mindex.Count))
entwine_105 = Entwine(Branch00=cull_4, Branch01=split, FlattenInputs=True)  # -> flatten(Result)
ipy2 = IronPython2Script(materials=entwine_105)  # -> unique_materials; inputs materials: list
# ---------- ipy2: IronPython ----------
"""Grasshopper Script"""

unique_materials = []

for i in range(len(materials)):
    if materials[i] not in unique_materials:
        unique_materials.append(materials[i])
# ---------- end ipy2 ----------
join_3 = TextJoin(Text=ipy2, Join="|")
setdocumentusertext = Python3Script(key="Heath materials", value=join_3)
# ---------- setdocumentusertext: Python ----------
import Rhino
import rhinoscriptsyntax as rs
import scriptcontext as sc

def modify_value(value):
    sc.doc = Rhino.RhinoDoc.ActiveDoc

    test = rs.SetDocumentUserText(key, value)

    sc.doc = ghdoc
    
if value:
    done = modify_value(value)
# ---------- end setdocumentusertext ----------

# ----
# Define program
selected_building_2 = RemoteReceiver(selected_building)
searchprog = HBSearchPrograms(bldg_prog=selected_building_2)  # -> room_prog; plug-in component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
constantschedule = HBConstantSchedule(values=Slider(1, range=0..1))  # -> report, schedule, idf_text; plug-in component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
constantschedule_2 = HBConstantSchedule(values=Slider(1, range=0..1))  # -> report, schedule, idf_text; plug-in component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
python = GhPythonScript(power_density=Slider(2.4, range=0..10), schedule=constantschedule.schedule)  # -> out, hot_water
# ---------- python: Python ----------
__author__ = "sawen"
__version__ = "2024.05.24"

import rhinoscriptsyntax as rs
from honeybee_energy.load.hotwater import ServiceHotWater as shw

if not name:
    name = "Domestic Hot Water"
    

hot_water = shw.from_watts_per_area(name, power_density, schedule, sensible_fraction = 0.0)
# ---------- end python ----------
equipment = HBEquipment(watts_per_area=Slider(2.4, range=0..10), schedule=constantschedule_2.schedule, lost_fract=Slider(0.3, range=0..1))  # -> equip; plug-in component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

split_2 = TextSplit(Text=searchprog, Separators="::")
item_13 = ListItem(List=split_2, Index=0, Wrap=True)  # -> flatten(Item1), Item, Item1_2, Item2
merge_8 = Merge(Data1=item_13.Item, Data2=item_13.Item2)
branch = TreeBranch(Tree=merge_8, Path=path, MaintainPaths=True)
entwine_106 = Entwine(Branch00=branch, Branch01=selected_room_2, FlattenInputs=True)  # -> flatten(Result)
join_4 = TextJoin(Text=entwine_106, Join="::")

# ----
# Select window construction
panel_127 = Panel("Generic")
subset_subface_window_2 = RemoteReceiver(subset_subface_window)
subset_subface_window_3 = RemoteReceiver(subset_subface_window)
null_12 = NullObject()
null_13 = NullObject()

# ----
# Select exterior construction
subset_exterior_roof_2 = RemoteReceiver(subset_exterior_roof)
subset_exterior_wall_3 = RemoteReceiver(subset_exterior_wall)
null_14 = NullObject()
null_15 = NullObject()
null_16 = NullObject()

# ----
# Select interior construction
subset_interior_floor_3 = RemoteReceiver(subset_interior_floor)
null_17 = NullObject()
null_18 = NullObject()

# ----
# Select ground construction
subset_ground_floor_2 = RemoteReceiver(subset_ground_floor)
null_19 = NullObject()

room_programs = RemoteSender(item_13.Item1)
applyloadvals = HBApplyLoadValues(room_or_program=flatten(join_4), people_per_floor=occupancy_2, vent_ach=Slider(0.53, range=0..1))  # -> report, mod_obj; plug-in component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
applysetpointvals = HBApplySetpointValues(room_or_program=flatten(applyloadvals.mod_obj), cooling_setpt=cooling_setpoint_3, heating_setpt=heating_setpoint_3)  # -> report, mod_obj; plug-in component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

# ---- group: Program module (continued)
room_programs_2 = RemoteReceiver(room_programs)
setlist_2 = SetListContents(ListToModify=pulldown_8, NewListContents=room_programs_2, SelectedIndex="0")

# ----
txt_5 = Text(applysetpointvals.mod_obj)

programtype = HBProgramType(name=txt_5, base_program=applysetpointvals.mod_obj, electric_equip=equipment, hot_water=python.hot_water)  # -> program; plug-in component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

deconstrprogram = HBDeconstructProgramType(program=programtype)  # -> people, lighting, electric_equip, gas_equip, hot_water, infiltration, ventilation, setpoint; plug-in component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
decnstrinfiltration = HBDeconstructInfiltration(infil=deconstrprogram.infiltration)  # -> name, flow_per_ext_area, schedule; plug-in component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
decnstrventilation = HBDeconstructVentilation(vent=deconstrprogram.ventilation)  # -> name, flow_per_person, flow_per_area, flow_per_zone, ach, schedule; plug-in component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

# ----
# Construction database
number_slider_31 = Slider(20, range=0..100)
repeat_3 = RepeatData(Data="🔍", Length=number_slider_31)
repeat_4 = RepeatData(Data="- ", Length=number_slider_31)
repeat_5 = RepeatData(Data="X", Length=number_slider_31)
button_37 = CreateButton(ButtonName="Sync database", ButtonStyle=0)
true_button_28 = CreateTrueOnlyButton(ButtonName="Create new construction", ButtonStyle=0)
label_57 = CreateLabel(LabelText="Constructions", LabelSize=18, Justification=0)
label_58 = CreateLabel(LabelText="Duplicate instances of constructions have been loaded", LabelSize=12, Justification=0)
filepicker = CreateFilePicker(
    ButtonLabelText="Save constructions to file",
    DialogType=1,
    MustExist=True,
    Filter="Text file|*.txt",
    StartingPath=results_folder_2)
true_button_29 = CreateTrueOnlyButton(ButtonName=repeat_3, ButtonStyle=3)
button_38 = CreateButton(ButtonName="Save constructions", ButtonStyle=0)
filepicker_2 = CreateFilePicker(
    ButtonLabelText="Load constructions from file",
    DialogType=0,
    MustExist=True,
    Filter="Text file|*.txt",
    StartingPath=results_folder_3)
button_39 = CreateButton(ButtonName=repeat_5, ButtonStyle=3)
button_40 = CreateButton(ButtonName="Load constructions", ButtonStyle=0)
tb_39 = CreateTextBlock(Text=repeat_4, TextSize=12, Justification=0)
values_126 = ValueListener(Elements=button_38, SomeProperty=True)  # -> Values, Indices
values_127 = ValueListener(Elements=true_button_29, SomeProperty=True)  # -> flatten(Values), Indices
values_128 = ValueListener(Elements=button_37, SomeProperty=True)  # -> Values, Indices
values_129 = ValueListener(Elements=true_button_28, SomeProperty=True)  # -> Values, Indices
values_130 = ValueListener(Elements=button_40, SomeProperty=True)  # -> Values, Indices
values_131 = ValueListener(Elements=filepicker, SomeProperty=True)  # -> Values, Indices
values_132 = ValueListener(Elements=button_39, SomeProperty=True)  # -> flatten(Values), Indices
cull_5 = CullPattern(List=values_132.Values, CullPattern=values_132.Values)
lng_4 = ListLength(List=cull_5)
filter_22 = StreamFilter(Gate=lng_4, Stream0="False", Stream1=cull_5)
freeze_gate_23 = StreamFreezeGate(Data=filter_22, PassingSwitch=invert(filter_22))
values_133 = ValueListener(Elements=filepicker_2, SomeProperty=True)  # -> Values, Indices
bool_22 = Boolean(invert(freeze_gate_23))
freeze_gate_24 = StreamFreezeGate(Data=values_126.Values, PassingSwitch=invert(values_126.Values))
freeze_gate_25 = StreamFreezeGate(Data=values_130.Values, PassingSwitch=invert(values_130.Values))
cset = CreateSet(List=values_127.Values)  # -> Set, Map
bool_23 = Boolean(values_131.Values)
bool_24 = Boolean(values_133.Values)
sync_construction_database = RemoteSender(values_128.Values)
tap_9 = TapBuffer(Reset=False, Incremental=True, Valve=bool_22, Hold=True)
create_construction_modal = RemoteSender(values_129.Values)
null_20 = NullItem(Item=bool_23)  # -> NullFlags, InvalidFlags, Description
pre_construction_database_remove_constru = RemoteSender(values_132.Values)  # "pre_construction_database_remove_construction"
cull_6 = CullPattern(List=cset.Set, CullPattern=cset.Set)
bool_25 = Boolean(invert(freeze_gate_24))
null_21 = NullItem(Item=bool_24)  # -> NullFlags, InvalidFlags, Description
save_constructions_file = RemoteSender(values_131.Values)
load_constructions_file = RemoteSender(values_133.Values)
bool_26 = Boolean(invert(freeze_gate_25))
expander_10 = CreateExpander(UIElements=simplify(graft(tb_39)), Header=simplify(graft(repeat_4)), Open=invert(True))  # -> flatten(Expander)
entwine_107 = Entwine(Branch00=true_button_28, Branch01=button_37, FlattenInputs=True)  # -> flatten(Result)
dam_17 = DataDam(DataA=tap_9, BufferDelay=2500000, BufferMode=2)
tap_10 = TapBuffer(Reset=False, Incremental=True, Valve=bool_25, Hold=True)
mindex_2 = MemberIndex(Set=values_127.Values, Member=cull_6)  # -> Index, Count
tap_11 = TapBuffer(Reset=False, Incremental=True, Valve=bool_26, Hold=True)
equals_21 = Equality(FirstNumber=tap_9, SecondNumber=dam_17)  # -> Equality, Inequality
stack_83 = CreateStack(UIElements=entwine_107, Horizontal=True)
dam_18 = DataDam(DataA=tap_10, BufferDelay=2500000, BufferMode=2)
bool_27 = Boolean(mindex_2.Count)
dam_19 = DataDam(DataA=tap_11, BufferDelay=2500000, BufferMode=2)
event_28 = EventGate(Data=equals_21.Inequality)  # -> Data, IsNew
hideshow_26 = HideShowElement(ElementToHideShow=button_38, Show=null_20.NullFlags, Collapse=True, Disable=False)
suirify = Suirify(true_button_29)
suirify_2 = Suirify(expander_10)
suirify_3 = Suirify(button_39)
null_22 = NullItem(Item=bool_27)  # -> NullFlags, InvalidFlags, Description
equals_22 = Equality(FirstNumber=tap_10, SecondNumber=dam_18)  # -> Equality, Inequality
equals_23 = Equality(FirstNumber=tap_11, SecondNumber=dam_19)  # -> Equality, Inequality
hideshow_27 = HideShowElement(ElementToHideShow=button_40, Show=null_21.NullFlags, Collapse=True, Disable=False)
merge_9 = Merge(Data1=graft(suirify_2), Data2=graft(suirify_3), Data3=graft(suirify))
adjustelem_32 = AdjustElementAppearance(ElementsToAdjust=label_58, Foreground=ColourSwatch(SwatchColor=RGB(255, 0, 0)))
construction_database_remove_constructio = RemoteSender(event_28.Data)  # "construction_database_remove_construction"
filter_23 = StreamFilter(Gate=null_22.NullFlags, Stream0=bool_27, Stream1="False")
number_slider_32 = Slider(26, range=0..300)
entwine_108 = Entwine(Branch00=filepicker, Branch01=button_38, FlattenInputs=True)  # -> flatten(Result)
stack_84 = CreateStack(UIElements=merge_9, Horizontal=True)  # -> flatten(Stack)
entwine_109 = Entwine(Branch00=filepicker_2, Branch01=button_40, FlattenInputs=True)  # -> flatten(Result)
construction_database_visualize_construc = RemoteSender(filter_23)  # "construction_database_visualize_construction"
pre_construction_database_visualize_cons = RemoteSender(mindex_2.Index)  # "pre_construction_database_visualize_construction"
stack_85 = CreateStack(UIElements=entwine_108, Horizontal=True)
adjustpos_78 = AdjustElementPositioning(ElementsToAdjust=button_38, AbsolutePositioning=False, Height=Slider(32, range=0..300), HorizontalAlignment=0)
adjustpos_79 = AdjustElementPositioning(
    ElementsToAdjust=filepicker,
    AbsolutePositioning=False,
    Width=Slider(180, range=0..300),
    Height=Slider(32, range=0..300),
    HorizontalAlignment=0)
adjustpos_80 = AdjustElementPositioning(
    ElementsToAdjust=true_button_29,
    AbsolutePositioning=False,
    Width=number_slider_32,
    Height=number_slider_32,
    HorizontalAlignment=2,
    VerticalAlignment=1)
stack_86 = CreateStack(UIElements=entwine_109, Horizontal=True)
adjustelem_33 = AdjustElementAppearance(
    ElementsToAdjust=true_button_29,
    Foreground=ColourSwatch(SwatchColor=RGBA(0, 0, 0, 205)),
    Background=ColourSwatch(SwatchColor=RGBA(245, 245, 245, 205)),
    FontSize=Slider(18, range=0..50))
adjustpos_81 = AdjustElementPositioning(ElementsToAdjust=button_40, AbsolutePositioning=False, Height=Slider(32, range=0..300), HorizontalAlignment=0)
adjustpos_82 = AdjustElementPositioning(
    ElementsToAdjust=filepicker_2,
    AbsolutePositioning=False,
    Width=Slider(180, range=0..300),
    Height=Slider(32, range=0..300),
    HorizontalAlignment=0)
adjustpos_83 = AdjustElementPositioning(
    ElementsToAdjust=button_39,
    AbsolutePositioning=False,
    Width=Slider(26, range=0..300),
    Height=Slider(26, range=0..300),
    HorizontalAlignment=2,
    VerticalAlignment=1)
adjustelem_34 = AdjustElementAppearance(ElementsToAdjust=button_39, Foreground=ColourSwatch(SwatchColor=RGB(255, 0, 0)), FontSize=Slider(12, range=0..50))
adjustpos_84 = AdjustElementPositioning(
    ElementsToAdjust=expander_10,
    Margin="0, 0, 0, 5",
    AbsolutePositioning=False,
    Width=Slider(285, range=100..500),
    HorizontalAlignment=0)
adjustpos_85 = AdjustElementPositioning(ElementsToAdjust=stack_84, Margin="5, 0, 0, 0", AbsolutePositioning=False, HorizontalAlignment=0)

# ----
# Remove constructions
pre_construction_database_remove_constru_2 = RemoteReceiver(pre_construction_database_remove_constru)  # "pre_construction_database_remove_construction"
construction_database_remove_constructio_2 = RemoteReceiver(construction_database_remove_constructio)  # "construction_database_remove_construction"
cset_2 = CreateSet(List=pre_construction_database_remove_constru_2)  # -> Set, Map
getdocumentusertext_2 = Python3Script(run=construction_database_remove_constructio_2, key="Heath constructions")  # -> json_string; same code as getdocumentusertext
cull_7 = CullPattern(List=cset_2.Set, CullPattern=cset_2.Set)
mindex_3 = MemberIndex(Set=pre_construction_database_remove_constru_2, Member=cull_7)  # -> Index, Count
split_3 = TextSplit(Text=getdocumentusertext_2, Separators="|")
hold = HoldingGate(Data=mindex_3.Index)
cull_i = CullIndex(List=split_3, Indices=hold, Wrap=True)
join_5 = TextJoin(Text=cull_i, Join="|")
nulls_in_empty = NullsInEmptyBranches(DataWithEmptyBranches=join_5)
null_23 = NullItem(Item=nulls_in_empty)  # -> NullFlags, InvalidFlags, Description
bool_28 = Boolean("False")
filter_24 = StreamFilter(Gate=null_23.NullFlags, Stream0=join_5, Stream1=bool_28)
freeze_gate_26 = StreamFreezeGate(Data=filter_24, PassingSwitch=construction_database_remove_constructio_2, Freeze=False, Hold=False)

sync_construction_database_2 = RemoteReceiver(sync_construction_database)

# ----
# Construction database launch
ping_open_construction_database_2 = RemoteReceiver(ping_open_construction_database)
open_construction_database_2 = RemoteReceiver(open_construction_database)
or_15 = GateOr(A=ping_open_construction_database_2, B=open_construction_database_2)
entwine_110 = Entwine(
    Branch00=stack_83,
    Branch01=label_58,
    Branch02=label_57,
    Branch03=stack_84,
    Branch04=stack_85,
    Branch05=stack_86,
    FlattenInputs=True)  # -> flatten(Result)
database_modal_location_5 = RemoteReceiver(database_modal_location)
ping_open_construction_database_3 = RemoteReceiver(ping_open_construction_database)
open_construction_database_3 = RemoteReceiver(open_construction_database)
or_16 = GateOr(A=ping_open_construction_database_3, B=open_construction_database_3)

null_24 = NullItem(Item=or_15)  # -> NullFlags, InvalidFlags, Description
filter_25 = StreamFilter(Gate=null_24.NullFlags, Stream0=or_15, Stream1="False")

# ----
# Material database
number_slider_33 = Slider(10, range=0..100)
lng_5 = ListLength(List=material_database_categories_4)
material_database_categories_6 = RemoteReceiver(material_database_categories_2)
repeat_6 = RepeatData(Data="X", Length=number_slider_33)  # -> graft(Data)
repeat_7 = RepeatData(Data="- ", Length=number_slider_33)  # -> graft(Data)
lng_6 = ListLength(List=material_database_categories_4)
repeat_8 = RepeatData(Data=simplify(repeat_6), Length=lng_5)
repeat_9 = RepeatData(Data=simplify(repeat_7), Length=lng_5)
filepicker_3 = CreateFilePicker(
    ButtonLabelText="Save materials to file",
    DialogType=1,
    MustExist=True,
    Filter="Text file|*.txt",
    StartingPath=results_folder_4)
button_41 = CreateButton(ButtonName="Sync database", ButtonStyle=0)
true_button_30 = CreateTrueOnlyButton(ButtonName="Create material", ButtonStyle=0)
button_42 = CreateButton(ButtonName="Save materials", ButtonStyle=0)
label_59 = CreateLabel(LabelText="Duplicate instances of materials have been loaded", LabelSize=12, Justification=0)
label_60 = CreateLabel(LabelText=material_database_categories_6, LabelSize=18, Justification=0)
filepicker_4 = CreateFilePicker(
    ButtonLabelText="Load materials from file",
    DialogType=0,
    MustExist=True,
    Filter="Text file|*.txt",
    StartingPath=results_folder_5)
button_43 = CreateButton(ButtonName="Load materials", ButtonStyle=0)
values_134 = ValueListener(Elements=button_42, SomeProperty=True)  # -> Values, Indices
button_44 = CreateButton(ButtonName=repeat_8, ButtonStyle=3)
tb_40 = CreateTextBlock(Text=repeat_9, TextSize=12, Justification=0)
values_135 = ValueListener(Elements=button_43, SomeProperty=True)  # -> Values, Indices
values_136 = ValueListener(Elements=filepicker_3, SomeProperty=True)  # -> Values, Indices
values_137 = ValueListener(Elements=filepicker_4, SomeProperty=True)  # -> Values, Indices
freeze_gate_27 = StreamFreezeGate(Data=values_134.Values, PassingSwitch=invert(values_134.Values))
values_138 = ValueListener(Elements=flatten(button_44), SomeProperty=True)  # -> flatten(Values), Indices
cull_8 = CullPattern(List=values_138.Values, CullPattern=values_138.Values)  # -> flatten(List)
lng_7 = ListLength(List=cull_8)
filter_26 = StreamFilter(Gate=lng_7, Stream0="False", Stream1=cull_8)
freeze_gate_28 = StreamFreezeGate(Data=filter_26, PassingSwitch=invert(filter_26))
values_139 = ValueListener(Elements=true_button_30, SomeProperty=True)  # -> Values, Indices
values_140 = ValueListener(Elements=button_41, SomeProperty=True)  # -> Values, Indices
freeze_gate_29 = StreamFreezeGate(Data=values_135.Values, PassingSwitch=invert(values_135.Values))
bool_29 = Boolean(values_136.Values)
bool_30 = Boolean(invert(freeze_gate_28))
bool_31 = Boolean(values_137.Values)
null_25 = NullItem(Item=bool_29)  # -> NullFlags, InvalidFlags, Description
bool_32 = Boolean(invert(freeze_gate_27))
save_materials_file = RemoteSender(values_136.Values)
null_26 = NullItem(Item=bool_31)  # -> NullFlags, InvalidFlags, Description
tap_12 = TapBuffer(Reset=False, Incremental=True, Valve=bool_30, Hold=True)
bool_33 = Boolean(invert(freeze_gate_29))
load_materials_file = RemoteSender(values_137.Values)
entwine_111 = Entwine(Branch00=true_button_30, Branch01=button_41, FlattenInputs=True)  # -> flatten(Result)
create_material_modal = RemoteSender(values_139.Values)
pre_material_database_remove_material = RemoteSender(values_138.Values)
tap_13 = TapBuffer(Reset=False, Incremental=True, Valve=bool_32, Hold=True)
dam_20 = DataDam(DataA=tap_12, BufferDelay=2500000, BufferMode=2)
tap_14 = TapBuffer(Reset=False, Incremental=True, Valve=bool_33, Hold=True)
suirify_4 = Suirify(tb_40)
suirify_5 = Suirify(button_44)
dam_21 = DataDam(DataA=tap_13, BufferDelay=2500000, BufferMode=2)
hideshow_28 = HideShowElement(ElementToHideShow=button_42, Show=null_25.NullFlags, Collapse=True, Disable=False)
dam_22 = DataDam(DataA=tap_14, BufferDelay=2500000, BufferMode=2)
equals_24 = Equality(FirstNumber=tap_12, SecondNumber=dam_20)  # -> Equality, Inequality
adjustelem_35 = AdjustElementAppearance(ElementsToAdjust=label_59, Foreground=ColourSwatch(SwatchColor=RGB(255, 0, 0)))
merge_10 = Merge(Data1=graft(suirify_4), Data2=graft(suirify_5))
equals_25 = Equality(FirstNumber=tap_13, SecondNumber=dam_21)  # -> Equality, Inequality
stack_87 = CreateStack(UIElements=entwine_111, Horizontal=True)
hideshow_29 = HideShowElement(ElementToHideShow=button_43, Show=null_26.NullFlags, Collapse=True, Disable=False)
equals_26 = Equality(FirstNumber=tap_14, SecondNumber=dam_22)  # -> Equality, Inequality
event_29 = EventGate(Data=equals_24.Inequality)  # -> Data, IsNew
stack_88 = CreateStack(UIElements=merge_10, Horizontal=True)
shfdep = ShiftToDepth(Tree=stack_88, Depth=Slider(1, range=0..100), shiftFromStart=False)
material_database_remove_material = RemoteSender(event_29.Data)
entwine_112 = Entwine(Branch00=filepicker_4, Branch01=button_43, FlattenInputs=True)  # -> flatten(Result)
merge_11 = Merge(Data1=simplify(graft(label_60)), Data2=shfdep)
entwine_113 = Entwine(Branch00=filepicker_3, Branch01=button_42, FlattenInputs=True)  # -> flatten(Result)
stack_89 = CreateStack(UIElements=entwine_112, Horizontal=True)
stack_90 = CreateStack(UIElements=merge_11, Horizontal=invert(True))  # -> flatten(Stack)
adjustpos_86 = AdjustElementPositioning(ElementsToAdjust=label_60, Margin="0, 5, 0, 0", AbsolutePositioning=False)
adjustpos_87 = AdjustElementPositioning(
    ElementsToAdjust=tb_40,
    Margin="0, 0, 0, 10",
    AbsolutePositioning=False,
    Width=Slider(300, range=0..500),
    Height=Slider(29, range=0..300),
    HorizontalAlignment=0,
    VerticalAlignment=1)
stack_91 = CreateStack(UIElements=entwine_113, Horizontal=True)
adjustpos_88 = AdjustElementPositioning(ElementsToAdjust=stack_88, Margin="5, 0, 0, 0", AbsolutePositioning=False, HorizontalAlignment=0)
adjustpos_89 = AdjustElementPositioning(
    ElementsToAdjust=button_44,
    Margin="5, 0, 0, 10",
    AbsolutePositioning=False,
    Width=Slider(26, range=0..300),
    Height=Slider(26, range=0..300),
    HorizontalAlignment=1,
    VerticalAlignment=1)
adjustelem_36 = AdjustElementAppearance(ElementsToAdjust=button_44, Foreground=ColourSwatch(SwatchColor=RGB(255, 0, 0)), FontSize=Slider(12, range=0..50))
adjustpos_90 = AdjustElementPositioning(
    ElementsToAdjust=filepicker_3,
    AbsolutePositioning=False,
    Width=Slider(180, range=0..300),
    Height=Slider(32, range=0..300),
    HorizontalAlignment=0)
adjustpos_91 = AdjustElementPositioning(ElementsToAdjust=stack_91, Margin="5, 20, 0, 0", AbsolutePositioning=False, HorizontalAlignment=0)
adjustpos_92 = AdjustElementPositioning(ElementsToAdjust=button_42, AbsolutePositioning=False, Height=Slider(32, range=0..300), HorizontalAlignment=0)
adjustpos_93 = AdjustElementPositioning(ElementsToAdjust=stack_89, Margin="5, 10, 0, 0", AbsolutePositioning=False, HorizontalAlignment=0)
adjustpos_94 = AdjustElementPositioning(
    ElementsToAdjust=filepicker_4,
    AbsolutePositioning=False,
    Width=Slider(180, range=0..300),
    Height=Slider(32, range=0..300),
    HorizontalAlignment=0)
adjustpos_95 = AdjustElementPositioning(ElementsToAdjust=button_43, AbsolutePositioning=False, Height=Slider(32, range=0..300), HorizontalAlignment=0)

sync_material_database = RemoteSender(values_140.Values)

# ----
# Window database
panel_128 = Panel("Duplicate instances of windows have been loaded")
number_slider_34 = Slider(20, range=0..100)
true_button_31 = CreateTrueOnlyButton(ButtonName="Create window", ButtonStyle=0)
label_61 = CreateLabel(LabelText=panel_128, LabelSize=12, Justification=0)
label_62 = CreateLabel(LabelText="Windows", LabelSize=18, Justification=0)
repeat_10 = RepeatData(Data="X", Length=number_slider_34)
repeat_11 = RepeatData(Data="- ", Length=number_slider_34)
values_141 = ValueListener(Elements=true_button_31, SomeProperty=True)  # -> Values, Indices
filepicker_5 = CreateFilePicker(
    ButtonLabelText="Save windows to file",
    DialogType=1,
    MustExist=True,
    Filter="Text file|*.txt",
    StartingPath=results_folder_6)
button_45 = CreateButton(ButtonName=repeat_10, ButtonStyle=3)
button_46 = CreateButton(ButtonName="Save windows", ButtonStyle=0)
tb_41 = CreateTextBlock(Text=repeat_11, TextSize=12, Justification=0)
filepicker_6 = CreateFilePicker(
    ButtonLabelText="Load windows from file",
    DialogType=0,
    MustExist=True,
    Filter="Text file|*.txt",
    StartingPath=results_folder_7)
button_47 = CreateButton(ButtonName="Load windows", ButtonStyle=0)
values_142 = ValueListener(Elements=button_46, SomeProperty=True)  # -> Values, Indices
values_143 = ValueListener(Elements=button_47, SomeProperty=True)  # -> Values, Indices
values_144 = ValueListener(Elements=button_45, SomeProperty=True)  # -> flatten(Values), Indices
cull_9 = CullPattern(List=values_144.Values, CullPattern=values_144.Values)
lng_8 = ListLength(List=cull_9)
filter_27 = StreamFilter(Gate=lng_8, Stream0="False", Stream1=cull_9)
freeze_gate_30 = StreamFreezeGate(Data=filter_27, PassingSwitch=invert(filter_27))
values_145 = ValueListener(Elements=filepicker_5, SomeProperty=True)  # -> Values, Indices
values_146 = ValueListener(Elements=filepicker_6, SomeProperty=True)  # -> Values, Indices
bool_34 = Boolean(invert(freeze_gate_30))
create_window_modal = RemoteSender(values_141.Values)
freeze_gate_31 = StreamFreezeGate(Data=values_142.Values, PassingSwitch=invert(values_142.Values))
freeze_gate_32 = StreamFreezeGate(Data=values_143.Values, PassingSwitch=invert(values_143.Values))
bool_35 = Boolean(values_145.Values)
bool_36 = Boolean(values_146.Values)
tap_15 = TapBuffer(Reset=False, Incremental=True, Valve=bool_34, Hold=True)
pre_window_database_remove_window = RemoteSender(values_144.Values)
null_27 = NullItem(Item=bool_35)  # -> NullFlags, InvalidFlags, Description
bool_37 = Boolean(invert(freeze_gate_31))
null_28 = NullItem(Item=bool_36)  # -> NullFlags, InvalidFlags, Description
save_windows_file = RemoteSender(values_145.Values)
bool_38 = Boolean(invert(freeze_gate_32))
load_windows_file = RemoteSender(values_146.Values)
suirify_6 = Suirify(tb_41)
suirify_7 = Suirify(button_45)
dam_23 = DataDam(DataA=tap_15, BufferDelay=2500000, BufferMode=2)
tap_16 = TapBuffer(Reset=False, Incremental=True, Valve=bool_37, Hold=True)
merge_12 = Merge(Data1=graft(suirify_6), Data2=graft(suirify_7))
tap_17 = TapBuffer(Reset=False, Incremental=True, Valve=bool_38, Hold=True)
equals_27 = Equality(FirstNumber=tap_15, SecondNumber=dam_23)  # -> Equality, Inequality
adjustelem_37 = AdjustElementAppearance(ElementsToAdjust=label_61, Foreground=ColourSwatch(SwatchColor=RGB(255, 0, 0)))
dam_24 = DataDam(DataA=tap_16, BufferDelay=2500000, BufferMode=2)
dam_25 = DataDam(DataA=tap_17, BufferDelay=2500000, BufferMode=2)
event_30 = EventGate(Data=equals_27.Inequality)  # -> Data, IsNew
hideshow_30 = HideShowElement(ElementToHideShow=button_46, Show=null_27.NullFlags, Collapse=True, Disable=False)
hideshow_31 = HideShowElement(ElementToHideShow=button_47, Show=null_28.NullFlags, Collapse=True, Disable=False)
equals_28 = Equality(FirstNumber=tap_16, SecondNumber=dam_24)  # -> Equality, Inequality
equals_29 = Equality(FirstNumber=tap_17, SecondNumber=dam_25)  # -> Equality, Inequality
window_database_remove_window = RemoteSender(event_30.Data)
entwine_114 = Entwine(Branch00=filepicker_5, Branch01=button_46, FlattenInputs=True)  # -> flatten(Result)
stack_92 = CreateStack(UIElements=merge_12, Horizontal=True)  # -> flatten(Stack)
entwine_115 = Entwine(Branch00=filepicker_6, Branch01=button_47, FlattenInputs=True)  # -> flatten(Result)
adjustpos_96 = AdjustElementPositioning(ElementsToAdjust=label_62, Margin="0, 0, 0, -10", AbsolutePositioning=False)
adjustpos_97 = AdjustElementPositioning(
    ElementsToAdjust=filepicker_5,
    AbsolutePositioning=False,
    Width=Slider(180, range=0..300),
    Height=Slider(32, range=0..300),
    HorizontalAlignment=0)
adjustpos_98 = AdjustElementPositioning(ElementsToAdjust=button_46, AbsolutePositioning=False, Height=Slider(32, range=0..300), HorizontalAlignment=0)
adjustpos_99 = AdjustElementPositioning(
    ElementsToAdjust=tb_41,
    Margin="0, 10, 0, 0",
    AbsolutePositioning=False,
    Width=Slider(300, range=0..300),
    Height=Slider(29, range=0..300),
    HorizontalAlignment=0,
    VerticalAlignment=1)
adjustpos_100 = AdjustElementPositioning(ElementsToAdjust=stack_92, Margin="5, 0, 0, 0", AbsolutePositioning=False, HorizontalAlignment=0)
adjustpos_101 = AdjustElementPositioning(
    ElementsToAdjust=button_45,
    Margin="5, 0, 0, 0",
    AbsolutePositioning=False,
    Width=Slider(26, range=0..300),
    Height=Slider(26, range=0..300),
    HorizontalAlignment=1,
    VerticalAlignment=1)
stack_93 = CreateStack(UIElements=entwine_114, Horizontal=True)
stack_94 = CreateStack(UIElements=entwine_115, Horizontal=True)
adjustelem_38 = AdjustElementAppearance(ElementsToAdjust=button_45, Foreground=ColourSwatch(SwatchColor=RGB(255, 0, 0)), FontSize=Slider(12, range=0..50))
adjustpos_102 = AdjustElementPositioning(
    ElementsToAdjust=filepicker_6,
    AbsolutePositioning=False,
    Width=Slider(180, range=0..300),
    Height=Slider(32, range=0..300),
    HorizontalAlignment=0)
adjustpos_103 = AdjustElementPositioning(ElementsToAdjust=button_47, AbsolutePositioning=False, Height=Slider(32, range=0..300), HorizontalAlignment=0)

entwine_116 = Entwine(Branch00=true_button_31, Branch01=button_9, FlattenInputs=True)  # -> flatten(Result)
stack_95 = CreateStack(UIElements=entwine_116, Horizontal=True)

# ----
# Remove window
pre_window_database_remove_window_2 = RemoteReceiver(pre_window_database_remove_window)
window_database_remove_window_2 = RemoteReceiver(window_database_remove_window)
cset_3 = CreateSet(List=pre_window_database_remove_window_2)  # -> Set, Map
getdocumentusertext_3 = Python3Script(run=window_database_remove_window_2, key="Heath windows")  # -> json_string; same code as getdocumentusertext
cull_10 = CullPattern(List=cset_3.Set, CullPattern=cset_3.Set)
mindex_4 = MemberIndex(Set=pre_window_database_remove_window_2, Member=cull_10)  # -> Index, Count
split_4 = TextSplit(Text=getdocumentusertext_3, Separators="|")
hold_2 = HoldingGate(Data=mindex_4.Index)
cull_i_2 = CullIndex(List=split_4, Indices=hold_2, Wrap=True)
join_6 = TextJoin(Text=cull_i_2, Join="|")
nulls_in_empty_2 = NullsInEmptyBranches(DataWithEmptyBranches=join_6)
null_29 = NullItem(Item=nulls_in_empty_2)  # -> NullFlags, InvalidFlags, Description
bool_39 = Boolean("False")
filter_28 = StreamFilter(Gate=null_29.NullFlags, Stream0=join_6, Stream1=bool_39)
freeze_gate_33 = StreamFreezeGate(Data=filter_28, PassingSwitch=window_database_remove_window_2, Freeze=False, Hold=False)

# ----
# Recursion
panel_129 = Panel("Heath help")
objbynn_6 = GetObjectByNickname(NickName=panel_129)
heath_help = Python3Script()  # -> status; same code as lca_window_status

# ----
# Heath window
entwine_117 = Entwine(Branch00=location_4, Branch01=location_5, Branch02=location_8, FlattenInputs=True)  # -> flatten(Result)
entwine_118 = Entwine(Branch00=location_2, Branch01=location_3, FlattenInputs=True)  # -> flatten(Result)
entwine_119 = Entwine(Branch00=stack_54, Branch01=location_7, Branch02=preview, FlattenInputs=True)  # -> flatten(Result)
data_13 = Data()
data_14 = Data(energy_simulations)
data_15 = Data(daylight_simulations_2)
data_16 = Data()
data_17 = Data(daylight_simulations)
launch_heath_4 = RemoteReceiver(launch_heath)
entwine_120 = Entwine(
    Branch00=select_model_2,
    Branch01=data_4,
    Branch02=data_3,
    Branch03=data_14,
    Branch04=data_13,
    Branch05=data_15,
    Branch06=data_16,
    Branch07=data_17,
    FlattenInputs=True)  # -> flatten(Result)
rec_31 = DataRecorder(heath_flying_3, DataLimit=-2, RecordData=True)
ma_30 = MassAddition(Input=rec_31)  # -> Result, PartialResults
entwine_121 = Entwine(Branch00=entwine_46, Branch01=expander_4, Branch02=expander_5, Branch03=gate_9.Target1, FlattenInputs=True)  # -> flatten(Result)
number_slider_35 = Slider(390, range=0..1000)
heath_window_location_2 = RemoteReceiver(heath_window_location)
true_button_32 = CreateTrueOnlyButton(ButtonName="Help!", ButtonStyle=0)
values_147 = ValueListener(Elements=true_button_32, SomeProperty=True)  # -> Values, Indices
help_button = RemoteSender(values_147.Values)
format_31 = Format(Format="{0}, {1}, {2}, {3}", Culture=127, Data0=Slider(10, range=0..300))
adjustpos_104 = AdjustElementPositioning(
    ElementsToAdjust=true_button_32,
    Margin=format_31,
    AbsolutePositioning=invert(False),
    HorizontalAlignment=2,
    VerticalAlignment=2)

stack_96 = CreateStack(UIElements=entwine_117, Horizontal=invert(True))
stack_97 = CreateStack(UIElements=entwine_118, Horizontal=invert(True))
stack_98 = CreateStack(UIElements=entwine_119, Horizontal=invert(True))
expander_11 = CreateExpander(UIElements=stack_98, Header="Import geometry from Rhino", Open=invert(True))
expander_12 = CreateExpander(UIElements=stack_97, Header="Select program", Open=invert(True))
expander_13 = CreateExpander(UIElements=stack_96, Header="Select construction", Open=invert(True))
stack_99 = CreateStack(UIElements=entwine_121, Horizontal=invert(True))
merge_13 = Merge(Data1=tb_13, Data2=entwine_120)
merge_14 = Merge(Data1=stack_99, Data2=tb_12)
heath_window_w = RemoteSender(number_slider_35)

heath_window_w_2 = RemoteReceiver(heath_window_w)
subtraction_12 = Subtraction(A=heath_window_w_2, B=Slider(70, range=0..100))
adjustpos_105 = AdjustElementPositioning(ElementsToAdjust=tb_18, AbsolutePositioning=False, Width=subtraction_12)

heath_window_w_3 = RemoteReceiver(heath_window_w)
subtraction_13 = Subtraction(A=heath_window_w_3, B=Slider(70, range=0..100))
adjustpos_106 = AdjustElementPositioning(ElementsToAdjust=tb_14, AbsolutePositioning=False, Width=subtraction_13)

heath_window_w_4 = RemoteReceiver(heath_window_w)
subtraction_14 = Subtraction(A=heath_window_w_4, B=Slider(70, range=0..100))
adjustpos_107 = AdjustElementPositioning(ElementsToAdjust=tb_15, AbsolutePositioning=False, Width=subtraction_14)

heath_window_w_5 = RemoteReceiver(heath_window_w)
subtraction_15 = Subtraction(A=heath_window_w_5, B=Slider(70, range=0..100))
adjustpos_108 = AdjustElementPositioning(ElementsToAdjust=tb_16, AbsolutePositioning=False, Width=subtraction_15)

heath_window_w_6 = RemoteReceiver(heath_window_w)
subtraction_16 = Subtraction(A=heath_window_w_6, B=Slider(70, range=0..100))
adjustpos_109 = AdjustElementPositioning(ElementsToAdjust=tb_17, AbsolutePositioning=False, Width=subtraction_16)

heath_window_w_7 = RemoteReceiver(heath_window_w)
subtraction_17 = Subtraction(A=heath_window_w_7, B=Slider(70, range=0..100))
adjustpos_110 = AdjustElementPositioning(ElementsToAdjust=tb_21, AbsolutePositioning=False, Width=subtraction_17)

heath_window_w_8 = RemoteReceiver(heath_window_w)
subtraction_18 = Subtraction(A=heath_window_w_8, B=Slider(70, range=0..100))
adjustpos_111 = AdjustElementPositioning(ElementsToAdjust=tb_22, AbsolutePositioning=False, Width=subtraction_18)

heath_window_w_9 = RemoteReceiver(heath_window_w)
subtraction_19 = Subtraction(A=heath_window_w_9, B=Slider(70, range=0..100))
adjustpos_112 = AdjustElementPositioning(ElementsToAdjust=tb_19, AbsolutePositioning=False, Width=subtraction_19)

heath_window_w_10 = RemoteReceiver(heath_window_w)
subtraction_20 = Subtraction(A=heath_window_w_10, B=Slider(70, range=0..100))
adjustpos_113 = AdjustElementPositioning(ElementsToAdjust=tb_23, AbsolutePositioning=False, Width=subtraction_20)

heath_window_w_11 = RemoteReceiver(heath_window_w)
subtraction_21 = Subtraction(A=heath_window_w_11, B=Slider(70, range=0..100))
adjustpos_114 = AdjustElementPositioning(ElementsToAdjust=tb_20, AbsolutePositioning=False, Width=subtraction_21)

heath_window_w_12 = RemoteReceiver(heath_window_w)
subtraction_22 = Subtraction(A=heath_window_w_12, B=Slider(70, range=0..100))
adjustpos_115 = AdjustElementPositioning(ElementsToAdjust=tb_27, AbsolutePositioning=False, Width=subtraction_22)

heath_window_w_13 = RemoteReceiver(heath_window_w)
subtraction_23 = Subtraction(A=heath_window_w_13, B=Slider(70, range=0..100))
adjustpos_116 = AdjustElementPositioning(ElementsToAdjust=tb_24, AbsolutePositioning=False, Width=subtraction_23)

heath_window_w_14 = RemoteReceiver(heath_window_w)
subtraction_24 = Subtraction(A=heath_window_w_14, B=Slider(70, range=0..100))
adjustpos_117 = AdjustElementPositioning(ElementsToAdjust=tb_25, AbsolutePositioning=False, Width=subtraction_24)

heath_window_w_15 = RemoteReceiver(heath_window_w)
subtraction_25 = Subtraction(A=heath_window_w_15, B=Slider(70, range=0..100))
adjustpos_118 = AdjustElementPositioning(ElementsToAdjust=tb_26, AbsolutePositioning=False, Width=subtraction_25)

heath_window_w_16 = RemoteReceiver(heath_window_w)
subtraction_26 = Subtraction(A=heath_window_w_16, B=Slider(50, range=0..100))
adjustpos_119 = AdjustElementPositioning(ElementsToAdjust=[expander_9, expander_7, expander_6, expander_2], AbsolutePositioning=False, Width=subtraction_26)
heath_window_w_17 = RemoteReceiver(heath_window_w)
subtraction_27 = Subtraction(A=heath_window_w_17, B=Slider(50, range=0..100))
adjustpos_120 = AdjustElementPositioning(
    ElementsToAdjust=[expander_11, expander_12, expander_13, expander, expander_4, expander_5, gate_9.Target1, tb_12, tb_13],
    AbsolutePositioning=False,
    Width=subtraction_27)
concat_5 = Concatenate(FragmentA=heath_folder_3, FragmentB="heath/butterfly_heath_short.png")

# ----
# Recursion
panel_130 = Panel("Heath main")
objbynn_7 = GetObjectByNickname(NickName=panel_130)
heath_main = Python3Script()  # -> status; same code as lca_window_status

# ----
# Define construction
# # Define program and construction
# To be added...
# 
# ## Instructions
# To be added...
# 
# ## Inputs
# - ...
# 
# ## Outputs
# - ...
# 
# ## Interpretation
# To be added...
panel_131 = Panel("My construction")

# ----
# Recursion
panel_132 = Panel("Material info")
objbynn_8 = GetObjectByNickname(NickName=panel_132)
material_info = Python3Script()  # -> status; same code as lca_window_status

# ----
# Recursion
panel_133 = Panel("Window database")
objbynn_9 = GetObjectByNickname(NickName=panel_133)
window_database = Python3Script()  # -> status; same code as lca_window_status

# ----
# Window database launch
open_window_database_2 = RemoteReceiver(open_window_database)
rec_32 = DataRecorder(open_window_database_2, DataLimit=-2, RecordData=True)
entwine_122 = Entwine(
    Branch00=stack_95,
    Branch01=label_61,
    Branch02=label_62,
    Branch03=stack_92,
    Branch04=stack_93,
    Branch05=stack_94,
    FlattenInputs=True)  # -> flatten(Result)
database_modal_location_6 = RemoteReceiver(database_modal_location)
open_window_database_3 = RemoteReceiver(open_window_database)

int_10 = Integer(rec_32)

ma_31 = MassAddition(Input=int_10)  # -> Result, PartialResults
entwine_123 = Entwine(Branch00=ma_31.Result, Branch01=window_database, FlattenInputs=True)
rec_33 = DataRecorder(entwine_123, DataLimit=2, RecordData=True)
item_14 = ListItem(List=rec_33, Index=0, Wrap=True)  # -> Item2, Item1, Item
equals_30 = Equality(FirstNumber=item_14.Item2, SecondNumber=item_14.Item1)  # -> Equality, Inequality
bang_5 = ExplodeTree(Data=equals_30.Inequality)  # -> Branch0, Branch1
py3_16 = Python3Script(x=bang_5.Branch0, y=bang_5.Branch1)  # -> a; same code as py3_5
event_31 = EventGate(Data=py3_16)  # -> Data, IsNew
freeze_gate_34 = StreamFreezeGate(Data=py3_16, PassingSwitch=event_31.IsNew)
event_32 = EventGate(Data=freeze_gate_34)  # -> Data, IsNew
panel_134 = Panel(event_32.Data)
launchwin_4 = LaunchWindow(
    Show=event_32.Data,
    Name="Window database",
    Width=Slider(380, range=0..1000),
    Height=Slider(580, range=0..1000),
    ChildStatus=1,
    EnableHorizScroll=False)
winprops_4 = SetWindowProperties(
    Window=launchwin_4,
    StartingLocation=database_modal_location_6,
    Theme=0,
    AccentColor=heath_accent_color_2,
    ShowTitleBar=True,
    BackgroundColor=RGB(255, 255, 255),
    ScaleFactor=1)
winstat_4 = WindowStatus(Window=launchwin_4)
addelems_4 = AddElements(Window=launchwin_4, Elements=flatten(entwine_122), DoVLChecking=True)  # -> AddedElements, ElementNames
py3_17 = Python3Script(window=launchwin_4, activate=open_window_database_3)  # same code as py3_6
window_database_status = RemoteSender(winstat_4)
window_database_elements = RemoteSender(addelems_4.AddedElements)

window_database_status_2 = RemoteReceiver(window_database_status)
expression_27 = Expression(x="Hidden", y=window_database_status_2, Expression="x=y")
expire_4 = ExpireObject(ObjectToExpire=objbynn_9, Expire=expression_27)

# ----
# Recursion
panel_135 = Panel("Material database")
objbynn_10 = GetObjectByNickname(NickName=panel_135)
material_database = Python3Script()  # -> status; same code as lca_window_status

# ----
# Material database launch
panel_136 = Panel("False")
entwine_124 = Entwine(
    Branch00=stack_87,
    Branch01=label_5,
    Branch02=label_59,
    Branch03=stack_90,
    Branch04=stack_91,
    Branch05=stack_89,
    FlattenInputs=True)  # -> flatten(Result)
database_modal_location_7 = RemoteReceiver(database_modal_location)
heath_accent_color_13 = RemoteReceiver(heath_accent_color)

# ----
# Heath module help
# 1. Make sure the geometry have been imported and that the program and constructions are in place, before creating a honeybee model.
# 
# 2. If the model has been created, the "Bake model" button will be enabled along with boxes that lets you visualize the model.
# 
# 3. Set the wall thickness and roof thickness.
# 
# 4. Switch the WWR (window-to-wall-ratio) on, if you want to generate windows automatically.
# 1. Verify that the honeybee model is correct by selecting attributes and clicking the checkboxes in the "Attributes visualization" segment.
# 
# 2. Click the "Run weather visualization" button. If the model is set up correctly the "Direct sun hours" and "Incident radiation" should be displayed on the model.
# 1. Pick which simulation you want to run.
# 
# 2. If the simulation failed a red text will show up, go back and review the honeybee model and settings.
# 
# 3. Otherwise, navigate through the expanded segment to select appropriate displays of the results.
# 
# 4. It is possible to transfer the results to Rhino by clicking "Bake", or to an image file by clicking "Pop-up window".
help_button_2 = RemoteReceiver(help_button)
rec_34 = DataRecorder(help_button_2, DataLimit=-2, RecordData=True)
ma_32 = MassAddition(Input=rec_34)  # -> Result, PartialResults
entwine_125 = Entwine(Branch00=ma_32.Result, Branch01=heath_help, FlattenInputs=True)
rec_35 = DataRecorder(entwine_125, DataLimit=2, RecordData=True)
item_15 = ListItem(List=rec_35, Index=0, Wrap=True)  # -> Item2, Item1, Item
equals_31 = Equality(FirstNumber=item_15.Item2, SecondNumber=item_15.Item1)  # -> Equality, Inequality
bang_6 = ExplodeTree(Data=equals_31.Inequality)  # -> Branch0, Branch1
py3_18 = Python3Script(x=bang_6.Branch0, y=bang_6.Branch1)  # -> a; same code as py3_5
event_33 = EventGate(Data=py3_18)  # -> Data, IsNew
# 1. Select geometry in Rhino.
# 
# 2. Select geometry type under the import geometry heading.
# 
# 3. Click "Save geometry".
# 
# 4. Verify the assigned geometry by pressing the "Preview" checkbox.
# 1. Select the program for the building and room.
# 
# 2. Use the sliders to set the cooling and heating setpoints.
# 
# 3. Estimate how many persons will be in the room with the occupancy slider.
# 1. Select base construction by climate and type of construction.
# 
# 2. If required, create your own material or window. Materials can later be selected when creating custom constructions.
# 
# 3. Constructions and windows make up the subset construction, which is used to modify the base construction.
# 
# 4. Constructions can be loaded from a file, which contains all previously created constructions.
panel_137 = Panel("""1. Import geometry from Rhino
- Select Rhino geometry
- Select "Geometry type" in the dropdown
    - Room: inhabited space
    - Window: aperture in surface
    - Adjacent: surface with no heat loss
    - Context: shading geometry
    - None: removes object from model
- Click "Save geometry" to add geometry to model
- Preview selected geometry using the coloured buttons
- Optionally, automatically generate windows by setting the window-to-wall-ratio using the slider

2. Select program for room
- Select the building type from the dropdown (representing the overarching category of building)
- Select the room type from the dropdown (representing the specific use of the rooms in the building)
- Optionally specify indoor conditions using the sliders

3. Select construction for room
- Select a base construction based on climate and construction type
- Select specific constructions for each subset
- Create new constructions using the hammer and wrench symbol
    - Specify the material and thickness for each layer
    - Create new materials using the hammer and wrench symbol

4. Set location
- Use the "Get weather file URL" to open a webpage and locate the correct location
- On the map, click the location and click "Copy" to copy the URL of the weather file
- Paste the URL in the "URL for weather file (.zip)" field 

5. Construct model
- Once the setup of the model is complete, click "Construct model" to create the analysis model""")
freeze_gate_35 = StreamFreezeGate(Data=py3_18, PassingSwitch=event_33.IsNew)
panel_138 = Panel("""1. Select model using dropdowns
- Rename and remove models as needed using the buttons
2. Inspect model geometry and program/construction
3. Inspect environmental conditions at location
4. Use Cyclops to carry out quick daylight simulations (experimental feature)""")
panel_139 = Panel("""1. Select model
2. Perform energy simulations
3. Perform daylight simulations
4. Perform LCA (GWP calculation)""")
heath_window_location_3 = RemoteReceiver(heath_window_location)
event_34 = EventGate(Data=freeze_gate_35)  # -> Data, IsNew
label_63 = CreateLabel(LabelText="Create model", LabelSize=18, Justification=0)
panel_140 = Panel(event_34.Data)
tb_42 = CreateTextBlock(Text="Create model", TextSize=12, Justification=0)
launchwin_5 = LaunchWindow(
    Show=event_34.Data,
    Name="Help!",
    Width=Slider(350, range=0..500),
    Height=Slider(500, range=0..500),
    ChildStatus=1,
    EnableHorizScroll=False)
pdecon_4 = Deconstruct(Point=heath_window_location_3)  # -> XComponent, YComponent, ZComponent
pt_13 = ConstructPoint(XCoordinate=Slider(460, range=0..1000), YCoordinate=pdecon_4.YComponent, ZCoordinate=0)
winprops_5 = SetWindowProperties(
    Window=launchwin_5,
    StartingLocation=pt_13,
    Theme=0,
    AccentColor=heath_accent_color_3,
    ShowTitleBar=True,
    BackgroundColor=RGB(255, 255, 255),
    ScaleFactor=1)
entwine_126 = Entwine(Branch00=label_63, Branch01=tb_42, FlattenInputs=True)  # -> flatten(Result)
winstat_5 = WindowStatus(Window=launchwin_5)
help_button_3 = RemoteReceiver(help_button)
heath_help_status = RemoteSender(winstat_5)
addelems_5 = AddElements(Window=launchwin_5, Elements=flatten(entwine_126), DoVLChecking=True)  # -> AddedElements, ElementNames
py3_19 = Python3Script(window=launchwin_5, activate=help_button_3)  # same code as py3_6

heath_help_status_2 = RemoteReceiver(heath_help_status)
expression_28 = Expression(x="Hidden", y=heath_help_status_2, Expression="x=y")
expire_5 = ExpireObject(ObjectToExpire=objbynn_6, Expire=expression_28)

# ----
# Recursion
panel_141 = Panel("Construction database")
objbynn_11 = GetObjectByNickname(NickName=panel_141)
construction_database = Python3Script()  # -> status; same code as lca_window_status

rec_36 = DataRecorder(filter_25, DataLimit=-2, RecordData=True)
int_11 = Integer(rec_36)
ma_33 = MassAddition(Input=int_11)  # -> Result, PartialResults
entwine_127 = Entwine(Branch00=ma_33.Result, Branch01=construction_database, FlattenInputs=True)
rec_37 = DataRecorder(entwine_127, DataLimit=2, RecordData=True)
item_16 = ListItem(List=rec_37, Index=0, Wrap=True)  # -> Item2, Item1, Item
equals_32 = Equality(FirstNumber=item_16.Item2, SecondNumber=item_16.Item1)  # -> Equality, Inequality
bang_7 = ExplodeTree(Data=equals_32.Inequality)  # -> Branch0, Branch1
py3_20 = Python3Script(x=bang_7.Branch0, y=bang_7.Branch1)  # -> a; same code as py3_5
event_35 = EventGate(Data=py3_20)  # -> Data, IsNew
freeze_gate_36 = StreamFreezeGate(Data=py3_20, PassingSwitch=event_35.IsNew)
event_36 = EventGate(Data=freeze_gate_36)  # -> Data, IsNew
panel_142 = Panel(event_36.Data)
launchwin_6 = LaunchWindow(
    Show=event_36.Data,
    Name="Construction database",
    Width=Slider(380, range=0..1000),
    Height=Slider(580, range=0..1000),
    ChildStatus=1,
    EnableHorizScroll=False)
winprops_6 = SetWindowProperties(
    Window=launchwin_6,
    StartingLocation=database_modal_location_5,
    Theme=0,
    AccentColor=heath_accent_color_4,
    ShowTitleBar=True,
    BackgroundColor=RGB(255, 255, 255),
    ScaleFactor=1)
winstat_6 = WindowStatus(Window=launchwin_6)
addelems_6 = AddElements(Window=launchwin_6, Elements=flatten(entwine_110), DoVLChecking=True)  # -> AddedElements, ElementNames
py3_21 = Python3Script(window=launchwin_6, activate=or_16)  # same code as py3_6
panel_143 = Panel(winstat_6)
construction_database_status = RemoteSender(winstat_6)
construction_database_elements = RemoteSender(addelems_6.AddedElements)

construction_database_status_2 = RemoteReceiver(construction_database_status)
expression_29 = Expression(x="Hidden", y=construction_database_status_2, Expression="x=y")
expire_6 = ExpireObject(ObjectToExpire=objbynn_11, Expire=expression_29)

construction_database_status_3 = RemoteReceiver(construction_database_status)
construction_database_status_4 = RemoteReceiver(construction_database_status)
expression_30 = Expression(x="Normal", y=construction_database_status_3, Expression="x=y")
expression_31 = Expression(x="Normal", y=construction_database_status_4, Expression="x=y")
and_10 = GateAnd(A=equals_22.Inequality, B=expression_30)
and_11 = GateAnd(A=equals_23.Inequality, B=expression_31)
event_37 = EventGate(Data=and_10)  # -> Data, IsNew
event_38 = EventGate(Data=and_11)  # -> Data, IsNew
panel_144 = Panel(event_37.Data)
save_constructions = RemoteSender(event_37.Data)
panel_145 = Panel(event_38.Data)
load_constructions = RemoteSender(event_38.Data)

# ----
# Save constructions
panel_146 = Panel("Heath constructions")
save_constructions_2 = RemoteReceiver(save_constructions)
getdocumentusertext_4 = Python3Script(run=save_constructions_2, key=panel_146)  # -> json_string; same code as getdocumentusertext
null_30 = NullItem(Item=getdocumentusertext_4)  # -> NullFlags, InvalidFlags, Description
save_constructions_file_2 = RemoteReceiver(save_constructions_file)
bool_40 = Boolean(invert(null_30.NullFlags))
filter_29 = StreamFilter(Gate=null_30.NullFlags, Stream0=save_constructions_2, Stream1=bool_40)
writetxt = WriteToTextFile(Run=filter_29, TextToWrite=getdocumentusertext_4, FilePath=save_constructions_file_2, Append=False, NewOnly=False)

# ----
# Load constructions
load_constructions_2 = RemoteReceiver(load_constructions)
load_constructions_file_2 = RemoteReceiver(load_constructions_file)
gate_11 = StreamGate(Stream=load_constructions_file_2, Gate=load_constructions_2)  # -> Target0, Target1
getdocumentusertext_5 = Python3Script(run=load_constructions_2, key="Heath constructions")  # -> json_string; same code as getdocumentusertext
file = ReadFile(File=gate_11.Target1, PerLineParse=False)
split_5 = TextSplit(Text=file, Separators="|")  # -> flatten(Result)
entwine_128 = Entwine(Branch00=getdocumentusertext_5, Branch01=file, FlattenInputs=True)  # -> flatten(Result)
strtoobj_2 = HBStringToObject(hb_str=split_5)  # -> hb_obj; plug-in component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
null_31 = NullItem(Item=strtoobj_2)  # -> NullFlags, InvalidFlags, Description
item_17 = ListItem(List=null_31.NullFlags, Index=0, Wrap=True)
filter_30 = StreamFilter(Gate=item_17, Stream0=entwine_128)
join_7 = TextJoin(Text=filter_30, Join="|")
freeze_gate_37 = StreamFreezeGate(Data=join_7, PassingSwitch=load_constructions_2, Freeze=False, Hold=False)

entwine_129 = Entwine(Branch00=ma_30.Result, Branch01=heath_main, FlattenInputs=True)
rec_38 = DataRecorder(entwine_129, DataLimit=2, RecordData=True)
item_18 = ListItem(List=rec_38, Index=0, Wrap=True)  # -> Item2, Item1, Item
equals_33 = Equality(FirstNumber=item_18.Item2, SecondNumber=item_18.Item1)  # -> Equality, Inequality
entwine_130 = Entwine(
    Branch00=model_name_3,
    Branch01=expander_11,
    Branch02=expander_12,
    Branch03=expander_13,
    Branch04=expander,
    Branch05=create_model,
    Branch06=tb_5,
    Branch07=merge,
    FlattenInputs=True)  # -> flatten(Result)
bang_8 = ExplodeTree(Data=equals_33.Inequality)  # -> Branch0, Branch1
py3_22 = Python3Script(x=bang_8.Branch0, y=bang_8.Branch1)  # -> a; same code as py3_5
event_39 = EventGate(Data=py3_22)  # -> Data, IsNew
freeze_gate_38 = StreamFreezeGate(Data=py3_22, PassingSwitch=event_39.IsNew)
event_40 = EventGate(Data=freeze_gate_38)  # -> Data, IsNew
launchwin_7 = LaunchWindow(
    Show=event_40.Data,
    Name="Heath",
    Width=number_slider_35,
    Height=Slider(520, range=0..1000),
    ChildStatus=1,
    EnableHorizScroll=False)
panel_147 = Panel(event_40.Data)
heath_is_active = RemoteSender(event_40.Data)
heath_window = RemoteSender(launchwin_7)
winprops_7 = SetWindowProperties(
    Window=launchwin_7,
    StartingLocation=heath_window_location_2,
    Theme=0,
    AccentColor=heath_accent_color_5,
    ShowTitleBar=True,
    BackgroundColor=RGB(255, 255, 255),
    ScaleFactor=1)
image_4 = CreateImage(ImageSource=concat_5, ImageWidth=Slider(30, range=0..100), ImageHeight=Slider(19, range=0..100))
py3_23 = Python3Script(window=launchwin_7, activate=heath_flying_4)  # same code as py3_6
winstat_7 = WindowStatus(Window=launchwin_7)
entwine_131 = Entwine(Branch00=image_4, Branch01=true_button_7, Branch02=true_button_32, FlattenInputs=True)  # -> flatten(Result)
heath_status = RemoteSender(winstat_7)
stack_100 = CreateStack(UIElements=entwine_131, Horizontal=True)

heath_is_active_2 = RemoteReceiver(heath_is_active)
launchwin_8 = LaunchWindow(
    Show=invert(heath_is_active_2),
    Name="Heath",
    Width=Slider(275, range=0..1000),
    Height=Slider(250, range=0..1000),
    ChildStatus=1,
    EnableHorizScroll=False)
winprops_8 = SetWindowProperties(Window=launchwin_8, StartingLocation=pt_12, AccentColor=heath_accent_color_12, ShowTitleBar=True, ScaleFactor=1)
addelems_7 = AddElements(Window=launchwin_8, Elements=flatten(entwine_100), DoVLChecking=True)  # -> AddedElements, ElementNames
winstat_8 = WindowStatus(Window=launchwin_8)
heath_launch_status = RemoteSender(winstat_8)
heath_launch_elements = RemoteSender(addelems_7.AddedElements)

heath_status_2 = RemoteReceiver(heath_status)
expression_32 = Expression(x="Hidden", y=heath_status_2, Expression="x=y")
expire_7 = ExpireObject(ObjectToExpire=objbynn_7, Expire=expression_32)

stack_101 = CreateStack(UIElements=entwine_130, Horizontal=invert(True))

window_database_status_3 = RemoteReceiver(window_database_status)
window_database_status_4 = RemoteReceiver(window_database_status)
expression_33 = Expression(x="Normal", y=window_database_status_3, Expression="x=y")
expression_34 = Expression(x="Normal", y=window_database_status_4, Expression="x=y")
and_12 = GateAnd(A=equals_28.Inequality, B=expression_33)
and_13 = GateAnd(A=equals_29.Inequality, B=expression_34)
event_41 = EventGate(Data=and_12)  # -> Data, IsNew
event_42 = EventGate(Data=and_13)  # -> Data, IsNew
panel_148 = Panel(event_41.Data)
save_windows = RemoteSender(event_41.Data)
panel_149 = Panel(event_42.Data)
load_windows = RemoteSender(event_42.Data)

# ----
# Load windows
load_windows_file_2 = RemoteReceiver(load_windows_file)
load_windows_2 = RemoteReceiver(load_windows)
gate_12 = StreamGate(Stream=load_windows_file_2, Gate=load_windows_2)  # -> Target0, Target1
getdocumentusertext_6 = Python3Script(run=load_windows_2, key="Heath windows")  # -> json_string; same code as getdocumentusertext
file_2 = ReadFile(File=gate_12.Target1, PerLineParse=False)
entwine_132 = Entwine(Branch00=getdocumentusertext_6, Branch01=file_2, FlattenInputs=True)  # -> flatten(Result)
split_6 = TextSplit(Text=file_2, Separators="|")  # -> flatten(Result)
strtoobj_3 = HBStringToObject(hb_str=split_6)  # -> hb_obj; plug-in component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
null_32 = NullItem(Item=strtoobj_3)  # -> NullFlags, InvalidFlags, Description
item_19 = ListItem(List=null_32.NullFlags, Index=0, Wrap=True)
filter_31 = StreamFilter(Gate=item_19, Stream0=entwine_132)
join_8 = TextJoin(Text=filter_31, Join="|")
freeze_gate_39 = StreamFreezeGate(Data=join_8, PassingSwitch=load_windows_2, Freeze=False, Hold=False)

# ----
# Save windows
panel_150 = Panel("Heath windows")
save_windows_2 = RemoteReceiver(save_windows)
getdocumentusertext_7 = Python3Script(run=save_windows_2, key=panel_150)  # -> json_string; same code as getdocumentusertext
null_33 = NullItem(Item=getdocumentusertext_7)  # -> NullFlags, InvalidFlags, Description
bool_41 = Boolean(invert(null_33.NullFlags))
save_windows_file_2 = RemoteReceiver(save_windows_file)
filter_32 = StreamFilter(Gate=null_33.NullFlags, Stream0=save_windows_2, Stream1=bool_41)
writetxt_2 = WriteToTextFile(Run=filter_32, TextToWrite=getdocumentusertext_7, FilePath=save_windows_file_2, Append=False, NewOnly=False)

# ----
# Heath material info
number_slider_36 = Slider(1.15, range=0..10)
number_slider_37 = Slider(560, range=0..1000)
number_slider_38 = Slider(500, range=0..1000)
panel_151 = Panel("heath/Building physics from physical principles to international standards, Marko Pinteric_page-0001.jpg")
multiplication = Multiplication(A=number_slider_36, B=number_slider_37)
create_modal_location_2 = RemoteReceiver(create_modal_location)
heath_accent_color_14 = RemoteReceiver(heath_accent_color)
multiplication_2 = Multiplication(A=Slider(1.25, range=0..10), B=number_slider_38)
concat_6 = Concatenate(FragmentA=heath_folder_2, FragmentB=panel_151)
image_5 = CreateImage(ImageSource=concat, ImageWidth=multiplication_2, ImageHeight=number_slider_38)
setimg = SetImage(ImageToModify=image_5, NewImagePath=concat_6)

# ----
# Assemble Honeybee model
# # Assemble Honeybee model
# This cluster takes input geometry and geometric information and generates a valid Honeybee model which can be used in the following analysis steps.
# 
# ## Instructions
# Enter the relevant inputs to generate the Honeybee model. Windows can either be created using an input geometry or through auto-generation using a window-to-wall ratio.
# 
# ### Room geometry
# Each 3D Brep entered represents one room or thermal zone in the building with no air exchange between them. The Breps should be closed and 3D to generate valid rooms. The room geometries should represent the inner boundary of the external walls
# 
# ### Adjacent geometry
# Geometry of adjacent buildings represented by a surface where they contact the room geometry. Adiabatic boundary condition will be assumed at the contact surface.
# 
# ### Windows/apertures
# Windows can either be defined through a list of 2D surfaces which intersect with the room 3D geometries, or be auto-generated through the list of numeric outputs.
# 
# ### Wall/roof thicknesses
# Wall and roof thicknesses are supplied to generate a shading geometry representing the external surface thickness
# 
# ### Louvers
# If all related inputs are entered, shading louvers will be generated on each window according to the entered parameters.
# 
# ### Different directions
# All the above inputs will be the same for all rooms, however they can be optionally entered as a list which represents different values for different cardinal directions, in the order (N, E, S, W).
# 
# ## Inputs
# - `Model name` - text string representing the name of the analysis model
# - `Room geometry` - list of 3D closed Brep geometries representing each room/zone in the model
# - `Construction set` - text string representing the construction to be used for the rooms, can be retrieved using the HB Construction Set by Climate component
# - `Program` - Honeybee Program or list of which are applied to the rooms in the model. Can be defined using the HB Search Programs component
# - `Context geometry` - list of surrounding Brep geometries which shades the analysed Rooms
# - `Windows` - list of 2D Brep geometries which represent the openings in the building envelope. If not supplied, windows are instead generated through definition of window-to-wall ratios as defined below
# - `Skylights` - list of 2D Brep geometries which represent the openings in the building roof
# - `Window-to-wall ratio` - number representing the window-to-wall ratio on each exterior surface Used if no window geometries are supplied.
# - `Subdivide generated windows` - set to True if the window surface area should be divided into multiple windows on each exterior surface
# - `Window height` - number representing the target height of the auto-generated windows
# - `Sill height` - number representing how high the lower edge of the auto-generated windows should be from the room floor
# - `Horizontal separation` - number representing how far separated the auto-generated windows should be horizontally
# - `Vertical separation` - number representing if auto-generated windows should be split vertically and if so, what distance
# - `Wall thickness` - number representing the thickness of the exterior walls, used to generate shading geometry for windows
# - `Roof thickness` - number representing the thickness of the roof, used to generate shading geometry for skylights
# - `Louver depth` - number optionally representing the depth of louvers
# - `Number of louvers` - number optionally representing the amount of louvers on each window
# - `Distance between louvers ` - number optionally representing the distance between louvers on each window
# - `Louver angle` - number optionally representing if louvers should be tilted
# - `Vertical/horizontal louvers` - boolean, set to True if louvers should be vertical
# 
# ## Outputs
# - `Honeybee model` - valid Honeybee model for further analysis
# 
# ## Interpretation
# To be added...
pre_create_model_2 = RemoteReceiver(pre_create_model)
heath_geometry_type_key_7 = RemoteReceiver(heath_geometry_type_key)
panel_152 = Panel("""Room
Adjacent
Context
Window""")
or_17 = GateOr(B=pre_create_model_2, C=Toggle(True))
gate_13 = StreamGate(Stream=heath_geometry_type_key_7, Gate=or_17)  # -> Target0, Target1
refkv = ReferenceByKeyValue(Key=gate_13.Target1, Val=graft(panel_152), lightweight=False, DisableAutoUpdate=True)
generate_wwr_2 = RemoteReceiver(generate_wwr)
pre_create_model_3 = RemoteReceiver(pre_create_model)
model_name_4 = RemoteReceiver(model_name)
data_18 = Data(programtype)
bang_9 = ExplodeTree(Data=refkv)  # -> Branch0, Branch1, Branch2, Branch3, Branch4
room = Geometry(bang_9.Branch0)
adjacent = Geometry(bang_9.Branch1)
context_2 = Geometry(bang_9.Branch2)
windows_3 = Geometry(bang_9.Branch3)
panel_153 = Panel(pre_create_model_3)
cluster = Cluster_6(id=room)
cluster_2 = Cluster_6(id=adjacent)
cluster_3 = Cluster_6(id=context_2)
cluster_4 = Cluster_6(id=windows_3)
heatcool = HBHeatCoolHVACTemplates({"Baseboard electric": "ElectricBaseboard", "Baseboard gas boiler": "BoilerBaseboard", "Baseboard central air source heat pump": "ASHPBaseboard", "Baseboard district hot water": "DHWBaseboard", "Direct evap coolers with baseboard electric": "EvapCoolers_ElectricBaseboard", "Direct evap coolers with baseboard gas boiler": "EvapCoolers_BoilerBaseboard"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}, selected="Residential heat pump with no cooling": "ResidentialHPNoCool")
window_height = Number()
sill_height = Number(Slider(0.3, range=0..1))
horizontal_separation = Number()
vertical_separation = Number()
subdivide_generated_windows = Boolean(Toggle(True))
load_models_ping = Python3Script()  # -> folder
# ---------- load_models_ping: Python ----------
import os
from Rhino import RhinoDoc

folder_path = ("\\").join(ghdoc.Path.split("\\")[:-1])
rhino_file_name = (RhinoDoc.ActiveDoc.Path).split("\\")[-1][:-4]
folder_name = 'Honeybee models'
full_path = folder_path + "\\heath_data\\" + rhino_file_name + "\\" + folder_name

try:
    os.mkdir(("\\").join(full_path.split("\\")[:-2]))
    os.mkdir(("\\").join(full_path.split("\\")[:-1]))
    os.mkdir(full_path)
except FileExistsError:
    # directory already exists
    pass

folder = full_path
# ---------- end load_models_ping ----------
py3_24 = Python3Script(folder=load_models_ping)  # -> model_names, files
# ---------- py3_24: Python ----------
import os

files = [str(folder + '\\' + f) for f in os.listdir(folder) if not os.path.isdir(os.path.join(folder, f))]

model_names = [f.split('\\')[-1][:-7] for f in files]
# ---------- end py3_24 ----------
cset_4 = CreateSet(List=py3_24.model_names)  # -> Set, Map
cset_5 = CreateSet(List=py3_24.files)  # -> Set, Map
item_20 = ListItem(List=cset_5.Set, Index=current_selected_model_visualise_module_4, Wrap=invert(True))
rename_current_model_name_4 = RemoteReceiver(rename_current_model_name)
pre_remove_current_model_3 = RemoteReceiver(pre_remove_current_model)
pre_rename_current_model_3 = RemoteReceiver(pre_rename_current_model)
current_all_created_models_names = RemoteSender(cset_4.Set)
show_honeybee_element_3 = RemoteReceiver(show_honeybee_element)
loadobjects = HBLoadObjects(hb_file=item_20, load=Toggle(True))  # -> report, flatten(hb_objs); plug-in component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
py3_25 = Python3Script(rename=pre_rename_current_model_3, rename_name=rename_current_model_name_4, file_path=item_20)  # -> name_dictionary
# ---------- py3_25: Python ----------
import os
from pathlib import Path
import time

if rename:
    rename_name = "\\".join(file_path.split("\\")[:-1]) + "\\" + rename_name
    
    if rename_name.endswith(".hbjson"):
        pass
    else:
        rename_name = rename_name + ".hbjson"

    if os.path.exists(file_path):
        os.rename(file_path, rename_name)
        current_time = time.time()
        os.utime(rename_name, (current_time, current_time))
    name_dictionary = (Path(file_path).stem, Path(rename_name).stem)
# ---------- end py3_25 ----------
py3_26 = Python3Script(remove=pre_remove_current_model_3, file_path=item_20)
# ---------- py3_26: Python ----------
import os
import shutil

if remove:
    print("hell oworld")
    if os.path.exists(file_path):
        print("hello")
        dir_path = os.path.dirname(file_path)
        new_dir = os.path.join(dir_path, "deleted")
        os.makedirs(new_dir, exist_ok = True)
        shutil.move(file_path, os.path.join(new_dir, os.path.basename(file_path)))
# ---------- end py3_26 ----------
data_19 = Data(loadobjects.hb_objs)
panel_154 = Panel(item_20)
panel_155 = Panel(pre_remove_current_model_3)
hasdata_4 = DataExists(Data=loadobjects.hb_objs)
gate_14 = StreamGate(Stream=loadobjects.hb_objs, Gate=show_honeybee_element_3)  # -> Target0, Target1
deconstructmodel = HBDeconstructModel(model=data_19)  # -> rooms, faces, apertures, doors, shades; plug-in component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
py3_27 = Python3Script(x=py3_25)  # -> out, a
# ---------- py3_27: Python ----------
a = x is not None
# ---------- end py3_27 ----------
vizbytype = HBVisualizeByType(hb_objs=gate_14.Target1)  # -> walls, interior_walls, roofs, ceilings, exterior_floors, interior_floors, air_walls, apertures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; plug-in component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
honeybee_model_ready = RemoteSender(hasdata_4)
gate_15 = StreamGate(Stream=py3_25, Gate=py3_27.a)  # -> Target0, Target1
geoprop = HBGeometryProperties(rooms=flatten(deconstructmodel.rooms))  # -> ext_wall_area, ext_win_area, volume, floor_area, floor_ep_constr; plug-in component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
rec_39 = DataRecorder(gate_15.Target1, DataLimit=-10, RecordData=True)
model_name_dictionary = RemoteSender(rec_39)
panel_156 = Panel(geoprop.floor_area)

current_all_created_models_names_2 = RemoteReceiver(current_all_created_models_names)
honeybee_model_ready_2 = RemoteReceiver(honeybee_model_ready)
lng_9 = ListLength(List=current_all_created_models_names_2)
current_all_created_models_names_3 = RemoteReceiver(current_all_created_models_names)
subtraction_28 = Subtraction(A=lng_9, B="1")
filter_33 = StreamFilter(Gate=honeybee_model_ready_2, Stream0=Slider(500, range=0..1000), Stream1=Slider(1000000, range=0..1000000))
filter_34 = StreamFilter(Gate=honeybee_model_ready_2, Stream0="Create a model before running the simulation", Stream1=" ")
tooltip_12 = AttachTooltipToElement(ElementsToAttachTo=button_5, TooltipContent=filter_34, ShowDelay=filter_33, Duration=2000)
expression_35 = Expression(x=model_name_2, y=current_all_created_models_names_3, Expression="x=y")
honeybee_model_ready_3 = RemoteReceiver(honeybee_model_ready)
ma_34 = MassAddition(Input=expression_35)  # -> Result, PartialResults
hideshow_32 = HideShowElement(ElementToHideShow=button_5, Show=True, Collapse=True, Disable=invert(honeybee_model_ready_3))
current_all_created_models_names_4 = RemoteReceiver(current_all_created_models_names)
lng_10 = ListLength(List=current_all_created_models_names_4)
hideshow_33 = HideShowElement(ElementToHideShow=[tb_12, tb_13], Show=invert(lng_10), Collapse=True, Disable=False)

# ----
# Models created in the
# the current folder
panel_157 = Panel(py3_24.model_names)

nulls_in_empty_3 = NullsInEmptyBranches(DataWithEmptyBranches=cset_5.Set)
null_34 = NullItem(Item=nulls_in_empty_3)  # -> NullFlags, InvalidFlags, Description
item_21 = ListItem(List=cset_4.Set, Index=current_selected_model_visualise_module_4, Wrap=invert(True))
bool_42 = Boolean(invert(null_34.NullFlags))
honeybee_model_exists = RemoteSender(bool_42)
honeybee_model_exists_2 = RemoteReceiver(honeybee_model_exists)
hideshow_34 = HideShowElement(ElementToHideShow=pulldown_2, Show=honeybee_model_exists_2, Collapse=True, Disable=False)
current_all_created_models_names_5 = RemoteReceiver(current_all_created_models_names)  # disabled
model_name_dictionary_2 = RemoteReceiver(model_name_dictionary)  # disabled
honeybee_model = Data(loadobjects.hb_objs)
model_name_dictionary_3 = RemoteReceiver(model_name_dictionary)
current_all_created_models_names_6 = RemoteReceiver(current_all_created_models_names)
current_all_created_models_names_7 = RemoteReceiver(current_all_created_models_names)
model_name_dictionary_4 = RemoteReceiver(model_name_dictionary)

# ---- group: Visualize module (continued)
current_all_created_models_names_8 = RemoteReceiver(current_all_created_models_names)
current_all_created_models_names_9 = RemoteReceiver(current_all_created_models_names)
lng_11 = ListLength(List=current_all_created_models_names_9)
mindex_5 = MemberIndex(Set=current_all_created_models_names_8, Member=rename_current_model_name_2)  # -> Index, Count
subtraction_29 = Subtraction(A=lng_11, B="1")
bool_43 = Boolean(invert(mindex_5.Count))
filter_35 = StreamFilter(Gate=bool_43, Stream0=Slider(500, range=0..1000), Stream1=Slider(1000000, range=0..1000000))
filter_36 = StreamFilter(Gate=bool_43, Stream0="Model name already exists", Stream1=" ")
tooltip_13 = AttachTooltipToElement(ElementsToAttachTo=button_24, TooltipContent=filter_36, ShowDelay=filter_35, Duration=2000)
honeybee_model_exists_3 = RemoteReceiver(honeybee_model_exists)
honeybee_model_exists_4 = RemoteReceiver(honeybee_model_exists)
honeybee_model_exists_5 = RemoteReceiver(honeybee_model_exists)
hideshow_35 = HideShowElement(ElementToHideShow=[pulldown_7, button_25], Show=honeybee_model_exists_3, Collapse=True, Disable=False)
hideshow_36 = HideShowElement(ElementToHideShow=button_24, Show=honeybee_model_exists_4, Collapse=True, Disable=mindex_5.Count)
hideshow_37 = HideShowElement(ElementToHideShow=textbox_8, Show=honeybee_model_exists_5, Collapse=True, Disable=False)

# ---- group: Analysis module (continued)
honeybee_model_ready_4 = RemoteReceiver(honeybee_model_ready)
honeybee_model_ready_5 = RemoteReceiver(honeybee_model_ready)
honeybee_model_ready_6 = RemoteReceiver(honeybee_model_ready)
filter_37 = StreamFilter(Gate=honeybee_model_ready_4, Stream0=Slider(500, range=0..1000), Stream1=Slider(1000000, range=0..1000000))
filter_38 = StreamFilter(Gate=honeybee_model_ready_4, Stream0="Create a model before running the simulation", Stream1=" ")
filter_39 = StreamFilter(Gate=honeybee_model_ready_5, Stream0=Slider(500, range=0..1000), Stream1=Slider(1000000, range=0..1000000))
filter_40 = StreamFilter(Gate=honeybee_model_ready_5, Stream0="Create a model before running the simulation", Stream1=" ")
hideshow_38 = HideShowElement(ElementToHideShow=button_29, Show=True, Collapse=True, Disable=invert(honeybee_model_ready_6))
tooltip_14 = AttachTooltipToElement(ElementsToAttachTo=button_29, TooltipContent=filter_38, ShowDelay=filter_37, Duration=2000)
tooltip_15 = AttachTooltipToElement(ElementsToAttachTo=button_30, TooltipContent=filter_40, ShowDelay=filter_39, Duration=2000)
honeybee_model_ready_7 = RemoteReceiver(honeybee_model_ready)
hideshow_39 = HideShowElement(ElementToHideShow=button_30, Show=True, Collapse=True, Disable=invert(honeybee_model_ready_7))
honeybee_model_ready_8 = RemoteReceiver(honeybee_model_ready)
hideshow_40 = HideShowElement(ElementToHideShow=label_43, Show=invert(honeybee_model_ready_8), Collapse=True, Disable=False)

# ----
honeybee_model_exists_6 = RemoteReceiver(honeybee_model_exists)
honeybee_model_exists_7 = RemoteReceiver(honeybee_model_exists)
honeybee_model_exists_8 = RemoteReceiver(honeybee_model_exists)
hideshow_41 = HideShowElement(ElementToHideShow=label_30, Show=invert(honeybee_model_exists_7), Collapse=True, Disable=False)
hideshow_42 = HideShowElement(ElementToHideShow=entwine_40, Show=honeybee_model_exists_8, Collapse=True, Disable=False)

honeybee_model_exists_9 = RemoteReceiver(honeybee_model_exists)
hideshow_43 = HideShowElement(ElementToHideShow=label_53, Show=invert(honeybee_model_exists_9), Collapse=True, Disable=False)

# ---- group: Prepare model (continued)
bool_44 = Boolean(ma_34.Result)
filter_41 = StreamFilter(Gate=bool_44, Stream0="Construct model!", Stream1="Update model")

# ----
tabs = TabbedView(
    TabNames=panel_17,
    TabTextSize=Slider(14, range=0..100),
    Tab0=flatten(stack_101),
    Tab1=flatten(stack_99),
    Tab2=flatten(entwine_120))
values_148 = ValueListener(Elements=tabs, SomeProperty=True)  # -> Values, Indices
current_tab_index = RemoteSender(values_148.Indices)
stack_102 = CreateStack(UIElements=tabs, Horizontal=True)
entwine_133 = Entwine(Branch00=stack_100, Branch01=stack_102, FlattenInputs=True)  # -> flatten(Result)
addelems_8 = AddElements(Window=launchwin_7, Elements=flatten(entwine_133), DoVLChecking=True)  # -> AddedElements, ElementNames
heath_elements = RemoteSender(addelems_8.AddedElements)

current_tab_index_2 = RemoteReceiver(current_tab_index)

# ----
# 1. Import geometry from Rhino
current_tab_index_3 = RemoteReceiver(current_tab_index)
filter_42 = StreamFilter(Gate=current_tab_index_3, Stream0="Create model", Stream1="Select model", Stream2="Simulate!")
filter_43 = StreamFilter(Gate=current_tab_index_3, Stream0=panel_137, Stream1=panel_138, Stream2=panel_139)
settextblock_10 = SetTextBlockContents(TextBlockToModify=tb_42, NewTextBlockContents=filter_43)
setlabel_3 = SetLabelContents(LabelToModify=label_63, NewLabelContents=filter_42)

event_43 = EventGate(Data=values_148.Values)  # -> Data, IsNew

current_tab = RemoteSender(event_43.Data)

current_tab_2 = RemoteReceiver(current_tab)
current_tab_3 = RemoteReceiver(current_tab)
expression_36 = Expression(x=tab_simulate_2, y=current_tab_2, Expression="x=y")
expression_37 = Expression(x=tab_simulate_3, y=current_tab_3, Expression="x=y")
and_14 = GateAnd(A=equals_2.Inequality, B=expression_36)
and_15 = GateAnd(A=equals.Inequality, B=expression_37)
event_44 = EventGate(Data=and_14)  # -> Data, IsNew
event_45 = EventGate(Data=and_15)  # -> Data, IsNew

# ---- group: Analysis settings (continued)
current_tab_4 = RemoteReceiver(current_tab)
expression_38 = Expression(x=tab_simulate_19, y=current_tab_4, Expression="x=y")
and_16 = GateAnd(A=equals_8.Inequality, B=expression_38)
event_46 = EventGate(Data=and_16)  # -> Data, IsNew
savenorthvector = RemoteSender(event_46.Data)

# ----
and_17 = GateAnd(A=savenorthvector, B=invert(null_9.NullFlags))
panel_158 = Panel(and_17)
setdocumentusertext_2 = Python3Script(key="heath_north_vector", load_value=join, sync=and_17)  # -> done
# ---------- setdocumentusertext_2: Python ----------
import Rhino
import rhinoscriptsyntax as rs
import scriptcontext as sc

def modify_value(value):
    sc.doc = Rhino.RhinoDoc.ActiveDoc

    return rs.SetDocumentUserText(key, value)

    sc.doc = ghdoc

print(sync, load_value)
if sync:
    if load_value:
        done = modify_value(load_value)

    if add_value:
        done = modify_value(add_value)

    if remove_value:
        done = modify_value(remove_value)

    if remove_value == False:
        done = modify_value(None)
# ---------- end setdocumentusertext_2 ----------

current_tab_5 = RemoteReceiver(current_tab)
expression_39 = Expression(x=tab_create_model_4, y=current_tab_5, Expression="x=y")
and_18 = GateAnd(A=equals_20.Inequality, B=expression_39)
event_47 = EventGate(Data=and_18)  # -> Data, IsNew

current_tab_6 = RemoteReceiver(current_tab)
expression_40 = Expression(x=tab_load_inspect_model_6, y=current_tab_6, Expression="x=y")
and_19 = GateAnd(A=equals_4.Inequality, B=expression_40)
current_tab_7 = RemoteReceiver(current_tab)
event_48 = EventGate(Data=and_19)  # -> Data, IsNew
expression_41 = Expression(x=tab_simulate_7, y=current_tab_7, Expression="x=y")
cyclops_info_url = RemoteSender(event_48.Data)
freeze_gate_40 = StreamFreezeGate(Data=expression_41, PassingSwitch=expression_41)

current_tab_8 = RemoteReceiver(current_tab)
expression_42 = Expression(x=tab_simulate_8, y=current_tab_8, Expression="x≠y")
freeze_gate_41 = StreamFreezeGate(Data=expression_42, PassingSwitch=expression_42, Freeze=True)
setexp = SetExpander(Expander=expander_6, ExpandedOpen=invert(freeze_gate_41))

current_tab_9 = RemoteReceiver(current_tab)
expression_43 = Expression(x=tab_simulate_9, y=current_tab_9, Expression="x≠y")
freeze_gate_42 = StreamFreezeGate(Data=expression_43, PassingSwitch=expression_43, Freeze=True)
setexp_2 = SetExpander(Expander=expander_7, ExpandedOpen=invert(freeze_gate_42))

py3_28 = Python3Script(get=freeze_gate_40)  # -> out, vec
# ---------- py3_28: Python ----------
import Rhino
import rhinoscriptsyntax as rs
import Rhino.Geometry as rg
import scriptcontext as sc


try:
    if get:
        sc.doc = Rhino.RhinoDoc.ActiveDoc
        vec_str = rs.GetDocumentUserText("heath_north_vector")
        vec_xyz = vec_str.split(sep=",")
        vec = rg.Vector3d(*map(float, vec_xyz))
    else: vec = None
except:
    vec = None
# ---------- end py3_28 ----------
current_tab_10 = RemoteReceiver(current_tab)

current_tab_11 = RemoteReceiver(current_tab)
expression_44 = Expression(x=tab_simulate_11, y=current_tab_11, Expression="x≠y")
freeze_gate_43 = StreamFreezeGate(Data=expression_44, PassingSwitch=expression_44, Freeze=True)
setexp_3 = SetExpander(Expander=expander_9, ExpandedOpen=invert(freeze_gate_43))

north_vector = RemoteSender(py3_28.vec)
expression_45 = Expression(x=tab_simulate_10, y=current_tab_10, Expression="x≠y")
freeze_gate_44 = StreamFreezeGate(Data=expression_45, PassingSwitch=expression_45, Freeze=True)
setexp_4 = SetExpander(Expander=expander_2, ExpandedOpen=invert(freeze_gate_44))

cyclops_info_url_2 = RemoteReceiver(cyclops_info_url)
py3_29 = Python3Script(url=item_10, launch=cyclops_info_url_2)  # same code as py3

# ----
# Determine which is the currently selected model, in the current tab
tab_load_inspect_model_11 = RemoteReceiver(tab_load_inspect_model)
current_selected_model_visualise_module_5 = RemoteReceiver(current_selected_model_visualise_module_3)
current_selected_model_analysis_module_2 = RemoteReceiver(current_selected_model_analysis_module)
tab_simulate_20 = RemoteReceiver(tab_simulate)
current_tab_12 = RemoteReceiver(current_tab)
current_tab_13 = RemoteReceiver(current_tab)
expression_46 = Expression(x=tab_load_inspect_model_11, y=current_tab_12, Expression="x=y")
expression_47 = Expression(x=tab_simulate_20, y=current_tab_13, Expression="x=y")
gate_16 = StreamGate(Stream=current_selected_model_analysis_module_2, Gate=expression_47)  # -> Target0, Target1
gate_17 = StreamGate(Stream=current_selected_model_visualise_module_5, Gate=expression_46)  # -> Target0, Target1
py3_30 = Python3Script(files=py3_24.files)  # -> out, newest_index; inputs files: list
# ---------- py3_30: Python ----------
""" Checks which of the input files was modified last"""

import os

m = -1
for i, f in enumerate(files):
    t = os.path.getmtime(f)
    # print (f, t)
    if t > m:
        m = t
        newest_index = i
# ---------- end py3_30 ----------
panel_159 = Panel(gate_17.Target1)
panel_160 = Panel(gate_16.Target1)
py3_31 = Python3Script(x2=gate_17.Target1, x3=gate_16.Target1, x4=py3_30.newest_index)  # -> out, a
# ---------- py3_31: Python ----------
""" Keeps track of the most recently updated value using stickycontext"""
""" Kind hacky tbh... but seems to work"""

import scriptcontext as sc

if not sc.sticky.get("current_model_index"):
    sc.sticky["current_model_index"] = (None, (None, None, None))

inputs = (x2, x3, x4)
for i, (u, v) in enumerate(zip(inputs, sc.sticky["current_model_index"][1])):
    if u != v:
        sc.sticky["current_model_index"] = (i, inputs)
        break
a = inputs[sc.sticky["current_model_index"][0]]
# ---------- end py3_31 ----------
event_49 = EventGate(Data=py3_31.a)  # -> Data, IsNew
panel_161 = Panel(event_49.Data)
current_selected_model = RemoteSender(event_49.Data)

current_selected_model_2 = RemoteReceiver(current_selected_model)
setlist_3 = SetListContents(ListToModify=pulldown_2, NewListContents=current_all_created_models_names_2, SelectedIndex=current_selected_model_2)
current_tab_14 = RemoteReceiver(current_tab)
expression_48 = Expression(x=tab_simulate_12, y=current_tab_14, Expression="x=y")
north_vector_2 = RemoteReceiver(north_vector)
remote_receiver = RemoteReceiver(north_vector)
north_vector_3 = RemoteReceiver(north_vector)

current_tab_15 = RemoteReceiver(current_tab)
expression_49 = Expression(x=tab_simulate_16, y=current_tab_15, Expression="x=y")
and_20 = GateAnd(A=equals_16.Inequality, B=expression_49)

current_tab_16 = RemoteReceiver(current_tab)
expression_50 = Expression(x=tab_simulate_17, y=current_tab_16, Expression="x=y")
and_21 = GateAnd(A=equals_6.Inequality, B=expression_50)
event_50 = EventGate(Data=and_21)  # -> Data, IsNew
current_tab_17 = RemoteReceiver(current_tab)
expression_51 = Expression(x=tab_simulate_18, y=current_tab_17, Expression="x=y")
and_22 = GateAnd(A=event_10.Data, B=expression_51)
panel_162 = Panel(and_22)
context_analysis_bake = RemoteSender(and_22)

# ---- group: Visualize module (continued)
current_tab_18 = RemoteReceiver(current_tab)
expression_52 = Expression(x=tab_load_inspect_model_2, y=current_tab_18, Expression="x=y")
current_selected_model_3 = RemoteReceiver(current_selected_model)
setlist_4 = SetListContents(ListToModify=pulldown_7, NewListContents=current_all_created_models_names_9, SelectedIndex=current_selected_model_3)
current_tab_19 = RemoteReceiver(current_tab)
current_tab_20 = RemoteReceiver(current_tab)
expression_53 = Expression(x=tab_load_inspect_model_3, y=current_tab_19, Expression="x=y")
expression_54 = Expression(x=tab_load_inspect_model_4, y=current_tab_20, Expression="x=y")
and_23 = GateAnd(A=equals_11.Inequality, B=expression_53)
and_24 = GateAnd(A=equals_12.Inequality, B=expression_54)
event_51 = EventGate(Data=and_23)  # -> Data, IsNew
event_52 = EventGate(Data=and_24)  # -> Data, IsNew
post_remove_current_model = RemoteSender(event_51.Data)
post_rename_current_model = RemoteSender(event_52.Data)

# ----
expression_55 = Expression(x=tab_simulate_4, y=current_tab_18, Expression="x=y")
or_18 = GateOr(A=expression_52, B=expression_55)

current_tab_21 = RemoteReceiver(current_tab)
expression_56 = Expression(x=tab_load_inspect_model_7, y=current_tab_21, Expression="x=y")
current_tab_22 = RemoteReceiver(current_tab)
current_tab_23 = RemoteReceiver(current_tab)
expression_57 = Expression(x=tab_load_inspect_model_8, y=current_tab_22, Expression="x=y")
expression_58 = Expression(x=tab_load_inspect_model_9, y=current_tab_23, Expression="x=y")
and_25 = GateAnd(A=expression_57, B=values_63.Values)
and_26 = GateAnd(A=values_61.Values, B=expression_57)
and_27 = GateAnd(A=or_2, B=expression_56)
and_28 = GateAnd(A=or_4, B=expression_56)
and_29 = GateAnd(A=or_3, B=expression_56)
and_30 = GateAnd(A=or_5, B=expression_56)
and_31 = GateAnd(A=or, B=expression_56)
and_32 = GateAnd(A=or_6, B=expression_56)
and_33 = GateAnd(A=event_13.Data, B=expression_58)
face_attribute_visualize = RemoteSender(and_25)
room_attribute_visualize = RemoteSender(and_26)
bake_model = RemoteSender(and_33)
show_honeybee_roof = RemoteSender(and_31)
show_honeybee_walls = RemoteSender(and_29)
show_honeybee_floors = RemoteSender(and_27)
show_honeybee_windows = RemoteSender(and_30)
show_honeybee_context = RemoteSender(and_32)
show_honeybee_ground = RemoteSender(and_28)

room_attribute_visualize_2 = RemoteReceiver(room_attribute_visualize)
face_attribute_visualize_2 = RemoteReceiver(face_attribute_visualize)

# ---- group: Geometry module (continued)
current_tab_24 = RemoteReceiver(current_tab)
expression_59 = Expression(x=tab_create_model_2, y=current_tab_24, Expression="x=y")
and_34 = GateAnd(A=bool_16, B=expression_59)
preview_2 = RemoteSender(and_34)
savegeometry = RemoteSender(event_47.Data)

# ----
savegeometry_2 = RemoteReceiver(savegeometry)
savegeometry_3 = RemoteReceiver(savegeometry)
preview_3 = RemoteReceiver(preview_2)
savegeometry_4 = RemoteReceiver(savegeometry)
savegeometry_5 = RemoteReceiver(savegeometry)
savegeometry_6 = RemoteReceiver(savegeometry)
preview_4 = RemoteReceiver(preview_2)
preview_5 = RemoteReceiver(preview_2)
preview_6 = RemoteReceiver(preview_2)
py3_32 = Python3Script(x=savegeometry_2)  # -> a
# ---------- py3_32: Python ----------
"""Grasshopper Script"""

import rhinoscriptsyntax as rs

if x:
    rs.Command("SelNone")
    a = True
# ---------- end py3_32 ----------
or_19 = GateOr(A=savegeometry_3, B=preview_3, C=expression_11)
or_20 = GateOr(A=savegeometry_4, B=preview_4, C=expression_13)
or_21 = GateOr(A=savegeometry_6, B=preview_6, C=expression_15)
or_22 = GateOr(A=Toggle(True), B=py3_32)
or_23 = GateOr(A=savegeometry_5, B=preview_5, C=expression_14)
preview_7 = RemoteReceiver(preview_2)
savegeometry_7 = RemoteReceiver(savegeometry)
gate_18 = StreamGate(Stream=heath_geometry_type_key_6, Gate=or_21)  # -> Target0, Target1
gate_19 = StreamGate(Stream=heath_geometry_type_key_3, Gate=or_19)  # -> Target0, Target1
gate_20 = StreamGate(Stream=heath_geometry_type_key_5, Gate=or_20)  # -> Target0, Target1
selobj_3 = ObjectsBySelection(Reset=or_22, LiveMode=True)
gate_21 = StreamGate(Stream=heath_geometry_type_key_4, Gate=or_23)  # -> Target0, Target1
or_24 = GateOr(A=preview_7, B=room_attribute_visualize_2, C=face_attribute_visualize_2, D=show_honeybee_element_2, E=and_20, F=not)
seletedgeometry = RemoteSender(selobj_3)
seletedgeometry_2 = RemoteReceiver(seletedgeometry)
freeze_gate_45 = StreamFreezeGate(Data=seletedgeometry_2, PassingSwitch=presavegeometry_2, Hold=False)
seletedgeometry_3 = RemoteReceiver(seletedgeometry)
detatt = DetachAttributes(Geometry=seletedgeometry_3)  # -> Geometry, Attributes
filtertype = FilterByType(ObjectType="Extrusion", Geometry=freeze_gate_45, invertFilter=False, returnNulls=False)  # -> ExcludedGeometry, IncludedGeometry
filtertype_2 = FilterByType(ObjectType="Brep", Geometry=freeze_gate_45, invertFilter=False, returnNulls=False)  # -> ExcludedGeometry, IncludedGeometry
filtertype_3 = FilterByType(ObjectType="Surface", Geometry=freeze_gate_45, invertFilter=False, returnNulls=False)  # -> ExcludedGeometry, IncludedGeometry
filtertype_4 = FilterByType(ObjectType="Mesh", Geometry=freeze_gate_45, invertFilter=False, returnNulls=False)  # -> ExcludedGeometry, IncludedGeometry
filtertype_5 = FilterByType(ObjectType="Polysurface", Geometry=freeze_gate_45, invertFilter=False, returnNulls=False)  # -> ExcludedGeometry, IncludedGeometry
ef_att = EleFrontAttributes(Attributes=detatt.Attributes, Keys="Construction", Values=constructiontype, maintainBakeName=False)
modratt = ModifyRhinoObjectAttributes(ReferencedObject=seletedgeometry_3, Attributes=ef_att, Activate=saveconstruction)
refkv_2 = ReferenceByKeyValue(Key=gate_19.Target1, Val=gate_5.Target1, lightweight=False)
refkv_3 = ReferenceByKeyValue(Key=gate_18.Target1, Val=gate_6.Target1, lightweight=False)
refkv_4 = ReferenceByKeyValue(Key=gate_20.Target1, Val=gate_8.Target1, lightweight=False)
planar = IsPlanar(Surface=filtertype_3.IncludedGeometry, Interior=True)  # -> Planar, Plane
refkv_5 = ReferenceByKeyValue(Key=gate_21.Target1, Val=gate_7.Target1, lightweight=False)
ispolysurfaceclosed = Python3Script(Ps=[filtertype.IncludedGeometry, filtertype_2.IncludedGeometry, filtertype_5.IncludedGeometry])  # -> C; inputs Ps: Brep
# ---------- ispolysurfaceclosed: Python ----------
if Ps:
    C = Ps.IsSolid
# ---------- end ispolysurfaceclosed ----------
panel_163 = Panel(modratt)
lng_12 = ListLength(List=freeze_gate_45)  # disabled
cluster_5 = Cluster_6(id=refkv_5)
filter_geometry_by_active_layer = Cluster_6(id=refkv_2)
cluster_6 = Cluster_6(id=refkv_3)
cluster_7 = Cluster_6(id=refkv_4)
cull_11 = CullPattern(
    List=[filtertype.IncludedGeometry, filtertype_2.IncludedGeometry, filtertype_5.IncludedGeometry],
    CullPattern=ispolysurfaceclosed)
cull_12 = CullPattern(List=filtertype_3.IncludedGeometry, CullPattern=planar.Planar)
savegeometry_8 = RemoteReceiver(savegeometry)  # disabled
filter_44 = StreamFilter(Gate=or_24, Stream0="Shaded", Stream1="Wireframe")
preview_8 = RemoteReceiver(preview_2)
preview_9 = RemoteReceiver(preview_2)
preview_10 = RemoteReceiver(preview_2)
preview_11 = RemoteReceiver(preview_2)
filter_45 = StreamFilter(
    Gate=geometrytype_validate_2,
    Stream0=cull_11,
    Stream1=cull_12,
    Stream2=[filtertype_5.IncludedGeometry, filtertype_3.IncludedGeometry],
    Stream3=[filtertype_4.IncludedGeometry, filtertype_3.IncludedGeometry, filtertype_5.IncludedGeometry, filtertype.IncludedGeometry, filtertype_2.IncludedGeometry],
    Stream4=freeze_gate_45)  # -> flatten(Stream)
id = Guid(filter_45)
txt_6 = Text(id)
cset_6 = CreateSet(List=txt_6)  # -> Set, Map
geo = Geometry(cset_6.Set)
detatt_2 = DetachAttributes(Geometry=geo)  # -> Geometry, Attributes
ef_att_2 = EleFrontAttributes(Attributes=detatt_2.Attributes, Keys=heath_geometry_type_key_2, Values=geometrytype_2, maintainBakeName=False)
modratt_2 = ModifyRhinoObjectAttributes(ReferencedObject=geo, Attributes=ef_att_2, Activate=savegeometry_7)
panel_164 = Panel(modratt_2)
lng_13 = ListLength(List=geo)  # disabled
equals_34 = Equality(FirstNumber=lng_12, SecondNumber=lng_13)  # -> Equality, Inequality; disabled
py3_33 = Python3Script(v=filter_44)
# ---------- py3_33: Python ----------
import Rhino
import scriptcontext as sc

if v:
    view = sc.doc.Views.ActiveView
    dm = Rhino.Display.DisplayModeDescription.FindByName(v)
    if dm:
        view.ActiveViewport.DisplayMode = dm
        view.Redraw()
# ---------- end py3_33 ----------
freeze_gate_46 = StreamFreezeGate(Data=equals_34.Equality, PassingSwitch=savegeometry_8)  # disabled
gate_22 = StreamGate(Stream=cluster_7, Gate=preview_9)  # -> Target0, Target1
gate_23 = StreamGate(Stream=cluster_6, Gate=preview_10)  # -> Target0, Target1
gate_24 = StreamGate(Stream=cluster_5, Gate=preview_8)  # -> Target0, Target1
gate_25 = StreamGate(Stream=filter_geometry_by_active_layer, Gate=preview_11)  # -> Target0, Target1
hasdata_5 = DataExists(Data=freeze_gate_46)  # disabled
preview_12 = CustomPreview(Geometry=gate_22.Target1, Material=ColourSwatch(SwatchColor=RGBA(128, 125, 0, 75)))
preview_13 = CustomPreview(Geometry=gate_23.Target1, Material=ColourSwatch(SwatchColor=RGBA(0, 17, 128, 75)))
preview_14 = CustomPreview(Geometry=gate_24.Target1, Material=ColourSwatch(SwatchColor=RGBA(128, 0, 102, 75)))
preview_15 = CustomPreview(Geometry=gate_25.Target1, Material=ColourSwatch(SwatchColor=RGBA(4, 128, 0, 75)))
filter_46 = StreamFilter(Gate=hasdata_5, Stream0=panel_46, Stream1=freeze_gate_46)  # disabled
geometry_saved = RemoteSender(filter_46)  # disabled

seletedgeometry_4 = RemoteReceiver(seletedgeometry)
seletedgeometry_5 = RemoteReceiver(seletedgeometry)
freeze_gate_47 = StreamFreezeGate(Data=seletedgeometry_4, PassingSwitch=event_44.Data)
freeze_gate_48 = StreamFreezeGate(Data=seletedgeometry_5, PassingSwitch=event_45.Data)
geo_2 = Geometry(freeze_gate_47)
geo_3 = Geometry(freeze_gate_48)
selected_shading_geometry = RemoteSender(geo_2)
selected_shading_geometry_2 = RemoteReceiver(selected_shading_geometry)
gate_26 = StreamGate(Stream=selected_shading_geometry_2, Gate=and_3)  # -> Target0, Target1
py3_34 = Python3Script(x=geo_3)  # -> out, a; inputs x: list
# ---------- py3_34: Python ----------
a = len(x) if x is not None and len(x) else 0
# ---------- end py3_34 ----------
format_32 = Format(Format="Show {0} targets", Culture=127, Data0=py3_34.a)
selected_target_geometry = RemoteSender(geo_3)
selected_target_geometry_2 = RemoteReceiver(selected_target_geometry)
gate_27 = StreamGate(Stream=selected_target_geometry_2, Gate=and_4)  # -> Target0, Target1
preview_16 = CustomPreview(Geometry=gate_27.Target1, Material=ColourSwatch(SwatchColor=RGB(84, 84, 84)))
py3_35 = Python3Script(x=geo_2)  # -> out, a; inputs x: list; same code as py3_34
format_33 = Format(Format="Show {0} shades", Culture=127, Data0=py3_35.a)
preview_17 = CustomPreview(Geometry=gate_26.Target1, Material=ColourSwatch(SwatchColor=RGB(84, 84, 84)))
bool_45 = Boolean(py3_34.a)
filter_47 = StreamFilter(Gate=bool_45, Stream0="No geometry selected", Stream1=format_32)
setcheckbox = SetCheckBox(CheckBoxToModify=checkbox_2, NewCheckBoxLabel=filter_47)
hideshow_44 = HideShowElement(ElementToHideShow=checkbox_2, Show=True, Collapse=True, Disable=invert(bool_45))
bool_46 = Boolean(py3_35.a)
filter_48 = StreamFilter(Gate=bool_46, Stream0="No geometry selected", Stream1=format_33)
hideshow_45 = HideShowElement(ElementToHideShow=checkbox, Show=True, Collapse=True, Disable=invert(bool_46))
setcheckbox_2 = SetCheckBox(CheckBoxToModify=checkbox, NewCheckBoxLabel=filter_48)

# ---- group: Geometry module (continued)
seletedgeometry_6 = RemoteReceiver(seletedgeometry)
seletedgeometry_7 = RemoteReceiver(seletedgeometry)
seletedgeometry_8 = RemoteReceiver(seletedgeometry)  # disabled
lng_14 = ListLength(List=seletedgeometry_6)
geometry_saved_2 = RemoteReceiver(geometry_saved)  # disabled
bool_47 = Boolean(lng_14)
lng_15 = ListLength(List=seletedgeometry_8)  # disabled
lng_16 = ListLength(List=seletedgeometry_7)
filter_49 = StreamFilter(Gate=bool_47, Stream0=Slider(500, range=0..1000), Stream1=Slider(1000000, range=0..1000000))
filter_50 = StreamFilter(Gate=bool_47, Stream0="First select the geometry in Rhino", Stream1=" ")
nor = GateNor(A=geometry_saved_2, B=lng_15)  # disabled
hideshow_46 = HideShowElement(ElementToHideShow=button_33, Show=True, Collapse=True, Disable=invert(lng_16))
hideshow_47 = HideShowElement(ElementToHideShow=label_48, Show=nor, Collapse=True, Disable=False)  # disabled
tooltip_16 = AttachTooltipToElement(ElementsToAttachTo=button_33, TooltipContent=filter_50, ShowDelay=filter_49, Duration=2000)

# ----
selected_target_geometry_3 = RemoteReceiver(selected_target_geometry)
selected_shading_geometry_3 = RemoteReceiver(selected_shading_geometry)
lng_17 = ListLength(List=selected_target_geometry_3)
bool_48 = Boolean(lng_17)
and_35 = GateAnd(A=bool_48, B=expression_48, C=context_analysis_expander_is_open_4, D=run_context_analysis_2)
gate_28 = StreamGate(Stream=selected_shading_geometry_3, Gate=and_35)  # -> Target0, Target1
preview_18 = CustomPreview(Geometry=gate_28.Target1, Material=swatch_2)
bbox = BoundingBox(Content=[selected_target_geometry_3, selected_shading_geometry_3], Plane=PlaneXY(0, 0, 0), UnionBox=True)  # -> Box, Box_2
zbb = ZoomBoundingBox(Box=bbox.Box, Run=zoom_context_analysis_2)

# ---- group: Analysis module (continued)
current_tab_25 = RemoteReceiver(current_tab)
current_tab_26 = RemoteReceiver(current_tab)
expression_60 = Expression(x=tab_simulate_5, y=current_tab_25, Expression="x=y")
expression_61 = Expression(x=tab_simulate_6, y=current_tab_26, Expression="x=y")
and_36 = GateAnd(A=equals_14.Inequality, B=expression_60)
and_37 = GateAnd(A=equals_15.Inequality, B=expression_61)
event_53 = EventGate(Data=and_36)  # -> Data, IsNew
event_54 = EventGate(Data=and_37)  # -> Data, IsNew
run_simple_energy_simulations = RemoteSender(event_53.Data)
run_daylight_simulations = RemoteSender(event_54.Data)

# ----
hideshow_48 = HideShowElement(ElementToHideShow=tb_11, Show=run_daylight_simulations, Collapse=True, Disable=False)
run_daylight_simulations_2 = RemoteReceiver(run_daylight_simulations)
run_daylight_simulations_3 = RemoteReceiver(run_daylight_simulations)

# ---- group: Prepare model (continued)
current_tab_27 = RemoteReceiver(current_tab)
expression_62 = Expression(x=tab_create_model_3, y=current_tab_27, Expression="x=y")

# ----
and_38 = GateAnd(A=expression_62, B=heath_flying_2)

# ---- group: Prepare model (continued)
and_39 = GateAnd(A=equals_13.Inequality, B=and_38)
event_55 = EventGate(Data=and_39)  # -> Data, IsNew
create_model_2 = RemoteSender(event_55.Data)

# ----
panel_165 = Panel(create_model_2)
freeze_gate_49 = StreamFreezeGate(Data=create_model_2, PassingSwitch=create_model_2, Freeze=True, Hold=False)
null_35 = NullItem(Item=freeze_gate_49)  # -> NullFlags, InvalidFlags, Description

current_tab_28 = RemoteReceiver(current_tab)
expression_63 = Expression(x=tab_load_inspect_model_5, y=current_tab_28, Expression="x=y")
and_40 = GateAnd(A=event_15.Data, B=expression_63)
weather_visualisation_bake = RemoteSender(and_40)
panel_166 = Panel(and_40)

current_tab_29 = RemoteReceiver(current_tab)
expression_64 = Expression(x=tab_load_inspect_model_10, y=current_tab_29, Expression="x=y")
and_41 = GateAnd(A=event_26.Data, B=expression_64)
cyclops_visualisation_bake = RemoteSender(and_41)

# ----
# Heath module info
panel_167 = Panel("""Energy use intensity (EUI): EUI measures the total energy consumed by a building annually per unit of its floor area.
Annual energy balance: A yearly overview of energy consumption and generation broken into categories such as heating, cooling, lighting, and equipment loads.
Daily cooling/heating profile: Hourly cooling or heating energy usage over a typical day.
Cooling/heating balance: The cooling or heating energy demand broken down by contributing factors across different periods.""")
panel_168 = Panel("Adjust the Window-to-Wall Ratio (WWR) slider to define the proportion of walls occupied by windows in the model. This determines window placement automatically. If diabled, windows that are maunally imported in the geometry module will be used.")
panel_169 = Panel("""Room attribute: Choose a property of the room to visualize and toggle its visibility using the "Show" checkbox.
Room energy attribute: Select energy-related attributes for rooms.
Face attribute: Visualize specific attributes for individual faces.
Face energy attribute: Display energy-specific properties for faces.""")
panel_170 = Panel("""By climate: Choose a predefined climate zone to automatically adjust construction properties for environmental conditions.

By type: Select the construction type that represents the structural system of the building.""")
panel_171 = Panel("""Building Type: Choose the type of building that corresponds to your model.

Room Type: Select the specific room type within the chosen building category.""")
panel_172 = Panel("""This dropdown menu allows you to select the type of geometry you want to work with in the model.

Room: Represents enclosed spaces or areas in the model.
Window: Refers to transparent surfaces, such as glass panels or openings.
Adjacent: Defines surfaces or spaces that are directly connected or neighboring the selected geometry.
Context: Includes external elements like surrounding structures or objects.""")
panel_173 = Panel("""Sky Dome: A 3D view of the sky with solar paths and light distribution.
Sky Mask: Shows visible portions of the sky from a location.
Wind Rose: Visualizes wind direction and speed.
Dry bulb temperature line chart: This chart shows the average daily dry bulb temperature variation throughout the year.
Dry bulb temperature 2D chart: This heatmap provides a detailed view of temperature variations by time of day and month.
Direct Sun Hours: Displays the total number of hours a surface receives direct sunlight throughout the year.
Incident Radiation: Represents the amount of solar radiation (in kWh/m²) received by the surface over the year.""")
panel_174 = Panel("""Spatial daylight autonomy (sDA): Shows the percentage of space that meets the daylight autonomy criteria.
Illuminance [Lux]: The intensity of light falling on a surface, measured in lumens per square meter.
Useful daylight illuminance (UDI): The percentage of time daylight levels fall within a desirable range (e.g., 50–3000 lux).""")
panel_175 = Panel("Assesses the environmental impact by calculating global warming potential (GWP) and visualizing contributions by model elements.")
panel_176 = Panel("""Current location: Displays the project's location .
Set location: Copy and paste from the website that is opened with the "Get clmate data" button, to retrieve climate data relevant to your project.
Get climate data: This button opens this website 
https://www.ladybug.tools/epwmap/""")
panel_177 = Panel("""Create new model: Create a new Honeybee model from the current imported geometry. Click the "update" button to load it into the UI.
Update: Load all of the models corresponding to this file, this can include models from previous sessions.
Remove current model: Delete the currently selected model.
Rename: Rename the currently selected model.""")
panel_178 = Panel("""Cooling Setpoint: Set the temperature at which cooling systems activate.

Heating Setpoint: Set the temperature at which heating systems activate.

Occupancy: Specify the expected number of occupants per 100 square meters.""")
panel_179 = Panel("""Window database: Access a library of window types with predefined thermal and solar properties.

Material database: Browse and select building materials with specific physical and thermal characteristics.

Construction database: Explore various construction assemblies and details for walls, roofs, and other elements.""")
panel_180 = Panel("Customize specific construction elements such as floors, walls and roofs by selecting from a list of options with their respective properties.")
info_save_geometry_2 = RemoteReceiver(info_save_geometry)
panel_181 = Panel("""Use this button to save the imported geometry as part of the Honeybee 
model. This ensures the geometry data is correctly stored and can be utilized for further analysis or visualization within the Heath.""")
panel_182 = Panel("This button generates a predefined sample model to help you explore and understand the tools features. Use it to test workflows, visualize geometry types, and familiarize yourself with the simulation processes before working with your own data.")
rec_40 = DataRecorder(info_save_geometry_2, DataLimit=-2, RecordData=True)
ma_35 = MassAddition(Input=rec_40)  # -> Result, PartialResults
entwine_134 = Entwine(Branch00=panel_169, Branch01=panel_173, FlattenInputs=True)  # -> flatten(Result)
entwine_135 = Entwine(Branch00=panel_167, Branch01=panel_174, Branch02=panel_175, FlattenInputs=True)  # -> flatten(Result)
entwine_136 = Entwine(Branch00="Model Visualization", Branch01="Weather Visualization", FlattenInputs=True)  # -> flatten(Result)
entwine_137 = Entwine(Branch00="Energy simulation", Branch01="Daylight simulation", Branch02="LCA", FlattenInputs=True)  # -> flatten(Result)
entwine_138 = Entwine(Branch00=panel_168, Branch01=panel_176, Branch02=panel_177, FlattenInputs=True)  # -> flatten(Result)
entwine_139 = Entwine(Branch00="Generate Windows Using WWR", Branch01="Location", Branch02="Model actions", FlattenInputs=True)  # -> flatten(Result)
entwine_140 = Entwine(Branch00=panel_171, Branch01=panel_178, FlattenInputs=True)  # -> flatten(Result)
entwine_141 = Entwine(Branch00=panel_170, Branch01=panel_179, Branch02=panel_180, FlattenInputs=True)  # -> flatten(Result)
entwine_142 = Entwine(Branch00="Select program", Branch01="Program settings", FlattenInputs=True)  # -> flatten(Result)
entwine_143 = Entwine(Branch00="Select Base Construction", Branch01="Databases", Branch02="Select Subset Constructions", FlattenInputs=True)  # -> flatten(Result)
entwine_144 = Entwine(Branch00="Geometry type", Branch01="Save Geometry", Branch02="Create test model", FlattenInputs=True)  # -> flatten(Result)
entwine_145 = Entwine(Branch00=panel_172, Branch01=panel_181, Branch02=panel_182, FlattenInputs=True)  # -> flatten(Result)
tb_43 = CreateTextBlock(TextSize=12, Justification=0)
label_64 = CreateLabel(LabelSize=18, Justification=0)
tb_44 = CreateTextBlock(TextSize=12, Justification=0)
tb_45 = CreateTextBlock(TextSize=12, Justification=0)
label_65 = CreateLabel(LabelSize=18, Justification=0)
label_66 = CreateLabel(LabelSize=18, Justification=0)
current_tab_index_4 = RemoteReceiver(current_tab_index)
filter_51 = StreamFilter(
    Gate=current_tab_index_4,
    Stream0=entwine_144,
    Stream1=entwine_142,
    Stream2=entwine_143,
    Stream3=entwine_139,
    Stream4=entwine_136,
    Stream5=entwine_137)
filter_52 = StreamFilter(
    Gate=current_tab_index_4,
    Stream0=entwine_145,
    Stream1=entwine_140,
    Stream2=entwine_141,
    Stream3=entwine_138,
    Stream4=entwine_134,
    Stream5=entwine_135)
format_34 = Format(
    Format="{0}, {1}, {2}, {3}",
    Culture=127,
    Data0=Slider(10, range=-10..10),
    Data1=Slider(0, range=-10..10),
    Data2=Slider(0, range=-10..10),
    Data3=Slider(0, range=-10..10))
format_35 = Format(
    Format="{0}, {1}, {2}, {3}",
    Culture=127,
    Data0=Slider(0, range=-10..10),
    Data1=Slider(10, range=-10..10),
    Data2=Slider(0, range=-10..10),
    Data3=Slider(0, range=-10..10))
entwine_146 = Entwine(Branch00=label_65, Branch01=tb_44, FlattenInputs=True)  # -> flatten(Result)
entwine_147 = Entwine(Branch00=label_64, Branch01=tb_43, FlattenInputs=True)  # -> flatten(Result)
entwine_148 = Entwine(Branch00=label_66, Branch01=tb_45, FlattenInputs=True)  # -> flatten(Result)
adjustpos_121 = AdjustElementPositioning(ElementsToAdjust=[tb_43, tb_45, tb_44], Margin=format_34, AbsolutePositioning=False, HorizontalAlignment=0)
adjustpos_122 = AdjustElementPositioning(ElementsToAdjust=[label_66, label_65], Margin=format_35, AbsolutePositioning=False, HorizontalAlignment=0)
setlabel_4 = SetLabelContents(LabelToModify=[label_64, label_66, label_65], NewLabelContents=filter_51)
settextblock_11 = SetTextBlockContents(TextBlockToModify=[tb_43, tb_45, tb_44], NewTextBlockContents=filter_52)
stack_103 = CreateStack(UIElements=entwine_146, Horizontal=invert(True))
stack_104 = CreateStack(UIElements=entwine_147, Horizontal=invert(True))
stack_105 = CreateStack(UIElements=entwine_148, Horizontal=invert(True))
entwine_149 = Entwine(Branch00=stack_104, Branch01=stack_105, Branch02=stack_103, FlattenInputs=True)  # -> flatten(Result)
database_modal_location_8 = RemoteReceiver(database_modal_location)
heath_accent_color_15 = RemoteReceiver(heath_accent_color)
info_save_geometry_3 = RemoteReceiver(info_save_geometry)

# ----
# Recursion
panel_183 = Panel("Geometry info")
objbynn_12 = GetObjectByNickname(NickName=panel_183)
geometry_info = Python3Script()  # -> status; same code as lca_window_status

entwine_150 = Entwine(Branch00=ma_35.Result, Branch01=geometry_info, FlattenInputs=True)
rec_41 = DataRecorder(entwine_150, DataLimit=2, RecordData=True)
item_22 = ListItem(List=rec_41, Index=0, Wrap=True)  # -> Item2, Item1, Item
equals_35 = Equality(FirstNumber=item_22.Item2, SecondNumber=item_22.Item1)  # -> Equality, Inequality
bang_10 = ExplodeTree(Data=equals_35.Inequality)  # -> Branch0, Branch1
py3_36 = Python3Script(x=bang_10.Branch0, y=bang_10.Branch1)  # -> a; same code as py3_5
event_56 = EventGate(Data=py3_36)  # -> Data, IsNew
freeze_gate_50 = StreamFreezeGate(Data=py3_36, PassingSwitch=event_56.IsNew)
event_57 = EventGate(Data=freeze_gate_50)  # -> Data, IsNew
panel_184 = Panel(event_57.Data)
launchwin_9 = LaunchWindow(
    Show=event_57.Data,
    Name="Module information",
    Width=Slider(430, range=0..1200),
    Height=Slider(450, range=0..1000),
    ChildStatus=1,
    EnableHorizScroll=False)
winstat_9 = WindowStatus(Window=launchwin_9)
winprops_9 = SetWindowProperties(
    Window=launchwin_9,
    StartingLocation=database_modal_location_8,
    Theme=0,
    AccentColor=heath_accent_color_15,
    ShowTitleBar=True,
    BackgroundColor=RGB(255, 255, 255),
    ScaleFactor=1)
geometry_info_status = RemoteSender(winstat_9)
py3_37 = Python3Script(window=launchwin_9, activate=info_save_geometry_3)  # same code as py3_6
addelems_9 = AddElements(Window=launchwin_9, Elements=flatten(entwine_149), DoVLChecking=True)  # -> AddedElements, ElementNames

geometry_info_status_2 = RemoteReceiver(geometry_info_status)
expression_65 = Expression(x="Hidden", y=geometry_info_status_2, Expression="x=y")
expire_8 = ExpireObject(ObjectToExpire=objbynn_12, Expire=expression_65)

# ---- group: Ref: B-Å Petersson: Byggnaders klimatskärm
heat_recovery_efficiency_2 = RemoteReceiver(heat_recovery_efficiency)

# ----
# Create material tooltip
panel_185 = Panel(":")

# ----
# Create construction tooltip
panel_186 = Panel(":")

# ----
# Backend data inside layers
panel_187 = Panel("0, 0, 0")
path_2 = DataPath(panel_187)
path_3 = DataPath("0, 0, 0")

# ----
# Create window tooltip
number_slider_39 = Slider(0, range=0..100)
dom_8 = ConstructDomain(DomainStart=number_slider_39, DomainEnd=Slider(12, range=0..100))
dom_9 = ConstructDomain(DomainStart=Slider(0, range=0..100), DomainEnd=Slider(1, range=0..100))

# ----
# Remove material
pre_material_database_remove_material_2 = RemoteReceiver(pre_material_database_remove_material)
cull_13 = CullPattern(List=pre_material_database_remove_material_2, CullPattern=pre_material_database_remove_material_2)
lng_18 = ListLength(List=cull_13)
filter_53 = StreamFilter(Gate=lng_18, Stream0="False", Stream1=cull_13)
freeze_gate_51 = StreamFreezeGate(Data=pre_material_database_remove_material_2, PassingSwitch=filter_53, Freeze=True, Hold=False)
material_database_remove_material_2 = RemoteReceiver(material_database_remove_material)
getdocumentusertext_8 = Python3Script(run=material_database_remove_material_2, key="Heath materials")  # -> json_string; same code as getdocumentusertext
split_7 = TextSplit(Text=getdocumentusertext_8, Separators="|")
strtoobj_4 = HBStringToObject(hb_str=split_7)  # -> flatten(hb_obj); plug-in component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
decnstrmat_2 = HBDeconstructMaterial(mat=strtoobj_4)  # -> values, attr_names, r_val_si, r_val_ip; plug-in component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
item_23 = ListItem(List=decnstrmat_2.values, Index=0, Wrap=True)  # -> flatten(Item)
cset_7 = CreateSet(List=item_23)  # -> Set, Map
lng_19 = ListLength(List=cset_7.Set)
larger_2 = LargerThan(FirstNumber=lng_19, SecondNumber="1")  # -> LargerThan, OrEqualTo
bool_49 = Boolean(larger_2.LargerThan)

# ----
# Do we want to validate
#  the model before creating it?
#  It would validate the model
# every time the user changes something...
toggle_4 = BooleanToggle(True)

# ----
# Backend visible layers
panel_188 = Panel("1")
neg = Negative(Value=panel_188)
starting_layers = Slider(1, range=0..6)

create_model_3 = RemoteReceiver(create_model_2)
panel_189 = Panel(create_model_3)
py3_38 = Python3Script(x=create_model_3)  # -> folder; same code as load_models_ping
post_remove_current_model_2 = RemoteReceiver(post_remove_current_model)
post_rename_current_model_2 = RemoteReceiver(post_rename_current_model)
current_model_name = RemoteSender(item_21)
show_honeybee_windows_2 = RemoteReceiver(show_honeybee_windows)
show_honeybee_context_2 = RemoteReceiver(show_honeybee_context)
show_honeybee_ground_2 = RemoteReceiver(show_honeybee_ground)
show_honeybee_floors_2 = RemoteReceiver(show_honeybee_floors)
show_honeybee_walls_2 = RemoteReceiver(show_honeybee_walls)
show_honeybee_roof_2 = RemoteReceiver(show_honeybee_roof)
gate_29 = StreamGate(Stream=[vizbytype.indoor_shades, vizbytype.outdoor_shades], Gate=show_honeybee_context_2)  # -> Target0, Target1
gate_30 = StreamGate(Stream=[vizbytype.apertures, vizbytype.interior_apertures], Gate=show_honeybee_windows_2)  # -> Target0, Target1
gate_31 = StreamGate(Stream=vizbytype.roofs, Gate=show_honeybee_roof_2)  # -> Target0, Target1
gate_32 = StreamGate(Stream=vizbytype.interior_floors, Gate=show_honeybee_floors_2)  # -> Target0, Target1
gate_33 = StreamGate(Stream=vizbytype.exterior_floors, Gate=show_honeybee_ground_2)  # -> Target0, Target1
gate_34 = StreamGate(Stream=[vizbytype.walls, vizbytype.interior_walls, vizbytype.air_walls], Gate=show_honeybee_walls_2)  # -> Target0, Target1
data_20 = Data(gate_31.Target1)
data_21 = Data(gate_30.Target1)
data_22 = Data(gate_34.Target1)
data_23 = Data(gate_32.Target1)
data_24 = Data(gate_33.Target1)
data_25 = Data(gate_29.Target1)

current_model_name_2 = RemoteReceiver(current_model_name)
current_model_name_3 = RemoteReceiver(current_model_name)

# ----
# Create construction
panel_190 = Panel("""Layer 1
Layer 2
Layer 3
Layer 4
Layer 5
Layer 6""")
panel_191 = Panel("""     Outdoors
------------------""")
panel_192 = Panel("""------------------
      Indoors""")
textbox_10 = CreateTextBox(Label="Name", DefaultText="New construction", UpdateButton=invert(True), showLabel=True)
lng_20 = ListLength(List=panel_190)
values_149 = ValueListener(Elements=textbox_10, SomeProperty=True)  # -> Values, Indices
empty_10 = EmptyObjectToEmptyBranch()
button_48 = CreateButton(ButtonName="+", ButtonStyle=3)
label_67 = CreateLabel(LabelText=panel_192, LabelSize=18, Justification=1)
button_49 = CreateButton(ButtonName="Create construction", ButtonStyle=0)
label_68 = CreateLabel(LabelText=panel_191, LabelSize=18, Justification=1)
label_69 = CreateLabel(LabelText=panel_190, LabelSize=18, Justification=0)
empty_11 = EmptyObjectToEmptyBranch()
construction_maximum_layer_limit = RemoteSender(lng_20)
construction_maximum_layer_limit_2 = RemoteReceiver(construction_maximum_layer_limit)
subtraction_30 = Subtraction(A=construction_maximum_layer_limit_2, B="1")
repeat_12 = RepeatData(Data="Material", Length=construction_maximum_layer_limit_2)
repeat_13 = RepeatData(Data="X", Length=construction_maximum_layer_limit_2)
repeat_14 = RepeatData(Data="⇕", Length=subtraction_30)
repeat_15 = RepeatData(Data="Thickness [m]", Length=construction_maximum_layer_limit_2)
panel_193 = Panel(values_149.Values)
create_construction_name = RemoteSender(values_149.Values)
button_50 = CreateButton(ButtonName=repeat_13, ButtonStyle=3)
values_150 = ValueListener(Elements=button_48, SomeProperty=True)  # -> Values, Indices
values_151 = ValueListener(Elements=button_49, SomeProperty=True)  # -> Values, Indices
button_51 = CreateButton(ButtonName=repeat_14, ButtonStyle=3)
pulldown_26 = CreatePulldownMenu(Label=repeat_12, ListItems=empty_11, showLabel=True)
textbox_11 = CreateTextBox(Label=repeat_15, DefaultText=Slider(0.25, range=0.01..1), UpdateButton=invert(True), showLabel=True)
values_152 = ValueListener(Elements=button_50, SomeProperty=True)  # -> flatten(Values), Indices
cull_14 = CullPattern(List=values_152.Values, CullPattern=values_152.Values)
lng_21 = ListLength(List=cull_14)
filter_54 = StreamFilter(Gate=lng_21, Stream0="False", Stream1=cull_14)
add_layer = RemoteSender(values_150.Values)
values_153 = ValueListener(Elements=button_51, SomeProperty=True)  # -> flatten(Values), Indices
cull_15 = CullPattern(List=values_153.Values, CullPattern=values_153.Values)
lng_22 = ListLength(List=cull_15)
filter_55 = StreamFilter(Gate=lng_22, Stream0="False", Stream1=cull_15)
create_construction = RemoteSender(values_151.Values)
values_154 = ValueListener(Elements=pulldown_26, SomeProperty=True)  # -> Values, Indices
values_155 = ValueListener(Elements=textbox_11, SomeProperty=True)  # -> Values, Indices
freeze_gate_52 = StreamFreezeGate(Data=filter_55, PassingSwitch=invert(filter_55))
merge_15 = Merge(Data1=simplify(graft(label_69)), Data2=simplify(graft(button_50)))
freeze_gate_53 = StreamFreezeGate(Data=filter_54, PassingSwitch=invert(filter_54))
create_construction_materials = RemoteSender(values_154.Indices)
pre_switch_layer = RemoteSender(values_153.Values)
create_construction_thickness = RemoteSender(values_155.Values)
pre_remove_layer = RemoteSender(values_152.Values)
bool_50 = Boolean(invert(freeze_gate_52))
bool_51 = Boolean(invert(freeze_gate_53))
stack_106 = CreateStack(UIElements=merge_15, Horizontal=True)
tap_18 = TapBuffer(Reset=False, Incremental=True, Valve=bool_50, Hold=True)
tap_19 = TapBuffer(Reset=False, Incremental=True, Valve=bool_51, Hold=True)
dam_26 = DataDam(DataA=tap_18, BufferDelay=2500000, BufferMode=2)
dam_27 = DataDam(DataA=tap_19, BufferDelay=2500000, BufferMode=2)
equals_36 = Equality(FirstNumber=tap_18, SecondNumber=dam_26)  # -> Equality, Inequality
equals_37 = Equality(FirstNumber=tap_19, SecondNumber=dam_27)  # -> Equality, Inequality
event_58 = EventGate(Data=equals_36.Inequality)  # -> Data, IsNew
event_59 = EventGate(Data=equals_37.Inequality)  # -> Data, IsNew
entwine_151 = Entwine(Branch00=textbox_10, FlattenInputs=True)  # -> flatten(Result)
switch_layer = RemoteSender(event_58.Data)
adjustpos_123 = AdjustElementPositioning(
    ElementsToAdjust=textbox_10,
    Margin="0, 0, 0, 5",
    AbsolutePositioning=False,
    Width=Slider(190, range=0..300),
    HorizontalAlignment=0)
adjustpos_124 = AdjustElementPositioning(
    ElementsToAdjust=pulldown_26,
    Margin="0, 0, 0, 0",
    AbsolutePositioning=False,
    Width=Slider(290, range=0..300),
    HorizontalAlignment=0,
    VerticalAlignment=2)
adjustpos_125 = AdjustElementPositioning(
    ElementsToAdjust=textbox_11,
    Margin="0, 2, 0, 0",
    AbsolutePositioning=False,
    Width=Slider(130, range=0..300),
    HorizontalAlignment=0,
    VerticalAlignment=2)
adjustpos_126 = AdjustElementPositioning(
    ElementsToAdjust=button_48,
    Margin="10, 5, 0, 0",
    AbsolutePositioning=False,
    Width=Slider(32, range=0..300),
    Height=Slider(32, range=0..300),
    HorizontalAlignment=0)
remove_layer = RemoteSender(event_59.Data)
adjustpos_127 = AdjustElementPositioning(
    ElementsToAdjust=button_51,
    Margin="5, 0, 0, 0",
    AbsolutePositioning=False,
    Width=Slider(26, range=0..300),
    Height=Slider(26, range=0..300),
    HorizontalAlignment=0,
    VerticalAlignment=2)
adjustelem_39 = AdjustElementAppearance(ElementsToAdjust=button_51, Foreground=ColourSwatch(SwatchColor=RGBA(38, 38, 38, 193)), FontSize=Slider(19, range=0..50))
adjustpos_128 = AdjustElementPositioning(
    ElementsToAdjust=button_50,
    AbsolutePositioning=False,
    Width=Slider(26, range=0..300),
    Height=Slider(26, range=0..300),
    HorizontalAlignment=0)
adjustelem_40 = AdjustElementAppearance(ElementsToAdjust=button_48, Foreground=ColourSwatch(SwatchColor=RGB(15, 178, 0)), FontSize=Slider(21, range=0..50))
adjustelem_41 = AdjustElementAppearance(ElementsToAdjust=button_50, Foreground=ColourSwatch(SwatchColor=RGB(255, 0, 0)), FontSize=Slider(12, range=0..50))
adjustpos_129 = AdjustElementPositioning(ElementsToAdjust=button_49, Margin="0, 10, 0, 0", AbsolutePositioning=False, HorizontalAlignment=1, VerticalAlignment=2)

pre_remove_layer_2 = RemoteReceiver(pre_remove_layer)
pre_switch_layer_2 = RemoteReceiver(pre_switch_layer)
create_construction_materials_2 = RemoteReceiver(flatten(create_construction_materials))
create_construction_thickness_2 = RemoteReceiver(flatten(create_construction_thickness))
cull_16 = CullPattern(List=pre_remove_layer_2, CullPattern=pre_remove_layer_2)
cull_17 = CullPattern(List=pre_switch_layer_2, CullPattern=pre_switch_layer_2)
add_layer_2 = RemoteReceiver(add_layer)
mindex_6 = MemberIndex(Set=pre_remove_layer_2, Member=cull_16)  # -> Index, Count
mindex_7 = MemberIndex(Set=pre_switch_layer_2, Member=cull_17)  # -> Index, Count
py3_39 = Python3Script(
    add_layer=add_layer_2,
    remove_layer=mindex_6.Index,
    switch_layer=mindex_7.Index,
    materials=create_construction_materials_2,
    thickness=create_construction_thickness_2)  # -> out_materials, out_thickness; inputs materials: list, thickness: list
# ---------- py3_39: Python ----------
def add_layers():
    thickness.append(0.25)
    out_thickness = thickness
    
def remove_layers():
    materials.pop(remove_layer)
    thickness.pop(remove_layer)

def switch_layers():
    temp_materials = materials[switch_layer]
    materials[switch_layer] = materials[switch_layer+1]
    materials[switch_layer+1] = temp_materials

    temp_thickness = thickness[switch_layer]
    thickness[switch_layer] = thickness[switch_layer+1]
    thickness[switch_layer+1] = temp_thickness
    

if add_layer:
    add_layers()

elif remove_layer is not None:
    remove_layers()
    out_materials = materials
    out_thickness = thickness

elif switch_layer is not None:
    switch_layers()
    out_materials = materials
    out_thickness = thickness
else:
    out_materials = None
    out_thickness = None
# ---------- end py3_39 ----------
branch_2 = TreeBranch(Tree=py3_39.out_thickness, Path=path_2, MaintainPaths=True)
branch_3 = TreeBranch(Tree=py3_39.out_materials, Path=path_3, MaintainPaths=True)
lng_23 = ListLength(List=branch_3)
lng_24 = ListLength(List=branch_2)
bool_52 = Boolean(lng_24)
bool_53 = Boolean(lng_23)
gate_35 = StreamGate(Stream=branch_2, Gate=bool_52)  # -> Target0, Target1
gate_36 = StreamGate(Stream=branch_3, Gate=bool_53)  # -> Target0, Target1
hold_3 = HoldingGate(Data=gate_35.Target1)
hold_4 = HoldingGate(Data=gate_36.Target1)
hasdata_6 = DataExists(Data=hold_3)
hasdata_7 = DataExists(Data=hold_4)
timeshift = TimeShifter(Data=hold_3, Capacity="1")
timeshift_2 = TimeShifter(Data=hold_4, Capacity="1")
bool_54 = Boolean(hasdata_6)
bool_55 = Boolean(hasdata_7)
remove_layer_2 = RemoteReceiver(remove_layer)
switch_layer_2 = RemoteReceiver(switch_layer)
filter_56 = StreamFilter(Gate=bool_54, Stream0=timeshift, Stream1=hold_3)
filter_57 = StreamFilter(Gate=bool_55, Stream0=timeshift_2, Stream1=hold_4)
entwine_152 = Entwine(Branch00=filter_57, Branch01=filter_56, FlattenInputs=True)
or_25 = GateOr(A=switch_layer_2, B=remove_layer_2)
gate_37 = StreamGate(Stream=entwine_152, Gate=or_25)  # -> Target0, Target1
bang_11 = ExplodeTree(Data=gate_37.Target1)  # -> Branch0, Branch1

add_layer_3 = RemoteReceiver(add_layer)
remove_layer_3 = RemoteReceiver(flatten(remove_layer))
construction_maximum_layer_limit_3 = RemoteReceiver(construction_maximum_layer_limit)
gate_38 = StreamGate(Stream=panel_188, Gate=add_layer_3)  # -> Target0, Target1
gate_39 = StreamGate(Stream=neg, Gate=remove_layer_3)  # -> Target0, Target1
rec_42 = DataRecorder([gate_38.Target1, gate_39.Target1], DataLimit=-10, RecordData=True)
py3_40 = Python3Script(numbers=[starting_layers, rec_42], maximum_layers=construction_maximum_layer_limit_3)  # -> visible_layers_arrows, visible_layers; inputs numbers: list of Int32, maximum_layers: Int32
# ---------- py3_40: Python ----------
current_sum = 0

for number in numbers:
    if (number == 1) and (current_sum >= maximum_layers):
        continue
    if (number == -1) and (current_sum <= 1):
        continue
    else:
        current_sum += number

visible_layers = [True]*current_sum
visible_layers.extend([False]*(maximum_layers-current_sum))
visible_layers_arrows = visible_layers[1:]
# ---------- end py3_40 ----------
visible_layers = RemoteSender(simplify(graft(py3_40.visible_layers)))
visible_layers_arrows = RemoteSender(py3_40.visible_layers_arrows)

repeat_16 = RepeatData(Data="🛠", Length=construction_maximum_layer_limit_2)
button_52 = CreateButton(ButtonName=repeat_16, ButtonStyle=0)
values_156 = ValueListener(Elements=button_52, SomeProperty=True)  # -> flatten(Values), Indices
ma_36 = MassAddition(Input=values_156.Values)  # -> Result, PartialResults
bool_56 = Boolean(ma_36.Result)
freeze_gate_54 = StreamFreezeGate(Data=bool_56, PassingSwitch=bool_56)
load_material_database = RemoteSender(bool_56)

# ----
# Sync when opening the database, recompute and sync
load_construction_database_2 = RemoteReceiver(load_construction_database)
load_material_database_2 = RemoteReceiver(load_material_database)
recompute_4 = RemoteReceiver(recompute)
panel_194 = Panel("""False
True""")
or_26 = GateOr(A=load_material_database_2, B=load_construction_database_2)
oilcan_2 = OilCan(DataList=panel_194, Reset=recompute_4, Drop=or_26, DropMode=3)
event_60 = EventGate(Data=oilcan_2)  # -> Data, IsNew
and_42 = GateAnd(A=oilcan_2, B=event_60.IsNew)
null_36 = NullItem(Item=and_42)  # -> NullFlags, InvalidFlags, Description
filter_58 = StreamFilter(Gate=null_36.NullFlags, Stream0=and_42, Stream1="False")
sync_material_database_2 = RemoteReceiver(sync_material_database)
event_61 = EventGate(Data=filter_58)  # -> Data, IsNew
or_27 = GateOr(A=sync_material_database_2, B=event_61.Data)

bool_57 = Boolean(invert(freeze_gate_54))
merge_16 = Merge(Data1=simplify(graft(pulldown_26)), Data2=simplify(graft(button_52)))
oilcan_3 = OilCan(DataList=panel_22, Reset=recompute_2, Drop=bool_56, DropMode=3)
ping_open_material_database = RemoteSender(bool_57)
event_62 = EventGate(Data=oilcan_3)  # -> Data, IsNew
stack_107 = CreateStack(UIElements=merge_16, Horizontal=True)
open_material_database = RemoteSender(event_62.Data)

ping_open_material_database_2 = RemoteReceiver(ping_open_material_database)
open_material_database_2 = RemoteReceiver(open_material_database)
or_28 = GateOr(A=ping_open_material_database_2, B=open_material_database_2)
null_37 = NullItem(Item=or_28)  # -> NullFlags, InvalidFlags, Description
filter_59 = StreamFilter(Gate=null_37.NullFlags, Stream0=or_28, Stream1=panel_136)
rec_43 = DataRecorder(filter_59, DataLimit=-2, RecordData=True)
int_12 = Integer(rec_43)
ma_37 = MassAddition(Input=int_12)  # -> Result, PartialResults
entwine_153 = Entwine(Branch00=ma_37.Result, Branch01=material_database, FlattenInputs=True)
rec_44 = DataRecorder(entwine_153, DataLimit=2, RecordData=True)
item_24 = ListItem(List=rec_44, Index=0, Wrap=True)  # -> Item2, Item1, Item
equals_38 = Equality(FirstNumber=item_24.Item2, SecondNumber=item_24.Item1)  # -> Equality, Inequality
bang_12 = ExplodeTree(Data=equals_38.Inequality)  # -> Branch0, Branch1
py3_41 = Python3Script(x=bang_12.Branch0, y=bang_12.Branch1)  # -> a; same code as py3_5
event_63 = EventGate(Data=py3_41)  # -> Data, IsNew
freeze_gate_55 = StreamFreezeGate(Data=py3_41, PassingSwitch=event_63.IsNew)
event_64 = EventGate(Data=freeze_gate_55)  # -> Data, IsNew
panel_195 = Panel(event_64.Data)
ping_open_material_database_3 = RemoteReceiver(ping_open_material_database)
launchwin_10 = LaunchWindow(
    Show=event_64.Data,
    Name="Material database",
    Width=Slider(380, range=0..1000),
    Height=Slider(580, range=0..1000),
    ChildStatus=1,
    EnableHorizScroll=False)
open_material_database_3 = RemoteReceiver(open_material_database)
or_29 = GateOr(A=ping_open_material_database_3, B=open_material_database_3)
winprops_10 = SetWindowProperties(
    Window=launchwin_10,
    StartingLocation=database_modal_location_7,
    Theme=0,
    AccentColor=heath_accent_color_13,
    ShowTitleBar=True,
    BackgroundColor=RGB(255, 255, 255),
    ScaleFactor=1)
winstat_10 = WindowStatus(Window=launchwin_10)
addelems_10 = AddElements(Window=launchwin_10, Elements=flatten(entwine_124), DoVLChecking=True)  # -> AddedElements, ElementNames
py3_42 = Python3Script(window=launchwin_10, activate=or_29)  # same code as py3_6
material_database_elements = RemoteSender(addelems_10.AddedElements)
material_database_status = RemoteSender(winstat_10)

material_database_status_2 = RemoteReceiver(material_database_status)
expression_66 = Expression(x="Hidden", y=material_database_status_2, Expression="x=y")
expire_9 = ExpireObject(ObjectToExpire=objbynn_10, Expire=expression_66)

adjustelem_42 = AdjustElementAppearance(ElementsToAdjust=button_52, Foreground=ColourSwatch(SwatchColor=RGB(102, 51, 0)), FontSize=Slider(14, range=10..25))
adjustpos_130 = AdjustElementPositioning(
    ElementsToAdjust=button_52,
    Margin="0, 0, 0, 0",
    AbsolutePositioning=False,
    Width=number_slider_11,
    Height=number_slider_11,
    HorizontalAlignment=0)

material_database_status_3 = RemoteReceiver(material_database_status)
material_database_status_4 = RemoteReceiver(material_database_status)
expression_67 = Expression(x="Normal", y=material_database_status_3, Expression="x=y")
expression_68 = Expression(x="Normal", y=material_database_status_4, Expression="x=y")
and_43 = GateAnd(A=equals_25.Inequality, B=expression_67)
and_44 = GateAnd(A=equals_26.Inequality, B=expression_68)
event_65 = EventGate(Data=and_43)  # -> Data, IsNew
event_66 = EventGate(Data=and_44)  # -> Data, IsNew
panel_196 = Panel(event_65.Data)
save_materials = RemoteSender(event_65.Data)
panel_197 = Panel(event_66.Data)
load_materials = RemoteSender(event_66.Data)

# ----
# Save materials
panel_198 = Panel("Heath materials")
save_materials_2 = RemoteReceiver(save_materials)
getdocumentusertext_9 = Python3Script(run=save_materials_2, key=panel_198)  # -> json_string; same code as getdocumentusertext
null_38 = NullItem(Item=getdocumentusertext_9)  # -> NullFlags, InvalidFlags, Description
bool_58 = Boolean(invert(null_38.NullFlags))
save_materials_file_2 = RemoteReceiver(save_materials_file)
filter_60 = StreamFilter(Gate=null_38.NullFlags, Stream0=save_materials_2, Stream1=bool_58)
writetxt_3 = WriteToTextFile(Run=filter_60, TextToWrite=getdocumentusertext_9, FilePath=save_materials_file_2, Append=False, NewOnly=False)

# ----
# Load materials
load_materials_file_2 = RemoteReceiver(load_materials_file)
load_materials_2 = RemoteReceiver(load_materials)
gate_40 = StreamGate(Stream=load_materials_file_2, Gate=load_materials_2)  # -> Target0, Target1
getdocumentusertext_10 = Python3Script(run=load_materials_2, key="Heath materials")  # -> json_string; same code as getdocumentusertext
file_3 = ReadFile(File=gate_40.Target1, PerLineParse=False)
entwine_154 = Entwine(Branch00=getdocumentusertext_10, Branch01=file_3, FlattenInputs=True)  # -> flatten(Result)
split_8 = TextSplit(Text=file_3, Separators="|")  # -> flatten(Result)
strtoobj_5 = HBStringToObject(hb_str=split_8)  # -> hb_obj; plug-in component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
null_39 = NullItem(Item=strtoobj_5)  # -> NullFlags, InvalidFlags, Description
item_25 = ListItem(List=null_39.NullFlags, Index=0, Wrap=True)
filter_61 = StreamFilter(Gate=item_25, Stream0=entwine_154)
join_9 = TextJoin(Text=filter_61, Join="|")
freeze_gate_56 = StreamFreezeGate(Data=join_9, PassingSwitch=load_materials_2, Freeze=False, Hold=False)

create_construction_name_2 = RemoteReceiver(create_construction_name)
create_construction_name_3 = RemoteReceiver(create_construction_name)
py3_43 = Python3Script(name=create_construction_name_3)  # -> not_valid; inputs name: String
# ---------- py3_43: Python ----------
if 'å' in name:
    not_valid = True
elif 'ä' in name:
    not_valid = True
elif 'ö' in name:
    not_valid = True
else:
    not_valid = False
# ---------- end py3_43 ----------
gate_41 = StreamGate(Stream="'å', 'ä' and 'ö' are not allowed", Gate=py3_43)  # -> Target0, Target1

# ----
# Add construction
create_construction_materials_3 = RemoteReceiver(create_construction_materials)
create_construction_thickness_3 = RemoteReceiver(create_construction_thickness)
visible_layers_2 = RemoteReceiver(visible_layers)
create_construction_name_4 = RemoteReceiver(create_construction_name)
repeat_17 = RepeatData(Data=create_construction_thickness_3, Length=visible_layers_2)  # -> flatten(Data)
create_construction_2 = RemoteReceiver(create_construction)
getdocumentusertext_11 = Python3Script(run=create_construction_2, key="Heath constructions")  # -> json_string; same code as getdocumentusertext

# ----
# Create material
number_slider_40 = Slider(3, range=0..10)
material_database_categories_7 = RemoteReceiver(material_database_categories_2)
textbox_12 = CreateTextBox(Label="Name", DefaultText="New material", UpdateButton=invert(True), showLabel=True)
textbox_13 = CreateTextBox(DefaultText=Slider(0.036, range=0..2), UpdateButton=invert(True), showLabel=False)
label_70 = CreateLabel(LabelText="Conductivity [W/m-K]", LabelSize=12, Justification=0)
pulldown_27 = CreatePulldownMenu(Label="Material category", ListItems=material_database_categories_7, SelectedIndex=number_slider_40, showLabel=True)
textbox_14 = CreateTextBox(DefaultText=Slider(28, range=0..1000), UpdateButton=invert(True), showLabel=False)
true_button_33 = CreateTrueOnlyButton(ButtonName="?", ButtonStyle=2)
button_53 = CreateButton(ButtonName="Create material", ButtonStyle=0)
textbox_15 = CreateTextBox(DefaultText=Slider(1500, range=0..10000), UpdateButton=invert(True), showLabel=False)
label_71 = CreateLabel(LabelText="A1-A3 [kg CO2eq/kg]", LabelSize=12, Justification=0)
label_72 = CreateLabel(LabelText="Specific heat [J/kg-K]", LabelSize=12, Justification=0)
label_73 = CreateLabel(LabelText="Density [kg/m3]", LabelSize=12, Justification=0)
values_157 = ValueListener(Elements=textbox_12, SomeProperty=True)  # -> Values, Indices
values_158 = ValueListener(Elements=true_button_33, SomeProperty=True)  # -> Values, Indices
values_159 = ValueListener(Elements=textbox_13, SomeProperty=True)  # -> Values, Indices
values_160 = ValueListener(Elements=button_53, SomeProperty=True)  # -> Values, Indices
values_161 = ValueListener(Elements=pulldown_27, SomeProperty=True)  # -> Values, Indices
values_162 = ValueListener(Elements=textbox_14, SomeProperty=True)  # -> Values, Indices
values_163 = ValueListener(Elements=textbox_15, SomeProperty=True)  # -> Values, Indices
create_material_name = RemoteSender(values_157.Values)
freeze_gate_57 = StreamFreezeGate(Data=values_160.Values, PassingSwitch=invert(values_160.Values))
create_material_conductivity = RemoteSender(values_159.Values)
info_create_material = RemoteSender(values_158.Values)
create_material_category = RemoteSender(values_161.Values)
entwine_155 = Entwine(Branch00=label_70, Branch01=textbox_13, FlattenInputs=True)  # -> flatten(Result)
create_material_density = RemoteSender(values_162.Values)
create_material_sprecific_heat = RemoteSender(values_163.Values)
entwine_156 = Entwine(Branch00=label_72, Branch01=textbox_15, FlattenInputs=True)  # -> flatten(Result)
entwine_157 = Entwine(Branch00=label_73, Branch01=textbox_14, FlattenInputs=True)  # -> flatten(Result)
bool_59 = Boolean(invert(freeze_gate_57))
stack_108 = CreateStack(UIElements=entwine_155, Horizontal=True)
entwine_158 = Entwine(Branch00=label_71, Branch01=textbox_3, FlattenInputs=True)  # -> flatten(Result)
tap_20 = TapBuffer(Reset=False, Incremental=True, Valve=bool_59, Hold=True)
dam_28 = DataDam(DataA=tap_20, BufferDelay=2500000, BufferMode=2)
create_material_modal_2 = RemoteReceiver(create_material_modal)
adjustelem_43 = AdjustElementAppearance(
    ElementsToAdjust=true_button_33,
    Foreground=ColourSwatch(SwatchColor=RGB(0, 0, 0)),
    Background=ColourSwatch(SwatchColor=RGB(230, 230, 230)),
    FontSize=Slider(12, range=0..300))
equals_39 = Equality(FirstNumber=tap_20, SecondNumber=dam_28)  # -> Equality, Inequality
and_45 = GateAnd(A=equals_39.Inequality, B=create_material_modal_2)
number_slider_41 = Slider(29, range=0..300)
event_67 = EventGate(Data=and_45)  # -> Data, IsNew
entwine_159 = Entwine(Branch00=textbox_12, Branch01=true_button_33, FlattenInputs=True)  # -> flatten(Result)
stack_109 = CreateStack(UIElements=entwine_157, Horizontal=True)
stack_110 = CreateStack(UIElements=entwine_156, Horizontal=True)
create_material = RemoteSender(event_67.Data)
stack_111 = CreateStack(UIElements=entwine_159, Horizontal=True)
adjustpos_131 = AdjustElementPositioning(
    ElementsToAdjust=textbox_12,
    Margin="0, 5, 0, 10",
    AbsolutePositioning=False,
    Width=Slider(185, range=0..300),
    HorizontalAlignment=0)
adjustpos_132 = AdjustElementPositioning(
    ElementsToAdjust=true_button_33,
    Margin="5, -5, 0, 0",
    AbsolutePositioning=False,
    Width=number_slider_41,
    Height=number_slider_41)
adjustpos_133 = AdjustElementPositioning(ElementsToAdjust=pulldown_27, AbsolutePositioning=False, Width=Slider(225, range=0..300), HorizontalAlignment=0)
adjustpos_134 = AdjustElementPositioning(
    ElementsToAdjust=[label_71, label_72, label_73, label_70, label_6, label_7],
    AbsolutePositioning=False,
    Width=Slider(150, range=0..300),
    HorizontalAlignment=0,
    VerticalAlignment=2)
adjustpos_135 = AdjustElementPositioning(
    ElementsToAdjust=[textbox_15, textbox_14, textbox_13, textbox_3, textbox, textbox_2],
    AbsolutePositioning=False,
    Width=Slider(50, range=0..300),
    HorizontalAlignment=0,
    VerticalAlignment=2)
adjustpos_136 = AdjustElementPositioning(ElementsToAdjust=button_53, Margin="0, 10, 0, 0", AbsolutePositioning=False, HorizontalAlignment=1, VerticalAlignment=2)

info_create_material_2 = RemoteReceiver(info_create_material)
rec_45 = DataRecorder(info_create_material_2, DataLimit=-2, RecordData=True)
ma_38 = MassAddition(Input=rec_45)  # -> Result, PartialResults
entwine_160 = Entwine(Branch00=ma_38.Result, Branch01=material_info, FlattenInputs=True)
rec_46 = DataRecorder(entwine_160, DataLimit=2, RecordData=True)
item_26 = ListItem(List=rec_46, Index=0, Wrap=True)  # -> Item2, Item1, Item
equals_40 = Equality(FirstNumber=item_26.Item2, SecondNumber=item_26.Item1)  # -> Equality, Inequality
bang_13 = ExplodeTree(Data=equals_40.Inequality)  # -> Branch0, Branch1
py3_44 = Python3Script(x=bang_13.Branch0, y=bang_13.Branch1)  # -> a; same code as py3_5
event_68 = EventGate(Data=py3_44)  # -> Data, IsNew
freeze_gate_58 = StreamFreezeGate(Data=py3_44, PassingSwitch=event_68.IsNew)
event_69 = EventGate(Data=freeze_gate_58)  # -> Data, IsNew
panel_199 = Panel(event_69.Data)
launchwin_11 = LaunchWindow(
    Show=event_69.Data,
    Name="Common materials",
    Width=multiplication,
    Height=number_slider_37,
    ChildStatus=1,
    EnableHorizScroll=False)
info_create_material_3 = RemoteReceiver(info_create_material)
winstat_11 = WindowStatus(Window=launchwin_11)
winprops_11 = SetWindowProperties(
    Window=launchwin_11,
    StartingLocation=create_modal_location_2,
    Theme=0,
    AccentColor=heath_accent_color_14,
    ShowTitleBar=True,
    BackgroundColor=RGB(255, 255, 255),
    ScaleFactor=1)
material_info_status = RemoteSender(winstat_11)
py3_45 = Python3Script(window=launchwin_11, activate=info_create_material_3)  # same code as py3_6
addelems_11 = AddElements(Window=launchwin_11, Elements=flatten(image_5), DoVLChecking=True)  # -> AddedElements, ElementNames

material_info_status_2 = RemoteReceiver(material_info_status)
expression_69 = Expression(x="Hidden", y=material_info_status_2, Expression="x=y")
expire_10 = ExpireObject(ObjectToExpire=objbynn_8, Expire=expression_69)

# ----
# A1-A3
stack_112 = CreateStack(UIElements=entwine_158, Horizontal=True)
data_26 = Data(stack_112)  # "A1-A3"

specific_heat = Data(stack_110)
density = Data(stack_109)

create_material_name_2 = RemoteReceiver(create_material_name)
create_material_name_3 = RemoteReceiver(create_material_name)
py3_46 = Python3Script(name=create_material_name_3)  # -> not_valid; inputs name: String; same code as py3_43
gate_42 = StreamGate(Stream="'å', 'ä' and 'ö' are not allowed", Gate=py3_46)  # -> Target0, Target1

# ----
# Add material
create_material_sprecific_heat_2 = RemoteReceiver(create_material_sprecific_heat)
create_material_conductivity_2 = RemoteReceiver(create_material_conductivity)
create_material_category_2 = RemoteReceiver(create_material_category)
create_material_density_2 = RemoteReceiver(create_material_density)
create_material_name_4 = RemoteReceiver(create_material_name)
opaquemat_2 = HBOpaqueMaterial(
    name=create_material_name_4,
    thickness="inf",
    conductivity=create_material_conductivity_2,
    density=create_material_density_2,
    spec_heat=create_material_sprecific_heat_2,
    category=create_material_category_2)  # -> out, mat; plug-in component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
create_material_a1_a3_kg_2 = RemoteReceiver(create_material_a1_a3_kg)
create_material_a5_1_kg_2 = RemoteReceiver(create_material_a5_1_kg)
create_material_a4_kg_2 = RemoteReceiver(create_material_a4_kg)
create_material_error = RemoteSender(opaquemat_2.out)
create_material_2 = RemoteReceiver(create_material)
getdocumentusertext_12 = Python3Script(run=create_material_2, key="Heath materials")  # -> json_string; same code as getdocumentusertext

add_life_cycle_info = BrimstoneAddLifeCycleInfoToHoneybeeMaterial(
    hb_material=opaquemat_2.mat,
    gwp_a1_a3=create_material_a1_a3_kg_2,
    gwp_a4=create_material_a4_kg_2,
    gwp_a5_1=create_material_a5_1_kg_2)  # -> mod_material
# ---------- add_life_cycle_info: Python ----------
"""
Adds GWP info to a Honeybee Material

    Args:
        hb_material: Honeybee EnergyMaterial to be updated
        gwp_a1_a3: GWP (A1-A3) [kg CO2eq/kg]
        gwp_a4: GWP (A4) [kg CO2eq/kg]
        gwp_a5_1: GWP (A5.1) [kg CO2eq/kg]

    Returns:
        mod_material: Updated Honeybee EnergyMaterial
"""

import scriptcontext
import brimstone
ghenv.Component.Message = brimstone.globals.version
import Grasshopper

ghenv.Component.Name = 'Brimstone - Add Life Cycle Info to Honeybee Material'
ghenv.Component.NickName = 'Add Life Cycle Info'

try:  # import the core honeybee dependencies
    from honeybee_energy.material.opaque import EnergyMaterial
except ImportError as e:
    raise ImportError('\nFailed to import honeybee:\n\t{}'.format(e))

def main(hb_material):
    if not isinstance(hb_material, EnergyMaterial):
        raise Exception("Input material must be a valid Honeybee material")
    mod_material = hb_material.duplicate()
    user_data = mod_material.user_data if mod_material.user_data else {}
    
    impact_data = {
        "gwp_a1_a3": gwp_a1_a3,
        "gwp_a4": gwp_a4,
        "gwp_a5_1": gwp_a5_1,
        "gwp_c1": gwp_c1,
        "gwp_c2": gwp_c2,
        "gwp_c3": gwp_c3,
    }
    
    for k, v in impact_data.items():
        if v is not None:
            user_data[k] = v

    mod_material.user_data = user_data
    
    return mod_material

if __name__ == "__main__":
    try:
        flying = scriptcontext.sticky["brimstone_flying"]
    except:
        raise Exception("The 'Brimstone - Fly' component needs to exist on the canvas")
    mod_material = main(hb_material)
# ---------- end add_life_cycle_info ----------

gate_43 = StreamGate(Stream=add_life_cycle_info, Gate=create_material_2)  # -> Target0, Target1
objtostr_2 = HBObjectToString(hb_obj=gate_43.Target1)  # -> hb_str; plug-in component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
entwine_161 = Entwine(Branch00=getdocumentusertext_12, Branch01=objtostr_2, FlattenInputs=True)  # -> flatten(Result)
join_10 = TextJoin(Text=entwine_161, Join="|")
freeze_gate_59 = StreamFreezeGate(Data=join_10, PassingSwitch=create_material_2, Freeze=False, Hold=False)

create_material_error_2 = RemoteReceiver(create_material_error)
panel_200 = Panel(create_material_error_2)
split_9 = TextSplit(Text=create_material_error_2, Separators=panel_185)
trim = TextTrim(Text=split_9, Start=True, End=True)
item_27 = ListItem(List=trim, Index=0, Wrap=True)  # -> Item, Item1
lng_25 = ListLength(List=split_9)
len_4 = TextLength(Text=item_27.Item1)
larger_3 = LargerThan(FirstNumber=lng_25, SecondNumber="1")  # -> LargerThan, OrEqualTo
subtraction_31 = Subtraction(A=len_4, B=Slider(11, range=0..20))
fragment_4 = TextFragment(Text=item_27.Item1, Start="0", Count=subtraction_31)
filter_62 = StreamFilter(Gate=larger_3.LargerThan, Stream0=create_material_error_2, Stream1=fragment_4)

# ----
# Create window
number_slider_42 = Slider(0.5, range=0..12)
button_54 = CreateButton(ButtonName="Create window", ButtonStyle=0)
textbox_16 = CreateTextBox(Label="Name", DefaultText="New window", UpdateButton=invert(True), showLabel=True)
textbox_17 = CreateTextBox(DefaultText=number_slider_42, UpdateButton=invert(True), showLabel=False)
label_74 = CreateLabel(LabelText="U-factor [W/m2-K]", LabelSize=12, Justification=0)
textbox_18 = CreateTextBox(DefaultText=Slider(0.3, range=0..1), UpdateButton=invert(True), showLabel=False)
label_75 = CreateLabel(LabelText="SHGC [-]", LabelSize=12, Justification=0)
values_164 = ValueListener(Elements=textbox_16, SomeProperty=True)  # -> Values, Indices
values_165 = ValueListener(Elements=textbox_17, SomeProperty=True)  # -> Values, Indices
values_166 = ValueListener(Elements=button_54, SomeProperty=True)  # -> Values, Indices
values_167 = ValueListener(Elements=textbox_18, SomeProperty=True)  # -> Values, Indices
freeze_gate_60 = StreamFreezeGate(Data=values_166.Values, PassingSwitch=invert(values_166.Values))
pre_create_window = RemoteSender(values_166.Values)
create_window_u_factor = RemoteSender(values_165.Values)
create_window_shgc = RemoteSender(values_167.Values)
panel_201 = Panel(values_164.Values)
create_window_name = RemoteSender(values_164.Values)
entwine_162 = Entwine(Branch00=label_74, Branch01=textbox_17, FlattenInputs=True)  # -> flatten(Result)
entwine_163 = Entwine(Branch00=label_75, Branch01=textbox_18, FlattenInputs=True)  # -> flatten(Result)
bool_60 = Boolean(invert(freeze_gate_60))
stack_113 = CreateStack(UIElements=entwine_162, Horizontal=True)
tap_21 = TapBuffer(Reset=False, Incremental=True, Valve=bool_60, Hold=True)
stack_114 = CreateStack(UIElements=entwine_163, Horizontal=True)
dam_29 = DataDam(DataA=tap_21, BufferDelay=2500000, BufferMode=2)
create_window_modal_2 = RemoteReceiver(create_window_modal)
equals_41 = Equality(FirstNumber=tap_21, SecondNumber=dam_29)  # -> Equality, Inequality
and_46 = GateAnd(A=equals_41.Inequality, B=create_window_modal_2)
event_70 = EventGate(Data=and_46)  # -> Data, IsNew
create_window = RemoteSender(event_70.Data)
adjustpos_137 = AdjustElementPositioning(
    ElementsToAdjust=[label_9, label_75, label_74, label_10, label_8],
    AbsolutePositioning=False,
    Width=Slider(150, range=0..300),
    HorizontalAlignment=0,
    VerticalAlignment=2)
adjustpos_138 = AdjustElementPositioning(
    ElementsToAdjust=[textbox_18, textbox_17, textbox_6, textbox_4, textbox_5],
    AbsolutePositioning=False,
    Width=Slider(50, range=0..300),
    HorizontalAlignment=0,
    VerticalAlignment=2)
adjustpos_139 = AdjustElementPositioning(ElementsToAdjust=button_54, Margin="0, 10, 0, 0", AbsolutePositioning=False, HorizontalAlignment=1, VerticalAlignment=2)

# ----
# Add window
create_window_u_factor_2 = RemoteReceiver(create_window_u_factor)
create_window_shgc_2 = RemoteReceiver(create_window_shgc)
create_window_name_2 = RemoteReceiver(create_window_name)
windowmat = HBWindowMaterial(name=create_window_name_2, u_factor=create_window_u_factor_2, shgc=create_window_shgc_2)  # -> out, mat; plug-in component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
create_window_conversion_value_2 = RemoteReceiver(create_window_conversion_value)
create_window_a1_a3_kg_2 = RemoteReceiver(create_window_a1_a3_kg)
create_window_a4_kg_2 = RemoteReceiver(create_window_a4_kg)
windowconstr = HBWindowConstruction(name=create_window_name_2, materials=windowmat.mat)  # -> constr; plug-in component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
create_window_error = RemoteSender(windowmat.out)
add_life_cycle_info_construction = BrimstoneAddLifeCycleInfoToHoneybeeConstruction(
    hb_construction=windowconstr,
    gwp_a1_a3=create_window_a1_a3_kg_2,
    gwp_a4=create_window_a4_kg_2,
    density=create_window_conversion_value_2)  # -> mod_construction
# ---------- add_life_cycle_info_construction: Python ----------
"""
Adds GWP info to a Honeybee Construction

    Args:
        hb_construction: Honeybee Construction to be updated
        gwp_a1_a3: GWP (A1-A3) [kg CO2eq/kg]
        gwp_a4: GWP (A4) [kg CO2eq/kg]
        density: GWP (A5.1) [kg/m2]

    Returns:
        mod_construction: Updated Honeybee Construction
"""

import scriptcontext
import brimstone
ghenv.Component.Message = brimstone.globals.version
import Grasshopper

ghenv.Component.Name = 'Brimstone - Add Life Cycle Info to Honeybee Construction'
ghenv.Component.NickName = 'Add Life Cycle Info (Construction)'

try:  # import the core honeybee dependencies
    from honeybee_energy.construction.window import WindowConstruction
    from honeybee_energy.construction.opaque import OpaqueConstruction
except ImportError as e:
    raise ImportError('\nFailed to import honeybee:\n\t{}'.format(e))

def main(hb_construction, gwp_a1_a3, gwp_a4, density):
    if not isinstance(hb_construction, WindowConstruction)\
        and not isinstance(hb_construction, OpaqueConstruction):
        raise Exception("Currently only Window and Opaque constructions are supported")
    mod_construction = hb_construction.duplicate()
    user_data = mod_construction.user_data if mod_construction.user_data else {}
    
    user_data["gwp_a1_a3"] = gwp_a1_a3
    user_data["gwp_a4"] = gwp_a4
    user_data["conv_value"] = density
    
    mod_construction.user_data = user_data

    return mod_construction

if __name__ == "__main__":
    try:
        flying = scriptcontext.sticky["brimstone_flying"]
    except:
        raise Exception("The 'Brimstone - Fly' component needs to exist on the canvas")
    mod_construction = main(hb_construction, gwp_a1_a3, gwp_a4, density)
# ---------- end add_life_cycle_info_construction ----------
create_window_2 = RemoteReceiver(create_window)
gate_44 = StreamGate(Stream=add_life_cycle_info_construction, Gate=create_window_2)  # -> Target0, Target1
getdocumentusertext_13 = Python3Script(run=create_window_2, key="Heath windows")  # -> json_string; same code as getdocumentusertext
objtostr_3 = HBObjectToString(hb_obj=gate_44.Target1)  # -> hb_str; plug-in component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
entwine_164 = Entwine(Branch00=getdocumentusertext_13, Branch01=objtostr_3, FlattenInputs=True)  # -> flatten(Result)
freeze_gate_61 = StreamFreezeGate(Data=entwine_164, PassingSwitch=create_window_2, Freeze=False, Hold=False)
join_11 = TextJoin(Text=freeze_gate_61, Join="|")

panel_202 = Panel(windowconstr)
panel_203 = Panel(add_life_cycle_info_construction)
entwine_165 = Entwine(Branch00=textbox_16, Branch01=true_button_8, FlattenInputs=True)  # -> flatten(Result)
stack_115 = CreateStack(UIElements=entwine_165, Horizontal=True)
adjustpos_140 = AdjustElementPositioning(
    ElementsToAdjust=textbox_16,
    Margin="0, 5, 0, 10",
    AbsolutePositioning=False,
    Width=Slider(185, range=0..300),
    HorizontalAlignment=0)

# ----
# Windows database
sync_window_database_2 = RemoteReceiver(sync_window_database)
setdocumentusertext_3 = Python3Script(
    key="Heath windows",
    load_value=freeze_gate_39,
    remove_value=freeze_gate_33,
    add_value=join_11,
    sync=sync_window_database_2)  # -> done
# ---------- setdocumentusertext_3: Python ----------
import Rhino
import rhinoscriptsyntax as rs
import scriptcontext as sc

def modify_value(value):
    sc.doc = Rhino.RhinoDoc.ActiveDoc

    return rs.SetDocumentUserText(key, value)

    sc.doc = ghdoc

if load_value:
    done = modify_value(load_value)

if add_value:
    done = modify_value(add_value)

if remove_value:
    done = modify_value(remove_value)

if remove_value == False:
    done = modify_value(None)

elif sync:
    done = True
# ---------- end setdocumentusertext_3 ----------
getdocumentusertext_14 = Python3Script(run=setdocumentusertext_3, key="Heath windows")  # -> json_string
# ---------- getdocumentusertext_14: Python ----------
import Rhino
import rhinoscriptsyntax as rs
import scriptcontext as sc

if run:
    sc.doc = Rhino.RhinoDoc.ActiveDoc

    json_string = rs.GetDocumentUserText(key)
    if json_string == None:
        json_string = False

    sc.doc = ghdoc
# ---------- end getdocumentusertext_14 ----------
split_10 = TextSplit(Text=getdocumentusertext_14, Separators="|")
hold_5 = HoldingGate(Data=split_10)
strtoobj_6 = HBStringToObject(hb_str=hold_5)  # -> flatten(hb_obj); plug-in component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
ipy2_2 = IronPython2Script(windows=strtoobj_6)  # -> unique_windows; inputs windows: list
# ---------- ipy2_2: IronPython ----------
"""Grasshopper Script"""

unique_windows = []

for i in range(len(windows)):
    if windows[i] not in unique_windows:
        unique_windows.append(windows[i])
# ---------- end ipy2_2 ----------
clean = CleanTree(RemoveNulls=True, RemoveInvalid=True, RemoveEmpty=False, Tree=ipy2_2)
lng_26 = ListLength(List=ipy2_2)
lng_27 = ListLength(List=strtoobj_6)
smaller = SmallerThan(FirstNumber=lng_26, SecondNumber=lng_27)  # -> SmallerThan, OrEqualTo
created_windows_database = RemoteSender(clean)
hasdata_8 = DataExists(Data=smaller.SmallerThan)
filter_63 = StreamFilter(Gate=hasdata_8, Stream0="False", Stream1=smaller.SmallerThan)
overlap_windows = RemoteSender(filter_63)

created_windows_database_2 = RemoteReceiver(created_windows_database)
decnstrconstr_2 = HBDeconstructConstruction(constr=created_windows_database_2)  # -> materials, layers, r_val_si, r_val_ip, u_fac_si, u_fac_ip, shgc, t_sol, t_vis; plug-in component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
decnstrmat_3 = HBDeconstructMaterial(mat=decnstrconstr_2.materials)  # -> values, attr_names, r_val_si, r_val_ip; plug-in component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
item_28 = ListItem(List=decnstrmat_3.values, Index=0, Wrap=True)  # -> flatten(Item), Item1, Item2
entwine_166 = Entwine(Branch00=generic_shgc, Branch01=item_28.Item2, FlattenInputs=True)  # -> flatten(Result)
entwine_167 = Entwine(Branch00=generic_u_value, Branch01=item_28.Item1, FlattenInputs=True)  # -> flatten(Result)
clean_2 = CleanTree(RemoveNulls=True, RemoveInvalid=True, RemoveEmpty=False, Tree=item_28.Item)
clean_3 = CleanTree(RemoveNulls=True, RemoveInvalid=True, RemoveEmpty=False, Tree=entwine_167)
clean_4 = CleanTree(RemoveNulls=True, RemoveInvalid=True, RemoveEmpty=False, Tree=entwine_166)
num_7 = Number(clean_4)
num_8 = Number(clean_3)
entwine_168 = Entwine(Branch00="Generic", Branch01=clean_2, FlattenInputs=True)  # -> flatten(Result)
expression_70 = Expression(x=num_7, Expression="Round(x, 2)")
expression_71 = Expression(x=num_8, Expression="Round(x, 2)")
create_window_names = RemoteSender(entwine_168)
format_36 = Format(Format="{0} (U-factor: {1}, SHGC: {2})", Culture=127, Data0=entwine_168, Data1=expression_71, Data2=expression_70)
panel_204 = Panel(format_36)
create_window_full_names = RemoteSender(format_36)

created_windows_database_3 = RemoteReceiver(created_windows_database)

created_windows_database_4 = RemoteReceiver(created_windows_database)
entwine_169 = Entwine(Branch00=panel_127, Branch01=created_windows_database_3, FlattenInputs=True)  # -> flatten(Result)
entwine_170 = Entwine(Branch00="Generic", Branch01=created_windows_database_4, FlattenInputs=True)  # -> flatten(Result)
item_29 = ListItem(List=entwine_169, Index=subset_subface_window_2, Wrap=True)
item_30 = ListItem(List=entwine_170, Index=subset_subface_window_3, Wrap=True)
expression_72 = Expression(x="Generic", y=item_29, Expression="x=y")
expression_73 = Expression(x="Generic", y=item_30, Expression="x=y")
filter_64 = StreamFilter(Gate=expression_72, Stream0=item_29, Stream1=null_12)
filter_65 = StreamFilter(Gate=expression_73, Stream0=item_30, Stream1=null_13)
subfacesubset = HBSubfaceSubset(window=filter_65, skylight=filter_64)  # -> subface_set; plug-in component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

create_window_full_names_2 = RemoteReceiver(create_window_full_names)
cull_i_3 = CullIndex(List=create_window_full_names_2, Indices="0", Wrap=invert(True))
concat_7 = Concatenate(FragmentA="- ", FragmentB=cull_i_3)
overlap_windows_2 = RemoteReceiver(overlap_windows)
lng_28 = ListLength(List=cull_i_3)
settextblock_12 = SetTextBlockContents(TextBlockToModify=tb_41, NewTextBlockContents=concat_7)
py3_47 = Python3Script(current_windows=lng_28, maximum_windows=number_slider_34)  # -> status; inputs current_windows: Int32, maximum_windows: Int32
# ---------- py3_47: Python ----------
status = [True]*current_windows
status.extend([False]*(maximum_windows-current_windows))
# ---------- end py3_47 ----------
hideshow_49 = HideShowElement(ElementToHideShow=label_61, Show=overlap_windows_2, Collapse=True, Disable=False)
hideshow_50 = HideShowElement(ElementToHideShow=simplify(merge_12), Show=simplify(graft(py3_47)), Collapse=True, Disable=False)

create_window_names_2 = RemoteReceiver(create_window_names)
create_window_name_3 = RemoteReceiver(create_window_name)
create_window_error_2 = RemoteReceiver(create_window_error)
create_window_u_factor_3 = RemoteReceiver(create_window_u_factor)
create_window_shgc_3 = RemoteReceiver(create_window_shgc)
create_window_name_4 = RemoteReceiver(create_window_name)
expression_74 = Expression(x=create_window_names_2, y=create_window_name_3, Expression="x=y")
len_5 = TextLength(Text=create_window_error_2)
py3_48 = Python3Script(name=create_window_name_4)  # -> not_valid; inputs name: String; same code as py3_43
inc = Includes(Value=create_window_shgc_3, Domain=dom_9)  # -> Includes, Deviation
inc_2 = Includes(Value=create_window_u_factor_3, Domain=dom_8)  # -> Includes, Deviation
cull_18 = CullPattern(List=expression_74, CullPattern=expression_74)
bool_61 = Boolean(len_5)
gate_45 = StreamGate(Stream="U-factor has to to between 0 and 12", Gate=inc_2.Includes)  # -> Target0, Target1
gate_46 = StreamGate(Stream="Window name contains no valid characters", Gate=bool_61)  # -> Target0, Target1
gate_47 = StreamGate(Stream="Window already exists", Gate=cull_18)  # -> Target0, Target1
gate_48 = StreamGate(Stream="'å', 'ä' and 'ö' are not allowed", Gate=py3_48)  # -> Target0, Target1
gate_49 = StreamGate(Stream="SHGC has to to between 0 and 1", Gate=inc.Includes)  # -> Target0, Target1
entwine_171 = Entwine(
    Branch00=gate_45.Target0,
    Branch01=gate_49.Target0,
    Branch02=gate_46.Target1,
    Branch03=gate_47.Target1,
    Branch04=gate_48.Target1,
    FlattenInputs=True)  # -> flatten(Result)
panel_205 = Panel(entwine_171)
item_31 = ListItem(List=entwine_171, Index=0, Wrap=True)
create_window_error_message = RemoteSender(item_31)

create_window_error_message_2 = RemoteReceiver(create_window_error_message)
null_40 = NullItem(Item=create_window_error_message_2)  # -> NullFlags, InvalidFlags, Description
filter_66 = StreamFilter(Gate=null_40.NullFlags, Stream0=create_window_error_message_2, Stream1=" ")
filter_67 = StreamFilter(Gate=null_40.NullFlags, Stream0=Slider(500, range=0..1000), Stream1=Slider(1000000, range=0..1000000))
hideshow_51 = HideShowElement(ElementToHideShow=button_54, Show=True, Collapse=True, Disable=invert(null_40.NullFlags))
tooltip_17 = AttachTooltipToElement(ElementsToAttachTo=button_54, TooltipContent=filter_66, ShowDelay=filter_67, Duration=2000)

panel_206 = Panel(hold_5)
panel_207 = Panel(split_10)
panel_208 = Panel(clean)

# ---- group: Construction module (continued)
create_window_full_names_3 = RemoteReceiver(create_window_full_names)
create_window_full_names_4 = RemoteReceiver(create_window_full_names)
setlist_5 = SetListContents(ListToModify=pulldown_10, NewListContents=create_window_full_names_4, SelectedIndex=panel_97)  # disabled
setlist_6 = SetListContents(ListToModify=pulldown_11, NewListContents=create_window_full_names_3, SelectedIndex="0")

# ----
# Construction inspection
pre_construction_database_visualize_cons_2 = RemoteReceiver(pre_construction_database_visualize_cons)  # "pre_construction_database_visualize_construction"
path_4 = DataPath(pre_construction_database_visualize_cons_2)
construction_maximum_layer_limit_4 = RemoteReceiver(construction_maximum_layer_limit)
construction_maximum_layer_limit_5 = RemoteReceiver(construction_maximum_layer_limit)
construction_maximum_layer_limit_6 = RemoteReceiver(construction_maximum_layer_limit)
panel_209 = Panel("Construction thickness: {0}")
repeat_18 = RepeatData(Data="0 m", Length=construction_maximum_layer_limit_4)
repeat_19 = RepeatData(Data="Material", Length=construction_maximum_layer_limit_5)
repeat_20 = RepeatData(Data=" ", Length=construction_maximum_layer_limit_6)
tb_46 = CreateTextBlock(Text=repeat_18, TextSize=12, Justification=1)
label_76 = CreateLabel(LabelText="Construction inspection", LabelSize=18, Justification=1)
label_77 = CreateLabel(LabelText="🌳", LabelSize=18, Justification=1)
label_78 = CreateLabel(LabelText="🏠", LabelSize=18, Justification=1)
label_79 = CreateLabel(LabelText=panel_209, LabelSize=18, Justification=1)
tb_47 = CreateTextBlock(Text=repeat_19, TextSize=16, Justification=Slider(1, range=0..10))
tb_48 = CreateTextBlock(Text=repeat_20, TextSize=16, Justification=Slider(1, range=0..10))
construction_maximum_layer_limit_7 = RemoteReceiver(construction_maximum_layer_limit)
settextblock_13 = SetTextBlockContents(TextBlockToModify=tb_48, NewTextBlockContents=" ")
suirify_8 = Suirify(tb_46)
suirify_9 = Suirify(tb_47)
merge_17 = Merge(Data1=graft(suirify_9), Data2=graft(suirify_8))
stack_116 = CreateStack(UIElements=merge_17, Horizontal=True)  # -> flatten(Stack)
material_database_categories_8 = RemoteReceiver(material_database_categories_2)
suirify_10 = Suirify(tb_48)
suirify_11 = Suirify(stack_116)
merge_18 = Merge(Data1=graft(suirify_10), Data2=graft(suirify_11))
number_slider_43 = Slider(250, range=0..1000)
entwine_172 = Entwine(
    Branch00=ColourSwatch(SwatchColor=RGB(204, 102, 51)),
    Branch01=ColourSwatch(SwatchColor=RGB(153, 102, 51)),
    Branch02=ColourSwatch(SwatchColor=RGB(128, 128, 128)),
    Branch03=ColourSwatch(SwatchColor=RGB(255, 204, 102)),
    Branch04=ColourSwatch(SwatchColor=RGB(102, 102, 153)),
    Branch05=ColourSwatch(SwatchColor=RGB(255, 153, 51)),
    Branch06=ColourSwatch(SwatchColor=RGB(102, 51, 0)),
    Branch07=ColourSwatch(SwatchColor=RGB(77, 77, 77)),
    Branch08=ColourSwatch(SwatchColor=RGB(0, 102, 204)),
    Branch09=ColourSwatch(SwatchColor=RGB(153, 153, 153)),
    FlattenInputs=True)  # -> flatten(Result)
stack_117 = CreateStack(UIElements=merge_18, Horizontal=invert(True))  # -> flatten(Stack)
entwine_173 = Entwine(Branch00=label_76, Branch01=label_79, Branch02=label_77, Branch03=stack_117, Branch04=label_78, FlattenInputs=True)  # -> flatten(Result)
swatch_8 = ColourSwatch(SwatchColor=RGB(0, 0, 0))
adjustpos_141 = AdjustElementPositioning(ElementsToAdjust=tb_46, Margin="8, 0, 0, 0", AbsolutePositioning=False, HorizontalAlignment=0)
adjustpos_142 = AdjustElementPositioning(ElementsToAdjust=stack_117, Margin="53, 0, 0, 0", AbsolutePositioning=False, HorizontalAlignment=0)

# ----
# Construction inspection launch
construction_database_visualize_construc_2 = RemoteReceiver(construction_database_visualize_construc)  # "construction_database_visualize_construction"
construction_database_visualize_construc_3 = RemoteReceiver(construction_database_visualize_construc)  # "construction_database_visualize_construction"
create_modal_location_3 = RemoteReceiver(create_modal_location)

bool_62 = Boolean(construction_database_visualize_construc_2)

settextbox_2 = SetTextBoxContents(TextBoxToModify=textbox_11, NewTextBoxContents=bang_11.Branch1)
visible_layers_3 = RemoteReceiver(flatten(visible_layers))
visible_layers_arrows_2 = RemoteReceiver(visible_layers_arrows)
int_13 = Integer(visible_layers_3)
merge_19 = Merge(Data1=simplify(graft(stack_107)), Data2=simplify(graft(textbox_11)))
ma_39 = MassAddition(Input=int_13)  # -> Result, PartialResults
hideshow_52 = HideShowElement(ElementToHideShow=button_51, Show=visible_layers_arrows_2, Collapse=True, Disable=False)
larger_4 = LargerThan(FirstNumber=ma_39.Result, SecondNumber="1")  # -> LargerThan, OrEqualTo
stack_118 = CreateStack(UIElements=merge_19, Horizontal=invert(True))
visible_layers_4 = RemoteReceiver(visible_layers)
filter_68 = StreamFilter(Gate=larger_4.LargerThan, Stream0=larger_4.LargerThan, Stream1=visible_layers_3)
merge_20 = Merge(Data1=simplify(stack_106), Data2=simplify(stack_118), Data3=simplify(graft(button_51)))
hideshow_53 = HideShowElement(ElementToHideShow=stack_118, Show=visible_layers_4, Collapse=True, Disable=False)
hideshow_54 = HideShowElement(ElementToHideShow=label_69, Show=visible_layers_3, Collapse=True, Disable=False)
hideshow_55 = HideShowElement(ElementToHideShow=button_50, Show=filter_68, Collapse=True, Disable=False)

# ----
# Recursion
panel_210 = Panel("Construction visualization")
objbynn_13 = GetObjectByNickname(NickName=panel_210)
construction_visualization = Python3Script()  # -> status; same code as lca_window_status

rec_47 = DataRecorder(bool_62, DataLimit=-2, RecordData=True)
ma_40 = MassAddition(Input=rec_47)  # -> Result, PartialResults
entwine_174 = Entwine(Branch00=ma_40.Result, Branch01=construction_visualization, FlattenInputs=True)
rec_48 = DataRecorder(entwine_174, DataLimit=2, RecordData=True)
item_32 = ListItem(List=rec_48, Index=0, Wrap=True)  # -> Item2, Item1, Item
equals_42 = Equality(FirstNumber=item_32.Item2, SecondNumber=item_32.Item1)  # -> Equality, Inequality
bang_14 = ExplodeTree(Data=equals_42.Inequality)  # -> Branch0, Branch1
py3_49 = Python3Script(x=bang_14.Branch0, y=bang_14.Branch1)  # -> a; same code as py3_5
event_71 = EventGate(Data=py3_49)  # -> Data, IsNew
freeze_gate_62 = StreamFreezeGate(Data=py3_49, PassingSwitch=event_71.IsNew)
event_72 = EventGate(Data=freeze_gate_62)  # -> Data, IsNew
panel_211 = Panel(event_72.Data)
launchwin_12 = LaunchWindow(
    Show=event_72.Data,
    Name="Construction inspection",
    Width=Slider(380, range=0..1000),
    Height=Slider(580, range=0..1000),
    ChildStatus=1,
    EnableHorizScroll=False)
winprops_12 = SetWindowProperties(
    Window=launchwin_12,
    StartingLocation=create_modal_location_3,
    Theme=0,
    AccentColor=heath_accent_color_6,
    ShowTitleBar=True,
    BackgroundColor=RGB(255, 255, 255),
    ScaleFactor=1)
winstat_12 = WindowStatus(Window=launchwin_12)
addelems_12 = AddElements(Window=launchwin_12, Elements=flatten(entwine_173), DoVLChecking=True)  # -> AddedElements, ElementNames
py3_50 = Python3Script(window=launchwin_12, activate=construction_database_visualize_construc_3)  # same code as py3_6
panel_212 = Panel(winstat_12)
construction_visualization_status = RemoteSender(winstat_12)

construction_visualization_status_2 = RemoteReceiver(construction_visualization_status)
expression_75 = Expression(x="Hidden", y=construction_visualization_status_2, Expression="x=y")
expire_11 = ExpireObject(ObjectToExpire=objbynn_13, Expire=expression_75)

# ----
# Recursion
panel_213 = Panel("Construction modal")
create_construction_3 = RemoteReceiver(create_construction)
objbynn_14 = GetObjectByNickname(NickName=panel_213)
construction_modal = Python3Script()  # -> status; same code as lca_window_status

# ----
# Create construction launch
create_construction_modal_2 = RemoteReceiver(create_construction_modal)
rec_49 = DataRecorder(create_construction_modal_2, DataLimit=-2, RecordData=True)
ma_41 = MassAddition(Input=rec_49)  # -> Result, PartialResults
entwine_175 = Entwine(Branch00=ma_41.Result, Branch01=construction_modal, FlattenInputs=True)
rec_50 = DataRecorder(entwine_175, DataLimit=2, RecordData=True)
item_33 = ListItem(List=rec_50, Index=0, Wrap=True)  # -> Item2, Item1, Item
equals_43 = Equality(FirstNumber=item_33.Item2, SecondNumber=item_33.Item1)  # -> Equality, Inequality
bang_15 = ExplodeTree(Data=equals_43.Inequality)  # -> Branch0, Branch1
py3_51 = Python3Script(x=bang_15.Branch0, y=bang_15.Branch1)  # -> a; same code as py3_5
event_73 = EventGate(Data=py3_51)  # -> Data, IsNew
freeze_gate_63 = StreamFreezeGate(Data=py3_51, PassingSwitch=event_73.IsNew)
event_74 = EventGate(Data=freeze_gate_63)  # -> Data, IsNew
entwine_176 = Entwine(
    Branch00=entwine_151,
    Branch01=label_68,
    Branch02=merge_20,
    Branch03=button_48,
    Branch04=label_67,
    Branch05=button_49,
    FlattenInputs=True)  # -> flatten(Result)
launchwin_13 = LaunchWindow(
    Show=event_74.Data,
    Name="Create construction",
    Width=Slider(360, range=0..1000),
    Height=Slider(540, range=0..1000),
    ChildStatus=1,
    EnableHorizScroll=False)
panel_214 = Panel(event_74.Data)
create_construction_modal_3 = RemoteReceiver(create_construction_modal)
create_modal_location_4 = RemoteReceiver(create_modal_location)
addelems_13 = AddElements(Window=launchwin_13, Elements=flatten(entwine_176), DoVLChecking=True)  # -> AddedElements, ElementNames
winprops_13 = SetWindowProperties(
    Window=launchwin_13,
    StartingLocation=create_modal_location_4,
    Theme=0,
    AccentColor=heath_accent_color_8,
    ShowTitleBar=True,
    BackgroundColor=RGB(255, 255, 255),
    ScaleFactor=1)
winstat_13 = WindowStatus(Window=launchwin_13)
py3_52 = Python3Script(window=launchwin_13, activate=create_construction_modal_3)  # same code as py3_6
create_construction_modal_status = RemoteSender(winstat_13)
construction_elements = RemoteSender(addelems_13.AddedElements)

create_construction_modal_status_2 = RemoteReceiver(create_construction_modal_status)
expression_76 = Expression(x="Hidden", y=create_construction_modal_status_2, Expression="x=y")
or_30 = GateOr(A=expression_76, C=create_construction_3)
expire_12 = ExpireObject(ObjectToExpire=objbynn_14, Expire=or_30)

# ----
# Recursion
panel_215 = Panel("Window modal")
create_window_3 = RemoteReceiver(create_window)
objbynn_15 = GetObjectByNickname(NickName=panel_215)
window_modal = Python3Script()  # -> status; same code as lca_window_status

# ----
# Create window launch
create_window_modal_3 = RemoteReceiver(create_window_modal)
rec_51 = DataRecorder(create_window_modal_3, DataLimit=-2, RecordData=True)
ma_42 = MassAddition(Input=rec_51)  # -> Result, PartialResults
entwine_177 = Entwine(Branch00=ma_42.Result, Branch01=window_modal, FlattenInputs=True)
rec_52 = DataRecorder(entwine_177, DataLimit=2, RecordData=True)
item_34 = ListItem(List=rec_52, Index=0, Wrap=True)  # -> Item2, Item1, Item
equals_44 = Equality(FirstNumber=item_34.Item2, SecondNumber=item_34.Item1)  # -> Equality, Inequality
bang_16 = ExplodeTree(Data=equals_44.Inequality)  # -> Branch0, Branch1
py3_53 = Python3Script(x=bang_16.Branch0, y=bang_16.Branch1)  # -> a; same code as py3_5
event_75 = EventGate(Data=py3_53)  # -> Data, IsNew
freeze_gate_64 = StreamFreezeGate(Data=py3_53, PassingSwitch=event_75.IsNew)
event_76 = EventGate(Data=freeze_gate_64)  # -> Data, IsNew
panel_216 = Panel(event_76.Data)
entwine_178 = Entwine(
    Branch00=stack_115,
    Branch01=stack_113,
    Branch02=stack_114,
    Branch03=stack_6,
    Branch04=data,
    Branch05=a4,
    Branch06=button_54,
    FlattenInputs=True)  # -> flatten(Result)
launchwin_14 = LaunchWindow(
    Show=event_76.Data,
    Name="Create window",
    Width=Slider(235, range=0..1000),
    Height=Slider(305, range=0..1000),
    ChildStatus=1,
    EnableHorizScroll=False)
create_modal_location_5 = RemoteReceiver(create_modal_location)
create_window_modal_4 = RemoteReceiver(create_window_modal)
winstat_14 = WindowStatus(Window=launchwin_14)
addelems_14 = AddElements(Window=launchwin_14, Elements=flatten(entwine_178), DoVLChecking=True)  # -> AddedElements, ElementNames
py3_54 = Python3Script(window=launchwin_14, activate=create_window_modal_4)  # same code as py3_6
winprops_14 = SetWindowProperties(
    Window=launchwin_14,
    StartingLocation=create_modal_location_5,
    Theme=0,
    AccentColor=heath_accent_color_7,
    ShowTitleBar=True,
    BackgroundColor=RGB(255, 255, 255),
    ScaleFactor=1)
create_window_modal_status = RemoteSender(winstat_14)
window_elements = RemoteSender(addelems_14.AddedElements)

create_window_modal_status_2 = RemoteReceiver(create_window_modal_status)
expression_77 = Expression(x="Hidden", y=create_window_modal_status_2, Expression="x=y")
or_31 = GateOr(A=expression_77, C=create_window_3)
expire_13 = ExpireObject(ObjectToExpire=objbynn_15, Expire=or_31)

# ----
# Recursion
panel_217 = Panel("Material modal")
create_material_3 = RemoteReceiver(create_material)
objbynn_16 = GetObjectByNickname(NickName=panel_217)
material_modal = Python3Script()  # -> status; same code as lca_window_status

# ----
# Create material launch
create_material_modal_3 = RemoteReceiver(create_material_modal)
rec_53 = DataRecorder(create_material_modal_3, DataLimit=-2, RecordData=True)
ma_43 = MassAddition(Input=rec_53)  # -> Result, PartialResults
entwine_179 = Entwine(Branch00=ma_43.Result, Branch01=material_modal, FlattenInputs=True)
rec_54 = DataRecorder(entwine_179, DataLimit=2, RecordData=True)
item_35 = ListItem(List=rec_54, Index=0, Wrap=True)  # -> Item2, Item1, Item
equals_45 = Equality(FirstNumber=item_35.Item2, SecondNumber=item_35.Item1)  # -> Equality, Inequality
bang_17 = ExplodeTree(Data=equals_45.Inequality)  # -> Branch0, Branch1
py3_55 = Python3Script(x=bang_17.Branch0, y=bang_17.Branch1)  # -> a; same code as py3_5
event_77 = EventGate(Data=py3_55)  # -> Data, IsNew
freeze_gate_65 = StreamFreezeGate(Data=py3_55, PassingSwitch=event_77.IsNew)
event_78 = EventGate(Data=freeze_gate_65)  # -> Data, IsNew
entwine_180 = Entwine(
    Branch00=stack_111,
    Branch01=pulldown_27,
    Branch02=stack_108,
    Branch03=density,
    Branch04=specific_heat,
    Branch05=data_26,
    Branch06=a4_2,
    Branch07=data_2,
    Branch08=button_53,
    FlattenInputs=True)  # -> flatten(Result)
launchwin_15 = LaunchWindow(
    Show=event_78.Data,
    Name="Create material",
    Width=Slider(250, range=0..1000),
    Height=Slider(380, range=0..1000),
    ChildStatus=1,
    EnableHorizScroll=False)
panel_218 = Panel(event_78.Data)
create_modal_location_6 = RemoteReceiver(create_modal_location)
create_material_modal_4 = RemoteReceiver(create_material_modal)
heath_accent_color_16 = RemoteReceiver(heath_accent_color)
addelems_15 = AddElements(Window=launchwin_15, Elements=flatten(entwine_180), DoVLChecking=True)  # -> AddedElements, ElementNames
py3_56 = Python3Script(window=launchwin_15, activate=create_material_modal_4)  # same code as py3_6
winprops_15 = SetWindowProperties(
    Window=launchwin_15,
    StartingLocation=create_modal_location_6,
    Theme=0,
    AccentColor=heath_accent_color_16,
    ShowTitleBar=True,
    BackgroundColor=RGB(255, 255, 255),
    ScaleFactor=1)
winstat_15 = WindowStatus(Window=launchwin_15)
material_elements = RemoteSender(addelems_15.AddedElements)
create_material_modal_status = RemoteSender(winstat_15)

create_material_modal_status_2 = RemoteReceiver(create_material_modal_status)
expression_78 = Expression(x="Hidden", y=create_material_modal_status_2, Expression="x=y")
or_32 = GateOr(A=expression_78, C=create_material_3)
expire_14 = ExpireObject(ObjectToExpire=objbynn_16, Expire=or_32)

# ----
# Constructions database
panel_219 = Panel("Heath constructions")

# ----
# Materials database
panel_220 = Panel("Heath materials")

# ----
# Bake model
panel_221 = Panel("""Heath::honeybee model::walls
Heath::honeybee model::roof
Heath::honeybee model::floors
Heath::honeybee model::ground
Heath::honeybee model::windows
Heath::honeybee model::context""")
entwine_181 = Entwine(
    Branch00=data_22,
    Branch01=data_20,
    Branch02=data_23,
    Branch03=data_24,
    Branch04=data_21,
    Branch05=data_25,
    FlattenInputs=True)
bake_model_2 = RemoteReceiver(bake_model)
clean_5 = CleanTree(RemoveNulls=True, RemoveInvalid=True, RemoveEmpty=invert(False), Tree=entwine_181)
bbox_2 = BoundingBox(Content=clean_5, Plane=PlaneXY(0, 0, 0))  # -> Box, Box_2
getbrn = GetMatchingBranches(PrimaryData=clean_5, SecondaryData1=graft(panel_221), removeEmpty=False)  # -> flatten(PrimaryData), flatten(SecondaryData1)
null_41 = NullItem(Item=bbox_2.Box)  # -> flatten(NullFlags), InvalidFlags, Description
honeybee_model_bounding_box = RemoteSender(bbox_2.Box)
cull_19 = CullPattern(List=null_41.NullFlags, CullPattern=invert(null_41.NullFlags))
lng_29 = ListLength(List=cull_19)
honeybee_model_displayed = RemoteSender(lng_29)

honeybee_model_displayed_2 = RemoteReceiver(honeybee_model_displayed)
hideshow_56 = HideShowElement(
    ElementToHideShow=[button_20, button_19],
    Show=honeybee_model_exists_6,
    Collapse=True,
    Disable=invert(honeybee_model_displayed_2))

ef_layer = EleFrontLayer(Layer=getbrn.SecondaryData1, fullpath=True)
ef_att_3 = EleFrontAttributes(Layer=ef_layer, maintainBakeName=False)
hasdata_9 = DataExists(Data=getbrn.PrimaryData)

gate_50 = StreamGate(Stream=ef_att_3, Gate=hasdata_9)  # -> Target0, Target1

bake = BakeObjects(Geometry=getbrn.PrimaryData, Attributes=gate_50.Target1, Bake=bake_model_2, createGroups=False)  # -> Message, Ghosts

# ----
# Zoom honeybee model
honeybee_model_bounding_box_2 = RemoteReceiver(honeybee_model_bounding_box)
zoom_honeybee_model_2 = RemoteReceiver(zoom_honeybee_model)
zbb_2 = ZoomBoundingBox(Box=flatten(honeybee_model_bounding_box_2), Run=zoom_honeybee_model_2)

# ----
# CYCLOPS
cyclops_generate_wwr_2 = RemoteReceiver(cyclops_generate_wwr)  # disabled
facesbytype = HBFacesByType(hb_objs=loadobjects.hb_objs)  # -> walls, interior_walls, roofs, ceilings, exterior_floors, interior_floors, air_walls, apertures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; disabled; plug-in component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
deconstructmodel_2 = HBDeconstructModel(model=loadobjects.hb_objs)  # -> rooms, faces, apertures, doors, shades; disabled; plug-in component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
cyclops_generate_wwr_3 = RemoteReceiver(cyclops_generate_wwr)  # disabled
round = Round(Number=cyclops_generate_wwr_3)  # -> Nearest, Floor, Ceiling; disabled
vizquick = HBVisualizeQuick(hb_objs=flatten(deconstructmodel_2.rooms))  # -> geo; disabled; plug-in component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
vizquick_2 = HBVisualizeQuick(hb_objs=flatten(facesbytype.apertures))  # -> geo; disabled; plug-in component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
vizquick_3 = HBVisualizeQuick(hb_objs=flatten(facesbytype.outdoor_shades))  # -> geo; disabled; plug-in component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
clean_6 = CleanTree(RemoveNulls=True, RemoveInvalid=True, RemoveEmpty=False, Tree=vizquick_3)  # disabled
clean_7 = CleanTree(RemoveNulls=True, RemoveInvalid=True, RemoveEmpty=False, Tree=vizquick)  # disabled
clean_8 = CleanTree(RemoveNulls=True, RemoveInvalid=True, RemoveEmpty=False, Tree=vizquick_2)  # disabled
cyclops_generate_wwr_4 = RemoteReceiver(cyclops_generate_wwr)  # disabled
filter_69 = StreamFilter(Gate=cyclops_select_geometry_2, Stream0=clean_6, Stream1=context)  # disabled
filter_70 = StreamFilter(Gate=cyclops_select_geometry_2, Stream0=clean_7, Stream1=merge_3)  # disabled
filter_71 = StreamFilter(Gate=cyclops_select_geometry_2, Stream0=clean_8, Stream1=merge_4)  # disabled
round_2 = Round(Number=cyclops_generate_wwr_4)  # -> Nearest, Floor, Ceiling; disabled
cyclops_preview_opacity_2 = RemoteReceiver(cyclops_preview_opacity)  # disabled
expander_cyclops_daylight_approximation_3 = RemoteReceiver(expander_cyclops_daylight_approximation)  # disabled
cyclops_preview_opacity_3 = RemoteReceiver(cyclops_preview_opacity)  # disabled
bool_63 = Boolean(cyclops_preview_opacity_3)  # disabled
debrep = DeconstructBrep(Brep=filter_69)  # -> Faces, Edges, Vertices; disabled
and_47 = GateAnd(A=expander_cyclops_daylight_approximation_3, B=bool_63)  # disabled
obstruction_surface = Geometry(debrep.Faces)  # disabled
number_slider_44 = Slider(0.05, range=0..0.1)  # disabled
md_slider = MDSlider(SliderMode=0, slider_value=Point(0.5, 0.5, 0.5), x_domain=Domain(0, 1), y_domain=Domain(0, 1), z_domain=Domain(0, 1))  # disabled
location_weather_url_4 = RemoteReceiver(location_weather_url)  # disabled
number_slider_45 = Slider(0.01, range=0..0.01)  # disabled
number_slider_46 = Slider(0.01, range=0..0.01)  # disabled
srf = Surface(obstruction_surface)  # disabled
downloadepw_3 = LBDownloadWeather(weather_URL=location_weather_url_4)  # -> epw_file, stat_file, ddy_file; disabled; plug-in component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
Z = UnitZ(Factor=number_slider_45)  # disabled
glass_transmittance = Slider(0.8, range=0..1)  # disabled
importloc_3 = LBImportLocation(epw_file=downloadepw_3.epw_file)  # -> location; disabled; plug-in component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
panel_222 = Panel("24")  # disabled
decnstrloc_3 = LBDeconstructLocation(location=importloc_3)  # -> name, latitude, longitude, time_zone, elevation; disabled; plug-in component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
material_name = Panel("Glass")  # disabled
panel_223 = Panel("0.0057")  # disabled
panel_224 = Panel("0.2")  # disabled
material_name_2 = Panel("Plaster")  # disabled
swatch_9 = ColourSwatch(SwatchColor=RGB(210, 205, 182))  # disabled
hsv = ColourHSV(Alpha=1, Hue=0, Saturation=0, Value=glass_transmittance)  # disabled
panel_225 = Panel("3")  # disabled
hours = Series(Start=0, Step=1, Count=panel_222)  # disabled
panel_226 = Panel("21")  # disabled
swatch_10 = ColourSwatch(SwatchColor=RGBA(167, 128, 26, 12))  # disabled
C = LocationFromCoordinates(Latitude=decnstrloc_3.latitude, Longitude=decnstrloc_3.longitude, method="Location From Coordinates", version="1.0.0.0")  # disabled
tp = FromSchedule(Months=panel_225, Days=panel_226, Hours=hours, TimeStep=1, method="From Schedule", version="0.0.0.DevBuild")  # disabled
M = PlasticMaterial(
    Name=material_name_2,
    BaseColor=swatch_9,
    Specularity=panel_223,
    Roughness=panel_224,
    method="Plastic Material",
    version="1.0.0.0")  # disabled
M_2 = GlassMaterial(Name=material_name, Transmittance=hsv, RefractiveIndex=1.52, method="Glass Material", version="0.0.0.DevBuild")  # disabled
R = SunRig(NorthVector=Vector(0, 1, 0), Location=C, TimePattern=tp, CutOffElevation=0, method="Sun Rig", version="1.0.0.0")  # disabled
intersection_type = IntersectionType(CyclopsValueList="Target", version="1.2.0.60000")  # disabled
subdivision = Subdivision(CyclopsValueList="EqualAreaAspectSubdivision", version="1.0.0.0")  # disabled
cell_count = Slider(128, range=0..1000)  # disabled
H = Hemisphere(CellCount=cell_count, Subdivision=subdivision, method="Hemisphere", version="0.0.0.DevBuild")  # disabled
cyclops_select_simulation_4 = RemoteReceiver(cyclops_select_simulation)  # disabled
luminous_efficacy_model = LuminousEfficacyModel(CyclopsValueList="Measured Illuminance", version="1.2.0.60000")  # disabled
cyclops_select_simulation_5 = RemoteReceiver(cyclops_select_simulation)  # disabled
hemisphere = Data(H)  # disabled
months = Series(Start=number_slider_14, Step=1, Count=number_slider_15)  # disabled
days = Series(Start=number_slider_17, Step=1, Count=number_slider_12)  # disabled
hours_2 = Series(Start=number_slider_16, Step=1, Count=number_slider_13)  # disabled
luminance_distribution_model = LuminanceDistributionModel(CyclopsValueList="CIE Standard Sky Model", version="1.2.0.60000")  # disabled
analysis_quality = AnalysisQuality(CyclopsValueList="Medium", version="1.2.0.60000")  # disabled
hemisphere_2 = Data(H)  # disabled
hemisphere_3 = Data(H)  # disabled
tp_2 = FromSchedule(Months=months, Days=days, Hours=hours_2, TimeStep=1, method="From Schedule", version="0.0.0.DevBuild")  # disabled
W = Weather(
    Path=downloadepw_3.epw_file,
    NorthVector=Vector(0, 1, 0),
    LuminousEfficacyModel=luminous_efficacy_model,
    version="1.2.0.60000")  # disabled
aps = PresetAnalysisSettings(AnalysisQuality=analysis_quality, version="1.2.0.60000")  # disabled
ss = SkySeries(
    Weather=W,
    Hemisphere=hemisphere,
    TimePattern=tp_2,
    LuminanceDistributionModel=luminance_distribution_model,
    version="1.2.0.60000")  # disabled
sky_type = SkyType(CyclopsValueList="S01_CIEStandardOvercastSky", version="1.0.0.0")  # disabled
cyclops_select_simulation_6 = RemoteReceiver(cyclops_select_simulation)  # disabled
cyclops_select_simulation_7 = RemoteReceiver(cyclops_select_simulation)  # disabled
cyclops_select_simulation_8 = RemoteReceiver(cyclops_select_simulation)  # disabled
cyclops_select_simulation_9 = RemoteReceiver(cyclops_select_simulation)  # disabled
cyclops_select_simulation_10 = RemoteReceiver(cyclops_select_simulation)  # disabled
sky_type_2 = SkyType(CyclopsValueList="S01_CIEStandardOvercastSky", version="1.2.0.60000")  # disabled
cyclops_select_simulation_11 = RemoteReceiver(cyclops_select_simulation)  # disabled
threshold = Slider(300, range=0..1000)  # disabled
number_slider_47 = Slider(2000, range=0..10000)  # disabled
threshold_2 = Slider(300, range=0..1000)  # disabled
sun_rig = CyclopsObject(R, version="1.2.0.60000")  # disabled
properties = Properties(CyclopsValueList="Hemisphere", version="1.2.0.60000")  # disabled
dom_10 = ConstructDomain(DomainStart=threshold, DomainEnd=number_slider_47)  # disabled
properties_2 = Properties(CyclopsValueList="Cumulative Sky", version="1.2.0.60000")  # disabled
gpv = GetPropertyValue(Object=ss, Property=properties, version="1.2.0.60000")  # disabled
gpv_2 = GetPropertyValue(Object=ss, Property=properties_2, version="1.2.0.60000")  # disabled
properties_3 = Properties(CyclopsValueList="Luminance Cells", version="1.2.0.60000")  # disabled
panel_227 = Panel("""10000
500
60000""")  # disabled
gpv_3 = GetPropertyValue(Object=gpv_2, Property=properties_3, version="1.2.0.60000")  # disabled
item_36 = ListItem(List=panel_227, Index=cyclops_metric_option_3, Wrap=True)  # disabled
properties_4 = Properties(CyclopsValueList="Total Luminance", version="1.2.0.60000")  # disabled
cyclops_slider_value_6 = RemoteReceiver(cyclops_slider_value)  # disabled
number_slider_48 = Slider(1200, range=0..1200)  # disabled
cyclops_slider_value_7 = RemoteReceiver(cyclops_slider_value)  # disabled
number_slider_49 = Slider(10, range=0..10)  # disabled
cyclops_slider_value_8 = RemoteReceiver(cyclops_slider_value)  # disabled
gpv_4 = GetPropertyValue(Object=gpv_3, Property=properties_4, version="1.2.0.60000")  # -> flatten(Value); disabled
panel_228 = Panel("0.2")  # disabled
cyclops_filter_checkbox_6 = RemoteReceiver(cyclops_filter_checkbox)  # disabled
cyclops_filter_checkbox_7 = RemoteReceiver(cyclops_filter_checkbox)  # disabled
panel_229 = Panel("0.5")  # disabled
cyclops_filter_checkbox_8 = RemoteReceiver(cyclops_filter_checkbox)  # disabled
cyclops_filter_checkbox_9 = RemoteReceiver(cyclops_filter_checkbox)  # disabled
panel_230 = Panel("True")  # disabled
panel_231 = Panel("True")  # disabled
bnd = Bounds(Numbers=gpv_4)  # disabled
panel_232 = Panel("True")  # disabled
panel_233 = Panel("True")  # disabled
interactive_gradient = InteractiveGradient(
    Domain=bnd,
    version="0.0.0.DevBuild",
    CyclopsGradient_Linear=False,
    CyclopsGradient_Grip0_Factor=0,
    CyclopsGradient_Grip1_Factor=0.25,
    CyclopsGradient_Grip2_Factor=0.5,
    CyclopsGradient_Grip3_Factor=0.75,
    CyclopsGradient_Grip4_Factor=1)  # disabled
hemisphere_projection = HemisphereProjection(CyclopsValueList="Spherical", version="1.2.0.60000")  # disabled
number_slider_50 = Slider(10, range=0..100)  # disabled
D = HemisphereMesh(
    Hemisphere=gpv,
    Position=Point(0, 0, 0),
    Scale=number_slider_50,
    HemisphereProjection=hemisphere_projection,
    Parameters=gpv_4,
    Gradient=interactive_gradient,
    method="Hemisphere Mesh",
    version="1.2.0.60000")  # disabled
hemishere_visualisation = Mesh(D)  # disabled
expander_cyclops_daylight_approximation_4 = RemoteReceiver(expander_cyclops_daylight_approximation)  # disabled

clean_9 = CleanTree(RemoveNulls=True, RemoveInvalid=True, RemoveEmpty=False, Tree=filter_70)  # disabled
clean_10 = CleanTree(RemoveNulls=True, RemoveInvalid=True, RemoveEmpty=False, Tree=filter_71)  # disabled
gate_51 = StreamGate(Stream=filter_69, Gate=expander_cyclops_daylight_approximation_2)  # -> Target0, Target1; disabled
preview_19 = CustomPreview(Geometry=gate_51.Target1, Material=swatch)  # disabled
expression_79 = Expression(x=panel_23, y=cyclops_select_simulation_4, Expression="x=y")  # disabled
expression_80 = Expression(x=panel_24, y=cyclops_select_simulation_4, Expression="x=y")  # disabled
expression_81 = Expression(x=panel_25, y=cyclops_select_simulation_4, Expression="x=y")  # disabled
expression_82 = Expression(x=panel_26, y=cyclops_select_simulation_4, Expression="x=y")  # disabled
expression_83 = Expression(x=panel_27, y=cyclops_select_simulation_5, Expression="x=y")  # disabled
expression_84 = Expression(x=panel_28, y=cyclops_select_simulation_6, Expression="x=y")  # disabled
expression_85 = Expression(x=panel_29, y=cyclops_select_simulation_7, Expression="x=y")  # disabled
expression_86 = Expression(x=panel_32, y=cyclops_select_simulation_9, Expression="x=y")  # disabled
expression_87 = Expression(x=panel_30, y=cyclops_select_simulation_8, Expression="x=y")  # disabled
expression_88 = Expression(x=panel_31, y=cyclops_select_simulation_10, Expression="x=y")  # disabled
expression_89 = Expression(x=panel_33, y=cyclops_select_simulation_11, Expression="x=y")  # disabled

# ----
# Weather visualisation
# # Weather visualisation
# This cluster visualises weather data from a .epw file including solar radiation and temperature, as applied to a target geometry
# 
# ## Instructions
# Enter all the inputs and visualise wind, sky view and temperature,  set `Run direct sun hours study` and `Run incident radiation study` to visualise solar radiation
# 
# ## Inputs
# - `EPW file URL` - the URL for a EPW file which describes the location
# - `Target Geometry` - geometry on which to apply irradiation study
# - `Context Geometry` - geometry which shades the target geometry
# - `Run direct sun hours study` - set to True to run the direct sun hours study
# - `Run incident radiation study` - set to True to run the incident radiation study
# - `Sky mask centre point` - point at which to generate sky mask
# 
# ## Outputs
# - `Sky dome` - mesh visualising the directions where solar radiation comes from during the year at the location
# - `Sky mask - mesh visualising what portions of the sky are visible at the specified point
# - `Wind rose` - mesh visualising wind directions and velocities during the year
# - `Dry bulb temperature line chart` - mesh visualising dry bulb temperature during the year
# - `Dry bulb temperature 2D chart` - mesh visualising dry bulb temperature for each hour of the year
# - `Direct sun hours` - mesh visualising the number of direct sun hours on the target geometry
# - `Incident radiation` - mesh visualising the incident radiation [kWh/m2] on the target geometry
# 
# ## Interpretation
# To be added...
location_weather_url_5 = RemoteReceiver(location_weather_url)
data_27 = Data(location_weather_url_5)
downloadepw_4 = LBDownloadWeather(weather_URL=data_27)  # -> epw_file, stat_file, ddy_file; plug-in component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
importepw = LBImportEPW(epw_file=downloadepw_4.epw_file)  # -> location, dry_bulb_temperature, dew_point_temperature, relative_humidity, wind_speed, wind_direction, direct_normal_rad, diffuse_horizontal_rad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; plug-in component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
timeop = LBTimeIntervalOperation(data=importepw.dry_bulb_temperature)  # -> daily, monthly, mon_per_hr; plug-in component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
analysisperiod_2 = LBAnalysisPeriod(
    start_month=Slider(1, range=1..12),
    start_day=Slider(1, range=1..31),
    start_hour=Slider(0, range=0..23),
    end_month=Slider(12, range=1..12),
    end_day=Slider(31, range=1..31),
    end_hour=Slider(23, range=0..23))  # -> period, hoys, dates; plug-in component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
legendpar = LBLegendParameters(
    min=Slider(-15, range=-15..30),
    max=Slider(25, range=0..100),
    num_decimals=Slider(0, range=0..100),
    larger_smaller=Toggle(True),
    vert_or_horiz=Toggle(False))  # -> leg_par; plug-in component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
monthlychart = LBMonthlyChart(data=timeop.daily)  # -> report, data_mesh, data_lines, col_lines, legend, borders, labels, y_title, title, vis_set; plug-in component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
windrose = LBWindRose(
    data=importepw.wind_speed,
    wind_direction=importepw.wind_direction,
    show_calm=Toggle(True),
    period=analysisperiod_2.period)  # -> report, mesh, compass, orient_line, freq_line, windrose_line, legend, title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; plug-in component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
hourlyplot = LBHourlyPlot(data=importepw.dry_bulb_temperature, z_dim=Slider(0, range=0..100), reverse_y=Toggle(True), legend_par=legendpar)  # -> report, mesh, legend, borders, labels, title, vis_set; plug-in component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
merge_21 = Merge(Data1=hourlyplot.mesh, Data2=hourlyplot.legend, Data4=hourlyplot.labels, Data5=hourlyplot.title)
merge_22 = Merge(
    Data1=monthlychart.data_mesh,
    Data2=monthlychart.legend,
    Data4=monthlychart.labels,
    Data5=monthlychart.y_title,
    Data6=monthlychart.title)  # -> flatten(DryBulbTemperatureLineChart)
merge_23 = Merge(
    Data1=windrose.mesh,
    Data2=windrose.compass,
    Data3=windrose.orient_line,
    Data4=windrose.freq_line,
    Data6=windrose.legend,
    Data7=windrose.title)
weather_visualization_type_2 = RemoteReceiver(weather_visualization_type)
filter_72 = StreamFilter(Gate=weather_visualization_type_2, Stream0=hemishere_visualisation, Stream1=merge_23, Stream2=merge_22, Stream3=merge_21)
null_42 = NullItem(Item=filter_72)  # -> NullFlags, InvalidFlags, Description
cull_20 = CullPattern(List=null_42.NullFlags, CullPattern=invert(null_42.NullFlags))
clean_11 = CleanTree(RemoveNulls=True, RemoveInvalid=True, RemoveEmpty=False, Tree=filter_72)
lng_30 = ListLength(List=cull_20)
indices = ListIndices(Data=filter_72)
index_2 = ItemIndex(List=filter_72, Item=clean_11)
weather_visualisation_exists = RemoteSender(lng_30)
exdiff = SetDifferenceS(SetA=indices, SetB=index_2)
item_37 = ListItem(List=filter_72, Index=exdiff, Wrap=True)
alignvert = AlignVertices(Mesh=item_37, Tolerance=0.01)  # -> Result, Count
expander_inspect_location_environment_2 = RemoteReceiver(expander_inspect_location_environment)
clean_12 = CleanTree(RemoveNulls=True, RemoveInvalid=True, RemoveEmpty=False, Tree=alignvert.Result)
merge_24 = Merge(Data1=clean_11, Data2=clean_12)
gate_52 = StreamGate(Stream=merge_24, Gate=expander_inspect_location_environment_2)  # -> Target0, Target1
preview_20 = CustomPreview(Geometry=gate_52.Target1, Material=ColourSwatch(SwatchColor=RGB(84, 84, 84)))

weather_visualisation_exists_2 = RemoteReceiver(weather_visualisation_exists)
hideshow_57 = HideShowElement(ElementToHideShow=[button_21, button_22], Show=weather_visualisation_exists_2, Collapse=True, Disable=False)

division_11 = Division(A=cyclops_slider_value_6, B=panel_34)  # disabled
skymatrix = LBCumulativeSkyMatrix(
    north=north_vector_2,
    location=importepw.location,
    direct_rad=importepw.direct_normal_rad,
    diffuse_rad=importepw.diffuse_horizontal_rad,
    hoys=analysisperiod.hoys,
    run=and_35)  # -> report, sky_mtx; plug-in component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
incidentradiation = LBIncidentRadiation(
    sky_mtx=skymatrix.sky_mtx,
    geometry=flatten(selected_target_geometry_3),
    context=flatten(selected_shading_geometry_3),
    grid_size=daylight_grid_size_2,
    offset_dist=Slider(0.1, range=0..0.1),
    run=and_35)  # -> report, points, results, total, mesh, legend, title, int_mtx; plug-in component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
skydome = LBSkyDome(sky_mtx=skymatrix.sky_mtx)  # -> report, mesh, compass, legend, title, patch_vecs, patch_values, mesh_values, vis_set; disabled; plug-in component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
merge_25 = Merge(Data1=skydome.mesh, Data2=skydome.compass, Data3=skydome.legend, Data4=skydome.title)  # -> flatten(SkyDome)
merge_26 = Merge(Data1=incidentradiation.mesh, Data2=incidentradiation.legend, Data3=incidentradiation.title)  # -> flatten(IncidentRadiation)
filter_73 = StreamFilter(Gate=context_analysis_type_2, Stream0=merge_26, Stream1=merge_25)
null_43 = NullItem(Item=filter_73)  # -> NullFlags, InvalidFlags, Description
cull_21 = CullPattern(List=null_43.NullFlags, CullPattern=invert(null_43.NullFlags))
clean_13 = CleanTree(RemoveNulls=True, RemoveInvalid=True, RemoveEmpty=False, Tree=filter_73)
lng_31 = ListLength(List=cull_21)
indices_2 = ListIndices(Data=filter_73)
index_3 = ItemIndex(List=filter_73, Item=clean_13)
context_analysis_exists = RemoteSender(lng_31)

context_analysis_exists_2 = RemoteReceiver(context_analysis_exists)

exdiff_2 = SetDifferenceS(SetA=indices_2, SetB=index_3)
item_38 = ListItem(List=filter_73, Index=exdiff_2, Wrap=True)
alignvert_2 = AlignVertices(Mesh=item_38, Tolerance=0.01)  # -> Result, Count
clean_14 = CleanTree(RemoveNulls=True, RemoveInvalid=True, RemoveEmpty=False, Tree=alignvert_2.Result)
merge_27 = Merge(Data1=clean_13, Data2=clean_14)
gate_53 = StreamGate(Stream=merge_27, Gate=context_analysis_expander_is_open_5)  # -> Target0, Target1
preview_21 = CustomPreview(Geometry=gate_53.Target1, Material=swatch_2)

# ----
# Bake weather visualization
panel_234 = Panel("""Heath::weather::Hemisphere visualisation
Heath::weather::Wind rose
Heath::weather::Temperature line chart
Heath::weather::Temperature 2D chart""")
weather_visualization_type_3 = RemoteReceiver(weather_visualization_type)
weather_visualisation_bake_2 = RemoteReceiver(weather_visualisation_bake)
item_39 = ListItem(List=panel_234, Index=weather_visualization_type_3, Wrap=invert(True))
gate_54 = StreamGate(Stream=item_39, Gate=weather_visualisation_bake_2)  # -> Target0, Target1
connected = GetConnectedObjects(Objects=gate_52.Target1)
layers = CreateModifyLayers(LayerName=gate_54.Target1, DeleteLayer=False, enableFullPath=True)  # -> LayerNames, LayerFullPath
createatts = CreateAttributes(LayerName=layers.LayerFullPath, enableFullPath=True)
bake_2 = BakeObject(Objects=connected, ObjectAttributes=createatts, Bake=weather_visualisation_bake_2)

# ----
# Zoom weather visualization
mesh = Mesh(gate_52.Target1)
zoom_weather_visualization_2 = RemoteReceiver(zoom_weather_visualization)
bbox_3 = BoundingBox(Content=mesh, Plane=PlaneXY(0, 0, 0), UnionBox=True)  # -> Box, Box_2
zbb_3 = ZoomBoundingBox(Box=bbox_3.Box, Run=zoom_weather_visualization_2)

merge_28 = Merge(Data1=gate_53.Target1, Data2=merge_27)  # -> flatten(Result)
connected_2 = GetConnectedObjects(Objects=merge_28)

# ----
# Bake context analysis
panel_235 = Panel("Heath::context::Incident radiation")
context_analysis_type_3 = RemoteReceiver(context_analysis_type)
item_40 = ListItem(List=panel_235, Index=context_analysis_type_3, Wrap=invert(True))
context_analysis_bake_2 = RemoteReceiver(context_analysis_bake)
gate_55 = StreamGate(Stream=item_40, Gate=context_analysis_bake_2)  # -> Target0, Target1
layers_2 = CreateModifyLayers(LayerName=gate_55.Target1, DeleteLayer=False, enableFullPath=True)  # -> LayerNames, LayerFullPath
createatts_2 = CreateAttributes(LayerName=layers_2.LayerFullPath, enableFullPath=True)
bake_3 = BakeObject(Objects=connected_2, ObjectAttributes=createatts_2, Bake=context_analysis_bake_2)

srf_2 = Surface(clean_10)  # disabled
roomsolid = HBRoomFromSolid(geo=flatten(clean_9), conditioned=True)  # -> report, rooms; disabled; plug-in component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
aperture = HBAperture(geo=srf_2)  # -> report, apertures; disabled; plug-in component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
gate_56 = StreamGate(Stream=roomsolid.rooms, Gate=round.Ceiling)  # -> Target0, Target1; disabled
aperturesbyratio = HBAperturesByRatio(hb_objs=flatten(gate_56.Target1), ratio=cyclops_generate_wwr_2)  # -> report, hb_objs; disabled; plug-in component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
addsubface = HBAddSubface(hb_obj=flatten(gate_56.Target0), sub_faces=flatten(aperture.apertures))  # -> hb_obj; disabled; plug-in component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
filter_74 = StreamFilter(Gate=round.Ceiling, Stream0=addsubface, Stream1=aperturesbyratio.hb_objs)  # disabled
vizbytype_2 = HBVisualizeByType(hb_objs=filter_74)  # -> walls, interior_walls, roofs, ceilings, exterior_floors, interior_floors, air_walls, apertures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; disabled; plug-in component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
medges = MeshEdges(Mesh=vizbytype_2.apertures)  # -> NakedEdges, InteriorEdges, NonManifoldEdges; disabled
clean_15 = CleanTree(
    RemoveNulls=True,
    RemoveInvalid=True,
    RemoveEmpty=False,
    Tree=[vizbytype_2.walls, vizbytype_2.roofs, vizbytype_2.apertures, vizbytype_2.ceilings, vizbytype_2.exterior_floors, vizbytype_2.interior_floors])  # disabled
join_12 = JoinCurves(Curves=medges.NakedEdges, Preserve=False)  # disabled
demesh = DeconstructMesh(Mesh=clean_15)  # -> Vertices, Faces, Colours, Normals; disabled
filter_75 = StreamFilter(Gate=round_2.Ceiling, Stream0=clean_10, Stream1=join_12)  # disabled
argb = SplitARGB(Colour=demesh.Colours, IntegerChannels=True)  # -> Alpha, Red, Green, Blue; disabled
rgb = ColourRGB(Alpha=cyclops_preview_opacity_2, Red=argb.Red, Green=argb.Green, Blue=argb.Blue)  # disabled
conmesh = ConstructMesh(Vertices=demesh.Vertices, Faces=demesh.Faces, Colours=rgb)  # disabled
fbd = BrepFacesByDirection(Brep=clean_9, Tolerance=0.9)  # -> Top, Bottom, Sides; disabled
windows_4 = Geometry(filter_75)  # disabled
gate_57 = StreamGate(Stream=conmesh, Gate=and_47)  # -> Target0, Target1; disabled
roof = Geometry(fbd.Top)  # disabled
floor = Geometry(fbd.Bottom)  # disabled
facade = Geometry(fbd.Sides)  # disabled
mjoin = MeshJoin(Meshes=flatten(gate_57.Target1))  # disabled
area = Area(Geometry=windows_4, UseTasks=True)  # -> Area, Centroid; disabled
srf_cp = SurfaceClosestPoint(Point=flatten(area.Centroid), Surface=graft(facade))  # -> Point, UVPoint, Distance; disabled
smaller_2 = SmallerThan(FirstNumber=srf_cp.Distance, SecondNumber=number_slider_44)  # -> SmallerThan, OrEqualTo; disabled
equals_46 = Equality(FirstNumber=srf_cp.Distance, SecondNumber=srf_cp.Distance)  # -> Equality, Inequality; disabled
and_48 = GateAnd(A=equals_46.Equality, B=smaller_2.SmallerThan)  # disabled
cull_22 = CullPattern(List=and_48, CullPattern=and_48)  # disabled
crv = Curve(graft(facade))  # disabled
index_4 = ItemIndex(List=and_48, Item=cull_22)  # disabled
item_41 = ListItem(List=windows_4, Index=index_4, Wrap=True)  # disabled
lng_32 = ListLength(List=item_41)  # disabled
dispatch = Dispatch(List=crv, DispatchPattern=invert(lng_32))  # -> ListA, ListB; disabled
merge_29 = Merge(Data1=dispatch.ListA, Data2=dispatch.ListB, Data3=item_41)  # disabled
evalsrf = EvaluateSurface(Surface=reparameterize(facade), Point=md_slider)  # -> Point, Normal, UDirection, VDirection, Frame; disabled
boundary = BoundarySurfaces(Edges=merge_29)  # disabled
srf_3 = Surface(boundary)  # disabled
srf_4 = Surface(roof)  # disabled
srf_5 = Surface(floor)  # disabled
srf_6 = Surface(windows_4)  # disabled
multiplication_3 = Multiplication(A=number_slider_46, B=evalsrf.Normal)  # disabled
move = Move(Geometry=srf_5, Motion=Z)  # -> Geometry, Transform; disabled
move_2 = Move(Geometry=facade, Motion=multiplication_3)  # -> Geometry, Transform; disabled
dim = Dimensions(Surface=move.Geometry)  # -> UDimension, VDimension; disabled
dim_2 = Dimensions(Surface=move_2.Geometry)  # -> UDimension, VDimension; disabled
mesh_uv = MeshSurface(Surface=move.Geometry, UCount=dim.UDimension, VCount=dim.VDimension, Overhang=True, Equalize=False)  # disabled
mesh_uv_2 = MeshSurface(Surface=move_2.Geometry, UCount=dim_2.UDimension, VCount=dim_2.VDimension, Overhang=True, Equalize=False)  # disabled
merge_30 = Merge(Data1=srf, Data2=srf_4, Data3=srf_5, Data4=srf_3)  # -> flatten(Result); disabled
glass = Geometry(srf_6)  # disabled
mjoin_2 = MeshJoin(Meshes=flatten(mesh_uv))  # disabled
mjoin_3 = MeshJoin(Meshes=flatten(mesh_uv_2))  # disabled
demesh_2 = DeconstructMesh(Mesh=mjoin_2)  # -> Vertices, Faces, Colours, Normals; disabled
G = Geometry(Mesh=merge_30, MaterialName=material_name_2, Parameter=0, method="Geometry", version="0.0.0.DevBuild")  # disabled
G_2 = Geometry(Mesh=glass, MaterialName=material_name, Parameter=0, method="Geometry", version="0.0.0.DevBuild")  # disabled
facen = FaceNormals(Mesh=mjoin_2)  # -> Centers, Normals; disabled
preview_22 = CustomPreview(Geometry=merge_30, Material=swatch_10)  # disabled
demesh_3 = DeconstructMesh(Mesh=mjoin_3)  # -> Vertices, Faces, Colours, Normals; disabled
facen_2 = FaceNormals(Mesh=mjoin_3)  # -> Centers, Normals; disabled
abs = Absolute(Value=facen.Normals)  # disabled
deface = DeconstructFace(Face=demesh_2.Faces)  # -> CornerA, CornerB, CornerC, CornerD; disabled
deface_2 = DeconstructFace(Face=demesh_3.Faces)  # -> CornerA, CornerB, CornerC, CornerD; disabled
A = AnalysisPoint(Position=facen_2.Centers, Direction=facen_2.Normals, method="Analysis Point", version="1.0.0.0")  # disabled
A_2 = AnalysisPoint(Position=facen.Centers, Direction=abs, method="Analysis Point", version="1.0.0.0")  # disabled
merge_31 = Merge(Data1=graft(deface.CornerA), Data2=graft(deface.CornerB), Data3=graft(deface.CornerC), Data4=graft(deface.CornerD))  # disabled
merge_32 = Merge(Data1=G, Data2=G_2)  # -> flatten(Result); disabled
merge_33 = Merge(
    Data1=graft(deface_2.CornerA),
    Data2=graft(deface_2.CornerB),
    Data3=graft(deface_2.CornerC),
    Data4=graft(deface_2.CornerD))  # disabled
item_42 = ListItem(List=demesh_2.Vertices, Index=merge_31, Wrap=True)  # disabled
G_3 = GeometryGroup(
    Name="Default Geometry Group",
    Geometry=merge_32,
    VisibilityMask="""{
  "Mask1": true,
  "Mask2": true,
  "Mask3": true,
  "Mask4": true,
  "Mask5": true,
  "Mask6": true,
  "Mask7": true,
  "Mask8": true,
  "BitMap": [
    true,
    true,
    true,
    true,
    true,
    true,
    true,
    true
  ]
}""",
    Transforms={TransformCount=1, Name="Generic", m00=1, m01=0, m02=0, m03=0, m10=0, m11=1, m12=0, m13=0, m20=0, m21=0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},
    IntersectionType=intersection_type,
    method="Geometry Group",
    version="1.0.0.0")  # disabled
item_43 = ListItem(List=demesh_3.Vertices, Index=merge_33, Wrap=True)  # disabled
conmesh_2 = ConstructMesh(Vertices=item_42, Faces={A=0, B=1, C=2, D=3})  # disabled
conmesh_3 = ConstructMesh(Vertices=item_43, Faces={A=0, B=1, C=2, D=3})  # disabled
scene_objects = Merge(Data1=G_3, Data2=M, Data3=M_2)  # -> flatten(Result); disabled
analysis_points = CyclopsObject(A_2, version="0.0.0.DevBuild")  # disabled
scene_objects_2 = CyclopsObject(scene_objects, version="0.0.0.DevBuild")  # disabled
analysis_points_2 = CyclopsObject(A, version="0.0.0.DevBuild")  # disabled
scene_objects_3 = CyclopsObject(scene_objects, version="0.0.0.DevBuild")  # disabled
or_33 = GateOr(A=expression_82, B=expression_80, C=expression_81, D=expression_79)  # disabled
sma = ShadingMaskAnalysis(
    Run=expression_83,
    SceneObjects=scene_objects_3,
    AnalysisPoints=analysis_points_2,
    Hemisphere=hemisphere_3,
    SamplingSettings=do,
    VisibilityMask="""{
  "Mask1": true,
  "Mask2": true,
  "Mask3": true,
  "Mask4": true,
  "Mask5": true,
  "Mask6": true,
  "Mask7": true,
  "Mask8": true,
  "BitMap": [
    true,
    true,
    true,
    true,
    true,
    true,
    true,
    true
  ]
}""",
    version="1.2.0.60000")  # -> Scene, ShadingMasks; disabled
sma_2 = ShadingMaskAnalysis(
    Run=or_33,
    SceneObjects=scene_objects_2,
    AnalysisPoints=analysis_points,
    Hemisphere=hemisphere_2,
    SamplingSettings=aps,
    VisibilityMask="""{
  "Mask1": true,
  "Mask2": true,
  "Mask3": true,
  "Mask4": true,
  "Mask5": true,
  "Mask6": true,
  "Mask7": true,
  "Mask8": true,
  "BitMap": [
    true,
    true,
    true,
    true,
    true,
    true,
    true,
    true
  ]
}""",
    version="1.2.0.60000")  # -> Scene, ShadingMasks; disabled
analysis_points_3 = CyclopsObject(A, version="0.0.0.DevBuild")  # disabled
scene_objects_4 = CyclopsObject(scene_objects, version="0.0.0.DevBuild")  # disabled
analysis_points_4 = CyclopsObject(A, version="1.2.0.60000")  # disabled
scene_objects_5 = CyclopsObject(scene_objects, version="1.2.0.60000")  # disabled
gate_58 = StreamGate(Stream=sma_2.ShadingMasks, Gate=expression_84)  # -> Target0, Target1; disabled
gate_59 = StreamGate(Stream=sma_2.ShadingMasks, Gate=expression_86)  # -> Target0, Target1; disabled
gate_60 = StreamGate(Stream=sma_2.ShadingMasks, Gate=expression_87)  # -> Target0, Target1; disabled
gate_61 = StreamGate(Stream=sma_2.ShadingMasks, Gate=expression_88)  # -> Target0, Target1; disabled
sha = SunlightHourAnalysis(
    Run=expression_85,
    SceneObjects=scene_objects_5,
    SunRig=sun_rig,
    AnalysisPoints=analysis_points_4,
    VisibilityMask="""{
  "Mask1": true,
  "Mask2": true,
  "Mask3": true,
  "Mask4": true,
  "Mask5": true,
  "Mask6": true,
  "Mask7": true,
  "Mask8": true,
  "BitMap": [
    true,
    true,
    true,
    true,
    true,
    true,
    true,
    true
  ]
}""",
    method="Sunlight Hour Analysis",
    version="1.0.0.0")  # -> Scene, SunlightHours; disabled
udi = UsefulDaylightIlluminance(
    ShadingMasks=gate_59.Target1,
    SkySeries=ss,
    IlluminanceInterval=dom_10,
    method="Useful Daylight Illuminance",
    version="1.0.0.0")  # -> UDI, UDILow, UDIHigh; disabled
ra = CumulativeRadiation(ShadingMasks=sma.ShadingMasks, SkySeries=ss, method="Cumulative Radiation", version="0.0.0.DevBuild")  # -> CumulativeRadiation, AverageIrradiance; disabled
df = DaylightFactor(ShadingMasks=gate_58.Target1, SkyType=sky_type_2, version="1.2.0.60000")  # disabled
da = DaylightAutonomy(
    ShadingMasks=gate_60.Target1,
    SkySeries=ss,
    IlluminanceThreshold=threshold_2,
    method="Daylight Autonomy",
    version="0.0.0.DevBuild")  # -> DA, CDA; disabled
sca = SkyComponentAnalysis(
    Run=expression_89,
    SceneObjects=scene_objects_4,
    AnalysisPoints=analysis_points_3,
    SkyType=sky_type,
    VisibilityMask="""{
  "Mask1": true,
  "Mask2": true,
  "Mask3": true,
  "Mask4": true,
  "Mask5": true,
  "Mask6": true,
  "Mask7": true,
  "Mask8": true,
  "BitMap": [
    true,
    true,
    true,
    true,
    true,
    true,
    true,
    true
  ]
}""",
    method="Sky Component Analysis",
    version="1.0.0.0")  # -> Scene, SkyComponent; disabled
dm = DaylightMetrics(ShadingMasks=gate_61.Target1, SkySeries=ss, method="Daylight Metrics", version="1.0.0.0")  # -> Average, Min, Max; disabled
filter_76 = StreamFilter(Gate=cyclops_metric_option_3, Stream0=dm.Average, Stream1=dm.Min, Stream2=dm.Max)  # disabled
facade_panels = Geometry(conmesh_3)  # disabled
analysis_results = Number(sca.SkyComponent)  # disabled
analysis_results_2 = Number(sha.SunlightHours)  # disabled
facade_panels_2 = Geometry(conmesh_3)  # disabled
facade_panels_3 = Geometry(conmesh_3)  # disabled
floor_panels = Geometry(conmesh_2)  # disabled
analysis_results_3 = Number(da.DA)  # disabled
analysis_results_4 = Number(ra.CumulativeRadiation)  # disabled
analysis_results_5 = Number(df)  # disabled
analysis_results_6 = Number(udi.UDI)  # disabled
floor_panels_2 = Geometry(conmesh_2)  # disabled
floor_panels_3 = Geometry(conmesh_2)  # disabled
floor_panels_4 = Geometry(conmesh_2)  # disabled
larger_5 = LargerThan(FirstNumber=analysis_results_2, SecondNumber=cyclops_slider_value_8)  # -> LargerThan, OrEqualTo; disabled
larger_6 = LargerThan(FirstNumber=analysis_results, SecondNumber=division_11)  # -> LargerThan, OrEqualTo; disabled
gradient = Gradient(
    LowerLimit=0,
    UpperLimit=number_slider_49,
    Parameter=analysis_results_2,
    stops=[0: RGB(64, 64, 0), 0.494: RGB(255, 255, 0), 1: RGB(255, 255, 255)])  # disabled
gradient_2 = Gradient(
    LowerLimit=0,
    UpperLimit=panel_229,
    Parameter=analysis_results,
    stops=[0: RGB(0, 0, 64), 0.495: RGB(173, 203, 249), 1: RGB(255, 255, 255)])  # disabled
gradient_3 = Gradient(
    LowerLimit=0,
    UpperLimit=number_slider_48,
    Parameter=analysis_results_4,
    stops=[0: RGB(75, 107, 169), 0.25: RGB(173, 203, 249), 0.5: RGB(254, 244, 84), 0.75: RGB(234, 126, 0), 1: RGB(234, 38, 0)])  # disabled
gradient_4 = Gradient(
    LowerLimit=0,
    UpperLimit=panel_38,
    Parameter=analysis_results_6,
    stops=[0: RGB(34, 34, 34), 0.327: RGB(0, 79, 127), 0.658: RGB(46, 156, 240), 1: RGB(255, 255, 255)])  # disabled
gradient_5 = Gradient(
    LowerLimit=0,
    UpperLimit=panel_39,
    Parameter=analysis_results_3,
    stops=[0: RGB(34, 34, 34), 0.327: RGB(0, 79, 127), 0.658: RGB(46, 156, 240), 1: RGB(255, 255, 255)])  # disabled
larger_7 = LargerThan(FirstNumber=analysis_results_4, SecondNumber=cyclops_slider_value_7)  # -> LargerThan, OrEqualTo; disabled
larger_8 = LargerThan(FirstNumber=analysis_results_5, SecondNumber=division_10)  # -> LargerThan, OrEqualTo; disabled
gradient_6 = Gradient(
    LowerLimit=0,
    UpperLimit=panel_228,
    Parameter=analysis_results_5,
    stops=[0: RGB(34, 34, 34), 0.327: RGB(0, 79, 127), 0.658: RGB(46, 156, 240), 1: RGB(255, 255, 255)])  # disabled
filter_77 = StreamFilter(Gate=cyclops_filter_checkbox_6, Stream0=panel_230, Stream1=larger_5.OrEqualTo)  # disabled
filter_78 = StreamFilter(Gate=cyclops_filter_checkbox_7, Stream0=panel_231, Stream1=larger_6.OrEqualTo)  # disabled
filter_79 = StreamFilter(Gate=cyclops_filter_checkbox_8, Stream0=panel_232, Stream1=larger_7.OrEqualTo)  # disabled
filter_80 = StreamFilter(Gate=cyclops_filter_checkbox_9, Stream0=panel_233, Stream1=larger_8.OrEqualTo)  # disabled
cull_23 = CullPattern(List=facade_panels, CullPattern=graft(filter_77))  # disabled
cull_24 = CullPattern(List=facade_panels_3, CullPattern=graft(filter_78))  # disabled
cull_25 = CullPattern(List=facade_panels_2, CullPattern=graft(filter_79))  # disabled
cull_26 = CullPattern(List=floor_panels_2, CullPattern=graft(filter_80))  # disabled
mcol = MeshColours(Mesh=graft(cull_23), Colours=graft(gradient))  # disabled
mcol_2 = MeshColours(Mesh=graft(cull_24), Colours=graft(gradient_2))  # disabled
mcol_3 = MeshColours(Mesh=graft(cull_25), Colours=graft(gradient_3))  # disabled
mcol_4 = MeshColours(Mesh=graft(cull_26), Colours=graft(gradient_6))  # disabled
culmulative_radiation = Mesh(mcol_3)  # disabled
sunlight_hour_analysis = Mesh(mcol)  # disabled
daylight_factor = Mesh(mcol_4)  # disabled
sky_component_analysis = Mesh(mcol_2)  # disabled

gate_62 = StreamGate(Stream=conmesh, Gate=expander_cyclops_daylight_approximation_3)  # -> Target0, Target1; disabled
cyclopsdisplaybbox = RemoteSender(gate_62.Target1)  # disabled
merge_34 = Merge(Data1=mjoin, Data2=gate_51.Target1)  # disabled
lng_33 = ListLength(List=flatten(conmesh_2))  # disabled
lng_34 = ListLength(List=flatten(conmesh_3))  # disabled
cyclopsallfloorpanelamount = RemoteSender(lng_33)  # disabled
cyclopsallfacadepanelamount = RemoteSender(lng_34)  # disabled
analysis_results_7 = Number(filter_76)  # disabled
larger_9 = LargerThan(FirstNumber=analysis_results_7, SecondNumber=cyclops_slider_value_5)  # -> LargerThan, OrEqualTo; disabled
larger_10 = LargerThan(FirstNumber=analysis_results_3, SecondNumber=division_8)  # -> LargerThan, OrEqualTo; disabled
larger_11 = LargerThan(FirstNumber=analysis_results_6, SecondNumber=division_9)  # -> LargerThan, OrEqualTo; disabled
filter_81 = StreamFilter(Gate=cyclops_filter_checkbox_3, Stream0=panel_40, Stream1=larger_9.OrEqualTo)  # disabled
filter_82 = StreamFilter(Gate=cyclops_filter_checkbox_4, Stream0=panel_41, Stream1=larger_10.OrEqualTo)  # disabled
filter_83 = StreamFilter(Gate=cyclops_filter_checkbox_5, Stream0=panel_42, Stream1=larger_11.OrEqualTo)  # disabled
cull_27 = CullPattern(List=floor_panels_4, CullPattern=graft(filter_81))  # disabled
cull_28 = CullPattern(List=floor_panels_3, CullPattern=graft(filter_82))  # disabled
cull_29 = CullPattern(List=floor_panels, CullPattern=graft(filter_83))  # disabled

displaymesh = Mesh(flatten(merge_34))  # disabled
gradient_7 = Gradient(
    LowerLimit=0,
    UpperLimit=item_36,
    Parameter=analysis_results_7,
    stops=[0: RGB(34, 34, 34), 0.327: RGB(0, 79, 127), 0.658: RGB(46, 156, 240), 1: RGB(255, 255, 255)])  # disabled
mcol_5 = MeshColours(Mesh=graft(cull_29), Colours=graft(gradient_4))  # disabled
mcol_6 = MeshColours(Mesh=graft(cull_28), Colours=graft(gradient_5))  # disabled
mcol_7 = MeshColours(Mesh=graft(cull_27), Colours=graft(gradient_7))  # disabled
useful_daylight_illuminance = Mesh(mcol_5)  # disabled
daylight_autonomy = Mesh(mcol_6)  # disabled
daylight_metrics = Mesh(mcol_7)  # disabled
filter_84 = StreamFilter(
    Gate=cyclops_select_simulation_index_4,
    Stream0=sunlight_hour_analysis,
    Stream1=sky_component_analysis,
    Stream2=culmulative_radiation,
    Stream3=daylight_factor,
    Stream4=useful_daylight_illuminance,
    Stream5=daylight_autonomy,
    Stream6=daylight_metrics)  # -> flatten(Stream); disabled
gate_63 = StreamGate(Stream=filter_84, Gate=expander_cyclops_daylight_approximation_4)  # -> Target0, Target1; disabled
mjoin_4 = MeshJoin(Meshes=gate_63.Target1)  # disabled
null_44 = NullItem(Item=gate_63.Target1)  # -> NullFlags, InvalidFlags, Description; disabled
cull_30 = CullPattern(List=null_44.NullFlags, CullPattern=invert(null_44.NullFlags))  # disabled
displaymesh_2 = Mesh(mjoin_4)  # disabled
lng_35 = ListLength(List=cull_30)  # disabled
cyclops_visualisation_exists = RemoteSender(lng_35)  # disabled

lng_36 = ListLength(List=flatten(filter_84))  # disabled
cyclopspassedpanelamount = RemoteSender(lng_36)  # disabled

cyclopsallfacadepanelamount_2 = RemoteReceiver(cyclopsallfacadepanelamount)
cyclopsallfloorpanelamount_2 = RemoteReceiver(cyclopsallfloorpanelamount)
cyclopspassedpanelamount_2 = RemoteReceiver(cyclopspassedpanelamount)
filter_85 = StreamFilter(Gate=larger.LargerThan, Stream0=cyclopsallfacadepanelamount_2, Stream1=cyclopsallfloorpanelamount_2)
division_12 = Division(A=cyclopspassedpanelamount_2, B=filter_85)
multiplication_4 = Multiplication(A=division_12, B="100")
round_3 = Round(Number=multiplication_4)  # -> Nearest, Floor, Ceiling
cyclops_visualisation_exists_2 = RemoteReceiver(cyclops_visualisation_exists)
format_37 = Format(Format="Amount of geometry above the threshold: {0}%", Culture=127, Data0=round_3.Floor)
setlabel_5 = SetLabelContents(LabelToModify=label_56, NewLabelContents=format_37)
hideshow_58 = HideShowElement(ElementToHideShow=[button_34, button_35], Show=cyclops_visualisation_exists_2, Collapse=True, Disable=False)

# ----
# Bake Cyclops
cyclops_select_simulation_12 = RemoteReceiver(cyclops_select_simulation)  # disabled
panel_236 = Panel("Heath::Cyclops::")  # disabled
cyclops_visualisation_bake_2 = RemoteReceiver(cyclops_visualisation_bake)  # disabled
concat_8 = Concatenate(FragmentA=panel_236, FragmentB=cyclops_select_simulation_12)  # disabled
gate_64 = StreamGate(Stream=concat_8, Gate=cyclops_visualisation_bake_2)  # -> Target0, Target1; disabled
layers_3 = CreateModifyLayers(LayerName=gate_64.Target1, DeleteLayer=False, enableFullPath=True)  # -> LayerNames, LayerFullPath; disabled
createatts_3 = CreateAttributes(LayerName=layers_3.LayerFullPath, enableFullPath=True)  # disabled
connected_3 = GetConnectedObjects(Objects=displaymesh_2)  # disabled
bake_4 = BakeObject(Objects=connected_3, ObjectAttributes=createatts_3, Bake=cyclops_visualisation_bake_2)  # disabled

# ----
# Zoom Cyclops
zoom_cyclops_visualization_2 = RemoteReceiver(zoom_cyclops_visualization)  # disabled
mesh_2 = Mesh(displaymesh_2)  # disabled
bbox_4 = BoundingBox(Content=mesh_2, Plane=PlaneXY(0, 0, 0), UnionBox=True)  # -> Box, Box_2; disabled
zbb_4 = ZoomBoundingBox(Box=bbox_4.Box, Run=zoom_cyclops_visualization_2)  # disabled

# ----
# Visualise properties
# # Visualise properties
# This cluster visualises room and face attributes of a Honeybee model
# 
# ## Instructions
# Input the Honeybee model to be visualised and select room/face attributes using the HB Room Attributes/HB Room Energy Attibrutes/HB Face Attributes/HB Face Energy Attributes dropdown components. Adjust precision of the attributes using the `Number of decimals` inputs
# 
# ## Inputs
# - `Honeybee model` - Honeybee model to be visualised
# - `Room attribute` - Honeybee Room  or Room Energy attribute to visualise
# - `Number of decimals (room)` - Precision of room attribute output
# - `Face attribute` - Honeybee Face  or Face Energy attribute to visualise
# - `Number of decimals (face)` - Precision of face attribute output
# 
# ## Outputs
# - `Visualised room attributes` - mesh representing the selected room attribute
# - `Visualised face attributes` - mesh representing the selected face attribute
# 
# ## Interpretation
# To be added...
room_attribute_visualize_3 = RemoteReceiver(room_attribute_visualize)
face_attribute_visualize_3 = RemoteReceiver(face_attribute_visualize)
room_attribute_2 = RemoteReceiver(room_attribute)
face_attribute_2 = RemoteReceiver(face_attribute)
gate_65 = StreamGate(Stream=face_attribute_2, Gate=face_attribute_visualize_3)  # -> Target0, Target1
gate_66 = StreamGate(Stream=room_attribute_2, Gate=room_attribute_visualize_3)  # -> Target0, Target1
face_attribute_3 = Text(gate_65.Target1)
data_28 = Data(loadobjects.hb_objs)
room_attribute_3 = Text(gate_66.Target1)
number_of_decimals_room = Number(Slider(4, range=0..10))
legendpar_2 = LBLegendParameters(num_decimals=number_of_decimals_room)  # -> leg_par; plug-in component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
legendpar_3 = LBLegendParameters(num_decimals=number_of_decimals_room)  # -> leg_par; plug-in component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
room_attribute_visualize_4 = RemoteReceiver(room_attribute_visualize)
face_attribute_visualize_4 = RemoteReceiver(face_attribute_visualize)

deconstructmodel_3 = HBDeconstructModel(model=data_28)  # -> rooms, faces, apertures, doors, shades; plug-in component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
model = HBModel(
    rooms=flatten(deconstructmodel_3.rooms),
    faces=flatten(deconstructmodel_3.faces),
    apertures=flatten(deconstructmodel_3.apertures))  # -> report, model; plug-in component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

colorroomattr = HBColorRoomAttributes(rooms_model=flatten(model.model), attribute=room_attribute_3, legend_par=legendpar_2)  # -> mesh, legend, wire_frame, values, colors, vis_set; plug-in component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
colorfaceattr = HBColorFaceAttributes(hb_objs=flatten(model.model), attribute=face_attribute_3, legend_par=legendpar_3)  # -> mesh, legend, wire_frame, values, colors, vis_set; plug-in component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
merge_35 = Merge(Data1=colorfaceattr.mesh, Data2=colorfaceattr.legend, Data3=colorfaceattr.wire_frame)
merge_36 = Merge(Data1=colorroomattr.mesh, Data2=colorroomattr.legend, Data3=colorroomattr.wire_frame)
gate_67 = StreamGate(Stream=merge_35, Gate=face_attribute_visualize_4)  # -> Target0, Target1
gate_68 = StreamGate(Stream=merge_36, Gate=room_attribute_visualize_4)  # -> Target0, Target1
preview_23 = CustomPreview(Geometry=gate_68.Target1, Material=ColourSwatch(SwatchColor=RGB(84, 84, 84)))
preview_24 = CustomPreview(Geometry=gate_67.Target1, Material=ColourSwatch(SwatchColor=RGB(84, 84, 84)))

null_45 = NullItem(Item=flatten(merge_26))  # -> NullFlags, InvalidFlags, Description; disabled
py3_57 = Python3Script(x=merge_26)  # -> out, a; inputs x: tree; disabled
# ---------- py3_57: Python ----------
import time
if x:
    a = time.time()
    print(a)
# ---------- end py3_57 ----------
item_44 = ListItem(List=null_45.NullFlags, Index=0, Wrap=True)  # disabled
current_model_name_4 = RemoteReceiver(current_model_name)  # disabled
panel_237 = Panel("{1;*}")  # disabled
current_selected_model_analysis_module_n_8 = RemoteReceiver(current_selected_model_analysis_module_n)  # "current_selected_model_analysis_module_name"; disabled
panel_238 = Panel("-1")  # disabled
panel_239 = Panel("False")  # disabled
daylight_simulation_type_3 = RemoteReceiver(daylight_simulation_type)  # disabled

gate_69 = StreamGate(Stream=merge_26, Gate=item_44)  # -> Target0, Target1; disabled
entwine_182 = Entwine(Branch0X=gate_69.Target0, Branch1X=current_model_name_4, FlattenInputs=False)  # disabled
rec_55 = DataRecorder(py3_57.a, DataLimit=-10, RecordData=True)  # disabled

freeze_gate_66 = StreamFreezeGate(Data=entwine_182, PassingSwitch=and_5, Freeze=True, Hold=False)  # disabled
split_11 = SplitTree(Data=freeze_gate_66, Masks=flatten(panel_237))  # -> Positive, Negative; disabled

py3_58 = Python3Script(data=graft(split_11.Negative), enable=toggle_2, reset=button_10, t=py3_57.a)  # -> out, a; inputs data: tree; disabled
# ---------- py3_58: Python ----------
""" this component replaces Data recorder """
""" There was an issue where data was stored even after reset,
    possibly because of telepathy components downstream.
    this seems to work! """

from Grasshopper import DataTree
guid = str(ghenv.Component.InstanceGuid) + str(ghdoc.Path)
guid_t = str(ghenv.Component.InstanceGuid) + str(t)
from scriptcontext import sticky

empty_value = "Recorder has been initiated/reset."

if reset:
    sticky[guid] = empty_value

if enable:
    if guid not in sticky: sticky[guid] = empty_value
    
    if sticky[guid] == empty_value:
        sticky[guid] = DataTree[object]()
    
    if guid_t in sticky:
        pass
    else:
        sticky[guid_t] = True
        sticky[guid].MergeTree(data)

if sticky[guid] != empty_value:
    a = sticky[guid]
else:
    a = None
# ---------- end py3_58 ----------
py3_59 = Python3Script(data=graft(split_11.Positive), enable=toggle_2, reset=button_10, t=py3_57.a)  # -> out, a; inputs data: tree; disabled; same code as py3_58

py3_60 = Python3Script(all_simulated_models=py3_59.a, model_dictionary=model_name_dictionary_2)  # -> out, simulated_models_renamed; inputs all_simulated_models: list, model_dictionary: list; disabled
# ---------- py3_60: Python ----------
if model_dictionary and len(model_dictionary):
    mapping = {}
    for (key, value) in model_dictionary:
        mapping[key] = value

    # Resolve transitive mappings
    for key in list(mapping.keys()):
        while mapping.get(mapping[key], None):
            mapping[key] = mapping[mapping[key]]

    simulated_models_renamed = [mapping.get(x, x) for x in all_simulated_models]
else: simulated_models_renamed = all_simulated_models
# ---------- end py3_60 ----------
py3_61 = Python3Script(
    all_simulated_models=py3_60.simulated_models_renamed,
    existing_models=current_all_created_models_names_5,
    all_simulation_data=py3_58.a)  # -> out, filtered_simulated_models, filtered_simulation_data_pattern; inputs all_simulated_models: list, existing_models: list, all_simulation_data: tree; disabled
# ---------- py3_61: Python ----------
from ghpythonlib import treehelpers as th
import Grasshopper as gh

model_indexes = {}
for i, m in enumerate(all_simulated_models):
    if m in existing_models:
        # we make sure here to take the latest index with a unique name
        model_indexes[m] = i

print(model_indexes)

filtered_simulation_data_pattern = gh.DataTree[object](all_simulation_data)
for i, branch in enumerate(filtered_simulation_data_pattern.Branches):
    for j in range(len(branch)):
        branch[j] = j in model_indexes.values()

filtered_simulated_models = list(model_indexes.keys())
#filtered_simulation_data = th.list_to_tree(filtered_simulation_data)
# ---------- end py3_61 ----------
data_29 = Data(py3_61.filtered_simulated_models)  # disabled
cull_31 = CullPattern(List=py3_58.a, CullPattern=py3_61.filtered_simulation_data_pattern)  # disabled

mindex_8 = MemberIndex(Set=data_29, Member=current_selected_model_analysis_module_n_8)  # -> flatten(Index), Count; disabled
null_46 = NullItem(Item=mindex_8.Count)  # -> NullFlags, InvalidFlags, Description; disabled
item_45 = ListItem(List=mindex_8.Index, Index=panel_238, Wrap=True)  # disabled
item_46 = ListItem(List=simplify(cull_31), Index=item_45, Wrap=invert(True))  # disabled
current_all_simulations_context = RemoteSender(py3_58.a)  # disabled
filter_86 = StreamFilter(Gate=null_46.NullFlags, Stream0=mindex_8.Count, Stream1=panel_239)  # disabled
daylight_data_exists = RemoteSender(filter_86)  # disabled

current_all_simulation_models_context = RemoteSender(data_29)  # disabled

# ----
# Legend Cyclops
cyclopsdisplaybbox_2 = RemoteReceiver(cyclopsdisplaybbox)  # disabled
mesh_3 = Mesh(cyclopsdisplaybbox_2)  # disabled
bbox_5 = BoundingBox(Content=mesh_3, Plane=PlaneXY(0, 0, 0), UnionBox=True)  # -> Box, Box_2; disabled
debox = DeconstructBox(Box=bbox_5.Box)  # -> Plane, X, Y, Z; disabled
number_slider_51 = Slider(25, range=0..100)  # disabled
cyclops_metric_option_4 = RemoteReceiver(cyclops_metric_option)  # disabled
num_9 = Number(debox.Y)  # disabled
number_slider_52 = Slider(1200, range=0..1500)  # disabled
cyclops_select_simulation_index_6 = RemoteReceiver(cyclops_select_simulation_index)  # disabled
number_slider_53 = Slider(10, range=0..10)  # disabled
dedomain = DeconstructDomain(Domain=debox.X)  # -> Start, End; disabled
division_13 = Division(A=num_9, B=number_slider_51)  # disabled
panel_240 = Panel("""10000
500
60000""")  # disabled
panel_241 = Panel("2.5")  # disabled
panel_242 = Panel("1")  # disabled
panel_243 = Panel("0.2")  # disabled
panel_244 = Panel("100")  # disabled
panel_245 = Panel("1")  # disabled
panel_246 = Panel("100")  # disabled
range = Range(Domain=debox.Y, Steps=10)  # disabled
addition_3 = Addition(A=panel_242, B=dedomain.End)  # disabled
min = Minimum(A=division_13, B=panel_241)  # disabled
item_47 = ListItem(List=panel_240, Index=cyclops_metric_option_4, Wrap=True)  # disabled
multiplication_5 = Multiplication(A=panel_243, B=panel_244)  # disabled
multiplication_6 = Multiplication(A=panel_245, B=panel_246)  # disabled
sort = SortList(Keys=range)  # -> Keys, ValuesA; disabled
addition_4 = Addition(A=min, B=addition_3)  # disabled
filter_87 = StreamFilter(
    Gate=cyclops_select_simulation_index_6,
    Stream0=number_slider_53,
    Stream1=multiplication_6,
    Stream2=number_slider_52,
    Stream3=multiplication_5,
    Stream4=multiplication_6,
    Stream5=multiplication_6,
    Stream6=item_47)  # disabled
cyclops_select_simulation_index_7 = RemoteReceiver(cyclops_select_simulation_index)  # disabled
panel_247 = Panel("1.4")  # disabled
pt_14 = ConstructPoint(XCoordinate=addition_4, YCoordinate=sort.Keys, ZCoordinate=0)  # disabled
pt_15 = ConstructPoint(XCoordinate=addition_3, YCoordinate=sort.Keys, ZCoordinate=0)  # disabled
dom_11 = ConstructDomain(DomainStart=0, DomainEnd=filter_87)  # disabled
panel_248 = Panel("Hours")  # disabled
panel_249 = Panel("kWh/m²")  # disabled
panel_250 = Panel("Lux")  # disabled
panel_251 = Panel("%")  # disabled
panel_252 = Panel("-1")  # disabled
panel_253 = Panel("-1")  # disabled
item_48 = ListItem(List=pt_15, Index=0, Wrap=True)  # -> Item1, Item; disabled
range_2 = Range(Domain=dom_11, Steps=10)  # disabled
shift = ShiftList(List=pt_14, Shift=1, Wrap=invert(True))  # disabled
shift_2 = ShiftList(List=pt_15, Shift=1, Wrap=invert(True))  # disabled
cull_i_4 = CullIndex(List=pt_14, Indices=panel_252, Wrap=True)  # disabled
cull_i_5 = CullIndex(List=pt_15, Indices=panel_253, Wrap=True)  # disabled
filter_88 = StreamFilter(
    Gate=cyclops_select_simulation_index_7,
    Stream0=panel_248,
    Stream1=panel_251,
    Stream2=panel_249,
    Stream3=panel_251,
    Stream4=panel_251,
    Stream5=panel_251,
    Stream6=panel_250)  # disabled
gradient_8 = Gradient(
    LowerLimit=0,
    UpperLimit=filter_87,
    Parameter=range_2,
    stops=[0: RGB(64, 64, 0), 0.494: RGB(255, 255, 0), 1: RGB(255, 255, 255)])  # disabled
gradient_9 = Gradient(
    LowerLimit=0,
    UpperLimit=filter_87,
    Parameter=range_2,
    stops=[0: RGB(0, 0, 64), 0.495: RGB(173, 203, 249), 1: RGB(255, 255, 255)])  # disabled
gradient_10 = Gradient(
    LowerLimit=0,
    UpperLimit=filter_87,
    Parameter=range_2,
    stops=[0: RGB(75, 107, 169), 0.25: RGB(173, 203, 249), 0.5: RGB(254, 244, 84), 0.75: RGB(234, 126, 0), 1: RGB(234, 38, 0)])  # disabled
gradient_11 = Gradient(
    LowerLimit=0,
    UpperLimit=filter_87,
    Parameter=range_2,
    stops=[0: RGB(34, 34, 34), 0.327: RGB(0, 79, 127), 0.658: RGB(46, 156, 240), 1: RGB(255, 255, 255)])  # disabled
srf4pt = _4PointSurface(CornerA=shift, CornerB=cull_i_4, CornerC=cull_i_5, CornerD=shift_2)  # disabled
panel_254 = Panel("1")  # disabled
filter_89 = StreamFilter(
    Gate=cyclops_select_simulation_index_6,
    Stream0=gradient_8,
    Stream1=gradient_9,
    Stream2=gradient_10,
    Stream3=gradient_11,
    Stream4=gradient_11,
    Stream5=gradient_11,
    Stream6=gradient_11)  # disabled
swatch_11 = ColourSwatch(SwatchColor=RGB(0, 0, 0))  # disabled
preview_25 = CustomPreview(Geometry=srf4pt, Material=filter_89)  # disabled

division_14 = Division(A=division_13, B=number_slider_19)  # disabled
multiplication_7 = Multiplication(A=panel_247, B=division_14)  # disabled
multiplication_8 = Multiplication(A=division_14, B=panel_254)  # disabled

Y = UnitY(Factor=multiplication_7)  # disabled
move_3 = Move(Geometry=item_48.Item1, Motion=Y)  # -> Geometry, Transform; disabled
X = UnitX(Factor=multiplication_8)  # disabled
move_4 = Move(Geometry=pt_14, Motion=X)  # -> Geometry, Transform; disabled
tag = TextTag3D(Location=move_3.Geometry, Text=filter_88, Size=division_14, Colour=swatch_11, Justification=7)  # disabled
tag_2 = TextTag3D(Location=move_4.Geometry, Text=range_2, Size=division_14, Colour=swatch_11, Justification=4)  # disabled

# ----
# Revised LCA calculation
# # Life Cycle Assessment (LCA)
# This cluster calculates the embodied carbon for the input Honeybee model
# 
# ## Instructions
# Enter the inputs to calculate the GWP (Global Warming Potential), i.e. the embodied carbon, for the materials in the Honeybee model
# 
# ## Inputs
# - `Honeybee model` - the Honeybee model for analysis
# 
# ## Outputs
# - `Total GWP` - total GWP for the modules A1-A5.1 [kg CO2eq]
# - `GWP by element type` - GWP of each element type for the modules A1-A5.1 [kg CO2eq]
# - `Element types` - list of element types in the model
# 
# ## Interpretation
# To be added...
data_30 = Data(loadobjects.hb_objs)
get_resources = BrimstoneGetResources(json_data=get_categories.json_data, category="Energy and fuel")  # -> out, json_data, resources
# ---------- get_resources: Python ----------
"""Extracts resource names from a Klimatdatabas json object
    Inputs:
        json_data: dictionary with json data
        category: readable name of category to extract resources from
    Output:
        resources: List of resources in category"""

import scriptcontext

import brimstone
ghenv.Component.Message = brimstone.globals.version

ghenv.Component.Name = 'Brimstone - Get Resources'
ghenv.Component.NickName = 'Get Resources'

def main(json_data, category):
    resources = get_resources(json_data, category)
    return resources
    
def get_resources(json_data, category):
    pred = lambda v: v["Text"] == category
    resources = []
    for resource in json_data["Resources"]:
        if len(filter(pred, resource["Categories"])) > 0:
            resources.append(resource["Name"])
    return resources

if __name__ == "__main__":
    if not scriptcontext.sticky["brimstone_flying"]:
        raise Exception("The 'Brimstone - Fly' component needs to exist on the canvas")
    print json_data
    resources = main(json_data, category)
    
    json_data = [json_data]
# ---------- end get_resources ----------
list_4 = ItemSelector(
    get_resources.resources,
    {"Electricity, Swedish mix", "Diesel, reduction obligation  (2021)": "Diesel, reduction obligation (2021)", "Diesel, fossil", "Petrol, reduction obligation  (2021)": "Petrol, reduction obligation (2021)", "Petrol, 100% fossil", "District heating, Swedish average", "HVO100", "Gasol", "Wood pellets", "E85 ethanol", "Biogas", "Fuel oil 1", "Fuel oil 2-5", "FAME100", "ED95"}, selected="Electricity, Swedish mix")
get_lca_data = BrimstoneGetLCAData(json_data=get_resources.json_data, resources="District heating, Swedish average")  # -> out, json_data, lca_data, indicators, values; inputs resources: list, addtl_indicators: list
#   port json_data: List of resources in category
# ---------- get_lca_data: Python ----------
"""Extracts LCA indicators and values from a Klimatdatabas json for a specific resource
    Inputs:
        json_data: dictionary with json data
        resources: list of readable names of resources
        addtl_indicators: list of additional keys to retrieve from resource
    Output:
        lca_data: list of dictionaries with LCA data for each resource
        indicators: list of indicators
        values: list of indicator values"""

import scriptcontext
import ghpythonlib.treehelpers as th
from collections import OrderedDict
import copy

import brimstone
ghenv.Component.Message = brimstone.globals.version

ghenv.Component.Name = 'Brimstone - Get LCA Data'
ghenv.Component.NickName = 'Get LCA Data'

# todo: magic string here - not good!
gwp_data_string = "Global Warming potential"

# keys: names in output dict, values: DataModuleCode in json db
gwp_data_entries = {
    "GWPA1A3Conservative": "A1-A3 Conservative",
    "GWPA1A3Typical": "A1-A3 Typical",
    "GWPA4": "A4",
    "GWPA5.1": "A5.1",
}

def main(json_data, resource, addtl_indicators):
    lca_data, indicators, values = [], [], []

    for i, resource in enumerate(resources):
        lca_data.append(get_lca_data(json_data, resource, addtl_indicators))
        resource_indicators, resource_values = get_indicator_values(lca_data[i], addtl_indicators)
        indicators.append(resource_indicators)
        values.append(resource_values)
    return lca_data, indicators, values
    
def get_lca_data(json_data, resource_name, addtl_indicators):
    resource_data = copy.deepcopy(
        find_obj_in_array(
            json_data["Resources"],
            "Name",
            resource_name
        )
    )
    
    if not resource_data:
        raise Exception(
            "Resource with name {resource_name} was not found in database."
            .format(resource_name = resource_name)
       )
    try:
        lca_data = extract_lca_data(resource_data, addtl_indicators)
    except KeyError:
        raise Exception("Format of JSON data is not supported.")
    return lca_data

def extract_lca_data(resource_data, addtl_indicators):
    lca_data = OrderedDict()
    resource_name = resource_data["Name"]
    
    lca_data["Name"] = resource_name
    
    if "Conversions" in resource_data:
        # can a resource have multiple conversions?
        lca_data["ConversionUnit"] = resource_data["Conversions"][0]["Unit"]
        lca_data["ConversionValue"] = resource_data["Conversions"][0]["Value"]
    
    if "InventoryUnit" in resource_data:
        lca_data["InventoryUnit"] = resource_data["InventoryUnit"]
    
    for data_prop in resource_data["DataItems"]:
        if data_prop["PropertyName"] == gwp_data_string:
            gwp_data = copy.deepcopy(data_prop)
            break
            
    if not gwp_data:
        raise Exception("GWP data not found for {resource_name}"
            .format(resource_name = resource_name))
    
    lca_data["GWPUnit"] = gwp_data["PropertyUnitCode"]
    for key in gwp_data_entries:
        value = find_obj_in_array(
            gwp_data["DataValueItems"],
            "DataModuleCode",
            gwp_data_entries[key]
        )
        if value is not None:
            lca_data[key] = value["Value"]
            
    for addtl_indicator in addtl_indicators:
        if addtl_indicator in resource_data:
            lca_data[addtl_indicator] = resource_data[addtl_indicator]
    
    return lca_data

def find_obj_in_array(array, key, value):
    return next((x for x in array if x[key] == value), None)

def get_indicator_values(lca_data, addtl_indicators):
    indicator_dict = OrderedDict([
        ("Name", "Name"),
        ("InventoryUnit", "Inventory unit"),
        ("ConversionUnit", "Conversion unit"),
        ("ConversionValue", "Conversion value"),
        ("GWPUnit", "GWP unit"),
        ("GWPA1A3Conservative", "GWP (A1-A3 Conservative)"),
        ("GWPA1A3Typical", "GWP (A1-A3 Typical)"),
        ("GWPA4", "GWP (A4)"),
        ("GWPA5.1", "GWP (A5.1)"),
    ])
    
    for addtl_indicator in addtl_indicators:
        indicator_dict[addtl_indicator] = addtl_indicator
    
    indicators, values = [], []
    
    for key, indicator_name in indicator_dict.items():
        indicator_value = lca_data[key] if key in lca_data else None
        if indicator_value:
            indicators.append(indicator_name)
            values.append(indicator_value)
    
    return indicators, values

if __name__ == "__main__":
    if not scriptcontext.sticky["brimstone_flying"]:
        raise Exception("The 'Brimstone - Fly' component needs to exist on the canvas")
    lca_data, indicators, values = main(json_data, resources, addtl_indicators)
    
    lca_data_treeable = []
    
    for resource_lca_data in lca_data:
        lca_data_treeable.append([resource_lca_data.keys(), resource_lca_data.values()])
    lca_data = th.list_to_tree(lca_data_treeable)
    indicators = th.list_to_tree(indicators)
    values = th.list_to_tree(values)
    json_data = [json_data]
# ---------- end get_lca_data ----------
area_m2 = Data(geoprop.floor_area)
panel_255 = Panel("kg CO2eq")
lca_total_gfa = RemoteSender(area_m2)
honeybee_model_exists_10 = RemoteReceiver(honeybee_model_exists)

null_47 = NullItem(Item=data_30)  # -> NullFlags, InvalidFlags, Description
and_49 = GateAnd(A=invert(null_47.NullFlags), B=pre_calculate_lca_2)
freeze_gate_67 = StreamFreezeGate(Data=data_30, PassingSwitch=and_49, Freeze=True)
calculate_honeybee_model = BrimstoneCalculateEmbodiedCarbonOfHoneybeeModel(hb_model=freeze_gate_67, kdb_json_data=get_categories.json_data)  # -> tot_emb_carbon, elements, el_emb_carbon, elements_modules, el_emb_carbon_modules
# ---------- calculate_honeybee_model: Python ----------
"""
Calculates embodied carbon for the elements of a Honeybee model if data is available
This component was inspired by the 'HB Color Face Attributes' component of Ladybug Tools 1.6.0

    Args:
        hb_model: Honeybee model for analysis
        kdb_json_data: Optional json data object for materials which do not include impact data

    Returns:
        tot_emb_carbon: total embodied carbon of model
        elements: element types in the model
        el_emb_carbon: embodied carbon for each element type in the model
"""

import scriptcontext
import brimstone
ghenv.Component.Message = brimstone.globals.version
import Grasshopper
import os
import csv, codecs

ghenv.Component.Name = 'Brimstone - Calculate Embodied Carbon of Honeybee Model'
ghenv.Component.NickName = 'Calculate Honeybee Model'

try:  # import the core honeybee dependencies
    from honeybee_energy.construction.windowshade import WindowConstructionShade
    from honeybee_energy.construction.air import AirBoundaryConstruction
    from honeybee_energy.material.opaque import EnergyMaterialNoMass
    from honeybee.model import Model
    from honeybee.properties import FaceProperties
    from honeybee.typing import clean_ep_string
except ImportError as e:
    raise ImportError('\nFailed to import honeybee:\n\t{}'.format(e))
    

# todo: magic string here - not good!
gwp_data_string = "Global Warming potential"
gwp_data_points = {
    "gwp_a1_a3": "A1-A3 Conservative",
    "gwp_a4": "A4",
    "gwp_a5_1": "A5.1",
}

# Hack to fix default materials for ACE405 course
# From klimatdatabas 02.05.000
default_layers = {
    "Expanded polystyrene": {
        "gwp_a1_a3": 4,
        "gwp_a4": 0.0345,
        "gwp_a5_1": 0.282,
    },
    "Mineral wool": {
        "gwp_a1_a3": 1.6,
        "gwp_a4": 0.0345,
        "gwp_a5_1": 0.114,
    },
    "Timber": {
        "gwp_a1_a3": 0.08,
        "gwp_a4": 0.0158,
        "gwp_a5_1": 0.00958,
    },
    "Solid brick": {
        "gwp_a1_a3": 0.314,
        "gwp_a4": 0.0495,
        "gwp_a5_1": 0.0182,
    },
    "Gypsum plasterboard": {
        "gwp_a1_a3": 0.284,
        "gwp_a4": 0.0232,
        "gwp_a5_1": 0.0368,
    },
    "Medium density concrete": {
        "gwp_a1_a3": 0.0913,
        "gwp_a4": 0.0039,
        "gwp_a5_1": 0.00285,
    },
    "Ceramic and porcelain": {
        "gwp_a1_a3": 2.5,
        "gwp_a4": 0,
        "gwp_a5_1": 0,
    },
    "Steel": {
        "gwp_a1_a3": 3.15,
        "gwp_a4": 0.0795,
        "gwp_a5_1": 0.161,
    },
    "Crystalline stone": {
        "gwp_a1_a3": 0.5,
        "gwp_a4": 0.0,
        "gwp_a5_1": 0.0,
    },
    "Soil/sand/gravel": {
        "gwp_a1_a3": 0.02,
        "gwp_a4": 0,
        "gwp_a5_1": 0,
    },
}

# hack to fix ACE405 issues
# used if single layer aperture has no matching material
# source: klimatdatabas 02.005.000 aluminum window
# https://klimatdatabasen.boverket.se/detaljer/3/6000000225
default_aperture_density = 39.2# [kg/m2]
default_aperture_impact = { # value is kg CO2eq/m2
    "gwp_a1_a3": 3.83 * default_aperture_density,
    "gwp_a4": 0.0626 * default_aperture_density,
    "gwp_a5_1": 0.0 * default_aperture_density,
}

def main(hb_model):
    tot_emb_carbon = 0
    elements = []
    el_emb_carbon = []
    elements_modules = []
    el_emb_carbon_modules = []
    if not isinstance(hb_model, Model):
        raise Exception("hb_model input must be a valid honeybee model")
    faces = []
    apertures = []
    model_mats = []
    face_types = {
    }
    
    for face_type in [
        "Wall",
        "RoofCeiling",
        "Floor",
        "Aperture",
    ]: 
        face_types[face_type] = { "impact": {} }
    
    energy_properties = hb_model.properties.energy
    
    for material in energy_properties.materials:
        model_mats.append(material)
    for room in hb_model.rooms:
        faces.extend(room.faces)
        faces.extend(room.shades)
    faces.extend(hb_model.orphaned_faces)
    faces.extend(hb_model.orphaned_apertures)
    faces.extend(hb_model.orphaned_doors)
    faces.extend(hb_model.orphaned_shades)
    
    for face_obj in faces:
        
        if isinstance(face_obj.properties, FaceProperties):
            if isinstance(face_obj.properties.energy.construction, AirBoundaryConstruction):
                continue # skip if airboundary
                
            face_area = face_obj.area - face_obj.aperture_area
            face_type = face_obj.type
            
            face_impact = {}
            for lyr in face_obj.properties.energy.construction.layers:
                #print face_type, lyr, face_area
                face_impact_per_module = get_face_impact(model_mats, lyr, face_area)
                for key in face_impact_per_module:
                    if key in face_impact:
                        face_impact[key] += face_impact_per_module[key]
                    else:
                         face_impact[key] = face_impact_per_module[key]
                """
                if lyr not in model_mats:
                    model_mats[lyr] = { area: face_area }
                else:
                    model_mats[lyr].area = model_mats[lyr].area + face_area
                """
                       
            if str(face_type) not in face_types:
                face_types[str(face_type)] = { "impact": face_impact }
            else:
                for key in face_impact:
                    if key in face_types[str(face_type)]["impact"]:
                        face_types[str(face_type)]["impact"][key] += face_impact[key]
                    else:
                        face_types[str(face_type)]["impact"][key] = face_impact[key]
                
            for aperture in face_obj.apertures:
                aperture_impact = get_aperture_impact(aperture)
                if "Aperture" not in face_types:
                    face_types["Aperture"] = { "impact": aperture_impact }
                else:
                    for key in aperture_impact:
                        if key in face_types["Aperture"]["impact"]:
                            face_types["Aperture"]["impact"][key] += aperture_impact[key]
                        else:
                            face_types["Aperture"]["impact"][key] = aperture_impact[key]
    for face_type in face_types.items():
        face_impact = sum(face_type[1]["impact"].values())
        tot_emb_carbon += face_impact
        elements.append(face_type[0])
        el_emb_carbon.append(face_impact)
        
        for key, value in face_type[1]["impact"].items():
            elements_modules.append(str(face_type[0]) + " " + key)
            el_emb_carbon_modules.append(value)
    return tot_emb_carbon, elements, el_emb_carbon, elements_modules, el_emb_carbon_modules

def get_face_impact(materials, layer_name, face_area):
    for material in materials:
        if material.identifier == layer_name:
            if type(material) == EnergyMaterialNoMass:
                brimstone.utils.warn(ghenv, "The calculation may be faulty as material " + layer_name + " is modelled as EnergyMaterialNoMass.")
                return {}
            abs_impact = {}
            gwp_data_keys = gwp_data_points.keys()
            
            if material.user_data and all(key in material.user_data.keys() for key in gwp_data_keys):
                for key, value in gwp_data_points.items():
                    abs_impact[value] = material.density*material.user_data[key]
            elif material.user_data and layer_name in default_layers:
                for key in gwp_data_keys:
                    material.user_data[key] = default_layers[layer_name][key]
            else:
                abs_impact = get_face_impact_from_material_name(material.identifier, material.density)
            impact = { key: material.thickness*abs_impact[key]*face_area for key in abs_impact }
            return impact
    brimstone.utils.warn(ghenv, "The calculation may be faulty as material " + layer_name + " was not found among the energy materials in the model.")
    return {}

# Gets material impact data from a honeybee material by referencing names in .csv file
def get_face_impact_from_material_name(material_name, density):
    csv_data_file = brimstone.globals.hb_kdb_csv_path
    csv_data_file_path = os.path.join(Grasshopper.Folders.UserObjectFolders[0], csv_data_file)
    if not os.path.exists(csv_data_file_path):
        raise Exception("Failed to open csv file, it should reside in [UserComponents folder]/brimstone_data/")
    kdb_name = check_name_in_kdb(material_name)
    if not kdb_name:
        with open(csv_data_file_path, 'r') as csv_file:
            file_reader = csv.DictReader(csv_file, delimiter=",")
            for row in file_reader:
                if row["HB Name"] == material_name:
                    kdb_name = clean_ep_string(row["Klimatdatabas name"])
                    if not kdb_name or kdb_name == "missing":
                        brimstone.utils.warn(ghenv, "The calculation may be faulty as impact data is missing for some of the materials in the model: " + material_name)
                        return {}
                    break
    if not kdb_name:
        brimstone.utils.warn(ghenv, "The calculation may be faulty as material " + material_name + " could not be matched to any material in the brimstone material database.")
        return {}
    
    return get_impact_from_json_data(kdb_name, density)

def check_name_in_kdb(material_name):
    if not kdb_json_data:
        brimstone.utils.warn(ghenv, "The calculation may be faulty as kdb_json_data is missing")
    else: 
        for resource in kdb_json_data["Resources"]:
            if clean_ep_string(resource["Name"]) == material_name:
                return material_name
    return ""
    
# TODO: currently only works for KDB windows
def get_aperture_impact(aperture):
    c = aperture.properties.energy.construction
    c = c.window_construction if type(c) == WindowConstructionShade else c
    if c.user_data and "conv_value" in c.user_data:
        impact = {}
        for key, value in gwp_data_points.items():
            if key in c.user_data:
                impact[value] = float(c.user_data[key]) * c.user_data["conv_value"] * aperture.area
        return impact
    if not len(c.layers) == 1:
        brimstone.utils.warn(ghenv, "The calculation may be faulty as only one layer window constructions can be calculated.")
        return {}
    
    window_material = c.layers[0]
    abs_impact = get_impact_from_json_data(window_material)
    
    # hack to fix ACE405 calculations
    if not len(abs_impact.keys()):
        abs_impact = default_aperture_impact
    
    impact = { key: abs_impact[key]*aperture.area for key in abs_impact }
    return impact

# density parameter is used as fallback if KDB data does not have density
def get_impact_from_json_data(kdb_name, density = 0):
    if not kdb_json_data:
        brimstone.utils.warn(ghenv, "The calculation may be faulty as kdb_json_data is missing")
        return {}
    for resource in kdb_json_data["Resources"]:
        if clean_ep_string(resource["Name"]) == kdb_name:
            if "Conversions" not in resource:
                brimstone.utils.warn(ghenv, "The calculation may be faulty as material " + kdb_name + " has no conversion value in kdb_json_data. Using HB material density")
                conv = density
            else:
                conv = resource["Conversions"][0]["Value"]
            
            for data_item in resource["DataItems"]:
                if data_item["PropertyName"] == gwp_data_string:
                    abs_impact = {}
                    for data_pt in gwp_data_points.values():
                        for data_val_item in data_item["DataValueItems"]:
                            if data_val_item["DataModuleCode"] == data_pt:
                                abs_impact[data_pt] = data_val_item["Value"]*conv
                    return abs_impact
            brimstone.utils.warn(ghenv, "The calculation may be faulty as material " + kdb_name + " has no GWP data in kdb_json_data")
            return {}
    brimstone.utils.warn(ghenv, "The calculation may be faulty as material " + kdb_name + " was not found in kdb_json_data")
    return {}

if __name__ == "__main__":
    try:
        flying = scriptcontext.sticky["brimstone_flying"]
    except:
        raise Exception("The 'Brimstone - Fly' component needs to exist on the canvas")
    tot_emb_carbon, elements, el_emb_carbon, elements_modules, el_emb_carbon_modules = main(hb_model)
# ---------- end calculate_honeybee_model ----------

lca_total_gfa_2 = RemoteReceiver(lca_total_gfa)

ma_44 = MassAddition(Input=lca_total_gfa_2)  # -> Result, PartialResults

# ---- group: Analysis module (continued)
lca_total_gfa_3 = RemoteReceiver(lca_total_gfa)
lca_total_gfa_4 = RemoteReceiver(lca_total_gfa)

# ----
ma_45 = MassAddition(Input=lca_total_gfa_3)  # -> Result, PartialResults

# ---- group: Analyse performance
# Simple energy simulations
# # Simple energy simulations
# Streamlined energy simulations which calculate energy balance across the year, and peak loads on the design day, for the input Honeybee rooms.
# 
# ## Instructions
# Enter all inputs and set `Run Energy Balance` or `Run Peak Loads`to True to investigate energy use for the specified Honeybee rooms considering the specified Honeybee shade objects. Adjust the y axis of output graphs using the `Graph max` input.
# 
# ## Inputs
# - `EPW file URL` - the URL for a EPW file which describes the location
# - `Honeybee rooms` - the Honeybee rooms which shall be analysed
# - `Shading objects` - Honeybee shade objects which block solar radiation toward the simulated rooms
# - `Run Energy Balance` - set to True to run the energy balance simulation
# - `Run Peak Loads` - set to True to run the peak loads simulation
# - `Graph max` - max value for the y axis of output graphs
# 
# ## Outputs
# - `Annual energy balance` - mesh visualising energy balance of each month of the year broken down into energy sources/sinks
# - `Daily cooling profile` - mesh visualising the cooling need during the design day (hottest day of the year)
# - `Daily heating profile` - mesh visualising the heating need during the design day (coldest day of the year)
# - `Cooling balance (design day)` - mesh visualising the cooling sources and sinks during the design day (hottest day of the year)
# - `Heating balance (design day)` - mesh visualising the heating sources and sinks during the design day (coldest day of the year)
# 
# ## Interpretation
# To be added...
location_weather_url_6 = RemoteReceiver(location_weather_url)
pre_run_simple_energy_simulations_3 = RemoteReceiver(pre_run_simple_energy_simulations)
toggle_5 = BooleanToggle(True)
data_31 = Data(location_weather_url_6)
honeybee_rooms = Data(deconstructmodel.rooms)
shades = Data(deconstructmodel.shades)
objbynn_17 = GetObjectByNickname(NickName="PeakLoads")
objbynn_18 = GetObjectByNickname(NickName="AnnualLoads")
current_model_name_5 = RemoteReceiver(current_model_name)
run_simple_energy_simulations_2 = RemoteReceiver(run_simple_energy_simulations)
simple_energy_simulation_height_2 = RemoteReceiver(simple_energy_simulation_height)
colrange_3 = LBColorRange(index=Slider(0, range=0..26))  # -> colors; plug-in component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
colrange_4 = LBColorRange(index=Slider(26, range=0..26))  # -> colors; plug-in component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
addition_5 = Addition(A=simple_energy_simulation_height_2, B=Slider(15, range=0..100))
Y_2 = UnitY(Factor=addition_5)
simple_energy_simulation_base_point_2 = RemoteReceiver(simple_energy_simulation_base_point)
simple_energy_simulation_height_3 = RemoteReceiver(simple_energy_simulation_height)
simple_energy_simulation_width_2 = RemoteReceiver(simple_energy_simulation_width)
move_5 = Move(Geometry=pt_4, Motion=Y_2)  # -> Geometry, Transform
simple_energy_simulation_base_point_comp = RemoteSender(move_5.Geometry)  # "simple_energy_simulation_base_point_compare"

# ----
entwine_183 = Entwine(
    Branch00=data_31,
    Branch01=honeybee_rooms,
    Branch02=shades,
    Branch03=pre_run_simple_energy_simulations_3,
    FlattenInputs=True)
panel_258 = Panel(pre_run_simple_energy_simulations_3)

# ----
# Daylight (Illuminance, DA and UDI)
# # Daylight (Illuminance, DA and UDI)
# This cluster simulates illuminance for a specified hour of the year and daylight autonomy (DA) and useful daylight illuminance (UDI) for the entire year across an analysis surface.
# 
# ## Instructions
# Enter all inputs and set `Run Illuminance` or `Run Annual Daylight Simulation`to True to investigate daylight. The illuminance study covers a specified time step whereas the annual daylight simulation covers the full year. The `grid size` and `detail level` inputs can be used to improve the fidelity of the simulation at the cost of simulation time. The study can take several minutes, depending on the grid size and detail level.
# 
# ## Inputs
# - `EPW file URL` - the URL for a EPW file which describes the location
# - `Honeybee model` - the Honeybee model for analysis
# - `Grid size` - the resolution of the analysis grid in metres
# - `Detail level (0-2)` - level of detail for the daylight simulation, the higher value, the higher detail and the slower the simulation
# - `Month (illuminance)` - month of the analysis period  for the illuminance simulation (1-12)
# - `Day (illuminance)` - date of the analysis period for the illuminance simulation (1-31)
# - `Hour (illuminance)` - hour of the analysis period for the illuminance simulation (0-23)
# - `Run Illuminance` - set to True to run the illuminance analysis for the specified timestep
# - `Run Annual Daylight Simulation` - set to True to run the full year daylight simulation
# 
# ## Outputs
# - `Illuminance [Lux]` - a mesh visualising the amount of incident radiation which hits the analysis surface at the specified timestep
# - `Spatial Daylight Autonomy [-]` - the mean SDA for the entire analysis surface
# - `Daylight autonomy [%]` - a mesh visualising the value of DA across the analysis surface
# - `UDI [%]` - a mesh visualising the value of Useful Daylight Illuminance across the analysis surface
# - `UDI <50 [%]` - a mesh visualising the percentage of time that the lower treshold of illuminance is not achieved across the analysis surface
# - `UDI >3000 [%]` - a mesh visualising the percentage of time that the upper treshold of illuminance is exceeded across the analysis surface
# 
# ## Interpretation
# To be added...
toggle_6 = BooleanToggle(True)
data_32 = Data(location_weather_url_3)
honeybee_model_2 = Data(honeybee_model)
panel_259 = Panel(run_daylight_simulations_2)

entwine_184 = Entwine(
    Branch00=data_32,
    Branch01=honeybee_model_2,
    Branch02=run_daylight_simulations_2,
    Branch03=remote_receiver,
    Branch04=daylight_grid_size_3,
    FlattenInputs=True)
freeze_gate_68 = StreamFreezeGate(Data=entwine_184, PassingSwitch=run_daylight_simulations_2, Freeze=True)
bang_18 = ExplodeTree(Data=freeze_gate_68)  # -> Branch0, Branch1, Branch2, Branch3, Branch4
north = Vector(bang_18.Branch3)
null_48 = NullItem(Item=bang_18.Branch2)  # -> NullFlags, InvalidFlags, Description
filter_90 = StreamFilter(Gate=null_48.NullFlags, Stream0=bang_18.Branch2, Stream1="False")
bool_64 = Boolean(filter_90)

# ---- group: Analyse performance (continued)
freeze_gate_69 = StreamFreezeGate(Data=entwine_183, PassingSwitch=pre_run_simple_energy_simulations_3, Freeze=True)

# ----
bang_19 = ExplodeTree(Data=freeze_gate_69)  # -> Branch0, Branch1, Branch2, Branch3

# ---- group: Analyse performance (continued)
null_49 = NullItem(Item=bang_19.Branch3)  # -> NullFlags, InvalidFlags, Description
downloadepw_5 = LBDownloadWeather(weather_URL=bang_19.Branch0)  # -> epw_file, stat_file, ddy_file; plug-in component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
filter_91 = StreamFilter(Gate=null_49.NullFlags, Stream0=bang_19.Branch3, Stream1="False")
run_energy_balance = Boolean(filter_91)
data_33 = Data(bang_19.Branch1)
data_34 = Data(bang_19.Branch2)
data_35 = Data(downloadepw_5.epw_file)
run_peak_loads = Boolean(filter_91)
honeybee_rooms_2 = Data(bang_19.Branch1)
data_36 = Data(downloadepw_5.ddy_file)
shading_geometry = Data(bang_19.Branch2)
annualloads = HBAnnualLoads(rooms=flatten(data_33), epw_file=data_35, north=north_vector_3, run_bal=run_energy_balance, run=run_energy_balance)  # -> report, total_load, cooling, heating, lighting, equip, process, hot_water, balance; plug-in component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
panel_260 = Panel(annualloads.report)
peakloads = HBPeakLoads(rooms=honeybee_rooms_2, ddy_file=data_36, run_bal=run_peak_loads, run=run_peak_loads)  # -> report, peak_cool, peak_heat, cooling, heating, cool_bal, heat_bal; plug-in component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
panel_261 = Panel(peakloads.report)
gate_70 = StreamGate(Stream=objbynn_17, Gate=run_peak_loads)  # -> Target0, Target1
gate_71 = StreamGate(Stream=objbynn_18, Gate=run_energy_balance)  # -> Target0, Target1
hold_6 = HoldingGate(Data=gate_70.Target1)
annual_energy_balance_data = Data(peakloads.cooling)
annual_energy_balance_data_2 = Data(peakloads.cool_bal)
hold_7 = HoldingGate(Data=gate_71.Target1)
annual_energy_balance_data_3 = Data(peakloads.heating)
annual_energy_balance_data_4 = Data(peakloads.heat_bal)
annual_energy_balance_data_5 = Data(annualloads.balance)
total_load_eui = Data(annualloads.total_load)
simple_energy_simulations_report = RemoteSender(peakloads.report)
msgs = GetRuntimeMessages(Objects=hold_6)  # -> Errors, Warnings
simple_energy_simulations_report_2 = RemoteSender(annualloads.report)
msgs_2 = GetRuntimeMessages(Objects=hold_7)  # -> Errors, Warnings
peakloads_message_error = RemoteSender(msgs.Errors)
peakloads_message_warning = RemoteSender(msgs.Warnings)
panel_262 = Panel(msgs_2.Warnings)
annualloads_message_error = RemoteSender(msgs_2.Errors)
annualloads_message_warning = RemoteSender(msgs_2.Warnings)

# ----
merge_37 = Merge(
    Data1=annualloads.lighting,
    Data2=annualloads.heating,
    Data3=annualloads.cooling,
    Data4=annualloads.equip,
    Data5=annualloads.process,
    Data6=annualloads.hot_water)  # -> flatten(Result)

simple_energy_simulations_report_3 = RemoteReceiver([simple_energy_simulations_report, simple_energy_simulations_report_2])

# ---- group: Analysis module (continued)
annualloads_message_warning_2 = RemoteReceiver(annualloads_message_warning)
peakloads_message_warning_2 = RemoteReceiver(peakloads_message_warning)
annualloads_message_error_2 = RemoteReceiver(annualloads_message_error)
peakloads_message_error_2 = RemoteReceiver(peakloads_message_error)
lng_37 = ListLength(List=[peakloads_message_error_2, annualloads_message_error_2])
lng_38 = ListLength(List=[peakloads_message_warning_2, annualloads_message_warning_2])
ma_46 = MassAddition(Input=[lng_38, lng_37])  # -> Result, PartialResults
bool_65 = Boolean(ma_46.Result)
hasdata_10 = DataExists(Data=bool_65)
filter_92 = StreamFilter(Gate=hasdata_10, Stream0="False", Stream1=bool_65)
hideshow_59 = HideShowElement(ElementToHideShow=tb_28, Show=filter_92, Collapse=True, Disable=False)

# ----
bool_66 = Boolean(lng_37)

# ---- group: Analysis module (continued)
filter_93 = StreamFilter(Gate=bool_66, Stream0="Warning", Stream1="Error")
filter_94 = StreamFilter(Gate=bool_66, Stream0=ColourSwatch(SwatchColor=RGB(237, 185, 94)), Stream1=ColourSwatch(SwatchColor=RGB(226, 54, 54)))
adjustelem_44 = AdjustElementAppearance(ElementsToAdjust=tb_28, Foreground=filter_94)
settextblock_14 = SetTextBlockContents(TextBlockToModify=tb_28, NewTextBlockContents=filter_93)

# ---- group: Analyse performance
# Chart title
current_selected_model_analysis_module_n_9 = RemoteReceiver(current_selected_model_analysis_module_n)  # "current_selected_model_analysis_module_name"

# ----
epw_file_url = Data(bang_18.Branch0)
downloadepw_6 = LBDownloadWeather(weather_URL=epw_file_url)  # -> epw_file, stat_file, ddy_file; plug-in component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
run_annual_daylight_simulation = Boolean(bool_64)

gate_72 = StreamGate(Stream=objbynn_2, Gate=run_annual_daylight_simulation)  # -> Target0, Target1
hold_8 = HoldingGate(Data=gate_72.Target1)
msgs_3 = GetRuntimeMessages(Objects=hold_8)  # -> Errors, Warnings
annualdaylight_message_error = RemoteSender(msgs_3.Errors)
annualdaylight_message_warning = RemoteSender(msgs_3.Warnings)

# ---- group: Analysis module (continued)
annualdaylight_message_warning_2 = RemoteReceiver(annualdaylight_message_warning)
annualdaylight_message_error_2 = RemoteReceiver(annualdaylight_message_error)

# ----
element_types = Data(calculate_honeybee_model.elements)
total_gwp = Data(calculate_honeybee_model.tot_emb_carbon)
gwp_by_element_type = Data(calculate_honeybee_model.el_emb_carbon)
connected_4 = GetConnectedObjects(Objects=calculate_honeybee_model.tot_emb_carbon)
panel_263 = Panel(gwp_by_element_type)
gate_73 = StreamGate(Stream=connected_4, Gate=Toggle(False))  # -> Target0, Target1
ma_47 = MassAddition(Input=gwp_by_element_type)  # -> Result, PartialResults
panel_264 = Panel(element_types)
panel_265 = Panel(total_gwp)
lca_element_types = RemoteSender(element_types)
lca_total_gwp = RemoteSender(ma_47.Result)
lca_gwp_by_element_type = RemoteSender(gwp_by_element_type)
msgs_4 = GetRuntimeMessages(Objects=gate_73.Target1)  # -> Errors, Warnings
lca_gwp_by_element_type_2 = RemoteReceiver(lca_gwp_by_element_type)
lca_errors = RemoteSender(msgs_4.Errors)
lca_warnings = RemoteSender(msgs_4.Warnings)
lca_element_types_2 = RemoteReceiver(lca_element_types)
lca_total_gwp_2 = RemoteReceiver(lca_total_gwp)
lca_errors_2 = RemoteReceiver(lca_errors)
lng_39 = ListLength(List=lca_errors_2)

null_50 = NullItem(Item=lca_total_gwp)  # -> NullFlags, InvalidFlags, Description
bool_67 = Boolean(invert(null_50.NullFlags))
post_calculate_lca = RemoteSender(bool_67)
post_calculate_lca_2 = RemoteReceiver(post_calculate_lca)

lca_gwp_by_element_type_3 = RemoteReceiver(lca_gwp_by_element_type)
lca_element_types_3 = RemoteReceiver(lca_element_types)
entwine_185 = Entwine(
    Branch00="Model name",
    Branch01=lca_element_types_3,
    Branch02="Operational emissions",
    Branch03="GFA",
    FlattenInputs=True)  # -> flatten(Result)
panel_266 = Panel(entwine_185)

lng_40 = ListLength(List=entwine_185)
equals_47 = Equality(FirstNumber=lng_40, SecondNumber="7")  # -> Equality, Inequality
and_50 = GateAnd(A=equals_47.Equality, B=pre_calculate_lca_3)

lca_warnings_2 = RemoteReceiver(lca_warnings)
lca_errors_3 = RemoteReceiver(lca_errors)

# ---- group: Analysis module (continued)
lca_total_gwp_3 = RemoteReceiver(lca_total_gwp)
lca_total_gwp_4 = RemoteReceiver(lca_total_gwp)
division_15 = Division(A=lca_total_gwp_3, B=ma_45.Result)
lca_warnings_3 = RemoteReceiver(lca_warnings)
lca_errors_4 = RemoteReceiver(lca_errors)
expression_90 = Expression(x=division_15, Expression="Round(x, 1)")
expression_91 = Expression(x=lca_total_gwp_4, Expression="Round(x, 1)")
lng_41 = ListLength(List=lca_errors_4)
lng_42 = ListLength(List=lca_warnings_3)
format_38 = Format(Format=panel_108, Culture=127, Data0=expression_90)
format_39 = Format(Format=panel_109, Culture=127, Data0=expression_91)
ma_48 = MassAddition(Input=[lng_41, lng_42])  # -> Result, PartialResults
setlabel_6 = SetLabelContents(LabelToModify=label_42, NewLabelContents=format_38)
setlabel_7 = SetLabelContents(LabelToModify=label_44, NewLabelContents=format_39)
bool_68 = Boolean(ma_48.Result)
hasdata_11 = DataExists(Data=bool_68)
filter_95 = StreamFilter(Gate=hasdata_11, Stream0="False", Stream1=bool_68)
filter_96 = StreamFilter(Gate=lng_41, Stream0="Warning", Stream1="Error")
filter_97 = StreamFilter(Gate=lng_41, Stream0=ColourSwatch(SwatchColor=RGB(237, 185, 94)), Stream1=ColourSwatch(SwatchColor=RGB(226, 54, 54)))
adjustelem_45 = AdjustElementAppearance(ElementsToAdjust=tb_34, Foreground=filter_97)
settextblock_15 = SetTextBlockContents(TextBlockToModify=tb_34, NewTextBlockContents=filter_96)
hideshow_60 = HideShowElement(ElementToHideShow=tb_34, Show=filter_95, Collapse=True, Disable=False)

# ----
# Chart title
current_selected_simulation_simple_energ_2 = RemoteReceiver(current_selected_simulation_simple_energ)  # "current_selected_simulation_simple_energy_compare"

# ---- group: Analyse performance (continued)
entwine_186 = Entwine(
    Branch00=total_load_eui,
    Branch01=annual_energy_balance_data_5,
    Branch02=annual_energy_balance_data,
    Branch03=annual_energy_balance_data_3,
    Branch04=annual_energy_balance_data_2,
    Branch05=annual_energy_balance_data_4,
    Branch06=merge_37,
    FlattenInputs=True)
null_51 = NullItem(Item=flatten(entwine_186))  # -> NullFlags, InvalidFlags, Description
item_49 = ListItem(List=null_51.NullFlags, Index=0, Wrap=True)
gate_74 = StreamGate(Stream=entwine_186, Gate=item_49)  # -> Target0, Target1
entwine_187 = Entwine(Branch0X=gate_74.Target0, Branch1X=current_model_name_5, FlattenInputs=False)
freeze_gate_70 = StreamFreezeGate(Data=entwine_187, PassingSwitch=run_simple_energy_simulations_2, Freeze=True, Hold=False)
split_12 = SplitTree(Data=freeze_gate_70, Masks=flatten("{1;*}"))  # -> Positive, Negative
rec_56 = DataRecorder(split_12.Positive, DataLimit=-10, RecordData=True)
rec_57 = DataRecorder(graft(split_12.Negative), DataLimit=-10, RecordData=True)

# ----
py3_62 = Python3Script(all_simulated_models=rec_56, model_dictionary=model_name_dictionary_3)  # -> out, simulated_models_renamed; inputs all_simulated_models: list, model_dictionary: list; same code as py3_60
py3_63 = Python3Script(
    all_simulated_models=py3_62.simulated_models_renamed,
    existing_models=current_all_created_models_names_6,
    all_simulation_data=rec_57)  # -> out, filtered_simulated_models, filtered_simulation_data_pattern; inputs all_simulated_models: list, existing_models: list, all_simulation_data: tree
# ---------- py3_63: Python ----------
from ghpythonlib import treehelpers as th
import Grasshopper as gh

model_indexes = {}
for i, m in enumerate(all_simulated_models):
    if m in existing_models:
        # we make sure here to take the latest index with a unique name
        model_indexes[m] = i

filtered_simulation_data_pattern = gh.DataTree[object](all_simulation_data)
for i, branch in enumerate(filtered_simulation_data_pattern.Branches):
    for j in range(len(branch)):
        branch[j] = j in model_indexes.values()

filtered_simulated_models = list(model_indexes.keys())
#filtered_simulation_data = th.list_to_tree(filtered_simulation_data)
# ---------- end py3_63 ----------
cull_32 = CullPattern(List=rec_57, CullPattern=py3_63.filtered_simulation_data_pattern)
mindex_9 = MemberIndex(Set=py3_63.filtered_simulated_models, Member=current_selected_model_analysis_module_n_6)  # -> flatten(Index), Count
item_50 = ListItem(List=mindex_9.Index, Index="-1", Wrap=True)
null_52 = NullItem(Item=mindex_9.Count)  # -> NullFlags, InvalidFlags, Description
filter_98 = StreamFilter(Gate=null_52.NullFlags, Stream0=mindex_9.Count, Stream1="False")
simple_energy_data_exists = RemoteSender(filter_98)
simple_energy_data_exists_2 = RemoteReceiver(simple_energy_data_exists)
simple_energy_data_exists_3 = RemoteReceiver(simple_energy_data_exists)

# ---- group: Analysis module (continued)
simple_energy_data_exists_4 = RemoteReceiver(simple_energy_data_exists)
simple_energy_data_exists_5 = RemoteReceiver(simple_energy_data_exists)
simple_energy_data_exists_6 = RemoteReceiver(simple_energy_data_exists)
hideshow_61 = HideShowElement(ElementToHideShow=button_28, Show=simple_energy_data_exists_5, Collapse=True, Disable=False)
hideshow_62 = HideShowElement(ElementToHideShow=button_27, Show=simple_energy_data_exists_6, Collapse=True, Disable=False)
simple_energy_data_exists_7 = RemoteReceiver(simple_energy_data_exists)
simple_energy_data_exists_8 = RemoteReceiver(simple_energy_data_exists)
simple_energy_data_exists_9 = RemoteReceiver(simple_energy_data_exists)
hideshow_63 = HideShowElement(ElementToHideShow=tb_32, Show=simple_energy_data_exists_7, Collapse=True, Disable=False)
simple_energy_data_exists_10 = RemoteReceiver(simple_energy_data_exists)
bool_69 = Boolean(invert(simple_energy_data_exists_8))
hideshow_64 = HideShowElement(ElementToHideShow=tb_31, Show=bool_69, Collapse=simple_energy_data_exists_8, Disable=False)
hideshow_65 = HideShowElement(ElementToHideShow=entwine_62, Show=simple_energy_data_exists_9, Collapse=True, Disable=False)

# ----
# Create analysis grid
grid_size = Number(bang_18.Branch4)
honeybee_model_3 = Data(bang_18.Branch1)

nullrep = ReplaceNulls(Items=grid_size, Replacements=Slider(1, range=0..1))  # -> Items, Count

gridrooms = HBSensorGridFromRooms(rooms=honeybee_model_3, grid_size=nullrep.Items, dist_floor=Slider(0.7, range=0..5))  # -> grid, points, mesh; plug-in component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
assigngridsviews = HBAssignGridsAndViews(model=honeybee_model_3, grids=flatten(gridrooms.grid))  # -> model; plug-in component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
grid_mesh = Data(gridrooms.mesh)
honeybee_model_4 = Data(assigngridsviews)

# ---- group: Simulate illuminance
importloc_4 = LBImportLocation(epw_file=downloadepw_6.epw_file)  # -> location; plug-in component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
detail_level_0_2 = Number(Slider(0, range=0..2))
day_illuminance = Number(Slider(21, range=1..31))
hour_illuminance = Number(Slider(12, range=0..23))
month_illuminance = Number(Slider(6, range=1..12))
radpar = HBRadianceParameter(recipe_type=Slider(0, range=0..2), detail_level=detail_level_0_2)  # -> rad_par; plug-in component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
run_illuminance = Boolean(bool_64)
ciesky = HBCIEStandardSky(north=north, location=importloc_4, month=month_illuminance, day=day_illuminance, hour=hour_illuminance, type=0)  # -> sky; plug-in component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
mjoin_5 = MeshJoin(Meshes=grid_mesh)
pitgrid = HBPointInTimeGridBased(model=honeybee_model_4, sky=ciesky, radiance_par=radpar, run=run_illuminance)  # -> report, flatten(results); plug-in component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
sort_2 = SortList(Keys=pitgrid.results)  # -> reverse(Keys), ValuesA
objbynn_19 = GetObjectByNickname(NickName="PITGrid")
item_51 = ListItem(List=sort_2.Keys, Index=0, Wrap=True)
gate_75 = StreamGate(Stream=objbynn_19, Gate=run_illuminance)  # -> Target0, Target1
daylight_report = RemoteSender(pitgrid.report)
max = Maximum(A=Slider(2000, range=0..10000), B=item_51)
hold_9 = HoldingGate(Data=gate_75.Target1)
legendpar_4 = LBLegendParameters(max=max)  # -> leg_par; plug-in component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
msgs_5 = GetRuntimeMessages(Objects=hold_9)  # -> Errors, Warnings
pitgrid_message_error = RemoteSender(msgs_5.Errors)
pitgrid_message_warning = RemoteSender(msgs_5.Warnings)
heatmap = LBSpatialHeatmap(values=pitgrid.results, mesh=mjoin_5, legend_par=legendpar_4, legend_title="Lux", global_title="Illuminance")  # -> mesh, legend, title, colors, legend_par, vis_set; plug-in component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
txt_7 = Text(heatmap.title)
entwine_188 = Entwine(Branch00=heatmap.mesh, Branch01=heatmap.legend, Branch02=txt_7, FlattenInputs=True)  # -> flatten(Result)
illuminance_lux = Data(entwine_188)

# ----
daylight_report_2 = RemoteReceiver(daylight_report)

# ---- group: Analysis module (continued)
pitgrid_message_warning_2 = RemoteReceiver(pitgrid_message_warning)
pitgrid_message_error_2 = RemoteReceiver(pitgrid_message_error)
lng_43 = ListLength(List=[annualdaylight_message_error_2, pitgrid_message_error_2])
lng_44 = ListLength(List=[annualdaylight_message_warning_2, pitgrid_message_warning_2])
ma_49 = MassAddition(Input=[lng_43, lng_44])  # -> Result, PartialResults
bool_70 = Boolean(ma_49.Result)
hasdata_12 = DataExists(Data=bool_70)
filter_99 = StreamFilter(Gate=hasdata_12, Stream0="False", Stream1=bool_70)
filter_100 = StreamFilter(Gate=lng_43, Stream0="Warning", Stream1="Error")
filter_101 = StreamFilter(Gate=lng_43, Stream0=ColourSwatch(SwatchColor=RGB(237, 185, 94)), Stream1=ColourSwatch(SwatchColor=RGB(226, 54, 54)))
adjustelem_46 = AdjustElementAppearance(ElementsToAdjust=tb_33, Foreground=filter_101)
settextblock_16 = SetTextBlockContents(TextBlockToModify=tb_33, NewTextBlockContents=filter_100)
hideshow_66 = HideShowElement(ElementToHideShow=tb_33, Show=filter_99, Collapse=True, Disable=False)

# ----
# Calculate operational emissions
list_5 = ValueList({"Conservative": "conservative", "Typical": "typical"}, selected="Conservative")
panel_267 = Panel("kg CO2eq/year")

# ----
# Simple energy simulations - Compare
current_selected_simulation_simple_energ_3 = RemoteReceiver(current_selected_simulation_simple_energ)  # "current_selected_simulation_simple_energy_compare"
colrange_5 = LBColorRange(index=Slider(26, range=0..26))  # -> colors; plug-in component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
colrange_6 = LBColorRange(index=Slider(0, range=0..26))  # -> colors; plug-in component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

equals_48 = Equality(FirstNumber=current_selected_simulation_simple_energ_3, SecondNumber="-1")  # -> Equality, Inequality

gate_76 = StreamGate(Stream=current_selected_simulation_simple_energ_3, Gate=equals_48.Inequality)  # -> Target0, Target1

# ---- group: Daylight Factor
# Daylight Factor [%]
number_slider_54 = Slider(0, range=0..2)
number_slider_55 = Slider(0, range=0..2)  # disabled
falsestart = LBFalseStartToggle(False)  # disabled
detail_level_0_2_2 = Number(number_slider_54)
radpar_2 = HBRadianceParameter(recipe_type=number_slider_55, detail_level=detail_level_0_2_2)  # -> rad_par; disabled; plug-in component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
run_daylight_factor = Data(falsestart)  # disabled
panel_268 = Panel("Daylight Factor [%]")  # disabled
cluster_8 = Cluster_5()  # disabled

# ---- group: Spatial climate based daylight
number_slider_56 = Slider(0, range=0..2)
panel_269 = Panel("-t 50 -lt 200 -ut 2000")
wea = HBWeaFromEPW(epw_file=downloadepw_6.epw_file)  # -> wea; plug-in component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
analysis_mesh = Mesh(grid_mesh)
mjoin_6 = MeshJoin(Meshes=analysis_mesh)
cluster_9 = Cluster_5()
cluster_10 = Cluster_5()
cluster_11 = Cluster_5()
cluster_12 = Cluster_5()

# ----
detail_level_0_2_3 = Number(number_slider_56)
honeybee_model_5 = Data(honeybee_model_4)

# ---- group: Daylight Factor (continued)
daylightfactor = HBDaylightFactor(model=honeybee_model_5, radiance_par=radpar_2, run=run_daylight_factor)  # -> report, results; disabled; plug-in component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
median = GhPythonScript(list=daylightfactor.results)  # -> out, median; inputs list: list; disabled
# ---------- median: Python ----------
"""Provides a scripting component.
    Inputs:
        list: list of numeric values to retrieve median
    Output:
        median: median value in list

__author__ = "sawen"
__version__ = "2024.06.14"
"""

import statistics

def main(list):
    return statistics.median(list)

if __name__ == "__main__":
    if list:
        median = main(list)
# ---------- end median ----------
heatmap_2 = LBSpatialHeatmap(values=flatten(daylightfactor.results), legend_par=cluster_8, legend_title=panel_268)  # -> mesh, legend, title, colors, legend_par, vis_set; disabled; plug-in component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
daylight_factor_2 = Data(flatten([heatmap_2.mesh, heatmap_2.legend, heatmap_2.title]))  # disabled

# ---- group: Spatial climate based daylight (continued)
radpar_3 = HBRadianceParameter(recipe_type=Slider(2, range=0..2), detail_level=detail_level_0_2_3, additional_par="-ab 4")  # -> rad_par; plug-in component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
panel_270 = Panel(radpar_3)
annualdaylight = HBAnnualDaylight(
    model=honeybee_model_5,
    wea=wea,
    north=north,
    schedule="Generic Office Occupancy",
    radiance_par=radpar_3,
    run=run_annual_daylight_simulation)  # -> report, results, DA, cDA, UDI, UDI_low, UDI_up; plug-in component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
heatmap_3 = LBSpatialHeatmap(
    values=flatten(annualdaylight.UDI_up),
    mesh=mjoin_6,
    legend_par=cluster_10,
    legend_title="%",
    global_title="UDI > 3000 lux")  # -> mesh, legend, title, colors, legend_par, vis_set; plug-in component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
heatmap_4 = LBSpatialHeatmap(
    values=flatten(annualdaylight.UDI_low),
    mesh=mjoin_6,
    legend_par=cluster_9,
    legend_title="%",
    global_title="UDI < 50 lux")  # -> mesh, legend, title, colors, legend_par, vis_set; plug-in component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
heatmap_5 = LBSpatialHeatmap(
    values=flatten(annualdaylight.UDI),
    mesh=mjoin_6,
    legend_par=cluster_11,
    legend_title="%",
    global_title="Useful daylight illuminance")  # -> mesh, legend, title, colors, legend_par, vis_set; plug-in component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
sda = HBSpatialDaylightAutonomy(DA=flatten(annualdaylight.DA), mesh=mjoin_6)  # -> report, sDA, pass_fail; plug-in component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
heatmap_6 = LBSpatialHeatmap(
    values=flatten(annualdaylight.DA),
    mesh=mjoin_6,
    legend_par=cluster_12,
    legend_title="%",
    global_title="Daylight autonomy")  # -> mesh, legend, title, colors, legend_par, vis_set; plug-in component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
entwine_189 = Entwine(Branch00=heatmap_3.mesh, Branch01=heatmap_3.legend, Branch02=heatmap_3.title, FlattenInputs=True)  # -> flatten(Result)
entwine_190 = Entwine(Branch00=heatmap_4.mesh, Branch01=heatmap_4.legend, Branch02=heatmap_4.title, FlattenInputs=True)  # -> flatten(Result)
entwine_191 = Entwine(Branch00=heatmap_5.mesh, Branch01=heatmap_5.legend, Branch02=heatmap_5.title, FlattenInputs=True)  # -> flatten(Result)
entwine_192 = Entwine(Branch00=heatmap_6.mesh, Branch01=heatmap_6.legend, Branch02=heatmap_6.title, FlattenInputs=True)  # -> flatten(Result)
panel_271 = Panel(sda.sDA)
udi_3000 = Data(flatten(entwine_189))
udi_50 = Data(flatten(entwine_190))
udi_2 = Data(flatten(entwine_191))
daylight_autonomy_2 = Data(flatten(entwine_192))
spatial_daylight_autonomy = Data(sda.sDA)

# ----
lng_45 = ListLength(List=annualdaylight.report)
and_51 = GateAnd(A=Toggle(True), B=invert(lng_45))

# ---- group: Analyse performance (continued)
current_all_simulation_models_simple_ene = RemoteSender(py3_63.filtered_simulated_models)  # "current_all_simulation_models_simple_energy"
current_all_simulations_simple_energy = RemoteSender(cull_32)
split_13 = SplitTree(Data=cull_32, Masks=flatten("{0;0;0;*}"))  # -> Positive, Negative
flip = FlipMatrix(Data=split_13.Positive)
item_52 = ListItem(List=simplify(current_all_simulations_simple_energy), Index=item_50, Wrap=True)
total_load_eui_all_simulations = RemoteSender(flip)
pshift = ShiftPaths(Data=item_52, Offset=-1)
bang_20 = ExplodeTree(Data=pshift)  # -> Branch0, Branch1, Branch2, Branch3, Branch4, Branch5, Branch6

# ----
total_load_eui_all_simulations_2 = RemoteReceiver(total_load_eui_all_simulations)
num_10 = Number(total_load_eui_all_simulations_2)
current_all_simulation_models_simple_ene_2 = RemoteReceiver(current_all_simulation_models_simple_ene)  # "current_all_simulation_models_simple_energy"
expression_92 = Expression(x=num_10, Expression="Round(x, 1)")
cset_8 = CreateSet(List=current_all_simulation_models_simple_ene_2)  # -> Set, Map
cull_33 = CullPattern(List=expression_92, CullPattern=graft(values_28.Values))  # -> flatten(List)
cull_34 = CullPattern(List=cset_8.Set, CullPattern=values_28.Values)
setchecklist = SetChecklistContents(ChecklistToModify=checklist, NewChecklistContents=cset_8.Set, Selected="True")
entwine_193 = Entwine(
    Branch00=nextfile,
    Branch01="EUI (kWh/m2,a)",
    Branch02="Energy use intensity (EUI) per model (kWh/m2,a)",
    Branch03=cull_34,
    Branch04=rev,
    Branch05=cull_33,
    Branch06=fragment,
    FlattenInputs=True)
freeze_gate_71 = StreamFreezeGate(Data=entwine_193, PassingSwitch=and_2)
bang_21 = ExplodeTree(Data=freeze_gate_71)  # -> Branch0, Branch1, Branch2, Branch3, Branch4, Branch5, Branch6
lng_46 = ListLength(List=flatten(bang_21.Branch4))
partition = PartitionList(List=flatten(bang_21.Branch5), Size=lng_46)
py3_64 = Python3Script(
    file_location=bang_21.Branch0,
    y_label=bang_21.Branch1,
    title=bang_21.Branch2,
    labels=bang_21.Branch3,
    elements=bang_21.Branch4,
    values=partition,
    colors=bang_21.Branch6,
    img_width=bar_chart_img_width_3,
    img_height=bar_chart_img_height_3)  # -> file_location_out; inputs labels: list, elements: list, values: tree of Double, colors: list
# ---------- py3_64: Python ----------
# requirements: matplotlib
# requirements: numpy

import matplotlib.pyplot as plt
import numpy as np
import os
import ghpythonlib.treehelpers as th

if not os.path.exists(file_location):
    seperatedLabels = []
    for label in labels:
        if '(' in label:
            seperatedLabels.append(('\n(').join(label.split('(')))
        else:
            seperatedLabels.append(label)
    
    colors = colors[:len(elements)]
    for i in range(len(colors)):
        colors[i] = colors[i].split(',')
        colors[i] = tuple([float(j) for j in colors[i]])
    
    values_list = th.tree_to_list(values)

    px = 1/plt.rcParams['figure.dpi']  # pixel in inches
    fig, ax = plt.subplots(figsize=(img_width*px, img_height*px))

    # Add the stacked bars
    bottom = np.zeros(len(values_list))
    bar_width = 0.25
    for i in range(len(values_list)):
        for j in range(len(values_list[i])):
            ax.bar(seperatedLabels[i], values_list[i][j], color=colors[j], 
             bottom=bottom[i], align='center', width=bar_width, zorder=2)
            
            if values_list[i][j] > 0:
                ax.text(i, bottom[i] + values_list[i][j] / 2, f"{int(values_list[i][j])}",
                ha='center', va='center', fontsize=10, color='black', zorder=3)
            
            bottom[i] += values_list[i][j]
    
    y_range = max(bottom)*1.1
    interval = 10 ** (np.floor(np.log10(y_range)) - 1)  # Base interval as a power of 10
    while y_range / interval > 10:  # Adjust interval if too many ticks
        interval *= 2
    while y_range / interval < 5:  # Adjust interval if too few ticks
        interval /= 2

    # Ensure interval is a clean power of 10 or multiple thereof
    interval = round(interval, -int(np.floor(np.log10(interval))))

    # Set y-axis limits
    ax.set_ylim(0, y_range)

    # Generate tick positions
    yticks = list(range(0, int(y_range) + 1, int(interval)))

    # Add horizontal lines
    for y in yticks:
        ax.axhline(y=y, color='gray', linestyle='--', linewidth=0.4, zorder=1)

    # Set yticks to match the lines
    ax.set_yticks(yticks)
    ax.set_title(title)
    ax.set_ylabel(y_label)
    ax.set_xticks(range(len(seperatedLabels)))
    ax.set_xticklabels(seperatedLabels, rotation=35, ha='right', rotation_mode='anchor')
    
    plt.subplots_adjust(right=0.65)

    # Create the legend
    patches = [plt.Rectangle((0, 0), 1, 1, color=color) for color in colors[::-1][:len(elements)]]
    ax.legend(patches, elements, title="Elements", bbox_to_anchor=(1.0, 1), loc='upper left', reverse=False)

    plt.tight_layout()
    plt.savefig(file_location)
    file_location_out = file_location

    #plt.show()
# ---------- end py3_64 ----------
setimg_2 = SetImage(ImageToModify=image_2, NewImagePath=py3_64)

panel_272 = Panel(total_load_eui_all_simulations_2)
current_all_simulation_models_simple_ene_3 = RemoteReceiver(current_all_simulation_models_simple_ene)  # "current_all_simulation_models_simple_energy"
entwine_194 = Entwine(Branch00="None", Branch01=current_all_simulation_models_simple_ene_3, FlattenInputs=True)  # -> flatten(Result)
total_load_eui_all_simulations_3 = RemoteReceiver(total_load_eui_all_simulations)
setlist_7 = SetListContents(ListToModify=pulldown, NewListContents=entwine_194, SelectedIndex="0")
ma_50 = MassAddition(Input=total_load_eui_all_simulations_3)  # -> flatten(Result), PartialResults
hasdata_13 = DataExists(Data=ma_50.Result)
current_all_simulations_simple_energy_2 = RemoteReceiver(current_all_simulations_simple_energy)
filter_102 = StreamFilter(Gate=hasdata_13, Stream0="0", Stream1=ma_50.Result)
lng_47 = ListLength(List=filter_102)
larger_12 = LargerThan(FirstNumber=lng_47, SecondNumber="1")  # -> LargerThan, OrEqualTo
hasdata_14 = DataExists(Data=current_all_simulations_simple_energy_2)
hideshow_67 = HideShowElement(ElementToHideShow=tb_3, Show=hasdata_14, Collapse=True, Disable=False)
and_52 = GateAnd(A=simple_energy_data_exists_2, B=larger_12.LargerThan)

current_all_simulation_models_simple_ene_4 = RemoteReceiver(current_all_simulation_models_simple_ene)  # "current_all_simulation_models_simple_energy"
item_53 = ListItem(List=current_all_simulation_models_simple_ene_4, Index=current_selected_simulation_simple_energ_2, Wrap=invert(True))
current_selected_simulation_simple_energ_4 = RemoteSender(item_53)  # "current_selected_simulation_simple_energy_compare_title"

xdata = LBDeconstructData(data=bang_20.Branch6)  # -> header, values; plug-in component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

# ---- group: Analyse performance
xdata_2 = LBDeconstructData(data=bang_20.Branch2)  # -> header, values; plug-in component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
xdata_3 = LBDeconstructData(data=bang_20.Branch1)  # -> header, values; plug-in component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
xdata_4 = LBDeconstructData(data=bang_20.Branch3)  # -> header, values; plug-in component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
xdata_5 = LBDeconstructData(data=bang_20.Branch4)  # -> header, values; plug-in component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
xdata_6 = LBDeconstructData(data=bang_20.Branch5)  # -> header, values; plug-in component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
smaller_3 = SmallerThan(FirstNumber=xdata_4.values, SecondNumber="0")  # -> SmallerThan, OrEqualTo
smaller_4 = SmallerThan(FirstNumber=xdata_2.values, SecondNumber="0")  # -> SmallerThan, OrEqualTo
smaller_5 = SmallerThan(FirstNumber=xdata_3.values, SecondNumber="0")  # -> SmallerThan, OrEqualTo
smaller_6 = SmallerThan(FirstNumber=xdata_5.values, SecondNumber="0")  # -> SmallerThan, OrEqualTo
smaller_7 = SmallerThan(FirstNumber=xdata_6.values, SecondNumber="0")  # -> SmallerThan, OrEqualTo
sift = SiftPattern(List=xdata_4.values, SiftPattern=smaller_3.OrEqualTo)  # -> Output0, Output1
sift_2 = SiftPattern(List=xdata_3.values, SiftPattern=smaller_5.OrEqualTo)  # -> Output0, Output1
sift_3 = SiftPattern(List=xdata_2.values, SiftPattern=smaller_4.OrEqualTo)  # -> Output0, Output1
sift_4 = SiftPattern(List=xdata_5.values, SiftPattern=smaller_6.OrEqualTo)  # -> Output0, Output1
sift_5 = SiftPattern(List=xdata_6.values, SiftPattern=smaller_7.OrEqualTo)  # -> Output0, Output1
flip_2 = FlipMatrix(Data=sift_3.Output0)
flip_3 = FlipMatrix(Data=sift_3.Output1)
flip_4 = FlipMatrix(Data=sift.Output0)
flip_5 = FlipMatrix(Data=sift.Output1)
flip_6 = FlipMatrix(Data=sift_5.Output0)
flip_7 = FlipMatrix(Data=sift_5.Output1)
flip_8 = FlipMatrix(Data=sift_2.Output0)
flip_9 = FlipMatrix(Data=sift_2.Output1)
flip_10 = FlipMatrix(Data=sift_4.Output0)
flip_11 = FlipMatrix(Data=sift_4.Output1)
ma_51 = MassAddition(Input=flip_3)  # -> Result, PartialResults
ma_52 = MassAddition(Input=flip_5)  # -> Result, PartialResults
ma_53 = MassAddition(Input=flip_2)  # -> Result, PartialResults
ma_54 = MassAddition(Input=flip_7)  # -> Result, PartialResults
ma_55 = MassAddition(Input=flip_9)  # -> Result, PartialResults
ma_56 = MassAddition(Input=flip_4)  # -> Result, PartialResults
ma_57 = MassAddition(Input=flip_11)  # -> Result, PartialResults
ma_58 = MassAddition(Input=flip_6)  # -> Result, PartialResults
ma_59 = MassAddition(Input=flip_8)  # -> Result, PartialResults
ma_60 = MassAddition(Input=flip_10)  # -> Result, PartialResults
extremes = MinMax(Number=flatten(ma_53.Result))  # -> Minimum, Maximum
extremes_2 = MinMax(Number=flatten(ma_51.Result))  # -> Minimum, Maximum
extremes_3 = MinMax(Number=flatten(ma_56.Result))  # -> Minimum, Maximum
extremes_4 = MinMax(Number=flatten(ma_52.Result))  # -> Minimum, Maximum
extremes_5 = MinMax(Number=flatten(ma_58.Result))  # -> Minimum, Maximum
extremes_6 = MinMax(Number=flatten(ma_59.Result))  # -> Minimum, Maximum
extremes_7 = MinMax(Number=flatten(ma_54.Result))  # -> Minimum, Maximum
extremes_8 = MinMax(Number=flatten(ma_55.Result))  # -> Minimum, Maximum
extremes_9 = MinMax(Number=flatten(ma_60.Result))  # -> Minimum, Maximum
extremes_10 = MinMax(Number=flatten(ma_57.Result))  # -> Minimum, Maximum
cooling_balance_min = RemoteSender(extremes_10.Minimum)
cooling_balance_max = RemoteSender(extremes_9.Maximum)
heating_balance_min = RemoteSender(extremes_7.Minimum)
heating_balance_max = RemoteSender(extremes_5.Maximum)
daily_cooling_profile_min = RemoteSender(extremes_2.Minimum)
daily_heating_profile_min = RemoteSender(extremes_4.Minimum)
daily_cooling_profile_max = RemoteSender(extremes.Maximum)
daily_heating_profile_max = RemoteSender(extremes_3.Maximum)
annual_energy_balance_max = RemoteSender(extremes_6.Maximum)
annual_energy_balance_min = RemoteSender(extremes_8.Minimum)

# ----
data_37 = Data(bang_20.Branch4)
data_38 = Data(bang_20.Branch3)
data_39 = Data(bang_20.Branch5)
data_40 = Data(bang_20.Branch2)

# ----
# Detailed data from energy simulation
data_41 = Data(flatten(bang_20.Branch1))

# ---- group: Analysis module (continued)
hideshow_68 = HideShowElement(ElementToHideShow=stack_5, Show=and_52, Collapse=True, Disable=False)

# ---- group: Analyse performance (continued)
current_all_simulation_models_simple_ene_5 = RemoteReceiver(current_all_simulation_models_simple_ene)  # "current_all_simulation_models_simple_energy"
mindex_10 = MemberIndex(Set=current_all_simulation_models_simple_ene_5, Member=current_selected_model_analysis_module_n_9)  # -> flatten(Index), Count

# ----
item_54 = ListItem(List=mindex_10.Index, Index="-1", Wrap=True)

# ---- group: Analyse performance (continued)
item_55 = ListItem(List=current_all_simulation_models_simple_ene_5, Index=item_54, Wrap=True)
current_selected_simulation_simple_energ_5 = RemoteSender(item_55)  # "current_selected_simulation_simple_energy_title"

# ----
current_selected_simulation_simple_energ_6 = RemoteReceiver(current_selected_simulation_simple_energ_5)  # "current_selected_simulation_simple_energy_title"
current_selected_simulation_simple_energ_7 = RemoteReceiver(current_selected_simulation_simple_energ_5)  # "current_selected_simulation_simple_energy_title"
cluster_13 = Cluster_8(title="Heating balance", model=current_selected_simulation_simple_energ_6, data=data_39)
cluster_14 = Cluster_8(title="Cooling profile", model=current_selected_simulation_simple_energ_7, data=data_40)

current_all_simulations_simple_energy_3 = RemoteReceiver(current_all_simulations_simple_energy)
item_56 = ListItem(List=current_all_simulations_simple_energy_3, Index=gate_76.Target1, Wrap=invert(True))  # -> simplify(Item)
pshift_2 = ShiftPaths(Data=item_56, Offset=-1)
bang_22 = ExplodeTree(Data=pshift_2)  # -> Branch0, Branch1, Branch2, Branch3, Branch4, Branch5, Branch6

xdata_7 = LBDeconstructData(data=bang_22.Branch2)  # -> header, values; plug-in component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
xdata_8 = LBDeconstructData(data=bang_22.Branch1)  # -> header, values; plug-in component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
xdata_9 = LBDeconstructData(data=bang_22.Branch3)  # -> header, values; plug-in component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
xdata_10 = LBDeconstructData(data=bang_22.Branch4)  # -> header, values; plug-in component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
xdata_11 = LBDeconstructData(data=bang_22.Branch5)  # -> header, values; plug-in component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
smaller_8 = SmallerThan(FirstNumber=xdata_9.values, SecondNumber="0")  # -> SmallerThan, OrEqualTo
smaller_9 = SmallerThan(FirstNumber=xdata_7.values, SecondNumber="0")  # -> SmallerThan, OrEqualTo
smaller_10 = SmallerThan(FirstNumber=xdata_8.values, SecondNumber="0")  # -> SmallerThan, OrEqualTo
smaller_11 = SmallerThan(FirstNumber=xdata_10.values, SecondNumber="0")  # -> SmallerThan, OrEqualTo
smaller_12 = SmallerThan(FirstNumber=xdata_11.values, SecondNumber="0")  # -> SmallerThan, OrEqualTo
sift_6 = SiftPattern(List=xdata_9.values, SiftPattern=smaller_8.OrEqualTo)  # -> Output0, Output1
sift_7 = SiftPattern(List=xdata_8.values, SiftPattern=smaller_10.OrEqualTo)  # -> Output0, Output1
sift_8 = SiftPattern(List=xdata_7.values, SiftPattern=smaller_9.OrEqualTo)  # -> Output0, Output1
sift_9 = SiftPattern(List=xdata_10.values, SiftPattern=smaller_11.OrEqualTo)  # -> Output0, Output1
sift_10 = SiftPattern(List=xdata_11.values, SiftPattern=smaller_12.OrEqualTo)  # -> Output0, Output1
flip_12 = FlipMatrix(Data=sift_8.Output0)
flip_13 = FlipMatrix(Data=sift_8.Output1)
flip_14 = FlipMatrix(Data=sift_6.Output0)
flip_15 = FlipMatrix(Data=sift_6.Output1)
flip_16 = FlipMatrix(Data=sift_10.Output0)
flip_17 = FlipMatrix(Data=sift_10.Output1)
flip_18 = FlipMatrix(Data=sift_7.Output0)
flip_19 = FlipMatrix(Data=sift_7.Output1)
flip_20 = FlipMatrix(Data=sift_9.Output0)
flip_21 = FlipMatrix(Data=sift_9.Output1)
ma_61 = MassAddition(Input=flip_13)  # -> Result, PartialResults
ma_62 = MassAddition(Input=flip_15)  # -> Result, PartialResults
ma_63 = MassAddition(Input=flip_12)  # -> Result, PartialResults
ma_64 = MassAddition(Input=flip_17)  # -> Result, PartialResults
ma_65 = MassAddition(Input=flip_19)  # -> Result, PartialResults
ma_66 = MassAddition(Input=flip_14)  # -> Result, PartialResults
ma_67 = MassAddition(Input=flip_21)  # -> Result, PartialResults
ma_68 = MassAddition(Input=flip_16)  # -> Result, PartialResults
ma_69 = MassAddition(Input=flip_18)  # -> Result, PartialResults
ma_70 = MassAddition(Input=flip_20)  # -> Result, PartialResults
extremes_11 = MinMax(Number=flatten(ma_63.Result))  # -> Minimum, Maximum
extremes_12 = MinMax(Number=flatten(ma_61.Result))  # -> Minimum, Maximum
extremes_13 = MinMax(Number=flatten(ma_66.Result))  # -> Minimum, Maximum
extremes_14 = MinMax(Number=flatten(ma_62.Result))  # -> Minimum, Maximum
extremes_15 = MinMax(Number=flatten(ma_68.Result))  # -> Minimum, Maximum
extremes_16 = MinMax(Number=flatten(ma_69.Result))  # -> Minimum, Maximum
extremes_17 = MinMax(Number=flatten(ma_64.Result))  # -> Minimum, Maximum
extremes_18 = MinMax(Number=flatten(ma_65.Result))  # -> Minimum, Maximum
extremes_19 = MinMax(Number=flatten(ma_70.Result))  # -> Minimum, Maximum
extremes_20 = MinMax(Number=flatten(ma_67.Result))  # -> Minimum, Maximum
cooling_balance_min_compare = RemoteSender(extremes_20.Minimum)
cooling_balance_max_compare = RemoteSender(extremes_19.Maximum)
heating_balance_max_compare = RemoteSender(extremes_15.Maximum)
heating_balance_min_compare = RemoteSender(extremes_17.Minimum)
annual_energy_balance_max_compare = RemoteSender(extremes_16.Maximum)
daily_cooling_profile_min_compare = RemoteSender(extremes_12.Minimum)
daily_heating_profile_min_compare = RemoteSender(extremes_14.Minimum)
daily_cooling_profile_max_compare = RemoteSender(extremes_11.Maximum)
daily_heating_profile_max_compare = RemoteSender(extremes_13.Maximum)
annual_energy_balance_min_compare = RemoteSender(extremes_18.Minimum)

daily_cooling_profile_max_compare_2 = RemoteReceiver(daily_cooling_profile_max_compare)
daily_cooling_profile_min_compare_2 = RemoteReceiver(daily_cooling_profile_min_compare)
daily_heating_profile_max_compare_2 = RemoteReceiver(daily_heating_profile_max_compare)
daily_heating_profile_min_compare_2 = RemoteReceiver(daily_heating_profile_min_compare)
cooling_balance_max_compare_2 = RemoteReceiver(cooling_balance_max_compare)
cooling_balance_min_compare_2 = RemoteReceiver(cooling_balance_min_compare)
heating_balance_max_compare_2 = RemoteReceiver(heating_balance_max_compare)
heating_balance_min_compare_2 = RemoteReceiver(heating_balance_min_compare)
cluster_15 = Cluster_3(int=heating_balance_max_compare_2)
cluster_16 = Cluster_4(x=daily_cooling_profile_min_compare_2)
cluster_17 = Cluster_3(int=daily_cooling_profile_max_compare_2)
cluster_18 = Cluster_3(int=cooling_balance_max_compare_2)
cluster_19 = Cluster_4(x=heating_balance_min_compare_2)
cluster_20 = Cluster_4(x=cooling_balance_min_compare_2)
cluster_21 = Cluster_4(x=daily_heating_profile_min_compare_2)
cluster_22 = Cluster_3(int=daily_heating_profile_max_compare_2)
legendpar_5 = LBLegendParameters(min=cluster_19, max=cluster_15)  # -> leg_par; plug-in component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
cluster_23 = Cluster_2(min=cluster_20, max=cluster_18, colors=colrange_6)
cluster_24 = Cluster_2(min=cluster_21, max=cluster_22, colors=colrange_5)

annual_energy_balance_min_compare_2 = RemoteReceiver(annual_energy_balance_min_compare)
annual_energy_balance_max_compare_2 = RemoteReceiver(annual_energy_balance_max_compare)
cluster_25 = Cluster_4(x=annual_energy_balance_min_compare_2)
cluster_26 = Cluster_3(int=annual_energy_balance_max_compare_2)
data_42 = Data(bang_22.Branch2)
data_43 = Data(bang_22.Branch3)
data_44 = Data(bang_22.Branch4)
data_45 = Data(bang_22.Branch5)

# ---- group: Simple energy balance
current_selected_simulation_simple_energ_8 = RemoteReceiver(current_selected_simulation_simple_energ_4)  # "current_selected_simulation_simple_energy_compare_title"
colrange_7 = LBColorRange(index=Slider(19, range=0..100))  # -> colors; plug-in component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
simple_energy_simulation_base_point_comp_2 = RemoteReceiver(simple_energy_simulation_base_point_comp)  # "simple_energy_simulation_base_point_compare"
simple_energy_simulation_height_4 = RemoteReceiver(simple_energy_simulation_height)
simple_energy_simulation_width_3 = RemoteReceiver(simple_energy_simulation_width)
toggle_7 = BooleanToggle(True)

# ----
entwine_195 = Entwine(Branch00="Annual energy balance", Branch01=current_selected_simulation_simple_energ_8, FlattenInputs=True)  # -> flatten(Result)
entwine_196 = Entwine(Branch00="Energy intensity per end use", Branch01=current_selected_simulation_simple_energ_8, FlattenInputs=True)  # -> flatten(Result)
join_13 = TextJoin(Text=entwine_195, Join="Model: ")
join_14 = TextJoin(Text=entwine_196, Join="Model: ")

# ---- group: Simple peak loads
current_selected_simulation_simple_energ_9 = RemoteReceiver(current_selected_simulation_simple_energ_4)  # "current_selected_simulation_simple_energy_compare_title"
legendpar_6 = LBLegendParameters(min=cluster_16, max=cluster_17)  # -> leg_par; plug-in component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
simple_energy_simulation_width_4 = RemoteReceiver(simple_energy_simulation_width)
simple_energy_simulation_base_point_comp_3 = RemoteReceiver(simple_energy_simulation_base_point_comp)  # "simple_energy_simulation_base_point_compare"
simple_energy_simulation_base_point_comp_4 = RemoteReceiver(simple_energy_simulation_base_point_comp)  # "simple_energy_simulation_base_point_compare"
simple_energy_simulation_base_point_comp_5 = RemoteReceiver(simple_energy_simulation_base_point_comp)  # "simple_energy_simulation_base_point_compare"
simple_energy_simulation_base_point_comp_6 = RemoteReceiver(simple_energy_simulation_base_point_comp)  # "simple_energy_simulation_base_point_compare"
simple_energy_simulation_height_5 = RemoteReceiver(simple_energy_simulation_height)
simple_energy_simulation_height_6 = RemoteReceiver(simple_energy_simulation_height)
simple_energy_simulation_height_7 = RemoteReceiver(simple_energy_simulation_height)
simple_energy_simulation_height_8 = RemoteReceiver(simple_energy_simulation_height)
toggle_8 = BooleanToggle(True)
toggle_9 = BooleanToggle(True)
toggle_10 = BooleanToggle(True)
toggle_11 = BooleanToggle(True)

# ----
cluster_27 = Cluster_8(title="Cooling profile", model=current_selected_simulation_simple_energ_9, data=data_42)
cluster_28 = Cluster_8(title="Heating profile", model=current_selected_simulation_simple_energ_9, data=data_43)
cluster_29 = Cluster_8(title="Cooling balance", model=current_selected_simulation_simple_energ_9, data=data_44)
multiplication_9 = Multiplication(A=simple_energy_simulation_width_4, B=12)
cluster_30 = Cluster_8(title="Heating balance", model=current_selected_simulation_simple_energ_9, data=data_45)

# ---- group: Simple peak loads (continued)
monthlychart_2 = LBMonthlyChart(
    data=data_43,
    base_pt=simple_energy_simulation_base_point_comp_4,
    x_dim=multiplication_9,
    y_dim=simple_energy_simulation_height_6,
    stack=toggle_8,
    time_marks=toggle_8,
    global_title=cluster_28,
    legend_par=cluster_24)  # -> report, data_mesh, data_lines, col_lines, legend, borders, labels, y_title, title, vis_set; plug-in component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
monthlychart_3 = LBMonthlyChart(
    data=data_42,
    base_pt=simple_energy_simulation_base_point_comp_3,
    x_dim=multiplication_9,
    y_dim=simple_energy_simulation_height_5,
    stack=toggle_9,
    time_marks=toggle_9,
    global_title=cluster_27,
    legend_par=legendpar_6)  # -> report, data_mesh, data_lines, col_lines, legend, borders, labels, y_title, title, vis_set; plug-in component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
monthlychart_4 = LBMonthlyChart(
    data=data_44,
    base_pt=simple_energy_simulation_base_point_comp_5,
    x_dim=multiplication_9,
    y_dim=simple_energy_simulation_height_7,
    stack=toggle_10,
    time_marks=toggle_10,
    global_title=cluster_29,
    legend_par=cluster_23)  # -> report, data_mesh, data_lines, col_lines, legend, borders, labels, y_title, title, vis_set; plug-in component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
monthlychart_5 = LBMonthlyChart(
    data=data_45,
    base_pt=simple_energy_simulation_base_point_comp_6,
    x_dim=multiplication_9,
    y_dim=simple_energy_simulation_height_8,
    stack=toggle_11,
    time_marks=toggle_11,
    global_title=cluster_30,
    legend_par=legendpar_5)  # -> report, data_mesh, data_lines, col_lines, legend, borders, labels, y_title, title, vis_set; plug-in component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
daily_heating_profile = Data(flatten([monthlychart_2.data_mesh, monthlychart_2.data_lines, monthlychart_2.col_lines, monthlychart_2.legend, monthlychart_2.borders, monthlychart_2.labels, monthlychart_2.y_title, monthlychart_2.title]))
daily_cooling_profile = Data(flatten([monthlychart_3.data_mesh, monthlychart_3.data_lines, monthlychart_3.col_lines, monthlychart_3.legend, monthlychart_3.borders, monthlychart_3.labels, monthlychart_3.y_title, monthlychart_3.title]))
heating_balance_design_day = Data(flatten([monthlychart_5.data_mesh, monthlychart_5.data_lines, monthlychart_5.col_lines, monthlychart_5.legend, monthlychart_5.borders, monthlychart_5.labels, monthlychart_5.y_title, monthlychart_5.title]))
cooling_balance_design_day = Data(flatten([monthlychart_4.data_mesh, monthlychart_4.data_lines, monthlychart_4.col_lines, monthlychart_4.legend, monthlychart_4.borders, monthlychart_4.y_title, monthlychart_4.labels, monthlychart_4.title]))

# ----
daily_cooling_profile_2 = Data(flatten(daily_cooling_profile))
daily_cooling_profile_3 = Data(flatten(daily_heating_profile))
daily_cooling_profile_4 = Data(flatten(cooling_balance_design_day))
daily_cooling_profile_5 = Data(flatten(heating_balance_design_day))

# ---- group: Analyse performance (continued)
annual_energy_balance_max_2 = RemoteReceiver(annual_energy_balance_max)
annual_energy_balance_min_2 = RemoteReceiver(annual_energy_balance_min)
cooling_balance_max_2 = RemoteReceiver(cooling_balance_max)
cooling_balance_min_2 = RemoteReceiver(cooling_balance_min)
heating_balance_max_2 = RemoteReceiver(heating_balance_max)
heating_balance_min_2 = RemoteReceiver(heating_balance_min)
daily_heating_profile_max_2 = RemoteReceiver(daily_heating_profile_max)
daily_heating_profile_min_2 = RemoteReceiver(daily_heating_profile_min)
daily_cooling_profile_max_2 = RemoteReceiver(daily_cooling_profile_max)
daily_cooling_profile_min_2 = RemoteReceiver(daily_cooling_profile_min)
cluster_31 = Cluster_3(int=cooling_balance_max_2)
cluster_32 = Cluster_4(x=cooling_balance_min_2)
cluster_33 = Cluster_3(int=heating_balance_max_2)
cluster_34 = Cluster_4(x=heating_balance_min_2)
cluster_35 = Cluster_4(x=daily_cooling_profile_min_2)
cluster_36 = Cluster_3(int=daily_cooling_profile_max_2)
cluster_37 = Cluster_4(x=daily_heating_profile_min_2)
cluster_38 = Cluster_3(int=daily_heating_profile_max_2)
cluster_39 = Cluster_2(min=cluster_37, max=cluster_38, colors=colrange_4)
legendpar_7 = LBLegendParameters(min=cluster_34, max=cluster_33)  # -> leg_par; plug-in component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
cluster_40 = Cluster_2(min=cluster_32, max=cluster_31, colors=colrange_3)

# ----
cluster_41 = Cluster_4(x=annual_energy_balance_min_2)
cluster_42 = Cluster_3(int=annual_energy_balance_max_2)
max_2 = Maximum(A=cluster_26, B=cluster_42)
min_2 = Minimum(A=cluster_41, B=cluster_25)
null_53 = NullItem(Item=max_2)  # -> NullFlags, InvalidFlags, Description
null_54 = NullItem(Item=min_2)  # -> NullFlags, InvalidFlags, Description
filter_103 = StreamFilter(Gate=null_54.NullFlags, Stream0=min_2, Stream1=cluster_41)
filter_104 = StreamFilter(Gate=null_53.NullFlags, Stream0=max_2, Stream1=cluster_42)

# ---- group: Simple energy balance (continued)
legendpar_8 = LBLegendParameters(min=min_2, max=max_2, colors=colrange_7)  # -> leg_par; plug-in component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
monthlychart_6 = LBMonthlyChart(
    data=bang_22.Branch1,
    base_pt=simple_energy_simulation_base_point_comp_2,
    x_dim=simple_energy_simulation_width_3,
    y_dim=simple_energy_simulation_height_4,
    stack=toggle_7,
    global_title=join_13,
    legend_par=legendpar_8)  # -> report, data_mesh, data_lines, col_lines, legend, borders, labels, y_title, title, vis_set; plug-in component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
annual_energy_balance = Data(flatten([monthlychart_6.data_mesh, monthlychart_6.data_lines, monthlychart_6.col_lines, monthlychart_6.legend, monthlychart_6.borders, monthlychart_6.labels, monthlychart_6.y_title, monthlychart_6.title]))

# ----
legendpar_9 = LBLegendParameters(min=filter_103, max=filter_104, colors=colrange)  # -> leg_par; plug-in component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
monthlychart_7 = LBMonthlyChart(
    data=bang_22.Branch6,
    base_pt=simple_energy_simulation_base_point_comp_2,
    x_dim=simple_energy_simulation_width_3,
    y_dim=simple_energy_simulation_height_4,
    stack=toggle_7,
    global_title=join_14,
    legend_par=legendpar_9)  # -> report, data_mesh, data_lines, col_lines, legend, borders, labels, y_title, title, vis_set; plug-in component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
annual_energy_balance_2 = Data(flatten([monthlychart_7.data_mesh, monthlychart_7.data_lines, monthlychart_7.col_lines, monthlychart_7.legend, monthlychart_7.borders, monthlychart_7.labels, monthlychart_7.y_title, monthlychart_7.title]))
daily_cooling_profile_6 = Data(flatten(annual_energy_balance))
daily_cooling_profile_7 = Data(flatten(annual_energy_balance_2))

# ---- group: Analyse performance / Simple energy balance
colrange_8 = LBColorRange(index=Slider(19, range=0..100))  # -> colors; plug-in component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
current_selected_simulation_simple_energ_10 = RemoteReceiver(current_selected_simulation_simple_energ_5)  # "current_selected_simulation_simple_energy_title"
legendpar_10 = LBLegendParameters(min=filter_103, max=filter_104, colors=colrange_8)  # -> leg_par; plug-in component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
toggle_12 = BooleanToggle(True)

# ----
entwine_197 = Entwine(Branch00="Annual energy balance", Branch01=current_selected_simulation_simple_energ_10, FlattenInputs=True)  # -> flatten(Result)
entwine_198 = Entwine(Branch00="Energy intensity per end use", Branch01=current_selected_simulation_simple_energ_10, FlattenInputs=True)  # -> flatten(Result)
join_15 = TextJoin(Text=entwine_197, Join="Model: ")
join_16 = TextJoin(Text=entwine_198, Join="Model: ")

# ---- group: Analyse performance / Simple energy balance (continued)
monthlychart_8 = LBMonthlyChart(
    data=bang_20.Branch1,
    base_pt=simple_energy_simulation_base_point_2,
    x_dim=simple_energy_simulation_width_2,
    y_dim=simple_energy_simulation_height_3,
    stack=toggle_12,
    global_title=join_15,
    legend_par=legendpar_10)  # -> report, data_mesh, data_lines, col_lines, legend, borders, labels, y_title, title, vis_set; plug-in component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

# ----
monthlychart_9 = LBMonthlyChart(
    data=bang_20.Branch6,
    base_pt=simple_energy_simulation_base_point_2,
    x_dim=simple_energy_simulation_width_2,
    y_dim=simple_energy_simulation_height_3,
    stack=toggle_12,
    global_title=join_16,
    legend_par=legendpar_9)  # -> report, data_mesh, data_lines, col_lines, legend, borders, labels, y_title, title, vis_set; plug-in component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

# ---- group: Analyse performance (continued)
annual_energy_balance_3 = Data(flatten([monthlychart_8.data_mesh, monthlychart_8.data_lines, monthlychart_8.col_lines, monthlychart_8.legend, monthlychart_8.borders, monthlychart_8.labels, monthlychart_8.y_title, monthlychart_8.title]))

# ----
annual_energy_balance_4 = Data(flatten([monthlychart_9.data_mesh, monthlychart_9.data_lines, monthlychart_9.col_lines, monthlychart_9.legend, monthlychart_9.borders, monthlychart_9.labels, monthlychart_9.y_title, monthlychart_9.title]))
daily_cooling_profile_8 = Data(flatten(annual_energy_balance_4))
entwine_199 = Entwine(Branch00=daily_cooling_profile_7, Branch01=daily_cooling_profile_8, FlattenInputs=True)  # -> flatten(Result)

# ---- group: Analyse performance / Simple peak loads
legendpar_11 = LBLegendParameters(min=cluster_35, max=cluster_36)  # -> leg_par; plug-in component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
current_selected_simulation_simple_energ_11 = RemoteReceiver(current_selected_simulation_simple_energ_5)  # "current_selected_simulation_simple_energy_title"
current_selected_simulation_simple_energ_12 = RemoteReceiver(current_selected_simulation_simple_energ_5)  # "current_selected_simulation_simple_energy_title"
simple_energy_simulation_base_point_3 = RemoteReceiver(simple_energy_simulation_base_point)
simple_energy_simulation_base_point_4 = RemoteReceiver(simple_energy_simulation_base_point)
simple_energy_simulation_height_9 = RemoteReceiver(simple_energy_simulation_height)
simple_energy_simulation_width_5 = RemoteReceiver(simple_energy_simulation_width)
simple_energy_simulation_height_10 = RemoteReceiver(simple_energy_simulation_height)
simple_energy_simulation_width_6 = RemoteReceiver(simple_energy_simulation_width)
simple_energy_simulation_base_point_5 = RemoteReceiver(simple_energy_simulation_base_point)
simple_energy_simulation_base_point_6 = RemoteReceiver(simple_energy_simulation_base_point)
simple_energy_simulation_height_11 = RemoteReceiver(simple_energy_simulation_height)
simple_energy_simulation_width_7 = RemoteReceiver(simple_energy_simulation_width)
simple_energy_simulation_height_12 = RemoteReceiver(simple_energy_simulation_height)
simple_energy_simulation_width_8 = RemoteReceiver(simple_energy_simulation_width)
toggle_13 = BooleanToggle(True)
toggle_14 = BooleanToggle(True)
toggle_15 = BooleanToggle(True)
toggle_16 = BooleanToggle(True)

# ----
cluster_43 = Cluster_8(title="Heating profile", model=current_selected_simulation_simple_energ_11, data=data_38)
cluster_44 = Cluster_8(title="Cooling balance", model=current_selected_simulation_simple_energ_12, data=data_37)
multiplication_10 = Multiplication(A=simple_energy_simulation_width_5, B=12)
multiplication_11 = Multiplication(A=simple_energy_simulation_width_6, B=12)
multiplication_12 = Multiplication(A=simple_energy_simulation_width_8, B=12)
multiplication_13 = Multiplication(A=simple_energy_simulation_width_7, B=12)

# ---- group: Analyse performance / Simple peak loads (continued)
monthlychart_10 = LBMonthlyChart(
    data=data_38,
    base_pt=simple_energy_simulation_base_point_4,
    x_dim=multiplication_11,
    y_dim=simple_energy_simulation_height_10,
    stack=toggle_13,
    time_marks=toggle_13,
    global_title=cluster_43,
    legend_par=cluster_39)  # -> report, data_mesh, data_lines, col_lines, legend, borders, labels, y_title, title, vis_set; plug-in component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
monthlychart_11 = LBMonthlyChart(
    data=data_40,
    base_pt=simple_energy_simulation_base_point_3,
    x_dim=multiplication_10,
    y_dim=simple_energy_simulation_height_9,
    stack=toggle_14,
    time_marks=toggle_14,
    global_title=cluster_14,
    legend_par=legendpar_11)  # -> report, data_mesh, data_lines, col_lines, legend, borders, labels, y_title, title, vis_set; plug-in component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
monthlychart_12 = LBMonthlyChart(
    data=data_39,
    base_pt=simple_energy_simulation_base_point_5,
    x_dim=multiplication_13,
    y_dim=simple_energy_simulation_height_11,
    stack=toggle_15,
    time_marks=toggle_15,
    global_title=cluster_13,
    legend_par=legendpar_7)  # -> report, data_mesh, data_lines, col_lines, legend, borders, labels, y_title, title, vis_set; plug-in component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
monthlychart_13 = LBMonthlyChart(
    data=data_37,
    base_pt=simple_energy_simulation_base_point_6,
    x_dim=multiplication_12,
    y_dim=simple_energy_simulation_height_12,
    stack=toggle_16,
    time_marks=toggle_16,
    global_title=cluster_44,
    legend_par=cluster_40)  # -> report, data_mesh, data_lines, col_lines, legend, borders, labels, y_title, title, vis_set; plug-in component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
daily_heating_profile_2 = Data(flatten([monthlychart_10.data_mesh, monthlychart_10.data_lines, monthlychart_10.col_lines, monthlychart_10.legend, monthlychart_10.borders, monthlychart_10.labels, monthlychart_10.y_title, monthlychart_10.title]))
daily_cooling_profile_9 = Data(flatten([monthlychart_11.data_mesh, monthlychart_11.data_lines, monthlychart_11.col_lines, monthlychart_11.legend, monthlychart_11.borders, monthlychart_11.labels, monthlychart_11.y_title, monthlychart_11.title]))
heating_balance_design_day_2 = Data(flatten([monthlychart_12.data_mesh, monthlychart_12.data_lines, monthlychart_12.col_lines, monthlychart_12.legend, monthlychart_12.borders, monthlychart_12.labels, monthlychart_12.y_title, monthlychart_12.title]))
cooling_balance_design_day_2 = Data(flatten([monthlychart_13.data_mesh, monthlychart_13.data_lines, monthlychart_13.col_lines, monthlychart_13.legend, monthlychart_13.borders, monthlychart_13.y_title, monthlychart_13.labels, monthlychart_13.title]))

# ----
data_46 = Data(spatial_daylight_autonomy)
data_47 = Data(daylight_autonomy_2)
data_48 = Data(udi_2)
data_49 = Data(udi_50)
data_50 = Data(udi_3000)
data_51 = Data(illuminance_lux)
entwine_200 = Entwine(
    Branch00=data_46,
    Branch01=data_51,
    Branch02=data_47,
    Branch03=data_48,
    Branch04=data_49,
    Branch05=data_50,
    FlattenInputs=True)
current_model_name_6 = RemoteReceiver(current_model_name)
current_selected_model_analysis_module_n_10 = RemoteReceiver(current_selected_model_analysis_module_n)  # "current_selected_model_analysis_module_name"
daylight_simulation_type_4 = RemoteReceiver(daylight_simulation_type)
annualdaylight_message_error_3 = RemoteReceiver(annualdaylight_message_error)
pitgrid_message_error_3 = RemoteReceiver(pitgrid_message_error)
daylight_expander_is_open_4 = RemoteReceiver(daylight_expander_is_open)
lng_48 = ListLength(List=pitgrid_message_error_3)
lng_49 = ListLength(List=annualdaylight_message_error_3)
current_tab_30 = RemoteReceiver(current_tab)
or_34 = GateOr(A=lng_48, B=lng_49)
expression_93 = Expression(x=tab_simulate_14, y=current_tab_30, Expression="x=y")

null_55 = NullItem(Item=flatten(entwine_200))  # -> NullFlags, InvalidFlags, Description
py3_65 = Python3Script(x=entwine_200)  # -> out, a; inputs x: tree; same code as py3_57
item_57 = ListItem(List=null_55.NullFlags, Index=0, Wrap=True)
gate_77 = StreamGate(Stream=entwine_200, Gate=item_57)  # -> Target0, Target1
entwine_201 = Entwine(Branch0X=gate_77.Target0, Branch1X=current_model_name_6, FlattenInputs=False)

simple_energy_simulation_type_2 = RemoteReceiver(simple_energy_simulation_type)
daily_cooling_profile_10 = Data(flatten(annual_energy_balance_3))
daily_cooling_profile_11 = Data(flatten(daily_heating_profile_2))
daily_cooling_profile_12 = Data(flatten(daily_cooling_profile_9))
daily_cooling_profile_13 = Data(flatten(cooling_balance_design_day_2))
daily_cooling_profile_14 = Data(flatten(heating_balance_design_day_2))
data_52 = Data(flatten(bang_20.Branch0))
annualloads_message_error_3 = RemoteReceiver(annualloads_message_error)
ma_71 = MassAddition(Input=data_52)  # -> Result, PartialResults
peakloads_message_error_3 = RemoteReceiver(peakloads_message_error)
total_load_eui_2 = RemoteSender(ma_71.Result)
simple_energy_expander_is_open_2 = RemoteReceiver(simple_energy_expander_is_open)
bool_71 = Boolean(ma_71.Result)
current_tab_31 = RemoteReceiver(current_tab)
null_56 = NullItem(Item=bool_71)  # -> NullFlags, InvalidFlags, Description
filter_105 = StreamFilter(Gate=null_56.NullFlags, Stream0=bool_71, Stream1="False")
expression_94 = Expression(x=tab_simulate_13, y=current_tab_31, Expression="x=y")

entwine_202 = Entwine(Branch00=daily_cooling_profile_3, Branch01=daily_cooling_profile_11, FlattenInputs=True)  # -> flatten(Result)
entwine_203 = Entwine(Branch00=daily_cooling_profile_6, Branch01=daily_cooling_profile_10, FlattenInputs=True)  # -> flatten(Result)
entwine_204 = Entwine(Branch00=daily_cooling_profile_2, Branch01=daily_cooling_profile_12, FlattenInputs=True)  # -> flatten(Result)
entwine_205 = Entwine(Branch00=daily_cooling_profile_4, Branch01=daily_cooling_profile_13, FlattenInputs=True)  # -> flatten(Result)
entwine_206 = Entwine(Branch00=daily_cooling_profile_5, Branch01=daily_cooling_profile_14, FlattenInputs=True)  # -> flatten(Result)
lng_50 = ListLength(List=annualloads_message_error_3)
lng_51 = ListLength(List=peakloads_message_error_3)
and_53 = GateAnd(A=expression_94, B=simple_energy_data_exists_3, C=simple_energy_expander_is_open_2)

# ---- group: Analysis module (continued)
total_load_eui_3 = RemoteReceiver(total_load_eui_2)
ma_72 = MassAddition(Input=total_load_eui_3)  # -> Result, PartialResults
expression_95 = Expression(x=ma_72.Result, Expression="Round(x, 1)")
format_40 = Format(Format=panel_107, Culture=127, Data0=expression_95)
settextblock_17 = SetTextBlockContents(TextBlockToModify=tb_32, NewTextBlockContents=format_40)

# ----
total_load_eui_4 = RemoteReceiver(total_load_eui_2)
energy_use_intensity_kwh_m2 = Data(total_load_eui_4)
calculate_operational_emissions = BrimstoneCalculateOperationalEmissions(lca_data=get_lca_data.lca_data, eui=energy_use_intensity_kwh_m2, area=area_m2, mode=list_5)  # -> out, gwp_total; inputs lca_data: tree
# ---------- calculate_operational_emissions: Python ----------
"""Calculates operational emissions based on energy resource, EUI and floor area
    Inputs:
        lca_data: tree containing GWP information for the selected resource
        eui: energy use intensity of building in kWh/m2
        gfa: gross floor area of building
        mode: mode of GWP calculation ("typical" or "conservative")
        
    Output:
        gwp_total: total GWP for the selected space"""

import scriptcontext
import brimstone
reload(brimstone)
ghenv.Component.Message = brimstone.globals.version

ghenv.Component.Name = 'Brimstone - Calculate Operational Emissions'
ghenv.Component.NickName = 'Calculate Operational Emissions'

import rhinoscriptsyntax as rs
import ghpythonlib.treehelpers as th

from collections import OrderedDict

inv_unit_string = 'kWh'
gwp_unit_string = 'kg CO2 eq./kWh' # GWP

def main(lca_data, eui, area, mode):
    if not lca_data.BranchCount:
        brimstone.utils.warn(ghenv, "LCA data is missing")
        return
    if eui != 0 and not eui:
        brimstone.utils.warn(ghenv, "EUI is missing")
        return
    if area != 0 and not area:
        brimstone.utils.warn(ghenv, "Area is missing")
        return
    
    lca_data = th.tree_to_list(lca_data)
    lca_data = [OrderedDict(zip(l[0], l[1])) for l in lca_data]
    gwp_total =  []
    
    for resource_lca_data in lca_data:
        try:
            gwp_total.append(calculate_gwp_total(resource_lca_data, eui, area, mode))
        except KeyError as e:
            raise Exception("GWP value could not be calculated: {error}".format(error = e))
    
    return gwp_total
    
def calculate_gwp_total(lca_data, eui, area, mode):    
    inv_unit = lca_data["InventoryUnit"]
    
    if inv_unit != inv_unit_string:
        raise Exception("Wrong unit for calculation of operational energy")    
    
    gwp_unit = lca_data["GWPUnit"]
    if gwp_unit != gwp_unit_string:
        raise Exception("Wrong unit for GWP calculation")
    
    if mode == "conservative":
        gwp_a1_a3_str = "GWPA1A3Conservative"
    elif mode == "typical":
        gwp_a1_a3_str = "GWPA1A3Typical"
    else:
        raise Exception("Mode not recognised (must be conservative or typical)")
    
    gwp_impact = (
        float(lca_data[gwp_a1_a3_str])
    )
    
    gwp_total = (
        float(lca_data[gwp_a1_a3_str])
    ) * area * eui
        
    return gwp_total

if __name__ == "__main__":
    if not scriptcontext.sticky["brimstone_flying"]:
        raise Exception("The 'Brimstone - Fly' component needs to exist on the canvas")   
    gwp_total = main(lca_data, eui, area, mode)
    gwp_total = th.list_to_tree(gwp_total)
# ---------- end calculate_operational_emissions ----------
operational_gwp_total_kg_co2eq_year = Data(calculate_operational_emissions.gwp_total)
panel_273 = Panel(operational_gwp_total_kg_co2eq_year)
ma_73 = MassAddition(Input=calculate_operational_emissions.gwp_total)  # -> Result, PartialResults
lca_operational_gwp_total = RemoteSender(ma_73.Result)

lca_operational_gwp_total_2 = RemoteReceiver(lca_operational_gwp_total)
entwine_207 = Entwine(
    Branch00=lca_element_types_2,
    Branch01=lca_gwp_by_element_type_2,
    Branch02=lca_total_gwp_2,
    Branch03=lca_operational_gwp_total_2,
    FlattenInputs=True)  # -> flatten(Result)
hasdata_15 = DataExists(Data=entwine_207)
filter_106 = StreamFilter(Gate=hasdata_15, Stream0="False", Stream1=entwine_207)
lng_52 = ListLength(List=filter_106)
and_54 = GateAnd(A=honeybee_model_exists_10, B=lng_52)
and_55 = GateAnd(A=invert(lng_39), B=and_54)
lca_data_exists = RemoteSender(and_55)

lca_operational_gwp_total_3 = RemoteReceiver(lca_operational_gwp_total)

nullrep_2 = ReplaceNulls(Items=lca_operational_gwp_total_3, Replacements=int)  # -> Items, Count

entwine_208 = Entwine(
    Branch00=current_selected_model_analysis_module_n_7,
    Branch01=lca_gwp_by_element_type_3,
    Branch02=nullrep_2.Items,
    Branch03=ma_44.Result,
    FlattenInputs=True)  # -> flatten(Result)
panel_274 = Panel(entwine_208)
save_lca = Python3Script(elements=entwine_185, data=entwine_208, save=post_calculate_lca_2)  # -> out, file_path, saved; inputs elements: list of String, data: list
# ---------- save_lca: Python ----------
import csv
import os

import ghpythonlib.treehelpers as th

from Rhino import RhinoDoc

folder_path = ("\\").join(ghdoc.Path.split("\\")[:-1])
rhino_file_name = (RhinoDoc.ActiveDoc.Path).split("\\")[-1][:-4]
full_path = folder_path + "\\heath_data\\" + rhino_file_name + "\\" + rhino_file_name + "_LCA.csv"

try:
    os.mkdir(("\\").join(full_path.split("\\")[:-2]))
    os.mkdir(("\\").join(full_path.split("\\")[:-1]))
    os.mkdir(full_path)
except FileExistsError:
    # directory already exists
    pass

file_path = full_path


# Ensure file path and data are provided
if file_path and data and save:
    try:
        # Ensure the directory exists
        directory = os.path.dirname(file_path)
        if not os.path.exists(directory):
            os.makedirs(directory)  # Create directory if it doesn't exist

        file_exists = os.path.isfile(file_path)
        existing_models = set()
        rows = []

        if file_exists:
            with open(file_path, 'r', newline='', encoding='utf-8') as csv_file:
                reader = csv.reader(csv_file)
                header = next(reader, None)
                for row in reader:
                    if row:
                        existing_models.add(row[0])
                        rows.append(row)
        else:
            header = elements

        # keeps track of the existing header vs the incoming elements
        column_dict = {element: elements.index(element) for element in header}
        new_row = [data[column_dict[element]] for element in header]

        if data[0] in existing_models:
            # replace existing row
            rows = [new_row if row[0] == data[0] else row for row in rows]
        else:
            # append new row
            rows.append(new_row)

        with open(file_path, 'w', newline='', encoding='utf-8') as csv_file:
            writer = csv.writer(csv_file)
            writer.writerow(header)
            writer.writerows(rows)
        saved = True

        print(f"File successfully created/appended at: {file_path}")
    except Exception as e:
        raise e
        print(f"Error: {str(e)}")
else:
    pass
    # print("Provide a valid file path and data.")
# ---------- end save_lca ----------
panel_275 = Panel(save_lca.file_path)
py3_66 = Python3Script(
    rename=pre_rename_current_model_2,
    model_name=current_model_name_2,
    new_model_name=rename_current_model_name_3,
    csv_file_path=save_lca.file_path)  # -> out, a
# ---------- py3_66: Python ----------
import os
import csv

name_col = "Model name"
if rename and os.path.exists(csv_file_path):
    new_rows = []
    with open(csv_file_path, 'r', newline='') as csv_file:
        reader = csv.DictReader(csv_file)
        renamed_rows = list(reader)
        fieldnames = reader.fieldnames        
    
    for row in renamed_rows:
        if row[name_col] == model_name:
            row[name_col] = new_model_name

    with open(csv_file_path, 'w', newline ="") as csv_file:
        writer = csv.DictWriter(csv_file, fieldnames = reader.fieldnames)
        writer.writeheader()
        writer.writerows(renamed_rows)

    print(f"Successfully renamed {model_name} to {new_model_name} in {csv_file_path} csv")
# ---------- end py3_66 ----------
py3_67 = Python3Script(remove=pre_remove_current_model_2, model_name=current_model_name_3, csv_file_path=save_lca.file_path)  # -> out, a
# ---------- py3_67: Python ----------
import os
import csv

name_col = "Model name"
if remove and os.path.exists(csv_file_path):
    with open(csv_file_path, 'r', newline='') as csv_file:
        reader = csv.DictReader(csv_file)
        filtered_rows = [row for row in reader if row[name_col] != model_name]
    with open(csv_file_path, 'w', newline ="") as csv_file:
        writer = csv.DictWriter(csv_file, fieldnames = reader.fieldnames)
        writer.writeheader()
        writer.writerows(filtered_rows)

    print(f"Successfully removed {model_name} from {csv_file_path} csv")
# ---------- end py3_67 ----------
freeze_gate_72 = StreamFreezeGate(Data=save_lca.file_path, PassingSwitch=save_lca.saved)

panel_276 = Panel(save_lca.out)

load_lca = Python3Script(file_path=freeze_gate_72)  # -> error, a
# ---------- load_lca: Python ----------
import csv
import ghpythonlib.treehelpers as th

# Initialize output list
output_data = []

error = False
# Ensure the file path is provided
if file_path:
    try:
        # Open and read the CSV file
        with open(file_path, 'r', encoding='utf-8') as csv_file:
            reader = csv.reader(csv_file)
            for row in reader:
                output_data.append(row)  # Append each row as a list
                
        a = output_data  # Output data to Grasshopper
        a = th.list_to_tree(a)
    except Exception as e:
        error = True
        a = [f"Error: {str(e)}"]
else:
    a = ["Please provide a valid file path."]
# ---------- end load_lca ----------
split_14 = SplitList(List=load_lca.a, Index="1")  # -> flatten(ListA), ListB
split_15 = SplitList(List=split_14.ListB, Index="5")  # -> ListA, flatten(ListB)
split_16 = SplitTree(Data=split_15.ListA, Masks=flatten("{0;0;0;0}"))  # -> Positive, Negative
cull_i_6 = CullIndex(List=split_14.ListA, Indices="0", Wrap=invert(True))
cset_9 = CreateSet(List=cull_i_6)  # -> Set, Map
cull_35 = CullPattern(List=split_16.Negative, CullPattern=graft(values_30.Values))  # -> flatten(List)
cull_36 = CullPattern(List=cset_9.Set, CullPattern=values_30.Values)
setchecklist_2 = SetChecklistContents(ChecklistToModify=checklist_2, NewChecklistContents=cset_9.Set, Selected="True")

panel_277 = Panel(load_lca.a)
bool_72 = Boolean(invert(load_lca.error))
visualize_lca_is_possible = RemoteSender(bool_72)
cull_i_7 = CullIndex(List=split_15.ListB, Indices="0", Wrap=True)
visualize_lca_is_possible_2 = RemoteReceiver(visualize_lca_is_possible)

entwine_209 = Entwine(
    Branch00=nextfile_2,
    Branch01=cull_36,
    Branch02=split_16.Positive,
    Branch03=cull_35,
    Branch04=cull_i_7,
    Branch05=fragment_2,
    FlattenInputs=True)
freeze_gate_73 = StreamFreezeGate(Data=entwine_209, PassingSwitch=or_8)
bang_23 = ExplodeTree(Data=freeze_gate_73)  # -> Branch0, Branch1, Branch2, Branch3, Branch4, Branch5

lng_53 = ListLength(List=flatten(bang_23.Branch2))
partition_2 = PartitionList(List=flatten(bang_23.Branch3), Size=lng_53)
py3_68 = Python3Script(
    file_location=bang_23.Branch0,
    y_label=filter_7,
    title=filter_8,
    labels=bang_23.Branch1,
    elements=bang_23.Branch2,
    values=partition_2,
    GFA=bang_23.Branch4,
    colors=bang_23.Branch5,
    perGFA=bool_3,
    img_width=bar_chart_img_width_2,
    img_height=bar_chart_img_height_2)  # -> out, file_location_out; inputs labels: list, elements: list, values: tree of Double, GFA: list of Double, colors: list
# ---------- py3_68: Python ----------
# requirements: matplotlib
# requirements: numpy
title
import matplotlib.pyplot as plt
import numpy as np
import os
import ghpythonlib.treehelpers as th

if not os.path.exists(file_location):
    seperatedLabels = []
    for label in labels:
        if '(' in label:
            seperatedLabels.append(('\n(').join(label.split('(')))
        else:
            seperatedLabels.append(label)
    
    colors = colors[:len(elements)]
    for i in range(len(colors)):
        colors[i] = colors[i].split(',')
        colors[i] = tuple([float(j) for j in colors[i]])
    
    values_list = th.tree_to_list(values)
    if perGFA:
        for i in range(len(values_list)):
            for j in range(len(values_list[i])):
                values_list[i][j] = values_list[i][j]/GFA[i]

    px = 1/plt.rcParams['figure.dpi']  # pixel in inches
    fig, ax = plt.subplots(figsize=(img_width*px, img_height*px))

    # Add the stacked bars
    bottom = np.zeros(len(values_list))
    bar_width = 0.25
    for i in range(len(values_list)):
        for j in range(len(values_list[i])):
            print(values_list[i][j],seperatedLabels[i], colors[j])
            ax.bar(seperatedLabels[i], values_list[i][j], color=colors[j], 
             bottom=bottom[i], align='center', width=bar_width, zorder=2)
            
            if values_list[i][j] > 0:
                ax.text(i, bottom[i] + values_list[i][j] / 2, f"{int(values_list[i][j])}",
                ha='center', va='center', fontsize=10, color='black', zorder=3)
            
            bottom[i] += values_list[i][j]
    
    y_range = max(bottom)*1.1
    interval = 10 ** (np.floor(np.log10(y_range)) - 1)  # Base interval as a power of 10
    while y_range / interval > 10:  # Adjust interval if too many ticks
        interval *= 2
    while y_range / interval < 5:  # Adjust interval if too few ticks
        interval /= 2

    # Ensure interval is a clean power of 10 or multiple thereof
    interval = round(interval, -int(np.floor(np.log10(interval))))

    # Set y-axis limits
    ax.set_ylim(0, y_range)

    # Generate tick positions
    yticks = list(range(0, int(y_range) + 1, int(interval)))

    # Add horizontal lines
    for y in yticks:
        ax.axhline(y=y, color='gray', linestyle='--', linewidth=0.4, zorder=1)

    # Set yticks to match the lines
    ax.set_yticks(yticks)

    ax.set_title(title)
    ax.set_ylabel(y_label)
    ax.set_xticks(range(len(seperatedLabels)))
    ax.set_xticklabels(seperatedLabels, rotation=35, ha='right', rotation_mode='anchor')
    
    plt.subplots_adjust(right=0.65)

    # Create the legend
    patches = [plt.Rectangle((0, 0), 1, 1, color=color) for color in colors[:len(elements)]]
    ax.legend(patches, elements, title="Elements", bbox_to_anchor=(1.0, 1), loc='upper left', reverse=True)

    plt.tight_layout()
    plt.savefig(file_location)
    file_location_out = file_location

    #plt.show()
# ---------- end py3_68 ----------

setimg_3 = SetImage(ImageToModify=image, NewImagePath=py3_68.file_location_out)

# ---- group: Analysis module (continued)
lca_operational_gwp_total_4 = RemoteReceiver(lca_operational_gwp_total)
lca_operational_gwp_total_5 = RemoteReceiver(lca_operational_gwp_total)
lca_operational_gwp_total_6 = RemoteReceiver(lca_operational_gwp_total)
division_16 = Division(A=lca_operational_gwp_total_4, B=lca_total_gfa_4)
multiplication_14 = Multiplication(A="50", B=lca_operational_gwp_total_5)
expression_96 = Expression(x=division_16, Expression="Round(x, 1)")
expression_97 = Expression(x=lca_operational_gwp_total_6, Expression="Round(x, 1)")
expression_98 = Expression(x=multiplication_14, Expression="Round(x, 1)")
format_41 = Format(Format=panel_110, Culture=127, Data0=expression_96)
format_42 = Format(Format=panel_111, Culture=127, Data0=expression_97)
format_43 = Format(Format=panel_112, Culture=127, Data0="50", Data1=expression_98)
setlabel_8 = SetLabelContents(LabelToModify=label_45, NewLabelContents=format_41)
setlabel_9 = SetLabelContents(LabelToModify=label_46, NewLabelContents=format_42)
setlabel_10 = SetLabelContents(LabelToModify=label_47, NewLabelContents=format_43)
lca_data_exists_2 = RemoteReceiver(lca_data_exists)
and_56 = GateAnd(A=lca_data_exists_2, B=simple_energy_data_exists_10)
hideshow_69 = HideShowElement(ElementToHideShow=true_button_25, Show=True, Collapse=True, Disable=invert(visualize_lca_is_possible_2))
hideshow_70 = HideShowElement(ElementToHideShow=[label_46, label_47, label_45], Show=and_56, Collapse=True, Disable=False)
hideshow_71 = HideShowElement(ElementToHideShow=[label_44, true_button_25, label_42], Show=lca_data_exists_2, Collapse=True, Disable=False)

# ----
filter_107 = StreamFilter(
    Gate=simple_energy_simulation_type_2,
    Stream0=entwine_203,
    Stream1=entwine_204,
    Stream2=entwine_202,
    Stream3=entwine_205,
    Stream4=entwine_206,
    Stream5=entwine_199)
sortbytype = SortObjectsByType(RhinoObjects=filter_107)  # -> Points, Curves, Surfaces, Breps, Meshes, TextObjects, HatchObjects, LightObjects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
or_35 = GateOr(A=lng_50, B=lng_51)
line = Line(sortbytype.Curves)
null_57 = NullItem(Item=line)  # -> NullFlags, InvalidFlags, Description
data_53 = Data([sortbytype.Other, sortbytype.Meshes])
bbox_6 = BoundingBox(Content=sortbytype.Meshes, Plane=PlaneXY(0, 0, 0), UnionBox=True)  # -> Box, Box_2
sift_11 = SiftPattern(List=sortbytype.Curves, SiftPattern=null_57.NullFlags)  # -> Output0, Output1
gate_78 = StreamGate(Stream=sift_11.Output1, Gate=and_53)  # -> Target0, Target1
gate_79 = StreamGate(Stream=data_53, Gate=and_53)  # -> Target0, Target1
gate_80 = StreamGate(Stream=bbox_6.Box, Gate=and_53)  # -> Target0, Target1
clean_16 = CleanTree(RemoveNulls=True, RemoveInvalid=True, RemoveEmpty=False, Tree=gate_79.Target1)
data_54 = Data(gate_79.Target1)
zoom_simple_energy_simulation_bounding_b = RemoteSender(gate_80.Target1)  # "zoom_simple_energy_simulation_bounding_box"
indices_3 = ListIndices(Data=gate_79.Target1)
index_5 = ItemIndex(List=gate_79.Target1, Item=clean_16)
preview_26 = CustomPreview(Geometry=gate_78.Target1, Material=ColourSwatch(SwatchColor=RGB(84, 84, 84)))
exdiff_3 = SetDifferenceS(SetA=indices_3, SetB=index_5)
item_58 = ListItem(List=gate_79.Target1, Index=exdiff_3, Wrap=True)

and_57 = GateAnd(A=invert(or_35), B=filter_105)
alignvert_3 = AlignVertices(Mesh=item_58, Tolerance=0.01)  # -> Result, Count

clean_17 = CleanTree(RemoveNulls=True, RemoveInvalid=True, RemoveEmpty=False, Tree=alignvert_3.Result)

# ----
# Bake simple energy simulation
panel_278 = Panel("""Heath::Energy simulation::Annual energy balance
Heath::Energy simulation::Daily cooling profile
Heath::Energy simulation::Daily heating profile
Heath::Energy simulation::Cooling balance
Heath::Energy simulation::Heating balance""")
merge_38 = Merge(Data1=clean_16, Data2=clean_17)
simple_energy_simulation_type_3 = RemoteReceiver(simple_energy_simulation_type)
bake_simple_energy_simulation_2 = RemoteReceiver(bake_simple_energy_simulation)
simple_energy_simulation_annual_energy_b = Data(merge_38)  # "simple_energy_simulation_Annual_energy_balance"
item_59 = ListItem(List=panel_278, Index=simple_energy_simulation_type_3, Wrap=invert(True))
gate_81 = StreamGate(Stream=item_59, Gate=bake_simple_energy_simulation_2)  # -> Target0, Target1
layers_4 = CreateModifyLayers(LayerName=gate_81.Target1, DeleteLayer=False, enableFullPath=True)  # -> LayerNames, LayerFullPath
createatts_4 = CreateAttributes(LayerName=layers_4.LayerFullPath, enableFullPath=True)
connected_5 = GetConnectedObjects(Objects=simple_energy_simulation_annual_energy_b)
bake_5 = BakeObject(Objects=connected_5, ObjectAttributes=createatts_4, Bake=bake_simple_energy_simulation_2)

# ----
# Zoom simple energy
zoom_simple_energy_simulation_bounding_b_2 = RemoteReceiver(zoom_simple_energy_simulation_bounding_b)  # "zoom_simple_energy_simulation_bounding_box"
zoom_simple_energy_simulation_2 = RemoteReceiver(zoom_simple_energy_simulation)
zbb_5 = ZoomBoundingBox(Box=zoom_simple_energy_simulation_bounding_b_2, Run=zoom_simple_energy_simulation_2)
panel_279 = Panel(zoom_simple_energy_simulation_2)

panel_280 = Panel(createatts_4)

freeze_gate_74 = StreamFreezeGate(Data=entwine_201, PassingSwitch=run_daylight_simulations_3, Freeze=True, Hold=False)
split_17 = SplitTree(Data=freeze_gate_74, Masks=flatten("{1;*}"))  # -> Positive, Negative

py3_69 = Python3Script(data=graft(split_17.Negative), enable=and_51, reset=button_11, t=py3_65.a)  # -> out, a; inputs data: tree; same code as py3_58
py3_70 = Python3Script(data=graft(split_17.Positive), enable=and_51, reset=button_11, t=py3_65.a)  # -> out, a; inputs data: tree
# ---------- py3_70: Python ----------
""" this component replaces Data recorder """
""" There was an issue where data was stored even after reset,
    possibly because of telepathy components downstream.
    this seems to work! """

from Grasshopper import DataTree
guid = str(ghenv.Component.InstanceGuid) + str(ghdoc.Path)
guid_t = str(ghenv.Component.InstanceGuid) + str(t)
from scriptcontext import sticky

empty_value = "Recorder has been initiated/reset."

if reset:
    sticky[guid] = empty_value

if enable:
    if guid not in sticky: sticky[guid] = empty_value
    
    if sticky[guid] == empty_value:
        sticky[guid] = DataTree[object]()
    
    if guid_t in sticky:
        pass
    else:
        sticky[guid_t] = True
        sticky[guid].MergeTree(data)
print(sticky[guid_t], sticky[guid])
if sticky[guid] != empty_value:
    a = sticky[guid]
else:
    a = None
# ---------- end py3_70 ----------

panel_281 = Panel(py3_69.a)
py3_71 = Python3Script(all_simulated_models=py3_70.a, model_dictionary=model_name_dictionary_4)  # -> out, simulated_models_renamed; inputs all_simulated_models: list, model_dictionary: list; same code as py3_60
py3_72 = Python3Script(
    all_simulated_models=py3_71.simulated_models_renamed,
    existing_models=current_all_created_models_names_7,
    all_simulation_data=py3_69.a)  # -> out, filtered_simulated_models, filtered_simulation_data_pattern; inputs all_simulated_models: list, existing_models: list, all_simulation_data: tree; same code as py3_61
data_55 = Data(py3_72.filtered_simulated_models)
cull_37 = CullPattern(List=py3_69.a, CullPattern=py3_72.filtered_simulation_data_pattern)
current_all_simulation_models_daylight = RemoteSender(data_55)

current_all_simulation_models_daylight_2 = RemoteReceiver(current_all_simulation_models_daylight)
cset_10 = CreateSet(List=current_all_simulation_models_daylight_2)  # -> Set, Map
cull_38 = CullPattern(List=cset_10.Set, CullPattern=values_32.Values)
mindex_11 = MemberIndex(Set=current_all_simulation_models_daylight_2, Member=graft(cull_38))  # -> Index, Count
item_60 = ListItem(List=mindex_11.Index, Index="-1", Wrap=True)  # -> flatten(Item)
setchecklist_3 = SetChecklistContents(ChecklistToModify=checklist_3, NewChecklistContents=cset_10.Set, Selected="True")

# ---- group: Analysis module (continued)
current_all_simulation_models_daylight_3 = RemoteReceiver(current_all_simulation_models_daylight)
entwine_210 = Entwine(Branch00="None", Branch01=current_all_simulation_models_daylight_3, FlattenInputs=True)  # -> flatten(Result)
setlist_8 = SetListContents(ListToModify=pulldown_20, NewListContents=entwine_210, SelectedIndex="0")

# ----
mindex_12 = MemberIndex(Set=data_55, Member=current_selected_model_analysis_module_n_10)  # -> flatten(Index), Count
split_18 = SplitTree(Data=cull_37, Masks=flatten("{0;0;0;*}"))  # -> Positive, Negative
null_58 = NullItem(Item=mindex_12.Count)  # -> NullFlags, InvalidFlags, Description
flip_22 = FlipMatrix(Data=split_18.Positive)
item_61 = ListItem(List=mindex_12.Index, Index="-1", Wrap=True)
ma_74 = MassAddition(Input=flip_22)  # -> flatten(Result), PartialResults
item_62 = ListItem(List=simplify(cull_37), Index=item_61, Wrap=invert(True))
current_all_simulations_daylight = RemoteSender(py3_69.a)
spatialdaylightautonomy_all_simulations = RemoteSender(ma_74.Result)
pshift_3 = ShiftPaths(Data=item_62, Offset=-1)
filter_108 = StreamFilter(Gate=null_58.NullFlags, Stream0=mindex_12.Count, Stream1="False")
bang_24 = ExplodeTree(Data=pshift_3)  # -> Branch0, Branch1, Branch2, Branch3, Branch4, Branch5
daylight_data_exists_2 = RemoteSender(filter_108)
data_56 = Data(bang_24.Branch1)
data_57 = Data(bang_24.Branch2)
data_58 = Data(bang_24.Branch3)
data_59 = Data(bang_24.Branch4)
data_60 = Data(bang_24.Branch0)
data_61 = Data(bang_24.Branch5)
filter_109 = StreamFilter(Gate=daylight_simulation_type_4, Stream0=data_56, Stream1=data_57, Stream2=data_58, Stream3=data_59, Stream4=data_61)
spatialdaylightautonomy_current = RemoteSender(data_60)
spatialdaylightautonomy_current_2 = RemoteReceiver(spatialdaylightautonomy_current)
null_59 = NullItem(Item=spatialdaylightautonomy_current_2)  # -> NullFlags, InvalidFlags, Description
bool_73 = Boolean(invert(null_59.NullFlags))
and_58 = GateAnd(A=expression_93, B=daylight_expander_is_open_4, C=bool_73)
and_59 = GateAnd(A=bool_73, B=invert(or_34))
data_62 = Data(filter_109)

# ---- group: Analysis module (continued)
spatialdaylightautonomy_current_3 = RemoteReceiver(spatialdaylightautonomy_current)
expression_99 = Expression(x=spatialdaylightautonomy_current_3, Expression="Round(x*100, 1)")
daylight_data_exists_3 = RemoteReceiver([daylight_data_exists_2, daylight_data_exists])
spatialdaylightautonomy_all_simulations_2 = RemoteReceiver(spatialdaylightautonomy_all_simulations)
format_44 = Format(Format=panel_106, Culture=127, Data0=expression_99)
daylight_data_exists_4 = RemoteReceiver([daylight_data_exists_2, daylight_data_exists])
or_36 = GateOr(A=daylight_data_exists_3, B=filter_16)
rec_58 = DataRecorder(or_36, DataLimit=-10, RecordData=True)
settextblock_18 = SetTextBlockContents(TextBlockToModify=tb_30, NewTextBlockContents=format_44)
hideshow_72 = HideShowElement(ElementToHideShow=button_31, Show=daylight_data_exists_4, Collapse=True, Disable=False)
ma_75 = MassAddition(Input=flatten(rec_58))  # -> Result, PartialResults
daylight_data_exists_5 = RemoteReceiver([daylight_data_exists_2, daylight_data_exists])
hasdata_16 = DataExists(Data=spatialdaylightautonomy_all_simulations_2)
mod_17 = Modulus(A=ma_75.Result, B=Slider(2, range=0..10))
filter_110 = StreamFilter(Gate=hasdata_16, Stream0="0", Stream1=spatialdaylightautonomy_all_simulations_2)
daylight_data_exists_6 = RemoteReceiver([daylight_data_exists_2, daylight_data_exists])
daylight_data_exists_7 = RemoteReceiver([daylight_data_exists_2, daylight_data_exists])
hideshow_73 = HideShowElement(ElementToHideShow=[pulldown_22, label_41], Show=daylight_data_exists_5, Collapse=True, Disable=False)
bool_74 = Boolean(mod_17)
lng_54 = ListLength(List=filter_110)
filter_111 = StreamFilter(Gate=bool_74, Stream0="Simulation failed...", Stream1="Daylight simulation is running...")
hideshow_74 = HideShowElement(ElementToHideShow=tb_30, Show=daylight_data_exists_6, Collapse=True, Disable=False)
bool_75 = Boolean(invert(daylight_data_exists_7))
larger_13 = LargerThan(FirstNumber=lng_54, SecondNumber="1")  # -> LargerThan, OrEqualTo
gate_82 = StreamGate(Stream=filter_111, Gate=freeze_gate_17)  # -> Target0, Target1
daylight_data_exists_8 = RemoteReceiver([daylight_data_exists_2, daylight_data_exists])
hideshow_75 = HideShowElement(ElementToHideShow=tb_29, Show=bool_75, Collapse=daylight_data_exists_7, Disable=False)
and_60 = GateAnd(A=daylight_data_exists_8, B=larger_13.LargerThan)
hideshow_76 = HideShowElement(ElementToHideShow=stack_49, Show=and_60, Collapse=True, Disable=False)

# ----
daylight_data_exists_9 = RemoteReceiver([daylight_data_exists_2, daylight_data_exists])
hideshow_77 = HideShowElement(ElementToHideShow=button_7, Show=daylight_data_exists_9, Collapse=True, Disable=False)
current_all_simulations_daylight_2 = RemoteReceiver(current_all_simulations_daylight)
hasdata_17 = DataExists(Data=current_all_simulations_daylight_2)
hideshow_78 = HideShowElement(ElementToHideShow=tb_2, Show=hasdata_17, Collapse=True, Disable=False)

spatialdaylightautonomy_all_simulations_3 = RemoteReceiver(spatialdaylightautonomy_all_simulations)
num_11 = Number(spatialdaylightautonomy_all_simulations_3)
expression_100 = Expression(x=num_11, Expression="Round(x, 2)")
item_63 = ListItem(List=expression_100, Index=item_60, Wrap=invert(True))
entwine_211 = Entwine(
    Branch00=nextfile_3,
    Branch01=panel_57,
    Branch02=panel_57,
    Branch03=cull_38,
    Branch04=item_63,
    Branch05=fragment_3,
    FlattenInputs=True)
freeze_gate_75 = StreamFreezeGate(Data=entwine_211, PassingSwitch=and_7)
bang_25 = ExplodeTree(Data=freeze_gate_75)  # -> Branch0, Branch1, Branch2, Branch3, Branch4, Branch5

multiplication_15 = Multiplication(A=bang_25.Branch4, B=Slider(100, range=0..100))

py3_73 = Python3Script(
    file_location=bang_25.Branch0,
    y_label=bang_25.Branch1,
    title=bang_25.Branch2,
    labels=bang_25.Branch3,
    values=multiplication_15,
    colors=bang_25.Branch5,
    img_width=bar_chart_img_width_4,
    img_height=bar_chart_img_height_4)  # -> file_location_out; inputs labels: list, values: list, colors: list
# ---------- py3_73: Python ----------
# requirements: matplotlib
# requirements: numpy

import matplotlib.pyplot as plt
import numpy as np

if file_location:
    seperatedLabels = []
    for label in labels:
        if '(' in label:
            seperatedLabels.append(('\n(').join(label.split('(')))
        else:
            seperatedLabels.append(label)

    for i in range(len(colors)):
        colors[i] = colors[i].split(',')
        colors[i] = tuple([float(j) for j in colors[i]])

    px = 1/plt.rcParams['figure.dpi']  # pixel in inches
    fig, ax = plt.subplots(figsize=(img_width*px, img_height*px))
    ax.bar(seperatedLabels, values, label=seperatedLabels, color=colors, align="center")

    ax.set_ylim(0, max(values)*1.1)
    ax.set_ylabel(y_label)
    ax.set_title(title)

    plt.subplots_adjust(right=0.65)

    # ax.legend(title=title, bbox_to_anchor=(1.0, 1), loc='upper left', reverse=False)

    plt.savefig(file_location)
    file_location_out = file_location

    #plt.show()
# ---------- end py3_73 ----------
setimg_4 = SetImage(ImageToModify=image_3, NewImagePath=py3_73)

current_selected_simulation_daylight_com_2 = RemoteReceiver(current_selected_simulation_daylight_com)  # "current_selected_simulation_daylight_compare"
item_64 = ListItem(List=simplify(cull_37), Index=current_selected_simulation_daylight_com_2, Wrap=invert(True))
pshift_4 = ShiftPaths(Data=item_64, Offset=-1)
bang_26 = ExplodeTree(Data=pshift_4)  # -> Branch0, Branch1, Branch2, Branch3, Branch4, Branch5
daylight_simulation_type_5 = RemoteReceiver(daylight_simulation_type)
data_63 = Data(bang_26.Branch1)
data_64 = Data(bang_26.Branch2)
data_65 = Data(bang_26.Branch3)
data_66 = Data(bang_26.Branch4)
data_67 = Data(bang_26.Branch5)
filter_112 = StreamFilter(Gate=daylight_simulation_type_5, Stream0=data_63, Stream1=data_64, Stream2=data_65, Stream3=data_66, Stream4=data_67)
daylight_expander_is_open_5 = RemoteReceiver(daylight_expander_is_open)
bbox_7 = BoundingBox(Content=data_62, Plane=PlaneXY(0, 0, 0), UnionBox=True)  # -> Box, Box_2
current_tab_32 = RemoteReceiver(current_tab)
debox_2 = DeconstructBox(Box=bbox_7.Box)  # -> Plane, X, Y, Z
expression_101 = Expression(x=tab_simulate_15, y=current_tab_32, Expression="x=y")
num_12 = Number(debox_2.Y)
addition_6 = Addition(A=num_12, B=Slider(15, range=0..100))
Y_3 = UnitY(Factor=addition_6)

expression_102 = Expression(x=current_selected_simulation_daylight_com_2, Expression="x>-1")

and_61 = GateAnd(A=expression_101, B=daylight_expander_is_open_5, C=expression_102)
gate_83 = StreamGate(Stream=filter_112, Gate=and_61)  # -> Target0, Target1
move_6 = Move(Geometry=gate_83.Target1, Motion=Y_3)  # -> Geometry, Transform

gate_84 = StreamGate(Stream=move_6.Geometry, Gate=expression_102)  # -> Target0, Target1

merge_39 = Merge(Data1=data_62, Data2=gate_84.Target1)
gate_85 = StreamGate(Stream=merge_39, Gate=and_58)  # -> Target0, Target1
bbox_8 = BoundingBox(Content=merge_39, Plane=PlaneXY(0, 0, 0), UnionBox=True)  # -> Box, Box_2
data_68 = Data(gate_85.Target1)

panel_282 = Panel(data_68)

# ----
# Bake daylight simulation
panel_283 = Panel("""Heath::Daylight simulation::Illuminance [Lux]
Heath::Daylight simulation::Daylight autonomy [%]
Heath::Daylight simulation::UDI [%]
Heath::Daylight simulation::UDI <50 [%]
Heath::Daylight simulation::UDI >3000 [%]""")
bake_daylight_simulation_2 = RemoteReceiver(bake_daylight_simulation)
daylight_simulation_type_6 = RemoteReceiver(daylight_simulation_type)
daylight_simulation = Data(data_68)
item_65 = ListItem(List=panel_283, Index=daylight_simulation_type_6, Wrap=invert(True))
gate_86 = StreamGate(Stream=item_65, Gate=bake_daylight_simulation_2)  # -> Target0, Target1

# ----
# Zoom daylight simulation
zoom_daylight_simulation_2 = RemoteReceiver(zoom_daylight_simulation)
zbb_6 = ZoomBoundingBox(Box=bbox_8.Box, Run=zoom_daylight_simulation_2)

bake_geometries_to_layers = BakeGeometriesToLayers(geometry=daylight_simulation, layers=gate_86.Target1, bake=bake_daylight_simulation_2)

# ----
# Show label in Rhino
bbox_9 = BoundingBox(Content=gate_84.Target1, Plane=PlaneXY(0, 0, 0), UnionBox=True)  # -> Box, Box_2
debox_3 = DeconstructBox(Box=bbox_9.Box)  # -> Plane, X, Y, Z
dedomain_2 = DeconstructDomain(Domain=debox_3.Z)  # -> Start, End
dedomain_3 = DeconstructDomain(Domain=debox_3.Y)  # -> Start, End
dedomain_4 = DeconstructDomain(Domain=debox_3.X)  # -> Start, End
current_selected_simulation_daylight_com_3 = RemoteReceiver(current_selected_simulation_daylight_com)  # "current_selected_simulation_daylight_compare"
current_all_simulation_models_daylight_4 = RemoteReceiver(current_all_simulation_models_daylight)
addition_7 = Addition(A=dedomain_4.Start, B=dedomain_4.End)
addition_8 = Addition(A=Slider(2, range=0..100), B=dedomain_3.End)
division_17 = Division(A=addition_7, B="2")
item_66 = ListItem(List=current_all_simulation_models_daylight_4, Index=current_selected_simulation_daylight_com_3, Wrap=invert(True))
pt_16 = ConstructPoint(XCoordinate=division_17, YCoordinate=addition_8, ZCoordinate=dedomain_2.Start)

gate_87 = StreamGate(Stream=item_66, Gate=daylight_expander_is_open_3)  # -> Target0, Target1

tag_3 = TextTag3D(
    Location=pt_16,
    Text=gate_87.Target1,
    Size=Slider(1.5, range=0..5),
    Colour=ColourSwatch(SwatchColor=RGB(255, 255, 255)),
    Justification=8)

# ----
# Show label in Rhino
number_slider_57 = Slider(2, range=0..100)
dedomain_5 = DeconstructDomain(Domain=debox_2.Z)  # -> Start, End
dedomain_6 = DeconstructDomain(Domain=debox_2.Y)  # -> Start, End
dedomain_7 = DeconstructDomain(Domain=debox_2.X)  # -> Start, End
addition_9 = Addition(A=dedomain_7.Start, B=dedomain_7.End)
addition_10 = Addition(A=number_slider_57, B=dedomain_6.End)
current_selected_model_analysis_module_n_11 = RemoteReceiver(current_selected_model_analysis_module_n)  # "current_selected_model_analysis_module_name"
division_18 = Division(A=addition_9, B="2")
pt_17 = ConstructPoint(XCoordinate=division_18, YCoordinate=addition_10, ZCoordinate=dedomain_5.Start)

gate_88 = StreamGate(Stream=current_selected_model_analysis_module_n_11, Gate=daylight_expander_is_open_2)  # -> Target0, Target1

tag_4 = TextTag3D(
    Location=pt_17,
    Text=gate_88.Target1,
    Size=Slider(1.5, range=0..5),
    Colour=ColourSwatch(SwatchColor=RGB(255, 255, 255)),
    Justification=8)

created_constructions_database = RemoteReceiver(created_constructions_database_2)
decnstrconstr_3 = HBDeconstructConstruction(constr=created_constructions_database)  # -> name, materials, layers, r_val_si, r_val_ip, u_fac_si, u_fac_ip, shgc, t_sol, t_vis; plug-in component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
decnstrmat_4 = HBDeconstructMaterial(mat=decnstrconstr_3.materials)  # -> values, attr_names, r_val_si, r_val_ip; plug-in component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
expression_103 = Expression(x=decnstrconstr_3.u_fac_si, Expression="Round(x, 2)")
null_60 = NullItem(Item=created_constructions_database)  # -> NullFlags, InvalidFlags, Description
item_67 = ListItem(List=decnstrmat_4.values, Index=0, Wrap=True)  # -> Item, Item1
item_68 = ListItem(List=null_60.NullFlags, Index=0, Wrap=True)
shiftm = ShiftMatch(GuideTree=decnstrconstr_3.materials, SecondaryData1=item_67.Item, SecondaryData2=item_67.Item1, shiftFromStart=False)  # -> GuideTree, SecondaryData1, SecondaryData2
visualize_construction_thickness = RemoteSender(shiftm.SecondaryData2)
visualize_construction_materials = RemoteSender(shiftm.SecondaryData1)
format_45 = Format(Format="{0} (U-factor: {1})", Culture=127, Data0=decnstrconstr_3.name, Data1=expression_103)
format_46 = Format(Format="{0}, {1}m", Culture=127, Data0=shiftm.SecondaryData1, Data1=shiftm.SecondaryData2)
gate_89 = StreamGate(Stream=format_45, Gate=item_68)  # -> Target0, Target1
tstat = TreeStatistics(Tree=format_46)  # -> Paths, Length, Count
tstat_2 = TreeStatistics(Tree=format_46)  # -> Paths, Length, Count
repeat_21 = RepeatData(Data="Indoors", Length=tstat_2.Count)
repeat_22 = RepeatData(Data="Outdoors", Length=tstat.Count)
entwine_212 = Entwine(Branch00=format_21, Branch01=gate_89.Target0, FlattenInputs=True)  # -> flatten(Result)
entwine_213 = Entwine(Branch00=format_23, Branch01=gate_89.Target0, FlattenInputs=True)  # -> flatten(Result)
entwine_214 = Entwine(Branch00=format_24, Branch01=gate_89.Target0, FlattenInputs=True)  # -> flatten(Result)
entwine_215 = Entwine(Branch00=format_22, Branch01=gate_89.Target0, FlattenInputs=True)  # -> flatten(Result)
entwine_216 = Entwine(Branch00=format_26, Branch01=gate_89.Target0, FlattenInputs=True)  # -> flatten(Result)
entwine_217 = Entwine(Branch00=format_25, Branch01=gate_89.Target0, FlattenInputs=True)  # -> flatten(Result)
concat_9 = Concatenate(FragmentA="- ", FragmentB=format_46)
tree = CreateTree(Data=repeat_22, Path=tstat.Paths)
tree_2 = CreateTree(Data=repeat_21, Path=tstat_2.Paths)
entwine_218 = Entwine(Branch00=panel_44, Branch01=decnstrconstr_3.name, FlattenInputs=True)  # -> flatten(Result)
entwine_219 = Entwine(Branch00=panel_44, Branch01=created_constructions_database, FlattenInputs=True)  # -> flatten(Result)
merge_40 = Merge(Data1=tree, Data2=concat_9, Data3=tree_2)
filter_113 = StreamFilter(Gate=item_68, Stream0=entwine_212, Stream1=format_21)
filter_114 = StreamFilter(Gate=item_68, Stream0=entwine_213, Stream1=format_23)
filter_115 = StreamFilter(Gate=item_68, Stream0=entwine_214, Stream1=format_24)
filter_116 = StreamFilter(Gate=item_68, Stream0=entwine_215, Stream1=format_22)
filter_117 = StreamFilter(Gate=item_68, Stream0=entwine_216, Stream1=format_26)
filter_118 = StreamFilter(Gate=item_68, Stream0=entwine_217, Stream1=format_25)
filter_119 = StreamFilter(Gate=item_68, Stream0=entwine_219, Stream1=panel_44)
filter_120 = StreamFilter(Gate=item_68, Stream0=entwine_218, Stream1=panel_44)
gate_90 = StreamGate(Stream=merge_40, Gate=item_68)  # -> Target0, Target1
panel_284 = Panel(merge_40)
all_construction_display_interior_walls = RemoteSender(filter_118)
all_construction_display_exterior_walls = RemoteSender(filter_117)
all_construction_display_interior_floors = RemoteSender(filter_115)
all_construction_display_exterior_roofs = RemoteSender(filter_114)
all_construction_display_exterior_floors = RemoteSender(filter_116)
all_construction_display_ground = RemoteSender(filter_113)
custom_constructions = RemoteSender(gate_89.Target0)
custom_constructions_info = RemoteSender(gate_90.Target0)
all_construction_names = RemoteSender(filter_120)
all_constructions = RemoteSender(filter_119)

# ---- group: Construction module (continued)
all_construction_display_exterior_floors_2 = RemoteReceiver(all_construction_display_exterior_floors)  # disabled
all_construction_display_exterior_walls_2 = RemoteReceiver(all_construction_display_exterior_walls)
all_construction_display_ground_2 = RemoteReceiver(all_construction_display_ground)
all_construction_display_interior_walls_2 = RemoteReceiver(all_construction_display_interior_walls)  # disabled
all_construction_display_interior_floors_2 = RemoteReceiver(all_construction_display_interior_floors)
all_construction_display_exterior_roofs_2 = RemoteReceiver(all_construction_display_exterior_roofs)
setlist_9 = SetListContents(ListToModify=pulldown_13, NewListContents=all_construction_display_ground_2, SelectedIndex="0")
setlist_10 = SetListContents(ListToModify=pulldown_15, NewListContents=all_construction_display_exterior_floors_2, SelectedIndex=panel_95)  # disabled
setlist_11 = SetListContents(ListToModify=pulldown_12, NewListContents=all_construction_display_exterior_walls_2, SelectedIndex="0")
setlist_12 = SetListContents(ListToModify=pulldown_17, NewListContents=all_construction_display_interior_walls_2, SelectedIndex=panel_96)  # disabled
setlist_13 = SetListContents(ListToModify=pulldown_16, NewListContents=all_construction_display_exterior_roofs_2, SelectedIndex="0")
setlist_14 = SetListContents(ListToModify=pulldown_14, NewListContents=all_construction_display_interior_floors_2, SelectedIndex="0")

# ----
all_constructions_2 = RemoteReceiver(all_constructions)
all_constructions_3 = RemoteReceiver(all_constructions)
all_constructions_4 = RemoteReceiver(all_constructions)
item_69 = ListItem(List=all_constructions_2, Index=subset_interior_floor_2, Wrap=True)
item_70 = ListItem(List=all_constructions_3, Index=subset_exterior_wall_3, Wrap=True)
item_71 = ListItem(List=all_constructions_4, Index=subset_exterior_roof_2, Wrap=True)
expression_104 = Expression(x="Generic", y=item_69, Expression="x=y")
expression_105 = Expression(x="Generic", y=item_70, Expression="x=y")
expression_106 = Expression(x="Generic", y=item_71, Expression="x=y")
filter_121 = StreamFilter(Gate=expression_104, Stream0=item_69, Stream1=null_14)
filter_122 = StreamFilter(Gate=expression_105, Stream0=item_70, Stream1=null_15)
filter_123 = StreamFilter(Gate=expression_106, Stream0=item_71, Stream1=null_16)
exteriorsubset = HBExteriorConstructionSubset(exterior_wall=filter_122, exterior_roof=filter_123, exposed_floor=filter_121)  # -> exterior_set; plug-in component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

all_constructions_5 = RemoteReceiver(all_constructions)
all_constructions_6 = RemoteReceiver(all_constructions)
item_72 = ListItem(List=all_constructions_5, Index=subset_exterior_wall_2, Wrap=True)
item_73 = ListItem(List=all_constructions_6, Index=subset_interior_floor_3, Wrap=True)
expression_107 = Expression(x="Generic", y=item_72, Expression="x=y")
expression_108 = Expression(x="Generic", y=item_73, Expression="x=y")
filter_124 = StreamFilter(Gate=expression_107, Stream0=item_72, Stream1=null_17)
filter_125 = StreamFilter(Gate=expression_108, Stream0=item_73, Stream1=null_18)
interiorsubset = HBInteriorConstructionSubset(interior_wall=filter_124, interior_floor=filter_125)  # -> interior_set; plug-in component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

all_constructions_7 = RemoteReceiver(all_constructions)
item_74 = ListItem(List=all_constructions_7, Index=subset_ground_floor_2, Wrap=True)
expression_109 = Expression(x="Generic", y=item_74, Expression="x=y")
filter_126 = StreamFilter(Gate=expression_109, Stream0=item_74, Stream1=null_19)
groundsubset = HBGroundConstructionSubset(ground_floor=filter_126)  # -> ground_set; plug-in component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

constructionset_2 = HBConstructionSet(
    name=panel_131,
    base_constr_set=panel_101,
    exterior_subset=exteriorsubset,
    ground_subset=groundsubset,
    interior_subset=interiorsubset,
    subface_subset=subfacesubset)  # -> constr_set; plug-in component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
decnstrconstrset_2 = HBDeconstructConstructionSet(constr_set=constructionset_2)  # -> exterior_wall, exterior_roof, exposed_floor, ground_wall, ground_roof, ground_floor, window, skylight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; plug-in component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
panel_285 = Panel(decnstrconstrset_2.exterior_wall)
decnstrconstr_4 = HBDeconstructConstruction(constr=decnstrconstrset_2.exterior_roof)  # -> materials, layers, r_val_si, r_val_ip, u_fac_si, u_fac_ip, shgc, t_sol, t_vis; plug-in component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
decnstrconstr_5 = HBDeconstructConstruction(constr=decnstrconstrset_2.exterior_wall)  # -> materials, layers, r_val_si, r_val_ip, u_fac_si, u_fac_ip, shgc, t_sol, t_vis; plug-in component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
add_dynamic_shades = AddDynamicShades(base_construction_set=constructionset_2, setpoint=Slider(100, range=0..200))

calc_mat_thickness = HBDeconstructMaterial(mats=decnstrconstr_4.materials)  # -> out, t; inputs mats: list
#   port mats: A material to be deconstructed. This can also be text for a material to be looked up in the material library.
# ---------- calc_mat_thickness: Python ----------
from honeybee_energy.material.opaque import EnergyMaterial, EnergyMaterialNoMass
t = 0
lamb = 0.036
for mat in mats:
    print(mat.thickness, type(mat))
    if type(mat) == EnergyMaterial:
        t = t + mat.thickness
    elif type(mat) == EnergyMaterialNoMass:
        print (mat.r_value * lamb)
        t = t + (mat.r_value * lamb)
    else:
        pass
print ('total thickness:' + str(t))
# ---------- end calc_mat_thickness ----------
calc_mat_thickness_2 = HBDeconstructMaterial(mats=decnstrconstr_5.materials)  # -> out, t; inputs mats: list; same code as calc_mat_thickness

custom_constructions_info_2 = RemoteReceiver(custom_constructions_info)
join_17 = TextJoin(Text=custom_constructions_info_2)  # -> flatten(Result)
lng_55 = ListLength(List=join_17)
py3_74 = Python3Script(current_elements=lng_55, maximum_elements=number_slider_31)  # -> status; inputs current_elements: Int32, maximum_elements: Int32
# ---------- py3_74: Python ----------
if current_elements:
    status = [True]*current_elements
    status.extend([False]*(maximum_elements-current_elements))
else:
    status = False
# ---------- end py3_74 ----------
settextblock_19 = SetTextBlockContents(TextBlockToModify=tb_39, NewTextBlockContents=join_17)
custom_constructions_2 = RemoteReceiver(custom_constructions)
setexp_5 = SetExpander(Expander=expander_10, Name=custom_constructions_2)
hideshow_79 = HideShowElement(ElementToHideShow=simplify(merge_9), Show=simplify(graft(py3_74)), Collapse=True, Disable=False)

panel_286 = Panel(lng_55)

data_69 = Data(add_dynamic_shades)
entwine_220 = Entwine(
    Branch00=cluster,
    Branch01=cluster_2,
    Branch02=cluster_3,
    Branch03=cluster_4,
    Branch04=data_18,
    Branch05=data_69,
    Branch06=model_name_4,
    Branch07=generate_wwr_2,
    Branch08=calc_mat_thickness_2.t,
    Branch09=calc_mat_thickness.t,
    FlattenInputs=True)
freeze_gate_76 = StreamFreezeGate(Data=entwine_220, PassingSwitch=pre_create_model_3, Hold=True)
bang_27 = ExplodeTree(Data=freeze_gate_76)  # -> Branch0, Branch1, Branch2, Branch3, Branch4, Branch5, Branch6, Branch7, Branch8, Branch9
construction = Data(bang_27.Branch5)
program = Data(bang_27.Branch4)
model_name_5 = Data(bang_27.Branch6)
roof_thickness = Data(bang_27.Branch9)
wall_thickness = Data(bang_27.Branch8)
wwr = Data(bang_27.Branch7)
python_2 = GhPythonScript(in_list=construction)  # -> out_list; inputs in_list: list
# ---------- python_2: Python ----------
"""Converts lists of HB objects to dicts for use with Py3.
    Inputs:
        in_list: List of HB objects
    Output:
        out_list: List of Python dictionaries representing HB objects"""

__author__ = "sawen"
__version__ = "2024.07.09"

out_list = list([x.to_dict() for x in in_list])
# ---------- end python_2 ----------
python_3 = GhPythonScript(in_list=program)  # -> out_list; inputs in_list: list; same code as python_2
model_name_6 = Text(model_name_5)
adjacent_geometry = Geometry(bang_27.Branch1)
windows_5 = Geometry(bang_27.Branch3)
window_to_wall_ratio = Number(wwr)
room_geometry = Geometry(bang_27.Branch0)
context_geometry = Geometry(bang_27.Branch2)
wall_thickness_2 = Number(wall_thickness)
py3_75 = Python3Script(
    window_wall_ratio=window_to_wall_ratio,
    window_height=window_height,
    sill_height=sill_height,
    horizontal_separation=horizontal_separation,
    wall_thickness=wall_thickness_2)  # -> out, window_settings
# ---------- py3_75: Python ----------
from heath import WindowSettings

"""Create Window Settings"""
window_settings = WindowSettings(window_wall_ratio, window_height, sill_height, horizontal_separation, wall_thickness)
# ---------- end py3_75 ----------

# ---- group: Filter window geometry if WWR option is active
bool_76 = Boolean(window_to_wall_ratio)
gate_91 = StreamGate(Stream=windows_5, Gate=bool_76)  # -> Target0, Target1

# ----
py3_76 = Python3Script(
    model_name=model_name_6,
    room_geo=room_geometry,
    construction_sets=python_2,
    programs=python_3,
    energy_systems=heatcool,
    adjacent_surfaces=adjacent_geometry,
    window_geo=gate_91.Target0,
    window_settings=py3_75.window_settings,
    context_geo=context_geometry,
    jsonify=Toggle(True))  # -> out, hb_model, report, warnings; inputs room_geo: list of Brep, construction_sets: list, programs: list, energy_systems: list, adjacent_surfaces: list of Brep, window_geo: list of Surface, context_geo: list of GeometryBase
# ---------- py3_76: Python ----------
# Copyright (c) 2024, Heath.
# You should have received a copy of the GNU Affero General Public License
# along with Heath; If not, see <http://www.gnu.org/licenses/>.
# 
# @license AGPL-3.0-or-later <https://spdx.org/licenses/AGPL-3.0-or-later>

"""Grasshopper Script"""
        
from heath import create_hb_model, heath_globals, utils

import Rhino.Geometry as rg
import IronPython
import importlib
import honeybee_energy

from time import time as t

from honeybee.room import Room
cs = honeybee_energy.constructionset.ConstructionSet
pt = honeybee_energy.programtype.ProgramType 

import scriptcontext

def dictify(d):
    if type(d) in [dict, IronPython.Runtime.PythonDictionary]:
        d = dict(d)
        for key in d:
            d[key] = dictify(d[key])
    elif type(d) in [list, IronPython.Runtime.List]:
        d = [dictify(value) for value in list(d)]
    return d

if __name__ == "__main__":
    if not scriptcontext.sticky["heath_flying"]:
        raise Exception("Heath - fly component must exist on the canvas")
    ghenv.Component.Message = heath_globals.version

    # SUPER HACK because Py3 does not retain the Honeybee types
    # https://discourse.ladybug.tools/t/ladybug-honeybee-datatypes-are-converted-when-input-to-py3-component/28216
    construction_sets = [cs.from_dict(dictify(c)) for c in construction_sets]
    
    programs_patched = []
    for p in programs:
        # hack to fix py2-py3 conversion of dicts
        p = pt.from_dict(dictify(p))
        programs_patched.append(p)
    
    try:
        hb_model, report, warning_dict = create_hb_model(ghenv, list(room_geo), construction_sets, programs_patched, adjacent_surfaces, energy_systems, window_geo, window_settings, louver_settings, context_geo, model_name)
    except Exception as e:
        print(e)
        raise e
    print(report)
    warnings = []
    for key in warning_dict:
        warnings.extend(warning_dict[key])
    if jsonify:
        hb_model = utils.jsonify(hb_model.to_dict())
# ---------- end py3_76 ----------
strtoobj_7 = HBStringToObject(hb_str=py3_76.hb_model)  # -> hb_obj; plug-in component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

py3_77 = Python3Script(x=py3_76.warnings)  # -> out, a
# ---------- py3_77: Python ----------
a = x if x is not None else []
# ---------- end py3_77 ----------
lng_56 = ListLength(List=py3_77.a)
bool_77 = Boolean(lng_56)
and_62 = GateAnd(D=invert(null_35.NullFlags), A=freeze_gate_49, B=invert(pre_create_model), C=invert(bool_77))
and_63 = GateAnd(D=invert(null_35.NullFlags), A=freeze_gate_49, B=invert(pre_create_model), C=bool_77)
hideshow_80 = HideShowElement(ElementToHideShow=tb_7, Show=and_63, Collapse=True, Disable=False)
hideshow_81 = HideShowElement(ElementToHideShow=tb_8, Show=and_62, Collapse=True, Disable=False)
deconstructmodel_4 = HBDeconstructModel(model=strtoobj_7)  # -> rooms, faces, apertures, doors, shades; plug-in component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

# ---- group: Ref: B-Å Petersson: Byggnaders klimatskärm (continued)
idealair = HBIdealAir(
    rooms=flatten(deconstructmodel_4.rooms),
    dcv=Toggle(True),
    sensible_hr=heat_recovery_efficiency_2,
    latent_hr=heat_recovery_efficiency_2)  # -> report, rooms; plug-in component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
absoluteloadvals = HBApplyAbsoluteLoadValues(rooms=flatten(idealair.rooms), infiltration_ach=Slider(0.1, range=0..1))  # -> report, rooms; plug-in component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

# ----
join_18 = TextJoin(Text=py3_76.warnings)
txt_8 = Text(join_18)
merge_41 = Merge(Data1=panel_3, Data2=txt_8)  # -> flatten(Result)
join_19 = TextJoin(Text=merge_41)
model_2 = HBModel(
    rooms=flatten(absoluteloadvals.rooms),
    faces=flatten(deconstructmodel_4.faces),
    shades=flatten(deconstructmodel_4.shades),
    apertures=flatten(deconstructmodel_4.apertures),
    doors=flatten(deconstructmodel_4.doors))  # -> report, model; plug-in component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
data_70 = Data(model_2.model)
panel_287 = Panel(py3_76.out)
deconstructmodel_5 = HBDeconstructModel(model=data_70)  # -> rooms, faces, apertures, doors, shades; plug-in component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

validatemodel = HBValidateModel(model=data_70, validate=toggle_4)  # -> report; plug-in component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

all_construction_names_2 = RemoteReceiver(all_construction_names)
expression_110 = Expression(x=all_construction_names_2, y=create_construction_name_2, Expression="x=y")
cull_39 = CullPattern(List=expression_110, CullPattern=expression_110)
gate_92 = StreamGate(Stream="Material already exists", Gate=cull_39)  # -> Target0, Target1

lng_57 = ListLength(List=data_70)
bool_78 = Boolean(lng_57)
py3_78 = Python3Script(update=bool_78)  # -> timestamp
# ---------- py3_78: Python ----------
import datetime

if update:
    timestamp = ' (' + str(datetime.datetime.now())[:-7] + ')'
    timestamp = timestamp.replace(':', '.')
# ---------- end py3_78 ----------
entwine_221 = Entwine(Branch0X=data_70, Branch1X=model_name_6, Branch2X=py3_78, FlattenInputs=False)
split_19 = SplitTree(Data=entwine_221, Masks=flatten("{0;*}"))  # -> Positive, flatten(Negative)
join_20 = TextJoin(Text=split_19.Negative)
dumpobjects = HBDumpObjects(hb_objs=flatten(split_19.Positive), name=join_20, folder=py3_38, dump=create_model_3)  # -> report, hb_file; plug-in component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
null_61 = NullItem(Item=dumpobjects.hb_file)  # -> NullFlags, InvalidFlags, Description
panel_288 = Panel(dumpobjects.hb_file)

freeze_gate_77 = StreamFreezeGate(Data=join_20, PassingSwitch=create_model_3)
panel_289 = Panel(freeze_gate_77)
lng_58 = ListLength(List=panel_289)
rec_59 = DataRecorder(dumpobjects.hb_file, DataLimit=-10, RecordData=True)
bool_79 = Boolean(lng_58)
rec_60 = DataRecorder(dumpobjects.report, DataLimit=-10, RecordData=True)
panel_290 = Panel(rec_60)

visualize_construction_thickness_2 = RemoteReceiver(visualize_construction_thickness)
visualize_construction_materials_2 = RemoteReceiver(visualize_construction_materials)
tstat_3 = TreeStatistics(Tree=visualize_construction_materials_2)  # -> Paths, Length, Count
tstat_4 = TreeStatistics(Tree=visualize_construction_thickness_2)  # -> Paths, Length, Count
stack_119 = StackData(Data=tstat_3.Paths, Stack=tstat_3.Length)
stack_120 = StackData(Data=tstat_4.Paths, Stack=tstat_4.Length)
tree_3 = CreateTree(Data=flatten(visualize_construction_materials_2), Path=stack_119)
tree_4 = CreateTree(Data=flatten(visualize_construction_thickness_2), Path=stack_120)
custom_constructions_3 = RemoteReceiver(custom_constructions)
suirify_12 = Suirify(tree_3)
suirify_13 = Suirify(tree_4)
branch_4 = TreeBranch(Tree=suirify_12, Path=path_4, MaintainPaths=True)
branch_5 = TreeBranch(Tree=suirify_13, Path=path_4, MaintainPaths=True)
item_75 = ListItem(List=custom_constructions_3, Index=pre_construction_database_visualize_cons_2, Wrap=True)
ma_76 = MassAddition(Input=branch_5)  # -> Result, PartialResults
concat_10 = Concatenate(FragmentA=ma_76.Result, FragmentB=" m")
concat_11 = Concatenate(FragmentA=branch_5, FragmentB=" m")
multiplication_16 = Multiplication(A=Slider(400, range=0..1000), B=branch_5)
format_47 = Format(Format=panel_209, Culture=127, Data0=concat_10)
cull_i_8 = CullIndex(List=multiplication_16, Indices="-1", Wrap=True)
item_76 = ListItem(List=multiplication_16, Index="-1", Wrap=True)
lng_59 = ListLength(List=concat_11)
py3_79 = Python3Script(current_elements=lng_59, maximum_elements=construction_maximum_layer_limit_7)  # -> status; inputs current_elements: Int32, maximum_elements: Int32
# ---------- py3_79: Python ----------
status = [True]*current_elements
status.extend([False]*(maximum_elements-current_elements))
# ---------- end py3_79 ----------
setlabel_11 = SetLabelContents(LabelToModify=label_76, NewLabelContents=item_75)
setlabel_12 = SetLabelContents(LabelToModify=label_79, NewLabelContents=format_47)
settextblock_20 = SetTextBlockContents(TextBlockToModify=tb_47, NewTextBlockContents=branch_4)
settextblock_21 = SetTextBlockContents(TextBlockToModify=tb_46, NewTextBlockContents=concat_11)
entwine_222 = Entwine(Branch00=cull_i_8, Branch01=item_76, FlattenInputs=True)  # -> flatten(Result)
hideshow_82 = HideShowElement(ElementToHideShow=tb_46, Show=py3_79, Collapse=True, Disable=False)
hideshow_83 = HideShowElement(ElementToHideShow=tb_47, Show=py3_79, Collapse=True, Disable=False)
hideshow_84 = HideShowElement(ElementToHideShow=tb_48, Show=py3_79, Collapse=True, Disable=False)
py3_80 = Python3Script(layerHeight=entwine_222, textHeight=Slider(22, range=0..100))  # -> over_text, under_text; inputs layerHeight: list
# ---------- py3_80: Python ----------
over_text = []
under_text = []

for layer in layerHeight:
    if layer <= textHeight:
        over_text.append(0)
        under_text.append(layer)
    else:
        over_text.append((layer/2)-(textHeight/2))

        under_text.append((layer/2)+(textHeight/2))
# ---------- end py3_80 ----------
adjustpos_143 = AdjustElementPositioning(
    ElementsToAdjust=tb_48,
    Margin="0, 0, 0, -1",
    AbsolutePositioning=False,
    Width=number_slider_43,
    Height=py3_80.over_text,
    HorizontalAlignment=0,
    VerticalAlignment=1)
adjustpos_144 = AdjustElementPositioning(
    ElementsToAdjust=tb_47,
    AbsolutePositioning=False,
    Width=number_slider_43,
    Height=py3_80.under_text,
    HorizontalAlignment=0,
    VerticalAlignment=1)

created_materials_database = RemoteReceiver(created_materials_database_2)
panel_291 = Panel(created_materials_database)
decnstrmat_5 = HBDeconstructMaterial(mat=created_materials_database)  # -> category, values, attr_names, r_val_si, r_val_ip; plug-in component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
item_77 = ListItem(List=decnstrmat_5.values, Index=0, Wrap=True)  # -> flatten(Item), flatten(Item1), flatten(Item2), flatten(Item3), flatten(Item4)
create_material_categories = RemoteSender(decnstrmat_5.category)
clean_18 = CleanTree(RemoveNulls=True, RemoveInvalid=True, RemoveEmpty=False, Tree=item_77.Item)
clean_19 = CleanTree(RemoveNulls=True, RemoveInvalid=True, RemoveEmpty=False, Tree=item_77.Item2)
clean_20 = CleanTree(RemoveNulls=True, RemoveInvalid=True, RemoveEmpty=False, Tree=item_77.Item3)
clean_21 = CleanTree(RemoveNulls=True, RemoveInvalid=True, RemoveEmpty=False, Tree=item_77.Item4)
lng_60 = ListLength(List=clean_18)
num_13 = Number(clean_19)
create_material_names = RemoteSender(clean_18)
num_14 = Number(clean_20)
num_15 = Number(clean_21)
expression_111 = Expression(x=num_13, Expression="Round(x, 2)")
expression_112 = Expression(x=num_14, Expression="Round(x, 2)")
expression_113 = Expression(x=num_15, Expression="Round(x, 2)")
bool_80 = Boolean(lng_60)
gate_93 = StreamGate(Stream=panel_47, Gate=bool_80)  # -> Target0, Target1
format_48 = Format(Format=gate_93.Target1, Culture=127, Data0=clean_18, Data1=expression_111, Data2=expression_112, Data3=expression_113)
panel_292 = Panel(format_48)
database_materials = RemoteSender(format_48)

create_material_categories_2 = RemoteReceiver(create_material_categories)
create_material_names_2 = RemoteReceiver(create_material_names)
database_materials_2 = RemoteReceiver(database_materials)
mindex_13 = MemberIndex(Set=material_database_categories_3, Member=create_material_categories_2)  # -> simplify(Index), Count
getbrn_2 = GetMatchingBranches(
    PrimaryData=mindex_13.Index,
    SecondaryData1=simplify(graft(database_materials_2)),
    SecondaryData2=simplify(graft(create_material_names_2)),
    removeEmpty=True,
    ValueTable_removeEmpty=False)  # -> flatten(PrimaryData), flatten(SecondaryData1), flatten(SecondaryData2)
cull_40 = CullPattern(List=create_material_categories_2, CullPattern=mindex_13.Count)
database_materials_current = RemoteSender(getbrn_2.SecondaryData1)
create_material_names_current = RemoteSender(getbrn_2.SecondaryData2)
create_material_categories_current = RemoteSender(cull_40)
material_database_categories_current = RemoteSender(getbrn_2.PrimaryData)

material_database_categories_current_2 = RemoteReceiver(material_database_categories_current)
material_database_categories_current_3 = RemoteReceiver(material_database_categories_current)
create_material_names_current_2 = RemoteReceiver(create_material_names_current)
database_materials_current_2 = RemoteReceiver(database_materials_current)
create_material_names_current_3 = RemoteReceiver(create_material_names_current)

expression_114 = Expression(x=create_material_names_current_3, y=create_material_name_2, Expression="x=y")
cull_41 = CullPattern(List=expression_114, CullPattern=expression_114)
gate_94 = StreamGate(Stream="Material already exists", Gate=cull_41)  # -> Target0, Target1
entwine_223 = Entwine(Branch00=filter_62, Branch01=gate_94.Target1, Branch02=gate_42.Target1, FlattenInputs=True)  # -> flatten(Result)
item_78 = ListItem(List=entwine_223, Index=0, Wrap=True)
create_material_error_message = RemoteSender(item_78)

create_material_error_message_2 = RemoteReceiver(create_material_error_message)
null_62 = NullItem(Item=create_material_error_message_2)  # -> NullFlags, InvalidFlags, Description
filter_127 = StreamFilter(Gate=null_62.NullFlags, Stream0=create_material_error_message_2, Stream1=" ")
filter_128 = StreamFilter(Gate=null_62.NullFlags, Stream0=Slider(500, range=0..1000), Stream1=Slider(1000000, range=0..1000000))
hideshow_85 = HideShowElement(ElementToHideShow=button_53, Show=True, Collapse=True, Disable=invert(null_62.NullFlags))
tooltip_18 = AttachTooltipToElement(ElementsToAttachTo=button_53, TooltipContent=filter_127, ShowDelay=filter_128, Duration=Slider(5000, range=0..10000))

create_material_names_current_4 = RemoteReceiver(create_material_names_current)
create_material_categories_current_2 = RemoteReceiver(create_material_categories_current)

mindex_14 = MemberIndex(Set=create_material_names_current_4, Member=branch_4)  # -> flatten(Index), Count
item_79 = ListItem(List=create_material_categories_current_2, Index=mindex_14.Index, Wrap=True)
mindex_15 = MemberIndex(Set=material_database_categories_8, Member=item_79)  # -> flatten(Index), Count
item_80 = ListItem(List=entwine_172, Index=mindex_15.Index, Wrap=True)
adjustelem_47 = AdjustElementAppearance(ElementsToAdjust=tb_48, Foreground=swatch_8, Background=item_80)
adjustelem_48 = AdjustElementAppearance(ElementsToAdjust=tb_47, Foreground=swatch_8, Background=item_80)

sort_3 = SortList(
    Keys=material_database_categories_current_2,
    ValuesA=database_materials_current_2,
    ValuesB=create_material_names_current_2)  # -> Keys, ValuesA, ValuesB
py3_81 = Python3Script(maximum_elements=lng_6, current_elements=material_database_categories_current_3, maximum_buttons=number_slider_33)  # -> status; inputs current_elements: list, maximum_buttons: Int32
# ---------- py3_81: Python ----------
from collections import Counter
import ghpythonlib.treehelpers as th

c = Counter(current_elements)
status = []

for i in range(maximum_elements):
    current_category = [True]*c[i]
    current_category.extend([False]*(maximum_buttons-c[i]))
    status.append(current_category)

status = th.list_to_tree(status)
# ---------- end py3_81 ----------
create_material_names_sorted = RemoteSender(sort_3.ValuesB)
concat_12 = Concatenate(FragmentA="- ", FragmentB=sort_3.ValuesA)
cull_42 = CullPattern(List=tb_40, CullPattern=py3_81)  # -> flatten(List)
material_database_hideshow = RemoteSender(py3_81)
settextblock_22 = SetTextBlockContents(TextBlockToModify=cull_42, NewTextBlockContents=concat_12)
hideshow_86 = HideShowElement(ElementToHideShow=simplify(shfdep), Show=simplify(py3_81), Collapse=True, Disable=False)

material_database_hideshow_2 = RemoteReceiver(flatten(material_database_hideshow))
filter_129 = StreamFilter(Gate=lng_18, Stream0="False", Stream1=material_database_hideshow_2)
freeze_gate_78 = StreamFreezeGate(Data=filter_129, PassingSwitch=filter_53, Freeze=True, Hold=False)
cull_43 = CullPattern(List=freeze_gate_51, CullPattern=freeze_gate_78)
create_material_names_sorted_2 = RemoteReceiver(create_material_names_sorted)
cset_11 = CreateSet(List=cull_43)  # -> Set, Map
cull_44 = CullPattern(List=cset_11.Set, CullPattern=cset_11.Set)
mindex_16 = MemberIndex(Set=cull_43, Member=cull_44)  # -> Index, Count
freeze_gate_79 = StreamFreezeGate(Data=create_material_names_sorted_2, PassingSwitch=filter_53, Freeze=True, Hold=False)
hold_10 = HoldingGate(Data=mindex_16.Index)
item_81 = ListItem(List=freeze_gate_79, Index=hold_10, Wrap=True)
expression_115 = Expression(x=item_23, y=item_81, Expression="x≠y")
cull_45 = CullPattern(List=split_7, CullPattern=expression_115)
join_21 = TextJoin(Text=cull_45, Join="|")
filter_130 = StreamFilter(Gate=bool_49, Stream0=bool_49, Stream1=join_21)
freeze_gate_80 = StreamFreezeGate(Data=filter_130, PassingSwitch=material_database_remove_material_2, Freeze=False, Hold=False)

panel_293 = Panel(filter_130)
panel_294 = Panel(freeze_gate_80)
setdocumentusertext_4 = Python3Script(key=panel_220, load_value=freeze_gate_56, remove_value=freeze_gate_80, add_value=freeze_gate_59, sync=or_27)  # -> done
# ---------- setdocumentusertext_4: Python ----------
import Rhino
import rhinoscriptsyntax as rs
import scriptcontext as sc

def modify_value(value):
    sc.doc = Rhino.RhinoDoc.ActiveDoc

    return rs.SetDocumentUserText(key, value)

    sc.doc = ghdoc

if load_value:
    done = modify_value(load_value)

elif add_value:
    done = modify_value(add_value)

elif remove_value:
    done = modify_value(remove_value)
elif remove_value == False:
    done = modify_value(None)

elif sync:
    done = True
# ---------- end setdocumentusertext_4 ----------
getdocumentusertext_15 = Python3Script(run=setdocumentusertext_4, key="Heath materials")  # -> json_string; same code as getdocumentusertext_14
split_20 = TextSplit(Text=getdocumentusertext_15, Separators="|")
hold_11 = HoldingGate(Data=split_20)
strtoobj_8 = HBStringToObject(hb_str=hold_11)  # -> flatten(hb_obj); plug-in component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
ipy2_3 = IronPython2Script(materials=strtoobj_8)  # -> unique_materials; inputs materials: list; same code as ipy2
lng_61 = ListLength(List=ipy2_3)
lng_62 = ListLength(List=strtoobj_8)
clean_22 = CleanTree(RemoveNulls=True, RemoveInvalid=True, RemoveEmpty=False, Tree=ipy2_3)
smaller_13 = SmallerThan(FirstNumber=lng_61, SecondNumber=lng_62)  # -> SmallerThan, OrEqualTo
created_materials_database_2 = RemoteSender(clean_22)
hasdata_18 = DataExists(Data=smaller_13.SmallerThan)
filter_131 = StreamFilter(Gate=hasdata_18, Stream0="False", Stream1=smaller_13.SmallerThan)
overlap_materials = RemoteSender(filter_131)

overlap_materials_2 = RemoteReceiver(overlap_materials)
hideshow_87 = HideShowElement(ElementToHideShow=label_59, Show=overlap_materials_2, Collapse=True, Disable=False)

panel_295 = Panel(setdocumentusertext_4)
panel_296 = Panel(getdocumentusertext_15)
panel_297 = Panel(clean_22)

created_materials_database_3 = RemoteReceiver(created_materials_database_2)
cull_46 = CullPattern(List=created_materials_database_3, CullPattern=mindex_13.Count)
lng_63 = ListLength(List=created_materials_database_3)
lng_64 = ListLength(List=cull_46)
created_materials_database_current = RemoteSender(cull_46)

larger_14 = LargerThan(FirstNumber=lng_63, SecondNumber=lng_64)  # -> LargerThan, OrEqualTo

hasdata_19 = DataExists(Data=larger_14.LargerThan)
filter_132 = StreamFilter(Gate=hasdata_19, Stream0="False", Stream1=larger_14.LargerThan)
invalid_material_categories = RemoteSender(filter_132)

invalid_material_categories_2 = RemoteReceiver(invalid_material_categories)
hideshow_88 = HideShowElement(ElementToHideShow=label_5, Show=invalid_material_categories_2, Collapse=True, Disable=False)

created_materials_database_current_2 = RemoteReceiver(created_materials_database_current)

database_materials_current_3 = RemoteReceiver(database_materials_current)
lng_65 = ListLength(List=database_materials_current_3)
series = Series(Start=0, Step=1, Count=lng_65)
hasdata_20 = DataExists(Data=database_materials_current_3)
tsort = SortText(Keys=database_materials_current_3, Values=series, Culture=127)  # -> Keys, Values
filter_133 = StreamFilter(Gate=hasdata_20, Stream0=empty_10, Stream1=tsort.Keys)
create_construction_materials_sorted = RemoteSender(tsort.Values)
setlist_15 = SetListContents(ListToModify=pulldown_26, NewListContents=filter_133, SelectedIndex=bang_11.Branch0)

create_construction_materials_sorted_2 = RemoteReceiver(create_construction_materials_sorted)
item_82 = ListItem(List=created_materials_database_current_2, Index=create_construction_materials_sorted_2, Wrap=invert(True))
item_83 = ListItem(List=item_82, Index=create_construction_materials_3, Wrap=invert(True))
repeat_23 = RepeatData(Data=item_83, Length=visible_layers_2)  # -> flatten(Data)
cluster_45 = Cluster(materials=repeat_23, construction_name=create_construction_name_4, thicknesses=repeat_17)  # -> error_2, construction_2
create_construction_error = RemoteSender(cluster_45.error_2)
gate_95 = StreamGate(Stream=cluster_45.construction_2, Gate=create_construction_2)  # -> Target0, Target1
objtostr_4 = HBObjectToString(hb_obj=gate_95.Target1)  # -> hb_str; plug-in component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
entwine_224 = Entwine(Branch00=getdocumentusertext_11, Branch01=objtostr_4, FlattenInputs=True)  # -> flatten(Result)
freeze_gate_81 = StreamFreezeGate(Data=entwine_224, PassingSwitch=create_construction_2, Freeze=False, Hold=False)
join_22 = TextJoin(Text=freeze_gate_81, Join="|")

create_construction_error_2 = RemoteReceiver(create_construction_error)
panel_298 = Panel(create_construction_error_2)
split_21 = TextSplit(Text=create_construction_error_2, Separators=panel_186)
trim_2 = TextTrim(Text=split_21, Start=True, End=True)
item_84 = ListItem(List=trim_2, Index=0, Wrap=True)  # -> Item, Item1
lng_66 = ListLength(List=split_21)
len_6 = TextLength(Text=item_84.Item1)
larger_15 = LargerThan(FirstNumber=lng_66, SecondNumber="1")  # -> LargerThan, OrEqualTo
subtraction_32 = Subtraction(A=len_6, B=Slider(11, range=0..20))
fragment_5 = TextFragment(Text=item_84.Item1, Start="0", Count=subtraction_32)
filter_134 = StreamFilter(Gate=larger_15.LargerThan, Stream0=create_construction_error_2, Stream1=fragment_5)
entwine_225 = Entwine(Branch00=filter_134, Branch01=gate_92.Target1, Branch02=gate_41.Target1, FlattenInputs=True)  # -> flatten(Result)
panel_299 = Panel(filter_134)
item_85 = ListItem(List=entwine_225, Index=0, Wrap=True)
create_construction_error_message = RemoteSender(item_85)

create_construction_error_message_2 = RemoteReceiver(create_construction_error_message)
null_63 = NullItem(Item=create_construction_error_message_2)  # -> NullFlags, InvalidFlags, Description
filter_135 = StreamFilter(Gate=null_63.NullFlags, Stream0=create_construction_error_message_2, Stream1=" ")
filter_136 = StreamFilter(Gate=null_63.NullFlags, Stream0=Slider(500, range=0..1000), Stream1=Slider(1000000, range=0..1000000))
hideshow_89 = HideShowElement(ElementToHideShow=button_49, Show=True, Collapse=True, Disable=invert(null_63.NullFlags))
tooltip_19 = AttachTooltipToElement(ElementsToAttachTo=button_49, TooltipContent=filter_135, ShowDelay=filter_136, Duration=Slider(5000, range=0..10000))

setdocumentusertext_5 = Python3Script(
    key=panel_219,
    load_value=freeze_gate_37,
    remove_value=freeze_gate_26,
    add_value=join_22,
    sync=sync_construction_database_2)  # -> done
# ---------- setdocumentusertext_5: Python ----------
import Rhino
import rhinoscriptsyntax as rs
import scriptcontext as sc

def modify_value(value):
    sc.doc = Rhino.RhinoDoc.ActiveDoc

    done = rs.SetDocumentUserText(key, value)
    return done

    sc.doc = ghdoc

if load_value:
    done = modify_value(load_value)

if add_value:
    done = modify_value(add_value)

if remove_value:
    done = modify_value(remove_value)

if remove_value == False:
    done = modify_value(None)

elif sync:
    done = True
# ---------- end setdocumentusertext_5 ----------
getdocumentusertext_16 = Python3Script(run=setdocumentusertext_5, key="Heath constructions")  # -> json_string; same code as getdocumentusertext_14
split_22 = TextSplit(Text=getdocumentusertext_16, Separators="|")
hold_12 = HoldingGate(Data=split_22)
strtoobj_9 = HBStringToObject(hb_str=hold_12)  # -> flatten(hb_obj); plug-in component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
ipy2_4 = IronPython2Script(constructions=strtoobj_9)  # -> unique_constructions; inputs constructions: list
# ---------- ipy2_4: IronPython ----------
"""Grasshopper Script"""

unique_constructions = []

for i in range(len(constructions)):
    if constructions[i] not in unique_constructions:
        unique_constructions.append(constructions[i])
# ---------- end ipy2_4 ----------
lng_67 = ListLength(List=ipy2_4)
lng_68 = ListLength(List=strtoobj_9)
clean_23 = CleanTree(RemoveNulls=True, RemoveInvalid=True, RemoveEmpty=False, Tree=ipy2_4)
smaller_14 = SmallerThan(FirstNumber=lng_67, SecondNumber=lng_68)  # -> SmallerThan, OrEqualTo
created_constructions_database_2 = RemoteSender(clean_23)
hasdata_21 = DataExists(Data=smaller_14.SmallerThan)
filter_137 = StreamFilter(Gate=hasdata_21, Stream0="False", Stream1=smaller_14.SmallerThan)
overlap_constructions = RemoteSender(filter_137)

overlap_constructions_2 = RemoteReceiver(overlap_constructions)
hideshow_90 = HideShowElement(ElementToHideShow=label_58, Show=overlap_constructions_2, Collapse=True, Disable=False)

panel_300 = Panel(strtoobj_9)
panel_301 = Panel(clean_23)
hideshow_91 = HideShowElement(ElementToHideShow=[pulldown_7, button_25, textbox_8], Show=True, Collapse=True, Disable=load_honeybee_model_2)

# ---- group: Visualize module (continued)
freeze_gate_82 = StreamFreezeGate(Data=and_64, PassingSwitch=and_64)
bool_81 = Boolean(freeze_gate_82)
rec_61 = DataRecorder(bool_81, DataLimit=-10, RecordData=True)
int_14 = Integer(rec_61)
ma_77 = MassAddition(Input=int_14)  # -> Result, PartialResults
event_79 = EventGate(Data=ma_77.Result)  # -> Data, IsNew
dam_30 = DataDam(DataA=event_79.Data, BufferDelay=2500000, BufferMode=2)
equals_49 = Equality(FirstNumber=event_79.Data, SecondNumber=dam_30)  # -> Equality, Inequality
event_80 = EventGate(Data=equals_49.Inequality)  # -> Data, IsNew
load_honeybee_model = RemoteSender(event_80.Data)

# ----
load_honeybee_model_2 = RemoteReceiver(load_honeybee_model)
hideshow_92 = HideShowElement(ElementToHideShow=tb_4, Show=load_honeybee_model_2, Collapse=True, Disable=False)
load_honeybee_model_3 = RemoteReceiver(load_honeybee_model)
hideshow_93 = HideShowElement(ElementToHideShow=tb_9, Show=load_honeybee_model_3, Collapse=True, Disable=False)
py3_82 = Python3Script(hb_models_loaded=load_honeybee_model_2, hb_models_created=create_model_2)  # -> out, a
# ---------- py3_82: Python ----------
from scriptcontext import sticky

if "hb_models_loaded" not in sticky or hb_models_created:
    sticky["hb_models_loaded"] = False
elif hb_models_loaded:
    sticky["hb_models_loaded"] = True

a = sticky["hb_models_loaded"]
# ---------- end py3_82 ----------
and_64 = GateAnd(A=or_18, B=invert(py3_82.a))

# ---- group: Visualize module (continued)
pre_update_honeybee_model = RemoteSender(and_64)

# ----
panel_302 = Panel(py3_82.a)

load_honeybee_model_4 = RemoteReceiver(load_honeybee_model)
or_37 = GateOr(A=load_honeybee_model_4, B=post_remove_current_model_2, C=post_rename_current_model_2)

event_81 = EventGate(Data=or_37)  # -> Data, IsNew
expire_15 = ExpireObject(ObjectToExpire=objbynn, Expire=event_81.Data, AllObjects_Object=load_models_ping)

# ==== cluster AddDynamicShades
base_construction_set = ClusterInput()
setpoint = ClusterInput()
base_construction_set_2 = Data(base_construction_set)
decnstrconstrset = HBDeconstructConstructionSet(constr_set=base_construction_set_2)  # -> exterior_wall, exterior_roof, exposed_floor, ground_wall, ground_roof, ground_floor, window, skylight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; plug-in component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
setpoint_2 = Data(setpoint)
python = GhPythonScript(x=decnstrconstrset.window)  # -> out, a
# ---------- python: Python ----------
a = x.display_name
# ---------- end python ----------
merge = Merge(Data1=flatten(python.a), Data2=flatten("_dynamic_shades"))
shademat = HBShadeMaterial(thickness=Slider(0.01, range=0..0.01), transmittance=Slider(0.4, range=0..1))  # -> mat; plug-in component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
panel = Panel("Simple Glazing Window")
join = TextJoin(Text=merge)
windowconstrshd = HBWindowConstructionShade(
    name=join,
    win_constr=decnstrconstrset.window,
    shd_material=shademat,
    shd_location="Exterior",
    control_type=Slider(1, range=0..8),
    setpoint=setpoint_2)  # -> constr; plug-in component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
subfacesubset = HBSubfaceSubset(window=windowconstrshd, operable=windowconstrshd)  # -> subface_set; plug-in component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
constructionset = HBConstructionSet(base_constr_set=base_construction_set_2, subface_subset=subfacesubset)  # -> constr_set; plug-in component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
construction_set = Data(constructionset)
construction_set_2 = ClusterOutput(construction_set)

# ==== cluster Cluster
materials = ClusterInput()
materials_2 = Data(materials)
opaqueconstr = HBOpaqueConstruction(materials=materials_2)  # -> constr; plug-in component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
thicknesses = ClusterInput()
decnstrconstr = HBDeconstructConstruction(constr=opaqueconstr)  # -> materials, layers, r_val_si, r_val_ip, u_fac_si, u_fac_ip, shgc, t_sol, t_vis; plug-in component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
thicknesses_2 = Number(thicknesses)
nullrep = ReplaceNulls(Items=thicknesses_2, Replacements="0")  # -> Items, Count
construction_name = ClusterInput()
modify_layer_thicknesses = BrimstoneModifyThicknessesOfHoneybeeMaterials(hb_materials=decnstrconstr.materials, thicknesses=nullrep.Items)  # -> out, mod_materials; inputs hb_materials: list, thicknesses: list
# ---------- modify_layer_thicknesses: Python ----------
"""
Calculates embodied carbon for the elements of a Honeybee model if data is available
This component was inspired by the 'HB Color Face Attributes' component of Ladybug Tools 1.6.0

    Args:
        hb_materials: List of Honeybee materials which should get new thickness
        thicknesses: List of new material thicknesses

    Returns:
        mod_materials: Modified Honeybee materials
"""

import scriptcontext
#import brimstone

ghenv.Component.Message = ""#brimstone.globals.version

ghenv.Component.Name = 'Brimstone - Modify thicknesses of Honeybee materials'
ghenv.Component.NickName = 'Modify layer thicknesses'

try:  # import the core honeybee dependencies
    from honeybee_energy.material.opaque import EnergyMaterial
    from honeybee_energy.material.opaque import EnergyMaterialNoMass
except ImportError as e:
    raise ImportError('\nFailed to import honeybee:\n\t{}'.format(e))

def main(hb_materials, thicknesses):
    mod_materials = []
    assert len(hb_materials) == len(thicknesses), "Materials and thickness list must be of the same length"
    for (i, material) in enumerate(hb_materials):
        if not isinstance(material, EnergyMaterial):
            if isinstance(material, EnergyMaterialNoMass):
                mod_material = material.duplicate()
                mod_materials.append(mod_material)
            else:
                raise Exception("All materials must be valid Honeybee Energy Materials or Energy Materials (No Mass)")
        else: # if material is EnergyMaterial
            mod_material = material.duplicate()
            mod_material.thickness = thicknesses[i]
            mod_materials.append(mod_material)
    return mod_materials

if __name__ == "__main__":
    try:
        pass#flying = scriptcontext.sticky["brimstone_flying"]
    except:
        raise Exception("The 'Brimstone - Fly' component needs to exist on the canvas")
    mod_materials = main(hb_materials, thicknesses)
# ---------- end modify_layer_thicknesses ----------
construction_name_2 = Text(construction_name)
opaqueconstr_2 = HBOpaqueConstruction(name=construction_name_2, materials=modify_layer_thicknesses.mod_materials)  # -> constr; plug-in component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
error = Data(modify_layer_thicknesses.out)
error_2 = ClusterOutput(error)
construction = Data(opaqueconstr_2)
construction_2 = ClusterOutput(construction)

# ==== cluster Cluster_2
min = ClusterInput()
max = ClusterInput()
colors = ClusterInput()
legendpar = LBLegendParameters(min=min, max=max, colors=colors)  # -> leg_par; plug-in component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
leg_par = ClusterOutput(legendpar)

# ==== cluster Cluster_3
int = ClusterInput()
number_slider = Slider(2, range=0..10)
int_2 = Integer(int)
fragment = TextFragment(Text=int_2, Start="0", Count=number_slider)
fragment_2 = TextFragment(Text=int_2, Start=number_slider)
len = TextLength(Text=fragment_2)
addition = Addition(A=fragment, B="1")
equals = Equality(FirstNumber="0", SecondNumber=fragment)  # -> Equality, Inequality
filter = StreamFilter(Gate=equals.Equality, Stream0=addition, Stream1=fragment)
_10º = PowerOf10(Value=len)
multiplication = Multiplication(A=_10º, B=filter)
R = ClusterOutput(multiplication)

# ==== cluster Cluster_4
x = ClusterInput()
abs = Absolute(Value=x)
number_slider = Slider(2, range=0..10)
int = Integer(abs)
fragment = TextFragment(Text=int, Start="0", Count=number_slider)
fragment_2 = TextFragment(Text=int, Start=number_slider)
equals = Equality(FirstNumber="0", SecondNumber=fragment)  # -> Equality, Inequality
len = TextLength(Text=fragment_2)
addition = Addition(A=fragment, B="1")
filter = StreamFilter(Gate=equals.Equality, Stream0=addition, Stream1=fragment)
_10º = PowerOf10(Value=len)
multiplication = Multiplication(A=_10º, B=filter)
neg = Negative(Value=multiplication)
y = ClusterOutput(neg)

# ==== cluster Cluster_5
legendpar = LBLegendParameters(min=Slider(0, range=0..100), max=Slider(100, range=0..100), num_decimals=Slider(0, range=0..100))  # -> leg_par; plug-in component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
leg_par = ClusterOutput(legendpar)

# ==== cluster BakeGeometriesToLayers
geometry = ClusterInput()
geometry_2 = Data(geometry)
clean = CleanTree(RemoveNulls=True, RemoveInvalid=True, RemoveEmpty=False, Tree=geometry_2)
data = Data(clean)
py3 = Python3Script(x=data)  # -> out, a; inputs x: list
# ---------- py3: Python ----------
import rhinoscriptsyntax as rs
#import Rhino.Display.Text3d
import ladybug_rhino

a = []
for i in x:
    o_is_text = str(type(i)) == "<class 'IronPython.NewTypes.Grasshopper.Kernel.Types.GH_GeometricGoo`1#IGH_BakeAwareData#IGH_PreviewData_23$24'>"
    a.append(o_is_text)
    if o_is_text:
        print(dir(i))
# ---------- end py3 ----------
cull = CullPattern(List=data, CullPattern=invert(py3.a))
layers = ClusterInput()
bake = ClusterInput()
layers_2 = Data(layers)
bbox = BoundingBox(Content=<missing>, Plane=PlaneXY(0, 0, 0))  # -> Box, Box_2
txt = Text(<missing>)
bake_2 = Data(bake)
ef_layer = EleFrontLayer(Layer=layers_2, fullpath=True)
area = Area(Geometry=bbox.Box)  # -> Area, Centroid
bklay = BakeLayers(Layers=ef_layer, Bake=Toggle(True))
ef_att = EleFrontAttributes(Layer=ef_layer, maintainBakeName=False)
text_entity = TextEntity(Plane=area.Centroid, Text=txt)  # -> TextEntity, Plane, Text
weave = Weave(Pattern=[0, 1], Stream0=cull, Stream1=text_entity.TextEntity, NullGaps=False)
py3_2 = Python3Script(geo=weave, layers=ef_att)  # -> out, geo, layers; inputs geo: list, layers: list
# ---------- py3_2: Python ----------
if len(geo) == len(layers):
    pass
else:
    layers = [layers[0] for _ in range(len(geo))]
# ---------- end py3_2 ----------
bake_3 = BakeObjects(Geometry=py3_2.geo, Attributes=py3_2.layers, Bake=bake_2, createGroups=False)  # -> Message, Ghosts

# ==== cluster Cluster_6
id = ClusterInput()
id_2 = Guid(id)
filter_geometry_by_active_layer = Python3Script(geo=id_2)  # -> filtered_geo; inputs geo: list
# ---------- filter_geometry_by_active_layer: Python ----------
"""Filters geometry by active layer"""

import Rhino.Geometry as rg
import rhinoscriptsyntax as rs
import scriptcontext as sc
import Rhino

filtered_geo = []
sc.doc = Rhino.RhinoDoc.ActiveDoc
for g in geo:
    obj = sc.doc.Objects.Find(g)
    index = obj.Attributes.LayerIndex
    layer = sc.doc.Layers[index]
    if(layer.IsVisible):
        filtered_geo.append(g)
sc.doc = ghdoc
# ---------- end filter_geometry_by_active_layer ----------
rooms = Geometry(filter_geometry_by_active_layer)
rooms_2 = ClusterOutput(rooms)

# ==== cluster Cluster_8
data = ClusterInput()
model = ClusterInput()
title = ClusterInput()
data_2 = Data(data)
model_2 = Text(model)
title_2 = Text(title)
cluster = Cluster_7(L=data_2)
join = TextJoin(Text=[title_2, " (design day: {0})"])
format = Format(Format=join, Culture=127, Data0=cluster)
entwine = Entwine(Branch00=format, Branch01=model_2, FlattenInputs=True)
join_2 = TextJoin(Text=flatten(entwine), Join="Model: ")
graph_title = Data(join_2)
graph_title_2 = ClusterOutput(graph_title)

# ==== cluster Cluster_7
L = ClusterInput()
item = ListItem(List=L, Index=0, Wrap=True)
datadt = LBDataDateTimes(data=item)  # -> hoys; plug-in component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
item_2 = ListItem(List=datadt, Index=0, Wrap=True)
py3 = Python3Script(x=item_2)  # -> out, a
# ---------- py3: Python ----------
import datetime

# Define the year
year = 2026

# Convert HOY → datetime
start_of_year = datetime.datetime(year, 1, 1, 0, 0)   # midnight Jan 1
date = start_of_year + datetime.timedelta(hours=x)

a = date.strftime("%b %d")
# ---------- end py3 ----------
a = ClusterOutput(py3.a)
