# Grasshopper definition heathUI_0.4.0-dev-im.gh (Grasshopper 1.0.8)
# plug-ins: RhinoCodePluginGH, Heteroptera, Human UI, Pufferfish, Human, LadybugGrasshopper, MetaHopper, eleFront, Wombat, Telepathy

restart_heath = RemoteSender(Button())

panel = Panel("""LargeOffice
MediumOffice
SmallOffice
MidriseApartment
HighriseApartment
Retail
StripMall
PrimarySchool
SecondarySchool
SmallHotel
LargeHotel
Hospital
Outpatient
Laboratory
Warehouse
SuperMarket
FullServiceRestaurant
QuickServiceRestaurant
Courthouse
LargeDataCenterHighITE
LargeDataCenterLowITE
SmallDataCenterHighITE
SmallDataCenterLowITE""")

# ----
# CLICK BUTTON
# TO RESTART
# HEATH
number_slider = Slider(200, range=0..1000)
selobj = GetSelectedObjects()  # -> ComponentObjects, ParamObjects, OtherObjects
# Dev notes
# Sprint 3
# - Assign type changed to import geometry
# - Pre-window with link to github and mail
# - Attribute description changed to Heath geometry type
# - Wireframe mode for all modules with preview checkbox
# - Zoom button for locating visualisations
# - Heating setpoint is strictly lower than cooling setpoint
# - Added tooltips to construction modules and sliders
# - Preview in geometry module is updated when model is scaled
# - Preview is only active when its corresponding tab is active
# - The chackboxes in analysis module is changed to a pulldown menu
# - Preview all option is available is geometry tab
# - A legend is made to the preview in the geometry tab
# - Bug in the create model in assembly module is made, now the model components can be shown
# - The option to show all is added in the show model components
# - Ticks have been added to the sliders, along with the setting of appropriate ranges
# - Units have been added to the sliders
# - Python dependencies have been tested for the Grasshopper script
# - Crate window construction have been added to the construction module
# - Select window construction possibility, (from created windows) have been added to the construction module
# - Matplotlib bug is fixed so that it can display an arbitrary amount of features
# - Daylight simulation has been added to the analysis module
# - Detailed energy simulation have been added to the analysis module, (NOT YET)
# - The help button have been poplated
# - Handling if the simulation fails, with appropriate information provided, (NOT YET)
setscribble = SetScribbleProperties(Scribble=selobj.OtherObjects, ScribbleSize=number_slider)

panel_2 = Panel("""properties.energy.construction.display_name
properties.energy.construction.layers
properties.energy.construction.thickness
properties.energy.construction.mass_area_density
properties.energy.construction.area_heat_capacity
properties.energy.construction.r_value
properties.energy.construction.u_value
properties.energy.construction.u_factor
properties.energy.construction.shgc
properties.energy.r_factor
properties.energy.u_factor
properties.energy.shgc""")
panel_3 = Panel("""properties.energy.program_type.display_name
properties.energy.construction_set.display_name
properties.energy.is_conditioned
properties.energy.people.people_per_area
properties.energy.people.area_per_person
properties.energy.lighting.watts_per_area
properties.energy.electric_equipment.watts_per_area
properties.energy.gas_equipment.watts_per_area
properties.energy.service_hot_water.flow_per_area""")
bldg_programs = RemoteSender(panel)
panel_4 = Panel("""display_name
identifier
multiplier
exclude_floor_area
story
volume
floor_area
exposed_area
exterior_wall_area
exterior_aperture_area
average_floor_height""")
panel_5 = Panel("""display_name
identifier
boundary_condition
has_parent
parent
azimuth
altitude
area
perimeter
type
is_operable
is_glass""")
panel_6 = Panel("""Could not save geometry. 
It was not of the correct type.""")

label = CreateLabel(LabelText="Exterior", LabelSize=12, Justification=0)

label_2 = CreateLabel(LabelText="Ground", LabelSize=12, Justification=0)

label_3 = CreateLabel(LabelText="Subface", LabelSize=12, Justification=0)

label_4 = CreateLabel(LabelText="Interior", LabelSize=12, Justification=0)

true_button = CreateTrueOnlyButton(ButtonName="?", ButtonStyle=2)
label_5 = CreateLabel(LabelText=panel_6, LabelSize=12, Justification=0)
values = ValueListener(Elements=true_button, SomeProperty=True)  # -> Values, Indices
info_save_geometry = RemoteSender(values.Values)
adjustelem = AdjustElementAppearance(
    ElementsToAdjust=true_button,
    Foreground=ColourSwatch(SwatchColor=RGB(0, 0, 0)),
    Background=ColourSwatch(SwatchColor=RGB(230, 230, 230)),
    FontSize=Slider(12, range=0..300))
data = Data(label)
toggle = BooleanToggle(False)
adjustpos = AdjustElementPositioning(ElementsToAdjust=true_button, AbsolutePositioning=False, Width=Slider(29, range=0..300))
adjustelem_2 = AdjustElementAppearance(ElementsToAdjust=label_5, Foreground=ColourSwatch(SwatchColor=RGB(255, 0, 0)))

# ----
# Louvers
location = Data()

# ----
# Location
location_2 = Data()

# ----
# For testing
data_2 = Data(["Heating", "Solar", "Service Hot Water", "Electric Equipment", "Lighting", "People", "Infiltration", "Mechanical Ventilation", "Opaque Conduction", "Window Conduction", "Cooling", "Storage"])
panel_7 = Panel(data_2)
data_3 = Data(Tree({0;0}: [0, 0, 0, 0, 0, 0, 0, 0, 0, 0, 0, 0], {0;1}: [0.1154636743, 0.2088814282, 0.4621754872, 0.6375773836, 0.7940293548, 0.7463955098, 0.7771035315, 0.6868606807, 0.5770758629, 0.3882011428, 0.1539180345, 0.1039965989], {0;2}: [0.2845266784, 0.2593931982, 0.3068475988, 0.3112341165, 0.3274388209, 0.3004628568, 0.2994641541, 0.2849765538, 0.2931936837, 0.2954218727, 0.2799234578, 0.2870384056], {0;3}: [3.26489514, 2.948937546, 3.26489514, 3.159575942, 3.26489514, 3.159575942, 3.26489514, 3.26489514, 3.159575942, 3.26489514, 3.159575942, 3.26489514], {0;4}: [0.4188465123, 0.3783129788, 0.4188465123, 0.4053353345, 0.4188465123, 0.4053353345, 0.4188465123, 0.4188465123, 0.4053353345, 0.4188465123, 0.4053353345, 0.4188465123], {0;5}: [145.0707, 131.0316, 145.0707, 140.391, 145.0707, 140.391, 145.0707, 145.0707, 140.391, 145.0707, 140.391, 145.0707], {0;6}: [-13.42394635, -12.17954569, -11.63497027, -9.703517743, -7.231149303, -5.714291235, -5.026111258, -5.365052955, -6.984852185, -8.612623152, -10.78235179, -12.63972442], {0;7}: [-127.6578232, -115.5253908, -130.3991254, -128.4476678, -136.7388039, -132.9998708, -138.3167409, -138.9867771, -132.4821465, -134.6450452, -126.8261408, -128.9392353], {0;8}: [-4.317090982, -3.828538366, -4.007361586, -3.591511594, -3.312717163, -3.049022121, -3.055337228, -3.177779608, -3.37671771, -3.733105664, -3.928085146, -4.22849013], {0;9}: [-1.904284325, -1.611011521, -1.522864461, -1.139056545, -0.6851745139, -0.4758042193, -0.339572292, -0.4501261671, -0.7765412269, -1.097827525, -1.460511454, -1.777338546], {0;10}: [-0.7767994186, -0.568607221, -0.5137867107, -0.7067512703, -0.665388473, -1.639501883, -1.948212559, -0.6954699949, -0.143473928, -0.2547466496, -0.4393643663, -0.5620924752], {0;11}: [-1.074487752, -1.11403151, -1.445356325, -1.316217828, -1.242676437, -1.124279386, -1.145035073, -1.051073081, -1.062449287, -1.094716512, -0.9532992481, -0.9985958205]))
panel_8 = Panel(data_3)
num = Number(panel_8)

# ----
# For testing
data_4 = Data(["Heating", "Solar", "Service Hot Water", "Electric Equipment", "Lighting", "People", "Infiltration", "Mechanical Ventilation", "Opaque Conduction", "Window Conduction", "Cooling", "Storage"])
panel_9 = Panel(data_4)
data_5 = Data(Tree({0;0}: [0, 0, 0, 0, 0, 0, 0, 0, 0, 0, 0, 0], {0;1}: [0.1154636743, 0.2088814282, 0.4621754872, 0.6375773836, 0.7940293548, 0.7463955098, 0.7771035315, 0.6868606807, 0.5770758629, 0.3882011428, 0.1539180345, 0.1039965989], {0;2}: [0.2845266784, 0.2593931982, 0.3068475988, 0.3112341165, 0.3274388209, 0.3004628568, 0.2994641541, 0.2849765538, 0.2931936837, 0.2954218727, 0.2799234578, 0.2870384056], {0;3}: [3.26489514, 2.948937546, 3.26489514, 3.159575942, 3.26489514, 3.159575942, 3.26489514, 3.26489514, 3.159575942, 3.26489514, 3.159575942, 3.26489514], {0;4}: [0.4188465123, 0.3783129788, 0.4188465123, 0.4053353345, 0.4188465123, 0.4053353345, 0.4188465123, 0.4188465123, 0.4053353345, 0.4188465123, 0.4053353345, 0.4188465123], {0;5}: [145.0707, 131.0316, 145.0707, 140.391, 145.0707, 140.391, 145.0707, 145.0707, 140.391, 145.0707, 140.391, 145.0707], {0;6}: [-13.42394635, -12.17954569, -11.63497027, -9.703517743, -7.231149303, -5.714291235, -5.026111258, -5.365052955, -6.984852185, -8.612623152, -10.78235179, -12.63972442], {0;7}: [-127.6578232, -115.5253908, -130.3991254, -128.4476678, -136.7388039, -132.9998708, -138.3167409, -138.9867771, -132.4821465, -134.6450452, -126.8261408, -128.9392353], {0;8}: [-4.317090982, -3.828538366, -4.007361586, -3.591511594, -3.312717163, -3.049022121, -3.055337228, -3.177779608, -3.37671771, -3.733105664, -3.928085146, -4.22849013], {0;9}: [-1.904284325, -1.611011521, -1.522864461, -1.139056545, -0.6851745139, -0.4758042193, -0.339572292, -0.4501261671, -0.7765412269, -1.097827525, -1.460511454, -1.777338546], {0;10}: [-0.7767994186, -0.568607221, -0.5137867107, -0.7067512703, -0.665388473, -1.639501883, -1.948212559, -0.6954699949, -0.143473928, -0.2547466496, -0.4393643663, -0.5620924752], {0;11}: [-1.074487752, -1.11403151, -1.445356325, -1.316217828, -1.242676437, -1.124279386, -1.145035073, -1.051073081, -1.062449287, -1.094716512, -0.9532992481, -0.9985958205]))
panel_10 = Panel(data_5)
num_2 = Number(panel_10)

# ----
# For testing
data_6 = Data(["Heating", "Solar", "Service Hot Water", "Electric Equipment", "Lighting", "People", "Infiltration", "Mechanical Ventilation", "Opaque Conduction", "Window Conduction", "Cooling", "Storage"])
panel_11 = Panel(data_6)
data_7 = Data(Tree({0;0}: [0, 0, 0, 0, 0, 0, 0, 0, 0, 0, 0, 0], {0;1}: [0.1154636743, 0.2088814282, 0.4621754872, 0.6375773836, 0.7940293548, 0.7463955098, 0.7771035315, 0.6868606807, 0.5770758629, 0.3882011428, 0.1539180345, 0.1039965989], {0;2}: [0.2845266784, 0.2593931982, 0.3068475988, 0.3112341165, 0.3274388209, 0.3004628568, 0.2994641541, 0.2849765538, 0.2931936837, 0.2954218727, 0.2799234578, 0.2870384056], {0;3}: [3.26489514, 2.948937546, 3.26489514, 3.159575942, 3.26489514, 3.159575942, 3.26489514, 3.26489514, 3.159575942, 3.26489514, 3.159575942, 3.26489514], {0;4}: [0.4188465123, 0.3783129788, 0.4188465123, 0.4053353345, 0.4188465123, 0.4053353345, 0.4188465123, 0.4188465123, 0.4053353345, 0.4188465123, 0.4053353345, 0.4188465123], {0;5}: [145.0707, 131.0316, 145.0707, 140.391, 145.0707, 140.391, 145.0707, 145.0707, 140.391, 145.0707, 140.391, 145.0707], {0;6}: [-13.42394635, -12.17954569, -11.63497027, -9.703517743, -7.231149303, -5.714291235, -5.026111258, -5.365052955, -6.984852185, -8.612623152, -10.78235179, -12.63972442], {0;7}: [-127.6578232, -115.5253908, -130.3991254, -128.4476678, -136.7388039, -132.9998708, -138.3167409, -138.9867771, -132.4821465, -134.6450452, -126.8261408, -128.9392353], {0;8}: [-4.317090982, -3.828538366, -4.007361586, -3.591511594, -3.312717163, -3.049022121, -3.055337228, -3.177779608, -3.37671771, -3.733105664, -3.928085146, -4.22849013], {0;9}: [-1.904284325, -1.611011521, -1.522864461, -1.139056545, -0.6851745139, -0.4758042193, -0.339572292, -0.4501261671, -0.7765412269, -1.097827525, -1.460511454, -1.777338546], {0;10}: [-0.7767994186, -0.568607221, -0.5137867107, -0.7067512703, -0.665388473, -1.639501883, -1.948212559, -0.6954699949, -0.143473928, -0.2547466496, -0.4393643663, -0.5620924752], {0;11}: [-1.074487752, -1.11403151, -1.445356325, -1.316217828, -1.242676437, -1.124279386, -1.145035073, -1.051073081, -1.062449287, -1.094716512, -0.9532992481, -0.9985958205]))
panel_12 = Panel(data_7)
num_3 = Number(panel_12)

# ----
# Create construction
panel_13 = Panel("gypsum")
number_slider_2 = Slider(0.3, range=0..1)
searchmats = HBSearchMaterials(keywords="insulation")  # -> opaque_mats, window_mats; plug-in component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
searchmats_2 = HBSearchMaterials(keywords="concrete")  # -> opaque_mats, window_mats; plug-in component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
searchmats_3 = HBSearchMaterials()  # -> opaque_mats, window_mats; plug-in component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
searchmats_4 = HBSearchMaterials(keywords="air")  # -> opaque_mats, window_mats; plug-in component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
searchmats_5 = HBSearchMaterials(keywords="plywood")  # -> opaque_mats, window_mats; plug-in component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
searchmats_6 = HBSearchMaterials(keywords=panel_13)  # -> opaque_mats, window_mats; plug-in component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
searchconstrs = HBSearchConstructions()  # -> opaque_constrs, window_constrs, shade_constrs; plug-in component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
searchconstrs_2 = HBSearchConstructions()  # -> opaque_constrs, window_constrs, shade_constrs; plug-in component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
list = ItemSelector(
    searchmats.opaque_mats,
    {"AtticFloor Insulation", "Generic 25mm Insulation", "Generic 50mm Insulation", "I01 25mm insulation board", "I02 50mm insulation board", "IEAD NonRes Roof Insulation-1.76", "IEAD Roof Insulation R-3.47 IP", "Insulation 1m", "Mass NonRes Wall Insulation-0.43", "Mass Wall Insulation R-4.23 IP"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}, selected="AtticFloor Insulation")
list_2 = ItemSelector(
    searchmats_2.opaque_mats,
    {"100mm Normalweight concrete floor", "12 in. Normalweight Concrete Floor", "4 in. Normalweight Concrete Floor", "4 in. Normalweight Concrete Wall", "6 in. Heavyweight Concrete Roof", "6 in. Normalweight Concrete Floor", "8 in. Concrete Block Basement Wall", "8 in. Concrete Block Wall", "8 in. Normalweight Concrete Floor", "8 in. Normalweight Concrete Wall", "8IN CONCRETE HW RefBldg", "8IN Concrete HW", "Concrete Pavement", "Generic HW Concrete", "Generic LW Concrete", "HW CONCRETE", "HW CONCRETE 8 in", "M11 100mm lightweight concrete", "M15 200mm heavyweight concrete", "MAT-CC05 4 HW CONCRETE", "MAT-CC05 8 HW CONCRETE", "NACM_Concrete 4in_140lb/ft3"}, selected="100mm Normalweight concrete floor")
list_3 = ItemSelector(
    searchmats_6.opaque_mats,
    {"1/2 in. Gypsum Board", "1/2IN Gypsum", "5/8 in. Gypsum Board", "G01 13mm gypsum board", "G01a 19mm gypsum board", "Generic Gypsum Board", "Gypsum Board - 1/2 in. CBES", "Gypsum Or Plaster Board - 3/8 in.", "NACM_Gypsum Board 5/8in"}, selected="1/2 in. Gypsum Board")
list_4 = ItemSelector(
    searchmats_4.opaque_mats,
    {"F04 Wall air space resistance", "F05 Ceiling air space resistance", "Generic Ceiling Air Gap", "Generic Wall Air Gap", "Typical Air Wall"}, selected="F04 Wall air space resistance")
list_5 = ItemSelector(searchmats_5.opaque_mats, {"5/8 in. Plywood", "Plywood - 5/8 in. CBES"}, selected="5/8 in. Plywood")
number_slider_3 = Slider(0.3, range=0..1)
opaquemat = HBOpaqueMaterial(
    name="XPS insulation",
    thickness=number_slider_2,
    conductivity=Slider(0.036, range=0..0.1),
    density=Slider(28, range=0..100),
    spec_heat=Slider(1500, range=0..10000))  # -> mat; plug-in component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
list_6 = ItemSelector(
    searchconstrs.window_constrs,
    {"ASHRAE 189.1-2009 ExtWindow ClimateZone 1", "ASHRAE 189.1-2009 ExtWindow ClimateZone 2", "ASHRAE 189.1-2009 ExtWindow ClimateZone 3", "ASHRAE 189.1-2009 ExtWindow ClimateZone 4-5", "ASHRAE 189.1-2009 ExtWindow ClimateZone 6", "ASHRAE 189.1-2009 ExtWindow ClimateZone 7-8"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}, selected="U 0.17 SHGC 0.36 Simple Glazing Window")
list_7 = ItemSelector(
    searchconstrs_2.window_constrs,
    {"ASHRAE 189.1-2009 ExtWindow ClimateZone 1", "ASHRAE 189.1-2009 ExtWindow ClimateZone 2", "ASHRAE 189.1-2009 ExtWindow ClimateZone 3", "ASHRAE 189.1-2009 ExtWindow ClimateZone 4-5", "ASHRAE 189.1-2009 ExtWindow ClimateZone 6", "ASHRAE 189.1-2009 ExtWindow ClimateZone 7-8"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}, selected="ASHRAE 189.1-2009 ExtWindow ClimateZone 1")
merge = Merge(Data1=list_2, Data2=list_4, Data3=list_5, Data4=opaquemat, Data5=list_3)
merge_2 = Merge(
    Data1=Slider(0.1, range=0..1),
    Data2=Slider(0.11, range=0..1),
    Data3=Slider(0.016, range=0..0.1),
    Data4=number_slider_2,
    Data5=Slider(0.012, range=0..0.1))
interiorsubset = HBInteriorConstructionSubset()  # -> interior_set; plug-in component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
groundsubset = HBGroundConstructionSubset()  # -> ground_set; plug-in component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
cluster = Cluster(materials=merge, construction_name="Construction 1", thicknesses=merge_2)  # -> error_2, construction_2
bldgvintages = HBBuildingVintages({"ASHRAE 90.1 2019  |  IECC 2021": "2019", "ASHRAE 90.1 2016  |  IECC 2018": "2016", "ASHRAE 90.1 2013  |  IECC 2015": "2013", "ASHRAE 90.1 2010  |  IECC 2012": "2010", "ASHRAE 90.1 2007  |  IECC 2009": "2007", "ASHRAE 90.1 2004  |  IECC 2006": "2004", "1980-2004 (CBECS)": "1980_2004", "Pre-1980 (CBECS)": "pre_1980"}, selected="ASHRAE 90.1 2019  |  IECC 2021")
cluster_2 = Cluster_2(window_construction=list_7, gwp_a1_a3="2.5", gwp_a4="0.042", density_kg_m2="38.2")
decnstrconstr = HBDeconstructConstruction(constr=list_6)  # -> materials, layers, r_val_si, r_val_ip, u_fac_si, u_fac_ip, shgc, t_sol, t_vis; plug-in component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
constructiontypes = HBConstructionTypes({"SteelFramed", "WoodFramed", "Mass", "Metal Building"}, selected="WoodFramed")
climatezones = HBClimateZones({"1 - Very Hot": "1", "2 - Hot": "2", "3 - Warm": "3", "4 - Mixed": "4", "5 - Cool": "5", "6 - Cold": "6", "7 - Very Cold": "7", "8 - Subarctic": "8"}, selected="5 - Cool")
data_8 = Data(cluster_2)
panel_14 = Panel(decnstrconstr.u_fac_ip)
panel_15 = Panel(decnstrconstr.u_fac_si)
exteriorsubset = HBExteriorConstructionSubset(exterior_wall=cluster.construction_2)  # -> exterior_set; plug-in component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
subfacesubset = HBSubfaceSubset(window=data_8)  # -> subface_set; plug-in component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
panel_16 = Panel(cluster.construction_2)
constrsetclimate = HBConstructionSetByClimate(climate_zone=climatezones, vintage=bldgvintages, constr_type=constructiontypes)  # -> constr_set; plug-in component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
constructionset = HBConstructionSet(base_constr_set=constrsetclimate, exterior_subset=exteriorsubset, subface_subset=subfacesubset)  # -> constr_set; plug-in component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
decnstrconstrset = HBDeconstructConstructionSet(constr_set=constructionset)  # -> exterior_wall, exterior_roof, exposed_floor, ground_wall, ground_roof, ground_floor, window, skylight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; plug-in component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
panel_17 = Panel(decnstrconstrset.exterior_wall)

# ----
# FLY!
fly = BrimstoneFly()
# ---------- fly: Python ----------
"""This component sets up global information for Brimstone
    Inputs:
    Output:
        """

import Grasshopper
import sys
sys.path.append(Grasshopper.Folders.UserObjectFolders[0])

import brimstone
reload(brimstone)

import scriptcontext

ghenv.Component.Name = 'Brimstone - Fly!'
ghenv.Component.NickName = 'Fly!'

scriptcontext.sticky["brimstone_flying"] = 'true'
scriptcontext.sticky["brimstone_kdb_hb_json"] = 'brimstone_data/230721klimatdatabas_hb_materials.json' # json which adds honeybee material info to klimatdatabas materials
scriptcontext.sticky["brimstone_hb_kdb_csv"] = 'brimstone_data/230728_HBKlimatdatabas.csv' # csv file which translates honeybee material names to klimatdatabas material names
ghenv.Component.Message = brimstone.globals.version
# ---------- end fly ----------

# ----
# Heath launch window
panel_18 = Panel("Start")
restart_heath_2 = RemoteReceiver(restart_heath)
panel_19 = Panel("Heath provides a user interface for life cycle building performance assessment in the Rhino environment.")
gate = StreamGate(Stream=panel_18, Gate=restart_heath_2)  # -> Target0, Target1
true_button_2 = CreateTrueOnlyButton(ButtonName="Github Heath", ButtonStyle=0)
true_button_3 = CreateTrueOnlyButton(ButtonName=gate.Target0, ButtonStyle=0)
tb = CreateTextBlock(TextSize=16, Justification=1)
tb_2 = CreateTextBlock(TextSize=12, Justification=0)
values_2 = ValueListener(Elements=true_button_2, SomeProperty=True)  # -> Values, Indices
values_3 = ValueListener(Elements=true_button_3, SomeProperty=True)  # -> Values, Indices
settextblock = SetTextBlockContents(TextBlockToModify=tb, NewTextBlockContents="Email: sawen@chalmers.se")
settextblock_2 = SetTextBlockContents(TextBlockToModify=tb_2, NewTextBlockContents=panel_19)
launch_heath = RemoteSender(values_3.Values)
launch_heath_2 = RemoteReceiver(launch_heath)
launchwin = LaunchWindow(
    Show=invert(launch_heath_2),
    Name="Heath",
    Width=Slider(275, range=0..1000),
    Height=Slider(220, range=0..1000),
    ChildStatus=0,
    EnableHorizScroll=False)
github_heath = RemoteSender(values_2.Values)
accent_colors = ValueList({"Amber", "Blue", "Brown", "Cobalt", "Crimson", "Cyan", "Emerald", "Green", "Indigo", "Lime", "Magenta", "Mauve", "Olive", "Orange", "Pink", "Purple", "Red", "Sienna", "Steel", "Taupe", "Teal", "Violet", "Yellow"}, selected="Blue")
pt = ConstructPoint(XCoordinate=Slider(142, range=0..1000), YCoordinate=Slider(193, range=0..1000), ZCoordinate=0)
winprops = SetWindowProperties(
    Window=launchwin,
    StartingLocation=pt,
    Theme=0,
    AccentColor=accent_colors,
    ShowTitleBar=True,
    BackgroundColor=RGB(255, 255, 255),
    ScaleFactor=1)
entwine = Entwine(Branch00=tb_2, Branch01=true_button_2, Branch02=true_button_3, Branch03=tb, FlattenInputs=True)  # -> flatten(Result)
adjustpos_2 = AdjustElementPositioning(ElementsToAdjust=tb_2, AbsolutePositioning=False, Height=Slider(60, range=0..100))
adjustpos_3 = AdjustElementPositioning(ElementsToAdjust=tb, Margin="0, 8, 0, 0", AbsolutePositioning=False, Height=Slider(20, range=0..100))
addelems = AddElements(Window=launchwin, Elements=flatten(entwine), DoVLChecking=True)  # -> AddedElements, ElementNames
heath_launch_elements = RemoteSender(addelems.AddedElements)

info_save_geometry_2 = RemoteReceiver(info_save_geometry)
winstat = WindowStatus(Window=launchwin)

# ----
# Transparent window
panel_20 = Panel("Import geometry")
pickbtn = CreateRhinoPickButton(
    ButtonName=panel_20,
    Prompt="Please select geometry...",
    AllowMultiple=invert(True),
    AllowNone=True,
    Type=2,
    ButtonStyle=0)
values_4 = ValueListener(Elements=pickbtn, SomeProperty=True)  # -> Values, Indices
launchxpwin = LaunchTransparentWindow(Show=Toggle(False), Name="Control Window", Width=370, Height=400, ChildStatus=0, EnableHorizScroll=False)
addelems_2 = AddElements(Window=launchxpwin, Elements=flatten(pickbtn), DoVLChecking=True)  # -> AddedElements, ElementNames
panel_21 = Panel(values_4.Values)

# ----
# Heath github
panel_22 = Panel("https://github.com/sawenchalmers/heath")
github_heath_2 = RemoteReceiver(github_heath)
py3 = Python3Script(url=panel_22, launch=github_heath_2)
# ---------- py3: Python ----------
"""Grasshopper Script"""
import webbrowser as wb
if launch == True:
    wb.open(url, 2, True)
# ---------- end py3 ----------

# ---- group: Launch
# Launch Heath
fly_2 = HeathFly()  # -> flying
# ---------- fly_2: Python ----------
# Copyright (c) 2024, Heath.
# You should have received a copy of the GNU Affero General Public License
# along with Heath; If not, see <http://www.gnu.org/licenses/>.
# 
# @license AGPL-3.0-or-later <https://spdx.org/licenses/AGPL-3.0-or-later>

import Grasshopper, scriptcontext
import os, sys, importlib

sys.path.append(Grasshopper.Folders.UserObjectFolders[0])

# make sure we can import ladybug tools
ladybug_tools_path = "ladybug_tools\\python\\Lib\\site-packages\\"
program_files_dir = os.path.dirname(f"{os.environ['ProgramFiles']}\\{ladybug_tools_path}")
if os.path.isdir(program_files_dir):
    sys.path.append(program_files_dir)
else:
    user_folder_dir = os.path.dirname(f"{os.path.expanduser('~')}\\{ladybug_tools_path}")
    if os.path.isdir(user_folder_dir):
        sys.path.append(user_folder_dir)
    else:
        raise Exception("Couldn't find Ladybug tools python module path")

try:
    import heath
    importlib.reload(heath)
except Exception as e:
    # hack to allow the module to reside in the repo
    sys.path.append(os.path.join(os.path.dirname(ghdoc.Path), '..\src'))
    import heath
    importlib.reload(heath)

ghenv.Component.Name = 'Heath - Fly!'
ghenv.Component.NickName = 'Fly!'

scriptcontext.sticky["heath_flying"] = 'true'
ghenv.Component.Message = heath.heath_globals.version

flying = True
# ---------- end fly_2 ----------
heath_flying = RemoteSender(fly_2)

# ----
toggle_2 = BooleanToggle(True)
toggle_3 = BooleanToggle(True)
shading_geometry = Data()

# ----
# Create test model
building = Geometry([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])
adjacent_rooms_1 = Geometry([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])
ground = Geometry(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)
site = Geometry([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])
panel_23 = Panel("""Heath::Test model::Rooms
Heath::Test model::Windows
Heath::Test model::Adjacent
Heath::Test model::Context""")
adjacent_rooms_2 = Geometry([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])
entwine_2 = Entwine(Branch00="Room", Branch01="Window", Branch02="Adjacent", Branch03="Context", FlattenInputs=True)
merge_3 = Merge(Data1=ground, Data2=site, Data3=building, Data4=adjacent_rooms_1)
merge_4 = Merge(Data1=ground, Data2=site, Data3=building, Data4=adjacent_rooms_2)
lng = ListLength(List=flatten(entwine_2))
ef_layer = EleFrontLayer(FullPath=panel_23)  # -> graft(Layer), FullPath, Hidden, Locked, DisplayColour, MaterialName, Linetype, PrintColour, PrintWidth
repeat = RepeatData(Data="Heath geometry type", Length=lng)  # -> graft(Data)
ef_att = EleFrontAttributes(Keys=repeat, Values=entwine_2, Layer=ef_layer.Layer)  # -> Attributes, Keys, Values, Name, Layer, ColourSource, DisplayColour, MaterialSource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

# ----
# Model 1
windows1 = Geometry([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])
room1 = Geometry(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)
adjacent_1 = Geometry([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])
context_1 = Geometry(merge_3)

# ----
# Model 2
geo = Geometry(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)
adjacent_2 = Geometry([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])
geo_2 = Geometry([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])
context_2 = Geometry(merge_4)

entwine_3 = Entwine(Branch00=room1, Branch01=windows1, Branch02=adjacent_1, Branch03=context_1, FlattenInputs=True)
lng_2 = ListLength(List=entwine_3)
repeat_2 = RepeatData(Data=ef_att.Attributes, Length=lng_2)

# ----
# Display the materials
number_slider_4 = Slider(2, range=1..2)
generic_shgc = Data(0.4240807069)
generic_u_value = Data(1.687787378)

# ----
# Display the construction parts??
panel_24 = Panel("{0} (conductivity: {1}, density: {2}, specific heat: {3})")

# ----
# Analysis module
panel_25 = Panel("""Illuminance [Lux]
Spatial Daylight Autonomy
Daylight autonomy [%]
UDI [%]
UDI <50 [%]
UDI >3000 [%]
None""")
panel_26 = Panel("""Annual energy balance
Daily cooling profile
Daily heating profile
Cooling balance
Heating balance
None""")
panel_27 = Panel("""Annual energy balance
Daily cooling profile
Daily heating profile
Cooling balance
Heating balance
None""")
height = Slider(40, range=1..100)
width = Slider(5, range=1..100)
height_2 = Slider(40, range=1..100)
width_2 = Slider(5, range=1..100)
true_button_4 = CreateTrueOnlyButton(ButtonName="Pop-up window", ButtonStyle=0)
button = CreateButton(ButtonName="Zoom", ButtonStyle=0)
button_2 = CreateButton(ButtonName="Run daylight simulation", ButtonStyle=0)
true_button_5 = CreateTrueOnlyButton(ButtonName="Pop-up window", ButtonStyle=0)
button_3 = CreateButton(ButtonName="Zoom", ButtonStyle=0)
button_4 = CreateButton(ButtonName="Run detailed energy simulation", ButtonStyle=0)
values_5 = ValueListener(Elements=button, SomeProperty=True)  # -> Values, Indices
pulldown = CreatePulldownMenu(Label="Display", ListItems=panel_25, showLabel=True)
values_6 = ValueListener(Elements=true_button_4, SomeProperty=True)  # -> Values, Indices
values_7 = ValueListener(Elements=button_2, SomeProperty=True)  # -> Values, Indices
values_8 = ValueListener(Elements=button_3, SomeProperty=True)  # -> Values, Indices
pulldown_2 = CreatePulldownMenu(Label="Display", ListItems=panel_26, showLabel=True)
values_9 = ValueListener(Elements=true_button_5, SomeProperty=True)  # -> Values, Indices
label_6 = CreateLabel(LabelText="Display settings", LabelSize=12, Justification=0)
slider = CreateSlider(
    Slider=width,
    SnapValue=Slider(2, range=0..10),
    ShowBounds=False,
    ShowTicks=True,
    ShowTooltip=False,
    ShowValLabel=False,
    showLabel=True)
slider_2 = CreateSlider(
    Slider=height,
    SnapValue=Slider(2, range=0..10),
    ShowBounds=False,
    ShowTicks=True,
    ShowTooltip=False,
    ShowValLabel=False,
    showLabel=True)
pulldown_3 = CreatePulldownMenu(Label="Display", ListItems=panel_27, showLabel=True)
label_7 = CreateLabel(LabelText="Display settings", LabelSize=12, Justification=0)
values_10 = ValueListener(Elements=button_4, SomeProperty=True)  # -> Values, Indices
slider_3 = CreateSlider(
    Slider=width_2,
    SnapValue=Slider(2, range=0..10),
    ShowBounds=False,
    ShowTicks=True,
    ShowTooltip=False,
    ShowValLabel=False,
    showLabel=True)
slider_4 = CreateSlider(
    Slider=height_2,
    SnapValue=Slider(2, range=0..10),
    ShowBounds=False,
    ShowTicks=True,
    ShowTooltip=False,
    ShowValLabel=False,
    showLabel=True)
zoom_daylight_simulation = RemoteSender(values_5.Values)
visualize_daylight_simulations = RemoteSender(values_6.Values)
values_11 = ValueListener(Elements=pulldown, SomeProperty=True)  # -> Values, Indices
freeze_gate = StreamFreezeGate(Data=values_7.Values, PassingSwitch=invert(values_7.Values))
pre_run_daylight_simulations = RemoteSender(values_7.Values)
pre_run_daylight_simulations_2 = RemoteReceiver(pre_run_daylight_simulations)
zoom_detailed_energy_simulation = RemoteSender(values_8.Values)
detailed_energy_data_exists = RemoteReceiver()
visualize_detailed_energy_simulations = RemoteSender(values_9.Values)
values_12 = ValueListener(Elements=pulldown_2, SomeProperty=True)  # -> Values, Indices
freeze_gate_2 = StreamFreezeGate(Data=values_10.Values, PassingSwitch=invert(values_10.Values))
values_13 = ValueListener(Elements=pulldown_3, SomeProperty=True)  # -> Values, Indices
values_14 = ValueListener(Elements=slider, SomeProperty=True)  # -> Values, Indices
values_15 = ValueListener(Elements=slider_2, SomeProperty=True)  # -> Values, Indices
entwine_4 = Entwine(Branch00=slider_2, Branch01=slider, FlattenInputs=True)  # -> flatten(Result)
values_16 = ValueListener(Elements=slider_3, SomeProperty=True)  # -> Values, Indices
values_17 = ValueListener(Elements=slider_4, SomeProperty=True)  # -> Values, Indices
entwine_5 = Entwine(Branch00=slider_4, Branch01=slider_3, FlattenInputs=True)  # -> flatten(Result)
daylight_simulation_type = RemoteSender(values_11.Indices)
bool = Boolean(invert(freeze_gate))
detailed_energy_data_exists_2 = RemoteReceiver()
detailed_energy_simulation_type = RemoteSender(values_12.Indices)
tb_3 = CreateTextBlock(Text="Simulations can take a few minutes...", TextSize=16, Justification=0)
simple_energy_simulation_type = RemoteSender(values_13.Indices)
bool_2 = Boolean(invert(freeze_gate_2))
detailed_energy_simulation_width = RemoteSender(values_14.Values)
detailed_energy_simulation_height = RemoteSender(values_15.Values)
entwine_6 = Entwine(Branch00=button_2, Branch01=button, Branch02=true_button_4, FlattenInputs=True)  # -> flatten(Result)
simple_energy_simulation_height = RemoteSender(values_17.Values)
simple_energy_simulation_width = RemoteSender(values_16.Values)
hideshow = HideShowElement(ElementToHideShow=true_button_4, Show=Toggle(False), Collapse=True, Disable=False)
tap = TapBuffer(Reset=False, Incremental=True, Valve=bool, Hold=True)
tb_4 = CreateTextBlock(Text="Simulations can take a few minutes...", TextSize=16, Justification=0)
stack = CreateStack(UIElements=entwine_4, Horizontal=True)
tb_5 = CreateTextBlock(Text="Simulations can take a few minutes...", TextSize=16, Justification=0)
stack_2 = CreateStack(UIElements=entwine_5, Horizontal=True)
entwine_7 = Entwine(Branch00=label_6, Branch01=stack, FlattenInputs=True)  # -> flatten(Result)
entwine_8 = Entwine(Branch00=button_4, Branch01=button_3, Branch02=true_button_5, FlattenInputs=True)  # -> flatten(Result)
entwine_9 = Entwine(Branch00=label_7, Branch01=stack_2, FlattenInputs=True)  # -> flatten(Result)
hideshow_2 = HideShowElement(ElementToHideShow=true_button_5, Show=Toggle(False), Collapse=True, Disable=False)
hideshow_3 = HideShowElement(ElementToHideShow=button_3, Show=Toggle(False), Collapse=True, Disable=False)
tap_2 = TapBuffer(Reset=False, Incremental=True, Valve=bool_2, Hold=True)
dam = DataDam(DataA=tap, BufferDelay=2500000, BufferMode=2)
dam_2 = DataDam(DataA=tap_2, BufferDelay=2500000, BufferMode=2)
bool_3 = Boolean(invert(toggle))
stack_3 = CreateStack(UIElements=entwine_7, Horizontal=invert(True))
stack_4 = CreateStack(UIElements=entwine_9, Horizontal=invert(True))
equals = Equality(FirstNumber=tap, SecondNumber=dam)  # -> Equality, Inequality
equals_2 = Equality(FirstNumber=tap_2, SecondNumber=dam_2)  # -> Equality, Inequality
hideshow_4 = HideShowElement(ElementToHideShow=tb_5, Show=bool_3, Collapse=toggle, Disable=False)
adjustpos_4 = AdjustElementPositioning(
    ElementsToAdjust=true_button_4,
    Margin="15, 0, 0, 0",
    AbsolutePositioning=False,
    Width=Slider(110, range=0..1000),
    Height=Slider(30, range=0..1000),
    HorizontalAlignment=0)
stack_5 = CreateStack(UIElements=entwine_6, Horizontal=True)
adjustpos_5 = AdjustElementPositioning(
    ElementsToAdjust=button,
    Margin="15, 0, 0, 0",
    AbsolutePositioning=False,
    Width=Slider(60, range=0..1000),
    Height=Slider(30, range=0..1000),
    HorizontalAlignment=0)
entwine_10 = Entwine(Branch00=pulldown_2, Branch01=stack_3, FlattenInputs=True)  # -> flatten(Result)
entwine_11 = Entwine(Branch00=pulldown_3, Branch01=stack_4, FlattenInputs=True)  # -> flatten(Result)
adjustpos_6 = AdjustElementPositioning(
    ElementsToAdjust=true_button_5,
    Margin="15, 0, 0, 0",
    AbsolutePositioning=False,
    Width=Slider(110, range=0..1000),
    Height=Slider(30, range=0..1000),
    HorizontalAlignment=0)
stack_6 = CreateStack(UIElements=entwine_8, Horizontal=True)
adjustpos_7 = AdjustElementPositioning(
    ElementsToAdjust=button_3,
    Margin="15, 0, 0, 0",
    AbsolutePositioning=False,
    Width=Slider(60, range=0..1000),
    Height=Slider(30, range=0..1000),
    HorizontalAlignment=0)
detailed_energy_data_exists_3 = RemoteReceiver()
stack_7 = CreateStack(UIElements=entwine_10, Horizontal=True)
stack_8 = CreateStack(UIElements=entwine_11, Horizontal=True)
adjustpos_8 = AdjustElementPositioning(
    ElementsToAdjust=pulldown,
    AbsolutePositioning=False,
    Width=Slider(235, range=0..1000),
    Height=Slider(40, range=0..1000),
    HorizontalAlignment=0)
adjustpos_9 = AdjustElementPositioning(
    ElementsToAdjust=pulldown_2,
    AbsolutePositioning=False,
    Width=Slider(215, range=0..1000),
    Height=Slider(40, range=0..1000),
    HorizontalAlignment=0)
adjustpos_10 = AdjustElementPositioning(
    ElementsToAdjust=pulldown_3,
    AbsolutePositioning=False,
    Width=Slider(215, range=0..1000),
    Height=Slider(40, range=0..1000),
    HorizontalAlignment=0)
hideshow_5 = HideShowElement(ElementToHideShow=stack_7, Show=Toggle(False), Collapse=True, Disable=False)

button_5 = CreateButton(ButtonName="Zoom", ButtonStyle=0)
true_button_6 = CreateTrueOnlyButton(ButtonName="Pop-up window", ButtonStyle=0)
button_6 = CreateButton(ButtonName="Run simple energy simulation", ButtonStyle=0)
freeze_gate_3 = StreamFreezeGate(Data=pre_run_daylight_simulations_2, PassingSwitch=pre_run_daylight_simulations_2)
pre_run_detailed_energy_simulations = RemoteSender(values_10.Values)

# ----
# Run daylight simulations
entwine_12 = Entwine(Branch00=stack_5, Branch01=tb_3, Branch02=pulldown, FlattenInputs=True)  # -> flatten(Result)
stack_9 = CreateStack(UIElements=entwine_12, Horizontal=invert(True))
number_slider_5 = Slider(650, range=0..1000)
border = CreateBorder(
    UIElement=stack_9,
    BorderThickness=Slider(1, range=0..10),
    BorderColor=ColourSwatch(SwatchColor=RGB(217, 217, 217)),
    CornerRadius=Slider(2, range=0..10))
adjustpos_11 = AdjustElementPositioning(ElementsToAdjust=border, Margin="0, 0, 0, 0", AbsolutePositioning=False, HorizontalAlignment=0)
location_3 = Data(border)

# ----
# Run detailed energy simulations
entwine_13 = Entwine(Branch00=stack_6, Branch01=tb_5, Branch02=stack_7, FlattenInputs=True)  # -> flatten(Result)
stack_10 = CreateStack(UIElements=entwine_13, Horizontal=invert(True))
number_slider_6 = Slider(650, range=0..1000)
border_2 = CreateBorder(
    UIElement=stack_10,
    BorderThickness=Slider(1, range=0..10),
    BorderColor=ColourSwatch(SwatchColor=RGB(217, 217, 217)),
    CornerRadius=Slider(2, range=0..10))
adjustpos_12 = AdjustElementPositioning(ElementsToAdjust=border_2, Margin="0, 0, 0, 0", AbsolutePositioning=False, HorizontalAlignment=0)
location_4 = Data(border_2)

zoom_daylight_simulation_2 = RemoteReceiver(zoom_daylight_simulation)
daylight_simulation_type_2 = RemoteReceiver(daylight_simulation_type)
equals_3 = Equality(FirstNumber="6", SecondNumber=daylight_simulation_type_2)  # -> Equality, Inequality
simple_energy_simulation_height_2 = RemoteReceiver(simple_energy_simulation_height)
simple_energy_simulation_width_2 = RemoteReceiver(simple_energy_simulation_width)
simple_energy_simulation_height_3 = RemoteReceiver(simple_energy_simulation_height)
simple_energy_simulation_width_3 = RemoteReceiver(simple_energy_simulation_width)
simple_energy_simulation_height_4 = RemoteReceiver(simple_energy_simulation_height)
simple_energy_simulation_height_5 = RemoteReceiver(simple_energy_simulation_height)
simple_energy_simulation_width_4 = RemoteReceiver(simple_energy_simulation_width)
simple_energy_simulation_width_5 = RemoteReceiver(simple_energy_simulation_width)
simple_energy_simulation_height_6 = RemoteReceiver(simple_energy_simulation_height)
simple_energy_simulation_width_6 = RemoteReceiver(simple_energy_simulation_width)

# ----
# Construction module
heath_flying_2 = RemoteReceiver(heath_flying)
panel_28 = Panel("""Very Hot
Hot
Warm
Mixed
Cool
Cold
Very Cold
Subarctic""")
panel_29 = Panel("""SteelFramed
WoodFramed
Mass
Metal Building""")
py3_2 = Python3Script(get=heath_flying_2)  # -> mpl_folder
# ---------- py3_2: Python ----------
"""Grasshopper Script"""
import heath

if __name__ == "__main__":
    if get:
        print(ghdoc)
        mpl_folder = heath.get_results_folder(ghdoc)
# ---------- end py3_2 ----------
pulldown_4 = CreatePulldownMenu(Label="Type", ListItems=panel_28, SelectedIndex=Slider(4, range=0..7), showLabel=True)
pulldown_5 = CreatePulldownMenu(Label="Type", ListItems=panel_29, SelectedIndex=Slider(1, range=0..3), showLabel=True)
label_8 = CreateLabel(LabelText="Select construcion by climate", LabelSize=12, Justification=0)
true_button_7 = CreateTrueOnlyButton(ButtonName="Create window", ButtonStyle=0)
true_button_8 = CreateTrueOnlyButton(ButtonName="Create material", ButtonStyle=0)
label_9 = CreateLabel(LabelText="Select construction by type", LabelSize=12, Justification=0)
true_button_9 = CreateTrueOnlyButton(ButtonName="Create construction", ButtonStyle=0)
filepicker = CreateFilePicker(
    ButtonLabelText="Pick constructions from file",
    DialogType=0,
    MustExist=True,
    Filter="JSON File|*.json",
    StartingPath=py3_2)
button_7 = CreateButton(ButtonName="Load constructions", ButtonStyle=0)
label_10 = CreateLabel(LabelText="Select subset construction", LabelSize=12, Justification=0)
values_18 = ValueListener(Elements=filepicker, SomeProperty=True)  # -> Values, Indices
values_19 = ValueListener(Elements=true_button_8, SomeProperty=True)  # -> Values, Indices
values_20 = ValueListener(Elements=true_button_7, SomeProperty=True)  # -> Values, Indices
values_21 = ValueListener(Elements=true_button_9, SomeProperty=True)  # -> Values, Indices
values_22 = ValueListener(Elements=pulldown_5, SomeProperty=True)  # -> Values, Indices
values_23 = ValueListener(Elements=pulldown_4, SomeProperty=True)  # -> Values, Indices
bool_4 = Boolean(values_18.Values)
panel_30 = Panel(values_19.Values)
create_material_modal = RemoteSender(values_19.Values)
base_type = RemoteSender(values_22.Values)
panel_31 = Panel(values_20.Values)
panel_32 = Panel(values_21.Values)
create_construction_window = RemoteSender(values_21.Values)
create_window_modal = RemoteSender(values_20.Values)
loaded_constructions_file = RemoteSender(values_18.Values)
null = NullItem(Item=bool_4)  # -> NullFlags, InvalidFlags, Description
addition = Addition(A=values_23.Indices, B="1")
entwine_14 = Entwine(Branch00=label_8, Branch01=pulldown_4, FlattenInputs=True)  # -> flatten(Result)
entwine_15 = Entwine(Branch00=label_9, Branch01=pulldown_5, FlattenInputs=True)  # -> flatten(Result)
base_climate = RemoteSender(addition)
stack_11 = CreateStack(UIElements=entwine_14, Horizontal=invert(True))
data_9 = Data(label_3)
stack_12 = CreateStack(UIElements=entwine_15, Horizontal=invert(True))
number_slider_7 = Slider(200, range=0..300)
number_slider_8 = Slider(200, range=0..300)
adjustpos_13 = AdjustElementPositioning(ElementsToAdjust=label_8, AbsolutePositioning=False, HorizontalAlignment=0)
number_slider_9 = Slider(35, range=0..300)
number_slider_10 = Slider(190, range=0..300)
adjustpos_14 = AdjustElementPositioning(ElementsToAdjust=pulldown_4, AbsolutePositioning=False, Width=Slider(135, range=0..300), HorizontalAlignment=0)
tooltip = AttachTooltipToElement(ElementsToAttachTo=pulldown_4, TooltipContent="Select climate", ShowDelay=500, Duration=2000)
adjustpos_15 = AdjustElementPositioning(ElementsToAdjust=label_9, AbsolutePositioning=False, HorizontalAlignment=0)
tooltip_2 = AttachTooltipToElement(ElementsToAttachTo=pulldown_5, TooltipContent="Select type of construction", ShowDelay=500, Duration=2000)
adjustpos_16 = AdjustElementPositioning(ElementsToAdjust=pulldown_5, AbsolutePositioning=False, Width=Slider(155, range=0..300), HorizontalAlignment=0)
adjustpos_17 = AdjustElementPositioning(ElementsToAdjust=true_button_7, AbsolutePositioning=False, Height=Slider(32, range=0..300), HorizontalAlignment=0)
adjustpos_18 = AdjustElementPositioning(ElementsToAdjust=true_button_9, AbsolutePositioning=False, Height=Slider(32, range=0..300), HorizontalAlignment=0)
adjustpos_19 = AdjustElementPositioning(ElementsToAdjust=true_button_8, AbsolutePositioning=False, Height=Slider(32, range=0..300), HorizontalAlignment=0)
adjustpos_20 = AdjustElementPositioning(
    ElementsToAdjust=label_3,
    AbsolutePositioning=False,
    Width=Slider(80, range=0..300),
    Height=Slider(25, range=0..300),
    HorizontalAlignment=0)
adjustpos_21 = AdjustElementPositioning(
    ElementsToAdjust=label,
    AbsolutePositioning=False,
    Width=Slider(80, range=0..300),
    Height=Slider(25, range=0..300),
    HorizontalAlignment=0)
adjustpos_22 = AdjustElementPositioning(
    ElementsToAdjust=label_4,
    AbsolutePositioning=False,
    Width=Slider(80, range=0..300),
    Height=Slider(25, range=0..300),
    HorizontalAlignment=0)
adjustpos_23 = AdjustElementPositioning(
    ElementsToAdjust=label_2,
    AbsolutePositioning=False,
    Width=Slider(80, range=0..300),
    Height=Slider(25, range=0..300),
    HorizontalAlignment=0)
entwine_16 = Entwine(
    Branch00=true_button_7,
    Branch01=true_button_9,
    Branch02=true_button_8,
    Branch03=filepicker,
    Branch04=button_7,
    FlattenInputs=True)  # -> flatten(Result)
entwine_17 = Entwine(Branch00=stack_11, Branch01=stack_12, FlattenInputs=True)  # -> flatten(Result)

values_24 = ValueListener(Elements=button_7, SomeProperty=True)  # -> Values, Indices
freeze_gate_4 = StreamFreezeGate(Data=values_24.Values, PassingSwitch=invert(values_24.Values))
bool_5 = Boolean(invert(freeze_gate_4))
tap_3 = TapBuffer(Reset=False, Incremental=True, Valve=bool_5, Hold=True)
dam_3 = DataDam(DataA=tap_3, BufferDelay=2500000, BufferMode=2)
hideshow_6 = HideShowElement(ElementToHideShow=button_7, Show=null.NullFlags, Collapse=True, Disable=False)
equals_4 = Equality(FirstNumber=tap_3, SecondNumber=dam_3)  # -> Equality, Inequality
adjustpos_24 = AdjustElementPositioning(
    ElementsToAdjust=filepicker,
    AbsolutePositioning=False,
    Width=Slider(200, range=0..300),
    Height=Slider(32, range=0..300),
    HorizontalAlignment=0)
adjustpos_25 = AdjustElementPositioning(ElementsToAdjust=button_7, AbsolutePositioning=False, Height=Slider(32, range=0..300), HorizontalAlignment=0)

# ----
# Construction by climate and type
location_5 = Data(entwine_17)

# ----
# Create constructions or materials - buttons
location_6 = Data(entwine_16)

stack_13 = CreateStack(UIElements=location_6, Horizontal=True)
stack_14 = CreateStack(UIElements=location_5, Horizontal=True)
entwine_18 = Entwine(Branch00=stack_14, Branch01=stack_13, FlattenInputs=True)  # -> flatten(Result)
create_material_modal_2 = RemoteReceiver(create_material_modal)

# ----
# Geometry module
panel_33 = Panel("Save geometry")
panel_34 = Panel("""Room
Window
Adjacent
Context
None""")
panel_35 = Panel("""All
Room
Window
Adjacent
Context""")
panel_36 = Panel("""gbg
mumindalen
villa villekulla""")
number_slider_11 = Slider(15, range=0..20)
number_slider_12 = Slider(15, range=0..20)
number_slider_13 = Slider(15, range=0..20)
number_slider_14 = Slider(15, range=0..20)
number_slider_15 = Slider(10, range=0..10)
number_slider_16 = Slider(10, range=0..10)
number_slider_17 = Slider(10, range=0..10)
number_slider_18 = Slider(10, range=0..10)
label_11 = CreateLabel(LabelText="Import geometry", LabelSize=12, Justification=0)
pulldown_6 = CreatePulldownMenu(Label="Type", ListItems=panel_34, showLabel=True)
button_8 = CreateButton(ButtonName=panel_33, ButtonStyle=0)
checkbox = CreateCheckbox(Label="Preview", StartingValue=False)
pulldown_7 = CreatePulldownMenu(Label="Type", ListItems=panel_35, showLabel=True)
label_12 = CreateLabel(LabelText="Preview geometry", LabelSize=12, Justification=0)
pt_2 = ConstructPoint(XCoordinate=Slider(10, range=0..10), YCoordinate=Slider(-20, range=-100..0), ZCoordinate=0)
pt_3 = ConstructPoint(XCoordinate=Slider(10, range=0..10), YCoordinate=Slider(-20, range=-100..0), ZCoordinate=0)
pt_4 = ConstructPoint(XCoordinate=Slider(10, range=0..10), YCoordinate=Slider(-20, range=-100..0), ZCoordinate=0)
pt_5 = ConstructPoint(XCoordinate=Slider(10, range=0..10), YCoordinate=Slider(-20, range=-100..0), ZCoordinate=0)
pulldown_8 = CreatePulldownMenu(ListItems=panel_36, showLabel=True)
label_13 = CreateLabel(LabelText="Set location", LabelSize=18, Justification=0)
button_9 = CreateButton(ButtonName="Create test model", ButtonStyle=0)
button_10 = CreateButton(ButtonName="Get climate data", ButtonStyle=0)
values_25 = ValueListener(Elements=button_8, SomeProperty=True)  # -> Values, Indices
rectangle = Rectangle(Plane=PlaneXY(0, 0, 0), XSize=number_slider_15, YSize=number_slider_15, Radius=0)  # -> Rectangle, Length
rectangle_2 = Rectangle(Plane=PlaneXY(0, 0, 0), XSize=number_slider_16, YSize=number_slider_16, Radius=0)  # -> Rectangle, Length
rectangle_3 = Rectangle(Plane=pt_2, XSize=number_slider_11, YSize=number_slider_11, Radius=0)  # -> Rectangle, Length
rectangle_4 = Rectangle(Plane=pt_3, XSize=number_slider_12, YSize=number_slider_12, Radius=0)  # -> Rectangle, Length
values_26 = ValueListener(Elements=pulldown_6, SomeProperty=True)  # -> Values, Indices
rectangle_5 = Rectangle(Plane=PlaneXY(0, 0, 0), XSize=number_slider_17, YSize=number_slider_17, Radius=0)  # -> Rectangle, Length
rectangle_6 = Rectangle(Plane=PlaneXY(0, 0, 0), XSize=number_slider_18, YSize=number_slider_18, Radius=0)  # -> Rectangle, Length
rectangle_7 = Rectangle(Plane=pt_4, XSize=number_slider_13, YSize=number_slider_13, Radius=0)  # -> Rectangle, Length
rectangle_8 = Rectangle(Plane=pt_5, XSize=number_slider_14, YSize=number_slider_14, Radius=0)  # -> Rectangle, Length
entwine_19 = Entwine(Branch00=pulldown_7, Branch01=checkbox, FlattenInputs=True)  # -> flatten(Result)
values_27 = ValueListener(Elements=checkbox, SomeProperty=True)  # -> Values, Indices
freeze_gate_5 = StreamFreezeGate(Data=values_25.Values, PassingSwitch=invert(values_25.Values))
values_28 = ValueListener(Elements=button_9, SomeProperty=True)  # -> Values, Indices
presavegeometry = RemoteSender(values_25.Values)
tb_6 = CreateTextBlock(TextSize=12, Justification=0)
tb_7 = CreateTextBlock(TextSize=12, Justification=0)
shapes = CreateShapes(Shapes=rectangle.Rectangle, StrokeColor=RGB(0, 0, 0), Scale=1, ClickMode=3)
shapes_2 = CreateShapes(Shapes=rectangle_2.Rectangle, StrokeColor=RGB(0, 0, 0), Scale=1, ClickMode=3)
tb_8 = CreateTextBlock(TextSize=12, Justification=0)
tb_9 = CreateTextBlock(TextSize=12, Justification=0)
shapes_3 = CreateShapes(Shapes=rectangle_5.Rectangle, StrokeColor=RGB(0, 0, 0), Scale=1, ClickMode=3)
shapes_4 = CreateShapes(Shapes=rectangle_6.Rectangle, StrokeColor=RGB(0, 0, 0), Scale=1, ClickMode=3)
values_29 = ValueListener(Elements=pulldown_8, SomeProperty=True)  # -> Values, Indices
geometrytype = RemoteSender(values_26.Values)
geometrytype_validate = RemoteSender(values_26.Indices)
values_30 = ValueListener(Elements=button_10, SomeProperty=True)  # -> Values, Indices
freeze_gate_6 = StreamFreezeGate(Data=values_28.Values, PassingSwitch=invert(values_28.Values))
stack_15 = CreateStack(UIElements=entwine_19, Horizontal=True)
values_31 = ValueListener(Elements=pulldown_7, SomeProperty=True)  # -> Values, Indices
bool_6 = Boolean(invert(freeze_gate_5))
settextblock_3 = SetTextBlockContents(TextBlockToModify=tb_6, NewTextBlockContents="Window geometry")
settextblock_4 = SetTextBlockContents(TextBlockToModify=tb_7, NewTextBlockContents="Context geometry")
location_7 = RemoteSender(values_29.Values)
settextblock_5 = SetTextBlockContents(TextBlockToModify=tb_8, NewTextBlockContents="Room geometry")
settextblock_6 = SetTextBlockContents(TextBlockToModify=tb_9, NewTextBlockContents="Adjacent geometry")
getclimatedata = RemoteSender(values_30.Values)
tap_4 = TapBuffer(Reset=False, Incremental=True, Valve=bool_6, Hold=True)
previewtype = RemoteSender(values_31.Values)
bool_7 = Boolean(invert(freeze_gate_6))
setshapes = SetShapes(
    ShapeToModify=shapes,
    ShapeCurves=rectangle_3.Rectangle,
    FillColors=ColourSwatch(SwatchColor=RGBA(128, 0, 102, 75)),
    StrokeColors=ColourSwatch(SwatchColor=RGB(255, 255, 255)),
    Scale=1)
setshapes_2 = SetShapes(
    ShapeToModify=shapes_2,
    ShapeCurves=rectangle_4.Rectangle,
    FillColors=ColourSwatch(SwatchColor=RGBA(128, 125, 0, 75)),
    StrokeColors=ColourSwatch(SwatchColor=RGB(255, 255, 255)),
    Scale=1)
setshapes_3 = SetShapes(
    ShapeToModify=shapes_3,
    ShapeCurves=rectangle_7.Rectangle,
    FillColors=ColourSwatch(SwatchColor=RGBA(4, 128, 0, 75)),
    StrokeColors=ColourSwatch(SwatchColor=RGB(255, 255, 255)),
    Scale=1)
setshapes_4 = SetShapes(
    ShapeToModify=shapes_4,
    ShapeCurves=rectangle_8.Rectangle,
    FillColors=ColourSwatch(SwatchColor=RGBA(0, 17, 128, 75)),
    StrokeColors=ColourSwatch(SwatchColor=RGB(255, 255, 255)),
    Scale=1)
dam_4 = DataDam(DataA=tap_4, BufferDelay=2500000, BufferMode=2)
tap_5 = TapBuffer(Reset=False, Incremental=True, Valve=bool_7, Hold=True)
entwine_20 = Entwine(Branch00=shapes, Branch01=tb_6, FlattenInputs=True)  # -> flatten(Result)
entwine_21 = Entwine(Branch00=shapes_2, Branch01=tb_7, FlattenInputs=True)  # -> flatten(Result)
entwine_22 = Entwine(Branch00=shapes_3, Branch01=tb_8, FlattenInputs=True)  # -> flatten(Result)
entwine_23 = Entwine(Branch00=shapes_4, Branch01=tb_9, FlattenInputs=True)  # -> flatten(Result)
equals_5 = Equality(FirstNumber=tap_4, SecondNumber=dam_4)  # -> Equality, Inequality
dam_5 = DataDam(DataA=tap_5, BufferDelay=2500000, BufferMode=2)
hideshow_7 = HideShowElement(ElementToHideShow=pulldown_6, Show=True, Collapse=True, Disable=False)
equals_6 = Equality(FirstNumber=tap_5, SecondNumber=dam_5)  # -> Equality, Inequality
stack_16 = CreateStack(UIElements=entwine_20, Horizontal=True)
stack_17 = CreateStack(UIElements=entwine_21, Horizontal=True)
stack_18 = CreateStack(UIElements=entwine_22, Horizontal=True)
stack_19 = CreateStack(UIElements=entwine_23, Horizontal=True)
number_slider_19 = Slider(120, range=0..300)
adjustpos_26 = AdjustElementPositioning(ElementsToAdjust=tb_6, Margin="5, 5, 0, 0", AbsolutePositioning=False)
adjustelem_3 = AdjustElementAppearance(ElementsToAdjust=tb_6, Foreground=ColourSwatch(SwatchColor=RGB(0, 0, 0)))
adjustpos_27 = AdjustElementPositioning(ElementsToAdjust=tb_7, Margin="5, 5, 0, 0", AbsolutePositioning=False)
adjustelem_4 = AdjustElementAppearance(ElementsToAdjust=tb_7, Foreground=ColourSwatch(SwatchColor=RGB(0, 0, 0)))
adjustpos_28 = AdjustElementPositioning(ElementsToAdjust=tb_8, Margin="5, 5, 0, 0", AbsolutePositioning=False)
adjustelem_5 = AdjustElementAppearance(ElementsToAdjust=tb_8, Foreground=ColourSwatch(SwatchColor=RGB(0, 0, 0)))
adjustpos_29 = AdjustElementPositioning(ElementsToAdjust=tb_9, Margin="5, 5, 0, 0", AbsolutePositioning=False)
adjustelem_6 = AdjustElementAppearance(ElementsToAdjust=tb_9, Foreground=ColourSwatch(SwatchColor=RGB(0, 0, 0)))
adjustpos_30 = AdjustElementPositioning(ElementsToAdjust=pulldown_7, AbsolutePositioning=False, Width=Slider(150, range=0..300), HorizontalAlignment=0)
adjustpos_31 = AdjustElementPositioning(ElementsToAdjust=button_10, AbsolutePositioning=False, Width=Slider(120, range=0..300), HorizontalAlignment=0)
adjustpos_32 = AdjustElementPositioning(
    ElementsToAdjust=button_9,
    Margin="10, 15, 0, 0",
    AbsolutePositioning=False,
    Width=Slider(120, range=0..300),
    HorizontalAlignment=0)
adjustpos_33 = AdjustElementPositioning(ElementsToAdjust=pulldown_8, AbsolutePositioning=False, Width=Slider(150, range=0..300), HorizontalAlignment=0)
adjustpos_34 = AdjustElementPositioning(ElementsToAdjust=pulldown_6, AbsolutePositioning=False, Width=Slider(150, range=0..300), HorizontalAlignment=0)
adjustpos_35 = AdjustElementPositioning(ElementsToAdjust=button_8, AbsolutePositioning=False, HorizontalAlignment=0)
entwine_24 = Entwine(Branch00=stack_18, Branch01=stack_16, Branch02=stack_19, Branch03=stack_17, FlattenInputs=True)  # -> flatten(Result)
entwine_25 = Entwine(Branch00=label_13, Branch01=pulldown_8, Branch02=button_10, FlattenInputs=True)  # -> flatten(Result)

# ----
# Preview label
preview = Data(label_12)

entwine_26 = Entwine(Branch00=button_8, Branch01=true_button, FlattenInputs=True)  # -> flatten(Result)
stack_20 = CreateStack(UIElements=entwine_26, Horizontal=True)
entwine_27 = Entwine(Branch00=stack_20, Branch01=label_5, FlattenInputs=True)  # -> flatten(Result)

# ----
# Test model
location_8 = Data(button_9)

presavegeometry_2 = RemoteReceiver(presavegeometry)
getclimatedata_2 = RemoteReceiver(getclimatedata)

# ---- group: Setup study case
# Get climate data
panel_37 = Panel("https://energyplus-weather.s3.amazonaws.com/europe_wmo_region_6/SWE/SWE_Goteborg.Landvetter.025260_IWEC/SWE_Goteborg.Landvetter.025260_IWEC.zip")
button_11 = Button()
epwmap = LBEPWmap(epw_map=getclimatedata_2)  # -> report; plug-in component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

# ----
panel_38 = Panel(getclimatedata_2)

# ----
# Program module
number_slider_20 = Slider(27, range=10..40)
bldg_programs_2 = RemoteReceiver(bldg_programs)
empty = EmptyObjectToEmptyBranch()
label_14 = CreateLabel(LabelText="Select building program", LabelSize=12, Justification=0)
pulldown_9 = CreatePulldownMenu(Label="Type", ListItems=bldg_programs_2, SelectedIndex="3", showLabel=True)
pulldown_10 = CreatePulldownMenu(Label="Type", ListItems=empty, showLabel=True)
slider_5 = CreateSlider(Slider=number_slider_20, ShowBounds=False, ShowTicks=True, ShowTooltip=True, ShowValLabel=True, showLabel=False)
label_15 = CreateLabel(LabelText="Select room program", LabelSize=12, Justification=0)
label_16 = CreateLabel(LabelText="Cooling setpoint [ºC]", LabelSize=12, Justification=0)
slider_6 = CreateSlider(Slider=Slider(21, range=10..40), ShowBounds=False, ShowTicks=True, ShowTooltip=False, ShowValLabel=True, showLabel=False)
label_17 = CreateLabel(LabelText="Heating setpoint [ºC]", LabelSize=12, Justification=0)
label_18 = CreateLabel(LabelText="Occupancy [person]", LabelSize=12, Justification=0)
slider_7 = CreateSlider(Slider=Slider(3, range=0..20), ShowBounds=False, ShowTicks=True, ShowTooltip=True, ShowValLabel=True, showLabel=False)
values_32 = ValueListener(Elements=pulldown_9, SomeProperty=True)  # -> Values, Indices
values_33 = ValueListener(Elements=pulldown_10, SomeProperty=True)  # -> Values, Indices
values_34 = ValueListener(Elements=slider_6, SomeProperty=True)  # -> Values, Indices
values_35 = ValueListener(Elements=slider_5, SomeProperty=True)  # -> Values, Indices
tooltip_3 = AttachTooltipToElement(ElementsToAttachTo=slider_6, TooltipContent="Doubleclick to input value", ShowDelay=500, Duration=2000)
values_36 = ValueListener(Elements=slider_7, SomeProperty=True)  # -> Values, Indices
tooltip_4 = AttachTooltipToElement(ElementsToAttachTo=slider_7, TooltipContent="Doubleclick to input value", ShowDelay=500, Duration=2000)
tooltip_5 = AttachTooltipToElement(ElementsToAttachTo=slider_5, TooltipContent="Doubleclick to input value", ShowDelay=500, Duration=2000)
selected_building = RemoteSender(values_32.Values)
selected_room = RemoteSender(values_33.Values)
cooling_setpoint = RemoteSender(values_35.Values)
cooling_setpoint_2 = RemoteReceiver(cooling_setpoint)
subtraction = Subtraction(A=cooling_setpoint_2, B="1")
dom = ConstructDomain(DomainStart=Slider(10, range=0..100), DomainEnd=subtraction)
setslider = SetSlider(UISlider=slider_6, Range=dom)
heating_setpoint = RemoteSender(values_34.Values)
heating_setpoint_2 = RemoteReceiver(heating_setpoint)
addition_2 = Addition(A=heating_setpoint_2, B="1")
dom_2 = ConstructDomain(DomainStart=addition_2, DomainEnd=Slider(40, range=0..100))
setslider_2 = SetSlider(UISlider=slider_5, Range=dom_2)
occupancy = RemoteSender(values_36.Values)
adjustpos_36 = AdjustElementPositioning(ElementsToAdjust=slider_7, AbsolutePositioning=False, Width=Slider(200, range=0..300), HorizontalAlignment=0)
adjustpos_37 = AdjustElementPositioning(ElementsToAdjust=slider_6, AbsolutePositioning=False, Width=Slider(200, range=0..300), HorizontalAlignment=0)
entwine_28 = Entwine(Branch00=label_14, Branch01=pulldown_9, FlattenInputs=True)  # -> flatten(Result)
entwine_29 = Entwine(Branch00=label_15, Branch01=pulldown_10, FlattenInputs=True)  # -> flatten(Result)
entwine_30 = Entwine(Branch00=label_16, Branch01=slider_5, FlattenInputs=True)  # -> flatten(Result)
adjustpos_38 = AdjustElementPositioning(ElementsToAdjust=pulldown_10, AbsolutePositioning=False, Width=Slider(250, range=0..300), HorizontalAlignment=0)
adjustpos_39 = AdjustElementPositioning(ElementsToAdjust=pulldown_9, AbsolutePositioning=False, Width=Slider(250, range=0..300), HorizontalAlignment=0)
adjustpos_40 = AdjustElementPositioning(ElementsToAdjust=slider_5, AbsolutePositioning=False, Width=Slider(200, range=0..300), HorizontalAlignment=0)
entwine_31 = Entwine(Branch00=label_17, Branch01=slider_6, FlattenInputs=True)  # -> flatten(Result)
entwine_32 = Entwine(Branch00=label_18, Branch01=slider_7, FlattenInputs=True)  # -> flatten(Result)

# ----
# Select building program
location_9 = Data(entwine_28)

# ----
# Cooling setpoint
location_10 = Data(entwine_30)

# ----
# Occupancy
location_11 = Data(entwine_32)

# ----
# Select room program
location_12 = Data(entwine_29)

# ----
# Heating setpoint
location_13 = Data(entwine_31)

# ----
# Define program
# Simplified Boverket data
number_slider_21 = Slider(6, range=0..10)
selected_building_2 = RemoteReceiver(selected_building)
merge_5 = Merge(Data1=number_slider_21, Data2=Slider(12, range=0..100), Data3=Slider(6, range=0..10))
merge_6 = Merge(Data1=Slider(0.8, range=0..10), Data2=Slider(1.2, range=0..10), Data3=Slider(0.8, range=0..10))
python = GhPythonScript(sublist_lengths=merge_5, values=merge_6)  # -> out, out_list; inputs sublist_lengths: list of Int32, values: list
# ---------- python: Python ----------
"""Creates one list from a list of sublist lengths and the value to put in each sublist
    Inputs:
        sublist_lengths: sublist_lengths
        values: value in each sublist
    Output:
        a: The a output variable"""

__author__ = "sawen"
__version__ = "2024.05.24"

import rhinoscriptsyntax as rs

if not (len(sublist_lengths) == len(values)):
    raise Exception("sublist lengths and values must be the same size")

out_list = []

for i in range(len(sublist_lengths)):
    for j in range(int(sublist_lengths[i])):
        out_list.append(values[i])
# ---------- end python ----------
searchprog = HBSearchPrograms(bldg_prog=selected_building_2)  # -> room_prog; plug-in component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
constantschedule = HBConstantSchedule(values=python.out_list, name="household_electricity")  # -> report, schedule, idf_text; plug-in component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
room_programs = RemoteSender(searchprog)
selected_room_2 = RemoteReceiver(selected_room)
occupancy_2 = RemoteReceiver(occupancy)
constantschedule_2 = HBConstantSchedule(values=Slider(1, range=0..1))  # -> report, schedule, idf_text; plug-in component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
constantschedule_3 = HBConstantSchedule(values=Slider(1, range=0..1))  # -> report, schedule, idf_text; plug-in component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
applyloadvals = HBApplyLoadValues(room_or_program=flatten(selected_room_2), people_per_floor=occupancy_2)  # -> report, mod_obj; plug-in component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
cooling_setpoint_3 = RemoteReceiver(cooling_setpoint)
heating_setpoint_3 = RemoteReceiver(heating_setpoint)
python_2 = GhPythonScript(power_density=Slider(2.6, range=0..10), schedule=constantschedule_2.schedule)  # -> out, hot_water
# ---------- python_2: Python ----------
__author__ = "sawen"
__version__ = "2024.05.24"

import rhinoscriptsyntax as rs
from honeybee_energy.load.hotwater import ServiceHotWater as shw

if not name:
    name = "Domestic Hot Water"
    

hot_water = shw.from_watts_per_area(name, power_density, schedule)
# ---------- end python_2 ----------
equipment = HBEquipment(watts_per_area=Slider(3.4, range=0..10), schedule=constantschedule_3.schedule, lost_fract=Slider(0.3, range=0..1))  # -> equip; plug-in component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
applysetpointvals = HBApplySetpointValues(room_or_program=flatten(applyloadvals.mod_obj), cooling_setpt=cooling_setpoint_3, heating_setpt=heating_setpoint_3)  # -> report, mod_obj; plug-in component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
program = Data(applysetpointvals.mod_obj)
programtype = HBProgramType(name="My program", base_program=program, electric_equip=equipment, hot_water=python_2.hot_water)  # -> program; plug-in component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

room_programs_2 = RemoteReceiver(room_programs)
setlist = SetListContents(ListToModify=pulldown_10, NewListContents=room_programs_2, SelectedIndex="0")

# ----
# Visualize module
panel_39 = Panel("""Program
Construction Set
Is Conditioned
People per Area [ppl/m2]
Area per Person [m2/ppl]
Lighting per Area [W/m2]
Electric Equipment per Area [W/m2]
Gas Equipment per Area [W/m2]
Hot Water per Area [L/h-m2]""")
panel_40 = Panel("""Display Name
Simulation Name (Identifier)
Boundary Condition
Has Parent
Parent
Azimuth
Altitude
Area
Perimeter
Face Type
Aperture Is Operable
Door Is Glass""")
panel_41 = Panel("""Sky dome
Sky mask
Wind rose
Dry bulb temperature line chart
Dry bulb temperature 2D chart
Direct sun hours
Incident radiation""")
panel_42 = Panel("""Construction
Materials
Thickness [m]
Density [kg/m2]
Heat Capacity [J/K-m2]
Construction R-Value [m2-K/W]
Construction U-Value [W/m2-K]
Construction U-Factor [W/m2-K]
Construction SHGC [Unshaded]
R-Factor [m2-K/W]
U-Factor [W/m2-K]
SHGC [Unshaded]""")
panel_43 = Panel("""Display Name
Simulation Name (Identifier)
Multiplier
Floor Area Excluded
Story
Volume
Gross Floor Area
Exposed Area
Exterior Wall Area
Exterior Aperture Area
Average Floor Elevation""")
button_12 = CreateButton(ButtonName="Run weather visualization", ButtonStyle=0)
button_13 = CreateButton(ButtonName="Zoom", ButtonStyle=0)
button_14 = CreateButton(ButtonName="Bake", ButtonStyle=0)
values_37 = ValueListener(Elements=button_13, SomeProperty=True)  # -> Values, Indices
values_38 = ValueListener(Elements=button_14, SomeProperty=True)  # -> Values, Indices
values_39 = ValueListener(Elements=button_12, SomeProperty=True)  # -> Values, Indices
pulldown_11 = CreatePulldownMenu(Label="Type", ListItems=panel_41, showLabel=True)
checkbox_2 = CreateCheckbox(Label="Visualize", StartingValue=False)
pulldown_12 = CreatePulldownMenu(Label="Room attribute", ListItems=panel_43, showLabel=True)
pulldown_13 = CreatePulldownMenu(Label="Room energy attribute", ListItems=panel_39, showLabel=True)
checkbox_3 = CreateCheckbox(Label="Visualize", StartingValue=False)
checkbox_4 = CreateCheckbox(Label="Visualize", StartingValue=False)
label_19 = CreateLabel(LabelText="Attributes visualization", LabelSize=12, Justification=0)
checkbox_5 = CreateCheckbox(Label="Visualize", StartingValue=False)
pulldown_14 = CreatePulldownMenu(Label="Face attribute", ListItems=panel_40, showLabel=True)
zoom_weather_visualization = RemoteSender(values_37.Values)
pulldown_15 = CreatePulldownMenu(Label="Face energy attribute", ListItems=panel_42, showLabel=True)
checkbox_6 = CreateCheckbox(Label="Visualize", StartingValue=False)
freeze_gate_7 = StreamFreezeGate(Data=values_38.Values, PassingSwitch=invert(values_38.Values))
freeze_gate_8 = StreamFreezeGate(Data=values_39.Values, PassingSwitch=invert(values_39.Values))
entwine_33 = Entwine(Branch00=pulldown_11, Branch01=checkbox_2, FlattenInputs=True)  # -> flatten(Result)
values_40 = ValueListener(Elements=pulldown_11, SomeProperty=True)  # -> Values, Indices
values_41 = ValueListener(Elements=checkbox_2, SomeProperty=True)  # -> Values, Indices
values_42 = ValueListener(Elements=checkbox_4, SomeProperty=True)  # -> Values, Indices
values_43 = ValueListener(Elements=pulldown_13, SomeProperty=True)  # -> Values, Indices
entwine_34 = Entwine(Branch00=pulldown_12, Branch01=checkbox_3, FlattenInputs=True)  # -> flatten(Result)
entwine_35 = Entwine(Branch00=pulldown_13, Branch01=checkbox_4, FlattenInputs=True)  # -> flatten(Result)
values_44 = ValueListener(Elements=pulldown_12, SomeProperty=True)  # -> Values, Indices
values_45 = ValueListener(Elements=pulldown_14, SomeProperty=True)  # -> Values, Indices
values_46 = ValueListener(Elements=checkbox_3, SomeProperty=True)  # -> Values, Indices
values_47 = ValueListener(Elements=checkbox_5, SomeProperty=True)  # -> Values, Indices
entwine_36 = Entwine(Branch00=pulldown_14, Branch01=checkbox_5, FlattenInputs=True)  # -> flatten(Result)
values_48 = ValueListener(Elements=pulldown_15, SomeProperty=True)  # -> Values, Indices
bool_8 = Boolean(invert(freeze_gate_7))
bool_9 = Boolean(invert(freeze_gate_8))
entwine_37 = Entwine(Branch00=pulldown_15, Branch01=checkbox_6, FlattenInputs=True)  # -> flatten(Result)
values_49 = ValueListener(Elements=checkbox_6, SomeProperty=True)  # -> Values, Indices
item = ListItem(List=panel_3, Index=values_43.Indices, Wrap=invert(True))
weather_visualization_type = RemoteSender(values_40.Indices)
stack_21 = CreateStack(UIElements=entwine_33, Horizontal=True)
item_2 = ListItem(List=panel_4, Index=values_44.Indices, Wrap=invert(True))
stack_22 = CreateStack(UIElements=entwine_35, Horizontal=True)
tap_6 = TapBuffer(Reset=False, Incremental=True, Valve=bool_8, Hold=True)
item_3 = ListItem(List=panel_5, Index=values_45.Indices, Wrap=invert(True))
tap_7 = TapBuffer(Reset=False, Incremental=True, Valve=bool_9, Hold=True)
stack_23 = CreateStack(UIElements=entwine_34, Horizontal=True)
item_4 = ListItem(List=panel_2, Index=values_48.Indices, Wrap=invert(True))
stack_24 = CreateStack(UIElements=entwine_36, Horizontal=True)
stack_25 = CreateStack(UIElements=entwine_37, Horizontal=True)
room_energy_attribute = RemoteSender(item)
room_attribute = RemoteSender(item_2)
dam_6 = DataDam(DataA=tap_6, BufferDelay=2500000, BufferMode=2)
dam_7 = DataDam(DataA=tap_7, BufferDelay=2500000, BufferMode=2)
face_attribute = RemoteSender(item_3)
entwine_38 = Entwine(Branch00=button_12, Branch01=button_13, Branch02=button_14, FlattenInputs=True)  # -> flatten(Result)
face_energy_attribute = RemoteSender(item_4)
equals_7 = Equality(FirstNumber=tap_7, SecondNumber=dam_7)  # -> Equality, Inequality
equals_8 = Equality(FirstNumber=tap_6, SecondNumber=dam_6)  # -> Equality, Inequality
stack_26 = CreateStack(UIElements=entwine_38, Horizontal=True)
hideshow_8 = HideShowElement(ElementToHideShow=checkbox_3, Show=True, Collapse=True, Disable=values_42.Values)
hideshow_9 = HideShowElement(ElementToHideShow=checkbox_4, Show=True, Collapse=True, Disable=values_46.Values)
hideshow_10 = HideShowElement(ElementToHideShow=checkbox_5, Show=True, Collapse=True, Disable=values_49.Values)
hideshow_11 = HideShowElement(ElementToHideShow=checkbox_6, Show=True, Collapse=True, Disable=values_47.Values)
entwine_39 = Entwine(Branch00=label_19, Branch01=stack_23, Branch02=stack_22, Branch03=stack_24, Branch04=stack_25, FlattenInputs=True)  # -> flatten(Result)
entwine_40 = Entwine(Branch00=stack_26, Branch01=stack_21, FlattenInputs=True)  # -> flatten(Result)
stack_27 = CreateStack(UIElements=entwine_39, Horizontal=invert(True))
adjustpos_41 = AdjustElementPositioning(ElementsToAdjust=pulldown_11, Margin="5, 5, 0, 0", AbsolutePositioning=False, Width=Slider(215, range=0..400))
adjustpos_42 = AdjustElementPositioning(ElementsToAdjust=checkbox_2, Margin="5, 5, 0, 0", AbsolutePositioning=False)
adjustpos_43 = AdjustElementPositioning(
    ElementsToAdjust=label_19,
    AbsolutePositioning=False,
    Width=Slider(145, range=0..300),
    Height=Slider(25, range=0..300),
    HorizontalAlignment=0)
adjustpos_44 = AdjustElementPositioning(ElementsToAdjust=pulldown_12, AbsolutePositioning=False, Width=Slider(335, range=0..400), HorizontalAlignment=0)
adjustpos_45 = AdjustElementPositioning(ElementsToAdjust=pulldown_13, AbsolutePositioning=False, Width=Slider(335, range=0..400), HorizontalAlignment=0)
stack_28 = CreateStack(UIElements=entwine_40, Horizontal=invert(True))
adjustpos_46 = AdjustElementPositioning(ElementsToAdjust=pulldown_14, AbsolutePositioning=False, Width=Slider(335, range=0..400), HorizontalAlignment=0)
adjustpos_47 = AdjustElementPositioning(ElementsToAdjust=pulldown_15, AbsolutePositioning=False, Width=Slider(335, range=0..400), HorizontalAlignment=0)
border_3 = CreateBorder(
    UIElement=stack_27,
    BorderThickness=Slider(1, range=0..10),
    BorderColor=ColourSwatch(SwatchColor=RGB(217, 217, 217)),
    CornerRadius=Slider(2, range=0..10))
border_4 = CreateBorder(
    UIElement=stack_28,
    BorderThickness=Slider(1, range=0..10),
    BorderColor=ColourSwatch(SwatchColor=RGB(217, 217, 217)),
    CornerRadius=Slider(2, range=0..10))
adjustpos_48 = AdjustElementPositioning(ElementsToAdjust=stack_28, AbsolutePositioning=False, Width=Slider(300, range=0..300), HorizontalAlignment=0)
adjustpos_49 = AdjustElementPositioning(ElementsToAdjust=border_4, AbsolutePositioning=False, HorizontalAlignment=0, VerticalAlignment=2)
adjustpos_50 = AdjustElementPositioning(
    ElementsToAdjust=border_3,
    Margin="10, 0, 0, 0",
    AbsolutePositioning=False,
    Width=Slider(435, range=0..1000),
    Height=Slider(200, range=0..300),
    HorizontalAlignment=0,
    VerticalAlignment=2)

# ----
# Run weather visualization
location_14 = Data(border_4)

# ----
# Attributes visualization
location_15 = Data(border_3)

entwine_41 = Entwine(Branch00=location_14, Branch01=location_15, FlattenInputs=True)  # -> flatten(Result)
stack_29 = CreateStack(UIElements=entwine_41, Horizontal=True)

# ----
# Assembly model
number_slider_22 = Slider(5, range=0..10)
panel_44 = Panel("""The document is currently in {0}. 
Honeybee models require models in meters.""")
checkbox_7 = CreateCheckbox(Label="Doors", StartingValue=False)
checkbox_8 = CreateCheckbox(Label="Context", StartingValue=False)
checkbox_9 = CreateCheckbox(Label="Windows", StartingValue=False)
textbox = CreateTextBox(Label="Model name", DefaultText="My model", UpdateButton=invert(True), showLabel=True)
checkbox_10 = CreateCheckbox(Label="All", StartingValue=False)
checkbox_11 = CreateCheckbox(Label="Ground", StartingValue=False)
checkbox_12 = CreateCheckbox(Label="Floors", StartingValue=False)
label_20 = CreateLabel(LabelText="Show model components", LabelSize=12, Justification=0)
button_15 = CreateButton(ButtonName="Create model", ButtonStyle=0)
values_50 = ValueListener(Elements=button_15, SomeProperty=True)  # -> Values, Indices
checkbox_13 = CreateCheckbox(Label="Roof", StartingValue=False)
button_16 = CreateButton(ButtonName="Bake model", ButtonStyle=0)
values_51 = ValueListener(Elements=button_16, SomeProperty=True)  # -> Values, Indices
checkbox_14 = CreateCheckbox(Label="Walls", StartingValue=False)
toggle_4 = CreateToggle(Default=False)
label_21 = CreateLabel(LabelText="Generate windows using WWR [%]", LabelSize=12, Justification=0)
slider_8 = CreateSlider(
    Slider=Slider(30, range=5..95),
    SnapValue=number_slider_22,
    ShowBounds=False,
    ShowTicks=True,
    ShowTooltip=True,
    ShowValLabel=True,
    showLabel=False)
button_17 = CreateButton(ButtonName="Change document units", ButtonStyle=0)
tb_10 = CreateTextBlock(TextSize=16, Justification=0)
slider_9 = CreateSlider(
    Slider=Slider(0.3, range=0.05..1),
    SnapValue=Slider(0.05, range=0..1),
    ShowBounds=False,
    ShowTicks=True,
    ShowTooltip=False,
    ShowValLabel=True,
    showLabel=False)
slider_10 = CreateSlider(
    Slider=Slider(0.3, range=0.05..1),
    SnapValue=Slider(0.05, range=0..1),
    ShowBounds=False,
    ShowTicks=True,
    ShowTooltip=True,
    ShowValLabel=True,
    showLabel=False)
label_22 = CreateLabel(LabelText="Set wall thickness [m]", LabelSize=12, Justification=0)
label_23 = CreateLabel(LabelText="Set roof thickness [m]", LabelSize=12, Justification=0)
slider_11 = CreateSlider(
    Slider=Slider(50, range=0..100),
    SnapValue=Slider(5, range=0..10),
    ShowBounds=False,
    ShowTicks=True,
    ShowTooltip=False,
    ShowValLabel=True,
    showLabel=False)
slider_12 = CreateSlider(
    Slider=Slider(50, range=0..100),
    SnapValue=Slider(5, range=0..10),
    ShowBounds=False,
    ShowTicks=True,
    ShowTooltip=False,
    ShowValLabel=True,
    showLabel=False)
slider_13 = CreateSlider(
    Slider=Slider(0, range=0..10),
    SnapValue=Slider(1, range=0..1),
    ShowBounds=False,
    ShowTicks=True,
    ShowTooltip=False,
    ShowValLabel=True,
    showLabel=False)
label_24 = CreateLabel(LabelText="Louver depth", LabelSize=12, Justification=0)
label_25 = CreateLabel(LabelText="Distance between louvers", LabelSize=12, Justification=0)
label_26 = CreateLabel(LabelText="Number of louvers", LabelSize=12, Justification=0)
slider_14 = CreateSlider(
    Slider=Slider(50, range=0..100),
    SnapValue=Slider(5, range=0..10),
    ShowBounds=False,
    ShowTicks=True,
    ShowTooltip=False,
    ShowValLabel=True,
    showLabel=False)
label_27 = CreateLabel(LabelText="Louver angle", LabelSize=12, Justification=0)
freeze_gate_9 = StreamFreezeGate(Data=values_50.Values, PassingSwitch=invert(values_50.Values))
freeze_gate_10 = StreamFreezeGate(Data=values_51.Values, PassingSwitch=invert(values_51.Values))
values_52 = ValueListener(Elements=checkbox_7, SomeProperty=True)  # -> Values, Indices
values_53 = ValueListener(Elements=checkbox_8, SomeProperty=True)  # -> Values, Indices
values_54 = ValueListener(Elements=checkbox_9, SomeProperty=True)  # -> Values, Indices
values_55 = ValueListener(Elements=checkbox_10, SomeProperty=True)  # -> Values, Indices
values_56 = ValueListener(Elements=checkbox_11, SomeProperty=True)  # -> Values, Indices
values_57 = ValueListener(Elements=checkbox_12, SomeProperty=True)  # -> Values, Indices
values_58 = ValueListener(Elements=checkbox_13, SomeProperty=True)  # -> Values, Indices
values_59 = ValueListener(Elements=checkbox_14, SomeProperty=True)  # -> Values, Indices
values_60 = ValueListener(Elements=textbox, SomeProperty=True)  # -> Values, Indices
bool_10 = Boolean(invert(freeze_gate_9))
bool_11 = Boolean(invert(freeze_gate_10))
values_61 = ValueListener(Elements=slider_9, SomeProperty=True)  # -> Values, Indices
values_62 = ValueListener(Elements=slider_13, SomeProperty=True)  # -> Values, Indices
values_63 = ValueListener(Elements=slider_10, SomeProperty=True)  # -> Values, Indices
tooltip_6 = AttachTooltipToElement(ElementsToAttachTo=slider_9, TooltipContent="Doubleclick to input value", ShowDelay=500, Duration=2000)
values_64 = ValueListener(Elements=slider_12, SomeProperty=True)  # -> Values, Indices
values_65 = ValueListener(Elements=slider_11, SomeProperty=True)  # -> Values, Indices
tooltip_7 = AttachTooltipToElement(ElementsToAttachTo=slider_10, TooltipContent="Doubleclick to input value", ShowDelay=500, Duration=2000)
values_66 = ValueListener(Elements=slider_14, SomeProperty=True)  # -> Values, Indices
values_67 = ValueListener(Elements=button_17, SomeProperty=True)  # -> Values, Indices
values_68 = ValueListener(Elements=slider_8, SomeProperty=True)  # -> Values, Indices
panel_45 = Panel(values_60.Values)
tooltip_8 = AttachTooltipToElement(ElementsToAttachTo=slider_8, TooltipContent="Doubleclick to input value", ShowDelay=500, Duration=2000)
model_name = RemoteSender(values_60.Values)
entwine_42 = Entwine(Branch00=label_22, Branch01=slider_9, FlattenInputs=True)  # -> flatten(Result)
tap_8 = TapBuffer(Reset=False, Incremental=True, Valve=bool_10, Hold=True)
entwine_43 = Entwine(Branch00=label_24, Branch01=slider_11, FlattenInputs=True)  # -> flatten(Result)
tap_9 = TapBuffer(Reset=False, Incremental=True, Valve=bool_11, Hold=True)
values_69 = ValueListener(Elements=toggle_4, SomeProperty=True)  # -> Values, Indices
entwine_44 = Entwine(Branch00=label_25, Branch01=slider_12, FlattenInputs=True)  # -> flatten(Result)
entwine_45 = Entwine(Branch00=label_26, Branch01=slider_13, FlattenInputs=True)  # -> flatten(Result)
entwine_46 = Entwine(Branch00=label_27, Branch01=slider_14, FlattenInputs=True)  # -> flatten(Result)
entwine_47 = Entwine(Branch00=label_23, Branch01=slider_10, FlattenInputs=True)  # -> flatten(Result)
wall_thickness = RemoteSender(values_61.Values)
distance_between_louvers = RemoteSender(values_64.Values)
roof_thickness = RemoteSender(values_63.Values)
louver_depth = RemoteSender(values_65.Values)
louver_angle = RemoteSender(values_66.Values)
change_document_units = RemoteSender(values_67.Values)
number_of_louvers = RemoteSender(values_62.Values)
dam_8 = DataDam(DataA=tap_8, BufferDelay=2500000, BufferMode=2)
filter = StreamFilter(Gate=values_69.Values, Stream0="0", Stream1=values_68.Values)
dam_9 = DataDam(DataA=tap_9, BufferDelay=2500000, BufferMode=2)
entwine_48 = Entwine(Branch00=toggle_4, Branch01=slider_8, FlattenInputs=True)  # -> flatten(Result)
stack_30 = CreateStack(UIElements=entwine_42, Horizontal=invert(True))
stack_31 = CreateStack(UIElements=entwine_43, Horizontal=invert(True))
stack_32 = CreateStack(UIElements=entwine_44, Horizontal=invert(True))
stack_33 = CreateStack(UIElements=entwine_45, Horizontal=invert(True))
stack_34 = CreateStack(UIElements=entwine_46, Horizontal=invert(True))
stack_35 = CreateStack(UIElements=entwine_47, Horizontal=invert(True))
equals_9 = Equality(FirstNumber=tap_8, SecondNumber=dam_8)  # -> Equality, Inequality
equals_10 = Equality(FirstNumber=tap_9, SecondNumber=dam_9)  # -> Equality, Inequality
number_of_louvers_2 = RemoteReceiver(number_of_louvers)
number_of_louvers_3 = RemoteReceiver(number_of_louvers)
division = Division(A=filter, B="100")
number_of_louvers_4 = RemoteReceiver(number_of_louvers)
hideshow_12 = HideShowElement(ElementToHideShow=slider_8, Show=values_69.Values, Collapse=True, Disable=False)
stack_36 = CreateStack(UIElements=entwine_48, Horizontal=True)
generate_wwr = RemoteSender(division)
entwine_49 = Entwine(Branch00=tb_10, Branch01=button_17, FlattenInputs=True)  # -> flatten(Result)
hideshow_13 = HideShowElement(ElementToHideShow=stack_31, Show=number_of_louvers_2, Collapse=True, Disable=False)
hideshow_14 = HideShowElement(ElementToHideShow=stack_34, Show=number_of_louvers_4, Collapse=True, Disable=False)
hideshow_15 = HideShowElement(ElementToHideShow=stack_32, Show=number_of_louvers_3, Collapse=True, Disable=False)
entwine_50 = Entwine(
    Branch00=label_20,
    Branch01=checkbox_10,
    Branch02=checkbox_14,
    Branch03=checkbox_13,
    Branch04=checkbox_12,
    Branch05=checkbox_11,
    Branch06=checkbox_9,
    Branch07=checkbox_7,
    Branch08=checkbox_8,
    FlattenInputs=True)  # -> flatten(Result)
entwine_51 = Entwine(Branch00=textbox, Branch01=button_15, Branch02=button_16, FlattenInputs=True)  # -> flatten(Result)
entwine_52 = Entwine(Branch00=label_21, Branch01=stack_36, FlattenInputs=True)  # -> flatten(Result)
entwine_53 = Entwine(Branch00=stack_30, Branch01=stack_35, FlattenInputs=True)  # -> flatten(Result)
entwine_54 = Entwine(Branch00=stack_33, Branch01=stack_31, Branch02=stack_32, Branch03=stack_34, FlattenInputs=True)  # -> flatten(Result)
stack_37 = CreateStack(UIElements=entwine_49, Horizontal=invert(True))
stack_38 = CreateStack(UIElements=entwine_50, Horizontal=invert(True))
stack_39 = CreateStack(UIElements=entwine_51, Horizontal=True)
stack_40 = CreateStack(UIElements=entwine_52, Horizontal=invert(True))
adjustpos_51 = AdjustElementPositioning(
    ElementsToAdjust=slider_8,
    Margin="20, 10, 0, 0",
    AbsolutePositioning=False,
    Width=Slider(90, range=0..300),
    Height=Slider(43, range=0..300),
    HorizontalAlignment=0,
    VerticalAlignment=2)
stack_41 = CreateStack(UIElements=entwine_53, Horizontal=True)
adjustpos_52 = AdjustElementPositioning(
    ElementsToAdjust=label_22,
    Margin="0, 20, 0, 0",
    AbsolutePositioning=False,
    Width=Slider(200, range=0..300),
    Height=Slider(25, range=0..300),
    HorizontalAlignment=0,
    VerticalAlignment=2)
adjustpos_53 = AdjustElementPositioning(
    ElementsToAdjust=slider_9,
    Margin="0, 0, 0, 0",
    AbsolutePositioning=False,
    Width=Slider(200, range=0..300),
    Height=Slider(25, range=0..300),
    HorizontalAlignment=0,
    VerticalAlignment=2)
adjustpos_54 = AdjustElementPositioning(
    ElementsToAdjust=label_23,
    Margin="0, 20, 0, 0",
    AbsolutePositioning=False,
    Width=Slider(200, range=0..300),
    Height=Slider(25, range=0..300),
    HorizontalAlignment=0,
    VerticalAlignment=2)
adjustpos_55 = AdjustElementPositioning(
    ElementsToAdjust=slider_10,
    Margin="0, 0, 0, 0",
    AbsolutePositioning=False,
    Width=Slider(200, range=0..300),
    Height=Slider(25, range=0..300),
    HorizontalAlignment=0,
    VerticalAlignment=2)
border_5 = CreateBorder(
    UIElement=stack_38,
    BorderThickness=Slider(1, range=0..10),
    BorderColor=ColourSwatch(SwatchColor=RGB(217, 217, 217)),
    CornerRadius=Slider(2, range=0..10))
stack_42 = CreateStack(UIElements=entwine_54, Horizontal=True)
adjustpos_56 = AdjustElementPositioning(
    ElementsToAdjust=button_15,
    AbsolutePositioning=False,
    Width=Slider(100, range=0..500),
    Height=Slider(30, range=0..300),
    HorizontalAlignment=0)
adjustpos_57 = AdjustElementPositioning(
    ElementsToAdjust=textbox,
    AbsolutePositioning=False,
    Width=Slider(190, range=0..300),
    Height=Slider(30, range=0..300),
    HorizontalAlignment=0)
adjustpos_58 = AdjustElementPositioning(ElementsToAdjust=border_5, Margin="15, 5, 0, 0", AbsolutePositioning=False, HorizontalAlignment=0, VerticalAlignment=2)
adjustpos_59 = AdjustElementPositioning(ElementsToAdjust=stack_37, AbsolutePositioning=False, Width=Slider(320, range=0..350))
hideshow_16 = HideShowElement(ElementToHideShow=button_15, Show=True, Collapse=True, Disable=False)

# ----
# Document units
doc_units = DocumentUnits()
change_document_units_2 = RemoteReceiver(change_document_units)
document_units = RemoteSender(doc_units)
gate_2 = StreamGate(Stream="4", Gate=change_document_units_2)  # -> Target0, Target1
unit_warning = UnitWarning(UnitSystem=gate_2.Target1)

# ----
# Wall and roof thickness
location_16 = Data(stack_41)

# ----
# Visualize model
location_17 = Data(border_5)

# ----
# Document unit warning text
location_18 = Data(stack_37)

# ----
# Model name and create model
location_19 = Data(stack_39)

# ----
# Generate using WWR
location_20 = Data(stack_40)

entwine_55 = Entwine(Branch00=location_19, Branch01=location_16, Branch02=location_20, Branch03=location, FlattenInputs=True)  # -> flatten(Result)
stack_43 = CreateStack(UIElements=entwine_55, Horizontal=invert(True))
entwine_56 = Entwine(Branch00=stack_43, Branch01=location_18, Branch02=location_17, FlattenInputs=True)  # -> flatten(Result)
stack_44 = CreateStack(UIElements=entwine_56, Horizontal=True)

document_units_2 = RemoteReceiver(document_units)
case = TextCase(Text=document_units_2, Culture=127)  # -> UpperCase, LowerCase
format = Format(Format=panel_44, Culture=127, Data0=case.LowerCase)
settextblock_7 = SetTextBlockContents(TextBlockToModify=tb_10, NewTextBlockContents=format)
document_units_3 = RemoteReceiver(document_units)
expression = Expression(x=document_units_3, y="Meters", Expression="x=y")
hideshow_17 = HideShowElement(ElementToHideShow=stack_37, Show=invert(expression), Collapse=True, Disable=False)

pre_run_detailed_energy_simulations_2 = RemoteReceiver(pre_run_detailed_energy_simulations)
values_70 = ValueListener(Elements=button_5, SomeProperty=True)  # -> Values, Indices
values_71 = ValueListener(Elements=true_button_6, SomeProperty=True)  # -> Values, Indices
values_72 = ValueListener(Elements=button_6, SomeProperty=True)  # -> Values, Indices
zoom_simple_energy_simulation = RemoteSender(values_70.Values)
visualize_simple_energy_simulations = RemoteSender(values_71.Values)
pre_run_simple_energy_simulations = RemoteSender(values_72.Values)
pre_run_simple_energy_simulations_2 = RemoteReceiver(pre_run_simple_energy_simulations)
freeze_gate_11 = StreamFreezeGate(Data=pre_run_simple_energy_simulations_2, PassingSwitch=pre_run_simple_energy_simulations_2)
filter_2 = StreamFilter(Gate=freeze_gate_3, Stream0="Simulations can take a few minutes...", Stream1="Daylight simulation is running...")
filter_3 = StreamFilter(Gate=freeze_gate_11, Stream0="Simulations can take a few minutes...", Stream1="Energy simulation is running...")
entwine_57 = Entwine(Branch00=button_6, Branch01=button_5, Branch02=true_button_6, FlattenInputs=True)  # -> flatten(Result)
settextblock_8 = SetTextBlockContents(TextBlockToModify=tb_3, NewTextBlockContents=filter_2)
settextblock_9 = SetTextBlockContents(TextBlockToModify=tb_4, NewTextBlockContents=filter_3)
adjustpos_60 = AdjustElementPositioning(
    ElementsToAdjust=true_button_6,
    Margin="15, 0, 0, 0",
    AbsolutePositioning=False,
    Width=Slider(110, range=0..1000),
    Height=Slider(30, range=0..1000),
    HorizontalAlignment=0)
stack_45 = CreateStack(UIElements=entwine_57, Horizontal=True)
adjustpos_61 = AdjustElementPositioning(
    ElementsToAdjust=button_5,
    Margin="15, 0, 0, 0",
    AbsolutePositioning=False,
    Width=Slider(60, range=0..1000),
    Height=Slider(30, range=0..1000),
    HorizontalAlignment=0)

freeze_gate_12 = StreamFreezeGate(Data=pre_run_detailed_energy_simulations_2, PassingSwitch=pre_run_detailed_energy_simulations_2)
freeze_gate_13 = StreamFreezeGate(Data=values_72.Values, PassingSwitch=invert(values_72.Values))
bool_12 = Boolean(invert(freeze_gate_13))
tap_10 = TapBuffer(Reset=False, Incremental=True, Valve=bool_12, Hold=True)
dam_10 = DataDam(DataA=tap_10, BufferDelay=2500000, BufferMode=2)
equals_11 = Equality(FirstNumber=tap_10, SecondNumber=dam_10)  # -> Equality, Inequality

# ----
# Run simple energy simulations
entwine_58 = Entwine(Branch00=stack_45, Branch01=tb_4, Branch02=stack_8, FlattenInputs=True)  # -> flatten(Result)
stack_46 = CreateStack(UIElements=entwine_58, Horizontal=invert(True))
number_slider_23 = Slider(650, range=0..1000)
border_6 = CreateBorder(
    UIElement=stack_46,
    BorderThickness=Slider(1, range=0..10),
    BorderColor=ColourSwatch(SwatchColor=RGB(217, 217, 217)),
    CornerRadius=Slider(2, range=0..10))
adjustpos_62 = AdjustElementPositioning(ElementsToAdjust=border_6, Margin="0, 0, 0, 0", AbsolutePositioning=False, HorizontalAlignment=0)
location_21 = Data(border_6)

filter_4 = StreamFilter(Gate=freeze_gate_12, Stream0="Simulations can take a few minutes...", Stream1="Energy simulation is running...")
settextblock_10 = SetTextBlockContents(TextBlockToModify=tb_5, NewTextBlockContents=filter_4)

entwine_59 = Entwine(Branch00=label_11, Branch01=pulldown_6, Branch02=entwine_27, FlattenInputs=True)  # -> flatten(Result)
entwine_60 = Entwine(Branch00=preview, Branch01=stack_15, Branch02=entwine_24, FlattenInputs=True)  # -> flatten(Result)

# ----
# Assign type
assign_type = Data(entwine_59)

# ----
# Preview
preview_2 = Data(entwine_60)

# ----
# Geometry module interface
document_units_4 = RemoteReceiver(document_units)
document_units_5 = RemoteReceiver(document_units)
document_units_6 = RemoteReceiver(document_units)
document_units_7 = RemoteReceiver(document_units)
previewtype_2 = RemoteReceiver(previewtype)
previewtype_3 = RemoteReceiver(previewtype)
previewtype_4 = RemoteReceiver(previewtype)
previewtype_5 = RemoteReceiver(previewtype)
constructiontype = RemoteReceiver()
geometrytype_2 = RemoteReceiver(geometrytype)
presavegeometry_3 = RemoteReceiver(presavegeometry)
saveconstruction = RemoteReceiver()
expression_2 = Expression(x=document_units_4, y="Meters", Expression="x=y")
expression_3 = Expression(x=previewtype_3, y="All", Expression="x=y")
expression_4 = Expression(x="Room", y=previewtype_3, Expression="x=y")
expression_5 = Expression(x=document_units_5, y="Meters", Expression="x=y")
expression_6 = Expression(x=previewtype_2, y="All", Expression="x=y")
expression_7 = Expression(x="Context", y=previewtype_2, Expression="x=y")
expression_8 = Expression(x=document_units_6, y="Meters", Expression="x=y")
expression_9 = Expression(x=document_units_7, y="Meters", Expression="x=y")
expression_10 = Expression(x="Window", y=previewtype_5, Expression="x=y")
expression_11 = Expression(x=previewtype_5, y="All", Expression="x=y")
expression_12 = Expression(x="Adjacent", y=previewtype_4, Expression="x=y")
expression_13 = Expression(x=previewtype_4, y="All", Expression="x=y")
ef_att_2 = EleFrontAttributes(Keys="Heath geometry type", Values=geometrytype_2)
ef_att_3 = EleFrontAttributes(Keys="Construction", Values=constructiontype)
or = GateOr(A=expression_7, B=expression_6)
or_2 = GateOr(A=expression_4, B=expression_3)
or_3 = GateOr(A=expression_10, B=expression_11)
or_4 = GateOr(A=expression_12, B=expression_13)
gate_3 = StreamGate(Stream="Context", Gate=or)  # -> Target0, Target1
gate_4 = StreamGate(Stream="Adjacent", Gate=or_4)  # -> Target0, Target1
gate_5 = StreamGate(Stream="Room", Gate=or_2)  # -> Target0, Target1
gate_6 = StreamGate(Stream="Window", Gate=or_3)  # -> Target0, Target1
geometrytype_validate_2 = RemoteReceiver(geometrytype_validate)

# ----
# Zoom simple energy module
zoom_simple_energy_simulation_2 = RemoteReceiver(zoom_simple_energy_simulation)
panel_46 = Panel(zoom_simple_energy_simulation_2)

# ----
# Zoom weather visualization module
zoom_weather_visualization_2 = RemoteReceiver(zoom_weather_visualization)

# ----
# Zoom simple energy module
panel_47 = Panel(zoom_daylight_simulation_2)

# ----
# Detailed energy simulations visualizations
number_slider_24 = Slider(19, range=0..100)
colrange = LBColorRange(index=number_slider_24)  # -> colors; plug-in component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
split = SplitList(List=colrange, Index=Slider(7, range=0..10))  # -> ListA, ListB
entwine_61 = Entwine(Branch00=split.ListA, Branch01=ColourSwatch(SwatchColor=RGB(13, 207, 255)), Branch02=split.ListB, FlattenInputs=True)  # -> flatten(Result)

# ----
# Simple energy simulations visualizations
number_slider_25 = Slider(19, range=0..100)
colrange_2 = LBColorRange(index=number_slider_25)  # -> colors; plug-in component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
split_2 = SplitList(List=colrange_2, Index=Slider(7, range=0..10))  # -> ListA, ListB
entwine_62 = Entwine(Branch00=split_2.ListA, Branch01=ColourSwatch(SwatchColor=RGB(13, 207, 255)), Branch02=split_2.ListB, FlattenInputs=True)  # -> flatten(Result)

# ----
# Daylight simulations visualizations
number_slider_26 = Slider(19, range=0..100)
colrange_3 = LBColorRange(index=number_slider_26)  # -> colors; plug-in component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
split_3 = SplitList(List=colrange_3, Index=Slider(7, range=0..10))  # -> ListA, ListB
entwine_63 = Entwine(Branch00=split_3.ListA, Branch01=ColourSwatch(SwatchColor=RGB(13, 207, 255)), Branch02=split_3.ListB, FlattenInputs=True)  # -> flatten(Result)

# ----
# Create material tooltip
panel_48 = Panel(":")

number_slider_27 = Slider(1, range=0..1)
neg = Negative(Value=number_slider_27)

# ----
# Create construction tooltip
panel_49 = Panel(":")

# ----
# 1IN Stucco
# 5/8 in. Gypsum Board
# 5/8 in. Plywood
# 8IN Concrete HW
# Acoustic Ceiling
# Adiabatic Material
# Asphalt Pavement
# HW CONCRETE
# Metal Surface
panel_50 = Panel("""Adiabatic Roof
Adiabatic Wall
Asphalt Pavement
Concrete Pavement
Dry Dust
Dry Sand""")
database_constructions = RemoteSender(panel_50)

database_constructions_2 = RemoteReceiver(database_constructions)

database_constructions_3 = RemoteReceiver(database_constructions)
database_constructions_4 = RemoteReceiver(database_constructions)
database_constructions_5 = RemoteReceiver(database_constructions)
database_constructions_6 = RemoteReceiver(database_constructions)
database_constructions_7 = RemoteReceiver(database_constructions)
database_constructions_8 = RemoteReceiver(database_constructions)
database_constructions_9 = RemoteReceiver(database_constructions)
database_constructions_10 = RemoteReceiver(database_constructions)
database_constructions_11 = RemoteReceiver(database_constructions)
database_constructions_12 = RemoteReceiver(database_constructions)
database_constructions_13 = RemoteReceiver(database_constructions)
database_constructions_14 = RemoteReceiver(database_constructions)
database_constructions_15 = RemoteReceiver(database_constructions)
database_constructions_16 = RemoteReceiver(database_constructions)
database_constructions_17 = RemoteReceiver(database_constructions)
database_constructions_18 = RemoteReceiver(database_constructions)
database_constructions_19 = RemoteReceiver(database_constructions)
pulldown_16 = CreatePulldownMenu(Label="Glass door", ListItems=database_constructions_6, showLabel=True)
pulldown_17 = CreatePulldownMenu(Label="Overhead door", ListItems=database_constructions_8, showLabel=True)
pulldown_18 = CreatePulldownMenu(Label="Wall", ListItems=database_constructions_2, SelectedIndex="0", showLabel=True)
pulldown_19 = CreatePulldownMenu(Label="Roof", ListItems=database_constructions_3, showLabel=True)
pulldown_20 = CreatePulldownMenu(Label="Floor", ListItems=database_constructions_9, showLabel=True)
pulldown_21 = CreatePulldownMenu(Label="Exterior door", ListItems=database_constructions_11, showLabel=True)
pulldown_22 = CreatePulldownMenu(Label="Operable", ListItems=database_constructions_10, showLabel=True)
pulldown_23 = CreatePulldownMenu(Label="Skylight", ListItems=database_constructions_14, showLabel=True)
pulldown_24 = CreatePulldownMenu(Label="Wall", ListItems=database_constructions_7, showLabel=True)
pulldown_25 = CreatePulldownMenu(Label="Roof", ListItems=database_constructions_5, showLabel=True)
pulldown_26 = CreatePulldownMenu(Label="Floor", ListItems=database_constructions_4, showLabel=True)
pulldown_27 = CreatePulldownMenu(Label="Glass door", ListItems=database_constructions_13, showLabel=True)
pulldown_28 = CreatePulldownMenu(Label="Window", ListItems=database_constructions_16, SelectedIndex="0", showLabel=True)
pulldown_29 = CreatePulldownMenu(Label="Window", ListItems=database_constructions_15, showLabel=True)
pulldown_30 = CreatePulldownMenu(Label="Door", ListItems=database_constructions_12, showLabel=True)
pulldown_31 = CreatePulldownMenu(Label="Floor", ListItems=database_constructions_17, showLabel=True)
pulldown_32 = CreatePulldownMenu(Label="Ceiling", ListItems=database_constructions_19, showLabel=True)
pulldown_33 = CreatePulldownMenu(Label="Wall", ListItems=database_constructions_18, showLabel=True)
values_73 = ValueListener(Elements=pulldown_20, SomeProperty=True)  # -> Values, Indices
values_74 = ValueListener(Elements=pulldown_29, SomeProperty=True)  # -> Values, Indices
values_75 = ValueListener(Elements=pulldown_16, SomeProperty=True)  # -> Values, Indices
values_76 = ValueListener(Elements=pulldown_27, SomeProperty=True)  # -> Values, Indices
values_77 = ValueListener(Elements=pulldown_17, SomeProperty=True)  # -> Values, Indices
values_78 = ValueListener(Elements=pulldown_19, SomeProperty=True)  # -> Values, Indices
values_79 = ValueListener(Elements=pulldown_25, SomeProperty=True)  # -> Values, Indices
values_80 = ValueListener(Elements=pulldown_26, SomeProperty=True)  # -> Values, Indices
values_81 = ValueListener(Elements=pulldown_21, SomeProperty=True)  # -> Values, Indices
values_82 = ValueListener(Elements=pulldown_24, SomeProperty=True)  # -> Values, Indices
values_83 = ValueListener(Elements=pulldown_23, SomeProperty=True)  # -> Values, Indices
values_84 = ValueListener(Elements=pulldown_22, SomeProperty=True)  # -> Values, Indices
values_85 = ValueListener(Elements=pulldown_32, SomeProperty=True)  # -> Values, Indices
values_86 = ValueListener(Elements=pulldown_30, SomeProperty=True)  # -> Values, Indices
values_87 = ValueListener(Elements=pulldown_28, SomeProperty=True)  # -> Values, Indices
values_88 = ValueListener(Elements=pulldown_33, SomeProperty=True)  # -> Values, Indices
values_89 = ValueListener(Elements=pulldown_31, SomeProperty=True)  # -> Values, Indices
values_90 = ValueListener(Elements=pulldown_18, SomeProperty=True)  # -> Values, Indices
subset_interior_window = RemoteSender(values_74.Values)
subset_interior_glass_door = RemoteSender(values_76.Values)
subset_subface_overhead_door = RemoteSender(values_77.Values)
subset_subface_glass_door = RemoteSender(values_75.Values)
subset_exterior_floor = RemoteSender(values_73.Values)
subset_subface_window_index = RemoteSender(values_87.Indices)
subset_subface_exterior_door = RemoteSender(values_81.Values)
subset_interior_door = RemoteSender(values_86.Values)
subset_subface_skylight = RemoteSender(values_83.Values)
subset_interior_wall = RemoteSender(values_88.Values)
subset_interior_ceiling = RemoteSender(values_85.Values)
subset_subface_operable = RemoteSender(values_84.Values)
subset_ground_floor = RemoteSender(values_80.Values)
subset_ground_roof = RemoteSender(values_79.Values)
subset_exterior_roof = RemoteSender(values_78.Values)
subset_interior_floor = RemoteSender(values_89.Values)
subset_ground_wall = RemoteSender(values_82.Values)
subset_exterior_wall = RemoteSender(values_90.Indices)
entwine_64 = Entwine(Branch00=label_2, Branch01=pulldown_24, Branch02=pulldown_25, Branch03=pulldown_26, FlattenInputs=True)  # -> flatten(Result)
data_10 = Data(pulldown_28)
data_11 = Data(pulldown_23)
data_12 = Data(pulldown_22)
data_13 = Data(pulldown_21)
data_14 = Data(pulldown_17)
data_15 = Data(pulldown_16)
entwine_65 = Entwine(Branch00=data_9, Branch01=data_10, FlattenInputs=True)  # -> flatten(Result)
entwine_66 = Entwine(
    Branch00=label_4,
    Branch01=pulldown_33,
    Branch02=pulldown_32,
    Branch03=pulldown_31,
    Branch04=pulldown_30,
    Branch05=pulldown_29,
    Branch06=pulldown_27,
    FlattenInputs=True)  # -> flatten(Result)
stack_47 = CreateStack(UIElements=entwine_66, Horizontal=invert(True))
stack_48 = CreateStack(UIElements=entwine_64, Horizontal=invert(True))
stack_49 = CreateStack(UIElements=entwine_65, Horizontal=invert(True))
border_7 = CreateBorder(
    UIElement=stack_49,
    BorderThickness=Slider(1, range=0..10),
    BorderColor=ColourSwatch(SwatchColor=RGB(217, 217, 217)),
    CornerRadius=Slider(2, range=0..10))
adjustpos_63 = AdjustElementPositioning(
    ElementsToAdjust=pulldown_28,
    AbsolutePositioning=False,
    Width=Slider(300, range=0..300),
    Height=Slider(35, range=0..300),
    HorizontalAlignment=0)
adjustpos_64 = AdjustElementPositioning(
    ElementsToAdjust=pulldown_23,
    AbsolutePositioning=False,
    Width=Slider(190, range=0..300),
    Height=Slider(35, range=0..300),
    HorizontalAlignment=0)
adjustpos_65 = AdjustElementPositioning(
    ElementsToAdjust=pulldown_17,
    AbsolutePositioning=False,
    Width=Slider(190, range=0..300),
    Height=Slider(35, range=0..300),
    HorizontalAlignment=0)
adjustpos_66 = AdjustElementPositioning(
    ElementsToAdjust=pulldown_22,
    AbsolutePositioning=False,
    Width=Slider(190, range=0..300),
    Height=Slider(35, range=0..300),
    HorizontalAlignment=0)
adjustpos_67 = AdjustElementPositioning(
    ElementsToAdjust=pulldown_21,
    AbsolutePositioning=False,
    Width=Slider(190, range=0..300),
    Height=Slider(35, range=0..300),
    HorizontalAlignment=0)
adjustpos_68 = AdjustElementPositioning(
    ElementsToAdjust=pulldown_16,
    AbsolutePositioning=False,
    Width=Slider(190, range=0..300),
    Height=Slider(35, range=0..300),
    HorizontalAlignment=0)
adjustpos_69 = AdjustElementPositioning(ElementsToAdjust=pulldown_18, AbsolutePositioning=False, HorizontalAlignment=0)
border_8 = CreateBorder(
    UIElement=stack_47,
    BorderThickness=Slider(1, range=0..10),
    BorderColor=ColourSwatch(SwatchColor=RGB(217, 217, 217)),
    CornerRadius=Slider(2, range=0..10))
adjustpos_70 = AdjustElementPositioning(
    ElementsToAdjust=pulldown_33,
    AbsolutePositioning=False,
    Width=Slider(190, range=0..300),
    Height=Slider(35, range=0..300),
    HorizontalAlignment=0)
adjustpos_71 = AdjustElementPositioning(
    ElementsToAdjust=pulldown_19,
    AbsolutePositioning=False,
    Width=Slider(190, range=0..300),
    Height=Slider(35, range=0..300),
    HorizontalAlignment=0)
adjustpos_72 = AdjustElementPositioning(
    ElementsToAdjust=pulldown_20,
    AbsolutePositioning=False,
    Width=Slider(190, range=0..300),
    Height=Slider(35, range=0..300),
    HorizontalAlignment=0)
border_9 = CreateBorder(
    UIElement=stack_48,
    BorderThickness=Slider(1, range=0..10),
    BorderColor=ColourSwatch(SwatchColor=RGB(217, 217, 217)),
    CornerRadius=Slider(2, range=0..10))
adjustpos_73 = AdjustElementPositioning(
    ElementsToAdjust=pulldown_24,
    AbsolutePositioning=False,
    Width=Slider(190, range=0..300),
    Height=Slider(35, range=0..300),
    HorizontalAlignment=0)
adjustpos_74 = AdjustElementPositioning(
    ElementsToAdjust=pulldown_32,
    AbsolutePositioning=False,
    Width=Slider(190, range=0..300),
    Height=Slider(35, range=0..300),
    HorizontalAlignment=0)
adjustpos_75 = AdjustElementPositioning(
    ElementsToAdjust=pulldown_29,
    AbsolutePositioning=False,
    Width=Slider(190, range=0..300),
    Height=Slider(35, range=0..300),
    HorizontalAlignment=0)
adjustpos_76 = AdjustElementPositioning(
    ElementsToAdjust=pulldown_31,
    AbsolutePositioning=False,
    Width=Slider(190, range=0..300),
    Height=Slider(35, range=0..300),
    HorizontalAlignment=0)
adjustpos_77 = AdjustElementPositioning(
    ElementsToAdjust=pulldown_30,
    AbsolutePositioning=False,
    Width=Slider(190, range=0..300),
    Height=Slider(35, range=0..300),
    HorizontalAlignment=0)
adjustpos_78 = AdjustElementPositioning(
    ElementsToAdjust=pulldown_25,
    AbsolutePositioning=False,
    Width=Slider(190, range=0..300),
    Height=Slider(35, range=0..300),
    HorizontalAlignment=0)
adjustpos_79 = AdjustElementPositioning(
    ElementsToAdjust=pulldown_27,
    AbsolutePositioning=False,
    Width=Slider(190, range=0..300),
    Height=Slider(35, range=0..300),
    HorizontalAlignment=0)
adjustpos_80 = AdjustElementPositioning(
    ElementsToAdjust=pulldown_26,
    AbsolutePositioning=False,
    Width=Slider(190, range=0..300),
    Height=Slider(35, range=0..300),
    HorizontalAlignment=0)
adjustpos_81 = AdjustElementPositioning(ElementsToAdjust=border_7, Margin="5, 0, 0, 0", AbsolutePositioning=False, HorizontalAlignment=0)
adjustpos_82 = AdjustElementPositioning(
    ElementsToAdjust=border_8,
    Margin="5, 0, 0, 0",
    AbsolutePositioning=False,
    Width=Slider(200, range=0..300),
    Height=Slider(285, range=0..300),
    HorizontalAlignment=0)
adjustpos_83 = AdjustElementPositioning(
    ElementsToAdjust=border_9,
    Margin="5, 0, 0, 0",
    AbsolutePositioning=False,
    Width=Slider(200, range=0..300),
    Height=Slider(155, range=0..300),
    HorizontalAlignment=0,
    VerticalAlignment=2)

data_16 = Data(pulldown_18)
data_17 = Data(pulldown_19)
data_18 = Data(pulldown_20)
data_19 = Data(border_8)
data_20 = Data(border_7)
data_21 = Data(border_9)

entwine_67 = Entwine(Branch00=data, Branch01=data_16, FlattenInputs=True)  # -> flatten(Result)
stack_50 = CreateStack(UIElements=entwine_67, Horizontal=invert(True))
border_10 = CreateBorder(
    UIElement=stack_50,
    BorderThickness=Slider(1, range=0..10),
    BorderColor=ColourSwatch(SwatchColor=RGB(217, 217, 217)),
    CornerRadius=Slider(2, range=0..10))
adjustpos_84 = AdjustElementPositioning(
    ElementsToAdjust=border_10,
    Margin="5, 0, 0, 0",
    AbsolutePositioning=False,
    Width=Slider(200, range=0..300),
    Height=Slider(155, range=0..300),
    HorizontalAlignment=0,
    VerticalAlignment=2)

data_22 = Data(border_10)
entwine_68 = Entwine(Branch01=data_20, Branch02=data_22, FlattenInputs=True)  # -> flatten(Result)
stack_51 = CreateStack(UIElements=entwine_68, Horizontal=True)
entwine_69 = Entwine(Branch00=label_10, Branch01=stack_51, FlattenInputs=True)  # -> flatten(Result)
stack_52 = CreateStack(UIElements=entwine_69, Horizontal=invert(True))

# ----
# Select subset construction
location_22 = Data(stack_52)

# ----
# Heath window
number_slider_28 = Slider(850, range=0..1000)
launch_heath_3 = RemoteReceiver(launch_heath)
data_23 = Data(location_4)
panel_51 = Panel("C:\Users\Isac\Desktop\Toivo_Chalmers\heath\Icons\butterfly_heath.png")
panel_52 = Panel("C:\Users\Isac\Desktop\Toivo_Chalmers\heath\Icons\butterfly_smol.png")
entwine_70 = Entwine(Branch00=stack_44, FlattenInputs=True)
entwine_71 = Entwine(Branch00=entwine_18, Branch01=location_22, FlattenInputs=True)
entwine_72 = Entwine(Branch00=assign_type, Branch01=preview_2, Branch02=location_2, Branch03=location_8, FlattenInputs=True)
entwine_73 = Entwine(
    Branch00=location_9,
    Branch01=location_12,
    Branch02=location_10,
    Branch03=location_13,
    Branch04=location_11,
    FlattenInputs=True)
entwine_74 = Entwine(Branch00=location_21, Branch02=location_3, FlattenInputs=True)
entwine_75 = Entwine(Branch00=stack_29, FlattenInputs=True)
launchwin_2 = LaunchWindow(
    Show=launch_heath_3,
    Name="Heath",
    Width=number_slider_28,
    Height=Slider(460, range=0..1000),
    ChildStatus=1,
    EnableHorizScroll=False)
heath_flying_3 = RemoteReceiver(heath_flying)
heath_window = RemoteSender(launchwin_2)
accent_colors_2 = ValueList({"Amber", "Blue", "Brown", "Cobalt", "Crimson", "Cyan", "Emerald", "Green", "Indigo", "Lime", "Magenta", "Mauve", "Olive", "Orange", "Pink", "Purple", "Red", "Sienna", "Steel", "Taupe", "Teal", "Violet", "Yellow"}, selected="Blue")
py3_3 = Python3Script(get=heath_flying_3)  # -> mpl_folder; same code as py3_2
panel_53 = Panel("""Geometry module
Program module
Construction module
Assembly module
Visualize module
Analysis module""")
pt_6 = ConstructPoint(XCoordinate=Slider(6, range=0..1000), YCoordinate=Slider(43, range=0..1000), ZCoordinate=0)
button_18 = CreateButton(ButtonName="Load state", ButtonStyle=0)
filepicker_2 = CreateFilePicker(ButtonLabelText="Pick state", DialogType=0, MustExist=True, Filter="Textdokument|*.txt", StartingPath=py3_3)
true_button_10 = CreateTrueOnlyButton(ButtonName="Save state", ButtonStyle=0)
true_button_11 = CreateTrueOnlyButton(ButtonName="Help!", ButtonStyle=0)
tabs = TabbedView(
    TabNames=panel_53,
    TabTextSize=Slider(12, range=0..100),
    Tab0=flatten(entwine_72),
    Tab1=flatten(entwine_73),
    Tab2=flatten(entwine_71),
    Tab3=flatten(entwine_70),
    Tab4=flatten(entwine_75),
    Tab5=flatten(entwine_74))
winprops_2 = SetWindowProperties(
    Window=launchwin_2,
    StartingLocation=pt_6,
    Theme=0,
    AccentColor=accent_colors_2,
    ShowTitleBar=True,
    BackgroundColor=RGB(255, 255, 255),
    ScaleFactor=1)
values_91 = ValueListener(Elements=tabs, SomeProperty=True)  # -> Values, Indices
values_92 = ValueListener(Elements=true_button_11, SomeProperty=True)  # -> Values, Indices
values_93 = ValueListener(Elements=filepicker_2, SomeProperty=True)  # -> Values, Indices
values_94 = ValueListener(Elements=true_button_10, SomeProperty=True)  # -> Values, Indices
values_95 = ValueListener(Elements=button_18, SomeProperty=True)  # -> Values, Indices
bool_13 = Boolean(values_93.Values)
current_tab = RemoteSender(values_91.Values)
current_tab_index = RemoteSender(values_91.Indices)
save_state = RemoteSender(values_94.Values)
help_button = RemoteSender(values_92.Values)
load_state_file = RemoteSender(values_93.Values)
load_state = RemoteSender(values_95.Values)
entwine_76 = Entwine(Branch00=true_button_11, Branch01=true_button_10, Branch02=filepicker_2, Branch03=button_18, FlattenInputs=True)  # -> flatten(Result)
null_2 = NullItem(Item=bool_13)  # -> NullFlags, InvalidFlags, Description
stack_53 = CreateStack(UIElements=entwine_76, Horizontal=invert(True))
entwine_77 = Entwine(Branch00=tabs, Branch01=stack_53, FlattenInputs=True)  # -> flatten(Result)
stack_54 = CreateStack(UIElements=entwine_77, Horizontal=True)
hideshow_18 = HideShowElement(ElementToHideShow=button_18, Show=null_2.NullFlags, Collapse=True, Disable=False)
addelems_3 = AddElements(Window=launchwin_2, Elements=flatten(stack_54), DoVLChecking=True)  # -> AddedElements, ElementNames
number_slider_29 = Slider(30, range=0..100)
number_slider_30 = Slider(50, range=0..100)
heath_elements = RemoteSender(addelems_3.AddedElements)
adjustpos_85 = AdjustElementPositioning(ElementsToAdjust=tabs, AbsolutePositioning=False)
adjustpos_86 = AdjustElementPositioning(ElementsToAdjust=true_button_11, AbsolutePositioning=invert(False), HorizontalAlignment=1, VerticalAlignment=2)
adjustpos_87 = AdjustElementPositioning(
    ElementsToAdjust=filepicker_2,
    AbsolutePositioning=invert(False),
    Width=Slider(90, range=0..100),
    Height=Slider(32, range=0..100),
    HorizontalAlignment=1,
    VerticalAlignment=2)

current_tab_2 = RemoteReceiver(current_tab)
current_tab_3 = RemoteReceiver(current_tab)
expression_14 = Expression(x="Analysis module", y=current_tab_2, Expression="x=y")
expression_15 = Expression(x="Construction module", y=current_tab_3, Expression="x=y")
and = GateAnd(A=equals_11.Inequality, B=expression_14)
and_2 = GateAnd(A=equals_4.Inequality, B=expression_15)
event = EventGate(Data=and)  # -> Data, IsNew
event_2 = EventGate(Data=and_2)  # -> Data, IsNew
load_constructions = RemoteSender(event_2.Data)
panel_54 = Panel(event_2.Data)

# ----
# Heath help
panel_55 = Panel("""1. Select geometry in Rhino.

2. Select geometry type under the import geometry heading.

3. Click "Save geometry".

4. Verify the assigned geometry by pressing the "Preview" checkbox.""")
panel_56 = Panel("""1. Select the program for the building and room.

2. Use the sliders to set the cooling and heating setpoints.

3. Estimate how many persons will be in the room with the occupancy slider.""")
panel_57 = Panel("""1. Select base construction by climate and type of construction.

2. If required, create your own material or window. Materials can later be selected when creating custom constructions.

3. Constructions and windows make up the subset construction, which is used to modify the base construction.

4. Constructions can be loaded from a file, which contains all previously created constructions.""")
current_tab_index_2 = RemoteReceiver(current_tab_index)
panel_58 = Panel("""1. Verify that the honeybee model is correct by selecting attributes and clicking the checkboxes in the "Attributes visualization" segment.

2. Click the "Run weather visualization" button. If the model is set up correctly the "Direct sun hours" and "Incident radiation" should be displayed on the model.""")
panel_59 = Panel("""1. Pick which simulation you want to run.

2. If the simulation failed a red text will show up, go back and review the honeybee model and settings.

3. Otherwise, navigate through the expanded segment to select appropriate displays of the results.

4. It is possible to transfer the results to Rhino by clicking "Bake", or to an image file by clicking "Pop-up window".""")
panel_60 = Panel("""1. Make sure the geometry have been imported and that the program and constructions are in place, before creating a honeybee model.

2. If the model has been created, the "Bake model" button will be enabled along with boxes that lets you visualize the model.

3. Set the wall thickness and roof thickness.

4. Switch the WWR (window-to-wall-ratio) on, if you want to generate windows automatically.""")
help_button_2 = RemoteReceiver(help_button)
heath_window_2 = RemoteReceiver(heath_window)
filter_5 = StreamFilter(
    Gate=current_tab_index_2,
    Stream0="Geometry module",
    Stream1="Program module",
    Stream2="Construction module",
    Stream3="Assembly module",
    Stream4="Visualize module",
    Stream5="Analysis module")
filter_6 = StreamFilter(
    Gate=current_tab_index_2,
    Stream0=panel_55,
    Stream1=panel_56,
    Stream2=panel_57,
    Stream3=panel_60,
    Stream4=panel_58,
    Stream5=panel_59)
label_28 = CreateLabel(LabelText="Geometry module", LabelSize=18, Justification=0)
tb_11 = CreateTextBlock(Text="Geometry module", TextSize=12, Justification=0)
launchwin_3 = LaunchWindow(
    Show=help_button_2,
    Name="Help!",
    Width=Slider(350, range=0..500),
    Height=Slider(280, range=0..500),
    ChildStatus=0,
    EnableHorizScroll=False)
pt_7 = ConstructPoint(XCoordinate=Slider(325, range=0..1000), YCoordinate=Slider(165, range=0..1000), ZCoordinate=0)
settextblock_11 = SetTextBlockContents(TextBlockToModify=tb_11, NewTextBlockContents=filter_6)
setlabel = SetLabelContents(LabelToModify=label_28, NewLabelContents=filter_5)
childwin = MakeChildWindow(ParentWindow=heath_window_2, ChildWindow=launchwin_3)
winprops_3 = SetWindowProperties(Window=launchwin_3, StartingLocation=pt_7, Theme=0, ShowTitleBar=True, BackgroundColor=RGB(255, 255, 255), ScaleFactor=1)
entwine_78 = Entwine(Branch00=label_28, Branch01=tb_11, FlattenInputs=True)  # -> flatten(Result)
addelems_4 = AddElements(Window=launchwin_3, Elements=flatten(entwine_78), DoVLChecking=True)  # -> AddedElements, ElementNames

heath_window_3 = RemoteReceiver(heath_window)

# ----
# Heath info
number_slider_31 = Slider(148, range=0..500)
panel_61 = Panel("""Import geometry which is 
used to create the 
honeybee model""")
label_29 = CreateLabel(LabelText=panel_61, LabelSize=12, Justification=0)
launchwin_4 = LaunchWindow(
    Show=info_save_geometry_2,
    Name="Info",
    Width=Slider(180, range=0..500),
    Height=number_slider_31,
    ChildStatus=0,
    EnableHorizScroll=False)
pt_8 = ConstructPoint(XCoordinate=Slider(183, range=0..1000), YCoordinate=Slider(183, range=0..1000), ZCoordinate=0)
addelems_5 = AddElements(Window=launchwin_4, Elements=flatten(label_29), DoVLChecking=True)  # -> AddedElements, ElementNames
childwin_2 = MakeChildWindow(ParentWindow=heath_window_3, ChildWindow=launchwin_4)
winprops_4 = SetWindowProperties(Window=launchwin_4, StartingLocation=pt_8, Theme=0, ShowTitleBar=True, BackgroundColor=RGB(255, 255, 255), ScaleFactor=1)

winstat_2 = WindowStatus(Window=launchwin_2)
heath_status = RemoteSender(winstat_2)
heath_window_4 = RemoteReceiver(heath_window)
heath_window_5 = RemoteReceiver(heath_window)
heath_window_6 = RemoteReceiver(heath_window)

# ----
# Load constructions, (not sorted)
loaded_constructions_file_2 = RemoteReceiver(loaded_constructions_file)
load_constructions_2 = RemoteReceiver(load_constructions)
loadobjects = HBLoadObjects(hb_file=loaded_constructions_file_2, load=load_constructions_2)  # -> report, hb_objs; plug-in component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
hold = HoldingGate(Data=loadobjects.hb_objs)
panel_62 = Panel(hold)
loaded_constructions = RemoteSender(hold)

panel_63 = Panel(load_constructions_2)

current_tab_4 = RemoteReceiver(current_tab)
current_tab_5 = RemoteReceiver(current_tab)
current_tab_6 = RemoteReceiver(current_tab)
current_tab_7 = RemoteReceiver(current_tab)
current_tab_8 = RemoteReceiver(current_tab)
current_tab_9 = RemoteReceiver(current_tab)
expression_16 = Expression(x="Assembly module", y=current_tab_4, Expression="x=y")
expression_17 = Expression(x="Assembly module", y=current_tab_5, Expression="x=y")
expression_18 = Expression(x="Assembly module", y=current_tab_6, Expression="x=y")
current_tab_10 = RemoteReceiver(current_tab)
expression_19 = Expression(x="Assembly module", y=current_tab_7, Expression="x=y")
expression_20 = Expression(x="Assembly module", y=current_tab_8, Expression="x=y")
expression_21 = Expression(x="Assembly module", y=current_tab_9, Expression="x=y")
current_tab_11 = RemoteReceiver(current_tab)
expression_22 = Expression(x="Assembly module", y=current_tab_10, Expression="x=y")
expression_23 = Expression(x="Assembly module", y=current_tab_11, Expression="x=y")
and_3 = GateAnd(A=values_55.Values, B=expression_22)
current_tab_12 = RemoteReceiver(current_tab)
current_tab_13 = RemoteReceiver(current_tab)
show_honeybee_all = RemoteSender(and_3)
show_honeybee_all_2 = RemoteReceiver(show_honeybee_all)
show_honeybee_all_3 = RemoteReceiver(show_honeybee_all)
show_honeybee_all_4 = RemoteReceiver(show_honeybee_all)
show_honeybee_all_5 = RemoteReceiver(show_honeybee_all)
show_honeybee_all_6 = RemoteReceiver(show_honeybee_all)
show_honeybee_all_7 = RemoteReceiver(show_honeybee_all)
show_honeybee_all_8 = RemoteReceiver(show_honeybee_all)
or_5 = GateOr(A=values_52.Values, B=show_honeybee_all_2)
or_6 = GateOr(A=values_53.Values, B=show_honeybee_all_3)
or_7 = GateOr(A=values_54.Values, B=show_honeybee_all_4)
or_8 = GateOr(A=values_56.Values, B=show_honeybee_all_5)
or_9 = GateOr(A=values_57.Values, B=show_honeybee_all_6)
or_10 = GateOr(A=values_58.Values, B=show_honeybee_all_7)
or_11 = GateOr(A=values_59.Values, B=show_honeybee_all_8)
and_4 = GateAnd(A=or_5, B=expression_16)
and_5 = GateAnd(A=or_6, B=expression_23)
and_6 = GateAnd(A=or_7, B=expression_17)
and_7 = GateAnd(A=or_8, B=expression_18)
and_8 = GateAnd(A=or_9, B=expression_19)
and_9 = GateAnd(A=or_10, B=expression_20)
and_10 = GateAnd(A=or_11, B=expression_21)
show_honeybee_context = RemoteSender(and_5)
show_honeybee_ground = RemoteSender(and_7)
show_honeybee_floors = RemoteSender(and_8)
expression_24 = Expression(x="Assembly module", y=current_tab_12, Expression="x=y")
expression_25 = Expression(x="Assembly module", y=current_tab_13, Expression="x=y")
show_honeybee_walls = RemoteSender(and_10)
show_honeybee_windows = RemoteSender(and_6)
show_honeybee_roof = RemoteSender(and_9)
show_honeybee_doors = RemoteSender(and_4)
and_11 = GateAnd(A=equals_10.Inequality, B=expression_25)
and_12 = GateAnd(A=equals_9.Inequality, B=expression_24)
event_3 = EventGate(Data=and_11)  # -> Data, IsNew
event_4 = EventGate(Data=and_12)  # -> Data, IsNew
bake_model = RemoteSender(event_3.Data)
create_model = RemoteSender(event_4.Data)

current_tab_14 = RemoteReceiver(current_tab)
expression_26 = Expression(x="Geometry module", y=current_tab_14, Expression="x=y")
and_13 = GateAnd(A=values_27.Values, B=expression_26)
preview_3 = RemoteSender(and_13)
current_tab_15 = RemoteReceiver(current_tab)
heath_status_2 = RemoteReceiver(heath_status)
current_tab_16 = RemoteReceiver(current_tab)
expression_27 = Expression(x="Geometry module", y=current_tab_15, Expression="x=y")
expression_28 = Expression(x="Geometry module", y=current_tab_16, Expression="x=y")
expression_29 = Expression(x="Hidden", y=heath_status_2, Expression="x=y")
and_14 = GateAnd(A=equals_5.Inequality, B=expression_27)
event_5 = EventGate(Data=and_14)  # -> Data, IsNew
and_15 = GateAnd(A=equals_6.Inequality, B=expression_28, C=invert(expression_29))
savegeometry = RemoteSender(event_5.Data)
event_6 = EventGate(Data=and_15)  # -> Data, IsNew
create_test_model = RemoteSender(event_6.Data)

create_test_model_2 = RemoteReceiver(create_test_model)
bake = BakeObjects(Geometry=entwine_3, Attributes=repeat_2, Bake=create_test_model_2, createGroups=False)  # -> Message, Ghosts

current_tab_17 = RemoteReceiver(current_tab)
current_tab_18 = RemoteReceiver(current_tab)
current_tab_19 = RemoteReceiver(current_tab)
current_tab_20 = RemoteReceiver(current_tab)
current_tab_21 = RemoteReceiver(current_tab)
expression_30 = Expression(x="Visualize module", y=current_tab_17, Expression="x=y")
expression_31 = Expression(x="Visualize module", y=current_tab_18, Expression="x=y")
expression_32 = Expression(x="Visualize module", y=current_tab_19, Expression="x=y")
expression_33 = Expression(x="Visualize module", y=current_tab_20, Expression="x=y")
expression_34 = Expression(x="Visualize module", y=current_tab_21, Expression="x=y")
and_16 = GateAnd(A=values_42.Values, B=expression_30)
and_17 = GateAnd(A=values_41.Values, B=expression_31)
and_18 = GateAnd(A=values_47.Values, B=expression_32)
and_19 = GateAnd(A=values_46.Values, B=expression_33)
and_20 = GateAnd(A=values_49.Values, B=expression_34)
current_tab_22 = RemoteReceiver(current_tab)
room_energy_attribute_visualize = RemoteSender(and_16)
current_tab_23 = RemoteReceiver(current_tab)
weather_visualization_show = RemoteSender(and_17)
face_attribute_visualize = RemoteSender(and_18)
room_attribute_visualize = RemoteSender(and_19)
face_energy_attribute_visualize = RemoteSender(and_20)
expression_35 = Expression(x="Visualize module", y=current_tab_22, Expression="x=y")
expression_36 = Expression(x="Visualize module", y=current_tab_23, Expression="x=y")
and_21 = GateAnd(A=equals_8.Inequality, B=expression_35)
and_22 = GateAnd(A=equals_7.Inequality, B=expression_36)
event_7 = EventGate(Data=and_21)  # -> Data, IsNew
event_8 = EventGate(Data=and_22)  # -> Data, IsNew
weather_visualisation_bake = RemoteSender(event_7.Data)
run_weather_visualisation = RemoteSender(event_8.Data)

run_weather_visualisation_2 = RemoteReceiver(run_weather_visualisation)

current_tab_24 = RemoteReceiver(current_tab)
current_tab_25 = RemoteReceiver(current_tab)
expression_37 = Expression(x="Analysis module", y=current_tab_24, Expression="x=y")
expression_38 = Expression(x="Analysis module", y=current_tab_25, Expression="x=y")
and_23 = GateAnd(A=equals.Inequality, B=expression_37)
and_24 = GateAnd(A=equals_2.Inequality, B=expression_38)
event_9 = EventGate(Data=and_23)  # -> Data, IsNew
event_10 = EventGate(Data=and_24)  # -> Data, IsNew
run_daylight_simulations = RemoteSender(event_9.Data)
run_detailed_energy_simulations = RemoteSender(event_10.Data)
run_simple_energy_simulations = RemoteSender(event.Data)

run_detailed_energy_simulations_2 = RemoteReceiver(run_detailed_energy_simulations)
run_simple_energy_simulations_2 = RemoteReceiver(run_simple_energy_simulations)
run_daylight_simulations_2 = RemoteReceiver(run_daylight_simulations)
py3_4 = Python3Script(get=run_daylight_simulations_2)  # -> mpl_folder; same code as py3_2
py3_5 = Python3Script(get=run_simple_energy_simulations_2)  # -> mpl_folder; same code as py3_2
run_simple_energy_simulations_3 = RemoteReceiver(run_simple_energy_simulations)
panel_65 = Panel(run_simple_energy_simulations_3)

savegeometry_2 = RemoteReceiver(savegeometry)
savegeometry_3 = RemoteReceiver(savegeometry)
savegeometry_4 = RemoteReceiver(savegeometry)
savegeometry_5 = RemoteReceiver(savegeometry)
savegeometry_6 = RemoteReceiver(savegeometry)
py3_6 = Python3Script(x=savegeometry_2)  # -> a
# ---------- py3_6: Python ----------
"""Grasshopper Script"""

import rhinoscriptsyntax as rs

if x:
    rs.Command("SelNone")
    a = True
# ---------- end py3_6 ----------
preview_4 = RemoteReceiver(preview_3)
preview_5 = RemoteReceiver(preview_3)
preview_6 = RemoteReceiver(preview_3)
preview_7 = RemoteReceiver(preview_3)
or_12 = GateOr(A=Toggle(True), B=py3_6)
or_13 = GateOr(A=savegeometry_4, B=preview_5, C=expression_5)
or_14 = GateOr(A=savegeometry_3, B=preview_4, C=expression_2)
or_15 = GateOr(A=savegeometry_6, B=preview_7, C=expression_9)
or_16 = GateOr(A=savegeometry_5, B=preview_6, C=expression_8)
selobj_2 = ObjectsBySelection(Reset=or_12, LiveMode=True)
gate_7 = StreamGate(Stream="Heath geometry type", Gate=or_15)  # -> Target0, Target1
gate_8 = StreamGate(Stream="Heath geometry type", Gate=or_13)  # -> Target0, Target1
gate_9 = StreamGate(Stream="Heath geometry type", Gate=or_14)  # -> Target0, Target1
gate_10 = StreamGate(Stream="Heath geometry type", Gate=or_16)  # -> Target0, Target1
id = Guid(selobj_2)
seletedgeometry = RemoteSender(selobj_2)
seletedgeometry_2 = RemoteReceiver(seletedgeometry)
seletedgeometry_3 = RemoteReceiver(seletedgeometry)
modratt = ModifyRhinoObjectAttributes(ReferencedObject=seletedgeometry_3, Attributes=ef_att_3, Activate=saveconstruction)
refkv = ReferenceByKeyValue(Key=gate_8.Target1, Val=gate_3.Target1, lightweight=False)
panel_66 = Panel(modratt)
refkv_2 = ReferenceByKeyValue(Key=gate_9.Target1, Val=gate_5.Target1, lightweight=False)
refkv_3 = ReferenceByKeyValue(Key=gate_7.Target1, Val=gate_4.Target1, lightweight=False)
refkv_4 = ReferenceByKeyValue(Key=gate_10.Target1, Val=gate_6.Target1, lightweight=False)
panel_67 = Panel(id)
preview_8 = RemoteReceiver(preview_3)
preview_9 = RemoteReceiver(preview_3)
preview_10 = RemoteReceiver(preview_3)
preview_11 = RemoteReceiver(preview_3)
gate_11 = StreamGate(Stream=refkv, Gate=preview_8)  # -> Target0, Target1
gate_12 = StreamGate(Stream=refkv_3, Gate=preview_9)  # -> Target0, Target1
gate_13 = StreamGate(Stream=refkv_4, Gate=preview_10)  # -> Target0, Target1
gate_14 = StreamGate(Stream=refkv_2, Gate=preview_11)  # -> Target0, Target1
preview_12 = CustomPreview(Geometry=gate_11.Target1, Material=ColourSwatch(SwatchColor=RGBA(128, 125, 0, 75)))
preview_13 = CustomPreview(Geometry=gate_12.Target1, Material=ColourSwatch(SwatchColor=RGBA(0, 17, 128, 75)))
preview_14 = CustomPreview(Geometry=gate_13.Target1, Material=ColourSwatch(SwatchColor=RGBA(128, 0, 102, 75)))
preview_15 = CustomPreview(Geometry=gate_14.Target1, Material=ColourSwatch(SwatchColor=RGBA(4, 128, 0, 75)))
room_energy_attribute_visualize_2 = RemoteReceiver(room_energy_attribute_visualize)
face_energy_attribute_visualize_2 = RemoteReceiver(face_energy_attribute_visualize)
show_honeybee_windows_2 = RemoteReceiver(show_honeybee_windows)
room_attribute_visualize_2 = RemoteReceiver(room_attribute_visualize)
show_honeybee_ground_2 = RemoteReceiver(show_honeybee_ground)
show_honeybee_context_2 = RemoteReceiver(show_honeybee_context)
face_attribute_visualize_2 = RemoteReceiver(face_attribute_visualize)
show_honeybee_floors_2 = RemoteReceiver(show_honeybee_floors)
show_honeybee_doors_2 = RemoteReceiver(show_honeybee_doors)
show_honeybee_walls_2 = RemoteReceiver(show_honeybee_walls)
show_honeybee_roof_2 = RemoteReceiver(show_honeybee_roof)
preview_16 = RemoteReceiver(preview_3)

seletedgeometry_4 = RemoteReceiver(seletedgeometry)
lng_3 = ListLength(List=seletedgeometry_4)
bool_14 = Boolean(lng_3)
filter_7 = StreamFilter(Gate=bool_14, Stream0=Slider(500, range=0..1000), Stream1=Slider(1000000, range=0..1000000))
filter_8 = StreamFilter(Gate=bool_14, Stream0="Select Rhino geometry to import", Stream1=" ")
seletedgeometry_5 = RemoteReceiver(seletedgeometry)
tooltip_9 = AttachTooltipToElement(ElementsToAttachTo=button_8, TooltipContent=filter_8, ShowDelay=filter_7, Duration=2000)
lng_4 = ListLength(List=seletedgeometry_5)
hideshow_19 = HideShowElement(ElementToHideShow=button_8, Show=True, Collapse=True, Disable=invert(lng_4))

freeze_gate_14 = StreamFreezeGate(Data=seletedgeometry_2, PassingSwitch=presavegeometry_2, Hold=False)
filtertype = FilterByType(ObjectType="Extrusion", Geometry=freeze_gate_14, invertFilter=False, returnNulls=False)  # -> ExcludedGeometry, IncludedGeometry
filtertype_2 = FilterByType(ObjectType="Brep", Geometry=freeze_gate_14, invertFilter=False, returnNulls=False)  # -> ExcludedGeometry, IncludedGeometry
filtertype_3 = FilterByType(ObjectType="Surface", Geometry=freeze_gate_14, invertFilter=False, returnNulls=False)  # -> ExcludedGeometry, IncludedGeometry
filtertype_4 = FilterByType(ObjectType="Mesh", Geometry=freeze_gate_14, invertFilter=False, returnNulls=False)  # -> ExcludedGeometry, IncludedGeometry
filtertype_5 = FilterByType(ObjectType="Polysurface", Geometry=freeze_gate_14, invertFilter=False, returnNulls=False)  # -> ExcludedGeometry, IncludedGeometry

psrfclsd = IsPolysurfaceClosed(Polysurface=[filtertype.IncludedGeometry, filtertype_2.IncludedGeometry, filtertype_5.IncludedGeometry])
planar = IsPlanar(Surface=filtertype_3.IncludedGeometry, Interior=True)  # -> Planar, Plane
cull = CullPattern(List=[filtertype.IncludedGeometry, filtertype_2.IncludedGeometry, filtertype_5.IncludedGeometry], CullPattern=psrfclsd)
cull_2 = CullPattern(List=filtertype_3.IncludedGeometry, CullPattern=planar.Planar)
filter_9 = StreamFilter(
    Gate=geometrytype_validate_2,
    Stream0=cull,
    Stream1=cull_2,
    Stream2=[filtertype_5.IncludedGeometry, filtertype_3.IncludedGeometry],
    Stream3=[filtertype_4.IncludedGeometry, filtertype_3.IncludedGeometry, filtertype_5.IncludedGeometry, filtertype.IncludedGeometry, filtertype_2.IncludedGeometry],
    Stream4=freeze_gate_14)  # -> flatten(Stream)
modratt_2 = ModifyRhinoObjectAttributes(ReferencedObject=filter_9, Attributes=ef_att_2, Activate=presavegeometry_3)
lng_5 = ListLength(List=filter_9)
hasdata = DataExists(Data=lng_5)
bool_15 = Boolean(invert(hasdata))
filter_10 = StreamFilter(Gate=hasdata, Stream0=bool_15, Stream1=lng_5)
geometry_saved = RemoteSender(filter_10)

geometry_saved_2 = RemoteReceiver(geometry_saved)
hideshow_20 = HideShowElement(ElementToHideShow=label_5, Show=invert(geometry_saved_2), Collapse=True, Disable=False)
panel_68 = Panel(modratt_2)

py3_7 = Python3Script(get=run_detailed_energy_simulations_2)  # -> mpl_folder; same code as py3_2
nextfile = NextAvailableFilename(Format="Annual energy balance{000}.png", FolderPath=py3_7, Trigger=run_detailed_energy_simulations_2)
panel_69 = Panel(nextfile)

nextfile_2 = NextAvailableFilename(Format="Annual energy balance{000}.png", FolderPath=py3_5, Trigger=run_simple_energy_simulations_2)
panel_70 = Panel(nextfile_2)

nextfile_3 = NextAvailableFilename(Format="Annual energy balance{000}.png", FolderPath=py3_4, Trigger=run_daylight_simulations_2)
panel_71 = Panel(nextfile_3)

# ----
# Create window tooltip
number_slider_32 = Slider(0, range=0..100)
dom_3 = ConstructDomain(DomainStart=number_slider_32, DomainEnd=Slider(12, range=0..100))
dom_4 = ConstructDomain(DomainStart=Slider(0, range=0..100), DomainEnd=Slider(1, range=0..100))

# ----
# Detailed energy simulations UI
panel_72 = Panel("C:/Users/Isac/Desktop/Toivo_Chalmers/UI/matplotlib")
panel_73 = Panel("total load EUI: {0} (kWh/m2)")
visualize_detailed_energy_simulations_2 = RemoteReceiver(visualize_detailed_energy_simulations)
format_2 = Format(Format=panel_73, Culture=127, Data0=Slider(0, range=0..100))
nextfile_4 = NextAvailableFilename(Format="test_{000}.png", FolderPath=panel_72, Trigger=Toggle(True))
launchwin_5 = LaunchWindow(
    Show=visualize_detailed_energy_simulations_2,
    Name="Detailed energy simulations",
    Width=Slider(700, range=0..1000),
    Height=Slider(500, range=0..1000),
    ChildStatus=2,
    EnableHorizScroll=False)
py3_8 = Python3Script(x=nextfile_4)  # -> out, a
# ---------- py3_8: Python ----------
# requirements: matplotlib

import matplotlib.pyplot as plt
import random as rd

fig, ax = plt.subplots()

counts = [rd.randint(0, 100), rd.randint(0, 100),
          rd.randint(0, 100), rd.randint(0, 100)]
fruits = ['apple', 'blueberry', 'cherry', 'orange']
bar_labels = ['red', 'blue', '_red', 'orange']
bar_colors = ['tab:red', 'tab:blue', 'tab:red', 'tab:orange']

ax.bar(fruits, counts, label=bar_labels, color=bar_colors)

ax.set_ylabel('fruit supply')
ax.set_title('Fruit supply by kind and color')
ax.legend(title='Fruit color')

plt.savefig(x)
a = x

#plt.show()
# ---------- end py3_8 ----------
tb_12 = CreateTextBlock(Text=format_2, TextSize=16, Justification=0)
image = CreateImage(ImageSource=py3_8.a, ImageWidth=Slider(700, range=0..1000), ImageHeight=Slider(350, range=0..1000))
accent_colors_3 = ValueList({"Amber", "Blue", "Brown", "Cobalt", "Crimson", "Cyan", "Emerald", "Green", "Indigo", "Lime", "Magenta", "Mauve", "Olive", "Orange", "Pink", "Purple", "Red", "Sienna", "Steel", "Taupe", "Teal", "Violet", "Yellow"}, selected="Blue")
pt_9 = ConstructPoint(XCoordinate=Slider(24, range=0..1000), YCoordinate=Slider(258, range=0..1000), ZCoordinate=0)
entwine_79 = Entwine(Branch00=tb_12, Branch01=image, FlattenInputs=True)  # -> flatten(Result)
winprops_5 = SetWindowProperties(
    Window=launchwin_5,
    StartingLocation=pt_9,
    Theme=0,
    AccentColor=accent_colors_3,
    ShowTitleBar=True,
    BackgroundColor=RGB(255, 255, 255),
    ScaleFactor=1)
addelems_6 = AddElements(Window=launchwin_5, Elements=flatten(entwine_79), DoVLChecking=True)  # -> AddedElements, ElementNames

# ----
# Simple energy simulations UI
panel_74 = Panel("C:/Users/Isac/Desktop/Toivo_Chalmers/UI/matplotlib")
panel_75 = Panel("total load EUI: {0} (kWh/m2)")
visualize_simple_energy_simulations_2 = RemoteReceiver(visualize_simple_energy_simulations)
format_3 = Format(Format=panel_75, Culture=127, Data0=Slider(0, range=0..100))
nextfile_5 = NextAvailableFilename(Format="test_{000}.png", FolderPath=panel_74, Trigger=Toggle(True))
launchwin_6 = LaunchWindow(
    Show=visualize_simple_energy_simulations_2,
    Name="Simple energy simulations",
    Width=Slider(700, range=0..1000),
    Height=Slider(500, range=0..1000),
    ChildStatus=2,
    EnableHorizScroll=False)
py3_9 = Python3Script(x=nextfile_5)  # -> out, a; same code as py3_8
tb_13 = CreateTextBlock(Text=format_3, TextSize=16, Justification=0)
image_2 = CreateImage(ImageSource=py3_9.a, ImageWidth=Slider(700, range=0..1000), ImageHeight=Slider(350, range=0..1000))
accent_colors_4 = ValueList({"Amber", "Blue", "Brown", "Cobalt", "Crimson", "Cyan", "Emerald", "Green", "Indigo", "Lime", "Magenta", "Mauve", "Olive", "Orange", "Pink", "Purple", "Red", "Sienna", "Steel", "Taupe", "Teal", "Violet", "Yellow"}, selected="Blue")
pt_10 = ConstructPoint(XCoordinate=Slider(24, range=0..1000), YCoordinate=Slider(258, range=0..1000), ZCoordinate=0)
entwine_80 = Entwine(Branch00=tb_13, Branch01=image_2, FlattenInputs=True)  # -> flatten(Result)
addelems_7 = AddElements(Window=launchwin_6, Elements=flatten(entwine_80), DoVLChecking=True)  # -> AddedElements, ElementNames
winprops_6 = SetWindowProperties(
    Window=launchwin_6,
    StartingLocation=pt_10,
    Theme=0,
    AccentColor=accent_colors_4,
    ShowTitleBar=True,
    BackgroundColor=RGB(255, 255, 255),
    ScaleFactor=1)

# ----
# Daylight simulations UI
panel_76 = Panel("C:/Users/Isac/Desktop/Toivo_Chalmers/UI/matplotlib")
panel_77 = Panel("total load EUI: {0} (kWh/m2)")
visualize_daylight_simulations_2 = RemoteReceiver(visualize_daylight_simulations)
format_4 = Format(Format=panel_77, Culture=127, Data0=Slider(0, range=0..100))
nextfile_6 = NextAvailableFilename(Format="test_{000}.png", FolderPath=panel_76, Trigger=Toggle(True))
launchwin_7 = LaunchWindow(
    Show=visualize_daylight_simulations_2,
    Name="Daylight simulations",
    Width=Slider(700, range=0..1000),
    Height=Slider(500, range=0..1000),
    ChildStatus=2,
    EnableHorizScroll=False)
py3_10 = Python3Script(x=nextfile_6)  # -> out, a; same code as py3_8
tb_14 = CreateTextBlock(Text=format_4, TextSize=16, Justification=0)
image_3 = CreateImage(ImageSource=py3_10.a, ImageWidth=Slider(700, range=0..1000), ImageHeight=Slider(350, range=0..1000))
accent_colors_5 = ValueList({"Amber", "Blue", "Brown", "Cobalt", "Crimson", "Cyan", "Emerald", "Green", "Indigo", "Lime", "Magenta", "Mauve", "Olive", "Orange", "Pink", "Purple", "Red", "Sienna", "Steel", "Taupe", "Teal", "Violet", "Yellow"}, selected="Blue")
pt_11 = ConstructPoint(XCoordinate=Slider(24, range=0..1000), YCoordinate=Slider(258, range=0..1000), ZCoordinate=0)
entwine_81 = Entwine(Branch00=tb_14, Branch01=image_3, FlattenInputs=True)  # -> flatten(Result)
winprops_7 = SetWindowProperties(
    Window=launchwin_7,
    StartingLocation=pt_11,
    Theme=0,
    AccentColor=accent_colors_5,
    ShowTitleBar=True,
    BackgroundColor=RGB(255, 255, 255),
    ScaleFactor=1)
addelems_8 = AddElements(Window=launchwin_7, Elements=flatten(entwine_81), DoVLChecking=True)  # -> AddedElements, ElementNames

# ---- group: Building occupancy and systems
# Select window construction
subset_subface_window_index_2 = RemoteReceiver(subset_subface_window_index)
null_3 = NullObject()

# ----
# Create material
number_slider_33 = Slider(28, range=0..1000)
panel_78 = Panel("""Rough
Smooth""")
textbox_2 = CreateTextBox(Label="Name", DefaultText="New material", UpdateButton=invert(True), showLabel=True)
textbox_3 = CreateTextBox(DefaultText=Slider(0.036, range=0..2), UpdateButton=invert(True), showLabel=False)
label_30 = CreateLabel(LabelText="Conductivity [W/m-K]", LabelSize=12, Justification=0)
textbox_4 = CreateTextBox(DefaultText=Slider(200, range=0..1000), UpdateButton=invert(True), showLabel=False)
textbox_5 = CreateTextBox(DefaultText=number_slider_33, UpdateButton=invert(True), showLabel=False)
button_19 = CreateButton(ButtonName="Create material", ButtonStyle=0)
textbox_6 = CreateTextBox(DefaultText=Slider(1500, range=0..10000), UpdateButton=invert(True), showLabel=False)
label_31 = CreateLabel(LabelText="Roughness", LabelSize=12, Justification=0)
label_32 = CreateLabel(LabelText="Specific heat [J/kg-K]", LabelSize=12, Justification=0)
label_33 = CreateLabel(LabelText="Absorption", LabelSize=12, Justification=0)
pulldown_34 = CreatePulldownMenu(ListItems=panel_78, showLabel=False)
label_34 = CreateLabel(LabelText="Density [kg/m3]", LabelSize=12, Justification=0)
values_96 = ValueListener(Elements=textbox_2, SomeProperty=True)  # -> Values, Indices
values_97 = ValueListener(Elements=textbox_3, SomeProperty=True)  # -> Values, Indices
values_98 = ValueListener(Elements=button_19, SomeProperty=True)  # -> Values, Indices
values_99 = ValueListener(Elements=pulldown_34, SomeProperty=True)  # -> Values, Indices
values_100 = ValueListener(Elements=textbox_4, SomeProperty=True)  # -> Values, Indices
values_101 = ValueListener(Elements=textbox_5, SomeProperty=True)  # -> Values, Indices
values_102 = ValueListener(Elements=textbox_6, SomeProperty=True)  # -> Values, Indices
panel_79 = Panel(values_96.Values)
create_material_name = RemoteSender(values_96.Values)
create_material_conductivity = RemoteSender(values_97.Values)
freeze_gate_15 = StreamFreezeGate(Data=values_98.Values, PassingSwitch=invert(values_98.Values))
create_material_density = RemoteSender(values_101.Values)
create_material_sprecific_heat = RemoteSender(values_102.Values)
entwine_82 = Entwine(Branch00=label_30, Branch01=textbox_3, FlattenInputs=True)  # -> flatten(Result)
entwine_83 = Entwine(Branch00=label_33, Branch01=textbox_4, FlattenInputs=True)  # -> flatten(Result)
entwine_84 = Entwine(Branch00=label_31, Branch01=pulldown_34, FlattenInputs=True)  # -> flatten(Result)
entwine_85 = Entwine(Branch00=label_32, Branch01=textbox_6, FlattenInputs=True)  # -> flatten(Result)
entwine_86 = Entwine(Branch00=label_34, Branch01=textbox_5, FlattenInputs=True)  # -> flatten(Result)
bool_16 = Boolean(invert(freeze_gate_15))
stack_55 = CreateStack(UIElements=entwine_82, Horizontal=True)
stack_56 = CreateStack(UIElements=entwine_85, Horizontal=True)
stack_57 = CreateStack(UIElements=entwine_86, Horizontal=True)
tap_11 = TapBuffer(Reset=False, Incremental=True, Valve=bool_16, Hold=True)
dam_11 = DataDam(DataA=tap_11, BufferDelay=2500000, BufferMode=2)
equals_12 = Equality(FirstNumber=tap_11, SecondNumber=dam_11)  # -> Equality, Inequality
and_25 = GateAnd(A=equals_12.Inequality, B=create_material_modal_2)
event_11 = EventGate(Data=and_25)  # -> Data, IsNew
create_material = RemoteSender(event_11.Data)
entwine_87 = Entwine(Branch00=textbox_2, Branch01=stack_55, Branch02=stack_57, Branch03=stack_56, Branch04=button_19, FlattenInputs=True)  # -> flatten(Result)
adjustpos_88 = AdjustElementPositioning(ElementsToAdjust=button_19, Margin="0, 10, 0, 0", AbsolutePositioning=False, HorizontalAlignment=1, VerticalAlignment=2)
adjustpos_89 = AdjustElementPositioning(
    ElementsToAdjust=textbox_4,
    AbsolutePositioning=False,
    Width=Slider(50, range=0..300),
    HorizontalAlignment=0,
    VerticalAlignment=2)

# ----
# Roughness
stack_58 = CreateStack(UIElements=entwine_84, Horizontal=True)
data_24 = Data()

# ----
# Absorption
stack_59 = CreateStack(UIElements=entwine_83, Horizontal=True)
data_25 = Data()

adjustpos_90 = AdjustElementPositioning(ElementsToAdjust=textbox_2, AbsolutePositioning=False, Width=Slider(200, range=0..300), HorizontalAlignment=0)
adjustpos_91 = AdjustElementPositioning(
    ElementsToAdjust=label_33,
    AbsolutePositioning=False,
    Width=Slider(150, range=0..300),
    HorizontalAlignment=0,
    VerticalAlignment=2)
adjustpos_92 = AdjustElementPositioning(
    ElementsToAdjust=label_34,
    AbsolutePositioning=False,
    Width=Slider(150, range=0..300),
    HorizontalAlignment=0,
    VerticalAlignment=2)
adjustpos_93 = AdjustElementPositioning(
    ElementsToAdjust=textbox_5,
    AbsolutePositioning=False,
    Width=Slider(50, range=0..300),
    HorizontalAlignment=0,
    VerticalAlignment=2)
adjustpos_94 = AdjustElementPositioning(
    ElementsToAdjust=label_31,
    AbsolutePositioning=False,
    Width=Slider(150, range=0..300),
    HorizontalAlignment=0,
    VerticalAlignment=2)
adjustpos_95 = AdjustElementPositioning(
    ElementsToAdjust=label_30,
    AbsolutePositioning=False,
    Width=Slider(150, range=0..300),
    HorizontalAlignment=0,
    VerticalAlignment=2)
adjustpos_96 = AdjustElementPositioning(
    ElementsToAdjust=pulldown_34,
    AbsolutePositioning=False,
    Width=Slider(50, range=0..300),
    HorizontalAlignment=0,
    VerticalAlignment=2)
adjustpos_97 = AdjustElementPositioning(
    ElementsToAdjust=textbox_3,
    AbsolutePositioning=False,
    Width=Slider(50, range=0..300),
    HorizontalAlignment=0,
    VerticalAlignment=2)
adjustpos_98 = AdjustElementPositioning(
    ElementsToAdjust=label_32,
    AbsolutePositioning=False,
    Width=Slider(150, range=0..300),
    HorizontalAlignment=0,
    VerticalAlignment=2)
adjustpos_99 = AdjustElementPositioning(
    ElementsToAdjust=textbox_6,
    AbsolutePositioning=False,
    Width=Slider(50, range=0..300),
    HorizontalAlignment=0,
    VerticalAlignment=2)

# ----
# Create material window
create_material_modal_3 = RemoteReceiver(create_material_modal)
launchwin_8 = LaunchWindow(
    Show=create_material_modal_3,
    Name="Create material",
    Width=Slider(235, range=0..1000),
    Height=Slider(235, range=0..1000),
    ChildStatus=2,
    EnableHorizScroll=False)
accent_colors_6 = ValueList({"Amber", "Blue", "Brown", "Cobalt", "Crimson", "Cyan", "Emerald", "Green", "Indigo", "Lime", "Magenta", "Mauve", "Olive", "Orange", "Pink", "Purple", "Red", "Sienna", "Steel", "Taupe", "Teal", "Violet", "Yellow"}, selected="Blue")
pt_12 = ConstructPoint(XCoordinate=Slider(352, range=0..1000), YCoordinate=Slider(210, range=0..1000), ZCoordinate=0)
winprops_8 = SetWindowProperties(
    Window=launchwin_8,
    StartingLocation=pt_12,
    Theme=0,
    AccentColor=accent_colors_6,
    ShowTitleBar=True,
    BackgroundColor=RGB(255, 255, 255),
    ScaleFactor=1)
addelems_9 = AddElements(Window=launchwin_8, Elements=flatten(entwine_87), DoVLChecking=True)  # -> AddedElements, ElementNames

childwin_3 = MakeChildWindow(ParentWindow=heath_window_5, ChildWindow=launchwin_8)
material_elements = RemoteSender(addelems_9.AddedElements)

# ----
# Create material
create_material_sprecific_heat_2 = RemoteReceiver(create_material_sprecific_heat)
create_material_conductivity_2 = RemoteReceiver(create_material_conductivity)
create_material_density_2 = RemoteReceiver(create_material_density)
create_material_name_2 = RemoteReceiver(create_material_name)
opaquemat_2 = HBOpaqueMaterial(
    name=create_material_name_2,
    thickness="inf",
    conductivity=create_material_conductivity_2,
    density=create_material_density_2,
    spec_heat=create_material_sprecific_heat_2)  # -> out, mat; plug-in component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
create_material_2 = RemoteReceiver(create_material)
panel_80 = Panel(create_material_2)
create_material_error = RemoteSender(opaquemat_2.out)
freeze_gate_16 = StreamFreezeGate(Data=opaquemat_2.mat, PassingSwitch=create_material_2, Freeze=True)

# ----
# Created materials database
rec = DataRecorder(freeze_gate_16, DataLimit=-10, RecordData=True)
ipy2 = IronPython2Script(materials=rec)  # -> unique_materials; inputs materials: list
# ---------- ipy2: IronPython ----------
"""Grasshopper Script"""

unique_materials = []

for i in range(len(materials)):
    if materials[i] not in unique_materials:
        unique_materials.append(materials[i])
# ---------- end ipy2 ----------
clean = CleanTree(RemoveNulls=True, RemoveInvalid=True, RemoveEmpty=False, Tree=ipy2)
created_materials_database = RemoteSender(clean)

created_materials_database_2 = RemoteReceiver(created_materials_database)
decnstrmat = HBDeconstructMaterial(mat=created_materials_database_2)  # -> values, attr_names, r_val_si, r_val_ip; plug-in component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
item_5 = ListItem(List=decnstrmat.values, Index=0, Wrap=True)  # -> flatten(Item), flatten(Item1), flatten(Item2), flatten(Item3), flatten(Item4)
clean_2 = CleanTree(RemoveNulls=True, RemoveInvalid=True, RemoveEmpty=False, Tree=item_5.Item2)
clean_3 = CleanTree(RemoveNulls=True, RemoveInvalid=True, RemoveEmpty=False, Tree=item_5.Item4)
clean_4 = CleanTree(RemoveNulls=True, RemoveInvalid=True, RemoveEmpty=False, Tree=item_5.Item)
clean_5 = CleanTree(RemoveNulls=True, RemoveInvalid=True, RemoveEmpty=False, Tree=item_5.Item3)
lng_6 = ListLength(List=clean_4)
create_material_names = RemoteSender(clean_4)
roundd = RoundToDecimalPlace(NumberX=clean_2, DecimalPlace="1", RoundType=0)  # -> Rounded, Difference
roundd_2 = RoundToDecimalPlace(NumberX=clean_3, DecimalPlace="1", RoundType=0)  # -> Rounded, Difference
roundd_3 = RoundToDecimalPlace(NumberX=clean_5, DecimalPlace="1", RoundType=0)  # -> Rounded, Difference
bool_17 = Boolean(lng_6)
gate_15 = StreamGate(Stream="{0} (conductivity: {1}, density: {2}, specific heat: {3})", Gate=bool_17)  # -> Target0, Target1
format_5 = Format(Format=gate_15.Target1, Culture=127, Data0=clean_4, Data1=roundd.Rounded, Data2=roundd_3.Rounded, Data3=roundd_2.Rounded)
database_materials = RemoteSender(format_5)

create_material_error_2 = RemoteReceiver(create_material_error)
split_4 = TextSplit(Text=create_material_error_2, Separators=panel_48)
trim = TextTrim(Text=split_4, Start=True, End=True)
item_6 = ListItem(List=trim, Index=0, Wrap=True)  # -> Item, Item1
create_material_names_2 = RemoteReceiver(create_material_names)
create_material_name_3 = RemoteReceiver(create_material_name)
lng_7 = ListLength(List=split_4)
len = TextLength(Text=item_6.Item1)
larger = LargerThan(FirstNumber=lng_7, SecondNumber="1")  # -> LargerThan, OrEqualTo
subtraction_2 = Subtraction(A=len, B=Slider(11, range=0..20))
expression_39 = Expression(x=create_material_names_2, y=create_material_name_3, Expression="x=y")
fragment = TextFragment(Text=item_6.Item1, Start="0", Count=subtraction_2)
cull_3 = CullPattern(List=expression_39, CullPattern=expression_39)
filter_11 = StreamFilter(Gate=larger.LargerThan, Stream0=create_material_error_2, Stream1=fragment)
gate_16 = StreamGate(Stream="Material already exists", Gate=cull_3)  # -> Target0, Target1
entwine_88 = Entwine(Branch00=filter_11, Branch01=gate_16.Target1, FlattenInputs=True)  # -> flatten(Result)
item_7 = ListItem(List=entwine_88, Index=0, Wrap=True)
create_material_error_message = RemoteSender(item_7)

panel_81 = Panel(create_material_error_2)
panel_82 = Panel(created_materials_database_2)

create_material_error_message_2 = RemoteReceiver(create_material_error_message)
null_4 = NullItem(Item=create_material_error_message_2)  # -> NullFlags, InvalidFlags, Description
filter_12 = StreamFilter(Gate=null_4.NullFlags, Stream0=create_material_error_message_2, Stream1=" ")
filter_13 = StreamFilter(Gate=null_4.NullFlags, Stream0=Slider(500, range=0..1000), Stream1=Slider(1000000, range=0..1000000))
hideshow_21 = HideShowElement(ElementToHideShow=button_19, Show=True, Collapse=True, Disable=invert(null_4.NullFlags))
tooltip_10 = AttachTooltipToElement(ElementsToAttachTo=button_19, TooltipContent=filter_12, ShowDelay=filter_13, Duration=Slider(5000, range=0..10000))

created_materials_database_3 = RemoteReceiver(created_materials_database)
panel_83 = Panel(clean)

# ----
# Create window
number_slider_34 = Slider(0.5, range=0..12)
textbox_7 = CreateTextBox(Label="Name", DefaultText="New window", UpdateButton=invert(True), showLabel=True)
button_20 = CreateButton(ButtonName="Create window", ButtonStyle=0)
textbox_8 = CreateTextBox(DefaultText=number_slider_34, UpdateButton=invert(True), showLabel=False)
label_35 = CreateLabel(LabelText="U-factor [W/m2-K]", LabelSize=12, Justification=0)
textbox_9 = CreateTextBox(DefaultText=Slider(0.3, range=0..1), UpdateButton=invert(True), showLabel=False)
label_36 = CreateLabel(LabelText="SHGC", LabelSize=12, Justification=0)
values_103 = ValueListener(Elements=textbox_7, SomeProperty=True)  # -> Values, Indices
values_104 = ValueListener(Elements=button_20, SomeProperty=True)  # -> Values, Indices
values_105 = ValueListener(Elements=textbox_8, SomeProperty=True)  # -> Values, Indices
create_window_name = RemoteSender(values_103.Values)
values_106 = ValueListener(Elements=textbox_9, SomeProperty=True)  # -> Values, Indices
panel_84 = Panel(values_103.Values)
create_window_u_factor = RemoteSender(values_105.Values)
create_window_shgc = RemoteSender(values_106.Values)
entwine_89 = Entwine(Branch00=label_35, Branch01=textbox_8, FlattenInputs=True)  # -> flatten(Result)
entwine_90 = Entwine(Branch00=label_36, Branch01=textbox_9, FlattenInputs=True)  # -> flatten(Result)
stack_60 = CreateStack(UIElements=entwine_89, Horizontal=True)
stack_61 = CreateStack(UIElements=entwine_90, Horizontal=True)
create_window_modal_2 = RemoteReceiver(create_window_modal)
entwine_91 = Entwine(Branch00=textbox_7, Branch01=stack_60, Branch02=stack_61, Branch03=button_20, FlattenInputs=True)  # -> flatten(Result)
adjustpos_100 = AdjustElementPositioning(ElementsToAdjust=textbox_7, AbsolutePositioning=False, Width=Slider(200, range=0..300), HorizontalAlignment=0)
adjustpos_101 = AdjustElementPositioning(
    ElementsToAdjust=label_35,
    AbsolutePositioning=False,
    Width=Slider(150, range=0..300),
    HorizontalAlignment=0,
    VerticalAlignment=2)
adjustpos_102 = AdjustElementPositioning(
    ElementsToAdjust=textbox_8,
    AbsolutePositioning=False,
    Width=Slider(50, range=0..300),
    HorizontalAlignment=0,
    VerticalAlignment=2)
adjustpos_103 = AdjustElementPositioning(
    ElementsToAdjust=label_36,
    AbsolutePositioning=False,
    Width=Slider(150, range=0..300),
    HorizontalAlignment=0,
    VerticalAlignment=2)
adjustpos_104 = AdjustElementPositioning(
    ElementsToAdjust=textbox_9,
    AbsolutePositioning=False,
    Width=Slider(50, range=0..300),
    HorizontalAlignment=0,
    VerticalAlignment=2)
adjustpos_105 = AdjustElementPositioning(ElementsToAdjust=button_20, Margin="0, 10, 0, 0", AbsolutePositioning=False, HorizontalAlignment=1, VerticalAlignment=2)

freeze_gate_17 = StreamFreezeGate(Data=values_104.Values, PassingSwitch=invert(values_104.Values))
bool_18 = Boolean(invert(freeze_gate_17))
tap_12 = TapBuffer(Reset=False, Incremental=True, Valve=bool_18, Hold=True)

# ----
# Create window window
create_window_modal_3 = RemoteReceiver(create_window_modal)
launchwin_9 = LaunchWindow(
    Show=create_window_modal_3,
    Name="Create window",
    Width=Slider(235, range=0..1000),
    Height=Slider(200, range=0..1000),
    ChildStatus=2,
    EnableHorizScroll=False)
accent_colors_7 = ValueList({"Amber", "Blue", "Brown", "Cobalt", "Crimson", "Cyan", "Emerald", "Green", "Indigo", "Lime", "Magenta", "Mauve", "Olive", "Orange", "Pink", "Purple", "Red", "Sienna", "Steel", "Taupe", "Teal", "Violet", "Yellow"}, selected="Blue")
pt_13 = ConstructPoint(XCoordinate=Slider(352, range=0..1000), YCoordinate=Slider(210, range=0..1000), ZCoordinate=0)
winprops_9 = SetWindowProperties(
    Window=launchwin_9,
    StartingLocation=pt_13,
    Theme=0,
    AccentColor=accent_colors_7,
    ShowTitleBar=True,
    BackgroundColor=RGB(255, 255, 255),
    ScaleFactor=1)
addelems_10 = AddElements(Window=launchwin_9, Elements=flatten(entwine_91), DoVLChecking=True)  # -> AddedElements, ElementNames

childwin_4 = MakeChildWindow(ParentWindow=heath_window_4, ChildWindow=launchwin_9)
window_elements = RemoteSender(addelems_10.AddedElements)

create_window_name_2 = RemoteReceiver(create_window_name)
create_window_u_factor_2 = RemoteReceiver(create_window_u_factor)
create_window_shgc_2 = RemoteReceiver(create_window_shgc)
inc = Includes(Value=create_window_shgc_2, Domain=dom_4)  # -> Includes, Deviation
inc_2 = Includes(Value=create_window_u_factor_2, Domain=dom_3)  # -> Includes, Deviation
gate_17 = StreamGate(Stream="U-factor has to to between 0 and 12", Gate=inc_2.Includes)  # -> Target0, Target1
gate_18 = StreamGate(Stream="SHGC has to to between 0 and 1", Gate=inc.Includes)  # -> Target0, Target1

# ---- group: Building occupancy and systems / Select construction set
bldgvintages_2 = HBBuildingVintages({"ASHRAE 90.1 2019  |  IECC 2021": "2019", "ASHRAE 90.1 2016  |  IECC 2018": "2016", "ASHRAE 90.1 2013  |  IECC 2015": "2013", "ASHRAE 90.1 2010  |  IECC 2012": "2010", "ASHRAE 90.1 2007  |  IECC 2009": "2007", "ASHRAE 90.1 2004  |  IECC 2006": "2004", "1980-2004 (CBECS)": "1980_2004", "Pre-1980 (CBECS)": "pre_1980"}, selected="ASHRAE 90.1 2019  |  IECC 2021")
panel_85 = Panel("My construction")

# ----
# Create construction
number_slider_35 = Slider(0.25, range=0.01..1)
database_materials_2 = RemoteReceiver(database_materials)
database_materials_3 = RemoteReceiver(database_materials)
database_materials_4 = RemoteReceiver(database_materials)
database_materials_5 = RemoteReceiver(database_materials)
empty_2 = EmptyObjectToEmptyBranch()
database_materials_6 = RemoteReceiver(database_materials)
empty_3 = EmptyObjectToEmptyBranch()
empty_4 = EmptyObjectToEmptyBranch()
database_materials_7 = RemoteReceiver(database_materials)
empty_5 = EmptyObjectToEmptyBranch()
empty_6 = EmptyObjectToEmptyBranch()
empty_7 = EmptyObjectToEmptyBranch()
textbox_10 = CreateTextBox(Label="Name", DefaultText="New construction", UpdateButton=invert(True), showLabel=True)
button_21 = CreateButton(ButtonName="Add", ButtonStyle=0)
button_22 = CreateButton(ButtonName="Remove", ButtonStyle=0)
textbox_11 = CreateTextBox(Label="Thickness [m]", DefaultText=number_slider_35, UpdateButton=invert(True), showLabel=True)
pulldown_35 = CreatePulldownMenu(Label="Material", ListItems=empty_2, showLabel=True)
label_37 = CreateLabel(LabelText="Layer 1", LabelSize=12, Justification=0)
textbox_12 = CreateTextBox(Label="Thickness [m]", DefaultText=Slider(0.25, range=0.01..1), UpdateButton=invert(True), showLabel=True)
pulldown_36 = CreatePulldownMenu(Label="Material", ListItems=empty_3, showLabel=True)
label_38 = CreateLabel(LabelText="Layer 2", LabelSize=12, Justification=0)
textbox_13 = CreateTextBox(Label="Thickness [m]", DefaultText=Slider(0.25, range=0.01..1), UpdateButton=invert(True), showLabel=True)
pulldown_37 = CreatePulldownMenu(Label="Material", ListItems=empty_4, showLabel=True)
label_39 = CreateLabel(LabelText="Layer 3", LabelSize=12, Justification=0)
textbox_14 = CreateTextBox(Label="Thickness [m]", DefaultText=Slider(0.25, range=0.01..1), UpdateButton=invert(True), showLabel=True)
pulldown_38 = CreatePulldownMenu(Label="Material", ListItems=empty_5, showLabel=True)
label_40 = CreateLabel(LabelText="Layer 4", LabelSize=12, Justification=0)
textbox_15 = CreateTextBox(Label="Thickness [m]", DefaultText=Slider(0.25, range=0.01..1), UpdateButton=invert(True), showLabel=True)
pulldown_39 = CreatePulldownMenu(Label="Material", ListItems=empty_6, showLabel=True)
label_41 = CreateLabel(LabelText="Layer 5", LabelSize=12, Justification=0)
textbox_16 = CreateTextBox(Label="Thickness [m]", DefaultText=Slider(0.25, range=0.01..1), UpdateButton=invert(True), showLabel=True)
pulldown_40 = CreatePulldownMenu(Label="Material", ListItems=empty_7, showLabel=True)
label_42 = CreateLabel(LabelText="Layer 6", LabelSize=12, Justification=0)
button_23 = CreateButton(ButtonName="Create construction", ButtonStyle=0)
setlist_2 = SetListContents(ListToModify=pulldown_35, NewListContents=database_materials_2)
setlist_3 = SetListContents(ListToModify=pulldown_36, NewListContents=database_materials_3)
values_107 = ValueListener(Elements=pulldown_35, SomeProperty=True)  # -> Values, Indices
values_108 = ValueListener(Elements=button_21, SomeProperty=True)  # -> Values, Indices
setlist_4 = SetListContents(ListToModify=pulldown_37, NewListContents=database_materials_4)
values_109 = ValueListener(Elements=button_22, SomeProperty=True)  # -> Values, Indices
values_110 = ValueListener(Elements=textbox_11, SomeProperty=True)  # -> Values, Indices
values_111 = ValueListener(Elements=textbox_10, SomeProperty=True)  # -> Values, Indices
values_112 = ValueListener(Elements=pulldown_36, SomeProperty=True)  # -> Values, Indices
setlist_5 = SetListContents(ListToModify=pulldown_38, NewListContents=database_materials_5)
values_113 = ValueListener(Elements=textbox_12, SomeProperty=True)  # -> Values, Indices
values_114 = ValueListener(Elements=pulldown_37, SomeProperty=True)  # -> Values, Indices
setlist_6 = SetListContents(ListToModify=pulldown_39, NewListContents=database_materials_6)
values_115 = ValueListener(Elements=textbox_13, SomeProperty=True)  # -> Values, Indices
values_116 = ValueListener(Elements=pulldown_38, SomeProperty=True)  # -> Values, Indices
values_117 = ValueListener(Elements=textbox_14, SomeProperty=True)  # -> Values, Indices
values_118 = ValueListener(Elements=pulldown_39, SomeProperty=True)  # -> Values, Indices
values_119 = ValueListener(Elements=textbox_15, SomeProperty=True)  # -> Values, Indices
setlist_7 = SetListContents(ListToModify=pulldown_40, NewListContents=database_materials_7)
values_120 = ValueListener(Elements=pulldown_40, SomeProperty=True)  # -> Values, Indices
values_121 = ValueListener(Elements=button_23, SomeProperty=True)  # -> Values, Indices
values_122 = ValueListener(Elements=textbox_16, SomeProperty=True)  # -> Values, Indices
layer1_material = RemoteSender(values_107.Indices)
layer1_thickness = RemoteSender(values_110.Values)
add_layer = RemoteSender(values_108.Values)
remove_layer = RemoteSender(values_109.Values)
entwine_92 = Entwine(Branch00=pulldown_36, Branch01=textbox_12, FlattenInputs=True)  # -> flatten(Result)
layer2_thickness = RemoteSender(values_113.Values)
layer2_material = RemoteSender(values_112.Indices)
entwine_93 = Entwine(Branch00=pulldown_35, Branch01=textbox_11, FlattenInputs=True)  # -> flatten(Result)
panel_86 = Panel(values_111.Values)
layer3_material = RemoteSender(values_114.Indices)
create_construction_name = RemoteSender(values_111.Values)
entwine_94 = Entwine(Branch00=pulldown_37, Branch01=textbox_13, FlattenInputs=True)  # -> flatten(Result)
layer3_thickness = RemoteSender(values_115.Values)
layer4_material = RemoteSender(values_116.Indices)
entwine_95 = Entwine(Branch00=pulldown_38, Branch01=textbox_14, FlattenInputs=True)  # -> flatten(Result)
layer4_thickness = RemoteSender(values_117.Values)
layer5_material = RemoteSender(values_118.Indices)
entwine_96 = Entwine(Branch00=pulldown_39, Branch01=textbox_15, FlattenInputs=True)  # -> flatten(Result)
layer5_thickness = RemoteSender(values_119.Values)
layer6_material = RemoteSender(values_120.Indices)
layer6_thickness = RemoteSender(values_122.Values)
create_construction = RemoteSender(values_121.Values)
entwine_97 = Entwine(Branch00=pulldown_40, Branch01=textbox_16, FlattenInputs=True)  # -> flatten(Result)
stack_62 = CreateStack(UIElements=entwine_93, Horizontal=True)
stack_63 = CreateStack(UIElements=entwine_92, Horizontal=True)
stack_64 = CreateStack(UIElements=entwine_94, Horizontal=True)
stack_65 = CreateStack(UIElements=entwine_95, Horizontal=True)
stack_66 = CreateStack(UIElements=entwine_96, Horizontal=True)
stack_67 = CreateStack(UIElements=entwine_97, Horizontal=True)
entwine_98 = Entwine(Branch00=label_37, Branch01=stack_62, FlattenInputs=True)  # -> flatten(Result)
entwine_99 = Entwine(Branch00=textbox_10, Branch01=button_21, Branch02=button_22, FlattenInputs=True)  # -> flatten(Result)
entwine_100 = Entwine(Branch00=label_38, Branch01=stack_63, FlattenInputs=True)  # -> flatten(Result)
adjustpos_106 = AdjustElementPositioning(ElementsToAdjust=textbox_10, AbsolutePositioning=False, Width=Slider(190, range=0..300), HorizontalAlignment=0)
entwine_101 = Entwine(Branch00=label_39, Branch01=stack_64, FlattenInputs=True)  # -> flatten(Result)
entwine_102 = Entwine(Branch00=label_41, Branch01=stack_66, FlattenInputs=True)  # -> flatten(Result)
entwine_103 = Entwine(Branch00=label_40, Branch01=stack_65, FlattenInputs=True)  # -> flatten(Result)
entwine_104 = Entwine(Branch00=label_42, Branch01=stack_67, FlattenInputs=True)  # -> flatten(Result)
stack_68 = CreateStack(UIElements=entwine_99, Horizontal=True)
adjustpos_107 = AdjustElementPositioning(
    ElementsToAdjust=pulldown_35,
    AbsolutePositioning=False,
    Width=Slider(190, range=0..300),
    HorizontalAlignment=0,
    VerticalAlignment=2)
adjustpos_108 = AdjustElementPositioning(
    ElementsToAdjust=textbox_11,
    Margin="0, 5, 0, 0",
    AbsolutePositioning=False,
    Width=Slider(120, range=0..300),
    HorizontalAlignment=0,
    VerticalAlignment=2)
adjustpos_109 = AdjustElementPositioning(
    ElementsToAdjust=pulldown_36,
    AbsolutePositioning=False,
    Width=Slider(190, range=0..300),
    HorizontalAlignment=0,
    VerticalAlignment=2)
adjustpos_110 = AdjustElementPositioning(
    ElementsToAdjust=textbox_12,
    Margin="0, 5, 0, 0",
    AbsolutePositioning=False,
    Width=Slider(120, range=0..300),
    HorizontalAlignment=0,
    VerticalAlignment=2)
adjustpos_111 = AdjustElementPositioning(
    ElementsToAdjust=pulldown_37,
    AbsolutePositioning=False,
    Width=Slider(190, range=0..300),
    HorizontalAlignment=0,
    VerticalAlignment=2)
adjustpos_112 = AdjustElementPositioning(
    ElementsToAdjust=textbox_13,
    Margin="0, 5, 0, 0",
    AbsolutePositioning=False,
    Width=Slider(120, range=0..300),
    HorizontalAlignment=0,
    VerticalAlignment=2)
adjustpos_113 = AdjustElementPositioning(
    ElementsToAdjust=pulldown_38,
    AbsolutePositioning=False,
    Width=Slider(190, range=0..300),
    HorizontalAlignment=0,
    VerticalAlignment=2)
adjustpos_114 = AdjustElementPositioning(
    ElementsToAdjust=textbox_14,
    Margin="0, 5, 0, 0",
    AbsolutePositioning=False,
    Width=Slider(120, range=0..300),
    HorizontalAlignment=0,
    VerticalAlignment=2)
adjustpos_115 = AdjustElementPositioning(
    ElementsToAdjust=pulldown_39,
    AbsolutePositioning=False,
    Width=Slider(190, range=0..300),
    HorizontalAlignment=0,
    VerticalAlignment=2)
adjustpos_116 = AdjustElementPositioning(
    ElementsToAdjust=textbox_15,
    Margin="0, 5, 0, 0",
    AbsolutePositioning=False,
    Width=Slider(120, range=0..300),
    HorizontalAlignment=0,
    VerticalAlignment=2)
adjustpos_117 = AdjustElementPositioning(
    ElementsToAdjust=pulldown_40,
    AbsolutePositioning=False,
    Width=Slider(190, range=0..300),
    HorizontalAlignment=0,
    VerticalAlignment=2)
adjustpos_118 = AdjustElementPositioning(
    ElementsToAdjust=textbox_16,
    Margin="0, 5, 0, 0",
    AbsolutePositioning=False,
    Width=Slider(120, range=0..300),
    HorizontalAlignment=0,
    VerticalAlignment=2)
adjustpos_119 = AdjustElementPositioning(ElementsToAdjust=button_23, Margin="0, 10, 0, 0", AbsolutePositioning=False, HorizontalAlignment=1, VerticalAlignment=2)

remove_layer_2 = RemoteReceiver(remove_layer)
add_layer_2 = RemoteReceiver(add_layer)
filter_14 = StreamFilter(Gate=add_layer_2, Stream1=number_slider_27)
filter_15 = StreamFilter(Gate=remove_layer_2, Stream1=neg)
rec_2 = DataRecorder([filter_14, filter_15], DataLimit=-10, RecordData=True)
ma = MassAddition(Input=[Slider(1, range=0..1), rec_2])  # -> Result, PartialResults
subtraction_3 = Subtraction(A=Slider(6, range=0..10), B=ma.Result)
repeat_3 = RepeatData(Data="True", Length=ma.Result)
repeat_4 = RepeatData(Data="False", Length=subtraction_3)
entwine_105 = Entwine(Branch00=repeat_3, Branch01=repeat_4, FlattenInputs=True)  # -> flatten(Result)
bang = ExplodeTree(Data=simplify(graft(entwine_105)))  # -> Branch0, Branch1, Branch2, Branch3, Branch4, Branch5
layer2 = RemoteSender(bang.Branch1)
layer3 = RemoteSender(bang.Branch2)
layer4 = RemoteSender(bang.Branch3)
layer6 = RemoteSender(bang.Branch5)
layer1 = RemoteSender(bang.Branch0)
layer5 = RemoteSender(bang.Branch4)

active_layers = RemoteSender(entwine_105)
entwine_106 = Entwine(
    Branch00=stack_68,
    Branch01=entwine_98,
    Branch02=entwine_100,
    Branch03=entwine_101,
    Branch04=entwine_103,
    Branch05=entwine_102,
    Branch06=entwine_104,
    Branch07=button_23,
    FlattenInputs=True)  # -> flatten(Result)

# ----
# Create construction window
create_construction_window_2 = RemoteReceiver(create_construction_window)
launchwin_10 = LaunchWindow(
    Show=create_construction_window_2,
    Name="Create construction",
    Width=Slider(345, range=0..1000),
    Height=Slider(540, range=0..1000),
    ChildStatus=2,
    EnableHorizScroll=False)
accent_colors_8 = ValueList({"Amber", "Blue", "Brown", "Cobalt", "Crimson", "Cyan", "Emerald", "Green", "Indigo", "Lime", "Magenta", "Mauve", "Olive", "Orange", "Pink", "Purple", "Red", "Sienna", "Steel", "Taupe", "Teal", "Violet", "Yellow"}, selected="Blue")
pt_14 = ConstructPoint(XCoordinate=Slider(352, range=0..1000), YCoordinate=Slider(210, range=0..1000), ZCoordinate=0)
winprops_10 = SetWindowProperties(
    Window=launchwin_10,
    StartingLocation=pt_14,
    Theme=0,
    AccentColor=accent_colors_8,
    ShowTitleBar=True,
    BackgroundColor=RGB(255, 255, 255),
    ScaleFactor=1)
addelems_11 = AddElements(Window=launchwin_10, Elements=flatten(entwine_106), DoVLChecking=True)  # -> AddedElements, ElementNames

childwin_5 = MakeChildWindow(ParentWindow=heath_window_6, ChildWindow=launchwin_10)
construction_elements = RemoteSender(addelems_11.AddedElements)

create_construction_name_2 = RemoteReceiver(create_construction_name)

# ----
# Select exterior wall construction
subset_exterior_wall_2 = RemoteReceiver(subset_exterior_wall)
null_5 = NullObject()

# ---- group: Building occupancy and systems
# Define construction
# # Define program and construction
# To be added...
# 
# ## Instructions
# To be added...
# 
# ## Inputs
# - ...
# 
# ## Outputs
# - ...
# 
# ## Interpretation
# To be added...
base_climate_2 = RemoteReceiver(base_climate)
base_type_2 = RemoteReceiver(base_type)

# ---- group: Building occupancy and systems / Select construction set (continued)
constrsetclimate_2 = HBConstructionSetByClimate(climate_zone=base_climate_2, vintage=bldgvintages_2, constr_type=base_type_2)  # -> constr_set; plug-in component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
panel_87 = Panel(constrsetclimate_2)

# ----
dam_12 = DataDam(DataA=tap_12, BufferDelay=2500000, BufferMode=2)

equals_13 = Equality(FirstNumber=tap_12, SecondNumber=dam_12)  # -> Equality, Inequality

layer1_2 = RemoteReceiver(layer1)
layer2_2 = RemoteReceiver(layer2)
layer3_2 = RemoteReceiver(layer3)
layer4_2 = RemoteReceiver(layer4)
layer6_2 = RemoteReceiver(layer6)
layer5_2 = RemoteReceiver(layer5)
hideshow_22 = HideShowElement(ElementToHideShow=entwine_98, Show=layer1_2, Collapse=True, Disable=False)
hideshow_23 = HideShowElement(ElementToHideShow=entwine_100, Show=layer2_2, Collapse=True, Disable=False)
hideshow_24 = HideShowElement(ElementToHideShow=entwine_101, Show=layer3_2, Collapse=True, Disable=False)
hideshow_25 = HideShowElement(ElementToHideShow=entwine_103, Show=layer4_2, Collapse=True, Disable=False)
hideshow_26 = HideShowElement(ElementToHideShow=entwine_102, Show=layer5_2, Collapse=True, Disable=False)
hideshow_27 = HideShowElement(ElementToHideShow=entwine_104, Show=layer6_2, Collapse=True, Disable=False)

and_26 = GateAnd(A=equals_13.Inequality, B=create_window_modal_2)
event_12 = EventGate(Data=and_26)  # -> Data, IsNew
create_window = RemoteSender(event_12.Data)

# ----
# Create window
create_window_u_factor_3 = RemoteReceiver(create_window_u_factor)
create_window_name_3 = RemoteReceiver(create_window_name)
create_window_shgc_3 = RemoteReceiver(create_window_shgc)
create_window_2 = RemoteReceiver(create_window)
windowmat = HBWindowMaterial(name=create_window_name_3, u_factor=create_window_u_factor_3, shgc=create_window_shgc_3)  # -> out, mat; plug-in component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
panel_88 = Panel(create_window_2)
freeze_gate_18 = StreamFreezeGate(Data=windowmat.mat, PassingSwitch=create_window_2, Freeze=True)
create_window_error = RemoteSender(windowmat.out)

panel_89 = Panel(freeze_gate_18)

# ----
# Created windows database
rec_3 = DataRecorder(freeze_gate_18, DataLimit=-10, RecordData=True)
ipy2_2 = IronPython2Script(materials=rec_3)  # -> unique_materials; inputs materials: list; same code as ipy2
clean_6 = CleanTree(RemoveNulls=True, RemoveInvalid=True, RemoveEmpty=False, Tree=ipy2_2)
created_windows_database = RemoteSender(clean_6)

created_windows_database_2 = RemoteReceiver(created_windows_database)
decnstrmat_2 = HBDeconstructMaterial(mat=created_windows_database_2)  # -> values, attr_names, r_val_si, r_val_ip; plug-in component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
item_8 = ListItem(List=decnstrmat_2.values, Index=Slider(1, range=1..2), Wrap=True)
item_9 = ListItem(List=decnstrmat_2.values, Index=number_slider_4, Wrap=True)
entwine_107 = Entwine(Branch00=generic_u_value, Branch01=item_8, FlattenInputs=True)  # -> flatten(Result)
entwine_108 = Entwine(Branch00=generic_shgc, Branch01=item_9, FlattenInputs=True)  # -> flatten(Result)
item_10 = ListItem(List=decnstrmat_2.values, Index=0, Wrap=True)  # -> flatten(Item)
clean_7 = CleanTree(RemoveNulls=True, RemoveInvalid=True, RemoveEmpty=False, Tree=item_10)
clean_8 = CleanTree(RemoveNulls=True, RemoveInvalid=True, RemoveEmpty=False, Tree=entwine_108)
clean_9 = CleanTree(RemoveNulls=True, RemoveInvalid=True, RemoveEmpty=False, Tree=entwine_107)
entwine_109 = Entwine(Branch00="Generic", Branch01=clean_7, FlattenInputs=True)  # -> flatten(Result)
roundd_4 = RoundToDecimalPlace(NumberX=clean_8, DecimalPlace="1", RoundType=0)  # -> Rounded, Difference
roundd_5 = RoundToDecimalPlace(NumberX=clean_9, DecimalPlace="1", RoundType=0)  # -> Rounded, Difference
format_6 = Format(Format="{0} (U-value: {1}, SHGC: {2})", Culture=127, Data0=entwine_109, Data1=roundd_5.Rounded, Data2=roundd_4.Rounded)
create_window_names = RemoteSender(entwine_109)
panel_90 = Panel(format_6)

setlist_8 = SetListContents(ListToModify=pulldown_28, NewListContents=format_6)

create_window_names_2 = RemoteReceiver(create_window_names)
create_window_error_2 = RemoteReceiver(create_window_error)
expression_40 = Expression(x=create_window_names_2, y=create_window_name_2, Expression="x=y")
len_2 = TextLength(Text=create_window_error_2)
cull_4 = CullPattern(List=expression_40, CullPattern=expression_40)
bool_19 = Boolean(len_2)
gate_19 = StreamGate(Stream="Window name contains no valid characters", Gate=bool_19)  # -> Target0, Target1
gate_20 = StreamGate(Stream="Window already exists", Gate=cull_4)  # -> Target0, Target1
entwine_110 = Entwine(
    Branch00=gate_17.Target0,
    Branch01=gate_18.Target0,
    Branch02=gate_19.Target1,
    Branch03=gate_20.Target1,
    FlattenInputs=True)  # -> flatten(Result)
item_11 = ListItem(List=entwine_110, Index=0, Wrap=True)
create_window_error_message = RemoteSender(item_11)

# ---- group: Building occupancy and systems (continued)
created_windows_database_3 = RemoteReceiver(created_windows_database)
entwine_111 = Entwine(Branch00="Generic", Branch01=created_windows_database_3, FlattenInputs=True)  # -> flatten(Result)
item_12 = ListItem(List=entwine_111, Index=subset_subface_window_index_2, Wrap=True)
expression_41 = Expression(x="Generic", y=item_12, Expression="x=y")
filter_16 = StreamFilter(Gate=expression_41, Stream0=item_12, Stream1=null_3)
windowconstr = HBWindowConstruction(materials=filter_16)  # -> constr; plug-in component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
cluster_3 = Cluster_2(window_construction=windowconstr, gwp_a1_a3="2.5", gwp_a4="0.042", density_kg_m2="38.2")
subfacesubset_2 = HBSubfaceSubset(window=cluster_3)  # -> subface_set; plug-in component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

# ----
create_window_error_message_2 = RemoteReceiver(create_window_error_message)
null_6 = NullItem(Item=create_window_error_message_2)  # -> NullFlags, InvalidFlags, Description
filter_17 = StreamFilter(Gate=null_6.NullFlags, Stream0=create_window_error_message_2, Stream1=" ")
filter_18 = StreamFilter(Gate=null_6.NullFlags, Stream0=Slider(500, range=0..1000), Stream1=Slider(1000000, range=0..1000000))
hideshow_28 = HideShowElement(ElementToHideShow=button_20, Show=True, Collapse=True, Disable=invert(null_6.NullFlags))
tooltip_11 = AttachTooltipToElement(ElementsToAttachTo=button_20, TooltipContent=filter_17, ShowDelay=filter_18, Duration=2000)

panel_91 = Panel(clean_6)

# ----
# Save/restore states
heath_flying_4 = RemoteReceiver(heath_flying)
py3_11 = Python3Script(get=heath_flying_4)  # -> mpl_folder; same code as py3_2
save_state_2 = RemoteReceiver(save_state)
load_state_file_2 = RemoteReceiver(load_state_file)
py3_12 = Python3Script(trigger=save_state_2, name="state", folder=py3_11)  # -> full_path, file_name
# ---------- py3_12: Python ----------
import os
if trigger:
    indentation = 0
    while indentation < 100:
        path = folder + '\\' + name + ' ' + str(indentation) + '.txt'
        print(os.path.exists(path))
        if not os.path.exists(path):
            break
        indentation += 1
    file_name = name + ' ' + str(indentation)
    full_path = path
# ---------- end py3_12 ----------
split_5 = TextSplit(Text=load_state_file_2, Separators="\")
item_13 = ListItem(List=split_5, Index=0, Wrap=True)  # -> Item1, Item
all_states = Data(flatten([pulldown_6, pulldown_7, checkbox, pulldown_9, pulldown_10, slider_5, slider_6, slider_7, pulldown_4, pulldown_5, filepicker, pulldown_28, pulldown_18, textbox, slider_9, slider_10, toggle_4, slider_8, checkbox_10, checkbox_14, checkbox_13, checkbox_12, checkbox_11, checkbox_9, checkbox_7, checkbox_8, pulldown_11, checkbox_2, pulldown_12, checkbox_3, pulldown_13, checkbox_4, pulldown_14, checkbox_5, pulldown_15, checkbox_6, pulldown_3, slider_4, slider_3, pulldown_2, slider_2, slider, pulldown, textbox_10, pulldown_35, textbox_11, pulldown_36, textbox_12, pulldown_37, textbox_13, pulldown_38, textbox_14, pulldown_39, textbox_15, pulldown_40, textbox_16, textbox_2, textbox_3, textbox_5, textbox_6, textbox_7, textbox_8, textbox_9]))
writetxt = WriteToTextFile(Run=save_state_2, TextToWrite=py3_12.file_name, FilePath=py3_12.full_path, Append=False, NewOnly=False)
split_6 = TextSplit(Text=item_13.Item1, Separators=".")
load_state_2 = RemoteReceiver(load_state)
item_14 = ListItem(List=split_6, Index=0, Wrap=True)
panel_92 = Panel(item_14)

savestates = SaveElementStates(Elements=all_states, SaveState=writetxt, StateName=py3_12.file_name, ClearSavedStates=Button())  # -> SavedStates, SavedStateNames

restore = RestoreElementStates(Restore=load_state_2, SavedStates=savestates.SavedStates, StateNameToRestore=item_14)
panel_93 = Panel(savestates.SavedStateNames)

# ---- group: Prepare for analysis
# Assemble Honeybee model
# # Assemble Honeybee model
# This cluster takes input geometry and geometric information and generates a valid Honeybee model which can be used in the following analysis steps.
# 
# ## Instructions
# Enter the relevant inputs to generate the Honeybee model. Windows can either be created using an input geometry or through auto-generation using a window-to-wall ratio.
# 
# ### Room geometry
# Each 3D Brep entered represents one room or thermal zone in the building with no air exchange between them. The Breps should be closed and 3D to generate valid rooms. The room geometries should represent the inner boundary of the external walls
# 
# ### Adjacent geometry
# Geometry of adjacent buildings represented by a surface where they contact the room geometry. Adiabatic boundary condition will be assumed at the contact surface.
# 
# ### Windows/apertures
# Windows can either be defined through a list of 2D surfaces which intersect with the room 3D geometries, or be auto-generated through the list of numeric outputs.
# 
# ### Wall/roof thicknesses
# Wall and roof thicknesses are supplied to generate a shading geometry representing the external surface thickness
# 
# ### Louvers
# If all related inputs are entered, shading louvers will be generated on each window according to the entered parameters.
# 
# ### Different directions
# All the above inputs will be the same for all rooms, however they can be optionally entered as a list which represents different values for different cardinal directions, in the order (N, E, S, W).
# 
# ## Inputs
# - `Model name` - text string representing the name of the analysis model
# - `Room geometry` - list of 3D closed Brep geometries representing each room/zone in the model
# - `Construction set` - text string representing the construction to be used for the rooms, can be retrieved using the HB Construction Set by Climate component
# - `Program` - Honeybee Program or list of which are applied to the rooms in the model. Can be defined using the HB Search Programs component
# - `Context geometry` - list of surrounding Brep geometries which shades the analysed Rooms
# - `Windows` - list of 2D Brep geometries which represent the openings in the building envelope. If not supplied, windows are instead generated through definition of window-to-wall ratios as defined below
# - `Skylights` - list of 2D Brep geometries which represent the openings in the building roof
# - `Window-to-wall ratio` - number representing the window-to-wall ratio on each exterior surface Used if no window geometries are supplied.
# - `Subdivide generated windows` - set to True if the window surface area should be divided into multiple windows on each exterior surface
# - `Window height` - number representing the target height of the auto-generated windows
# - `Sill height` - number representing how high the lower edge of the auto-generated windows should be from the room floor
# - `Horizontal separation` - number representing how far separated the auto-generated windows should be horizontally
# - `Vertical separation` - number representing if auto-generated windows should be split vertically and if so, what distance
# - `Wall thickness` - number representing the thickness of the exterior walls, used to generate shading geometry for windows
# - `Roof thickness` - number representing the thickness of the roof, used to generate shading geometry for skylights
# - `Louver depth` - number optionally representing the depth of louvers
# - `Number of louvers` - number optionally representing the amount of louvers on each window
# - `Distance between louvers ` - number optionally representing the distance between louvers on each window
# - `Louver angle` - number optionally representing if louvers should be tilted
# - `Vertical/horizontal louvers` - boolean, set to True if louvers should be vertical
# 
# ## Outputs
# - `Honeybee model` - valid Honeybee model for further analysis
# 
# ## Interpretation
# To be added...
savegeometry_7 = RemoteReceiver(savegeometry)
create_model_2 = RemoteReceiver(create_model)
savegeometry_8 = RemoteReceiver(savegeometry)
savegeometry_9 = RemoteReceiver(savegeometry)
create_model_3 = RemoteReceiver(create_model)
savegeometry_10 = RemoteReceiver(savegeometry)
create_model_4 = RemoteReceiver(create_model)
create_model_5 = RemoteReceiver(create_model)
distance_between_louvers_2 = RemoteReceiver(distance_between_louvers)
number_of_louvers_5 = RemoteReceiver(number_of_louvers)
louver_angle_2 = RemoteReceiver(louver_angle)
louver_depth_2 = RemoteReceiver(louver_depth)
or_17 = GateOr(A=savegeometry_7, B=create_model_2, C=Toggle(True))
or_18 = GateOr(A=savegeometry_8, B=create_model_3, C=Toggle(True))
or_19 = GateOr(A=savegeometry_9, B=create_model_4, C=Toggle(True))
or_20 = GateOr(A=savegeometry_10, B=create_model_5, C=Toggle(True))
bool_20 = Boolean(number_of_louvers_5)
gate_21 = StreamGate(Stream="Heath geometry type", Gate=or_17)  # -> Target0, Target1
gate_22 = StreamGate(Stream="Heath geometry type", Gate=or_18)  # -> Target0, Target1
gate_23 = StreamGate(Stream="Heath geometry type", Gate=or_19)  # -> Target0, Target1
gate_24 = StreamGate(Stream="Heath geometry type", Gate=or_20)  # -> Target0, Target1
savegeometry_11 = RemoteReceiver(savegeometry)
create_model_6 = RemoteReceiver(create_model)
filter_19 = StreamFilter(Gate=bool_20, Stream0="0", Stream1=louver_angle_2)
filter_20 = StreamFilter(Gate=bool_20, Stream0="0", Stream1=distance_between_louvers_2)
filter_21 = StreamFilter(Gate=bool_20, Stream0="0", Stream1=louver_depth_2)
number_slider_36 = Slider(0.3, range=0..1)
refkv_5 = ReferenceByKeyValue(Key=gate_21.Target1, Val="Room", lightweight=False)
refkv_6 = ReferenceByKeyValue(Key=gate_22.Target1, Val="Adjacent", lightweight=False)
refkv_7 = ReferenceByKeyValue(Key=gate_23.Target1, Val="Context", lightweight=False, DisableAutoUpdate=True)
refkv_8 = ReferenceByKeyValue(Key=gate_24.Target1, Val="Window", lightweight=False)
model_name_2 = RemoteReceiver(model_name)
generate_wwr_2 = RemoteReceiver(generate_wwr)
roof_thickness_2 = RemoteReceiver(roof_thickness)
wall_thickness_2 = RemoteReceiver(wall_thickness)
toggle_5 = BooleanToggle(True)
data_26 = Data(programtype)
or_21 = GateOr(B=create_model_6)
adjacent = Geometry(refkv_6)
room = Geometry(refkv_5)
windows = Geometry(refkv_8)
context = Geometry(refkv_7)
create_model_7 = RemoteReceiver(create_model)
panel_94 = Panel(create_model_7)
show_honeybee_windows_3 = RemoteReceiver(show_honeybee_windows)
show_honeybee_context_3 = RemoteReceiver(show_honeybee_context)
show_honeybee_ground_3 = RemoteReceiver(show_honeybee_ground)
show_honeybee_doors_3 = RemoteReceiver(show_honeybee_doors)
show_honeybee_floors_3 = RemoteReceiver(show_honeybee_floors)
show_honeybee_walls_3 = RemoteReceiver(show_honeybee_walls)
show_honeybee_roof_3 = RemoteReceiver(show_honeybee_roof)

# ----
vertical_separation = Number()
horizontal_separation = Number()
sill_height = Number(number_slider_36)
window_height = Number()
subdivide_generated_windows = Boolean(toggle_5)
louver_depth_3 = Number(filter_21)
number_of_louvers_6 = Number(number_of_louvers_5)
vertical_horizontal_louvers = Boolean()
distance_between_louvers_3 = Number(filter_20)
louver_angle_3 = Number(filter_19)

# ---- group: Prepare for analysis
# Simple energy system
heatcool = HBHeatCoolHVACTemplates({"Baseboard electric": "ElectricBaseboard", "Baseboard gas boiler": "BoilerBaseboard", "Baseboard central air source heat pump": "ASHPBaseboard", "Baseboard district hot water": "DHWBaseboard", "Direct evap coolers with baseboard electric": "EvapCoolers_ElectricBaseboard", "Direct evap coolers with baseboard gas boiler": "EvapCoolers_BoilerBaseboard"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}, selected="Residential heat pump with no cooling": "ResidentialHPNoCool")

# ----
# Create construction
layer1_thickness_2 = RemoteReceiver(layer1_thickness)
layer2_thickness_2 = RemoteReceiver(layer2_thickness)
layer3_thickness_2 = RemoteReceiver(layer3_thickness)
layer4_thickness_2 = RemoteReceiver(layer4_thickness)
layer5_thickness_2 = RemoteReceiver(layer5_thickness)
layer6_thickness_2 = RemoteReceiver(layer6_thickness)
layer1_material_2 = RemoteReceiver(layer1_material)
layer2_material_2 = RemoteReceiver(layer2_material)
layer3_material_2 = RemoteReceiver(layer3_material)
layer4_material_2 = RemoteReceiver(layer4_material)
layer5_material_2 = RemoteReceiver(layer5_material)
layer6_material_2 = RemoteReceiver(layer6_material)
active_layers_2 = RemoteReceiver(simplify(graft(active_layers)))
entwine_112 = Entwine(
    Branch00=layer1_material_2,
    Branch01=layer2_material_2,
    Branch02=layer3_material_2,
    Branch03=layer4_material_2,
    Branch04=layer5_material_2,
    Branch05=layer6_material_2,
    FlattenInputs=True)
entwine_113 = Entwine(
    Branch00=layer1_thickness_2,
    Branch01=layer2_thickness_2,
    Branch02=layer3_thickness_2,
    Branch03=layer4_thickness_2,
    Branch04=layer5_thickness_2,
    Branch05=layer6_thickness_2,
    FlattenInputs=True)
create_construction_name_3 = RemoteReceiver(create_construction_name)
repeat_5 = RepeatData(Data=entwine_113, Length=active_layers_2)  # -> flatten(Data)
create_construction_2 = RemoteReceiver(create_construction)
panel_95 = Panel(create_construction_2)

item_15 = ListItem(List=created_materials_database_3, Index=entwine_112, Wrap=invert(True))

repeat_6 = RepeatData(Data=item_15, Length=active_layers_2)  # -> flatten(Data)
cluster_4 = Cluster(materials=repeat_6, construction_name=create_construction_name_3, thicknesses=repeat_5)  # -> error_2, construction_2
create_construction_error = RemoteSender(cluster_4.error_2)
freeze_gate_19 = StreamFreezeGate(Data=cluster_4.construction_2, PassingSwitch=create_construction_2, Freeze=True)

panel_96 = Panel(freeze_gate_19)

create_construction_error_2 = RemoteReceiver(create_construction_error)
panel_97 = Panel(create_construction_error_2)
split_7 = TextSplit(Text=create_construction_error_2, Separators=panel_49)
trim_2 = TextTrim(Text=split_7, Start=True, End=True)
item_16 = ListItem(List=trim_2, Index=0, Wrap=True)  # -> Item, Item1
lng_8 = ListLength(List=split_7)
len_3 = TextLength(Text=item_16.Item1)
larger_2 = LargerThan(FirstNumber=lng_8, SecondNumber="1")  # -> LargerThan, OrEqualTo
subtraction_4 = Subtraction(A=len_3, B=Slider(11, range=0..20))
fragment_2 = TextFragment(Text=item_16.Item1, Start="0", Count=subtraction_4)
filter_22 = StreamFilter(Gate=larger_2.LargerThan, Stream0=create_construction_error_2, Stream1=fragment_2)
panel_98 = Panel(filter_22)

# ----
# Bake model
panel_99 = Panel("""Heath::honeybee model::walls
Heath::honeybee model::roof
Heath::honeybee model::floors
Heath::honeybee model::ground
Heath::honeybee model::windows
Heath::honeybee model::doors
Heath::honeybee model::context""")
ef_layer_2 = EleFrontLayer(FullPath=panel_99)  # -> Layer, FullPath, Hidden, Locked, DisplayColour, MaterialName, Linetype, PrintColour, PrintWidth
ef_att_4 = EleFrontAttributes(Layer=ef_layer_2.Layer)  # -> graft(Attributes), Keys, Values, Name, Layer, ColourSource, DisplayColour, MaterialSource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
bake_model_2 = RemoteReceiver(bake_model)

# ----
# Created constructions database
rec_4 = DataRecorder(freeze_gate_19, DataLimit=-10, RecordData=True)
ipy2_3 = IronPython2Script(materials=rec_4)  # -> unique_materials; inputs materials: list; same code as ipy2
loaded_constructions_2 = RemoteReceiver(loaded_constructions)
clean_10 = CleanTree(RemoveNulls=True, RemoveInvalid=True, RemoveEmpty=False, Tree=ipy2_3)
created_constructions_database = RemoteSender(clean_10)
entwine_114 = Entwine(Branch00=clean_10, Branch01=loaded_constructions_2, FlattenInputs=True)  # -> flatten(Result)

clean_11 = CleanTree(RemoveNulls=True, RemoveInvalid=True, RemoveEmpty=False, Tree=entwine_114)

ipy2_4 = IronPython2Script(materials=clean_11)  # -> unique_materials; inputs materials: list; same code as ipy2
all_constructions_database = RemoteSender(ipy2_4)

all_constructions_database_2 = RemoteReceiver(all_constructions_database)
decnstrmat_3 = HBDeconstructMaterial(mat=all_constructions_database_2)  # -> values, attr_names, r_val_si, r_val_ip; plug-in component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
panel_100 = Panel(decnstrmat_3.values)
item_17 = ListItem(List=decnstrmat_3.values, Index=0, Wrap=True)  # -> flatten(Item), flatten(Item1), flatten(Item2), flatten(Item3), flatten(Item4)
clean_12 = CleanTree(RemoveNulls=True, RemoveInvalid=True, RemoveEmpty=False, Tree=item_17.Item2)
clean_13 = CleanTree(RemoveNulls=True, RemoveInvalid=True, RemoveEmpty=False, Tree=item_17.Item4)
clean_14 = CleanTree(RemoveNulls=True, RemoveInvalid=True, RemoveEmpty=False, Tree=item_17.Item3)
clean_15 = CleanTree(RemoveNulls=True, RemoveInvalid=True, RemoveEmpty=False, Tree=item_17.Item)
lng_9 = ListLength(List=clean_15)
entwine_115 = Entwine(Branch00="Generic", Branch01=clean_15, FlattenInputs=True)  # -> flatten(Result)
roundd_6 = RoundToDecimalPlace(NumberX=clean_12, DecimalPlace="1", RoundType=0)  # -> Rounded, Difference
roundd_7 = RoundToDecimalPlace(NumberX=clean_13, DecimalPlace="1", RoundType=0)  # -> Rounded, Difference
roundd_8 = RoundToDecimalPlace(NumberX=clean_14, DecimalPlace="1", RoundType=0)  # -> Rounded, Difference
bool_21 = Boolean(lng_9)
gate_25 = StreamGate(Stream=panel_24, Gate=bool_21)  # -> Target0, Target1
format_7 = Format(Culture=127, Data0=clean_15, Data1=roundd_6.Rounded, Data2=roundd_8.Rounded, Data3=roundd_7.Rounded)

entwine_116 = Entwine(Branch00="Generic", Branch01=all_constructions_database_2, FlattenInputs=True)  # -> flatten(Result)
all_constructions = RemoteSender(entwine_116)
all_construction_names = RemoteSender(entwine_115)
setlist_9 = SetListContents(ListToModify=pulldown_18, NewListContents=entwine_115)
all_construction_names_2 = RemoteReceiver(all_construction_names)

expression_42 = Expression(x=all_construction_names_2, y=create_construction_name_2, Expression="x=y")
cull_5 = CullPattern(List=expression_42, CullPattern=expression_42)
gate_26 = StreamGate(Stream="Material already exists", Gate=cull_5)  # -> Target0, Target1
entwine_117 = Entwine(Branch00=filter_22, Branch01=gate_26.Target1, FlattenInputs=True)  # -> flatten(Result)
item_18 = ListItem(List=entwine_117, Index=0, Wrap=True)
create_construction_error_message = RemoteSender(item_18)

all_constructions_2 = RemoteReceiver(all_constructions)

create_construction_error_message_2 = RemoteReceiver(create_construction_error_message)
null_7 = NullItem(Item=create_construction_error_message_2)  # -> NullFlags, InvalidFlags, Description
filter_23 = StreamFilter(Gate=null_7.NullFlags, Stream0=create_construction_error_message_2, Stream1=" ")
filter_24 = StreamFilter(Gate=null_7.NullFlags, Stream0=Slider(500, range=0..1000), Stream1=Slider(1000000, range=0..1000000))
hideshow_29 = HideShowElement(ElementToHideShow=button_23, Show=True, Collapse=True, Disable=invert(null_7.NullFlags))
tooltip_12 = AttachTooltipToElement(ElementsToAttachTo=button_23, TooltipContent=filter_23, ShowDelay=filter_24, Duration=Slider(5000, range=0..10000))

item_19 = ListItem(List=all_constructions_2, Index=subset_exterior_wall_2, Wrap=True)
expression_43 = Expression(x="Generic", y=item_19, Expression="x=y")
filter_25 = StreamFilter(Gate=expression_43, Stream0=item_19, Stream1=null_5)
exteriorsubset_2 = HBExteriorConstructionSubset(exterior_wall=filter_25)  # -> exterior_set; plug-in component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

constructionset_2 = HBConstructionSet(name=panel_85, base_constr_set=panel_87, exterior_subset=exteriorsubset_2, subface_subset=subfacesubset_2)  # -> constr_set; plug-in component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

# ---- group: Building occupancy and systems (continued)
add_dynamic_shades = AddDynamicShades(base_construction_set=constructionset_2, setpoint=Slider(100, range=0..200))

# ----
decnstrconstrset_2 = HBDeconstructConstructionSet(constr_set=constructionset_2)  # -> exterior_wall, exterior_roof, exposed_floor, ground_wall, ground_roof, ground_floor, window, skylight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; plug-in component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
panel_101 = Panel(decnstrconstrset_2.exterior_wall)

# ----
# Save constructions, (triggered after creating)
heath_flying_5 = RemoteReceiver(heath_flying)
py3_13 = Python3Script(get=heath_flying_5)  # -> mpl_folder; same code as py3_2
all_constructions_database_3 = RemoteReceiver(all_constructions_database)
create_construction_3 = RemoteReceiver(create_construction)
py3_14 = Python3Script(name="constructions", folder=py3_13)  # -> file_name
# ---------- py3_14: Python ----------
import os

indentation = 0
while indentation < 100:
    path = folder + '\\' + name + ' ' + str(indentation) + '.json'
    if not os.path.exists(path):
        break
    indentation += 1
file_name = name + ' ' + str(indentation)
# ---------- end py3_14 ----------
dumpobjects = HBDumpObjects(hb_objs=flatten(all_constructions_database_3), name=py3_14, folder=py3_13, dump=create_construction_3)  # -> report, hb_file; plug-in component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
panel_102 = Panel(py3_14)
panel_103 = Panel(dumpobjects.hb_file)

# ---- group: Prepare for analysis (continued)
data_27 = Data(add_dynamic_shades)
entwine_118 = Entwine(
    Branch00=room,
    Branch01=adjacent,
    Branch02=context,
    Branch03=windows,
    Branch04=data_26,
    Branch05=data_27,
    Branch06=model_name_2,
    Branch07=generate_wwr_2,
    Branch08=wall_thickness_2,
    Branch09=roof_thickness_2,
    FlattenInputs=True)
freeze_gate_20 = StreamFreezeGate(Data=entwine_118, PassingSwitch=or_21, Hold=True)
bang_2 = ExplodeTree(Data=freeze_gate_20)  # -> Branch0, Branch1, Branch2, Branch3, Branch4, Branch5, Branch6, Branch7, Branch8, Branch9
hasdata_2 = DataExists(Data=bang_2.Branch0)
model_rooms_exists = RemoteSender(hasdata_2)

# ----
construction = Data(bang_2.Branch5)
program_2 = Data(bang_2.Branch4)
model_name_3 = Data(bang_2.Branch6)
roof_thickness_3 = Data(bang_2.Branch9)
wwr = Data(bang_2.Branch7)
wall_thickness_3 = Data(bang_2.Branch8)
python_3 = GhPythonScript(in_list=construction)  # -> out_list; inputs in_list: list
# ---------- python_3: Python ----------
"""Converts lists of HB objects to dicts for use with Py3.
    Inputs:
        in_list: List of HB objects
    Output:
        out_list: List of Python dictionaries representing HB objects"""

__author__ = "sawen"
__version__ = "2024.07.09"

out_list = list([x.to_dict() for x in in_list])
# ---------- end python_3 ----------
python_4 = GhPythonScript(in_list=program_2)  # -> out_list; inputs in_list: list; same code as python_3

roof_thickness_4 = Number(roof_thickness_3)
window_to_wall_ratio = Number(wwr)
wall_thickness_4 = Number(wall_thickness_3)
context_geometry = Geometry(bang_2.Branch2)
skylights = Geometry(bang_2.Branch3)
windows_2 = Geometry(bang_2.Branch3)
adjacent_geometry = Geometry(bang_2.Branch1)
model_name_4 = Text(model_name_3)
shade = HBShade(geo=context_geometry)  # -> report, shades; plug-in component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
aperture = HBAperture(geo=windows_2)  # -> report, apertures; plug-in component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
aperture_2 = HBAperture(geo=skylights)  # -> report, apertures; plug-in component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
python_5 = GhPythonScript(list=shade.shades)  # -> out, list_checked; inputs list: list
# ---------- python_5: Python ----------
"""Outputs an empty list if all items in input list are null.
    Inputs:
        list: list to be checked for null
    Output:
        list_checked: outputs list if any items are not null, otherwise outputs an empty list"""

list_checked = [] if all(v is None for v in list) else list
# ---------- end python_5 ----------
vizquick = HBVisualizeQuick(hb_objs=flatten(python_5.list_checked))  # -> geo; plug-in component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
null_8 = NullItem(Item=aperture.apertures)  # -> NullFlags, InvalidFlags, Description
item_20 = ListItem(List=null_8.NullFlags, Index=0, Wrap=True)
bordershades = HBExtrudedBorderShades(hb_objs=flatten(aperture_2.apertures), depth=roof_thickness_4)  # -> report, hb_objs; plug-in component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
panel_105 = Panel(model_name_4)

py3_15 = Python3Script(
    room_geo=bang_2.Branch0,
    construction_sets=python_3,
    programs=python_4,
    adjacent_surfaces=adjacent_geometry,
    window_geo=windows_2)  # -> out, rooms; inputs room_geo: list of Brep, construction_sets: list, programs: list, adjacent_surfaces: list of Brep, window_geo: list of Surface
# ---------- py3_15: Python ----------
# Copyright (c) 2024, Heath.
# You should have received a copy of the GNU Affero General Public License
# along with Heath; If not, see <http://www.gnu.org/licenses/>.
# 
# @license AGPL-3.0-or-later <https://spdx.org/licenses/AGPL-3.0-or-later>

"""Grasshopper Script"""
        
from heath import create_hb_model, heath_globals
import heath

import Rhino.Geometry as rg
import IronPython
import importlib
import honeybee_energy

from honeybee.room import Room
cs = honeybee_energy.constructionset.ConstructionSet
pt = honeybee_energy.programtype.ProgramType 

import scriptcontext


def dictify(d):
    for key in d:
        if type(d[key]) == IronPython.Runtime.PythonDictionary:
            d[key] = dict(d[key])
            dictify(d[key])

if __name__ == "__main__":
    if not scriptcontext.sticky["heath_flying"]:
        raise Exception("Heath - fly component must exist on the canvas")
    ghenv.Component.Message = heath_globals.version

    # SUPER HACK because Py3 does not retain the Honeybee types
    # https://discourse.ladybug.tools/t/ladybug-honeybee-datatypes-are-converted-when-input-to-py3-component/28216
    construction_sets = [cs.from_dict(c) for c in construction_sets]
    p = programs[0]
    programs_patched = []
    for p in programs:
        # hack to fix py2-py3 conversion of dicts
        dictify(p)
        p = pt.from_dict(p)
        programs_patched.append(p)

    rooms = create_hb_model(list(room_geo), construction_sets, programs_patched, adjacent_surfaces, window_geo)
# ---------- end py3_15 ----------
python_6 = GhPythonScript(in_list=py3_15.rooms)  # -> out_list; inputs in_list: list; same code as python_3
txt = Text(python_6)
python_7 = GhPythonScript(room_dict_as_str=txt)  # -> out, rooms; inputs room_dict_as_str: list
# ---------- python_7: Python ----------
__author__ = "sawen"
__version__ = "2024.07.09"

from honeybee.room import Room
import ast

rooms = []

for r in room_dict_as_str:
    # holy hackeroni! Py2 can't read the dict directly unless
    # it is converted to a string first!
    rooms.append(Room.from_dict(ast.literal_eval(r)))
# ---------- end python_7 ----------

guidesurface = HBPropertiesByGuideSurface(rooms=python_7.rooms, guide=adjacent_geometry, bc="Adiabatic")  # -> rooms; plug-in component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
aperturesbyratio = HBAperturesByRatio(
    hb_objs=flatten(guidesurface),
    ratio=window_to_wall_ratio,
    subdivide=subdivide_generated_windows,
    win_height=window_height,
    sill_height=sill_height,
    horiz_separ=horizontal_separation,
    vert_separ=vertical_separation)  # -> report, hb_objs; plug-in component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
decnstrobj = HBDeconstructObject(hb_obj=aperturesbyratio.hb_objs)  # -> faces, flatten(apertures), doors, shades; plug-in component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
filter_26 = StreamFilter(Gate=item_20, Stream0=aperture.apertures, Stream1=decnstrobj.apertures)
bordershades_2 = HBExtrudedBorderShades(hb_objs=flatten(filter_26), depth=wall_thickness_4)  # -> report, hb_objs; plug-in component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
louvershades = HBLouverShades(
    hb_objs=flatten(bordershades_2.hb_objs),
    depth=louver_depth_3,
    shade_count=number_of_louvers_6,
    dist_between=distance_between_louvers_3,
    angle=louver_angle_3,
    vertical=vertical_horizontal_louvers)  # -> report, hb_objs; plug-in component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
null_9 = NullItem(Item=louvershades.hb_objs)  # -> NullFlags, InvalidFlags, Description
item_21 = ListItem(List=null_9.NullFlags, Index=0, Wrap=True)
viznorm = HBVisualizeNormals(hb_objs=filter_26)  # -> points, vectors; plug-in component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
filter_27 = StreamFilter(Gate=item_21, Stream0=louvershades.hb_objs, Stream1=bordershades_2.hb_objs)
merge_7 = Merge(Data1=filter_27, Data2=bordershades.hb_objs)  # -> flatten(Result)
null_10 = NullItem(Item=merge_7)  # -> NullFlags, InvalidFlags, Description
cull_6 = CullPattern(List=merge_7, CullPattern=invert(null_10.NullFlags))
vdis = VectorDisplay(Anchor=viznorm.points, Vector=viznorm.vectors)
addsubface = HBAddSubface(hb_obj=flatten(guidesurface), sub_faces=flatten(cull_6))  # -> hb_obj; plug-in component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
model = HBModel(rooms=flatten(addsubface), shades=flatten(python_5.list_checked), name=panel_105)  # -> report, model; plug-in component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

# ---- group: Prepare for analysis (continued)
filter_28 = StreamFilter(Gate=create_model_7, Stream1=model.model)

# ----
python_8 = GhPythonScript(model=filter_28)  # -> out, model, errors
# ---------- python_8: Python ----------
"""Validates HB model
    Inputs:
        x: The x script variable
        y: The y script variable
    Output:
        a: The a output variable"""

errors = []

def main(model):
    if not validate_units(model):
        errors.append("Model unit in Rhino must be Meters.")
    if len(errors):
        return None
    return model

def validate_units(model):
    return model.units == "Meters"

if __name__ == "__main__":
    model = main(model)
# ---------- end python_8 ----------

# ---- group: Prepare for analysis (continued)
panel_106 = Panel(python_8.errors)
hasdata_3 = DataExists(Data=python_8.model)
hasdata_4 = DataExists(Data=python_8.model)
freeze_gate_21 = StreamFreezeGate(Data=python_8.model, PassingSwitch=hasdata_3, Hold=True)
honeybee_model_possible = RemoteSender(hasdata_4)

deconstructmodel = HBDeconstructModel(model=freeze_gate_21)  # -> rooms, faces, apertures, doors, shades; plug-in component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
heatcoolhvac = HBHeatCoolHVAC(rooms=flatten(deconstructmodel.rooms), system_type=heatcool)  # -> report, rooms; plug-in component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
model_2 = HBModel(
    rooms=flatten(heatcoolhvac.rooms),
    faces=flatten(deconstructmodel.faces),
    shades=flatten(deconstructmodel.shades),
    apertures=flatten(deconstructmodel.apertures),
    doors=flatten(deconstructmodel.doors),
    name=model_name_4)  # -> report, model; plug-in component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

deconstructmodel_2 = HBDeconstructModel(model=model_2.model)  # -> rooms, faces, apertures, doors, shades; plug-in component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
vizbytype = HBVisualizeByType(hb_objs=model_2.model)  # -> walls, interior_walls, roofs, ceilings, exterior_floors, interior_floors, air_walls, apertures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; plug-in component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
vizbybc = HBVisualizeByBC(hb_objs=model_2.model)  # -> outdoors, surface, ground, adiabatic, other, wire_frame; plug-in component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
hasdata_5 = DataExists(Data=model_2.model)
honeybee_model_ready = RemoteSender(hasdata_5)
panel_107 = Panel(model_2.model)
panel_108 = Panel(hasdata_5)
geoprop = HBGeometryProperties(rooms=deconstructmodel_2.rooms)  # -> ext_wall_area, ext_win_area, volume, floor_area, floor_ep_constr; plug-in component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
null_11 = NullItem(Item=[vizbytype.walls, vizbytype.interior_walls, vizbytype.roofs, vizbytype.ceilings, vizbytype.exterior_floors, vizbytype.interior_floors, vizbytype.air_walls, vizbytype.apertures, vizbytype.interior_apertures, vizbytype.doors, vizbytype.interior_doors, vizbytype.outdoor_shades, vizbytype.indoor_shades])  # -> NullFlags, InvalidFlags, Description
cull_7 = CullPattern(List=null_11.NullFlags, CullPattern=invert(null_11.NullFlags))
panel_109 = Panel(geoprop.floor_area)
gate_27 = StreamGate(Stream=[vizbytype.indoor_shades, vizbytype.outdoor_shades], Gate=show_honeybee_context_3)  # -> Target0, Target1
gate_28 = StreamGate(Stream=[vizbytype.apertures, vizbytype.interior_apertures], Gate=show_honeybee_windows_3)  # -> Target0, Target1
gate_29 = StreamGate(Stream=[vizbytype.doors, vizbytype.interior_doors], Gate=show_honeybee_doors_3)  # -> Target0, Target1
gate_30 = StreamGate(Stream=vizbytype.roofs, Gate=show_honeybee_roof_3)  # -> Target0, Target1
gate_31 = StreamGate(Stream=vizbytype.interior_floors, Gate=show_honeybee_floors_3)  # -> Target0, Target1
gate_32 = StreamGate(Stream=vizbytype.exterior_floors, Gate=show_honeybee_ground_3)  # -> Target0, Target1
gate_33 = StreamGate(Stream=[vizbytype.walls, vizbytype.interior_walls, vizbytype.air_walls], Gate=show_honeybee_walls_3)  # -> Target0, Target1
lng_10 = ListLength(List=cull_7)
honeybee_model_exists = RemoteSender(lng_10)
data_28 = Data(gate_29.Target1)
data_29 = Data(gate_30.Target1)
data_30 = Data(gate_28.Target1)
data_31 = Data(gate_27.Target1)
data_32 = Data(gate_33.Target1)
data_33 = Data(gate_31.Target1)
data_34 = Data(gate_32.Target1)

# ----
honeybee_model_exists_2 = RemoteReceiver(honeybee_model_exists)
honeybee_model_possible_2 = RemoteReceiver(honeybee_model_possible)
hideshow_30 = HideShowElement(ElementToHideShow=button_16, Show=True, Collapse=True, Disable=invert(honeybee_model_exists_2))
bool_22 = Boolean(honeybee_model_possible_2)
honeybee_model_exists_3 = RemoteReceiver(honeybee_model_exists)
filter_29 = StreamFilter(Gate=bool_22, Stream0=Slider(500, range=0..1000), Stream1=Slider(1000000, range=0..1000000))
filter_30 = StreamFilter(Gate=bool_22, Stream0="Import geometry before creating the model", Stream1=" ")
hideshow_31 = HideShowElement(ElementToHideShow=border_5, Show=honeybee_model_exists_3, Collapse=True, Disable=False)
tooltip_13 = AttachTooltipToElement(ElementsToAttachTo=button_15, TooltipContent=filter_30, ShowDelay=filter_29, Duration=2000)

entwine_119 = Entwine(
    Branch00=data_32,
    Branch01=data_29,
    Branch02=data_33,
    Branch03=data_34,
    Branch04=data_30,
    Branch05=data_28,
    Branch06=data_31,
    FlattenInputs=True)
clean_16 = CleanTree(RemoveNulls=True, RemoveInvalid=True, RemoveEmpty=False, Tree=entwine_119)
lng_11 = ListLength(List=clean_16)
repeat_7 = RepeatData(Data=ef_att_4.Attributes, Length=lng_11)
bake_2 = BakeObjects(Geometry=clean_16, Attributes=repeat_7, Bake=bake_model_2, createGroups=False, preset="Moderate")  # -> Message, Ghosts

# ----
# Detailed energy simulations
# https://energyplus-weather.s3.amazonaws.com/africa_wmo_region_1/LBY/LBY_Tripoli.620100_IWEC/LBY_Tripoli.620100_IWEC.zip
# # Detailed energy simulations
# This cluster simulates energy balance over a year and outputs the total energy use intensity (EUI), divided into end uses, and detailed graphs of the energy balance, peak cooling/heating, and cooling/heating load profiles
# 
# ## Instructions
# Enter all inputs and set `Run Energy Simulation` to true to run the energy simulation
# 
# ## Inputs
# - `EPW file URL` - the URL for a EPW file which describes the location
# - `Honeybee model` - the Honeybee model for analysis
# - `Run Energy Simulation` - set to True to run the energy simulation
# 
# ## Outputs
# - `Energy use intensity [kWh/m2a]` - A number representing the total energy use of the model
# - `Energy use intensity per end use [kWh/m2a]` - A list of values with the energy uses split into different end uses
# - `End uses` - A list of text strings representing the different end uses
# - `Annual hourly energy results` - various meshes representing different energy results over the hours of the year
# - `Monthly energy balance` - A monthly breakdown of the energy balance, with energy sources in the top and energy sinks in the bottom
# - `Peak cooling` - A number representing the peak cooling load in each zone
# - `Peak heating` - A number representing the peak heating load in each zone
# - `Cooling load profile` - A mesh representing the cooling load profile during the design day
# - `Heating load profile` - A mesh representing the heating load profile during the design day
# 
# ## Interpretation
# To be added...
falsestart = LBFalseStartToggle(False)
data_35 = Data(model_2.model)
data_36 = Data(panel_37)
detailed_energy_simulations = DetailedEnergySimulations(epw_file_url=data_36, run_energy_simulation=falsestart)  # -> energy_use_intensity_2, energy_use_intensity_per_end_use_2, end_uses_2, annual_hourly_energy_results_2, monthly_energy_balance_2, peak_cooling_2, peak_heating_2, cooling_load_profile_2, heating_load_profile_2
data_37 = Data(detailed_energy_simulations.energy_use_intensity_2)
data_38 = Data(detailed_energy_simulations.energy_use_intensity_per_end_use_2)
data_39 = Data(detailed_energy_simulations.end_uses_2)
data_40 = Data(detailed_energy_simulations.annual_hourly_energy_results_2)
data_41 = Data(detailed_energy_simulations.monthly_energy_balance_2)
data_42 = Data(detailed_energy_simulations.peak_cooling_2)
data_43 = Data(detailed_energy_simulations.peak_heating_2)
data_44 = Data(detailed_energy_simulations.cooling_load_profile_2)
data_45 = Data(detailed_energy_simulations.heating_load_profile_2)
panel_110 = Panel(data_38)
panel_111 = Panel(data_37)
panel_112 = Panel(data_42)
panel_113 = Panel(data_43)
panel_114 = Panel(data_39)

# ----
# Revised LCA calculation
# # Life Cycle Assessment (LCA)
# This cluster calculates the embodied carbon for the input Honeybee model
# 
# ## Instructions
# Enter the inputs to calculate the GWP (Global Warming Potential), i.e. the embodied carbon, for the materials in the Honeybee model
# 
# ## Inputs
# - `Honeybee model` - the Honeybee model for analysis
# 
# ## Outputs
# - `Total GWP` - total GWP for the modules A1-A5.1 [kg CO2eq]
# - `GWP by element type` - GWP of each element type for the modules A1-A5.1 [kg CO2eq]
# - `Element types` - list of element types in the model
# 
# ## Interpretation
# To be added...
data_46 = Data(model_2.model)
cluster_5 = Cluster_7(honeybee_model=data_46, area_m2=geoprop.floor_area)  # -> total_gwp_2, gwp_by_element_type_2, element_types_2, operational_gwp_total_kg_co2eq_year_2
data_47 = Data(cluster_5.operational_gwp_total_kg_co2eq_year_2)
data_48 = Data(cluster_5.total_gwp_2)
data_49 = Data(cluster_5.gwp_by_element_type_2)
data_50 = Data(cluster_5.element_types_2)
panel_115 = Panel(data_47)
panel_116 = Panel(data_50)
panel_117 = Panel("kg CO2eq/year")
panel_118 = Panel(data_49)
multiplication = Multiplication(A=panel_115, B=Slider(50, range=0..100))
panel_119 = Panel("kg CO2eq")
panel_120 = Panel(data_48)

# ----
# Daylight Glare Probability (DGP)
# # Daylight Glare Probability
# This cluster calculates the DGP for a specific view.
# 
# ## Instructions
# Enter all inputs and set `Run Glare analysis`to True to investigate glare potential for the set viewport and time. For a simple model this simulation takes around 50-60s.
# 
# ## Inputs
# - `EPW file URL` - the URL for a EPW file which describes the location
# - `Honeybee model` - the Honeybee model for analysis
# - `Viewport name` - the string name of a viewport in the Rhino model which shall be analysed
# - `Month` - month of the analysis period (1-12)
# - `Day` - date of the analysis period (1-31)
# - `Hour` - hour of the analysis period (0-23)
# - `Run Glare analysis` - set to True to run the analysis
# 
# ## Outputs
# - `Daylight glare probability (DGP)` - a value for the probability of glare occuring in this view at this time [%]
# - `HDR image` - a HDR image which can be visualised using LB ImageViewer to show what areas cause glare
# - `HDR false color image` - a HDR image with modified colors to more clearly see causes of glare
# 
# ## Interpretation
# To be added...
panel_123 = Panel("Perspective")
falsestart_2 = LBFalseStartToggle(False)
txt_2 = Text(panel_123)
data_51 = Data(model_2.model)
data_52 = Data(panel_37)
glare = Glare(
    epw_file_url_2=data_52,
    viewport_name=txt_2,
    month=Slider(6, range=1..12),
    day=Slider(21, range=1..31),
    hour=Slider(12, range=0..23),
    run_glare_analysis=falsestart_2)  # -> daylight_glare_probability_dgp_2, hdr_image_2, hdr_false_color_image_2
num_4 = Number(falsestart_2)
num_5 = Number(glare.daylight_glare_probability_dgp_2)
num_6 = Number(falsestart_2)
imageviewer = LBImageViewer(ImagePath_=glare.hdr_false_color_image_2, _scale_=num_4, DisableClickable=False, SaveImgWithCoords=False, scale=0.5)  # -> ImagePath, Values, GIF
imageviewer_2 = LBImageViewer(ImagePath_=glare.hdr_image_2, _scale_=num_6, DisableClickable=False, SaveImgWithCoords=False, scale=0.5)  # -> ImagePath, Values, GIF

honeybee_model_ready_2 = RemoteReceiver(honeybee_model_ready)
honeybee_model_ready_3 = RemoteReceiver(honeybee_model_ready)
honeybee_model_ready_4 = RemoteReceiver(honeybee_model_ready)
honeybee_model_ready_5 = RemoteReceiver(honeybee_model_ready)
filter_31 = StreamFilter(Gate=honeybee_model_ready_2, Stream0=Slider(500, range=0..1000), Stream1=Slider(1000000, range=0..1000000))
filter_32 = StreamFilter(Gate=honeybee_model_ready_2, Stream0="Create a model before running the simulation", Stream1=" ")
honeybee_model_ready_6 = RemoteReceiver(honeybee_model_ready)
filter_33 = StreamFilter(Gate=honeybee_model_ready_3, Stream0=Slider(500, range=0..1000), Stream1=Slider(1000000, range=0..1000000))
filter_34 = StreamFilter(Gate=honeybee_model_ready_3, Stream0="Create a model before running the simulation", Stream1=" ")
honeybee_model_ready_7 = RemoteReceiver(honeybee_model_ready)
filter_35 = StreamFilter(Gate=honeybee_model_ready_4, Stream0=Slider(500, range=0..1000), Stream1=Slider(1000000, range=0..1000000))
filter_36 = StreamFilter(Gate=honeybee_model_ready_4, Stream0="Create a model before running the simulation", Stream1=" ")
hideshow_32 = HideShowElement(ElementToHideShow=button_2, Show=True, Collapse=True, Disable=invert(honeybee_model_ready_5))
tooltip_14 = AttachTooltipToElement(ElementsToAttachTo=button_2, TooltipContent=filter_32, ShowDelay=filter_31, Duration=2000)
hideshow_33 = HideShowElement(ElementToHideShow=button_4, Show=True, Collapse=True, Disable=invert(honeybee_model_ready_6))
tooltip_15 = AttachTooltipToElement(ElementsToAttachTo=button_4, TooltipContent=filter_34, ShowDelay=filter_33, Duration=2000)
hideshow_34 = HideShowElement(ElementToHideShow=button_6, Show=True, Collapse=True, Disable=invert(honeybee_model_ready_7))
tooltip_16 = AttachTooltipToElement(ElementsToAttachTo=button_6, TooltipContent=filter_36, ShowDelay=filter_35, Duration=2000)

# ---- group: Analyse context and model
# Weather visualisation
# # Weather visualisation
# This cluster visualises weather data from a .epw file including solar radiation and temperature, as applied to a target geometry
# 
# ## Instructions
# Enter all the inputs and visualise wind, sky view and temperature,  set `Run direct sun hours study` and `Run incident radiation study` to visualise solar radiation
# 
# ## Inputs
# - `EPW file URL` - the URL for a EPW file which describes the location
# - `Target Geometry` - geometry on which to apply irradiation study
# - `Context Geometry` - geometry which shades the target geometry
# - `Run direct sun hours study` - set to True to run the direct sun hours study
# - `Run incident radiation study` - set to True to run the incident radiation study
# - `Sky mask centre point` - point at which to generate sky mask
# 
# ## Outputs
# - `Sky dome` - mesh visualising the directions where solar radiation comes from during the year at the location
# - `Sky mask - mesh visualising what portions of the sky are visible at the specified point
# - `Wind rose` - mesh visualising wind directions and velocities during the year
# - `Dry bulb temperature line chart` - mesh visualising dry bulb temperature during the year
# - `Dry bulb temperature 2D chart` - mesh visualising dry bulb temperature for each hour of the year
# - `Direct sun hours` - mesh visualising the number of direct sun hours on the target geometry
# - `Incident radiation` - mesh visualising the incident radiation [kWh/m2] on the target geometry
# 
# ## Interpretation
# To be added...
# Visualise properties
# # Visualise properties
# This cluster visualises room and face attributes of a Honeybee model
# 
# ## Instructions
# Input the Honeybee model to be visualised and select room/face attributes using the HB Room Attributes/HB Room Energy Attibrutes/HB Face Attributes/HB Face Energy Attributes dropdown components. Adjust precision of the attributes using the `Number of decimals` inputs
# 
# ## Inputs
# - `Honeybee model` - Honeybee model to be visualised
# - `Room attribute` - Honeybee Room  or Room Energy attribute to visualise
# - `Number of decimals (room)` - Precision of room attribute output
# - `Face attribute` - Honeybee Face  or Face Energy attribute to visualise
# - `Number of decimals (face)` - Precision of face attribute output
# 
# ## Outputs
# - `Visualised room attributes` - mesh representing the selected room attribute
# - `Visualised face attributes` - mesh representing the selected face attribute
# 
# ## Interpretation
# To be added...
run_weather_visualisation_3 = RemoteReceiver(run_weather_visualisation)
run_weather_visualisation_4 = RemoteReceiver(run_weather_visualisation)
gate_34 = StreamGate(Stream="Heath geometry type", Gate=run_weather_visualisation_3)  # -> Target0, Target1
gate_35 = StreamGate(Stream="Heath geometry type", Gate=run_weather_visualisation_4)  # -> Target0, Target1
roomenergyattr = HBRoomEnergyAttributes({"Program": "properties.energy.program_type.display_name", "Construction Set": "properties.energy.construction_set.display_name", "Is Conditioned": "properties.energy.is_conditioned", "People per Area [ppl/m2]": "properties.energy.people.people_per_area", "Area per Person [m2/ppl]": "properties.energy.people.area_per_person", "Lighting per Area [W/m2]": "properties.energy.lighting.watts_per_area"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}, selected="Program")
refkv_9 = ReferenceByKeyValue(Key=gate_34.Target1, Val="Room", lightweight=False)
refkv_10 = ReferenceByKeyValue(Key=gate_35.Target1, Val="Context", lightweight=False)
pt_15 = ConstructPoint(XCoordinate=Slider(21, range=0..100), YCoordinate=Slider(15, range=0..100), ZCoordinate=0)
faceenergyattr = HBFaceEnergyAttributes({"Construction": "properties.energy.construction.display_name", "Materials": "properties.energy.construction.layers", "Thickness [m]": "properties.energy.construction.thickness", "Density [kg/m2]": "properties.energy.construction.mass_area_density", "Heat Capacity [J/K-m2]": "properties.energy.construction.area_heat_capacity", "Construction R-Value [m2-K/W]": "properties.energy.construction.r_value", "Construction U-Value [W/m2-K]": "properties.energy.construction.u_value", "Construction U-Factor [W/m2-K]": "properties.energy.construction.u_factor", "Construction SHGC [Unshaded]": "properties.energy.construction.shgc", "R-Factor [m2-K/W]": "properties.energy.r_factor", "U-Factor [W/m2-K]": "properties.energy.u_factor", "SHGC [Unshaded]": "properties.energy.shgc", "Solar Transmitance [Unshaded]": "properties.energy.construction.solar_transmittance", "Visible Transmitance [Unshaded]": "properties.energy.construction.visible_transmittance", "Solar Reflectance [Outside]": "properties.energy.construction.outside_solar_reflectance", "Solar Reflectance [Inside]": "properties.energy.construction.inside_solar_reflectance", "Fraction Area Operable": "properties.energy.vent_opening.fraction_area_operable", "Fraction Height Operable": "properties.energy.vent_opening.fraction_height_operable", "Discharge Coefficient": "properties.energy.vent_opening.discharge_coefficient"}, selected="Construction SHGC [Unshaded]")
room_attribute_visualize_3 = RemoteReceiver(room_attribute_visualize)
room_energy_attribute_2 = RemoteReceiver(room_energy_attribute)
face_attribute_visualize_3 = RemoteReceiver(face_attribute_visualize)
face_energy_attribute_2 = RemoteReceiver(face_energy_attribute)
run_weather_visualisation_5 = RemoteReceiver(run_weather_visualisation)
roomattr = HBRoomAttributes({"Display Name": "display_name", "Simulation Name (Identifier)": "identifier", "Multiplier": "multiplier", "Floor Area Excluded": "exclude_floor_area", "Story": "story", "Volume": "volume", "Gross Floor Area": "floor_area", "Exposed Area": "exposed_area", "Exterior Wall Area": "exterior_wall_area", "Exterior Aperture Area": "exterior_aperture_area", "Average Floor Elevation": "average_floor_height"}, selected="Exterior Aperture Area")
faceattr = HBFaceAttributes({"Display Name": "display_name", "Simulation Name (Identifier)": "identifier", "Boundary Condition": "boundary_condition", "Has Parent": "has_parent", "Parent": "parent", "Azimuth": "azimuth", "Altitude": "altitude", "Area": "area", "Perimeter": "perimeter", "Face Type": "type", "Aperture Is Operable": "is_operable", "Door Is Glass": "is_glass"}, selected="Face Type")
room_attribute_2 = RemoteReceiver(room_attribute)
face_attribute_2 = RemoteReceiver(face_attribute)
pt_16 = Point(pt_15)
data_53 = Data(panel_37)
filter_37 = StreamFilter(Gate=face_attribute_visualize_3, Stream0=face_energy_attribute_2, Stream1=face_attribute_2)
filter_38 = StreamFilter(Gate=room_attribute_visualize_3, Stream0=room_energy_attribute_2, Stream1=room_attribute_2)
data_54 = Data(model_2.model)
weather_visualisation = WeatherVisualisation(
    _1=data_53,
    run_weather_visualisation=run_weather_visualisation_5,
    target_geometry_2=refkv_9,
    target_geometry=refkv_10,
    run_direct_sun_hours_study=run_weather_visualisation_5,
    run_incident_radiation_study=run_weather_visualisation_5,
    sky_mask_centre_point=pt_16)  # -> sky_dome, sky_mask, wind_rose, dry_bulb_temperature_line_chart, dry_bulb_temperature_2d_chart, direct_sun_hours_2, incident_radiation
visualise_properties = VisualiseProperties(
    honeybee_model=data_54,
    room_attribute=filter_38,
    number_of_decimals_room=Slider(4, range=0..10),
    face_attribute=filter_37,
    number_of_decimals_face=Slider(4, range=0..10))  # -> visualised_room_attributes_2, visualised_face_attributes_2
room_energy_attribute_visualize_3 = RemoteReceiver(room_energy_attribute_visualize)
face_energy_attribute_visualize_3 = RemoteReceiver(face_energy_attribute_visualize)
room_attribute_visualize_4 = RemoteReceiver(room_attribute_visualize)
face_attribute_visualize_4 = RemoteReceiver(face_attribute_visualize)
weather_visualization_type_2 = RemoteReceiver(weather_visualization_type)
or_22 = GateOr(A=room_attribute_visualize_4, B=room_energy_attribute_visualize_3)
or_23 = GateOr(A=face_attribute_visualize_4, B=face_energy_attribute_visualize_3)
weather_visualization_show_2 = RemoteReceiver(weather_visualization_show)
gate_36 = StreamGate(Stream=visualise_properties.visualised_room_attributes_2, Gate=or_22)  # -> Target0, Target1
gate_37 = StreamGate(Stream=visualise_properties.visualised_face_attributes_2, Gate=or_23)  # -> Target0, Target1
weather_visualization_show_3 = RemoteReceiver(weather_visualization_show)
equals_14 = Equality(FirstNumber="3", SecondNumber=weather_visualization_type_2)  # -> Equality, Inequality
equals_15 = Equality(FirstNumber="4", SecondNumber=weather_visualization_type_2)  # -> Equality, Inequality
equals_16 = Equality(FirstNumber="5", SecondNumber=weather_visualization_type_2)  # -> Equality, Inequality
equals_17 = Equality(FirstNumber="6", SecondNumber=weather_visualization_type_2)  # -> Equality, Inequality
data_55 = Data(gate_36.Target1)
data_56 = Data(gate_37.Target1)
nor = GateNor(A=equals_14.Equality, B=equals_15.Equality)
or_24 = GateOr(A=equals_16.Equality, B=equals_17.Equality)
and_27 = GateAnd(A=weather_visualization_show_3, B=or_24)
weather_visualisation_wireframe = RemoteSender(and_27)
weather_visualization_show_4 = RemoteReceiver(weather_visualization_show)
swatch = ColourSwatch(SwatchColor=RGB(84, 84, 84))
gate_38 = StreamGate(Stream=swatch, Gate=weather_visualization_show_4)  # -> Target0, Target1

# ----
entwine_120 = Entwine(
    Branch00=weather_visualisation.sky_dome,
    Branch01=weather_visualisation.sky_mask,
    Branch02=weather_visualisation.wind_rose,
    Branch03=weather_visualisation.dry_bulb_temperature_line_chart,
    Branch04=weather_visualisation.dry_bulb_temperature_2d_chart,
    Branch05=weather_visualisation.direct_sun_hours_2,
    Branch06=weather_visualisation.incident_radiation,
    FlattenInputs=True)
freeze_gate_22 = StreamFreezeGate(Data=entwine_120, PassingSwitch=run_weather_visualisation_2, Hold=True)
bang_3 = ExplodeTree(Data=freeze_gate_22)  # -> Branch0, Branch1, Branch2, Branch3, Branch4, Branch5, Branch6

# ---- group: Analyse context and model (continued)
null_12 = NullItem(Item=flatten(freeze_gate_22))  # -> NullFlags, InvalidFlags, Description
filter_39 = StreamFilter(
    Gate=weather_visualization_type_2,
    Stream0=bang_3.Branch0,
    Stream1=bang_3.Branch1,
    Stream2=bang_3.Branch2,
    Stream3=bang_3.Branch3,
    Stream4=bang_3.Branch4,
    Stream5=bang_3.Branch5,
    Stream6=bang_3.Branch6)
cull_8 = CullPattern(List=null_12.NullFlags, CullPattern=invert(null_12.NullFlags))
gate_39 = StreamGate(Stream=filter_39, Gate=weather_visualization_show_2)  # -> Target0, Target1
lng_12 = ListLength(List=cull_8)
gate_40 = StreamGate(Stream=gate_39.Target1, Gate=nor)  # -> Target0, Target1
weather_visualisation_exists = RemoteSender(lng_12)
mesh = Mesh([gate_40.Target1, gate_40.Target0])
sortbytype = SortObjectsByType(RhinoObjects=gate_40.Target0)  # -> Points, Curves, Surfaces, Breps, Meshes, TextObjects, HatchObjects, LightObjects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
bbox = BoundingBox(Content=mesh, Plane=PlaneXY(0, 0, 0), UnionBox=True)  # -> Box, Box_2
line = Line(sortbytype.Curves)
zoom_weather_visualization_bounding_box = RemoteSender(bbox.Box)
null_13 = NullItem(Item=line)  # -> NullFlags, InvalidFlags, Description
data_57 = Data([sortbytype.Other, sortbytype.Meshes])
sift = SiftPattern(List=sortbytype.Curves, SiftPattern=null_13.NullFlags)  # -> Output0, Output1
preview_17 = CustomPreview(Geometry=[sift.Output1, data_57], Material=swatch)
preview_18 = CustomPreview(Geometry=gate_40.Target1, Material=gate_38.Target1)

# ----
weather_visualisation_exists_2 = RemoteReceiver(weather_visualisation_exists)
weather_visualisation_exists_3 = RemoteReceiver(weather_visualisation_exists)
hideshow_35 = HideShowElement(ElementToHideShow=button_13, Show=True, Collapse=True, Disable=invert(weather_visualisation_exists_2))
hideshow_36 = HideShowElement(ElementToHideShow=button_14, Show=True, Collapse=True, Disable=invert(weather_visualisation_exists_2))
hideshow_37 = HideShowElement(ElementToHideShow=stack_21, Show=weather_visualisation_exists_3, Collapse=True, Disable=False)

zoom_weather_visualization_bounding_box_2 = RemoteReceiver(zoom_weather_visualization_bounding_box)
zbb = ZoomBoundingBox(Box=zoom_weather_visualization_bounding_box_2, Run=zoom_weather_visualization_2)

weather_visualisation_wireframe_2 = RemoteReceiver(weather_visualisation_wireframe)

# ----
# Bake model
panel_124 = Panel("""Heath::weather::Sky dome
Heath::weather::Sky mask
Heath::weather::Wind rose
Heath::weather::Dry bulb temperature line chart
Heath::weather::Dry bulb temperature 2D chart
Heath::weather::Direct sun hours
Heath::weather::Incident radiation""")
merge_8 = Merge(Data1=sift.Output1, Data2=data_57, Data3=gate_40.Target1)
weather_visualization_type_3 = RemoteReceiver(weather_visualization_type)
item_22 = ListItem(List=panel_124, Index=weather_visualization_type_3, Wrap=True)
ef_layer_3 = EleFrontLayer(FullPath=item_22)  # -> Layer, FullPath, Hidden, Locked, DisplayColour, MaterialName, Linetype, PrintColour, PrintWidth
weather_visualisation_bake_2 = RemoteReceiver(weather_visualisation_bake)
ef_att_5 = EleFrontAttributes(Layer=ef_layer_3.Layer)  # -> Attributes, Keys, Values, Name, Layer, ColourSource, DisplayColour, MaterialSource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

clean_17 = CleanTree(RemoveNulls=True, RemoveInvalid=True, RemoveEmpty=False, Tree=merge_8)

lng_13 = ListLength(List=clean_17)
repeat_8 = RepeatData(Data=ef_att_5.Attributes, Length=lng_13)
bake_3 = BakeObjects(Geometry=clean_17, Attributes=repeat_8, Bake=weather_visualisation_bake_2, createGroups=False, preset="Moderate")  # -> Message, Ghosts

# ----
# # Simple energy simulations
# Streamlined energy simulations which calculate energy balance across the year, and peak loads on the design day, for the input Honeybee rooms.
# 
# ## Instructions
# Enter all inputs and set `Run Energy Balance` or `Run Peak Loads`to True to investigate energy use for the specified Honeybee rooms considering the specified Honeybee shade objects. Adjust the y axis of output graphs using the `Graph max` input.
# 
# ## Inputs
# - `EPW file URL` - the URL for a EPW file which describes the location
# - `Honeybee rooms` - the Honeybee rooms which shall be analysed
# - `Shading objects` - Honeybee shade objects which block solar radiation toward the simulated rooms
# - `Run Energy Balance` - set to True to run the energy balance simulation
# - `Run Peak Loads` - set to True to run the peak loads simulation
# - `Graph max` - max value for the y axis of output graphs
# 
# ## Outputs
# - `Annual energy balance` - mesh visualising energy balance of each month of the year broken down into energy sources/sinks
# - `Daily cooling profile` - mesh visualising the cooling need during the design day (hottest day of the year)
# - `Daily heating profile` - mesh visualising the heating need during the design day (coldest day of the year)
# - `Cooling balance (design day)` - mesh visualising the cooling sources and sinks during the design day (hottest day of the year)
# - `Heating balance (design day)` - mesh visualising the heating sources and sinks during the design day (coldest day of the year)
# 
# ## Interpretation
# To be added...
panel_125 = Panel(bake_3.Ghosts)

# ---- group: Analyse performance
# Simple energy simulations
run_simple_energy_simulations_4 = RemoteReceiver(run_simple_energy_simulations)
honeybee_rooms = Data(deconstructmodel_2.rooms)
data_58 = Data(panel_37)
data_59 = Data(deconstructmodel_2.shades)
downloadepw = LBDownloadWeather(weather_URL=data_58)  # -> epw_file, stat_file, ddy_file; plug-in component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
run_peak_loads = Boolean(run_simple_energy_simulations_4)
run_energy_balance = Boolean(run_simple_energy_simulations_4)
data_60 = Data(honeybee_rooms)
data_61 = Data()
annualloads = HBAnnualLoads(
    rooms=flatten(data_60),
    shades=data_61,
    epw_file=downloadepw.epw_file,
    run_bal=run_energy_balance,
    run=run_energy_balance)  # -> report, total_load, cooling, heating, lighting, equip, process, hot_water, balance; plug-in component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
total_load_eui = Data(annualloads.total_load)
annual_energy_balance_data = Data(annualloads.balance)
panel_126 = Panel(annualloads.total_load)
colrange_4 = LBColorRange(index=Slider(0, range=0..26))  # -> colors; plug-in component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
colrange_5 = LBColorRange(index=Slider(26, range=0..26))  # -> colors; plug-in component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
number_slider_37 = Slider(760000, range=0..1000000)
neg_2 = Negative(Value=Slider(100000, range=0..100000))
pt_17 = ConstructPoint(XCoordinate=Slider(80, range=0..100), YCoordinate=Slider(5, range=0..100), ZCoordinate=0)
simple_energy_simulation_base_point = RemoteSender(pt_17)
simple_energy_simulation_base_point_2 = RemoteReceiver(simple_energy_simulation_base_point)
simple_energy_simulation_base_point_3 = RemoteReceiver(simple_energy_simulation_base_point)
simple_energy_simulation_base_point_4 = RemoteReceiver(simple_energy_simulation_base_point)
simple_energy_simulation_base_point_5 = RemoteReceiver(simple_energy_simulation_base_point)
simple_energy_simulation_base_point_6 = RemoteReceiver(simple_energy_simulation_base_point)

# ----
honeybee_rooms_2 = Data(honeybee_rooms)
data_62 = Data(downloadepw.ddy_file)
peakloads = HBPeakLoads(rooms=honeybee_rooms_2, shades=shading_geometry, ddy_file=data_62, run_bal=run_peak_loads, run=run_peak_loads)  # -> report, peak_cool, peak_heat, cooling, heating, cool_bal, heat_bal; plug-in component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
annual_energy_balance_data_2 = Data(peakloads.cooling)
annual_energy_balance_data_3 = Data(peakloads.cool_bal)
annual_energy_balance_data_4 = Data(peakloads.heating)
annual_energy_balance_data_5 = Data(peakloads.heat_bal)
entwine_121 = Entwine(
    Branch00=total_load_eui,
    Branch01=annual_energy_balance_data,
    Branch02=annual_energy_balance_data_2,
    Branch03=annual_energy_balance_data_4,
    Branch04=annual_energy_balance_data_3,
    Branch05=annual_energy_balance_data_5,
    FlattenInputs=True)
freeze_gate_23 = StreamFreezeGate(Data=entwine_121, PassingSwitch=run_simple_energy_simulations_3, Hold=True)
bang_4 = ExplodeTree(Data=freeze_gate_23)  # -> Branch0, Branch1, Branch2, Branch3, Branch4, Branch5

# ---- group: Analyse performance
xdata = LBDeconstructData(data=bang_4.Branch2)  # -> header, values; plug-in component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
xdata_2 = LBDeconstructData(data=bang_4.Branch1)  # -> header, values; plug-in component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
xdata_3 = LBDeconstructData(data=bang_4.Branch3)  # -> header, values; plug-in component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
xdata_4 = LBDeconstructData(data=bang_4.Branch4)  # -> header, values; plug-in component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
xdata_5 = LBDeconstructData(data=bang_4.Branch5)  # -> header, values; plug-in component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
smaller = SmallerThan(FirstNumber=xdata_3.values, SecondNumber="0")  # -> SmallerThan, OrEqualTo
smaller_2 = SmallerThan(FirstNumber=xdata.values, SecondNumber="0")  # -> SmallerThan, OrEqualTo
smaller_3 = SmallerThan(FirstNumber=xdata_2.values, SecondNumber="0")  # -> SmallerThan, OrEqualTo
smaller_4 = SmallerThan(FirstNumber=xdata_4.values, SecondNumber="0")  # -> SmallerThan, OrEqualTo
smaller_5 = SmallerThan(FirstNumber=xdata_5.values, SecondNumber="0")  # -> SmallerThan, OrEqualTo
sift_2 = SiftPattern(List=xdata_3.values, SiftPattern=smaller.OrEqualTo)  # -> Output0, Output1
sift_3 = SiftPattern(List=xdata_2.values, SiftPattern=smaller_3.OrEqualTo)  # -> Output0, Output1
sift_4 = SiftPattern(List=xdata.values, SiftPattern=smaller_2.OrEqualTo)  # -> Output0, Output1
sift_5 = SiftPattern(List=xdata_4.values, SiftPattern=smaller_4.OrEqualTo)  # -> Output0, Output1
sift_6 = SiftPattern(List=xdata_5.values, SiftPattern=smaller_5.OrEqualTo)  # -> Output0, Output1
flip = FlipMatrix(Data=sift_4.Output0)
flip_2 = FlipMatrix(Data=sift_4.Output1)
flip_3 = FlipMatrix(Data=sift_2.Output0)
flip_4 = FlipMatrix(Data=sift_2.Output1)
flip_5 = FlipMatrix(Data=sift_6.Output0)
flip_6 = FlipMatrix(Data=sift_6.Output1)
flip_7 = FlipMatrix(Data=sift_3.Output0)
flip_8 = FlipMatrix(Data=sift_3.Output1)
flip_9 = FlipMatrix(Data=sift_5.Output0)
flip_10 = FlipMatrix(Data=sift_5.Output1)
ma_2 = MassAddition(Input=flip_2)  # -> Result, PartialResults
ma_3 = MassAddition(Input=flip_4)  # -> Result, PartialResults
ma_4 = MassAddition(Input=flip)  # -> Result, PartialResults
ma_5 = MassAddition(Input=flip_6)  # -> Result, PartialResults
ma_6 = MassAddition(Input=flip_8)  # -> Result, PartialResults
ma_7 = MassAddition(Input=flip_3)  # -> Result, PartialResults
ma_8 = MassAddition(Input=flip_10)  # -> Result, PartialResults
ma_9 = MassAddition(Input=flip_5)  # -> Result, PartialResults
ma_10 = MassAddition(Input=flip_7)  # -> Result, PartialResults
ma_11 = MassAddition(Input=flip_9)  # -> Result, PartialResults
extremes = MinMax(Number=flatten(ma_4.Result))  # -> Minimum, Maximum
extremes_2 = MinMax(Number=flatten(ma_2.Result))  # -> Minimum, Maximum
extremes_3 = MinMax(Number=flatten(ma_7.Result))  # -> Minimum, Maximum
extremes_4 = MinMax(Number=flatten(ma_3.Result))  # -> Minimum, Maximum
extremes_5 = MinMax(Number=flatten(ma_9.Result))  # -> Minimum, Maximum
extremes_6 = MinMax(Number=flatten(ma_10.Result))  # -> Minimum, Maximum
extremes_7 = MinMax(Number=flatten(ma_5.Result))  # -> Minimum, Maximum
extremes_8 = MinMax(Number=flatten(ma_6.Result))  # -> Minimum, Maximum
extremes_9 = MinMax(Number=flatten(ma_11.Result))  # -> Minimum, Maximum
extremes_10 = MinMax(Number=flatten(ma_8.Result))  # -> Minimum, Maximum
cooling_balance_min = RemoteSender(extremes_10.Minimum)
heating_balance_min = RemoteSender(extremes_7.Minimum)
daily_heating_profile_min = RemoteSender(extremes_4.Minimum)
cooling_balance_max = RemoteSender(extremes_9.Maximum)
daily_cooling_profile_max = RemoteSender(extremes.Maximum)
daily_cooling_profile_min = RemoteSender(extremes_2.Minimum)
heating_balance_max = RemoteSender(extremes_5.Maximum)
annual_energy_balance_max = RemoteSender(extremes_6.Maximum)
annual_energy_balance_min = RemoteSender(extremes_8.Minimum)
daily_heating_profile_max = RemoteSender(extremes_3.Maximum)

# ----
# Daylight (Illuminance, DA and UDI)
# Create analysis grid
# Alternatively create grid from surface
# # Daylight (Illuminance, DA and UDI)
# This cluster simulates illuminance for a specified hour of the year and daylight autonomy (DA) and useful daylight illuminance (UDI) for the entire year across an analysis surface.
# 
# ## Instructions
# Enter all inputs and set `Run Illuminance` or `Run Annual Daylight Simulation`to True to investigate daylight. The illuminance study covers a specified time step whereas the annual daylight simulation covers the full year. The `grid size` and `detail level` inputs can be used to improve the fidelity of the simulation at the cost of simulation time. The study can take several minutes, depending on the grid size and detail level.
# 
# ## Inputs
# - `EPW file URL` - the URL for a EPW file which describes the location
# - `Honeybee model` - the Honeybee model for analysis
# - `Grid size` - the resolution of the analysis grid in metres
# - `Detail level (0-2)` - level of detail for the daylight simulation, the higher value, the higher detail and the slower the simulation
# - `Month (illuminance)` - month of the analysis period  for the illuminance simulation (1-12)
# - `Day (illuminance)` - date of the analysis period for the illuminance simulation (1-31)
# - `Hour (illuminance)` - hour of the analysis period for the illuminance simulation (0-23)
# - `Run Illuminance` - set to True to run the illuminance analysis for the specified timestep
# - `Run Annual Daylight Simulation` - set to True to run the full year daylight simulation
# 
# ## Outputs
# - `Illuminance [Lux]` - a mesh visualising the amount of incident radiation which hits the analysis surface at the specified timestep
# - `Spatial Daylight Autonomy [-]` - the mean SDA for the entire analysis surface
# - `Daylight autonomy [%]` - a mesh visualising the value of DA across the analysis surface
# - `UDI [%]` - a mesh visualising the value of Useful Daylight Illuminance across the analysis surface
# - `UDI <50 [%]` - a mesh visualising the percentage of time that the lower treshold of illuminance is not achieved across the analysis surface
# - `UDI >3000 [%]` - a mesh visualising the percentage of time that the upper treshold of illuminance is exceeded across the analysis surface
# 
# ## Interpretation
# To be added...
number_slider_38 = Slider(12, range=0..23)
run_daylight_simulations_3 = RemoteReceiver(run_daylight_simulations)
number_slider_39 = Slider(0, range=0..2)
data_63 = Data(panel_37)
honeybee_model = Data(model_2.model)
epw_file_url = Data(data_63)
downloadepw_2 = LBDownloadWeather(weather_URL=epw_file_url)  # -> epw_file, stat_file, ddy_file; plug-in component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
deconstructmodel_3 = HBDeconstructModel(model=honeybee_model)  # -> rooms, faces, apertures, doors, shades; plug-in component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
decnstrobj_2 = HBDeconstructObject(hb_obj=deconstructmodel_3.rooms)  # -> faces, apertures, doors, shades; plug-in component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
vizquick_2 = HBVisualizeQuick(hb_objs=decnstrobj_2.faces)  # -> geo; plug-in component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
area = Area(Geometry=vizquick_2)  # -> Area, Centroid
detail_level_0_2 = Number(number_slider_39)
pdecon = Deconstruct(Point=area.Centroid)  # -> XComponent, YComponent, ZComponent
sort = SortList(Keys=pdecon.ZComponent, ValuesA=vizquick_2)  # -> Keys, ValuesA
grid_size = Number(Slider(1, range=0..10))
honeybee_model_2 = Data(honeybee_model)
run_annual_daylight_simulation = Boolean(run_daylight_simulations_3)
detail_level_0_2_2 = Number(number_slider_39)
run_illuminance = Boolean(run_daylight_simulations_3)
cluster_6 = Cluster_6()
X = UnitX(Factor=Slider(0, range=0..400))

# ---- group: Set up sensor grids
srf = Surface(sort.ValuesA)
item_23 = ListItem(List=srf, Index=Slider(0, range=0..5), Wrap=True)
flip_11 = Flip(Surface=item_23)  # -> Surface, Result
genpts = LBGeneratePointGrid(geometry=flip_11.Surface, grid_size=Slider(1, range=0..5), offset_dist=Slider(0.7, range=0..5))  # -> points, vectors, face_areas, mesh; plug-in component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
gridrooms = HBSensorGridFromRooms(rooms=honeybee_model_2, grid_size=grid_size, dist_floor=Slider(0.7, range=0..5))  # -> grid, points, mesh; plug-in component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
sensorgrid = HBSensorGrid(positions=genpts.points, directions=genpts.vectors, mesh=genpts.mesh)  # -> grid; plug-in component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
assigngridsviews = HBAssignGridsAndViews(model=honeybee_model_2, grids=flatten(gridrooms.grid))  # -> model; plug-in component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

# ---- group: Analyse performance (continued)
daily_heating_profile_max_2 = RemoteReceiver(daily_heating_profile_max)
daily_heating_profile_min_2 = RemoteReceiver(daily_heating_profile_min)
daily_cooling_profile_max_2 = RemoteReceiver(daily_cooling_profile_max)
daily_cooling_profile_min_2 = RemoteReceiver(daily_cooling_profile_min)
heating_balance_max_2 = RemoteReceiver(heating_balance_max)
heating_balance_min_2 = RemoteReceiver(heating_balance_min)
cooling_balance_max_2 = RemoteReceiver(cooling_balance_max)
cooling_balance_min_2 = RemoteReceiver(cooling_balance_min)
annual_energy_balance_max_2 = RemoteReceiver(annual_energy_balance_max)
annual_energy_balance_min_2 = RemoteReceiver(annual_energy_balance_min)

# ----
cluster_7 = Cluster_4(int=heating_balance_max_2)
cluster_8 = Cluster_5(x=daily_cooling_profile_min_2)
cluster_9 = Cluster_4(int=daily_cooling_profile_max_2)
cluster_10 = Cluster_4(int=cooling_balance_max_2)
cluster_11 = Cluster_5(x=heating_balance_min_2)
cluster_12 = Cluster_5(x=cooling_balance_min_2)
cluster_13 = Cluster_5(x=daily_heating_profile_min_2)
cluster_14 = Cluster_4(int=daily_heating_profile_max_2)
cluster_15 = Cluster_5(x=annual_energy_balance_min_2)
cluster_16 = Cluster_4(int=annual_energy_balance_max_2)

# ---- group: Analyse performance / Simple energy balance
colrange_6 = LBColorRange(index=Slider(19, range=0..100))  # -> colors; plug-in component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
legendpar = LBLegendParameters(min=cluster_15, max=cluster_16, colors=colrange_6)  # -> leg_par; plug-in component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
monthlychart = LBMonthlyChart(
    data=bang_4.Branch1,
    base_pt=simple_energy_simulation_base_point_2,
    x_dim=simple_energy_simulation_width_2,
    y_dim=simple_energy_simulation_height_2,
    stack=Toggle(True),
    legend_par=legendpar)  # -> report, data_mesh, data_lines, col_lines, legend, borders, labels, y_title, title, vis_set; plug-in component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

# ---- group: Analyse performance (continued)
legendpar_2 = LBLegendParameters(min=cluster_11, max=cluster_7)  # -> leg_par; plug-in component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
cluster_17 = Cluster_3(min=cluster_12, max=cluster_10, colors=colrange_4)
cluster_18 = Cluster_3(min=cluster_13, max=cluster_14, colors=colrange_5)
annual_energy_balance = Data(flatten([monthlychart.data_mesh, monthlychart.data_lines, monthlychart.col_lines, monthlychart.legend, monthlychart.borders, monthlychart.labels, monthlychart.y_title, monthlychart.title]))

# ---- group: Analyse performance / Simple peak loads
legendpar_3 = LBLegendParameters(min=cluster_8, max=cluster_9)  # -> leg_par; plug-in component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
toggle_6 = BooleanToggle(True)
toggle_7 = BooleanToggle(True)
toggle_8 = BooleanToggle(True)
toggle_9 = BooleanToggle(True)
monthlychart_2 = LBMonthlyChart(
    data=bang_4.Branch4,
    base_pt=simple_energy_simulation_base_point_4,
    x_dim=simple_energy_simulation_width_4,
    y_dim=simple_energy_simulation_height_4,
    stack=toggle_6,
    time_marks=toggle_6,
    legend_par=cluster_18)  # -> report, data_mesh, data_lines, col_lines, legend, borders, labels, y_title, title, vis_set; plug-in component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
monthlychart_3 = LBMonthlyChart(
    data=bang_4.Branch2,
    base_pt=simple_energy_simulation_base_point_3,
    x_dim=simple_energy_simulation_width_3,
    y_dim=simple_energy_simulation_height_3,
    stack=toggle_7,
    time_marks=toggle_7,
    legend_par=legendpar_3)  # -> report, data_mesh, data_lines, col_lines, legend, borders, labels, y_title, title, vis_set; plug-in component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
monthlychart_4 = LBMonthlyChart(
    data=bang_4.Branch4,
    base_pt=simple_energy_simulation_base_point_5,
    x_dim=simple_energy_simulation_width_5,
    y_dim=simple_energy_simulation_height_5,
    stack=toggle_8,
    time_marks=toggle_8,
    legend_par=cluster_17)  # -> report, data_mesh, data_lines, col_lines, legend, borders, labels, y_title, title, vis_set; plug-in component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
monthlychart_5 = LBMonthlyChart(
    data=bang_4.Branch5,
    base_pt=simple_energy_simulation_base_point_6,
    x_dim=simple_energy_simulation_width_6,
    y_dim=simple_energy_simulation_height_6,
    stack=toggle_9,
    time_marks=toggle_9,
    legend_par=legendpar_2)  # -> report, data_mesh, data_lines, col_lines, legend, borders, labels, y_title, title, vis_set; plug-in component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
daily_heating_profile = Data(flatten([monthlychart_2.data_mesh, monthlychart_2.data_lines, monthlychart_2.col_lines, monthlychart_2.legend, monthlychart_2.borders, monthlychart_2.labels, monthlychart_2.y_title, monthlychart_2.title]))
daily_cooling_profile = Data(flatten([monthlychart_3.data_mesh, monthlychart_3.data_lines, monthlychart_3.col_lines, monthlychart_3.legend, monthlychart_3.borders, monthlychart_3.labels, monthlychart_3.y_title, monthlychart_3.title]))
heating_balance_design_day = Data(flatten([monthlychart_5.data_mesh, monthlychart_5.data_lines, monthlychart_5.col_lines, monthlychart_5.legend, monthlychart_5.borders, monthlychart_5.labels, monthlychart_5.y_title, monthlychart_5.title]))
cooling_balance_design_day = Data(flatten([monthlychart_4.data_mesh, monthlychart_4.data_lines, monthlychart_4.col_lines, monthlychart_4.legend, monthlychart_4.borders, monthlychart_4.y_title, monthlychart_4.labels, monthlychart_4.title]))

# ----
panel_127 = Panel(legendpar)

simple_energy_simulation_type_2 = RemoteReceiver(simple_energy_simulation_type)
data_64 = Data(flatten(bang_4.Branch1))
daily_cooling_profile_2 = Data(flatten(annual_energy_balance))
daily_cooling_profile_3 = Data(flatten(daily_cooling_profile))
daily_cooling_profile_4 = Data(flatten(daily_heating_profile))
daily_cooling_profile_5 = Data(flatten(cooling_balance_design_day))
daily_cooling_profile_6 = Data(flatten(heating_balance_design_day))
data_65 = Data(flatten(bang_4.Branch0))
xdata_6 = LBDeconstructData(data=data_64)  # -> header, values; plug-in component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
filter_40 = StreamFilter(
    Gate=simple_energy_simulation_type_2,
    Stream0=daily_cooling_profile_2,
    Stream1=daily_cooling_profile_3,
    Stream2=daily_cooling_profile_4,
    Stream3=daily_cooling_profile_5,
    Stream4=daily_cooling_profile_6)
item_24 = ListItem(List=data_65, Index=0, Wrap=True)
total_load_eui_2 = RemoteSender(data_65)
null_14 = NullItem(Item=item_24)  # -> NullFlags, InvalidFlags, Description
annual_energy_balance_data_header = RemoteSender(xdata_6.header)
annual_energy_balance_data_values = RemoteSender(xdata_6.values)
bool_23 = Boolean(invert(null_14.NullFlags))
sortbytype_2 = SortObjectsByType(RhinoObjects=filter_40)  # -> Points, Curves, Surfaces, Breps, Meshes, TextObjects, HatchObjects, LightObjects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
simple_energy_data_exists = RemoteSender(bool_23)
line_2 = Line(sortbytype_2.Curves)
bbox_2 = BoundingBox(Content=sortbytype_2.Meshes, Plane=PlaneXY(0, 0, 0), UnionBox=True)  # -> Box, Box_2
null_15 = NullItem(Item=line_2)  # -> NullFlags, InvalidFlags, Description
data_66 = Data([sortbytype_2.Other, sortbytype_2.Meshes])
zoom_simple_energy_simulation_bounding_b = RemoteSender(bbox_2.Box)  # "zoom_simple_energy_simulation_bounding_box"
sift_7 = SiftPattern(List=sortbytype_2.Curves, SiftPattern=null_15.NullFlags)  # -> Output0, Output1
preview_19 = CustomPreview(Geometry=sift_7.Output1, Material=ColourSwatch(SwatchColor=RGB(84, 84, 84)))

zoom_simple_energy_simulation_bounding_b_2 = RemoteReceiver(zoom_simple_energy_simulation_bounding_b)  # "zoom_simple_energy_simulation_bounding_box"
zbb_2 = ZoomBoundingBox(Box=zoom_simple_energy_simulation_bounding_b_2, Run=zoom_simple_energy_simulation_2)

simple_energy_data_exists_2 = RemoteReceiver(simple_energy_data_exists)
simple_energy_data_exists_3 = RemoteReceiver(simple_energy_data_exists)
simple_energy_data_exists_4 = RemoteReceiver(simple_energy_data_exists)
hideshow_38 = HideShowElement(ElementToHideShow=true_button_6, Show=simple_energy_data_exists_2, Collapse=True, Disable=False)
hideshow_39 = HideShowElement(ElementToHideShow=button_5, Show=simple_energy_data_exists_3, Collapse=True, Disable=False)
bool_24 = Boolean(invert(simple_energy_data_exists_4))
hideshow_40 = HideShowElement(ElementToHideShow=tb_4, Show=bool_24, Collapse=simple_energy_data_exists_4, Disable=False)
simple_energy_data_exists_5 = RemoteReceiver(simple_energy_data_exists)
hideshow_41 = HideShowElement(ElementToHideShow=stack_8, Show=simple_energy_data_exists_5, Collapse=True, Disable=False)

annual_energy_balance_data_header_2 = RemoteReceiver(annual_energy_balance_data_header)
split_8 = TextSplit(Text=annual_energy_balance_data_header_2, Separators=":")
item_25 = ListItem(List=split_8, Index="-1", Wrap=True)
annual_energy_balance_data_values_2 = RemoteReceiver(annual_energy_balance_data_values)
fragment_3 = TextFragment(Text=item_25, Start="1")  # -> flatten(Fragment)
panel_128 = Panel(fragment_3)
num_7 = Number(annual_energy_balance_data_values_2)
long = LongestList(ListA=fragment_3, ListB=entwine_61, PaddingMode=2)  # -> ListA, ListB
short = ShortestList(ListA=fragment_3, ListB=entwine_61, TrimMode=2)  # -> ListA, ListB
lng_14 = ListLength(List=fragment_3)
lng_15 = ListLength(List=long.ListA)
equals_18 = Equality(FirstNumber=lng_14, SecondNumber=lng_15)  # -> Equality, Inequality
filter_41 = StreamFilter(Gate=equals_18.Inequality, Stream0=long.ListB, Stream1=short.ListB)
panel_129 = Panel(annual_energy_balance_data_header_2)

txt_3 = Text(filter_41)
pt_18 = Point(txt_3)

division_2 = Division(A=pt_18, B="255")
len_4 = TextLength(Text=division_2)
subtraction_5 = Subtraction(A=len_4, B=Slider(2, range=0..10))
fragment_4 = TextFragment(Text=division_2, Start="1", Count=subtraction_5)
py3_16 = Python3Script(file_location=nextfile, title="Energy Intensity (kWh/m2)", labels=fragment_3, values=num_7, colors=fragment_4)  # -> out, a; inputs labels: list, values: tree, colors: list
# ---------- py3_16: Python ----------
# requirements: matplotlib
# requirements: numpy

import matplotlib.pyplot as plt
import random as rd
import numpy as np
import matplotlib.colors as mplcolors
import ghpythonlib.treehelpers as th


fig, ax = plt.subplots()

x = ["Jan", "Feb", "Mar", "Apr", "May", "Jun",
"Jul", "Aug", "Sep", "Oct", "Nov", "Dec"]

values = th.tree_to_list(values)

bar_labels = labels

for i in range(len(colors)):
    colors[i] = colors[i].split(',')
    colors[i] = [float(j) for j in colors[i]]
    colors[i] = tuple(colors[i])

fig, ax = plt.subplots(figsize=(14, 6))

positive = np.zeros(len(x))
negative = np.zeros(len(x))


for i in range(len(values)):
    color = colors[i]
    if sum(values[i]) >= 0:
        ax.bar(x, values[i], label=bar_labels[i], color=colors[i],
        bottom=positive, align="edge")
        positive += values[i]
    elif sum(values[i]) < 0:
        ax.bar(x, values[i], label=bar_labels[i], color=colors[i],
        bottom=negative, align="edge")
        negative += values[i]


ax.set_ylabel(title)
ax.set_title(title)

y_max, y_min = max(positive)*1.1, min(negative)*1.1
ax.set_ylim(y_min, y_max)

plt.subplots_adjust(right=0.8)

ax.legend(title="Energy intensity", bbox_to_anchor=(1.0, 1),
loc='upper left', reverse=True)

plt.savefig(file_location)
a = file_location

#plt.show()
# ---------- end py3_16 ----------
panel_130 = Panel(py3_16.a)
panel_131 = Panel(py3_16.out)

total_load_eui_3 = RemoteReceiver(total_load_eui_2)
ma_12 = MassAddition(Input=total_load_eui_3)  # -> Result, PartialResults
round = Round(Number=ma_12.Result)  # -> Nearest, Floor, Ceiling
format_8 = Format(Format=panel_73, Culture=127, Data0=round.Nearest)
settextblock_12 = SetTextBlockContents(TextBlockToModify=tb_12, NewTextBlockContents=format_8)
setimg = SetImage(ImageToModify=image, NewImagePath=py3_16.a)

annual_energy_balance_data_header_3 = RemoteReceiver(annual_energy_balance_data_header)
split_9 = TextSplit(Text=annual_energy_balance_data_header_3, Separators=":")
item_26 = ListItem(List=split_9, Index="-1", Wrap=True)
annual_energy_balance_data_values_3 = RemoteReceiver(annual_energy_balance_data_values)
fragment_5 = TextFragment(Text=item_26, Start="1")  # -> flatten(Fragment)
panel_132 = Panel(fragment_5)
num_8 = Number(annual_energy_balance_data_values_3)
long_2 = LongestList(ListA=fragment_5, ListB=entwine_62, PaddingMode=2)  # -> ListA, ListB
short_2 = ShortestList(ListA=fragment_5, ListB=entwine_62, TrimMode=2)  # -> ListA, ListB
lng_16 = ListLength(List=fragment_5)
lng_17 = ListLength(List=long_2.ListA)
equals_19 = Equality(FirstNumber=lng_16, SecondNumber=lng_17)  # -> Equality, Inequality
filter_42 = StreamFilter(Gate=equals_19.Inequality, Stream0=long_2.ListB, Stream1=short_2.ListB)
panel_133 = Panel(annual_energy_balance_data_header_3)

txt_4 = Text(filter_42)
pt_19 = Point(txt_4)

division_3 = Division(A=pt_19, B="255")
len_5 = TextLength(Text=division_3)
subtraction_6 = Subtraction(A=len_5, B=Slider(2, range=0..10))
fragment_6 = TextFragment(Text=division_3, Start="1", Count=subtraction_6)
py3_17 = Python3Script(file_location=nextfile_2, title="Energy Intensity (kWh/m2)", labels=fragment_5, values=num_8, colors=fragment_6)  # -> out, a; inputs labels: list, values: tree, colors: list; same code as py3_16
panel_134 = Panel(py3_17.a)
panel_135 = Panel(py3_17.out)

total_load_eui_4 = RemoteReceiver(total_load_eui_2)
ma_13 = MassAddition(Input=total_load_eui_4)  # -> Result, PartialResults
round_2 = Round(Number=ma_13.Result)  # -> Nearest, Floor, Ceiling
format_9 = Format(Format=panel_75, Culture=127, Data0=round_2.Nearest)
settextblock_13 = SetTextBlockContents(TextBlockToModify=tb_13, NewTextBlockContents=format_9)
setimg_2 = SetImage(ImageToModify=image_2, NewImagePath=py3_17.a)

annual_energy_balance_data_header_4 = RemoteReceiver(annual_energy_balance_data_header)
split_10 = TextSplit(Text=annual_energy_balance_data_header_4, Separators=":")
item_27 = ListItem(List=split_10, Index="-1", Wrap=True)
annual_energy_balance_data_values_4 = RemoteReceiver(annual_energy_balance_data_values)
fragment_7 = TextFragment(Text=item_27, Start="1")  # -> flatten(Fragment)
panel_136 = Panel(fragment_7)
num_9 = Number(annual_energy_balance_data_values_4)
long_3 = LongestList(ListA=fragment_7, ListB=entwine_63, PaddingMode=2)  # -> ListA, ListB
short_3 = ShortestList(ListA=fragment_7, ListB=entwine_63, TrimMode=2)  # -> ListA, ListB
lng_18 = ListLength(List=fragment_7)
lng_19 = ListLength(List=long_3.ListA)
equals_20 = Equality(FirstNumber=lng_18, SecondNumber=lng_19)  # -> Equality, Inequality
filter_43 = StreamFilter(Gate=equals_20.Inequality, Stream0=long_3.ListB, Stream1=short_3.ListB)
panel_137 = Panel(annual_energy_balance_data_header_4)

txt_5 = Text(filter_43)
pt_20 = Point(txt_5)

division_4 = Division(A=pt_20, B="255")
len_6 = TextLength(Text=division_4)
subtraction_7 = Subtraction(A=len_6, B=Slider(2, range=0..10))
fragment_8 = TextFragment(Text=division_4, Start="1", Count=subtraction_7)
py3_18 = Python3Script(file_location=nextfile_3, title="Energy Intensity (kWh/m2)", labels=fragment_7, values=num_9, colors=fragment_8)  # -> out, a; inputs labels: list, values: tree, colors: list; same code as py3_16
panel_138 = Panel(py3_18.a)
panel_139 = Panel(py3_18.out)

total_load_eui_5 = RemoteReceiver(total_load_eui_2)
ma_14 = MassAddition(Input=total_load_eui_5)  # -> Result, PartialResults
round_3 = Round(Number=ma_14.Result)  # -> Nearest, Floor, Ceiling
format_10 = Format(Format=panel_77, Culture=127, Data0=round_3.Nearest)
settextblock_14 = SetTextBlockContents(TextBlockToModify=tb_14, NewTextBlockContents=format_10)
setimg_3 = SetImage(ImageToModify=image_3, NewImagePath=py3_18.a)

# ---- group: Daylight Factor
# Daylight Factor [%]
number_slider_40 = Slider(0, range=0..2)
falsestart_3 = LBFalseStartToggle(False)
radpar = HBRadianceParameter(recipe_type=number_slider_40, detail_level=detail_level_0_2)  # -> rad_par; plug-in component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
run_daylight_factor = Data(falsestart_3)
cluster_19 = Cluster_6()

# ----
grid_mesh = Data(gridrooms.mesh)
honeybee_model_3 = Data(assigngridsviews)
honeybee_model_4 = Data(honeybee_model_3)

# ---- group: Daylight Factor (continued)
daylightfactor = HBDaylightFactor(model=honeybee_model_4, radiance_par=radpar, run=run_daylight_factor)  # -> report, results; plug-in component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
median = GhPythonScript(list=daylightfactor.results)  # -> out, median; inputs list: list
# ---------- median: Python ----------
"""Provides a scripting component.
    Inputs:
        list: list of numeric values to retrieve median
    Output:
        median: median value in list

__author__ = "sawen"
__version__ = "2024.06.14"
"""

import statistics

def main(list):
    return statistics.median(list)

if __name__ == "__main__":
    if list:
        median = main(list)
# ---------- end median ----------
heatmap = LBSpatialHeatmap(values=flatten(daylightfactor.results), legend_par=cluster_19, legend_title="Daylight Factor [%]")  # -> mesh, legend, title, colors, legend_par, vis_set; plug-in component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
daylight_factor = Data(flatten([heatmap.mesh, heatmap.legend, heatmap.title]))

# ---- group: Simulate illuminance
importloc = LBImportLocation(epw_file=downloadepw_2.epw_file)  # -> location; plug-in component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
day_illuminance = Number(Slider(21, range=1..31))
hour_illuminance = Number(number_slider_38)
month_illuminance = Number(Slider(6, range=1..12))
radpar_2 = HBRadianceParameter(recipe_type=Slider(0, range=0..2), detail_level=detail_level_0_2_2)  # -> rad_par; plug-in component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
ciesky = HBCIEStandardSky(location=importloc, month=month_illuminance, day=day_illuminance, hour=hour_illuminance, type=0)  # -> sky; plug-in component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
mjoin = MeshJoin(Meshes=grid_mesh)
legendpar_4 = LBLegendParameters(max=Slider(2000, range=0..10000))  # -> leg_par; plug-in component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
pitgrid = HBPointInTimeGridBased(model=honeybee_model_3, sky=ciesky, radiance_par=radpar_2, run=run_illuminance)  # -> report, flatten(results); plug-in component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
heatmap_2 = LBSpatialHeatmap(values=pitgrid.results, mesh=mjoin, legend_par=legendpar_4, legend_title="Lux", global_title="Illuminance")  # -> mesh, legend, title, colors, legend_par, vis_set; plug-in component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

# ---- group: Spatial climate based daylight
panel_140 = Panel("-t 50 -lt 200 -ut 2000")
radpar_3 = HBRadianceParameter(recipe_type=Slider(2, range=0..2), detail_level=detail_level_0_2, additional_par="-ab 4")  # -> rad_par; plug-in component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
wea = HBWeaFromEPW(epw_file=downloadepw_2.epw_file)  # -> wea; plug-in component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
analysis_mesh = Mesh(grid_mesh)
annualdaylight = HBAnnualDaylight(
    model=honeybee_model_4,
    wea=wea,
    schedule="Generic Office Occupancy",
    radiance_par=radpar_3,
    run=run_annual_daylight_simulation)  # -> report, results, DA, cDA, UDI, UDI_low, UDI_up; plug-in component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
panel_141 = Panel(radpar_3)
mjoin_2 = MeshJoin(Meshes=analysis_mesh)
cluster_20 = Cluster_6()
cluster_21 = Cluster_6()
cluster_22 = Cluster_6()
heatmap_3 = LBSpatialHeatmap(values=flatten(annualdaylight.UDI_up), mesh=mjoin_2, legend_par=cluster_20, legend_title="UDI >3000 [%]")  # -> mesh, legend, title, colors, legend_par, vis_set; plug-in component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
heatmap_4 = LBSpatialHeatmap(values=flatten(annualdaylight.UDI_low), mesh=mjoin_2, legend_par=cluster_21, legend_title="UDI <50 [%]")  # -> mesh, legend, title, colors, legend_par, vis_set; plug-in component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
heatmap_5 = LBSpatialHeatmap(values=flatten(annualdaylight.UDI), mesh=mjoin_2, legend_par=cluster_22, legend_title="UDI [%]")  # -> mesh, legend, title, colors, legend_par, vis_set; plug-in component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
sda = HBSpatialDaylightAutonomy(DA=flatten(annualdaylight.DA), mesh=mjoin_2)  # -> report, sDA, pass_fail; plug-in component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
heatmap_6 = LBSpatialHeatmap(values=flatten(annualdaylight.DA), mesh=mjoin_2, legend_par=cluster_6, legend_title="Daylight autonomy [%]")  # -> mesh, legend, title, colors, legend_par, vis_set; plug-in component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
X_2 = UnitX(Factor=Slider(150, range=0..400))
X_3 = UnitX(Factor=Slider(100, range=0..400))
X_4 = UnitX(Factor=Slider(50, range=0..400))
panel_142 = Panel(sda.sDA)

# ---- group: Extract hourly data from annual results
facen = FaceNormals(Mesh=mjoin_2)  # -> Centers, Normals
pt_21 = Point(facen.Centers)
flatten = FlattenTree(Tree=pt_21, Path="{0}")
item_28 = ListItem(List=flatten, Index=Slider(581, range=0..1000), Wrap=True)
number_slider_41 = Slider(0.1, range=0..0.1)
annualtodata = HBAnnualResultsToData(results=annualdaylight.results, sel_pts=flatten(item_28), all_pts=pt_21)  # -> report, data; plug-in component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
legendpar_5 = LBLegendParameters(max=Slider(3000, range=0..3000))  # -> leg_par; plug-in component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
multiplication_2 = Multiplication(A=number_slider_41, B=4)
pt_22 = Point(Point(0, 35, 0))
hourlyplot = LBHourlyPlot(data=annualtodata.data, base_pt=pt_22, x_dim=number_slider_41, y_dim=multiplication_2, legend_par=legendpar_5)  # -> report, mesh, legend, borders, labels, title, vis_set; plug-in component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
sph = Sphere(Base=item_28, Radius=Slider(1.2, range=0..5))
merge_9 = Merge(Data1=sph, Data2=hourlyplot.mesh, Data3=hourlyplot.legend, Data4=hourlyplot.labels)  # -> flatten(Result)

# ----
merge_10 = Merge(Data1=heatmap_2.mesh, Data2=heatmap_2.legend, Data3=heatmap_2.title)  # -> flatten(Result)
illuminance_lux = Data(merge_10)
udi_50 = Data(flatten([heatmap_4.mesh, heatmap_4.legend, heatmap_4.title]))
udi_3000 = Data(flatten([heatmap_3.mesh, heatmap_3.legend, heatmap_3.title]))
udi = Data(flatten([heatmap_5.mesh, heatmap_5.legend, heatmap_5.title]))
daylight_autonomy = Data(flatten([heatmap_6.mesh, heatmap_6.legend, heatmap_6.title]))
move = Move(Geometry=daylight_autonomy, Motion=X)  # -> Geometry, Transform
hourly_results_in_one_point = Data(merge_9)
spatial_daylight_autonomy = Data(sda.sDA)

# ---- group: Spatial climate based daylight (continued)
move_2 = Move(Geometry=udi_3000, Motion=X_2)  # -> Geometry, Transform
move_3 = Move(Geometry=udi_50, Motion=X_3)  # -> Geometry, Transform
move_4 = Move(Geometry=udi, Motion=X_4)  # -> Geometry, Transform
merge_11 = Merge(Data1=move.Geometry, Data2=move_4.Geometry, Data3=move_3.Geometry, Data4=move_2.Geometry)

# ----
data_67 = Data(merge_11)

data_68 = Data(illuminance_lux)
data_69 = Data(spatial_daylight_autonomy)
data_70 = Data(daylight_autonomy)
data_71 = Data(udi)
data_72 = Data(udi_50)
data_73 = Data(udi_3000)
run_daylight_simulations_4 = RemoteReceiver(run_daylight_simulations)
entwine_122 = Entwine(
    Branch00=data_68,
    Branch01=data_69,
    Branch02=data_70,
    Branch03=data_71,
    Branch04=data_72,
    Branch05=data_73,
    FlattenInputs=True)
freeze_gate_24 = StreamFreezeGate(Data=entwine_122, PassingSwitch=run_daylight_simulations_4, Hold=True)
bang_5 = ExplodeTree(Data=freeze_gate_24)  # -> Branch0, Branch1, Branch2, Branch3, Branch4, Branch5
daylight_simulation_type_3 = RemoteReceiver(daylight_simulation_type)
null_16 = NullItem(Item=flatten(freeze_gate_24))  # -> NullFlags, InvalidFlags, Description
cull_9 = CullPattern(List=null_16.NullFlags, CullPattern=invert(null_16.NullFlags))
data_74 = Data(bang_5.Branch0)
data_75 = Data(bang_5.Branch1)
data_76 = Data(bang_5.Branch2)
data_77 = Data(bang_5.Branch3)
data_78 = Data(bang_5.Branch4)
data_79 = Data(bang_5.Branch5)
lng_20 = ListLength(List=cull_9)
filter_44 = StreamFilter(
    Gate=daylight_simulation_type_3,
    Stream0=data_74,
    Stream1=data_75,
    Stream2=data_76,
    Stream3=data_77,
    Stream4=data_78,
    Stream5=data_79)
daylight_data_exists = RemoteSender(lng_20)
data_80 = Data(filter_44)
bbox_3 = BoundingBox(Content=data_80, Plane=PlaneXY(0, 0, 0), UnionBox=True)  # -> Box, Box_2
zoom_daylight_simulation_bounding_box = RemoteSender(bbox_3.Box)

daylight_data_exists_2 = RemoteReceiver(daylight_data_exists)
daylight_data_exists_3 = RemoteReceiver(daylight_data_exists)
hideshow_42 = HideShowElement(ElementToHideShow=button, Show=daylight_data_exists_2, Collapse=True, Disable=False)
bool_25 = Boolean(invert(daylight_data_exists_3))
hideshow_43 = HideShowElement(ElementToHideShow=tb_3, Show=bool_25, Collapse=daylight_data_exists_3, Disable=False)
daylight_data_exists_4 = RemoteReceiver(daylight_data_exists)
hideshow_44 = HideShowElement(ElementToHideShow=pulldown, Show=daylight_data_exists_4, Collapse=True, Disable=False)

zoom_daylight_simulation_bounding_box_2 = RemoteReceiver(zoom_daylight_simulation_bounding_box)

zbb_3 = ZoomBoundingBox(Box=zoom_daylight_simulation_bounding_box_2, Run=zoom_daylight_simulation_2)

daylight_data_exists_5 = RemoteReceiver(daylight_data_exists)
and_28 = GateAnd(A=equals_3.Inequality, B=daylight_data_exists_5)

or_25 = GateOr(
    A=preview_16,
    B=room_attribute_visualize_2,
    C=room_energy_attribute_visualize_2,
    D=face_attribute_visualize_2,
    E=face_energy_attribute_visualize_2,
    F=show_honeybee_walls_2,
    G=show_honeybee_roof_2,
    H=show_honeybee_floors_2,
    I=show_honeybee_ground_2,
    J=show_honeybee_windows_2,
    K=show_honeybee_doors_2,
    L=show_honeybee_context_2,
    M=weather_visualisation_wireframe_2,
    N=and_28)
filter_45 = StreamFilter(Gate=or_25, Stream0="Shaded", Stream1="Wireframe")
mod_viewport = ModifyViewport(DisplayMode=filter_45, AnimateRestore=False, RestoreFrames=10)

# ==== cluster Glare
run_glare_analysis = ClusterInput()
epw_file_url = ClusterInput()
viewport_name = ClusterInput()
epw_file_url_2 = ClusterInput()
month = ClusterInput()
day = ClusterInput()
hour = ClusterInput()
epw_file_url_3 = Data(epw_file_url)
run_glare_analysis_2 = Boolean(run_glare_analysis)
day_2 = Number(day)
hour_2 = Number(hour)
month_2 = Number(month)

# ---- group: Glare analysis
epw_file_url_4 = Data(epw_file_url_2)
viewport_name_2 = Data(viewport_name)
pt = ConstructPoint(XCoordinate=Slider(6, range=0..10), YCoordinate=Slider(5, range=0..10), ZCoordinate=Slider(2, range=0..10))
viewport = HBViewFromViewport(name=viewport_name_2, viewport=viewport_name_2, view_type=Slider(4, range=0..5))  # -> view; plug-in component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
pt_2 = ConstructPoint(XCoordinate=Slider(4, range=0..10), YCoordinate=Slider(4, range=0..10), ZCoordinate=Slider(1.6, range=0..10))
vec2pt = Vector2Pt(PointA=pt_2, PointB=pt, Unitize=False)  # -> Vector, Length
assigngridsviews = HBAssignGridsAndViews(model=epw_file_url_3, views=flatten(viewport))  # -> model; plug-in component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
view = HBView(position=pt_2, direction=vec2pt.Vector, view_type=Slider(4, range=0..5))  # -> view; plug-in component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
hoy = LBCalculateHOY(month=month_2, day=day_2, hour=hour_2)  # -> flatten(hoy), flatten(doy), flatten(date); plug-in component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

# ----
downloadepw = LBDownloadWeather(weather_URL=epw_file_url_4)  # -> epw_file, stat_file, ddy_file; plug-in component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

# ---- group: Glare analysis (continued)
importloc = LBImportLocation(epw_file=downloadepw.epw_file)  # -> location; plug-in component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
ciesky = HBCIEStandardSky(location=importloc, month=month_2, day=day_2, hour=hour_2, type=0)  # -> sky; plug-in component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
pitview = HBPointInTimeViewBased(model=assigngridsviews, sky=ciesky, run=run_glare_analysis_2)  # -> report, results; plug-in component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
glare = HBGlarePostprocess(hdr=pitview.results)  # -> DGP, category, glare_indices, check_hdr; plug-in component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
merge = Merge(Data1=hoy.date, Data2=glare.category, Data3=glare.DGP)
daylight_glare_probability_dgp = Data(glare.DGP)
join = TextJoin(Text=merge)
falsecolor = HBFalseColor(hdr=pitview.results, max=Slider(2300, range=0..10000), contour_lines=Toggle(True))  # -> hdr; plug-in component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
adjusthdr = HBAdjustHDR(hdr=pitview.results, adj_expos=Toggle(True), label=join)  # -> hdr; plug-in component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
hdr_image = Data(adjusthdr)
hdr_false_color_image = Data(falsecolor)

# ----
daylight_glare_probability_dgp_2 = ClusterOutput(daylight_glare_probability_dgp)
hdr_image_2 = ClusterOutput(hdr_image)
hdr_false_color_image_2 = ClusterOutput(hdr_false_color_image)

# ==== cluster DetailedEnergySimulations

# ---- group: Request specific outputs
toggle = BooleanToggle(True)
simoutput = HBSimulationOutput(zone_energy_use=toggle, gains_and_losses=toggle, comfort_metrics=toggle, surface_energy_flow=toggle)  # -> report, sim_output; plug-in component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
simpar = HBSimulationParameter(output=simoutput.sim_output, timestep=6)  # -> sim_par; plug-in component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

# ----
epw_file_url = ClusterInput()
honeybee_model = ClusterInput()
run_energy_simulation = ClusterInput()
honeybee_model_2 = Data(honeybee_model)
epw_file_url_2 = Data(epw_file_url)
downloadepw = LBDownloadWeather(weather_URL=epw_file_url_2)  # -> epw_file, stat_file, ddy_file; plug-in component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

# ---- group: Simulate
honeybee_model_3 = Data(honeybee_model_2)
run_energy_simulation_2 = Boolean(run_energy_simulation)
modeltoosm = HBModelToOSM(
    model=honeybee_model_3,
    epw_file=downloadepw.epw_file,
    sim_par=simpar,
    write=run_energy_simulation_2,
    run=run_energy_simulation_2)  # -> report, jsons, osw, osm, idf, sql, zsz, rdd, html; plug-in component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
eui = HBEndUseIntensity(sql=modeltoosm.sql)  # -> eui, eui_end_use, end_uses, gross_floor; plug-in component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
panel = Panel(eui.eui)
panel_2 = Panel(eui.end_uses)
panel_3 = Panel(eui.eui_end_use)

# ---- group: Peak loads
readhvac = HBReadHVACSizing(sql=modeltoosm.sql)  # -> zone_names, zone_peak_cool, zone_peak_heat, comp_types, comp_properties, comp_values; plug-in component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
readzsz = HBReadZoneSizing(zsz=modeltoosm.zsz)  # -> cooling_load, heating_load; plug-in component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
toggle_2 = BooleanToggle(True)
toggle_3 = BooleanToggle(True)
panel_4 = Panel([readhvac.zone_peak_heat, readhvac.zone_peak_cool])
monthlychart = LBMonthlyChart(data=readzsz.heating_load, x_dim=Slider(40, range=0..100), stack=toggle_2, time_marks=toggle_2)  # -> report, data_mesh, data_lines, col_lines, legend, borders, labels, y_title, title, vis_set; plug-in component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
monthlychart_2 = LBMonthlyChart(data=readzsz.cooling_load, x_dim=Slider(40, range=0..100), stack=toggle_3, time_marks=toggle_3)  # -> report, data_mesh, data_lines, col_lines, legend, borders, labels, y_title, title, vis_set; plug-in component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
heating_load_profile = Data(flatten([monthlychart.data_mesh, monthlychart.data_lines, monthlychart.col_lines, monthlychart.legend, monthlychart.borders, monthlychart.labels, monthlychart.y_title, monthlychart.title]))
cooling_load_profile = Data(flatten([monthlychart_2.data_mesh, monthlychart_2.data_lines, monthlychart_2.col_lines, monthlychart_2.legend, monthlychart_2.borders, monthlychart_2.labels, monthlychart_2.y_title, monthlychart_2.title]))
peak_heating = Data(readhvac.zone_peak_heat)

# ---- group: Load previous model
falsestart = LBFalseStartToggle(False)
item = ListItem(List=modeltoosm.jsons, Index=0, Wrap=True)
loadobjects = HBLoadObjects(hb_file=item, load=falsestart)  # -> report, hb_objs; plug-in component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

# ---- group: extract and visualise data
roomenergyresult = HBReadRoomEnergyResult(sql=modeltoosm.sql)  # -> cooling, heating, lighting, electric_equip, gas_equip, process, hot_water, fan_electric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; plug-in component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
merge = Merge(
    Data1=roomenergyresult.heating,
    Data2=roomenergyresult.cooling,
    Data3=roomenergyresult.lighting,
    Data4=roomenergyresult.electric_equip,
    Data5=roomenergyresult.hot_water,
    Data6=roomenergyresult.people_gain,
    Data7=roomenergyresult.solar_gain)
hourlyplot = LBHourlyPlot(data=merge)  # -> report, mesh, legend, borders, labels, title, vis_set; plug-in component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
xdata = LBDeconstructData(data=roomenergyresult.cooling)  # -> header, values; plug-in component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

# ----
energy_use_intensity = Data(eui.eui)
energy_use_intensity_per_end_use = Data(eui.eui_end_use)
end_uses = Data(eui.end_uses)
peak_cooling = Data(readhvac.zone_peak_cool)
data = Data(honeybee_model_2)
number_slider = Slider(50, range=0..100)

# ---- group: Energy balance
faceresult = HBReadFaceResult(sql=modeltoosm.sql)  # -> face_indoor_temp, face_outdoor_temp, face_energy_flow; plug-in component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
loadbalance = HBThermalLoadBalance(
    rooms_model=flatten(data),
    cooling=roomenergyresult.cooling,
    heating=roomenergyresult.heating,
    lighting=roomenergyresult.lighting,
    electric_equip=roomenergyresult.electric_equip,
    hot_water=roomenergyresult.hot_water,
    people_gain=roomenergyresult.people_gain,
    solar_gain=roomenergyresult.solar_gain,
    infiltration_load=roomenergyresult.infiltration_load,
    mech_vent_load=roomenergyresult.mech_vent_load,
    face_energy_flow=faceresult.face_energy_flow)  # -> report, balance, balance_stor, norm_bal, norm_bal_stor; plug-in component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
timeop = LBTimeIntervalOperation(data=loadbalance.norm_bal_stor)  # -> daily, monthly, mon_per_hr; plug-in component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
colrange = LBColorRange(index=Slider(19, range=0..100))  # -> colors; plug-in component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
neg = Negative(Value=number_slider)
legendpar = LBLegendParameters(min=neg, max=number_slider, colors=colrange)  # -> leg_par; plug-in component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
monthlychart_3 = LBMonthlyChart(data=timeop.monthly, stack=Toggle(True), legend_par=legendpar)  # -> report, data_mesh, data_lines, col_lines, legend, borders, labels, y_title, title, vis_set; plug-in component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

# ----
monthly_energy_balance = Data(flatten([monthlychart_3.data_mesh, monthlychart_3.data_lines, monthlychart_3.col_lines, monthlychart_3.legend, monthlychart_3.borders, monthlychart_3.labels, monthlychart_3.y_title, monthlychart_3.title]))
annual_hourly_energy_results = Data(flatten([hourlyplot.mesh, hourlyplot.legend, hourlyplot.borders, hourlyplot.labels, hourlyplot.title]))
energy_use_intensity_2 = ClusterOutput(energy_use_intensity)
energy_use_intensity_per_end_use_2 = ClusterOutput(energy_use_intensity_per_end_use)
end_uses_2 = ClusterOutput(end_uses)
annual_hourly_energy_results_2 = ClusterOutput(annual_hourly_energy_results)
monthly_energy_balance_2 = ClusterOutput(monthly_energy_balance)
peak_heating_2 = ClusterOutput(peak_heating)
heating_load_profile_2 = ClusterOutput(heating_load_profile)
cooling_load_profile_2 = ClusterOutput(cooling_load_profile)
peak_cooling_2 = ClusterOutput(peak_cooling)

# ==== cluster VisualiseProperties
number_of_decimals_room = ClusterInput()
face_attribute = ClusterInput()
honeybee_model = ClusterInput()
number_of_decimals_face = ClusterInput()
room_attribute = ClusterInput()
face_attribute_2 = Text(face_attribute)
honeybee_model_2 = Data(honeybee_model)
room_attribute_2 = Text(room_attribute)
number_of_decimals_face_2 = Number(number_of_decimals_face)
legendpar = LBLegendParameters(num_decimals=number_of_decimals_face_2)  # -> leg_par; plug-in component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
number_of_decimals_room_2 = Number(number_of_decimals_room)
legendpar_2 = LBLegendParameters(num_decimals=number_of_decimals_room_2)  # -> leg_par; plug-in component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
colorfaceattr = HBColorFaceAttributes(hb_objs=flatten(honeybee_model_2), attribute=face_attribute_2, legend_par=legendpar)  # -> mesh, legend, wire_frame, values, colors, vis_set; plug-in component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
colorroomattr = HBColorRoomAttributes(rooms_model=flatten(honeybee_model_2), attribute=room_attribute_2, legend_par=legendpar_2)  # -> mesh, legend, wire_frame, values, colors, vis_set; plug-in component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
visualised_face_attributes = Data([colorfaceattr.mesh, colorfaceattr.legend, colorfaceattr.wire_frame])
visualised_room_attributes = Data([colorroomattr.mesh, colorroomattr.legend, colorroomattr.wire_frame])
visualised_face_attributes_2 = ClusterOutput(visualised_face_attributes)
visualised_room_attributes_2 = ClusterOutput(visualised_room_attributes)

# ==== cluster AddDynamicShades
base_construction_set = ClusterInput()
setpoint = ClusterInput()
base_construction_set_2 = Data(base_construction_set)
decnstrconstrset = HBDeconstructConstructionSet(constr_set=base_construction_set_2)  # -> exterior_wall, exterior_roof, exposed_floor, ground_wall, ground_roof, ground_floor, window, skylight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; plug-in component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
setpoint_2 = Data(setpoint)
shademat = HBShadeMaterial(thickness=Slider(0.01, range=0..0.01), transmittance=Slider(0.4, range=0..1))  # -> mat; plug-in component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
windowconstrshd = HBWindowConstructionShade(
    name="Simple Glazing Window",
    win_constr=decnstrconstrset.window,
    shd_material=shademat,
    shd_location="Exterior",
    control_type=Slider(1, range=0..8),
    setpoint=setpoint_2)  # -> constr; plug-in component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
subfacesubset = HBSubfaceSubset(window=windowconstrshd, operable=windowconstrshd)  # -> subface_set; plug-in component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
constructionset = HBConstructionSet(base_constr_set=base_construction_set_2, subface_subset=subfacesubset)  # -> constr_set; plug-in component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
construction_set = Data(constructionset)
construction_set_2 = ClusterOutput(construction_set)

# ==== cluster Cluster
materials = ClusterInput()
materials_2 = Data(materials)
opaqueconstr = HBOpaqueConstruction(materials=materials_2)  # -> constr; plug-in component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
thicknesses = ClusterInput()
thicknesses_2 = Number(thicknesses)
decnstrconstr = HBDeconstructConstruction(constr=opaqueconstr)  # -> materials, layers, r_val_si, r_val_ip, u_fac_si, u_fac_ip, shgc, t_sol, t_vis; plug-in component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
nullrep = ReplaceNulls(Items=thicknesses_2, Replacements="0")  # -> Items, Count
construction_name = ClusterInput()
modify_layer_thicknesses = BrimstoneModifyThicknessesOfHoneybeeMaterials(hb_materials=decnstrconstr.materials, thicknesses=nullrep.Items)  # -> out, mod_materials; inputs hb_materials: list, thicknesses: list
# ---------- modify_layer_thicknesses: Python ----------
"""
Calculates embodied carbon for the elements of a Honeybee model if data is available
This component was inspired by the 'HB Color Face Attributes' component of Ladybug Tools 1.6.0

    Args:
        hb_materials: List of Honeybee materials which should get new thickness
        thicknesses: List of new material thicknesses

    Returns:
        mod_materials: Modified Honeybee materials
"""

import scriptcontext
#import brimstone

ghenv.Component.Message = ""#brimstone.globals.version

ghenv.Component.Name = 'Brimstone - Modify thicknesses of Honeybee materials'
ghenv.Component.NickName = 'Modify layer thicknesses'

try:  # import the core honeybee dependencies
    from honeybee_energy.material.opaque import EnergyMaterial
    from honeybee_energy.material.opaque import EnergyMaterialNoMass
except ImportError as e:
    raise ImportError('\nFailed to import honeybee:\n\t{}'.format(e))

def main(hb_materials, thicknesses):
    mod_materials = []
    assert len(hb_materials) == len(thicknesses), "Materials and thickness list must be of the same length"
    for (i, material) in enumerate(hb_materials):
        if not isinstance(material, EnergyMaterial):
            if isinstance(material, EnergyMaterialNoMass):
                mod_material = material.duplicate()
                mod_materials.append(mod_material)
            else:
                raise Exception("All materials must be valid Honeybee Energy Materials or Energy Materials (No Mass)")
        else: # if material is EnergyMaterial
            mod_material = material.duplicate()
            mod_material.thickness = thicknesses[i]
            mod_materials.append(mod_material)
    return mod_materials

if __name__ == "__main__":
    try:
        pass#flying = scriptcontext.sticky["brimstone_flying"]
    except:
        raise Exception("The 'Brimstone - Fly' component needs to exist on the canvas")
    mod_materials = main(hb_materials, thicknesses)
# ---------- end modify_layer_thicknesses ----------
construction_name_2 = Text(construction_name)
opaqueconstr_2 = HBOpaqueConstruction(name=construction_name_2, materials=modify_layer_thicknesses.mod_materials)  # -> constr; plug-in component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
error = Data(modify_layer_thicknesses.out)
error_2 = ClusterOutput(error)
construction = Data(opaqueconstr_2)
construction_2 = ClusterOutput(construction)

# ==== cluster Cluster_2
window_construction = ClusterInput()
window_construction_2 = Data(window_construction)
fly = BrimstoneFly()
# ---------- fly: Python ----------
"""This component sets up global information for Brimstone
    Inputs:
    Output:
        """

import Grasshopper
import sys
sys.path.append(Grasshopper.Folders.UserObjectFolders[0])

import brimstone
reload(brimstone)

import scriptcontext

ghenv.Component.Name = 'Brimstone - Fly!'
ghenv.Component.NickName = 'Fly!'

scriptcontext.sticky["brimstone_flying"] = 'true'
ghenv.Component.Message = brimstone.globals.version
# ---------- end fly ----------
subfacesubset = HBSubfaceSubset(window=window_construction_2)  # -> subface_set; plug-in component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
panel = Panel(subfacesubset)
constructionset = HBConstructionSet(subface_subset=subfacesubset)  # -> constr_set; plug-in component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
density_kg_m2 = ClusterInput()
gwp_a1_a3 = ClusterInput()
gwp_a4 = ClusterInput()
decnstrconstrset = HBDeconstructConstructionSet(constr_set=constructionset)  # -> exterior_wall, exterior_roof, exposed_floor, ground_wall, ground_roof, ground_floor, window, skylight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; plug-in component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
gwp_a1_a3_2 = Data(gwp_a1_a3)
gwp_a4_2 = Data(gwp_a4)
density_kg_m2_2 = Data(density_kg_m2)
add_life_cycle_info_construction = BrimstoneAddLifeCycleInfoToHoneybeeConstruction(hb_construction=decnstrconstrset.window, gwp_a1_a3=gwp_a1_a3_2, gwp_a4=gwp_a4_2, density=density_kg_m2_2)  # -> mod_construction
# ---------- add_life_cycle_info_construction: Python ----------
"""
Adds GWP info to a Honeybee Construction

    Args:
        hb_construction: Honeybee Construction to be updated
        gwp_a1_a3: GWP (A1-A3) [kg CO2eq/m2]
        gwp_a4: GWP (A4) [kg CO2eq/m2]
        gwp_a5_1: GWP (A5.1) [kg CO2eq/m2]

    Returns:
        mod_construction: Updated Honeybee Construction
"""

import scriptcontext
import brimstone
ghenv.Component.Message = brimstone.globals.version
import Grasshopper

ghenv.Component.Name = 'Brimstone - Add Life Cycle Info to Honeybee Construction'
ghenv.Component.NickName = 'Add Life Cycle Info (Construction)'

try:  # import the core honeybee dependencies
    from honeybee_energy.construction.window import WindowConstruction
    from honeybee_energy.construction.opaque import OpaqueConstruction
except ImportError as e:
    raise ImportError('\nFailed to import honeybee:\n\t{}'.format(e))

def main(hb_construction, gwp_a1_a3, gwp_a4, density):
    if not isinstance(hb_construction, WindowConstruction)\
        and not isinstance(hb_construction, OpaqueConstruction):
        raise Exception("Currently only Window and Opaque constructions are supported")
    mod_construction = hb_construction.duplicate()
    mod_construction.properties.gwp_a1_a3 = gwp_a1_a3
    mod_construction.properties.gwp_a4 = gwp_a4
    mod_construction.properties.conv_value = density
    return mod_construction

if __name__ == "__main__":
    try:
        flying = scriptcontext.sticky["brimstone_flying"]
    except:
        raise Exception("The 'Brimstone - Fly' component needs to exist on the canvas")
    mod_construction = main(hb_construction, gwp_a1_a3, gwp_a4, density)
# ---------- end add_life_cycle_info_construction ----------
panel_2 = Panel(decnstrconstrset.window)
updated_construction = Data(add_life_cycle_info_construction)
panel_3 = Panel(add_life_cycle_info_construction)
updated_construction_2 = ClusterOutput(updated_construction)

# ==== cluster WeatherVisualisation
target_geometry = ClusterInput()
run_direct_sun_hours_study = ClusterInput()
_1 = ClusterInput()
run_incident_radiation_study = ClusterInput()
run_weather_visualisation = ClusterInput()
target_geometry_2 = ClusterInput()
sky_mask_centre_point = ClusterInput()
run_weather_visualisation_2 = Boolean(run_weather_visualisation)
filter = StreamFilter(Gate=run_weather_visualisation_2, Stream1=_1)
epw_file_url = Data(filter)

# ---- group: Get weather data
downloadepw = LBDownloadWeather(weather_URL=epw_file_url)  # -> epw_file, stat_file, ddy_file; plug-in component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
falsestart = LBFalseStartToggle(False)
epwtoddy = LBEPWToDDY(weather_file=downloadepw.epw_file, write=falsestart)  # -> ddy_file; plug-in component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
importloc = LBImportLocation(epw_file=downloadepw.epw_file)  # -> location; plug-in component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
importstat = LBImportSTAT(stat_file=downloadepw.stat_file)  # -> location, ashrae_zone, koppen_zone, clear_dir_norm_rad, clear_diff_horiz_rad, ann_heat_dday_996, ann_heat_dday_990, ann_cool_dday_004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; plug-in component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
constrloc = LBConstructLocation(elevation=0)  # -> location; plug-in component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
importepw = LBImportEPW(epw_file=downloadepw.epw_file)  # -> location, dry_bulb_temperature, dew_point_temperature, relative_humidity, wind_speed, wind_direction, direct_normal_rad, diffuse_horizontal_rad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; plug-in component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
importddy = LBImportDDY(ddy_file=downloadepw.ddy_file)  # -> location, design_days; plug-in component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

# ----
panel = Panel(importloc)

# ---- group: Wind rose
analysisperiod = LBAnalysisPeriod(
    start_month=Slider(1, range=1..12),
    start_day=Slider(1, range=1..31),
    start_hour=Slider(0, range=0..23),
    end_month=Slider(12, range=1..12),
    end_day=Slider(31, range=1..31),
    end_hour=Slider(23, range=0..23))  # -> period, hoys, dates; plug-in component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
windrose = LBWindRose(data=importepw.wind_speed, wind_direction=importepw.wind_direction, show_calm=Toggle(True), period=analysisperiod.period)  # -> report, mesh, compass, orient_line, freq_line, windrose_line, legend, title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; plug-in component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

# ---- group: Sun path
analysisperiod_2 = LBAnalysisPeriod(
    start_month=Slider(1, range=1..12),
    start_day=Slider(1, range=1..31),
    start_hour=Slider(0, range=0..23),
    end_month=Slider(12, range=1..12),
    end_day=Slider(31, range=1..31),
    end_hour=Slider(23, range=0..23))  # -> period, hoys, dates; plug-in component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
panel_2 = Panel("a>24")
sunpath = LBSunPath(location=importloc, hoys=analysisperiod_2.hoys, scale=1, data=importepw.dry_bulb_temperature)  # -> report, vectors, altitudes, azimuths, hoys, sun_pts, analemma, daily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; plug-in component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
msphere = MeshSphere(Base=sunpath.sun_pts, Radius=Slider(3, range=0..10), UCount=10, VCount=20)

# ---- group: Graph data
timeop = LBTimeIntervalOperation(data=importepw.dry_bulb_temperature)  # -> daily, monthly, mon_per_hr; plug-in component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
legendpar = LBLegendParameters(
    min=Slider(-15, range=-15..30),
    max=Slider(25, range=0..100),
    num_decimals=Slider(0, range=0..100),
    larger_smaller=Toggle(True),
    vert_or_horiz=Toggle(False))  # -> leg_par; plug-in component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
monthlychart = LBMonthlyChart(data=timeop.daily)  # -> report, data_mesh, data_lines, col_lines, legend, borders, labels, y_title, title, vis_set; plug-in component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
hourlyplot = LBHourlyPlot(data=importepw.dry_bulb_temperature, z_dim=Slider(0, range=0..100), reverse_y=Toggle(True), legend_par=legendpar)  # -> report, mesh, legend, borders, labels, title, vis_set; plug-in component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

# ----
run_incident_radiation_study_2 = Boolean(run_incident_radiation_study)

# ---- group: Sky matrix and incident radiation
analysisperiod_3 = LBAnalysisPeriod(
    start_month=Slider(1, range=1..12),
    start_day=Slider(1, range=1..31),
    start_hour=Slider(0, range=0..23),
    end_month=Slider(12, range=1..12),
    end_day=Slider(31, range=1..31),
    end_hour=Slider(23, range=0..23))  # -> period, hoys, dates; plug-in component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
skymatrix = LBCumulativeSkyMatrix(
    location=importepw.location,
    direct_rad=importepw.direct_normal_rad,
    diffuse_rad=importepw.diffuse_horizontal_rad,
    hoys=analysisperiod_3.hoys,
    high_density=Toggle(False))  # -> report, sky_mtx; plug-in component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
context_geometry = Geometry(target_geometry)
target_geometry_3 = Geometry(target_geometry_2)
incidentradiation = LBIncidentRadiation(
    sky_mtx=skymatrix.sky_mtx,
    geometry=flatten(target_geometry_3),
    context=flatten(context_geometry),
    grid_size=Slider(1, range=0..1),
    offset_dist=Slider(0.1, range=0..0.1),
    run=run_incident_radiation_study_2)  # -> report, points, results, total, mesh, legend, title, int_mtx; plug-in component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
skydome = LBSkyDome(sky_mtx=skymatrix.sky_mtx)  # -> report, mesh, compass, legend, title, patch_vecs, patch_values, mesh_values, vis_set; plug-in component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

# ----
merge = Merge(
    Data1=windrose.mesh,
    Data2=windrose.compass,
    Data3=windrose.orient_line,
    Data4=windrose.freq_line,
    Data5=windrose.windrose_line,
    Data6=windrose.legend,
    Data7=windrose.title)
run_direct_sun_hours_study_2 = Boolean(run_direct_sun_hours_study)

# ---- group: Direct sun hours
toggle = BooleanToggle(True)
target_geometry_4 = Geometry(target_geometry_2)
context_geometry_2 = Geometry(target_geometry)
directsunhours = LBDirectSunHours(
    vectors=flatten(sunpath.vectors),
    geometry=flatten(target_geometry_4),
    context=flatten(context_geometry_2),
    grid_size=Slider(1, range=0..10),
    offset_dist=Slider(0.1, range=0..1),
    run=run_direct_sun_hours_study_2)  # -> report, points, results, mesh, legend, title, int_mtx; plug-in component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

# ---- group: Sky mask
sky_mask_centre_point_2 = Point(sky_mask_centre_point)
symask = LBSkyMask(
    context=context_geometry_2,
    density=Slider(3, range=0..10),
    center=sky_mask_centre_point_2,
    scale=Slider(0.1, range=0..1))  # -> report, context_mask, orient_mask, strategy_mask, sky_mask, context_view, orient_view, strategy_view, sky_view; plug-in component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

# ----
merge_2 = Merge(Data1=skydome.mesh, Data2=skydome.compass, Data3=skydome.legend, Data4=skydome.title)  # -> flatten(SkyDome)
merge_3 = Merge(
    Data1=monthlychart.data_mesh,
    Data2=monthlychart.legend,
    Data3=monthlychart.borders,
    Data4=monthlychart.labels,
    Data5=monthlychart.y_title,
    Data6=monthlychart.title)  # -> flatten(DryBulbTemperatureLineChart)
merge_4 = Merge(Data1=incidentradiation.mesh, Data2=incidentradiation.legend, Data3=incidentradiation.title)  # -> flatten(IncidentRadiation)
merge_5 = Merge(
    Data1=hourlyplot.mesh,
    Data2=hourlyplot.legend,
    Data3=hourlyplot.borders,
    Data4=hourlyplot.labels,
    Data5=hourlyplot.title)
sky_dome = ClusterOutput(merge_2)
wind_rose = ClusterOutput(merge)
dry_bulb_temperature_line_chart = ClusterOutput(merge_3)
dry_bulb_temperature_2d_chart = ClusterOutput(merge_5)
direct_sun_hours = Merge(Data1=directsunhours.mesh, Data2=directsunhours.legend, Data3=directsunhours.title)  # -> flatten(DirectSunHours)
direct_sun_hours_2 = ClusterOutput(direct_sun_hours)
incident_radiation = ClusterOutput(merge_4)
merge_6 = Merge(Data1=symask.context_mask, Data2=symask.sky_mask)
sky_mask = ClusterOutput(merge_6)

# ==== cluster Cluster_3
min = ClusterInput()
max = ClusterInput()
colors = ClusterInput()
legendpar = LBLegendParameters(min=min, max=max, colors=colors)  # -> leg_par; plug-in component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
leg_par = ClusterOutput(legendpar)

# ==== cluster Cluster_4
int = ClusterInput()
number_slider = Slider(2, range=0..10)
int_2 = Integer(int)
fragment = TextFragment(Text=int_2, Start="0", Count=number_slider)
fragment_2 = TextFragment(Text=int_2, Start=number_slider)
len = TextLength(Text=fragment_2)
addition = Addition(A=fragment, B="1")
equals = Equality(FirstNumber="0", SecondNumber=fragment)  # -> Equality, Inequality
filter = StreamFilter(Gate=equals.Equality, Stream0=addition, Stream1=fragment)
_10º = PowerOf10(Value=len)
multiplication = Multiplication(A=_10º, B=filter)
R = ClusterOutput(multiplication)

# ==== cluster Cluster_5
x = ClusterInput()
abs = Absolute(Value=x)
number_slider = Slider(2, range=0..10)
int = Integer(abs)
fragment = TextFragment(Text=int, Start="0", Count=number_slider)
fragment_2 = TextFragment(Text=int, Start=number_slider)
equals = Equality(FirstNumber="0", SecondNumber=fragment)  # -> Equality, Inequality
len = TextLength(Text=fragment_2)
addition = Addition(A=fragment, B="1")
filter = StreamFilter(Gate=equals.Equality, Stream0=addition, Stream1=fragment)
_10º = PowerOf10(Value=len)
multiplication = Multiplication(A=_10º, B=filter)
neg = Negative(Value=multiplication)
y = ClusterOutput(neg)

# ==== cluster Cluster_6
legendpar = LBLegendParameters(min=Slider(0, range=0..100), max=Slider(100, range=0..100), num_decimals=Slider(0, range=0..100))  # -> leg_par; plug-in component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
leg_par = ClusterOutput(legendpar)

# ==== cluster Cluster_7
list = ValueList({"Swedish": "sv", "English": "en"}, selected="English")
# Get Klimatdatabas data
list_2 = ValueList({"File": "file", "API": "api"}, selected="API")
honeybee_model = ClusterInput()
get_categories = BrimstoneGetCategories(mode=list_2, language=list)  # -> out, json_data, categories, klimatdatabas_version
# ---------- get_categories: Python ----------
"""Gets Klimatdatabas from the Boverket API or a file, extracts json data, and resource category names
    Inputs:
        mode: api or file mode
        language: language of database to retrieve
        json_path: path to json file if file mode
    Output:
        json_data: json file as dictionary
        categories: Categories present in the database
        klimatdatabas_version: String representing the version of Klimatdatabas used"""

import scriptcontext
import brimstone
import Grasshopper
import os, io

ghenv.Component.Name = 'Brimstone - Get Categories'
ghenv.Component.NickName = 'Get Categories'
ver = brimstone.globals.version
ghenv.Component.Message = ver

import json

from System.Net import WebRequest
from System.IO import StreamReader
from System.Text import Encoding

def main(mode):    
    if mode == "file":
        json_file = brimstone.globals.kdb_json_path
        json_path = os.path.join(Grasshopper.Folders.UserObjectFolders[0], json_file)
        if not os.path.exists(json_path):
            raise Exception("Failed to open json file, it should reside in [UserComponents folder]/brimstone_data/")
        json_data = get_json_data_from_file(json_path)
    elif mode == "api":
        json_data = get_json_data_from_api()
    else:
        raise Exception("Mode {mode} not supported".format(mode = mode))
    
    categories = get_categories(json_data)
    version = json_data.get("Version") 
    
    return categories, json_data, version

def get_json_data_from_file(json_path):
    f = io.open(json_path, encoding='utf-8')
    json_data = json.load(f)
    return json_data
    
def get_json_data_from_api():
    version = "02.04.000"
    lng = language if language else "en"
    format = "json"

    url = "https://api.boverket.se/klimatdatabas/v2/get-all-resources/{version}/{language}/{format}".format(
        version=version, language=lng, format=format)
    
    request = WebRequest.Create(url)
    
    request.Method = "GET"
    request.Timeout = 5000
    #request.ContentType = "application/json"
    response = request.GetResponse()
    
    stream_reader = StreamReader(response.GetResponseStream())
    json_data = json.loads(stream_reader.ReadToEnd())
    return json_data
    
def get_categories(json_data):
    categories = []
    try:
        for metaCategory in json_data['Categories']:
            for cat in metaCategory["Children"]:
                categories.append(cat["Title"])
    except KeyError:
        raise Exception("Format of JSON data is not supported.")
    return categories

if __name__ == "__main__":
    if not scriptcontext.sticky["brimstone_flying"]:
        raise Exception("The 'Brimstone - Fly' component needs to exist on the canvas")
    categories, json_data, klimatdatabas_version = main(mode)
    json_data = [json_data] # need to put it in an array so GH understands it as a dictionary
# ---------- end get_categories ----------
energy_use_intensity_kwh_m2 = ClusterInput()
area_m2 = ClusterInput()
honeybee_model_2 = Data(honeybee_model)
panel = Panel(get_categories.klimatdatabas_version)
list_3 = ItemSelector(
    get_categories.categories,
    {"Mineral materials", "Windows, doors and glass", "Paints and sealants", "Concrete", "Insulation", "Steel and other metals", "Blocks and tiles", "Building boards", "Waterproofing", "Solid woods", "Energy and fuel"}, selected="Mineral materials")
calculate_honeybee_model = BrimstoneCalculateEmbodiedCarbonOfHoneybeeModel(hb_model=honeybee_model_2, kdb_json_data=get_categories.json_data)  # -> tot_emb_carbon, elements, el_emb_carbon
# ---------- calculate_honeybee_model: Python ----------
"""
Calculates embodied carbon for the elements of a Honeybee model if data is available
This component was inspired by the 'HB Color Face Attributes' component of Ladybug Tools 1.6.0

    Args:
        hb_model: Honeybee model for analysis
        kdb_json_data: Optional json data object for materials which do not include impact data

    Returns:
        tot_emb_carbon: total embodied carbon of model
        elements: element types in the model
        el_emb_carbon: embodied carbon for each element type in the model
"""

import scriptcontext
import brimstone
ghenv.Component.Message = brimstone.globals.version
import Grasshopper
import os
import csv, codecs

ghenv.Component.Name = 'Brimstone - Calculate Embodied Carbon of Honeybee Model'
ghenv.Component.NickName = 'Calculate Honeybee Model'

try:  # import the core honeybee dependencies
    from honeybee.model import Model
    from honeybee.properties import FaceProperties
    from honeybee.typing import clean_ep_string
except ImportError as e:
    raise ImportError('\nFailed to import honeybee:\n\t{}'.format(e))
    

# todo: magic string here - not good!
gwp_data_string = "Global Warming potential"
gwp_data_points = [
    "A1-A3 Conservative",
    "A4",
    "A5.1",
]

def main(hb_model):
    tot_emb_carbon = 0
    elements = []
    el_emb_carbon = []
    if not isinstance(hb_model, Model):
        raise Exception("hb_model input must be a valid honeybee model")
    faces = []
    apertures = []
    model_mats = []
    face_types = {}
    
    energy_properties = hb_model.properties.energy
    
    for material in energy_properties.materials:
        model_mats.append(material)
    for room in hb_model.rooms:
        faces.extend(room.faces)
        faces.extend(room.shades)
    faces.extend(hb_model.orphaned_faces)
    faces.extend(hb_model.orphaned_apertures)
    faces.extend(hb_model.orphaned_doors)
    faces.extend(hb_model.orphaned_shades)
    
    for face_obj in faces:
        if isinstance(face_obj.properties, FaceProperties):
            face_area = face_obj.area - face_obj.aperture_area
            face_type = face_obj.type
            
            face_impact = 0
            for lyr in face_obj.properties.energy.construction.layers:
                face_impact += get_face_impact(model_mats, lyr, face_area)
                """
                if lyr not in model_mats:
                    model_mats[lyr] = { area: face_area }
                else:
                    model_mats[lyr].area = model_mats[lyr].area + face_area
                """
                       
            if face_type not in face_types:
                face_types[face_type] = { "impact": face_impact }
            else:
                face_types[face_type]["impact"] += face_impact
                
            
            for aperture in face_obj.apertures:
                aperture_impact = get_aperture_impact(aperture)
                if "Aperture" not in face_types:
                    face_types["Aperture"] = { "impact": aperture_impact }
                else:
                    face_types["Aperture"]["impact"] += aperture_impact
    for face_type in face_types.items():
        face_impact = face_type[1]["impact"]
        tot_emb_carbon += face_impact
        elements.append(face_type[0])
        el_emb_carbon.append(face_impact)
    return tot_emb_carbon, elements, el_emb_carbon

def get_face_impact(materials, layer_name, face_area):
    for material in materials:
        if material.identifier == layer_name:
            abs_impact = 0
            gwp_data_keys = ["gwp_a1_a3", "gwp_a4", "gwp_a5_1"]
            if material.user_data and all(key in material.user_data.keys() for key in gwp_data_keys):
                impact = sum(float(material.user_data[key]) for key in gwp_data_keys)
                abs_impact = material.density*impact
            else:
                abs_impact = get_face_impact_from_material_name(material.identifier)
            return material.thickness*abs_impact*face_area
    brimstone.utils.warn(ghenv, "The calculation may be faulty as material " + layer_name + " was not found among the energy materials in the model.")
    return 0

# Gets material impact data from a honeybee material by referencing names in .csv file
def get_face_impact_from_material_name(material_name):
    csv_data_file = brimstone.globals.hb_kdb_csv_path
    csv_data_file_path = os.path.join(Grasshopper.Folders.UserObjectFolders[0], csv_data_file)
    if not os.path.exists(csv_data_file_path):
        raise Exception("Failed to open csv file, it should reside in [UserComponents folder]/brimstone_data/")
    kdb_name = check_name_in_kdb(material_name)
    if not kdb_name:
        with open(csv_data_file_path, 'r') as csv_file:
            file_reader = csv.DictReader(csv_file, delimiter=",")
            for row in file_reader:
                if row["HB Name"] == material_name:
                    kdb_name = clean_ep_string(row["Klimatdatabas name"])
                    if not kdb_name or kdb_name == "missing":
                        brimstone.utils.warn(ghenv, "The calculation may be faulty as impact data is missing for some of the materials in the model: " + material_name)
                        return 0
                    break
    if not kdb_name:
        brimstone.utils.warn(ghenv, "The calculation may be faulty as material " + material_name + " could not be matched to any material in the brimstone material database.")
        return 0
    
    return get_impact_from_json_data(kdb_name)

def check_name_in_kdb(material_name):
    if not kdb_json_data:
        brimstone.utils.warn(ghenv, "The calculation may be faulty as kdb_json_data is missing")
    else: 
        for resource in kdb_json_data["Resources"]:
            if clean_ep_string(resource["Name"]) == material_name:
                return material_name
    return ""
    
# TODO: currently only works for KDB windows
def get_aperture_impact(aperture):
    if hasattr(aperture.properties.energy.construction.properties, "conv_value"):
        c = aperture.properties.energy.construction
        return (float(c.properties.gwp_a1_a3) + float(c.properties.gwp_a4))\
            * float(c.properties.conv_value) * aperture.area
    if not len(aperture.properties.energy.construction.layers) == 1:
        brimstone.utils.warn(ghenv, "The calculation may be faulty as only one layer window constructions can be calculated.")
        return 0
    
    window_material = aperture.properties.energy.construction.layers[0]
    return get_impact_from_json_data(window_material)*aperture.area

def get_impact_from_json_data(kdb_name):
    if not kdb_json_data:
        brimstone.utils.warn(ghenv, "The calculation may be faulty as kdb_json_data is missing")
        return 0
    for resource in kdb_json_data["Resources"]:
        if clean_ep_string(resource["Name"]) == kdb_name:
            conv = resource["Conversions"][0]["Value"]
            
            for data_item in resource["DataItems"]:
                if data_item["PropertyName"] == gwp_data_string:
                    abs_impact = 0
                    for data_pt in gwp_data_points:
                        for data_val_item in data_item["DataValueItems"]:
                            if data_val_item["DataModuleCode"] == data_pt:
                                abs_impact += data_val_item["Value"]
                    return abs_impact*conv
            brimstone.utils.warn(ghenv, "The calculation may be faulty as material " + kdb_name + " has no GWP data in kdb_json_data")
            return 0
    brimstone.utils.warn(ghenv, "The calculation may be faulty as material " + kdb_name + " was not found in kdb_json_data")
    return 0

if __name__ == "__main__":
    try:
        flying = scriptcontext.sticky["brimstone_flying"]
    except:
        raise Exception("The 'Brimstone - Fly' component needs to exist on the canvas")
    tot_emb_carbon, elements, el_emb_carbon = main(hb_model)
# ---------- end calculate_honeybee_model ----------
get_resources = BrimstoneGetResources(json_data=get_categories.json_data, category="Energy and fuel")  # -> out, json_data, resources
# ---------- get_resources: Python ----------
"""Extracts resource names from a Klimatdatabas json object
    Inputs:
        json_data: dictionary with json data
        category: readable name of category to extract resources from
    Output:
        resources: List of resources in category"""

import scriptcontext

import brimstone
ghenv.Component.Message = brimstone.globals.version

ghenv.Component.Name = 'Brimstone - Get Resources'
ghenv.Component.NickName = 'Get Resources'

def main(json_data, category):
    resources = get_resources(json_data, category)
    return resources
    
def get_resources(json_data, category):
    pred = lambda v: v["Text"] == category
    resources = []
    for resource in json_data["Resources"]:
        if len(filter(pred, resource["Categories"])) > 0:
            resources.append(resource["Name"])
    return resources

if __name__ == "__main__":
    if not scriptcontext.sticky["brimstone_flying"]:
        raise Exception("The 'Brimstone - Fly' component needs to exist on the canvas")
    print json_data
    resources = main(json_data, category)
    
    json_data = [json_data]
# ---------- end get_resources ----------
total_gwp = Data(calculate_honeybee_model.tot_emb_carbon)
element_types = Data(calculate_honeybee_model.el_emb_carbon)
gwp_by_element_type = Data(calculate_honeybee_model.elements)
list_4 = ItemSelector(
    get_resources.resources,
    {"Electricity, Swedish mix", "Diesel, reduction obligation  (2021)": "Diesel, reduction obligation (2021)", "Diesel, fossil", "Petrol, reduction obligation  (2021)": "Petrol, reduction obligation (2021)", "Petrol, 100% fossil", "District heating, Swedish average", "HVO100", "Gasol", "Wood pellets", "E85 ethanol", "Biogas", "Fuel oil 1", "Fuel oil 2-5", "FAME100", "ED95"}, selected="Electricity, Swedish mix")
gwp_by_element_type_2 = ClusterOutput(gwp_by_element_type)
element_types_2 = ClusterOutput(element_types)
total_gwp_2 = ClusterOutput(total_gwp)
area_m2_2 = Data(area_m2)
energy_use_intensity_kwh_m2_2 = Data(energy_use_intensity_kwh_m2)
get_lca_data = BrimstoneGetLCAData(json_data=get_resources.json_data, resources="District heating, Swedish average")  # -> out, json_data, lca_data, indicators, values; inputs resources: list, addtl_indicators: list
#   port json_data: List of resources in category
# ---------- get_lca_data: Python ----------
"""Extracts LCA indicators and values from a Klimatdatabas json for a specific resource
    Inputs:
        json_data: dictionary with json data
        resources: list of readable names of resources
        addtl_indicators: list of additional keys to retrieve from resource
    Output:
        lca_data: list of dictionaries with LCA data for each resource
        indicators: list of indicators
        values: list of indicator values"""

import scriptcontext
import ghpythonlib.treehelpers as th
from collections import OrderedDict
import copy

import brimstone
ghenv.Component.Message = brimstone.globals.version

ghenv.Component.Name = 'Brimstone - Get LCA Data'
ghenv.Component.NickName = 'Get LCA Data'

# todo: magic string here - not good!
gwp_data_string = "Global Warming potential"

# keys: names in output dict, values: DataModuleCode in json db
gwp_data_entries = {
    "GWPA1A3Conservative": "A1-A3 Conservative",
    "GWPA1A3Typical": "A1-A3 Typical",
    "GWPA4": "A4",
    "GWPA5.1": "A5.1",
}

def main(json_data, resource, addtl_indicators):
    lca_data, indicators, values = [], [], []

    for i, resource in enumerate(resources):
        lca_data.append(get_lca_data(json_data, resource, addtl_indicators))
        resource_indicators, resource_values = get_indicator_values(lca_data[i], addtl_indicators)
        indicators.append(resource_indicators)
        values.append(resource_values)
    return lca_data, indicators, values
    
def get_lca_data(json_data, resource_name, addtl_indicators):
    resource_data = copy.deepcopy(
        find_obj_in_array(
            json_data["Resources"],
            "Name",
            resource_name
        )
    )
    
    if not resource_data:
        raise Exception(
            "Resource with name {resource_name} was not found in database."
            .format(resource_name = resource_name)
       )
    try:
        lca_data = extract_lca_data(resource_data, addtl_indicators)
    except KeyError:
        raise Exception("Format of JSON data is not supported.")
    return lca_data

def extract_lca_data(resource_data, addtl_indicators):
    lca_data = OrderedDict()
    resource_name = resource_data["Name"]
    
    lca_data["Name"] = resource_name
    
    if "Conversions" in resource_data:
        # can a resource have multiple conversions?
        lca_data["ConversionUnit"] = resource_data["Conversions"][0]["Unit"]
        lca_data["ConversionValue"] = resource_data["Conversions"][0]["Value"]
    
    if "InventoryUnit" in resource_data:
        lca_data["InventoryUnit"] = resource_data["InventoryUnit"]
    
    for data_prop in resource_data["DataItems"]:
        if data_prop["PropertyName"] == gwp_data_string:
            gwp_data = copy.deepcopy(data_prop)
            break
            
    if not gwp_data:
        raise Exception("GWP data not found for {resource_name}"
            .format(resource_name = resource_name))
    
    lca_data["GWPUnit"] = gwp_data["PropertyUnitCode"]
    for key in gwp_data_entries:
        value = find_obj_in_array(
            gwp_data["DataValueItems"],
            "DataModuleCode",
            gwp_data_entries[key]
        )
        if value is not None:
            lca_data[key] = value["Value"]
            
    for addtl_indicator in addtl_indicators:
        if addtl_indicator in resource_data:
            lca_data[addtl_indicator] = resource_data[addtl_indicator]
    
    return lca_data

def find_obj_in_array(array, key, value):
    return next((x for x in array if x[key] == value), None)

def get_indicator_values(lca_data, addtl_indicators):
    indicator_dict = OrderedDict([
        ("Name", "Name"),
        ("InventoryUnit", "Inventory unit"),
        ("ConversionUnit", "Conversion unit"),
        ("ConversionValue", "Conversion value"),
        ("GWPUnit", "GWP unit"),
        ("GWPA1A3Conservative", "GWP (A1-A3 Conservative)"),
        ("GWPA1A3Typical", "GWP (A1-A3 Typical)"),
        ("GWPA4", "GWP (A4)"),
        ("GWPA5.1", "GWP (A5.1)"),
    ])
    
    for addtl_indicator in addtl_indicators:
        indicator_dict[addtl_indicator] = addtl_indicator
    
    indicators, values = [], []
    
    for key, indicator_name in indicator_dict.items():
        indicator_value = lca_data[key] if key in lca_data else None
        if indicator_value:
            indicators.append(indicator_name)
            values.append(indicator_value)
    
    return indicators, values

if __name__ == "__main__":
    if not scriptcontext.sticky["brimstone_flying"]:
        raise Exception("The 'Brimstone - Fly' component needs to exist on the canvas")
    lca_data, indicators, values = main(json_data, resources, addtl_indicators)
    
    lca_data_treeable = []
    
    for resource_lca_data in lca_data:
        lca_data_treeable.append([resource_lca_data.keys(), resource_lca_data.values()])
    lca_data = th.list_to_tree(lca_data_treeable)
    indicators = th.list_to_tree(indicators)
    values = th.list_to_tree(values)
    json_data = [json_data]
# ---------- end get_lca_data ----------

# ----
# Calculate operational emissions
list_5 = ValueList({"Conservative": "conservative", "Typical": "typical"}, selected="Conservative")
calculate_operational_emissions = BrimstoneCalculateOperationalEmissions(lca_data=get_lca_data.lca_data, eui=energy_use_intensity_kwh_m2_2, area=area_m2_2, mode=list_5)  # -> out, gwp_total; inputs lca_data: tree
# ---------- calculate_operational_emissions: Python ----------
"""Calculates operational emissions based on energy resource, EUI and floor area
    Inputs:
        lca_data: tree containing GWP information for the selected resource
        eui: energy use intensity of building in kWh/m2
        gfa: gross floor area of building
        mode: mode of GWP calculation ("typical" or "conservative")
        
    Output:
        gwp_total: total GWP for the selected space"""

import scriptcontext
import brimstone
reload(brimstone)
ghenv.Component.Message = brimstone.globals.version

ghenv.Component.Name = 'Brimstone - Calculate Operational Emissions'
ghenv.Component.NickName = 'Calculate Operational Emissions'

import rhinoscriptsyntax as rs
import ghpythonlib.treehelpers as th

from collections import OrderedDict

inv_unit_string = 'kWh'
gwp_unit_string = 'kg CO2 eq./kWh' # GWP

def main(lca_data, eui, area, mode):
    if not lca_data.BranchCount:
        brimstone.utils.warn(ghenv, "LCA data is missing")
        return
    if eui != 0 and not eui:
        brimstone.utils.warn(ghenv, "EUI is missing")
        return
    if area != 0 and not area:
        brimstone.utils.warn(ghenv, "Area is missing")
        return
    
    lca_data = th.tree_to_list(lca_data)
    lca_data = [OrderedDict(zip(l[0], l[1])) for l in lca_data]
    gwp_total =  []
    
    for resource_lca_data in lca_data:
        try:
            gwp_total.append(calculate_gwp_total(resource_lca_data, eui, area, mode))
        except KeyError as e:
            raise Exception("GWP value could not be calculated: {error}".format(error = e))
    
    return gwp_total
    
def calculate_gwp_total(lca_data, eui, area, mode):    
    inv_unit = lca_data["InventoryUnit"]
    
    if inv_unit != inv_unit_string:
        raise Exception("Wrong unit for calculation of operational energy")    
    
    gwp_unit = lca_data["GWPUnit"]
    if gwp_unit != gwp_unit_string:
        raise Exception("Wrong unit for GWP calculation")
    
    if mode == "conservative":
        gwp_a1_a3_str = "GWPA1A3Conservative"
    elif mode == "typical":
        gwp_a1_a3_str = "GWPA1A3Typical"
    else:
        raise Exception("Mode not recognised (must be conservative or typical)")
    
    gwp_impact = (
        float(lca_data[gwp_a1_a3_str])
    )
    
    gwp_total = (
        float(lca_data[gwp_a1_a3_str])
    ) * area * eui
        
    return gwp_total

if __name__ == "__main__":
    if not scriptcontext.sticky["brimstone_flying"]:
        raise Exception("The 'Brimstone - Fly' component needs to exist on the canvas")   
    gwp_total = main(lca_data, eui, area, mode)
    gwp_total = th.list_to_tree(gwp_total)
# ---------- end calculate_operational_emissions ----------

operational_gwp_total_kg_co2eq_year = Data(calculate_operational_emissions.gwp_total)
operational_gwp_total_kg_co2eq_year_2 = ClusterOutput(operational_gwp_total_kg_co2eq_year)
