# Grasshopper definition heathUI_0.5.1-dev.gh (Grasshopper 1.0.8)
# plug-ins: RhinoCodePluginGH, Heteroptera, treesloth01, Human UI, Pufferfish, Human, LadybugGrasshopper, MetaHopper, eleFront, Wombat, Telepathy

# ----
# Click here
button = Button()
restart_heath = RemoteSender(button)

# ----
# Sends signal when recompute
panel = Panel("recompute")
button_2 = CreateButton(ButtonName=panel, ButtonStyle=0)
values = ValueListener(Elements=button_2, SomeProperty=True)  # -> Values, Indices
freeze_gate = StreamFreezeGate(Data=values.Values, PassingSwitch=invert(values.Values))
bool = Boolean(invert(freeze_gate))
tap = TapBuffer(Reset=False, Incremental=True, Valve=bool, Hold=True)
dam = DataDam(DataA=tap, BufferDelay=2500000, BufferMode=2)
equals = Equality(FirstNumber=tap, SecondNumber=dam)  # -> Equality, Inequality
event = EventGate(Data=equals.Inequality)  # -> Data, IsNew
recompute = RemoteSender(event.Data)

checklist = CreateChecklist(Selected=invert(False))
values_2 = ValueListener(Elements=checklist, SomeProperty=True)  # -> Values, Indices

# ----
# CLICK BUTTON
# TO RESTART
# HEATH
number_slider = Slider(500, range=0..1000)
selobj = GetSelectedObjects()  # -> ComponentObjects, ParamObjects, OtherObjects
# Color codes
# UI module elements
# UI launch windows
# Front-end database
# Back-end database
setscribble = SetScribbleProperties(Scribble=selobj.OtherObjects, ScribbleSize=number_slider)

pulldown = CreatePulldownMenu(Label="Select model", showLabel=True)
tb = CreateTextBlock(TextSize=12, Justification=0)
pulldown_2 = CreatePulldownMenu(Label="Compare with", showLabel=True)
panel_2 = Panel("""Current simulation: 
{0}""")
label = CreateLabel(LabelText="Compare simulations", LabelSize=18, Justification=0)
true_button = CreateTrueOnlyButton(ButtonName="Compare simulations bar chart", ButtonStyle=0)
pulldown_3 = CreatePulldownMenu(Label="Select model", showLabel=True)
relay = Relay()
values_3 = ValueListener(Elements=pulldown, SomeProperty=True)  # -> Values, Indices
tb_2 = CreateTextBlock(TextSize=16, Justification=0)
button_3 = CreateButton(ButtonName="Bake", ButtonStyle=0)
panel_3 = Panel("""Current simulation: 
{0}""")
values_4 = ValueListener(Elements=pulldown_2, SomeProperty=True)  # -> Values, Indices
pulldown_4 = CreatePulldownMenu(Label="Select simulation", showLabel=True)
values_5 = ValueListener(Elements=true_button, SomeProperty=True)  # -> Values, Indices
values_6 = ValueListener(Elements=pulldown_3, SomeProperty=True)  # -> Values, Indices
event_2 = EventGate(Data=values_3.Indices)  # -> Data, IsNew
values_7 = ValueListener(Elements=button_3, SomeProperty=True)  # -> Values, Indices
values_8 = ValueListener(Elements=pulldown_4, SomeProperty=True)  # -> Values, Indices
simple_energy_simulation_compare_pop_up = RemoteSender(values_5.Values)
simple_energy_simulation_compare_pop_up_2 = RemoteReceiver(simple_energy_simulation_compare_pop_up)
event_3 = EventGate(Data=values_6.Indices)  # -> Data, IsNew
current_selected_model_analysis_module_n = RemoteSender(values_6.Values)  # "current_selected_model_analysis_module_name"
current_selected_model_analysis_module_n_2 = RemoteReceiver(current_selected_model_analysis_module_n)  # "current_selected_model_analysis_module_name"
subtraction = Subtraction(A=values_4.Indices, B="1")
recompute_2 = RemoteReceiver(recompute)
current_selected_model_visualise_module = RemoteSender(event_2.Data)
recompute_3 = RemoteReceiver(recompute)
panel_4 = Panel("""False
True""")
panel_5 = Panel("""False
True""")
format = Format(Format=panel_3, Culture=127, Data0=current_selected_model_analysis_module_n_2)
bake_daylight_simulation = RemoteSender(values_7.Values)
current_selected_model_analysis_module = RemoteSender(event_3.Data)
current_selected_simulation_simple_energ = RemoteSender(subtraction)  # "current_selected_simulation_simple_energy_compare"
current_selected_simulation_daylight = RemoteSender(values_8.Indices)
settextblock = SetTextBlockContents(TextBlockToModify=tb_2, NewTextBlockContents=format)
format_2 = Format(Format="{0}, {1}, 0, 0", Culture=127, Data0=Slider(0, range=-25..25), Data1=Slider(0, range=0..100))
format_3 = Format(Format="{0}, {1}, 0, 0", Culture=127, Data0=Slider(5, range=-25..25), Data1=Slider(8, range=0..100))
adjustpos = AdjustElementPositioning(
    ElementsToAdjust=pulldown,
    Margin=format_2,
    AbsolutePositioning=False,
    Width=Slider(300, range=0..400),
    HorizontalAlignment=0,
    VerticalAlignment=2)
adjustpos_2 = AdjustElementPositioning(
    ElementsToAdjust=pulldown_3,
    Margin=format_3,
    AbsolutePositioning=False,
    Width=Slider(300, range=0..400),
    HorizontalAlignment=0,
    VerticalAlignment=2)
format_4 = Format(
    Format="{0}, {1}, 0, {2}",
    Culture=127,
    Data0=Slider(5, range=-25..25),
    Data1=Slider(10, range=0..100),
    Data2=Slider(5, range=0..100))
format_5 = Format(
    Format="{0}, {1}, 0, {2}",
    Culture=127,
    Data0=Slider(5, range=-25..25),
    Data1=Slider(5, range=-15..15),
    Data2=Slider(5, range=0..100))
format_6 = Format(
    Format="{0}, {1}, 0, {2}",
    Culture=127,
    Data0=Slider(10, range=-25..25),
    Data1=Slider(5, range=-15..15),
    Data2=Slider(5, range=0..100))
format_7 = Format(
    Format="{0}, {1}, 0, {2}",
    Culture=127,
    Data0=Slider(5, range=-25..25),
    Data1=Slider(5, range=0..100),
    Data2=Slider(3, range=0..100))
format_8 = Format(
    Format="{0}, {1}, 0, {2}",
    Culture=127,
    Data0=Slider(5, range=-25..25),
    Data1=Slider(0, range=0..100),
    Data2=Slider(0, range=0..100))
adjustpos_3 = AdjustElementPositioning(
    ElementsToAdjust=tb_2,
    Margin=format_4,
    AbsolutePositioning=False,
    Width=Slider(245, range=0..300),
    HorizontalAlignment=0,
    VerticalAlignment=2)
adjustpos_4 = AdjustElementPositioning(
    ElementsToAdjust=pulldown_4,
    Margin=format_7,
    AbsolutePositioning=False,
    Width=Slider(245, range=0..300),
    HorizontalAlignment=0,
    VerticalAlignment=2)
entwine = Entwine(Branch00=label, Branch01=true_button, Branch02=pulldown_2, FlattenInputs=True)  # -> flatten(Result)
adjustpos_5 = AdjustElementPositioning(
    ElementsToAdjust=pulldown_2,
    Margin=format_5,
    AbsolutePositioning=False,
    Width=Slider(245, range=0..300),
    HorizontalAlignment=0,
    VerticalAlignment=2)
adjustelem = AdjustElementAppearance(ElementsToAdjust=tb, Foreground=ColourSwatch(SwatchColor=RGB(25, 25, 25)))
adjustpos_6 = AdjustElementPositioning(
    ElementsToAdjust=tb,
    Margin=format_8,
    AbsolutePositioning=False,
    Width=Slider(245, range=0..300),
    HorizontalAlignment=0,
    VerticalAlignment=2)
adjustpos_7 = AdjustElementPositioning(ElementsToAdjust=true_button, Margin=format_6, AbsolutePositioning=False, HorizontalAlignment=0, VerticalAlignment=2)
stack = CreateStack(UIElements=entwine, Horizontal=invert(True))

# ----
# Select model
select_model = Data(pulldown_3)

# ----
# Glare simulations info
panel_6 = Panel("?")
true_button_2 = CreateTrueOnlyButton(ButtonName=panel_6, ButtonStyle=2)
values_9 = ValueListener(Elements=true_button_2, SomeProperty=True)  # -> Values, Indices
glare_info = RemoteSender(values_9.Values)
number_slider_2 = Slider(29, range=0..300)
adjustpos_8 = AdjustElementPositioning(
    ElementsToAdjust=true_button_2,
    Margin="5, 0, 0, 0",
    AbsolutePositioning=False,
    Width=number_slider_2,
    Height=number_slider_2)
adjustelem_2 = AdjustElementAppearance(
    ElementsToAdjust=true_button_2,
    Foreground=ColourSwatch(SwatchColor=RGB(0, 0, 0)),
    Background=ColourSwatch(SwatchColor=RGB(230, 230, 230)),
    FontSize=Slider(12, range=0..300))

# ----
# LCA info
panel_7 = Panel("?")
true_button_3 = CreateTrueOnlyButton(ButtonName=panel_7, ButtonStyle=2)
values_10 = ValueListener(Elements=true_button_3, SomeProperty=True)  # -> Values, Indices
lca_info = RemoteSender(values_10.Values)
number_slider_3 = Slider(29, range=0..300)
adjustpos_9 = AdjustElementPositioning(
    ElementsToAdjust=true_button_3,
    Margin="5, 0, 0, 0",
    AbsolutePositioning=False,
    Width=number_slider_3,
    Height=number_slider_3)
adjustelem_3 = AdjustElementAppearance(
    ElementsToAdjust=true_button_3,
    Foreground=ColourSwatch(SwatchColor=RGB(0, 0, 0)),
    Background=ColourSwatch(SwatchColor=RGB(230, 230, 230)),
    FontSize=Slider(12, range=0..300))

# ----
# Select model
select_model_2 = Data(pulldown)

# ----
# Daylight simulations info
panel_8 = Panel("?")
true_button_4 = CreateTrueOnlyButton(ButtonName=panel_8, ButtonStyle=2)
values_11 = ValueListener(Elements=true_button_4, SomeProperty=True)  # -> Values, Indices
daylight_info = RemoteSender(values_11.Values)
number_slider_4 = Slider(29, range=0..300)
adjustpos_10 = AdjustElementPositioning(
    ElementsToAdjust=true_button_4,
    Margin="5, 0, 0, 0",
    AbsolutePositioning=False,
    Width=number_slider_4,
    Height=number_slider_4)
adjustelem_4 = AdjustElementAppearance(
    ElementsToAdjust=true_button_4,
    Foreground=ColourSwatch(SwatchColor=RGB(0, 0, 0)),
    Background=ColourSwatch(SwatchColor=RGB(230, 230, 230)),
    FontSize=Slider(12, range=0..300))

# ----
# Energy simulations info
panel_9 = Panel("?")
true_button_5 = CreateTrueOnlyButton(ButtonName=panel_9, ButtonStyle=2)
values_12 = ValueListener(Elements=true_button_5, SomeProperty=True)  # -> Values, Indices
simple_energy_info = RemoteSender(values_12.Values)
number_slider_5 = Slider(29, range=0..300)
adjustpos_11 = AdjustElementPositioning(
    ElementsToAdjust=true_button_5,
    Margin="5, 0, 0, 0",
    AbsolutePositioning=False,
    Width=number_slider_5,
    Height=number_slider_5)
adjustelem_5 = AdjustElementAppearance(
    ElementsToAdjust=true_button_5,
    Foreground=ColourSwatch(SwatchColor=RGB(0, 0, 0)),
    Background=ColourSwatch(SwatchColor=RGB(230, 230, 230)),
    FontSize=Slider(12, range=0..300))

# ----
# Launch  glare simulations info
panel_10 = Panel("https://www.boverket.se/en/start/publications/2019/boverkets-building-regulations--mandatory-provisions-and-general-recommendations-bbr/")

# ----
# Launch  LCA info
panel_11 = Panel("https://www.boverket.se/en/start/publications/2019/boverkets-building-regulations--mandatory-provisions-and-general-recommendations-bbr/")

glare_info_2 = RemoteReceiver(glare_info)
py3 = Python3Script(url=panel_10, launch=glare_info_2)
# ---------- py3: Python ----------
"""Grasshopper Script"""
import webbrowser as wb
if launch == True:
    wb.open(url, 2, True)
# ---------- end py3 ----------

# ----
# Launch  daylight simulations info
panel_12 = Panel("https://www.boverket.se/en/start/publications/2019/boverkets-building-regulations--mandatory-provisions-and-general-recommendations-bbr/")
daylight_info_2 = RemoteReceiver(daylight_info)
py3_2 = Python3Script(url=panel_12, launch=daylight_info_2)  # same code as py3

lca_info_2 = RemoteReceiver(lca_info)
py3_3 = Python3Script(url=panel_11, launch=lca_info_2)  # same code as py3

panel_13 = Panel("https://www.boverket.se/en/start/publications/2019/boverkets-building-regulations--mandatory-provisions-and-general-recommendations-bbr/")

# ----
# Launch energy simulations info
simple_energy_info_2 = RemoteReceiver(simple_energy_info)
py3_4 = Python3Script(url=panel_13, launch=simple_energy_info_2)  # same code as py3

# ----
# Create construction
# For user to interact with
# Testing
# Needs work...
# Under development
panel_14 = Panel("gypsum")  # disabled
panel_15 = Panel("insulation")  # disabled
panel_16 = Panel("concrete")  # disabled
panel_17 = Panel("plywood")  # disabled
panel_18 = Panel("air")  # disabled
number_slider_6 = Slider(0.036, range=0..0.1)  # disabled
number_slider_7 = Slider(0.3, range=0..1)  # disabled
number_slider_8 = Slider(1500, range=0..10000)  # disabled
number_slider_9 = Slider(28, range=0..100)  # disabled
searchmats = HBSearchMaterials(keywords=panel_15)  # -> opaque_mats, window_mats; disabled; plug-in component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
searchmats_2 = HBSearchMaterials(keywords=panel_16)  # -> opaque_mats, window_mats; disabled; plug-in component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
searchmats_3 = HBSearchMaterials()  # -> opaque_mats, window_mats; disabled; plug-in component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
searchmats_4 = HBSearchMaterials(keywords=panel_18)  # -> opaque_mats, window_mats; disabled; plug-in component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
searchmats_5 = HBSearchMaterials(keywords=panel_17)  # -> opaque_mats, window_mats; disabled; plug-in component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
searchmats_6 = HBSearchMaterials(keywords=panel_14)  # -> opaque_mats, window_mats; disabled; plug-in component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
panel_19 = Panel("XPS insulation")  # disabled
searchconstrs = HBSearchConstructions()  # -> opaque_constrs, window_constrs, shade_constrs; disabled; plug-in component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
searchconstrs_2 = HBSearchConstructions()  # -> opaque_constrs, window_constrs, shade_constrs; disabled; plug-in component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
list = ItemSelector(
    searchmats.opaque_mats,
    {"AtticFloor Insulation", "Generic 25mm Insulation", "Generic 50mm Insulation", "I01 25mm insulation board", "I02 50mm insulation board", "IEAD NonRes Roof Insulation-1.76", "IEAD Roof Insulation R-3.47 IP", "Insulation 1m", "Mass NonRes Wall Insulation-0.43", "Mass Wall Insulation R-4.23 IP"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}, selected="AtticFloor Insulation")  # disabled
number_slider_10 = Slider(0.1, range=0..1)  # disabled
list_2 = ItemSelector(
    searchmats_2.opaque_mats,
    {"100mm Normalweight concrete floor", "12 in. Normalweight Concrete Floor", "4 in. Normalweight Concrete Floor", "4 in. Normalweight Concrete Wall", "6 in. Heavyweight Concrete Roof", "6 in. Normalweight Concrete Floor", "8 in. Concrete Block Basement Wall", "8 in. Concrete Block Wall", "8 in. Normalweight Concrete Floor", "8 in. Normalweight Concrete Wall", "8IN CONCRETE HW RefBldg", "8IN Concrete HW", "Concrete Pavement", "Generic HW Concrete", "Generic LW Concrete", "HW CONCRETE", "HW CONCRETE 8 in", "M11 100mm lightweight concrete", "M15 200mm heavyweight concrete", "MAT-CC05 4 HW CONCRETE", "MAT-CC05 8 HW CONCRETE", "NACM_Concrete 4in_140lb/ft3"}, selected="100mm Normalweight concrete floor")  # disabled
list_3 = ItemSelector(
    searchmats_6.opaque_mats,
    {"1/2 in. Gypsum Board", "1/2IN Gypsum", "5/8 in. Gypsum Board", "G01 13mm gypsum board", "G01a 19mm gypsum board", "Generic Gypsum Board", "Gypsum Board - 1/2 in. CBES", "Gypsum Or Plaster Board - 3/8 in.", "NACM_Gypsum Board 5/8in"}, selected="1/2 in. Gypsum Board")  # disabled
number_slider_11 = Slider(0.016, range=0..0.1)  # disabled
list_4 = ItemSelector(
    searchmats_4.opaque_mats,
    {"F04 Wall air space resistance", "F05 Ceiling air space resistance", "Generic Ceiling Air Gap", "Generic Wall Air Gap", "Typical Air Wall"}, selected="F04 Wall air space resistance")  # disabled
list_5 = ItemSelector(searchmats_5.opaque_mats, {"5/8 in. Plywood", "Plywood - 5/8 in. CBES"}, selected="5/8 in. Plywood")  # disabled
number_slider_12 = Slider(0.11, range=0..1)  # disabled
number_slider_13 = Slider(0.3, range=0..1)  # disabled
number_slider_14 = Slider(0.012, range=0..0.1)  # disabled
opaquemat = HBOpaqueMaterial(
    name=panel_19,
    thickness=number_slider_7,
    conductivity=number_slider_6,
    density=number_slider_9,
    spec_heat=number_slider_8)  # -> mat; disabled; plug-in component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
list_6 = ItemSelector(
    searchconstrs.window_constrs,
    {"ASHRAE 189.1-2009 ExtWindow ClimateZone 1", "ASHRAE 189.1-2009 ExtWindow ClimateZone 2", "ASHRAE 189.1-2009 ExtWindow ClimateZone 3", "ASHRAE 189.1-2009 ExtWindow ClimateZone 4-5", "ASHRAE 189.1-2009 ExtWindow ClimateZone 6", "ASHRAE 189.1-2009 ExtWindow ClimateZone 7-8"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}, selected="U 0.17 SHGC 0.36 Simple Glazing Window")  # disabled
list_7 = ItemSelector(
    searchconstrs_2.window_constrs,
    {"ASHRAE 189.1-2009 ExtWindow ClimateZone 1", "ASHRAE 189.1-2009 ExtWindow ClimateZone 2", "ASHRAE 189.1-2009 ExtWindow ClimateZone 3", "ASHRAE 189.1-2009 ExtWindow ClimateZone 4-5", "ASHRAE 189.1-2009 ExtWindow ClimateZone 6", "ASHRAE 189.1-2009 ExtWindow ClimateZone 7-8"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}, selected="ASHRAE 189.1-2009 ExtWindow ClimateZone 1")  # disabled
panel_20 = Panel("Construction 1")  # disabled
merge = Merge(Data1=list_2, Data2=list_4, Data3=list_5, Data4=opaquemat, Data5=list_3)  # disabled
merge_2 = Merge(Data1=number_slider_10, Data2=number_slider_12, Data3=number_slider_11, Data4=number_slider_7, Data5=number_slider_14)  # disabled
interiorsubset = HBInteriorConstructionSubset()  # -> interior_set; disabled; plug-in component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
panel_21 = Panel("0.042")  # disabled
groundsubset = HBGroundConstructionSubset()  # -> ground_set; disabled; plug-in component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
panel_22 = Panel("38.2")  # disabled
panel_23 = Panel("2.5")  # disabled
cluster = Cluster(materials=merge, construction_name=panel_20, thicknesses=merge_2)  # -> error_2, construction_2; disabled
bldgvintages = HBBuildingVintages({"ASHRAE 90.1 2019  |  IECC 2021": "2019", "ASHRAE 90.1 2016  |  IECC 2018": "2016", "ASHRAE 90.1 2013  |  IECC 2015": "2013", "ASHRAE 90.1 2010  |  IECC 2012": "2010", "ASHRAE 90.1 2007  |  IECC 2009": "2007", "ASHRAE 90.1 2004  |  IECC 2006": "2004", "1980-2004 (CBECS)": "1980_2004", "Pre-1980 (CBECS)": "pre_1980"}, selected="ASHRAE 90.1 2019  |  IECC 2021")  # disabled
cluster_2 = Cluster_2(window_construction=list_7, gwp_a1_a3=panel_23, gwp_a4=panel_21, density_kg_m2=panel_22)  # disabled
decnstrconstr = HBDeconstructConstruction(constr=list_6)  # -> materials, layers, r_val_si, r_val_ip, u_fac_si, u_fac_ip, shgc, t_sol, t_vis; disabled; plug-in component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
constructiontypes = HBConstructionTypes({"SteelFramed", "WoodFramed", "Mass", "Metal Building"}, selected="WoodFramed")  # disabled
climatezones = HBClimateZones({"1 - Very Hot": "1", "2 - Hot": "2", "3 - Warm": "3", "4 - Mixed": "4", "5 - Cool": "5", "6 - Cold": "6", "7 - Very Cold": "7", "8 - Subarctic": "8"}, selected="5 - Cool")  # disabled
data = Data(cluster_2)  # disabled
panel_24 = Panel(decnstrconstr.u_fac_ip)  # disabled
panel_25 = Panel(decnstrconstr.u_fac_si)  # disabled
exteriorsubset = HBExteriorConstructionSubset(exterior_wall=cluster.construction_2)  # -> exterior_set; disabled; plug-in component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
subfacesubset = HBSubfaceSubset(window=data)  # -> subface_set; disabled; plug-in component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
panel_26 = Panel(cluster.construction_2)  # disabled
constrsetclimate = HBConstructionSetByClimate(climate_zone=climatezones, vintage=bldgvintages, constr_type=constructiontypes)  # -> constr_set; disabled; plug-in component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
constructionset = HBConstructionSet(base_constr_set=constrsetclimate, exterior_subset=exteriorsubset, subface_subset=subfacesubset)  # -> constr_set; disabled; plug-in component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
decnstrconstrset = HBDeconstructConstructionSet(constr_set=constructionset)  # -> exterior_wall, exterior_roof, exposed_floor, ground_wall, ground_roof, ground_floor, window, skylight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; disabled; plug-in component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
panel_27 = Panel(decnstrconstrset.exterior_wall)  # disabled

# ----
# Simplified Boverket data
number_slider_15 = Slider(6, range=0..10)
merge_3 = Merge(Data1=Slider(0.8, range=0..10), Data2=Slider(1.2, range=0..10), Data3=Slider(0.8, range=0..10))
merge_4 = Merge(Data1=number_slider_15, Data2=Slider(12, range=0..100), Data3=Slider(6, range=0..10))
python = GhPythonScript(sublist_lengths=merge_4, values=merge_3)  # -> out, out_list; inputs sublist_lengths: list of Int32, values: list
# ---------- python: Python ----------
"""Creates one list from a list of sublist lengths and the value to put in each sublist
    Inputs:
        sublist_lengths: sublist_lengths
        values: value in each sublist
    Output:
        a: The a output variable"""

__author__ = "sawen"
__version__ = "2024.05.24"

import rhinoscriptsyntax as rs

if not (len(sublist_lengths) == len(values)):
    raise Exception("sublist lengths and values must be the same size")

out_list = []

for i in range(len(sublist_lengths)):
    for j in range(int(sublist_lengths[i])):
        out_list.append(values[i])
# ---------- end python ----------
constantschedule = HBConstantSchedule(values=python.out_list, name="household_electricity")  # -> report, schedule, idf_text; plug-in component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

# ----
# Heath UI global settings
accent_colors = ValueList({"Amber", "Blue", "Brown", "Cobalt", "Crimson", "Cyan", "Emerald", "Green", "Indigo", "Lime", "Magenta", "Mauve", "Olive", "Orange", "Pink", "Purple", "Red", "Sienna", "Steel", "Taupe", "Teal", "Violet", "Yellow"}, selected="Brown")
heath_accent_color = RemoteSender(accent_colors)

invbool = InvertBoolean(Boolean=Button())  # -> Inverted, Number
bool_2 = Boolean("False")
panel_28 = Panel("Materials with an invalid category exists in the Rhino file")
button_4 = CreateButton(ButtonName="Sync database", ButtonStyle=0)
label_2 = CreateLabel(LabelText=panel_28, LabelSize=12, Justification=0)
values_13 = ValueListener(Elements=button_4, SomeProperty=True)  # -> Values, Indices
sync_window_database = RemoteSender(values_13.Values)
adjustelem_6 = AdjustElementAppearance(ElementsToAdjust=label_2, Foreground=ColourSwatch(SwatchColor=RGB(255, 0, 0)))
select_model_3 = Data(select_model)

# ----
# Transparent window
panel_29 = Panel("Import geometry")  # disabled
toggle = BooleanToggle(False)  # disabled
pickbtn = CreateRhinoPickButton(
    ButtonName=panel_29,
    Prompt="Please select geometry...",
    AllowMultiple=invert(True),
    AllowNone=True,
    Type=2,
    ButtonStyle=0)  # disabled
values_14 = ValueListener(Elements=pickbtn, SomeProperty=True)  # -> Values, Indices; disabled
launchxpwin = LaunchTransparentWindow(Show=toggle, Name="Control Window", Width=370, Height=400, ChildStatus=1, EnableHorizScroll=False)  # disabled
addelems = AddElements(Window=launchxpwin, Elements=flatten(pickbtn), DoVLChecking=True)  # -> AddedElements, ElementNames; disabled
panel_30 = Panel(values_14.Values)  # disabled

panel_31 = Panel("""Room
Adjacent
Context
Window""")
heath_accent_color_2 = RemoteReceiver(heath_accent_color)
heath_accent_color_3 = RemoteReceiver(heath_accent_color)
heath_accent_color_4 = RemoteReceiver(heath_accent_color)
heath_accent_color_5 = RemoteReceiver(heath_accent_color)
heath_accent_color_6 = RemoteReceiver(heath_accent_color)
heath_accent_color_7 = RemoteReceiver(heath_accent_color)
heatcool = HBHeatCoolHVACTemplates({"Baseboard electric": "ElectricBaseboard", "Baseboard gas boiler": "BoilerBaseboard", "Baseboard central air source heat pump": "ASHPBaseboard", "Baseboard district hot water": "DHWBaseboard", "Direct evap coolers with baseboard electric": "EvapCoolers_ElectricBaseboard", "Direct evap coolers with baseboard gas boiler": "EvapCoolers_BoilerBaseboard"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}, selected="Residential heat pump with no cooling": "ResidentialHPNoCool")
py3_5 = Python3Script(x=Slider(10, range=0..10), y=Slider(10, range=0..10))  # -> out, a; inputs x: Int32, y: Int32
# ---------- py3_5: Python ----------
import Rhino.Geometry as rg

pts = []

for i in range (0,x):
    for j in range (0,y):
        pts.append(rg.Point2d(i,j))

a = pts
# ---------- end py3_5 ----------

# ----
# Modal UI locations
number_slider_16 = Slider(180, range=0..1000)
pt = ConstructPoint(XCoordinate=Slider(460, range=0..1000), YCoordinate=number_slider_16, ZCoordinate=0)
pt_2 = ConstructPoint(XCoordinate=Slider(65, range=0..1000), YCoordinate=number_slider_16, ZCoordinate=0)
pt_3 = ConstructPoint(XCoordinate=Slider(845, range=0..1000), YCoordinate=number_slider_16, ZCoordinate=0)
heath_window_location = RemoteSender(pt_2)
database_modal_location = RemoteSender(pt)
create_modal_location = RemoteSender(pt_3)

textbox = CreateTextBox(DefaultText=Slider(0.05, range=0..10), UpdateButton=invert(True), showLabel=False)
textbox_2 = CreateTextBox(DefaultText=Slider(0.02, range=0..10), UpdateButton=invert(True), showLabel=False)
textbox_3 = CreateTextBox(DefaultText=Slider(0.35, range=0..10), UpdateButton=invert(True), showLabel=False)
true_button_6 = CreateTrueOnlyButton(ButtonName="?", ButtonStyle=2)
label_3 = CreateLabel(LabelText="A4 [kg CO2eq/kg]", LabelSize=12, Justification=0)
label_4 = CreateLabel(LabelText="A5.1 [kg CO2eq/kg]", LabelSize=12, Justification=0)
textbox_4 = CreateTextBox(DefaultText=Slider(0.05, range=0..10), UpdateButton=invert(True), showLabel=False)
textbox_5 = CreateTextBox(DefaultText=Slider(0.35, range=0..10), UpdateButton=invert(True), showLabel=False)
textbox_6 = CreateTextBox(DefaultText=Slider(28, range=0..100), UpdateButton=invert(True), showLabel=False)
label_5 = CreateLabel(LabelText="A4 [kg CO2eq/kg]", LabelSize=12, Justification=0)
label_6 = CreateLabel(LabelText="Conversion value [kg/m2]", LabelSize=12, Justification=0)
label_7 = CreateLabel(LabelText="A1-A3 [kg CO2eq/kg]", LabelSize=12, Justification=0)
values_15 = ValueListener(Elements=true_button_6, SomeProperty=True)  # -> Values, Indices
values_16 = ValueListener(Elements=textbox_6, SomeProperty=True)  # -> Values, Indices
values_17 = ValueListener(Elements=textbox_3, SomeProperty=True)  # -> Values, Indices
values_18 = ValueListener(Elements=textbox_2, SomeProperty=True)  # -> Values, Indices
values_19 = ValueListener(Elements=textbox, SomeProperty=True)  # -> Values, Indices
values_20 = ValueListener(Elements=textbox_5, SomeProperty=True)  # -> Values, Indices
values_21 = ValueListener(Elements=textbox_4, SomeProperty=True)  # -> Values, Indices

# ----
# No link at the moment
info_create_window = RemoteSender(values_15.Values)

num = Number(values_17.Values)
num_2 = Number(values_18.Values)
num_3 = Number(values_19.Values)
num_4 = Number(values_16.Values)
num_5 = Number(values_20.Values)
num_6 = Number(values_21.Values)
current_selected_model_visualise_module_2 = RemoteReceiver(current_selected_model_visualise_module)
entwine_2 = Entwine(Branch00=label_6, Branch01=textbox_6, FlattenInputs=True)  # -> flatten(Result)
current_selected_model_analysis_module_2 = RemoteReceiver(current_selected_model_analysis_module)
null = NullItem(Item=num)  # -> NullFlags, InvalidFlags, Description
null_2 = NullItem(Item=num_2)  # -> NullFlags, InvalidFlags, Description
null_3 = NullItem(Item=num_3)  # -> NullFlags, InvalidFlags, Description
null_4 = NullItem(Item=num_4)  # -> NullFlags, InvalidFlags, Description
null_5 = NullItem(Item=num_5)  # -> NullFlags, InvalidFlags, Description
null_6 = NullItem(Item=num_6)  # -> NullFlags, InvalidFlags, Description
entwine_3 = Entwine(Branch00=label_3, Branch01=textbox, FlattenInputs=True)  # -> flatten(Result)
entwine_4 = Entwine(Branch00=label_4, Branch01=textbox_2, FlattenInputs=True)  # -> flatten(Result)
entwine_5 = Entwine(Branch00=label_7, Branch01=textbox_5, FlattenInputs=True)  # -> flatten(Result)
entwine_6 = Entwine(Branch00=label_5, Branch01=textbox_4, FlattenInputs=True)  # -> flatten(Result)
filter = StreamFilter(Gate=null_2.NullFlags, Stream0=num_2, Stream1="0")
filter_2 = StreamFilter(Gate=null_3.NullFlags, Stream0=num_3, Stream1="0")
filter_3 = StreamFilter(Gate=null.NullFlags, Stream0=num, Stream1="0")
filter_4 = StreamFilter(Gate=null_4.NullFlags, Stream0=num_4, Stream1="0")
filter_5 = StreamFilter(Gate=null_6.NullFlags, Stream0=num_6, Stream1="0")
filter_6 = StreamFilter(Gate=null_5.NullFlags, Stream0=num_5, Stream1="0")
stack_2 = CreateStack(UIElements=entwine_2, Horizontal=True)
create_material_a4_kg = RemoteSender(filter_2)
create_material_a5_1_kg = RemoteSender(filter)
create_window_conversion_value = RemoteSender(filter_4)
create_material_a1_a3_kg = RemoteSender(filter_3)
create_window_a4_kg = RemoteSender(filter_5)
create_window_a1_a3_kg = RemoteSender(filter_6)
adjustelem_7 = AdjustElementAppearance(
    ElementsToAdjust=true_button_6,
    Foreground=ColourSwatch(SwatchColor=RGB(0, 0, 0)),
    Background=ColourSwatch(SwatchColor=RGB(230, 230, 230)),
    FontSize=Slider(12, range=0..300))
number_slider_17 = Slider(29, range=0..300)

# ----
# A4
stack_3 = CreateStack(UIElements=entwine_6, Horizontal=True)
a4 = Data(stack_3)

# ----
# A1-A3
stack_4 = CreateStack(UIElements=entwine_5, Horizontal=True)
data_2 = Data(stack_4)  # "A1-A3"

# ----
# A4
stack_5 = CreateStack(UIElements=entwine_3, Horizontal=True)
a4_2 = Data(stack_5)

# ----
# A5.1
stack_6 = CreateStack(UIElements=entwine_4, Horizontal=True)
data_3 = Data(stack_6)

adjustpos_12 = AdjustElementPositioning(
    ElementsToAdjust=true_button_6,
    Margin="5, -5, 0, 0",
    AbsolutePositioning=False,
    Width=number_slider_17,
    Height=number_slider_17)
empty = EmptyObjectToEmptyBranch()
heath_accent_color_8 = RemoteReceiver(heath_accent_color)
heath_accent_color_9 = RemoteReceiver(heath_accent_color)
heath_accent_color_10 = RemoteReceiver(heath_accent_color)

# ----
# Get Klimatdatabas data
list_8 = ValueList({"Swedish": "sv", "English": "en"}, selected="English")
list_9 = ValueList({"File": "file", "API": "api"}, selected="API")
get_categories = BrimstoneGetCategories(mode=list_9, language=list_8)  # -> out, json_data, categories, klimatdatabas_version
# ---------- get_categories: Python ----------
"""Gets Klimatdatabas from the Boverket API or a file, extracts json data, and resource category names
    Inputs:
        mode: api or file mode
        language: language of database to retrieve
        json_path: path to json file if file mode
    Output:
        json_data: json file as dictionary
        categories: Categories present in the database
        klimatdatabas_version: String representing the version of Klimatdatabas used"""

import scriptcontext
import brimstone
import Grasshopper
import os, io

ghenv.Component.Name = 'Brimstone - Get Categories'
ghenv.Component.NickName = 'Get Categories'
ver = brimstone.globals.version
ghenv.Component.Message = ver

import json

from System.Net import WebRequest
from System.IO import StreamReader
from System.Text import Encoding

def main(mode):    
    if mode == "file":
        json_file = brimstone.globals.kdb_json_path
        json_path = os.path.join(Grasshopper.Folders.UserObjectFolders[0], json_file)
        if not os.path.exists(json_path):
            raise Exception("Failed to open json file, it should reside in [UserComponents folder]/brimstone_data/")
        json_data = get_json_data_from_file(json_path)
    elif mode == "api":
        json_data = get_json_data_from_api()
    else:
        raise Exception("Mode {mode} not supported".format(mode = mode))
    
    categories = get_categories(json_data)
    version = json_data.get("Version") 
    
    return categories, json_data, version

def get_json_data_from_file(json_path):
    f = io.open(json_path, encoding='utf-8')
    json_data = json.load(f)
    return json_data
    
def get_json_data_from_api():
    version = "02.04.000"
    lng = language if language else "en"
    format = "json"

    url = "https://api.boverket.se/klimatdatabas/v2/get-all-resources/{version}/{language}/{format}".format(
        version=version, language=lng, format=format)
    
    request = WebRequest.Create(url)
    
    request.Method = "GET"
    request.Timeout = 5000
    #request.ContentType = "application/json"
    response = request.GetResponse()
    
    stream_reader = StreamReader(response.GetResponseStream())
    json_data = json.loads(stream_reader.ReadToEnd())
    return json_data
    
def get_categories(json_data):
    categories = []
    try:
        for metaCategory in json_data['Categories']:
            for cat in metaCategory["Children"]:
                categories.append(cat["Title"])
    except KeyError:
        raise Exception("Format of JSON data is not supported.")
    return categories

if __name__ == "__main__":
    if not scriptcontext.sticky["brimstone_flying"]:
        raise Exception("The 'Brimstone - Fly' component needs to exist on the canvas")
    categories, json_data, klimatdatabas_version = main(mode)
    json_data = [json_data] # need to put it in an array so GH understands it as a dictionary
# ---------- end get_categories ----------
list_10 = ItemSelector(
    get_categories.categories,
    {"Mineral materials", "Windows, doors and glass", "Paints and sealants", "Concrete", "Insulation", "Steel and other metals", "Blocks and tiles", "Building boards", "Waterproofing", "Solid woods", "Energy and fuel"}, selected="Mineral materials")
panel_32 = Panel(get_categories.klimatdatabas_version)

# ---- group: Request specific outputs
toggle_2 = BooleanToggle(True)  # disabled
simoutput = HBSimulationOutput(zone_energy_use=toggle_2, gains_and_losses=toggle_2, comfort_metrics=toggle_2, surface_energy_flow=toggle_2)  # -> report, sim_output; disabled; plug-in component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
simpar = HBSimulationParameter(output=simoutput.sim_output, timestep=6)  # -> sim_par; disabled; plug-in component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

# ----
objbynn = GetObjectByNickname(NickName="PITView")
current_selected_model_analysis_module_n_3 = RemoteReceiver(current_selected_model_analysis_module_n)  # "current_selected_model_analysis_module_name"

# ---- group: Analyse performance
pt_4 = ConstructPoint(XCoordinate=Slider(80, range=0..100), YCoordinate=Slider(10, range=0..100), ZCoordinate=0)
simple_energy_simulation_base_point = RemoteSender(pt_4)

# ----
objbynn_2 = GetObjectByNickname(NickName="AnnualDaylight")

# ----
# Recursion
panel_33 = Panel("LCA window status")
objbynn_3 = GetObjectByNickname(NickName=panel_33)
lca_window_status = Python3Script()  # -> status
# ---------- lca_window_status: Python ----------
status = False
# ---------- end lca_window_status ----------

# ----
# LCA pop-up window
panel_34 = Panel("Update")
button_5 = CreateButton(ButtonName=panel_34, ButtonStyle=0)
values_22 = ValueListener(Elements=button_5, SomeProperty=True)  # -> Values, Indices
adjustpos_13 = AdjustElementPositioning(ElementsToAdjust=button_5, AbsolutePositioning=False, HorizontalAlignment=1)
event_4 = EventGate(Data=values_22.Values)  # -> Data, IsNew
colrange = LBColorRange(index=Slider(19, range=0..100))  # -> colors; plug-in component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
txt = Text(colrange)
pt_5 = Point(txt)
division = Division(A=pt_5, B="255")
len = TextLength(Text=division)
subtraction_2 = Subtraction(A=len, B=Slider(2, range=0..10))
fragment = TextFragment(Text=division, Start="1", Count=subtraction_2)
panel_35 = Panel("C:\Users\Isac\Desktop\Toivo_Chalmers\heath\Icons\butterfly_heath.png")
database_modal_location_2 = RemoteReceiver(database_modal_location)
image = CreateImage(ImageSource=panel_35, ImageWidth=Slider(1100, range=0..1200), ImageHeight=Slider(500, range=0..1000))
pdecon = Deconstruct(Point=database_modal_location_2)  # -> XComponent, YComponent, ZComponent
subtraction_3 = Subtraction(A=pdecon.XComponent, B=Slider(100, range=0..100))
heath_accent_color_11 = RemoteReceiver(heath_accent_color)
entwine_7 = Entwine(Branch00=button_5, Branch01=image, FlattenInputs=True)  # -> flatten(Result)
pt_6 = ConstructPoint(XCoordinate=subtraction_3, YCoordinate=pdecon.YComponent, ZCoordinate=0)

# ----
# Recursion
panel_36 = Panel("LCA window status")
objbynn_4 = GetObjectByNickname(NickName=panel_36)
lca_window_status_2 = Python3Script()  # -> status; same code as lca_window_status

# ----
# EUI pop-up window
panel_37 = Panel("Update")
simple_energy_simulation_compare_pop_up_3 = RemoteReceiver(simple_energy_simulation_compare_pop_up)
button_6 = CreateButton(ButtonName=panel_37, ButtonStyle=0)
values_23 = ValueListener(Elements=button_6, SomeProperty=True)  # -> Values, Indices
rec = DataRecorder(simple_energy_simulation_compare_pop_up_3, DataLimit=-2, RecordData=True)
adjustpos_14 = AdjustElementPositioning(ElementsToAdjust=button_6, AbsolutePositioning=False, HorizontalAlignment=1)
ma = MassAddition(Input=rec)  # -> Result, PartialResults
entwine_8 = Entwine(Branch00=ma.Result, Branch01=lca_window_status_2, FlattenInputs=True)
colrange_2 = LBColorRange(index=Slider(3, range=0..100))  # -> colors; plug-in component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
rec_2 = DataRecorder(entwine_8, DataLimit=2, RecordData=True)
txt_2 = Text(colrange_2)
item = ListItem(List=rec_2, Index=0, Wrap=True)  # -> Item2, Item1, Item
pt_7 = Point(txt_2)
equals_2 = Equality(FirstNumber=item.Item2, SecondNumber=item.Item1)  # -> Equality, Inequality
division_2 = Division(A=pt_7, B="255")
len_2 = TextLength(Text=division_2)
bang = ExplodeTree(Data=equals_2.Inequality)  # -> Branch0, Branch1
subtraction_4 = Subtraction(A=len_2, B=Slider(2, range=0..10))
py3_6 = Python3Script(x=bang.Branch0, y=bang.Branch1)  # -> a
# ---------- py3_6: Python ----------
if x:
    a = True
elif y:
    a = False
else:
    a = False
# ---------- end py3_6 ----------
fragment_2 = TextFragment(Text=division_2, Start="1", Count=subtraction_4)
event_5 = EventGate(Data=py3_6)  # -> Data, IsNew
freeze_gate_2 = StreamFreezeGate(Data=py3_6, PassingSwitch=event_5.IsNew)
panel_38 = Panel("C:\Users\Isac\Desktop\Toivo_Chalmers\heath\Icons\butterfly_heath.png")
event_6 = EventGate(Data=freeze_gate_2)  # -> Data, IsNew
database_modal_location_3 = RemoteReceiver(database_modal_location)
panel_39 = Panel(event_6.Data)
launchwin = LaunchWindow(
    Show=event_6.Data,
    Name="EUI visualisations",
    Width=Slider(725, range=0..1200),
    Height=Slider(421, range=0..1000),
    ChildStatus=1,
    EnableHorizScroll=False)
image_2 = CreateImage(ImageSource=panel_38, ImageWidth=Slider(750, range=0..1200), ImageHeight=Slider(325, range=0..1200))
entwine_9 = Entwine(Branch00=checklist, Branch01=image_2, FlattenInputs=True)  # -> flatten(Result)
pdecon_2 = Deconstruct(Point=database_modal_location_3)  # -> XComponent, YComponent, ZComponent
simple_energy_simulation_compare_pop_up_4 = RemoteReceiver(simple_energy_simulation_compare_pop_up)
subtraction_5 = Subtraction(A=pdecon_2.XComponent, B=Slider(0, range=0..100))
heath_accent_color_12 = RemoteReceiver(heath_accent_color)
adjustpos_15 = AdjustElementPositioning(ElementsToAdjust=checklist, Margin="0, 40, 0, 0", AbsolutePositioning=False)
pt_8 = ConstructPoint(XCoordinate=subtraction_5, YCoordinate=pdecon_2.YComponent, ZCoordinate=0)
winstat = WindowStatus(Window=launchwin)
eui_status = RemoteSender(winstat)
winprops = SetWindowProperties(
    Window=launchwin,
    StartingLocation=pt_8,
    Theme=0,
    AccentColor=heath_accent_color_12,
    ShowTitleBar=True,
    BackgroundColor=RGB(255, 255, 255),
    ScaleFactor=1)
py3_7 = Python3Script(window=launchwin, activate=simple_energy_simulation_compare_pop_up_4)
# ---------- py3_7: Python ----------
import System

if activate and (str(window.WindowState) == "Minimized"):
    window.set_WindowState(System.Windows.WindowState(0))
# ---------- end py3_7 ----------

eui_status_2 = RemoteReceiver(eui_status)
expression = Expression(x="Hidden", y=eui_status_2, Expression="x=y")
expire = ExpireObject(ObjectToExpire=objbynn_4, Expire=expression)

event_7 = EventGate(Data=values_23.Values)  # -> Data, IsNew
and = GateAnd(A=simple_energy_simulation_compare_pop_up_2, B=event_7.Data)
stack_7 = CreateStack(UIElements=entwine_9, Horizontal=True)
entwine_10 = Entwine(Branch00=button_6, Branch01=stack_7, FlattenInputs=True)  # -> flatten(Result)
stack_8 = CreateStack(UIElements=entwine_10, Horizontal=invert(True))

# ----
# Database constructions
exterior_wall = Data(0.2670918015)
exterior_roof = Data(0.1170909002)
interior_floor = Data(1.155238836)
exterior_floor = Data(0.1475301828)
ground = Data(0.8527343676)
interior_wall = Data(2.116723713)
expression_2 = Expression(x=ground, Expression="Round(x, 2)")
expression_3 = Expression(x=exterior_floor, Expression="Round(x, 2)")
expression_4 = Expression(x=exterior_roof, Expression="Round(x, 2)")
expression_5 = Expression(x=interior_floor, Expression="Round(x, 2)")
expression_6 = Expression(x=interior_wall, Expression="Round(x, 2)")
expression_7 = Expression(x=exterior_wall, Expression="Round(x, 2)")
format_9 = Format(Format="{0} (U-factor: {1})", Culture=127, Data0="Generic", Data1=expression_2)
format_10 = Format(Format="{0} (U-factor: {1})", Culture=127, Data0="Generic", Data1=expression_3)
format_11 = Format(Format="{0} (U-factor: {1})", Culture=127, Data0="Generic", Data1=expression_4)
format_12 = Format(Format="{0} (U-factor: {1})", Culture=127, Data0="Generic", Data1=expression_5)
format_13 = Format(Format="{0} (U-factor: {1})", Culture=127, Data0="Generic", Data1=expression_6)
format_14 = Format(Format="{0} (U-factor: {1})", Culture=127, Data0="Generic", Data1=expression_7)

# ----
# Geometry module interface
# Attribute modification
# Preview geometry
# Geometry visibility settings
panel_40 = Panel("Polysurface")
constructiontype = RemoteReceiver()
saveconstruction = RemoteReceiver()

# ----
# Database windows
generic_u_value = Data(1.687787378)
generic_shgc = Data(0.4240807069)

py3_8 = Python3Script(get=and)  # -> mpl_folder
# ---------- py3_8: Python ----------
"""Grasshopper Script"""
import heath

if __name__ == "__main__":
    if get:
        print(ghdoc)
        mpl_folder = heath.get_results_folder(ghdoc)
# ---------- end py3_8 ----------
nextfile = NextAvailableFilename(Format="EUI{000}.png", FolderPath=py3_8, Trigger=and)
freeze_gate_3 = StreamFreezeGate(Data=nextfile, PassingSwitch=and)
addelems_2 = AddElements(Window=launchwin, Elements=flatten(stack_8), DoVLChecking=True)  # -> AddedElements, ElementNames

# ----
# Create test model
building = Geometry([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])
adjacent_rooms_1 = Geometry([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])
ground_2 = Geometry(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)
site = Geometry([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])
panel_41 = Panel("""Heath::Test model::Rooms
Heath::Test model::Windows
Heath::Test model::Adjacent
Heath::Test model::Context""")
entwine_11 = Entwine(Branch00="Room", Branch01="Window", Branch02="Adjacent", Branch03="Context", FlattenInputs=True)
merge_5 = Merge(Data1=ground_2, Data2=site, Data3=building, Data4=adjacent_rooms_1)
lng = ListLength(List=flatten(entwine_11))
ef_layer = EleFrontLayer(FullPath=panel_41)  # -> graft(Layer), FullPath, Hidden, Locked, DisplayColour, MaterialName, Linetype, PrintColour, PrintWidth
repeat = RepeatData(Data="Heath geometry type", Length=lng)  # -> graft(Data)
windows1 = Geometry([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])
room1 = Geometry(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)
adjacent_1 = Geometry([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])
context_1 = Geometry(merge_5)
ef_att = EleFrontAttributes(Keys=repeat, Values=entwine_11, Layer=ef_layer.Layer)  # -> Attributes, Keys, Values, Name, Layer, ColourSource, DisplayColour, MaterialSource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
entwine_12 = Entwine(Branch00=room1, Branch01=windows1, Branch02=adjacent_1, Branch03=context_1, FlattenInputs=True)
lng_2 = ListLength(List=entwine_12)
repeat_2 = RepeatData(Data=ef_att.Attributes, Length=lng_2)

# ----
# Database materials
panel_42 = Panel("{0} (conductivity: {1}, density: {2}, specific heat: {3})")

# ---- group: Assembly model
panel_43 = Panel("https://energyplus-weather.s3.amazonaws.com/europe_wmo_region_6/SWE/SWE_Goteborg.Landvetter.025260_IWEC/SWE_Goteborg.Landvetter.025260_IWEC.zip")
button_7 = CreateButton(ButtonName="Sync", ButtonStyle=0)
values_24 = ValueListener(Elements=button_7, SomeProperty=True)  # -> Values, Indices
button_8 = CreateButton(ButtonName="Bake model", ButtonStyle=0)
textbox_7 = CreateTextBox(Label="Rename model", DefaultText="Renamed model", UpdateButton=invert(True), showLabel=True)
button_9 = CreateButton(ButtonName="Rename", ButtonStyle=0)
checkbox = CreateCheckbox(Label="Doors", StartingValue=False)
button_10 = CreateButton(ButtonName="Remove current model", ButtonStyle=0)
checkbox_2 = CreateCheckbox(Label="Context", StartingValue=False)
checkbox_3 = CreateCheckbox(Label="Windows", StartingValue=False)
checkbox_4 = CreateCheckbox(Label="All", StartingValue=False)
checkbox_5 = CreateCheckbox(Label="Ground", StartingValue=False)
checkbox_6 = CreateCheckbox(Label="Floors", StartingValue=False)
label_8 = CreateLabel(LabelText="Show components", LabelSize=12, Justification=0)
button_11 = CreateButton(ButtonName="Create model", ButtonStyle=0)
values_25 = ValueListener(Elements=button_11, SomeProperty=True)  # -> Values, Indices
checkbox_7 = CreateCheckbox(Label="Roof", StartingValue=False)
pulldown_5 = CreatePulldownMenu(Label="Models", showLabel=True)
checkbox_8 = CreateCheckbox(Label="Walls", StartingValue=False)
button_12 = CreateButton(ButtonName="Zoom", ButtonStyle=0)
textbox_8 = CreateTextBox(Label="Model name", DefaultText="My model", UpdateButton=invert(True), showLabel=True)
freeze_gate_4 = StreamFreezeGate(Data=values_25.Values, PassingSwitch=invert(values_25.Values))
values_26 = ValueListener(Elements=button_8, SomeProperty=True)  # -> Values, Indices
label_9 = CreateLabel(LabelText="Honeybee model", LabelSize=18, Justification=0)
toggle_3 = CreateToggle(Default=False)
label_10 = CreateLabel(LabelText="Generate windows using WWR [%]", LabelSize=12, Justification=0)
slider = CreateSlider(
    Slider=Slider(30, range=5..95),
    SnapValue=Slider(5, range=0..10),
    ShowBounds=False,
    ShowTicks=True,
    ShowTooltip=True,
    ShowValLabel=True,
    showLabel=False)
slider_2 = CreateSlider(
    Slider=Slider(50, range=0..100),
    SnapValue=Slider(5, range=0..10),
    ShowBounds=False,
    ShowTicks=True,
    ShowTooltip=False,
    ShowValLabel=True,
    showLabel=False)
slider_3 = CreateSlider(
    Slider=Slider(50, range=0..100),
    SnapValue=Slider(5, range=0..10),
    ShowBounds=False,
    ShowTicks=True,
    ShowTooltip=False,
    ShowValLabel=True,
    showLabel=False)
slider_4 = CreateSlider(
    Slider=Slider(1, range=0..10),
    SnapValue=Slider(1, range=0..1),
    ShowBounds=False,
    ShowTicks=True,
    ShowTooltip=False,
    ShowValLabel=True,
    showLabel=False)
label_11 = CreateLabel(LabelText="Louver depth", LabelSize=12, Justification=0)
label_12 = CreateLabel(LabelText="Distance between louvers", LabelSize=12, Justification=0)
label_13 = CreateLabel(LabelText="Number of louvers", LabelSize=12, Justification=0)
values_27 = ValueListener(Elements=button_9, SomeProperty=True)  # -> Values, Indices
slider_5 = CreateSlider(
    Slider=Slider(50, range=0..100),
    SnapValue=Slider(5, range=0..10),
    ShowBounds=False,
    ShowTicks=True,
    ShowTooltip=False,
    ShowValLabel=True,
    showLabel=False)
label_14 = CreateLabel(LabelText="Louver angle", LabelSize=12, Justification=0)
values_28 = ValueListener(Elements=button_10, SomeProperty=True)  # -> Values, Indices
label_15 = CreateLabel(LabelText="Set location", LabelSize=12, Justification=0)
values_29 = ValueListener(Elements=textbox_7, SomeProperty=True)  # -> Values, Indices
values_30 = ValueListener(Elements=checkbox, SomeProperty=True)  # -> Values, Indices
values_31 = ValueListener(Elements=checkbox_2, SomeProperty=True)  # -> Values, Indices
values_32 = ValueListener(Elements=checkbox_3, SomeProperty=True)  # -> Values, Indices
values_33 = ValueListener(Elements=button_12, SomeProperty=True)  # -> Values, Indices
values_34 = ValueListener(Elements=checkbox_4, SomeProperty=True)  # -> Values, Indices
values_35 = ValueListener(Elements=checkbox_5, SomeProperty=True)  # -> Values, Indices
textbox_9 = CreateTextBox(Label="Set location", DefaultText=panel_43, UpdateButton=True, showLabel=True)
button_13 = CreateButton(ButtonName="Get climate data", ButtonStyle=0)
values_36 = ValueListener(Elements=checkbox_6, SomeProperty=True)  # -> Values, Indices
values_37 = ValueListener(Elements=pulldown_5, SomeProperty=True)  # -> Values, Indices
values_38 = ValueListener(Elements=checkbox_7, SomeProperty=True)  # -> Values, Indices
values_39 = ValueListener(Elements=checkbox_8, SomeProperty=True)  # -> Values, Indices
bool_3 = Boolean(invert(freeze_gate_4))
rec_3 = DataRecorder(values_26.Values, DataLimit=-10, RecordData=True)
zoom_honeybee_model = RemoteSender(values_33.Values)
current_selected_model_assembly_module_n = RemoteSender(values_37.Values)  # "current_selected_model_assembly_module_name"
current_selected_model_assembly_module_n_2 = RemoteReceiver(current_selected_model_assembly_module_n)  # "current_selected_model_assembly_module_name"
event_8 = EventGate(Data=values_37.Indices)  # -> Data, IsNew
panel_44 = Panel(values_27.Values)
rename_current_model_name = RemoteSender(values_29.Values)
rename_current_model = RemoteSender(values_27.Values)
remove_current_model = RemoteSender(values_28.Values)
panel_45 = Panel(values_28.Values)
rec_4 = DataRecorder(bool_3, DataLimit=-10, RecordData=True)
values_40 = ValueListener(Elements=textbox_8, SomeProperty=True)  # -> Values, Indices
values_41 = ValueListener(Elements=slider_4, SomeProperty=True)  # -> Values, Indices
values_42 = ValueListener(Elements=slider_3, SomeProperty=True)  # -> Values, Indices
values_43 = ValueListener(Elements=slider_2, SomeProperty=True)  # -> Values, Indices
values_44 = ValueListener(Elements=slider_5, SomeProperty=True)  # -> Values, Indices
values_45 = ValueListener(Elements=button_13, SomeProperty=True)  # -> Values, Indices
values_46 = ValueListener(Elements=slider, SomeProperty=True)  # -> Values, Indices
panel_46 = Panel("https://energyplus-weather.s3.amazonaws.com/europe_wmo_region_6/SWE/SWE_Goteborg.Landvetter.025260_IWEC/SWE_Goteborg.Landvetter.025260_IWEC.zip")
values_47 = ValueListener(Elements=textbox_9, SomeProperty=True)  # -> Values, Indices
downloadepw = LBDownloadWeather(weather_URL=values_47.Values)  # -> epw_file, stat_file, ddy_file; plug-in component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
importepw = LBImportEPW(epw_file=downloadepw.epw_file)  # -> location, dry_bulb_temperature, dew_point_temperature, relative_humidity, wind_speed, wind_direction, direct_normal_rad, diffuse_horizontal_rad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; plug-in component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
decnstrloc = LBDeconstructLocation(location=importepw.location)  # -> name, latitude, longitude, time_zone, elevation; plug-in component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
int = Integer(rec_3)
tooltip = AttachTooltipToElement(ElementsToAttachTo=slider, TooltipContent="Doubleclick to input value", ShowDelay=500, Duration=2000)
entwine_13 = Entwine(Branch00=label_11, Branch01=slider_2, FlattenInputs=True)  # -> flatten(Result)
entwine_14 = Entwine(Branch00=label_12, Branch01=slider_3, FlattenInputs=True)  # -> flatten(Result)
entwine_15 = Entwine(Branch00=label_13, Branch01=slider_4, FlattenInputs=True)  # -> flatten(Result)
entwine_16 = Entwine(Branch00=label_14, Branch01=slider_5, FlattenInputs=True)  # -> flatten(Result)
current_selected_model_assembly_module = RemoteSender(event_8.Data)
values_48 = ValueListener(Elements=toggle_3, SomeProperty=True)  # -> Values, Indices
ma_2 = MassAddition(Input=int)  # -> Result, PartialResults
model_name = RemoteSender(values_40.Values)
panel_47 = Panel(values_40.Values)
int_2 = Integer(rec_4)
distance_between_louvers = RemoteSender(values_42.Values)
louver_depth = RemoteSender(values_43.Values)
louver_angle = RemoteSender(values_44.Values)
number_of_louvers = RemoteSender(values_41.Values)
getclimatedata = RemoteSender(values_45.Values)
entwine_17 = Entwine(Branch00=toggle_3, Branch01=slider, FlattenInputs=True)  # -> flatten(Result)
filter_7 = StreamFilter(Gate=values_48.Values, Stream0="0", Stream1=values_46.Values)
ma_3 = MassAddition(Input=int_2)  # -> Result, PartialResults
stack_9 = CreateStack(UIElements=entwine_13, Horizontal=invert(True))
stack_10 = CreateStack(UIElements=entwine_14, Horizontal=invert(True))
stack_11 = CreateStack(UIElements=entwine_15, Horizontal=invert(True))
null_7 = NullItem(Item=decnstrloc.name)  # -> NullFlags, InvalidFlags, Description
stack_12 = CreateStack(UIElements=entwine_16, Horizontal=invert(True))
event_9 = EventGate(Data=ma_2.Result)  # -> Data, IsNew
settextbox = SetTextBoxContents(TextBoxToModify=textbox_7, NewTextBoxContents=current_selected_model_assembly_module_n_2)
number_of_louvers_2 = RemoteReceiver(number_of_louvers)
number_of_louvers_3 = RemoteReceiver(number_of_louvers)
number_of_louvers_4 = RemoteReceiver(number_of_louvers)
event_10 = EventGate(Data=ma_3.Result)  # -> Data, IsNew
division_3 = Division(A=filter_7, B="100")
dam_2 = DataDam(DataA=event_9.Data, BufferDelay=2500000, BufferMode=2)
stack_13 = CreateStack(UIElements=entwine_17, Horizontal=invert(True))
filter_8 = StreamFilter(Gate=null_7.NullFlags, Stream0=decnstrloc.name, Stream1="Could not find location")
filter_9 = StreamFilter(Gate=null_7.NullFlags, Stream0=ColourSwatch(SwatchColor=RGB(0, 0, 0)), Stream1=ColourSwatch(SwatchColor=RGB(255, 0, 0)))
filter_10 = StreamFilter(Gate=null_7.NullFlags, Stream0=values_47.Values, Stream1=panel_46)
dam_3 = DataDam(DataA=event_10.Data, BufferDelay=2500000, BufferMode=2)
generate_wwr = RemoteSender(division_3)
hideshow = HideShowElement(ElementToHideShow=slider, Show=values_48.Values, Collapse=invert(True), Disable=False)
equals_3 = Equality(FirstNumber=event_9.Data, SecondNumber=dam_2)  # -> Equality, Inequality
entwine_18 = Entwine(Branch00=textbox_9, Branch01=button_13, FlattenInputs=True)  # -> flatten(Result)
hideshow_2 = HideShowElement(ElementToHideShow=stack_9, Show=number_of_louvers_2, Collapse=True, Disable=False)
hideshow_3 = HideShowElement(ElementToHideShow=stack_12, Show=number_of_louvers_4, Collapse=True, Disable=False)
hideshow_4 = HideShowElement(ElementToHideShow=stack_10, Show=number_of_louvers_3, Collapse=True, Disable=False)
format_15 = Format(Format="Location: {0}", Culture=127, Data0=filter_8)
location = RemoteSender(filter_10)
equals_4 = Equality(FirstNumber=event_10.Data, SecondNumber=dam_3)  # -> Equality, Inequality
event_11 = EventGate(Data=equals_3.Inequality)  # -> Data, IsNew
entwine_19 = Entwine(
    Branch00=label_8,
    Branch01=checkbox_4,
    Branch02=checkbox_8,
    Branch03=checkbox_7,
    Branch04=checkbox_6,
    Branch05=checkbox_5,
    Branch06=checkbox_3,
    Branch07=checkbox,
    Branch08=checkbox_2,
    Branch09=button_8,
    FlattenInputs=True)  # -> flatten(Result)
adjustpos_16 = AdjustElementPositioning(ElementsToAdjust=textbox_9, AbsolutePositioning=False, Width=Slider(200, range=0..1000), HorizontalAlignment=0)
adjustpos_17 = AdjustElementPositioning(
    ElementsToAdjust=button_13,
    Margin="5, 0, 0, 0",
    AbsolutePositioning=False,
    Width=Slider(200, range=0..1000),
    HorizontalAlignment=0)
stack_14 = CreateStack(UIElements=entwine_18, Horizontal=invert(True))
entwine_20 = Entwine(Branch00=label_10, Branch01=stack_13, FlattenInputs=True)  # -> flatten(Result)
entwine_21 = Entwine(Branch00=stack_11, Branch01=stack_9, Branch02=stack_10, Branch03=stack_12, FlattenInputs=True)  # -> flatten(Result)
adjustelem_8 = AdjustElementAppearance(ElementsToAdjust=label_15, Foreground=filter_9)
setlabel = SetLabelContents(LabelToModify=label_15, NewLabelContents=format_15)
entwine_22 = Entwine(Branch00=label_9, Branch01=textbox_8, FlattenInputs=True)  # -> flatten(Result)
event_12 = EventGate(Data=equals_4.Inequality)  # -> Data, IsNew
stack_15 = CreateStack(UIElements=entwine_19, Horizontal=invert(True))
panel_48 = Panel(event_12.Data)
stack_16 = CreateStack(UIElements=entwine_20, Horizontal=invert(True))
format_16 = Format(Format="{0}, {1}, 0, 0", Culture=127, Data0=Slider(5, range=-25..25), Data1=Slider(13, range=0..100))
format_17 = Format(Format="{0}, {1}, 0, 0", Culture=127, Data0=Slider(5, range=-25..25), Data1=Slider(10, range=0..100))
stack_17 = CreateStack(UIElements=entwine_22, Horizontal=invert(True))
border = CreateBorder(
    UIElement=stack_15,
    BorderThickness=Slider(1, range=0..10),
    BorderColor=ColourSwatch(SwatchColor=RGB(217, 217, 217)),
    CornerRadius=Slider(2, range=0..10))
adjustpos_18 = AdjustElementPositioning(
    ElementsToAdjust=textbox_8,
    Margin="0, 5, 0, 5",
    AbsolutePositioning=False,
    Width=Slider(210, range=0..300),
    Height=Slider(30, range=0..300),
    HorizontalAlignment=0)
adjustpos_19 = AdjustElementPositioning(ElementsToAdjust=label_10, Margin="0, 5, 0, 0", AbsolutePositioning=False, HorizontalAlignment=0, VerticalAlignment=2)
adjustpos_20 = AdjustElementPositioning(ElementsToAdjust=slider, Margin="10, 5, 0, 0", AbsolutePositioning=False, HorizontalAlignment=0, VerticalAlignment=2)
adjustpos_21 = AdjustElementPositioning(
    ElementsToAdjust=button_8,
    Margin="5, 10, 5, 5",
    AbsolutePositioning=False,
    Width=Slider(98, range=0..100),
    HorizontalAlignment=0,
    VerticalAlignment=2)
entwine_23 = Entwine(Branch00=label_15, Branch01=stack_14, FlattenInputs=True)  # -> flatten(Result)
adjustpos_22 = AdjustElementPositioning(ElementsToAdjust=stack_15, Margin="5, 0, 5, 5", AbsolutePositioning=False, HorizontalAlignment=0, VerticalAlignment=2)
adjustpos_23 = AdjustElementPositioning(ElementsToAdjust=border, Margin="25, 5, 0, 0", AbsolutePositioning=False, HorizontalAlignment=0, VerticalAlignment=2)
adjustpos_24 = AdjustElementPositioning(ElementsToAdjust=label_15, Margin="0, 5, 0, 0", AbsolutePositioning=False, HorizontalAlignment=0)
adjustpos_25 = AdjustElementPositioning(ElementsToAdjust=stack_14, AbsolutePositioning=False, Width=Slider(210, range=0..1000), HorizontalAlignment=0)
adjustpos_26 = AdjustElementPositioning(
    ElementsToAdjust=[button_10, button_7, button_11],
    Margin="5, 5, 0, 0",
    AbsolutePositioning=False,
    Height=Slider(29, range=0..100),
    HorizontalAlignment=0)
adjustpos_27 = AdjustElementPositioning(
    ElementsToAdjust=textbox_7,
    Margin="5, 5, 0, 0",
    AbsolutePositioning=False,
    Width=Slider(280, range=0..350),
    Height=Slider(29, range=0..100),
    HorizontalAlignment=0)
adjustpos_28 = AdjustElementPositioning(ElementsToAdjust=button_12, Margin=format_16, AbsolutePositioning=False, HorizontalAlignment=0, VerticalAlignment=2)
adjustpos_29 = AdjustElementPositioning(
    ElementsToAdjust=pulldown_5,
    Margin=format_17,
    AbsolutePositioning=False,
    Width=Slider(275, range=0..400),
    HorizontalAlignment=0,
    VerticalAlignment=2)
stack_18 = CreateStack(UIElements=entwine_21, Horizontal=True)

# ----
freeze_gate_5 = StreamFreezeGate(Data=values_24.Values, PassingSwitch=invert(values_24.Values))
event_13 = EventGate(Data=values_24.Values)  # -> Data, IsNew
event_14 = EventGate(Data=values_25.Values)  # -> Data, IsNew
bool_4 = Boolean(invert(freeze_gate_5))
pre_sync_honeybee_model = RemoteSender(event_13.Data)
rec_5 = DataRecorder(bool_4, DataLimit=-10, RecordData=True)
panel_49 = Panel(values_29.Values)
int_3 = Integer(rec_5)
ma_4 = MassAddition(Input=int_3)  # -> Result, PartialResults
event_15 = EventGate(Data=ma_4.Result)  # -> Data, IsNew
dam_4 = DataDam(DataA=event_15.Data, BufferDelay=2500000, BufferMode=2)
equals_5 = Equality(FirstNumber=event_15.Data, SecondNumber=dam_4)  # -> Equality, Inequality
event_16 = EventGate(Data=equals_5.Inequality)  # -> Data, IsNew
adjustpos_30 = AdjustElementPositioning(
    ElementsToAdjust=button_9,
    Margin="5, 5, 0, 0",
    AbsolutePositioning=False,
    Height=Slider(29, range=0..100),
    HorizontalAlignment=0)

entwine_24 = Entwine(Branch00=pulldown_5, Branch01=button_12, FlattenInputs=True)  # -> flatten(Result)
stack_19 = CreateStack(UIElements=entwine_24, Horizontal=True)

# ----
# Visualize model
location_2 = Data(border)

entwine_25 = Entwine(Branch00=button_11, Branch01=button_7, Branch02=button_10, FlattenInputs=True)  # -> flatten(Result)
stack_20 = CreateStack(UIElements=entwine_25, Horizontal=True)

entwine_26 = Entwine(Branch00=textbox_7, Branch01=button_9, FlattenInputs=True)  # -> flatten(Result)
stack_21 = CreateStack(UIElements=entwine_26, Horizontal=True)

# ----
# Location
location_3 = Data(entwine_23)

# ----
# Louvers
location_4 = Data(stack_18)

# ----
# Model name
model_name_2 = Data(stack_17)

# ----
# Generate using WWR
location_5 = Data(stack_16)

# ----
# Create model
entwine_27 = Entwine(Branch00=stack_19, Branch01=stack_20, Branch02=stack_21, FlattenInputs=True)  # -> flatten(Result)
stack_22 = CreateStack(UIElements=entwine_27, Horizontal=invert(True))
create_model = Data(stack_22)

entwine_28 = Entwine(Branch00=model_name_2, Branch01=location_5, Branch02=location_3, FlattenInputs=True)  # -> flatten(Result)
stack_23 = CreateStack(UIElements=entwine_28, Horizontal=invert(True))

entwine_29 = Entwine(Branch00=stack_23, Branch01=location_2, FlattenInputs=True)  # -> flatten(Result)
stack_24 = CreateStack(UIElements=entwine_29, Horizontal=True)

entwine_30 = Entwine(Branch00=stack_24, Branch01=create_model, FlattenInputs=True)  # -> flatten(Result)
stack_25 = CreateStack(UIElements=entwine_30, Horizontal=invert(True))

# ----
# Get climate data
# https://energyplus-weather.s3.amazonaws.com/europe_wmo_region_6/SWE/SWE_Goteborg.Landvetter.025260_IWEC/SWE_Goteborg.Landvetter.025260_IWEC.zip
getclimatedata_2 = RemoteReceiver(getclimatedata)
location_6 = RemoteReceiver(location)
panel_50 = Panel(getclimatedata_2)
epwmap = LBEPWmap(epw_map=getclimatedata_2)  # -> report; plug-in component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

pre_sync_honeybee_model_2 = RemoteReceiver(pre_sync_honeybee_model)
current_selected_model_assembly_module_2 = RemoteReceiver(current_selected_model_assembly_module)
rename_current_model_name_2 = RemoteReceiver(rename_current_model_name)
rename_current_model_2 = RemoteReceiver(rename_current_model)
remove_current_model_2 = RemoteReceiver(remove_current_model)
current_selected_model_assembly_module_3 = RemoteReceiver(current_selected_model_assembly_module)
# Models created during
# the current session
panel_51 = Panel(rename_current_model_2)
location_7 = RemoteReceiver(location)  # disabled
location_8 = RemoteReceiver(location)
location_9 = RemoteReceiver(location)

# ---- group: Visualize module
panel_52 = Panel("""properties.energy.construction.display_name
properties.energy.construction.layers
properties.energy.construction.thickness
properties.energy.construction.mass_area_density
properties.energy.construction.area_heat_capacity
properties.energy.construction.r_value
properties.energy.construction.u_value
properties.energy.construction.u_factor
properties.energy.construction.shgc
properties.energy.r_factor
properties.energy.u_factor
properties.energy.shgc""")
panel_53 = Panel("""properties.energy.program_type.display_name
properties.energy.construction_set.display_name
properties.energy.is_conditioned
properties.energy.people.people_per_area
properties.energy.people.area_per_person
properties.energy.lighting.watts_per_area
properties.energy.electric_equipment.watts_per_area
properties.energy.gas_equipment.watts_per_area
properties.energy.service_hot_water.flow_per_area""")
panel_54 = Panel("""Sky dome
Sky mask
Wind rose
Dry bulb temperature line chart
Dry bulb temperature 2D chart
Direct sun hours
Incident radiation""")
panel_55 = Panel("""display_name
identifier
multiplier
exclude_floor_area
story
volume
floor_area
exposed_area
exterior_wall_area
exterior_aperture_area
average_floor_height""")
panel_56 = Panel("""display_name
identifier
boundary_condition
has_parent
parent
azimuth
altitude
area
perimeter
type
is_operable
is_glass""")
button_14 = CreateButton(ButtonName="Run weather visualization", ButtonStyle=0)
button_15 = CreateButton(ButtonName="Zoom", ButtonStyle=0)
button_16 = CreateButton(ButtonName="Bake", ButtonStyle=0)
label_16 = CreateLabel(LabelText="Weather visualization", LabelSize=18, Justification=0)
values_49 = ValueListener(Elements=button_15, SomeProperty=True)  # -> Values, Indices
values_50 = ValueListener(Elements=button_16, SomeProperty=True)  # -> Values, Indices
values_51 = ValueListener(Elements=button_14, SomeProperty=True)  # -> Values, Indices
checkbox_9 = CreateCheckbox(Label="Show", StartingValue=False)
pulldown_6 = CreatePulldownMenu(Label="Display type", ListItems=panel_54, showLabel=True)
panel_57 = Panel("""Program
Construction Set
Is Conditioned
People per Area [ppl/m2]
Area per Person [m2/ppl]
Lighting per Area [W/m2]
Electric Equipment per Area [W/m2]
Gas Equipment per Area [W/m2]
Hot Water per Area [L/h-m2]""")
panel_58 = Panel("""Display Name
Simulation Name (Identifier)
Boundary Condition
Has Parent
Parent
Azimuth
Altitude
Area
Perimeter
Face Type
Aperture Is Operable
Door Is Glass""")
panel_59 = Panel("""Construction
Materials
Thickness [m]
Density [kg/m2]
Heat Capacity [J/K-m2]
Construction R-Value [m2-K/W]
Construction U-Value [W/m2-K]
Construction U-Factor [W/m2-K]
Construction SHGC [Unshaded]
R-Factor [m2-K/W]
U-Factor [W/m2-K]
SHGC [Unshaded]""")
panel_60 = Panel("""Display Name
Simulation Name (Identifier)
Multiplier
Floor Area Excluded
Story
Volume
Gross Floor Area
Exposed Area
Exterior Wall Area
Exterior Aperture Area
Average Floor Elevation""")
zoom_weather_visualization = RemoteSender(values_49.Values)
freeze_gate_6 = StreamFreezeGate(Data=values_50.Values, PassingSwitch=invert(values_50.Values))
freeze_gate_7 = StreamFreezeGate(Data=values_51.Values, PassingSwitch=invert(values_51.Values))
values_52 = ValueListener(Elements=checkbox_9, SomeProperty=True)  # -> Values, Indices
values_53 = ValueListener(Elements=pulldown_6, SomeProperty=True)  # -> Values, Indices
bool_5 = Boolean(invert(freeze_gate_6))
bool_6 = Boolean(invert(freeze_gate_7))
entwine_31 = Entwine(Branch00=pulldown_6, Branch01=checkbox_9, FlattenInputs=True)  # -> flatten(Result)
weather_visualization_type = RemoteSender(values_53.Indices)
tap_2 = TapBuffer(Reset=False, Incremental=True, Valve=bool_5, Hold=True)
tap_3 = TapBuffer(Reset=False, Incremental=True, Valve=bool_6, Hold=True)
stack_26 = CreateStack(UIElements=entwine_31, Horizontal=True)
pulldown_7 = CreatePulldownMenu(Label="Room attribute", ListItems=panel_60, showLabel=True)
pulldown_8 = CreatePulldownMenu(Label="Room energy attribute", ListItems=panel_57, showLabel=True)
checkbox_10 = CreateCheckbox(Label="Show", StartingValue=False)
checkbox_11 = CreateCheckbox(Label="Show", StartingValue=False)
label_17 = CreateLabel(LabelText="Model visualization", LabelSize=18, Justification=0)
checkbox_12 = CreateCheckbox(Label="Show", StartingValue=False)
pulldown_9 = CreatePulldownMenu(Label="Face attribute", ListItems=panel_58, showLabel=True)
dam_5 = DataDam(DataA=tap_2, BufferDelay=2500000, BufferMode=2)
dam_6 = DataDam(DataA=tap_3, BufferDelay=2500000, BufferMode=2)
entwine_32 = Entwine(Branch00=button_14, Branch01=button_15, Branch02=button_16, FlattenInputs=True)  # -> flatten(Result)
pulldown_10 = CreatePulldownMenu(Label="Face energy attribute", ListItems=panel_59, showLabel=True)
checkbox_13 = CreateCheckbox(Label="Show", StartingValue=False)
equals_6 = Equality(FirstNumber=tap_3, SecondNumber=dam_6)  # -> Equality, Inequality
equals_7 = Equality(FirstNumber=tap_2, SecondNumber=dam_5)  # -> Equality, Inequality
values_54 = ValueListener(Elements=checkbox_11, SomeProperty=True)  # -> Values, Indices
values_55 = ValueListener(Elements=pulldown_8, SomeProperty=True)  # -> Values, Indices
entwine_33 = Entwine(Branch00=pulldown_7, Branch01=checkbox_10, FlattenInputs=True)  # -> flatten(Result)
entwine_34 = Entwine(Branch00=pulldown_8, Branch01=checkbox_11, FlattenInputs=True)  # -> flatten(Result)
values_56 = ValueListener(Elements=pulldown_7, SomeProperty=True)  # -> Values, Indices
values_57 = ValueListener(Elements=pulldown_9, SomeProperty=True)  # -> Values, Indices
values_58 = ValueListener(Elements=checkbox_10, SomeProperty=True)  # -> Values, Indices
values_59 = ValueListener(Elements=checkbox_12, SomeProperty=True)  # -> Values, Indices
values_60 = ValueListener(Elements=pulldown_10, SomeProperty=True)  # -> Values, Indices
values_61 = ValueListener(Elements=checkbox_13, SomeProperty=True)  # -> Values, Indices
stack_27 = CreateStack(UIElements=entwine_32, Horizontal=True)
item_2 = ListItem(List=panel_53, Index=values_55.Indices, Wrap=invert(True))
item_3 = ListItem(List=panel_55, Index=values_56.Indices, Wrap=invert(True))
stack_28 = CreateStack(UIElements=entwine_34, Horizontal=True)
item_4 = ListItem(List=panel_56, Index=values_57.Indices, Wrap=invert(True))
stack_29 = CreateStack(UIElements=entwine_33, Horizontal=True)
item_5 = ListItem(List=panel_52, Index=values_60.Indices, Wrap=invert(True))
room_energy_attribute = RemoteSender(item_2)
room_attribute = RemoteSender(item_3)
entwine_35 = Entwine(Branch00=stack_27, Branch01=tb, Branch02=stack_26, FlattenInputs=True)  # -> flatten(Result)
face_attribute = RemoteSender(item_4)
entwine_36 = Entwine(Branch00=pulldown_10, Branch01=checkbox_13, FlattenInputs=True)  # -> flatten(Result)
face_energy_attribute = RemoteSender(item_5)
entwine_37 = Entwine(Branch00=pulldown_9, Branch01=checkbox_12, FlattenInputs=True)  # -> flatten(Result)
stack_30 = CreateStack(UIElements=entwine_35, Horizontal=invert(True))
stack_31 = CreateStack(UIElements=entwine_36, Horizontal=True)
stack_32 = CreateStack(UIElements=entwine_37, Horizontal=True)
entwine_38 = Entwine(Branch00=label_17, Branch01=stack_29, Branch02=stack_28, Branch03=stack_32, Branch04=stack_31, FlattenInputs=True)  # -> flatten(Result)
adjustpos_31 = AdjustElementPositioning(ElementsToAdjust=stack_30, AbsolutePositioning=False, Width=Slider(300, range=0..300), HorizontalAlignment=0)
adjustpos_32 = AdjustElementPositioning(ElementsToAdjust=pulldown_6, Margin="5, 5, 0, 0", AbsolutePositioning=False, Width=Slider(215, range=0..400))
adjustpos_33 = AdjustElementPositioning(ElementsToAdjust=checkbox_9, Margin="5, 5, 0, 0", AbsolutePositioning=False)
hideshow_5 = HideShowElement(ElementToHideShow=checkbox_10, Show=True, Collapse=True, Disable=values_54.Values)
hideshow_6 = HideShowElement(ElementToHideShow=checkbox_11, Show=True, Collapse=True, Disable=values_58.Values)
hideshow_7 = HideShowElement(ElementToHideShow=checkbox_13, Show=True, Collapse=True, Disable=values_59.Values)
hideshow_8 = HideShowElement(ElementToHideShow=checkbox_12, Show=True, Collapse=True, Disable=values_61.Values)
stack_33 = CreateStack(UIElements=entwine_38, Horizontal=invert(True))
border_2 = CreateBorder(
    UIElement=stack_30,
    BorderThickness=Slider(1, range=0..10),
    BorderColor=ColourSwatch(SwatchColor=RGB(217, 217, 217)),
    CornerRadius=Slider(2, range=0..10))
border_3 = CreateBorder(
    UIElement=stack_33,
    BorderThickness=Slider(1, range=0..10),
    BorderColor=ColourSwatch(SwatchColor=RGB(217, 217, 217)),
    CornerRadius=Slider(2, range=0..10))
entwine_39 = Entwine(Branch00=label_16, Branch01=border_2, FlattenInputs=True)  # -> flatten(Result)
entwine_40 = Entwine(Branch00=label_17, Branch01=border_3, FlattenInputs=True)  # -> flatten(Result)
adjustpos_34 = AdjustElementPositioning(ElementsToAdjust=border_2, AbsolutePositioning=False, HorizontalAlignment=0, VerticalAlignment=2)
adjustpos_35 = AdjustElementPositioning(ElementsToAdjust=border_3, Margin="0, 0, 0, 10", AbsolutePositioning=False, HorizontalAlignment=0, VerticalAlignment=2)
adjustpos_36 = AdjustElementPositioning(ElementsToAdjust=[checkbox_10, checkbox_11, checkbox_12, checkbox_13], Margin="0, 0, 10, 0", AbsolutePositioning=False)
adjustpos_37 = AdjustElementPositioning(
    ElementsToAdjust=[pulldown_7, pulldown_8, pulldown_9, pulldown_10],
    AbsolutePositioning=False,
    Width=Slider(239, range=0..400),
    HorizontalAlignment=0)

# ----
# Run weather visualization
location_10 = Data(entwine_39)

# ----
# Attributes visualization
location_11 = Data(entwine_40)

entwine_41 = Entwine(Branch00=select_model_2, Branch01=location_11, Branch02=location_10, FlattenInputs=True)  # -> flatten(Result)

# ---- group: Geometry module
panel_61 = Panel("""This document is currently in {0}.
Honeybee models require models in meters.""")
panel_62 = Panel("""None
Room
Window
Adjacent
Context
All""")
panel_63 = Panel("""Room
Window
Adjacent
Context
None""")
panel_64 = Panel("""Could not save geometry. 
It was not of the correct type.""")
number_slider_18 = Slider(15, range=0..20)
number_slider_19 = Slider(15, range=0..20)
number_slider_20 = Slider(15, range=0..20)
number_slider_21 = Slider(15, range=0..20)
number_slider_22 = Slider(10, range=0..10)
number_slider_23 = Slider(10, range=0..10)
number_slider_24 = Slider(10, range=0..10)
number_slider_25 = Slider(10, range=0..10)
button_17 = CreateButton(ButtonName="Change document units", ButtonStyle=0)
tb_3 = CreateTextBlock(TextSize=12, Justification=0)
label_18 = CreateLabel(LabelText="Import geometry", LabelSize=18, Justification=0)
listbox = CreateListBox(ListItems=panel_62, SelectedIndex=0, Height=100)
label_19 = CreateLabel(LabelText="Preview geometry", LabelSize=18, Justification=0)
pulldown_11 = CreatePulldownMenu(Label="Geometry type", ListItems=panel_63, showLabel=True)
true_button_7 = CreateTrueOnlyButton(ButtonName="?", ButtonStyle=2)
button_18 = CreateButton(ButtonName="Save geometry", ButtonStyle=0)
pt_9 = ConstructPoint(XCoordinate=Slider(10, range=0..10), YCoordinate=Slider(-20, range=-100..0), ZCoordinate=0)
pt_10 = ConstructPoint(XCoordinate=Slider(10, range=0..10), YCoordinate=Slider(-20, range=-100..0), ZCoordinate=0)
pt_11 = ConstructPoint(XCoordinate=Slider(10, range=0..10), YCoordinate=Slider(-20, range=-100..0), ZCoordinate=0)
pt_12 = ConstructPoint(XCoordinate=Slider(10, range=0..10), YCoordinate=Slider(-20, range=-100..0), ZCoordinate=0)
label_20 = CreateLabel(LabelText=panel_64, LabelSize=12, Justification=0)
button_19 = CreateButton(ButtonName="Create test model", ButtonStyle=0)
values_62 = ValueListener(Elements=listbox, SomeProperty=True)  # -> Values, Indices
rectangle = Rectangle(Plane=PlaneXY(0, 0, 0), XSize=number_slider_24, YSize=number_slider_24, Radius=0)  # -> Rectangle, Length
rectangle_2 = Rectangle(Plane=PlaneXY(0, 0, 0), XSize=number_slider_23, YSize=number_slider_23, Radius=0)  # -> Rectangle, Length
rectangle_3 = Rectangle(Plane=pt_9, XSize=number_slider_20, YSize=number_slider_20, Radius=0)  # -> Rectangle, Length
rectangle_4 = Rectangle(Plane=pt_10, XSize=number_slider_19, YSize=number_slider_19, Radius=0)  # -> Rectangle, Length
rectangle_5 = Rectangle(Plane=PlaneXY(0, 0, 0), XSize=number_slider_25, YSize=number_slider_25, Radius=0)  # -> Rectangle, Length
values_63 = ValueListener(Elements=button_17, SomeProperty=True)  # -> Values, Indices
rectangle_6 = Rectangle(Plane=pt_11, XSize=number_slider_21, YSize=number_slider_21, Radius=0)  # -> Rectangle, Length
rectangle_7 = Rectangle(Plane=PlaneXY(0, 0, 0), XSize=number_slider_22, YSize=number_slider_22, Radius=0)  # -> Rectangle, Length
rectangle_8 = Rectangle(Plane=pt_12, XSize=number_slider_18, YSize=number_slider_18, Radius=0)  # -> Rectangle, Length
values_64 = ValueListener(Elements=pulldown_11, SomeProperty=True)  # -> Values, Indices
values_65 = ValueListener(Elements=true_button_7, SomeProperty=True)  # -> Values, Indices
number_slider_26 = Slider(29, range=0..300)
values_66 = ValueListener(Elements=button_18, SomeProperty=True)  # -> Values, Indices
values_67 = ValueListener(Elements=button_19, SomeProperty=True)  # -> Values, Indices
shapes = CreateShapes(Shapes=rectangle.Rectangle, StrokeColor=RGB(0, 0, 0), Scale=1, ClickMode=3)
shapes_2 = CreateShapes(Shapes=rectangle_2.Rectangle, StrokeColor=RGB(0, 0, 0), Scale=1, ClickMode=3)
shapes_3 = CreateShapes(Shapes=rectangle_5.Rectangle, StrokeColor=RGB(0, 0, 0), Scale=1, ClickMode=3)
shapes_4 = CreateShapes(Shapes=rectangle_7.Rectangle, StrokeColor=RGB(0, 0, 0), Scale=1, ClickMode=3)
previewtype = RemoteSender(values_62.Values)
change_document_units = RemoteSender(values_63.Values)
bool_7 = Boolean(values_62.Indices)
geometrytype_validate = RemoteSender(values_64.Indices)
geometrytype = RemoteSender(values_64.Values)
geometry_module_state_import_type = RemoteSender(values_64.Indices)
adjustelem_9 = AdjustElementAppearance(ElementsToAdjust=tb_3, Foreground=ColourSwatch(SwatchColor=RGB(0, 0, 0)))
info_save_geometry = RemoteSender(values_65.Values)
adjustelem_10 = AdjustElementAppearance(
    ElementsToAdjust=true_button_7,
    Foreground=ColourSwatch(SwatchColor=RGB(0, 0, 0)),
    Background=ColourSwatch(SwatchColor=RGB(230, 230, 230)),
    FontSize=Slider(12, range=0..300))
freeze_gate_8 = StreamFreezeGate(Data=values_66.Values, PassingSwitch=invert(values_66.Values))
presavegeometry = RemoteSender(values_66.Values)
freeze_gate_9 = StreamFreezeGate(Data=values_67.Values, PassingSwitch=invert(values_67.Values))
bool_8 = Boolean(invert(freeze_gate_8))
adjustpos_38 = AdjustElementPositioning(ElementsToAdjust=true_button_7, AbsolutePositioning=False, Width=number_slider_26, Height=number_slider_26)
bool_9 = Boolean(invert(freeze_gate_9))
entwine_42 = Entwine(Branch00=button_18, Branch01=true_button_7, FlattenInputs=True)  # -> flatten(Result)
setshapes = SetShapes(
    ShapeToModify=shapes,
    ShapeCurves=rectangle_3.Rectangle,
    FillColors=ColourSwatch(SwatchColor=RGBA(128, 0, 102, 75)),
    StrokeColors=ColourSwatch(SwatchColor=RGB(255, 255, 255)),
    Scale=1)
setshapes_2 = SetShapes(
    ShapeToModify=shapes_2,
    ShapeCurves=rectangle_4.Rectangle,
    FillColors=ColourSwatch(SwatchColor=RGBA(4, 128, 0, 75)),
    StrokeColors=ColourSwatch(SwatchColor=RGB(255, 255, 255)),
    Scale=1)
setshapes_3 = SetShapes(
    ShapeToModify=shapes_3,
    ShapeCurves=rectangle_6.Rectangle,
    FillColors=ColourSwatch(SwatchColor=RGBA(0, 17, 128, 75)),
    StrokeColors=ColourSwatch(SwatchColor=RGB(255, 255, 255)),
    Scale=1)
setshapes_4 = SetShapes(
    ShapeToModify=shapes_4,
    ShapeCurves=rectangle_8.Rectangle,
    FillColors=ColourSwatch(SwatchColor=RGBA(128, 125, 0, 75)),
    StrokeColors=ColourSwatch(SwatchColor=RGB(255, 255, 255)),
    Scale=1)
tap_4 = TapBuffer(Reset=False, Incremental=True, Valve=bool_8, Hold=True)
tap_5 = TapBuffer(Reset=False, Incremental=True, Valve=bool_9, Hold=True)
entwine_43 = Entwine(Branch00=tb_3, Branch01=button_17, FlattenInputs=True)  # -> flatten(Result)
stack_34 = CreateStack(UIElements=entwine_42, Horizontal=True)
dam_7 = DataDam(DataA=tap_4, BufferDelay=2500000, BufferMode=2)
dam_8 = DataDam(DataA=tap_5, BufferDelay=2500000, BufferMode=2)
stack_35 = CreateStack(UIElements=entwine_43, Horizontal=invert(True))
equals_8 = Equality(FirstNumber=tap_4, SecondNumber=dam_7)  # -> Equality, Inequality
entwine_44 = Entwine(Branch00=stack_34, Branch01=label_20, FlattenInputs=True)  # -> flatten(Result)
equals_9 = Equality(FirstNumber=tap_5, SecondNumber=dam_8)  # -> Equality, Inequality
format_18 = Format(Format="{0}, {1}, 0, 0", Culture=127, Data0=Slider(5, range=0..25), Data1=Slider(25, range=0..50))
adjustpos_39 = AdjustElementPositioning(ElementsToAdjust=button_19, Margin=format_18, AbsolutePositioning=False)
adjustpos_40 = AdjustElementPositioning(
    ElementsToAdjust=listbox,
    AbsolutePositioning=False,
    Width=Slider(150, range=0..300),
    Height=Slider(150, range=0..300),
    HorizontalAlignment=0)
# FLY!
# Simulations
# Metahopper recursions
# Launch website
entwine_45 = Entwine(Branch00=label_18, Branch01=pulldown_11, Branch02=entwine_44, FlattenInputs=True)  # -> flatten(Result)
adjustpos_41 = AdjustElementPositioning(ElementsToAdjust=button_17, AbsolutePositioning=False, Width=Slider(150, range=0..800), HorizontalAlignment=0)
adjustpos_42 = AdjustElementPositioning(ElementsToAdjust=stack_35, Margin="5, 5, 0, 0", AbsolutePositioning=False, Width=Slider(160, range=0..800))
entwine_46 = Entwine(Branch00=shapes_2, Branch01=shapes, Branch02=shapes_3, Branch03=shapes_4, FlattenInputs=True)  # -> flatten(Result)
stack_36 = CreateStack(UIElements=entwine_46, Horizontal=invert(True))
entwine_47 = Entwine(Branch00=stack_36, Branch01=listbox, FlattenInputs=True)  # -> flatten(Result)
stack_37 = CreateStack(UIElements=entwine_47, Horizontal=True)
border_4 = CreateBorder(
    UIElement=stack_35,
    BorderThickness=Slider(1, range=0..10),
    BorderColor=ColourSwatch(SwatchColor=RGB(255, 0, 0)),
    CornerRadius=Slider(1, range=0..10))
stack_38 = CreateStack(UIElements=entwine_45, Horizontal=invert(True))
entwine_48 = Entwine(Branch00=label_19, Branch01=stack_37, FlattenInputs=True)  # -> flatten(Result)
adjustpos_43 = AdjustElementPositioning(ElementsToAdjust=pulldown_11, AbsolutePositioning=False, Width=Slider(180, range=0..300), HorizontalAlignment=0)
adjustelem_11 = AdjustElementAppearance(ElementsToAdjust=label_20, Foreground=ColourSwatch(SwatchColor=RGB(255, 0, 0)))
adjustpos_44 = AdjustElementPositioning(ElementsToAdjust=stack_36, Margin="0, 26, 5, 0", AbsolutePositioning=False, HorizontalAlignment=0)
adjustpos_45 = AdjustElementPositioning(
    ElementsToAdjust=[shapes_4, shapes_3, shapes, shapes_2],
    Margin="0, 0, 0, 4",
    AbsolutePositioning=False,
    HorizontalAlignment=0)

# Document units
doc_units = DocumentUnits()
change_document_units_2 = RemoteReceiver(change_document_units)
document_units = RemoteSender(doc_units)
gate = StreamGate(Stream="4", Gate=change_document_units_2)  # -> Target0, Target1
unit_warning = UnitWarning(UnitSystem=gate.Target1)

# ----
# Preview
preview = Data(entwine_48)

# ----
# Document unit warning text
location_12 = Data(border_4)

# ----
# Model visualization
# Model creation
# Zoom and bake geometry
# Geometry handling
# Assign type
assign_type = Data(stack_38)

# ----
# Test model
location_13 = Data(button_19)

entwine_49 = Entwine(Branch00=assign_type, Branch01=location_12, FlattenInputs=True)  # -> flatten(Result)
stack_39 = CreateStack(UIElements=entwine_49, Horizontal=True)

presavegeometry_2 = RemoteReceiver(presavegeometry)
document_units_2 = RemoteReceiver(document_units)
document_units_3 = RemoteReceiver(document_units)
document_units_4 = RemoteReceiver(document_units)
document_units_5 = RemoteReceiver(document_units)
previewtype_2 = RemoteReceiver(previewtype)
previewtype_3 = RemoteReceiver(previewtype)
previewtype_4 = RemoteReceiver(previewtype)
previewtype_5 = RemoteReceiver(previewtype)
expression_8 = Expression(x=document_units_2, y="Meters", Expression="x=y")
expression_9 = Expression(x=previewtype_3, y="All", Expression="x=y")
expression_10 = Expression(x=document_units_3, y="Meters", Expression="x=y")
expression_11 = Expression(x="Room", y=previewtype_3, Expression="x=y")
geometrytype_2 = RemoteReceiver(geometrytype)
expression_12 = Expression(x=document_units_4, y="Meters", Expression="x=y")
expression_13 = Expression(x=previewtype_2, y="All", Expression="x=y")
expression_14 = Expression(x=document_units_5, y="Meters", Expression="x=y")
expression_15 = Expression(x="Context", y=previewtype_2, Expression="x=y")
expression_16 = Expression(x="Window", y=previewtype_5, Expression="x=y")
expression_17 = Expression(x=previewtype_5, y="All", Expression="x=y")
expression_18 = Expression(x="Adjacent", y=previewtype_4, Expression="x=y")
expression_19 = Expression(x=previewtype_4, y="All", Expression="x=y")
or = GateOr(A=expression_15, B=expression_13)
or_2 = GateOr(A=expression_11, B=expression_9)
or_3 = GateOr(A=expression_16, B=expression_17)
or_4 = GateOr(A=expression_18, B=expression_19)
gate_2 = StreamGate(Stream="Adjacent", Gate=or_4)  # -> Target0, Target1
gate_3 = StreamGate(Stream="Context", Gate=or)  # -> Target0, Target1
gate_4 = StreamGate(Stream="Room", Gate=or_2)  # -> Target0, Target1
gate_5 = StreamGate(Stream="Window", Gate=or_3)  # -> Target0, Target1
geometrytype_validate_2 = RemoteReceiver(geometrytype_validate)

# ---- group: Program module
panel_65 = Panel("""LargeOffice
MediumOffice
SmallOffice
MidriseApartment
HighriseApartment
Retail
StripMall
PrimarySchool
SecondarySchool
SmallHotel
LargeHotel
Hospital
Outpatient
Laboratory
Warehouse
SuperMarket
FullServiceRestaurant
QuickServiceRestaurant
Courthouse
LargeDataCenterHighITE
LargeDataCenterLowITE
SmallDataCenterHighITE
SmallDataCenterLowITE""")
cooling_setpoint_ºc = Slider(27, range=10..40)
heating_setpoint_ºc = Slider(21, range=10..40)
empty_2 = EmptyObjectToEmptyBranch()
pulldown_12 = CreatePulldownMenu(Label="Room type", ListItems=empty_2, showLabel=True)
label_21 = CreateLabel(LabelText="Select program", LabelSize=18, Justification=0)
label_22 = CreateLabel(LabelText="Program settings", LabelSize=18, Justification=0)
pulldown_13 = CreatePulldownMenu(Label="Building type", ListItems=panel_65, SelectedIndex="3", showLabel=True)
slider_6 = CreateSlider(Slider=cooling_setpoint_ºc, ShowBounds=False, ShowTicks=True, ShowTooltip=True, ShowValLabel=True, showLabel=False)
label_23 = CreateLabel(LabelText="Cooling setpoint [ºC]", LabelSize=12, Justification=0)
slider_7 = CreateSlider(Slider=heating_setpoint_ºc, ShowBounds=False, ShowTicks=True, ShowTooltip=False, ShowValLabel=True, showLabel=False)
label_24 = CreateLabel(LabelText="Heating setpoint [ºC]", LabelSize=12, Justification=0)
label_25 = CreateLabel(LabelText="Occupancy [persons/100 m2]", LabelSize=12, Justification=0)
slider_8 = CreateSlider(Slider=Slider(3, range=0..20), ShowBounds=False, ShowTicks=True, ShowTooltip=True, ShowValLabel=True, showLabel=False)
values_68 = ValueListener(Elements=pulldown_13, SomeProperty=True)  # -> Values, Indices
values_69 = ValueListener(Elements=pulldown_12, SomeProperty=True)  # -> Values, Indices
values_70 = ValueListener(Elements=slider_7, SomeProperty=True)  # -> Values, Indices
values_71 = ValueListener(Elements=slider_6, SomeProperty=True)  # -> Values, Indices
tooltip_2 = AttachTooltipToElement(ElementsToAttachTo=slider_7, TooltipContent="Doubleclick to input value", ShowDelay=500, Duration=2000)
values_72 = ValueListener(Elements=slider_8, SomeProperty=True)  # -> Values, Indices
tooltip_3 = AttachTooltipToElement(ElementsToAttachTo=slider_8, TooltipContent="Doubleclick to input value", ShowDelay=500, Duration=2000)
tooltip_4 = AttachTooltipToElement(ElementsToAttachTo=slider_6, TooltipContent="Doubleclick to input value", ShowDelay=500, Duration=2000)
selected_building = RemoteSender(values_68.Values)
selected_room = RemoteSender(values_69.Values)
cooling_setpoint = RemoteSender(values_71.Values)
cooling_setpoint_2 = RemoteReceiver(cooling_setpoint)
subtraction_6 = Subtraction(A=cooling_setpoint_2, B="1")
dom = ConstructDomain(DomainStart=Slider(10, range=0..100), DomainEnd=subtraction_6)
setslider = SetSlider(UISlider=slider_7, Range=dom)
heating_setpoint = RemoteSender(values_70.Values)
heating_setpoint_2 = RemoteReceiver(heating_setpoint)
addition = Addition(A=heating_setpoint_2, B="1")
dom_2 = ConstructDomain(DomainStart=addition, DomainEnd=Slider(40, range=0..100))
setslider_2 = SetSlider(UISlider=slider_6, Range=dom_2)
entwine_50 = Entwine(Branch00=label_23, Branch01=slider_6, FlattenInputs=True)  # -> flatten(Result)
entwine_51 = Entwine(Branch00=label_24, Branch01=slider_7, FlattenInputs=True)  # -> flatten(Result)
entwine_52 = Entwine(Branch00=label_25, Branch01=slider_8, FlattenInputs=True)  # -> flatten(Result)
number_slider_27 = Slider(300, range=0..350)
stack_40 = CreateStack(UIElements=entwine_51, Horizontal=invert(True))
stack_41 = CreateStack(UIElements=entwine_50, Horizontal=invert(True))
stack_42 = CreateStack(UIElements=entwine_52, Horizontal=invert(True))
format_19 = Format(Format="{0}, {1}, 0, 0", Culture=127, Data0=Slider(10, range=0..25), Data1=Slider(0, range=0..50))
entwine_53 = Entwine(Branch00=label_21, Branch01=pulldown_13, Branch02=pulldown_12, FlattenInputs=True)  # -> flatten(Result)
entwine_54 = Entwine(Branch00=label_22, Branch01=stack_41, Branch02=stack_40, Branch03=stack_42, FlattenInputs=True)  # -> flatten(Result)
adjustpos_46 = AdjustElementPositioning(ElementsToAdjust=pulldown_13, AbsolutePositioning=False, Width=number_slider_27, HorizontalAlignment=0)
adjustpos_47 = AdjustElementPositioning(ElementsToAdjust=pulldown_12, AbsolutePositioning=False, Width=number_slider_27, HorizontalAlignment=0)
adjustpos_48 = AdjustElementPositioning(
    ElementsToAdjust=[slider_8, slider_7, slider_6],
    Margin=format_19,
    AbsolutePositioning=False,
    Width=Slider(200, range=0..300),
    HorizontalAlignment=0)

# ----
division_4 = Division(A=values_72.Values, B="100")

# ----
# Select building and room program
location_14 = Data(entwine_53)

# ----
# Setpoints and occupancy
location_15 = Data(entwine_54)

# ---- group: Construction module
panel_66 = Panel("""Very Hot
Hot
Warm
Mixed
Cool
Cold
Very Cold
Subarctic""")
panel_67 = Panel("""SteelFramed
WoodFramed
Mass
Metal Building""")
empty_3 = EmptyObjectToEmptyBranch()
empty_4 = EmptyObjectToEmptyBranch()
empty_5 = EmptyObjectToEmptyBranch()
empty_6 = EmptyObjectToEmptyBranch()
empty_7 = EmptyObjectToEmptyBranch()
empty_8 = EmptyObjectToEmptyBranch()
empty_9 = EmptyObjectToEmptyBranch()
empty_10 = EmptyObjectToEmptyBranch()
panel_68 = Panel("Construction database")
pulldown_14 = CreatePulldownMenu(Label="Skylights", ListItems=empty_4, showLabel=True)
pulldown_15 = CreatePulldownMenu(Label="Windows", ListItems=empty_3, showLabel=True)
pulldown_16 = CreatePulldownMenu(Label="Exterior walls", ListItems=empty_6, showLabel=True)
pulldown_17 = CreatePulldownMenu(Label="Ground", ListItems=empty_5, showLabel=True)
pulldown_18 = CreatePulldownMenu(Label="Interior floors", ListItems=empty_9, showLabel=True)
pulldown_19 = CreatePulldownMenu(Label="Exterior floor", ListItems=empty_8, showLabel=True)
pulldown_20 = CreatePulldownMenu(Label="Exterior roof", ListItems=empty_7, showLabel=True)
pulldown_21 = CreatePulldownMenu(Label="Interior walls", ListItems=empty_10, showLabel=True)
true_button_8 = CreateTrueOnlyButton(ButtonName="Window database", ButtonStyle=0)
button_20 = CreateButton(ButtonName="Material database", ButtonStyle=0)
label_26 = CreateLabel(LabelText="Databases", LabelSize=18, Justification=0)
pulldown_22 = CreatePulldownMenu(Label="By climate", ListItems=panel_66, SelectedIndex=Slider(5, range=0..7), showLabel=True)
label_27 = CreateLabel(LabelText="Select base construction", LabelSize=18, Justification=0)
pulldown_23 = CreatePulldownMenu(Label="By type", ListItems=panel_67, SelectedIndex=Slider(1, range=0..3), showLabel=True)
values_73 = ValueListener(Elements=pulldown_14, SomeProperty=True)  # -> Values, Indices
values_74 = ValueListener(Elements=pulldown_15, SomeProperty=True)  # -> Values, Indices
values_75 = ValueListener(Elements=pulldown_21, SomeProperty=True)  # -> Values, Indices
values_76 = ValueListener(Elements=pulldown_18, SomeProperty=True)  # -> Values, Indices
values_77 = ValueListener(Elements=pulldown_19, SomeProperty=True)  # -> Values, Indices
values_78 = ValueListener(Elements=pulldown_17, SomeProperty=True)  # -> Values, Indices
values_79 = ValueListener(Elements=true_button_8, SomeProperty=True)  # -> Values, Indices
values_80 = ValueListener(Elements=pulldown_20, SomeProperty=True)  # -> Values, Indices
values_81 = ValueListener(Elements=button_20, SomeProperty=True)  # -> Values, Indices
values_82 = ValueListener(Elements=pulldown_16, SomeProperty=True)  # -> Values, Indices
values_83 = ValueListener(Elements=pulldown_23, SomeProperty=True)  # -> Values, Indices
subset_subface_skylight = RemoteSender(values_73.Indices)
subset_interior_wall = RemoteSender(values_75.Indices)
subset_interior_floor = RemoteSender(values_76.Indices)
subset_exterior_floor = RemoteSender(values_77.Indices)
subset_ground_floor = RemoteSender(values_78.Indices)
subset_subface_window = RemoteSender(values_74.Indices)
values_84 = ValueListener(Elements=pulldown_22, SomeProperty=True)  # -> Values, Indices
subset_exterior_roof = RemoteSender(values_80.Indices)
subset_exterior_wall = RemoteSender(values_82.Indices)
panel_69 = Panel(values_79.Values)
open_window_database = RemoteSender(values_79.Values)
base_type = RemoteSender(values_83.Values)
load_material_database = RemoteSender(values_81.Values)
addition_2 = Addition(A=values_84.Indices, B="1")
entwine_55 = Entwine(Branch00=pulldown_22, Branch01=pulldown_23, FlattenInputs=True)  # -> flatten(Result)
base_climate = RemoteSender(addition_2)
stack_43 = CreateStack(UIElements=entwine_55, Horizontal=True)
entwine_56 = Entwine(Branch00=label_27, Branch01=stack_43, FlattenInputs=True)  # -> flatten(Result)
stack_44 = CreateStack(UIElements=entwine_56, Horizontal=invert(True))
tooltip_5 = AttachTooltipToElement(ElementsToAttachTo=pulldown_23, TooltipContent="Select type of construction", ShowDelay=500, Duration=2000)
adjustpos_49 = AdjustElementPositioning(ElementsToAdjust=pulldown_23, AbsolutePositioning=False, Width=Slider(170, range=0..300), HorizontalAlignment=0)
adjustpos_50 = AdjustElementPositioning(ElementsToAdjust=pulldown_22, AbsolutePositioning=False, Width=Slider(160, range=0..300), HorizontalAlignment=0)
tooltip_6 = AttachTooltipToElement(ElementsToAttachTo=pulldown_22, TooltipContent="Select climate", ShowDelay=500, Duration=2000)
adjustpos_51 = AdjustElementPositioning(
    ElementsToAdjust=[pulldown_18, pulldown_17, pulldown_19, pulldown_20, pulldown_21, pulldown_16],
    AbsolutePositioning=False,
    Width=Slider(300, range=0..300),
    HorizontalAlignment=0)
adjustpos_52 = AdjustElementPositioning(
    ElementsToAdjust=[pulldown_15, pulldown_14],
    AbsolutePositioning=False,
    Width=Slider(300, range=0..300),
    HorizontalAlignment=0)

# ----
button_21 = CreateButton(ButtonName=panel_68, ButtonStyle=0)
freeze_gate_10 = StreamFreezeGate(Data=values_81.Values, PassingSwitch=values_81.Values)
bool_10 = Boolean(invert(freeze_gate_10))
oilcan = OilCan(DataList=panel_5, Reset=recompute_3, Drop=values_81.Values, DropMode=3)
event_17 = EventGate(Data=oilcan)  # -> Data, IsNew
open_material_database = RemoteSender(event_17.Data)

# ----
# Select subset construction
data_4 = Data(pulldown_16)
data_5 = Data(pulldown_15)
data_6 = Data(pulldown_14)
data_7 = Data(pulldown_21)
data_8 = Data(pulldown_20)
data_9 = Data(pulldown_18)
data_10 = Data(pulldown_19)
data_11 = Data(pulldown_17)
entwine_57 = Entwine(
    Branch00=data_5,
    Branch01=data_6,
    Branch02=data_4,
    Branch03=data_7,
    Branch04=data_8,
    Branch05=data_9,
    Branch06=data_10,
    Branch07=data_11,
    FlattenInputs=True)  # -> flatten(Result)
expander = CreateExpander(UIElements=entwine_57, Header="Select subset constructions", Open="False")
adjustpos_53 = AdjustElementPositioning(ElementsToAdjust=expander, Margin="0, 10, 0, 0", AbsolutePositioning=False, Width=Slider(320, range=0..350))
location_16 = Data(expander)

# ----
# Construction by climate and type
location_17 = Data(stack_44)

bldgvintages_2 = HBBuildingVintages({"ASHRAE 90.1 2019  |  IECC 2021": "2019", "ASHRAE 90.1 2016  |  IECC 2018": "2016", "ASHRAE 90.1 2013  |  IECC 2015": "2013", "ASHRAE 90.1 2010  |  IECC 2012": "2010", "ASHRAE 90.1 2007  |  IECC 2009": "2007", "ASHRAE 90.1 2004  |  IECC 2006": "2004", "1980-2004 (CBECS)": "1980_2004", "Pre-1980 (CBECS)": "pre_1980"}, selected="ASHRAE 90.1 2019  |  IECC 2021")
base_climate_2 = RemoteReceiver(base_climate)
base_type_2 = RemoteReceiver(base_type)
constrsetclimate_2 = HBConstructionSetByClimate(climate_zone=base_climate_2, vintage=bldgvintages_2, constr_type=base_type_2)  # -> constr_set; plug-in component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
panel_70 = Panel(constrsetclimate_2)

# ---- group: Geometry module (continued)
document_units_6 = RemoteReceiver(document_units)
case = TextCase(Text=document_units_6, Culture=127)  # -> UpperCase, LowerCase
format_20 = Format(Format=panel_61, Culture=127, Data0=case.LowerCase)
settextblock_2 = SetTextBlockContents(TextBlockToModify=tb_3, NewTextBlockContents=format_20)
document_units_7 = RemoteReceiver(document_units)
expression_20 = Expression(x=document_units_7, y="Meters", Expression="x=y")
hideshow_9 = HideShowElement(ElementToHideShow=border_4, Show=invert(expression_20), Collapse=True, Disable=False)

# ---- group: Analysis module
# Energy simulation
# Detailed energy simulation
# Daylight simulation
# Glare probability
# LCA calculations
panel_71 = Panel("""Illuminance [Lux]
Daylight autonomy [%]
UDI [%]
UDI <50 [%]
UDI >3000 [%]
None""")
number_slider_28 = Slider(50, range=0..100)
panel_72 = Panel("""Annual energy balance
Daily cooling profile
Daily heating profile
Cooling balance
Heating balance
None""")
panel_73 = Panel("Spatial daylight autonomy: {0}%")
height = Slider(40, range=1..100)
width = Slider(5, range=1..100)
panel_74 = Panel("Total load EUI: {0} (kWh/m2)")
panel_75 = Panel("Daylight glare probability (DGP): {0} %")
panel_76 = Panel("""Annual energy balance
Daily cooling profile
Daily heating profile
Cooling balance
Heating balance
None""")
panel_77 = Panel("Total embodied GWP per area: {0} kg CO2eq/m2")
panel_78 = Panel("Total embodied GWP: {0} kg CO2eq")
panel_79 = Panel("Create a model in the assembly module to get a LCA")
panel_80 = Panel("Operational GWP total: {0} kg CO2eq/year")
width_2 = Slider(5, range=1..100)
height_2 = Slider(40, range=1..100)
panel_81 = Panel("Operational GWP total ({0} years): {1} kg CO2eq")
button_22 = CreateButton(ButtonName="Bake", ButtonStyle=0)
button_23 = CreateButton(ButtonName="Zoom", ButtonStyle=0)
button_24 = CreateButton(ButtonName="Run energy simulation", ButtonStyle=0)
tb_4 = CreateTextBlock(TextSize=16, Justification=0)
tb_5 = CreateTextBlock(TextSize=16, Justification=0)
label_28 = CreateLabel(LabelText="Display settings", LabelSize=18, Justification=0)
pulldown_24 = CreatePulldownMenu(Label="Display type", ListItems=panel_72, showLabel=True)
slider_9 = CreateSlider(
    Slider=width,
    SnapValue=Slider(2, range=0..10),
    ShowBounds=False,
    ShowTicks=True,
    ShowTooltip=False,
    ShowValLabel=False,
    showLabel=True)
slider_10 = CreateSlider(
    Slider=height,
    SnapValue=Slider(2, range=0..10),
    ShowBounds=False,
    ShowTicks=True,
    ShowTooltip=False,
    ShowValLabel=False,
    showLabel=True)
pulldown_25 = CreatePulldownMenu(Label="Display type", ListItems=panel_71, SelectedIndex="0", showLabel=True)
tb_6 = CreateTextBlock(Text="Simulations can take a few minutes...", TextSize=16, Justification=0)
tb_7 = CreateTextBlock(Text=panel_73, TextSize=16, Justification=0)
tb_8 = CreateTextBlock(Text="Simulations can take a few minutes...", TextSize=12, Justification=0)
label_29 = CreateLabel(LabelText="Display settings", LabelSize=18, Justification=0)
tb_9 = CreateTextBlock(Text=panel_74, TextSize=16, Justification=0)
button_25 = CreateButton(ButtonName="Zoom", ButtonStyle=0)
tb_10 = CreateTextBlock(Text="Simulations can take a few minutes...", TextSize=16, Justification=0)
button_26 = CreateButton(ButtonName="Run daylight simulation", ButtonStyle=0)
tb_11 = CreateTextBlock(TextSize=16, Justification=0)
true_button_9 = CreateTrueOnlyButton(ButtonName="Pop-up window", ButtonStyle=0)
button_27 = CreateButton(ButtonName="Zoom", ButtonStyle=0)
button_28 = CreateButton(ButtonName="Run detailed energy simulation", ButtonStyle=0)
true_button_10 = CreateTrueOnlyButton(ButtonName="Visualize GWP by element", ButtonStyle=0)
values_85 = ValueListener(Elements=button_23, SomeProperty=True)  # -> Values, Indices
tb_12 = CreateTextBlock(TextSize=16, Justification=0)
tb_13 = CreateTextBlock(Text="Simulations can take a few minutes...", TextSize=16, Justification=0)
values_86 = ValueListener(Elements=button_22, SomeProperty=True)  # -> Values, Indices
button_29 = CreateButton(ButtonName="Calculate Glare probability", ButtonStyle=0)
tb_14 = CreateTextBlock(Text=panel_75, TextSize=16, Justification=0)
pulldown_26 = CreatePulldownMenu(Label="Display", ListItems=panel_76, showLabel=True)
hasdata = DataExists(Data=relay)
label_30 = CreateLabel(LabelText="Display settings", LabelSize=12, Justification=0)
values_87 = ValueListener(Elements=button_24, SomeProperty=True)  # -> Values, Indices
slider_11 = CreateSlider(
    Slider=width_2,
    SnapValue=Slider(2, range=0..10),
    ShowBounds=False,
    ShowTicks=True,
    ShowTooltip=False,
    ShowValLabel=False,
    showLabel=True)
slider_12 = CreateSlider(
    Slider=height_2,
    SnapValue=Slider(2, range=0..10),
    ShowBounds=False,
    ShowTicks=True,
    ShowTooltip=False,
    ShowValLabel=False,
    showLabel=True)
values_88 = ValueListener(Elements=button_27, SomeProperty=True)  # -> Values, Indices
values_89 = ValueListener(Elements=button_26, SomeProperty=True)  # -> Values, Indices
values_90 = ValueListener(Elements=true_button_9, SomeProperty=True)  # -> Values, Indices
values_91 = ValueListener(Elements=button_28, SomeProperty=True)  # -> Values, Indices
values_92 = ValueListener(Elements=true_button_10, SomeProperty=True)  # -> Values, Indices
values_93 = ValueListener(Elements=pulldown_24, SomeProperty=True)  # -> Values, Indices
values_94 = ValueListener(Elements=pulldown_25, SomeProperty=True)  # -> Values, Indices
values_95 = ValueListener(Elements=slider_10, SomeProperty=True)  # -> Values, Indices
label_31 = CreateLabel(LabelText=panel_77, LabelSize=12, Justification=0)
label_32 = CreateLabel(LabelText=panel_79, LabelSize=12, Justification=0)
label_33 = CreateLabel(LabelText=panel_78, LabelSize=12, Justification=0)
values_96 = ValueListener(Elements=slider_9, SomeProperty=True)  # -> Values, Indices
values_97 = ValueListener(Elements=button_29, SomeProperty=True)  # -> Values, Indices
filter_11 = StreamFilter(Gate=hasdata, Stream0="0", Stream1=relay)
values_98 = ValueListener(Elements=button_25, SomeProperty=True)  # -> Values, Indices
zoom_simple_energy_simulation = RemoteSender(values_85.Values)
label_34 = CreateLabel(LabelText=panel_80, LabelSize=12, Justification=0)
bake_simple_energy_simulation = RemoteSender(values_86.Values)
freeze_gate_11 = StreamFreezeGate(Data=values_87.Values, PassingSwitch=invert(values_87.Values))
values_99 = ValueListener(Elements=pulldown_26, SomeProperty=True)  # -> Values, Indices
label_35 = CreateLabel(LabelText=panel_81, LabelSize=12, Justification=0)
pre_run_simple_energy_simulations = RemoteSender(values_87.Values)
pre_run_simple_energy_simulations_2 = RemoteReceiver(pre_run_simple_energy_simulations)
freeze_gate_12 = StreamFreezeGate(Data=pre_run_simple_energy_simulations_2, PassingSwitch=pre_run_simple_energy_simulations_2)
zoom_detailed_energy_simulation = RemoteSender(values_88.Values)
values_100 = ValueListener(Elements=slider_11, SomeProperty=True)  # -> Values, Indices
visualize_detailed_energy_simulations = RemoteSender(values_90.Values)
values_101 = ValueListener(Elements=slider_12, SomeProperty=True)  # -> Values, Indices
entwine_58 = Entwine(Branch00=slider_12, Branch01=slider_11, FlattenInputs=True)  # -> flatten(Result)
freeze_gate_13 = StreamFreezeGate(Data=values_89.Values, PassingSwitch=invert(values_89.Values))
freeze_gate_14 = StreamFreezeGate(Data=values_91.Values, PassingSwitch=invert(values_91.Values))
simple_energy_simulation_type = RemoteSender(values_93.Indices)
daylight_simulation_type = RemoteSender(values_94.Indices)
visualize_lca_gwp_by_element = RemoteSender(values_92.Values)
pre_run_detailed_energy_simulations = RemoteSender(values_91.Values)
pre_run_detailed_energy_simulations_2 = RemoteReceiver(pre_run_detailed_energy_simulations)
freeze_gate_15 = StreamFreezeGate(Data=pre_run_detailed_energy_simulations_2, PassingSwitch=pre_run_detailed_energy_simulations_2)
hasdata_2 = DataExists(Data=freeze_gate_15)
filter_12 = StreamFilter(Gate=hasdata_2, Stream0="0", Stream1=freeze_gate_15)
pre_calculate_glare_probability = RemoteSender(values_97.Values)
pre_calculate_glare_probability_2 = RemoteReceiver(pre_calculate_glare_probability)
freeze_gate_16 = StreamFreezeGate(Data=pre_calculate_glare_probability_2, PassingSwitch=pre_calculate_glare_probability_2)
hasdata_3 = DataExists(Data=freeze_gate_16)
filter_13 = StreamFilter(Gate=hasdata_3, Stream0="0", Stream1=freeze_gate_16)
simple_energy_simulation_height = RemoteSender(values_95.Values)
pre_run_daylight_simulations = RemoteSender(values_89.Values)
pre_run_daylight_simulations_2 = RemoteReceiver(pre_run_daylight_simulations)
freeze_gate_17 = StreamFreezeGate(Data=pre_run_daylight_simulations_2, PassingSwitch=pre_run_daylight_simulations_2)
hasdata_4 = DataExists(Data=freeze_gate_17)
filter_14 = StreamFilter(Gate=hasdata_4, Stream0="0", Stream1=freeze_gate_17)
simple_energy_simulation_width = RemoteSender(values_96.Values)
freeze_gate_18 = StreamFreezeGate(Data=values_97.Values, PassingSwitch=invert(values_97.Values))
or_5 = GateOr(B=filter_11)
zoom_daylight_simulation = RemoteSender(values_98.Values)
detailed_energy_simulation_type = RemoteSender(values_99.Indices)
bool_11 = Boolean(invert(freeze_gate_11))
detailed_energy_simulation_width = RemoteSender(values_100.Values)
detailed_energy_simulation_height = RemoteSender(values_101.Values)
bool_12 = Boolean(invert(freeze_gate_13))
bool_13 = Boolean(invert(freeze_gate_14))
stack_45 = CreateStack(UIElements=entwine_58, Horizontal=True)
entwine_59 = Entwine(Branch00=slider_10, Branch01=slider_9, FlattenInputs=True)  # -> flatten(Result)
entwine_60 = Entwine(Branch00=button_24, Branch01=button_23, Branch02=button_22, FlattenInputs=True)  # -> flatten(Result)
entwine_61 = Entwine(Branch00=label_30, Branch01=stack_45, FlattenInputs=True)  # -> flatten(Result)
rec_6 = DataRecorder(or_5, DataLimit=-10, RecordData=True)
bool_14 = Boolean(invert(freeze_gate_18))
tap_6 = TapBuffer(Reset=False, Incremental=True, Valve=bool_11, Hold=True)
entwine_62 = Entwine(Branch00=button_28, Branch01=button_27, Branch02=true_button_9, FlattenInputs=True)  # -> flatten(Result)
tap_7 = TapBuffer(Reset=False, Incremental=True, Valve=bool_12, Hold=True)
tap_8 = TapBuffer(Reset=False, Incremental=True, Valve=bool_13, Hold=True)
tap_9 = TapBuffer(Reset=False, Incremental=True, Valve=bool_14, Hold=True)
ma_5 = MassAddition(Input=flatten(rec_6))  # -> Result, PartialResults
dam_9 = DataDam(DataA=tap_6, BufferDelay=2500000, BufferMode=2)
stack_46 = CreateStack(UIElements=entwine_61, Horizontal=invert(True))
dam_10 = DataDam(DataA=tap_7, BufferDelay=2500000, BufferMode=2)
dam_11 = DataDam(DataA=tap_8, BufferDelay=2500000, BufferMode=2)
dam_12 = DataDam(DataA=tap_9, BufferDelay=2500000, BufferMode=2)
entwine_63 = Entwine(Branch00=pulldown_24, Branch01=entwine_59, FlattenInputs=True)  # -> flatten(Result)
mod = Modulus(A=ma_5.Result, B=Slider(2, range=0..10))
equals_10 = Equality(FirstNumber=tap_6, SecondNumber=dam_9)  # -> Equality, Inequality
equals_11 = Equality(FirstNumber=tap_7, SecondNumber=dam_10)  # -> Equality, Inequality
equals_12 = Equality(FirstNumber=tap_8, SecondNumber=dam_11)  # -> Equality, Inequality
entwine_64 = Entwine(Branch00=pulldown_26, Branch01=stack_46, FlattenInputs=True)  # -> flatten(Result)
equals_13 = Equality(FirstNumber=tap_9, SecondNumber=dam_12)  # -> Equality, Inequality
stack_47 = CreateStack(UIElements=entwine_60, Horizontal=True)
bool_15 = Boolean(mod)
entwine_65 = Entwine(Branch00=label_29, Branch01=pulldown_25, FlattenInputs=True)  # -> flatten(Result)
stack_48 = CreateStack(UIElements=entwine_63, Horizontal=invert(True))
adjustelem_12 = AdjustElementAppearance(ElementsToAdjust=tb_14, Foreground=ColourSwatch(SwatchColor=RGB(0, 0, 0)), FontSize=Slider(14, range=0..100))
stack_49 = CreateStack(UIElements=entwine_64, Horizontal=True)
adjustelem_13 = AdjustElementAppearance(ElementsToAdjust=tb_7, Foreground=ColourSwatch(SwatchColor=RGB(0, 0, 0)), FontSize=Slider(14, range=0..100))
adjustelem_14 = AdjustElementAppearance(ElementsToAdjust=tb_9, Foreground=ColourSwatch(SwatchColor=RGB(0, 0, 0)), FontSize=Slider(14, range=0..100))
filter_15 = StreamFilter(Gate=bool_15, Stream0="Simulation failed...", Stream1="Energy simulation is running...")
stack_50 = CreateStack(UIElements=entwine_65, Horizontal=invert(True))
entwine_66 = Entwine(Branch00=button_26, Branch01=button_25, Branch02=button_3, FlattenInputs=True)  # -> flatten(Result)
entwine_67 = Entwine(Branch00=label_28, Branch01=stack_48, FlattenInputs=True)  # -> flatten(Result)
gate_6 = StreamGate(Stream=filter_15, Gate=freeze_gate_12)  # -> Target0, Target1
adjustpos_54 = AdjustElementPositioning(
    ElementsToAdjust=pulldown_26,
    AbsolutePositioning=False,
    Width=Slider(215, range=0..1000),
    Height=Slider(40, range=0..1000),
    HorizontalAlignment=0)
adjustpos_55 = AdjustElementPositioning(ElementsToAdjust=tb_4, Margin="10, 0, 0, 5", AbsolutePositioning=False, HorizontalAlignment=0)
adjustpos_56 = AdjustElementPositioning(ElementsToAdjust=tb_5, Margin="10, 0, 0, 5", AbsolutePositioning=False, HorizontalAlignment=0)
adjustpos_57 = AdjustElementPositioning(
    ElementsToAdjust=pulldown_24,
    AbsolutePositioning=False,
    Width=Slider(245, range=0..1000),
    Height=Slider(35, range=0..100),
    HorizontalAlignment=0)
adjustpos_58 = AdjustElementPositioning(
    ElementsToAdjust=[slider_10, slider_9],
    Margin="5, 5, 10, 0",
    AbsolutePositioning=False,
    Width=Slider(240, range=0..1000),
    HorizontalAlignment=0)
stack_51 = CreateStack(UIElements=entwine_66, Horizontal=True)
adjustpos_59 = AdjustElementPositioning(ElementsToAdjust=[button_26, button_25, button_3], Margin="5, 5, 0, 0", AbsolutePositioning=False, HorizontalAlignment=0)
entwine_68 = Entwine(Branch00=tb_7, Branch01=stack_50, FlattenInputs=True)  # -> flatten(Result)
adjustpos_60 = AdjustElementPositioning(ElementsToAdjust=tb_7, Margin="5, 10, 0, 5", AbsolutePositioning=False, HorizontalAlignment=0)
adjustpos_61 = AdjustElementPositioning(ElementsToAdjust=tb_9, Margin="10, 5, 0, 10", AbsolutePositioning=False, HorizontalAlignment=0)
adjustpos_62 = AdjustElementPositioning(
    ElementsToAdjust=pulldown_25,
    AbsolutePositioning=False,
    Width=Slider(245, range=0..1000),
    Height=Slider(35, range=0..100),
    HorizontalAlignment=0)
adjustpos_63 = AdjustElementPositioning(ElementsToAdjust=tb_11, Margin="10, 0, 0, 5", AbsolutePositioning=False, HorizontalAlignment=0)
adjustpos_64 = AdjustElementPositioning(ElementsToAdjust=true_button_10, AbsolutePositioning=False, HorizontalAlignment=0)
adjustpos_65 = AdjustElementPositioning(ElementsToAdjust=button_29, AbsolutePositioning=False, HorizontalAlignment=0)
adjustpos_66 = AdjustElementPositioning(
    ElementsToAdjust=[button_22, button_23, button_24],
    Margin="5, 5, 0, 0",
    AbsolutePositioning=False,
    HorizontalAlignment=0)
adjustpos_67 = AdjustElementPositioning(ElementsToAdjust=tb_12, Margin="10, 0, 0, 5", AbsolutePositioning=False, HorizontalAlignment=0)
adjustpos_68 = AdjustElementPositioning(ElementsToAdjust=tb_8, Margin="5, 0, 0, 5", AbsolutePositioning=False, HorizontalAlignment=0)
adjustpos_69 = AdjustElementPositioning(ElementsToAdjust=tb_14, Margin="5, 10, 5, 5", AbsolutePositioning=False, HorizontalAlignment=0)
adjustpos_70 = AdjustElementPositioning(
    ElementsToAdjust=true_button_9,
    Margin="15, 0, 0, 0",
    AbsolutePositioning=False,
    Width=Slider(110, range=0..1000),
    Height=Slider(30, range=0..1000),
    HorizontalAlignment=0)
stack_52 = CreateStack(UIElements=entwine_62, Horizontal=True)
adjustpos_71 = AdjustElementPositioning(
    ElementsToAdjust=button_27,
    Margin="15, 0, 0, 0",
    AbsolutePositioning=False,
    Width=Slider(60, range=0..1000),
    Height=Slider(30, range=0..1000),
    HorizontalAlignment=0)

# ----
gate_7 = StreamGate(Stream="No available simulation for this model.", Gate=freeze_gate_12)  # -> Target0, Target1
adjustpos_72 = AdjustElementPositioning(ElementsToAdjust=tb_10, Margin="5, 0, 0, 5", AbsolutePositioning=False, HorizontalAlignment=0)
adjustpos_73 = AdjustElementPositioning(ElementsToAdjust=tb_13, Margin="5, 0, 0, 5", AbsolutePositioning=False, HorizontalAlignment=0)

# ----
# Run detailed energy simulations
entwine_69 = Entwine(Branch00=stack_52, Branch01=tb_6, Branch02=stack_49, FlattenInputs=True)  # -> flatten(Result)
stack_53 = CreateStack(UIElements=entwine_69, Horizontal=invert(True))
number_slider_29 = Slider(650, range=0..1000)
border_5 = CreateBorder(
    UIElement=stack_53,
    BorderThickness=Slider(1, range=0..10),
    BorderColor=ColourSwatch(SwatchColor=RGB(217, 217, 217)),
    CornerRadius=Slider(2, range=0..10))
adjustpos_74 = AdjustElementPositioning(ElementsToAdjust=border_5, Margin="0, 5, 0, 0", AbsolutePositioning=False, HorizontalAlignment=0)
location_18 = Data()

visualize_lca_gwp_by_element_2 = RemoteReceiver(visualize_lca_gwp_by_element)
rec_7 = DataRecorder(visualize_lca_gwp_by_element_2, DataLimit=-2, RecordData=True)
ma_6 = MassAddition(Input=rec_7)  # -> Result, PartialResults
visualize_lca_gwp_by_element_3 = RemoteReceiver(visualize_lca_gwp_by_element)
entwine_70 = Entwine(Branch00=ma_6.Result, Branch01=lca_window_status, FlattenInputs=True)
rec_8 = DataRecorder(entwine_70, DataLimit=2, RecordData=True)
and_2 = GateAnd(A=visualize_lca_gwp_by_element_3, B=event_4.Data)
item_6 = ListItem(List=rec_8, Index=0, Wrap=True)  # -> Item2, Item1, Item
py3_9 = Python3Script(get=and_2)  # -> mpl_folder; same code as py3_8
equals_14 = Equality(FirstNumber=item_6.Item2, SecondNumber=item_6.Item1)  # -> Equality, Inequality
bang_2 = ExplodeTree(Data=equals_14.Inequality)  # -> Branch0, Branch1
nextfile_2 = NextAvailableFilename(Format="LCA{000}.png", FolderPath=py3_9, Trigger=and_2)
py3_10 = Python3Script(x=bang_2.Branch0, y=bang_2.Branch1)  # -> a; same code as py3_6
panel_82 = Panel(nextfile_2)
event_18 = EventGate(Data=py3_10)  # -> Data, IsNew
freeze_gate_19 = StreamFreezeGate(Data=py3_10, PassingSwitch=event_18.IsNew)
event_19 = EventGate(Data=freeze_gate_19)  # -> Data, IsNew
panel_83 = Panel(event_19.Data)
launchwin_2 = LaunchWindow(
    Show=event_19.Data,
    Name="LCA visualisations",
    Width=Slider(1150, range=0..1200),
    Height=Slider(600, range=0..1000),
    ChildStatus=1,
    EnableHorizScroll=False)
visualize_lca_gwp_by_element_4 = RemoteReceiver(visualize_lca_gwp_by_element)
winstat_2 = WindowStatus(Window=launchwin_2)
lca_status = RemoteSender(winstat_2)
py3_11 = Python3Script(window=launchwin_2, activate=visualize_lca_gwp_by_element_4)  # same code as py3_7
addelems_3 = AddElements(Window=launchwin_2, Elements=flatten(entwine_7), DoVLChecking=True)  # -> AddedElements, ElementNames
winprops_2 = SetWindowProperties(
    Window=launchwin_2,
    StartingLocation=pt_6,
    Theme=0,
    AccentColor=heath_accent_color_11,
    ShowTitleBar=True,
    BackgroundColor=RGB(255, 255, 255),
    ScaleFactor=1)

lca_status_2 = RemoteReceiver(lca_status)
expression_21 = Expression(x="Hidden", y=lca_status_2, Expression="x=y")
expire_2 = ExpireObject(ObjectToExpire=objbynn_3, Expire=expression_21)

freeze_gate_20 = StreamFreezeGate(Data=nextfile_2, PassingSwitch=and_2)

daylight_simulation_type_2 = RemoteReceiver(daylight_simulation_type)
equals_15 = Equality(FirstNumber="5", SecondNumber=daylight_simulation_type_2)  # -> Equality, Inequality

# ---- group: Assembly model (continued)
pre_create_model = RemoteSender(event_14.Data)

# ----
pre_create_model_2 = RemoteReceiver(pre_create_model)

# ---- group: Construction module (continued)
values_102 = ValueListener(Elements=button_21, SomeProperty=True)  # -> Values, Indices
ping_open_material_database = RemoteSender(bool_10)
entwine_71 = Entwine(Branch00=label_26, Branch01=true_button_8, Branch02=button_20, Branch03=button_21, FlattenInputs=True)  # -> flatten(Result)

# ----
freeze_gate_21 = StreamFreezeGate(Data=values_102.Values, PassingSwitch=values_102.Values)
load_construction_database = RemoteSender(values_102.Values)
bool_16 = Boolean(invert(freeze_gate_21))
oilcan_2 = OilCan(DataList=panel_4, Reset=recompute_2, Drop=values_102.Values, DropMode=3)
ping_open_construction_database = RemoteSender(bool_16)
event_20 = EventGate(Data=oilcan_2)  # -> Data, IsNew
open_construction_database = RemoteSender(event_20.Data)

# ----
# Databases
location_19 = Data(entwine_71)

# ---- group: Program module (continued)
occupancy = RemoteSender(division_4)

# ----
# Define program
selected_building_2 = RemoteReceiver(selected_building)
searchprog = HBSearchPrograms(bldg_prog=selected_building_2)  # -> room_prog; plug-in component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
room_programs = RemoteSender(searchprog)
selected_room_2 = RemoteReceiver(selected_room)
occupancy_2 = RemoteReceiver(occupancy)
applyloadvals = HBApplyLoadValues(
    room_or_program=flatten(selected_room_2),
    people_per_floor=occupancy_2,
    infilt_per_exterior=Slider(0.0001, range=0..0.001))  # -> report, mod_obj; plug-in component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
cooling_setpoint_3 = RemoteReceiver(cooling_setpoint)
heating_setpoint_3 = RemoteReceiver(heating_setpoint)
constantschedule_2 = HBConstantSchedule(values=Slider(1, range=0..1))  # -> report, schedule, idf_text; plug-in component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
constantschedule_3 = HBConstantSchedule(values=Slider(1, range=0..1))  # -> report, schedule, idf_text; plug-in component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
applysetpointvals = HBApplySetpointValues(room_or_program=flatten(applyloadvals.mod_obj), cooling_setpt=cooling_setpoint_3, heating_setpt=heating_setpoint_3)  # -> report, mod_obj; plug-in component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
python_2 = GhPythonScript(power_density=Slider(2.6, range=0..10), schedule=constantschedule_2.schedule)  # -> out, hot_water
# ---------- python_2: Python ----------
__author__ = "sawen"
__version__ = "2024.05.24"

import rhinoscriptsyntax as rs
from honeybee_energy.load.hotwater import ServiceHotWater as shw

if not name:
    name = "Domestic Hot Water"
    

hot_water = shw.from_watts_per_area(name, power_density, schedule)
# ---------- end python_2 ----------
equipment = HBEquipment(watts_per_area=Slider(3.4, range=0..10), schedule=constantschedule_3.schedule, lost_fract=Slider(0.3, range=0..1))  # -> equip; plug-in component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
programtype = HBProgramType(name="My program", base_program=applysetpointvals.mod_obj, electric_equip=equipment, hot_water=python_2.hot_water)  # -> program; plug-in component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

# ---- group: Program module (continued)
room_programs_2 = RemoteReceiver(room_programs)
setlist = SetListContents(ListToModify=pulldown_12, NewListContents=room_programs_2, SelectedIndex="0")

# ---- group: Analysis module (continued)
settextblock_3 = SetTextBlockContents(TextBlockToModify=tb_8, NewTextBlockContents=gate_7.Target1)

# ----
# Calculare glare probability
entwine_72 = Entwine(Branch00=button_29, Branch01=tb_14, Branch02=tb_13, Branch03=tb_5, FlattenInputs=True)  # -> flatten(Result)
stack_54 = CreateStack(UIElements=entwine_72, Horizontal=invert(True))
expander_2 = CreateExpander(UIElements=stack_54, Header="Glare simulation", Open=invert(True))
adjustpos_75 = AdjustElementPositioning(ElementsToAdjust=expander_2, AbsolutePositioning=False, Width=Slider(300, range=100..500), HorizontalAlignment=0)

entwine_73 = Entwine(Branch00=expander_2, Branch01=true_button_2, FlattenInputs=True)  # -> flatten(Result)
stack_55 = CreateStack(UIElements=entwine_73, Horizontal=True)
daylight_simulations = Data(stack_55)

# ----
# Calculare LCA
entwine_74 = Entwine(
    Branch00=label_32,
    Branch01=label_33,
    Branch02=label_31,
    Branch03=label_34,
    Branch04=label_35,
    Branch05=true_button_10,
    Branch06=tb_12,
    FlattenInputs=True)  # -> flatten(Result)
stack_56 = CreateStack(UIElements=entwine_74, Horizontal=invert(True))
expander_3 = CreateExpander(UIElements=stack_56, Header="LCA calculation", Open=invert(True))
adjustpos_76 = AdjustElementPositioning(ElementsToAdjust=expander_3, AbsolutePositioning=False, Width=Slider(300, range=100..500), HorizontalAlignment=0)

entwine_75 = Entwine(Branch00=expander_3, Branch01=true_button_3, FlattenInputs=True)  # -> flatten(Result)
stack_57 = CreateStack(UIElements=entwine_75, Horizontal=True)
daylight_simulations_2 = Data(stack_57)

# ----
# Run daylight simulations
entwine_76 = Entwine(Branch00=stack_51, Branch01=tb_10, Branch02=entwine_68, Branch03=tb_11, Branch04=pulldown_4, FlattenInputs=True)  # -> flatten(Result)
stack_58 = CreateStack(UIElements=entwine_76, Horizontal=invert(True))
expander_4 = CreateExpander(UIElements=stack_58, Header="Daylight simulation", Open=invert(True))
values_103 = ValueListener(Elements=expander_4, SomeProperty=True)  # -> Values, Indices
adjustpos_77 = AdjustElementPositioning(ElementsToAdjust=expander_4, AbsolutePositioning=False, Width=Slider(300, range=100..500), HorizontalAlignment=0)
daylight_expander_is_open = RemoteSender(values_103.Values)

entwine_77 = Entwine(Branch00=expander_4, Branch01=true_button_4, FlattenInputs=True)  # -> flatten(Result)
stack_59 = CreateStack(UIElements=entwine_77, Horizontal=True)
daylight_simulations_3 = Data(stack_59)

daylight_expander_is_open_2 = RemoteReceiver(daylight_expander_is_open)

daylight_expander_is_open_3 = RemoteReceiver(daylight_expander_is_open)

# ----
# Run energy simulations
entwine_78 = Entwine(
    Branch00=stack_47,
    Branch01=tb_2,
    Branch02=tb_8,
    Branch03=tb_9,
    Branch05=entwine_67,
    Branch06=tb_4,
    Branch07=stack,
    FlattenInputs=True)  # -> flatten(Result)
stack_60 = CreateStack(UIElements=entwine_78, Horizontal=invert(True))
expander_5 = CreateExpander(UIElements=stack_60, Header="Energy simulation", Open=invert(True))
values_104 = ValueListener(Elements=expander_5, SomeProperty=True)  # -> Values, Indices
adjustpos_78 = AdjustElementPositioning(ElementsToAdjust=expander_5, AbsolutePositioning=False, Width=Slider(300, range=100..500), HorizontalAlignment=0)
simple_energy_expander_is_open = RemoteSender(values_104.Values)

entwine_79 = Entwine(Branch00=expander_5, Branch01=true_button_5, FlattenInputs=True)  # -> flatten(Result)
stack_61 = CreateStack(UIElements=entwine_79, Horizontal=True)
energy_simulations = Data(stack_61)

# ----
# Material database categories
material_database_categories = Panel("""Blocks and tiles
Building boards
Concrete
Insulation
Mineral materials
Paints and sealants
Solid woods
Steel and other metals
Waterproofing
Other""")
material_database_categories_2 = RemoteSender(material_database_categories)
material_database_categories_3 = RemoteReceiver(material_database_categories_2)

material_database_categories_4 = RemoteReceiver(material_database_categories_2)

# ----
# Basic material database
number_slider_30 = Slider(0.035, range=0.001..1)
basic_material_database_does_not_allow_c = Panel("""Expanded polystyrene
Mineral wool
Timber
Solid brick
Gypsum plasterboard
Medium density concrete
Ceramic and porcelain
Steel
Crystalline stone
Soil/sand/gravel""")  # "Basic material database, (does not allow comma)"
entwine_80 = Entwine(
    Branch00=Slider(0.035, range=0.001..1),
    Branch01=number_slider_30,
    Branch02=Slider(0.13, range=0.001..1),
    Branch03=Slider(0.8, range=0.001..1),
    Branch04=Slider(0.21, range=0.001..1),
    Branch05=Slider(1.65, range=0.001..5),
    Branch06=Slider(1.3, range=0.001..5),
    Branch07=Slider(50, range=0.001..100),
    Branch08=Slider(3.5, range=0.001..5),
    Branch09=Slider(2, range=0.001..5),
    FlattenInputs=True)  # -> flatten(Result)
entwine_81 = Entwine(
    Branch00=Slider(30, range=1..10000),
    Branch01=Slider(100, range=1..10000),
    Branch02=Slider(500, range=1..10000),
    Branch03=Slider(1800, range=1..10000),
    Branch04=Slider(700, range=1..10000),
    Branch05=Slider(2200, range=1..10000),
    Branch06=Slider(2300, range=1..10000),
    Branch07=Slider(7800, range=1..10000),
    Branch08=Slider(2800, range=1..10000),
    Branch09=Slider(1950, range=1..10000),
    FlattenInputs=True)  # -> flatten(Result)
entwine_82 = Entwine(
    Branch00=Slider(1450, range=1..10000),
    Branch01=Slider(1030, range=1..10000),
    Branch02=Slider(1600, range=1..10000),
    Branch03=Slider(1000, range=1..10000),
    Branch04=Slider(1000, range=1..10000),
    Branch05=Slider(1000, range=1..10000),
    Branch06=Slider(840, range=1..10000),
    Branch07=Slider(450, range=1..10000),
    Branch08=Slider(1000, range=1..10000),
    Branch09=Slider(1050, range=1..10000),
    FlattenInputs=True)  # -> flatten(Result)
entwine_83 = Entwine(
    Branch00=Slider(3, range=1..9),
    Branch01=Slider(3, range=1..9),
    Branch02=Slider(6, range=1..9),
    Branch03=Slider(0, range=0..9),
    Branch04=Slider(1, range=1..9),
    Branch05=Slider(2, range=1..9),
    Branch06=Slider(0, range=0..9),
    Branch07=Slider(7, range=1..9),
    Branch08=Slider(4, range=1..9),
    Branch09=Slider(9, range=1..9),
    FlattenInputs=True)  # -> flatten(Result)
material_database_categories_5 = RemoteReceiver(material_database_categories_2)
lng_3 = ListLength(List=basic_material_database_does_not_allow_c)
item_7 = ListItem(List=material_database_categories_5, Index=entwine_83, Wrap=True)
repeat_3 = RepeatData(Data="inf", Length=lng_3)
opaquemat_2 = HBOpaqueMaterial(
    name=basic_material_database_does_not_allow_c,
    thickness=repeat_3,
    conductivity=entwine_80,
    density=entwine_81,
    spec_heat=entwine_82,
    category=item_7)  # -> mat; plug-in component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
objtostr = HBObjectToString(hb_obj=opaquemat_2)  # -> hb_str; plug-in component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
lng_4 = ListLength(List=objtostr)
bool_17 = Boolean(lng_4)
getdocumentusertext = Python3Script(run=bool_17, key="Heath materials")  # -> json_string
# ---------- getdocumentusertext: Python ----------
import Rhino
import rhinoscriptsyntax as rs
import scriptcontext as sc

if run:
    sc.doc = Rhino.RhinoDoc.ActiveDoc

    json_string = rs.GetDocumentUserText(key)

    sc.doc = ghdoc
# ---------- end getdocumentusertext ----------
split = TextSplit(Text=getdocumentusertext, Separators="|")
strtoobj = HBStringToObject(hb_str=split)  # -> flatten(hb_obj); plug-in component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
decnstrmat = HBDeconstructMaterial(mat=strtoobj)  # -> values, attr_names, r_val_si, r_val_ip; plug-in component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
item_8 = ListItem(List=decnstrmat.values, Index=0, Wrap=True)  # -> flatten(Item)
mindex = MemberIndex(Set=item_8, Member=basic_material_database_does_not_allow_c)  # -> Index, Count
cull = CullPattern(List=objtostr, CullPattern=invert(mindex.Count))
entwine_84 = Entwine(Branch00=cull, Branch01=split, FlattenInputs=True)  # -> flatten(Result)
ipy2 = IronPython2Script(materials=entwine_84)  # -> unique_materials; inputs materials: list
# ---------- ipy2: IronPython ----------
"""Grasshopper Script"""

unique_materials = []

for i in range(len(materials)):
    if materials[i] not in unique_materials:
        unique_materials.append(materials[i])
# ---------- end ipy2 ----------
join = TextJoin(Text=ipy2, Join="|")
setdocumentusertext = Python3Script(key="Heath materials", value=join)
# ---------- setdocumentusertext: Python ----------
import Rhino
import rhinoscriptsyntax as rs
import scriptcontext as sc

def modify_value(value):
    sc.doc = Rhino.RhinoDoc.ActiveDoc

    test = rs.SetDocumentUserText(key, value)

    sc.doc = ghdoc
    
if value:
    done = modify_value(value)
# ---------- end setdocumentusertext ----------

# ----
# Select window construction
subset_subface_skylight_2 = RemoteReceiver(subset_subface_skylight)
subset_subface_window_2 = RemoteReceiver(subset_subface_window)
subset_subface_window_3 = RemoteReceiver(subset_subface_window)
entwine_85 = Entwine(Branch00="Generic", Branch01=subset_subface_skylight_2, FlattenInputs=True)  # -> flatten(Result)
item_9 = ListItem(List=entwine_85, Index=subset_subface_window_2, Wrap=True)
expression_22 = Expression(x="Generic", y=item_9, Expression="x=y")
null_8 = NullObject()
null_9 = NullObject()
filter_16 = StreamFilter(Gate=expression_22, Stream0=item_9, Stream1=null_8)

# ----
# Select exterior construction
subset_exterior_floor_2 = RemoteReceiver(subset_exterior_floor)
subset_exterior_roof_2 = RemoteReceiver(subset_exterior_roof)
subset_exterior_wall_2 = RemoteReceiver(subset_exterior_wall)
null_10 = NullObject()
null_11 = NullObject()
null_12 = NullObject()

# ----
# Select interior construction
subset_interior_floor_2 = RemoteReceiver(subset_interior_floor)
subset_interior_wall_2 = RemoteReceiver(subset_interior_wall)
null_13 = NullObject()
null_14 = NullObject()

# ----
# Select ground construction
subset_ground_floor_2 = RemoteReceiver(subset_ground_floor)
null_15 = NullObject()

# ----
# Heath launch window
number_slider_31 = Slider(142, range=0..1000)
number_slider_32 = Slider(275, range=0..1000)
number_slider_33 = Slider(220, range=0..1000)
heath_accent_color_13 = RemoteReceiver(heath_accent_color)
pt_13 = ConstructPoint(XCoordinate=number_slider_31, YCoordinate=Slider(193, range=0..1000), ZCoordinate=0)
restart_heath_2 = RemoteReceiver(restart_heath)
panel_84 = Panel("Heath provides a user interface for life cycle building performance assessment in the Rhino environment.")
gate_8 = StreamGate(Stream="Start", Gate=restart_heath_2)  # -> Target0, Target1
true_button_11 = CreateTrueOnlyButton(ButtonName="Github Heath", ButtonStyle=0)
true_button_12 = CreateTrueOnlyButton(ButtonName=gate_8.Target0, ButtonStyle=0)
tb_15 = CreateTextBlock(TextSize=16, Justification=1)
tb_16 = CreateTextBlock(TextSize=12, Justification=0)
values_105 = ValueListener(Elements=true_button_11, SomeProperty=True)  # -> Values, Indices
values_106 = ValueListener(Elements=true_button_12, SomeProperty=True)  # -> Values, Indices
settextblock_4 = SetTextBlockContents(TextBlockToModify=tb_15, NewTextBlockContents="Email: sawen@chalmers.se")
settextblock_5 = SetTextBlockContents(TextBlockToModify=tb_16, NewTextBlockContents=panel_84)
github_heath = RemoteSender(values_105.Values)
launch_heath = RemoteSender(values_106.Values)
entwine_86 = Entwine(Branch00=tb_16, Branch01=true_button_11, Branch02=true_button_12, Branch03=tb_15, FlattenInputs=True)  # -> flatten(Result)
adjustpos_79 = AdjustElementPositioning(ElementsToAdjust=tb_16, AbsolutePositioning=False, Height=Slider(60, range=0..100))
adjustpos_80 = AdjustElementPositioning(ElementsToAdjust=tb_15, Margin="0, 8, 0, 0", AbsolutePositioning=False, Height=Slider(20, range=0..100))

launch_heath_2 = RemoteReceiver(launch_heath)
# Global parameters
launch_heath_3 = RemoteReceiver(launch_heath)

# ----
# Heath FLY!
fly = HeathFly(x=launch_heath_2)  # -> flying
# ---------- fly: Python ----------
# Copyright (c) 2024, Heath.
# You should have received a copy of the GNU Affero General Public License
# along with Heath; If not, see <http://www.gnu.org/licenses/>.
# 
# @license AGPL-3.0-or-later <https://spdx.org/licenses/AGPL-3.0-or-later>

import Grasshopper, scriptcontext
import os, sys, importlib

sys.path.append(Grasshopper.Folders.UserObjectFolders[0])

# make sure we can import ladybug tools
ladybug_tools_path = "ladybug_tools\\python\\Lib\\site-packages\\"
program_files_dir = os.path.dirname(f"{os.environ['ProgramFiles']}\\{ladybug_tools_path}")
if os.path.isdir(program_files_dir):
    sys.path.append(program_files_dir)
else:
    user_folder_dir = os.path.dirname(f"{os.path.expanduser('~')}\\{ladybug_tools_path}")
    if os.path.isdir(user_folder_dir):
        sys.path.append(user_folder_dir)
    else:
        raise Exception("Couldn't find Ladybug tools python module path")

try:
    import heath
    import heath_ui
    importlib.reload(heath)
    importlib.reload(heath_ui)
except Exception as e:
    # hack to allow the module to reside in the repo
    sys.path.append(os.path.join(os.path.dirname(ghdoc.Path), '..\src'))
    import heath
    import heath_ui
    importlib.reload(heath)
    importlib.reload(heath_ui)

ghenv.Component.Name = 'Heath - Fly!'
ghenv.Component.NickName = 'Fly!'

scriptcontext.sticky["heath_flying"] = 'true'
ghenv.Component.Message = heath.heath_globals.version

flying = True
# ---------- end fly ----------
panel_85 = Panel(fly)
heath_flying = RemoteSender(fly)

# ----
# Brimstone FLY!
fly_2 = BrimstoneFly(x=launch_heath_3)
# ---------- fly_2: Python ----------
"""This component sets up global information for Brimstone
    Inputs:
    Output:
        """

import Grasshopper
import sys

sys.path.append(Grasshopper.Folders.UserObjectFolders[0])

import brimstone
reload(brimstone)

import scriptcontext

ghenv.Component.Name = 'Brimstone - Fly!'
ghenv.Component.NickName = 'Fly!'

scriptcontext.sticky["brimstone_flying"] = 'true'
scriptcontext.sticky["brimstone_kdb_hb_json"] = 'brimstone_data/230721klimatdatabas_hb_materials.json' # json which adds honeybee material info to klimatdatabas materials
scriptcontext.sticky["brimstone_hb_kdb_csv"] = 'brimstone_data/230728_HBKlimatdatabas.csv' # csv file which translates honeybee material names to klimatdatabas material names
ghenv.Component.Message = brimstone.globals.version
# ---------- end fly_2 ----------

py3_12 = Python3Script(
    show=bool_2,
    title="Heath",
    win_height=number_slider_33,
    win_width=number_slider_32,
    accent_color=heath_accent_color_13,
    location=pt_13,
    x=tb_16)  # -> out, win, gh_button_out; inputs show: Boolean, location: Point3d; disabled
# ---------- py3_12: Python ----------
import heath_ui
import scriptcontext as sc
from System import Guid
from System.Windows.Controls import TextBlock
from System.Windows import TextWrapping
from HumanUI import TrueOnlyButton, UIElement_Goo
from HumanUI.Components.UI_Elements import CreateButton_Component, buttonStyle


if __name__ == "__main__":
    win, status = heath_ui.heath_main_window(title, win_width, win_height, accent_color, location, show)
    tb = TextBlock()
    tb.Text = "Heath provides a user interface for life cycle building performance assessment in the Rhino environment."
    tb.TextWrapping = TextWrapping.Wrap
    win.AddElement(tb)

    gh_button_name = "Github Heath"
    gh_button = TrueOnlyButton()
    CreateButton_Component.SetupButton(gh_button_name, None, True, False, gh_button, buttonStyle.Default)
    win.AddElement(gh_button)

    gh_button_out = UIElement_Goo(gh_button, gh_button_name, Guid(), 0)
# ---------- end py3_12 ----------

# ----
# Heath github
panel_86 = Panel("https://github.com/sawenchalmers/heath")
github_heath_2 = RemoteReceiver(github_heath)
py3_13 = Python3Script(url=panel_86, launch=github_heath_2)  # same code as py3

# ----
# Save/restore states front-end
heath_flying_2 = RemoteReceiver(heath_flying)  # disabled
heath_flying_3 = RemoteReceiver(heath_flying)  # disabled
panel_87 = Panel("Textdokument|*.txt")  # disabled
panel_88 = Panel("Textdokument|*.txt")  # disabled
py3_14 = Python3Script(get=heath_flying_2)  # -> mpl_folder; disabled; same code as py3_8
py3_15 = Python3Script(get=heath_flying_3)  # -> mpl_folder; disabled; same code as py3_8
panel_89 = Panel("Save state")  # disabled
panel_90 = Panel("Load state")  # disabled
panel_91 = Panel("Pick state")  # disabled
panel_92 = Panel("Save location")  # disabled
button_30 = CreateButton(ButtonName=panel_90, ButtonStyle=0)  # disabled
filepicker = CreateFilePicker(ButtonLabelText=panel_91, DialogType=0, MustExist=True, Filter=panel_87, StartingPath=py3_14)  # disabled
filepicker_2 = CreateFilePicker(ButtonLabelText=panel_92, DialogType=1, MustExist=True, Filter=panel_88, StartingPath=py3_15)  # disabled
button_31 = CreateButton(ButtonName=panel_89, ButtonStyle=0)  # disabled
values_107 = ValueListener(Elements=filepicker_2, SomeProperty=True)  # -> Values, Indices; disabled
values_108 = ValueListener(Elements=button_31, SomeProperty=True)  # -> Values, Indices; disabled
values_109 = ValueListener(Elements=filepicker, SomeProperty=True)  # -> Values, Indices; disabled
values_110 = ValueListener(Elements=button_30, SomeProperty=True)  # -> Values, Indices; disabled
save_state = RemoteSender(values_108.Values)  # disabled
save_location = RemoteSender(values_107.Values)  # disabled
load_state_file = RemoteSender(values_109.Values)  # disabled
load_state = RemoteSender(values_110.Values)  # disabled
bool_18 = Boolean(values_107.Values)  # disabled
bool_19 = Boolean(values_109.Values)  # disabled
null_16 = NullItem(Item=bool_18)  # -> NullFlags, InvalidFlags, Description; disabled
null_17 = NullItem(Item=bool_19)  # -> NullFlags, InvalidFlags, Description; disabled
hideshow_10 = HideShowElement(ElementToHideShow=button_31, Show=null_16.NullFlags, Collapse=True, Disable=False)  # disabled
hideshow_11 = HideShowElement(ElementToHideShow=button_30, Show=null_17.NullFlags, Collapse=True, Disable=False)  # disabled
number_slider_34 = Slider(32, range=0..100)  # disabled
number_slider_35 = Slider(90, range=0..100)  # disabled
number_slider_36 = Slider(32, range=0..100)  # disabled
number_slider_37 = Slider(90, range=0..100)  # disabled
adjustpos_81 = AdjustElementPositioning(
    ElementsToAdjust=filepicker_2,
    AbsolutePositioning=invert(False),
    Width=number_slider_35,
    Height=number_slider_34,
    HorizontalAlignment=1,
    VerticalAlignment=2)  # disabled
adjustpos_82 = AdjustElementPositioning(
    ElementsToAdjust=filepicker,
    AbsolutePositioning=invert(False),
    Width=number_slider_37,
    Height=number_slider_36,
    HorizontalAlignment=1,
    VerticalAlignment=2)  # disabled

# ----
# Save/restore states back-end
load_state_file_2 = RemoteReceiver(load_state_file)  # disabled
geometry_module_state_import_type_2 = RemoteReceiver(geometry_module_state_import_type)  # disabled
load_state_2 = RemoteReceiver(load_state)  # disabled
save_location_2 = RemoteReceiver(save_location)  # disabled
save_state_2 = RemoteReceiver(save_state)  # disabled
gate_9 = StreamGate(Stream=load_state_file_2, Gate=load_state_2)  # -> Target0, Target1; disabled
file = ReadFile(File=gate_9.Target0, PerLineParse=True)  # disabled
writetxt = WriteToTextFile(Run=save_state_2, TextToWrite=geometry_module_state_import_type_2, FilePath=save_location_2, Append=False, NewOnly=False)  # disabled
geometry_module_loaded_state_import_type = RemoteSender(file)  # disabled

heath_flying_4 = RemoteReceiver(heath_flying)
py3_16 = Python3Script(x=heath_flying_4)  # -> folder
# ---------- py3_16: Python ----------
import os
from Rhino import RhinoDoc



folder_path = ("\\").join(ghdoc.Path.split("\\")[:-1])
rhino_file_name = (RhinoDoc.ActiveDoc.Path).split("\\")[-1][:-4]
folder_name = 'Honeybee models'
full_path = folder_path + "\\heath_data\\" + rhino_file_name + "\\" + folder_name

try:
    os.mkdir(("\\").join(full_path.split("\\")[:-2]))
    os.mkdir(("\\").join(full_path.split("\\")[:-1]))
    os.mkdir(full_path)
except FileExistsError:
    # directory already exists
    pass

folder = full_path
# ---------- end py3_16 ----------
heath_flying_5 = RemoteReceiver(heath_flying)
py3_17 = Python3Script(x=heath_flying_5)  # -> folder; same code as py3_16

# ---- group: Geometry module (continued)
geometry_module_loaded_state_import_type_2 = RemoteReceiver(geometry_module_loaded_state_import_type)
setlist_2 = SetListContents(ListToModify=pulldown_11, NewListContents=panel_63, SelectedIndex=geometry_module_loaded_state_import_type_2)

# ----
# Material database launch
ping_open_material_database_2 = RemoteReceiver(ping_open_material_database)
open_material_database_2 = RemoteReceiver(open_material_database)
or_6 = GateOr(A=ping_open_material_database_2, B=open_material_database_2)
ping_open_material_database_3 = RemoteReceiver(ping_open_material_database)
database_modal_location_4 = RemoteReceiver(database_modal_location)
open_material_database_3 = RemoteReceiver(open_material_database)
heath_accent_color_14 = RemoteReceiver(heath_accent_color)
or_7 = GateOr(A=ping_open_material_database_3, B=open_material_database_3)

hasdata_5 = DataExists(Data=or_6)
filter_17 = StreamFilter(Gate=hasdata_5, Stream0="False", Stream1=or_6)

# ----
# Construction database launch
ping_open_construction_database_2 = RemoteReceiver(ping_open_construction_database)
open_construction_database_2 = RemoteReceiver(open_construction_database)
or_8 = GateOr(A=ping_open_construction_database_2, B=open_construction_database_2)
database_modal_location_5 = RemoteReceiver(database_modal_location)
ping_open_construction_database_3 = RemoteReceiver(ping_open_construction_database)
open_construction_database_3 = RemoteReceiver(open_construction_database)
or_9 = GateOr(A=ping_open_construction_database_3, B=open_construction_database_3)

hasdata_6 = DataExists(Data=or_8)
null_18 = NullItem(Item=or_8)  # -> NullFlags, InvalidFlags, Description
filter_18 = StreamFilter(Gate=null_18.NullFlags, Stream0=or_8, Stream1="False")

# ----
# Construction database
number_slider_38 = Slider(20, range=0..100)
heath_flying_6 = RemoteReceiver(heath_flying)
heath_flying_7 = RemoteReceiver(heath_flying)
py3_18 = Python3Script(get=heath_flying_6)  # -> mpl_folder; same code as py3_8
py3_19 = Python3Script(get=heath_flying_7)  # -> mpl_folder; same code as py3_8
repeat_4 = RepeatData(Data="🔍", Length=number_slider_38)
repeat_5 = RepeatData(Data="- ", Length=number_slider_38)
repeat_6 = RepeatData(Data="X", Length=number_slider_38)
button_32 = CreateButton(ButtonName="Sync database", ButtonStyle=0)
true_button_13 = CreateTrueOnlyButton(ButtonName="Create construction", ButtonStyle=0)
label_36 = CreateLabel(LabelText="Constructions", LabelSize=18, Justification=0)
label_37 = CreateLabel(LabelText="Duplicate instances of constructions have been loaded", LabelSize=12, Justification=0)
filepicker_3 = CreateFilePicker(
    ButtonLabelText="Save constructions to file",
    DialogType=1,
    MustExist=True,
    Filter="Text file|*.txt",
    StartingPath=py3_18)
true_button_14 = CreateTrueOnlyButton(ButtonName=repeat_4, ButtonStyle=3)
button_33 = CreateButton(ButtonName="Save constructions", ButtonStyle=0)
filepicker_4 = CreateFilePicker(
    ButtonLabelText="Load constructions from file",
    DialogType=0,
    MustExist=True,
    Filter="Text file|*.txt",
    StartingPath=py3_19)
button_34 = CreateButton(ButtonName=repeat_6, ButtonStyle=3)
button_35 = CreateButton(ButtonName="Load constructions", ButtonStyle=0)
tb_17 = CreateTextBlock(Text=repeat_5, TextSize=12, Justification=0)
values_111 = ValueListener(Elements=button_33, SomeProperty=True)  # -> Values, Indices
values_112 = ValueListener(Elements=true_button_14, SomeProperty=True)  # -> flatten(Values), Indices
values_113 = ValueListener(Elements=button_32, SomeProperty=True)  # -> Values, Indices
values_114 = ValueListener(Elements=true_button_13, SomeProperty=True)  # -> Values, Indices
values_115 = ValueListener(Elements=button_35, SomeProperty=True)  # -> Values, Indices
values_116 = ValueListener(Elements=filepicker_3, SomeProperty=True)  # -> Values, Indices
values_117 = ValueListener(Elements=button_34, SomeProperty=True)  # -> flatten(Values), Indices
cull_2 = CullPattern(List=values_117.Values, CullPattern=values_117.Values)
lng_5 = ListLength(List=cull_2)
filter_19 = StreamFilter(Gate=lng_5, Stream0="False", Stream1=cull_2)
freeze_gate_22 = StreamFreezeGate(Data=filter_19, PassingSwitch=invert(filter_19))
values_118 = ValueListener(Elements=filepicker_4, SomeProperty=True)  # -> Values, Indices
bool_20 = Boolean(invert(freeze_gate_22))
freeze_gate_23 = StreamFreezeGate(Data=values_111.Values, PassingSwitch=invert(values_111.Values))
freeze_gate_24 = StreamFreezeGate(Data=values_115.Values, PassingSwitch=invert(values_115.Values))
cset = CreateSet(List=values_112.Values)  # -> Set, Map
bool_21 = Boolean(values_116.Values)
sync_construction_database = RemoteSender(values_113.Values)
bool_22 = Boolean(values_118.Values)
tap_10 = TapBuffer(Reset=False, Incremental=True, Valve=bool_20, Hold=True)
create_construction_modal = RemoteSender(values_114.Values)
pre_construction_database_remove_constru = RemoteSender(values_117.Values)  # "pre_construction_database_remove_construction"
null_19 = NullItem(Item=bool_21)  # -> NullFlags, InvalidFlags, Description
save_constructions_file = RemoteSender(values_116.Values)
load_constructions_file = RemoteSender(values_118.Values)
cull_3 = CullPattern(List=cset.Set, CullPattern=cset.Set)
bool_23 = Boolean(invert(freeze_gate_23))
null_20 = NullItem(Item=bool_22)  # -> NullFlags, InvalidFlags, Description
bool_24 = Boolean(invert(freeze_gate_24))
expander_6 = CreateExpander(UIElements=simplify(graft(tb_17)), Header=simplify(graft(repeat_5)), Open=invert(True))  # -> flatten(Expander)
entwine_87 = Entwine(Branch00=true_button_13, Branch01=button_32, FlattenInputs=True)  # -> flatten(Result)
dam_13 = DataDam(DataA=tap_10, BufferDelay=2500000, BufferMode=2)
tap_11 = TapBuffer(Reset=False, Incremental=True, Valve=bool_23, Hold=True)
mindex_2 = MemberIndex(Set=values_112.Values, Member=cull_3)  # -> Index, Count
tap_12 = TapBuffer(Reset=False, Incremental=True, Valve=bool_24, Hold=True)
equals_16 = Equality(FirstNumber=tap_10, SecondNumber=dam_13)  # -> Equality, Inequality
stack_62 = CreateStack(UIElements=entwine_87, Horizontal=True)
dam_14 = DataDam(DataA=tap_11, BufferDelay=2500000, BufferMode=2)
bool_25 = Boolean(mindex_2.Count)
dam_15 = DataDam(DataA=tap_12, BufferDelay=2500000, BufferMode=2)
event_21 = EventGate(Data=equals_16.Inequality)  # -> Data, IsNew
hideshow_12 = HideShowElement(ElementToHideShow=button_33, Show=null_19.NullFlags, Collapse=True, Disable=False)
suirify = Suirify(true_button_14)
suirify_2 = Suirify(expander_6)
suirify_3 = Suirify(button_34)
null_21 = NullItem(Item=bool_25)  # -> NullFlags, InvalidFlags, Description
equals_17 = Equality(FirstNumber=tap_11, SecondNumber=dam_14)  # -> Equality, Inequality
equals_18 = Equality(FirstNumber=tap_12, SecondNumber=dam_15)  # -> Equality, Inequality
hideshow_13 = HideShowElement(ElementToHideShow=button_35, Show=null_20.NullFlags, Collapse=True, Disable=False)
construction_database_remove_constructio = RemoteSender(event_21.Data)  # "construction_database_remove_construction"
merge_6 = Merge(Data1=graft(suirify_2), Data2=graft(suirify_3), Data3=graft(suirify))
adjustelem_15 = AdjustElementAppearance(ElementsToAdjust=label_37, Foreground=ColourSwatch(SwatchColor=RGB(255, 0, 0)))
filter_20 = StreamFilter(Gate=null_21.NullFlags, Stream0=bool_25, Stream1="False")
number_slider_39 = Slider(26, range=0..300)
entwine_88 = Entwine(Branch00=filepicker_3, Branch01=button_33, FlattenInputs=True)  # -> flatten(Result)
pre_construction_database_visualize_cons = RemoteSender(mindex_2.Index)  # "pre_construction_database_visualize_construction"
construction_database_visualize_construc = RemoteSender(filter_20)  # "construction_database_visualize_construction"
stack_63 = CreateStack(UIElements=merge_6, Horizontal=True)  # -> flatten(Stack)
entwine_89 = Entwine(Branch00=filepicker_4, Branch01=button_35, FlattenInputs=True)  # -> flatten(Result)
stack_64 = CreateStack(UIElements=entwine_88, Horizontal=True)
adjustpos_83 = AdjustElementPositioning(ElementsToAdjust=button_33, AbsolutePositioning=False, Height=Slider(32, range=0..300), HorizontalAlignment=0)
adjustpos_84 = AdjustElementPositioning(
    ElementsToAdjust=filepicker_3,
    AbsolutePositioning=False,
    Width=Slider(180, range=0..300),
    Height=Slider(32, range=0..300),
    HorizontalAlignment=0)
adjustpos_85 = AdjustElementPositioning(
    ElementsToAdjust=true_button_14,
    AbsolutePositioning=False,
    Width=number_slider_39,
    Height=number_slider_39,
    HorizontalAlignment=2,
    VerticalAlignment=1)
stack_65 = CreateStack(UIElements=entwine_89, Horizontal=True)
adjustelem_16 = AdjustElementAppearance(
    ElementsToAdjust=true_button_14,
    Foreground=ColourSwatch(SwatchColor=RGBA(0, 0, 0, 205)),
    Background=ColourSwatch(SwatchColor=RGBA(245, 245, 245, 205)),
    FontSize=Slider(18, range=0..50))
adjustpos_86 = AdjustElementPositioning(ElementsToAdjust=button_35, AbsolutePositioning=False, Height=Slider(32, range=0..300), HorizontalAlignment=0)
adjustpos_87 = AdjustElementPositioning(
    ElementsToAdjust=filepicker_4,
    AbsolutePositioning=False,
    Width=Slider(180, range=0..300),
    Height=Slider(32, range=0..300),
    HorizontalAlignment=0)
adjustpos_88 = AdjustElementPositioning(
    ElementsToAdjust=button_34,
    AbsolutePositioning=False,
    Width=Slider(26, range=0..300),
    Height=Slider(26, range=0..300),
    HorizontalAlignment=2,
    VerticalAlignment=1)
adjustelem_17 = AdjustElementAppearance(ElementsToAdjust=button_34, Foreground=ColourSwatch(SwatchColor=RGB(255, 0, 0)), FontSize=Slider(12, range=0..50))
adjustpos_89 = AdjustElementPositioning(
    ElementsToAdjust=expander_6,
    Margin="0, 0, 0, 5",
    AbsolutePositioning=False,
    Width=Slider(285, range=100..500),
    HorizontalAlignment=0)
adjustpos_90 = AdjustElementPositioning(ElementsToAdjust=stack_63, Margin="5, 0, 0, 0", AbsolutePositioning=False, HorizontalAlignment=0)

# ----
# Remove constructions
pre_construction_database_remove_constru_2 = RemoteReceiver(pre_construction_database_remove_constru)  # "pre_construction_database_remove_construction"
construction_database_remove_constructio_2 = RemoteReceiver(construction_database_remove_constructio)  # "construction_database_remove_construction"
cset_2 = CreateSet(List=pre_construction_database_remove_constru_2)  # -> Set, Map
getdocumentusertext_2 = Python3Script(run=construction_database_remove_constructio_2, key="Heath constructions")  # -> json_string; same code as getdocumentusertext
cull_4 = CullPattern(List=cset_2.Set, CullPattern=cset_2.Set)
mindex_3 = MemberIndex(Set=pre_construction_database_remove_constru_2, Member=cull_4)  # -> Index, Count
split_2 = TextSplit(Text=getdocumentusertext_2, Separators="|")
hold = HoldingGate(Data=mindex_3.Index)
cull_i = CullIndex(List=split_2, Indices=hold, Wrap=True)
join_2 = TextJoin(Text=cull_i, Join="|")
nulls_in_empty = NullsInEmptyBranches(DataWithEmptyBranches=join_2)
null_22 = NullItem(Item=nulls_in_empty)  # -> NullFlags, InvalidFlags, Description
bool_26 = Boolean("False")
filter_21 = StreamFilter(Gate=null_22.NullFlags, Stream0=join_2, Stream1=bool_26)
freeze_gate_25 = StreamFreezeGate(Data=filter_21, PassingSwitch=construction_database_remove_constructio_2, Freeze=False, Hold=False)

sync_construction_database_2 = RemoteReceiver(sync_construction_database)

# ----
# Material database
number_slider_40 = Slider(10, range=0..100)
heath_flying_8 = RemoteReceiver(heath_flying)
heath_flying_9 = RemoteReceiver(heath_flying)
material_database_categories_6 = RemoteReceiver(material_database_categories_2)
lng_6 = ListLength(List=material_database_categories_4)
py3_20 = Python3Script(get=heath_flying_8)  # -> mpl_folder; same code as py3_8
repeat_7 = RepeatData(Data="X", Length=number_slider_40)  # -> graft(Data)
repeat_8 = RepeatData(Data="- ", Length=number_slider_40)  # -> graft(Data)
py3_21 = Python3Script(get=heath_flying_9)  # -> mpl_folder; same code as py3_8
lng_7 = ListLength(List=material_database_categories_4)
repeat_9 = RepeatData(Data=simplify(repeat_7), Length=lng_6)
repeat_10 = RepeatData(Data=simplify(repeat_8), Length=lng_6)
filepicker_5 = CreateFilePicker(ButtonLabelText="Save materials to file", DialogType=1, MustExist=True, Filter="Text file|*.txt", StartingPath=py3_20)
button_36 = CreateButton(ButtonName="Sync database", ButtonStyle=0)
true_button_15 = CreateTrueOnlyButton(ButtonName="Create material", ButtonStyle=0)
button_37 = CreateButton(ButtonName="Save materials", ButtonStyle=0)
label_38 = CreateLabel(LabelText="Duplicate instances of materials have been loaded", LabelSize=12, Justification=0)
label_39 = CreateLabel(LabelText=material_database_categories_6, LabelSize=18, Justification=0)
filepicker_6 = CreateFilePicker(ButtonLabelText="Load materials from file", DialogType=0, MustExist=True, Filter="Text file|*.txt", StartingPath=py3_21)
button_38 = CreateButton(ButtonName="Load materials", ButtonStyle=0)
values_119 = ValueListener(Elements=button_37, SomeProperty=True)  # -> Values, Indices
button_39 = CreateButton(ButtonName=repeat_9, ButtonStyle=3)
tb_18 = CreateTextBlock(Text=repeat_10, TextSize=12, Justification=0)
values_120 = ValueListener(Elements=button_38, SomeProperty=True)  # -> Values, Indices
values_121 = ValueListener(Elements=filepicker_5, SomeProperty=True)  # -> Values, Indices
values_122 = ValueListener(Elements=filepicker_6, SomeProperty=True)  # -> Values, Indices
freeze_gate_26 = StreamFreezeGate(Data=values_119.Values, PassingSwitch=invert(values_119.Values))
values_123 = ValueListener(Elements=flatten(button_39), SomeProperty=True)  # -> flatten(Values), Indices
cull_5 = CullPattern(List=values_123.Values, CullPattern=values_123.Values)  # -> flatten(List)
lng_8 = ListLength(List=cull_5)
filter_22 = StreamFilter(Gate=lng_8, Stream0="False", Stream1=cull_5)
freeze_gate_27 = StreamFreezeGate(Data=filter_22, PassingSwitch=invert(filter_22))
values_124 = ValueListener(Elements=true_button_15, SomeProperty=True)  # -> Values, Indices
values_125 = ValueListener(Elements=button_36, SomeProperty=True)  # -> Values, Indices
freeze_gate_28 = StreamFreezeGate(Data=values_120.Values, PassingSwitch=invert(values_120.Values))
bool_27 = Boolean(values_121.Values)
bool_28 = Boolean(invert(freeze_gate_27))
bool_29 = Boolean(values_122.Values)
null_23 = NullItem(Item=bool_27)  # -> NullFlags, InvalidFlags, Description
save_materials_file = RemoteSender(values_121.Values)
bool_30 = Boolean(invert(freeze_gate_26))
null_24 = NullItem(Item=bool_29)  # -> NullFlags, InvalidFlags, Description
load_materials_file = RemoteSender(values_122.Values)
tap_13 = TapBuffer(Reset=False, Incremental=True, Valve=bool_28, Hold=True)
pre_material_database_remove_material = RemoteSender(values_123.Values)
bool_31 = Boolean(invert(freeze_gate_28))
create_material_modal = RemoteSender(values_124.Values)
entwine_90 = Entwine(Branch00=true_button_15, Branch01=button_36, FlattenInputs=True)  # -> flatten(Result)
tap_14 = TapBuffer(Reset=False, Incremental=True, Valve=bool_30, Hold=True)
dam_16 = DataDam(DataA=tap_13, BufferDelay=2500000, BufferMode=2)
tap_15 = TapBuffer(Reset=False, Incremental=True, Valve=bool_31, Hold=True)
suirify_4 = Suirify(tb_18)
suirify_5 = Suirify(button_39)
dam_17 = DataDam(DataA=tap_14, BufferDelay=2500000, BufferMode=2)
hideshow_14 = HideShowElement(ElementToHideShow=button_37, Show=null_23.NullFlags, Collapse=True, Disable=False)
dam_18 = DataDam(DataA=tap_15, BufferDelay=2500000, BufferMode=2)
equals_19 = Equality(FirstNumber=tap_13, SecondNumber=dam_16)  # -> Equality, Inequality
adjustelem_18 = AdjustElementAppearance(ElementsToAdjust=label_38, Foreground=ColourSwatch(SwatchColor=RGB(255, 0, 0)))
merge_7 = Merge(Data1=graft(suirify_4), Data2=graft(suirify_5))
equals_20 = Equality(FirstNumber=tap_14, SecondNumber=dam_17)  # -> Equality, Inequality
stack_66 = CreateStack(UIElements=entwine_90, Horizontal=True)
hideshow_15 = HideShowElement(ElementToHideShow=button_38, Show=null_24.NullFlags, Collapse=True, Disable=False)
equals_21 = Equality(FirstNumber=tap_15, SecondNumber=dam_18)  # -> Equality, Inequality
event_22 = EventGate(Data=equals_19.Inequality)  # -> Data, IsNew
stack_67 = CreateStack(UIElements=merge_7, Horizontal=True)
material_database_remove_material = RemoteSender(event_22.Data)
shfdep = ShiftToDepth(Tree=stack_67, Depth=Slider(1, range=0..100), shiftFromStart=False)
entwine_91 = Entwine(Branch00=filepicker_6, Branch01=button_38, FlattenInputs=True)  # -> flatten(Result)
merge_8 = Merge(Data1=simplify(graft(label_39)), Data2=shfdep)
entwine_92 = Entwine(Branch00=filepicker_5, Branch01=button_37, FlattenInputs=True)  # -> flatten(Result)
stack_68 = CreateStack(UIElements=entwine_91, Horizontal=True)
stack_69 = CreateStack(UIElements=merge_8, Horizontal=invert(True))  # -> flatten(Stack)
adjustpos_91 = AdjustElementPositioning(ElementsToAdjust=label_39, Margin="0, 5, 0, 0", AbsolutePositioning=False)
adjustpos_92 = AdjustElementPositioning(
    ElementsToAdjust=tb_18,
    Margin="0, 0, 0, 10",
    AbsolutePositioning=False,
    Width=Slider(300, range=0..500),
    Height=Slider(29, range=0..300),
    HorizontalAlignment=0,
    VerticalAlignment=1)
stack_70 = CreateStack(UIElements=entwine_92, Horizontal=True)
adjustpos_93 = AdjustElementPositioning(ElementsToAdjust=stack_67, Margin="5, 0, 0, 0", AbsolutePositioning=False, HorizontalAlignment=0)
adjustpos_94 = AdjustElementPositioning(
    ElementsToAdjust=button_39,
    Margin="5, 0, 0, 10",
    AbsolutePositioning=False,
    Width=Slider(26, range=0..300),
    Height=Slider(26, range=0..300),
    HorizontalAlignment=1,
    VerticalAlignment=1)
adjustelem_19 = AdjustElementAppearance(ElementsToAdjust=button_39, Foreground=ColourSwatch(SwatchColor=RGB(255, 0, 0)), FontSize=Slider(12, range=0..50))
adjustpos_95 = AdjustElementPositioning(
    ElementsToAdjust=filepicker_5,
    AbsolutePositioning=False,
    Width=Slider(180, range=0..300),
    Height=Slider(32, range=0..300),
    HorizontalAlignment=0)
adjustpos_96 = AdjustElementPositioning(ElementsToAdjust=stack_70, Margin="5, 20, 0, 0", AbsolutePositioning=False, HorizontalAlignment=0)
adjustpos_97 = AdjustElementPositioning(ElementsToAdjust=button_37, AbsolutePositioning=False, Height=Slider(32, range=0..300), HorizontalAlignment=0)
adjustpos_98 = AdjustElementPositioning(ElementsToAdjust=stack_68, Margin="5, 10, 0, 0", AbsolutePositioning=False, HorizontalAlignment=0)
adjustpos_99 = AdjustElementPositioning(
    ElementsToAdjust=filepicker_6,
    AbsolutePositioning=False,
    Width=Slider(180, range=0..300),
    Height=Slider(32, range=0..300),
    HorizontalAlignment=0)
adjustpos_100 = AdjustElementPositioning(ElementsToAdjust=button_38, AbsolutePositioning=False, Height=Slider(32, range=0..300), HorizontalAlignment=0)

sync_material_database = RemoteSender(values_125.Values)

# ----
# Sync when opening the database, recompute and sync
load_construction_database_2 = RemoteReceiver(load_construction_database)
load_material_database_2 = RemoteReceiver(load_material_database)
recompute_4 = RemoteReceiver(recompute)
panel_93 = Panel("""False
True""")
or_10 = GateOr(A=load_material_database_2, B=load_construction_database_2)
oilcan_3 = OilCan(DataList=panel_93, Reset=recompute_4, Drop=or_10, DropMode=3)
event_23 = EventGate(Data=oilcan_3)  # -> Data, IsNew
and_3 = GateAnd(A=oilcan_3, B=event_23.IsNew)
null_25 = NullItem(Item=and_3)  # -> NullFlags, InvalidFlags, Description
filter_23 = StreamFilter(Gate=null_25.NullFlags, Stream0=and_3, Stream1="False")
sync_material_database_2 = RemoteReceiver(sync_material_database)
event_24 = EventGate(Data=filter_23)  # -> Data, IsNew
or_11 = GateOr(A=sync_material_database_2, B=event_24.Data)

# ----
# Window database
panel_94 = Panel("Duplicate instances of windows have been loaded")
number_slider_41 = Slider(20, range=0..100)
heath_flying_10 = RemoteReceiver(heath_flying)
heath_flying_11 = RemoteReceiver(heath_flying)
true_button_16 = CreateTrueOnlyButton(ButtonName="Create window", ButtonStyle=0)
label_40 = CreateLabel(LabelText=panel_94, LabelSize=12, Justification=0)
label_41 = CreateLabel(LabelText="Windows", LabelSize=18, Justification=0)
py3_22 = Python3Script(get=heath_flying_10)  # -> mpl_folder; same code as py3_8
py3_23 = Python3Script(get=heath_flying_11)  # -> mpl_folder; same code as py3_8
repeat_11 = RepeatData(Data="X", Length=number_slider_41)
repeat_12 = RepeatData(Data="- ", Length=number_slider_41)
values_126 = ValueListener(Elements=true_button_16, SomeProperty=True)  # -> Values, Indices
filepicker_7 = CreateFilePicker(ButtonLabelText="Save windows to file", DialogType=1, MustExist=True, Filter="Text file|*.txt", StartingPath=py3_22)
button_40 = CreateButton(ButtonName=repeat_11, ButtonStyle=3)
button_41 = CreateButton(ButtonName="Save windows", ButtonStyle=0)
tb_19 = CreateTextBlock(Text=repeat_12, TextSize=12, Justification=0)
filepicker_8 = CreateFilePicker(ButtonLabelText="Load windows from file", DialogType=0, MustExist=True, Filter="Text file|*.txt", StartingPath=py3_23)
button_42 = CreateButton(ButtonName="Load windows", ButtonStyle=0)
values_127 = ValueListener(Elements=button_41, SomeProperty=True)  # -> Values, Indices
values_128 = ValueListener(Elements=button_42, SomeProperty=True)  # -> Values, Indices
values_129 = ValueListener(Elements=button_40, SomeProperty=True)  # -> flatten(Values), Indices
cull_6 = CullPattern(List=values_129.Values, CullPattern=values_129.Values)
lng_9 = ListLength(List=cull_6)
filter_24 = StreamFilter(Gate=lng_9, Stream0="False", Stream1=cull_6)
freeze_gate_29 = StreamFreezeGate(Data=filter_24, PassingSwitch=invert(filter_24))
values_130 = ValueListener(Elements=filepicker_7, SomeProperty=True)  # -> Values, Indices
values_131 = ValueListener(Elements=filepicker_8, SomeProperty=True)  # -> Values, Indices
create_window_modal = RemoteSender(values_126.Values)
bool_32 = Boolean(invert(freeze_gate_29))
freeze_gate_30 = StreamFreezeGate(Data=values_127.Values, PassingSwitch=invert(values_127.Values))
freeze_gate_31 = StreamFreezeGate(Data=values_128.Values, PassingSwitch=invert(values_128.Values))
bool_33 = Boolean(values_130.Values)
bool_34 = Boolean(values_131.Values)
tap_16 = TapBuffer(Reset=False, Incremental=True, Valve=bool_32, Hold=True)
pre_window_database_remove_window = RemoteSender(values_129.Values)
null_26 = NullItem(Item=bool_33)  # -> NullFlags, InvalidFlags, Description
bool_35 = Boolean(invert(freeze_gate_30))
save_windows_file = RemoteSender(values_130.Values)
null_27 = NullItem(Item=bool_34)  # -> NullFlags, InvalidFlags, Description
bool_36 = Boolean(invert(freeze_gate_31))
load_windows_file = RemoteSender(values_131.Values)
suirify_6 = Suirify(tb_19)
suirify_7 = Suirify(button_40)
dam_19 = DataDam(DataA=tap_16, BufferDelay=2500000, BufferMode=2)
tap_17 = TapBuffer(Reset=False, Incremental=True, Valve=bool_35, Hold=True)
merge_9 = Merge(Data1=graft(suirify_6), Data2=graft(suirify_7))
tap_18 = TapBuffer(Reset=False, Incremental=True, Valve=bool_36, Hold=True)
equals_22 = Equality(FirstNumber=tap_16, SecondNumber=dam_19)  # -> Equality, Inequality
adjustelem_20 = AdjustElementAppearance(ElementsToAdjust=label_40, Foreground=ColourSwatch(SwatchColor=RGB(255, 0, 0)))
dam_20 = DataDam(DataA=tap_17, BufferDelay=2500000, BufferMode=2)
dam_21 = DataDam(DataA=tap_18, BufferDelay=2500000, BufferMode=2)
event_25 = EventGate(Data=equals_22.Inequality)  # -> Data, IsNew
hideshow_16 = HideShowElement(ElementToHideShow=button_41, Show=null_26.NullFlags, Collapse=True, Disable=False)
hideshow_17 = HideShowElement(ElementToHideShow=button_42, Show=null_27.NullFlags, Collapse=True, Disable=False)
equals_23 = Equality(FirstNumber=tap_17, SecondNumber=dam_20)  # -> Equality, Inequality
equals_24 = Equality(FirstNumber=tap_18, SecondNumber=dam_21)  # -> Equality, Inequality
window_database_remove_window = RemoteSender(event_25.Data)
entwine_93 = Entwine(Branch00=filepicker_7, Branch01=button_41, FlattenInputs=True)  # -> flatten(Result)
stack_71 = CreateStack(UIElements=merge_9, Horizontal=True)  # -> flatten(Stack)
entwine_94 = Entwine(Branch00=filepicker_8, Branch01=button_42, FlattenInputs=True)  # -> flatten(Result)
adjustpos_101 = AdjustElementPositioning(ElementsToAdjust=label_41, Margin="0, 0, 0, -10", AbsolutePositioning=False)
adjustpos_102 = AdjustElementPositioning(
    ElementsToAdjust=filepicker_7,
    AbsolutePositioning=False,
    Width=Slider(180, range=0..300),
    Height=Slider(32, range=0..300),
    HorizontalAlignment=0)
adjustpos_103 = AdjustElementPositioning(ElementsToAdjust=button_41, AbsolutePositioning=False, Height=Slider(32, range=0..300), HorizontalAlignment=0)
adjustpos_104 = AdjustElementPositioning(
    ElementsToAdjust=tb_19,
    Margin="0, 10, 0, 0",
    AbsolutePositioning=False,
    Width=Slider(300, range=0..300),
    Height=Slider(29, range=0..300),
    HorizontalAlignment=0,
    VerticalAlignment=1)
adjustpos_105 = AdjustElementPositioning(ElementsToAdjust=stack_71, Margin="5, 0, 0, 0", AbsolutePositioning=False, HorizontalAlignment=0)
adjustpos_106 = AdjustElementPositioning(
    ElementsToAdjust=button_40,
    Margin="5, 0, 0, 0",
    AbsolutePositioning=False,
    Width=Slider(26, range=0..300),
    Height=Slider(26, range=0..300),
    HorizontalAlignment=1,
    VerticalAlignment=1)
stack_72 = CreateStack(UIElements=entwine_93, Horizontal=True)
stack_73 = CreateStack(UIElements=entwine_94, Horizontal=True)
adjustelem_21 = AdjustElementAppearance(ElementsToAdjust=button_40, Foreground=ColourSwatch(SwatchColor=RGB(255, 0, 0)), FontSize=Slider(12, range=0..50))
adjustpos_107 = AdjustElementPositioning(
    ElementsToAdjust=filepicker_8,
    AbsolutePositioning=False,
    Width=Slider(180, range=0..300),
    Height=Slider(32, range=0..300),
    HorizontalAlignment=0)
adjustpos_108 = AdjustElementPositioning(ElementsToAdjust=button_42, AbsolutePositioning=False, Height=Slider(32, range=0..300), HorizontalAlignment=0)

entwine_95 = Entwine(Branch00=true_button_16, Branch01=button_4, FlattenInputs=True)  # -> flatten(Result)
stack_74 = CreateStack(UIElements=entwine_95, Horizontal=True)

# ----
# Remove window
pre_window_database_remove_window_2 = RemoteReceiver(pre_window_database_remove_window)
window_database_remove_window_2 = RemoteReceiver(window_database_remove_window)
cset_3 = CreateSet(List=pre_window_database_remove_window_2)  # -> Set, Map
getdocumentusertext_3 = Python3Script(run=window_database_remove_window_2, key="Heath windows")  # -> json_string; same code as getdocumentusertext
cull_7 = CullPattern(List=cset_3.Set, CullPattern=cset_3.Set)
mindex_4 = MemberIndex(Set=pre_window_database_remove_window_2, Member=cull_7)  # -> Index, Count
split_3 = TextSplit(Text=getdocumentusertext_3, Separators="|")
hold_2 = HoldingGate(Data=mindex_4.Index)
cull_i_2 = CullIndex(List=split_3, Indices=hold_2, Wrap=True)
join_3 = TextJoin(Text=cull_i_2, Join="|")
nulls_in_empty_2 = NullsInEmptyBranches(DataWithEmptyBranches=join_3)
null_28 = NullItem(Item=nulls_in_empty_2)  # -> NullFlags, InvalidFlags, Description
bool_37 = Boolean("False")
filter_25 = StreamFilter(Gate=null_28.NullFlags, Stream0=join_3, Stream1=bool_37)
freeze_gate_32 = StreamFreezeGate(Data=filter_25, PassingSwitch=window_database_remove_window_2, Freeze=False, Hold=False)

# ----
# Recursion
panel_95 = Panel("Heath help")
objbynn_5 = GetObjectByNickname(NickName=panel_95)
heath_help = Python3Script()  # -> status; same code as lca_window_status

# ----
# Recursion
panel_96 = Panel("Geometry info")
objbynn_6 = GetObjectByNickname(NickName=panel_96)
geometry_info = Python3Script()  # -> status; same code as lca_window_status

# ----
# Heath geometry info
info_save_geometry_2 = RemoteReceiver(info_save_geometry)
rec_9 = DataRecorder(info_save_geometry_2, DataLimit=-2, RecordData=True)
ma_7 = MassAddition(Input=rec_9)  # -> Result, PartialResults
entwine_96 = Entwine(Branch00=ma_7.Result, Branch01=geometry_info, FlattenInputs=True)
rec_10 = DataRecorder(entwine_96, DataLimit=2, RecordData=True)
item_10 = ListItem(List=rec_10, Index=0, Wrap=True)  # -> Item2, Item1, Item
equals_25 = Equality(FirstNumber=item_10.Item2, SecondNumber=item_10.Item1)  # -> Equality, Inequality
bang_3 = ExplodeTree(Data=equals_25.Inequality)  # -> Branch0, Branch1
py3_24 = Python3Script(x=bang_3.Branch0, y=bang_3.Branch1)  # -> a; same code as py3_6
event_26 = EventGate(Data=py3_24)  # -> Data, IsNew
freeze_gate_33 = StreamFreezeGate(Data=py3_24, PassingSwitch=event_26.IsNew)
panel_97 = Panel("""Import geometry which is 
used to create the 
honeybee model""")
event_27 = EventGate(Data=freeze_gate_33)  # -> Data, IsNew
label_42 = CreateLabel(LabelText=panel_97, LabelSize=12, Justification=0)
panel_98 = Panel(event_27.Data)
launchwin_3 = LaunchWindow(
    Show=event_27.Data,
    Name="Info",
    Width=Slider(180, range=0..500),
    Height=Slider(148, range=0..500),
    ChildStatus=1,
    EnableHorizScroll=False)
pt_14 = ConstructPoint(XCoordinate=Slider(240, range=0..1000), YCoordinate=Slider(380, range=0..1000), ZCoordinate=0)
info_save_geometry_3 = RemoteReceiver(info_save_geometry)
winstat_3 = WindowStatus(Window=launchwin_3)
winprops_3 = SetWindowProperties(
    Window=launchwin_3,
    StartingLocation=pt_14,
    Theme=0,
    AccentColor=heath_accent_color_4,
    ShowTitleBar=True,
    BackgroundColor=RGB(255, 255, 255),
    ScaleFactor=1)
addelems_4 = AddElements(Window=launchwin_3, Elements=flatten(label_42), DoVLChecking=True)  # -> AddedElements, ElementNames
geometry_info_status = RemoteSender(winstat_3)
py3_25 = Python3Script(window=launchwin_3, activate=info_save_geometry_3)  # same code as py3_7

geometry_info_status_2 = RemoteReceiver(geometry_info_status)
expression_23 = Expression(x="Hidden", y=geometry_info_status_2, Expression="x=y")
expire_3 = ExpireObject(ObjectToExpire=objbynn_6, Expire=expression_23)

# ----
# Recursion
panel_99 = Panel("Material info")
objbynn_7 = GetObjectByNickname(NickName=panel_99)
material_info = Python3Script()  # -> status; same code as lca_window_status

# ----
# Recursion
panel_100 = Panel("Heath main")
objbynn_8 = GetObjectByNickname(NickName=panel_100)
heath_main = Python3Script()  # -> status; same code as lca_window_status

# ----
# Define construction
# # Define program and construction
# To be added...
# 
# ## Instructions
# To be added...
# 
# ## Inputs
# - ...
# 
# ## Outputs
# - ...
# 
# ## Interpretation
# To be added...
panel_101 = Panel("My construction")

# ----
# Recursion
panel_102 = Panel("Window database")
objbynn_9 = GetObjectByNickname(NickName=panel_102)
window_database = Python3Script()  # -> status; same code as lca_window_status

# ----
# Window database launch
open_window_database_2 = RemoteReceiver(open_window_database)
rec_11 = DataRecorder(open_window_database_2, DataLimit=-2, RecordData=True)
entwine_97 = Entwine(
    Branch00=stack_74,
    Branch01=label_40,
    Branch02=label_41,
    Branch03=stack_71,
    Branch04=stack_72,
    Branch05=stack_73,
    FlattenInputs=True)  # -> flatten(Result)
database_modal_location_6 = RemoteReceiver(database_modal_location)
open_window_database_3 = RemoteReceiver(open_window_database)

int_4 = Integer(rec_11)

ma_8 = MassAddition(Input=int_4)  # -> Result, PartialResults
entwine_98 = Entwine(Branch00=ma_8.Result, Branch01=window_database, FlattenInputs=True)
rec_12 = DataRecorder(entwine_98, DataLimit=2, RecordData=True)
item_11 = ListItem(List=rec_12, Index=0, Wrap=True)  # -> Item2, Item1, Item
equals_26 = Equality(FirstNumber=item_11.Item2, SecondNumber=item_11.Item1)  # -> Equality, Inequality
bang_4 = ExplodeTree(Data=equals_26.Inequality)  # -> Branch0, Branch1
py3_26 = Python3Script(x=bang_4.Branch0, y=bang_4.Branch1)  # -> a; same code as py3_6
event_28 = EventGate(Data=py3_26)  # -> Data, IsNew
freeze_gate_34 = StreamFreezeGate(Data=py3_26, PassingSwitch=event_28.IsNew)
event_29 = EventGate(Data=freeze_gate_34)  # -> Data, IsNew
panel_103 = Panel(event_29.Data)
launchwin_4 = LaunchWindow(
    Show=event_29.Data,
    Name="Window database",
    Width=Slider(380, range=0..1000),
    Height=Slider(580, range=0..1000),
    ChildStatus=1,
    EnableHorizScroll=False)
winprops_4 = SetWindowProperties(
    Window=launchwin_4,
    StartingLocation=database_modal_location_6,
    Theme=0,
    AccentColor=heath_accent_color_2,
    ShowTitleBar=True,
    BackgroundColor=RGB(255, 255, 255),
    ScaleFactor=1)
winstat_4 = WindowStatus(Window=launchwin_4)
addelems_5 = AddElements(Window=launchwin_4, Elements=flatten(entwine_97), DoVLChecking=True)  # -> AddedElements, ElementNames
py3_27 = Python3Script(window=launchwin_4, activate=open_window_database_3)  # same code as py3_7
window_database_status = RemoteSender(winstat_4)
window_database_elements = RemoteSender(addelems_5.AddedElements)

window_database_status_2 = RemoteReceiver(window_database_status)
expression_24 = Expression(x="Hidden", y=window_database_status_2, Expression="x=y")
expire_4 = ExpireObject(ObjectToExpire=objbynn_9, Expire=expression_24)

# ----
# Recursion
panel_104 = Panel("Material database")
objbynn_10 = GetObjectByNickname(NickName=panel_104)
material_database = Python3Script()  # -> status; same code as lca_window_status

rec_13 = DataRecorder(filter_17, DataLimit=-2, RecordData=True)
int_5 = Integer(rec_13)
ma_9 = MassAddition(Input=int_5)  # -> Result, PartialResults
entwine_99 = Entwine(Branch00=ma_9.Result, Branch01=material_database, FlattenInputs=True)
rec_14 = DataRecorder(entwine_99, DataLimit=2, RecordData=True)
item_12 = ListItem(List=rec_14, Index=0, Wrap=True)  # -> Item2, Item1, Item
equals_27 = Equality(FirstNumber=item_12.Item2, SecondNumber=item_12.Item1)  # -> Equality, Inequality
bang_5 = ExplodeTree(Data=equals_27.Inequality)  # -> Branch0, Branch1
py3_28 = Python3Script(x=bang_5.Branch0, y=bang_5.Branch1)  # -> a; same code as py3_6
event_30 = EventGate(Data=py3_28)  # -> Data, IsNew
freeze_gate_35 = StreamFreezeGate(Data=py3_28, PassingSwitch=event_30.IsNew)
event_31 = EventGate(Data=freeze_gate_35)  # -> Data, IsNew
entwine_100 = Entwine(
    Branch00=stack_66,
    Branch01=label_2,
    Branch02=label_38,
    Branch03=stack_69,
    Branch04=stack_70,
    Branch05=stack_68,
    FlattenInputs=True)  # -> flatten(Result)
panel_105 = Panel(event_31.Data)
launchwin_5 = LaunchWindow(
    Show=event_31.Data,
    Name="Material database",
    Width=Slider(380, range=0..1000),
    Height=Slider(580, range=0..1000),
    ChildStatus=1,
    EnableHorizScroll=False)
winprops_5 = SetWindowProperties(
    Window=launchwin_5,
    StartingLocation=database_modal_location_4,
    Theme=0,
    AccentColor=heath_accent_color_14,
    ShowTitleBar=True,
    BackgroundColor=RGB(255, 255, 255),
    ScaleFactor=1)
winstat_5 = WindowStatus(Window=launchwin_5)
addelems_6 = AddElements(Window=launchwin_5, Elements=flatten(entwine_100), DoVLChecking=True)  # -> AddedElements, ElementNames
py3_29 = Python3Script(window=launchwin_5, activate=or_7)  # same code as py3_7
material_database_elements = RemoteSender(addelems_6.AddedElements)
material_database_status = RemoteSender(winstat_5)

material_database_status_2 = RemoteReceiver(material_database_status)
expression_25 = Expression(x="Hidden", y=material_database_status_2, Expression="x=y")
expire_5 = ExpireObject(ObjectToExpire=objbynn_10, Expire=expression_25)

# ----
# Heath window
launch_heath_4 = RemoteReceiver(launch_heath)
rec_15 = DataRecorder(launch_heath_4, DataLimit=-2, RecordData=True)
ma_10 = MassAddition(Input=rec_15)  # -> Result, PartialResults
entwine_101 = Entwine(Branch00=ma_10.Result, Branch01=heath_main, FlattenInputs=True)
rec_16 = DataRecorder(entwine_101, DataLimit=2, RecordData=True)
item_13 = ListItem(List=rec_16, Index=0, Wrap=True)  # -> Item2, Item1, Item
equals_28 = Equality(FirstNumber=item_13.Item2, SecondNumber=item_13.Item1)  # -> Equality, Inequality
bang_6 = ExplodeTree(Data=equals_28.Inequality)  # -> Branch0, Branch1
data_12 = Data(energy_simulations)
data_13 = Data(location_18)
data_14 = Data(daylight_simulations)
data_15 = Data(daylight_simulations_3)
data_16 = Data(daylight_simulations_2)
entwine_102 = Entwine(Branch00=entwine_41, FlattenInputs=True)  # -> flatten(Result)
entwine_103 = Entwine(Branch00=stack_25, FlattenInputs=True)  # -> flatten(Result)
entwine_104 = Entwine(Branch00=location_17, Branch01=location_19, Branch02=location_16, FlattenInputs=True)  # -> flatten(Result)
entwine_105 = Entwine(Branch00=stack_39, Branch01=preview, Branch02=location_13, FlattenInputs=True)  # -> flatten(Result)
entwine_106 = Entwine(Branch00=location_14, Branch01=location_15, FlattenInputs=True)  # -> flatten(Result)
entwine_107 = Entwine(
    Branch00=select_model_3,
    Branch01=data_12,
    Branch02=data_13,
    Branch03=data_15,
    Branch04=data_14,
    Branch05=data_16,
    FlattenInputs=True)  # -> flatten(Result)
py3_30 = Python3Script(x=bang_6.Branch0, y=bang_6.Branch1)  # -> a; same code as py3_6
event_32 = EventGate(Data=py3_30)  # -> Data, IsNew
stack_75 = CreateStack(UIElements=entwine_103, Horizontal=invert(True))
stack_76 = CreateStack(UIElements=entwine_102, Horizontal=invert(True))
freeze_gate_36 = StreamFreezeGate(Data=py3_30, PassingSwitch=event_32.IsNew)
panel_106 = Panel("""Geometry module
Program module
Construction module
Assembly module
Visualize module
Analysis module""")
event_33 = EventGate(Data=freeze_gate_36)  # -> Data, IsNew
tabs = TabbedView(
    TabNames=panel_106,
    TabTextSize=Slider(13, range=0..100),
    Tab0=flatten(entwine_105),
    Tab1=flatten(entwine_106),
    Tab2=flatten(entwine_104),
    Tab3=flatten(stack_75),
    Tab4=flatten(stack_76),
    Tab5=flatten(entwine_107))
launchwin_6 = LaunchWindow(
    Show=event_33.Data,
    Name="Heath",
    Width=Slider(390, range=0..1000),
    Height=Slider(520, range=0..1000),
    ChildStatus=1,
    EnableHorizScroll=False)
panel_107 = Panel(event_33.Data)
heath_is_active = RemoteSender(event_33.Data)
heath_window = RemoteSender(launchwin_6)
values_132 = ValueListener(Elements=tabs, SomeProperty=True)  # -> Values, Indices
adjustpos_109 = AdjustElementPositioning(ElementsToAdjust=tabs, AbsolutePositioning=False, Width=Slider(365, range=100..1500))
adjustpos_110 = AdjustElementPositioning(
    ElementsToAdjust=[entwine_105, entwine_106, entwine_104, stack_75, stack_76, entwine_107],
    Margin="0, 5, 0, 0",
    AbsolutePositioning=False,
    HorizontalAlignment=0,
    VerticalAlignment=2)
heath_window_location_2 = RemoteReceiver(heath_window_location)
current_tab_index = RemoteSender(values_132.Indices)
winprops_6 = SetWindowProperties(
    Window=launchwin_6,
    StartingLocation=heath_window_location_2,
    Theme=0,
    AccentColor=heath_accent_color_7,
    ShowTitleBar=True,
    BackgroundColor=RGB(255, 255, 255),
    ScaleFactor=1)
panel_108 = Panel("C:\Users\Isac\Desktop\Toivo_Chalmers\heath\Icons\butterfly_heath_short.png")
launch_heath_5 = RemoteReceiver(launch_heath)
image_3 = CreateImage(ImageSource=panel_108, ImageWidth=Slider(30, range=0..100), ImageHeight=Slider(19, range=0..100))
true_button_17 = CreateTrueOnlyButton(ButtonName="Help!", ButtonStyle=0)
py3_31 = Python3Script(window=launchwin_6, activate=launch_heath_5)  # same code as py3_7
winstat_6 = WindowStatus(Window=launchwin_6)
entwine_108 = Entwine(Branch00=image_3, Branch01=true_button_17, FlattenInputs=True)  # -> flatten(Result)
values_133 = ValueListener(Elements=true_button_17, SomeProperty=True)  # -> Values, Indices
heath_status = RemoteSender(winstat_6)
help_button = RemoteSender(values_133.Values)
stack_77 = CreateStack(UIElements=entwine_108, Horizontal=True)
stack_78 = CreateStack(UIElements=tabs, Horizontal=True)
entwine_109 = Entwine(Branch00=stack_77, Branch01=stack_78, FlattenInputs=True)  # -> flatten(Result)
addelems_7 = AddElements(Window=launchwin_6, Elements=flatten(entwine_109), DoVLChecking=True)  # -> AddedElements, ElementNames
heath_elements = RemoteSender(addelems_7.AddedElements)
format_21 = Format(Format="{0}, {1}, {2}, {3}", Culture=127, Data0=Slider(265, range=100..300))
adjustpos_111 = AdjustElementPositioning(
    ElementsToAdjust=true_button_17,
    Margin=format_21,
    AbsolutePositioning=invert(False),
    HorizontalAlignment=2,
    VerticalAlignment=2)

heath_status_2 = RemoteReceiver(heath_status)
expression_26 = Expression(x="Hidden", y=heath_status_2, Expression="x=y")
expire_6 = ExpireObject(ObjectToExpire=objbynn_8, Expire=expression_26)

# ----
# Heath help
help_button_2 = RemoteReceiver(help_button)
rec_17 = DataRecorder(help_button_2, DataLimit=-2, RecordData=True)
ma_11 = MassAddition(Input=rec_17)  # -> Result, PartialResults
entwine_110 = Entwine(Branch00=ma_11.Result, Branch01=heath_help, FlattenInputs=True)
rec_18 = DataRecorder(entwine_110, DataLimit=2, RecordData=True)
item_14 = ListItem(List=rec_18, Index=0, Wrap=True)  # -> Item2, Item1, Item
equals_29 = Equality(FirstNumber=item_14.Item2, SecondNumber=item_14.Item1)  # -> Equality, Inequality
bang_7 = ExplodeTree(Data=equals_29.Inequality)  # -> Branch0, Branch1
py3_32 = Python3Script(x=bang_7.Branch0, y=bang_7.Branch1)  # -> a; same code as py3_6
event_34 = EventGate(Data=py3_32)  # -> Data, IsNew
freeze_gate_37 = StreamFreezeGate(Data=py3_32, PassingSwitch=event_34.IsNew)
panel_109 = Panel("""1. Select geometry in Rhino.

2. Select geometry type under the import geometry heading.

3. Click "Save geometry".

4. Verify the assigned geometry by pressing the "Preview" checkbox.""")
panel_110 = Panel("""1. Select the program for the building and room.

2. Use the sliders to set the cooling and heating setpoints.

3. Estimate how many persons will be in the room with the occupancy slider.""")
panel_111 = Panel("""1. Select base construction by climate and type of construction.

2. If required, create your own material or window. Materials can later be selected when creating custom constructions.

3. Constructions and windows make up the subset construction, which is used to modify the base construction.

4. Constructions can be loaded from a file, which contains all previously created constructions.""")
current_tab_index_2 = RemoteReceiver(current_tab_index)
panel_112 = Panel("""1. Make sure the geometry have been imported and that the program and constructions are in place, before creating a honeybee model.

2. If the model has been created, the "Bake model" button will be enabled along with boxes that lets you visualize the model.

3. Set the wall thickness and roof thickness.

4. Switch the WWR (window-to-wall-ratio) on, if you want to generate windows automatically.""")
panel_113 = Panel("""1. Verify that the honeybee model is correct by selecting attributes and clicking the checkboxes in the "Attributes visualization" segment.

2. Click the "Run weather visualization" button. If the model is set up correctly the "Direct sun hours" and "Incident radiation" should be displayed on the model.""")
panel_114 = Panel("""1. Pick which simulation you want to run.

2. If the simulation failed a red text will show up, go back and review the honeybee model and settings.

3. Otherwise, navigate through the expanded segment to select appropriate displays of the results.

4. It is possible to transfer the results to Rhino by clicking "Bake", or to an image file by clicking "Pop-up window".""")
heath_window_location_3 = RemoteReceiver(heath_window_location)
event_35 = EventGate(Data=freeze_gate_37)  # -> Data, IsNew
filter_26 = StreamFilter(
    Gate=current_tab_index_2,
    Stream0="Geometry module",
    Stream1="Program module",
    Stream2="Construction module",
    Stream3="Assembly module",
    Stream4="Visualize module",
    Stream5="Analysis module")
filter_27 = StreamFilter(
    Gate=current_tab_index_2,
    Stream0=panel_109,
    Stream1=panel_110,
    Stream2=panel_111,
    Stream3=panel_112,
    Stream4=panel_113,
    Stream5=panel_114)
label_43 = CreateLabel(LabelText="Geometry module", LabelSize=18, Justification=0)
panel_115 = Panel(event_35.Data)
tb_20 = CreateTextBlock(Text="Geometry module", TextSize=12, Justification=0)
launchwin_7 = LaunchWindow(
    Show=event_35.Data,
    Name="Help!",
    Width=Slider(350, range=0..500),
    Height=Slider(290, range=0..500),
    ChildStatus=1,
    EnableHorizScroll=False)
pdecon_3 = Deconstruct(Point=heath_window_location_3)  # -> XComponent, YComponent, ZComponent
pt_15 = ConstructPoint(XCoordinate=Slider(460, range=0..1000), YCoordinate=pdecon_3.YComponent, ZCoordinate=0)
settextblock_6 = SetTextBlockContents(TextBlockToModify=tb_20, NewTextBlockContents=filter_27)
setlabel_2 = SetLabelContents(LabelToModify=label_43, NewLabelContents=filter_26)
winprops_7 = SetWindowProperties(
    Window=launchwin_7,
    StartingLocation=pt_15,
    Theme=0,
    AccentColor=heath_accent_color_5,
    ShowTitleBar=True,
    BackgroundColor=RGB(255, 255, 255),
    ScaleFactor=1)
entwine_111 = Entwine(Branch00=label_43, Branch01=tb_20, FlattenInputs=True)  # -> flatten(Result)
winstat_7 = WindowStatus(Window=launchwin_7)
help_button_3 = RemoteReceiver(help_button)
heath_help_status = RemoteSender(winstat_7)
addelems_8 = AddElements(Window=launchwin_7, Elements=flatten(entwine_111), DoVLChecking=True)  # -> AddedElements, ElementNames
py3_33 = Python3Script(window=launchwin_7, activate=help_button_3)  # same code as py3_7

heath_help_status_2 = RemoteReceiver(heath_help_status)
expression_27 = Expression(x="Hidden", y=heath_help_status_2, Expression="x=y")
expire_7 = ExpireObject(ObjectToExpire=objbynn_5, Expire=expression_27)

event_36 = EventGate(Data=values_132.Values)  # -> Data, IsNew

current_tab = RemoteSender(event_36.Data)

current_tab_2 = RemoteReceiver(current_tab)
current_tab_3 = RemoteReceiver(current_tab)
expression_28 = Expression(x="Assembly module", y=current_tab_2, Expression="x=y")
expression_29 = Expression(x="Assembly module", y=current_tab_3, Expression="x≠y")
and_4 = GateAnd(A=event_16.Data, B=expression_28)
freeze_gate_38 = StreamFreezeGate(Data=expression_29, PassingSwitch=expression_29)
setcheckbox = SetCheckBox(
    CheckBoxToModify=[checkbox_4, checkbox_8, checkbox_7, checkbox_6, checkbox_5, checkbox_3, checkbox, checkbox_2],
    NewValue=invert(freeze_gate_38))

current_tab_4 = RemoteReceiver(current_tab)
expression_30 = Expression(x="Analysis module", y=current_tab_4, Expression="x≠y")
freeze_gate_39 = StreamFreezeGate(Data=expression_30, PassingSwitch=expression_30, Freeze=True)
setexp = SetExpander(Expander=expander_2, ExpandedOpen=invert(freeze_gate_39))

current_tab_5 = RemoteReceiver(current_tab)
expression_31 = Expression(x="Analysis module", y=current_tab_5, Expression="x≠y")
freeze_gate_40 = StreamFreezeGate(Data=expression_31, PassingSwitch=expression_31, Freeze=True)
setexp_2 = SetExpander(Expander=expander_3, ExpandedOpen=invert(freeze_gate_40))

current_tab_6 = RemoteReceiver(current_tab)
expression_32 = Expression(x="Analysis module", y=current_tab_6, Expression="x≠y")
freeze_gate_41 = StreamFreezeGate(Data=expression_32, PassingSwitch=expression_32, Freeze=True)
setexp_3 = SetExpander(Expander=expander_4, ExpandedOpen=invert(freeze_gate_41))

current_tab_7 = RemoteReceiver(current_tab)
expression_33 = Expression(x="Analysis module", y=current_tab_7, Expression="x≠y")
freeze_gate_42 = StreamFreezeGate(Data=expression_33, PassingSwitch=expression_33, Freeze=True)
setexp_4 = SetExpander(Expander=expander_5, ExpandedOpen=invert(freeze_gate_42))

# ----
# Determine which is the currently selected model, in the current tab
current_selected_model_assembly_module_4 = RemoteReceiver(current_selected_model_assembly_module)
current_selected_model_analysis_module_3 = RemoteReceiver(current_selected_model_analysis_module)
current_tab_8 = RemoteReceiver(current_tab)
expression_34 = Expression(x="Assembly module", y=current_tab_8, Expression="x=y")
filter_28 = StreamFilter(Gate=expression_34, Stream0=current_selected_model_analysis_module_3, Stream1=current_selected_model_assembly_module_4)
event_37 = EventGate(Data=filter_28)  # -> Data, IsNew
panel_116 = Panel(event_37.Data)
current_selected_model = RemoteSender(event_37.Data)

current_tab_9 = RemoteReceiver(current_tab)
expression_35 = Expression(x="Analysis module", y=current_tab_9, Expression="x=y")

# ---- group: Assembly model (continued)
current_tab_10 = RemoteReceiver(current_tab)
current_tab_11 = RemoteReceiver(current_tab)
current_tab_12 = RemoteReceiver(current_tab)
current_tab_13 = RemoteReceiver(current_tab)
current_tab_14 = RemoteReceiver(current_tab)
current_tab_15 = RemoteReceiver(current_tab)
current_tab_16 = RemoteReceiver(current_tab)
expression_36 = Expression(x="Assembly module", y=current_tab_10, Expression="x=y")
expression_37 = Expression(x="Assembly module", y=current_tab_13, Expression="x=y")
expression_38 = Expression(x="Assembly module", y=current_tab_11, Expression="x=y")
expression_39 = Expression(x="Assembly module", y=current_tab_14, Expression="x=y")
expression_40 = Expression(x="Assembly module", y=current_tab_12, Expression="x=y")
current_tab_17 = RemoteReceiver(current_tab)
expression_41 = Expression(x="Assembly module", y=current_tab_15, Expression="x=y")
expression_42 = Expression(x="Assembly module", y=current_tab_16, Expression="x=y")
expression_43 = Expression(x="Assembly module", y=current_tab_17, Expression="x=y")
and_5 = GateAnd(A=values_34.Values, B=expression_43)
show_honeybee_all = RemoteSender(and_5)
show_honeybee_all_2 = RemoteReceiver(show_honeybee_all)
show_honeybee_all_3 = RemoteReceiver(show_honeybee_all)
show_honeybee_all_4 = RemoteReceiver(show_honeybee_all)
show_honeybee_all_5 = RemoteReceiver(show_honeybee_all)
show_honeybee_all_6 = RemoteReceiver(show_honeybee_all)
show_honeybee_all_7 = RemoteReceiver(show_honeybee_all)
show_honeybee_all_8 = RemoteReceiver(show_honeybee_all)
or_12 = GateOr(A=values_30.Values, B=show_honeybee_all_3)
or_13 = GateOr(A=values_31.Values, B=show_honeybee_all_2)
or_14 = GateOr(A=values_32.Values, B=show_honeybee_all_4)
or_15 = GateOr(A=values_35.Values, B=show_honeybee_all_5)
or_16 = GateOr(A=values_36.Values, B=show_honeybee_all_6)
or_17 = GateOr(A=values_38.Values, B=show_honeybee_all_7)
or_18 = GateOr(A=values_39.Values, B=show_honeybee_all_8)
and_6 = GateAnd(A=or_12, B=expression_36)
and_7 = GateAnd(A=or_13, B=expression_40)
and_8 = GateAnd(A=or_14, B=expression_38)
and_9 = GateAnd(A=or_15, B=expression_37)
and_10 = GateAnd(A=or_16, B=expression_39)
and_11 = GateAnd(A=or_17, B=expression_41)
and_12 = GateAnd(A=or_18, B=expression_42)
show_honeybee_ground = RemoteSender(and_9)
show_honeybee_context = RemoteSender(and_7)
show_honeybee_floors = RemoteSender(and_10)
show_honeybee_walls = RemoteSender(and_12)
show_honeybee_windows = RemoteSender(and_8)
show_honeybee_roof = RemoteSender(and_11)
show_honeybee_doors = RemoteSender(and_6)
current_tab_18 = RemoteReceiver(current_tab)
current_tab_19 = RemoteReceiver(current_tab)
expression_44 = Expression(x="Assembly module", y=current_tab_18, Expression="x=y")
expression_45 = Expression(x="Assembly module", y=current_tab_19, Expression="x=y")
and_13 = GateAnd(A=event_11.Data, B=expression_44)
and_14 = GateAnd(A=event_12.Data, B=expression_45)
bake_model = RemoteSender(and_13)
sync_honeybee_model = RemoteSender(and_4)
create_model_2 = RemoteSender(and_14)

# ----
create_model_3 = RemoteReceiver(create_model_2)
py3_34 = Python3Script(update=create_model_3)  # -> timestamp
# ---------- py3_34: Python ----------
import datetime

timestamp = ' (' + str(datetime.datetime.now())[:-7] + ')'
timestamp = timestamp.replace(':', '.')
print(timestamp)
# ---------- end py3_34 ----------
sync_honeybee_model_2 = RemoteReceiver(sync_honeybee_model)
freeze_gate_43 = StreamFreezeGate(Data=py3_17, PassingSwitch=sync_honeybee_model_2)
py3_35 = Python3Script(folder=freeze_gate_43)  # -> model_names, files
# ---------- py3_35: Python ----------
import os

files = [str(folder + '\\' + f) for f in os.listdir(folder)]

model_names = [f.split('\\')[-1][:-7] for f in files]
# ---------- end py3_35 ----------
rec_19 = DataRecorder(py3_35.model_names, DataLimit=-10, RecordData=True)
panel_117 = Panel(rec_19)
panel_118 = Panel(py3_35.files)
cset_4 = CreateSet(List=py3_35.model_names)  # -> Set, Map
item_15 = ListItem(List=py3_35.files, Index=current_selected_model_assembly_module_2, Wrap=True)
panel_119 = Panel(item_15)
cset_5 = CreateSet(List=py3_35.files)  # -> Set, Map
py3_36 = Python3Script(rename=rename_current_model_2, rename_name=rename_current_model_name_2, file_path=item_15)
# ---------- py3_36: Python ----------
import os

if rename:
    rename_name = "\\".join(file_path.split("\\")[:-1]) + "\\" + rename_name

    if rename_name.endswith(".hbjson"):
        pass
    else:
        rename_name = rename_name + ".hbjson"

    print(rename_name)

    if os.path.exists(file_path):
        os.rename(file_path, rename_name)
# ---------- end py3_36 ----------
py3_37 = Python3Script(remove=remove_current_model_2, file_path=item_15)
# ---------- py3_37: Python ----------
import os

if remove:
    if os.path.exists(file_path):
        os.remove(file_path)
# ---------- end py3_37 ----------
item_16 = ListItem(List=cset_5.Set, Index=current_selected_model_assembly_module_3, Wrap=invert(True))
item_17 = ListItem(List=cset_5.Set, Index=current_selected_model_visualise_module_2, Wrap=invert(True))
item_18 = ListItem(List=cset_5.Set, Index=current_selected_model_analysis_module_2, Wrap=invert(True))
current_all_created_models_names = RemoteSender(cset_4.Set)
current_all_created_models_names_2 = RemoteReceiver(current_all_created_models_names)
current_all_created_models_names_3 = RemoteReceiver(current_all_created_models_names)
fragment_3 = TextFragment(Text=current_all_created_models_names_2, Start="7")
lng_10 = ListLength(List=current_all_created_models_names_2)
lng_11 = ListLength(List=current_all_created_models_names_3)
subtraction_7 = Subtraction(A=lng_10, B="1")
subtraction_8 = Subtraction(A=lng_11, B="1")
setlist_3 = SetListContents(ListToModify=pulldown, NewListContents=current_all_created_models_names_2, SelectedIndex=subtraction_7)
setlist_4 = SetListContents(ListToModify=pulldown_3, NewListContents=current_all_created_models_names_3, SelectedIndex=subtraction_8)
panel_120 = Panel(cset_5.Set)
py3_38 = Python3Script(file_name=item_18)  # -> model_name
# ---------- py3_38: Python ----------
model_name = file_name.split('\\')[-1][:-7]
# ---------- end py3_38 ----------
loadobjects = HBLoadObjects(hb_file=item_16, load=Toggle(True))  # -> report, flatten(hb_objs); plug-in component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
current_model_name = RemoteSender(py3_38)
py3_39 = Python3Script(file_name=item_17)  # -> model_name; same code as py3_38
loadobjects_2 = HBLoadObjects(hb_file=item_18, load=Toggle(True))  # -> report, flatten(hb_objs); plug-in component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
loadobjects_3 = HBLoadObjects(hb_file=item_17, load=Toggle(True))  # -> report, flatten(hb_objs); plug-in component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
rec_20 = DataRecorder(loadobjects.hb_objs, DataLimit=-10, RecordData=True)
panel_121 = Panel(rec_20)
data_17 = Data(loadobjects_2.hb_objs)
data_18 = Data(loadobjects_2.hb_objs)
data_19 = Data(loadobjects_2.hb_objs)
null_29 = NullItem(Item=py3_35.files)  # -> NullFlags, InvalidFlags, Description
item_19 = ListItem(List=null_29.NullFlags, Index=0, Wrap=True)
filter_29 = StreamFilter(Gate=item_19, Stream0=py3_35.files, Stream1=empty)
honeybee_model = Data(data_17)
honeybee_model_2 = Data(data_17)

show_honeybee_windows_2 = RemoteReceiver(show_honeybee_windows)
show_honeybee_context_2 = RemoteReceiver(show_honeybee_context)
show_honeybee_ground_2 = RemoteReceiver(show_honeybee_ground)
show_honeybee_floors_2 = RemoteReceiver(show_honeybee_floors)
show_honeybee_doors_2 = RemoteReceiver(show_honeybee_doors)
show_honeybee_walls_2 = RemoteReceiver(show_honeybee_walls)
show_honeybee_roof_2 = RemoteReceiver(show_honeybee_roof)

# ---- group: Assembly model (continued)
current_all_created_models_names_4 = RemoteReceiver(current_all_created_models_names)
lng_12 = ListLength(List=current_all_created_models_names_4)
subtraction_9 = Subtraction(A=lng_12, B="1")
setlist_5 = SetListContents(ListToModify=pulldown_5, NewListContents=current_all_created_models_names_4, SelectedIndex=subtraction_9)

# ---- group: Geometry module (continued)
current_tab_20 = RemoteReceiver(current_tab)
expression_46 = Expression(x="Geometry module", y=current_tab_20, Expression="x=y")
and_15 = GateAnd(A=bool_7, B=expression_46)
preview_2 = RemoteSender(and_15)
current_tab_21 = RemoteReceiver(current_tab)
heath_status_3 = RemoteReceiver(heath_status)
current_tab_22 = RemoteReceiver(current_tab)
expression_47 = Expression(x="Geometry module", y=current_tab_21, Expression="x=y")
expression_48 = Expression(x="Geometry module", y=current_tab_22, Expression="x=y")
expression_49 = Expression(x="Hidden", y=heath_status_3, Expression="x=y")
and_16 = GateAnd(A=equals_8.Inequality, B=expression_47)
and_17 = GateAnd(A=equals_9.Inequality, B=expression_48, C=invert(expression_49))
event_38 = EventGate(Data=and_16)  # -> Data, IsNew
event_39 = EventGate(Data=and_17)  # -> Data, IsNew
savegeometry = RemoteSender(event_38.Data)
create_test_model = RemoteSender(event_39.Data)

# ----
create_test_model_2 = RemoteReceiver(create_test_model)
bake = BakeObjects(Geometry=entwine_12, Attributes=repeat_2, Bake=create_test_model_2, createGroups=False)  # -> Message, Ghosts

savegeometry_2 = RemoteReceiver(savegeometry)
create_test_model_3 = RemoteReceiver(create_test_model)
savegeometry_3 = RemoteReceiver(savegeometry)
create_test_model_4 = RemoteReceiver(create_test_model)
create_test_model_5 = RemoteReceiver(create_test_model)
create_test_model_6 = RemoteReceiver(create_test_model)
savegeometry_4 = RemoteReceiver(savegeometry)
preview_3 = RemoteReceiver(preview_2)
savegeometry_5 = RemoteReceiver(savegeometry)
savegeometry_6 = RemoteReceiver(savegeometry)
py3_40 = Python3Script(x=savegeometry_2)  # -> a
# ---------- py3_40: Python ----------
"""Grasshopper Script"""

import rhinoscriptsyntax as rs

if x:
    rs.Command("SelNone")
    a = True
# ---------- end py3_40 ----------
preview_4 = RemoteReceiver(preview_2)
preview_5 = RemoteReceiver(preview_2)
preview_6 = RemoteReceiver(preview_2)
savegeometry_7 = RemoteReceiver(savegeometry)
or_19 = GateOr(A=Toggle(True), B=py3_40)
or_20 = GateOr(A=savegeometry_3, B=preview_3, C=expression_8, D=create_test_model_3)
or_21 = GateOr(A=savegeometry_4, B=preview_4, C=expression_10, D=create_test_model_4)
or_22 = GateOr(A=savegeometry_6, B=preview_6, C=expression_14, D=create_test_model_5)
or_23 = GateOr(A=savegeometry_5, B=preview_5, C=expression_12, D=create_test_model_6)
preview_7 = RemoteReceiver(preview_2)
selobj_2 = ObjectsBySelection(Reset=or_19, LiveMode=True)
gate_10 = StreamGate(Stream="Heath geometry type", Gate=or_22)  # -> Target0, Target1
gate_11 = StreamGate(Stream="Heath geometry type", Gate=or_20)  # -> Target0, Target1
gate_12 = StreamGate(Stream="Heath geometry type", Gate=or_21)  # -> Target0, Target1
gate_13 = StreamGate(Stream="Heath geometry type", Gate=or_23)  # -> Target0, Target1
refkv = ReferenceByKeyValue(Key=gate_11.Target1, Val=gate_4.Target1, lightweight=False)
refkv_2 = ReferenceByKeyValue(Key=gate_10.Target1, Val=gate_2.Target1, lightweight=False)
refkv_3 = ReferenceByKeyValue(Key=gate_12.Target1, Val=gate_3.Target1, lightweight=False)
refkv_4 = ReferenceByKeyValue(Key=gate_13.Target1, Val=gate_5.Target1, lightweight=False)
seletedgeometry = RemoteSender(selobj_2)
seletedgeometry_2 = RemoteReceiver(seletedgeometry)
freeze_gate_44 = StreamFreezeGate(Data=seletedgeometry_2, PassingSwitch=presavegeometry_2, Hold=False)
seletedgeometry_3 = RemoteReceiver(seletedgeometry)
detatt = DetachAttributes(Geometry=seletedgeometry_3)  # -> Geometry, Attributes
filtertype = FilterByType(ObjectType="Extrusion", Geometry=freeze_gate_44, invertFilter=False, returnNulls=False)  # -> ExcludedGeometry, IncludedGeometry
filtertype_2 = FilterByType(ObjectType="Brep", Geometry=freeze_gate_44, invertFilter=False, returnNulls=False)  # -> ExcludedGeometry, IncludedGeometry
filtertype_3 = FilterByType(ObjectType="Surface", Geometry=freeze_gate_44, invertFilter=False, returnNulls=False)  # -> ExcludedGeometry, IncludedGeometry
filtertype_4 = FilterByType(ObjectType="Mesh", Geometry=freeze_gate_44, invertFilter=False, returnNulls=False)  # -> ExcludedGeometry, IncludedGeometry
filtertype_5 = FilterByType(ObjectType=panel_40, Geometry=freeze_gate_44, invertFilter=False, returnNulls=False)  # -> ExcludedGeometry, IncludedGeometry
ef_att_2 = EleFrontAttributes(Attributes=detatt.Attributes, Keys="Construction", Values=constructiontype)
modratt = ModifyRhinoObjectAttributes(ReferencedObject=seletedgeometry_3, Attributes=ef_att_2, Activate=saveconstruction)
planar = IsPlanar(Surface=filtertype_3.IncludedGeometry, Interior=True)  # -> Planar, Plane
ispolysurfaceclosed = Python3Script(Ps=[filtertype.IncludedGeometry, filtertype_2.IncludedGeometry, filtertype_5.IncludedGeometry])  # -> C; inputs Ps: Brep
# ---------- ispolysurfaceclosed: Python ----------
if Ps:
    C = Ps.IsSolid
# ---------- end ispolysurfaceclosed ----------
id = Guid(refkv_4)
panel_122 = Panel(modratt)
lng_13 = ListLength(List=freeze_gate_44)
preview_8 = RemoteReceiver(preview_2)
preview_9 = RemoteReceiver(preview_2)
preview_10 = RemoteReceiver(preview_2)
preview_11 = RemoteReceiver(preview_2)
cull_8 = CullPattern(
    List=[filtertype.IncludedGeometry, filtertype_2.IncludedGeometry, filtertype_5.IncludedGeometry],
    CullPattern=ispolysurfaceclosed)
cull_9 = CullPattern(List=filtertype_3.IncludedGeometry, CullPattern=planar.Planar)
py3_41 = Python3Script(x=id)  # -> out, a; inputs x: list
# ---------- py3_41: Python ----------
import Rhino.Geometry as rg
import rhinoscriptsyntax as rs
import scriptcontext as sc
import Rhino

a = []
sc.doc = Rhino.RhinoDoc.ActiveDoc
for g in x:
    print(g)
    obj = sc.doc.Objects.Find(g)
    index = obj.Attributes.LayerIndex
    layer = sc.doc.Layers[index]
    if(layer.IsVisible):
        a.append(g)
sc.doc = ghdoc
# ---------- end py3_41 ----------
savegeometry_8 = RemoteReceiver(savegeometry)
gate_14 = StreamGate(Stream=refkv_2, Gate=preview_8)  # -> Target0, Target1
gate_15 = StreamGate(Stream=refkv_3, Gate=preview_9)  # -> Target0, Target1
gate_16 = StreamGate(Stream=refkv, Gate=preview_11)  # -> Target0, Target1
windows = Geometry(py3_41.a)
gate_17 = StreamGate(Stream=windows, Gate=preview_10)  # -> Target0, Target1
filter_30 = StreamFilter(
    Gate=geometrytype_validate_2,
    Stream0=cull_8,
    Stream1=cull_9,
    Stream2=[filtertype_5.IncludedGeometry, filtertype_3.IncludedGeometry],
    Stream3=[filtertype_4.IncludedGeometry, filtertype_3.IncludedGeometry, filtertype_5.IncludedGeometry, filtertype.IncludedGeometry, filtertype_2.IncludedGeometry],
    Stream4=freeze_gate_44)  # -> flatten(Stream)
id_2 = Guid(filter_30)
txt_3 = Text(id_2)
cset_6 = CreateSet(List=txt_3)  # -> Set, Map
geo = Geometry(cset_6.Set)
detatt_2 = DetachAttributes(Geometry=geo)  # -> Geometry, Attributes
ef_att_3 = EleFrontAttributes(Attributes=detatt_2.Attributes, Keys="Heath geometry type", Values=geometrytype_2)
modratt_2 = ModifyRhinoObjectAttributes(ReferencedObject=geo, Attributes=ef_att_3, Activate=savegeometry_7)
panel_123 = Panel(modratt_2)
lng_14 = ListLength(List=geo)
equals_30 = Equality(FirstNumber=lng_13, SecondNumber=lng_14)  # -> Equality, Inequality
freeze_gate_45 = StreamFreezeGate(Data=equals_30.Equality, PassingSwitch=savegeometry_8)
preview_12 = CustomPreview(Geometry=gate_14.Target1, Material=ColourSwatch(SwatchColor=RGBA(0, 17, 128, 75)))
preview_13 = CustomPreview(Geometry=gate_15.Target1, Material=ColourSwatch(SwatchColor=RGBA(128, 125, 0, 75)))
preview_14 = CustomPreview(Geometry=gate_17.Target1, Material=ColourSwatch(SwatchColor=RGBA(128, 0, 102, 75)))
preview_15 = CustomPreview(Geometry=gate_16.Target1, Material=ColourSwatch(SwatchColor=RGBA(4, 128, 0, 75)))
hasdata_7 = DataExists(Data=freeze_gate_45)
filter_31 = StreamFilter(Gate=hasdata_7, Stream0="1", Stream1=freeze_gate_45)
geometry_saved = RemoteSender(filter_31)

# ---- group: Geometry module (continued)
seletedgeometry_4 = RemoteReceiver(seletedgeometry)
seletedgeometry_5 = RemoteReceiver(seletedgeometry)
lng_15 = ListLength(List=seletedgeometry_4)
geometry_saved_2 = RemoteReceiver(geometry_saved)
bool_38 = Boolean(lng_15)
seletedgeometry_6 = RemoteReceiver(seletedgeometry)
lng_16 = ListLength(List=seletedgeometry_5)
filter_32 = StreamFilter(Gate=bool_38, Stream0=Slider(500, range=0..1000), Stream1=Slider(1000000, range=0..1000000))
filter_33 = StreamFilter(Gate=bool_38, Stream0="Select Rhino geometry to import", Stream1=" ")
nor = GateNor(A=geometry_saved_2, B=lng_16)
lng_17 = ListLength(List=seletedgeometry_6)
hideshow_18 = HideShowElement(ElementToHideShow=button_18, Show=True, Collapse=True, Disable=invert(lng_17))
tooltip_7 = AttachTooltipToElement(ElementsToAttachTo=button_18, TooltipContent=filter_33, ShowDelay=filter_32, Duration=2000)
hideshow_19 = HideShowElement(ElementToHideShow=label_20, Show=nor, Collapse=True, Disable=False)

# ---- group: Visualize module (continued)
current_tab_23 = RemoteReceiver(current_tab)
expression_50 = Expression(x="Visualize module", y=current_tab_23, Expression="x≠y")
and_18 = GateAnd(A=values_52.Values, B=invert(expression_50))
freeze_gate_46 = StreamFreezeGate(Data=expression_50, PassingSwitch=expression_50, Freeze=True)
current_tab_24 = RemoteReceiver(current_tab)
current_tab_25 = RemoteReceiver(current_tab)
current_tab_26 = RemoteReceiver(current_tab)
current_tab_27 = RemoteReceiver(current_tab)
weather_visualization_show = RemoteSender(and_18)
setcheckbox_2 = SetCheckBox(CheckBoxToModify=checkbox_9, NewValue=invert(freeze_gate_46))
expression_51 = Expression(x="Visualize module", y=current_tab_24, Expression="x≠y")
expression_52 = Expression(x="Visualize module", y=current_tab_26, Expression="x=y")
expression_53 = Expression(x="Visualize module", y=current_tab_27, Expression="x≠y")
expression_54 = Expression(x="Visualize module", y=current_tab_25, Expression="x=y")
and_19 = GateAnd(A=equals_7.Inequality, B=expression_52)
and_20 = GateAnd(A=equals_6.Inequality, B=expression_54)
and_21 = GateAnd(A=values_59.Values, B=invert(expression_51))
and_22 = GateAnd(A=values_54.Values, B=invert(expression_53))
and_23 = GateAnd(A=values_61.Values, B=invert(expression_51))
and_24 = GateAnd(A=values_58.Values, B=invert(expression_53))
event_40 = EventGate(Data=and_19)  # -> Data, IsNew
event_41 = EventGate(Data=and_20)  # -> Data, IsNew
face_attribute_visualize = RemoteSender(and_21)
room_energy_attribute_visualize = RemoteSender(and_22)
face_energy_attribute_visualize = RemoteSender(and_23)
room_attribute_visualize = RemoteSender(and_24)
weather_visualisation_bake = RemoteSender(event_40.Data)
run_weather_visualisation = RemoteSender(event_41.Data)

# ----
freeze_gate_47 = StreamFreezeGate(Data=expression_53, PassingSwitch=expression_53)
freeze_gate_48 = StreamFreezeGate(Data=expression_51, PassingSwitch=expression_51)
setcheckbox_3 = SetCheckBox(CheckBoxToModify=[checkbox_11, checkbox_10], NewValue=invert(freeze_gate_47))
setcheckbox_4 = SetCheckBox(CheckBoxToModify=[checkbox_12, checkbox_13], NewValue=invert(freeze_gate_48))

# ----
# Weather visualisation
# # Weather visualisation
# This cluster visualises weather data from a .epw file including solar radiation and temperature, as applied to a target geometry
# 
# ## Instructions
# Enter all the inputs and visualise wind, sky view and temperature,  set `Run direct sun hours study` and `Run incident radiation study` to visualise solar radiation
# 
# ## Inputs
# - `EPW file URL` - the URL for a EPW file which describes the location
# - `Target Geometry` - geometry on which to apply irradiation study
# - `Context Geometry` - geometry which shades the target geometry
# - `Run direct sun hours study` - set to True to run the direct sun hours study
# - `Run incident radiation study` - set to True to run the incident radiation study
# - `Sky mask centre point` - point at which to generate sky mask
# 
# ## Outputs
# - `Sky dome` - mesh visualising the directions where solar radiation comes from during the year at the location
# - `Sky mask - mesh visualising what portions of the sky are visible at the specified point
# - `Wind rose` - mesh visualising wind directions and velocities during the year
# - `Dry bulb temperature line chart` - mesh visualising dry bulb temperature during the year
# - `Dry bulb temperature 2D chart` - mesh visualising dry bulb temperature for each hour of the year
# - `Direct sun hours` - mesh visualising the number of direct sun hours on the target geometry
# - `Incident radiation` - mesh visualising the incident radiation [kWh/m2] on the target geometry
# 
# ## Interpretation
# To be added...
# Visualise properties
# # Visualise properties
# This cluster visualises room and face attributes of a Honeybee model
# 
# ## Instructions
# Input the Honeybee model to be visualised and select room/face attributes using the HB Room Attributes/HB Room Energy Attibrutes/HB Face Attributes/HB Face Energy Attributes dropdown components. Adjust precision of the attributes using the `Number of decimals` inputs
# 
# ## Inputs
# - `Honeybee model` - Honeybee model to be visualised
# - `Room attribute` - Honeybee Room  or Room Energy attribute to visualise
# - `Number of decimals (room)` - Precision of room attribute output
# - `Face attribute` - Honeybee Face  or Face Energy attribute to visualise
# - `Number of decimals (face)` - Precision of face attribute output
# 
# ## Outputs
# - `Visualised room attributes` - mesh representing the selected room attribute
# - `Visualised face attributes` - mesh representing the selected face attribute
# 
# ## Interpretation
# To be added...
run_weather_visualisation_2 = RemoteReceiver(run_weather_visualisation)
data_20 = Data(loadobjects_3.hb_objs)
entwine_112 = Entwine(Branch00=py3_39, Branch01=data_20, FlattenInputs=True)
freeze_gate_49 = StreamFreezeGate(Data=entwine_112, PassingSwitch=run_weather_visualisation_2)
split_4 = SplitTree(Data=freeze_gate_49, Masks=flatten("{0;0}"))  # -> Positive, Negative
roomenergyattr = HBRoomEnergyAttributes({"Program": "properties.energy.program_type.display_name", "Construction Set": "properties.energy.construction_set.display_name", "Is Conditioned": "properties.energy.is_conditioned", "People per Area [ppl/m2]": "properties.energy.people.people_per_area", "Area per Person [m2/ppl]": "properties.energy.people.area_per_person", "Lighting per Area [W/m2]": "properties.energy.lighting.watts_per_area"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}, selected="Program")
deconstructmodel = HBDeconstructModel(model=split_4.Negative)  # -> rooms, faces, apertures, doors, shades; plug-in component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
current_weather_simulation_name = RemoteSender(split_4.Positive)
faceenergyattr = HBFaceEnergyAttributes({"Construction": "properties.energy.construction.display_name", "Materials": "properties.energy.construction.layers", "Thickness [m]": "properties.energy.construction.thickness", "Density [kg/m2]": "properties.energy.construction.mass_area_density", "Heat Capacity [J/K-m2]": "properties.energy.construction.area_heat_capacity", "Construction R-Value [m2-K/W]": "properties.energy.construction.r_value", "Construction U-Value [W/m2-K]": "properties.energy.construction.u_value", "Construction U-Factor [W/m2-K]": "properties.energy.construction.u_factor", "Construction SHGC [Unshaded]": "properties.energy.construction.shgc", "R-Factor [m2-K/W]": "properties.energy.r_factor", "U-Factor [W/m2-K]": "properties.energy.u_factor", "SHGC [Unshaded]": "properties.energy.shgc", "Solar Transmitance [Unshaded]": "properties.energy.construction.solar_transmittance", "Visible Transmitance [Unshaded]": "properties.energy.construction.visible_transmittance", "Solar Reflectance [Outside]": "properties.energy.construction.outside_solar_reflectance", "Solar Reflectance [Inside]": "properties.energy.construction.inside_solar_reflectance", "Fraction Area Operable": "properties.energy.vent_opening.fraction_area_operable", "Fraction Height Operable": "properties.energy.vent_opening.fraction_height_operable", "Discharge Coefficient": "properties.energy.vent_opening.discharge_coefficient"}, selected="Construction SHGC [Unshaded]")
room_attribute_visualize_2 = RemoteReceiver(room_attribute_visualize)
room_energy_attribute_2 = RemoteReceiver(room_energy_attribute)
face_attribute_visualize_2 = RemoteReceiver(face_attribute_visualize)
face_energy_attribute_2 = RemoteReceiver(face_energy_attribute)
roomattr = HBRoomAttributes({"Display Name": "display_name", "Simulation Name (Identifier)": "identifier", "Multiplier": "multiplier", "Floor Area Excluded": "exclude_floor_area", "Story": "story", "Volume": "volume", "Gross Floor Area": "floor_area", "Exposed Area": "exposed_area", "Exterior Wall Area": "exterior_wall_area", "Exterior Aperture Area": "exterior_aperture_area", "Average Floor Elevation": "average_floor_height"}, selected="Exterior Aperture Area")
faceattr = HBFaceAttributes({"Display Name": "display_name", "Simulation Name (Identifier)": "identifier", "Boundary Condition": "boundary_condition", "Has Parent": "has_parent", "Parent": "parent", "Azimuth": "azimuth", "Altitude": "altitude", "Area": "area", "Perimeter": "perimeter", "Face Type": "type", "Aperture Is Operable": "is_operable", "Door Is Glass": "is_glass"}, selected="Face Type")
room_attribute_2 = RemoteReceiver(room_attribute)
face_attribute_2 = RemoteReceiver(face_attribute)
location_20 = RemoteReceiver(location)
vizquick = HBVisualizeQuick(hb_objs=flatten(deconstructmodel.shades))  # -> geo; plug-in component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
vizquick_2 = HBVisualizeQuick(hb_objs=flatten(deconstructmodel.rooms))  # -> geo; plug-in component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
pt_16 = ConstructPoint(XCoordinate=Slider(21, range=0..100), YCoordinate=Slider(15, range=0..100), ZCoordinate=0)
data_21 = Data(location_20)
filter_34 = StreamFilter(Gate=face_attribute_visualize_2, Stream0=face_energy_attribute_2, Stream1=face_attribute_2)
filter_35 = StreamFilter(Gate=room_attribute_visualize_2, Stream0=room_energy_attribute_2, Stream1=room_attribute_2)
pt_17 = Point(pt_16)
data_22 = Data(loadobjects_3.hb_objs)
weather_visualisation = WeatherVisualisation(
    _1=data_21,
    run_weather_visualisation=run_weather_visualisation_2,
    target_geometry_2=vizquick_2,
    target_geometry=vizquick,
    sky_mask_centre_point=pt_17)  # -> sky_dome, sky_mask, wind_rose, dry_bulb_temperature_line_chart, dry_bulb_temperature_2d_chart, direct_sun_hours_2, incident_radiation
visualise_properties = VisualiseProperties(
    honeybee_model=data_22,
    room_attribute=filter_35,
    number_of_decimals_room=Slider(4, range=0..10),
    face_attribute=filter_34,
    number_of_decimals_face=Slider(4, range=0..10))  # -> visualised_room_attributes_2, visualised_face_attributes_2
run_weather_visualisation_3 = RemoteReceiver(run_weather_visualisation)
entwine_113 = Entwine(
    Branch00=weather_visualisation.sky_dome,
    Branch01=weather_visualisation.sky_mask,
    Branch02=weather_visualisation.wind_rose,
    Branch03=weather_visualisation.dry_bulb_temperature_line_chart,
    Branch04=weather_visualisation.dry_bulb_temperature_2d_chart,
    Branch05=weather_visualisation.direct_sun_hours_2,
    Branch06=weather_visualisation.incident_radiation,
    FlattenInputs=True)
room_energy_attribute_visualize_2 = RemoteReceiver(room_energy_attribute_visualize)
face_energy_attribute_visualize_2 = RemoteReceiver(face_energy_attribute_visualize)
room_attribute_visualize_3 = RemoteReceiver(room_attribute_visualize)
face_attribute_visualize_3 = RemoteReceiver(face_attribute_visualize)
freeze_gate_50 = StreamFreezeGate(Data=entwine_113, PassingSwitch=run_weather_visualisation_3, Hold=True)
weather_visualization_type_2 = RemoteReceiver(weather_visualization_type)
null_30 = NullItem(Item=flatten(freeze_gate_50))  # -> NullFlags, InvalidFlags, Description
or_24 = GateOr(A=room_attribute_visualize_3, B=room_energy_attribute_visualize_2)
bang_8 = ExplodeTree(Data=freeze_gate_50)  # -> Branch0, Branch1, Branch2, Branch3, Branch4, Branch5, Branch6
or_25 = GateOr(A=face_attribute_visualize_3, B=face_energy_attribute_visualize_2)
weather_visualization_show_2 = RemoteReceiver(weather_visualization_show)
gate_18 = StreamGate(Stream=visualise_properties.visualised_room_attributes_2, Gate=or_24)  # -> Target0, Target1
gate_19 = StreamGate(Stream=visualise_properties.visualised_face_attributes_2, Gate=or_25)  # -> Target0, Target1
cull_10 = CullPattern(List=null_30.NullFlags, CullPattern=invert(null_30.NullFlags))
weather_visualization_show_3 = RemoteReceiver(weather_visualization_show)
filter_36 = StreamFilter(
    Gate=weather_visualization_type_2,
    Stream0=bang_8.Branch0,
    Stream1=bang_8.Branch1,
    Stream2=bang_8.Branch2,
    Stream3=bang_8.Branch3,
    Stream4=bang_8.Branch4,
    Stream5=bang_8.Branch5,
    Stream6=bang_8.Branch6)
equals_31 = Equality(FirstNumber="3", SecondNumber=weather_visualization_type_2)  # -> Equality, Inequality
equals_32 = Equality(FirstNumber="4", SecondNumber=weather_visualization_type_2)  # -> Equality, Inequality
equals_33 = Equality(FirstNumber="5", SecondNumber=weather_visualization_type_2)  # -> Equality, Inequality
equals_34 = Equality(FirstNumber="6", SecondNumber=weather_visualization_type_2)  # -> Equality, Inequality
data_23 = Data(gate_18.Target1)
data_24 = Data(gate_19.Target1)
lng_18 = ListLength(List=cull_10)
nor_2 = GateNor(A=equals_31.Equality, B=equals_32.Equality)
or_26 = GateOr(A=equals_33.Equality, B=equals_34.Equality)
gate_20 = StreamGate(Stream=filter_36, Gate=weather_visualization_show_2)  # -> Target0, Target1
weather_visualisation_exists = RemoteSender(lng_18)
and_25 = GateAnd(A=weather_visualization_show_3, B=or_26)
gate_21 = StreamGate(Stream=gate_20.Target1, Gate=nor_2)  # -> Target0, Target1
weather_visualisation_wireframe = RemoteSender(and_25)
weather_visualization_show_4 = RemoteReceiver(weather_visualization_show)
mesh = Mesh([gate_21.Target1, gate_21.Target0])
sortbytype = SortObjectsByType(RhinoObjects=gate_21.Target0)  # -> Points, Curves, Surfaces, Breps, Meshes, TextObjects, HatchObjects, LightObjects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
bbox = BoundingBox(Content=mesh, Plane=PlaneXY(0, 0, 0), UnionBox=True)  # -> Box, Box_2
swatch = ColourSwatch(SwatchColor=RGB(84, 84, 84))
line = Line(sortbytype.Curves)
zoom_weather_visualization_bounding_box = RemoteSender(bbox.Box)
gate_22 = StreamGate(Stream=swatch, Gate=weather_visualization_show_4)  # -> Target0, Target1
null_31 = NullItem(Item=line)  # -> NullFlags, InvalidFlags, Description
data_25 = Data([sortbytype.Other, sortbytype.Meshes])
sift = SiftPattern(List=sortbytype.Curves, SiftPattern=null_31.NullFlags)  # -> Output0, Output1
preview_16 = CustomPreview(Geometry=gate_21.Target1, Material=gate_22.Target1)
preview_17 = CustomPreview(Geometry=[sift.Output1, data_25], Material=swatch)

current_weather_simulation_name_2 = RemoteReceiver(current_weather_simulation_name)
format_22 = Format(Format=panel_2, Culture=127, Data0=current_weather_simulation_name_2)
settextblock_7 = SetTextBlockContents(TextBlockToModify=tb, NewTextBlockContents=format_22)

# ---- group: Visualize module (continued)
weather_visualisation_exists_2 = RemoteReceiver(weather_visualisation_exists)
weather_visualisation_exists_3 = RemoteReceiver(weather_visualisation_exists)
hideshow_20 = HideShowElement(ElementToHideShow=button_15, Show=True, Collapse=True, Disable=invert(weather_visualisation_exists_2))
hideshow_21 = HideShowElement(ElementToHideShow=button_16, Show=True, Collapse=True, Disable=invert(weather_visualisation_exists_2))
hideshow_22 = HideShowElement(ElementToHideShow=[stack_26, tb], Show=weather_visualisation_exists_3, Collapse=True, Disable=False)

# ----
# Zoom weather visualization module
zoom_weather_visualization_bounding_box_2 = RemoteReceiver(zoom_weather_visualization_bounding_box)
zoom_weather_visualization_2 = RemoteReceiver(zoom_weather_visualization)
zbb = ZoomBoundingBox(Box=zoom_weather_visualization_bounding_box_2, Run=zoom_weather_visualization_2)

# ----
# Bake weather visualization
panel_124 = Panel("""Heath::weather::Sky dome
Heath::weather::Sky mask
Heath::weather::Wind rose
Heath::weather::Dry bulb temperature line chart
Heath::weather::Dry bulb temperature 2D chart
Heath::weather::Direct sun hours
Heath::weather::Incident radiation""")
merge_10 = Merge(Data1=sift.Output1, Data2=data_25, Data3=gate_21.Target1)
weather_visualization_type_3 = RemoteReceiver(weather_visualization_type)
item_20 = ListItem(List=panel_124, Index=weather_visualization_type_3, Wrap=True)
clean = CleanTree(RemoveNulls=True, RemoveInvalid=True, RemoveEmpty=False, Tree=merge_10)
ef_layer_2 = EleFrontLayer(FullPath=item_20)  # -> Layer, FullPath, Hidden, Locked, DisplayColour, MaterialName, Linetype, PrintColour, PrintWidth
weather_visualisation_bake_2 = RemoteReceiver(weather_visualisation_bake)
lng_19 = ListLength(List=clean)
ef_att_4 = EleFrontAttributes(Layer=ef_layer_2.Layer)  # -> Attributes, Keys, Values, Name, Layer, ColourSource, DisplayColour, MaterialSource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
repeat_13 = RepeatData(Data=ef_att_4.Attributes, Length=lng_19)
bake_2 = BakeObjects(Geometry=clean, Attributes=repeat_13, Bake=weather_visualisation_bake_2, createGroups=False, preset="Moderate")  # -> Message, Ghosts

room_energy_attribute_visualize_3 = RemoteReceiver(room_energy_attribute_visualize)
weather_visualisation_wireframe_2 = RemoteReceiver(weather_visualisation_wireframe)
face_energy_attribute_visualize_3 = RemoteReceiver(face_energy_attribute_visualize)
room_attribute_visualize_4 = RemoteReceiver(room_attribute_visualize)
face_attribute_visualize_4 = RemoteReceiver(face_attribute_visualize)

# ---- group: Analysis module (continued)
current_tab_28 = RemoteReceiver(current_tab)
current_tab_29 = RemoteReceiver(current_tab)
current_tab_30 = RemoteReceiver(current_tab)
current_tab_31 = RemoteReceiver(current_tab)
expression_55 = Expression(x="Analysis module", y=current_tab_28, Expression="x=y")
expression_56 = Expression(x="Analysis module", y=current_tab_29, Expression="x=y")
expression_57 = Expression(x="Analysis module", y=current_tab_30, Expression="x=y")
expression_58 = Expression(x="Analysis module", y=current_tab_31, Expression="x=y")
and_26 = GateAnd(A=equals_10.Inequality, B=expression_55)
and_27 = GateAnd(A=equals_11.Inequality, B=expression_56)
and_28 = GateAnd(A=equals_12.Inequality, B=expression_57)
and_29 = GateAnd(A=equals_13.Inequality, B=expression_58)
event_42 = EventGate(Data=and_26)  # -> Data, IsNew
event_43 = EventGate(Data=and_27)  # -> Data, IsNew
event_44 = EventGate(Data=and_28)  # -> Data, IsNew
event_45 = EventGate(Data=and_29)  # -> Data, IsNew
run_simple_energy_simulations = RemoteSender(event_42.Data)
run_daylight_simulations = RemoteSender(event_43.Data)
run_detailed_energy_simulations = RemoteSender(event_44.Data)
calculate_glare_probability = RemoteSender(event_45.Data)

# ----
heath_is_active_2 = RemoteReceiver(heath_is_active)

launchwin_8 = LaunchWindow(
    Show=invert(heath_is_active_2),
    Name="Heath",
    Width=number_slider_32,
    Height=number_slider_33,
    ChildStatus=0,
    EnableHorizScroll=False)
winprops_8 = SetWindowProperties(Window=launchwin_8, StartingLocation=pt_13, AccentColor=heath_accent_color_13, ShowTitleBar=True, ScaleFactor=1)

addelems_9 = AddElements(Window=launchwin_8, Elements=flatten(entwine_86), DoVLChecking=True)  # -> AddedElements, ElementNames
winstat_8 = WindowStatus(Window=launchwin_8)
heath_launch_status = RemoteSender(winstat_8)
heath_launch_elements = RemoteSender(addelems_9.AddedElements)

# ----
# Recursion
panel_125 = Panel("Construction database")
objbynn_11 = GetObjectByNickname(NickName=panel_125)
construction_database = Python3Script()  # -> status; same code as lca_window_status

rec_21 = DataRecorder(filter_18, DataLimit=-2, RecordData=True)
int_6 = Integer(rec_21)
ma_12 = MassAddition(Input=int_6)  # -> Result, PartialResults
entwine_114 = Entwine(Branch00=ma_12.Result, Branch01=construction_database, FlattenInputs=True)
rec_22 = DataRecorder(entwine_114, DataLimit=2, RecordData=True)
item_21 = ListItem(List=rec_22, Index=0, Wrap=True)  # -> Item2, Item1, Item
equals_35 = Equality(FirstNumber=item_21.Item2, SecondNumber=item_21.Item1)  # -> Equality, Inequality
bang_9 = ExplodeTree(Data=equals_35.Inequality)  # -> Branch0, Branch1
py3_42 = Python3Script(x=bang_9.Branch0, y=bang_9.Branch1)  # -> a; same code as py3_6
event_46 = EventGate(Data=py3_42)  # -> Data, IsNew
freeze_gate_51 = StreamFreezeGate(Data=py3_42, PassingSwitch=event_46.IsNew)
event_47 = EventGate(Data=freeze_gate_51)  # -> Data, IsNew
entwine_115 = Entwine(
    Branch00=stack_62,
    Branch01=label_37,
    Branch02=label_36,
    Branch03=stack_63,
    Branch04=stack_64,
    Branch05=stack_65,
    FlattenInputs=True)  # -> flatten(Result)
panel_126 = Panel(event_47.Data)
launchwin_9 = LaunchWindow(
    Show=event_47.Data,
    Name="Construction database",
    Width=Slider(380, range=0..1000),
    Height=Slider(580, range=0..1000),
    ChildStatus=1,
    EnableHorizScroll=False)
winprops_9 = SetWindowProperties(
    Window=launchwin_9,
    StartingLocation=database_modal_location_5,
    Theme=0,
    AccentColor=heath_accent_color_6,
    ShowTitleBar=True,
    BackgroundColor=RGB(255, 255, 255),
    ScaleFactor=1)
winstat_9 = WindowStatus(Window=launchwin_9)
addelems_10 = AddElements(Window=launchwin_9, Elements=flatten(entwine_115), DoVLChecking=True)  # -> AddedElements, ElementNames
py3_43 = Python3Script(window=launchwin_9, activate=or_9)  # same code as py3_7
panel_127 = Panel(winstat_9)
construction_database_status = RemoteSender(winstat_9)
construction_database_elements = RemoteSender(addelems_10.AddedElements)

construction_database_status_2 = RemoteReceiver(construction_database_status)
expression_59 = Expression(x="Hidden", y=construction_database_status_2, Expression="x=y")
expire_8 = ExpireObject(ObjectToExpire=objbynn_11, Expire=expression_59)

construction_database_status_3 = RemoteReceiver(construction_database_status)
construction_database_status_4 = RemoteReceiver(construction_database_status)
expression_60 = Expression(x="Normal", y=construction_database_status_3, Expression="x=y")
expression_61 = Expression(x="Normal", y=construction_database_status_4, Expression="x=y")
and_30 = GateAnd(A=equals_17.Inequality, B=expression_60)
and_31 = GateAnd(A=equals_18.Inequality, B=expression_61)
event_48 = EventGate(Data=and_30)  # -> Data, IsNew
event_49 = EventGate(Data=and_31)  # -> Data, IsNew
save_constructions = RemoteSender(event_48.Data)
panel_128 = Panel(event_48.Data)
load_constructions = RemoteSender(event_49.Data)
panel_129 = Panel(event_49.Data)

# ----
# Load constructions
load_constructions_2 = RemoteReceiver(load_constructions)
load_constructions_file_2 = RemoteReceiver(load_constructions_file)
gate_23 = StreamGate(Stream=load_constructions_file_2, Gate=load_constructions_2)  # -> Target0, Target1
getdocumentusertext_4 = Python3Script(run=load_constructions_2, key="Heath constructions")  # -> json_string; same code as getdocumentusertext
file_2 = ReadFile(File=gate_23.Target1, PerLineParse=False)
split_5 = TextSplit(Text=file_2, Separators="|")  # -> flatten(Result)
entwine_116 = Entwine(Branch00=getdocumentusertext_4, Branch01=file_2, FlattenInputs=True)  # -> flatten(Result)
strtoobj_2 = HBStringToObject(hb_str=split_5)  # -> hb_obj; plug-in component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
null_32 = NullItem(Item=strtoobj_2)  # -> NullFlags, InvalidFlags, Description
item_22 = ListItem(List=null_32.NullFlags, Index=0, Wrap=True)
filter_37 = StreamFilter(Gate=item_22, Stream0=entwine_116)
join_4 = TextJoin(Text=filter_37, Join="|")
freeze_gate_52 = StreamFreezeGate(Data=join_4, PassingSwitch=load_constructions_2, Freeze=False, Hold=False)

# ----
# Save constructions
save_constructions_2 = RemoteReceiver(save_constructions)
getdocumentusertext_5 = Python3Script(run=save_constructions_2, key="Heath constructions")  # -> json_string; same code as getdocumentusertext
null_33 = NullItem(Item=getdocumentusertext_5)  # -> NullFlags, InvalidFlags, Description
save_constructions_file_2 = RemoteReceiver(save_constructions_file)
bool_39 = Boolean(invert(null_33.NullFlags))
filter_38 = StreamFilter(Gate=null_33.NullFlags, Stream0=save_constructions_2, Stream1=bool_39)
writetxt_2 = WriteToTextFile(Run=filter_38, TextToWrite=getdocumentusertext_5, FilePath=save_constructions_file_2, Append=False, NewOnly=False)

material_database_status_3 = RemoteReceiver(material_database_status)
material_database_status_4 = RemoteReceiver(material_database_status)
expression_62 = Expression(x="Normal", y=material_database_status_3, Expression="x=y")
expression_63 = Expression(x="Normal", y=material_database_status_4, Expression="x=y")
and_32 = GateAnd(A=equals_20.Inequality, B=expression_62)
and_33 = GateAnd(A=equals_21.Inequality, B=expression_63)
event_50 = EventGate(Data=and_32)  # -> Data, IsNew
event_51 = EventGate(Data=and_33)  # -> Data, IsNew
panel_130 = Panel(event_50.Data)
save_materials = RemoteSender(event_50.Data)
panel_131 = Panel(event_51.Data)
load_materials = RemoteSender(event_51.Data)

# ----
# Save materials
panel_132 = Panel("Heath materials")
save_materials_2 = RemoteReceiver(save_materials)
getdocumentusertext_6 = Python3Script(run=save_materials_2, key=panel_132)  # -> json_string; same code as getdocumentusertext
null_34 = NullItem(Item=getdocumentusertext_6)  # -> NullFlags, InvalidFlags, Description
bool_40 = Boolean(invert(null_34.NullFlags))
save_materials_file_2 = RemoteReceiver(save_materials_file)
filter_39 = StreamFilter(Gate=null_34.NullFlags, Stream0=save_materials_2, Stream1=bool_40)
writetxt_3 = WriteToTextFile(Run=filter_39, TextToWrite=getdocumentusertext_6, FilePath=save_materials_file_2, Append=False, NewOnly=False)

# ----
# Load materials
load_materials_file_2 = RemoteReceiver(load_materials_file)
load_materials_2 = RemoteReceiver(load_materials)
gate_24 = StreamGate(Stream=load_materials_file_2, Gate=load_materials_2)  # -> Target0, Target1
getdocumentusertext_7 = Python3Script(run=load_materials_2, key="Heath materials")  # -> json_string; same code as getdocumentusertext
file_3 = ReadFile(File=gate_24.Target1, PerLineParse=False)
entwine_117 = Entwine(Branch00=getdocumentusertext_7, Branch01=file_3, FlattenInputs=True)  # -> flatten(Result)
split_6 = TextSplit(Text=file_3, Separators="|")  # -> flatten(Result)
strtoobj_3 = HBStringToObject(hb_str=split_6)  # -> hb_obj; plug-in component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
null_35 = NullItem(Item=strtoobj_3)  # -> NullFlags, InvalidFlags, Description
item_23 = ListItem(List=null_35.NullFlags, Index=0, Wrap=True)
filter_40 = StreamFilter(Gate=item_23, Stream0=entwine_117)
join_5 = TextJoin(Text=filter_40, Join="|")
freeze_gate_53 = StreamFreezeGate(Data=join_5, PassingSwitch=load_materials_2, Freeze=False, Hold=False)

window_database_status_3 = RemoteReceiver(window_database_status)
window_database_status_4 = RemoteReceiver(window_database_status)
expression_64 = Expression(x="Normal", y=window_database_status_3, Expression="x=y")
expression_65 = Expression(x="Normal", y=window_database_status_4, Expression="x=y")
and_34 = GateAnd(A=equals_23.Inequality, B=expression_64)
and_35 = GateAnd(A=equals_24.Inequality, B=expression_65)
event_52 = EventGate(Data=and_34)  # -> Data, IsNew
event_53 = EventGate(Data=and_35)  # -> Data, IsNew
panel_133 = Panel(event_52.Data)
save_windows = RemoteSender(event_52.Data)
panel_134 = Panel(event_53.Data)
load_windows = RemoteSender(event_53.Data)

# ----
# Load windows
load_windows_file_2 = RemoteReceiver(load_windows_file)
load_windows_2 = RemoteReceiver(load_windows)
gate_25 = StreamGate(Stream=load_windows_file_2, Gate=load_windows_2)  # -> Target0, Target1
getdocumentusertext_8 = Python3Script(run=load_windows_2, key="Heath windows")  # -> json_string; same code as getdocumentusertext
file_4 = ReadFile(File=gate_25.Target1, PerLineParse=False)
entwine_118 = Entwine(Branch00=getdocumentusertext_8, Branch01=file_4, FlattenInputs=True)  # -> flatten(Result)
split_7 = TextSplit(Text=file_4, Separators="|")  # -> flatten(Result)
strtoobj_4 = HBStringToObject(hb_str=split_7)  # -> hb_obj; plug-in component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
null_36 = NullItem(Item=strtoobj_4)  # -> NullFlags, InvalidFlags, Description
item_24 = ListItem(List=null_36.NullFlags, Index=0, Wrap=True)
filter_41 = StreamFilter(Gate=item_24, Stream0=entwine_118)
join_6 = TextJoin(Text=filter_41, Join="|")
freeze_gate_54 = StreamFreezeGate(Data=join_6, PassingSwitch=load_windows_2, Freeze=False, Hold=False)

# ----
# Save windows
save_windows_2 = RemoteReceiver(save_windows)
getdocumentusertext_9 = Python3Script(run=save_windows_2, key="Heath windows")  # -> json_string; same code as getdocumentusertext
null_37 = NullItem(Item=getdocumentusertext_9)  # -> NullFlags, InvalidFlags, Description
bool_41 = Boolean(invert(null_37.NullFlags))
save_windows_file_2 = RemoteReceiver(save_windows_file)
filter_42 = StreamFilter(Gate=null_37.NullFlags, Stream0=save_windows_2, Stream1=bool_41)
writetxt_4 = WriteToTextFile(Run=filter_42, TextToWrite=getdocumentusertext_9, FilePath=save_windows_file_2, Append=False, NewOnly=False)

# ----
# Heath material info
panel_135 = Panel("C:\Users\Isac\Desktop\Toivo_Chalmers\heath\model\results\Building physics from physical principles to international standards, Marko Pinteric_page-0001.jpg")
heath_flying_12 = RemoteReceiver(heath_flying)
number_slider_42 = Slider(560, range=0..1000)
panel_136 = Panel("\Building physics from physical principles to international standards, Marko Pinteric_page-0001.jpg")
py3_44 = Python3Script(get=heath_flying_12)  # -> mpl_folder; same code as py3_8
multiplication = Multiplication(A=Slider(1.15, range=0..10), B=number_slider_42)
number_slider_43 = Slider(500, range=0..1000)
concat = Concatenate(FragmentA=py3_44, FragmentB=panel_136)
create_modal_location_2 = RemoteReceiver(create_modal_location)
null_38 = NullItem(Item=concat)  # -> NullFlags, InvalidFlags, Description
multiplication_2 = Multiplication(A=Slider(1.25, range=0..10), B=number_slider_43)
filter_43 = StreamFilter(Gate=null_38.NullFlags, Stream0=concat, Stream1=panel_135)
image_4 = CreateImage(ImageSource=filter_43, ImageWidth=multiplication_2, ImageHeight=number_slider_43)

# ----
# Assemble Honeybee model
# # Assemble Honeybee model
# This cluster takes input geometry and geometric information and generates a valid Honeybee model which can be used in the following analysis steps.
# 
# ## Instructions
# Enter the relevant inputs to generate the Honeybee model. Windows can either be created using an input geometry or through auto-generation using a window-to-wall ratio.
# 
# ### Room geometry
# Each 3D Brep entered represents one room or thermal zone in the building with no air exchange between them. The Breps should be closed and 3D to generate valid rooms. The room geometries should represent the inner boundary of the external walls
# 
# ### Adjacent geometry
# Geometry of adjacent buildings represented by a surface where they contact the room geometry. Adiabatic boundary condition will be assumed at the contact surface.
# 
# ### Windows/apertures
# Windows can either be defined through a list of 2D surfaces which intersect with the room 3D geometries, or be auto-generated through the list of numeric outputs.
# 
# ### Wall/roof thicknesses
# Wall and roof thicknesses are supplied to generate a shading geometry representing the external surface thickness
# 
# ### Louvers
# If all related inputs are entered, shading louvers will be generated on each window according to the entered parameters.
# 
# ### Different directions
# All the above inputs will be the same for all rooms, however they can be optionally entered as a list which represents different values for different cardinal directions, in the order (N, E, S, W).
# 
# ## Inputs
# - `Model name` - text string representing the name of the analysis model
# - `Room geometry` - list of 3D closed Brep geometries representing each room/zone in the model
# - `Construction set` - text string representing the construction to be used for the rooms, can be retrieved using the HB Construction Set by Climate component
# - `Program` - Honeybee Program or list of which are applied to the rooms in the model. Can be defined using the HB Search Programs component
# - `Context geometry` - list of surrounding Brep geometries which shades the analysed Rooms
# - `Windows` - list of 2D Brep geometries which represent the openings in the building envelope. If not supplied, windows are instead generated through definition of window-to-wall ratios as defined below
# - `Skylights` - list of 2D Brep geometries which represent the openings in the building roof
# - `Window-to-wall ratio` - number representing the window-to-wall ratio on each exterior surface Used if no window geometries are supplied.
# - `Subdivide generated windows` - set to True if the window surface area should be divided into multiple windows on each exterior surface
# - `Window height` - number representing the target height of the auto-generated windows
# - `Sill height` - number representing how high the lower edge of the auto-generated windows should be from the room floor
# - `Horizontal separation` - number representing how far separated the auto-generated windows should be horizontally
# - `Vertical separation` - number representing if auto-generated windows should be split vertically and if so, what distance
# - `Wall thickness` - number representing the thickness of the exterior walls, used to generate shading geometry for windows
# - `Roof thickness` - number representing the thickness of the roof, used to generate shading geometry for skylights
# - `Louver depth` - number optionally representing the depth of louvers
# - `Number of louvers` - number optionally representing the amount of louvers on each window
# - `Distance between louvers ` - number optionally representing the distance between louvers on each window
# - `Louver angle` - number optionally representing if louvers should be tilted
# - `Vertical/horizontal louvers` - boolean, set to True if louvers should be vertical
# 
# ## Outputs
# - `Honeybee model` - valid Honeybee model for further analysis
# 
# ## Interpretation
# To be added...
savegeometry_9 = RemoteReceiver(savegeometry)
or_27 = GateOr(A=savegeometry_9, B=pre_create_model_2, C=Toggle(True))
gate_26 = StreamGate(Stream="Heath geometry type", Gate=or_27)  # -> Target0, Target1
refkv_5 = ReferenceByKeyValue(Key=gate_26.Target1, Val=graft(panel_31), lightweight=False, DisableAutoUpdate=True)
distance_between_louvers_2 = RemoteReceiver(distance_between_louvers)
number_of_louvers_5 = RemoteReceiver(number_of_louvers)
generate_wwr_2 = RemoteReceiver(generate_wwr)
pre_create_model_3 = RemoteReceiver(pre_create_model)
model_name_3 = RemoteReceiver(model_name)
data_26 = Data(programtype)
louver_depth_2 = RemoteReceiver(louver_depth)
louver_angle_2 = RemoteReceiver(louver_angle)
bool_42 = Boolean(number_of_louvers_5)
filter_44 = StreamFilter(Gate=bool_42, Stream0="0", Stream1=louver_depth_2)
filter_45 = StreamFilter(Gate=bool_42, Stream0="0", Stream1=distance_between_louvers_2)
filter_46 = StreamFilter(Gate=bool_42, Stream0="0", Stream1=louver_angle_2)
multiplication_3 = Multiplication(A=filter_44, B="0.01")
vertical_horizontal_louvers = Boolean()
subdivide_generated_windows = Boolean(Toggle(True))
window_height = Number()
sill_height = Number(Slider(0.3, range=0..1))
horizontal_separation = Number()
vertical_separation = Number()
louver_depth_3 = Number(multiplication_3)
number_of_louvers_6 = Number(number_of_louvers_5)
distance_between_louvers_3 = Number(filter_45)
louver_angle_3 = Number(filter_46)
py3_45 = Python3Script(
    depth=louver_depth_3,
    count=number_of_louvers_6,
    dist=distance_between_louvers_3,
    angle=louver_angle_3,
    direction=vertical_horizontal_louvers)  # -> out, louver_settings
# ---------- py3_45: Python ----------
"""Create louver Settings"""
from heath import LouverSettings

louver_settings = LouverSettings(depth, int(count), dist, angle, direction)
# ---------- end py3_45 ----------
toggle_4 = BooleanToggle(True)
deconstructmodel_2 = HBDeconstructModel(model=data_18)  # -> rooms, faces, apertures, doors, shades; plug-in component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
hasdata_8 = DataExists(Data=data_19)
vizbytype = HBVisualizeByType(hb_objs=loadobjects.hb_objs)  # -> walls, interior_walls, roofs, ceilings, exterior_floors, interior_floors, air_walls, apertures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; plug-in component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
panel_137 = Panel(hasdata_8)
honeybee_model_ready = RemoteSender(hasdata_8)
geoprop = HBGeometryProperties(rooms=flatten(deconstructmodel_2.rooms))  # -> ext_wall_area, ext_win_area, volume, floor_area, floor_ep_constr; plug-in component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
show_honeybee_windows_3 = RemoteReceiver(show_honeybee_windows)
show_honeybee_context_3 = RemoteReceiver(show_honeybee_context)
show_honeybee_ground_3 = RemoteReceiver(show_honeybee_ground)
show_honeybee_doors_3 = RemoteReceiver(show_honeybee_doors)
show_honeybee_floors_3 = RemoteReceiver(show_honeybee_floors)
show_honeybee_walls_3 = RemoteReceiver(show_honeybee_walls)
show_honeybee_roof_3 = RemoteReceiver(show_honeybee_roof)
lng_20 = ListLength(List=filter_29)
honeybee_model_exists = RemoteSender(lng_20)
panel_138 = Panel(geoprop.floor_area)
gate_27 = StreamGate(Stream=[vizbytype.indoor_shades, vizbytype.outdoor_shades], Gate=show_honeybee_context_3)  # -> Target0, Target1
gate_28 = StreamGate(Stream=[vizbytype.apertures, vizbytype.interior_apertures], Gate=show_honeybee_windows_3)  # -> Target0, Target1
gate_29 = StreamGate(Stream=[vizbytype.doors, vizbytype.interior_doors], Gate=show_honeybee_doors_3)  # -> Target0, Target1
gate_30 = StreamGate(Stream=vizbytype.roofs, Gate=show_honeybee_roof_3)  # -> Target0, Target1
gate_31 = StreamGate(Stream=vizbytype.interior_floors, Gate=show_honeybee_floors_3)  # -> Target0, Target1
gate_32 = StreamGate(Stream=vizbytype.exterior_floors, Gate=show_honeybee_ground_3)  # -> Target0, Target1
gate_33 = StreamGate(Stream=[vizbytype.walls, vizbytype.interior_walls, vizbytype.air_walls], Gate=show_honeybee_walls_3)  # -> Target0, Target1
data_27 = Data(gate_29.Target1)
data_28 = Data(gate_30.Target1)
data_29 = Data(gate_28.Target1)
data_30 = Data(gate_27.Target1)
data_31 = Data(gate_33.Target1)
data_32 = Data(gate_31.Target1)
data_33 = Data(gate_32.Target1)

honeybee_model_exists_2 = RemoteReceiver(honeybee_model_exists)
honeybee_model_exists_3 = RemoteReceiver(honeybee_model_exists)
honeybee_model_exists_4 = RemoteReceiver(honeybee_model_exists)
hideshow_23 = HideShowElement(ElementToHideShow=pulldown, Show=honeybee_model_exists_3, Collapse=True, Disable=False)
honeybee_model_exists_5 = RemoteReceiver(honeybee_model_exists)
hideshow_24 = HideShowElement(ElementToHideShow=pulldown_3, Show=honeybee_model_exists_4, Collapse=True, Disable=False)
bang_10 = ExplodeTree(Data=refkv_5)  # -> Branch0, Branch1, Branch2, Branch3

# ----
# Bake model
panel_139 = Panel("""Heath::honeybee model::walls
Heath::honeybee model::roof
Heath::honeybee model::floors
Heath::honeybee model::ground
Heath::honeybee model::windows
Heath::honeybee model::doors
Heath::honeybee model::context""")
entwine_119 = Entwine(
    Branch00=data_31,
    Branch01=data_28,
    Branch02=data_32,
    Branch03=data_33,
    Branch04=data_29,
    Branch05=data_27,
    Branch06=data_30,
    FlattenInputs=True)
ef_layer_3 = EleFrontLayer(FullPath=panel_139)  # -> Layer, FullPath, Hidden, Locked, DisplayColour, MaterialName, Linetype, PrintColour, PrintWidth
clean_2 = CleanTree(RemoveNulls=True, RemoveInvalid=True, RemoveEmpty=False, Tree=entwine_119)
bbox_2 = BoundingBox(Content=clean_2, Plane=PlaneXY(0, 0, 0))  # -> Box, Box_2
null_39 = NullItem(Item=bbox_2.Box)  # -> flatten(NullFlags), InvalidFlags, Description
honeybee_model_bounding_box = RemoteSender(bbox_2.Box)
ef_att_5 = EleFrontAttributes(Layer=ef_layer_3.Layer)  # -> graft(Attributes), Keys, Values, Name, Layer, ColourSource, DisplayColour, MaterialSource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
cull_11 = CullPattern(List=null_39.NullFlags, CullPattern=invert(null_39.NullFlags))
lng_21 = ListLength(List=clean_2)
lng_22 = ListLength(List=cull_11)
bake_model_2 = RemoteReceiver(bake_model)
repeat_14 = RepeatData(Data=ef_att_5.Attributes, Length=lng_21)
honeybee_model_displayed = RemoteSender(lng_22)
bake_3 = BakeObjects(Geometry=clean_2, Attributes=repeat_14, Bake=bake_model_2, createGroups=False, preset="Moderate")  # -> Message, Ghosts

honeybee_model_displayed_2 = RemoteReceiver(honeybee_model_displayed)
honeybee_model_displayed_3 = RemoteReceiver(honeybee_model_displayed)
hideshow_25 = HideShowElement(ElementToHideShow=button_12, Show=honeybee_model_exists_2, Collapse=True, Disable=invert(honeybee_model_displayed_2))

# ----
# Zoom honeybee model
honeybee_model_bounding_box_2 = RemoteReceiver(honeybee_model_bounding_box)
zoom_honeybee_model_2 = RemoteReceiver(zoom_honeybee_model)
zbb_2 = ZoomBoundingBox(Box=flatten(honeybee_model_bounding_box_2), Run=zoom_honeybee_model_2)

bool_43 = Boolean(geoprop.floor_area)

# ---- group: Assembly model (continued)
honeybee_model_exists_6 = RemoteReceiver(honeybee_model_exists)
hideshow_26 = HideShowElement(ElementToHideShow=[pulldown_5, button_12], Show=honeybee_model_exists_6, Collapse=invert(True), Disable=False)
honeybee_model_exists_7 = RemoteReceiver(honeybee_model_exists)
hideshow_27 = HideShowElement(ElementToHideShow=button_8, Show=True, Collapse=True, Disable=invert(honeybee_model_displayed_3))
honeybee_model_exists_8 = RemoteReceiver(honeybee_model_exists)
bool_44 = Boolean(honeybee_model_exists_7)
filter_47 = StreamFilter(Gate=bool_44, Stream0="Create model", Stream1="Update model")
hideshow_28 = HideShowElement(ElementToHideShow=border, Show=honeybee_model_exists_8, Collapse=invert(True), Disable=False)
setbtn = SetButton(ButtonToModify=button_11, ButtonName=filter_47)
hideshow_29 = HideShowElement(ElementToHideShow=[button_10, textbox_7, button_9], Show=honeybee_model_exists_5, Collapse=True, Disable=False)

# ---- group: Analysis module (continued)
honeybee_model_ready_2 = RemoteReceiver(honeybee_model_ready)
honeybee_model_ready_3 = RemoteReceiver(honeybee_model_ready)
honeybee_model_ready_4 = RemoteReceiver(honeybee_model_ready)
honeybee_model_ready_5 = RemoteReceiver(honeybee_model_ready)
honeybee_model_ready_6 = RemoteReceiver(honeybee_model_ready)
honeybee_model_ready_7 = RemoteReceiver(honeybee_model_ready)
filter_48 = StreamFilter(Gate=honeybee_model_ready_2, Stream0=Slider(500, range=0..1000), Stream1=Slider(1000000, range=0..1000000))
filter_49 = StreamFilter(Gate=honeybee_model_ready_2, Stream0="Create a model before running the simulation", Stream1=" ")
honeybee_model_ready_8 = RemoteReceiver(honeybee_model_ready)
honeybee_model_ready_9 = RemoteReceiver(honeybee_model_ready)
filter_50 = StreamFilter(Gate=honeybee_model_ready_3, Stream0=Slider(500, range=0..1000), Stream1=Slider(1000000, range=0..1000000))
filter_51 = StreamFilter(Gate=honeybee_model_ready_3, Stream0="Create a model before running the simulation", Stream1=" ")
filter_52 = StreamFilter(Gate=honeybee_model_ready_4, Stream0=Slider(500, range=0..1000), Stream1=Slider(1000000, range=0..1000000))
filter_53 = StreamFilter(Gate=honeybee_model_ready_4, Stream0="Create a model before running the simulation", Stream1=" ")
filter_54 = StreamFilter(Gate=honeybee_model_ready_5, Stream0=Slider(500, range=0..1000), Stream1=Slider(1000000, range=0..1000000))
filter_55 = StreamFilter(Gate=honeybee_model_ready_5, Stream0="Create a model before running the simulation", Stream1=" ")
hideshow_30 = HideShowElement(ElementToHideShow=button_24, Show=True, Collapse=True, Disable=invert(honeybee_model_ready_6))
tooltip_8 = AttachTooltipToElement(ElementsToAttachTo=button_24, TooltipContent=filter_49, ShowDelay=filter_48, Duration=2000)
hideshow_31 = HideShowElement(ElementToHideShow=button_26, Show=True, Collapse=True, Disable=invert(honeybee_model_ready_7))
tooltip_9 = AttachTooltipToElement(ElementsToAttachTo=button_26, TooltipContent=filter_51, ShowDelay=filter_50, Duration=2000)
hideshow_32 = HideShowElement(ElementToHideShow=button_28, Show=True, Collapse=True, Disable=invert(honeybee_model_ready_8))
tooltip_10 = AttachTooltipToElement(ElementsToAttachTo=button_28, TooltipContent=filter_53, ShowDelay=filter_52, Duration=2000)
hideshow_33 = HideShowElement(ElementToHideShow=button_29, Show=True, Collapse=True, Disable=invert(honeybee_model_ready_9))
tooltip_11 = AttachTooltipToElement(ElementsToAttachTo=button_29, TooltipContent=filter_55, ShowDelay=filter_54, Duration=2000)

# ----
room = Geometry(bang_10.Branch0)
adjacent = Geometry(bang_10.Branch1)
context = Geometry(bang_10.Branch2)
windows_2 = Geometry(bang_10.Branch3)

id_3 = Guid(windows_2)
py3_46 = Python3Script(x=id_3)  # -> a; inputs x: list; same code as py3_41
windows_3 = Geometry(py3_46)

# ----
# Create material tooltip
panel_140 = Panel(":")

# ----
# Create construction tooltip
panel_141 = Panel(":")

# ----
# Backend data inside layers
panel_142 = Panel("0, 0, 0")
path = DataPath(panel_142)
path_2 = DataPath("0, 0, 0")

# ----
# Create window tooltip
number_slider_44 = Slider(0, range=0..100)
dom_3 = ConstructDomain(DomainStart=number_slider_44, DomainEnd=Slider(12, range=0..100))
dom_4 = ConstructDomain(DomainStart=Slider(0, range=0..100), DomainEnd=Slider(1, range=0..100))

# ----
# Remove material
pre_material_database_remove_material_2 = RemoteReceiver(pre_material_database_remove_material)
cull_12 = CullPattern(List=pre_material_database_remove_material_2, CullPattern=pre_material_database_remove_material_2)
lng_23 = ListLength(List=cull_12)
filter_56 = StreamFilter(Gate=lng_23, Stream0="False", Stream1=cull_12)
freeze_gate_55 = StreamFreezeGate(Data=pre_material_database_remove_material_2, PassingSwitch=filter_56, Freeze=True, Hold=False)
material_database_remove_material_2 = RemoteReceiver(material_database_remove_material)
getdocumentusertext_10 = Python3Script(run=material_database_remove_material_2, key="Heath materials")  # -> json_string; same code as getdocumentusertext
split_8 = TextSplit(Text=getdocumentusertext_10, Separators="|")
strtoobj_5 = HBStringToObject(hb_str=split_8)  # -> flatten(hb_obj); plug-in component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
decnstrmat_2 = HBDeconstructMaterial(mat=strtoobj_5)  # -> values, attr_names, r_val_si, r_val_ip; plug-in component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
item_25 = ListItem(List=decnstrmat_2.values, Index=0, Wrap=True)  # -> flatten(Item)
cset_7 = CreateSet(List=item_25)  # -> Set, Map
lng_24 = ListLength(List=cset_7.Set)
larger = LargerThan(FirstNumber=lng_24, SecondNumber="1")  # -> LargerThan, OrEqualTo
bool_45 = Boolean(larger.LargerThan)

# ----
# Backend visible layers
panel_143 = Panel("1")
neg = Negative(Value=panel_143)
starting_layers = Slider(1, range=0..6)

# ----
# Create material
material_database_categories_7 = RemoteReceiver(material_database_categories_2)
textbox_10 = CreateTextBox(Label="Name", DefaultText="New material", UpdateButton=invert(True), showLabel=True)
textbox_11 = CreateTextBox(DefaultText=Slider(0.036, range=0..2), UpdateButton=invert(True), showLabel=False)
label_44 = CreateLabel(LabelText="Conductivity [W/m-K]", LabelSize=12, Justification=0)
pulldown_27 = CreatePulldownMenu(
    Label="Material category",
    ListItems=material_database_categories_7,
    SelectedIndex=Slider(3, range=0..10),
    showLabel=True)
textbox_12 = CreateTextBox(DefaultText=Slider(28, range=0..1000), UpdateButton=invert(True), showLabel=False)
true_button_18 = CreateTrueOnlyButton(ButtonName="?", ButtonStyle=2)
button_43 = CreateButton(ButtonName="Create material", ButtonStyle=0)
textbox_13 = CreateTextBox(DefaultText=Slider(1500, range=0..10000), UpdateButton=invert(True), showLabel=False)
label_45 = CreateLabel(LabelText="A1-A3 [kg CO2eq/kg]", LabelSize=12, Justification=0)
label_46 = CreateLabel(LabelText="Specific heat [J/kg-K]", LabelSize=12, Justification=0)
label_47 = CreateLabel(LabelText="Density [kg/m3]", LabelSize=12, Justification=0)
values_134 = ValueListener(Elements=textbox_10, SomeProperty=True)  # -> Values, Indices
values_135 = ValueListener(Elements=true_button_18, SomeProperty=True)  # -> Values, Indices
values_136 = ValueListener(Elements=textbox_11, SomeProperty=True)  # -> Values, Indices
values_137 = ValueListener(Elements=button_43, SomeProperty=True)  # -> Values, Indices
values_138 = ValueListener(Elements=pulldown_27, SomeProperty=True)  # -> Values, Indices
values_139 = ValueListener(Elements=textbox_12, SomeProperty=True)  # -> Values, Indices
values_140 = ValueListener(Elements=textbox_13, SomeProperty=True)  # -> Values, Indices
create_material_name = RemoteSender(values_134.Values)
create_material_conductivity = RemoteSender(values_136.Values)
info_create_material = RemoteSender(values_135.Values)
freeze_gate_56 = StreamFreezeGate(Data=values_137.Values, PassingSwitch=invert(values_137.Values))
create_material_category = RemoteSender(values_138.Values)
create_material_sprecific_heat = RemoteSender(values_140.Values)
create_material_density = RemoteSender(values_139.Values)
entwine_120 = Entwine(Branch00=label_44, Branch01=textbox_11, FlattenInputs=True)  # -> flatten(Result)
entwine_121 = Entwine(Branch00=label_46, Branch01=textbox_13, FlattenInputs=True)  # -> flatten(Result)
entwine_122 = Entwine(Branch00=label_47, Branch01=textbox_12, FlattenInputs=True)  # -> flatten(Result)
bool_46 = Boolean(invert(freeze_gate_56))
stack_79 = CreateStack(UIElements=entwine_120, Horizontal=True)
entwine_123 = Entwine(Branch00=label_45, Branch01=textbox_3, FlattenInputs=True)  # -> flatten(Result)
tap_19 = TapBuffer(Reset=False, Incremental=True, Valve=bool_46, Hold=True)
create_material_modal_2 = RemoteReceiver(create_material_modal)
dam_22 = DataDam(DataA=tap_19, BufferDelay=2500000, BufferMode=2)
adjustelem_22 = AdjustElementAppearance(
    ElementsToAdjust=true_button_18,
    Foreground=ColourSwatch(SwatchColor=RGB(0, 0, 0)),
    Background=ColourSwatch(SwatchColor=RGB(230, 230, 230)),
    FontSize=Slider(12, range=0..300))
equals_36 = Equality(FirstNumber=tap_19, SecondNumber=dam_22)  # -> Equality, Inequality
and_36 = GateAnd(A=equals_36.Inequality, B=create_material_modal_2)
number_slider_45 = Slider(29, range=0..300)
event_54 = EventGate(Data=and_36)  # -> Data, IsNew
entwine_124 = Entwine(Branch00=textbox_10, Branch01=true_button_18, FlattenInputs=True)  # -> flatten(Result)
stack_80 = CreateStack(UIElements=entwine_122, Horizontal=True)
stack_81 = CreateStack(UIElements=entwine_121, Horizontal=True)
create_material = RemoteSender(event_54.Data)
stack_82 = CreateStack(UIElements=entwine_124, Horizontal=True)
adjustpos_112 = AdjustElementPositioning(
    ElementsToAdjust=textbox_10,
    Margin="0, 5, 0, 10",
    AbsolutePositioning=False,
    Width=Slider(185, range=0..300),
    HorizontalAlignment=0)
adjustpos_113 = AdjustElementPositioning(
    ElementsToAdjust=true_button_18,
    Margin="5, -5, 0, 0",
    AbsolutePositioning=False,
    Width=number_slider_45,
    Height=number_slider_45)
adjustpos_114 = AdjustElementPositioning(ElementsToAdjust=pulldown_27, AbsolutePositioning=False, Width=Slider(229, range=0..300), HorizontalAlignment=0)
adjustpos_115 = AdjustElementPositioning(
    ElementsToAdjust=[label_45, label_46, label_47, label_44, label_3, label_4],
    AbsolutePositioning=False,
    Width=Slider(150, range=0..300),
    HorizontalAlignment=0,
    VerticalAlignment=2)
adjustpos_116 = AdjustElementPositioning(
    ElementsToAdjust=[textbox_13, textbox_12, textbox_11, textbox_3, textbox, textbox_2],
    AbsolutePositioning=False,
    Width=Slider(50, range=0..300),
    HorizontalAlignment=0,
    VerticalAlignment=2)
adjustpos_117 = AdjustElementPositioning(ElementsToAdjust=button_43, Margin="0, 10, 0, 0", AbsolutePositioning=False, HorizontalAlignment=1, VerticalAlignment=2)

info_create_material_2 = RemoteReceiver(info_create_material)
rec_23 = DataRecorder(info_create_material_2, DataLimit=-2, RecordData=True)
ma_13 = MassAddition(Input=rec_23)  # -> Result, PartialResults
entwine_125 = Entwine(Branch00=ma_13.Result, Branch01=material_info, FlattenInputs=True)
rec_24 = DataRecorder(entwine_125, DataLimit=2, RecordData=True)
item_26 = ListItem(List=rec_24, Index=0, Wrap=True)  # -> Item2, Item1, Item
equals_37 = Equality(FirstNumber=item_26.Item2, SecondNumber=item_26.Item1)  # -> Equality, Inequality
bang_11 = ExplodeTree(Data=equals_37.Inequality)  # -> Branch0, Branch1
py3_47 = Python3Script(x=bang_11.Branch0, y=bang_11.Branch1)  # -> a; same code as py3_6
event_55 = EventGate(Data=py3_47)  # -> Data, IsNew
freeze_gate_57 = StreamFreezeGate(Data=py3_47, PassingSwitch=event_55.IsNew)
event_56 = EventGate(Data=freeze_gate_57)  # -> Data, IsNew
panel_144 = Panel(event_56.Data)
launchwin_10 = LaunchWindow(
    Show=event_56.Data,
    Name="Common materials",
    Width=multiplication,
    Height=number_slider_42,
    ChildStatus=1,
    EnableHorizScroll=False)
info_create_material_3 = RemoteReceiver(info_create_material)
winstat_10 = WindowStatus(Window=launchwin_10)
winprops_10 = SetWindowProperties(
    Window=launchwin_10,
    StartingLocation=create_modal_location_2,
    Theme=0,
    AccentColor=heath_accent_color_3,
    ShowTitleBar=True,
    BackgroundColor=RGB(255, 255, 255),
    ScaleFactor=1)
material_info_status = RemoteSender(winstat_10)
py3_48 = Python3Script(window=launchwin_10, activate=info_create_material_3)  # same code as py3_7
addelems_11 = AddElements(Window=launchwin_10, Elements=flatten(image_4), DoVLChecking=True)  # -> AddedElements, ElementNames

material_info_status_2 = RemoteReceiver(material_info_status)
expression_66 = Expression(x="Hidden", y=material_info_status_2, Expression="x=y")
expire_9 = ExpireObject(ObjectToExpire=objbynn_7, Expire=expression_66)

# ----
# Add material
create_material_sprecific_heat_2 = RemoteReceiver(create_material_sprecific_heat)
create_material_conductivity_2 = RemoteReceiver(create_material_conductivity)
create_material_category_2 = RemoteReceiver(create_material_category)
create_material_density_2 = RemoteReceiver(create_material_density)
create_material_name_2 = RemoteReceiver(create_material_name)
opaquemat_3 = HBOpaqueMaterial(
    name=create_material_name_2,
    thickness="inf",
    conductivity=create_material_conductivity_2,
    density=create_material_density_2,
    spec_heat=create_material_sprecific_heat_2,
    category=create_material_category_2)  # -> out, mat; plug-in component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
create_material_a1_a3_kg_2 = RemoteReceiver(create_material_a1_a3_kg)
create_material_a5_1_kg_2 = RemoteReceiver(create_material_a5_1_kg)
create_material_a4_kg_2 = RemoteReceiver(create_material_a4_kg)
create_material_error = RemoteSender(opaquemat_3.out)
add_life_cycle_info = BrimstoneAddLifeCycleInfoToHoneybeeMaterial(
    hb_material=opaquemat_3.mat,
    gwp_a1_a3=create_material_a1_a3_kg_2,
    gwp_a4=create_material_a4_kg_2,
    gwp_a5_1=create_material_a5_1_kg_2)  # -> mod_material
# ---------- add_life_cycle_info: Python ----------
"""
Adds GWP info to a Honeybee Material

    Args:
        hb_material: Honeybee EnergyMaterial to be updated
        gwp_a1_a3: GWP (A1-A3) [kg CO2eq/kg]
        gwp_a4: GWP (A4) [kg CO2eq/kg]
        gwp_a5_1: GWP (A5.1) [kg CO2eq/kg]

    Returns:
        mod_material: Updated Honeybee EnergyMaterial
"""

import scriptcontext
import brimstone
ghenv.Component.Message = brimstone.globals.version
import Grasshopper

ghenv.Component.Name = 'Brimstone - Add Life Cycle Info to Honeybee Material'
ghenv.Component.NickName = 'Add Life Cycle Info'

try:  # import the core honeybee dependencies
    from honeybee_energy.material.opaque import EnergyMaterial
except ImportError as e:
    raise ImportError('\nFailed to import honeybee:\n\t{}'.format(e))

def main(hb_material):
    if not isinstance(hb_material, EnergyMaterial):
        raise Exception("Input material must be a valid Honeybee material")
    mod_material = hb_material.duplicate()
    mod_material.properties.gwp_a1_a3 = gwp_a1_a3
    mod_material.properties.gwp_a4 = gwp_a4
    mod_material.properties.gwp_a5_1 = gwp_a5_1
    
    return mod_material

if __name__ == "__main__":
    try:
        flying = scriptcontext.sticky["brimstone_flying"]
    except:
        raise Exception("The 'Brimstone - Fly' component needs to exist on the canvas")
    mod_material = main(hb_material)
# ---------- end add_life_cycle_info ----------
create_material_2 = RemoteReceiver(create_material)
gate_34 = StreamGate(Stream=add_life_cycle_info, Gate=create_material_2)  # -> Target0, Target1
getdocumentusertext_11 = Python3Script(run=create_material_2, key="Heath materials")  # -> json_string; same code as getdocumentusertext
objtostr_2 = HBObjectToString(hb_obj=gate_34.Target1)  # -> hb_str; plug-in component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
entwine_126 = Entwine(Branch00=getdocumentusertext_11, Branch01=objtostr_2, FlattenInputs=True)  # -> flatten(Result)
join_7 = TextJoin(Text=entwine_126, Join="|")
freeze_gate_58 = StreamFreezeGate(Data=join_7, PassingSwitch=create_material_2, Freeze=False, Hold=False)

# ----
# A1-A3
stack_83 = CreateStack(UIElements=entwine_123, Horizontal=True)
data_34 = Data(stack_83)  # "A1-A3"

specific_heat = Data(stack_81)
density = Data(stack_80)

create_material_error_2 = RemoteReceiver(create_material_error)
panel_145 = Panel(create_material_error_2)
split_9 = TextSplit(Text=create_material_error_2, Separators=panel_140)
trim = TextTrim(Text=split_9, Start=True, End=True)
create_material_name_3 = RemoteReceiver(create_material_name)
item_27 = ListItem(List=trim, Index=0, Wrap=True)  # -> Item, Item1
create_material_name_4 = RemoteReceiver(create_material_name)
lng_25 = ListLength(List=split_9)
len_3 = TextLength(Text=item_27.Item1)
larger_2 = LargerThan(FirstNumber=lng_25, SecondNumber="1")  # -> LargerThan, OrEqualTo
subtraction_10 = Subtraction(A=len_3, B=Slider(11, range=0..20))
py3_49 = Python3Script(name=create_material_name_4)  # -> not_valid; inputs name: String
# ---------- py3_49: Python ----------
if 'å' in name:
    not_valid = True
elif 'ä' in name:
    not_valid = True
elif 'ö' in name:
    not_valid = True
else:
    not_valid = False
# ---------- end py3_49 ----------
fragment_4 = TextFragment(Text=item_27.Item1, Start="0", Count=subtraction_10)
gate_35 = StreamGate(Stream="'å', 'ä' and 'ö' are not allowed", Gate=py3_49)  # -> Target0, Target1
filter_57 = StreamFilter(Gate=larger_2.LargerThan, Stream0=create_material_error_2, Stream1=fragment_4)

# ----
# Create construction
panel_146 = Panel("""Layer 1
Layer 2
Layer 3
Layer 4
Layer 5
Layer 6""")
textbox_14 = CreateTextBox(Label="Name", DefaultText="New construction", UpdateButton=invert(True), showLabel=True)
lng_26 = ListLength(List=panel_146)
values_141 = ValueListener(Elements=textbox_14, SomeProperty=True)  # -> Values, Indices
empty_11 = EmptyObjectToEmptyBranch()
label_48 = CreateLabel(LabelText="[Innermost layer]", LabelSize=12, Justification=0)
button_44 = CreateButton(ButtonName="+", ButtonStyle=3)
button_45 = CreateButton(ButtonName="Create construction", ButtonStyle=0)
label_49 = CreateLabel(LabelText="[Outermost layer]", LabelSize=12, Justification=0)
label_50 = CreateLabel(LabelText=panel_146, LabelSize=18, Justification=0)
empty_12 = EmptyObjectToEmptyBranch()
construction_maximum_layer_limit = RemoteSender(lng_26)
construction_maximum_layer_limit_2 = RemoteReceiver(construction_maximum_layer_limit)
subtraction_11 = Subtraction(A=construction_maximum_layer_limit_2, B="1")
repeat_15 = RepeatData(Data="Material", Length=construction_maximum_layer_limit_2)
repeat_16 = RepeatData(Data="X", Length=construction_maximum_layer_limit_2)
repeat_17 = RepeatData(Data="⇕", Length=subtraction_11)
repeat_18 = RepeatData(Data="Thickness [m]", Length=construction_maximum_layer_limit_2)
create_construction_name = RemoteSender(values_141.Values)
panel_147 = Panel(values_141.Values)
button_46 = CreateButton(ButtonName=repeat_16, ButtonStyle=3)
values_142 = ValueListener(Elements=button_44, SomeProperty=True)  # -> Values, Indices
values_143 = ValueListener(Elements=button_45, SomeProperty=True)  # -> Values, Indices
button_47 = CreateButton(ButtonName=repeat_17, ButtonStyle=3)
pulldown_28 = CreatePulldownMenu(Label=repeat_15, ListItems=empty_12, showLabel=True)
textbox_15 = CreateTextBox(Label=repeat_18, DefaultText=Slider(0.25, range=0.01..1), UpdateButton=invert(True), showLabel=True)
add_layer = RemoteSender(values_142.Values)
values_144 = ValueListener(Elements=button_46, SomeProperty=True)  # -> flatten(Values), Indices
cull_13 = CullPattern(List=values_144.Values, CullPattern=values_144.Values)
lng_27 = ListLength(List=cull_13)
filter_58 = StreamFilter(Gate=lng_27, Stream0="False", Stream1=cull_13)
create_construction = RemoteSender(values_143.Values)
values_145 = ValueListener(Elements=button_47, SomeProperty=True)  # -> flatten(Values), Indices
cull_14 = CullPattern(List=values_145.Values, CullPattern=values_145.Values)
lng_28 = ListLength(List=cull_14)
filter_59 = StreamFilter(Gate=lng_28, Stream0="False", Stream1=cull_14)
values_146 = ValueListener(Elements=pulldown_28, SomeProperty=True)  # -> Values, Indices
values_147 = ValueListener(Elements=textbox_15, SomeProperty=True)  # -> Values, Indices
freeze_gate_59 = StreamFreezeGate(Data=filter_59, PassingSwitch=invert(filter_59))
merge_11 = Merge(Data1=simplify(graft(label_50)), Data2=simplify(graft(button_46)))
merge_12 = Merge(Data1=simplify(graft(pulldown_28)), Data2=simplify(graft(textbox_15)))
freeze_gate_60 = StreamFreezeGate(Data=filter_58, PassingSwitch=invert(filter_58))
create_construction_materials = RemoteSender(values_146.Indices)
create_construction_thickness = RemoteSender(values_147.Values)
pre_switch_layer = RemoteSender(values_145.Values)
pre_remove_layer = RemoteSender(values_144.Values)
bool_47 = Boolean(invert(freeze_gate_59))
bool_48 = Boolean(invert(freeze_gate_60))
stack_84 = CreateStack(UIElements=merge_12, Horizontal=True)
stack_85 = CreateStack(UIElements=merge_11, Horizontal=True)
tap_20 = TapBuffer(Reset=False, Incremental=True, Valve=bool_47, Hold=True)
tap_21 = TapBuffer(Reset=False, Incremental=True, Valve=bool_48, Hold=True)
dam_23 = DataDam(DataA=tap_20, BufferDelay=2500000, BufferMode=2)
dam_24 = DataDam(DataA=tap_21, BufferDelay=2500000, BufferMode=2)
equals_38 = Equality(FirstNumber=tap_20, SecondNumber=dam_23)  # -> Equality, Inequality
equals_39 = Equality(FirstNumber=tap_21, SecondNumber=dam_24)  # -> Equality, Inequality
event_57 = EventGate(Data=equals_38.Inequality)  # -> Data, IsNew
event_58 = EventGate(Data=equals_39.Inequality)  # -> Data, IsNew
merge_13 = Merge(Data1=simplify(stack_85), Data2=simplify(stack_84), Data3=simplify(graft(button_47)))
entwine_127 = Entwine(Branch00=textbox_14, FlattenInputs=True)  # -> flatten(Result)
switch_layer = RemoteSender(event_57.Data)
adjustpos_118 = AdjustElementPositioning(
    ElementsToAdjust=textbox_14,
    Margin="0, 0, 0, 5",
    AbsolutePositioning=False,
    Width=Slider(190, range=0..300),
    HorizontalAlignment=0)
remove_layer = RemoteSender(event_58.Data)
adjustpos_119 = AdjustElementPositioning(
    ElementsToAdjust=pulldown_28,
    AbsolutePositioning=False,
    Width=Slider(190, range=0..300),
    HorizontalAlignment=0,
    VerticalAlignment=2)
adjustpos_120 = AdjustElementPositioning(
    ElementsToAdjust=textbox_15,
    Margin="0, 5, 0, 0",
    AbsolutePositioning=False,
    Width=Slider(120, range=0..300),
    HorizontalAlignment=0,
    VerticalAlignment=2)
adjustpos_121 = AdjustElementPositioning(
    ElementsToAdjust=button_44,
    Margin="10, 5, 0, 0",
    AbsolutePositioning=False,
    Width=Slider(32, range=0..300),
    Height=Slider(32, range=0..300),
    HorizontalAlignment=0)
adjustpos_122 = AdjustElementPositioning(
    ElementsToAdjust=button_47,
    Margin="5, 0, 0, 0",
    AbsolutePositioning=False,
    Width=Slider(26, range=0..300),
    Height=Slider(26, range=0..300),
    HorizontalAlignment=0,
    VerticalAlignment=2)
adjustelem_23 = AdjustElementAppearance(ElementsToAdjust=button_47, Foreground=ColourSwatch(SwatchColor=RGBA(38, 38, 38, 193)), FontSize=Slider(19, range=0..50))
adjustpos_123 = AdjustElementPositioning(
    ElementsToAdjust=button_46,
    AbsolutePositioning=False,
    Width=Slider(26, range=0..300),
    Height=Slider(26, range=0..300),
    HorizontalAlignment=0)
adjustelem_24 = AdjustElementAppearance(ElementsToAdjust=button_44, Foreground=ColourSwatch(SwatchColor=RGB(15, 178, 0)), FontSize=Slider(21, range=0..50))
adjustelem_25 = AdjustElementAppearance(ElementsToAdjust=button_46, Foreground=ColourSwatch(SwatchColor=RGB(255, 0, 0)), FontSize=Slider(12, range=0..50))
adjustpos_124 = AdjustElementPositioning(ElementsToAdjust=button_45, Margin="0, 10, 0, 0", AbsolutePositioning=False, HorizontalAlignment=1, VerticalAlignment=2)

pre_remove_layer_2 = RemoteReceiver(pre_remove_layer)
pre_switch_layer_2 = RemoteReceiver(pre_switch_layer)
create_construction_materials_2 = RemoteReceiver(flatten(create_construction_materials))
create_construction_thickness_2 = RemoteReceiver(flatten(create_construction_thickness))
cull_15 = CullPattern(List=pre_remove_layer_2, CullPattern=pre_remove_layer_2)
cull_16 = CullPattern(List=pre_switch_layer_2, CullPattern=pre_switch_layer_2)
add_layer_2 = RemoteReceiver(add_layer)
mindex_5 = MemberIndex(Set=pre_remove_layer_2, Member=cull_15)  # -> Index, Count
mindex_6 = MemberIndex(Set=pre_switch_layer_2, Member=cull_16)  # -> Index, Count
py3_50 = Python3Script(
    add_layer=add_layer_2,
    remove_layer=mindex_5.Index,
    switch_layer=mindex_6.Index,
    materials=create_construction_materials_2,
    thickness=create_construction_thickness_2)  # -> out_materials, out_thickness; inputs materials: list, thickness: list
# ---------- py3_50: Python ----------
def add_layers():
    thickness.append(0.25)
    out_thickness = thickness
    
def remove_layers():
    materials.pop(remove_layer)
    thickness.pop(remove_layer)

def switch_layers():
    temp_materials = materials[switch_layer]
    materials[switch_layer] = materials[switch_layer+1]
    materials[switch_layer+1] = temp_materials

    temp_thickness = thickness[switch_layer]
    thickness[switch_layer] = thickness[switch_layer+1]
    thickness[switch_layer+1] = temp_thickness
    

if add_layer:
    add_layers()

elif remove_layer is not None:
    remove_layers()
    out_materials = materials
    out_thickness = thickness

elif switch_layer is not None:
    switch_layers()
    out_materials = materials
    out_thickness = thickness
else:
    out_materials = None
    out_thickness = None
# ---------- end py3_50 ----------
branch = TreeBranch(Tree=py3_50.out_thickness, Path=path, MaintainPaths=True)
branch_2 = TreeBranch(Tree=py3_50.out_materials, Path=path_2, MaintainPaths=True)
lng_29 = ListLength(List=branch_2)
lng_30 = ListLength(List=branch)
bool_49 = Boolean(lng_30)
bool_50 = Boolean(lng_29)
gate_36 = StreamGate(Stream=branch, Gate=bool_49)  # -> Target0, Target1
gate_37 = StreamGate(Stream=branch_2, Gate=bool_50)  # -> Target0, Target1
hold_3 = HoldingGate(Data=gate_36.Target1)
hold_4 = HoldingGate(Data=gate_37.Target1)
hasdata_9 = DataExists(Data=hold_3)
hasdata_10 = DataExists(Data=hold_4)
timeshift = TimeShifter(Data=hold_3, Capacity="1")
timeshift_2 = TimeShifter(Data=hold_4, Capacity="1")
bool_51 = Boolean(hasdata_9)
bool_52 = Boolean(hasdata_10)
remove_layer_2 = RemoteReceiver(remove_layer)
switch_layer_2 = RemoteReceiver(switch_layer)
filter_60 = StreamFilter(Gate=bool_51, Stream0=timeshift, Stream1=hold_3)
filter_61 = StreamFilter(Gate=bool_52, Stream0=timeshift_2, Stream1=hold_4)
entwine_128 = Entwine(Branch00=filter_61, Branch01=filter_60, FlattenInputs=True)
or_28 = GateOr(A=switch_layer_2, B=remove_layer_2)
gate_38 = StreamGate(Stream=entwine_128, Gate=or_28)  # -> Target0, Target1
bang_12 = ExplodeTree(Data=gate_38.Target1)  # -> Branch0, Branch1

remove_layer_3 = RemoteReceiver(flatten(remove_layer))
add_layer_3 = RemoteReceiver(add_layer)
construction_maximum_layer_limit_3 = RemoteReceiver(construction_maximum_layer_limit)
gate_39 = StreamGate(Stream=panel_143, Gate=add_layer_3)  # -> Target0, Target1
gate_40 = StreamGate(Stream=neg, Gate=remove_layer_3)  # -> Target0, Target1
rec_25 = DataRecorder([gate_39.Target1, gate_40.Target1], DataLimit=-10, RecordData=True)
py3_51 = Python3Script(numbers=[starting_layers, rec_25], maximum_layers=construction_maximum_layer_limit_3)  # -> visible_layers_arrows, visible_layers; inputs numbers: list of Int32, maximum_layers: Int32
# ---------- py3_51: Python ----------
current_sum = 0

for number in numbers:
    if (number == 1) and (current_sum >= maximum_layers):
        continue
    if (number == -1) and (current_sum <= 1):
        continue
    else:
        current_sum += number

visible_layers = [True]*current_sum
visible_layers.extend([False]*(maximum_layers-current_sum))
visible_layers_arrows = visible_layers[1:]
# ---------- end py3_51 ----------
visible_layers_arrows = RemoteSender(py3_51.visible_layers_arrows)
visible_layers = RemoteSender(simplify(graft(py3_51.visible_layers)))

create_construction_name_2 = RemoteReceiver(create_construction_name)
create_construction_name_3 = RemoteReceiver(create_construction_name)
py3_52 = Python3Script(name=create_construction_name_3)  # -> not_valid; inputs name: String; same code as py3_49
gate_41 = StreamGate(Stream="'å', 'ä' and 'ö' are not allowed", Gate=py3_52)  # -> Target0, Target1

# ----
# Add construction
create_construction_materials_3 = RemoteReceiver(create_construction_materials)
create_construction_thickness_3 = RemoteReceiver(create_construction_thickness)
visible_layers_2 = RemoteReceiver(visible_layers)
create_construction_name_4 = RemoteReceiver(create_construction_name)
repeat_19 = RepeatData(Data=create_construction_thickness_3, Length=visible_layers_2)  # -> flatten(Data)
create_construction_2 = RemoteReceiver(create_construction)
getdocumentusertext_12 = Python3Script(run=create_construction_2, key="Heath constructions")  # -> json_string; same code as getdocumentusertext

# ----
# Create window
number_slider_46 = Slider(0.5, range=0..12)
button_48 = CreateButton(ButtonName="Create window", ButtonStyle=0)
textbox_16 = CreateTextBox(Label="Name", DefaultText="New window", UpdateButton=invert(True), showLabel=True)
textbox_17 = CreateTextBox(DefaultText=number_slider_46, UpdateButton=invert(True), showLabel=False)
label_51 = CreateLabel(LabelText="U-factor [W/m2-K]", LabelSize=12, Justification=0)
textbox_18 = CreateTextBox(DefaultText=Slider(0.3, range=0..1), UpdateButton=invert(True), showLabel=False)
label_52 = CreateLabel(LabelText="SHGC [-]", LabelSize=12, Justification=0)
values_148 = ValueListener(Elements=textbox_16, SomeProperty=True)  # -> Values, Indices
values_149 = ValueListener(Elements=textbox_17, SomeProperty=True)  # -> Values, Indices
values_150 = ValueListener(Elements=button_48, SomeProperty=True)  # -> Values, Indices
values_151 = ValueListener(Elements=textbox_18, SomeProperty=True)  # -> Values, Indices
pre_create_window = RemoteSender(values_150.Values)
create_window_u_factor = RemoteSender(values_149.Values)
freeze_gate_61 = StreamFreezeGate(Data=values_150.Values, PassingSwitch=invert(values_150.Values))
create_window_shgc = RemoteSender(values_151.Values)
create_window_name = RemoteSender(values_148.Values)
panel_148 = Panel(values_148.Values)
entwine_129 = Entwine(Branch00=label_51, Branch01=textbox_17, FlattenInputs=True)  # -> flatten(Result)
entwine_130 = Entwine(Branch00=label_52, Branch01=textbox_18, FlattenInputs=True)  # -> flatten(Result)
bool_53 = Boolean(invert(freeze_gate_61))
stack_86 = CreateStack(UIElements=entwine_129, Horizontal=True)
tap_22 = TapBuffer(Reset=False, Incremental=True, Valve=bool_53, Hold=True)
stack_87 = CreateStack(UIElements=entwine_130, Horizontal=True)
create_window_modal_2 = RemoteReceiver(create_window_modal)
dam_25 = DataDam(DataA=tap_22, BufferDelay=2500000, BufferMode=2)
equals_40 = Equality(FirstNumber=tap_22, SecondNumber=dam_25)  # -> Equality, Inequality
and_37 = GateAnd(A=equals_40.Inequality, B=create_window_modal_2)
event_59 = EventGate(Data=and_37)  # -> Data, IsNew
create_window = RemoteSender(event_59.Data)
adjustpos_125 = AdjustElementPositioning(
    ElementsToAdjust=[label_6, label_52, label_51, label_7, label_5],
    AbsolutePositioning=False,
    Width=Slider(150, range=0..300),
    HorizontalAlignment=0,
    VerticalAlignment=2)
adjustpos_126 = AdjustElementPositioning(
    ElementsToAdjust=[textbox_18, textbox_17, textbox_6, textbox_4, textbox_5],
    AbsolutePositioning=False,
    Width=Slider(50, range=0..300),
    HorizontalAlignment=0,
    VerticalAlignment=2)
adjustpos_127 = AdjustElementPositioning(ElementsToAdjust=button_48, Margin="0, 10, 0, 0", AbsolutePositioning=False, HorizontalAlignment=1, VerticalAlignment=2)

# ----
# Add window
create_window_u_factor_2 = RemoteReceiver(create_window_u_factor)
create_window_name_2 = RemoteReceiver(create_window_name)
create_window_shgc_2 = RemoteReceiver(create_window_shgc)
windowmat = HBWindowMaterial(name=create_window_name_2, u_factor=create_window_u_factor_2, shgc=create_window_shgc_2)  # -> out, mat; plug-in component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
create_window_conversion_value_2 = RemoteReceiver(create_window_conversion_value)
create_window_a1_a3_kg_2 = RemoteReceiver(create_window_a1_a3_kg)
create_window_a4_kg_2 = RemoteReceiver(create_window_a4_kg)
windowconstr = HBWindowConstruction(name=create_window_name_2, materials=windowmat.mat)  # -> constr; plug-in component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
create_window_error = RemoteSender(windowmat.out)
add_life_cycle_info_construction = BrimstoneAddLifeCycleInfoToHoneybeeConstruction(
    hb_construction=windowconstr,
    gwp_a1_a3=create_window_a1_a3_kg_2,
    gwp_a4=create_window_a4_kg_2,
    density=create_window_conversion_value_2)  # -> mod_construction
# ---------- add_life_cycle_info_construction: Python ----------
"""
Adds GWP info to a Honeybee Construction

    Args:
        hb_construction: Honeybee Construction to be updated
        gwp_a1_a3: GWP (A1-A3) [kg CO2eq/kg]
        gwp_a4: GWP (A4) [kg CO2eq/kg]
        density: GWP (A5.1) [kg/m2]

    Returns:
        mod_construction: Updated Honeybee Construction
"""

import scriptcontext
import brimstone
ghenv.Component.Message = brimstone.globals.version
import Grasshopper

ghenv.Component.Name = 'Brimstone - Add Life Cycle Info to Honeybee Construction'
ghenv.Component.NickName = 'Add Life Cycle Info (Construction)'

try:  # import the core honeybee dependencies
    from honeybee_energy.construction.window import WindowConstruction
    from honeybee_energy.construction.opaque import OpaqueConstruction
except ImportError as e:
    raise ImportError('\nFailed to import honeybee:\n\t{}'.format(e))

def main(hb_construction, gwp_a1_a3, gwp_a4, density):
    if not isinstance(hb_construction, WindowConstruction)\
        and not isinstance(hb_construction, OpaqueConstruction):
        raise Exception("Currently only Window and Opaque constructions are supported")
    mod_construction = hb_construction.duplicate()
    user_data = mod_construction.user_data if mod_construction.user_data else {}
    
    user_data["gwp_a1_a3"] = gwp_a1_a3
    user_data["gwp_a4"] = gwp_a4
    user_data["conv_value"] = density
    
    mod_construction.user_data = user_data

    return mod_construction

if __name__ == "__main__":
    try:
        flying = scriptcontext.sticky["brimstone_flying"]
    except:
        raise Exception("The 'Brimstone - Fly' component needs to exist on the canvas")
    mod_construction = main(hb_construction, gwp_a1_a3, gwp_a4, density)
# ---------- end add_life_cycle_info_construction ----------
create_window_2 = RemoteReceiver(create_window)
gate_42 = StreamGate(Stream=add_life_cycle_info_construction, Gate=create_window_2)  # -> Target0, Target1
getdocumentusertext_13 = Python3Script(run=create_window_2, key="Heath windows")  # -> json_string; same code as getdocumentusertext
objtostr_3 = HBObjectToString(hb_obj=gate_42.Target1)  # -> hb_str; plug-in component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
entwine_131 = Entwine(Branch00=getdocumentusertext_13, Branch01=objtostr_3, FlattenInputs=True)  # -> flatten(Result)
freeze_gate_62 = StreamFreezeGate(Data=entwine_131, PassingSwitch=create_window_2, Freeze=False, Hold=False)
join_8 = TextJoin(Text=freeze_gate_62, Join="|")

entwine_132 = Entwine(Branch00=textbox_16, Branch01=true_button_6, FlattenInputs=True)  # -> flatten(Result)
stack_88 = CreateStack(UIElements=entwine_132, Horizontal=True)
adjustpos_128 = AdjustElementPositioning(
    ElementsToAdjust=textbox_16,
    Margin="0, 5, 0, 10",
    AbsolutePositioning=False,
    Width=Slider(185, range=0..300),
    HorizontalAlignment=0)

# ----
# Windows database
sync_window_database_2 = RemoteReceiver(sync_window_database)
setdocumentusertext_2 = Python3Script(
    key="Heath windows",
    load_value=freeze_gate_54,
    remove_value=freeze_gate_32,
    add_value=join_8,
    sync=sync_window_database_2)  # -> done
# ---------- setdocumentusertext_2: Python ----------
import Rhino
import rhinoscriptsyntax as rs
import scriptcontext as sc

def modify_value(value):
    sc.doc = Rhino.RhinoDoc.ActiveDoc

    return rs.SetDocumentUserText(key, value)

    sc.doc = ghdoc

if load_value:
    done = modify_value(load_value)

if add_value:
    done = modify_value(add_value)

if remove_value:
    done = modify_value(remove_value)

if remove_value == False:
    done = modify_value(None)

elif sync:
    done = True
# ---------- end setdocumentusertext_2 ----------
getdocumentusertext_14 = Python3Script(run=setdocumentusertext_2, key="Heath windows")  # -> json_string
# ---------- getdocumentusertext_14: Python ----------
import Rhino
import rhinoscriptsyntax as rs
import scriptcontext as sc

if run:
    sc.doc = Rhino.RhinoDoc.ActiveDoc

    json_string = rs.GetDocumentUserText(key)
    if json_string == None:
        json_string = False

    sc.doc = ghdoc
# ---------- end getdocumentusertext_14 ----------
split_10 = TextSplit(Text=getdocumentusertext_14, Separators="|")
hold_5 = HoldingGate(Data=split_10)
strtoobj_6 = HBStringToObject(hb_str=hold_5)  # -> flatten(hb_obj); plug-in component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
ipy2_2 = IronPython2Script(windows=strtoobj_6)  # -> unique_windows; inputs windows: list
# ---------- ipy2_2: IronPython ----------
"""Grasshopper Script"""

unique_windows = []

for i in range(len(windows)):
    if windows[i] not in unique_windows:
        unique_windows.append(windows[i])
# ---------- end ipy2_2 ----------
clean_3 = CleanTree(RemoveNulls=True, RemoveInvalid=True, RemoveEmpty=False, Tree=ipy2_2)
lng_31 = ListLength(List=ipy2_2)
lng_32 = ListLength(List=strtoobj_6)
smaller = SmallerThan(FirstNumber=lng_31, SecondNumber=lng_32)  # -> SmallerThan, OrEqualTo
created_windows_database = RemoteSender(clean_3)
hasdata_11 = DataExists(Data=smaller.SmallerThan)
filter_62 = StreamFilter(Gate=hasdata_11, Stream0="False", Stream1=smaller.SmallerThan)
overlap_windows = RemoteSender(filter_62)

created_windows_database_2 = RemoteReceiver(created_windows_database)
decnstrconstr_2 = HBDeconstructConstruction(constr=created_windows_database_2)  # -> materials, layers, r_val_si, r_val_ip, u_fac_si, u_fac_ip, shgc, t_sol, t_vis; plug-in component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
decnstrmat_3 = HBDeconstructMaterial(mat=decnstrconstr_2.materials)  # -> values, attr_names, r_val_si, r_val_ip; plug-in component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
item_28 = ListItem(List=decnstrmat_3.values, Index=0, Wrap=True)  # -> flatten(Item), Item1, Item2
entwine_133 = Entwine(Branch00=generic_shgc, Branch01=item_28.Item2, FlattenInputs=True)  # -> flatten(Result)
entwine_134 = Entwine(Branch00=generic_u_value, Branch01=item_28.Item1, FlattenInputs=True)  # -> flatten(Result)
clean_4 = CleanTree(RemoveNulls=True, RemoveInvalid=True, RemoveEmpty=False, Tree=item_28.Item)
clean_5 = CleanTree(RemoveNulls=True, RemoveInvalid=True, RemoveEmpty=False, Tree=entwine_134)
clean_6 = CleanTree(RemoveNulls=True, RemoveInvalid=True, RemoveEmpty=False, Tree=entwine_133)
num_7 = Number(clean_6)
num_8 = Number(clean_5)
entwine_135 = Entwine(Branch00="Generic", Branch01=clean_4, FlattenInputs=True)  # -> flatten(Result)
expression_67 = Expression(x=num_7, Expression="Round(x, 2)")
expression_68 = Expression(x=num_8, Expression="Round(x, 2)")
create_window_names = RemoteSender(entwine_135)
format_23 = Format(Format="{0} (U-factor: {1}, SHGC: {2})", Culture=127, Data0=entwine_135, Data1=expression_68, Data2=expression_67)
panel_149 = Panel(format_23)
create_window_full_names = RemoteSender(format_23)

create_window_full_names_2 = RemoteReceiver(create_window_full_names)

created_windows_database_3 = RemoteReceiver(created_windows_database)
entwine_136 = Entwine(Branch00="Generic", Branch01=created_windows_database_3, FlattenInputs=True)  # -> flatten(Result)
item_29 = ListItem(List=entwine_136, Index=subset_subface_window_3, Wrap=True)
expression_69 = Expression(x="Generic", y=item_29, Expression="x=y")
filter_63 = StreamFilter(Gate=expression_69, Stream0=item_29, Stream1=null_9)
subfacesubset_2 = HBSubfaceSubset(window=filter_63, skylight=filter_16)  # -> subface_set; plug-in component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

create_window_full_names_3 = RemoteReceiver(create_window_full_names)
cull_i_3 = CullIndex(List=create_window_full_names_3, Indices="0", Wrap=invert(True))
concat_2 = Concatenate(FragmentA="- ", FragmentB=cull_i_3)
overlap_windows_2 = RemoteReceiver(overlap_windows)
lng_33 = ListLength(List=cull_i_3)
settextblock_8 = SetTextBlockContents(TextBlockToModify=tb_19, NewTextBlockContents=concat_2)
py3_53 = Python3Script(current_windows=lng_33, maximum_windows=number_slider_41)  # -> status; inputs current_windows: Int32, maximum_windows: Int32
# ---------- py3_53: Python ----------
status = [True]*current_windows
status.extend([False]*(maximum_windows-current_windows))
# ---------- end py3_53 ----------
hideshow_34 = HideShowElement(ElementToHideShow=label_40, Show=overlap_windows_2, Collapse=True, Disable=False)
hideshow_35 = HideShowElement(ElementToHideShow=simplify(merge_9), Show=simplify(graft(py3_53)), Collapse=True, Disable=False)

create_window_names_2 = RemoteReceiver(create_window_names)
create_window_name_3 = RemoteReceiver(create_window_name)
create_window_error_2 = RemoteReceiver(create_window_error)
create_window_u_factor_3 = RemoteReceiver(create_window_u_factor)
create_window_shgc_3 = RemoteReceiver(create_window_shgc)
create_window_name_4 = RemoteReceiver(create_window_name)
expression_70 = Expression(x=create_window_names_2, y=create_window_name_3, Expression="x=y")
len_4 = TextLength(Text=create_window_error_2)
py3_54 = Python3Script(name=create_window_name_4)  # -> not_valid; inputs name: String; same code as py3_49
inc = Includes(Value=create_window_shgc_3, Domain=dom_4)  # -> Includes, Deviation
inc_2 = Includes(Value=create_window_u_factor_3, Domain=dom_3)  # -> Includes, Deviation
cull_17 = CullPattern(List=expression_70, CullPattern=expression_70)
bool_54 = Boolean(len_4)
gate_43 = StreamGate(Stream="U-factor has to to between 0 and 12", Gate=inc_2.Includes)  # -> Target0, Target1
gate_44 = StreamGate(Stream="Window name contains no valid characters", Gate=bool_54)  # -> Target0, Target1
gate_45 = StreamGate(Stream="Window already exists", Gate=cull_17)  # -> Target0, Target1
gate_46 = StreamGate(Stream="'å', 'ä' and 'ö' are not allowed", Gate=py3_54)  # -> Target0, Target1
gate_47 = StreamGate(Stream="SHGC has to to between 0 and 1", Gate=inc.Includes)  # -> Target0, Target1
entwine_137 = Entwine(
    Branch00=gate_43.Target0,
    Branch01=gate_47.Target0,
    Branch02=gate_44.Target1,
    Branch03=gate_45.Target1,
    Branch04=gate_46.Target1,
    FlattenInputs=True)  # -> flatten(Result)
panel_150 = Panel(entwine_137)
item_30 = ListItem(List=entwine_137, Index=0, Wrap=True)
create_window_error_message = RemoteSender(item_30)

create_window_error_message_2 = RemoteReceiver(create_window_error_message)
null_40 = NullItem(Item=create_window_error_message_2)  # -> NullFlags, InvalidFlags, Description
filter_64 = StreamFilter(Gate=null_40.NullFlags, Stream0=create_window_error_message_2, Stream1=" ")
filter_65 = StreamFilter(Gate=null_40.NullFlags, Stream0=Slider(500, range=0..1000), Stream1=Slider(1000000, range=0..1000000))
hideshow_36 = HideShowElement(ElementToHideShow=button_48, Show=True, Collapse=True, Disable=invert(null_40.NullFlags))
tooltip_12 = AttachTooltipToElement(ElementsToAttachTo=button_48, TooltipContent=filter_64, ShowDelay=filter_65, Duration=2000)

panel_151 = Panel(hold_5)
panel_152 = Panel(split_10)
panel_153 = Panel(clean_3)

# ---- group: Construction module (continued)
setlist_6 = SetListContents(ListToModify=pulldown_15, NewListContents=create_window_full_names_2, SelectedIndex="0")
setlist_7 = SetListContents(ListToModify=pulldown_14, NewListContents=create_window_full_names_2, SelectedIndex="0")

# ----
# Construction inspection
pre_construction_database_visualize_cons_2 = RemoteReceiver(pre_construction_database_visualize_cons)  # "pre_construction_database_visualize_construction"
path_3 = DataPath(pre_construction_database_visualize_cons_2)
construction_maximum_layer_limit_4 = RemoteReceiver(construction_maximum_layer_limit)
construction_maximum_layer_limit_5 = RemoteReceiver(construction_maximum_layer_limit)
construction_maximum_layer_limit_6 = RemoteReceiver(construction_maximum_layer_limit)
panel_154 = Panel("Construction thickness: {0}")
repeat_20 = RepeatData(Data="0 m", Length=construction_maximum_layer_limit_4)
repeat_21 = RepeatData(Data="Material", Length=construction_maximum_layer_limit_5)
repeat_22 = RepeatData(Data=" ", Length=construction_maximum_layer_limit_6)
tb_21 = CreateTextBlock(Text=repeat_20, TextSize=12, Justification=1)
label_53 = CreateLabel(LabelText="Construction inspection", LabelSize=18, Justification=1)
label_54 = CreateLabel(LabelText="🌳", LabelSize=18, Justification=1)
label_55 = CreateLabel(LabelText="🏠", LabelSize=18, Justification=1)
label_56 = CreateLabel(LabelText=panel_154, LabelSize=18, Justification=1)
tb_22 = CreateTextBlock(Text=repeat_21, TextSize=16, Justification=Slider(1, range=0..10))
tb_23 = CreateTextBlock(Text=repeat_22, TextSize=16, Justification=Slider(1, range=0..10))
construction_maximum_layer_limit_7 = RemoteReceiver(construction_maximum_layer_limit)
settextblock_9 = SetTextBlockContents(TextBlockToModify=tb_23, NewTextBlockContents=" ")
suirify_8 = Suirify(tb_21)
suirify_9 = Suirify(tb_22)
merge_14 = Merge(Data1=graft(suirify_9), Data2=graft(suirify_8))
stack_89 = CreateStack(UIElements=merge_14, Horizontal=True)  # -> flatten(Stack)
material_database_categories_8 = RemoteReceiver(material_database_categories_2)
suirify_10 = Suirify(tb_23)
suirify_11 = Suirify(stack_89)
merge_15 = Merge(Data1=graft(suirify_10), Data2=graft(suirify_11))
number_slider_47 = Slider(250, range=0..1000)
entwine_138 = Entwine(
    Branch00=ColourSwatch(SwatchColor=RGB(204, 102, 51)),
    Branch01=ColourSwatch(SwatchColor=RGB(153, 102, 51)),
    Branch02=ColourSwatch(SwatchColor=RGB(128, 128, 128)),
    Branch03=ColourSwatch(SwatchColor=RGB(255, 204, 102)),
    Branch04=ColourSwatch(SwatchColor=RGB(102, 102, 153)),
    Branch05=ColourSwatch(SwatchColor=RGB(255, 153, 51)),
    Branch06=ColourSwatch(SwatchColor=RGB(102, 51, 0)),
    Branch07=ColourSwatch(SwatchColor=RGB(77, 77, 77)),
    Branch08=ColourSwatch(SwatchColor=RGB(0, 102, 204)),
    Branch09=ColourSwatch(SwatchColor=RGB(153, 153, 153)),
    FlattenInputs=True)  # -> flatten(Result)
stack_90 = CreateStack(UIElements=merge_15, Horizontal=invert(True))  # -> flatten(Stack)
entwine_139 = Entwine(Branch00=label_53, Branch01=label_56, Branch02=label_54, Branch03=stack_90, Branch04=label_55, FlattenInputs=True)  # -> flatten(Result)
swatch_2 = ColourSwatch(SwatchColor=RGB(0, 0, 0))
adjustpos_129 = AdjustElementPositioning(ElementsToAdjust=tb_21, Margin="8, 0, 0, 0", AbsolutePositioning=False, HorizontalAlignment=0)
adjustpos_130 = AdjustElementPositioning(ElementsToAdjust=stack_90, Margin="53, 0, 0, 0", AbsolutePositioning=False, HorizontalAlignment=0)

# ----
# Construction inspection launch
construction_database_visualize_construc_2 = RemoteReceiver(construction_database_visualize_construc)  # "construction_database_visualize_construction"
construction_database_visualize_construc_3 = RemoteReceiver(construction_database_visualize_construc)  # "construction_database_visualize_construction"
create_modal_location_3 = RemoteReceiver(create_modal_location)

bool_55 = Boolean(construction_database_visualize_construc_2)

settextbox_2 = SetTextBoxContents(TextBoxToModify=textbox_15, NewTextBoxContents=bang_12.Branch1)
visible_layers_3 = RemoteReceiver(flatten(visible_layers))
visible_layers_arrows_2 = RemoteReceiver(visible_layers_arrows)
int_7 = Integer(visible_layers_3)
ma_14 = MassAddition(Input=int_7)  # -> Result, PartialResults
hideshow_37 = HideShowElement(ElementToHideShow=button_47, Show=visible_layers_arrows_2, Collapse=True, Disable=False)
larger_3 = LargerThan(FirstNumber=ma_14.Result, SecondNumber="1")  # -> LargerThan, OrEqualTo
visible_layers_4 = RemoteReceiver(visible_layers)
filter_66 = StreamFilter(Gate=larger_3.LargerThan, Stream0=larger_3.LargerThan, Stream1=visible_layers_3)
hideshow_38 = HideShowElement(ElementToHideShow=stack_84, Show=visible_layers_4, Collapse=True, Disable=False)
hideshow_39 = HideShowElement(ElementToHideShow=label_50, Show=visible_layers_3, Collapse=True, Disable=False)
hideshow_40 = HideShowElement(ElementToHideShow=button_46, Show=filter_66, Collapse=True, Disable=False)

# ----
# Recursion
panel_155 = Panel("Construction visualization")
objbynn_12 = GetObjectByNickname(NickName=panel_155)
construction_visualization = Python3Script()  # -> status; same code as lca_window_status

rec_26 = DataRecorder(bool_55, DataLimit=-2, RecordData=True)
ma_15 = MassAddition(Input=rec_26)  # -> Result, PartialResults
entwine_140 = Entwine(Branch00=ma_15.Result, Branch01=construction_visualization, FlattenInputs=True)
rec_27 = DataRecorder(entwine_140, DataLimit=2, RecordData=True)
item_31 = ListItem(List=rec_27, Index=0, Wrap=True)  # -> Item2, Item1, Item
equals_41 = Equality(FirstNumber=item_31.Item2, SecondNumber=item_31.Item1)  # -> Equality, Inequality
bang_13 = ExplodeTree(Data=equals_41.Inequality)  # -> Branch0, Branch1
py3_55 = Python3Script(x=bang_13.Branch0, y=bang_13.Branch1)  # -> a; same code as py3_6
event_60 = EventGate(Data=py3_55)  # -> Data, IsNew
freeze_gate_63 = StreamFreezeGate(Data=py3_55, PassingSwitch=event_60.IsNew)
event_61 = EventGate(Data=freeze_gate_63)  # -> Data, IsNew
panel_156 = Panel(event_61.Data)
launchwin_11 = LaunchWindow(
    Show=event_61.Data,
    Name="Construction inspection",
    Width=Slider(380, range=0..1000),
    Height=Slider(580, range=0..1000),
    ChildStatus=1,
    EnableHorizScroll=False)
winprops_11 = SetWindowProperties(
    Window=launchwin_11,
    StartingLocation=create_modal_location_3,
    Theme=0,
    AccentColor=heath_accent_color_8,
    ShowTitleBar=True,
    BackgroundColor=RGB(255, 255, 255),
    ScaleFactor=1)
winstat_11 = WindowStatus(Window=launchwin_11)
addelems_12 = AddElements(Window=launchwin_11, Elements=flatten(entwine_139), DoVLChecking=True)  # -> AddedElements, ElementNames
py3_56 = Python3Script(window=launchwin_11, activate=construction_database_visualize_construc_3)  # same code as py3_7
panel_157 = Panel(winstat_11)
construction_visualization_status = RemoteSender(winstat_11)

construction_visualization_status_2 = RemoteReceiver(construction_visualization_status)
expression_71 = Expression(x="Hidden", y=construction_visualization_status_2, Expression="x=y")
expire_10 = ExpireObject(ObjectToExpire=objbynn_12, Expire=expression_71)

# ----
# Recursion
panel_158 = Panel("Construction modal")
create_construction_3 = RemoteReceiver(create_construction)
objbynn_13 = GetObjectByNickname(NickName=panel_158)
construction_modal = Python3Script()  # -> status; same code as lca_window_status

# ----
# Create construction launch
create_construction_modal_2 = RemoteReceiver(create_construction_modal)
rec_28 = DataRecorder(create_construction_modal_2, DataLimit=-2, RecordData=True)
ma_16 = MassAddition(Input=rec_28)  # -> Result, PartialResults
entwine_141 = Entwine(Branch00=ma_16.Result, Branch01=construction_modal, FlattenInputs=True)
rec_29 = DataRecorder(entwine_141, DataLimit=2, RecordData=True)
item_32 = ListItem(List=rec_29, Index=0, Wrap=True)  # -> Item2, Item1, Item
equals_42 = Equality(FirstNumber=item_32.Item2, SecondNumber=item_32.Item1)  # -> Equality, Inequality
bang_14 = ExplodeTree(Data=equals_42.Inequality)  # -> Branch0, Branch1
py3_57 = Python3Script(x=bang_14.Branch0, y=bang_14.Branch1)  # -> a; same code as py3_6
event_62 = EventGate(Data=py3_57)  # -> Data, IsNew
freeze_gate_64 = StreamFreezeGate(Data=py3_57, PassingSwitch=event_62.IsNew)
event_63 = EventGate(Data=freeze_gate_64)  # -> Data, IsNew
entwine_142 = Entwine(
    Branch00=entwine_127,
    Branch01=label_49,
    Branch02=merge_13,
    Branch03=label_48,
    Branch04=button_44,
    Branch05=button_45,
    FlattenInputs=True)  # -> flatten(Result)
launchwin_12 = LaunchWindow(
    Show=event_63.Data,
    Name="Create construction",
    Width=Slider(360, range=0..1000),
    Height=Slider(540, range=0..1000),
    ChildStatus=1,
    EnableHorizScroll=False)
panel_159 = Panel(event_63.Data)
create_construction_modal_3 = RemoteReceiver(create_construction_modal)
create_modal_location_4 = RemoteReceiver(create_modal_location)
addelems_13 = AddElements(Window=launchwin_12, Elements=flatten(entwine_142), DoVLChecking=True)  # -> AddedElements, ElementNames
winprops_12 = SetWindowProperties(
    Window=launchwin_12,
    StartingLocation=create_modal_location_4,
    Theme=0,
    AccentColor=heath_accent_color_10,
    ShowTitleBar=True,
    BackgroundColor=RGB(255, 255, 255),
    ScaleFactor=1)
winstat_12 = WindowStatus(Window=launchwin_12)
py3_58 = Python3Script(window=launchwin_12, activate=create_construction_modal_3)  # same code as py3_7
create_construction_modal_status = RemoteSender(winstat_12)
construction_elements = RemoteSender(addelems_13.AddedElements)

create_construction_modal_status_2 = RemoteReceiver(create_construction_modal_status)
expression_72 = Expression(x="Hidden", y=create_construction_modal_status_2, Expression="x=y")
or_29 = GateOr(A=expression_72, C=create_construction_3)
expire_11 = ExpireObject(ObjectToExpire=objbynn_13, Expire=or_29)

# ----
# Recursion
panel_160 = Panel("Window modal")
create_window_3 = RemoteReceiver(create_window)
objbynn_14 = GetObjectByNickname(NickName=panel_160)
window_modal = Python3Script()  # -> status; same code as lca_window_status

# ----
# Create window launch
create_window_modal_3 = RemoteReceiver(create_window_modal)
rec_30 = DataRecorder(create_window_modal_3, DataLimit=-2, RecordData=True)
ma_17 = MassAddition(Input=rec_30)  # -> Result, PartialResults
entwine_143 = Entwine(Branch00=ma_17.Result, Branch01=window_modal, FlattenInputs=True)
rec_31 = DataRecorder(entwine_143, DataLimit=2, RecordData=True)
item_33 = ListItem(List=rec_31, Index=0, Wrap=True)  # -> Item2, Item1, Item
equals_43 = Equality(FirstNumber=item_33.Item2, SecondNumber=item_33.Item1)  # -> Equality, Inequality
bang_15 = ExplodeTree(Data=equals_43.Inequality)  # -> Branch0, Branch1
py3_59 = Python3Script(x=bang_15.Branch0, y=bang_15.Branch1)  # -> a; same code as py3_6
event_64 = EventGate(Data=py3_59)  # -> Data, IsNew
freeze_gate_65 = StreamFreezeGate(Data=py3_59, PassingSwitch=event_64.IsNew)
event_65 = EventGate(Data=freeze_gate_65)  # -> Data, IsNew
panel_161 = Panel(event_65.Data)
entwine_144 = Entwine(
    Branch00=stack_88,
    Branch01=stack_86,
    Branch02=stack_87,
    Branch03=stack_2,
    Branch04=data_2,
    Branch05=a4,
    Branch06=button_48,
    FlattenInputs=True)  # -> flatten(Result)
launchwin_13 = LaunchWindow(
    Show=event_65.Data,
    Name="Create window",
    Width=Slider(235, range=0..1000),
    Height=Slider(305, range=0..1000),
    ChildStatus=1,
    EnableHorizScroll=False)
create_modal_location_5 = RemoteReceiver(create_modal_location)
create_window_modal_4 = RemoteReceiver(create_window_modal)
winstat_13 = WindowStatus(Window=launchwin_13)
addelems_14 = AddElements(Window=launchwin_13, Elements=flatten(entwine_144), DoVLChecking=True)  # -> AddedElements, ElementNames
py3_60 = Python3Script(window=launchwin_13, activate=create_window_modal_4)  # same code as py3_7
winprops_13 = SetWindowProperties(
    Window=launchwin_13,
    StartingLocation=create_modal_location_5,
    Theme=0,
    AccentColor=heath_accent_color_9,
    ShowTitleBar=True,
    BackgroundColor=RGB(255, 255, 255),
    ScaleFactor=1)
create_window_modal_status = RemoteSender(winstat_13)
window_elements = RemoteSender(addelems_14.AddedElements)

create_window_modal_status_2 = RemoteReceiver(create_window_modal_status)
expression_73 = Expression(x="Hidden", y=create_window_modal_status_2, Expression="x=y")
or_30 = GateOr(A=expression_73, C=create_window_3)
expire_12 = ExpireObject(ObjectToExpire=objbynn_14, Expire=or_30)

# ----
# Recursion
panel_162 = Panel("Material modal")
create_material_3 = RemoteReceiver(create_material)
objbynn_15 = GetObjectByNickname(NickName=panel_162)
material_modal = Python3Script()  # -> status; same code as lca_window_status

# ----
# Create material launch
create_material_modal_3 = RemoteReceiver(create_material_modal)
rec_32 = DataRecorder(create_material_modal_3, DataLimit=-2, RecordData=True)
ma_18 = MassAddition(Input=rec_32)  # -> Result, PartialResults
entwine_145 = Entwine(Branch00=ma_18.Result, Branch01=material_modal, FlattenInputs=True)
rec_33 = DataRecorder(entwine_145, DataLimit=2, RecordData=True)
item_34 = ListItem(List=rec_33, Index=0, Wrap=True)  # -> Item2, Item1, Item
equals_44 = Equality(FirstNumber=item_34.Item2, SecondNumber=item_34.Item1)  # -> Equality, Inequality
bang_16 = ExplodeTree(Data=equals_44.Inequality)  # -> Branch0, Branch1
py3_61 = Python3Script(x=bang_16.Branch0, y=bang_16.Branch1)  # -> a; same code as py3_6
event_66 = EventGate(Data=py3_61)  # -> Data, IsNew
freeze_gate_66 = StreamFreezeGate(Data=py3_61, PassingSwitch=event_66.IsNew)
event_67 = EventGate(Data=freeze_gate_66)  # -> Data, IsNew
entwine_146 = Entwine(
    Branch00=stack_82,
    Branch01=pulldown_27,
    Branch02=stack_79,
    Branch03=density,
    Branch04=specific_heat,
    Branch05=data_34,
    Branch06=a4_2,
    Branch07=data_3,
    Branch08=button_43,
    FlattenInputs=True)  # -> flatten(Result)
launchwin_14 = LaunchWindow(
    Show=event_67.Data,
    Name="Create material",
    Width=Slider(250, range=0..1000),
    Height=Slider(375, range=0..1000),
    ChildStatus=1,
    EnableHorizScroll=False)
panel_163 = Panel(event_67.Data)
create_modal_location_6 = RemoteReceiver(create_modal_location)
create_material_modal_4 = RemoteReceiver(create_material_modal)
heath_accent_color_15 = RemoteReceiver(heath_accent_color)
addelems_15 = AddElements(Window=launchwin_14, Elements=flatten(entwine_146), DoVLChecking=True)  # -> AddedElements, ElementNames
py3_62 = Python3Script(window=launchwin_14, activate=create_material_modal_4)  # same code as py3_7
winprops_14 = SetWindowProperties(
    Window=launchwin_14,
    StartingLocation=create_modal_location_6,
    Theme=0,
    AccentColor=heath_accent_color_15,
    ShowTitleBar=True,
    BackgroundColor=RGB(255, 255, 255),
    ScaleFactor=1)
winstat_14 = WindowStatus(Window=launchwin_14)
create_material_modal_status = RemoteSender(winstat_14)
material_elements = RemoteSender(addelems_15.AddedElements)

create_material_modal_status_2 = RemoteReceiver(create_material_modal_status)
expression_74 = Expression(x="Hidden", y=create_material_modal_status_2, Expression="x=y")
or_31 = GateOr(A=expression_74, C=create_material_3)
expire_13 = ExpireObject(ObjectToExpire=objbynn_15, Expire=or_31)

# ----
# Constructions database
panel_164 = Panel("Heath constructions")

# ----
# Materials database
panel_165 = Panel("Heath materials")

# ----
# Detailed energy simulations
# https://energyplus-weather.s3.amazonaws.com/africa_wmo_region_1/LBY/LBY_Tripoli.620100_IWEC/LBY_Tripoli.620100_IWEC.zip
# # Detailed energy simulations
# This cluster simulates energy balance over a year and outputs the total energy use intensity (EUI), divided into end uses, and detailed graphs of the energy balance, peak cooling/heating, and cooling/heating load profiles
# 
# ## Instructions
# Enter all inputs and set `Run Energy Simulation` to true to run the energy simulation
# 
# ## Inputs
# - `EPW file URL` - the URL for a EPW file which describes the location
# - `Honeybee model` - the Honeybee model for analysis
# - `Run Energy Simulation` - set to True to run the energy simulation
# 
# ## Outputs
# - `Energy use intensity [kWh/m2a]` - A number representing the total energy use of the model
# - `Energy use intensity per end use [kWh/m2a]` - A list of values with the energy uses split into different end uses
# - `End uses` - A list of text strings representing the different end uses
# - `Annual hourly energy results` - various meshes representing different energy results over the hours of the year
# - `Monthly energy balance` - A monthly breakdown of the energy balance, with energy sources in the top and energy sinks in the bottom
# - `Peak cooling` - A number representing the peak cooling load in each zone
# - `Peak heating` - A number representing the peak heating load in each zone
# - `Cooling load profile` - A mesh representing the cooling load profile during the design day
# - `Heating load profile` - A mesh representing the heating load profile during the design day
# 
# ## Interpretation
# To be added...
run_detailed_energy_simulations_2 = RemoteReceiver(run_detailed_energy_simulations)  # disabled
data_35 = Data(location_7)  # disabled
data_36 = Data()  # disabled
toggle_5 = BooleanToggle(True)  # disabled
epw_file_url = Data(data_35)  # disabled
downloadepw_2 = LBDownloadWeather(weather_URL=epw_file_url)  # -> epw_file, stat_file, ddy_file; disabled; plug-in component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
number_slider_48 = Slider(50, range=0..100)  # disabled

freeze_gate_67 = StreamFreezeGate(Data=data_36, PassingSwitch=run_detailed_energy_simulations_2, Freeze=True)  # disabled

# ---- group: Analyse performance
# Simple energy simulations
# # Simple energy simulations
# Streamlined energy simulations which calculate energy balance across the year, and peak loads on the design day, for the input Honeybee rooms.
# 
# ## Instructions
# Enter all inputs and set `Run Energy Balance` or `Run Peak Loads`to True to investigate energy use for the specified Honeybee rooms considering the specified Honeybee shade objects. Adjust the y axis of output graphs using the `Graph max` input.
# 
# ## Inputs
# - `EPW file URL` - the URL for a EPW file which describes the location
# - `Honeybee rooms` - the Honeybee rooms which shall be analysed
# - `Shading objects` - Honeybee shade objects which block solar radiation toward the simulated rooms
# - `Run Energy Balance` - set to True to run the energy balance simulation
# - `Run Peak Loads` - set to True to run the peak loads simulation
# - `Graph max` - max value for the y axis of output graphs
# 
# ## Outputs
# - `Annual energy balance` - mesh visualising energy balance of each month of the year broken down into energy sources/sinks
# - `Daily cooling profile` - mesh visualising the cooling need during the design day (hottest day of the year)
# - `Daily heating profile` - mesh visualising the heating need during the design day (coldest day of the year)
# - `Cooling balance (design day)` - mesh visualising the cooling sources and sinks during the design day (hottest day of the year)
# - `Heating balance (design day)` - mesh visualising the heating sources and sinks during the design day (coldest day of the year)
# 
# ## Interpretation
# To be added...
pre_run_simple_energy_simulations_3 = RemoteReceiver(pre_run_simple_energy_simulations)
toggle_6 = BooleanToggle(True)
location_21 = RemoteReceiver(location)
honeybee_rooms = Data(deconstructmodel_2.rooms)
data_37 = Data(location_21)
data_38 = Data(deconstructmodel_2.shades)
downloadepw_3 = LBDownloadWeather(weather_URL=data_37)  # -> epw_file, stat_file, ddy_file; plug-in component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
freeze_gate_68 = StreamFreezeGate(Data=honeybee_rooms, PassingSwitch=pre_run_simple_energy_simulations_3, Freeze=True)
data_39 = Data(freeze_gate_68)
data_40 = Data()
data_41 = Data(downloadepw_3.epw_file)
honeybee_rooms_2 = Data(freeze_gate_68)
data_42 = Data(downloadepw_3.ddy_file)
shading_geometry = Data()
objbynn_16 = GetObjectByNickname(NickName="PeakLoads")
objbynn_17 = GetObjectByNickname(NickName="AnnualLoads")
current_model_name_2 = RemoteReceiver(current_model_name)
run_simple_energy_simulations_2 = RemoteReceiver(run_simple_energy_simulations)
simple_energy_simulation_height_2 = RemoteReceiver(simple_energy_simulation_height)
colrange_3 = LBColorRange(index=Slider(0, range=0..26))  # -> colors; plug-in component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
colrange_4 = LBColorRange(index=Slider(26, range=0..26))  # -> colors; plug-in component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
number_slider_49 = Slider(760000, range=0..1000000)
neg_2 = Negative(Value=Slider(100000, range=0..100000))
addition_3 = Addition(A=simple_energy_simulation_height_2, B=Slider(15, range=0..100))
Y = UnitY(Factor=addition_3)
simple_energy_simulation_base_point_2 = RemoteReceiver(simple_energy_simulation_base_point)
simple_energy_simulation_height_3 = RemoteReceiver(simple_energy_simulation_height)
simple_energy_simulation_width_2 = RemoteReceiver(simple_energy_simulation_width)
move = Move(Geometry=pt_4, Motion=Y)  # -> Geometry, Transform
simple_energy_simulation_base_point_comp = RemoteSender(move.Geometry)  # "simple_energy_simulation_base_point_compare"

# ----
panel_166 = Panel(pre_run_simple_energy_simulations_3)
freeze_gate_69 = StreamFreezeGate(Data=pre_run_simple_energy_simulations_3, PassingSwitch=pre_run_simple_energy_simulations_3, Freeze=True)

# ----
# Daylight Glare Probability (DGP)
# # Daylight Glare Probability
# This cluster calculates the DGP for a specific view.
# 
# ## Instructions
# Enter all inputs and set `Run Glare analysis`to True to investigate glare potential for the set viewport and time. For a simple model this simulation takes around 50-60s.
# 
# ## Inputs
# - `EPW file URL` - the URL for a EPW file which describes the location
# - `Honeybee model` - the Honeybee model for analysis
# - `Viewport name` - the string name of a viewport in the Rhino model which shall be analysed
# - `Month` - month of the analysis period (1-12)
# - `Day` - date of the analysis period (1-31)
# - `Hour` - hour of the analysis period (0-23)
# - `Run Glare analysis` - set to True to run the analysis
# 
# ## Outputs
# - `Daylight glare probability (DGP)` - a value for the probability of glare occuring in this view at this time [%]
# - `HDR image` - a HDR image which can be visualised using LB ImageViewer to show what areas cause glare
# - `HDR false color image` - a HDR image with modified colors to more clearly see causes of glare
# 
# ## Interpretation
# To be added...
panel_167 = Panel("Perspective")
calculate_glare_probability_2 = RemoteReceiver(calculate_glare_probability)
txt_4 = Text(panel_167)
run_glare_analysis = Boolean(calculate_glare_probability_2)
day = Number(Slider(21, range=1..31))
hour = Number(Slider(12, range=0..23))
month = Number(Slider(6, range=1..12))
num_9 = Number(calculate_glare_probability_2)
num_10 = Number(calculate_glare_probability_2)

freeze_gate_70 = StreamFreezeGate(Data=honeybee_model, PassingSwitch=calculate_glare_probability_2, Freeze=True)
gate_48 = StreamGate(Stream=objbynn, Gate=run_glare_analysis)  # -> Target0, Target1
hold_6 = HoldingGate(Data=gate_48.Target1)
msgs = GetRuntimeMessages(Objects=hold_6)  # -> Errors, Warnings
pitview_message_warning = RemoteSender(msgs.Warnings)
pitview_message_error = RemoteSender(msgs.Errors)

# ---- group: Analysis module (continued)
pitview_message_warning_2 = RemoteReceiver(pitview_message_warning)
pitview_message_error_2 = RemoteReceiver(pitview_message_error)
lng_34 = ListLength(List=pitview_message_error_2)
lng_35 = ListLength(List=pitview_message_warning_2)
ma_19 = MassAddition(Input=[lng_34, lng_35])  # -> Result, PartialResults
bool_56 = Boolean(ma_19.Result)
hasdata_12 = DataExists(Data=bool_56)
filter_67 = StreamFilter(Gate=hasdata_12, Stream0="False", Stream1=bool_56)
filter_68 = StreamFilter(Gate=lng_34, Stream0="Warning", Stream1="Error")
filter_69 = StreamFilter(Gate=lng_34, Stream0=ColourSwatch(SwatchColor=RGB(237, 185, 94)), Stream1=ColourSwatch(SwatchColor=RGB(226, 54, 54)))
adjustelem_26 = AdjustElementAppearance(ElementsToAdjust=tb_5, Foreground=filter_69)
settextblock_10 = SetTextBlockContents(TextBlockToModify=tb_5, NewTextBlockContents=filter_68)
hideshow_41 = HideShowElement(ElementToHideShow=tb_5, Show=filter_67, Collapse=True, Disable=False)

# ----
# Daylight (Illuminance, DA and UDI)
# # Daylight (Illuminance, DA and UDI)
# This cluster simulates illuminance for a specified hour of the year and daylight autonomy (DA) and useful daylight illuminance (UDI) for the entire year across an analysis surface.
# 
# ## Instructions
# Enter all inputs and set `Run Illuminance` or `Run Annual Daylight Simulation`to True to investigate daylight. The illuminance study covers a specified time step whereas the annual daylight simulation covers the full year. The `grid size` and `detail level` inputs can be used to improve the fidelity of the simulation at the cost of simulation time. The study can take several minutes, depending on the grid size and detail level.
# 
# ## Inputs
# - `EPW file URL` - the URL for a EPW file which describes the location
# - `Honeybee model` - the Honeybee model for analysis
# - `Grid size` - the resolution of the analysis grid in metres
# - `Detail level (0-2)` - level of detail for the daylight simulation, the higher value, the higher detail and the slower the simulation
# - `Month (illuminance)` - month of the analysis period  for the illuminance simulation (1-12)
# - `Day (illuminance)` - date of the analysis period for the illuminance simulation (1-31)
# - `Hour (illuminance)` - hour of the analysis period for the illuminance simulation (0-23)
# - `Run Illuminance` - set to True to run the illuminance analysis for the specified timestep
# - `Run Annual Daylight Simulation` - set to True to run the full year daylight simulation
# 
# ## Outputs
# - `Illuminance [Lux]` - a mesh visualising the amount of incident radiation which hits the analysis surface at the specified timestep
# - `Spatial Daylight Autonomy [-]` - the mean SDA for the entire analysis surface
# - `Daylight autonomy [%]` - a mesh visualising the value of DA across the analysis surface
# - `UDI [%]` - a mesh visualising the value of Useful Daylight Illuminance across the analysis surface
# - `UDI <50 [%]` - a mesh visualising the percentage of time that the lower treshold of illuminance is not achieved across the analysis surface
# - `UDI >3000 [%]` - a mesh visualising the percentage of time that the upper treshold of illuminance is exceeded across the analysis surface
# 
# ## Interpretation
# To be added...
run_daylight_simulations_2 = RemoteReceiver(run_daylight_simulations)
number_slider_50 = Slider(0, range=0..2)
toggle_7 = BooleanToggle(True)
data_43 = Data(location_9)
honeybee_model_3 = Data(honeybee_model_2)
panel_168 = Panel(run_daylight_simulations_2)
epw_file_url_2 = Data(data_43)
downloadepw_4 = LBDownloadWeather(weather_URL=epw_file_url_2)  # -> epw_file, stat_file, ddy_file; plug-in component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
detail_level_0_2 = Number(number_slider_50)
detail_level_0_2_2 = Number(number_slider_50)
run_annual_daylight_simulation = Boolean(run_daylight_simulations_2)
run_illuminance = Boolean(run_daylight_simulations_2)
cluster_3 = Cluster_6()
number_slider_51 = Slider(0, range=0..400)  # disabled
number_slider_52 = Slider(1.2, range=0..5)  # disabled
X = UnitX(Factor=number_slider_51)  # disabled

freeze_gate_71 = StreamFreezeGate(Data=honeybee_model_3, PassingSwitch=run_daylight_simulations_2, Freeze=True)

# ---- group: Set up sensor grids
# Alternatively create grid from surface
deconstructmodel_3 = HBDeconstructModel(model=freeze_gate_71)  # -> rooms, faces, apertures, doors, shades; disabled; plug-in component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
decnstrobj = HBDeconstructObject(hb_obj=deconstructmodel_3.rooms)  # -> faces, apertures, doors, shades; disabled; plug-in component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
number_slider_53 = Slider(0, range=0..5)  # disabled
vizquick_3 = HBVisualizeQuick(hb_objs=decnstrobj.faces)  # -> geo; disabled; plug-in component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
number_slider_54 = Slider(0.7, range=0..5)  # disabled
number_slider_55 = Slider(1, range=0..5)  # disabled
area = Area(Geometry=vizquick_3)  # -> Area, Centroid; disabled
pdecon_4 = Deconstruct(Point=area.Centroid)  # -> XComponent, YComponent, ZComponent; disabled
sort = SortList(Keys=pdecon_4.ZComponent, ValuesA=vizquick_3)  # -> Keys, ValuesA; disabled
srf = Surface(sort.ValuesA)  # disabled
item_35 = ListItem(List=srf, Index=number_slider_53, Wrap=True)  # disabled
flip = Flip(Surface=item_35)  # -> Surface, Result; disabled
genpts = LBGeneratePointGrid(geometry=flip.Surface, grid_size=number_slider_55, offset_dist=number_slider_54)  # -> points, vectors, face_areas, mesh; disabled; plug-in component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
sensorgrid = HBSensorGrid(positions=genpts.points, directions=genpts.vectors, mesh=genpts.mesh)  # -> grid; disabled; plug-in component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

# ----
# Create analysis grid
grid_size = Number(Slider(1, range=0..10))
honeybee_model_4 = Data(freeze_gate_71)
gridrooms = HBSensorGridFromRooms(rooms=honeybee_model_4, grid_size=grid_size, dist_floor=Slider(0.7, range=0..5))  # -> grid, points, mesh; plug-in component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
assigngridsviews = HBAssignGridsAndViews(model=honeybee_model_4, grids=flatten(gridrooms.grid))  # -> model; plug-in component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
grid_mesh = Data(gridrooms.mesh)
honeybee_model_5 = Data(assigngridsviews)

# ---- group: Simulate illuminance
importloc = LBImportLocation(epw_file=downloadepw_4.epw_file)  # -> location; plug-in component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
day_illuminance = Number(Slider(21, range=1..31))
hour_illuminance = Number(Slider(12, range=0..23))
month_illuminance = Number(Slider(6, range=1..12))
radpar = HBRadianceParameter(recipe_type=Slider(0, range=0..2), detail_level=detail_level_0_2_2)  # -> rad_par; plug-in component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
ciesky = HBCIEStandardSky(location=importloc, month=month_illuminance, day=day_illuminance, hour=hour_illuminance, type=0)  # -> sky; plug-in component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
mjoin = MeshJoin(Meshes=grid_mesh)
pitgrid = HBPointInTimeGridBased(model=honeybee_model_5, sky=ciesky, radiance_par=radpar, run=run_illuminance)  # -> report, flatten(results); plug-in component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
legendpar = LBLegendParameters(max=Slider(2000, range=0..10000))  # -> leg_par; plug-in component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
objbynn_18 = GetObjectByNickname(NickName="PITGrid")
gate_49 = StreamGate(Stream=objbynn_18, Gate=run_illuminance)  # -> Target0, Target1
daylight_report = RemoteSender(pitgrid.report)
hold_7 = HoldingGate(Data=gate_49.Target1)
heatmap = LBSpatialHeatmap(values=pitgrid.results, mesh=mjoin, legend_par=legendpar, legend_title="Lux", global_title="Illuminance")  # -> mesh, legend, title, colors, legend_par, vis_set; plug-in component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
msgs_2 = GetRuntimeMessages(Objects=hold_7)  # -> Errors, Warnings
pitgrid_message_error = RemoteSender(msgs_2.Errors)
pitgrid_message_warning = RemoteSender(msgs_2.Warnings)

# ----
gate_50 = StreamGate(Stream=objbynn_2, Gate=run_annual_daylight_simulation)  # -> Target0, Target1
hold_8 = HoldingGate(Data=gate_50.Target1)
msgs_3 = GetRuntimeMessages(Objects=hold_8)  # -> Errors, Warnings
annualdaylight_message_error = RemoteSender(msgs_3.Errors)
annualdaylight_message_warning = RemoteSender(msgs_3.Warnings)

# ----
# Reports
daylight_report_2 = RemoteReceiver(daylight_report)

# ---- group: Analysis module (continued)
annualdaylight_message_warning_2 = RemoteReceiver(annualdaylight_message_warning)
annualdaylight_message_error_2 = RemoteReceiver(annualdaylight_message_error)
pitgrid_message_warning_2 = RemoteReceiver(pitgrid_message_warning)
pitgrid_message_error_2 = RemoteReceiver(pitgrid_message_error)
lng_36 = ListLength(List=[annualdaylight_message_error_2, pitgrid_message_error_2])
lng_37 = ListLength(List=[annualdaylight_message_warning_2, pitgrid_message_warning_2])
ma_20 = MassAddition(Input=[lng_36, lng_37])  # -> Result, PartialResults
bool_57 = Boolean(ma_20.Result)
hasdata_13 = DataExists(Data=bool_57)
filter_70 = StreamFilter(Gate=hasdata_13, Stream0="False", Stream1=bool_57)
filter_71 = StreamFilter(Gate=lng_36, Stream0="Warning", Stream1="Error")
filter_72 = StreamFilter(Gate=lng_36, Stream0=ColourSwatch(SwatchColor=RGB(237, 185, 94)), Stream1=ColourSwatch(SwatchColor=RGB(226, 54, 54)))
adjustelem_27 = AdjustElementAppearance(ElementsToAdjust=tb_11, Foreground=filter_72)
settextblock_11 = SetTextBlockContents(TextBlockToModify=tb_11, NewTextBlockContents=filter_71)
hideshow_42 = HideShowElement(ElementToHideShow=tb_11, Show=filter_70, Collapse=True, Disable=False)

# ---- group: Analyse performance (continued)
null_41 = NullItem(Item=freeze_gate_69)  # -> NullFlags, InvalidFlags, Description
filter_73 = StreamFilter(Gate=null_41.NullFlags, Stream0=freeze_gate_69, Stream1="False")
run_energy_balance = Boolean(filter_73)
run_peak_loads = Boolean(filter_73)
annualloads = HBAnnualLoads(rooms=flatten(data_39), shades=data_40, epw_file=data_41, run_bal=run_energy_balance, run=run_energy_balance)  # -> report, total_load, cooling, heating, lighting, equip, process, hot_water, balance; plug-in component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
panel_169 = Panel(annualloads.report)
peakloads = HBPeakLoads(rooms=honeybee_rooms_2, shades=shading_geometry, ddy_file=data_42, run_bal=run_peak_loads, run=run_peak_loads)  # -> report, peak_cool, peak_heat, cooling, heating, cool_bal, heat_bal; plug-in component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
panel_170 = Panel(peakloads.report)
gate_51 = StreamGate(Stream=objbynn_16, Gate=run_peak_loads)  # -> Target0, Target1
gate_52 = StreamGate(Stream=objbynn_17, Gate=run_energy_balance)  # -> Target0, Target1
hold_9 = HoldingGate(Data=gate_51.Target1)
annual_energy_balance_data = Data(peakloads.cooling)
annual_energy_balance_data_2 = Data(peakloads.cool_bal)
hold_10 = HoldingGate(Data=gate_52.Target1)
annual_energy_balance_data_3 = Data(peakloads.heating)
annual_energy_balance_data_4 = Data(peakloads.heat_bal)
simple_energy_simulations_report = RemoteSender(peakloads.report)
annual_energy_balance_data_5 = Data(annualloads.balance)
simple_energy_simulations_report_2 = RemoteSender(annualloads.report)
total_load_eui = Data(annualloads.total_load)
msgs_4 = GetRuntimeMessages(Objects=hold_9)  # -> Errors, Warnings
msgs_5 = GetRuntimeMessages(Objects=hold_10)  # -> Errors, Warnings
entwine_147 = Entwine(
    Branch00=total_load_eui,
    Branch01=annual_energy_balance_data_5,
    Branch02=annual_energy_balance_data,
    Branch03=annual_energy_balance_data_3,
    Branch04=annual_energy_balance_data_2,
    Branch05=annual_energy_balance_data_4,
    FlattenInputs=True)
peakloads_message_warning = RemoteSender(msgs_4.Warnings)
peakloads_message_error = RemoteSender(msgs_4.Errors)
panel_171 = Panel(msgs_5.Warnings)
annualloads_message_error = RemoteSender(msgs_5.Errors)
annualloads_message_warning = RemoteSender(msgs_5.Warnings)
null_42 = NullItem(Item=flatten(entwine_147))  # -> NullFlags, InvalidFlags, Description
panel_172 = Panel(entwine_147)
item_36 = ListItem(List=null_42.NullFlags, Index=0, Wrap=True)
gate_53 = StreamGate(Stream=entwine_147, Gate=item_36)  # -> Target0, Target1
entwine_148 = Entwine(Branch0X=gate_53.Target0, Branch1X=current_model_name_2, FlattenInputs=False)
freeze_gate_72 = StreamFreezeGate(Data=entwine_148, PassingSwitch=run_simple_energy_simulations_2, Freeze=True, Hold=False)
split_11 = SplitTree(Data=freeze_gate_72, Masks=flatten("{1;*}"))  # -> Positive, Negative
rec_34 = DataRecorder(graft(split_11.Negative), DataLimit=-10, RecordData=True)
rec_35 = DataRecorder(split_11.Positive, DataLimit=-10, RecordData=True)
current_all_simulation_models_simple_ene = RemoteSender(rec_35)  # "current_all_simulation_models_simple_energy"
current_all_simulations_simple_energy = RemoteSender(rec_34)
split_12 = SplitTree(Data=rec_34, Masks=flatten("{0;0;0;*}"))  # -> Positive, Negative
flip_2 = FlipMatrix(Data=split_12.Positive)
ma_21 = MassAddition(Input=flip_2)  # -> flatten(Result), PartialResults
total_load_eui_all_simulations = RemoteSender(ma_21.Result)

# ----
current_all_simulation_models_simple_ene_2 = RemoteReceiver(current_all_simulation_models_simple_ene)  # "current_all_simulation_models_simple_energy"
entwine_149 = Entwine(Branch00="None", Branch01=current_all_simulation_models_simple_ene_2, FlattenInputs=True)  # -> flatten(Result)
total_load_eui_all_simulations_2 = RemoteReceiver(total_load_eui_all_simulations)
setlist_8 = SetListContents(ListToModify=pulldown_2, NewListContents=entwine_149)
hasdata_14 = DataExists(Data=total_load_eui_all_simulations_2)
current_all_simulations_simple_energy_2 = RemoteReceiver(current_all_simulations_simple_energy)
filter_74 = StreamFilter(Gate=hasdata_14, Stream0="0", Stream1=total_load_eui_all_simulations_2)
lng_38 = ListLength(List=filter_74)
larger_4 = LargerThan(FirstNumber=lng_38, SecondNumber="1")  # -> LargerThan, OrEqualTo
hasdata_15 = DataExists(Data=current_all_simulations_simple_energy_2)
hideshow_43 = HideShowElement(ElementToHideShow=tb_2, Show=hasdata_15, Collapse=True, Disable=False)

# ----
# Chart title
current_selected_simulation_simple_energ_2 = RemoteReceiver(current_selected_simulation_simple_energ)  # "current_selected_simulation_simple_energy_compare"
current_all_simulation_models_simple_ene_3 = RemoteReceiver(current_all_simulation_models_simple_ene)  # "current_all_simulation_models_simple_energy"
item_37 = ListItem(List=current_all_simulation_models_simple_ene_3, Index=current_selected_simulation_simple_energ_2, Wrap=invert(True))
current_selected_simulation_simple_energ_3 = RemoteSender(item_37)  # "current_selected_simulation_simple_energy_compare_title"

mindex_7 = MemberIndex(Set=rec_35, Member=current_selected_model_analysis_module_n_3)  # -> flatten(Index), Count
item_38 = ListItem(List=mindex_7.Index, Index="-1", Wrap=True)
null_43 = NullItem(Item=mindex_7.Count)  # -> NullFlags, InvalidFlags, Description
filter_75 = StreamFilter(Gate=null_43.NullFlags, Stream0=mindex_7.Count, Stream1="False")
simple_energy_data_exists = RemoteSender(filter_75)
simple_energy_data_exists_2 = RemoteReceiver(simple_energy_data_exists)
and_38 = GateAnd(A=simple_energy_data_exists_2, B=larger_4.LargerThan)
simple_energy_data_exists_3 = RemoteReceiver(simple_energy_data_exists)

current_all_simulation_models_simple_ene_4 = RemoteReceiver(current_all_simulation_models_simple_ene)  # "current_all_simulation_models_simple_energy"
total_load_eui_all_simulations_3 = RemoteReceiver(total_load_eui_all_simulations)
num_11 = Number(total_load_eui_all_simulations_3)
expression_75 = Expression(x=num_11, Expression="Round(x, 2)")
rev = ReverseList(List=current_all_simulation_models_simple_ene_4)

rev_2 = ReverseList(List=expression_75)
cset_8 = CreateSet(List=rev)  # -> Set, Map
cull_18 = CullPattern(List=cset_8.Set, CullPattern=values_2.Values)
mindex_8 = MemberIndex(Set=rev, Member=graft(cull_18))  # -> Index, Count
item_39 = ListItem(List=mindex_8.Index, Index="-1", Wrap=True)  # -> flatten(Item)
setchecklist = SetChecklistContents(ChecklistToModify=checklist, NewChecklistContents=cset_8.Set, Selected="True")
item_40 = ListItem(List=rev_2, Index=item_39, Wrap=invert(True))

py3_63 = Python3Script(
    file_location=freeze_gate_3,
    y_label="EUI (kWh/m2)",
    title="EUI per simulation (kWh/m2)",
    labels=cull_18,
    values=item_40,
    colors=fragment_2)  # -> file_location_out; inputs labels: list, values: list, colors: list
# ---------- py3_63: Python ----------
# requirements: matplotlib
# requirements: numpy

import matplotlib.pyplot as plt
import numpy as np

if file_location:
    separatedLabels = [label[:8] + '\n' + label[9:] for label in labels]

    fig, ax = plt.subplots()

    for i in range(len(colors)):
        colors[i] = colors[i].split(',')
        colors[i] = tuple([float(j) for j in colors[i]])

    fig, ax = plt.subplots(figsize=(14, 6))
    ax.bar(separatedLabels, values, label=separatedLabels, color=colors, align="center")

    ax.set_ylim(0, max(values)*1.1)
    ax.set_ylabel(y_label)
    ax.set_title(title)

    plt.subplots_adjust(right=0.65)

    # ax.legend(title=title, bbox_to_anchor=(1.0, 1), loc='upper left', reverse=False)

    plt.savefig(file_location)
    file_location_out = file_location

    #plt.show()
# ---------- end py3_63 ----------
setimg = SetImage(ImageToModify=image_2, NewImagePath=py3_63)

simple_energy_simulations_report_3 = RemoteReceiver([simple_energy_simulations_report, simple_energy_simulations_report_2])

# ---- group: Analysis module (continued)
annualloads_message_warning_2 = RemoteReceiver(annualloads_message_warning)
peakloads_message_warning_2 = RemoteReceiver(peakloads_message_warning)
annualloads_message_error_2 = RemoteReceiver(annualloads_message_error)
peakloads_message_error_2 = RemoteReceiver(peakloads_message_error)
simple_energy_data_exists_4 = RemoteReceiver(simple_energy_data_exists)
lng_39 = ListLength(List=[peakloads_message_error_2, annualloads_message_error_2])
lng_40 = ListLength(List=[peakloads_message_warning_2, annualloads_message_warning_2])
simple_energy_data_exists_5 = RemoteReceiver(simple_energy_data_exists)
simple_energy_data_exists_6 = RemoteReceiver(simple_energy_data_exists)
ma_22 = MassAddition(Input=[lng_40, lng_39])  # -> Result, PartialResults
bool_58 = Boolean(ma_22.Result)
hasdata_16 = DataExists(Data=bool_58)
hideshow_44 = HideShowElement(ElementToHideShow=button_23, Show=simple_energy_data_exists_5, Collapse=True, Disable=False)
hideshow_45 = HideShowElement(ElementToHideShow=button_22, Show=simple_energy_data_exists_6, Collapse=True, Disable=False)
filter_76 = StreamFilter(Gate=hasdata_16, Stream0="False", Stream1=bool_58)
simple_energy_data_exists_7 = RemoteReceiver(simple_energy_data_exists)
filter_77 = StreamFilter(Gate=lng_39, Stream0="Warning", Stream1="Error")
filter_78 = StreamFilter(Gate=lng_39, Stream0=ColourSwatch(SwatchColor=RGB(237, 185, 94)), Stream1=ColourSwatch(SwatchColor=RGB(226, 54, 54)))
simple_energy_data_exists_8 = RemoteReceiver(simple_energy_data_exists)
adjustelem_28 = AdjustElementAppearance(ElementsToAdjust=tb_4, Foreground=filter_78)
settextblock_12 = SetTextBlockContents(TextBlockToModify=tb_4, NewTextBlockContents=filter_77)
hideshow_46 = HideShowElement(ElementToHideShow=tb_4, Show=filter_76, Collapse=True, Disable=False)
simple_energy_data_exists_9 = RemoteReceiver(simple_energy_data_exists)
hideshow_47 = HideShowElement(ElementToHideShow=tb_9, Show=simple_energy_data_exists_7, Collapse=True, Disable=False)
simple_energy_data_exists_10 = RemoteReceiver(simple_energy_data_exists)
bool_59 = Boolean(invert(simple_energy_data_exists_8))
hideshow_48 = HideShowElement(ElementToHideShow=tb_8, Show=bool_59, Collapse=simple_energy_data_exists_8, Disable=False)
hideshow_49 = HideShowElement(ElementToHideShow=entwine_67, Show=simple_energy_data_exists_9, Collapse=True, Disable=False)
hideshow_50 = HideShowElement(ElementToHideShow=stack, Show=and_38, Collapse=True, Disable=False)

# ----
# Revised LCA calculation
# # Life Cycle Assessment (LCA)
# This cluster calculates the embodied carbon for the input Honeybee model
# 
# ## Instructions
# Enter the inputs to calculate the GWP (Global Warming Potential), i.e. the embodied carbon, for the materials in the Honeybee model
# 
# ## Inputs
# - `Honeybee model` - the Honeybee model for analysis
# 
# ## Outputs
# - `Total GWP` - total GWP for the modules A1-A5.1 [kg CO2eq]
# - `GWP by element type` - GWP of each element type for the modules A1-A5.1 [kg CO2eq]
# - `Element types` - list of element types in the model
# 
# ## Interpretation
# To be added...
data_44 = Data(data_17)
calculate_honeybee_model = BrimstoneCalculateEmbodiedCarbonOfHoneybeeModel(hb_model=data_44, kdb_json_data=get_categories.json_data)  # -> tot_emb_carbon, elements, el_emb_carbon
# ---------- calculate_honeybee_model: Python ----------
"""
Calculates embodied carbon for the elements of a Honeybee model if data is available
This component was inspired by the 'HB Color Face Attributes' component of Ladybug Tools 1.6.0

    Args:
        hb_model: Honeybee model for analysis
        kdb_json_data: Optional json data object for materials which do not include impact data

    Returns:
        tot_emb_carbon: total embodied carbon of model
        elements: element types in the model
        el_emb_carbon: embodied carbon for each element type in the model
"""

import scriptcontext
import brimstone
ghenv.Component.Message = brimstone.globals.version
import Grasshopper
import os
import csv, codecs

ghenv.Component.Name = 'Brimstone - Calculate Embodied Carbon of Honeybee Model'
ghenv.Component.NickName = 'Calculate Honeybee Model'

try:  # import the core honeybee dependencies
    from honeybee_energy.construction.windowshade import WindowConstructionShade
    from honeybee.model import Model
    from honeybee.properties import FaceProperties
    from honeybee.typing import clean_ep_string
except ImportError as e:
    raise ImportError('\nFailed to import honeybee:\n\t{}'.format(e))
    

# todo: magic string here - not good!
gwp_data_string = "Global Warming potential"
gwp_data_points = [
    "A1-A3 Conservative",
    "A4",
    "A5.1",
]

def main(hb_model):
    tot_emb_carbon = 0
    elements = []
    el_emb_carbon = []
    if not isinstance(hb_model, Model):
        raise Exception("hb_model input must be a valid honeybee model")
    faces = []
    apertures = []
    model_mats = []
    face_types = {}
    
    energy_properties = hb_model.properties.energy
    
    for material in energy_properties.materials:
        model_mats.append(material)
    for room in hb_model.rooms:
        faces.extend(room.faces)
        faces.extend(room.shades)
    faces.extend(hb_model.orphaned_faces)
    faces.extend(hb_model.orphaned_apertures)
    faces.extend(hb_model.orphaned_doors)
    faces.extend(hb_model.orphaned_shades)
    
    for face_obj in faces:
        if isinstance(face_obj.properties, FaceProperties):
            face_area = face_obj.area - face_obj.aperture_area
            face_type = face_obj.type
            
            face_impact = 0
            for lyr in face_obj.properties.energy.construction.layers:
                face_impact += get_face_impact(model_mats, lyr, face_area)
                """
                if lyr not in model_mats:
                    model_mats[lyr] = { area: face_area }
                else:
                    model_mats[lyr].area = model_mats[lyr].area + face_area
                """
                       
            if face_type not in face_types:
                face_types[face_type] = { "impact": face_impact }
            else:
                face_types[face_type]["impact"] += face_impact
                
            
            for aperture in face_obj.apertures:
                aperture_impact = get_aperture_impact(aperture)
                if "Aperture" not in face_types:
                    face_types["Aperture"] = { "impact": aperture_impact }
                else:
                    face_types["Aperture"]["impact"] += aperture_impact
    for face_type in face_types.items():
        face_impact = face_type[1]["impact"]
        tot_emb_carbon += face_impact
        elements.append(face_type[0])
        el_emb_carbon.append(face_impact)
    return tot_emb_carbon, elements, el_emb_carbon

def get_face_impact(materials, layer_name, face_area):
    for material in materials:
        if material.identifier == layer_name:
            abs_impact = 0
            gwp_data_keys = ["gwp_a1_a3", "gwp_a4", "gwp_a5_1"]
            if material.user_data and all(key in material.user_data.keys() for key in gwp_data_keys):
                impact = sum(float(material.user_data[key]) for key in gwp_data_keys)
                abs_impact = material.density*impact
            else:
                abs_impact = get_face_impact_from_material_name(material.identifier)
            return material.thickness*abs_impact*face_area
    brimstone.utils.warn(ghenv, "The calculation may be faulty as material " + layer_name + " was not found among the energy materials in the model.")
    return 0

# Gets material impact data from a honeybee material by referencing names in .csv file
def get_face_impact_from_material_name(material_name):
    csv_data_file = brimstone.globals.hb_kdb_csv_path
    csv_data_file_path = os.path.join(Grasshopper.Folders.UserObjectFolders[0], csv_data_file)
    if not os.path.exists(csv_data_file_path):
        raise Exception("Failed to open csv file, it should reside in [UserComponents folder]/brimstone_data/")
    kdb_name = check_name_in_kdb(material_name)
    if not kdb_name:
        with open(csv_data_file_path, 'r') as csv_file:
            file_reader = csv.DictReader(csv_file, delimiter=",")
            for row in file_reader:
                if row["HB Name"] == material_name:
                    kdb_name = clean_ep_string(row["Klimatdatabas name"])
                    if not kdb_name or kdb_name == "missing":
                        brimstone.utils.warn(ghenv, "The calculation may be faulty as impact data is missing for some of the materials in the model: " + material_name)
                        return 0
                    break
    if not kdb_name:
        brimstone.utils.warn(ghenv, "The calculation may be faulty as material " + material_name + " could not be matched to any material in the brimstone material database.")
        return 0
    
    return get_impact_from_json_data(kdb_name)

def check_name_in_kdb(material_name):
    if not kdb_json_data:
        brimstone.utils.warn(ghenv, "The calculation may be faulty as kdb_json_data is missing")
    else: 
        for resource in kdb_json_data["Resources"]:
            if clean_ep_string(resource["Name"]) == material_name:
                return material_name
    return ""
    
# TODO: currently only works for KDB windows
def get_aperture_impact(aperture):
    c = aperture.properties.energy.construction
    c = c.window_construction if type(c) == WindowConstructionShade else c
    if hasattr(c.user_data, "conv_value"):
        
        return (float(c.user_data.gwp_a1_a3) + float(c.user_data.gwp_a4))\
            * float(c.user_data.conv_value) * aperture.area
    if not len(c.layers) == 1:
        brimstone.utils.warn(ghenv, "The calculation may be faulty as only one layer window constructions can be calculated.")
        return 0
    
    window_material = c.layers[0]
    return get_impact_from_json_data(window_material)*aperture.area

def get_impact_from_json_data(kdb_name):
    if not kdb_json_data:
        brimstone.utils.warn(ghenv, "The calculation may be faulty as kdb_json_data is missing")
        return 0
    for resource in kdb_json_data["Resources"]:
        if clean_ep_string(resource["Name"]) == kdb_name:
            conv = resource["Conversions"][0]["Value"]
            
            for data_item in resource["DataItems"]:
                if data_item["PropertyName"] == gwp_data_string:
                    abs_impact = 0
                    for data_pt in gwp_data_points:
                        for data_val_item in data_item["DataValueItems"]:
                            if data_val_item["DataModuleCode"] == data_pt:
                                abs_impact += data_val_item["Value"]
                    return abs_impact*conv
            brimstone.utils.warn(ghenv, "The calculation may be faulty as material " + kdb_name + " has no GWP data in kdb_json_data")
            return 0
    brimstone.utils.warn(ghenv, "The calculation may be faulty as material " + kdb_name + " was not found in kdb_json_data")
    return 0

if __name__ == "__main__":
    try:
        flying = scriptcontext.sticky["brimstone_flying"]
    except:
        raise Exception("The 'Brimstone - Fly' component needs to exist on the canvas")
    tot_emb_carbon, elements, el_emb_carbon = main(hb_model)
# ---------- end calculate_honeybee_model ----------
get_resources = BrimstoneGetResources(json_data=get_categories.json_data, category="Energy and fuel")  # -> out, json_data, resources
# ---------- get_resources: Python ----------
"""Extracts resource names from a Klimatdatabas json object
    Inputs:
        json_data: dictionary with json data
        category: readable name of category to extract resources from
    Output:
        resources: List of resources in category"""

import scriptcontext

import brimstone
ghenv.Component.Message = brimstone.globals.version

ghenv.Component.Name = 'Brimstone - Get Resources'
ghenv.Component.NickName = 'Get Resources'

def main(json_data, category):
    resources = get_resources(json_data, category)
    return resources
    
def get_resources(json_data, category):
    pred = lambda v: v["Text"] == category
    resources = []
    for resource in json_data["Resources"]:
        if len(filter(pred, resource["Categories"])) > 0:
            resources.append(resource["Name"])
    return resources

if __name__ == "__main__":
    if not scriptcontext.sticky["brimstone_flying"]:
        raise Exception("The 'Brimstone - Fly' component needs to exist on the canvas")
    print json_data
    resources = main(json_data, category)
    
    json_data = [json_data]
# ---------- end get_resources ----------
list_11 = ItemSelector(
    get_resources.resources,
    {"Electricity, Swedish mix", "Diesel, reduction obligation  (2021)": "Diesel, reduction obligation (2021)", "Diesel, fossil", "Petrol, reduction obligation  (2021)": "Petrol, reduction obligation (2021)", "Petrol, 100% fossil", "District heating, Swedish average", "HVO100", "Gasol", "Wood pellets", "E85 ethanol", "Biogas", "Fuel oil 1", "Fuel oil 2-5", "FAME100", "ED95"}, selected="Electricity, Swedish mix")
element_types = Data(calculate_honeybee_model.elements)
total_gwp = Data(calculate_honeybee_model.tot_emb_carbon)
gwp_by_element_type = Data(calculate_honeybee_model.el_emb_carbon)
connected = GetConnectedObjects(Objects=calculate_honeybee_model.tot_emb_carbon)
panel_173 = Panel(element_types)
panel_174 = Panel(gwp_by_element_type)
panel_175 = Panel(total_gwp)
get_lca_data = BrimstoneGetLCAData(json_data=get_resources.json_data, resources="District heating, Swedish average")  # -> out, json_data, lca_data, indicators, values; inputs resources: list, addtl_indicators: list
#   port json_data: List of resources in category
# ---------- get_lca_data: Python ----------
"""Extracts LCA indicators and values from a Klimatdatabas json for a specific resource
    Inputs:
        json_data: dictionary with json data
        resources: list of readable names of resources
        addtl_indicators: list of additional keys to retrieve from resource
    Output:
        lca_data: list of dictionaries with LCA data for each resource
        indicators: list of indicators
        values: list of indicator values"""

import scriptcontext
import ghpythonlib.treehelpers as th
from collections import OrderedDict
import copy

import brimstone
ghenv.Component.Message = brimstone.globals.version

ghenv.Component.Name = 'Brimstone - Get LCA Data'
ghenv.Component.NickName = 'Get LCA Data'

# todo: magic string here - not good!
gwp_data_string = "Global Warming potential"

# keys: names in output dict, values: DataModuleCode in json db
gwp_data_entries = {
    "GWPA1A3Conservative": "A1-A3 Conservative",
    "GWPA1A3Typical": "A1-A3 Typical",
    "GWPA4": "A4",
    "GWPA5.1": "A5.1",
}

def main(json_data, resource, addtl_indicators):
    lca_data, indicators, values = [], [], []

    for i, resource in enumerate(resources):
        lca_data.append(get_lca_data(json_data, resource, addtl_indicators))
        resource_indicators, resource_values = get_indicator_values(lca_data[i], addtl_indicators)
        indicators.append(resource_indicators)
        values.append(resource_values)
    return lca_data, indicators, values
    
def get_lca_data(json_data, resource_name, addtl_indicators):
    resource_data = copy.deepcopy(
        find_obj_in_array(
            json_data["Resources"],
            "Name",
            resource_name
        )
    )
    
    if not resource_data:
        raise Exception(
            "Resource with name {resource_name} was not found in database."
            .format(resource_name = resource_name)
       )
    try:
        lca_data = extract_lca_data(resource_data, addtl_indicators)
    except KeyError:
        raise Exception("Format of JSON data is not supported.")
    return lca_data

def extract_lca_data(resource_data, addtl_indicators):
    lca_data = OrderedDict()
    resource_name = resource_data["Name"]
    
    lca_data["Name"] = resource_name
    
    if "Conversions" in resource_data:
        # can a resource have multiple conversions?
        lca_data["ConversionUnit"] = resource_data["Conversions"][0]["Unit"]
        lca_data["ConversionValue"] = resource_data["Conversions"][0]["Value"]
    
    if "InventoryUnit" in resource_data:
        lca_data["InventoryUnit"] = resource_data["InventoryUnit"]
    
    for data_prop in resource_data["DataItems"]:
        if data_prop["PropertyName"] == gwp_data_string:
            gwp_data = copy.deepcopy(data_prop)
            break
            
    if not gwp_data:
        raise Exception("GWP data not found for {resource_name}"
            .format(resource_name = resource_name))
    
    lca_data["GWPUnit"] = gwp_data["PropertyUnitCode"]
    for key in gwp_data_entries:
        value = find_obj_in_array(
            gwp_data["DataValueItems"],
            "DataModuleCode",
            gwp_data_entries[key]
        )
        if value is not None:
            lca_data[key] = value["Value"]
            
    for addtl_indicator in addtl_indicators:
        if addtl_indicator in resource_data:
            lca_data[addtl_indicator] = resource_data[addtl_indicator]
    
    return lca_data

def find_obj_in_array(array, key, value):
    return next((x for x in array if x[key] == value), None)

def get_indicator_values(lca_data, addtl_indicators):
    indicator_dict = OrderedDict([
        ("Name", "Name"),
        ("InventoryUnit", "Inventory unit"),
        ("ConversionUnit", "Conversion unit"),
        ("ConversionValue", "Conversion value"),
        ("GWPUnit", "GWP unit"),
        ("GWPA1A3Conservative", "GWP (A1-A3 Conservative)"),
        ("GWPA1A3Typical", "GWP (A1-A3 Typical)"),
        ("GWPA4", "GWP (A4)"),
        ("GWPA5.1", "GWP (A5.1)"),
    ])
    
    for addtl_indicator in addtl_indicators:
        indicator_dict[addtl_indicator] = addtl_indicator
    
    indicators, values = [], []
    
    for key, indicator_name in indicator_dict.items():
        indicator_value = lca_data[key] if key in lca_data else None
        if indicator_value:
            indicators.append(indicator_name)
            values.append(indicator_value)
    
    return indicators, values

if __name__ == "__main__":
    if not scriptcontext.sticky["brimstone_flying"]:
        raise Exception("The 'Brimstone - Fly' component needs to exist on the canvas")
    lca_data, indicators, values = main(json_data, resources, addtl_indicators)
    
    lca_data_treeable = []
    
    for resource_lca_data in lca_data:
        lca_data_treeable.append([resource_lca_data.keys(), resource_lca_data.values()])
    lca_data = th.list_to_tree(lca_data_treeable)
    indicators = th.list_to_tree(indicators)
    values = th.list_to_tree(values)
    json_data = [json_data]
# ---------- end get_lca_data ----------
area_m2 = Data(geoprop.floor_area)
panel_176 = Panel("kg CO2eq")

# ----
# Temporary data for developing UI
element_types_2 = Data(["Aperture", "Roof", "Wall", "Floor"])
gwp_by_element_type_2 = Data(["50", "40", "75", "25"])
placeholder_data = Panel(element_types_2)
placeholder_data_2 = Panel(gwp_by_element_type_2)
ma_23 = MassAddition(Input=gwp_by_element_type)  # -> Result, PartialResults
total_gwp_2 = Data(ma_23.Result)
lca_gwp_by_element_type = RemoteSender(gwp_by_element_type)
lca_element_types = RemoteSender(placeholder_data)
lca_total_gwp = RemoteSender(total_gwp_2)

lca_gwp_by_element_type_2 = RemoteReceiver(lca_gwp_by_element_type)
num_12 = Number(lca_gwp_by_element_type_2)
lca_element_types_2 = RemoteReceiver(lca_element_types)
expression_76 = Expression(x=num_12, Expression="Round(x, 2)")
py3_64 = Python3Script(
    file_location=freeze_gate_20,
    y_label="GWP (kg CO2eq)",
    title="GWP by element type (kg CO2eq)",
    labels=lca_element_types_2,
    values=expression_76,
    colors=fragment)  # -> out, file_location_out; inputs labels: list, values: list, colors: list
# ---------- py3_64: Python ----------
# requirements: matplotlib
# requirements: numpy

import matplotlib.pyplot as plt
import numpy as np

fig, ax = plt.subplots()

for i in range(len(colors)):
    colors[i] = colors[i].split(',')
    colors[i] = tuple([float(j) for j in colors[i]])

fig, ax = plt.subplots(figsize=(14, 6))
ax.bar(labels, values, label=labels, color=colors, align="center")
bottom = 0
for i in range(len(labels)):
    ax.bar('total GWP', values[i], color=colors[i], bottom=bottom, align='center')
    bottom += values[i]

ax.set_ylim(0, sum(values)*1.1)
ax.set_ylabel(y_label)
ax.set_title(title)

plt.subplots_adjust(right=0.8)

ax.legend(title=title, bbox_to_anchor=(1.0, 1), loc='upper left', reverse=True)

plt.savefig(file_location)
file_location_out = file_location

#plt.show()
# ---------- end py3_64 ----------
setimg_2 = SetImage(ImageToModify=image, NewImagePath=py3_64.file_location_out)

gate_54 = StreamGate(Stream=connected, Gate=bool_43)  # -> Target0, Target1
hold_11 = HoldingGate(Data=gate_54.Target1)
lca_total_gfa = RemoteSender(area_m2)

# ---- group: Analysis module (continued)
lca_total_gwp_2 = RemoteReceiver(lca_total_gwp)
lca_total_gfa_2 = RemoteReceiver(lca_total_gfa)
lca_total_gwp_3 = RemoteReceiver(lca_total_gwp)
lca_total_gwp_4 = RemoteReceiver(lca_total_gwp)
division_5 = Division(A=lca_total_gwp_2, B=lca_total_gfa_2)
expression_77 = Expression(x=division_5, Expression="Round(x, 2)")
expression_78 = Expression(x=lca_total_gwp_4, Expression="Round(x, 2)")
expression_79 = Expression(x=lca_total_gwp_3, Expression="Round(x, 2)")
format_24 = Format(Format=panel_77, Culture=127, Data0=expression_77)
format_25 = Format(Format=panel_79, Culture=127, Data0=expression_78)
format_26 = Format(Format=panel_78, Culture=127, Data0=expression_79)
setlabel_3 = SetLabelContents(LabelToModify=label_31, NewLabelContents=format_24)
setlabel_4 = SetLabelContents(LabelToModify=label_32, NewLabelContents=format_25)
setlabel_5 = SetLabelContents(LabelToModify=label_33, NewLabelContents=format_26)

# ---- group: Glare analysis
epw_file_url_3 = Data(location_8)
viewport_name = Data(txt_4)
pt_18 = ConstructPoint(XCoordinate=Slider(6, range=0..10), YCoordinate=Slider(5, range=0..10), ZCoordinate=Slider(2, range=0..10))
viewport = HBViewFromViewport(name=viewport_name, viewport=viewport_name, view_type=Slider(4, range=0..5))  # -> view; plug-in component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
pt_19 = ConstructPoint(XCoordinate=Slider(4, range=0..10), YCoordinate=Slider(4, range=0..10), ZCoordinate=Slider(1.6, range=0..10))
vec2pt = Vector2Pt(PointA=pt_19, PointB=pt_18, Unitize=False)  # -> Vector, Length
assigngridsviews_2 = HBAssignGridsAndViews(model=freeze_gate_70, views=flatten(viewport))  # -> model; plug-in component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
view = HBView(position=pt_19, direction=vec2pt.Vector, view_type=Slider(4, range=0..5))  # -> view; disabled; plug-in component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
hoy = LBCalculateHOY(month=month, day=day, hour=hour)  # -> flatten(hoy), flatten(doy), flatten(date); plug-in component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
falsecolor = HBFalseColor(max=Slider(2300, range=0..10000), contour_lines=Toggle(True))  # -> hdr; disabled; plug-in component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
hdr_false_color_image = Data(falsecolor)

# ---- group: Analyse performance
# Chart title
current_selected_model_analysis_module_n_4 = RemoteReceiver(current_selected_model_analysis_module_n)  # "current_selected_model_analysis_module_name"
current_all_simulation_models_simple_ene_5 = RemoteReceiver(current_all_simulation_models_simple_ene)  # "current_all_simulation_models_simple_energy"
current_all_simulation_models_simple_ene_6 = RemoteReceiver(current_all_simulation_models_simple_ene)  # "current_all_simulation_models_simple_energy"
mindex_9 = MemberIndex(Set=current_all_simulation_models_simple_ene_5, Member=current_selected_model_analysis_module_n_4)  # -> flatten(Index), Count

# ----
item_41 = ListItem(List=mindex_9.Index, Index="-1", Wrap=True)

# ---- group: Analyse performance (continued)
item_42 = ListItem(List=current_all_simulation_models_simple_ene_6, Index=item_41, Wrap=True)
current_selected_simulation_simple_energ_4 = RemoteSender(item_42)  # "current_selected_simulation_simple_energy_title"

# ----
downloadepw_5 = LBDownloadWeather(weather_URL=epw_file_url_3)  # -> epw_file, stat_file, ddy_file; plug-in component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

# ---- group: Glare analysis (continued)
importloc_2 = LBImportLocation(epw_file=downloadepw_5.epw_file)  # -> location; plug-in component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
ciesky_2 = HBCIEStandardSky(location=importloc_2, month=month, day=day, hour=hour, type=0)  # -> sky; plug-in component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
pitview = HBPointInTimeViewBased(model=assigngridsviews_2, sky=ciesky_2, run=run_glare_analysis)  # -> report, results; plug-in component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
glare = HBGlarePostprocess(hdr=pitview.results)  # -> DGP, category, glare_indices, check_hdr; plug-in component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
merge_16 = Merge(Data1=hoy.date, Data2=glare.category, Data3=glare.DGP)
daylight_glare_probability_dgp = Data(glare.DGP)
join_9 = TextJoin(Text=merge_16)
adjusthdr = HBAdjustHDR(adj_expos=Toggle(True), label=join_9)  # -> hdr; disabled; plug-in component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
hdr_image = Data(adjusthdr)

# ----
honeybee_model_6 = Data(freeze_gate_67)  # disabled
data_45 = Data(honeybee_model_6)  # disabled

# ---- group: Simulate
run_energy_simulation = Boolean(run_detailed_energy_simulations_2)  # disabled
modeltoosm = HBModelToOSM(
    model=honeybee_model_6,
    epw_file=downloadepw_2.epw_file,
    sim_par=simpar,
    write=run_energy_simulation,
    run=run_energy_simulation)  # -> report, jsons, osw, osm, idf, sql, zsz, rdd, html; disabled; plug-in component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
eui = HBEndUseIntensity(sql=modeltoosm.sql)  # -> eui, eui_end_use, end_uses, gross_floor; disabled; plug-in component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
panel_179 = Panel(eui.eui)  # disabled
panel_180 = Panel(eui.end_uses)  # disabled
panel_181 = Panel(eui.eui_end_use)  # disabled

# ---- group: Peak loads
readhvac = HBReadHVACSizing(sql=modeltoosm.sql)  # -> zone_names, zone_peak_cool, zone_peak_heat, comp_types, comp_properties, comp_values; disabled; plug-in component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
readzsz = HBReadZoneSizing(zsz=modeltoosm.zsz)  # -> cooling_load, heating_load; disabled; plug-in component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
number_slider_56 = Slider(40, range=0..100)  # disabled
number_slider_57 = Slider(40, range=0..100)  # disabled
toggle_8 = BooleanToggle(True)  # disabled
toggle_9 = BooleanToggle(True)  # disabled
panel_182 = Panel([readhvac.zone_peak_heat, readhvac.zone_peak_cool])  # disabled
monthlychart = LBMonthlyChart(data=readzsz.heating_load, x_dim=number_slider_56, stack=toggle_8, time_marks=toggle_8)  # -> report, data_mesh, data_lines, col_lines, legend, borders, labels, y_title, title, vis_set; disabled; plug-in component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
monthlychart_2 = LBMonthlyChart(data=readzsz.cooling_load, x_dim=number_slider_57, stack=toggle_9, time_marks=toggle_9)  # -> report, data_mesh, data_lines, col_lines, legend, borders, labels, y_title, title, vis_set; disabled; plug-in component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
heating_load_profile = Data(flatten([monthlychart.data_mesh, monthlychart.data_lines, monthlychart.col_lines, monthlychart.legend, monthlychart.borders, monthlychart.labels, monthlychart.y_title, monthlychart.title]))  # disabled
cooling_load_profile = Data(flatten([monthlychart_2.data_mesh, monthlychart_2.data_lines, monthlychart_2.col_lines, monthlychart_2.legend, monthlychart_2.borders, monthlychart_2.labels, monthlychart_2.y_title, monthlychart_2.title]))  # disabled
peak_cooling = Data(readhvac.zone_peak_cool)  # disabled
zone_names = Data(readhvac.zone_names)  # disabled
peak_heating = Data(readhvac.zone_peak_heat)  # disabled

# ---- group: Load previous model
falsestart = LBFalseStartToggle(False)  # disabled
item_43 = ListItem(List=modeltoosm.jsons, Index=0, Wrap=True)  # disabled
loadobjects_4 = HBLoadObjects(hb_file=item_43, load=falsestart)  # -> report, hb_objs; disabled; plug-in component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

# ---- group: extract and visualise data
roomenergyresult = HBReadRoomEnergyResult(sql=modeltoosm.sql)  # -> cooling, heating, lighting, electric_equip, gas_equip, process, hot_water, fan_electric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; disabled; plug-in component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
merge_17 = Merge(
    Data1=roomenergyresult.heating,
    Data2=roomenergyresult.cooling,
    Data3=roomenergyresult.lighting,
    Data4=roomenergyresult.electric_equip,
    Data5=roomenergyresult.hot_water,
    Data6=roomenergyresult.people_gain,
    Data7=roomenergyresult.solar_gain)  # disabled
hourlyplot = LBHourlyPlot(data=merge_17)  # -> report, mesh, legend, borders, labels, title, vis_set; disabled; plug-in component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
xdata = LBDeconstructData(data=roomenergyresult.cooling)  # -> header, values; disabled; plug-in component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

# ---- group: Energy balance
faceresult = HBReadFaceResult(sql=modeltoosm.sql)  # -> face_indoor_temp, face_outdoor_temp, face_energy_flow; disabled; plug-in component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
loadbalance = HBThermalLoadBalance(
    rooms_model=flatten(data_45),
    cooling=roomenergyresult.cooling,
    heating=roomenergyresult.heating,
    lighting=roomenergyresult.lighting,
    electric_equip=roomenergyresult.electric_equip,
    hot_water=roomenergyresult.hot_water,
    people_gain=roomenergyresult.people_gain,
    solar_gain=roomenergyresult.solar_gain,
    infiltration_load=roomenergyresult.infiltration_load,
    mech_vent_load=roomenergyresult.mech_vent_load,
    face_energy_flow=faceresult.face_energy_flow)  # -> report, balance, balance_stor, norm_bal, norm_bal_stor; disabled; plug-in component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
number_slider_58 = Slider(19, range=0..100)  # disabled
timeop = LBTimeIntervalOperation(data=loadbalance.norm_bal_stor)  # -> daily, monthly, mon_per_hr; disabled; plug-in component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
colrange_5 = LBColorRange(index=number_slider_58)  # -> colors; disabled; plug-in component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
toggle_10 = BooleanToggle(True)  # disabled
neg_3 = Negative(Value=number_slider_48)  # disabled
legendpar_2 = LBLegendParameters(min=neg_3, max=number_slider_48, colors=colrange_5)  # -> leg_par; disabled; plug-in component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
monthlychart_3 = LBMonthlyChart(data=timeop.monthly, stack=toggle_10, legend_par=legendpar_2)  # -> report, data_mesh, data_lines, col_lines, legend, borders, labels, y_title, title, vis_set; disabled; plug-in component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

# ----
detailed_energy_simulations_report = RemoteSender(modeltoosm.report)  # disabled
energy_use_intensity = Data(eui.eui)  # disabled
energy_use_intensity_per_end_use = Data(eui.eui_end_use)  # disabled
end_uses = Data(eui.end_uses)  # disabled
monthly_energy_balance = Data(flatten([monthlychart_3.data_mesh, monthlychart_3.data_lines, monthlychart_3.col_lines, monthlychart_3.legend, monthlychart_3.borders, monthlychart_3.labels, monthlychart_3.y_title, monthlychart_3.title]))  # disabled
annual_hourly_energy_results = Data(flatten([hourlyplot.mesh, hourlyplot.legend, hourlyplot.borders, hourlyplot.labels, hourlyplot.title]))  # disabled
cooling_load_profile_2 = Data(cooling_load_profile)  # disabled
monthly_energy_balance_2 = Data(monthly_energy_balance)  # disabled
energy_use_intensity_2 = Data(energy_use_intensity)  # disabled
peak_cooling_2 = Data(peak_cooling)  # disabled
heating_load_profile_2 = Data(heating_load_profile)  # disabled
energy_use_intensity_per_end_use_2 = Data(energy_use_intensity_per_end_use)  # disabled
end_uses_2 = Data(end_uses)  # disabled
peak_heating_2 = Data(peak_heating)  # disabled
annual_hourly_energy_results_2 = Data(annual_hourly_energy_results)  # disabled
peak_cooling_3 = Data(zone_names)  # disabled
panel_183 = Panel(peak_cooling_2)  # disabled
panel_184 = Panel(peak_heating_2)  # disabled
panel_185 = Panel(energy_use_intensity_per_end_use_2)  # disabled
panel_186 = Panel(energy_use_intensity_2)  # disabled
panel_187 = Panel(end_uses_2)  # disabled

detailed_energy_simulations_report_2 = RemoteReceiver(detailed_energy_simulations_report)

msgs_6 = GetRuntimeMessages(Objects=hold_11)  # -> Errors, Warnings
lca_errors = RemoteSender(msgs_6.Errors)
lca_warnings = RemoteSender(msgs_6.Warnings)

lca_errors_2 = RemoteReceiver(lca_errors)
lng_41 = ListLength(List=lca_errors_2)

lca_warnings_2 = RemoteReceiver(lca_warnings)
lca_errors_3 = RemoteReceiver(lca_errors)

# ---- group: Analysis module (continued)
lca_warnings_3 = RemoteReceiver(lca_warnings)
lca_errors_4 = RemoteReceiver(lca_errors)
lng_42 = ListLength(List=lca_errors_4)
lng_43 = ListLength(List=lca_warnings_3)
ma_24 = MassAddition(Input=[lng_42, lng_43])  # -> Result, PartialResults
bool_60 = Boolean(ma_24.Result)
hasdata_17 = DataExists(Data=bool_60)
filter_79 = StreamFilter(Gate=hasdata_17, Stream0="False", Stream1=bool_60)
filter_80 = StreamFilter(Gate=lng_42, Stream0="Warning", Stream1="Error")
filter_81 = StreamFilter(Gate=lng_42, Stream0=ColourSwatch(SwatchColor=RGB(237, 185, 94)), Stream1=ColourSwatch(SwatchColor=RGB(226, 54, 54)))
adjustelem_29 = AdjustElementAppearance(ElementsToAdjust=tb_12, Foreground=filter_81)
settextblock_13 = SetTextBlockContents(TextBlockToModify=tb_12, NewTextBlockContents=filter_80)
hideshow_51 = HideShowElement(ElementToHideShow=tb_12, Show=filter_79, Collapse=True, Disable=False)

# ----
lca_gwp_by_element_type_3 = RemoteReceiver(lca_gwp_by_element_type)
lca_element_types_3 = RemoteReceiver(lca_element_types)
lca_total_gwp_5 = RemoteReceiver(lca_total_gwp)
honeybee_model_exists_9 = RemoteReceiver(honeybee_model_exists)
lca_data_exists = RemoteSender(Toggle(True))

# ---- group: Analysis module (continued)
lca_data_exists_2 = RemoteReceiver(lca_data_exists)
lca_data_exists_3 = RemoteReceiver(lca_data_exists)
and_39 = GateAnd(A=lca_data_exists_2, B=simple_energy_data_exists_10)
hideshow_52 = HideShowElement(ElementToHideShow=label_32, Show=invert(lca_data_exists_3), Collapse=True, Disable=False)
hideshow_53 = HideShowElement(ElementToHideShow=[label_34, label_35], Show=and_39, Collapse=True, Disable=False)
hideshow_54 = HideShowElement(ElementToHideShow=[label_33, true_button_10, label_31], Show=lca_data_exists_2, Collapse=True, Disable=False)

# ----
glare_report = RemoteSender(pitview.report)
hdr_image_2 = Data(pitview.results)
hdr_false_color_image_2 = Data(pitview.results)
num_13 = Number(daylight_glare_probability_dgp)

glare_report_2 = RemoteReceiver(glare_report)

data_46 = Data(num_13)
data_47 = Data(hdr_image)
data_48 = Data(hdr_false_color_image)
calculate_glare_probability_3 = RemoteReceiver(calculate_glare_probability)
entwine_150 = Entwine(Branch00=data_46, FlattenInputs=True)
freeze_gate_73 = StreamFreezeGate(Data=entwine_150, PassingSwitch=calculate_glare_probability_3, Hold=True)
pitview_message_error_3 = RemoteReceiver(pitview_message_error)
bang_17 = ExplodeTree(Data=freeze_gate_73)  # -> Branch0, Branch1, Branch2
hasdata_18 = DataExists(Data=bang_17.Branch0)
lng_44 = ListLength(List=pitview_message_error_3)
data_49 = Data()
data_50 = Data()
data_51 = Data(bang_17.Branch0)
and_40 = GateAnd(A=invert(lng_44), B=hasdata_18)
glare_daylight_probability = RemoteSender(data_51)
glare_data_exists = RemoteSender(and_40)

imageviewer = LBImageViewer(ImagePath_=data_49, _scale_="1", DisableClickable=False, SaveImgWithCoords=False, scale=1)  # -> ImagePath, Values, GIF
imageviewer_2 = LBImageViewer(ImagePath_=data_50, _scale_="1", DisableClickable=False, SaveImgWithCoords=False, scale=1)  # -> ImagePath, Values, GIF
panel_188 = Panel(imageviewer_2.Values)
panel_189 = Panel(imageviewer_2.GIF)
panel_190 = Panel(imageviewer_2.ImagePath)

# ---- group: Analysis module (continued)
glare_daylight_probability_2 = RemoteReceiver(glare_daylight_probability)
expression_80 = Expression(x=glare_daylight_probability_2, Expression="Round(x, 2)")
glare_data_exists_2 = RemoteReceiver(glare_data_exists)
format_27 = Format(Format=panel_75, Culture=127, Data0=expression_80)
or_32 = GateOr(A=glare_data_exists_2, B=filter_13)
rec_36 = DataRecorder(or_32, DataLimit=-10, RecordData=True)
settextblock_14 = SetTextBlockContents(TextBlockToModify=tb_14, NewTextBlockContents=format_27)
ma_25 = MassAddition(Input=flatten(rec_36))  # -> Result, PartialResults
glare_data_exists_3 = RemoteReceiver(glare_data_exists)
mod_2 = Modulus(A=ma_25.Result, B=Slider(2, range=0..10))
bool_61 = Boolean(mod_2)
hideshow_55 = HideShowElement(ElementToHideShow=tb_14, Show=glare_data_exists_3, Collapse=True, Disable=False)
glare_data_exists_4 = RemoteReceiver(glare_data_exists)
filter_82 = StreamFilter(Gate=bool_61, Stream0="Simulation failed...", Stream1="Daylight simulation is running...")
gate_55 = StreamGate(Stream=filter_82, Gate=freeze_gate_16)  # -> Target0, Target1
settextblock_15 = SetTextBlockContents(TextBlockToModify=tb_13, NewTextBlockContents=gate_55.Target1)
bool_62 = Boolean(invert(glare_data_exists_4))
hideshow_56 = HideShowElement(ElementToHideShow=tb_13, Show=bool_62, Collapse=glare_data_exists_4, Disable=False)

# ----
# Simple energy simulations - Compare
current_selected_simulation_simple_energ_5 = RemoteReceiver(current_selected_simulation_simple_energ)  # "current_selected_simulation_simple_energy_compare"
current_all_simulations_simple_energy_3 = RemoteReceiver(current_all_simulations_simple_energy)
number_slider_59 = Slider(760000, range=0..1000000)
colrange_6 = LBColorRange(index=Slider(26, range=0..26))  # -> colors; plug-in component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
colrange_7 = LBColorRange(index=Slider(0, range=0..26))  # -> colors; plug-in component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
neg_4 = Negative(Value=Slider(100000, range=0..100000))

equals_45 = Equality(FirstNumber=current_selected_simulation_simple_energ_5, SecondNumber="-1")  # -> Equality, Inequality

# ----
# Calculate operational emissions
list_12 = ValueList({"Conservative": "conservative", "Typical": "typical"}, selected="Conservative")
panel_191 = Panel("kg CO2eq/year")

gate_56 = StreamGate(Stream=current_selected_simulation_simple_energ_5, Gate=equals_45.Inequality)  # -> Target0, Target1
item_44 = ListItem(List=current_all_simulations_simple_energy_3, Index=gate_56.Target1, Wrap=invert(True))  # -> simplify(Item)

shift = ShiftPaths(Data=item_44, Offset=-1)

# ---- group: Daylight Factor
# Daylight Factor [%]
number_slider_60 = Slider(0, range=0..2)  # disabled
falsestart_2 = LBFalseStartToggle(False)  # disabled
radpar_2 = HBRadianceParameter(recipe_type=number_slider_60, detail_level=detail_level_0_2)  # -> rad_par; disabled; plug-in component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
run_daylight_factor = Data(falsestart_2)  # disabled
panel_192 = Panel("Daylight Factor [%]")  # disabled
cluster_4 = Cluster_6()  # disabled

# ---- group: Analyse performance (continued)
item_45 = ListItem(List=simplify(rec_34), Index=item_38, Wrap=True)

# ----
shift_2 = ShiftPaths(Data=item_45, Offset=-1)

# ---- group: Analyse performance (continued)
panel_193 = Panel(shift_2)
bang_18 = ExplodeTree(Data=shift_2)  # -> Branch0, Branch1, Branch2, Branch3, Branch4, Branch5

xdata_2 = LBDeconstructData(data=bang_18.Branch2)  # -> header, values; plug-in component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
xdata_3 = LBDeconstructData(data=bang_18.Branch1)  # -> header, values; plug-in component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
xdata_4 = LBDeconstructData(data=bang_18.Branch3)  # -> header, values; plug-in component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
xdata_5 = LBDeconstructData(data=bang_18.Branch4)  # -> header, values; plug-in component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
xdata_6 = LBDeconstructData(data=bang_18.Branch5)  # -> header, values; plug-in component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
smaller_2 = SmallerThan(FirstNumber=xdata_4.values, SecondNumber="0")  # -> SmallerThan, OrEqualTo
smaller_3 = SmallerThan(FirstNumber=xdata_2.values, SecondNumber="0")  # -> SmallerThan, OrEqualTo
smaller_4 = SmallerThan(FirstNumber=xdata_3.values, SecondNumber="0")  # -> SmallerThan, OrEqualTo
smaller_5 = SmallerThan(FirstNumber=xdata_5.values, SecondNumber="0")  # -> SmallerThan, OrEqualTo
smaller_6 = SmallerThan(FirstNumber=xdata_6.values, SecondNumber="0")  # -> SmallerThan, OrEqualTo
sift_2 = SiftPattern(List=xdata_4.values, SiftPattern=smaller_2.OrEqualTo)  # -> Output0, Output1
sift_3 = SiftPattern(List=xdata_3.values, SiftPattern=smaller_4.OrEqualTo)  # -> Output0, Output1
sift_4 = SiftPattern(List=xdata_2.values, SiftPattern=smaller_3.OrEqualTo)  # -> Output0, Output1
sift_5 = SiftPattern(List=xdata_5.values, SiftPattern=smaller_5.OrEqualTo)  # -> Output0, Output1
sift_6 = SiftPattern(List=xdata_6.values, SiftPattern=smaller_6.OrEqualTo)  # -> Output0, Output1
flip_3 = FlipMatrix(Data=sift_4.Output0)
flip_4 = FlipMatrix(Data=sift_4.Output1)
flip_5 = FlipMatrix(Data=sift_2.Output0)
flip_6 = FlipMatrix(Data=sift_2.Output1)
flip_7 = FlipMatrix(Data=sift_6.Output0)
flip_8 = FlipMatrix(Data=sift_6.Output1)
flip_9 = FlipMatrix(Data=sift_3.Output0)
flip_10 = FlipMatrix(Data=sift_3.Output1)
flip_11 = FlipMatrix(Data=sift_5.Output0)
flip_12 = FlipMatrix(Data=sift_5.Output1)
ma_26 = MassAddition(Input=flip_4)  # -> Result, PartialResults
ma_27 = MassAddition(Input=flip_6)  # -> Result, PartialResults
ma_28 = MassAddition(Input=flip_3)  # -> Result, PartialResults
ma_29 = MassAddition(Input=flip_8)  # -> Result, PartialResults
ma_30 = MassAddition(Input=flip_10)  # -> Result, PartialResults
ma_31 = MassAddition(Input=flip_5)  # -> Result, PartialResults
ma_32 = MassAddition(Input=flip_12)  # -> Result, PartialResults
ma_33 = MassAddition(Input=flip_7)  # -> Result, PartialResults
ma_34 = MassAddition(Input=flip_9)  # -> Result, PartialResults
ma_35 = MassAddition(Input=flip_11)  # -> Result, PartialResults
extremes = MinMax(Number=flatten(ma_28.Result))  # -> Minimum, Maximum
extremes_2 = MinMax(Number=flatten(ma_26.Result))  # -> Minimum, Maximum
extremes_3 = MinMax(Number=flatten(ma_31.Result))  # -> Minimum, Maximum
extremes_4 = MinMax(Number=flatten(ma_27.Result))  # -> Minimum, Maximum
extremes_5 = MinMax(Number=flatten(ma_33.Result))  # -> Minimum, Maximum
extremes_6 = MinMax(Number=flatten(ma_34.Result))  # -> Minimum, Maximum
extremes_7 = MinMax(Number=flatten(ma_29.Result))  # -> Minimum, Maximum
extremes_8 = MinMax(Number=flatten(ma_30.Result))  # -> Minimum, Maximum
extremes_9 = MinMax(Number=flatten(ma_35.Result))  # -> Minimum, Maximum
extremes_10 = MinMax(Number=flatten(ma_32.Result))  # -> Minimum, Maximum
cooling_balance_min = RemoteSender(extremes_10.Minimum)
cooling_balance_max = RemoteSender(extremes_9.Maximum)
heating_balance_min = RemoteSender(extremes_7.Minimum)
daily_cooling_profile_min = RemoteSender(extremes_2.Minimum)
daily_heating_profile_min = RemoteSender(extremes_4.Minimum)
heating_balance_max = RemoteSender(extremes_5.Maximum)
annual_energy_balance_max = RemoteSender(extremes_6.Maximum)
daily_cooling_profile_max = RemoteSender(extremes.Maximum)
daily_heating_profile_max = RemoteSender(extremes_3.Maximum)
annual_energy_balance_min = RemoteSender(extremes_8.Minimum)

# ----
# Detailed data from energy simulation
data_52 = Data(flatten(bang_18.Branch1))

bang_19 = ExplodeTree(Data=shift)  # -> Branch0, Branch1, Branch2, Branch3, Branch4, Branch5

xdata_7 = LBDeconstructData(data=bang_19.Branch2)  # -> header, values; plug-in component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
xdata_8 = LBDeconstructData(data=bang_19.Branch1)  # -> header, values; plug-in component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
xdata_9 = LBDeconstructData(data=bang_19.Branch3)  # -> header, values; plug-in component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
xdata_10 = LBDeconstructData(data=bang_19.Branch4)  # -> header, values; plug-in component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
xdata_11 = LBDeconstructData(data=bang_19.Branch5)  # -> header, values; plug-in component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
smaller_7 = SmallerThan(FirstNumber=xdata_9.values, SecondNumber="0")  # -> SmallerThan, OrEqualTo
smaller_8 = SmallerThan(FirstNumber=xdata_7.values, SecondNumber="0")  # -> SmallerThan, OrEqualTo
smaller_9 = SmallerThan(FirstNumber=xdata_8.values, SecondNumber="0")  # -> SmallerThan, OrEqualTo
smaller_10 = SmallerThan(FirstNumber=xdata_10.values, SecondNumber="0")  # -> SmallerThan, OrEqualTo
smaller_11 = SmallerThan(FirstNumber=xdata_11.values, SecondNumber="0")  # -> SmallerThan, OrEqualTo
sift_7 = SiftPattern(List=xdata_9.values, SiftPattern=smaller_7.OrEqualTo)  # -> Output0, Output1
sift_8 = SiftPattern(List=xdata_8.values, SiftPattern=smaller_9.OrEqualTo)  # -> Output0, Output1
sift_9 = SiftPattern(List=xdata_7.values, SiftPattern=smaller_8.OrEqualTo)  # -> Output0, Output1
sift_10 = SiftPattern(List=xdata_10.values, SiftPattern=smaller_10.OrEqualTo)  # -> Output0, Output1
sift_11 = SiftPattern(List=xdata_11.values, SiftPattern=smaller_11.OrEqualTo)  # -> Output0, Output1
flip_13 = FlipMatrix(Data=sift_9.Output0)
flip_14 = FlipMatrix(Data=sift_9.Output1)
flip_15 = FlipMatrix(Data=sift_7.Output0)
flip_16 = FlipMatrix(Data=sift_7.Output1)
flip_17 = FlipMatrix(Data=sift_11.Output0)
flip_18 = FlipMatrix(Data=sift_11.Output1)
flip_19 = FlipMatrix(Data=sift_8.Output0)
flip_20 = FlipMatrix(Data=sift_8.Output1)
flip_21 = FlipMatrix(Data=sift_10.Output0)
flip_22 = FlipMatrix(Data=sift_10.Output1)
ma_36 = MassAddition(Input=flip_14)  # -> Result, PartialResults
ma_37 = MassAddition(Input=flip_16)  # -> Result, PartialResults
ma_38 = MassAddition(Input=flip_13)  # -> Result, PartialResults
ma_39 = MassAddition(Input=flip_18)  # -> Result, PartialResults
ma_40 = MassAddition(Input=flip_20)  # -> Result, PartialResults
ma_41 = MassAddition(Input=flip_15)  # -> Result, PartialResults
ma_42 = MassAddition(Input=flip_22)  # -> Result, PartialResults
ma_43 = MassAddition(Input=flip_17)  # -> Result, PartialResults
ma_44 = MassAddition(Input=flip_19)  # -> Result, PartialResults
ma_45 = MassAddition(Input=flip_21)  # -> Result, PartialResults
extremes_11 = MinMax(Number=flatten(ma_38.Result))  # -> Minimum, Maximum
extremes_12 = MinMax(Number=flatten(ma_36.Result))  # -> Minimum, Maximum
extremes_13 = MinMax(Number=flatten(ma_41.Result))  # -> Minimum, Maximum
extremes_14 = MinMax(Number=flatten(ma_37.Result))  # -> Minimum, Maximum
extremes_15 = MinMax(Number=flatten(ma_43.Result))  # -> Minimum, Maximum
extremes_16 = MinMax(Number=flatten(ma_44.Result))  # -> Minimum, Maximum
extremes_17 = MinMax(Number=flatten(ma_39.Result))  # -> Minimum, Maximum
extremes_18 = MinMax(Number=flatten(ma_40.Result))  # -> Minimum, Maximum
extremes_19 = MinMax(Number=flatten(ma_45.Result))  # -> Minimum, Maximum
extremes_20 = MinMax(Number=flatten(ma_42.Result))  # -> Minimum, Maximum
annual_energy_balance_max_compare = RemoteSender(extremes_16.Maximum)
cooling_balance_min_compare = RemoteSender(extremes_20.Minimum)
daily_heating_profile_min_compare = RemoteSender(extremes_14.Minimum)
cooling_balance_max_compare = RemoteSender(extremes_19.Maximum)
daily_cooling_profile_max_compare = RemoteSender(extremes_11.Maximum)
daily_cooling_profile_min_compare = RemoteSender(extremes_12.Minimum)
heating_balance_max_compare = RemoteSender(extremes_15.Maximum)
annual_energy_balance_min_compare = RemoteSender(extremes_18.Minimum)
daily_heating_profile_max_compare = RemoteSender(extremes_13.Maximum)
heating_balance_min_compare = RemoteSender(extremes_17.Minimum)

# ---- group: Simple energy balance
annual_energy_balance_min_compare_2 = RemoteReceiver(annual_energy_balance_min_compare)
annual_energy_balance_max_compare_2 = RemoteReceiver(annual_energy_balance_max_compare)
current_selected_simulation_simple_energ_6 = RemoteReceiver(current_selected_simulation_simple_energ_3)  # "current_selected_simulation_simple_energy_compare_title"
colrange_8 = LBColorRange(index=Slider(19, range=0..100))  # -> colors; plug-in component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
simple_energy_simulation_base_point_comp_2 = RemoteReceiver(simple_energy_simulation_base_point_comp)  # "simple_energy_simulation_base_point_compare"
cluster_5 = Cluster_5(x=annual_energy_balance_min_compare_2)
cluster_6 = Cluster_4(int=annual_energy_balance_max_compare_2)
simple_energy_simulation_height_4 = RemoteReceiver(simple_energy_simulation_height)
simple_energy_simulation_width_3 = RemoteReceiver(simple_energy_simulation_width)
legendpar_3 = LBLegendParameters(min=cluster_5, max=cluster_6, colors=colrange_8)  # -> leg_par; plug-in component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
monthlychart_4 = LBMonthlyChart(
    data=bang_19.Branch1,
    base_pt=simple_energy_simulation_base_point_comp_2,
    x_dim=simple_energy_simulation_width_3,
    y_dim=simple_energy_simulation_height_4,
    stack=Toggle(True),
    global_title=current_selected_simulation_simple_energ_6,
    legend_par=legendpar_3)  # -> report, data_mesh, data_lines, col_lines, legend, borders, labels, y_title, title, vis_set; plug-in component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
annual_energy_balance = Data(flatten([monthlychart_4.data_mesh, monthlychart_4.data_lines, monthlychart_4.col_lines, monthlychart_4.legend, monthlychart_4.borders, monthlychart_4.labels, monthlychart_4.y_title, monthlychart_4.title]))

# ----
daily_cooling_profile_max_compare_2 = RemoteReceiver(daily_cooling_profile_max_compare)
daily_cooling_profile_min_compare_2 = RemoteReceiver(daily_cooling_profile_min_compare)
daily_heating_profile_max_compare_2 = RemoteReceiver(daily_heating_profile_max_compare)
daily_heating_profile_min_compare_2 = RemoteReceiver(daily_heating_profile_min_compare)
cooling_balance_max_compare_2 = RemoteReceiver(cooling_balance_max_compare)
cooling_balance_min_compare_2 = RemoteReceiver(cooling_balance_min_compare)
heating_balance_max_compare_2 = RemoteReceiver(heating_balance_max_compare)
heating_balance_min_compare_2 = RemoteReceiver(heating_balance_min_compare)
cluster_7 = Cluster_4(int=heating_balance_max_compare_2)
cluster_8 = Cluster_5(x=daily_cooling_profile_min_compare_2)
cluster_9 = Cluster_4(int=daily_cooling_profile_max_compare_2)
cluster_10 = Cluster_4(int=cooling_balance_max_compare_2)
cluster_11 = Cluster_5(x=heating_balance_min_compare_2)
cluster_12 = Cluster_5(x=cooling_balance_min_compare_2)
cluster_13 = Cluster_5(x=daily_heating_profile_min_compare_2)
cluster_14 = Cluster_4(int=daily_heating_profile_max_compare_2)
legendpar_4 = LBLegendParameters(min=cluster_11, max=cluster_7)  # -> leg_par; plug-in component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
cluster_15 = Cluster_3(min=cluster_12, max=cluster_10, colors=colrange_7)
cluster_16 = Cluster_3(min=cluster_13, max=cluster_14, colors=colrange_6)
panel_194 = Panel(legendpar_3)

# ---- group: Simple peak loads
legendpar_5 = LBLegendParameters(min=cluster_8, max=cluster_9)  # -> leg_par; plug-in component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
current_selected_simulation_simple_energ_7 = RemoteReceiver(current_selected_simulation_simple_energ_3)  # "current_selected_simulation_simple_energy_compare_title"
current_selected_simulation_simple_energ_8 = RemoteReceiver(current_selected_simulation_simple_energ_3)  # "current_selected_simulation_simple_energy_compare_title"
current_selected_simulation_simple_energ_9 = RemoteReceiver(current_selected_simulation_simple_energ_3)  # "current_selected_simulation_simple_energy_compare_title"
current_selected_simulation_simple_energ_10 = RemoteReceiver(current_selected_simulation_simple_energ_3)  # "current_selected_simulation_simple_energy_compare_title"
simple_energy_simulation_base_point_comp_3 = RemoteReceiver(simple_energy_simulation_base_point_comp)  # "simple_energy_simulation_base_point_compare"
simple_energy_simulation_base_point_comp_4 = RemoteReceiver(simple_energy_simulation_base_point_comp)  # "simple_energy_simulation_base_point_compare"
simple_energy_simulation_base_point_comp_5 = RemoteReceiver(simple_energy_simulation_base_point_comp)  # "simple_energy_simulation_base_point_compare"
simple_energy_simulation_base_point_comp_6 = RemoteReceiver(simple_energy_simulation_base_point_comp)  # "simple_energy_simulation_base_point_compare"
simple_energy_simulation_height_5 = RemoteReceiver(simple_energy_simulation_height)
simple_energy_simulation_width_4 = RemoteReceiver(simple_energy_simulation_width)
simple_energy_simulation_height_6 = RemoteReceiver(simple_energy_simulation_height)
simple_energy_simulation_height_7 = RemoteReceiver(simple_energy_simulation_height)
simple_energy_simulation_width_5 = RemoteReceiver(simple_energy_simulation_width)
simple_energy_simulation_width_6 = RemoteReceiver(simple_energy_simulation_width)
simple_energy_simulation_height_8 = RemoteReceiver(simple_energy_simulation_height)
simple_energy_simulation_width_7 = RemoteReceiver(simple_energy_simulation_width)
toggle_11 = BooleanToggle(True)
toggle_12 = BooleanToggle(True)
toggle_13 = BooleanToggle(True)
toggle_14 = BooleanToggle(True)
monthlychart_5 = LBMonthlyChart(
    data=bang_19.Branch3,
    base_pt=simple_energy_simulation_base_point_comp_4,
    x_dim=simple_energy_simulation_width_5,
    y_dim=simple_energy_simulation_height_6,
    stack=toggle_11,
    time_marks=toggle_11,
    global_title=current_selected_simulation_simple_energ_8,
    legend_par=cluster_16)  # -> report, data_mesh, data_lines, col_lines, legend, borders, labels, y_title, title, vis_set; plug-in component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
monthlychart_6 = LBMonthlyChart(
    data=bang_19.Branch2,
    base_pt=simple_energy_simulation_base_point_comp_3,
    x_dim=simple_energy_simulation_width_4,
    y_dim=simple_energy_simulation_height_5,
    stack=toggle_12,
    time_marks=toggle_12,
    global_title=current_selected_simulation_simple_energ_10,
    legend_par=legendpar_5)  # -> report, data_mesh, data_lines, col_lines, legend, borders, labels, y_title, title, vis_set; plug-in component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
monthlychart_7 = LBMonthlyChart(
    data=bang_19.Branch4,
    base_pt=simple_energy_simulation_base_point_comp_5,
    x_dim=simple_energy_simulation_width_6,
    y_dim=simple_energy_simulation_height_7,
    stack=toggle_13,
    time_marks=toggle_13,
    global_title=current_selected_simulation_simple_energ_7,
    legend_par=cluster_15)  # -> report, data_mesh, data_lines, col_lines, legend, borders, labels, y_title, title, vis_set; plug-in component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
monthlychart_8 = LBMonthlyChart(
    data=bang_19.Branch5,
    base_pt=simple_energy_simulation_base_point_comp_6,
    x_dim=simple_energy_simulation_width_7,
    y_dim=simple_energy_simulation_height_8,
    stack=toggle_14,
    time_marks=toggle_14,
    global_title=current_selected_simulation_simple_energ_9,
    legend_par=legendpar_4)  # -> report, data_mesh, data_lines, col_lines, legend, borders, labels, y_title, title, vis_set; plug-in component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
daily_heating_profile = Data(flatten([monthlychart_5.data_mesh, monthlychart_5.data_lines, monthlychart_5.col_lines, monthlychart_5.legend, monthlychart_5.borders, monthlychart_5.labels, monthlychart_5.y_title, monthlychart_5.title]))
daily_cooling_profile = Data(flatten([monthlychart_6.data_mesh, monthlychart_6.data_lines, monthlychart_6.col_lines, monthlychart_6.legend, monthlychart_6.borders, monthlychart_6.labels, monthlychart_6.y_title, monthlychart_6.title]))
heating_balance_design_day = Data(flatten([monthlychart_8.data_mesh, monthlychart_8.data_lines, monthlychart_8.col_lines, monthlychart_8.legend, monthlychart_8.borders, monthlychart_8.labels, monthlychart_8.y_title, monthlychart_8.title]))
cooling_balance_design_day = Data(flatten([monthlychart_7.data_mesh, monthlychart_7.data_lines, monthlychart_7.col_lines, monthlychart_7.legend, monthlychart_7.borders, monthlychart_7.y_title, monthlychart_7.labels, monthlychart_7.title]))

# ----
daily_cooling_profile_2 = Data(flatten(annual_energy_balance))
daily_cooling_profile_3 = Data(flatten(daily_cooling_profile))
daily_cooling_profile_4 = Data(flatten(daily_heating_profile))
daily_cooling_profile_5 = Data(flatten(cooling_balance_design_day))
daily_cooling_profile_6 = Data(flatten(heating_balance_design_day))

# ---- group: Analyse performance (continued)
daily_heating_profile_max_2 = RemoteReceiver(daily_heating_profile_max)
daily_heating_profile_min_2 = RemoteReceiver(daily_heating_profile_min)
daily_cooling_profile_max_2 = RemoteReceiver(daily_cooling_profile_max)
daily_cooling_profile_min_2 = RemoteReceiver(daily_cooling_profile_min)
heating_balance_max_2 = RemoteReceiver(heating_balance_max)
heating_balance_min_2 = RemoteReceiver(heating_balance_min)
cooling_balance_max_2 = RemoteReceiver(cooling_balance_max)
cooling_balance_min_2 = RemoteReceiver(cooling_balance_min)
annual_energy_balance_max_2 = RemoteReceiver(annual_energy_balance_max)
annual_energy_balance_min_2 = RemoteReceiver(annual_energy_balance_min)
cluster_17 = Cluster_4(int=heating_balance_max_2)
cluster_18 = Cluster_5(x=daily_cooling_profile_min_2)
cluster_19 = Cluster_4(int=daily_cooling_profile_max_2)
cluster_20 = Cluster_4(int=cooling_balance_max_2)
cluster_21 = Cluster_5(x=heating_balance_min_2)
cluster_22 = Cluster_5(x=cooling_balance_min_2)
cluster_23 = Cluster_5(x=daily_heating_profile_min_2)
cluster_24 = Cluster_4(int=daily_heating_profile_max_2)
legendpar_6 = LBLegendParameters(min=cluster_21, max=cluster_17)  # -> leg_par; plug-in component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
cluster_25 = Cluster_3(min=cluster_22, max=cluster_20, colors=colrange_3)
cluster_26 = Cluster_3(min=cluster_23, max=cluster_24, colors=colrange_4)
cluster_27 = Cluster_4(int=annual_energy_balance_max_2)
cluster_28 = Cluster_5(x=annual_energy_balance_min_2)

# ---- group: Analyse performance / Simple energy balance
colrange_9 = LBColorRange(index=Slider(19, range=0..100))  # -> colors; plug-in component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
current_selected_simulation_simple_energ_11 = RemoteReceiver(current_selected_simulation_simple_energ_4)  # "current_selected_simulation_simple_energy_title"
legendpar_7 = LBLegendParameters(min=cluster_28, max=cluster_27, colors=colrange_9)  # -> leg_par; plug-in component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
monthlychart_9 = LBMonthlyChart(
    data=bang_18.Branch1,
    base_pt=simple_energy_simulation_base_point_2,
    x_dim=simple_energy_simulation_width_2,
    y_dim=simple_energy_simulation_height_3,
    stack=Toggle(True),
    global_title=current_selected_simulation_simple_energ_11,
    legend_par=legendpar_7)  # -> report, data_mesh, data_lines, col_lines, legend, borders, labels, y_title, title, vis_set; plug-in component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

# ---- group: Analyse performance / Simple peak loads
legendpar_8 = LBLegendParameters(min=cluster_18, max=cluster_19)  # -> leg_par; plug-in component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
current_selected_simulation_simple_energ_12 = RemoteReceiver(current_selected_simulation_simple_energ_4)  # "current_selected_simulation_simple_energy_title"
current_selected_simulation_simple_energ_13 = RemoteReceiver(current_selected_simulation_simple_energ_4)  # "current_selected_simulation_simple_energy_title"
current_selected_simulation_simple_energ_14 = RemoteReceiver(current_selected_simulation_simple_energ_4)  # "current_selected_simulation_simple_energy_title"
current_selected_simulation_simple_energ_15 = RemoteReceiver(current_selected_simulation_simple_energ_4)  # "current_selected_simulation_simple_energy_title"
simple_energy_simulation_base_point_3 = RemoteReceiver(simple_energy_simulation_base_point)
simple_energy_simulation_base_point_4 = RemoteReceiver(simple_energy_simulation_base_point)
simple_energy_simulation_base_point_5 = RemoteReceiver(simple_energy_simulation_base_point)
simple_energy_simulation_base_point_6 = RemoteReceiver(simple_energy_simulation_base_point)
simple_energy_simulation_height_9 = RemoteReceiver(simple_energy_simulation_height)
simple_energy_simulation_width_8 = RemoteReceiver(simple_energy_simulation_width)
simple_energy_simulation_height_10 = RemoteReceiver(simple_energy_simulation_height)
simple_energy_simulation_height_11 = RemoteReceiver(simple_energy_simulation_height)
simple_energy_simulation_width_9 = RemoteReceiver(simple_energy_simulation_width)
simple_energy_simulation_width_10 = RemoteReceiver(simple_energy_simulation_width)
simple_energy_simulation_height_12 = RemoteReceiver(simple_energy_simulation_height)
simple_energy_simulation_width_11 = RemoteReceiver(simple_energy_simulation_width)
toggle_15 = BooleanToggle(True)
toggle_16 = BooleanToggle(True)
toggle_17 = BooleanToggle(True)
toggle_18 = BooleanToggle(True)
monthlychart_10 = LBMonthlyChart(
    data=bang_18.Branch3,
    base_pt=simple_energy_simulation_base_point_4,
    x_dim=simple_energy_simulation_width_9,
    y_dim=simple_energy_simulation_height_10,
    stack=toggle_15,
    time_marks=toggle_15,
    global_title=current_selected_simulation_simple_energ_12,
    legend_par=cluster_26)  # -> report, data_mesh, data_lines, col_lines, legend, borders, labels, y_title, title, vis_set; plug-in component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
monthlychart_11 = LBMonthlyChart(
    data=bang_18.Branch2,
    base_pt=simple_energy_simulation_base_point_3,
    x_dim=simple_energy_simulation_width_8,
    y_dim=simple_energy_simulation_height_9,
    stack=toggle_16,
    time_marks=toggle_16,
    global_title=current_selected_simulation_simple_energ_15,
    legend_par=legendpar_8)  # -> report, data_mesh, data_lines, col_lines, legend, borders, labels, y_title, title, vis_set; plug-in component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
monthlychart_12 = LBMonthlyChart(
    data=bang_18.Branch4,
    base_pt=simple_energy_simulation_base_point_5,
    x_dim=simple_energy_simulation_width_10,
    y_dim=simple_energy_simulation_height_11,
    stack=toggle_18,
    time_marks=toggle_18,
    global_title=current_selected_simulation_simple_energ_14,
    legend_par=cluster_25)  # -> report, data_mesh, data_lines, col_lines, legend, borders, labels, y_title, title, vis_set; plug-in component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
monthlychart_13 = LBMonthlyChart(
    data=bang_18.Branch5,
    base_pt=simple_energy_simulation_base_point_6,
    x_dim=simple_energy_simulation_width_11,
    y_dim=simple_energy_simulation_height_12,
    stack=toggle_17,
    time_marks=toggle_17,
    global_title=current_selected_simulation_simple_energ_13,
    legend_par=legendpar_6)  # -> report, data_mesh, data_lines, col_lines, legend, borders, labels, y_title, title, vis_set; plug-in component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
daily_heating_profile_2 = Data(flatten([monthlychart_10.data_mesh, monthlychart_10.data_lines, monthlychart_10.col_lines, monthlychart_10.legend, monthlychart_10.borders, monthlychart_10.labels, monthlychart_10.y_title, monthlychart_10.title]))
daily_cooling_profile_7 = Data(flatten([monthlychart_11.data_mesh, monthlychart_11.data_lines, monthlychart_11.col_lines, monthlychart_11.legend, monthlychart_11.borders, monthlychart_11.labels, monthlychart_11.y_title, monthlychart_11.title]))
heating_balance_design_day_2 = Data(flatten([monthlychart_13.data_mesh, monthlychart_13.data_lines, monthlychart_13.col_lines, monthlychart_13.legend, monthlychart_13.borders, monthlychart_13.labels, monthlychart_13.y_title, monthlychart_13.title]))
cooling_balance_design_day_2 = Data(flatten([monthlychart_12.data_mesh, monthlychart_12.data_lines, monthlychart_12.col_lines, monthlychart_12.legend, monthlychart_12.borders, monthlychart_12.y_title, monthlychart_12.labels, monthlychart_12.title]))

# ---- group: Analyse performance (continued)
panel_195 = Panel(legendpar_7)
annual_energy_balance_2 = Data(flatten([monthlychart_9.data_mesh, monthlychart_9.data_lines, monthlychart_9.col_lines, monthlychart_9.legend, monthlychart_9.borders, monthlychart_9.labels, monthlychart_9.y_title, monthlychart_9.title]))

# ---- group: Spatial climate based daylight
panel_196 = Panel("-t 50 -lt 200 -ut 2000")
radpar_3 = HBRadianceParameter(recipe_type=Slider(2, range=0..2), detail_level=detail_level_0_2, additional_par="-ab 4")  # -> rad_par; plug-in component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
wea = HBWeaFromEPW(epw_file=downloadepw_4.epw_file)  # -> wea; plug-in component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
panel_197 = Panel(radpar_3)
analysis_mesh = Mesh(grid_mesh)
mjoin_2 = MeshJoin(Meshes=analysis_mesh)
cluster_29 = Cluster_6()
cluster_30 = Cluster_6()
cluster_31 = Cluster_6()
number_slider_61 = Slider(150, range=0..400)  # disabled
number_slider_62 = Slider(100, range=0..400)  # disabled
number_slider_63 = Slider(50, range=0..400)  # disabled
X_2 = UnitX(Factor=number_slider_61)  # disabled
X_3 = UnitX(Factor=number_slider_62)  # disabled
X_4 = UnitX(Factor=number_slider_63)  # disabled

# ----
honeybee_model_7 = Data(honeybee_model_5)
merge_18 = Merge(Data1=heatmap.mesh, Data2=heatmap.legend, Data3=heatmap.title)  # -> flatten(Result)
illuminance_lux = Data(merge_18)

# ---- group: Daylight Factor (continued)
daylightfactor = HBDaylightFactor(model=honeybee_model_7, radiance_par=radpar_2, run=run_daylight_factor)  # -> report, results; disabled; plug-in component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
median = GhPythonScript(list=daylightfactor.results)  # -> out, median; inputs list: list; disabled
# ---------- median: Python ----------
"""Provides a scripting component.
    Inputs:
        list: list of numeric values to retrieve median
    Output:
        median: median value in list

__author__ = "sawen"
__version__ = "2024.06.14"
"""

import statistics

def main(list):
    return statistics.median(list)

if __name__ == "__main__":
    if list:
        median = main(list)
# ---------- end median ----------
heatmap_2 = LBSpatialHeatmap(values=flatten(daylightfactor.results), legend_par=cluster_4, legend_title=panel_192)  # -> mesh, legend, title, colors, legend_par, vis_set; disabled; plug-in component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
daylight_factor = Data(flatten([heatmap_2.mesh, heatmap_2.legend, heatmap_2.title]))  # disabled

# ---- group: Spatial climate based daylight (continued)
annualdaylight = HBAnnualDaylight(
    model=honeybee_model_7,
    wea=wea,
    schedule="Generic Office Occupancy",
    radiance_par=radpar_3,
    run=run_annual_daylight_simulation)  # -> report, results, DA, cDA, UDI, UDI_low, UDI_up; plug-in component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
heatmap_3 = LBSpatialHeatmap(values=flatten(annualdaylight.UDI_up), mesh=mjoin_2, legend_par=cluster_30, legend_title="UDI >3000 [%]")  # -> mesh, legend, title, colors, legend_par, vis_set; plug-in component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
heatmap_4 = LBSpatialHeatmap(values=flatten(annualdaylight.UDI_low), mesh=mjoin_2, legend_par=cluster_29, legend_title="UDI <50 [%]")  # -> mesh, legend, title, colors, legend_par, vis_set; plug-in component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
heatmap_5 = LBSpatialHeatmap(values=flatten(annualdaylight.UDI), mesh=mjoin_2, legend_par=cluster_31, legend_title="UDI [%]")  # -> mesh, legend, title, colors, legend_par, vis_set; plug-in component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
sda = HBSpatialDaylightAutonomy(DA=flatten(annualdaylight.DA), mesh=mjoin_2)  # -> report, sDA, pass_fail; plug-in component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
heatmap_6 = LBSpatialHeatmap(values=flatten(annualdaylight.DA), mesh=mjoin_2, legend_par=cluster_3, legend_title="Daylight autonomy [%]")  # -> mesh, legend, title, colors, legend_par, vis_set; plug-in component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
panel_198 = Panel(sda.sDA)

# ---- group: Extract hourly data from annual results
facen = FaceNormals(Mesh=mjoin_2)  # -> Centers, Normals; disabled
pt_20 = Point(facen.Centers)  # disabled
number_slider_64 = Slider(581, range=0..1000)  # disabled
flatten = FlattenTree(Tree=pt_20, Path="{0}")  # disabled
item_46 = ListItem(List=flatten, Index=number_slider_64, Wrap=True)  # disabled
number_slider_65 = Slider(3000, range=0..3000)  # disabled
number_slider_66 = Slider(0.1, range=0..0.1)  # disabled
annualtodata = HBAnnualResultsToData(results=flatten(annualdaylight.results), sel_pts=flatten(item_46), all_pts=pt_20)  # -> report, data; disabled; plug-in component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
legendpar_9 = LBLegendParameters(max=number_slider_65)  # -> leg_par; disabled; plug-in component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
multiplication_4 = Multiplication(A=number_slider_66, B=4)  # disabled
pt_21 = Point(Point(0, 35, 0))  # disabled
sph = Sphere(Base=item_46, Radius=number_slider_52)  # disabled

# ----
udi_50 = Data(flatten([heatmap_4.mesh, heatmap_4.legend, heatmap_4.title]))
udi_3000 = Data(flatten([heatmap_3.mesh, heatmap_3.legend, heatmap_3.title]))
udi = Data(flatten([heatmap_5.mesh, heatmap_5.legend, heatmap_5.title]))
daylight_autonomy = Data(flatten([heatmap_6.mesh, heatmap_6.legend, heatmap_6.title]))
hourlyplot_2 = LBHourlyPlot(data=annualtodata.data, base_pt=pt_21, x_dim=number_slider_66, y_dim=multiplication_4, legend_par=legendpar_9)  # -> report, mesh, legend, borders, labels, title, vis_set; disabled; plug-in component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
move_2 = Move(Geometry=daylight_autonomy, Motion=X)  # -> Geometry, Transform; disabled
spatial_daylight_autonomy = Data(sda.sDA)

# ---- group: Spatial climate based daylight (continued)
move_3 = Move(Geometry=udi_3000, Motion=X_2)  # -> Geometry, Transform; disabled
move_4 = Move(Geometry=udi_50, Motion=X_3)  # -> Geometry, Transform; disabled
move_5 = Move(Geometry=udi, Motion=X_4)  # -> Geometry, Transform; disabled
merge_19 = Merge(Data1=move_2.Geometry, Data2=move_5.Geometry, Data3=move_4.Geometry, Data4=move_3.Geometry)  # disabled

# ---- group: Extract hourly data from annual results (continued)
merge_20 = Merge(Data1=sph, Data2=hourlyplot_2.mesh, Data3=hourlyplot_2.legend, Data4=hourlyplot_2.labels)  # -> flatten(Result); disabled

# ----
hourly_results_in_one_point = Data(merge_20)  # disabled
data_53 = Data(merge_19)  # disabled

run_daylight_simulations_3 = RemoteReceiver(run_daylight_simulations)
data_54 = Data(spatial_daylight_autonomy)
data_55 = Data(illuminance_lux)
data_56 = Data(daylight_autonomy)
data_57 = Data(udi)
data_58 = Data(udi_50)
data_59 = Data(udi_3000)
current_model_name_3 = RemoteReceiver(current_model_name)
entwine_151 = Entwine(
    Branch00=data_54,
    Branch01=data_55,
    Branch02=data_56,
    Branch03=data_57,
    Branch04=data_58,
    Branch05=data_59,
    FlattenInputs=True)
current_selected_simulation_daylight_2 = RemoteReceiver(current_selected_simulation_daylight)
freeze_gate_74 = StreamFreezeGate(Data=current_model_name_3, PassingSwitch=run_daylight_simulations_3, Freeze=True, Hold=False)
freeze_gate_75 = StreamFreezeGate(Data=entwine_151, PassingSwitch=run_daylight_simulations_3, Hold=True)
rec_37 = DataRecorder(graft(freeze_gate_75), DataLimit=-10, RecordData=True)
rec_38 = DataRecorder(freeze_gate_74, DataLimit=-10, RecordData=True)
fragment_5 = TextFragment(Text=freeze_gate_74, Start="7")
item_47 = ListItem(List=rec_37, Index=current_selected_simulation_daylight_2, Wrap=True)
current_all_simulation_models_daylight = RemoteSender(rec_38)
current_all_simulations_daylight = RemoteSender(rec_37)
shfdep_2 = ShiftToDepth(Tree=item_47, Depth="2", shiftFromStart=False)
daylight_simulation_type_3 = RemoteReceiver(daylight_simulation_type)
bang_20 = ExplodeTree(Data=shfdep_2)  # -> Branch0, Branch1, Branch2, Branch3, Branch4, Branch5
data_60 = Data(bang_20.Branch1)
data_61 = Data(bang_20.Branch2)
data_62 = Data(bang_20.Branch3)
data_63 = Data(bang_20.Branch4)
data_64 = Data(bang_20.Branch0)
data_65 = Data(bang_20.Branch5)
annualdaylight_message_error_3 = RemoteReceiver(annualdaylight_message_error)
pitgrid_message_error_3 = RemoteReceiver(pitgrid_message_error)
round = Round(Number=data_64)  # -> Nearest, Floor, Ceiling
spatialdaylightautonomy = RemoteSender(data_64)
filter_83 = StreamFilter(Gate=daylight_simulation_type_3, Stream0=data_60, Stream1=data_61, Stream2=data_62, Stream3=data_63, Stream4=data_65)
bool_63 = Boolean(round.Ceiling)
current_tab_32 = RemoteReceiver(current_tab)
lng_45 = ListLength(List=pitgrid_message_error_3)
lng_46 = ListLength(List=annualdaylight_message_error_3)
hasdata_19 = DataExists(Data=bool_63)
filter_84 = StreamFilter(Gate=hasdata_19, Stream0="False", Stream1=bool_63)
expression_81 = Expression(x="Analysis module", y=current_tab_32, Expression="x=y")
or_33 = GateOr(A=lng_45, B=lng_46)
and_41 = GateAnd(A=expression_81, B=daylight_expander_is_open_2, C=filter_84)
and_42 = GateAnd(A=filter_84, B=invert(or_33))
gate_57 = StreamGate(Stream=filter_83, Gate=and_41)  # -> Target0, Target1
daylight_data_exists = RemoteSender(and_42)
data_66 = Data(gate_57.Target1)
bbox_3 = BoundingBox(Content=data_66, Plane=PlaneXY(0, 0, 0), UnionBox=True)  # -> Box, Box_2
zoom_daylight_simulation_bounding_box = RemoteSender(bbox_3.Box)

daylight_data_exists_2 = RemoteReceiver(daylight_data_exists)
and_43 = GateAnd(A=equals_15.Inequality, B=daylight_data_exists_2, C=expression_35, D=daylight_expander_is_open_3)
or_34 = GateOr(
    A=preview_7,
    B=room_attribute_visualize_4,
    C=room_energy_attribute_visualize_3,
    D=face_attribute_visualize_4,
    E=face_energy_attribute_visualize_3,
    F=show_honeybee_walls_2,
    G=show_honeybee_roof_2,
    H=show_honeybee_floors_2,
    I=show_honeybee_ground_2,
    J=show_honeybee_windows_2,
    K=show_honeybee_doors_2,
    L=show_honeybee_context_2,
    M=weather_visualisation_wireframe_2,
    N=and_43)
filter_85 = StreamFilter(Gate=or_34, Stream0="Shaded", Stream1="Wireframe")
mod_viewport = ModifyViewport(DisplayMode=filter_85, AnimateRestore=False, RestoreFrames=10)

current_all_simulations_daylight_2 = RemoteReceiver(current_all_simulations_daylight)
current_all_simulation_models_daylight_2 = RemoteReceiver(current_all_simulation_models_daylight)
lng_47 = ListLength(List=current_all_simulations_daylight_2)  # -> flatten(Length)
daylight_data_exists_3 = RemoteReceiver(daylight_data_exists)
item_48 = ListItem(List=lng_47, Index=0, Wrap=True)
series = Series(Start="1", Step=1, Count=item_48)
hideshow_57 = HideShowElement(ElementToHideShow=button_3, Show=daylight_data_exists_3, Collapse=True, Disable=False)
format_28 = Format(Format="{0}: {1}", Culture=127, Data0=series, Data1=current_all_simulation_models_daylight_2)
subtraction_12 = Subtraction(A=item_48, B="1")
setlist_9 = SetListContents(ListToModify=pulldown_4, NewListContents=format_28, SelectedIndex=subtraction_12)
current_all_simulations_daylight_3 = RemoteReceiver(current_all_simulations_daylight)
hasdata_20 = DataExists(Data=current_all_simulations_daylight_3)
hideshow_58 = HideShowElement(ElementToHideShow=pulldown_4, Show=hasdata_20, Collapse=True, Disable=False)

# ----
# Zoom daylight simulation
zoom_daylight_simulation_bounding_box_2 = RemoteReceiver(zoom_daylight_simulation_bounding_box)
zoom_daylight_simulation_2 = RemoteReceiver(zoom_daylight_simulation)
zbb_3 = ZoomBoundingBox(Box=zoom_daylight_simulation_bounding_box_2, Run=zoom_daylight_simulation_2)
panel_199 = Panel(zoom_daylight_simulation_2)

# ----
# Bake daylight simulation
panel_200 = Panel("""Heath::Daylight simulation::Illuminance [Lux]
Heath::Daylight simulation::Daylight autonomy [%]
Heath::Daylight simulation::UDI [%]
Heath::Daylight simulation::UDI <50 [%]
Heath::Daylight simulation::UDI >3000 [%]""")
bake_daylight_simulation_2 = RemoteReceiver(bake_daylight_simulation)
daylight_simulation_type_4 = RemoteReceiver(daylight_simulation_type)
daylight_simulation = Data(data_66)
item_49 = ListItem(List=panel_200, Index=daylight_simulation_type_4, Wrap=invert(True))
gate_58 = StreamGate(Stream=item_49, Gate=bake_daylight_simulation_2)  # -> Target0, Target1
layers = CreateModifyLayers(LayerName=gate_58.Target1, DeleteLayer=False, enableFullPath=True)  # -> LayerNames, LayerFullPath
createatts = CreateAttributes(LayerName=layers.LayerFullPath, enableFullPath=True)
connected_2 = GetConnectedObjects(Objects=daylight_simulation)
bake_4 = BakeObject(Objects=connected_2, ObjectAttributes=createatts, Bake=bake_daylight_simulation_2)

# ---- group: Analysis module (continued)
spatialdaylightautonomy_2 = RemoteReceiver(spatialdaylightautonomy)
expression_82 = Expression(x=spatialdaylightautonomy_2, Expression="Round(x*100, 1)")
daylight_data_exists_4 = RemoteReceiver(daylight_data_exists)
format_29 = Format(Format=panel_73, Culture=127, Data0=expression_82)
daylight_data_exists_5 = RemoteReceiver(daylight_data_exists)
or_35 = GateOr(A=daylight_data_exists_4, B=filter_14)
rec_39 = DataRecorder(or_35, DataLimit=-10, RecordData=True)
settextblock_16 = SetTextBlockContents(TextBlockToModify=tb_7, NewTextBlockContents=format_29)
hideshow_59 = HideShowElement(ElementToHideShow=button_25, Show=daylight_data_exists_5, Collapse=True, Disable=False)
ma_46 = MassAddition(Input=flatten(rec_39))  # -> Result, PartialResults
daylight_data_exists_6 = RemoteReceiver(daylight_data_exists)
mod_3 = Modulus(A=ma_46.Result, B=Slider(2, range=0..10))
daylight_data_exists_7 = RemoteReceiver(daylight_data_exists)
daylight_data_exists_8 = RemoteReceiver(daylight_data_exists)
hideshow_60 = HideShowElement(ElementToHideShow=[pulldown_25, label_29], Show=daylight_data_exists_6, Collapse=True, Disable=False)
bool_64 = Boolean(mod_3)
filter_86 = StreamFilter(Gate=bool_64, Stream0="Simulation failed...", Stream1="Daylight simulation is running...")
hideshow_61 = HideShowElement(ElementToHideShow=tb_7, Show=daylight_data_exists_7, Collapse=True, Disable=False)
bool_65 = Boolean(invert(daylight_data_exists_8))
gate_59 = StreamGate(Stream=filter_86, Gate=freeze_gate_17)  # -> Target0, Target1
hideshow_62 = HideShowElement(ElementToHideShow=tb_10, Show=bool_65, Collapse=daylight_data_exists_8, Disable=False)
settextblock_17 = SetTextBlockContents(TextBlockToModify=tb_10, NewTextBlockContents=gate_59.Target1)

# ----
run_detailed_energy_simulations_3 = RemoteReceiver(run_detailed_energy_simulations)  # disabled
entwine_152 = Entwine(
    Branch00=annual_hourly_energy_results_2,
    Branch01=monthly_energy_balance_2,
    Branch02=energy_use_intensity_2,
    Branch03=energy_use_intensity_per_end_use_2,
    Branch04=end_uses_2,
    Branch05=peak_cooling_3,
    Branch06=peak_cooling_2,
    Branch07=peak_heating_2,
    Branch08=cooling_load_profile_2,
    Branch09=heating_load_profile_2,
    FlattenInputs=True)  # disabled
panel_201 = Panel(entwine_152)  # disabled
detailed_energy_simulation_type_2 = RemoteReceiver(detailed_energy_simulation_type)  # disabled
panel_202 = Panel("Analysis module")  # disabled
current_tab_33 = RemoteReceiver(current_tab)  # disabled
expression_83 = Expression(x=panel_202, y=current_tab_33, Expression="x=y")  # disabled
panel_203 = Panel("False")  # disabled

# ----
# Here is the data stored from the simulation
freeze_gate_76 = StreamFreezeGate(Data=entwine_152, PassingSwitch=run_detailed_energy_simulations_3, Hold=True)  # disabled
bang_21 = ExplodeTree(Data=freeze_gate_76)  # -> Branch0, Branch1, Branch2, Branch3, Branch4, Branch5, Branch6, Branch7, Branch8, Branch9; disabled
peak_heating_3 = Data(bang_21.Branch7)  # disabled
zone_names_2 = Data(bang_21.Branch5)  # disabled
peak_cooling_4 = Data(bang_21.Branch6)  # disabled
annual_hourly_energy_results_3 = Data(bang_21.Branch0)  # disabled
monthly_energy_balance_3 = Data(bang_21.Branch1)  # disabled
cooling_load_profile_3 = Data(bang_21.Branch8)  # disabled
heating_load_profile_3 = Data(bang_21.Branch9)  # disabled
energy_use_intensity_per_end_use_3 = Data(bang_21.Branch3)  # disabled
end_uses_3 = Data(bang_21.Branch4)  # disabled
energy_use_intensity_3 = Data(bang_21.Branch2)  # disabled

filter_87 = StreamFilter(
    Gate=detailed_energy_simulation_type_2,
    Stream0=annual_hourly_energy_results_3,
    Stream1=monthly_energy_balance_3,
    Stream2=cooling_load_profile_3,
    Stream3=heating_load_profile_3)  # disabled
hasdata_21 = DataExists(Data=energy_use_intensity_3)  # disabled
filter_88 = StreamFilter(Gate=hasdata_21, Stream0=panel_203, Stream1=energy_use_intensity_3)  # disabled
gate_60 = StreamGate(Stream=filter_87, Gate=expression_83)  # -> Target0, Target1; disabled
detailed_energy_data_exists = RemoteSender(filter_88)  # disabled
data_67 = Data(gate_60.Target1)  # disabled
bbox_4 = BoundingBox(Content=data_67, Plane=PlaneXY(0, 0, 0), UnionBox=True)  # -> Box, Box_2; disabled
zoom_detailed_energy_simulation_bounding = RemoteSender(bbox_4.Box)  # "zoom_detailed_energy_simulation_bounding_box"; disabled

# ----
# Zoom detailed energy
zoom_detailed_energy_simulation_bounding_2 = RemoteReceiver(zoom_detailed_energy_simulation_bounding)  # "zoom_detailed_energy_simulation_bounding_box"; disabled
zoom_detailed_energy_simulation_2 = RemoteReceiver(zoom_detailed_energy_simulation)  # disabled
zbb_4 = ZoomBoundingBox(Box=zoom_detailed_energy_simulation_bounding_2, Run=zoom_detailed_energy_simulation_2)  # disabled
panel_204 = Panel("Top")  # disabled

# ---- group: Analysis module (continued)
detailed_energy_data_exists_2 = RemoteReceiver(detailed_energy_data_exists)
detailed_energy_data_exists_3 = RemoteReceiver(detailed_energy_data_exists)
detailed_energy_data_exists_4 = RemoteReceiver(detailed_energy_data_exists)
or_36 = GateOr(A=detailed_energy_data_exists_2, B=filter_12)
rec_40 = DataRecorder(or_36, DataLimit=-10, RecordData=True)
hideshow_63 = HideShowElement(ElementToHideShow=true_button_9, Show=detailed_energy_data_exists_3, Collapse=True, Disable=False)
hideshow_64 = HideShowElement(ElementToHideShow=button_27, Show=detailed_energy_data_exists_4, Collapse=True, Disable=False)
ma_47 = MassAddition(Input=flatten(rec_40))  # -> Result, PartialResults
mod_4 = Modulus(A=ma_47.Result, B=Slider(2, range=0..10))
bool_66 = Boolean(mod_4)
detailed_energy_data_exists_5 = RemoteReceiver(detailed_energy_data_exists)
detailed_energy_data_exists_6 = RemoteReceiver(detailed_energy_data_exists)
filter_89 = StreamFilter(Gate=bool_66, Stream0="Simulation failed...", Stream1="Daylight simulation is running...")
gate_61 = StreamGate(Stream=filter_89, Gate=freeze_gate_15)  # -> Target0, Target1
bool_67 = Boolean(invert(detailed_energy_data_exists_5))
hideshow_65 = HideShowElement(ElementToHideShow=stack_49, Show=detailed_energy_data_exists_6, Collapse=True, Disable=False)
settextblock_18 = SetTextBlockContents(TextBlockToModify=tb_6, NewTextBlockContents=gate_61.Target1)
hideshow_66 = HideShowElement(ElementToHideShow=tb_6, Show=bool_67, Collapse=detailed_energy_data_exists_5, Disable=False)

# ----
simple_energy_simulation_type_2 = RemoteReceiver(simple_energy_simulation_type)
daily_cooling_profile_8 = Data(flatten(annual_energy_balance_2))
daily_cooling_profile_9 = Data(flatten(daily_heating_profile_2))
daily_cooling_profile_10 = Data(flatten(daily_cooling_profile_7))
daily_cooling_profile_11 = Data(flatten(cooling_balance_design_day_2))
daily_cooling_profile_12 = Data(flatten(heating_balance_design_day_2))
data_68 = Data(flatten(bang_18.Branch0))
annualloads_message_error_3 = RemoteReceiver(annualloads_message_error)
peakloads_message_error_3 = RemoteReceiver(peakloads_message_error)
ma_48 = MassAddition(Input=data_68)  # -> Result, PartialResults
total_load_eui_2 = RemoteSender(data_68)
simple_energy_expander_is_open_2 = RemoteReceiver(simple_energy_expander_is_open)
bool_68 = Boolean(ma_48.Result)
current_tab_34 = RemoteReceiver(current_tab)
null_44 = NullItem(Item=bool_68)  # -> NullFlags, InvalidFlags, Description
filter_90 = StreamFilter(Gate=null_44.NullFlags, Stream0=bool_68, Stream1="False")
expression_84 = Expression(x="Analysis module", y=current_tab_34, Expression="x=y")

total_load_eui_3 = RemoteReceiver(total_load_eui_2)
entwine_153 = Entwine(Branch00=daily_cooling_profile_4, Branch01=daily_cooling_profile_9, FlattenInputs=True)  # -> flatten(Result)
entwine_154 = Entwine(Branch00=daily_cooling_profile_2, Branch01=daily_cooling_profile_8, FlattenInputs=True)  # -> flatten(Result)
entwine_155 = Entwine(Branch00=daily_cooling_profile_3, Branch01=daily_cooling_profile_10, FlattenInputs=True)  # -> flatten(Result)
entwine_156 = Entwine(Branch00=daily_cooling_profile_5, Branch01=daily_cooling_profile_11, FlattenInputs=True)  # -> flatten(Result)
entwine_157 = Entwine(Branch00=daily_cooling_profile_6, Branch01=daily_cooling_profile_12, FlattenInputs=True)  # -> flatten(Result)
lng_48 = ListLength(List=annualloads_message_error_3)
lng_49 = ListLength(List=peakloads_message_error_3)
and_44 = GateAnd(A=expression_84, B=simple_energy_data_exists_3, C=simple_energy_expander_is_open_2)

filter_91 = StreamFilter(
    Gate=simple_energy_simulation_type_2,
    Stream0=entwine_154,
    Stream1=entwine_155,
    Stream2=entwine_153,
    Stream3=entwine_156,
    Stream4=entwine_157)
sortbytype_2 = SortObjectsByType(RhinoObjects=filter_91)  # -> Points, Curves, Surfaces, Breps, Meshes, TextObjects, HatchObjects, LightObjects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
or_37 = GateOr(A=lng_48, B=lng_49)
line_2 = Line(sortbytype_2.Curves)
null_45 = NullItem(Item=line_2)  # -> NullFlags, InvalidFlags, Description
data_69 = Data([sortbytype_2.Other, sortbytype_2.Meshes])
bbox_5 = BoundingBox(Content=sortbytype_2.Meshes, Plane=PlaneXY(0, 0, 0), UnionBox=True)  # -> Box, Box_2
sift_12 = SiftPattern(List=sortbytype_2.Curves, SiftPattern=null_45.NullFlags)  # -> Output0, Output1
gate_62 = StreamGate(Stream=sift_12.Output1, Gate=and_44)  # -> Target0, Target1
gate_63 = StreamGate(Stream=data_69, Gate=and_44)  # -> Target0, Target1
gate_64 = StreamGate(Stream=bbox_5.Box, Gate=and_44)  # -> Target0, Target1
zoom_simple_energy_simulation_bounding_b = RemoteSender(gate_64.Target1)  # "zoom_simple_energy_simulation_bounding_box"
clean_7 = CleanTree(RemoveNulls=True, RemoveInvalid=True, RemoveEmpty=False, Tree=gate_63.Target1)
data_70 = Data(gate_63.Target1)
indices = ListIndices(Data=gate_63.Target1)
index = ItemIndex(List=gate_63.Target1, Item=clean_7)
preview_18 = CustomPreview(Geometry=gate_62.Target1, Material=ColourSwatch(SwatchColor=RGB(84, 84, 84)))
exdiff = SetDifferenceS(SetA=indices, SetB=index)
item_50 = ListItem(List=gate_63.Target1, Index=exdiff, Wrap=True)
rebmsh = RebuildMesh(
    Mesh=item_50,
    RebuildNormals=False,
    CullUnused=invert(False),
    UnifyNormals=False,
    FlipNormals=False,
    IdenticalCombine=False,
    WeldVertices=0)
clean_8 = CleanTree(RemoveNulls=True, RemoveInvalid=True, RemoveEmpty=False, Tree=rebmsh)

and_45 = GateAnd(A=invert(or_37), B=filter_90)

# ----
# Bake simple energy simulation
panel_205 = Panel("""Heath::Energy simulation::Annual energy balance
Heath::Energy simulation::Daily cooling profile
Heath::Energy simulation::Daily heating profile
Heath::Energy simulation::Cooling balance
Heath::Energy simulation::Heating balance""")
simple_energy_simulation_type_3 = RemoteReceiver(simple_energy_simulation_type)
merge_21 = Merge(Data1=clean_7, Data2=clean_8)
bake_simple_energy_simulation_2 = RemoteReceiver(bake_simple_energy_simulation)
simple_energy_simulation_annual_energy_b = Data(merge_21)  # "simple_energy_simulation_Annual_energy_balance"
item_51 = ListItem(List=panel_205, Index=simple_energy_simulation_type_3, Wrap=invert(True))
gate_65 = StreamGate(Stream=item_51, Gate=bake_simple_energy_simulation_2)  # -> Target0, Target1
layers_2 = CreateModifyLayers(LayerName=gate_65.Target1, DeleteLayer=False, enableFullPath=True)  # -> LayerNames, LayerFullPath
createatts_2 = CreateAttributes(LayerName=layers_2.LayerFullPath, enableFullPath=True)
connected_3 = GetConnectedObjects(Objects=simple_energy_simulation_annual_energy_b)
bake_5 = BakeObject(Objects=connected_3, ObjectAttributes=createatts_2, Bake=bake_simple_energy_simulation_2)

# ----
# Zoom simple energy
zoom_simple_energy_simulation_bounding_b_2 = RemoteReceiver(zoom_simple_energy_simulation_bounding_b)  # "zoom_simple_energy_simulation_bounding_box"
zoom_simple_energy_simulation_2 = RemoteReceiver(zoom_simple_energy_simulation)
zbb_5 = ZoomBoundingBox(Box=zoom_simple_energy_simulation_bounding_b_2, Run=zoom_simple_energy_simulation_2)
panel_206 = Panel(zoom_simple_energy_simulation_2)

# ---- group: Analysis module (continued)
total_load_eui_4 = RemoteReceiver(total_load_eui_2)
ma_49 = MassAddition(Input=total_load_eui_4)  # -> Result, PartialResults
expression_85 = Expression(x=ma_49.Result, Expression="Round(x, 1)")
format_30 = Format(Format=panel_74, Culture=127, Data0=expression_85)
settextblock_19 = SetTextBlockContents(TextBlockToModify=tb_9, NewTextBlockContents=format_30)

# ----
energy_use_intensity_kwh_m2 = Data(total_load_eui_3)

calculate_operational_emissions = BrimstoneCalculateOperationalEmissions(lca_data=get_lca_data.lca_data, eui=energy_use_intensity_kwh_m2, area=area_m2, mode=list_12)  # -> out, gwp_total; inputs lca_data: tree
# ---------- calculate_operational_emissions: Python ----------
"""Calculates operational emissions based on energy resource, EUI and floor area
    Inputs:
        lca_data: tree containing GWP information for the selected resource
        eui: energy use intensity of building in kWh/m2
        gfa: gross floor area of building
        mode: mode of GWP calculation ("typical" or "conservative")
        
    Output:
        gwp_total: total GWP for the selected space"""

import scriptcontext
import brimstone
reload(brimstone)
ghenv.Component.Message = brimstone.globals.version

ghenv.Component.Name = 'Brimstone - Calculate Operational Emissions'
ghenv.Component.NickName = 'Calculate Operational Emissions'

import rhinoscriptsyntax as rs
import ghpythonlib.treehelpers as th

from collections import OrderedDict

inv_unit_string = 'kWh'
gwp_unit_string = 'kg CO2 eq./kWh' # GWP

def main(lca_data, eui, area, mode):
    if not lca_data.BranchCount:
        brimstone.utils.warn(ghenv, "LCA data is missing")
        return
    if eui != 0 and not eui:
        brimstone.utils.warn(ghenv, "EUI is missing")
        return
    if area != 0 and not area:
        brimstone.utils.warn(ghenv, "Area is missing")
        return
    
    lca_data = th.tree_to_list(lca_data)
    lca_data = [OrderedDict(zip(l[0], l[1])) for l in lca_data]
    gwp_total =  []
    
    for resource_lca_data in lca_data:
        try:
            gwp_total.append(calculate_gwp_total(resource_lca_data, eui, area, mode))
        except KeyError as e:
            raise Exception("GWP value could not be calculated: {error}".format(error = e))
    
    return gwp_total
    
def calculate_gwp_total(lca_data, eui, area, mode):    
    inv_unit = lca_data["InventoryUnit"]
    
    if inv_unit != inv_unit_string:
        raise Exception("Wrong unit for calculation of operational energy")    
    
    gwp_unit = lca_data["GWPUnit"]
    if gwp_unit != gwp_unit_string:
        raise Exception("Wrong unit for GWP calculation")
    
    if mode == "conservative":
        gwp_a1_a3_str = "GWPA1A3Conservative"
    elif mode == "typical":
        gwp_a1_a3_str = "GWPA1A3Typical"
    else:
        raise Exception("Mode not recognised (must be conservative or typical)")
    
    gwp_impact = (
        float(lca_data[gwp_a1_a3_str])
    )
    
    gwp_total = (
        float(lca_data[gwp_a1_a3_str])
    ) * area * eui
        
    return gwp_total

if __name__ == "__main__":
    if not scriptcontext.sticky["brimstone_flying"]:
        raise Exception("The 'Brimstone - Fly' component needs to exist on the canvas")   
    gwp_total = main(lca_data, eui, area, mode)
    gwp_total = th.list_to_tree(gwp_total)
# ---------- end calculate_operational_emissions ----------
operational_gwp_total_kg_co2eq_year = Data(calculate_operational_emissions.gwp_total)
panel_207 = Panel(operational_gwp_total_kg_co2eq_year)

panel_208 = Panel(operational_gwp_total_kg_co2eq_year)

ma_50 = MassAddition(Input=panel_207)  # -> Result, PartialResults

multiplication_5 = Multiplication(A=Slider(50, range=0..100), B=ma_50.Result)
lca_operational_gwp_total = RemoteSender(ma_50.Result)

# ---- group: Analysis module (continued)
lca_operational_gwp_total_2 = RemoteReceiver(lca_operational_gwp_total)
lca_operational_gwp_total_3 = RemoteReceiver(lca_operational_gwp_total)
multiplication_6 = Multiplication(A=lca_operational_gwp_total_2, B=number_slider_28)
expression_86 = Expression(x=multiplication_6, Expression="Round(x, 2)")
expression_87 = Expression(x=lca_operational_gwp_total_3, Expression="Round(x, 2)")
format_31 = Format(Format=panel_80, Culture=127, Data0=expression_87)
format_32 = Format(Format=panel_81, Culture=127, Data0=number_slider_28, Data1=expression_86)
setlabel_6 = SetLabelContents(LabelToModify=label_34, NewLabelContents=format_31)
setlabel_7 = SetLabelContents(LabelToModify=label_35, NewLabelContents=format_32)

# ----
lca_operational_gwp_total_4 = RemoteReceiver(lca_operational_gwp_total)
entwine_158 = Entwine(
    Branch00=lca_element_types_3,
    Branch01=lca_gwp_by_element_type_3,
    Branch02=lca_total_gwp_5,
    Branch03=lca_operational_gwp_total_4,
    FlattenInputs=True)  # -> flatten(Result)
hasdata_22 = DataExists(Data=entwine_158)
filter_92 = StreamFilter(Gate=hasdata_22, Stream0="False", Stream1=entwine_158)
lng_50 = ListLength(List=filter_92)
and_46 = GateAnd(A=honeybee_model_exists_9, B=lng_50)
and_47 = GateAnd(A=invert(lng_41), B=and_46)

created_constructions_database = RemoteReceiver(created_constructions_database_2)
decnstrconstr_3 = HBDeconstructConstruction(constr=created_constructions_database)  # -> name, materials, layers, r_val_si, r_val_ip, u_fac_si, u_fac_ip, shgc, t_sol, t_vis; plug-in component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
decnstrmat_4 = HBDeconstructMaterial(mat=decnstrconstr_3.materials)  # -> values, attr_names, r_val_si, r_val_ip; plug-in component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
expression_88 = Expression(x=decnstrconstr_3.u_fac_si, Expression="Round(x, 2)")
null_46 = NullItem(Item=created_constructions_database)  # -> NullFlags, InvalidFlags, Description
item_52 = ListItem(List=decnstrmat_4.values, Index=0, Wrap=True)  # -> Item, Item1
item_53 = ListItem(List=null_46.NullFlags, Index=0, Wrap=True)
shiftm = ShiftMatch(GuideTree=decnstrconstr_3.materials, SecondaryData1=item_52.Item, SecondaryData2=item_52.Item1, shiftFromStart=False)  # -> GuideTree, SecondaryData1, SecondaryData2
visualize_construction_materials = RemoteSender(shiftm.SecondaryData1)
visualize_construction_thickness = RemoteSender(shiftm.SecondaryData2)
format_33 = Format(Format="{0} (U-factor: {1})", Culture=127, Data0=decnstrconstr_3.name, Data1=expression_88)
format_34 = Format(Format="{0}, {1}m", Culture=127, Data0=shiftm.SecondaryData1, Data1=shiftm.SecondaryData2)
gate_66 = StreamGate(Stream=format_33, Gate=item_53)  # -> Target0, Target1
tstat = TreeStatistics(Tree=format_34)  # -> Paths, Length, Count
tstat_2 = TreeStatistics(Tree=format_34)  # -> Paths, Length, Count
repeat_23 = RepeatData(Data="[Innermost layer]", Length=tstat_2.Count)
repeat_24 = RepeatData(Data="[Outermost layer]", Length=tstat.Count)
entwine_159 = Entwine(Branch00=format_9, Branch01=gate_66.Target0, FlattenInputs=True)  # -> flatten(Result)
entwine_160 = Entwine(Branch00=format_11, Branch01=gate_66.Target0, FlattenInputs=True)  # -> flatten(Result)
entwine_161 = Entwine(Branch00=format_12, Branch01=gate_66.Target0, FlattenInputs=True)  # -> flatten(Result)
entwine_162 = Entwine(Branch00=format_10, Branch01=gate_66.Target0, FlattenInputs=True)  # -> flatten(Result)
entwine_163 = Entwine(Branch00=format_14, Branch01=gate_66.Target0, FlattenInputs=True)  # -> flatten(Result)
entwine_164 = Entwine(Branch00=format_13, Branch01=gate_66.Target0, FlattenInputs=True)  # -> flatten(Result)
concat_3 = Concatenate(FragmentA="- ", FragmentB=format_34)
tree = CreateTree(Data=repeat_24, Path=tstat.Paths)
tree_2 = CreateTree(Data=repeat_23, Path=tstat_2.Paths)
entwine_165 = Entwine(Branch00="Generic", Branch01=decnstrconstr_3.name, FlattenInputs=True)  # -> flatten(Result)
entwine_166 = Entwine(Branch00="Generic", Branch01=created_constructions_database, FlattenInputs=True)  # -> flatten(Result)
merge_22 = Merge(Data1=tree, Data2=concat_3, Data3=tree_2)
filter_93 = StreamFilter(Gate=item_53, Stream0=entwine_159, Stream1=format_9)
filter_94 = StreamFilter(Gate=item_53, Stream0=entwine_160, Stream1=format_11)
filter_95 = StreamFilter(Gate=item_53, Stream0=entwine_161, Stream1=format_12)
filter_96 = StreamFilter(Gate=item_53, Stream0=entwine_162, Stream1=format_10)
filter_97 = StreamFilter(Gate=item_53, Stream0=entwine_163, Stream1=format_14)
filter_98 = StreamFilter(Gate=item_53, Stream0=entwine_164, Stream1=format_13)
filter_99 = StreamFilter(Gate=item_53, Stream0=entwine_166, Stream1="Generic")
filter_100 = StreamFilter(Gate=item_53, Stream0=entwine_165, Stream1="Generic")
gate_67 = StreamGate(Stream=merge_22, Gate=item_53)  # -> Target0, Target1
all_construction_display_interior_walls = RemoteSender(filter_98)
all_construction_display_exterior_walls = RemoteSender(filter_97)
panel_209 = Panel(merge_22)
all_construction_display_exterior_roofs = RemoteSender(filter_94)
all_construction_display_interior_floors = RemoteSender(filter_95)
all_construction_display_exterior_floors = RemoteSender(filter_96)
all_construction_display_ground = RemoteSender(filter_93)
custom_constructions = RemoteSender(gate_66.Target0)
custom_constructions_info = RemoteSender(gate_67.Target0)
all_construction_names = RemoteSender(filter_100)
all_constructions = RemoteSender(filter_99)

# ---- group: Construction module (continued)
all_construction_display_exterior_floors_2 = RemoteReceiver(all_construction_display_exterior_floors)
all_construction_display_exterior_walls_2 = RemoteReceiver(all_construction_display_exterior_walls)
all_construction_display_interior_walls_2 = RemoteReceiver(all_construction_display_interior_walls)
all_construction_display_interior_floors_2 = RemoteReceiver(all_construction_display_interior_floors)
all_construction_display_exterior_roofs_2 = RemoteReceiver(all_construction_display_exterior_roofs)
all_construction_display_ground_2 = RemoteReceiver(all_construction_display_ground)
setlist_10 = SetListContents(ListToModify=pulldown_20, NewListContents=all_construction_display_exterior_roofs_2, SelectedIndex="0")
setlist_11 = SetListContents(ListToModify=pulldown_18, NewListContents=all_construction_display_interior_floors_2, SelectedIndex="0")
setlist_12 = SetListContents(ListToModify=pulldown_17, NewListContents=all_construction_display_ground_2, SelectedIndex="0")
setlist_13 = SetListContents(ListToModify=pulldown_19, NewListContents=all_construction_display_exterior_floors_2, SelectedIndex="0")
setlist_14 = SetListContents(ListToModify=pulldown_16, NewListContents=all_construction_display_exterior_walls_2, SelectedIndex="0")
setlist_15 = SetListContents(ListToModify=pulldown_21, NewListContents=all_construction_display_interior_walls_2, SelectedIndex="0")

# ----
all_constructions_2 = RemoteReceiver(all_constructions)
all_constructions_3 = RemoteReceiver(all_constructions)
all_constructions_4 = RemoteReceiver(all_constructions)
item_54 = ListItem(List=all_constructions_2, Index=subset_exterior_floor_2, Wrap=True)
item_55 = ListItem(List=all_constructions_3, Index=subset_exterior_wall_2, Wrap=True)
item_56 = ListItem(List=all_constructions_4, Index=subset_exterior_roof_2, Wrap=True)
expression_89 = Expression(x="Generic", y=item_54, Expression="x=y")
expression_90 = Expression(x="Generic", y=item_55, Expression="x=y")
expression_91 = Expression(x="Generic", y=item_56, Expression="x=y")
filter_101 = StreamFilter(Gate=expression_89, Stream0=item_54, Stream1=null_10)
filter_102 = StreamFilter(Gate=expression_90, Stream0=item_55, Stream1=null_11)
filter_103 = StreamFilter(Gate=expression_91, Stream0=item_56, Stream1=null_12)
exteriorsubset_2 = HBExteriorConstructionSubset(exterior_wall=filter_102, exterior_roof=filter_103, exposed_floor=filter_101)  # -> exterior_set; plug-in component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

all_constructions_5 = RemoteReceiver(all_constructions)
all_constructions_6 = RemoteReceiver(all_constructions)
item_57 = ListItem(List=all_constructions_5, Index=subset_interior_wall_2, Wrap=True)
item_58 = ListItem(List=all_constructions_6, Index=subset_interior_floor_2, Wrap=True)
expression_92 = Expression(x="Generic", y=item_57, Expression="x=y")
expression_93 = Expression(x="Generic", y=item_58, Expression="x=y")
filter_104 = StreamFilter(Gate=expression_92, Stream0=item_57, Stream1=null_13)
filter_105 = StreamFilter(Gate=expression_93, Stream0=item_58, Stream1=null_14)
interiorsubset_2 = HBInteriorConstructionSubset(interior_wall=filter_104, interior_floor=filter_105)  # -> interior_set; plug-in component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

all_constructions_7 = RemoteReceiver(all_constructions)
item_59 = ListItem(List=all_constructions_7, Index=subset_ground_floor_2, Wrap=True)
expression_94 = Expression(x="Generic", y=item_59, Expression="x=y")
filter_106 = StreamFilter(Gate=expression_94, Stream0=item_59, Stream1=null_15)
groundsubset_2 = HBGroundConstructionSubset(ground_floor=filter_106)  # -> ground_set; plug-in component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

constructionset_2 = HBConstructionSet(
    name=panel_101,
    base_constr_set=panel_70,
    exterior_subset=exteriorsubset_2,
    ground_subset=groundsubset_2,
    interior_subset=interiorsubset_2,
    subface_subset=subfacesubset_2)  # -> constr_set; plug-in component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
decnstrconstrset_2 = HBDeconstructConstructionSet(constr_set=constructionset_2)  # -> exterior_wall, exterior_roof, exposed_floor, ground_wall, ground_roof, ground_floor, window, skylight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; plug-in component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
panel_210 = Panel(decnstrconstrset_2.exterior_wall)
panel_211 = Panel(decnstrconstrset_2.window)
decnstrconstr_4 = HBDeconstructConstruction(constr=decnstrconstrset_2.exterior_roof)  # -> materials, layers, r_val_si, r_val_ip, u_fac_si, u_fac_ip, shgc, t_sol, t_vis; plug-in component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
decnstrconstr_5 = HBDeconstructConstruction(constr=decnstrconstrset_2.exterior_wall)  # -> materials, layers, r_val_si, r_val_ip, u_fac_si, u_fac_ip, shgc, t_sol, t_vis; plug-in component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
add_dynamic_shades = AddDynamicShades(base_construction_set=constructionset_2, setpoint=Slider(100, range=0..200))

calc_mat_thickness = HBDeconstructMaterial(mats=decnstrconstr_4.materials)  # -> out, t; inputs mats: list
#   port mats: A material to be deconstructed. This can also be text for a material to be looked up in the material library.
# ---------- calc_mat_thickness: Python ----------
from honeybee_energy.material.opaque import EnergyMaterial, EnergyMaterialNoMass
t = 0
lamb = 0.036
for mat in mats:
    print(mat.thickness, type(mat))
    if type(mat) == EnergyMaterial:
        t = t + mat.thickness
    elif type(mat) == EnergyMaterialNoMass:
        print (mat.r_value * lamb)
        t = t + (mat.r_value * lamb)
    else:
        pass
print ('total thickness:' + str(t))
# ---------- end calc_mat_thickness ----------
calc_mat_thickness_2 = HBDeconstructMaterial(mats=decnstrconstr_5.materials)  # -> out, t; inputs mats: list; same code as calc_mat_thickness

data_71 = Data(add_dynamic_shades)
entwine_167 = Entwine(
    Branch00=room,
    Branch01=adjacent,
    Branch02=context,
    Branch03=windows_3,
    Branch04=data_26,
    Branch05=data_71,
    Branch06=model_name_3,
    Branch07=generate_wwr_2,
    Branch08=calc_mat_thickness_2.t,
    Branch09=calc_mat_thickness.t,
    FlattenInputs=True)
freeze_gate_77 = StreamFreezeGate(Data=entwine_167, PassingSwitch=pre_create_model_3, Hold=True)
bang_22 = ExplodeTree(Data=freeze_gate_77)  # -> Branch0, Branch1, Branch2, Branch3, Branch4, Branch5, Branch6, Branch7, Branch8, Branch9
construction = Data(bang_22.Branch5)
program = Data(bang_22.Branch4)
model_name_4 = Data(bang_22.Branch6)
roof_thickness = Data(bang_22.Branch9)
wwr = Data(bang_22.Branch7)
wall_thickness = Data(bang_22.Branch8)
python_3 = GhPythonScript(in_list=construction)  # -> out_list; inputs in_list: list
# ---------- python_3: Python ----------
"""Converts lists of HB objects to dicts for use with Py3.
    Inputs:
        in_list: List of HB objects
    Output:
        out_list: List of Python dictionaries representing HB objects"""

__author__ = "sawen"
__version__ = "2024.07.09"

out_list = list([x.to_dict() for x in in_list])
# ---------- end python_3 ----------
python_4 = GhPythonScript(in_list=program)  # -> out_list; inputs in_list: list; same code as python_3
windows_4 = Geometry(bang_22.Branch3)
model_name_5 = Text(model_name_4)
room_geometry = Geometry(bang_22.Branch0)
adjacent_geometry = Geometry(bang_22.Branch1)
context_geometry = Geometry(bang_22.Branch2)
window_to_wall_ratio = Number(wwr)
wall_thickness_2 = Number(wall_thickness)
py3_65 = Python3Script(
    window_wall_ratio=window_to_wall_ratio,
    window_height=window_height,
    sill_height=sill_height,
    horizontal_separation=horizontal_separation,
    wall_thickness=wall_thickness_2)  # -> out, window_settings
# ---------- py3_65: Python ----------
from heath import WindowSettings

"""Create Window Settings"""
window_settings = WindowSettings(window_wall_ratio, window_height, sill_height, horizontal_separation, wall_thickness)
# ---------- end py3_65 ----------
py3_66 = Python3Script(
    model_name=model_name_5,
    room_geo=room_geometry,
    construction_sets=python_3,
    programs=python_4,
    energy_systems=heatcool,
    adjacent_surfaces=adjacent_geometry,
    window_geo=windows_4,
    window_settings=py3_65.window_settings,
    context_geo=context_geometry,
    jsonify=toggle_4)  # -> out, hb_model; inputs room_geo: list of Brep, construction_sets: list, programs: list, energy_systems: list, adjacent_surfaces: list of Brep, window_geo: list of Surface, context_geo: list of GeometryBase
# ---------- py3_66: Python ----------
# Copyright (c) 2024, Heath.
# You should have received a copy of the GNU Affero General Public License
# along with Heath; If not, see <http://www.gnu.org/licenses/>.
# 
# @license AGPL-3.0-or-later <https://spdx.org/licenses/AGPL-3.0-or-later>

"""Grasshopper Script"""
        
from heath import create_hb_model, heath_globals, utils

import Rhino.Geometry as rg
import IronPython
import importlib
import honeybee_energy

from honeybee.room import Room
cs = honeybee_energy.constructionset.ConstructionSet
pt = honeybee_energy.programtype.ProgramType 

import scriptcontext

def dictify(d):
    if type(d) in [dict, IronPython.Runtime.PythonDictionary]:
        d = dict(d)
        for key in d:
            d[key] = dictify(d[key])
    elif type(d) in [list, IronPython.Runtime.List]:
        d = [dictify(value) for value in list(d)]
    return d

if __name__ == "__main__":
    if not scriptcontext.sticky["heath_flying"]:
        raise Exception("Heath - fly component must exist on the canvas")
    ghenv.Component.Message = heath_globals.version

    # SUPER HACK because Py3 does not retain the Honeybee types
    # https://discourse.ladybug.tools/t/ladybug-honeybee-datatypes-are-converted-when-input-to-py3-component/28216
    construction_sets = [cs.from_dict(dictify(c)) for c in construction_sets]
    
    programs_patched = []
    for p in programs:
        # hack to fix py2-py3 conversion of dicts
        p = pt.from_dict(dictify(p))
        programs_patched.append(p)

    hb_model = create_hb_model(ghenv, list(room_geo), construction_sets, programs_patched, adjacent_surfaces, energy_systems, window_geo, window_settings, louver_settings, context_geo, model_name)

    if jsonify:
        hb_model = utils.jsonify(hb_model.to_dict())
# ---------- end py3_66 ----------
strtoobj_7 = HBStringToObject(hb_str=py3_66.hb_model)  # -> hb_obj; plug-in component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
filter_107 = StreamFilter(Gate=toggle_4, Stream0=py3_66.hb_model, Stream1=strtoobj_7)

debrep = DeconstructBrep(Brep=room_geometry)  # -> Faces, Edges, Vertices
evalsrf = EvaluateSurface(Surface=graft(debrep.Faces), Point=py3_5.a)  # -> Point, Normal, UDirection, VDirection, Frame
pt_22 = Point(evalsrf.Point)
entwine_168 = Entwine(Branch0X=strtoobj_7, Branch1X=model_name_5, Branch2X=py3_34, FlattenInputs=False)
freeze_gate_78 = StreamFreezeGate(Data=entwine_168, PassingSwitch=create_model_3)
split_13 = SplitTree(Data=freeze_gate_78, Masks=flatten("{0;*}"))  # -> Positive, flatten(Negative)

# ----
# Should it be possible
# to create a model
# that is not valid?
hasdata_23 = DataExists(Data=filter_107)
honeybee_model_possible = RemoteSender(hasdata_23)

# ---- group: Assembly model (continued)
honeybee_model_possible_2 = RemoteReceiver(honeybee_model_possible)
bool_69 = Boolean(honeybee_model_possible_2)
filter_108 = StreamFilter(Gate=bool_69, Stream0=Slider(500, range=0..1000), Stream1=Slider(1000000, range=0..1000000))
filter_109 = StreamFilter(Gate=bool_69, Stream0="Import geometry before creating the model", Stream1=" ")
tooltip_13 = AttachTooltipToElement(ElementsToAttachTo=button_11, TooltipContent=filter_109, ShowDelay=filter_108, Duration=2000)

# ----
join_10 = TextJoin(Text=split_13.Negative)
dumpobjects = HBDumpObjects(hb_objs=flatten(split_13.Positive), name=join_10, folder=py3_16, dump=Toggle(True))  # -> report, hb_file; plug-in component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
rec_41 = DataRecorder(dumpobjects.hb_file, DataLimit=-10, RecordData=True)
panel_212 = Panel(rec_41)

custom_constructions_info_2 = RemoteReceiver(custom_constructions_info)
join_11 = TextJoin(Text=custom_constructions_info_2)  # -> flatten(Result)
lng_51 = ListLength(List=join_11)
py3_67 = Python3Script(current_elements=lng_51, maximum_elements=number_slider_38)  # -> status; inputs current_elements: Int32, maximum_elements: Int32
# ---------- py3_67: Python ----------
status = [True]*current_elements
status.extend([False]*(maximum_elements-current_elements))
# ---------- end py3_67 ----------
settextblock_20 = SetTextBlockContents(TextBlockToModify=tb_17, NewTextBlockContents=join_11)
custom_constructions_2 = RemoteReceiver(custom_constructions)
setexp_5 = SetExpander(Expander=expander_6, Name=custom_constructions_2)
hideshow_67 = HideShowElement(ElementToHideShow=simplify(merge_6), Show=simplify(graft(py3_67)), Collapse=True, Disable=False)

all_construction_names_2 = RemoteReceiver(all_construction_names)
expression_95 = Expression(x=all_construction_names_2, y=create_construction_name_2, Expression="x=y")
cull_19 = CullPattern(List=expression_95, CullPattern=expression_95)
gate_68 = StreamGate(Stream="Material already exists", Gate=cull_19)  # -> Target0, Target1

visualize_construction_thickness_2 = RemoteReceiver(visualize_construction_thickness)
visualize_construction_materials_2 = RemoteReceiver(visualize_construction_materials)
tstat_3 = TreeStatistics(Tree=visualize_construction_materials_2)  # -> Paths, Length, Count
tstat_4 = TreeStatistics(Tree=visualize_construction_thickness_2)  # -> Paths, Length, Count
stack_91 = StackData(Data=tstat_3.Paths, Stack=tstat_3.Length)
stack_92 = StackData(Data=tstat_4.Paths, Stack=tstat_4.Length)
tree_3 = CreateTree(Data=flatten(visualize_construction_materials_2), Path=stack_91)
tree_4 = CreateTree(Data=flatten(visualize_construction_thickness_2), Path=stack_92)
custom_constructions_3 = RemoteReceiver(custom_constructions)
suirify_12 = Suirify(tree_3)
suirify_13 = Suirify(tree_4)
branch_3 = TreeBranch(Tree=suirify_12, Path=path_3, MaintainPaths=True)
branch_4 = TreeBranch(Tree=suirify_13, Path=path_3, MaintainPaths=True)
item_60 = ListItem(List=custom_constructions_3, Index=pre_construction_database_visualize_cons_2, Wrap=True)
ma_51 = MassAddition(Input=branch_4)  # -> Result, PartialResults
concat_4 = Concatenate(FragmentA=ma_51.Result, FragmentB=" m")
concat_5 = Concatenate(FragmentA=branch_4, FragmentB=" m")
multiplication_7 = Multiplication(A=Slider(400, range=0..1000), B=branch_4)
format_35 = Format(Format=panel_154, Culture=127, Data0=concat_4)
cull_i_4 = CullIndex(List=multiplication_7, Indices="-1", Wrap=True)
item_61 = ListItem(List=multiplication_7, Index="-1", Wrap=True)
lng_52 = ListLength(List=concat_5)
py3_68 = Python3Script(current_elements=lng_52, maximum_elements=construction_maximum_layer_limit_7)  # -> status; inputs current_elements: Int32, maximum_elements: Int32; same code as py3_67
setlabel_8 = SetLabelContents(LabelToModify=label_53, NewLabelContents=item_60)
setlabel_9 = SetLabelContents(LabelToModify=label_56, NewLabelContents=format_35)
settextblock_21 = SetTextBlockContents(TextBlockToModify=tb_22, NewTextBlockContents=branch_3)
settextblock_22 = SetTextBlockContents(TextBlockToModify=tb_21, NewTextBlockContents=concat_5)
entwine_169 = Entwine(Branch00=cull_i_4, Branch01=item_61, FlattenInputs=True)  # -> flatten(Result)
hideshow_68 = HideShowElement(ElementToHideShow=tb_21, Show=py3_68, Collapse=True, Disable=False)
hideshow_69 = HideShowElement(ElementToHideShow=tb_22, Show=py3_68, Collapse=True, Disable=False)
hideshow_70 = HideShowElement(ElementToHideShow=tb_23, Show=py3_68, Collapse=True, Disable=False)
py3_69 = Python3Script(layerHeight=entwine_169, textHeight=Slider(22, range=0..100))  # -> over_text, under_text; inputs layerHeight: list
# ---------- py3_69: Python ----------
over_text = []
under_text = []

for layer in layerHeight:
    if layer <= textHeight:
        over_text.append(0)
        under_text.append(layer)
    else:
        over_text.append((layer/2)-(textHeight/2))

        under_text.append((layer/2)+(textHeight/2))
# ---------- end py3_69 ----------
adjustpos_131 = AdjustElementPositioning(
    ElementsToAdjust=tb_23,
    Margin="0, 0, 0, -1",
    AbsolutePositioning=False,
    Width=number_slider_47,
    Height=py3_69.over_text,
    HorizontalAlignment=0,
    VerticalAlignment=1)
adjustpos_132 = AdjustElementPositioning(
    ElementsToAdjust=tb_22,
    AbsolutePositioning=False,
    Width=number_slider_47,
    Height=py3_69.under_text,
    HorizontalAlignment=0,
    VerticalAlignment=1)

created_materials_database = RemoteReceiver(created_materials_database_2)
panel_213 = Panel(created_materials_database)
decnstrmat_5 = HBDeconstructMaterial(mat=created_materials_database)  # -> category, values, attr_names, r_val_si, r_val_ip; plug-in component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
create_material_categories = RemoteSender(decnstrmat_5.category)
item_62 = ListItem(List=decnstrmat_5.values, Index=0, Wrap=True)  # -> flatten(Item), flatten(Item1), flatten(Item2), flatten(Item3), flatten(Item4)
clean_9 = CleanTree(RemoveNulls=True, RemoveInvalid=True, RemoveEmpty=False, Tree=item_62.Item)
clean_10 = CleanTree(RemoveNulls=True, RemoveInvalid=True, RemoveEmpty=False, Tree=item_62.Item2)
clean_11 = CleanTree(RemoveNulls=True, RemoveInvalid=True, RemoveEmpty=False, Tree=item_62.Item3)
clean_12 = CleanTree(RemoveNulls=True, RemoveInvalid=True, RemoveEmpty=False, Tree=item_62.Item4)
lng_53 = ListLength(List=clean_9)
create_material_names = RemoteSender(clean_9)
num_14 = Number(clean_10)
num_15 = Number(clean_11)
num_16 = Number(clean_12)
expression_96 = Expression(x=num_14, Expression="Round(x, 2)")
expression_97 = Expression(x=num_15, Expression="Round(x, 2)")
expression_98 = Expression(x=num_16, Expression="Round(x, 2)")
bool_70 = Boolean(lng_53)
gate_69 = StreamGate(Stream=panel_42, Gate=bool_70)  # -> Target0, Target1
format_36 = Format(Format=gate_69.Target1, Culture=127, Data0=clean_9, Data1=expression_96, Data2=expression_97, Data3=expression_98)
database_materials = RemoteSender(format_36)
panel_214 = Panel(format_36)

create_material_categories_2 = RemoteReceiver(create_material_categories)
create_material_names_2 = RemoteReceiver(create_material_names)
database_materials_2 = RemoteReceiver(database_materials)
mindex_10 = MemberIndex(Set=material_database_categories_3, Member=create_material_categories_2)  # -> simplify(Index), Count
getbrn = GetMatchingBranches(
    PrimaryData=mindex_10.Index,
    SecondaryData1=simplify(graft(database_materials_2)),
    SecondaryData2=simplify(graft(create_material_names_2)),
    removeEmpty=True,
    ValueTable_removeEmpty=False)  # -> flatten(PrimaryData), flatten(SecondaryData1), flatten(SecondaryData2)
cull_20 = CullPattern(List=create_material_categories_2, CullPattern=mindex_10.Count)
create_material_categories_current = RemoteSender(cull_20)
material_database_categories_current = RemoteSender(getbrn.PrimaryData)
database_materials_current = RemoteSender(getbrn.SecondaryData1)
create_material_names_current = RemoteSender(getbrn.SecondaryData2)

material_database_categories_current_2 = RemoteReceiver(material_database_categories_current)
material_database_categories_current_3 = RemoteReceiver(material_database_categories_current)
create_material_names_current_2 = RemoteReceiver(create_material_names_current)
database_materials_current_2 = RemoteReceiver(database_materials_current)
create_material_names_current_3 = RemoteReceiver(create_material_names_current)

expression_99 = Expression(x=create_material_names_current_3, y=create_material_name_3, Expression="x=y")
cull_21 = CullPattern(List=expression_99, CullPattern=expression_99)
gate_70 = StreamGate(Stream="Material already exists", Gate=cull_21)  # -> Target0, Target1
entwine_170 = Entwine(Branch00=filter_57, Branch01=gate_70.Target1, Branch02=gate_35.Target1, FlattenInputs=True)  # -> flatten(Result)
item_63 = ListItem(List=entwine_170, Index=0, Wrap=True)
create_material_error_message = RemoteSender(item_63)

create_material_error_message_2 = RemoteReceiver(create_material_error_message)
null_47 = NullItem(Item=create_material_error_message_2)  # -> NullFlags, InvalidFlags, Description
filter_110 = StreamFilter(Gate=null_47.NullFlags, Stream0=create_material_error_message_2, Stream1=" ")
filter_111 = StreamFilter(Gate=null_47.NullFlags, Stream0=Slider(500, range=0..1000), Stream1=Slider(1000000, range=0..1000000))
hideshow_71 = HideShowElement(ElementToHideShow=button_43, Show=True, Collapse=True, Disable=invert(null_47.NullFlags))
tooltip_14 = AttachTooltipToElement(ElementsToAttachTo=button_43, TooltipContent=filter_110, ShowDelay=filter_111, Duration=Slider(5000, range=0..10000))

create_material_names_current_4 = RemoteReceiver(create_material_names_current)
create_material_categories_current_2 = RemoteReceiver(create_material_categories_current)

mindex_11 = MemberIndex(Set=create_material_names_current_4, Member=branch_3)  # -> flatten(Index), Count
item_64 = ListItem(List=create_material_categories_current_2, Index=mindex_11.Index, Wrap=True)
mindex_12 = MemberIndex(Set=material_database_categories_8, Member=item_64)  # -> flatten(Index), Count
item_65 = ListItem(List=entwine_138, Index=mindex_12.Index, Wrap=True)
adjustelem_30 = AdjustElementAppearance(ElementsToAdjust=tb_23, Foreground=swatch_2, Background=item_65)
adjustelem_31 = AdjustElementAppearance(ElementsToAdjust=tb_22, Foreground=swatch_2, Background=item_65)

sort_2 = SortList(
    Keys=material_database_categories_current_2,
    ValuesA=database_materials_current_2,
    ValuesB=create_material_names_current_2)  # -> Keys, ValuesA, ValuesB
py3_70 = Python3Script(maximum_elements=lng_7, current_elements=material_database_categories_current_3, maximum_buttons=number_slider_40)  # -> status; inputs current_elements: list, maximum_buttons: Int32
# ---------- py3_70: Python ----------
from collections import Counter
import ghpythonlib.treehelpers as th

c = Counter(current_elements)
status = []

for i in range(maximum_elements):
    current_category = [True]*c[i]
    current_category.extend([False]*(maximum_buttons-c[i]))
    status.append(current_category)

status = th.list_to_tree(status)
# ---------- end py3_70 ----------
create_material_names_sorted = RemoteSender(sort_2.ValuesB)
concat_6 = Concatenate(FragmentA="- ", FragmentB=sort_2.ValuesA)
material_database_hideshow = RemoteSender(py3_70)
cull_22 = CullPattern(List=tb_18, CullPattern=py3_70)  # -> flatten(List)
settextblock_23 = SetTextBlockContents(TextBlockToModify=cull_22, NewTextBlockContents=concat_6)
hideshow_72 = HideShowElement(ElementToHideShow=simplify(shfdep), Show=simplify(py3_70), Collapse=True, Disable=False)

material_database_hideshow_2 = RemoteReceiver(flatten(material_database_hideshow))
filter_112 = StreamFilter(Gate=lng_23, Stream0="False", Stream1=material_database_hideshow_2)
freeze_gate_79 = StreamFreezeGate(Data=filter_112, PassingSwitch=filter_56, Freeze=True, Hold=False)
cull_23 = CullPattern(List=freeze_gate_55, CullPattern=freeze_gate_79)
create_material_names_sorted_2 = RemoteReceiver(create_material_names_sorted)
cset_9 = CreateSet(List=cull_23)  # -> Set, Map
cull_24 = CullPattern(List=cset_9.Set, CullPattern=cset_9.Set)
mindex_13 = MemberIndex(Set=cull_23, Member=cull_24)  # -> Index, Count
freeze_gate_80 = StreamFreezeGate(Data=create_material_names_sorted_2, PassingSwitch=filter_56, Freeze=True, Hold=False)
hold_12 = HoldingGate(Data=mindex_13.Index)
item_66 = ListItem(List=freeze_gate_80, Index=hold_12, Wrap=True)
expression_100 = Expression(x=item_25, y=item_66, Expression="x≠y")
cull_25 = CullPattern(List=split_8, CullPattern=expression_100)
join_12 = TextJoin(Text=cull_25, Join="|")
filter_113 = StreamFilter(Gate=bool_45, Stream0=bool_45, Stream1=join_12)
freeze_gate_81 = StreamFreezeGate(Data=filter_113, PassingSwitch=material_database_remove_material_2, Freeze=False, Hold=False)

panel_215 = Panel(filter_113)
panel_216 = Panel(freeze_gate_81)
setdocumentusertext_3 = Python3Script(key=panel_165, load_value=freeze_gate_53, remove_value=freeze_gate_81, add_value=freeze_gate_58, sync=or_11)  # -> done
# ---------- setdocumentusertext_3: Python ----------
import Rhino
import rhinoscriptsyntax as rs
import scriptcontext as sc

def modify_value(value):
    sc.doc = Rhino.RhinoDoc.ActiveDoc

    return rs.SetDocumentUserText(key, value)

    sc.doc = ghdoc

if load_value:
    done = modify_value(load_value)

elif add_value:
    done = modify_value(add_value)

elif remove_value:
    done = modify_value(remove_value)
elif remove_value == False:
    done = modify_value(None)

elif sync:
    done = True
# ---------- end setdocumentusertext_3 ----------
getdocumentusertext_15 = Python3Script(run=setdocumentusertext_3, key="Heath materials")  # -> json_string; same code as getdocumentusertext_14
split_14 = TextSplit(Text=getdocumentusertext_15, Separators="|")
hold_13 = HoldingGate(Data=split_14)
strtoobj_8 = HBStringToObject(hb_str=hold_13)  # -> flatten(hb_obj); plug-in component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
ipy2_3 = IronPython2Script(materials=strtoobj_8)  # -> unique_materials; inputs materials: list; same code as ipy2
lng_54 = ListLength(List=ipy2_3)
lng_55 = ListLength(List=strtoobj_8)
clean_13 = CleanTree(RemoveNulls=True, RemoveInvalid=True, RemoveEmpty=False, Tree=ipy2_3)
smaller_12 = SmallerThan(FirstNumber=lng_54, SecondNumber=lng_55)  # -> SmallerThan, OrEqualTo
created_materials_database_2 = RemoteSender(clean_13)
hasdata_24 = DataExists(Data=smaller_12.SmallerThan)
filter_114 = StreamFilter(Gate=hasdata_24, Stream0="False", Stream1=smaller_12.SmallerThan)
overlap_materials = RemoteSender(filter_114)

overlap_materials_2 = RemoteReceiver(overlap_materials)
hideshow_73 = HideShowElement(ElementToHideShow=label_38, Show=overlap_materials_2, Collapse=True, Disable=False)

panel_217 = Panel(setdocumentusertext_3)
panel_218 = Panel(getdocumentusertext_15)
panel_219 = Panel(clean_13)

created_materials_database_3 = RemoteReceiver(created_materials_database_2)
cull_26 = CullPattern(List=created_materials_database_3, CullPattern=mindex_10.Count)
lng_56 = ListLength(List=created_materials_database_3)
lng_57 = ListLength(List=cull_26)
created_materials_database_current = RemoteSender(cull_26)

larger_5 = LargerThan(FirstNumber=lng_56, SecondNumber=lng_57)  # -> LargerThan, OrEqualTo

hasdata_25 = DataExists(Data=larger_5.LargerThan)
filter_115 = StreamFilter(Gate=hasdata_25, Stream0="False", Stream1=larger_5.LargerThan)
invalid_material_categories = RemoteSender(filter_115)

invalid_material_categories_2 = RemoteReceiver(invalid_material_categories)
hideshow_74 = HideShowElement(ElementToHideShow=label_2, Show=invalid_material_categories_2, Collapse=True, Disable=False)

created_materials_database_current_2 = RemoteReceiver(created_materials_database_current)

database_materials_current_3 = RemoteReceiver(database_materials_current)
lng_58 = ListLength(List=database_materials_current_3)
series_2 = Series(Start=0, Step=1, Count=lng_58)
hasdata_26 = DataExists(Data=database_materials_current_3)
tsort = SortText(Keys=database_materials_current_3, Values=series_2, Culture=127)  # -> Keys, Values
create_construction_materials_sorted = RemoteSender(tsort.Values)
filter_116 = StreamFilter(Gate=hasdata_26, Stream0=empty_11, Stream1=tsort.Keys)
setlist_16 = SetListContents(ListToModify=pulldown_28, NewListContents=filter_116, SelectedIndex=bang_12.Branch0)

create_construction_materials_sorted_2 = RemoteReceiver(create_construction_materials_sorted)
item_67 = ListItem(List=created_materials_database_current_2, Index=create_construction_materials_sorted_2, Wrap=invert(True))
item_68 = ListItem(List=item_67, Index=create_construction_materials_3, Wrap=invert(True))
repeat_25 = RepeatData(Data=item_68, Length=visible_layers_2)  # -> flatten(Data)
cluster_32 = Cluster(materials=repeat_25, construction_name=create_construction_name_4, thicknesses=repeat_19)  # -> error_2, construction_2
create_construction_error = RemoteSender(cluster_32.error_2)
gate_71 = StreamGate(Stream=cluster_32.construction_2, Gate=create_construction_2)  # -> Target0, Target1
objtostr_4 = HBObjectToString(hb_obj=gate_71.Target1)  # -> hb_str; plug-in component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
entwine_171 = Entwine(Branch00=getdocumentusertext_12, Branch01=objtostr_4, FlattenInputs=True)  # -> flatten(Result)
freeze_gate_82 = StreamFreezeGate(Data=entwine_171, PassingSwitch=create_construction_2, Freeze=False, Hold=False)
join_13 = TextJoin(Text=freeze_gate_82, Join="|")

create_construction_error_2 = RemoteReceiver(create_construction_error)
panel_220 = Panel(create_construction_error_2)
split_15 = TextSplit(Text=create_construction_error_2, Separators=panel_141)
trim_2 = TextTrim(Text=split_15, Start=True, End=True)
item_69 = ListItem(List=trim_2, Index=0, Wrap=True)  # -> Item, Item1
lng_59 = ListLength(List=split_15)
len_5 = TextLength(Text=item_69.Item1)
larger_6 = LargerThan(FirstNumber=lng_59, SecondNumber="1")  # -> LargerThan, OrEqualTo
subtraction_13 = Subtraction(A=len_5, B=Slider(11, range=0..20))
fragment_6 = TextFragment(Text=item_69.Item1, Start="0", Count=subtraction_13)
filter_117 = StreamFilter(Gate=larger_6.LargerThan, Stream0=create_construction_error_2, Stream1=fragment_6)
entwine_172 = Entwine(Branch00=filter_117, Branch01=gate_68.Target1, Branch02=gate_41.Target1, FlattenInputs=True)  # -> flatten(Result)
panel_221 = Panel(filter_117)
item_70 = ListItem(List=entwine_172, Index=0, Wrap=True)
create_construction_error_message = RemoteSender(item_70)

create_construction_error_message_2 = RemoteReceiver(create_construction_error_message)
null_48 = NullItem(Item=create_construction_error_message_2)  # -> NullFlags, InvalidFlags, Description
filter_118 = StreamFilter(Gate=null_48.NullFlags, Stream0=create_construction_error_message_2, Stream1=" ")
filter_119 = StreamFilter(Gate=null_48.NullFlags, Stream0=Slider(500, range=0..1000), Stream1=Slider(1000000, range=0..1000000))
hideshow_75 = HideShowElement(ElementToHideShow=button_45, Show=True, Collapse=True, Disable=invert(null_48.NullFlags))
tooltip_15 = AttachTooltipToElement(ElementsToAttachTo=button_45, TooltipContent=filter_118, ShowDelay=filter_119, Duration=Slider(5000, range=0..10000))

setdocumentusertext_4 = Python3Script(
    key=panel_164,
    load_value=freeze_gate_52,
    remove_value=freeze_gate_25,
    add_value=join_13,
    sync=sync_construction_database_2)  # -> done
# ---------- setdocumentusertext_4: Python ----------
import Rhino
import rhinoscriptsyntax as rs
import scriptcontext as sc

def modify_value(value):
    sc.doc = Rhino.RhinoDoc.ActiveDoc

    done = rs.SetDocumentUserText(key, value)
    return done

    sc.doc = ghdoc

if load_value:
    done = modify_value(load_value)

if add_value:
    done = modify_value(add_value)

if remove_value:
    done = modify_value(remove_value)

if remove_value == False:
    done = modify_value(None)

elif sync:
    done = True
# ---------- end setdocumentusertext_4 ----------
getdocumentusertext_16 = Python3Script(run=setdocumentusertext_4, key="Heath constructions")  # -> json_string; same code as getdocumentusertext_14
split_16 = TextSplit(Text=getdocumentusertext_16, Separators="|")
hold_14 = HoldingGate(Data=split_16)
strtoobj_9 = HBStringToObject(hb_str=hold_14)  # -> flatten(hb_obj); plug-in component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
ipy2_4 = IronPython2Script(constructions=strtoobj_9)  # -> unique_constructions; inputs constructions: list
# ---------- ipy2_4: IronPython ----------
"""Grasshopper Script"""

unique_constructions = []

for i in range(len(constructions)):
    if constructions[i] not in unique_constructions:
        unique_constructions.append(constructions[i])
# ---------- end ipy2_4 ----------
lng_60 = ListLength(List=ipy2_4)
lng_61 = ListLength(List=strtoobj_9)
clean_14 = CleanTree(RemoveNulls=True, RemoveInvalid=True, RemoveEmpty=False, Tree=ipy2_4)
smaller_13 = SmallerThan(FirstNumber=lng_60, SecondNumber=lng_61)  # -> SmallerThan, OrEqualTo
created_constructions_database_2 = RemoteSender(clean_14)
hasdata_27 = DataExists(Data=smaller_13.SmallerThan)
filter_120 = StreamFilter(Gate=hasdata_27, Stream0="False", Stream1=smaller_13.SmallerThan)
overlap_constructions = RemoteSender(filter_120)

overlap_constructions_2 = RemoteReceiver(overlap_constructions)
hideshow_76 = HideShowElement(ElementToHideShow=label_37, Show=overlap_constructions_2, Collapse=True, Disable=False)

panel_222 = Panel(strtoobj_9)
panel_223 = Panel(clean_14)

# ==== cluster VisualiseProperties
number_of_decimals_room = ClusterInput()
face_attribute = ClusterInput()
honeybee_model = ClusterInput()
number_of_decimals_face = ClusterInput()
room_attribute = ClusterInput()
face_attribute_2 = Text(face_attribute)
honeybee_model_2 = Data(honeybee_model)
room_attribute_2 = Text(room_attribute)
number_of_decimals_face_2 = Number(number_of_decimals_face)
number_of_decimals_room_2 = Number(number_of_decimals_room)
legendpar = LBLegendParameters(num_decimals=number_of_decimals_room_2)  # -> leg_par; plug-in component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
legendpar_2 = LBLegendParameters(num_decimals=number_of_decimals_face_2)  # -> leg_par; plug-in component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
colorroomattr = HBColorRoomAttributes(rooms_model=flatten(honeybee_model_2), attribute=room_attribute_2, legend_par=legendpar)  # -> mesh, legend, wire_frame, values, colors, vis_set; plug-in component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
colorfaceattr = HBColorFaceAttributes(hb_objs=flatten(honeybee_model_2), attribute=face_attribute_2, legend_par=legendpar_2)  # -> mesh, legend, wire_frame, values, colors, vis_set; plug-in component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
visualised_room_attributes = Data([colorroomattr.mesh, colorroomattr.legend, colorroomattr.wire_frame])
visualised_face_attributes = Data([colorfaceattr.mesh, colorfaceattr.legend, colorfaceattr.wire_frame])
visualised_room_attributes_2 = ClusterOutput(visualised_room_attributes)
visualised_face_attributes_2 = ClusterOutput(visualised_face_attributes)

# ==== cluster AddDynamicShades
base_construction_set = ClusterInput()
setpoint = ClusterInput()
base_construction_set_2 = Data(base_construction_set)
decnstrconstrset = HBDeconstructConstructionSet(constr_set=base_construction_set_2)  # -> exterior_wall, exterior_roof, exposed_floor, ground_wall, ground_roof, ground_floor, window, skylight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; plug-in component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
setpoint_2 = Data(setpoint)
shademat = HBShadeMaterial(thickness=Slider(0.01, range=0..0.01), transmittance=Slider(0.4, range=0..1))  # -> mat; plug-in component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
windowconstrshd = HBWindowConstructionShade(
    name="Simple Glazing Window",
    win_constr=decnstrconstrset.window,
    shd_material=shademat,
    shd_location="Exterior",
    control_type=Slider(1, range=0..8),
    setpoint=setpoint_2)  # -> constr; plug-in component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
subfacesubset = HBSubfaceSubset(window=windowconstrshd, operable=windowconstrshd)  # -> subface_set; plug-in component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
constructionset = HBConstructionSet(base_constr_set=base_construction_set_2, subface_subset=subfacesubset)  # -> constr_set; plug-in component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
construction_set = Data(constructionset)
construction_set_2 = ClusterOutput(construction_set)

# ==== cluster Cluster
materials = ClusterInput()
materials_2 = Data(materials)
opaqueconstr = HBOpaqueConstruction(materials=materials_2)  # -> constr; plug-in component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
thicknesses = ClusterInput()
decnstrconstr = HBDeconstructConstruction(constr=opaqueconstr)  # -> materials, layers, r_val_si, r_val_ip, u_fac_si, u_fac_ip, shgc, t_sol, t_vis; plug-in component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
thicknesses_2 = Number(thicknesses)
nullrep = ReplaceNulls(Items=thicknesses_2, Replacements="0")  # -> Items, Count
construction_name = ClusterInput()
modify_layer_thicknesses = BrimstoneModifyThicknessesOfHoneybeeMaterials(hb_materials=decnstrconstr.materials, thicknesses=nullrep.Items)  # -> out, mod_materials; inputs hb_materials: list, thicknesses: list
# ---------- modify_layer_thicknesses: Python ----------
"""
Calculates embodied carbon for the elements of a Honeybee model if data is available
This component was inspired by the 'HB Color Face Attributes' component of Ladybug Tools 1.6.0

    Args:
        hb_materials: List of Honeybee materials which should get new thickness
        thicknesses: List of new material thicknesses

    Returns:
        mod_materials: Modified Honeybee materials
"""

import scriptcontext
#import brimstone

ghenv.Component.Message = ""#brimstone.globals.version

ghenv.Component.Name = 'Brimstone - Modify thicknesses of Honeybee materials'
ghenv.Component.NickName = 'Modify layer thicknesses'

try:  # import the core honeybee dependencies
    from honeybee_energy.material.opaque import EnergyMaterial
    from honeybee_energy.material.opaque import EnergyMaterialNoMass
except ImportError as e:
    raise ImportError('\nFailed to import honeybee:\n\t{}'.format(e))

def main(hb_materials, thicknesses):
    mod_materials = []
    assert len(hb_materials) == len(thicknesses), "Materials and thickness list must be of the same length"
    for (i, material) in enumerate(hb_materials):
        if not isinstance(material, EnergyMaterial):
            if isinstance(material, EnergyMaterialNoMass):
                mod_material = material.duplicate()
                mod_materials.append(mod_material)
            else:
                raise Exception("All materials must be valid Honeybee Energy Materials or Energy Materials (No Mass)")
        else: # if material is EnergyMaterial
            mod_material = material.duplicate()
            mod_material.thickness = thicknesses[i]
            mod_materials.append(mod_material)
    return mod_materials

if __name__ == "__main__":
    try:
        pass#flying = scriptcontext.sticky["brimstone_flying"]
    except:
        raise Exception("The 'Brimstone - Fly' component needs to exist on the canvas")
    mod_materials = main(hb_materials, thicknesses)
# ---------- end modify_layer_thicknesses ----------
construction_name_2 = Text(construction_name)
opaqueconstr_2 = HBOpaqueConstruction(name=construction_name_2, materials=modify_layer_thicknesses.mod_materials)  # -> constr; plug-in component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
error = Data(modify_layer_thicknesses.out)
error_2 = ClusterOutput(error)
construction = Data(opaqueconstr_2)
construction_2 = ClusterOutput(construction)

# ==== cluster Cluster_2
window_construction = ClusterInput()
window_construction_2 = Data(window_construction)
fly = BrimstoneFly()
# ---------- fly: Python ----------
"""This component sets up global information for Brimstone
    Inputs:
    Output:
        """

import Grasshopper
import sys
sys.path.append(Grasshopper.Folders.UserObjectFolders[0])

import brimstone
reload(brimstone)

import scriptcontext

ghenv.Component.Name = 'Brimstone - Fly!'
ghenv.Component.NickName = 'Fly!'

scriptcontext.sticky["brimstone_flying"] = 'true'
ghenv.Component.Message = brimstone.globals.version
# ---------- end fly ----------
subfacesubset = HBSubfaceSubset(window=window_construction_2)  # -> subface_set; plug-in component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
panel = Panel(subfacesubset)
constructionset = HBConstructionSet(subface_subset=subfacesubset)  # -> constr_set; plug-in component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
density_kg_m2 = ClusterInput()
gwp_a1_a3 = ClusterInput()
gwp_a4 = ClusterInput()
decnstrconstrset = HBDeconstructConstructionSet(constr_set=constructionset)  # -> exterior_wall, exterior_roof, exposed_floor, ground_wall, ground_roof, ground_floor, window, skylight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; plug-in component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
gwp_a1_a3_2 = Data(gwp_a1_a3)
gwp_a4_2 = Data(gwp_a4)
density_kg_m2_2 = Data(density_kg_m2)
add_life_cycle_info_construction = BrimstoneAddLifeCycleInfoToHoneybeeConstruction(hb_construction=decnstrconstrset.window, gwp_a1_a3=gwp_a1_a3_2, gwp_a4=gwp_a4_2, density=density_kg_m2_2)  # -> mod_construction
# ---------- add_life_cycle_info_construction: Python ----------
"""
Adds GWP info to a Honeybee Construction

    Args:
        hb_construction: Honeybee Construction to be updated
        gwp_a1_a3: GWP (A1-A3) [kg CO2eq/m2]
        gwp_a4: GWP (A4) [kg CO2eq/m2]
        gwp_a5_1: GWP (A5.1) [kg CO2eq/m2]

    Returns:
        mod_construction: Updated Honeybee Construction
"""

import scriptcontext
import brimstone
ghenv.Component.Message = brimstone.globals.version
import Grasshopper

ghenv.Component.Name = 'Brimstone - Add Life Cycle Info to Honeybee Construction'
ghenv.Component.NickName = 'Add Life Cycle Info (Construction)'

try:  # import the core honeybee dependencies
    from honeybee_energy.construction.window import WindowConstruction
    from honeybee_energy.construction.opaque import OpaqueConstruction
except ImportError as e:
    raise ImportError('\nFailed to import honeybee:\n\t{}'.format(e))

def main(hb_construction, gwp_a1_a3, gwp_a4, density):
    if not isinstance(hb_construction, WindowConstruction)\
        and not isinstance(hb_construction, OpaqueConstruction):
        raise Exception("Currently only Window and Opaque constructions are supported")
    mod_construction = hb_construction.duplicate()
    user_data = mod_construction.user_data if mod_construction.user_data else {}
    
    user_data["gwp_a1_a3"] = gwp_a1_a3
    user_data["gwp_a4"] = gwp_a4
    user_data["conv_value"] = density
    
    mod_construction.user_data = user_data

    return mod_construction

if __name__ == "__main__":
    try:
        flying = scriptcontext.sticky["brimstone_flying"]
    except:
        raise Exception("The 'Brimstone - Fly' component needs to exist on the canvas")
    mod_construction = main(hb_construction, gwp_a1_a3, gwp_a4, density)
# ---------- end add_life_cycle_info_construction ----------
panel_2 = Panel(decnstrconstrset.window)
updated_construction = Data(add_life_cycle_info_construction)
panel_3 = Panel(add_life_cycle_info_construction)
updated_construction_2 = ClusterOutput(updated_construction)

# ==== cluster WeatherVisualisation
target_geometry = ClusterInput()
_1 = ClusterInput()
run_weather_visualisation = ClusterInput()
target_geometry_2 = ClusterInput()
sky_mask_centre_point = ClusterInput()
run_weather_visualisation_2 = Boolean(run_weather_visualisation)
filter = StreamFilter(Gate=run_weather_visualisation_2, Stream1=_1)
epw_file_url = Data(filter)

# ---- group: Get weather data
downloadepw = LBDownloadWeather(weather_URL=epw_file_url)  # -> epw_file, stat_file, ddy_file; plug-in component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
falsestart = LBFalseStartToggle(False)
epwtoddy = LBEPWToDDY(weather_file=downloadepw.epw_file, write=falsestart)  # -> ddy_file; plug-in component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
importloc = LBImportLocation(epw_file=downloadepw.epw_file)  # -> location; plug-in component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
importstat = LBImportSTAT(stat_file=downloadepw.stat_file)  # -> location, ashrae_zone, koppen_zone, clear_dir_norm_rad, clear_diff_horiz_rad, ann_heat_dday_996, ann_heat_dday_990, ann_cool_dday_004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; plug-in component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
constrloc = LBConstructLocation(elevation=0)  # -> location; plug-in component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
importepw = LBImportEPW(epw_file=downloadepw.epw_file)  # -> location, dry_bulb_temperature, dew_point_temperature, relative_humidity, wind_speed, wind_direction, direct_normal_rad, diffuse_horizontal_rad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; plug-in component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
importddy = LBImportDDY(ddy_file=downloadepw.ddy_file)  # -> location, design_days; plug-in component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

# ----
panel = Panel(importloc)

# ---- group: Sky matrix and incident radiation
analysisperiod = LBAnalysisPeriod(
    start_month=Slider(1, range=1..12),
    start_day=Slider(1, range=1..31),
    start_hour=Slider(0, range=0..23),
    end_month=Slider(12, range=1..12),
    end_day=Slider(31, range=1..31),
    end_hour=Slider(23, range=0..23))  # -> period, hoys, dates; plug-in component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
skymatrix = LBCumulativeSkyMatrix(
    location=importepw.location,
    direct_rad=importepw.direct_normal_rad,
    diffuse_rad=importepw.diffuse_horizontal_rad,
    hoys=analysisperiod.hoys,
    high_density=Toggle(False))  # -> report, sky_mtx; plug-in component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
context_geometry = Geometry(target_geometry)
target_geometry_3 = Geometry(target_geometry_2)
run_incident_radiation_study = Boolean(run_weather_visualisation_2)
incidentradiation = LBIncidentRadiation(
    sky_mtx=skymatrix.sky_mtx,
    geometry=flatten(target_geometry_3),
    context=flatten(context_geometry),
    grid_size=Slider(1, range=0..1),
    offset_dist=Slider(0.1, range=0..0.1),
    run=run_incident_radiation_study)  # -> report, points, results, total, mesh, legend, title, int_mtx; plug-in component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
skydome = LBSkyDome(sky_mtx=skymatrix.sky_mtx)  # -> report, mesh, compass, legend, title, patch_vecs, patch_values, mesh_values, vis_set; plug-in component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

# ---- group: Wind rose
analysisperiod_2 = LBAnalysisPeriod(
    start_month=Slider(1, range=1..12),
    start_day=Slider(1, range=1..31),
    start_hour=Slider(0, range=0..23),
    end_month=Slider(12, range=1..12),
    end_day=Slider(31, range=1..31),
    end_hour=Slider(23, range=0..23))  # -> period, hoys, dates; plug-in component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
windrose = LBWindRose(
    data=importepw.wind_speed,
    wind_direction=importepw.wind_direction,
    show_calm=Toggle(True),
    period=analysisperiod_2.period)  # -> report, mesh, compass, orient_line, freq_line, windrose_line, legend, title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; plug-in component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

# ---- group: Sun path
analysisperiod_3 = LBAnalysisPeriod(
    start_month=Slider(1, range=1..12),
    start_day=Slider(1, range=1..31),
    start_hour=Slider(0, range=0..23),
    end_month=Slider(12, range=1..12),
    end_day=Slider(31, range=1..31),
    end_hour=Slider(23, range=0..23))  # -> period, hoys, dates; plug-in component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
panel_2 = Panel("a>24")
sunpath = LBSunPath(location=importloc, hoys=analysisperiod_3.hoys, scale=1, data=importepw.dry_bulb_temperature)  # -> report, vectors, altitudes, azimuths, hoys, sun_pts, analemma, daily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; plug-in component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
msphere = MeshSphere(Base=sunpath.sun_pts, Radius=Slider(3, range=0..10), UCount=10, VCount=20)  # disabled

# ---- group: Graph data
timeop = LBTimeIntervalOperation(data=importepw.dry_bulb_temperature)  # -> daily, monthly, mon_per_hr; plug-in component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
legendpar = LBLegendParameters(
    min=Slider(-15, range=-15..30),
    max=Slider(25, range=0..100),
    num_decimals=Slider(0, range=0..100),
    larger_smaller=Toggle(True),
    vert_or_horiz=Toggle(False))  # -> leg_par; plug-in component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
monthlychart = LBMonthlyChart(data=timeop.daily)  # -> report, data_mesh, data_lines, col_lines, legend, borders, labels, y_title, title, vis_set; plug-in component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
hourlyplot = LBHourlyPlot(data=importepw.dry_bulb_temperature, z_dim=Slider(0, range=0..100), reverse_y=Toggle(True), legend_par=legendpar)  # -> report, mesh, legend, borders, labels, title, vis_set; plug-in component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

# ----
merge = Merge(
    Data1=windrose.mesh,
    Data2=windrose.compass,
    Data3=windrose.orient_line,
    Data4=windrose.freq_line,
    Data5=windrose.windrose_line,
    Data6=windrose.legend,
    Data7=windrose.title)

# ---- group: Direct sun hours
target_geometry_4 = Geometry(target_geometry_2)
context_geometry_2 = Geometry(target_geometry)
run_direct_sun_hours_study = Boolean(run_weather_visualisation_2)
directsunhours = LBDirectSunHours(
    vectors=flatten(sunpath.vectors),
    geometry=flatten(target_geometry_4),
    context=flatten(context_geometry_2),
    grid_size=Slider(1, range=0..10),
    offset_dist=Slider(0.1, range=0..1),
    run=run_direct_sun_hours_study)  # -> report, points, results, mesh, legend, title, int_mtx; plug-in component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

# ---- group: Sky mask
sky_mask_centre_point_2 = Point(sky_mask_centre_point)
symask = LBSkyMask(
    context=context_geometry_2,
    density=Slider(3, range=0..10),
    center=sky_mask_centre_point_2,
    scale=Slider(0.1, range=0..1))  # -> report, context_mask, orient_mask, strategy_mask, sky_mask, context_view, orient_view, strategy_view, sky_view; plug-in component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

# ----
merge_2 = Merge(Data1=skydome.mesh, Data2=skydome.compass, Data3=skydome.legend, Data4=skydome.title)  # -> flatten(SkyDome)
merge_3 = Merge(
    Data1=monthlychart.data_mesh,
    Data2=monthlychart.legend,
    Data3=monthlychart.borders,
    Data4=monthlychart.labels,
    Data5=monthlychart.y_title,
    Data6=monthlychart.title)  # -> flatten(DryBulbTemperatureLineChart)
merge_4 = Merge(Data1=incidentradiation.mesh, Data2=incidentradiation.legend, Data3=incidentradiation.title)  # -> flatten(IncidentRadiation)
merge_5 = Merge(
    Data1=hourlyplot.mesh,
    Data2=hourlyplot.legend,
    Data3=hourlyplot.borders,
    Data4=hourlyplot.labels,
    Data5=hourlyplot.title)
sky_dome = ClusterOutput(merge_2)
wind_rose = ClusterOutput(merge)
dry_bulb_temperature_line_chart = ClusterOutput(merge_3)
dry_bulb_temperature_2d_chart = ClusterOutput(merge_5)
direct_sun_hours = Merge(Data1=directsunhours.mesh, Data2=directsunhours.legend, Data3=directsunhours.title)  # -> flatten(DirectSunHours)
direct_sun_hours_2 = ClusterOutput(direct_sun_hours)
incident_radiation = ClusterOutput(merge_4)
merge_6 = Merge(Data1=symask.context_mask, Data2=symask.sky_mask)
sky_mask = ClusterOutput(merge_6)

# ==== cluster Cluster_3
min = ClusterInput()
max = ClusterInput()
colors = ClusterInput()
legendpar = LBLegendParameters(min=min, max=max, colors=colors)  # -> leg_par; plug-in component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
leg_par = ClusterOutput(legendpar)

# ==== cluster Cluster_4
int = ClusterInput()
number_slider = Slider(2, range=0..10)
int_2 = Integer(int)
fragment = TextFragment(Text=int_2, Start="0", Count=number_slider)
fragment_2 = TextFragment(Text=int_2, Start=number_slider)
len = TextLength(Text=fragment_2)
addition = Addition(A=fragment, B="1")
equals = Equality(FirstNumber="0", SecondNumber=fragment)  # -> Equality, Inequality
filter = StreamFilter(Gate=equals.Equality, Stream0=addition, Stream1=fragment)
_10º = PowerOf10(Value=len)
multiplication = Multiplication(A=_10º, B=filter)
R = ClusterOutput(multiplication)

# ==== cluster Cluster_5
x = ClusterInput()
abs = Absolute(Value=x)
number_slider = Slider(2, range=0..10)
int = Integer(abs)
fragment = TextFragment(Text=int, Start="0", Count=number_slider)
fragment_2 = TextFragment(Text=int, Start=number_slider)
equals = Equality(FirstNumber="0", SecondNumber=fragment)  # -> Equality, Inequality
len = TextLength(Text=fragment_2)
addition = Addition(A=fragment, B="1")
filter = StreamFilter(Gate=equals.Equality, Stream0=addition, Stream1=fragment)
_10º = PowerOf10(Value=len)
multiplication = Multiplication(A=_10º, B=filter)
neg = Negative(Value=multiplication)
y = ClusterOutput(neg)

# ==== cluster Cluster_6
legendpar = LBLegendParameters(min=Slider(0, range=0..100), max=Slider(100, range=0..100), num_decimals=Slider(0, range=0..100))  # -> leg_par; plug-in component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
leg_par = ClusterOutput(legendpar)
