# Grasshopper definition heathUI_0.7.6-dev.gh (Grasshopper 1.0.8)
# plug-ins: RhinoCodePluginGH, Heteroptera, Human UI, Human, LadybugGrasshopper, MetaHopper, eleFront, Wombat, Telepathy

number_slider = Slider(525, range=0..1000)
number_slider_2 = Slider(1000, range=0..1000)
subtraction = Subtraction(A=number_slider_2, B=Slider(215, range=0..1000))
subtraction_2 = Subtraction(A=number_slider, B=Slider(100, range=0..100))
bar_chart_popup_win_width = RemoteSender(number_slider_2)
bar_chart_popup_win_height = RemoteSender(number_slider)
bar_chart_img_height = RemoteSender(subtraction_2)
bar_chart_img_width = RemoteSender(subtraction)

# ----
# Click here
# LICENSE/SUPPORT
# Copyright (c) 2024, Heath.
# 
# You should have received a copy of the GNU Affero General Public License along with Heath; If not, see <http://www.gnu.org/licenses/>.
# 
# @license AGPL-3.0-or-later <https://spdx.org/licenses/AGPL-3.0-or-later>
# Contact
# Github: github.com/sawenchalmers/heath
# 
# Author: Toivo Säwén, sawen@chalmers.se
# 
# Contributors: Isac Mjörnell, misac@chalmers.se, Jieming Yan, jieming@chalmers.se
button = Button()
restart_heath = RemoteSender(button)

heath_geometry_type_key = RemoteSender("Heath geometry type")

# ----
# Sends signal when recompute
panel = Panel("recompute")
button_2 = CreateButton(ButtonName=panel, ButtonStyle=0)
values = ValueListener(Elements=button_2, SomeProperty=True)  # -> Values, Indices
freeze_gate = StreamFreezeGate(Data=values.Values, PassingSwitch=invert(values.Values))
bool = Boolean(invert(freeze_gate))
tap = TapBuffer(Reset=False, Incremental=True, Valve=bool, Hold=True)
dam = DataDam(DataA=tap, BufferDelay=2500000, BufferMode=2)
equals = Equality(FirstNumber=tap, SecondNumber=dam)  # -> Equality, Inequality
event = EventGate(Data=equals.Inequality)  # -> Data, IsNew
recompute = RemoteSender(event.Data)

bar_chart_popup_win_height_2 = RemoteReceiver(bar_chart_popup_win_height)
bar_chart_popup_win_width_2 = RemoteReceiver(bar_chart_popup_win_width)
heath_geometry_type_key_2 = RemoteReceiver(heath_geometry_type_key)
bar_chart_img_height_2 = RemoteReceiver(bar_chart_img_height)
bar_chart_img_width_2 = RemoteReceiver(bar_chart_img_width)
bar_chart_popup_win_height_3 = RemoteReceiver(bar_chart_popup_win_height)
bar_chart_popup_win_width_3 = RemoteReceiver(bar_chart_popup_win_width)
heath_geometry_type_key_3 = RemoteReceiver(heath_geometry_type_key)
heath_geometry_type_key_4 = RemoteReceiver(heath_geometry_type_key)
heath_geometry_type_key_5 = RemoteReceiver(heath_geometry_type_key)
heath_geometry_type_key_6 = RemoteReceiver(heath_geometry_type_key)
bar_chart_img_height_3 = RemoteReceiver(bar_chart_img_height)
bar_chart_img_width_3 = RemoteReceiver(bar_chart_img_width)
bar_chart_popup_win_height_4 = RemoteReceiver(bar_chart_popup_win_height)
bar_chart_popup_win_width_4 = RemoteReceiver(bar_chart_popup_win_width)
bar_chart_img_height_4 = RemoteReceiver(bar_chart_img_height)
bar_chart_img_width_4 = RemoteReceiver(bar_chart_img_width)
heath_geometry_type_key_7 = RemoteReceiver(heath_geometry_type_key)

# ----
# CLICK BUTTON
# TO RESTART
# HEATH
number_slider_3 = Slider(500, range=0..1000)
selobj = GetSelectedObjects()  # -> ComponentObjects, ParamObjects, OtherObjects
# Color codes
# UI module elements
# UI launch windows
# Front-end database
# Back-end database
setscribble = SetScribbleProperties(Scribble=selobj.OtherObjects, ScribbleSize=number_slider_3)

heath_geometry_type_key_8 = RemoteReceiver(heath_geometry_type_key)
panel_2 = Panel("""All
Walls
Roof
Floors
Ground
Windows
Context""")

number_slider_4 = Slider(1, range=0..1)  # disabled
number_slider_5 = Slider(5, range=0..10)  # disabled
number_slider_6 = Slider(5, range=0..10)  # disabled
number_slider_7 = Slider(5, range=0..10)  # disabled
number_slider_8 = Slider(1, range=0..10)  # disabled
number_slider_9 = Slider(50, range=0..100)  # disabled
number_slider_10 = Slider(50, range=0..100)  # disabled
number_slider_11 = Slider(50, range=0..100)  # disabled
panel_3 = Panel("Louver depth")  # disabled
panel_4 = Panel("Number of louvers")  # disabled
panel_5 = Panel("Distance between louvers")  # disabled
panel_6 = Panel("Louver angle")  # disabled
slider = CreateSlider(
    Slider=number_slider_9,
    SnapValue=number_slider_5,
    ShowBounds=False,
    ShowTicks=True,
    ShowTooltip=False,
    ShowValLabel=True,
    showLabel=False)  # disabled
slider_2 = CreateSlider(
    Slider=number_slider_10,
    SnapValue=number_slider_7,
    ShowBounds=False,
    ShowTicks=True,
    ShowTooltip=False,
    ShowValLabel=True,
    showLabel=False)  # disabled
slider_3 = CreateSlider(
    Slider=number_slider_8,
    SnapValue=number_slider_4,
    ShowBounds=False,
    ShowTicks=True,
    ShowTooltip=False,
    ShowValLabel=True,
    showLabel=False)  # disabled
label = CreateLabel(LabelText=panel_3, LabelSize=12, Justification=0)  # disabled
label_2 = CreateLabel(LabelText=panel_5, LabelSize=12, Justification=0)  # disabled
label_3 = CreateLabel(LabelText=panel_4, LabelSize=12, Justification=0)  # disabled
slider_4 = CreateSlider(
    Slider=number_slider_11,
    SnapValue=number_slider_6,
    ShowBounds=False,
    ShowTicks=True,
    ShowTooltip=False,
    ShowValLabel=True,
    showLabel=False)  # disabled
label_4 = CreateLabel(LabelText=panel_6, LabelSize=12, Justification=0)  # disabled
values_2 = ValueListener(Elements=slider_3, SomeProperty=True)  # -> Values, Indices; disabled
values_3 = ValueListener(Elements=slider_2, SomeProperty=True)  # -> Values, Indices; disabled
values_4 = ValueListener(Elements=slider, SomeProperty=True)  # -> Values, Indices; disabled
values_5 = ValueListener(Elements=slider_4, SomeProperty=True)  # -> Values, Indices; disabled
entwine = Entwine(Branch00=label, Branch01=slider, FlattenInputs=True)  # -> flatten(Result); disabled
entwine_2 = Entwine(Branch00=label_2, Branch01=slider_2, FlattenInputs=True)  # -> flatten(Result); disabled
entwine_3 = Entwine(Branch00=label_3, Branch01=slider_3, FlattenInputs=True)  # -> flatten(Result); disabled
entwine_4 = Entwine(Branch00=label_4, Branch01=slider_4, FlattenInputs=True)  # -> flatten(Result); disabled
louver_depth = RemoteSender(values_4.Values)  # disabled
louver_angle = RemoteSender(values_5.Values)  # disabled
distance_between_louvers = RemoteSender(values_3.Values)  # disabled
number_of_louvers = RemoteSender(values_2.Values)  # disabled
stack = CreateStack(UIElements=entwine, Horizontal=invert(True))  # disabled
stack_2 = CreateStack(UIElements=entwine_2, Horizontal=invert(True))  # disabled
stack_3 = CreateStack(UIElements=entwine_3, Horizontal=invert(True))  # disabled
stack_4 = CreateStack(UIElements=entwine_4, Horizontal=invert(True))  # disabled
number_of_louvers_2 = RemoteReceiver(number_of_louvers)  # disabled
number_of_louvers_3 = RemoteReceiver(number_of_louvers)  # disabled
number_of_louvers_4 = RemoteReceiver(number_of_louvers)  # disabled
hideshow = HideShowElement(ElementToHideShow=stack, Show=number_of_louvers_2, Collapse=True, Disable=False)  # disabled
hideshow_2 = HideShowElement(ElementToHideShow=stack_4, Show=number_of_louvers_4, Collapse=True, Disable=False)  # disabled
hideshow_3 = HideShowElement(ElementToHideShow=stack_2, Show=number_of_louvers_3, Collapse=True, Disable=False)  # disabled
entwine_5 = Entwine(Branch00=stack_3, Branch01=stack, Branch02=stack_2, Branch03=stack_4, FlattenInputs=True)  # -> flatten(Result); disabled
stack_5 = CreateStack(UIElements=entwine_5, Horizontal=True)  # disabled

checklist = CreateChecklist(ChecklistItems=panel_2, Selected=False)
button_3 = CreateButton(ButtonName="Zoom", ButtonStyle=0)
values_6 = ValueListener(Elements=checklist, SomeProperty=True)  # -> Values, Indices
pulldown = CreatePulldownMenu(Label="Select model", showLabel=True)
panel_7 = Panel("Operational GWP per area: {0} kg CO2eq/m2,year")
tb = CreateTextBlock(TextSize=12, Justification=0)
pulldown_2 = CreatePulldownMenu(Label="Compare with", showLabel=True)
button_4 = CreateButton(ButtonName="Calculate LCA", ButtonStyle=0)
values_7 = ValueListener(Elements=button_3, SomeProperty=True)  # -> Values, Indices
label_5 = CreateLabel(LabelText="Compare simulations", LabelSize=18, Justification=0)
true_button = CreateTrueOnlyButton(ButtonName="Compare simulations bar chart", ButtonStyle=0)
pulldown_3 = CreatePulldownMenu(Label="Select model", showLabel=True)
tb_2 = CreateTextBlock(TextSize=16, Justification=0)
item = ListItem(List=values_6.Values, Index=0, Wrap=invert(True))  # -> Item, Item1, Item2, Item3, Item4, Item5, Item6
cull = CullPattern(List=values_6.Values, CullPattern=values_6.Values)
panel_8 = Panel("""Current simulation: 
{0}""")
relay = Relay()
values_8 = ValueListener(Elements=pulldown, SomeProperty=True)  # -> Values, Indices
tb_3 = CreateTextBlock(TextSize=16, Justification=0)
button_5 = CreateButton(ButtonName="Bake", ButtonStyle=0)
panel_9 = Panel("""Current simulation: 
{0}""")
values_9 = ValueListener(Elements=pulldown_2, SomeProperty=True)  # -> Values, Indices
zoom_honeybee_model = RemoteSender(values_7.Values)
values_10 = ValueListener(Elements=button_4, SomeProperty=True)  # -> Values, Indices
values_11 = ValueListener(Elements=true_button, SomeProperty=True)  # -> Values, Indices
null = NullItem(Item=cull)  # -> NullFlags, InvalidFlags, Description
values_12 = ValueListener(Elements=pulldown_3, SomeProperty=True)  # -> Values, Indices
event_2 = EventGate(Data=values_8.Indices)  # -> Data, IsNew
values_13 = ValueListener(Elements=button_5, SomeProperty=True)  # -> Values, Indices
tb_4 = CreateTextBlock(TextSize=16, Justification=0)
panel_10 = Panel("""Selected model: 
{0}""")
pre_calculate_lca = RemoteSender(values_10.Values)
event_3 = EventGate(Data=values_12.Indices)  # -> Data, IsNew
subtraction_3 = Subtraction(A=values_9.Indices, B="1")
label_6 = CreateLabel(LabelText=panel_7, LabelSize=12, Justification=0)
filter = StreamFilter(Gate=null.NullFlags, Stream0=cull, Stream1="False")
simple_energy_simulation_compare_pop_up = RemoteSender(values_11.Values)
recompute_2 = RemoteReceiver(recompute)
current_selected_model_analysis_module_n = RemoteSender(values_12.Values)  # "current_selected_model_analysis_module_name"
current_selected_model_analysis_module_n_2 = RemoteReceiver(current_selected_model_analysis_module_n)  # "current_selected_model_analysis_module_name"
current_selected_model_analysis_module_n_3 = RemoteReceiver(current_selected_model_analysis_module_n)  # "current_selected_model_analysis_module_name"
current_selected_model_analysis_module_n_4 = RemoteReceiver(current_selected_model_analysis_module_n)  # "current_selected_model_analysis_module_name"
format = Format(Format=panel_8, Culture=127, Data0=current_selected_model_analysis_module_n_2)
panel_11 = Panel("""False
True""")
panel_12 = Panel("""False
True""")
recompute_3 = RemoteReceiver(recompute)
format_2 = Format(Format=panel_9, Culture=127, Data0=current_selected_model_analysis_module_n_3)
current_selected_model_visualise_module = RemoteSender(event_2.Data)
bake_daylight_simulation = RemoteSender(values_13.Values)
event_4 = EventGate(Data=filter)  # -> Data, IsNew
current_selected_model_analysis_module = RemoteSender(event_3.Data)
settextblock = SetTextBlockContents(TextBlockToModify=tb_2, NewTextBlockContents=format)
current_selected_simulation_simple_energ = RemoteSender(subtraction_3)  # "current_selected_simulation_simple_energy_compare"
format_3 = Format(Format=panel_10, Culture=127, Data0=current_selected_model_analysis_module_n_4)
settextblock_2 = SetTextBlockContents(TextBlockToModify=tb_3, NewTextBlockContents=format_2)
show_honeybee_element = RemoteSender(event_4.Data)
settextblock_3 = SetTextBlockContents(TextBlockToModify=tb_4, NewTextBlockContents=format_3)
format_4 = Format(Format="{0}, {1}, 0, 0", Culture=127, Data0=Slider(0, range=-25..25), Data1=Slider(0, range=0..100))
format_5 = Format(Format="{0}, {1}, 0, 0", Culture=127, Data0=Slider(5, range=-25..25), Data1=Slider(8, range=0..100))
current_selected_model_analysis_module_n_5 = RemoteReceiver(current_selected_model_analysis_module_n)  # "current_selected_model_analysis_module_name"
adjustpos = AdjustElementPositioning(
    ElementsToAdjust=pulldown,
    Margin=format_4,
    AbsolutePositioning=False,
    Width=Slider(300, range=0..400),
    HorizontalAlignment=0,
    VerticalAlignment=2)
adjustpos_2 = AdjustElementPositioning(
    ElementsToAdjust=pulldown_3,
    Margin=format_5,
    AbsolutePositioning=False,
    Width=Slider(300, range=0..400),
    HorizontalAlignment=0,
    VerticalAlignment=2)
format_6 = Format(
    Format="{0}, {1}, {2}, {3}",
    Culture=127,
    Data0=Slider(0, range=-25..25),
    Data1=Slider(10, range=0..100),
    Data2=Slider(0, range=0..100),
    Data3=Slider(-5, range=-25..25))
format_7 = Format(
    Format="{0}, {1}, 0, {2}",
    Culture=127,
    Data0=Slider(5, range=-25..25),
    Data1=Slider(10, range=0..100),
    Data2=Slider(5, range=0..100))
format_8 = Format(
    Format="{0}, {1}, 0, {2}",
    Culture=127,
    Data0=Slider(5, range=-25..25),
    Data1=Slider(10, range=0..100),
    Data2=Slider(5, range=0..100))
format_9 = Format(
    Format="{0}, {1}, 0, {2}",
    Culture=127,
    Data0=Slider(5, range=-25..25),
    Data1=Slider(5, range=-15..15),
    Data2=Slider(5, range=0..100))
format_10 = Format(
    Format="{0}, {1}, 0, {2}",
    Culture=127,
    Data0=Slider(10, range=-25..25),
    Data1=Slider(5, range=-15..15),
    Data2=Slider(5, range=0..100))
format_11 = Format(
    Format="{0}, {1}, 0, {2}",
    Culture=127,
    Data0=Slider(10, range=-25..25),
    Data1=Slider(5, range=0..100),
    Data2=Slider(5, range=0..100))
adjustpos_3 = AdjustElementPositioning(ElementsToAdjust=button_3, Margin=format_6, AbsolutePositioning=False, HorizontalAlignment=1, VerticalAlignment=2)
adjustpos_4 = AdjustElementPositioning(
    ElementsToAdjust=tb_3,
    Margin=format_7,
    AbsolutePositioning=False,
    Width=Slider(245, range=0..300),
    HorizontalAlignment=0,
    VerticalAlignment=2)
format_12 = Format(
    Format="{0}, {1}, {2}, {3}",
    Culture=127,
    Data0=Slider(0, range=-10..10),
    Data1=Slider(0, range=-10..10),
    Data2=Slider(0, range=-10..10),
    Data3=Slider(4.5, range=-10..10))
format_13 = Format(
    Format="{0}, {1}, 0, {2}",
    Culture=127,
    Data0=Slider(5, range=-25..25),
    Data1=Slider(10, range=0..100),
    Data2=Slider(5, range=0..100))
format_14 = Format(
    Format="{0}, {1}, {2}, {3}",
    Culture=127,
    Data0=Slider(0, range=-10..10),
    Data1=Slider(0, range=-10..10),
    Data2=Slider(4.5, range=-10..10),
    Data3=Slider(0, range=-10..10))
adjustpos_5 = AdjustElementPositioning(
    ElementsToAdjust=tb_2,
    Margin=format_8,
    AbsolutePositioning=False,
    Width=Slider(245, range=0..300),
    HorizontalAlignment=0,
    VerticalAlignment=2)
hasdata = DataExists(Data=current_selected_model_analysis_module_n_5)
entwine_6 = Entwine(Branch00=label_5, Branch01=true_button, Branch02=pulldown_2, FlattenInputs=True)  # -> flatten(Result)
adjustpos_6 = AdjustElementPositioning(
    ElementsToAdjust=pulldown_2,
    Margin=format_9,
    AbsolutePositioning=False,
    Width=Slider(245, range=0..300),
    HorizontalAlignment=0,
    VerticalAlignment=2)
adjustelem = AdjustElementAppearance(ElementsToAdjust=tb, Foreground=ColourSwatch(SwatchColor=RGB(25, 25, 25)))
adjustpos_7 = AdjustElementPositioning(
    ElementsToAdjust=tb,
    Margin=format_11,
    AbsolutePositioning=False,
    Width=Slider(245, range=0..300),
    HorizontalAlignment=0,
    VerticalAlignment=2)
adjustpos_8 = AdjustElementPositioning(ElementsToAdjust=true_button, Margin=format_10, AbsolutePositioning=False, HorizontalAlignment=0, VerticalAlignment=2)
adjustpos_9 = AdjustElementPositioning(ElementsToAdjust=button_4, AbsolutePositioning=False, HorizontalAlignment=0)
adjustpos_10 = AdjustElementPositioning(
    ElementsToAdjust=tb_4,
    Margin=format_13,
    AbsolutePositioning=False,
    Width=Slider(245, range=0..300),
    HorizontalAlignment=0,
    VerticalAlignment=2)
hideshow_4 = HideShowElement(ElementToHideShow=tb_4, Show=hasdata, Collapse=True, Disable=False)

# ----
# Louvers
location = Data(stack_5)  # disabled

stack_6 = CreateStack(UIElements=entwine_6, Horizontal=invert(True))

# ----
# Glare simulations info
panel_13 = Panel("?")  # disabled
true_button_2 = CreateTrueOnlyButton(ButtonName=panel_13, ButtonStyle=2)  # disabled
values_14 = ValueListener(Elements=true_button_2, SomeProperty=True)  # -> Values, Indices; disabled
glare_info = RemoteSender(values_14.Values)  # disabled
number_slider_12 = Slider(29, range=0..300)  # disabled
number_slider_13 = Slider(12, range=0..300)  # disabled
panel_14 = Panel("5, 0, 0, 0")  # disabled
swatch = ColourSwatch(SwatchColor=RGB(230, 230, 230))  # disabled
swatch_2 = ColourSwatch(SwatchColor=RGB(0, 0, 0))  # disabled
adjustpos_11 = AdjustElementPositioning(
    ElementsToAdjust=true_button_2,
    Margin=panel_14,
    AbsolutePositioning=False,
    Width=number_slider_12,
    Height=number_slider_12)  # disabled
adjustelem_2 = AdjustElementAppearance(ElementsToAdjust=true_button_2, Foreground=swatch_2, Background=swatch, FontSize=number_slider_13)  # disabled

# ----
# Select model
select_model = Data(pulldown_3)

# ----
# LCA info
panel_15 = Panel("?")
true_button_3 = CreateTrueOnlyButton(ButtonName=panel_15, ButtonStyle=2)
values_15 = ValueListener(Elements=true_button_3, SomeProperty=True)  # -> Values, Indices
lca_info = RemoteSender(values_15.Values)
number_slider_14 = Slider(29, range=0..300)
adjustpos_12 = AdjustElementPositioning(
    ElementsToAdjust=true_button_3,
    Margin="5, 0, 0, 0",
    AbsolutePositioning=False,
    Width=number_slider_14,
    Height=number_slider_14)
adjustelem_3 = AdjustElementAppearance(
    ElementsToAdjust=true_button_3,
    Foreground=ColourSwatch(SwatchColor=RGB(0, 0, 0)),
    Background=ColourSwatch(SwatchColor=RGB(230, 230, 230)),
    FontSize=Slider(12, range=0..300))

# ----
# Select model
select_model_2 = Data(pulldown)

# ----
# Daylight simulations info
panel_16 = Panel("?")
true_button_4 = CreateTrueOnlyButton(ButtonName=panel_16, ButtonStyle=2)
values_16 = ValueListener(Elements=true_button_4, SomeProperty=True)  # -> Values, Indices
daylight_info = RemoteSender(values_16.Values)
number_slider_15 = Slider(29, range=0..300)
adjustpos_13 = AdjustElementPositioning(
    ElementsToAdjust=true_button_4,
    Margin="5, 0, 0, 0",
    AbsolutePositioning=False,
    Width=number_slider_15,
    Height=number_slider_15)
adjustelem_4 = AdjustElementAppearance(
    ElementsToAdjust=true_button_4,
    Foreground=ColourSwatch(SwatchColor=RGB(0, 0, 0)),
    Background=ColourSwatch(SwatchColor=RGB(230, 230, 230)),
    FontSize=Slider(12, range=0..300))

# ----
# Energy simulations info
panel_17 = Panel("?")
true_button_5 = CreateTrueOnlyButton(ButtonName=panel_17, ButtonStyle=2)
values_17 = ValueListener(Elements=true_button_5, SomeProperty=True)  # -> Values, Indices
simple_energy_info = RemoteSender(values_17.Values)
number_slider_16 = Slider(29, range=0..300)
adjustpos_14 = AdjustElementPositioning(
    ElementsToAdjust=true_button_5,
    Margin="5, 0, 0, 0",
    AbsolutePositioning=False,
    Width=number_slider_16,
    Height=number_slider_16)
adjustelem_5 = AdjustElementAppearance(
    ElementsToAdjust=true_button_5,
    Foreground=ColourSwatch(SwatchColor=RGB(0, 0, 0)),
    Background=ColourSwatch(SwatchColor=RGB(230, 230, 230)),
    FontSize=Slider(12, range=0..300))

# ----
# Launch  glare simulations info
panel_18 = Panel("https://www.boverket.se/en/start/publications/2019/boverkets-building-regulations--mandatory-provisions-and-general-recommendations-bbr/")  # disabled

# ----
# Launch  LCA info
panel_19 = Panel("https://en.wikipedia.org/wiki/Life-cycle_assessment")
lca_info_2 = RemoteReceiver(lca_info)
py3 = Python3Script(url=panel_19, launch=lca_info_2)
# ---------- py3: Python ----------
"""Grasshopper Script"""
import webbrowser as wb
if launch == True:
    wb.open(url, 2, True)
# ---------- end py3 ----------

glare_info_2 = RemoteReceiver(glare_info)  # disabled
py3_2 = Python3Script(url=panel_18, launch=glare_info_2)  # disabled; same code as py3

# ----
# Launch  daylight simulations info
panel_20 = Panel("https://www.ladybug.tools/honeybee.html#illuminance")
daylight_info_2 = RemoteReceiver(daylight_info)
py3_3 = Python3Script(url=panel_20, launch=daylight_info_2)  # same code as py3

# ----
# Launch energy simulations info
panel_21 = Panel("https://www.ladybug.tools/honeybee.html#energyBal")
simple_energy_info_2 = RemoteReceiver(simple_energy_info)
py3_4 = Python3Script(url=panel_21, launch=simple_energy_info_2)  # same code as py3

# ----
# For user to interact with
# Testing
# Needs work...
# Under development
# Global parameters
panel_22 = Panel("hello")
hello = RemoteSender(panel_22)
panel_23 = Panel("""0.7.0
0.7.1
0.8.0""")

# ----
# Create construction
panel_24 = Panel("gypsum")  # disabled
panel_25 = Panel("insulation")  # disabled
panel_26 = Panel("concrete")  # disabled
panel_27 = Panel("plywood")  # disabled
panel_28 = Panel("air")  # disabled
number_slider_17 = Slider(0.036, range=0..0.1)  # disabled
number_slider_18 = Slider(0.3, range=0..1)  # disabled
number_slider_19 = Slider(1500, range=0..10000)  # disabled
number_slider_20 = Slider(28, range=0..100)  # disabled
searchmats = HBSearchMaterials(keywords=panel_25)  # -> opaque_mats, window_mats; disabled; plug-in component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
searchmats_2 = HBSearchMaterials(keywords=panel_26)  # -> opaque_mats, window_mats; disabled; plug-in component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
searchmats_3 = HBSearchMaterials()  # -> opaque_mats, window_mats; disabled; plug-in component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
searchmats_4 = HBSearchMaterials(keywords=panel_28)  # -> opaque_mats, window_mats; disabled; plug-in component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
searchmats_5 = HBSearchMaterials(keywords=panel_27)  # -> opaque_mats, window_mats; disabled; plug-in component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
searchmats_6 = HBSearchMaterials(keywords=panel_24)  # -> opaque_mats, window_mats; disabled; plug-in component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
panel_29 = Panel("XPS insulation")  # disabled
searchconstrs = HBSearchConstructions()  # -> opaque_constrs, window_constrs, shade_constrs; disabled; plug-in component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
searchconstrs_2 = HBSearchConstructions()  # -> opaque_constrs, window_constrs, shade_constrs; disabled; plug-in component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
list = ItemSelector(
    searchmats.opaque_mats,
    {"AtticFloor Insulation", "Generic 25mm Insulation", "Generic 50mm Insulation", "I01 25mm insulation board", "I02 50mm insulation board", "IEAD NonRes Roof Insulation-1.76", "IEAD Roof Insulation R-3.47 IP", "Insulation 1m", "Mass NonRes Wall Insulation-0.43", "Mass Wall Insulation R-4.23 IP"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}, selected="AtticFloor Insulation")  # disabled
number_slider_21 = Slider(0.1, range=0..1)  # disabled
list_2 = ItemSelector(
    searchmats_2.opaque_mats,
    {"100mm Normalweight concrete floor", "12 in. Normalweight Concrete Floor", "4 in. Normalweight Concrete Floor", "4 in. Normalweight Concrete Wall", "6 in. Heavyweight Concrete Roof", "6 in. Normalweight Concrete Floor", "8 in. Concrete Block Basement Wall", "8 in. Concrete Block Wall", "8 in. Normalweight Concrete Floor", "8 in. Normalweight Concrete Wall", "8IN CONCRETE HW RefBldg", "8IN Concrete HW", "Concrete Pavement", "Generic HW Concrete", "Generic LW Concrete", "HW CONCRETE", "HW CONCRETE 8 in", "M11 100mm lightweight concrete", "M15 200mm heavyweight concrete", "MAT-CC05 4 HW CONCRETE", "MAT-CC05 8 HW CONCRETE", "NACM_Concrete 4in_140lb/ft3"}, selected="100mm Normalweight concrete floor")  # disabled
list_3 = ItemSelector(
    searchmats_6.opaque_mats,
    {"1/2 in. Gypsum Board", "1/2IN Gypsum", "5/8 in. Gypsum Board", "G01 13mm gypsum board", "G01a 19mm gypsum board", "Generic Gypsum Board", "Gypsum Board - 1/2 in. CBES", "Gypsum Or Plaster Board - 3/8 in.", "NACM_Gypsum Board 5/8in"}, selected="1/2 in. Gypsum Board")  # disabled
list_4 = ItemSelector(
    searchmats_4.opaque_mats,
    {"F04 Wall air space resistance", "F05 Ceiling air space resistance", "Generic Ceiling Air Gap", "Generic Wall Air Gap", "Typical Air Wall"}, selected="F04 Wall air space resistance")  # disabled
list_5 = ItemSelector(searchmats_5.opaque_mats, {"5/8 in. Plywood", "Plywood - 5/8 in. CBES"}, selected="5/8 in. Plywood")  # disabled
number_slider_22 = Slider(0.016, range=0..0.1)  # disabled
number_slider_23 = Slider(0.11, range=0..1)  # disabled
number_slider_24 = Slider(0.3, range=0..1)  # disabled
number_slider_25 = Slider(0.012, range=0..0.1)  # disabled
opaquemat = HBOpaqueMaterial(
    name=panel_29,
    thickness=number_slider_18,
    conductivity=number_slider_17,
    density=number_slider_20,
    spec_heat=number_slider_19)  # -> mat; disabled; plug-in component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
list_6 = ItemSelector(
    searchconstrs.window_constrs,
    {"ASHRAE 189.1-2009 ExtWindow ClimateZone 1", "ASHRAE 189.1-2009 ExtWindow ClimateZone 2", "ASHRAE 189.1-2009 ExtWindow ClimateZone 3", "ASHRAE 189.1-2009 ExtWindow ClimateZone 4-5", "ASHRAE 189.1-2009 ExtWindow ClimateZone 6", "ASHRAE 189.1-2009 ExtWindow ClimateZone 7-8"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}, selected="U 0.17 SHGC 0.36 Simple Glazing Window")  # disabled
list_7 = ItemSelector(
    searchconstrs_2.window_constrs,
    {"ASHRAE 189.1-2009 ExtWindow ClimateZone 1", "ASHRAE 189.1-2009 ExtWindow ClimateZone 2", "ASHRAE 189.1-2009 ExtWindow ClimateZone 3", "ASHRAE 189.1-2009 ExtWindow ClimateZone 4-5", "ASHRAE 189.1-2009 ExtWindow ClimateZone 6", "ASHRAE 189.1-2009 ExtWindow ClimateZone 7-8"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}, selected="ASHRAE 189.1-2009 ExtWindow ClimateZone 1")  # disabled
panel_30 = Panel("Construction 1")  # disabled
merge = Merge(Data1=list_2, Data2=list_4, Data3=list_5, Data4=opaquemat, Data5=list_3)  # disabled
merge_2 = Merge(Data1=number_slider_21, Data2=number_slider_23, Data3=number_slider_22, Data4=number_slider_18, Data5=number_slider_25)  # disabled
interiorsubset = HBInteriorConstructionSubset()  # -> interior_set; disabled; plug-in component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
groundsubset = HBGroundConstructionSubset()  # -> ground_set; disabled; plug-in component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
panel_31 = Panel("0.042")  # disabled
panel_32 = Panel("38.2")  # disabled
panel_33 = Panel("2.5")  # disabled
cluster = Cluster(materials=merge, construction_name=panel_30, thicknesses=merge_2)  # -> error_2, construction_2; disabled
cluster_2 = Cluster_2(window_construction=list_7, gwp_a1_a3=panel_33, gwp_a4=panel_31, density_kg_m2=panel_32)  # disabled
bldgvintages = HBBuildingVintages({"ASHRAE 90.1 2019  |  IECC 2021": "2019", "ASHRAE 90.1 2016  |  IECC 2018": "2016", "ASHRAE 90.1 2013  |  IECC 2015": "2013", "ASHRAE 90.1 2010  |  IECC 2012": "2010", "ASHRAE 90.1 2007  |  IECC 2009": "2007", "ASHRAE 90.1 2004  |  IECC 2006": "2004", "1980-2004 (CBECS)": "1980_2004", "Pre-1980 (CBECS)": "pre_1980"}, selected="ASHRAE 90.1 2019  |  IECC 2021")  # disabled
decnstrconstr = HBDeconstructConstruction(constr=list_6)  # -> materials, layers, r_val_si, r_val_ip, u_fac_si, u_fac_ip, shgc, t_sol, t_vis; disabled; plug-in component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
constructiontypes = HBConstructionTypes({"SteelFramed", "WoodFramed", "Mass", "Metal Building"}, selected="WoodFramed")  # disabled
climatezones = HBClimateZones({"1 - Very Hot": "1", "2 - Hot": "2", "3 - Warm": "3", "4 - Mixed": "4", "5 - Cool": "5", "6 - Cold": "6", "7 - Very Cold": "7", "8 - Subarctic": "8"}, selected="5 - Cool")  # disabled
data = Data(cluster_2)  # disabled
panel_34 = Panel(decnstrconstr.u_fac_ip)  # disabled
panel_35 = Panel(decnstrconstr.u_fac_si)  # disabled
exteriorsubset = HBExteriorConstructionSubset(exterior_wall=cluster.construction_2)  # -> exterior_set; disabled; plug-in component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
subfacesubset = HBSubfaceSubset(window=data)  # -> subface_set; disabled; plug-in component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
panel_36 = Panel(cluster.construction_2)  # disabled
constrsetclimate = HBConstructionSetByClimate(climate_zone=climatezones, vintage=bldgvintages, constr_type=constructiontypes)  # -> constr_set; disabled; plug-in component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
constructionset = HBConstructionSet(base_constr_set=constrsetclimate, exterior_subset=exteriorsubset, subface_subset=subfacesubset)  # -> constr_set; disabled; plug-in component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
decnstrconstrset = HBDeconstructConstructionSet(constr_set=constructionset)  # -> exterior_wall, exterior_roof, exposed_floor, ground_wall, ground_roof, ground_floor, window, skylight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; disabled; plug-in component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
panel_37 = Panel(decnstrconstrset.exterior_wall)  # disabled

# ----
# Simplified Boverket data
number_slider_26 = Slider(6, range=0..10)
merge_3 = Merge(Data1=Slider(0.8, range=0..10), Data2=Slider(1.2, range=0..10), Data3=Slider(0.8, range=0..10))
merge_4 = Merge(Data1=number_slider_26, Data2=Slider(12, range=0..100), Data3=Slider(6, range=0..10))
python = GhPythonScript(sublist_lengths=merge_4, values=merge_3)  # -> out, out_list; inputs sublist_lengths: list of Int32, values: list
# ---------- python: Python ----------
"""Creates one list from a list of sublist lengths and the value to put in each sublist
    Inputs:
        sublist_lengths: sublist_lengths
        values: value in each sublist
    Output:
        a: The a output variable"""

__author__ = "sawen"
__version__ = "2024.05.24"

import rhinoscriptsyntax as rs

if not (len(sublist_lengths) == len(values)):
    raise Exception("sublist lengths and values must be the same size")

out_list = []

for i in range(len(sublist_lengths)):
    for j in range(int(sublist_lengths[i])):
        out_list.append(values[i])
# ---------- end python ----------
constantschedule = HBConstantSchedule(values=python.out_list, name="household_electricity")  # -> report, schedule, idf_text; plug-in component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

# ----
# Heath UI global settings
accent_colors = ValueList({"Amber", "Blue", "Brown", "Cobalt", "Crimson", "Cyan", "Emerald", "Green", "Indigo", "Lime", "Magenta", "Mauve", "Olive", "Orange", "Pink", "Purple", "Red", "Sienna", "Steel", "Taupe", "Teal", "Violet", "Yellow"}, selected="Brown")
heath_accent_color = RemoteSender(accent_colors)

bool_2 = Boolean("False")
panel_38 = Panel("Materials with an invalid category exists in the Rhino file")
button_6 = CreateButton(ButtonName="Sync database", ButtonStyle=0)
label_7 = CreateLabel(LabelText=panel_38, LabelSize=12, Justification=0)
values_18 = ValueListener(Elements=button_6, SomeProperty=True)  # -> Values, Indices
sync_window_database = RemoteSender(values_18.Values)
adjustelem_6 = AdjustElementAppearance(ElementsToAdjust=label_7, Foreground=ColourSwatch(SwatchColor=RGB(255, 0, 0)))
select_model_3 = Data(select_model)

# ----
# Transparent window
panel_39 = Panel("Import geometry")  # disabled
toggle = BooleanToggle(False)  # disabled
pickbtn = CreateRhinoPickButton(
    ButtonName=panel_39,
    Prompt="Please select geometry...",
    AllowMultiple=invert(True),
    AllowNone=True,
    Type=2,
    ButtonStyle=0)  # disabled
values_19 = ValueListener(Elements=pickbtn, SomeProperty=True)  # -> Values, Indices; disabled
launchxpwin = LaunchTransparentWindow(Show=toggle, Name="Control Window", Width=370, Height=400, ChildStatus=1, EnableHorizScroll=False)  # disabled
addelems = AddElements(Window=launchxpwin, Elements=flatten(pickbtn), DoVLChecking=True)  # -> AddedElements, ElementNames; disabled
panel_40 = Panel(values_19.Values)  # disabled

heath_geometry_type_key_9 = RemoteReceiver(heath_geometry_type_key)
save_program = RemoteReceiver()
heath_accent_color_2 = RemoteReceiver(heath_accent_color)
heath_accent_color_3 = RemoteReceiver(heath_accent_color)
heath_accent_color_4 = RemoteReceiver(heath_accent_color)
heath_accent_color_5 = RemoteReceiver(heath_accent_color)
true_button_6 = CreateTrueOnlyButton(ButtonName="?", ButtonStyle=2)
values_20 = ValueListener(Elements=true_button_6, SomeProperty=True)  # -> Values, Indices
info_save_geometry = RemoteSender(values_20.Values)
number_slider_27 = Slider(29, range=0..300)
format_15 = Format(Format="{0}, {1}, {2}, {3}", Culture=127, Data0=Slider(225, range=100..300))
adjustelem_7 = AdjustElementAppearance(
    ElementsToAdjust=true_button_6,
    Foreground=ColourSwatch(SwatchColor=RGB(0, 0, 0)),
    Background=ColourSwatch(SwatchColor=RGB(230, 230, 230)),
    FontSize=Slider(12, range=0..300))
adjustpos_15 = AdjustElementPositioning(
    ElementsToAdjust=true_button_6,
    Margin=format_15,
    AbsolutePositioning=invert(False),
    HorizontalAlignment=2,
    VerticalAlignment=2)
adjustpos_16 = AdjustElementPositioning(ElementsToAdjust=true_button_6, AbsolutePositioning=False, Width=number_slider_27, Height=number_slider_27)
roomradianceattr = HBRoomRadianceAttributes({"Modifier Set": "properties.radiance.modifier_set.display_name"}, selected="Modifier Set")
applymodset = HBApplyModifierSet()  # -> rooms; plug-in component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
txt = Text("""void plastic generic_wall_0.50
0
0
5 0.5 0.5 0.5 0.0 0.0""")

# ----
# Need to create model
#  to validate, to change
#  button availability
honeybee_model_possible = RemoteSender()

# ---- group: Assembly model
honeybee_model_possible_2 = RemoteReceiver(honeybee_model_possible)  # disabled
panel_41 = Panel("Import geometry before creating the model")  # disabled
number_slider_28 = Slider(1000000, range=0..1000000)  # disabled
number_slider_29 = Slider(500, range=0..1000)  # disabled
bool_3 = Boolean(honeybee_model_possible_2)  # disabled
panel_42 = Panel(" ")  # disabled
filter_2 = StreamFilter(Gate=bool_3, Stream0=number_slider_29, Stream1=number_slider_28)  # disabled
filter_3 = StreamFilter(Gate=bool_3, Stream0=panel_41, Stream1=panel_42)  # disabled
tooltip = AttachTooltipToElement(TooltipContent=filter_3, ShowDelay=filter_2, Duration=2000)  # disabled

# ----
# Modal UI locations
number_slider_30 = Slider(180, range=0..1000)
pt = ConstructPoint(XCoordinate=Slider(460, range=0..1000), YCoordinate=number_slider_30, ZCoordinate=0)
pt_2 = ConstructPoint(XCoordinate=Slider(65, range=0..1000), YCoordinate=number_slider_30, ZCoordinate=0)
pt_3 = ConstructPoint(XCoordinate=Slider(845, range=0..1000), YCoordinate=number_slider_30, ZCoordinate=0)
heath_window_location = RemoteSender(pt_2)
database_modal_location = RemoteSender(pt)
create_modal_location = RemoteSender(pt_3)

textbox = CreateTextBox(DefaultText=Slider(0.05, range=0..10), UpdateButton=invert(True), showLabel=False)
textbox_2 = CreateTextBox(DefaultText=Slider(0.02, range=0..10), UpdateButton=invert(True), showLabel=False)
textbox_3 = CreateTextBox(DefaultText=Slider(0.35, range=0..10), UpdateButton=invert(True), showLabel=False)
true_button_7 = CreateTrueOnlyButton(ButtonName="?", ButtonStyle=2)
label_8 = CreateLabel(LabelText="A4 [kg CO2eq/kg]", LabelSize=12, Justification=0)
label_9 = CreateLabel(LabelText="A5.1 [kg CO2eq/kg]", LabelSize=12, Justification=0)
textbox_4 = CreateTextBox(DefaultText=Slider(0.05, range=0..10), UpdateButton=invert(True), showLabel=False)
textbox_5 = CreateTextBox(DefaultText=Slider(0.35, range=0..10), UpdateButton=invert(True), showLabel=False)
textbox_6 = CreateTextBox(DefaultText=Slider(28, range=0..100), UpdateButton=invert(True), showLabel=False)
label_10 = CreateLabel(LabelText="A4 [kg CO2eq/kg]", LabelSize=12, Justification=0)
label_11 = CreateLabel(LabelText="Conversion value [kg/m2]", LabelSize=12, Justification=0)
label_12 = CreateLabel(LabelText="A1-A3 [kg CO2eq/kg]", LabelSize=12, Justification=0)
values_21 = ValueListener(Elements=true_button_7, SomeProperty=True)  # -> Values, Indices
values_22 = ValueListener(Elements=textbox_6, SomeProperty=True)  # -> Values, Indices
values_23 = ValueListener(Elements=textbox_3, SomeProperty=True)  # -> Values, Indices
values_24 = ValueListener(Elements=textbox_2, SomeProperty=True)  # -> Values, Indices
values_25 = ValueListener(Elements=textbox, SomeProperty=True)  # -> Values, Indices
values_26 = ValueListener(Elements=textbox_5, SomeProperty=True)  # -> Values, Indices
values_27 = ValueListener(Elements=textbox_4, SomeProperty=True)  # -> Values, Indices

# ----
# No link at the moment
info_create_window = RemoteSender(values_21.Values)

num = Number(values_23.Values)
num_2 = Number(values_24.Values)
num_3 = Number(values_25.Values)
num_4 = Number(values_22.Values)
num_5 = Number(values_26.Values)
num_6 = Number(values_27.Values)
entwine_7 = Entwine(Branch00=label_11, Branch01=textbox_6, FlattenInputs=True)  # -> flatten(Result)
null_2 = NullItem(Item=num)  # -> NullFlags, InvalidFlags, Description
null_3 = NullItem(Item=num_2)  # -> NullFlags, InvalidFlags, Description
null_4 = NullItem(Item=num_3)  # -> NullFlags, InvalidFlags, Description
null_5 = NullItem(Item=num_4)  # -> NullFlags, InvalidFlags, Description
null_6 = NullItem(Item=num_5)  # -> NullFlags, InvalidFlags, Description
null_7 = NullItem(Item=num_6)  # -> NullFlags, InvalidFlags, Description
entwine_8 = Entwine(Branch00=label_8, Branch01=textbox, FlattenInputs=True)  # -> flatten(Result)
entwine_9 = Entwine(Branch00=label_9, Branch01=textbox_2, FlattenInputs=True)  # -> flatten(Result)
entwine_10 = Entwine(Branch00=label_12, Branch01=textbox_5, FlattenInputs=True)  # -> flatten(Result)
entwine_11 = Entwine(Branch00=label_10, Branch01=textbox_4, FlattenInputs=True)  # -> flatten(Result)
filter_4 = StreamFilter(Gate=null_3.NullFlags, Stream0=num_2, Stream1="0")
filter_5 = StreamFilter(Gate=null_4.NullFlags, Stream0=num_3, Stream1="0")
filter_6 = StreamFilter(Gate=null_2.NullFlags, Stream0=num, Stream1="0")
filter_7 = StreamFilter(Gate=null_5.NullFlags, Stream0=num_4, Stream1="0")
filter_8 = StreamFilter(Gate=null_7.NullFlags, Stream0=num_6, Stream1="0")
filter_9 = StreamFilter(Gate=null_6.NullFlags, Stream0=num_5, Stream1="0")
stack_7 = CreateStack(UIElements=entwine_7, Horizontal=True)
create_material_a4_kg = RemoteSender(filter_5)
create_material_a5_1_kg = RemoteSender(filter_4)
create_material_a1_a3_kg = RemoteSender(filter_6)
create_window_conversion_value = RemoteSender(filter_7)
adjustelem_8 = AdjustElementAppearance(
    ElementsToAdjust=true_button_7,
    Foreground=ColourSwatch(SwatchColor=RGB(0, 0, 0)),
    Background=ColourSwatch(SwatchColor=RGB(230, 230, 230)),
    FontSize=Slider(12, range=0..300))
create_window_a4_kg = RemoteSender(filter_8)
create_window_a1_a3_kg = RemoteSender(filter_9)
number_slider_31 = Slider(29, range=0..300)

# ----
# A4
stack_8 = CreateStack(UIElements=entwine_11, Horizontal=True)
a4 = Data(stack_8)

# ----
# A1-A3
stack_9 = CreateStack(UIElements=entwine_10, Horizontal=True)
data_2 = Data(stack_9)  # "A1-A3"

# ----
# A4
stack_10 = CreateStack(UIElements=entwine_8, Horizontal=True)
a4_2 = Data(stack_10)

# ----
# A5.1
stack_11 = CreateStack(UIElements=entwine_9, Horizontal=True)
data_3 = Data(stack_11)

adjustpos_17 = AdjustElementPositioning(
    ElementsToAdjust=true_button_7,
    Margin="5, -5, 0, 0",
    AbsolutePositioning=False,
    Width=number_slider_31,
    Height=number_slider_31)
heath_accent_color_6 = RemoteReceiver(heath_accent_color)
heath_accent_color_7 = RemoteReceiver(heath_accent_color)
heath_accent_color_8 = RemoteReceiver(heath_accent_color)
bbox = BoundingBox(Plane=PlaneXY(0, 0, 0))  # -> Box, Box_2
txt_2 = Text()
area = Area(Geometry=bbox.Box)  # -> Area, Centroid
text_entity = TextEntity(Plane=area.Centroid, Text=txt_2)  # -> TextEntity, Plane, Text
fonts = FontTable()
samelib = GetObjectsOfSameLibrary()
select = SelectGHObject(Object=samelib)

roomenergyattr = HBRoomEnergyAttributes({"Program": "properties.energy.program_type.display_name", "Construction Set": "properties.energy.construction_set.display_name", "Is Conditioned": "properties.energy.is_conditioned", "People per Area [ppl/m2]": "properties.energy.people.people_per_area", "Area per Person [m2/ppl]": "properties.energy.people.area_per_person", "Lighting per Area [W/m2]": "properties.energy.lighting.watts_per_area"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}, selected="Program")
roomattr = HBRoomAttributes({"Display Name": "display_name", "Simulation Name (Identifier)": "identifier", "Multiplier": "multiplier", "Floor Area Excluded": "exclude_floor_area", "Story": "story", "Volume": "volume", "Gross Floor Area": "floor_area", "Exposed Area": "exposed_area", "Exterior Wall Area": "exterior_wall_area", "Exterior Aperture Area": "exterior_aperture_area", "Average Floor Elevation": "average_floor_height"}, selected="Exterior Aperture Area")

faceenergyattr = HBFaceEnergyAttributes({"Construction": "properties.energy.construction.display_name", "Materials": "properties.energy.construction.layers", "Thickness [m]": "properties.energy.construction.thickness", "Density [kg/m2]": "properties.energy.construction.mass_area_density", "Heat Capacity [J/K-m2]": "properties.energy.construction.area_heat_capacity", "Construction R-Value [m2-K/W]": "properties.energy.construction.r_value", "Construction U-Value [W/m2-K]": "properties.energy.construction.u_value", "Construction U-Factor [W/m2-K]": "properties.energy.construction.u_factor", "Construction SHGC [Unshaded]": "properties.energy.construction.shgc", "R-Factor [m2-K/W]": "properties.energy.r_factor", "U-Factor [W/m2-K]": "properties.energy.u_factor", "SHGC [Unshaded]": "properties.energy.shgc", "Solar Transmitance [Unshaded]": "properties.energy.construction.solar_transmittance", "Visible Transmitance [Unshaded]": "properties.energy.construction.visible_transmittance", "Solar Reflectance [Outside]": "properties.energy.construction.outside_solar_reflectance", "Solar Reflectance [Inside]": "properties.energy.construction.inside_solar_reflectance", "Fraction Area Operable": "properties.energy.vent_opening.fraction_area_operable", "Fraction Height Operable": "properties.energy.vent_opening.fraction_height_operable", "Discharge Coefficient": "properties.energy.vent_opening.discharge_coefficient"}, selected="Construction SHGC [Unshaded]")
faceattr = HBFaceAttributes({"Display Name": "display_name", "Simulation Name (Identifier)": "identifier", "Boundary Condition": "boundary_condition", "Has Parent": "has_parent", "Parent": "parent", "Azimuth": "azimuth", "Altitude": "altitude", "Area": "area", "Perimeter": "perimeter", "Face Type": "type", "Aperture Is Operable": "is_operable", "Door Is Glass": "is_glass"}, selected="Face Type")

# ----
# Get Klimatdatabas data
list_8 = ValueList({"Swedish": "sv", "English": "en"}, selected="English")
list_9 = ValueList({"File": "file", "API": "api"}, selected="API")
get_categories = BrimstoneGetCategories(mode=list_9, language=list_8)  # -> out, json_data, categories, klimatdatabas_version
# ---------- get_categories: Python ----------
"""Gets Klimatdatabas from the Boverket API or a file, extracts json data, and resource category names
    Inputs:
        mode: api or file mode
        language: language of database to retrieve
        json_path: path to json file if file mode
    Output:
        json_data: json file as dictionary
        categories: Categories present in the database
        klimatdatabas_version: String representing the version of Klimatdatabas used"""

import scriptcontext
import brimstone
import Grasshopper
import os, io

ghenv.Component.Name = 'Brimstone - Get Categories'
ghenv.Component.NickName = 'Get Categories'
ver = brimstone.globals.version
ghenv.Component.Message = ver

import json

from System.Net import WebRequest
from System.IO import StreamReader
from System.Text import Encoding

def main(mode):    
    if mode == "file":
        json_file = brimstone.globals.kdb_json_path
        json_path = os.path.join(Grasshopper.Folders.UserObjectFolders[0], json_file)
        if not os.path.exists(json_path):
            raise Exception("Failed to open json file, it should reside in [UserComponents folder]/brimstone_data/")
        json_data = get_json_data_from_file(json_path)
    elif mode == "api":
        json_data = get_json_data_from_api()
    else:
        raise Exception("Mode {mode} not supported".format(mode = mode))
    
    categories = get_categories(json_data)
    version = json_data.get("Version") 
    
    return categories, json_data, version

def get_json_data_from_file(json_path):
    f = io.open(json_path, encoding='utf-8')
    json_data = json.load(f)
    return json_data
    
def get_json_data_from_api():
    version = "02.04.000"
    lng = language if language else "en"
    format = "json"

    url = "https://api.boverket.se/klimatdatabas/v2/get-all-resources/{version}/{language}/{format}".format(
        version=version, language=lng, format=format)
    
    request = WebRequest.Create(url)
    
    request.Method = "GET"
    request.Timeout = 5000
    #request.ContentType = "application/json"
    response = request.GetResponse()
    
    stream_reader = StreamReader(response.GetResponseStream())
    json_data = json.loads(stream_reader.ReadToEnd())
    return json_data
    
def get_categories(json_data):
    categories = []
    try:
        for metaCategory in json_data['Categories']:
            for cat in metaCategory["Children"]:
                categories.append(cat["Title"])
    except KeyError:
        raise Exception("Format of JSON data is not supported.")
    return categories

if __name__ == "__main__":
    if not scriptcontext.sticky["brimstone_flying"]:
        raise Exception("The 'Brimstone - Fly' component needs to exist on the canvas")
    categories, json_data, klimatdatabas_version = main(mode)
    json_data = [json_data] # need to put it in an array so GH understands it as a dictionary
# ---------- end get_categories ----------
list_10 = ItemSelector(get_categories.categories)
panel_43 = Panel(get_categories.klimatdatabas_version)

# ---- group: Request specific outputs
toggle_2 = BooleanToggle(True)  # disabled
simoutput = HBSimulationOutput(zone_energy_use=toggle_2, gains_and_losses=toggle_2, comfort_metrics=toggle_2, surface_energy_flow=toggle_2)  # -> report, sim_output; disabled; plug-in component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
simpar = HBSimulationParameter(output=simoutput.sim_output, timestep=6)  # -> sim_par; disabled; plug-in component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

# ----
panel_44 = Panel("PITView")  # disabled
objbynn = GetObjectByNickname(NickName=panel_44)  # disabled
current_selected_model_analysis_module_n_6 = RemoteReceiver(current_selected_model_analysis_module_n)  # "current_selected_model_analysis_module_name"
objbynn_2 = GetObjectByNickname(NickName="AnnualDaylight")

# ---- group: Analyse performance
pt_4 = ConstructPoint(XCoordinate=Slider(80, range=0..100), YCoordinate=Slider(10, range=0..100), ZCoordinate=0)
simple_energy_simulation_base_point = RemoteSender(pt_4)

# ----
panel_45 = Panel("UDI < 50 lux")
toggle_3 = BooleanToggle(True)
button_7 = Button()

element_types = Data(["Aperture", "Roof", "Wall", "Floor"])
placeholder_data = Panel(element_types)
current_selected_model_analysis_module_n_7 = RemoteReceiver(current_selected_model_analysis_module_n)  # "current_selected_model_analysis_module_name"
lng = ListLength(List=current_selected_model_analysis_module_n_7)
dom = ConstructDomain(DomainStart=0, DomainEnd=Slider(50, range=0..100))
pre_calculate_lca_2 = RemoteReceiver(pre_calculate_lca)
panel_46 = Panel(pre_calculate_lca_2)

# ----
# EUI pop-up window
panel_47 = Panel("Update")
button_8 = CreateButton(ButtonName=panel_47, ButtonStyle=0)
adjustpos_18 = AdjustElementPositioning(ElementsToAdjust=button_8, AbsolutePositioning=False, Height=Slider(30, range=0..100), HorizontalAlignment=1)
categories = Panel("""Cooling
Heating
Lightning
Electrical equipment
Other""")
checklist_2 = CreateChecklist(Selected=invert(False))
values_28 = ValueListener(Elements=button_8, SomeProperty=True)  # -> Values, Indices
event_5 = EventGate(Data=values_28.Values)  # -> Data, IsNew
simple_energy_simulation_compare_pop_up_2 = RemoteReceiver(simple_energy_simulation_compare_pop_up)
rev = ReverseList(List=categories)
simple_energy_simulation_compare_pop_up_3 = RemoteReceiver(simple_energy_simulation_compare_pop_up)
adjustpos_19 = AdjustElementPositioning(ElementsToAdjust=checklist_2, Margin="0, 40, -5, 0", AbsolutePositioning=False, Width=Slider(215, range=0..1000))
panel_48 = Panel("""80, 140, 220
245, 75, 65
254, 244, 1
255, 121, 0
166, 249, 86""")
rec = DataRecorder(simple_energy_simulation_compare_pop_up_2, DataLimit=-2, RecordData=True)
txt_3 = Text(panel_48)
values_29 = ValueListener(Elements=checklist_2, SomeProperty=True)  # -> Values, Indices
ma = MassAddition(Input=rec)  # -> Result, PartialResults
pt_5 = Point(txt_3)
and = GateAnd(A=simple_energy_simulation_compare_pop_up_3, B=event_5.Data)
division = Division(A=pt_5, B="255")
py3_5 = Python3Script(get=and)  # -> mpl_folder
# ---------- py3_5: Python ----------
"""Grasshopper Script"""
import heath

if __name__ == "__main__":
    if get:
        print(ghdoc)
        mpl_folder = heath.get_results_folder(ghdoc)
# ---------- end py3_5 ----------
len = TextLength(Text=division)
subtraction_4 = Subtraction(A=len, B="2")
nextfile = NextAvailableFilename(Format="EUI{000}.png", FolderPath=py3_5, Trigger=and)
fragment = TextFragment(Text=division, Start="1", Count=subtraction_4)
database_modal_location_2 = RemoteReceiver(database_modal_location)
pdecon = Deconstruct(Point=database_modal_location_2)  # -> XComponent, YComponent, ZComponent
subtraction_5 = Subtraction(A=pdecon.XComponent, B=Slider(0, range=0..100))
heath_accent_color_9 = RemoteReceiver(heath_accent_color)
simple_energy_simulation_compare_pop_up_4 = RemoteReceiver(simple_energy_simulation_compare_pop_up)
pt_6 = ConstructPoint(XCoordinate=subtraction_5, YCoordinate=pdecon.YComponent, ZCoordinate=0)

# ----
# LCA pop-up window
panel_49 = Panel("Update")
button_9 = CreateButton(ButtonName=panel_49, ButtonStyle=0)
values_30 = ValueListener(Elements=button_9, SomeProperty=True)  # -> Values, Indices
adjustpos_20 = AdjustElementPositioning(ElementsToAdjust=button_9, AbsolutePositioning=False, Height=Slider(30, range=0..100), HorizontalAlignment=1)
event_6 = EventGate(Data=values_30.Values)  # -> Data, IsNew
checklist_3 = CreateChecklist(Selected=invert(False))
panel_50 = Panel("""166, 249, 86
255, 121, 0
254, 244, 1
80, 140, 220
97, 209, 246
255, 58, 49""")
values_31 = ValueListener(Elements=checklist_3, SomeProperty=True)  # -> Values, Indices
txt_4 = Text(panel_50)
pt_7 = Point(txt_4)
division_2 = Division(A=pt_7, B="255")
len_2 = TextLength(Text=division_2)
subtraction_6 = Subtraction(A=len_2, B="2")
format_16 = Format(Format="{0}, {1}, {2}, {3}", Culture=127, Data1=Slider(20, range=0..100), Data2=Slider(-5, range=-10..10))
fragment_2 = TextFragment(Text=division_2, Start="1", Count=subtraction_6)
adjustpos_21 = AdjustElementPositioning(ElementsToAdjust=checklist_3, Margin=format_16, AbsolutePositioning=False, Width=Slider(215, range=0..1000))
database_modal_location_3 = RemoteReceiver(database_modal_location)
pdecon_2 = Deconstruct(Point=database_modal_location_3)  # -> XComponent, YComponent, ZComponent
subtraction_7 = Subtraction(A=pdecon_2.XComponent, B=Slider(0, range=0..100))
heath_accent_color_10 = RemoteReceiver(heath_accent_color)
pt_8 = ConstructPoint(XCoordinate=subtraction_7, YCoordinate=pdecon_2.YComponent, ZCoordinate=0)

# ----
# Recursion
panel_51 = Panel("LCA window status")
objbynn_3 = GetObjectByNickname(NickName=panel_51)
lca_window_status = Python3Script()  # -> status
# ---------- lca_window_status: Python ----------
status = False
# ---------- end lca_window_status ----------

# ----
# Recursion
panel_52 = Panel("LCA window status")
objbynn_4 = GetObjectByNickname(NickName=panel_52)
lca_window_status_2 = Python3Script()  # -> status; same code as lca_window_status

# ----
# Recursion
panel_53 = Panel("SDA window status")
objbynn_5 = GetObjectByNickname(NickName=panel_53)
sda_window_status = Python3Script()  # -> status; same code as lca_window_status

# ----
# Spatial daylight autonomy pop-up window
panel_54 = Panel("Update")
button_10 = CreateButton(ButtonName=panel_54, ButtonStyle=0)
values_32 = ValueListener(Elements=button_10, SomeProperty=True)  # -> Values, Indices
adjustpos_22 = AdjustElementPositioning(ElementsToAdjust=button_10, AbsolutePositioning=False, Height=Slider(30, range=0..100), HorizontalAlignment=1)
event_7 = EventGate(Data=values_32.Values)  # -> Data, IsNew
panel_55 = Panel(values_32.Values)
checklist_4 = CreateChecklist(Selected=invert(False))
colrange = LBColorRange(index=Slider(3, range=0..100))  # -> colors; plug-in component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
shuffle = Python3Script(x=colrange)  # -> x; inputs x: list of Color
# ---------- shuffle: Python ----------
import random

random.shuffle(x)
# ---------- end shuffle ----------
txt_5 = Text(shuffle)
pt_9 = Point(txt_5)
values_33 = ValueListener(Elements=checklist_4, SomeProperty=True)  # -> Values, Indices
division_3 = Division(A=pt_9, B="255")
len_3 = TextLength(Text=division_3)
panel_56 = Panel("Spatial daylight autonomy (%)")
subtraction_8 = Subtraction(A=len_3, B=Slider(2, range=0..10))
fragment_3 = TextFragment(Text=division_3, Start="1", Count=subtraction_8)
database_modal_location_4 = RemoteReceiver(database_modal_location)
pdecon_3 = Deconstruct(Point=database_modal_location_4)  # -> XComponent, YComponent, ZComponent
subtraction_9 = Subtraction(A=pdecon_3.XComponent, B=Slider(0, range=0..100))
heath_accent_color_11 = RemoteReceiver(heath_accent_color)
adjustpos_23 = AdjustElementPositioning(ElementsToAdjust=checklist_4, Margin="0, 40, -5, 0", AbsolutePositioning=False, Width=Slider(215, range=0..1000))
pt_10 = ConstructPoint(XCoordinate=subtraction_9, YCoordinate=pdecon_3.YComponent, ZCoordinate=0)

entwine_12 = Entwine(Branch00=ma.Result, Branch01=lca_window_status_2, FlattenInputs=True)
rec_2 = DataRecorder(entwine_12, DataLimit=2, RecordData=True)
item_2 = ListItem(List=rec_2, Index=0, Wrap=True)  # -> Item2, Item1, Item
equals_2 = Equality(FirstNumber=item_2.Item2, SecondNumber=item_2.Item1)  # -> Equality, Inequality
bang = ExplodeTree(Data=equals_2.Inequality)  # -> Branch0, Branch1
py3_6 = Python3Script(x=bang.Branch0, y=bang.Branch1)  # -> a
# ---------- py3_6: Python ----------
if x:
    a = True
elif y:
    a = False
else:
    a = False
# ---------- end py3_6 ----------
event_8 = EventGate(Data=py3_6)  # -> Data, IsNew
freeze_gate_2 = StreamFreezeGate(Data=py3_6, PassingSwitch=event_8.IsNew)
event_9 = EventGate(Data=freeze_gate_2)  # -> Data, IsNew
panel_57 = Panel(event_9.Data)
launchwin = LaunchWindow(
    Show=event_9.Data,
    Name="EUI visualisations",
    Width=bar_chart_popup_win_width_3,
    Height=bar_chart_popup_win_height_3,
    ChildStatus=1,
    EnableHorizScroll=False)
winprops = SetWindowProperties(
    Window=launchwin,
    StartingLocation=pt_6,
    Theme=0,
    AccentColor=heath_accent_color_9,
    ShowTitleBar=True,
    BackgroundColor=RGB(255, 255, 255),
    ScaleFactor=1)
winstat = WindowStatus(Window=launchwin)
eui_status = RemoteSender(winstat)
py3_7 = Python3Script(window=launchwin, activate=simple_energy_simulation_compare_pop_up_4)
# ---------- py3_7: Python ----------
import System

if activate and (str(window.WindowState) == "Minimized"):
    window.set_WindowState(System.Windows.WindowState(0))
# ---------- end py3_7 ----------

eui_status_2 = RemoteReceiver(eui_status)
expression = Expression(x="Hidden", y=eui_status_2, Expression="x=y")
expire = ExpireObject(ObjectToExpire=objbynn_4, Expire=expression)

# ----
# Database constructions
panel_58 = Panel("Generic")

# ----
# Geometry module interface
# Attribute modification
# Preview geometry
# Geometry visibility settings
panel_59 = Panel("Polysurface")
constructiontype = RemoteReceiver()
saveconstruction = RemoteReceiver()

# ----
# Database windows
generic_u_value = Data(1.687787378)
generic_shgc = Data(0.4240807069)

# ----
# Create test model
panel_60 = Panel("Window")
panel_61 = Panel("""Heath::Test model::Rooms
Heath::Test model::Windows
Heath::Test model::Adjacent
Heath::Test model::Context""")
entwine_13 = Entwine(Branch00="Room", Branch01=panel_60, Branch02="Adjacent", Branch03="Context", FlattenInputs=True)
building = Geometry([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])
site = Geometry([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])
adjacent_rooms_1 = Geometry([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])
ground = Geometry(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)
merge_5 = Merge(Data1=ground, Data2=site, Data3=building, Data4=adjacent_rooms_1)
lng_2 = ListLength(List=flatten(entwine_13))
windows1 = Geometry([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])
room1 = Geometry(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)
adjacent_1 = Geometry([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])
context_1 = Geometry(merge_5)
repeat = RepeatData(Data=heath_geometry_type_key_7, Length=lng_2)  # -> graft(Data)
entwine_14 = Entwine(Branch00=room1, Branch01=windows1, Branch02=adjacent_1, Branch03=context_1, FlattenInputs=True)

# ----
# Database materials
panel_62 = Panel("{0} (conductivity: {1}, density: {2}, specific heat: {3})")

# ---- group: Assembly model
panel_63 = Panel("https://energyplus-weather.s3.amazonaws.com/europe_wmo_region_6/SWE/SWE_Goteborg.Landvetter.025260_IWEC/SWE_Goteborg.Landvetter.025260_IWEC.zip")
button_11 = CreateButton(ButtonName="Update / Load", ButtonStyle=0)
values_34 = ValueListener(Elements=button_11, SomeProperty=True)  # -> Values, Indices
button_12 = CreateButton(ButtonName="Bake model", ButtonStyle=0)
textbox_7 = CreateTextBox(Label="Rename model", DefaultText="Renamed model", UpdateButton=invert(True), showLabel=True)
pulldown_4 = CreatePulldownMenu(Label="Select model", showLabel=True)
button_13 = CreateButton(ButtonName="Rename", ButtonStyle=0)
button_14 = CreateButton(ButtonName="Remove model", ButtonStyle=0)
freeze_gate_3 = StreamFreezeGate(Data=values_34.Values, PassingSwitch=invert(values_34.Values))
button_15 = CreateButton(ButtonName="Create model", ButtonStyle=0)
values_35 = ValueListener(Elements=button_15, SomeProperty=True)  # -> Values, Indices
label_13 = CreateLabel(LabelText="Show components", LabelSize=12, Justification=0)
textbox_8 = CreateTextBox(Label="Model name", DefaultText="My model", UpdateButton=invert(True), showLabel=True)
freeze_gate_4 = StreamFreezeGate(Data=values_35.Values, PassingSwitch=invert(values_35.Values))
values_36 = ValueListener(Elements=button_12, SomeProperty=True)  # -> Values, Indices
event_10 = EventGate(Data=values_35.Values)  # -> Data, IsNew
label_14 = CreateLabel(LabelText="Honeybee model", LabelSize=18, Justification=0)
toggle_4 = CreateToggle(Default=False)
label_15 = CreateLabel(LabelText="Generate windows using WWR [%]", LabelSize=12, Justification=0)
slider_5 = CreateSlider(
    Slider=Slider(30, range=5..95),
    SnapValue=Slider(5, range=0..10),
    ShowBounds=False,
    ShowTicks=True,
    ShowTooltip=True,
    ShowValLabel=True,
    showLabel=False)
values_37 = ValueListener(Elements=button_13, SomeProperty=True)  # -> Values, Indices
freeze_gate_5 = StreamFreezeGate(Data=values_37.Values, PassingSwitch=invert(values_37.Values))
bool_4 = Boolean(invert(freeze_gate_5))
values_38 = ValueListener(Elements=button_14, SomeProperty=True)  # -> Values, Indices
freeze_gate_6 = StreamFreezeGate(Data=values_38.Values, PassingSwitch=invert(values_38.Values))
bool_5 = Boolean(invert(freeze_gate_6))
label_16 = CreateLabel(LabelText="Set location", LabelSize=12, Justification=0)
values_39 = ValueListener(Elements=textbox_7, SomeProperty=True)  # -> Values, Indices
bool_6 = Boolean(invert(freeze_gate_3))
textbox_9 = CreateTextBox(Label="Set location", DefaultText=panel_63, UpdateButton=True, showLabel=True)
button_16 = CreateButton(ButtonName="Get climate data", ButtonStyle=0)
values_40 = ValueListener(Elements=pulldown_4, SomeProperty=True)  # -> Values, Indices
rec_3 = DataRecorder(bool_5, DataLimit=-10, RecordData=True)
rec_4 = DataRecorder(bool_4, DataLimit=-10, RecordData=True)
bool_7 = Boolean(invert(freeze_gate_4))
pre_create_model = RemoteSender(event_10.Data)
rec_5 = DataRecorder(values_36.Values, DataLimit=-10, RecordData=True)
rec_6 = DataRecorder(bool_6, DataLimit=-10, RecordData=True)
pre_rename_current_model = RemoteSender(values_37.Values)
pre_remove_current_model = RemoteSender(values_38.Values)
panel_64 = Panel(values_39.Values)
event_11 = EventGate(Data=values_40.Indices)  # -> Data, IsNew
rename_current_model_name = RemoteSender(values_39.Values)
int = Integer(rec_3)
rec_7 = DataRecorder(bool_7, DataLimit=-10, RecordData=True)
current_selected_model_assembly_module_n = RemoteSender(values_40.Values)  # "current_selected_model_assembly_module_name"
current_selected_model_assembly_module_n_2 = RemoteReceiver(current_selected_model_assembly_module_n)  # "current_selected_model_assembly_module_name"
values_41 = ValueListener(Elements=textbox_8, SomeProperty=True)  # -> Values, Indices
int_2 = Integer(rec_4)
values_42 = ValueListener(Elements=button_16, SomeProperty=True)  # -> Values, Indices
values_43 = ValueListener(Elements=slider_5, SomeProperty=True)  # -> Values, Indices
panel_65 = Panel("https://energyplus-weather.s3.amazonaws.com/europe_wmo_region_6/SWE/SWE_Goteborg.Landvetter.025260_IWEC/SWE_Goteborg.Landvetter.025260_IWEC.zip")
values_44 = ValueListener(Elements=textbox_9, SomeProperty=True)  # -> Values, Indices
downloadepw = LBDownloadWeather(weather_URL=values_44.Values)  # -> epw_file, stat_file, ddy_file; plug-in component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
importepw = LBImportEPW(epw_file=downloadepw.epw_file)  # -> location, dry_bulb_temperature, dew_point_temperature, relative_humidity, wind_speed, wind_direction, direct_normal_rad, diffuse_horizontal_rad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; plug-in component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
decnstrloc = LBDeconstructLocation(location=importepw.location)  # -> name, latitude, longitude, time_zone, elevation; plug-in component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
int_3 = Integer(rec_5)
tooltip_2 = AttachTooltipToElement(ElementsToAttachTo=slider_5, TooltipContent="Doubleclick to input value", ShowDelay=500, Duration=2000)
int_4 = Integer(rec_6)
ma_2 = MassAddition(Input=int)  # -> Result, PartialResults
values_45 = ValueListener(Elements=toggle_4, SomeProperty=True)  # -> Values, Indices
ma_3 = MassAddition(Input=int_2)  # -> Result, PartialResults
ma_4 = MassAddition(Input=int_3)  # -> Result, PartialResults
panel_66 = Panel(values_41.Values)
current_selected_model_assembly_module = RemoteSender(event_11.Data)
int_5 = Integer(rec_7)
model_name = RemoteSender(values_41.Values)
ma_5 = MassAddition(Input=int_4)  # -> Result, PartialResults
getclimatedata = RemoteSender(values_42.Values)
event_12 = EventGate(Data=ma_2.Result)  # -> Data, IsNew
entwine_15 = Entwine(Branch00=toggle_4, Branch01=slider_5, FlattenInputs=True)  # -> flatten(Result)
filter_10 = StreamFilter(Gate=values_45.Values, Stream0="0", Stream1=values_43.Values)
event_13 = EventGate(Data=ma_3.Result)  # -> Data, IsNew
ma_6 = MassAddition(Input=int_5)  # -> Result, PartialResults
null_8 = NullItem(Item=decnstrloc.name)  # -> NullFlags, InvalidFlags, Description
event_14 = EventGate(Data=ma_4.Result)  # -> Data, IsNew
settextbox = SetTextBoxContents(TextBoxToModify=textbox_7, NewTextBoxContents=current_selected_model_assembly_module_n_2)
event_15 = EventGate(Data=ma_5.Result)  # -> Data, IsNew
dam_2 = DataDam(DataA=event_12.Data, BufferDelay=2500000, BufferMode=2)
event_16 = EventGate(Data=ma_6.Result)  # -> Data, IsNew
dam_3 = DataDam(DataA=event_13.Data, BufferDelay=2500000, BufferMode=2)
division_4 = Division(A=filter_10, B="100")
dam_4 = DataDam(DataA=event_14.Data, BufferDelay=2500000, BufferMode=2)
stack_12 = CreateStack(UIElements=entwine_15, Horizontal=invert(True))
dam_5 = DataDam(DataA=event_15.Data, BufferDelay=2500000, BufferMode=2)
equals_3 = Equality(FirstNumber=event_12.Data, SecondNumber=dam_2)  # -> Equality, Inequality
filter_11 = StreamFilter(Gate=null_8.NullFlags, Stream0=decnstrloc.name, Stream1="Could not find location")
filter_12 = StreamFilter(Gate=null_8.NullFlags, Stream0=ColourSwatch(SwatchColor=RGB(0, 0, 0)), Stream1=ColourSwatch(SwatchColor=RGB(255, 0, 0)))
filter_13 = StreamFilter(Gate=null_8.NullFlags, Stream0=values_44.Values, Stream1=panel_65)
dam_6 = DataDam(DataA=event_16.Data, BufferDelay=2500000, BufferMode=2)
equals_4 = Equality(FirstNumber=event_13.Data, SecondNumber=dam_3)  # -> Equality, Inequality
hideshow_5 = HideShowElement(ElementToHideShow=slider_5, Show=values_45.Values, Collapse=invert(True), Disable=False)
generate_wwr = RemoteSender(division_4)
equals_5 = Equality(FirstNumber=event_14.Data, SecondNumber=dam_4)  # -> Equality, Inequality
entwine_16 = Entwine(Branch00=textbox_9, Branch01=button_16, FlattenInputs=True)  # -> flatten(Result)
equals_6 = Equality(FirstNumber=event_15.Data, SecondNumber=dam_5)  # -> Equality, Inequality
event_17 = EventGate(Data=equals_3.Inequality)  # -> Data, IsNew
event_18 = EventGate(Data=equals_4.Inequality)  # -> Data, IsNew
format_17 = Format(Format="Location: {0}", Culture=127, Data0=filter_11)
equals_7 = Equality(FirstNumber=event_16.Data, SecondNumber=dam_6)  # -> Equality, Inequality
location_2 = RemoteSender(filter_13)
event_19 = EventGate(Data=equals_5.Inequality)  # -> Data, IsNew
adjustpos_24 = AdjustElementPositioning(ElementsToAdjust=textbox_9, AbsolutePositioning=False, Width=Slider(200, range=0..1000), HorizontalAlignment=0)
adjustpos_25 = AdjustElementPositioning(
    ElementsToAdjust=button_16,
    Margin="5, 5, 0, 0",
    AbsolutePositioning=False,
    Width=Slider(200, range=0..1000),
    HorizontalAlignment=0)
stack_13 = CreateStack(UIElements=entwine_16, Horizontal=invert(True))
event_20 = EventGate(Data=equals_6.Inequality)  # -> Data, IsNew
entwine_17 = Entwine(Branch00=label_15, Branch01=stack_12, FlattenInputs=True)  # -> flatten(Result)
adjustelem_9 = AdjustElementAppearance(ElementsToAdjust=label_16, Foreground=filter_12)
setlabel = SetLabelContents(LabelToModify=label_16, NewLabelContents=format_17)
entwine_18 = Entwine(Branch00=label_14, Branch01=textbox_8, FlattenInputs=True)  # -> flatten(Result)
event_21 = EventGate(Data=equals_7.Inequality)  # -> Data, IsNew
panel_67 = Panel(event_21.Data)
stack_14 = CreateStack(UIElements=entwine_17, Horizontal=invert(True))
format_18 = Format(Format="{0}, {1}, 0, 0", Culture=127, Data0=Slider(5, range=-25..25), Data1=Slider(5, range=0..100))
stack_15 = CreateStack(UIElements=entwine_18, Horizontal=invert(True))
adjustpos_26 = AdjustElementPositioning(
    ElementsToAdjust=textbox_8,
    Margin="0, 5, 0, 5",
    AbsolutePositioning=False,
    Width=Slider(210, range=0..300),
    Height=Slider(30, range=0..300),
    HorizontalAlignment=0)
adjustpos_27 = AdjustElementPositioning(ElementsToAdjust=label_15, Margin="0, 5, 0, 0", AbsolutePositioning=False, HorizontalAlignment=0, VerticalAlignment=2)
adjustpos_28 = AdjustElementPositioning(ElementsToAdjust=slider_5, Margin="10, 5, 0, 0", AbsolutePositioning=False, HorizontalAlignment=0, VerticalAlignment=2)
entwine_19 = Entwine(Branch00=label_16, Branch01=stack_13, FlattenInputs=True)  # -> flatten(Result)
adjustpos_29 = AdjustElementPositioning(ElementsToAdjust=label_16, Margin="0, 0, 0, 0", AbsolutePositioning=False, HorizontalAlignment=0)
adjustpos_30 = AdjustElementPositioning(ElementsToAdjust=stack_13, AbsolutePositioning=False, Width=Slider(210, range=0..1000), HorizontalAlignment=0)
adjustpos_31 = AdjustElementPositioning(
    ElementsToAdjust=[button_14, button_11, button_15],
    Margin="5, 12, 0, 0",
    AbsolutePositioning=False,
    Height=Slider(29, range=0..100),
    HorizontalAlignment=0)
adjustpos_32 = AdjustElementPositioning(
    ElementsToAdjust=textbox_7,
    Margin="5, 5, 0, 0",
    AbsolutePositioning=False,
    Width=Slider(280, range=0..350),
    Height=Slider(29, range=0..100),
    HorizontalAlignment=0)
adjustpos_33 = AdjustElementPositioning(
    ElementsToAdjust=button_12,
    Margin="5, 10, 5, 5",
    AbsolutePositioning=False,
    Width=Slider(98, range=0..100),
    HorizontalAlignment=0,
    VerticalAlignment=2)
adjustpos_34 = AdjustElementPositioning(
    ElementsToAdjust=button_13,
    Margin="5, 5, 0, 0",
    AbsolutePositioning=False,
    Height=Slider(29, range=0..100),
    HorizontalAlignment=0)
adjustpos_35 = AdjustElementPositioning(
    ElementsToAdjust=pulldown_4,
    Margin=format_18,
    AbsolutePositioning=False,
    Width=Slider(285, range=0..400),
    HorizontalAlignment=0,
    VerticalAlignment=2)

# ----
rename_current_model_name_2 = RemoteReceiver(rename_current_model_name)
pre_rename_current_model_2 = RemoteReceiver(pre_rename_current_model)
pre_remove_current_model_2 = RemoteReceiver(pre_remove_current_model)
rename_current_model_name_3 = RemoteReceiver(rename_current_model_name)
pre_update_honeybee_model = RemoteSender(values_34.Values)
pre_update_honeybee_model_2 = RemoteReceiver(pre_update_honeybee_model)
pre_update_honeybee_model_3 = RemoteReceiver(pre_update_honeybee_model)
gate = StreamGate(Stream="0", Gate=pre_update_honeybee_model_2)  # -> Target0, Target1
gate_2 = StreamGate(Stream="0", Gate=pre_update_honeybee_model_3)  # -> Target0, Target1
entwine_20 = Entwine(Branch00=label_13, Branch01=checklist, Branch02=button_3, Branch03=button_12, FlattenInputs=True)  # -> flatten(Result)

entwine_21 = Entwine(Branch00=textbox_7, Branch01=button_13, FlattenInputs=True)  # -> flatten(Result)
stack_16 = CreateStack(UIElements=entwine_21, Horizontal=True)

entwine_22 = Entwine(Branch00=button_15, Branch01=button_11, Branch02=button_14, FlattenInputs=True)  # -> flatten(Result)
stack_17 = CreateStack(UIElements=entwine_22, Horizontal=True)

# ----
# Location
location_3 = Data(entwine_19)

# ----
# Model name
model_name_2 = Data(stack_15)

# ----
# Generate using WWR
location_4 = Data(stack_14)

# ----
# Create model
entwine_23 = Entwine(Branch00=stack_17, Branch01=pulldown_4, Branch02=stack_16, FlattenInputs=True)  # -> flatten(Result)
stack_18 = CreateStack(UIElements=entwine_23, Horizontal=invert(True))
create_model = Data(stack_18)

entwine_24 = Entwine(Branch00=model_name_2, Branch01=location_4, Branch02=location_3, FlattenInputs=True)  # -> flatten(Result)
stack_19 = CreateStack(UIElements=entwine_24, Horizontal=invert(True))

# ----
# Get climate data
# https://energyplus-weather.s3.amazonaws.com/europe_wmo_region_6/SWE/SWE_Goteborg.Landvetter.025260_IWEC/SWE_Goteborg.Landvetter.025260_IWEC.zip
getclimatedata_2 = RemoteReceiver(getclimatedata)
location_5 = RemoteReceiver(location_2)
panel_68 = Panel(getclimatedata_2)
epwmap = LBEPWmap(epw_map=getclimatedata_2)  # -> report; plug-in component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

pre_create_model_2 = RemoteReceiver(pre_create_model)
location_6 = RemoteReceiver(location_2)  # disabled
location_7 = RemoteReceiver(location_2)
location_8 = RemoteReceiver(location_2)  # disabled

# ---- group: Visualize module
panel_69 = Panel("""properties.energy.construction.display_name
properties.energy.construction.layers
properties.energy.construction.thickness
properties.energy.construction.mass_area_density
properties.energy.construction.area_heat_capacity
properties.energy.construction.r_value
properties.energy.construction.u_value
properties.energy.construction.u_factor
properties.energy.construction.shgc
properties.energy.r_factor
properties.energy.u_factor
properties.energy.shgc""")
panel_70 = Panel("""properties.energy.program_type.display_name
properties.energy.construction_set.display_name
properties.energy.is_conditioned
properties.energy.people.people_per_area
properties.energy.people.area_per_person
properties.energy.lighting.watts_per_area
properties.energy.electric_equipment.watts_per_area
properties.energy.gas_equipment.watts_per_area
properties.energy.service_hot_water.flow_per_area""")
panel_71 = Panel("""Sky dome
Sky mask
Wind rose
Dry bulb temperature line chart
Dry bulb temperature 2D chart
Direct sun hours
Incident radiation""")
panel_72 = Panel("""display_name
identifier
multiplier
exclude_floor_area
story
volume
floor_area
exposed_area
exterior_wall_area
exterior_aperture_area
average_floor_height""")
panel_73 = Panel("""display_name
identifier
boundary_condition
has_parent
parent
azimuth
altitude
area
perimeter
type
is_operable
is_glass""")
button_17 = CreateButton(ButtonName="Run weather visualization", ButtonStyle=0)
button_18 = CreateButton(ButtonName="Zoom", ButtonStyle=0)
button_19 = CreateButton(ButtonName="Bake", ButtonStyle=0)
label_17 = CreateLabel(LabelText="Weather visualization", LabelSize=18, Justification=0)
values_46 = ValueListener(Elements=button_18, SomeProperty=True)  # -> Values, Indices
values_47 = ValueListener(Elements=button_19, SomeProperty=True)  # -> Values, Indices
values_48 = ValueListener(Elements=button_17, SomeProperty=True)  # -> Values, Indices
checkbox = CreateCheckbox(Label="Show", StartingValue=False)
pulldown_5 = CreatePulldownMenu(Label="Display type", ListItems=panel_71, showLabel=True)
panel_74 = Panel("""Program
Construction Set
Is Conditioned
People per Area [ppl/m2]
Area per Person [m2/ppl]
Lighting per Area [W/m2]
Electric Equipment per Area [W/m2]
Gas Equipment per Area [W/m2]
Hot Water per Area [L/h-m2]""")
panel_75 = Panel("""Display Name
Simulation Name (Identifier)
Boundary Condition
Has Parent
Parent
Azimuth
Altitude
Area
Perimeter
Face Type
Aperture Is Operable
Door Is Glass""")
panel_76 = Panel("""Construction
Materials
Thickness [m]
Density [kg/m2]
Heat Capacity [J/K-m2]
Construction R-Value [m2-K/W]
Construction U-Value [W/m2-K]
Construction U-Factor [W/m2-K]
Construction SHGC [Unshaded]
R-Factor [m2-K/W]
U-Factor [W/m2-K]
SHGC [Unshaded]""")
panel_77 = Panel("""Display Name
Simulation Name (Identifier)
Multiplier
Floor Area Excluded
Story
Volume
Gross Floor Area
Exposed Area
Exterior Wall Area
Exterior Aperture Area
Average Floor Elevation""")
freeze_gate_7 = StreamFreezeGate(Data=values_47.Values, PassingSwitch=invert(values_47.Values))
zoom_weather_visualization = RemoteSender(values_46.Values)
freeze_gate_8 = StreamFreezeGate(Data=values_48.Values, PassingSwitch=invert(values_48.Values))
values_49 = ValueListener(Elements=checkbox, SomeProperty=True)  # -> Values, Indices
values_50 = ValueListener(Elements=pulldown_5, SomeProperty=True)  # -> Values, Indices
bool_8 = Boolean(invert(freeze_gate_7))
bool_9 = Boolean(invert(freeze_gate_8))
entwine_25 = Entwine(Branch00=pulldown_5, Branch01=checkbox, FlattenInputs=True)  # -> flatten(Result)
weather_visualization_type = RemoteSender(values_50.Indices)
tap_2 = TapBuffer(Reset=False, Incremental=True, Valve=bool_8, Hold=True)
tap_3 = TapBuffer(Reset=False, Incremental=True, Valve=bool_9, Hold=True)
stack_20 = CreateStack(UIElements=entwine_25, Horizontal=True)
pulldown_6 = CreatePulldownMenu(Label="Room attribute", ListItems=panel_77, showLabel=True)
pulldown_7 = CreatePulldownMenu(Label="Room energy attribute", ListItems=panel_74, showLabel=True)
checkbox_2 = CreateCheckbox(Label="Show", StartingValue=False)
checkbox_3 = CreateCheckbox(Label="Show", StartingValue=False)
label_18 = CreateLabel(LabelText="Model visualization", LabelSize=18, Justification=0)
checkbox_4 = CreateCheckbox(Label="Show", StartingValue=False)
pulldown_8 = CreatePulldownMenu(Label="Face attribute", ListItems=panel_75, showLabel=True)
dam_7 = DataDam(DataA=tap_2, BufferDelay=2500000, BufferMode=2)
dam_8 = DataDam(DataA=tap_3, BufferDelay=2500000, BufferMode=2)
entwine_26 = Entwine(Branch00=button_17, Branch01=button_18, Branch02=button_19, FlattenInputs=True)  # -> flatten(Result)
pulldown_9 = CreatePulldownMenu(Label="Face energy attribute", ListItems=panel_76, showLabel=True)
checkbox_5 = CreateCheckbox(Label="Show", StartingValue=False)
equals_8 = Equality(FirstNumber=tap_3, SecondNumber=dam_8)  # -> Equality, Inequality
equals_9 = Equality(FirstNumber=tap_2, SecondNumber=dam_7)  # -> Equality, Inequality
values_51 = ValueListener(Elements=checkbox_3, SomeProperty=True)  # -> Values, Indices
values_52 = ValueListener(Elements=pulldown_7, SomeProperty=True)  # -> Values, Indices
entwine_27 = Entwine(Branch00=pulldown_6, Branch01=checkbox_2, FlattenInputs=True)  # -> flatten(Result)
entwine_28 = Entwine(Branch00=pulldown_7, Branch01=checkbox_3, FlattenInputs=True)  # -> flatten(Result)
values_53 = ValueListener(Elements=pulldown_6, SomeProperty=True)  # -> Values, Indices
values_54 = ValueListener(Elements=pulldown_8, SomeProperty=True)  # -> Values, Indices
values_55 = ValueListener(Elements=checkbox_2, SomeProperty=True)  # -> Values, Indices
values_56 = ValueListener(Elements=checkbox_4, SomeProperty=True)  # -> Values, Indices
values_57 = ValueListener(Elements=pulldown_9, SomeProperty=True)  # -> Values, Indices
values_58 = ValueListener(Elements=checkbox_5, SomeProperty=True)  # -> Values, Indices
stack_21 = CreateStack(UIElements=entwine_26, Horizontal=True)
item_3 = ListItem(List=panel_70, Index=values_52.Indices, Wrap=invert(True))
item_4 = ListItem(List=panel_72, Index=values_53.Indices, Wrap=invert(True))
stack_22 = CreateStack(UIElements=entwine_28, Horizontal=True)
item_5 = ListItem(List=panel_73, Index=values_54.Indices, Wrap=invert(True))
stack_23 = CreateStack(UIElements=entwine_27, Horizontal=True)
item_6 = ListItem(List=panel_69, Index=values_57.Indices, Wrap=invert(True))
room_energy_attribute = RemoteSender(item_3)
entwine_29 = Entwine(Branch00=stack_21, Branch01=tb, Branch02=stack_20, FlattenInputs=True)  # -> flatten(Result)
room_attribute = RemoteSender(item_4)
face_attribute = RemoteSender(item_5)
entwine_30 = Entwine(Branch00=pulldown_9, Branch01=checkbox_5, FlattenInputs=True)  # -> flatten(Result)
entwine_31 = Entwine(Branch00=pulldown_8, Branch01=checkbox_4, FlattenInputs=True)  # -> flatten(Result)
face_energy_attribute = RemoteSender(item_6)
stack_24 = CreateStack(UIElements=entwine_29, Horizontal=invert(True))
stack_25 = CreateStack(UIElements=entwine_30, Horizontal=True)
stack_26 = CreateStack(UIElements=entwine_31, Horizontal=True)
entwine_32 = Entwine(Branch00=label_18, Branch01=stack_23, Branch02=stack_22, Branch03=stack_26, Branch04=stack_25, FlattenInputs=True)  # -> flatten(Result)
adjustpos_36 = AdjustElementPositioning(ElementsToAdjust=stack_24, AbsolutePositioning=False, Width=Slider(300, range=0..300), HorizontalAlignment=0)
adjustpos_37 = AdjustElementPositioning(ElementsToAdjust=pulldown_5, Margin="5, 5, 0, 5", AbsolutePositioning=False, Width=Slider(215, range=0..400))
adjustpos_38 = AdjustElementPositioning(ElementsToAdjust=checkbox, Margin="5, 5, 0, 5", AbsolutePositioning=False)
hideshow_6 = HideShowElement(ElementToHideShow=checkbox_2, Show=True, Collapse=True, Disable=values_51.Values)
hideshow_7 = HideShowElement(ElementToHideShow=checkbox_3, Show=True, Collapse=True, Disable=values_55.Values)
hideshow_8 = HideShowElement(ElementToHideShow=checkbox_5, Show=True, Collapse=True, Disable=values_56.Values)
hideshow_9 = HideShowElement(ElementToHideShow=checkbox_4, Show=True, Collapse=True, Disable=values_58.Values)
stack_27 = CreateStack(UIElements=entwine_32, Horizontal=invert(True))
border = CreateBorder(
    UIElement=stack_24,
    BorderThickness=Slider(1, range=0..10),
    BorderColor=ColourSwatch(SwatchColor=RGB(217, 217, 217)),
    CornerRadius=Slider(2, range=0..10))
border_2 = CreateBorder(
    UIElement=stack_27,
    BorderThickness=Slider(1, range=0..10),
    BorderColor=ColourSwatch(SwatchColor=RGB(217, 217, 217)),
    CornerRadius=Slider(2, range=0..10))
entwine_33 = Entwine(Branch00=label_17, Branch01=border, FlattenInputs=True)  # -> flatten(Result)
entwine_34 = Entwine(Branch00=label_18, Branch01=border_2, FlattenInputs=True)  # -> flatten(Result)
adjustpos_39 = AdjustElementPositioning(ElementsToAdjust=border, AbsolutePositioning=False, HorizontalAlignment=0, VerticalAlignment=2)
adjustpos_40 = AdjustElementPositioning(ElementsToAdjust=border_2, Margin="0, 0, 0, 10", AbsolutePositioning=False, HorizontalAlignment=0, VerticalAlignment=2)
adjustpos_41 = AdjustElementPositioning(ElementsToAdjust=[checkbox_2, checkbox_3, checkbox_4, checkbox_5], Margin="0, 0, 10, 0", AbsolutePositioning=False)
adjustpos_42 = AdjustElementPositioning(
    ElementsToAdjust=[pulldown_6, pulldown_7, pulldown_8, pulldown_9],
    AbsolutePositioning=False,
    Width=Slider(239, range=0..400),
    HorizontalAlignment=0)

# ----
adjustpos_43 = AdjustElementPositioning(ElementsToAdjust=label_17, Margin="0, -6, 0, 0", AbsolutePositioning=False)

# ----
# Run weather visualization
location_9 = Data(entwine_33)

# ----
# Attributes visualization
location_10 = Data(entwine_34)

entwine_35 = Entwine(Branch00=select_model_2, Branch01=location_10, Branch02=location_9, FlattenInputs=True)  # -> flatten(Result)

# ---- group: Program module
panel_78 = Panel("""LargeOffice
MediumOffice
SmallOffice
MidriseApartment
HighriseApartment
Retail
StripMall
PrimarySchool
SecondarySchool
SmallHotel
LargeHotel
Hospital
Outpatient
Laboratory
Warehouse
SuperMarket
FullServiceRestaurant
QuickServiceRestaurant
Courthouse
LargeDataCenterHighITE
LargeDataCenterLowITE
SmallDataCenterHighITE
SmallDataCenterLowITE""")
cooling_setpoint_ºc = Slider(27, range=10..40)
heating_setpoint_ºc = Slider(21, range=10..40)
empty = EmptyObjectToEmptyBranch()
pulldown_10 = CreatePulldownMenu(Label="Room type", ListItems=empty, showLabel=True)
label_19 = CreateLabel(LabelText="Select program", LabelSize=18, Justification=0)
label_20 = CreateLabel(LabelText="Program settings", LabelSize=18, Justification=0)
pulldown_11 = CreatePulldownMenu(Label="Building type", ListItems=panel_78, SelectedIndex="3", showLabel=True)
slider_6 = CreateSlider(Slider=cooling_setpoint_ºc, ShowBounds=False, ShowTicks=True, ShowTooltip=True, ShowValLabel=True, showLabel=False)
label_21 = CreateLabel(LabelText="Cooling setpoint [ºC]", LabelSize=12, Justification=0)
slider_7 = CreateSlider(Slider=heating_setpoint_ºc, ShowBounds=False, ShowTicks=True, ShowTooltip=False, ShowValLabel=True, showLabel=False)
label_22 = CreateLabel(LabelText="Heating setpoint [ºC]", LabelSize=12, Justification=0)
label_23 = CreateLabel(LabelText="Occupancy [persons/100 m2]", LabelSize=12, Justification=0)
slider_8 = CreateSlider(Slider=Slider(3, range=0..20), ShowBounds=False, ShowTicks=True, ShowTooltip=True, ShowValLabel=True, showLabel=False)
values_59 = ValueListener(Elements=pulldown_11, SomeProperty=True)  # -> Values, Indices
values_60 = ValueListener(Elements=pulldown_10, SomeProperty=True)  # -> Values, Indices
values_61 = ValueListener(Elements=slider_7, SomeProperty=True)  # -> Values, Indices
values_62 = ValueListener(Elements=slider_6, SomeProperty=True)  # -> Values, Indices
tooltip_3 = AttachTooltipToElement(ElementsToAttachTo=slider_7, TooltipContent="Doubleclick to input value", ShowDelay=500, Duration=2000)
values_63 = ValueListener(Elements=slider_8, SomeProperty=True)  # -> Values, Indices
tooltip_4 = AttachTooltipToElement(ElementsToAttachTo=slider_8, TooltipContent="Doubleclick to input value", ShowDelay=500, Duration=2000)
tooltip_5 = AttachTooltipToElement(ElementsToAttachTo=slider_6, TooltipContent="Doubleclick to input value", ShowDelay=500, Duration=2000)
selected_building = RemoteSender(values_59.Values)
selected_room = RemoteSender(values_60.Values)
cooling_setpoint = RemoteSender(values_62.Values)
cooling_setpoint_2 = RemoteReceiver(cooling_setpoint)
subtraction_10 = Subtraction(A=cooling_setpoint_2, B="1")
dom_2 = ConstructDomain(DomainStart=Slider(10, range=0..100), DomainEnd=subtraction_10)
setslider = SetSlider(UISlider=slider_7, Range=dom_2)
heating_setpoint = RemoteSender(values_61.Values)
heating_setpoint_2 = RemoteReceiver(heating_setpoint)
addition = Addition(A=heating_setpoint_2, B="1")
dom_3 = ConstructDomain(DomainStart=addition, DomainEnd=Slider(40, range=0..100))
setslider_2 = SetSlider(UISlider=slider_6, Range=dom_3)
entwine_36 = Entwine(Branch00=label_21, Branch01=slider_6, FlattenInputs=True)  # -> flatten(Result)
entwine_37 = Entwine(Branch00=label_22, Branch01=slider_7, FlattenInputs=True)  # -> flatten(Result)
entwine_38 = Entwine(Branch00=label_23, Branch01=slider_8, FlattenInputs=True)  # -> flatten(Result)
number_slider_32 = Slider(300, range=0..350)
stack_28 = CreateStack(UIElements=entwine_37, Horizontal=invert(True))
stack_29 = CreateStack(UIElements=entwine_36, Horizontal=invert(True))
stack_30 = CreateStack(UIElements=entwine_38, Horizontal=invert(True))
format_19 = Format(Format="{0}, {1}, 0, 0", Culture=127, Data0=Slider(10, range=0..25), Data1=Slider(0, range=0..50))
entwine_39 = Entwine(Branch00=label_19, Branch01=pulldown_11, Branch02=pulldown_10, FlattenInputs=True)  # -> flatten(Result)
entwine_40 = Entwine(Branch00=label_20, Branch01=stack_29, Branch02=stack_28, Branch03=stack_30, FlattenInputs=True)  # -> flatten(Result)
adjustpos_44 = AdjustElementPositioning(ElementsToAdjust=pulldown_11, AbsolutePositioning=False, Width=number_slider_32, HorizontalAlignment=0)
adjustpos_45 = AdjustElementPositioning(ElementsToAdjust=pulldown_10, AbsolutePositioning=False, Width=number_slider_32, HorizontalAlignment=0)
adjustpos_46 = AdjustElementPositioning(
    ElementsToAdjust=[slider_8, slider_7, slider_6],
    Margin=format_19,
    AbsolutePositioning=False,
    Width=Slider(200, range=0..300),
    HorizontalAlignment=0)

# ----
division_5 = Division(A=values_63.Values, B="100")
location_11 = Data(entwine_39)
location_12 = Data(entwine_40)
selected_room_2 = RemoteReceiver(selected_room)
cooling_setpoint_3 = RemoteReceiver(cooling_setpoint)
heating_setpoint_3 = RemoteReceiver(heating_setpoint)

# ---- group: Construction module
panel_79 = Panel("""Very Hot
Hot
Warm
Mixed
Cool
Cold
Very Cold
Subarctic""")
panel_80 = Panel("""SteelFramed
WoodFramed
Mass
Metal Building""")
panel_81 = Panel("Construction database")
empty_2 = EmptyObjectToEmptyBranch()
empty_3 = EmptyObjectToEmptyBranch()
empty_4 = EmptyObjectToEmptyBranch()
empty_5 = EmptyObjectToEmptyBranch()
empty_6 = EmptyObjectToEmptyBranch()
empty_7 = EmptyObjectToEmptyBranch()
empty_8 = EmptyObjectToEmptyBranch()
empty_9 = EmptyObjectToEmptyBranch()
pulldown_12 = CreatePulldownMenu(Label="Skylights", ListItems=empty_3, showLabel=True)
pulldown_13 = CreatePulldownMenu(Label="Windows", ListItems=empty_2, showLabel=True)
pulldown_14 = CreatePulldownMenu(Label="Exterior walls", ListItems=empty_5, showLabel=True)
pulldown_15 = CreatePulldownMenu(Label="Ground", ListItems=empty_4, showLabel=True)
pulldown_16 = CreatePulldownMenu(Label="Interior floors", ListItems=empty_8, showLabel=True)
pulldown_17 = CreatePulldownMenu(Label="Exterior floor", ListItems=empty_7, showLabel=True)
pulldown_18 = CreatePulldownMenu(Label="Exterior roof", ListItems=empty_6, showLabel=True)
pulldown_19 = CreatePulldownMenu(Label="Interior walls", ListItems=empty_9, showLabel=True)
true_button_8 = CreateTrueOnlyButton(ButtonName="Window database", ButtonStyle=0)
button_20 = CreateButton(ButtonName="Material database", ButtonStyle=0)
label_24 = CreateLabel(LabelText="Databases", LabelSize=18, Justification=0)
pulldown_20 = CreatePulldownMenu(Label="By climate", ListItems=panel_79, SelectedIndex=Slider(5, range=0..7), showLabel=True)
label_25 = CreateLabel(LabelText="Select base construction", LabelSize=18, Justification=0)
pulldown_21 = CreatePulldownMenu(Label="By type", ListItems=panel_80, SelectedIndex=Slider(1, range=0..3), showLabel=True)
values_64 = ValueListener(Elements=pulldown_12, SomeProperty=True)  # -> Values, Indices
values_65 = ValueListener(Elements=pulldown_13, SomeProperty=True)  # -> Values, Indices
values_66 = ValueListener(Elements=pulldown_19, SomeProperty=True)  # -> Values, Indices
values_67 = ValueListener(Elements=pulldown_16, SomeProperty=True)  # -> Values, Indices
values_68 = ValueListener(Elements=pulldown_17, SomeProperty=True)  # -> Values, Indices
values_69 = ValueListener(Elements=pulldown_15, SomeProperty=True)  # -> Values, Indices
values_70 = ValueListener(Elements=true_button_8, SomeProperty=True)  # -> Values, Indices
values_71 = ValueListener(Elements=pulldown_18, SomeProperty=True)  # -> Values, Indices
values_72 = ValueListener(Elements=button_20, SomeProperty=True)  # -> Values, Indices
values_73 = ValueListener(Elements=pulldown_14, SomeProperty=True)  # -> Values, Indices
values_74 = ValueListener(Elements=pulldown_21, SomeProperty=True)  # -> Values, Indices
subset_subface_skylight = RemoteSender(values_64.Indices)
subset_interior_wall = RemoteSender(values_66.Indices)
subset_interior_floor = RemoteSender(values_67.Indices)
subset_exterior_floor = RemoteSender(values_68.Indices)
subset_ground_floor = RemoteSender(values_69.Indices)
values_75 = ValueListener(Elements=pulldown_20, SomeProperty=True)  # -> Values, Indices
subset_subface_window = RemoteSender(values_65.Indices)
subset_exterior_roof = RemoteSender(values_71.Indices)
subset_exterior_wall = RemoteSender(values_73.Indices)
panel_82 = Panel(values_70.Values)
open_window_database = RemoteSender(values_70.Values)
base_type = RemoteSender(values_74.Values)
load_material_database = RemoteSender(values_72.Values)
addition_2 = Addition(A=values_75.Indices, B="1")
entwine_41 = Entwine(Branch00=pulldown_20, Branch01=pulldown_21, FlattenInputs=True)  # -> flatten(Result)
base_climate = RemoteSender(addition_2)
stack_31 = CreateStack(UIElements=entwine_41, Horizontal=True)
entwine_42 = Entwine(Branch00=label_25, Branch01=stack_31, FlattenInputs=True)  # -> flatten(Result)
stack_32 = CreateStack(UIElements=entwine_42, Horizontal=invert(True))
tooltip_6 = AttachTooltipToElement(ElementsToAttachTo=pulldown_21, TooltipContent="Select type of construction", ShowDelay=500, Duration=2000)
adjustpos_47 = AdjustElementPositioning(ElementsToAdjust=pulldown_21, AbsolutePositioning=False, Width=Slider(170, range=0..300), HorizontalAlignment=0)
adjustpos_48 = AdjustElementPositioning(ElementsToAdjust=pulldown_20, AbsolutePositioning=False, Width=Slider(160, range=0..300), HorizontalAlignment=0)
tooltip_7 = AttachTooltipToElement(ElementsToAttachTo=pulldown_20, TooltipContent="Select climate", ShowDelay=500, Duration=2000)
adjustpos_49 = AdjustElementPositioning(
    ElementsToAdjust=[pulldown_16, pulldown_15, pulldown_17, pulldown_18, pulldown_19, pulldown_14, pulldown_12, pulldown_13],
    AbsolutePositioning=False,
    Width=Slider(300, range=0..300),
    HorizontalAlignment=0)

# ----
base_climate_2 = RemoteReceiver(base_climate)
base_type_2 = RemoteReceiver(base_type)
button_21 = CreateButton(ButtonName=panel_81, ButtonStyle=0)
freeze_gate_9 = StreamFreezeGate(Data=values_72.Values, PassingSwitch=values_72.Values)
bool_10 = Boolean(invert(freeze_gate_9))
oilcan = OilCan(DataList=panel_12, Reset=recompute_3, Drop=values_72.Values, DropMode=3)
event_22 = EventGate(Data=oilcan)  # -> Data, IsNew
open_material_database = RemoteSender(event_22.Data)

# ----
# Select subset construction
data_4 = Data(pulldown_14)
data_5 = Data(pulldown_13)
data_6 = Data(pulldown_12)
data_7 = Data(pulldown_19)
data_8 = Data(pulldown_18)
data_9 = Data(pulldown_16)
data_10 = Data(pulldown_17)
data_11 = Data(pulldown_15)
entwine_43 = Entwine(
    Branch00=data_5,
    Branch01=data_6,
    Branch02=data_4,
    Branch03=data_7,
    Branch04=data_8,
    Branch05=data_9,
    Branch06=data_10,
    Branch07=data_11,
    FlattenInputs=True)  # -> flatten(Result)
expander = CreateExpander(UIElements=entwine_43, Header="Select subset constructions", Open="False")
adjustpos_50 = AdjustElementPositioning(ElementsToAdjust=expander, Margin="-10, 10, 0, 0", AbsolutePositioning=False, Width=Slider(320, range=0..350))
location_13 = Data(expander)

# ----
# Construction by climate and type
location_14 = Data(stack_32)

bldgvintages_2 = HBBuildingVintages({"ASHRAE 90.1 2019  |  IECC 2021": "2019", "ASHRAE 90.1 2016  |  IECC 2018": "2016", "ASHRAE 90.1 2013  |  IECC 2015": "2013", "ASHRAE 90.1 2010  |  IECC 2012": "2010", "ASHRAE 90.1 2007  |  IECC 2009": "2007", "ASHRAE 90.1 2004  |  IECC 2006": "2004", "1980-2004 (CBECS)": "1980_2004", "Pre-1980 (CBECS)": "pre_1980"}, selected="ASHRAE 90.1 2019  |  IECC 2021")
base_climate_3 = RemoteReceiver(base_climate)
base_type_3 = RemoteReceiver(base_type)
constrsetclimate_2 = HBConstructionSetByClimate(climate_zone=base_climate_3, vintage=bldgvintages_2, constr_type=base_type_3)  # -> constr_set; plug-in component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
panel_83 = Panel(constrsetclimate_2)

constrsetclimate_3 = HBConstructionSetByClimate(climate_zone=base_climate_2, vintage=bldgvintages_2, constr_type=base_type_2)  # -> constr_set; plug-in component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
panel_84 = Panel(constrsetclimate_3)
constructionset_2 = HBConstructionSet(base_constr_set=panel_84)  # -> constr_set; plug-in component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
decnstrconstrset_2 = HBDeconstructConstructionSet(constr_set=constructionset_2)  # -> exterior_wall, exterior_roof, exposed_floor, ground_wall, ground_roof, ground_floor, window, skylight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; plug-in component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
decnstrconstrsetint = HBDeconstructConstructionSetInterior(constr_set=constructionset_2)  # -> interior_wall, ceiling, interior_floor, interior_window, interior_door, int_glass_door; plug-in component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
entwine_44 = Entwine(
    Branch00=decnstrconstrset_2.exterior_wall,
    Branch01=decnstrconstrsetint.interior_wall,
    Branch02=decnstrconstrset_2.exterior_roof,
    Branch03=decnstrconstrsetint.interior_floor,
    Branch04=decnstrconstrset_2.exposed_floor,
    Branch05=decnstrconstrset_2.ground_floor,
    FlattenInputs=True)
decnstrconstr_2 = HBDeconstructConstruction(constr=entwine_44)  # -> materials, layers, r_val_si, r_val_ip, u_fac_si, u_fac_ip, shgc, t_sol, t_vis; plug-in component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
bang_2 = ExplodeTree(Data=decnstrconstr_2.u_fac_si)  # -> Branch0, Branch1, Branch2, Branch3, Branch4, Branch5

exterior_wall = Data(bang_2.Branch0)
exterior_roof = Data(bang_2.Branch2)
interior_floor = Data(bang_2.Branch3)
exterior_floor = Data(bang_2.Branch4)
ground_2 = Data(bang_2.Branch5)
interior_wall = Data(bang_2.Branch1)
expression_2 = Expression(x=ground_2, Expression="Round(x, 2)")
expression_3 = Expression(x=exterior_floor, Expression="Round(x, 2)")
expression_4 = Expression(x=exterior_roof, Expression="Round(x, 2)")
expression_5 = Expression(x=interior_floor, Expression="Round(x, 2)")
expression_6 = Expression(x=interior_wall, Expression="Round(x, 2)")
expression_7 = Expression(x=exterior_wall, Expression="Round(x, 2)")
format_20 = Format(Format="{0} (U-factor: {1})", Culture=127, Data0=panel_58, Data1=expression_2)
format_21 = Format(Format="{0} (U-factor: {1})", Culture=127, Data0=panel_58, Data1=expression_3)
format_22 = Format(Format="{0} (U-factor: {1})", Culture=127, Data0=panel_58, Data1=expression_4)
format_23 = Format(Format="{0} (U-factor: {1})", Culture=127, Data0=panel_58, Data1=expression_5)
format_24 = Format(Format="{0} (U-factor: {1})", Culture=127, Data0=panel_58, Data1=expression_6)
format_25 = Format(Format="{0} (U-factor: {1})", Culture=127, Data0=panel_58, Data1=expression_7)

# ---- group: Analysis module
# Energy simulation
# Daylight simulation
# LCA calculations
panel_85 = Panel("Compare with")
panel_86 = Panel("""Illuminance [Lux]
Daylight autonomy [%]
UDI [%]
UDI <50 [%]
UDI >3000 [%]
None""")
panel_87 = Panel("""Annual energy balance
Daily cooling profile
Daily heating profile
Cooling balance
Heating balance
None""")
panel_88 = Panel("Spatial daylight autonomy: {0}%")
height = Slider(40, range=1..100)
width = Slider(5, range=1..100)
panel_89 = Panel("Total load EUI: {0} (kWh/m2)")
panel_90 = Panel("Total embodied GWP per area: {0} kg CO2eq/m2")
panel_91 = Panel("Total embodied GWP: {0} kg CO2eq")
panel_92 = Panel("Visualize GWP by model")
pulldown_22 = CreatePulldownMenu(Label=panel_85, showLabel=True)
panel_93 = Panel("Operational GWP total: {0} kg CO2eq/year")
panel_94 = Panel("Op. GWP total ({0} years): {1} kg CO2eq")
label_26 = CreateLabel(LabelText="Compare simulations", LabelSize=18, Justification=0)
true_button_9 = CreateTrueOnlyButton(ButtonName="Compare simulations bar chart", ButtonStyle=0)
button_22 = CreateButton(ButtonName="Bake", ButtonStyle=0)
button_23 = CreateButton(ButtonName="Zoom", ButtonStyle=0)
button_24 = CreateButton(ButtonName="Run energy simulation", ButtonStyle=0)
tb_5 = CreateTextBlock(TextSize=16, Justification=0)
label_27 = CreateLabel(LabelText="Display settings", LabelSize=18, Justification=0)
tb_6 = CreateTextBlock(Text="Simulations can take a few minutes...", TextSize=12, Justification=0)
values_76 = ValueListener(Elements=pulldown_22, SomeProperty=True)  # -> Values, Indices
pulldown_23 = CreatePulldownMenu(Label="Display type", ListItems=panel_87, showLabel=True)
slider_9 = CreateSlider(
    Slider=width,
    SnapValue=Slider(2, range=0..10),
    ShowBounds=False,
    ShowTicks=True,
    ShowTooltip=False,
    ShowValLabel=False,
    showLabel=True)
slider_10 = CreateSlider(
    Slider=height,
    SnapValue=Slider(2, range=0..10),
    ShowBounds=False,
    ShowTicks=True,
    ShowTooltip=False,
    ShowValLabel=False,
    showLabel=True)
pulldown_24 = CreatePulldownMenu(Label="Display type", ListItems=panel_86, SelectedIndex="0", showLabel=True)
tb_7 = CreateTextBlock(Text=panel_88, TextSize=16, Justification=0)
tb_8 = CreateTextBlock(Text="Simulations can take a few minutes...", TextSize=12, Justification=0)
label_28 = CreateLabel(LabelText="Display settings", LabelSize=18, Justification=0)
values_77 = ValueListener(Elements=true_button_9, SomeProperty=True)  # -> Values, Indices
tb_9 = CreateTextBlock(Text=panel_89, TextSize=16, Justification=0)
button_25 = CreateButton(ButtonName="Zoom", ButtonStyle=0)
button_26 = CreateButton(ButtonName="Run daylight simulation", ButtonStyle=0)
tb_10 = CreateTextBlock(TextSize=16, Justification=0)
tb_11 = CreateTextBlock(TextSize=16, Justification=0)
values_78 = ValueListener(Elements=button_23, SomeProperty=True)  # -> Values, Indices
values_79 = ValueListener(Elements=button_22, SomeProperty=True)  # -> Values, Indices
hasdata_2 = DataExists(Data=relay)
values_80 = ValueListener(Elements=button_24, SomeProperty=True)  # -> Values, Indices
values_81 = ValueListener(Elements=button_26, SomeProperty=True)  # -> Values, Indices
values_82 = ValueListener(Elements=pulldown_23, SomeProperty=True)  # -> Values, Indices
values_83 = ValueListener(Elements=pulldown_24, SomeProperty=True)  # -> Values, Indices
values_84 = ValueListener(Elements=slider_10, SomeProperty=True)  # -> Values, Indices
label_29 = CreateLabel(LabelText=panel_90, LabelSize=12, Justification=0)
label_30 = CreateLabel(LabelText="Create a model in the assembly module to get a LCA", LabelSize=12, Justification=0)
label_31 = CreateLabel(LabelText=panel_91, LabelSize=12, Justification=0)
values_85 = ValueListener(Elements=slider_9, SomeProperty=True)  # -> Values, Indices
subtraction_11 = Subtraction(A=values_76.Indices, B="1")
daylight_simulation_compare_pop_up = RemoteSender(values_77.Values)
filter_14 = StreamFilter(Gate=hasdata_2, Stream0="0", Stream1=relay)
values_86 = ValueListener(Elements=button_25, SomeProperty=True)  # -> Values, Indices
label_32 = CreateLabel(LabelText=panel_93, LabelSize=12, Justification=0)
freeze_gate_10 = StreamFreezeGate(Data=values_80.Values, PassingSwitch=invert(values_80.Values))
zoom_simple_energy_simulation = RemoteSender(values_78.Values)
label_33 = CreateLabel(LabelText=panel_94, LabelSize=12, Justification=0)
bake_simple_energy_simulation = RemoteSender(values_79.Values)
freeze_gate_11 = StreamFreezeGate(Data=values_81.Values, PassingSwitch=invert(values_81.Values))
pre_run_simple_energy_simulations = RemoteSender(values_80.Values)
pre_run_simple_energy_simulations_2 = RemoteReceiver(pre_run_simple_energy_simulations)
freeze_gate_12 = StreamFreezeGate(Data=pre_run_simple_energy_simulations_2, PassingSwitch=pre_run_simple_energy_simulations_2)
simple_energy_simulation_type = RemoteSender(values_82.Indices)
daylight_simulation_type = RemoteSender(values_83.Indices)
simple_energy_simulation_height = RemoteSender(values_84.Values)
simple_energy_simulation_width = RemoteSender(values_85.Values)
or = GateOr(B=filter_14)
current_selected_simulation_daylight_com = RemoteSender(subtraction_11)  # "current_selected_simulation_daylight_compare"
pre_run_daylight_simulations = RemoteSender(values_81.Values)
pre_run_daylight_simulations_2 = RemoteReceiver(pre_run_daylight_simulations)
freeze_gate_13 = StreamFreezeGate(Data=pre_run_daylight_simulations_2, PassingSwitch=pre_run_daylight_simulations_2)
hasdata_3 = DataExists(Data=freeze_gate_13)
filter_15 = StreamFilter(Gate=hasdata_3, Stream0="0", Stream1=freeze_gate_13)
zoom_daylight_simulation = RemoteSender(values_86.Values)
bool_11 = Boolean(invert(freeze_gate_10))
bool_12 = Boolean(invert(freeze_gate_11))
entwine_45 = Entwine(Branch00=slider_10, Branch01=slider_9, FlattenInputs=True)  # -> flatten(Result)
entwine_46 = Entwine(Branch00=button_24, Branch01=button_23, Branch02=button_22, FlattenInputs=True)  # -> flatten(Result)
rec_8 = DataRecorder(or, DataLimit=-10, RecordData=True)
tap_4 = TapBuffer(Reset=False, Incremental=True, Valve=bool_11, Hold=True)
tap_5 = TapBuffer(Reset=False, Incremental=True, Valve=bool_12, Hold=True)
ma_7 = MassAddition(Input=flatten(rec_8))  # -> Result, PartialResults
dam_9 = DataDam(DataA=tap_4, BufferDelay=2500000, BufferMode=2)
dam_10 = DataDam(DataA=tap_5, BufferDelay=2500000, BufferMode=2)
entwine_47 = Entwine(Branch00=pulldown_23, Branch01=entwine_45, FlattenInputs=True)  # -> flatten(Result)
mod = Modulus(A=ma_7.Result, B=Slider(2, range=0..10))
equals_10 = Equality(FirstNumber=tap_4, SecondNumber=dam_9)  # -> Equality, Inequality
equals_11 = Equality(FirstNumber=tap_5, SecondNumber=dam_10)  # -> Equality, Inequality
stack_33 = CreateStack(UIElements=entwine_46, Horizontal=True)
bool_13 = Boolean(mod)
entwine_48 = Entwine(Branch00=label_28, Branch01=pulldown_24, FlattenInputs=True)  # -> flatten(Result)
stack_34 = CreateStack(UIElements=entwine_47, Horizontal=invert(True))
adjustelem_10 = AdjustElementAppearance(ElementsToAdjust=tb_7, Foreground=ColourSwatch(SwatchColor=RGB(0, 0, 0)), FontSize=Slider(14, range=0..100))
adjustelem_11 = AdjustElementAppearance(ElementsToAdjust=tb_9, Foreground=ColourSwatch(SwatchColor=RGB(0, 0, 0)), FontSize=Slider(14, range=0..100))
filter_16 = StreamFilter(Gate=bool_13, Stream0="Simulation failed...", Stream1="Energy simulation is running...")
format_26 = Format(
    Format="{0}, {1}, 0, {2}",
    Culture=127,
    Data0=Slider(5, range=-25..25),
    Data1=Slider(5, range=-15..15),
    Data2=Slider(5, range=0..100))
stack_35 = CreateStack(UIElements=entwine_48, Horizontal=invert(True))
format_27 = Format(
    Format="{0}, {1}, 0, {2}",
    Culture=127,
    Data0=Slider(10, range=-25..25),
    Data1=Slider(5, range=-15..15),
    Data2=Slider(5, range=0..100))
entwine_49 = Entwine(Branch00=button_26, Branch01=button_25, Branch02=button_5, FlattenInputs=True)  # -> flatten(Result)
entwine_50 = Entwine(Branch00=label_27, Branch01=stack_34, FlattenInputs=True)  # -> flatten(Result)
gate_3 = StreamGate(Stream=filter_16, Gate=freeze_gate_12)  # -> Target0, Target1
adjustpos_51 = AdjustElementPositioning(ElementsToAdjust=tb_5, Margin="10, 0, 0, 5", AbsolutePositioning=False, HorizontalAlignment=0)
adjustpos_52 = AdjustElementPositioning(
    ElementsToAdjust=pulldown_23,
    AbsolutePositioning=False,
    Width=Slider(245, range=0..1000),
    Height=Slider(35, range=0..100),
    HorizontalAlignment=0)
adjustpos_53 = AdjustElementPositioning(
    ElementsToAdjust=[slider_10, slider_9],
    Margin="5, 5, 10, 0",
    AbsolutePositioning=False,
    Width=Slider(240, range=0..1000),
    HorizontalAlignment=0)
stack_36 = CreateStack(UIElements=entwine_49, Horizontal=True)
adjustpos_54 = AdjustElementPositioning(ElementsToAdjust=[button_26, button_25, button_5], Margin="5, 5, 0, 0", AbsolutePositioning=False, HorizontalAlignment=0)
entwine_51 = Entwine(Branch00=tb_7, Branch01=stack_35, FlattenInputs=True)  # -> flatten(Result)
entwine_52 = Entwine(Branch00=label_26, Branch01=true_button_9, Branch02=pulldown_22, FlattenInputs=True)  # -> flatten(Result)
adjustpos_55 = AdjustElementPositioning(ElementsToAdjust=tb_7, Margin="5, 10, 0, 5", AbsolutePositioning=False, HorizontalAlignment=0)
adjustpos_56 = AdjustElementPositioning(ElementsToAdjust=tb_9, Margin="10, 5, 0, 10", AbsolutePositioning=False, HorizontalAlignment=0)
adjustpos_57 = AdjustElementPositioning(
    ElementsToAdjust=pulldown_22,
    Margin=format_26,
    AbsolutePositioning=False,
    Width=Slider(245, range=0..300),
    HorizontalAlignment=0,
    VerticalAlignment=2)
adjustpos_58 = AdjustElementPositioning(
    ElementsToAdjust=pulldown_24,
    AbsolutePositioning=False,
    Width=Slider(245, range=0..1000),
    Height=Slider(35, range=0..100),
    HorizontalAlignment=0)
adjustpos_59 = AdjustElementPositioning(ElementsToAdjust=tb_10, Margin="10, 0, 0, 5", AbsolutePositioning=False, HorizontalAlignment=0)
adjustpos_60 = AdjustElementPositioning(ElementsToAdjust=true_button_9, Margin=format_27, AbsolutePositioning=False, HorizontalAlignment=0, VerticalAlignment=2)
adjustpos_61 = AdjustElementPositioning(ElementsToAdjust=tb_11, Margin="10, 0, 0, 5", AbsolutePositioning=False, HorizontalAlignment=0)
adjustpos_62 = AdjustElementPositioning(
    ElementsToAdjust=[button_22, button_23, button_24],
    Margin="5, 5, 0, 0",
    AbsolutePositioning=False,
    HorizontalAlignment=0)
adjustpos_63 = AdjustElementPositioning(ElementsToAdjust=tb_8, Margin="5, 0, 0, 5", AbsolutePositioning=False, HorizontalAlignment=0)
stack_37 = CreateStack(UIElements=entwine_52, Horizontal=invert(True))

# ----
true_button_10 = CreateTrueOnlyButton(ButtonName=panel_92, ButtonStyle=0)
gate_4 = StreamGate(Stream="No available simulation for this model.", Gate=freeze_gate_13)  # -> Target0, Target1
gate_5 = StreamGate(Stream="No available simulation for this model.", Gate=freeze_gate_12)  # -> Target0, Target1
adjustpos_64 = AdjustElementPositioning(ElementsToAdjust=tb_6, Margin="5, 0, 0, 5", AbsolutePositioning=False, HorizontalAlignment=0)

daylight_simulation_compare_pop_up_2 = RemoteReceiver(daylight_simulation_compare_pop_up)
rec_9 = DataRecorder(daylight_simulation_compare_pop_up_2, DataLimit=-2, RecordData=True)
ma_8 = MassAddition(Input=rec_9)  # -> Result, PartialResults
daylight_simulation_compare_pop_up_3 = RemoteReceiver(daylight_simulation_compare_pop_up)
entwine_53 = Entwine(Branch00=ma_8.Result, Branch01=sda_window_status, FlattenInputs=True)
rec_10 = DataRecorder(entwine_53, DataLimit=2, RecordData=True)
item_7 = ListItem(List=rec_10, Index=0, Wrap=True)  # -> Item2, Item1, Item
and_2 = GateAnd(A=daylight_simulation_compare_pop_up_3, B=event_7.Data)
equals_12 = Equality(FirstNumber=item_7.Item2, SecondNumber=item_7.Item1)  # -> Equality, Inequality
py3_8 = Python3Script(get=and_2)  # -> mpl_folder; same code as py3_5
bang_3 = ExplodeTree(Data=equals_12.Inequality)  # -> Branch0, Branch1
py3_9 = Python3Script(x=bang_3.Branch0, y=bang_3.Branch1)  # -> a; same code as py3_6
nextfile_2 = NextAvailableFilename(Format="SDA{000}.png", FolderPath=py3_8, Trigger=and_2)
event_23 = EventGate(Data=py3_9)  # -> Data, IsNew
freeze_gate_14 = StreamFreezeGate(Data=py3_9, PassingSwitch=event_23.IsNew)
event_24 = EventGate(Data=freeze_gate_14)  # -> Data, IsNew
panel_95 = Panel(event_24.Data)
launchwin_2 = LaunchWindow(
    Show=event_24.Data,
    Name="Spatial daylight autonomy",
    Width=bar_chart_popup_win_width_4,
    Height=bar_chart_popup_win_height_4,
    ChildStatus=1,
    EnableHorizScroll=False)
daylight_simulation_compare_pop_up_4 = RemoteReceiver(daylight_simulation_compare_pop_up)
winstat_2 = WindowStatus(Window=launchwin_2)
winprops_2 = SetWindowProperties(
    Window=launchwin_2,
    StartingLocation=pt_10,
    Theme=0,
    AccentColor=heath_accent_color_11,
    ShowTitleBar=True,
    BackgroundColor=RGB(255, 255, 255),
    ScaleFactor=1)
spacial_daylight_autonomy_status = RemoteSender(winstat_2)
py3_10 = Python3Script(window=launchwin_2, activate=daylight_simulation_compare_pop_up_4)  # same code as py3_7

spacial_daylight_autonomy_status_2 = RemoteReceiver(spacial_daylight_autonomy_status)
expression_8 = Expression(x="Hidden", y=spacial_daylight_autonomy_status_2, Expression="x=y")
expire_2 = ExpireObject(ObjectToExpire=objbynn_5, Expire=expression_8)

daylight_simulation_type_2 = RemoteReceiver(daylight_simulation_type)
equals_13 = Equality(FirstNumber="5", SecondNumber=daylight_simulation_type_2)  # -> Equality, Inequality

# ---- group: Geometry module
panel_96 = Panel("""This document is currently in {0}.
Honeybee models require models in meters.""")
panel_97 = Panel("""Room
Window
Adjacent
Context
None""")
panel_98 = Panel("""None
Room
Window
Adjacent
Context
All""")
panel_99 = Panel("""Could not save geometry. 
It was not of the correct type.""")
number_slider_33 = Slider(10, range=0..10)
button_27 = CreateButton(ButtonName="Change document units", ButtonStyle=0)
tb_12 = CreateTextBlock(TextSize=12, Justification=0)
label_34 = CreateLabel(LabelText="Import geometry", LabelSize=18, Justification=0)
listbox = CreateListBox(ListItems=panel_98, SelectedIndex=0, Height=100)
pulldown_25 = CreatePulldownMenu(Label="Geometry type", ListItems=panel_97, showLabel=True)
button_28 = CreateButton(ButtonName="Save geometry", ButtonStyle=0)
values_87 = ValueListener(Elements=button_28, SomeProperty=True)  # -> Values, Indices
label_35 = CreateLabel(LabelText=panel_99, LabelSize=12, Justification=0)
freeze_gate_15 = StreamFreezeGate(Data=values_87.Values, PassingSwitch=invert(values_87.Values))
button_29 = CreateButton(ButtonName="Create test model", ButtonStyle=0)  # disabled
presavegeometry = RemoteSender(values_87.Values)
label_36 = CreateLabel(LabelText="Preview geometry", LabelSize=18, Justification=0)
rectangle = Rectangle(Plane=PlaneXY(0, 0, 0), XSize=number_slider_33, YSize=number_slider_33, Radius=0)  # -> Rectangle, Length
number_slider_34 = Slider(15, range=0..20)
values_88 = ValueListener(Elements=listbox, SomeProperty=True)  # -> Values, Indices
values_89 = ValueListener(Elements=button_27, SomeProperty=True)  # -> Values, Indices
values_90 = ValueListener(Elements=pulldown_25, SomeProperty=True)  # -> Values, Indices
bool_14 = Boolean(invert(freeze_gate_15))
values_91 = ValueListener(Elements=button_29, SomeProperty=True)  # -> Values, Indices
pt_11 = ConstructPoint(XCoordinate=Slider(10, range=0..10), YCoordinate=Slider(-20, range=-100..0), ZCoordinate=0)
bool_15 = Boolean(values_88.Indices)
previewtype = RemoteSender(values_88.Values)
change_document_units = RemoteSender(values_89.Values)
adjustelem_12 = AdjustElementAppearance(ElementsToAdjust=tb_12, Foreground=ColourSwatch(SwatchColor=RGB(0, 0, 0)))
tap_6 = TapBuffer(Reset=False, Incremental=True, Valve=bool_14, Hold=True)
geometrytype = RemoteSender(values_90.Values)
geometrytype_validate = RemoteSender(values_90.Indices)
geometry_module_state_import_type = RemoteSender(values_90.Indices)
freeze_gate_16 = StreamFreezeGate(Data=values_91.Values, PassingSwitch=invert(values_91.Values))
shapes = CreateShapes(Shapes=rectangle.Rectangle, StrokeColor=RGB(0, 0, 0), Scale=1, ClickMode=3)  # -> flatten(Shape)
rectangle_2 = Rectangle(Plane=pt_11, XSize=number_slider_34, YSize=number_slider_34, Radius=0)  # -> Rectangle, Length
dam_11 = DataDam(DataA=tap_6, BufferDelay=2500000, BufferMode=2)
bool_16 = Boolean(invert(freeze_gate_16))
equals_14 = Equality(FirstNumber=tap_6, SecondNumber=dam_11)  # -> Equality, Inequality
tap_7 = TapBuffer(Reset=False, Incremental=True, Valve=bool_16, Hold=True)
entwine_54 = Entwine(Branch00=tb_12, Branch01=button_27, FlattenInputs=True)  # -> flatten(Result)
dam_12 = DataDam(DataA=tap_7, BufferDelay=2500000, BufferMode=2)
stack_38 = CreateStack(UIElements=entwine_54, Horizontal=invert(True))
adjustpos_65 = AdjustElementPositioning(ElementsToAdjust=button_27, AbsolutePositioning=False, Width=Slider(150, range=0..800), HorizontalAlignment=0)
equals_15 = Equality(FirstNumber=tap_7, SecondNumber=dam_12)  # -> Equality, Inequality
format_28 = Format(Format="{0}, {1}, 0, 0", Culture=127, Data0=Slider(-50, range=-50..25), Data1=Slider(25, range=0..50))
adjustpos_66 = AdjustElementPositioning(ElementsToAdjust=button_29, Margin=format_28, AbsolutePositioning=False)
adjustpos_67 = AdjustElementPositioning(
    ElementsToAdjust=listbox,
    AbsolutePositioning=False,
    Width=Slider(150, range=0..300),
    Height=Slider(150, range=0..300),
    HorizontalAlignment=0)
# FLY!
# Simulations
# Metahopper recursions
# Launch website
entwine_55 = Entwine(Branch00=label_34, Branch01=pulldown_25, Branch02=button_28, FlattenInputs=True)  # -> flatten(Result)
adjustpos_68 = AdjustElementPositioning(ElementsToAdjust=stack_38, Margin="5, 5, 0, 0", AbsolutePositioning=False, Width=Slider(160, range=0..800))
swatch_3 = ColourSwatch(SwatchColor=RGBA(0, 17, 128, 100))
swatch_4 = ColourSwatch(SwatchColor=RGBA(128, 0, 102, 100))
swatch_5 = ColourSwatch(SwatchColor=RGBA(4, 128, 0, 100))
swatch_6 = ColourSwatch(SwatchColor=RGBA(128, 125, 0, 100))
border_3 = CreateBorder(
    UIElement=stack_38,
    BorderThickness=Slider(1, range=0..10),
    BorderColor=ColourSwatch(SwatchColor=RGB(255, 0, 0)),
    CornerRadius=Slider(1, range=0..10))
stack_39 = CreateStack(UIElements=entwine_55, Horizontal=invert(True))
adjustpos_69 = AdjustElementPositioning(
    ElementsToAdjust=[button_28, pulldown_25],
    AbsolutePositioning=False,
    Width=Slider(180, range=0..300),
    HorizontalAlignment=0)
adjustelem_13 = AdjustElementAppearance(ElementsToAdjust=label_35, Foreground=ColourSwatch(SwatchColor=RGB(255, 0, 0)))
setshapes = SetShapes(
    ShapeToModify=shapes,
    ShapeCurves=rectangle_2.Rectangle,
    FillColors=ColourSwatch(SwatchColor=RGB(180, 180, 180)),
    StrokeColors=ColourSwatch(SwatchColor=RGB(255, 255, 255)),
    Scale=1)

# ----
shapes_2 = CreateShapes(Shapes=rectangle.Rectangle, StrokeColor=RGB(0, 0, 0), Scale=1, ClickMode=3)  # -> flatten(Shape)
shapes_3 = CreateShapes(Shapes=rectangle.Rectangle, StrokeColor=RGB(0, 0, 0), Scale=1, ClickMode=3)  # -> flatten(Shape)
shapes_4 = CreateShapes(Shapes=rectangle.Rectangle, StrokeColor=RGB(0, 0, 0), Scale=1, ClickMode=3)  # -> flatten(Shape)
shapes_5 = CreateShapes(Shapes=rectangle.Rectangle, StrokeColor=RGB(0, 0, 0), Scale=1, ClickMode=3)  # -> flatten(Shape)
shapes_6 = CreateShapes(Shapes=rectangle.Rectangle, StrokeColor=RGB(0, 0, 0), Scale=1, ClickMode=3)  # -> flatten(Shape)

# ---- group: Geometry module
# Document units
doc_units = DocumentUnits()
change_document_units_2 = RemoteReceiver(change_document_units)
document_units = RemoteSender(doc_units)
gate_6 = StreamGate(Stream="4", Gate=change_document_units_2)  # -> Target0, Target1
unit_warning = UnitWarning(UnitSystem=gate_6.Target1)

# ----
entwine_56 = Entwine(
    Branch00=shapes,
    Branch01=shapes_2,
    Branch02=shapes_3,
    Branch03=shapes_6,
    Branch04=shapes_4,
    Branch05=shapes_5,
    FlattenInputs=True)  # -> flatten(Result)
setshapes_2 = SetShapes(
    ShapeToModify=shapes_2,
    ShapeCurves=rectangle_2.Rectangle,
    FillColors=swatch_5,
    StrokeColors=ColourSwatch(SwatchColor=RGB(255, 255, 255)),
    Scale=1)
setshapes_3 = SetShapes(
    ShapeToModify=shapes_3,
    ShapeCurves=rectangle_2.Rectangle,
    FillColors=swatch_4,
    StrokeColors=ColourSwatch(SwatchColor=RGB(255, 255, 255)),
    Scale=1)
setshapes_4 = SetShapes(
    ShapeToModify=shapes_6,
    ShapeCurves=rectangle_2.Rectangle,
    FillColors=swatch_3,
    StrokeColors=ColourSwatch(SwatchColor=RGB(255, 255, 255)),
    Scale=1)
setshapes_5 = SetShapes(
    ShapeToModify=shapes_4,
    ShapeCurves=rectangle_2.Rectangle,
    FillColors=swatch_6,
    StrokeColors=ColourSwatch(SwatchColor=RGB(255, 255, 255)),
    Scale=1)
setshapes_6 = SetShapes(
    ShapeToModify=shapes_5,
    ShapeCurves=rectangle_2.Rectangle,
    FillColors=ColourSwatch(SwatchColor=RGB(230, 230, 230)),
    StrokeColors=ColourSwatch(SwatchColor=RGB(255, 255, 255)),
    Scale=1)

# ----
# Document unit warning text
location_15 = Data(border_3)

# ----
# Model visualization
# Model creation
# Zoom and bake geometry
# Geometry handling
# Assign type
assign_type = Data(stack_39)

# ----
# Test model
location_16 = Data(button_29)

entwine_57 = Entwine(Branch00=assign_type, Branch01=location_15, FlattenInputs=True)  # -> flatten(Result)
stack_40 = CreateStack(UIElements=entwine_57, Horizontal=True)

presavegeometry_2 = RemoteReceiver(presavegeometry)
document_units_2 = RemoteReceiver(document_units)
document_units_3 = RemoteReceiver(document_units)
document_units_4 = RemoteReceiver(document_units)
document_units_5 = RemoteReceiver(document_units)
previewtype_2 = RemoteReceiver(previewtype)
previewtype_3 = RemoteReceiver(previewtype)
previewtype_4 = RemoteReceiver(previewtype)
previewtype_5 = RemoteReceiver(previewtype)
expression_9 = Expression(x=document_units_2, y="Meters", Expression="x=y")
expression_10 = Expression(x=previewtype_3, y="All", Expression="x=y")
expression_11 = Expression(x=document_units_3, y="Meters", Expression="x=y")
expression_12 = Expression(x="Room", y=previewtype_3, Expression="x=y")
expression_13 = Expression(x=document_units_4, y="Meters", Expression="x=y")
expression_14 = Expression(x=previewtype_2, y="All", Expression="x=y")
expression_15 = Expression(x=document_units_5, y="Meters", Expression="x=y")
expression_16 = Expression(x="Context", y=previewtype_2, Expression="x=y")
geometrytype_2 = RemoteReceiver(geometrytype)
expression_17 = Expression(x="Window", y=previewtype_5, Expression="x=y")
expression_18 = Expression(x=previewtype_5, y="All", Expression="x=y")
expression_19 = Expression(x="Adjacent", y=previewtype_4, Expression="x=y")
expression_20 = Expression(x=previewtype_4, y="All", Expression="x=y")
or_2 = GateOr(A=expression_16, B=expression_14)
or_3 = GateOr(A=expression_12, B=expression_10)
or_4 = GateOr(A=expression_17, B=expression_18)
or_5 = GateOr(A=expression_19, B=expression_20)
gate_7 = StreamGate(Stream="Adjacent", Gate=or_5)  # -> Target0, Target1
gate_8 = StreamGate(Stream="Context", Gate=or_2)  # -> Target0, Target1
gate_9 = StreamGate(Stream="Room", Gate=or_3)  # -> Target0, Target1
gate_10 = StreamGate(Stream="Window", Gate=or_4)  # -> Target0, Target1
geometrytype_validate_2 = RemoteReceiver(geometrytype_validate)

# ---- group: Geometry module (continued)
document_units_6 = RemoteReceiver(document_units)
case = TextCase(Text=document_units_6, Culture=127)  # -> UpperCase, LowerCase
format_29 = Format(Format=panel_96, Culture=127, Data0=case.LowerCase)
settextblock_4 = SetTextBlockContents(TextBlockToModify=tb_12, NewTextBlockContents=format_29)
stack_41 = CreateStack(UIElements=entwine_56, Horizontal=invert(True))
document_units_7 = RemoteReceiver(document_units)
entwine_58 = Entwine(Branch00=stack_41, Branch01=listbox, FlattenInputs=True)  # -> flatten(Result)
stack_42 = CreateStack(UIElements=entwine_58, Horizontal=True)
expression_21 = Expression(x=document_units_7, y="Meters", Expression="x=y")
entwine_59 = Entwine(Branch00=label_36, Branch01=stack_42, FlattenInputs=True)  # -> flatten(Result)
adjustpos_70 = AdjustElementPositioning(
    ElementsToAdjust=[shapes_5, shapes_4, shapes_6, shapes_3, shapes_2, shapes],
    Margin=format_12,
    AbsolutePositioning=False,
    HorizontalAlignment=0)
hideshow_10 = HideShowElement(ElementToHideShow=border_3, Show=invert(expression_21), Collapse=True, Disable=False)
adjustpos_71 = AdjustElementPositioning(ElementsToAdjust=stack_41, Margin=format_14, AbsolutePositioning=False, HorizontalAlignment=0)

# ----
# Preview
preview = Data(entwine_59)

# ----
# Glare probability
panel_100 = Panel("")  # disabled
panel_101 = Panel("Daylight glare probability (DGP): {0} %")  # disabled
panel_102 = Panel("Simulations can take a few minutes...")  # disabled
panel_103 = Panel("Calculate Glare probability")  # disabled
tb_13 = CreateTextBlock(Text=panel_100, TextSize=16, Justification=0)  # disabled
panel_104 = Panel("Create a model before running the simulation")  # disabled
number_slider_35 = Slider(500, range=0..1000)  # disabled
number_slider_36 = Slider(1000000, range=0..1000000)  # disabled
tb_14 = CreateTextBlock(Text=panel_102, TextSize=16, Justification=0)  # disabled
button_30 = CreateButton(ButtonName=panel_103, ButtonStyle=0)  # disabled
tb_15 = CreateTextBlock(Text=panel_101, TextSize=16, Justification=0)  # disabled
values_92 = ValueListener(Elements=button_30, SomeProperty=True)  # -> Values, Indices; disabled
panel_105 = Panel("0")  # disabled
panel_106 = Panel(" ")  # disabled
freeze_gate_17 = StreamFreezeGate(Data=values_92.Values, PassingSwitch=invert(values_92.Values))  # disabled
pre_calculate_glare_probability = RemoteSender(values_92.Values)  # disabled
pre_calculate_glare_probability_2 = RemoteReceiver(pre_calculate_glare_probability)  # disabled
freeze_gate_18 = StreamFreezeGate(Data=pre_calculate_glare_probability_2, PassingSwitch=pre_calculate_glare_probability_2)  # disabled
hasdata_4 = DataExists(Data=freeze_gate_18)  # disabled
filter_17 = StreamFilter(Gate=hasdata_4, Stream0=panel_105, Stream1=freeze_gate_18)  # disabled
bool_17 = Boolean(invert(freeze_gate_17))  # disabled
number_slider_37 = Slider(2, range=0..10)  # disabled
panel_107 = Panel("False")  # disabled
tap_8 = TapBuffer(Reset=False, Incremental=True, Valve=bool_17, Hold=True)  # disabled
panel_108 = Panel("Analysis module")  # disabled
swatch_7 = ColourSwatch(SwatchColor=RGB(237, 185, 94))  # disabled
swatch_8 = ColourSwatch(SwatchColor=RGB(226, 54, 54))  # disabled
panel_109 = Panel("Warning")  # disabled
panel_110 = Panel("Error")  # disabled
number_slider_38 = Slider(14, range=0..100)  # disabled
dam_13 = DataDam(DataA=tap_8, BufferDelay=2500000, BufferMode=2)  # disabled
swatch_9 = ColourSwatch(SwatchColor=RGB(0, 0, 0))  # disabled
panel_111 = Panel("Simulation failed...")  # disabled
equals_16 = Equality(FirstNumber=tap_8, SecondNumber=dam_13)  # -> Equality, Inequality; disabled
panel_112 = Panel("Daylight simulation is running...")  # disabled
adjustelem_14 = AdjustElementAppearance(ElementsToAdjust=tb_15, Foreground=swatch_9, FontSize=number_slider_38)  # disabled
panel_113 = Panel("10, 0, 0, 5")  # disabled
panel_114 = Panel("5, 0, 0, 5")  # disabled
panel_115 = Panel("5, 10, 5, 5")  # disabled
adjustpos_72 = AdjustElementPositioning(ElementsToAdjust=tb_13, Margin=panel_113, AbsolutePositioning=False, HorizontalAlignment=0)  # disabled
adjustpos_73 = AdjustElementPositioning(ElementsToAdjust=button_30, AbsolutePositioning=False, HorizontalAlignment=0)  # disabled
adjustpos_74 = AdjustElementPositioning(ElementsToAdjust=tb_15, Margin=panel_115, AbsolutePositioning=False, HorizontalAlignment=0)  # disabled
adjustpos_75 = AdjustElementPositioning(ElementsToAdjust=tb_14, Margin=panel_114, AbsolutePositioning=False, HorizontalAlignment=0)  # disabled

# ---- group: Assembly model (continued)
pre_update_honeybee_model_4 = RemoteReceiver(pre_update_honeybee_model)
gate_11 = StreamGate(Stream="0", Gate=pre_update_honeybee_model_4)  # -> Target0, Target1
stack_43 = CreateStack(UIElements=entwine_20, Horizontal=invert(True))
border_4 = CreateBorder(
    UIElement=stack_43,
    BorderThickness=Slider(1, range=0..10),
    BorderColor=ColourSwatch(SwatchColor=RGB(217, 217, 217)),
    CornerRadius=Slider(2, range=0..10))
adjustpos_76 = AdjustElementPositioning(ElementsToAdjust=stack_43, Margin="5, 0, 5, 5", AbsolutePositioning=False, HorizontalAlignment=0, VerticalAlignment=2)
adjustpos_77 = AdjustElementPositioning(ElementsToAdjust=border_4, Margin="25, 5, 0, 0", AbsolutePositioning=False, HorizontalAlignment=0, VerticalAlignment=2)

# ----
# Visualize model
location_17 = Data(border_4)

entwine_60 = Entwine(Branch00=stack_19, Branch01=location_17, FlattenInputs=True)  # -> flatten(Result)
stack_44 = CreateStack(UIElements=entwine_60, Horizontal=True)

entwine_61 = Entwine(Branch00=stack_44, Branch01=create_model, FlattenInputs=True)  # -> flatten(Result)
stack_45 = CreateStack(UIElements=entwine_61, Horizontal=invert(True))

# ----
# Detailed energy simulation
panel_116 = Panel("Simulations can take a few minutes...")  # disabled
panel_117 = Panel("""Annual energy balance
Daily cooling profile
Daily heating profile
Cooling balance
Heating balance
None""")  # disabled
number_slider_39 = Slider(2, range=0..10)  # disabled
number_slider_40 = Slider(2, range=0..10)  # disabled
panel_118 = Panel("Run detailed energy simulation")  # disabled
width_2 = Slider(5, range=1..100)  # disabled
height_2 = Slider(40, range=1..100)  # disabled
panel_119 = Panel("Display")  # disabled
panel_120 = Panel("Pop-up window")  # disabled
panel_121 = Panel("Zoom")  # disabled
panel_122 = Panel("Display settings")  # disabled
panel_123 = Panel("Create a model before running the simulation")  # disabled
tb_16 = CreateTextBlock(Text=panel_116, TextSize=16, Justification=0)  # disabled
true_button_11 = CreateTrueOnlyButton(ButtonName=panel_120, ButtonStyle=0)  # disabled
button_31 = CreateButton(ButtonName=panel_121, ButtonStyle=0)  # disabled
button_32 = CreateButton(ButtonName=panel_118, ButtonStyle=0)  # disabled
number_slider_41 = Slider(500, range=0..1000)  # disabled
number_slider_42 = Slider(1000000, range=0..1000000)  # disabled
pulldown_26 = CreatePulldownMenu(Label=panel_119, ListItems=panel_117, showLabel=True)  # disabled
label_37 = CreateLabel(LabelText=panel_122, LabelSize=12, Justification=0)  # disabled
slider_11 = CreateSlider(
    Slider=width_2,
    SnapValue=number_slider_40,
    ShowBounds=False,
    ShowTicks=True,
    ShowTooltip=False,
    ShowValLabel=False,
    showLabel=True)  # disabled
slider_12 = CreateSlider(
    Slider=height_2,
    SnapValue=number_slider_39,
    ShowBounds=False,
    ShowTicks=True,
    ShowTooltip=False,
    ShowValLabel=False,
    showLabel=True)  # disabled
panel_124 = Panel("0")  # disabled
values_93 = ValueListener(Elements=button_31, SomeProperty=True)  # -> Values, Indices; disabled
values_94 = ValueListener(Elements=true_button_11, SomeProperty=True)  # -> Values, Indices; disabled
values_95 = ValueListener(Elements=button_32, SomeProperty=True)  # -> Values, Indices; disabled
values_96 = ValueListener(Elements=pulldown_26, SomeProperty=True)  # -> Values, Indices; disabled
panel_125 = Panel(" ")  # disabled
values_97 = ValueListener(Elements=slider_11, SomeProperty=True)  # -> Values, Indices; disabled
values_98 = ValueListener(Elements=slider_12, SomeProperty=True)  # -> Values, Indices; disabled
entwine_62 = Entwine(Branch00=slider_12, Branch01=slider_11, FlattenInputs=True)  # -> flatten(Result); disabled
zoom_detailed_energy_simulation = RemoteSender(values_93.Values)  # disabled
freeze_gate_19 = StreamFreezeGate(Data=values_95.Values, PassingSwitch=invert(values_95.Values))  # disabled
visualize_detailed_energy_simulations = RemoteSender(values_94.Values)  # disabled
pre_run_detailed_energy_simulations = RemoteSender(values_95.Values)  # disabled
pre_run_detailed_energy_simulations_2 = RemoteReceiver(pre_run_detailed_energy_simulations)  # disabled
freeze_gate_20 = StreamFreezeGate(Data=pre_run_detailed_energy_simulations_2, PassingSwitch=pre_run_detailed_energy_simulations_2)  # disabled
hasdata_5 = DataExists(Data=freeze_gate_20)  # disabled
filter_18 = StreamFilter(Gate=hasdata_5, Stream0=panel_124, Stream1=freeze_gate_20)  # disabled
detailed_energy_simulation_type = RemoteSender(values_96.Indices)  # disabled
detailed_energy_simulation_width = RemoteSender(values_97.Values)  # disabled
detailed_energy_simulation_height = RemoteSender(values_98.Values)  # disabled
number_slider_43 = Slider(2, range=0..10)  # disabled
bool_18 = Boolean(invert(freeze_gate_19))  # disabled
stack_46 = CreateStack(UIElements=entwine_62, Horizontal=True)  # disabled
entwine_63 = Entwine(Branch00=label_37, Branch01=stack_46, FlattenInputs=True)  # -> flatten(Result); disabled
entwine_64 = Entwine(Branch00=button_32, Branch01=button_31, Branch02=true_button_11, FlattenInputs=True)  # -> flatten(Result); disabled
tap_9 = TapBuffer(Reset=False, Incremental=True, Valve=bool_18, Hold=True)  # disabled
panel_126 = Panel("Analysis module")  # disabled
stack_47 = CreateStack(UIElements=entwine_63, Horizontal=invert(True))  # disabled
dam_14 = DataDam(DataA=tap_9, BufferDelay=2500000, BufferMode=2)  # disabled
panel_127 = Panel("Simulation failed...")  # disabled
panel_128 = Panel("Daylight simulation is running...")  # disabled
equals_17 = Equality(FirstNumber=tap_9, SecondNumber=dam_14)  # -> Equality, Inequality; disabled
entwine_65 = Entwine(Branch00=pulldown_26, Branch01=stack_47, FlattenInputs=True)  # -> flatten(Result); disabled
number_slider_44 = Slider(40, range=0..1000)  # disabled
number_slider_45 = Slider(215, range=0..1000)  # disabled
stack_48 = CreateStack(UIElements=entwine_65, Horizontal=True)  # disabled
number_slider_46 = Slider(110, range=0..1000)  # disabled
number_slider_47 = Slider(30, range=0..1000)  # disabled
number_slider_48 = Slider(30, range=0..1000)  # disabled
number_slider_49 = Slider(60, range=0..1000)  # disabled
panel_129 = Panel("15, 0, 0, 0")  # disabled
panel_130 = Panel("15, 0, 0, 0")  # disabled
adjustpos_78 = AdjustElementPositioning(
    ElementsToAdjust=pulldown_26,
    AbsolutePositioning=False,
    Width=number_slider_45,
    Height=number_slider_44,
    HorizontalAlignment=0)  # disabled
adjustpos_79 = AdjustElementPositioning(
    ElementsToAdjust=true_button_11,
    Margin=panel_129,
    AbsolutePositioning=False,
    Width=number_slider_46,
    Height=number_slider_47,
    HorizontalAlignment=0)  # disabled
stack_49 = CreateStack(UIElements=entwine_64, Horizontal=True)  # disabled
adjustpos_80 = AdjustElementPositioning(
    ElementsToAdjust=button_31,
    Margin=panel_130,
    AbsolutePositioning=False,
    Width=number_slider_49,
    Height=number_slider_48,
    HorizontalAlignment=0)  # disabled

# ----
# Run detailed energy simulations
entwine_66 = Entwine(Branch00=stack_49, Branch01=tb_16, Branch02=stack_48, FlattenInputs=True)  # -> flatten(Result); disabled
number_slider_50 = Slider(2, range=0..10)  # disabled
number_slider_51 = Slider(1, range=0..10)  # disabled
stack_50 = CreateStack(UIElements=entwine_66, Horizontal=invert(True))  # disabled
swatch_10 = ColourSwatch(SwatchColor=RGB(217, 217, 217))  # disabled
number_slider_52 = Slider(650, range=0..1000)  # disabled
panel_131 = Panel("0, 5, 0, 0")  # disabled
border_5 = CreateBorder(UIElement=stack_50, BorderThickness=number_slider_51, BorderColor=swatch_10, CornerRadius=number_slider_50)  # disabled
adjustpos_81 = AdjustElementPositioning(ElementsToAdjust=border_5, Margin=panel_131, AbsolutePositioning=False, HorizontalAlignment=0)  # disabled
location_18 = Data()

# ---- group: Construction module (continued)
values_99 = ValueListener(Elements=button_21, SomeProperty=True)  # -> Values, Indices
ping_open_material_database = RemoteSender(bool_10)
entwine_67 = Entwine(Branch00=label_24, Branch01=true_button_8, Branch02=button_20, Branch03=button_21, FlattenInputs=True)  # -> flatten(Result)
adjustpos_82 = AdjustElementPositioning(
    ElementsToAdjust=[true_button_8, button_20, button_21],
    Margin="5, 5, 0, 0",
    AbsolutePositioning=False,
    HorizontalAlignment=0)

# ----
freeze_gate_21 = StreamFreezeGate(Data=values_99.Values, PassingSwitch=values_99.Values)
load_construction_database = RemoteSender(values_99.Values)
bool_19 = Boolean(invert(freeze_gate_21))
oilcan_2 = OilCan(DataList=panel_11, Reset=recompute_2, Drop=values_99.Values, DropMode=3)
ping_open_construction_database = RemoteSender(bool_19)
event_25 = EventGate(Data=oilcan_2)  # -> Data, IsNew
open_construction_database = RemoteSender(event_25.Data)

# ----
# Databases
location_19 = Data(entwine_67)

# ---- group: Analysis module (continued)
values_100 = ValueListener(Elements=true_button_10, SomeProperty=True)  # -> Values, Indices
visualize_lca_gwp_by_element = RemoteSender(values_100.Values)
settextblock_5 = SetTextBlockContents(TextBlockToModify=tb_6, NewTextBlockContents=gate_4.Target1)
adjustpos_83 = AdjustElementPositioning(ElementsToAdjust=true_button_10, AbsolutePositioning=False, HorizontalAlignment=0)
settextblock_6 = SetTextBlockContents(TextBlockToModify=tb_8, NewTextBlockContents=gate_5.Target1)

# ----
visualize_lca_gwp_by_element_2 = RemoteReceiver(visualize_lca_gwp_by_element)
rec_11 = DataRecorder(visualize_lca_gwp_by_element_2, DataLimit=-2, RecordData=True)
ma_9 = MassAddition(Input=rec_11)  # -> Result, PartialResults
visualize_lca_gwp_by_element_3 = RemoteReceiver(visualize_lca_gwp_by_element)
entwine_68 = Entwine(Branch00=ma_9.Result, Branch01=lca_window_status, FlattenInputs=True)
rec_12 = DataRecorder(entwine_68, DataLimit=2, RecordData=True)
or_6 = GateOr(A=visualize_lca_gwp_by_element_3, B=event_6.Data)
item_8 = ListItem(List=rec_12, Index=0, Wrap=True)  # -> Item2, Item1, Item
py3_11 = Python3Script(get=or_6)  # -> mpl_folder; same code as py3_5
equals_18 = Equality(FirstNumber=item_8.Item2, SecondNumber=item_8.Item1)  # -> Equality, Inequality
bang_4 = ExplodeTree(Data=equals_18.Inequality)  # -> Branch0, Branch1
nextfile_3 = NextAvailableFilename(Format="LCA{000}.png", FolderPath=py3_11, Trigger=or_6)
py3_12 = Python3Script(x=bang_4.Branch0, y=bang_4.Branch1)  # -> a; same code as py3_6
event_26 = EventGate(Data=py3_12)  # -> Data, IsNew
freeze_gate_22 = StreamFreezeGate(Data=py3_12, PassingSwitch=event_26.IsNew)
event_27 = EventGate(Data=freeze_gate_22)  # -> Data, IsNew
launchwin_3 = LaunchWindow(
    Show=event_27.Data,
    Name="LCA visualisations",
    Width=bar_chart_popup_win_width_2,
    Height=bar_chart_popup_win_height_2,
    ChildStatus=1,
    EnableHorizScroll=False)
panel_132 = Panel(event_27.Data)
visualize_lca_gwp_by_element_4 = RemoteReceiver(visualize_lca_gwp_by_element)
winstat_3 = WindowStatus(Window=launchwin_3)
lca_status = RemoteSender(winstat_3)
py3_13 = Python3Script(window=launchwin_3, activate=visualize_lca_gwp_by_element_4)  # same code as py3_7
winprops_3 = SetWindowProperties(
    Window=launchwin_3,
    StartingLocation=pt_8,
    Theme=0,
    AccentColor=heath_accent_color_10,
    ShowTitleBar=True,
    BackgroundColor=RGB(255, 255, 255),
    ScaleFactor=1)

lca_status_2 = RemoteReceiver(lca_status)
expression_22 = Expression(x="Hidden", y=lca_status_2, Expression="x=y")
expire_3 = ExpireObject(ObjectToExpire=objbynn_3, Expire=expression_22)

visualize_lca_gwp_by_element_5 = RemoteReceiver(visualize_lca_gwp_by_element)

# ---- group: Program module (continued)
occupancy = RemoteSender(division_5)

# ----
occupancy_2 = RemoteReceiver(occupancy)

# ----
# Calculare glare probability
entwine_69 = Entwine(Branch00=button_30, Branch01=tb_15, Branch02=tb_14, Branch03=tb_13, FlattenInputs=True)  # -> flatten(Result); disabled
panel_133 = Panel("Analysis module")  # disabled
panel_134 = Panel("Glare simulation")  # disabled
stack_51 = CreateStack(UIElements=entwine_69, Horizontal=invert(True))  # disabled
number_slider_53 = Slider(300, range=100..500)  # disabled
expander_2 = CreateExpander(UIElements=stack_51, Header=panel_134, Open=invert(True))  # disabled
adjustpos_84 = AdjustElementPositioning(ElementsToAdjust=expander_2, AbsolutePositioning=False, Width=number_slider_53, HorizontalAlignment=0)  # disabled

entwine_70 = Entwine(Branch00=expander_2, Branch01=true_button_2, FlattenInputs=True)  # -> flatten(Result); disabled
stack_52 = CreateStack(UIElements=entwine_70, Horizontal=True)  # disabled
daylight_simulations = Data(stack_52)  # disabled

# ----
# Calculare LCA
entwine_71 = Entwine(
    Branch00=button_4,
    Branch01=tb_4,
    Branch02=label_30,
    Branch03=label_31,
    Branch04=label_29,
    Branch05=label_32,
    Branch06=label_6,
    Branch07=label_33,
    Branch08=true_button_10,
    Branch09=tb_11,
    FlattenInputs=True)  # -> flatten(Result)
stack_53 = CreateStack(UIElements=entwine_71, Horizontal=invert(True))
expander_3 = CreateExpander(UIElements=stack_53, Header="LCA calculation", Open=invert(True))
adjustpos_85 = AdjustElementPositioning(ElementsToAdjust=expander_3, AbsolutePositioning=False, Width=Slider(300, range=100..500), HorizontalAlignment=0)

entwine_72 = Entwine(Branch00=expander_3, Branch01=true_button_3, FlattenInputs=True)  # -> flatten(Result)
stack_54 = CreateStack(UIElements=entwine_72, Horizontal=True)
daylight_simulations_2 = Data(stack_54)

# ----
# Run daylight simulations
entwine_73 = Entwine(
    Branch00=stack_36,
    Branch01=tb_2,
    Branch02=tb_6,
    Branch03=entwine_51,
    Branch04=tb_10,
    Branch05=stack_37,
    FlattenInputs=True)  # -> flatten(Result)
stack_55 = CreateStack(UIElements=entwine_73, Horizontal=invert(True))
expander_4 = CreateExpander(UIElements=stack_55, Header="Daylight simulation", Open=invert(True))
values_101 = ValueListener(Elements=expander_4, SomeProperty=True)  # -> Values, Indices
adjustpos_86 = AdjustElementPositioning(ElementsToAdjust=expander_4, AbsolutePositioning=False, Width=Slider(300, range=100..500), HorizontalAlignment=0)
daylight_expander_is_open = RemoteSender(values_101.Values)

entwine_74 = Entwine(Branch00=expander_4, Branch01=true_button_4, FlattenInputs=True)  # -> flatten(Result)
stack_56 = CreateStack(UIElements=entwine_74, Horizontal=True)
daylight_simulations_3 = Data(stack_56)

daylight_expander_is_open_2 = RemoteReceiver(daylight_expander_is_open)
daylight_expander_is_open_3 = RemoteReceiver(daylight_expander_is_open)

daylight_expander_is_open_4 = RemoteReceiver(daylight_expander_is_open)

# ----
# Run energy simulations
entwine_75 = Entwine(
    Branch00=stack_33,
    Branch01=tb_3,
    Branch02=tb_8,
    Branch03=tb_9,
    Branch05=entwine_50,
    Branch06=tb_5,
    Branch07=stack_6,
    FlattenInputs=True)  # -> flatten(Result)
stack_57 = CreateStack(UIElements=entwine_75, Horizontal=invert(True))
expander_5 = CreateExpander(UIElements=stack_57, Header="Energy simulation", Open=invert(True))
values_102 = ValueListener(Elements=expander_5, SomeProperty=True)  # -> Values, Indices
adjustpos_87 = AdjustElementPositioning(ElementsToAdjust=expander_5, AbsolutePositioning=False, Width=Slider(300, range=100..500), HorizontalAlignment=0)
simple_energy_expander_is_open = RemoteSender(values_102.Values)

entwine_76 = Entwine(Branch00=expander_5, Branch01=true_button_5, FlattenInputs=True)  # -> flatten(Result)
stack_58 = CreateStack(UIElements=entwine_76, Horizontal=True)
energy_simulations = Data(stack_58)

# ----
# Material database categories
material_database_categories = Panel("""Blocks and tiles
Building boards
Concrete
Insulation
Mineral materials
Paints and sealants
Solid woods
Steel and other metals
Waterproofing
Other""")
material_database_categories_2 = RemoteSender(material_database_categories)
material_database_categories_3 = RemoteReceiver(material_database_categories_2)

material_database_categories_4 = RemoteReceiver(material_database_categories_2)

# ----
# Basic material database
number_slider_54 = Slider(0.035, range=0.001..1)
basic_material_database_does_not_allow_c = Panel("""Expanded polystyrene
Mineral wool
Timber
Solid brick
Gypsum plasterboard
Medium density concrete
Ceramic and porcelain
Steel
Crystalline stone
Soil/sand/gravel""")  # "Basic material database, (does not allow comma)"
entwine_77 = Entwine(
    Branch00=Slider(0.035, range=0.001..1),
    Branch01=number_slider_54,
    Branch02=Slider(0.13, range=0.001..1),
    Branch03=Slider(0.8, range=0.001..1),
    Branch04=Slider(0.21, range=0.001..1),
    Branch05=Slider(1.65, range=0.001..5),
    Branch06=Slider(1.3, range=0.001..5),
    Branch07=Slider(50, range=0.001..100),
    Branch08=Slider(3.5, range=0.001..5),
    Branch09=Slider(2, range=0.001..5),
    FlattenInputs=True)  # -> flatten(Result)
entwine_78 = Entwine(
    Branch00=Slider(30, range=1..10000),
    Branch01=Slider(100, range=1..10000),
    Branch02=Slider(500, range=1..10000),
    Branch03=Slider(1800, range=1..10000),
    Branch04=Slider(700, range=1..10000),
    Branch05=Slider(2200, range=1..10000),
    Branch06=Slider(2300, range=1..10000),
    Branch07=Slider(7800, range=1..10000),
    Branch08=Slider(2800, range=1..10000),
    Branch09=Slider(1950, range=1..10000),
    FlattenInputs=True)  # -> flatten(Result)
entwine_79 = Entwine(
    Branch00=Slider(1450, range=1..10000),
    Branch01=Slider(1030, range=1..10000),
    Branch02=Slider(1600, range=1..10000),
    Branch03=Slider(1000, range=1..10000),
    Branch04=Slider(1000, range=1..10000),
    Branch05=Slider(1000, range=1..10000),
    Branch06=Slider(840, range=1..10000),
    Branch07=Slider(450, range=1..10000),
    Branch08=Slider(1000, range=1..10000),
    Branch09=Slider(1050, range=1..10000),
    FlattenInputs=True)  # -> flatten(Result)
entwine_80 = Entwine(
    Branch00=Slider(3, range=1..9),
    Branch01=Slider(3, range=1..9),
    Branch02=Slider(6, range=1..9),
    Branch03=Slider(0, range=0..9),
    Branch04=Slider(1, range=1..9),
    Branch05=Slider(2, range=1..9),
    Branch06=Slider(0, range=0..9),
    Branch07=Slider(7, range=1..9),
    Branch08=Slider(4, range=1..9),
    Branch09=Slider(9, range=1..9),
    FlattenInputs=True)  # -> flatten(Result)
material_database_categories_5 = RemoteReceiver(material_database_categories_2)
lng_3 = ListLength(List=basic_material_database_does_not_allow_c)
item_9 = ListItem(List=material_database_categories_5, Index=entwine_80, Wrap=True)
repeat_2 = RepeatData(Data="inf", Length=lng_3)
opaquemat_2 = HBOpaqueMaterial(
    name=basic_material_database_does_not_allow_c,
    thickness=repeat_2,
    conductivity=entwine_77,
    density=entwine_78,
    spec_heat=entwine_79,
    category=item_9)  # -> mat; plug-in component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
objtostr = HBObjectToString(hb_obj=opaquemat_2)  # -> hb_str; plug-in component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
lng_4 = ListLength(List=objtostr)
bool_20 = Boolean(lng_4)
getdocumentusertext = Python3Script(run=bool_20, key="Heath materials")  # -> json_string
# ---------- getdocumentusertext: Python ----------
import Rhino
import rhinoscriptsyntax as rs
import scriptcontext as sc

if run:
    sc.doc = Rhino.RhinoDoc.ActiveDoc

    json_string = rs.GetDocumentUserText(key)

    sc.doc = ghdoc
# ---------- end getdocumentusertext ----------
split = TextSplit(Text=getdocumentusertext, Separators="|")
strtoobj = HBStringToObject(hb_str=split)  # -> flatten(hb_obj); plug-in component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
decnstrmat = HBDeconstructMaterial(mat=strtoobj)  # -> values, attr_names, r_val_si, r_val_ip; plug-in component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
item_10 = ListItem(List=decnstrmat.values, Index=0, Wrap=True)  # -> flatten(Item)
mindex = MemberIndex(Set=item_10, Member=basic_material_database_does_not_allow_c)  # -> Index, Count
cull_2 = CullPattern(List=objtostr, CullPattern=invert(mindex.Count))
entwine_81 = Entwine(Branch00=cull_2, Branch01=split, FlattenInputs=True)  # -> flatten(Result)
ipy2 = IronPython2Script(materials=entwine_81)  # -> unique_materials; inputs materials: list
# ---------- ipy2: IronPython ----------
"""Grasshopper Script"""

unique_materials = []

for i in range(len(materials)):
    if materials[i] not in unique_materials:
        unique_materials.append(materials[i])
# ---------- end ipy2 ----------
join = TextJoin(Text=ipy2, Join="|")
setdocumentusertext = Python3Script(key="Heath materials", value=join)
# ---------- setdocumentusertext: Python ----------
import Rhino
import rhinoscriptsyntax as rs
import scriptcontext as sc

def modify_value(value):
    sc.doc = Rhino.RhinoDoc.ActiveDoc

    test = rs.SetDocumentUserText(key, value)

    sc.doc = ghdoc
    
if value:
    done = modify_value(value)
# ---------- end setdocumentusertext ----------

# ----
# Select window construction
panel_135 = Panel("Generic")
subset_subface_window_2 = RemoteReceiver(subset_subface_window)
subset_subface_window_3 = RemoteReceiver(subset_subface_window)
null_9 = NullObject()
null_10 = NullObject()

# ----
# Select exterior construction
subset_exterior_floor_2 = RemoteReceiver(subset_exterior_floor)
subset_exterior_roof_2 = RemoteReceiver(subset_exterior_roof)
subset_exterior_wall_2 = RemoteReceiver(subset_exterior_wall)
null_11 = NullObject()
null_12 = NullObject()
null_13 = NullObject()

# ----
# Select interior construction
subset_interior_floor_2 = RemoteReceiver(subset_interior_floor)
subset_interior_wall_2 = RemoteReceiver(subset_interior_wall)
null_14 = NullObject()
null_15 = NullObject()

# ----
# Select ground construction
subset_ground_floor_2 = RemoteReceiver(subset_ground_floor)
null_16 = NullObject()

# ----
# Define program
selected_building_2 = RemoteReceiver(selected_building)
searchprog = HBSearchPrograms(bldg_prog=selected_building_2)  # -> room_prog; plug-in component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
room_programs = RemoteSender(searchprog)
applyloadvals = HBApplyLoadValues(
    room_or_program=flatten(selected_room_2),
    people_per_floor=occupancy_2,
    infilt_per_exterior=Slider(0.0001, range=0..0.001))  # -> report, mod_obj; plug-in component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
constantschedule_2 = HBConstantSchedule(values=Slider(1, range=0..1))  # -> report, schedule, idf_text; plug-in component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
constantschedule_3 = HBConstantSchedule(values=Slider(1, range=0..1))  # -> report, schedule, idf_text; plug-in component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
applysetpointvals = HBApplySetpointValues(room_or_program=flatten(applyloadvals.mod_obj), cooling_setpt=cooling_setpoint_3, heating_setpt=heating_setpoint_3)  # -> report, mod_obj; plug-in component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
python_2 = GhPythonScript(power_density=Slider(2.6, range=0..10), schedule=constantschedule_2.schedule)  # -> out, hot_water
# ---------- python_2: Python ----------
__author__ = "sawen"
__version__ = "2024.05.24"

import rhinoscriptsyntax as rs
from honeybee_energy.load.hotwater import ServiceHotWater as shw

if not name:
    name = "Domestic Hot Water"
    

hot_water = shw.from_watts_per_area(name, power_density, schedule)
# ---------- end python_2 ----------
equipment = HBEquipment(watts_per_area=Slider(3.4, range=0..10), schedule=constantschedule_3.schedule, lost_fract=Slider(0.3, range=0..1))  # -> equip; plug-in component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

# ---- group: Program module (continued)
room_programs_2 = RemoteReceiver(room_programs)
setlist = SetListContents(ListToModify=pulldown_10, NewListContents=room_programs_2, SelectedIndex="0")

# ----
txt_6 = Text(applysetpointvals.mod_obj)

programtype = HBProgramType(name=txt_6, base_program=applysetpointvals.mod_obj, electric_equip=equipment, hot_water=python_2.hot_water)  # -> program; plug-in component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

# ----
# Heath launch window
number_slider_55 = Slider(142, range=0..1000)
number_slider_56 = Slider(275, range=0..1000)
number_slider_57 = Slider(250, range=0..1000)
heath_accent_color_12 = RemoteReceiver(heath_accent_color)
pt_12 = ConstructPoint(XCoordinate=number_slider_55, YCoordinate=Slider(193, range=0..1000), ZCoordinate=0)
restart_heath_2 = RemoteReceiver(restart_heath)
panel_136 = Panel("Heath provides a user interface for life cycle building performance assessment in the Rhino environment.")
gate_12 = StreamGate(Stream="Start", Gate=restart_heath_2)  # -> Target0, Target1
true_button_12 = CreateTrueOnlyButton(ButtonName="Github Heath", ButtonStyle=0)
true_button_13 = CreateTrueOnlyButton(ButtonName=gate_12.Target0, ButtonStyle=0)
tb_17 = CreateTextBlock(TextSize=16, Justification=1)
tb_18 = CreateTextBlock(TextSize=12, Justification=0)
values_103 = ValueListener(Elements=true_button_12, SomeProperty=True)  # -> Values, Indices
values_104 = ValueListener(Elements=true_button_13, SomeProperty=True)  # -> Values, Indices
settextblock_7 = SetTextBlockContents(TextBlockToModify=tb_17, NewTextBlockContents="Email: sawen@chalmers.se")
settextblock_8 = SetTextBlockContents(TextBlockToModify=tb_18, NewTextBlockContents=panel_136)
github_heath = RemoteSender(values_103.Values)
adjustpos_88 = AdjustElementPositioning(ElementsToAdjust=tb_18, AbsolutePositioning=False, Height=Slider(60, range=0..100))
adjustpos_89 = AdjustElementPositioning(ElementsToAdjust=tb_17, Margin="0, 8, 0, 0", AbsolutePositioning=False, Height=Slider(20, range=0..100))

py3_14 = Python3Script(
    show=bool_2,
    title="Heath",
    win_height=number_slider_57,
    win_width=number_slider_56,
    accent_color=heath_accent_color_12,
    location=pt_12,
    x=tb_18)  # -> out, win, gh_button_out; inputs show: Boolean, location: Point3d; disabled
# ---------- py3_14: Python ----------
import heath_ui
import scriptcontext as sc
from System import Guid
from System.Windows.Controls import TextBlock
from System.Windows import TextWrapping
from HumanUI import TrueOnlyButton, UIElement_Goo
from HumanUI.Components.UI_Elements import CreateButton_Component, buttonStyle


if __name__ == "__main__":
    win, status = heath_ui.heath_main_window(title, win_width, win_height, accent_color, location, show)
    tb = TextBlock()
    tb.Text = "Heath provides a user interface for life cycle building performance assessment in the Rhino environment."
    tb.TextWrapping = TextWrapping.Wrap
    win.AddElement(tb)

    gh_button_name = "Github Heath"
    gh_button = TrueOnlyButton()
    CreateButton_Component.SetupButton(gh_button_name, None, True, False, gh_button, buttonStyle.Default)
    win.AddElement(gh_button)

    gh_button_out = UIElement_Goo(gh_button, gh_button_name, Guid(), 0)
# ---------- end py3_14 ----------
check_if_heath_can_be_launched = Python3Script(trigger_launch_heath=values_104.Values)  # -> out, launch_heath, e
# ---------- check_if_heath_can_be_launched: Python ----------
import Rhino

def check_launch_possible():
    e = []
    if not Rhino.RhinoDoc.ActiveDoc.Path:
        e.append("Please save the Rhino file before launching Heath.")
    return e

if __name__ == "__main__":
    e = check_launch_possible()
    launch_heath = trigger_launch_heath and not e
# ---------- end check_if_heath_can_be_launched ----------
merge_6 = Merge(Data1=flatten("Could not launch Heath:"), Data2=flatten(check_if_heath_can_be_launched.e))
join_2 = TextJoin(Text=merge_6, Join=" ")
lng_5 = ListLength(List=check_if_heath_can_be_launched.e)
tb_19 = CreateTextBlock(Text=join_2, TextSize=12, Justification=1)
and_3 = GateAnd(A=values_104.Values, B=lng_5)
settextblock_9 = SetTextBlockContents(TextBlockToModify=tb_19, NewTextBlockContents=join_2)
hideshow_11 = HideShowElement(ElementToHideShow=tb_19, Show=and_3, Collapse=True, Disable=False)

# ----
# Heath github
panel_137 = Panel("https://github.com/sawenchalmers/heath")
github_heath_2 = RemoteReceiver(github_heath)
py3_15 = Python3Script(url=panel_137, launch=github_heath_2)  # same code as py3

# ----
# Material database launch
ping_open_material_database_2 = RemoteReceiver(ping_open_material_database)
open_material_database_2 = RemoteReceiver(open_material_database)
or_7 = GateOr(A=ping_open_material_database_2, B=open_material_database_2)
null_17 = NullItem(Item=or_7)  # -> NullFlags, InvalidFlags, Description
filter_19 = StreamFilter(Gate=null_17.NullFlags, Stream0=or_7, Stream1="False")
rec_13 = DataRecorder(filter_19, DataLimit=-2, RecordData=True)
int_6 = Integer(rec_13)
ma_10 = MassAddition(Input=int_6)  # -> Result, PartialResults
ping_open_material_database_3 = RemoteReceiver(ping_open_material_database)
database_modal_location_5 = RemoteReceiver(database_modal_location)
open_material_database_3 = RemoteReceiver(open_material_database)
heath_accent_color_13 = RemoteReceiver(heath_accent_color)
or_8 = GateOr(A=ping_open_material_database_3, B=open_material_database_3)

# ----
# Construction database
number_slider_58 = Slider(20, range=0..100)
repeat_3 = RepeatData(Data="🔍", Length=number_slider_58)
repeat_4 = RepeatData(Data="- ", Length=number_slider_58)
repeat_5 = RepeatData(Data="X", Length=number_slider_58)
button_33 = CreateButton(ButtonName="Sync database", ButtonStyle=0)
true_button_14 = CreateTrueOnlyButton(ButtonName="Create construction", ButtonStyle=0)
label_38 = CreateLabel(LabelText="Constructions", LabelSize=18, Justification=0)
label_39 = CreateLabel(LabelText="Duplicate instances of constructions have been loaded", LabelSize=12, Justification=0)
true_button_15 = CreateTrueOnlyButton(ButtonName=repeat_3, ButtonStyle=3)
button_34 = CreateButton(ButtonName="Save constructions", ButtonStyle=0)
button_35 = CreateButton(ButtonName=repeat_5, ButtonStyle=3)
button_36 = CreateButton(ButtonName="Load constructions", ButtonStyle=0)
tb_20 = CreateTextBlock(Text=repeat_4, TextSize=12, Justification=0)
values_105 = ValueListener(Elements=button_34, SomeProperty=True)  # -> Values, Indices
values_106 = ValueListener(Elements=true_button_15, SomeProperty=True)  # -> flatten(Values), Indices
values_107 = ValueListener(Elements=button_33, SomeProperty=True)  # -> Values, Indices
values_108 = ValueListener(Elements=true_button_14, SomeProperty=True)  # -> Values, Indices
values_109 = ValueListener(Elements=button_36, SomeProperty=True)  # -> Values, Indices
values_110 = ValueListener(Elements=button_35, SomeProperty=True)  # -> flatten(Values), Indices
cull_3 = CullPattern(List=values_110.Values, CullPattern=values_110.Values)
lng_6 = ListLength(List=cull_3)
filter_20 = StreamFilter(Gate=lng_6, Stream0="False", Stream1=cull_3)
freeze_gate_23 = StreamFreezeGate(Data=filter_20, PassingSwitch=invert(filter_20))
bool_21 = Boolean(invert(freeze_gate_23))
freeze_gate_24 = StreamFreezeGate(Data=values_105.Values, PassingSwitch=invert(values_105.Values))
freeze_gate_25 = StreamFreezeGate(Data=values_109.Values, PassingSwitch=invert(values_109.Values))
cset = CreateSet(List=values_106.Values)  # -> Set, Map
sync_construction_database = RemoteSender(values_107.Values)
tap_10 = TapBuffer(Reset=False, Incremental=True, Valve=bool_21, Hold=True)
create_construction_modal = RemoteSender(values_108.Values)
pre_construction_database_remove_constru = RemoteSender(values_110.Values)  # "pre_construction_database_remove_construction"
cull_4 = CullPattern(List=cset.Set, CullPattern=cset.Set)
bool_22 = Boolean(invert(freeze_gate_24))
bool_23 = Boolean(invert(freeze_gate_25))
expander_6 = CreateExpander(UIElements=simplify(graft(tb_20)), Header=simplify(graft(repeat_4)), Open=invert(True))  # -> flatten(Expander)
entwine_82 = Entwine(Branch00=true_button_14, Branch01=button_33, FlattenInputs=True)  # -> flatten(Result)
dam_15 = DataDam(DataA=tap_10, BufferDelay=2500000, BufferMode=2)
tap_11 = TapBuffer(Reset=False, Incremental=True, Valve=bool_22, Hold=True)
mindex_2 = MemberIndex(Set=values_106.Values, Member=cull_4)  # -> Index, Count
tap_12 = TapBuffer(Reset=False, Incremental=True, Valve=bool_23, Hold=True)
equals_19 = Equality(FirstNumber=tap_10, SecondNumber=dam_15)  # -> Equality, Inequality
stack_59 = CreateStack(UIElements=entwine_82, Horizontal=True)
dam_16 = DataDam(DataA=tap_11, BufferDelay=2500000, BufferMode=2)
bool_24 = Boolean(mindex_2.Count)
dam_17 = DataDam(DataA=tap_12, BufferDelay=2500000, BufferMode=2)
event_28 = EventGate(Data=equals_19.Inequality)  # -> Data, IsNew
suirify = Suirify(true_button_15)
suirify_2 = Suirify(expander_6)
suirify_3 = Suirify(button_35)
null_18 = NullItem(Item=bool_24)  # -> NullFlags, InvalidFlags, Description
equals_20 = Equality(FirstNumber=tap_11, SecondNumber=dam_16)  # -> Equality, Inequality
equals_21 = Equality(FirstNumber=tap_12, SecondNumber=dam_17)  # -> Equality, Inequality
merge_7 = Merge(Data1=graft(suirify_2), Data2=graft(suirify_3), Data3=graft(suirify))
adjustelem_15 = AdjustElementAppearance(ElementsToAdjust=label_39, Foreground=ColourSwatch(SwatchColor=RGB(255, 0, 0)))
construction_database_remove_constructio = RemoteSender(event_28.Data)  # "construction_database_remove_construction"
filter_21 = StreamFilter(Gate=null_18.NullFlags, Stream0=bool_24, Stream1="False")
number_slider_59 = Slider(26, range=0..300)
stack_60 = CreateStack(UIElements=merge_7, Horizontal=True)  # -> flatten(Stack)
construction_database_visualize_construc = RemoteSender(filter_21)  # "construction_database_visualize_construction"
pre_construction_database_visualize_cons = RemoteSender(mindex_2.Index)  # "pre_construction_database_visualize_construction"
adjustpos_90 = AdjustElementPositioning(ElementsToAdjust=button_34, AbsolutePositioning=False, Height=Slider(32, range=0..300), HorizontalAlignment=0)
adjustpos_91 = AdjustElementPositioning(
    ElementsToAdjust=true_button_15,
    AbsolutePositioning=False,
    Width=number_slider_59,
    Height=number_slider_59,
    HorizontalAlignment=2,
    VerticalAlignment=1)
adjustelem_16 = AdjustElementAppearance(
    ElementsToAdjust=true_button_15,
    Foreground=ColourSwatch(SwatchColor=RGBA(0, 0, 0, 205)),
    Background=ColourSwatch(SwatchColor=RGBA(245, 245, 245, 205)),
    FontSize=Slider(18, range=0..50))
adjustpos_92 = AdjustElementPositioning(ElementsToAdjust=button_36, AbsolutePositioning=False, Height=Slider(32, range=0..300), HorizontalAlignment=0)
adjustpos_93 = AdjustElementPositioning(
    ElementsToAdjust=button_35,
    AbsolutePositioning=False,
    Width=Slider(26, range=0..300),
    Height=Slider(26, range=0..300),
    HorizontalAlignment=2,
    VerticalAlignment=1)
adjustelem_17 = AdjustElementAppearance(ElementsToAdjust=button_35, Foreground=ColourSwatch(SwatchColor=RGB(255, 0, 0)), FontSize=Slider(12, range=0..50))
adjustpos_94 = AdjustElementPositioning(
    ElementsToAdjust=expander_6,
    Margin="0, 0, 0, 5",
    AbsolutePositioning=False,
    Width=Slider(285, range=100..500),
    HorizontalAlignment=0)
adjustpos_95 = AdjustElementPositioning(ElementsToAdjust=stack_60, Margin="5, 0, 0, 0", AbsolutePositioning=False, HorizontalAlignment=0)

# ----
# Remove constructions
pre_construction_database_remove_constru_2 = RemoteReceiver(pre_construction_database_remove_constru)  # "pre_construction_database_remove_construction"
construction_database_remove_constructio_2 = RemoteReceiver(construction_database_remove_constructio)  # "construction_database_remove_construction"
cset_2 = CreateSet(List=pre_construction_database_remove_constru_2)  # -> Set, Map
getdocumentusertext_2 = Python3Script(run=construction_database_remove_constructio_2, key="Heath constructions")  # -> json_string; same code as getdocumentusertext
cull_5 = CullPattern(List=cset_2.Set, CullPattern=cset_2.Set)
mindex_3 = MemberIndex(Set=pre_construction_database_remove_constru_2, Member=cull_5)  # -> Index, Count
split_2 = TextSplit(Text=getdocumentusertext_2, Separators="|")
hold = HoldingGate(Data=mindex_3.Index)
cull_i = CullIndex(List=split_2, Indices=hold, Wrap=True)
join_3 = TextJoin(Text=cull_i, Join="|")
nulls_in_empty = NullsInEmptyBranches(DataWithEmptyBranches=join_3)
null_19 = NullItem(Item=nulls_in_empty)  # -> NullFlags, InvalidFlags, Description
bool_25 = Boolean("False")
filter_22 = StreamFilter(Gate=null_19.NullFlags, Stream0=join_3, Stream1=bool_25)
freeze_gate_26 = StreamFreezeGate(Data=filter_22, PassingSwitch=construction_database_remove_constructio_2, Freeze=False, Hold=False)

sync_construction_database_2 = RemoteReceiver(sync_construction_database)

# ----
# Construction database launch
ping_open_construction_database_2 = RemoteReceiver(ping_open_construction_database)
open_construction_database_2 = RemoteReceiver(open_construction_database)
or_9 = GateOr(A=ping_open_construction_database_2, B=open_construction_database_2)
database_modal_location_6 = RemoteReceiver(database_modal_location)
ping_open_construction_database_3 = RemoteReceiver(ping_open_construction_database)
open_construction_database_3 = RemoteReceiver(open_construction_database)
or_10 = GateOr(A=ping_open_construction_database_3, B=open_construction_database_3)

null_20 = NullItem(Item=or_9)  # -> NullFlags, InvalidFlags, Description
filter_23 = StreamFilter(Gate=null_20.NullFlags, Stream0=or_9, Stream1="False")

# ----
# Material database
number_slider_60 = Slider(10, range=0..100)
lng_7 = ListLength(List=material_database_categories_4)
material_database_categories_6 = RemoteReceiver(material_database_categories_2)
repeat_6 = RepeatData(Data="X", Length=number_slider_60)  # -> graft(Data)
repeat_7 = RepeatData(Data="- ", Length=number_slider_60)  # -> graft(Data)
lng_8 = ListLength(List=material_database_categories_4)
repeat_8 = RepeatData(Data=simplify(repeat_6), Length=lng_7)
repeat_9 = RepeatData(Data=simplify(repeat_7), Length=lng_7)
button_37 = CreateButton(ButtonName="Sync database", ButtonStyle=0)
true_button_16 = CreateTrueOnlyButton(ButtonName="Create material", ButtonStyle=0)
button_38 = CreateButton(ButtonName="Save materials", ButtonStyle=0)
label_40 = CreateLabel(LabelText="Duplicate instances of materials have been loaded", LabelSize=12, Justification=0)
label_41 = CreateLabel(LabelText=material_database_categories_6, LabelSize=18, Justification=0)
button_39 = CreateButton(ButtonName="Load materials", ButtonStyle=0)
values_111 = ValueListener(Elements=button_38, SomeProperty=True)  # -> Values, Indices
button_40 = CreateButton(ButtonName=repeat_8, ButtonStyle=3)
tb_21 = CreateTextBlock(Text=repeat_9, TextSize=12, Justification=0)
values_112 = ValueListener(Elements=button_39, SomeProperty=True)  # -> Values, Indices
freeze_gate_27 = StreamFreezeGate(Data=values_111.Values, PassingSwitch=invert(values_111.Values))
values_113 = ValueListener(Elements=flatten(button_40), SomeProperty=True)  # -> flatten(Values), Indices
cull_6 = CullPattern(List=values_113.Values, CullPattern=values_113.Values)  # -> flatten(List)
lng_9 = ListLength(List=cull_6)
filter_24 = StreamFilter(Gate=lng_9, Stream0="False", Stream1=cull_6)
freeze_gate_28 = StreamFreezeGate(Data=filter_24, PassingSwitch=invert(filter_24))
values_114 = ValueListener(Elements=true_button_16, SomeProperty=True)  # -> Values, Indices
values_115 = ValueListener(Elements=button_37, SomeProperty=True)  # -> Values, Indices
freeze_gate_29 = StreamFreezeGate(Data=values_112.Values, PassingSwitch=invert(values_112.Values))
bool_26 = Boolean(invert(freeze_gate_28))
bool_27 = Boolean(invert(freeze_gate_27))
tap_13 = TapBuffer(Reset=False, Incremental=True, Valve=bool_26, Hold=True)
bool_28 = Boolean(invert(freeze_gate_29))
entwine_83 = Entwine(Branch00=true_button_16, Branch01=button_37, FlattenInputs=True)  # -> flatten(Result)
create_material_modal = RemoteSender(values_114.Values)
pre_material_database_remove_material = RemoteSender(values_113.Values)
tap_14 = TapBuffer(Reset=False, Incremental=True, Valve=bool_27, Hold=True)
dam_18 = DataDam(DataA=tap_13, BufferDelay=2500000, BufferMode=2)
tap_15 = TapBuffer(Reset=False, Incremental=True, Valve=bool_28, Hold=True)
suirify_4 = Suirify(tb_21)
suirify_5 = Suirify(button_40)
dam_19 = DataDam(DataA=tap_14, BufferDelay=2500000, BufferMode=2)
dam_20 = DataDam(DataA=tap_15, BufferDelay=2500000, BufferMode=2)
equals_22 = Equality(FirstNumber=tap_13, SecondNumber=dam_18)  # -> Equality, Inequality
adjustelem_18 = AdjustElementAppearance(ElementsToAdjust=label_40, Foreground=ColourSwatch(SwatchColor=RGB(255, 0, 0)))
merge_8 = Merge(Data1=graft(suirify_4), Data2=graft(suirify_5))
equals_23 = Equality(FirstNumber=tap_14, SecondNumber=dam_19)  # -> Equality, Inequality
stack_61 = CreateStack(UIElements=entwine_83, Horizontal=True)
equals_24 = Equality(FirstNumber=tap_15, SecondNumber=dam_20)  # -> Equality, Inequality
event_29 = EventGate(Data=equals_22.Inequality)  # -> Data, IsNew
stack_62 = CreateStack(UIElements=merge_8, Horizontal=True)
shfdep = ShiftToDepth(Tree=stack_62, Depth=Slider(1, range=0..100), shiftFromStart=False)
material_database_remove_material = RemoteSender(event_29.Data)
merge_9 = Merge(Data1=simplify(graft(label_41)), Data2=shfdep)
stack_63 = CreateStack(UIElements=merge_9, Horizontal=invert(True))  # -> flatten(Stack)
adjustpos_96 = AdjustElementPositioning(ElementsToAdjust=label_41, Margin="0, 5, 0, 0", AbsolutePositioning=False)
adjustpos_97 = AdjustElementPositioning(
    ElementsToAdjust=tb_21,
    Margin="0, 0, 0, 10",
    AbsolutePositioning=False,
    Width=Slider(300, range=0..500),
    Height=Slider(29, range=0..300),
    HorizontalAlignment=0,
    VerticalAlignment=1)
adjustpos_98 = AdjustElementPositioning(ElementsToAdjust=stack_62, Margin="5, 0, 0, 0", AbsolutePositioning=False, HorizontalAlignment=0)
adjustpos_99 = AdjustElementPositioning(
    ElementsToAdjust=button_40,
    Margin="5, 0, 0, 10",
    AbsolutePositioning=False,
    Width=Slider(26, range=0..300),
    Height=Slider(26, range=0..300),
    HorizontalAlignment=1,
    VerticalAlignment=1)
adjustelem_19 = AdjustElementAppearance(ElementsToAdjust=button_40, Foreground=ColourSwatch(SwatchColor=RGB(255, 0, 0)), FontSize=Slider(12, range=0..50))
adjustpos_100 = AdjustElementPositioning(ElementsToAdjust=button_38, AbsolutePositioning=False, Height=Slider(32, range=0..300), HorizontalAlignment=0)
adjustpos_101 = AdjustElementPositioning(ElementsToAdjust=button_39, AbsolutePositioning=False, Height=Slider(32, range=0..300), HorizontalAlignment=0)

sync_material_database = RemoteSender(values_115.Values)

# ----
# Sync when opening the database, recompute and sync
load_construction_database_2 = RemoteReceiver(load_construction_database)
load_material_database_2 = RemoteReceiver(load_material_database)
recompute_4 = RemoteReceiver(recompute)
panel_138 = Panel("""False
True""")
or_11 = GateOr(A=load_material_database_2, B=load_construction_database_2)
oilcan_3 = OilCan(DataList=panel_138, Reset=recompute_4, Drop=or_11, DropMode=3)
event_30 = EventGate(Data=oilcan_3)  # -> Data, IsNew
and_4 = GateAnd(A=oilcan_3, B=event_30.IsNew)
null_21 = NullItem(Item=and_4)  # -> NullFlags, InvalidFlags, Description
filter_25 = StreamFilter(Gate=null_21.NullFlags, Stream0=and_4, Stream1="False")
sync_material_database_2 = RemoteReceiver(sync_material_database)
event_31 = EventGate(Data=filter_25)  # -> Data, IsNew
or_12 = GateOr(A=sync_material_database_2, B=event_31.Data)

# ----
# Window database
panel_139 = Panel("Duplicate instances of windows have been loaded")
number_slider_61 = Slider(20, range=0..100)
true_button_17 = CreateTrueOnlyButton(ButtonName="Create window", ButtonStyle=0)
label_42 = CreateLabel(LabelText=panel_139, LabelSize=12, Justification=0)
label_43 = CreateLabel(LabelText="Windows", LabelSize=18, Justification=0)
repeat_10 = RepeatData(Data="X", Length=number_slider_61)
repeat_11 = RepeatData(Data="- ", Length=number_slider_61)
values_116 = ValueListener(Elements=true_button_17, SomeProperty=True)  # -> Values, Indices
button_41 = CreateButton(ButtonName=repeat_10, ButtonStyle=3)
button_42 = CreateButton(ButtonName="Save windows", ButtonStyle=0)
tb_22 = CreateTextBlock(Text=repeat_11, TextSize=12, Justification=0)
button_43 = CreateButton(ButtonName="Load windows", ButtonStyle=0)
values_117 = ValueListener(Elements=button_42, SomeProperty=True)  # -> Values, Indices
values_118 = ValueListener(Elements=button_43, SomeProperty=True)  # -> Values, Indices
values_119 = ValueListener(Elements=button_41, SomeProperty=True)  # -> flatten(Values), Indices
cull_7 = CullPattern(List=values_119.Values, CullPattern=values_119.Values)
lng_10 = ListLength(List=cull_7)
filter_26 = StreamFilter(Gate=lng_10, Stream0="False", Stream1=cull_7)
freeze_gate_30 = StreamFreezeGate(Data=filter_26, PassingSwitch=invert(filter_26))
bool_29 = Boolean(invert(freeze_gate_30))
create_window_modal = RemoteSender(values_116.Values)
freeze_gate_31 = StreamFreezeGate(Data=values_117.Values, PassingSwitch=invert(values_117.Values))
freeze_gate_32 = StreamFreezeGate(Data=values_118.Values, PassingSwitch=invert(values_118.Values))
tap_16 = TapBuffer(Reset=False, Incremental=True, Valve=bool_29, Hold=True)
pre_window_database_remove_window = RemoteSender(values_119.Values)
bool_30 = Boolean(invert(freeze_gate_31))
bool_31 = Boolean(invert(freeze_gate_32))
suirify_6 = Suirify(tb_22)
suirify_7 = Suirify(button_41)
dam_21 = DataDam(DataA=tap_16, BufferDelay=2500000, BufferMode=2)
tap_17 = TapBuffer(Reset=False, Incremental=True, Valve=bool_30, Hold=True)
merge_10 = Merge(Data1=graft(suirify_6), Data2=graft(suirify_7))
tap_18 = TapBuffer(Reset=False, Incremental=True, Valve=bool_31, Hold=True)
equals_25 = Equality(FirstNumber=tap_16, SecondNumber=dam_21)  # -> Equality, Inequality
adjustelem_20 = AdjustElementAppearance(ElementsToAdjust=label_42, Foreground=ColourSwatch(SwatchColor=RGB(255, 0, 0)))
dam_22 = DataDam(DataA=tap_17, BufferDelay=2500000, BufferMode=2)
dam_23 = DataDam(DataA=tap_18, BufferDelay=2500000, BufferMode=2)
event_32 = EventGate(Data=equals_25.Inequality)  # -> Data, IsNew
equals_26 = Equality(FirstNumber=tap_17, SecondNumber=dam_22)  # -> Equality, Inequality
equals_27 = Equality(FirstNumber=tap_18, SecondNumber=dam_23)  # -> Equality, Inequality
window_database_remove_window = RemoteSender(event_32.Data)
stack_64 = CreateStack(UIElements=merge_10, Horizontal=True)  # -> flatten(Stack)
adjustpos_102 = AdjustElementPositioning(ElementsToAdjust=label_43, Margin="0, 0, 0, -10", AbsolutePositioning=False)
adjustpos_103 = AdjustElementPositioning(ElementsToAdjust=button_42, AbsolutePositioning=False, Height=Slider(32, range=0..300), HorizontalAlignment=0)
adjustpos_104 = AdjustElementPositioning(
    ElementsToAdjust=tb_22,
    Margin="0, 10, 0, 0",
    AbsolutePositioning=False,
    Width=Slider(300, range=0..300),
    Height=Slider(29, range=0..300),
    HorizontalAlignment=0,
    VerticalAlignment=1)
adjustpos_105 = AdjustElementPositioning(ElementsToAdjust=stack_64, Margin="5, 0, 0, 0", AbsolutePositioning=False, HorizontalAlignment=0)
adjustpos_106 = AdjustElementPositioning(
    ElementsToAdjust=button_41,
    Margin="5, 0, 0, 0",
    AbsolutePositioning=False,
    Width=Slider(26, range=0..300),
    Height=Slider(26, range=0..300),
    HorizontalAlignment=1,
    VerticalAlignment=1)
adjustelem_21 = AdjustElementAppearance(ElementsToAdjust=button_41, Foreground=ColourSwatch(SwatchColor=RGB(255, 0, 0)), FontSize=Slider(12, range=0..50))
adjustpos_107 = AdjustElementPositioning(ElementsToAdjust=button_43, AbsolutePositioning=False, Height=Slider(32, range=0..300), HorizontalAlignment=0)

entwine_84 = Entwine(Branch00=true_button_17, Branch01=button_6, FlattenInputs=True)  # -> flatten(Result)
stack_65 = CreateStack(UIElements=entwine_84, Horizontal=True)

# ----
# Remove window
pre_window_database_remove_window_2 = RemoteReceiver(pre_window_database_remove_window)
window_database_remove_window_2 = RemoteReceiver(window_database_remove_window)
cset_3 = CreateSet(List=pre_window_database_remove_window_2)  # -> Set, Map
getdocumentusertext_3 = Python3Script(run=window_database_remove_window_2, key="Heath windows")  # -> json_string; same code as getdocumentusertext
cull_8 = CullPattern(List=cset_3.Set, CullPattern=cset_3.Set)
mindex_4 = MemberIndex(Set=pre_window_database_remove_window_2, Member=cull_8)  # -> Index, Count
split_3 = TextSplit(Text=getdocumentusertext_3, Separators="|")
hold_2 = HoldingGate(Data=mindex_4.Index)
cull_i_2 = CullIndex(List=split_3, Indices=hold_2, Wrap=True)
join_4 = TextJoin(Text=cull_i_2, Join="|")
nulls_in_empty_2 = NullsInEmptyBranches(DataWithEmptyBranches=join_4)
null_22 = NullItem(Item=nulls_in_empty_2)  # -> NullFlags, InvalidFlags, Description
bool_32 = Boolean("False")
filter_27 = StreamFilter(Gate=null_22.NullFlags, Stream0=join_4, Stream1=bool_32)
freeze_gate_33 = StreamFreezeGate(Data=filter_27, PassingSwitch=window_database_remove_window_2, Freeze=False, Hold=False)

# ----
# Recursion
panel_140 = Panel("Heath help")
objbynn_6 = GetObjectByNickname(NickName=panel_140)
heath_help = Python3Script()  # -> status; same code as lca_window_status

# ----
# Recursion
panel_141 = Panel("Heath main")
objbynn_7 = GetObjectByNickname(NickName=panel_141)
heath_main = Python3Script()  # -> status; same code as lca_window_status

# ----
# Define construction
# # Define program and construction
# To be added...
# 
# ## Instructions
# To be added...
# 
# ## Inputs
# - ...
# 
# ## Outputs
# - ...
# 
# ## Interpretation
# To be added...
panel_142 = Panel("My construction")

# ----
# Recursion
panel_143 = Panel("Material info")
objbynn_8 = GetObjectByNickname(NickName=panel_143)
material_info = Python3Script()  # -> status; same code as lca_window_status

# ----
# Recursion
panel_144 = Panel("Window database")
objbynn_9 = GetObjectByNickname(NickName=panel_144)
window_database = Python3Script()  # -> status; same code as lca_window_status

# ----
# Window database launch
open_window_database_2 = RemoteReceiver(open_window_database)
rec_14 = DataRecorder(open_window_database_2, DataLimit=-2, RecordData=True)
database_modal_location_7 = RemoteReceiver(database_modal_location)
open_window_database_3 = RemoteReceiver(open_window_database)

int_7 = Integer(rec_14)

# ----
# Recursion
panel_145 = Panel("Material database")
objbynn_10 = GetObjectByNickname(NickName=panel_145)
material_database = Python3Script()  # -> status; same code as lca_window_status

# ----
# Recursion
panel_146 = Panel("Construction database")
objbynn_11 = GetObjectByNickname(NickName=panel_146)
construction_database = Python3Script()  # -> status; same code as lca_window_status

rec_15 = DataRecorder(filter_23, DataLimit=-2, RecordData=True)
int_8 = Integer(rec_15)
ma_11 = MassAddition(Input=int_8)  # -> Result, PartialResults
entwine_85 = Entwine(Branch00=ma_11.Result, Branch01=construction_database, FlattenInputs=True)
rec_16 = DataRecorder(entwine_85, DataLimit=2, RecordData=True)
item_11 = ListItem(List=rec_16, Index=0, Wrap=True)  # -> Item2, Item1, Item
equals_28 = Equality(FirstNumber=item_11.Item2, SecondNumber=item_11.Item1)  # -> Equality, Inequality
bang_5 = ExplodeTree(Data=equals_28.Inequality)  # -> Branch0, Branch1
py3_16 = Python3Script(x=bang_5.Branch0, y=bang_5.Branch1)  # -> a; same code as py3_6
event_33 = EventGate(Data=py3_16)  # -> Data, IsNew
freeze_gate_34 = StreamFreezeGate(Data=py3_16, PassingSwitch=event_33.IsNew)
event_34 = EventGate(Data=freeze_gate_34)  # -> Data, IsNew
panel_147 = Panel(event_34.Data)
launchwin_4 = LaunchWindow(
    Show=event_34.Data,
    Name="Construction database",
    Width=Slider(380, range=0..1000),
    Height=Slider(580, range=0..1000),
    ChildStatus=1,
    EnableHorizScroll=False)
winprops_4 = SetWindowProperties(
    Window=launchwin_4,
    StartingLocation=database_modal_location_6,
    Theme=0,
    AccentColor=heath_accent_color_4,
    ShowTitleBar=True,
    BackgroundColor=RGB(255, 255, 255),
    ScaleFactor=1)
winstat_4 = WindowStatus(Window=launchwin_4)
py3_17 = Python3Script(window=launchwin_4, activate=or_10)  # same code as py3_7
panel_148 = Panel(winstat_4)
construction_database_status = RemoteSender(winstat_4)

construction_database_status_2 = RemoteReceiver(construction_database_status)
expression_23 = Expression(x="Hidden", y=construction_database_status_2, Expression="x=y")
expire_4 = ExpireObject(ObjectToExpire=objbynn_11, Expire=expression_23)

ma_12 = MassAddition(Input=int_7)  # -> Result, PartialResults
entwine_86 = Entwine(Branch00=ma_12.Result, Branch01=window_database, FlattenInputs=True)
rec_17 = DataRecorder(entwine_86, DataLimit=2, RecordData=True)
item_12 = ListItem(List=rec_17, Index=0, Wrap=True)  # -> Item2, Item1, Item
equals_29 = Equality(FirstNumber=item_12.Item2, SecondNumber=item_12.Item1)  # -> Equality, Inequality
bang_6 = ExplodeTree(Data=equals_29.Inequality)  # -> Branch0, Branch1
py3_18 = Python3Script(x=bang_6.Branch0, y=bang_6.Branch1)  # -> a; same code as py3_6
event_35 = EventGate(Data=py3_18)  # -> Data, IsNew
freeze_gate_35 = StreamFreezeGate(Data=py3_18, PassingSwitch=event_35.IsNew)
event_36 = EventGate(Data=freeze_gate_35)  # -> Data, IsNew
panel_149 = Panel(event_36.Data)
launchwin_5 = LaunchWindow(
    Show=event_36.Data,
    Name="Window database",
    Width=Slider(380, range=0..1000),
    Height=Slider(580, range=0..1000),
    ChildStatus=1,
    EnableHorizScroll=False)
winprops_5 = SetWindowProperties(
    Window=launchwin_5,
    StartingLocation=database_modal_location_7,
    Theme=0,
    AccentColor=heath_accent_color_2,
    ShowTitleBar=True,
    BackgroundColor=RGB(255, 255, 255),
    ScaleFactor=1)
winstat_5 = WindowStatus(Window=launchwin_5)
py3_19 = Python3Script(window=launchwin_5, activate=open_window_database_3)  # same code as py3_7
window_database_status = RemoteSender(winstat_5)

window_database_status_2 = RemoteReceiver(window_database_status)
expression_24 = Expression(x="Hidden", y=window_database_status_2, Expression="x=y")
expire_5 = ExpireObject(ObjectToExpire=objbynn_9, Expire=expression_24)

construction_database_status_3 = RemoteReceiver(construction_database_status)
construction_database_status_4 = RemoteReceiver(construction_database_status)
expression_25 = Expression(x="Normal", y=construction_database_status_3, Expression="x=y")
expression_26 = Expression(x="Normal", y=construction_database_status_4, Expression="x=y")
and_5 = GateAnd(A=equals_20.Inequality, B=expression_25)
and_6 = GateAnd(A=equals_21.Inequality, B=expression_26)
event_37 = EventGate(Data=and_5)  # -> Data, IsNew
event_38 = EventGate(Data=and_6)  # -> Data, IsNew
panel_150 = Panel(event_37.Data)
save_constructions = RemoteSender(event_37.Data)
panel_151 = Panel(event_38.Data)
load_constructions = RemoteSender(event_38.Data)

entwine_87 = Entwine(Branch00=ma_10.Result, Branch01=material_database, FlattenInputs=True)
rec_18 = DataRecorder(entwine_87, DataLimit=2, RecordData=True)
item_13 = ListItem(List=rec_18, Index=0, Wrap=True)  # -> Item2, Item1, Item
equals_30 = Equality(FirstNumber=item_13.Item2, SecondNumber=item_13.Item1)  # -> Equality, Inequality
bang_7 = ExplodeTree(Data=equals_30.Inequality)  # -> Branch0, Branch1
py3_20 = Python3Script(x=bang_7.Branch0, y=bang_7.Branch1)  # -> a; same code as py3_6
event_39 = EventGate(Data=py3_20)  # -> Data, IsNew
freeze_gate_36 = StreamFreezeGate(Data=py3_20, PassingSwitch=event_39.IsNew)
event_40 = EventGate(Data=freeze_gate_36)  # -> Data, IsNew
panel_152 = Panel(event_40.Data)
launchwin_6 = LaunchWindow(
    Show=event_40.Data,
    Name="Material database",
    Width=Slider(380, range=0..1000),
    Height=Slider(580, range=0..1000),
    ChildStatus=1,
    EnableHorizScroll=False)
winprops_6 = SetWindowProperties(
    Window=launchwin_6,
    StartingLocation=database_modal_location_5,
    Theme=0,
    AccentColor=heath_accent_color_13,
    ShowTitleBar=True,
    BackgroundColor=RGB(255, 255, 255),
    ScaleFactor=1)
winstat_6 = WindowStatus(Window=launchwin_6)
py3_21 = Python3Script(window=launchwin_6, activate=or_8)  # same code as py3_7
material_database_status = RemoteSender(winstat_6)

material_database_status_2 = RemoteReceiver(material_database_status)
expression_27 = Expression(x="Hidden", y=material_database_status_2, Expression="x=y")
expire_6 = ExpireObject(ObjectToExpire=objbynn_10, Expire=expression_27)

material_database_status_3 = RemoteReceiver(material_database_status)
material_database_status_4 = RemoteReceiver(material_database_status)
expression_28 = Expression(x="Normal", y=material_database_status_3, Expression="x=y")
expression_29 = Expression(x="Normal", y=material_database_status_4, Expression="x=y")
and_7 = GateAnd(A=equals_23.Inequality, B=expression_28)
and_8 = GateAnd(A=equals_24.Inequality, B=expression_29)
event_41 = EventGate(Data=and_7)  # -> Data, IsNew
event_42 = EventGate(Data=and_8)  # -> Data, IsNew
panel_153 = Panel(event_41.Data)
save_materials = RemoteSender(event_41.Data)
panel_154 = Panel(event_42.Data)
load_materials = RemoteSender(event_42.Data)

window_database_status_3 = RemoteReceiver(window_database_status)
window_database_status_4 = RemoteReceiver(window_database_status)
expression_30 = Expression(x="Normal", y=window_database_status_3, Expression="x=y")
expression_31 = Expression(x="Normal", y=window_database_status_4, Expression="x=y")
and_9 = GateAnd(A=equals_26.Inequality, B=expression_30)
and_10 = GateAnd(A=equals_27.Inequality, B=expression_31)
event_43 = EventGate(Data=and_9)  # -> Data, IsNew
event_44 = EventGate(Data=and_10)  # -> Data, IsNew
panel_155 = Panel(event_43.Data)
save_windows = RemoteSender(event_43.Data)
panel_156 = Panel(event_44.Data)
load_windows = RemoteSender(event_44.Data)

entwine_88 = Entwine(Branch00=tb_18, Branch01=true_button_12, Branch02=true_button_13, Branch03=tb_19, Branch04=tb_17, FlattenInputs=True)  # -> flatten(Result)
launch_heath = RemoteSender(check_if_heath_can_be_launched.launch_heath)

# ----
# Heath FLY!
launch_heath_2 = RemoteReceiver(launch_heath)
fly = HeathFly(launch_heath=launch_heath_2, current_gh_versions=panel_23)  # -> flying, errors; inputs current_gh_versions: list
# ---------- fly: Python ----------
# Copyright (c) 2024, Heath.
# You should have received a copy of the GNU Affero General Public License
# along with Heath; If not, see <http://www.gnu.org/licenses/>.
# 
# @license AGPL-3.0-or-later <https://spdx.org/licenses/AGPL-3.0-or-later>

import Grasshopper, scriptcontext, Rhino
import os, sys, importlib

def main(gh_version):
    sys.path.append(Grasshopper.Folders.UserObjectFolders[0])
    heath_path = os.path.join(Grasshopper.Folders.UserObjectFolders[0], "heath")
    sys.path.append(heath_path)

    # make sure we can import ladybug tools
    ladybug_tools_path = "ladybug_tools\\python\\Lib\\site-packages\\"
    program_files_dir = os.path.dirname(f"{os.environ['ProgramFiles']}\\{ladybug_tools_path}")
    if os.path.isdir(program_files_dir):
        sys.path.append(program_files_dir)
    else:
        user_folder_dir = os.path.dirname(f"{os.path.expanduser('~')}\\{ladybug_tools_path}")
        if os.path.isdir(user_folder_dir):
            sys.path.append(user_folder_dir)
        else:
            raise Exception("Couldn't find Ladybug tools python module path")

    try:
        import heath
        import heath_ui
        importlib.reload(heath)
        importlib.reload(heath_ui)
        if not heath.__file__:
            raise Exception("Wrong module version imported")
    except Exception as e:
        # hack to allow the module to reside in the repo
        sys.path.append(os.path.join(os.path.dirname(ghdoc.Path), '..\src'))
        import heath
        import heath_ui
        importlib.reload(heath)
        importlib.reload(heath_ui)
    version = heath.heath_globals.version
    if not check_version(gh_version, version):
        raise Exception(f"Version mismatch: {gh_version} (gh), {version} (py)")

    ghenv.Component.Name = 'Heath - Fly!'
    ghenv.Component.NickName = 'Fly!'

    scriptcontext.sticky["heath_flying"] = 'true'
    ghenv.Component.Message = heath.heath_globals.version
    return True

def check_version(gh_ver, py_ver):
    return py_ver in gh_ver

if __name__ == "__main__":
    if not Rhino.RhinoDoc.ActiveDoc.Path:
        flying = False
    else:
        try:
            flying = main(current_gh_versions) if launch_heath else False
        except Exception as e:
            errors = e
            print(e)
            elvl = Grasshopper.Kernel.GH_RuntimeMessageLevel.Error
            ghenv.Component.AddRuntimeMessage(elvl, str(e))
            flying = False
# ---------- end fly ----------
panel_157 = Panel(fly.flying)
py3_22 = Python3Script(get=fly.flying)  # -> results_folder, heath_folder
# ---------- py3_22: Python ----------
"""Grasshopper Script"""
import heath
import Grasshopper

if __name__ == "__main__":
    if get:
        print(ghdoc)
        results_folder = heath.get_results_folder(ghdoc)
        heath_folder = Grasshopper.Folders.UserObjectFolders[0]
        print(results_folder)
        print(heath_folder)
# ---------- end py3_22 ----------
heath_flying = RemoteSender(fly.flying)
results_folder = RemoteSender(py3_22.results_folder)
heath_folder = RemoteSender(py3_22.heath_folder)

results_folder_2 = RemoteReceiver(results_folder)

# ----
# Brimstone FLY!
launch_heath_3 = RemoteReceiver(launch_heath)
fly_2 = BrimstoneFly(x=launch_heath_3)
# ---------- fly_2: Python ----------
"""This component sets up global information for Brimstone
    Inputs:
    Output:
        """

import Grasshopper
import sys
import os

sys.path.append(Grasshopper.Folders.UserObjectFolders[0])

import brimstone
reload(brimstone)

import scriptcontext

ghenv.Component.Name = 'Brimstone - Fly!'
ghenv.Component.NickName = 'Fly!'

scriptcontext.sticky["brimstone_flying"] = 'true'
scriptcontext.sticky["brimstone_kdb_hb_json"] = 'brimstone_data/230721klimatdatabas_hb_materials.json' # json which adds honeybee material info to klimatdatabas materials
scriptcontext.sticky["brimstone_hb_kdb_csv"] = 'brimstone_data/230728_HBKlimatdatabas.csv' # csv file which translates honeybee material names to klimatdatabas material names
ghenv.Component.Message = brimstone.globals.version
# ---------- end fly_2 ----------

results_folder_3 = RemoteReceiver(results_folder)
results_folder_4 = RemoteReceiver(results_folder)
results_folder_5 = RemoteReceiver(results_folder)
results_folder_6 = RemoteReceiver(results_folder)
results_folder_7 = RemoteReceiver(results_folder)
results_folder_8 = RemoteReceiver(results_folder)
heath_folder_2 = RemoteReceiver(heath_folder)
concat = Concatenate(FragmentA=heath_folder_2, FragmentB="heath/butterfly_heath.png")
heath_folder_3 = RemoteReceiver(heath_folder)

# ----
# Save/restore states front-end
heath_flying_2 = RemoteReceiver(heath_flying)  # disabled
heath_flying_3 = RemoteReceiver(heath_flying)  # disabled
panel_158 = Panel("Textdokument|*.txt")  # disabled
panel_159 = Panel("Textdokument|*.txt")  # disabled
py3_23 = Python3Script(get=heath_flying_2)  # -> mpl_folder; disabled; same code as py3_5
py3_24 = Python3Script(get=heath_flying_3)  # -> mpl_folder; disabled; same code as py3_5
panel_160 = Panel("Save state")  # disabled
panel_161 = Panel("Load state")  # disabled
panel_162 = Panel("Pick state")  # disabled
panel_163 = Panel("Save location")  # disabled
button_44 = CreateButton(ButtonName=panel_161, ButtonStyle=0)  # disabled
filepicker = CreateFilePicker(ButtonLabelText=panel_162, DialogType=0, MustExist=True, Filter=panel_158, StartingPath=py3_23)  # disabled
filepicker_2 = CreateFilePicker(ButtonLabelText=panel_163, DialogType=1, MustExist=True, Filter=panel_159, StartingPath=py3_24)  # disabled
button_45 = CreateButton(ButtonName=panel_160, ButtonStyle=0)  # disabled
values_120 = ValueListener(Elements=filepicker_2, SomeProperty=True)  # -> Values, Indices; disabled
values_121 = ValueListener(Elements=button_45, SomeProperty=True)  # -> Values, Indices; disabled
values_122 = ValueListener(Elements=filepicker, SomeProperty=True)  # -> Values, Indices; disabled
values_123 = ValueListener(Elements=button_44, SomeProperty=True)  # -> Values, Indices; disabled
save_state = RemoteSender(values_121.Values)  # disabled
save_location = RemoteSender(values_120.Values)  # disabled
load_state = RemoteSender(values_123.Values)  # disabled
load_state_file = RemoteSender(values_122.Values)  # disabled
bool_33 = Boolean(values_120.Values)  # disabled
bool_34 = Boolean(values_122.Values)  # disabled
null_23 = NullItem(Item=bool_33)  # -> NullFlags, InvalidFlags, Description; disabled
null_24 = NullItem(Item=bool_34)  # -> NullFlags, InvalidFlags, Description; disabled
hideshow_12 = HideShowElement(ElementToHideShow=button_45, Show=null_23.NullFlags, Collapse=True, Disable=False)  # disabled
hideshow_13 = HideShowElement(ElementToHideShow=button_44, Show=null_24.NullFlags, Collapse=True, Disable=False)  # disabled
number_slider_62 = Slider(32, range=0..100)  # disabled
number_slider_63 = Slider(90, range=0..100)  # disabled
number_slider_64 = Slider(32, range=0..100)  # disabled
number_slider_65 = Slider(90, range=0..100)  # disabled
adjustpos_108 = AdjustElementPositioning(
    ElementsToAdjust=filepicker_2,
    AbsolutePositioning=invert(False),
    Width=number_slider_63,
    Height=number_slider_62,
    HorizontalAlignment=1,
    VerticalAlignment=2)  # disabled
adjustpos_109 = AdjustElementPositioning(
    ElementsToAdjust=filepicker,
    AbsolutePositioning=invert(False),
    Width=number_slider_65,
    Height=number_slider_64,
    HorizontalAlignment=1,
    VerticalAlignment=2)  # disabled

# ----
# Save/restore states back-end
load_state_file_2 = RemoteReceiver(load_state_file)  # disabled
load_state_2 = RemoteReceiver(load_state)  # disabled
geometry_module_state_import_type_2 = RemoteReceiver(geometry_module_state_import_type)  # disabled
save_location_2 = RemoteReceiver(save_location)  # disabled
save_state_2 = RemoteReceiver(save_state)  # disabled
gate_13 = StreamGate(Stream=load_state_file_2, Gate=load_state_2)  # -> Target0, Target1; disabled
file = ReadFile(File=gate_13.Target0, PerLineParse=True)  # disabled
writetxt = WriteToTextFile(Run=save_state_2, TextToWrite=geometry_module_state_import_type_2, FilePath=save_location_2, Append=False, NewOnly=False)  # disabled
geometry_module_loaded_state_import_type = RemoteSender(file)  # disabled

results_folder_9 = RemoteReceiver(results_folder)
heath_folder_4 = RemoteReceiver(heath_folder)
concat_2 = Concatenate(FragmentA=heath_folder_4, FragmentB="heath/butterfly_heath.png")
image = CreateImage(ImageSource=concat_2, ImageWidth=bar_chart_img_width_4, ImageHeight=bar_chart_img_height_4)
entwine_89 = Entwine(Branch00=checklist_4, Branch01=image, FlattenInputs=True)  # -> flatten(Result)
stack_66 = CreateStack(UIElements=entwine_89, Horizontal=True)
entwine_90 = Entwine(Branch00=button_10, Branch01=stack_66, FlattenInputs=True)  # -> flatten(Result)
stack_67 = CreateStack(UIElements=entwine_90, Horizontal=invert(True))
addelems_2 = AddElements(Window=launchwin_2, Elements=flatten(stack_67), DoVLChecking=True)  # -> AddedElements, ElementNames

heath_folder_5 = RemoteReceiver(heath_folder)
concat_3 = Concatenate(FragmentA=heath_folder_5, FragmentB="heath/butterfly_heath.png")
image_2 = CreateImage(ImageSource=concat_3, ImageWidth=bar_chart_img_width_2, ImageHeight=bar_chart_img_height_2)
entwine_91 = Entwine(Branch00=checklist_3, Branch01=image_2, FlattenInputs=True)  # -> flatten(Result)
stack_68 = CreateStack(UIElements=entwine_91, Horizontal=True)
entwine_92 = Entwine(Branch00=button_9, Branch01=stack_68, FlattenInputs=True)  # -> flatten(Result)
addelems_3 = AddElements(Window=launchwin_3, Elements=flatten(entwine_92), DoVLChecking=True)  # -> AddedElements, ElementNames

heath_folder_6 = RemoteReceiver(heath_folder)
concat_4 = Concatenate(FragmentA=heath_folder_6, FragmentB="heath/butterfly_heath.png")
image_3 = CreateImage(ImageSource=concat_4, ImageWidth=bar_chart_img_width_3, ImageHeight=bar_chart_img_height_3)
entwine_93 = Entwine(Branch00=checklist_2, Branch01=image_3, FlattenInputs=True)  # -> flatten(Result)
stack_69 = CreateStack(UIElements=entwine_93, Horizontal=True)
entwine_94 = Entwine(Branch00=button_8, Branch01=stack_69, FlattenInputs=True)  # -> flatten(Result)
stack_70 = CreateStack(UIElements=entwine_94, Horizontal=invert(True))
addelems_4 = AddElements(Window=launchwin, Elements=flatten(stack_70), DoVLChecking=True)  # -> AddedElements, ElementNames

# ---- group: Geometry module (continued)
geometry_module_loaded_state_import_type_2 = RemoteReceiver(geometry_module_loaded_state_import_type)
setlist_2 = SetListContents(ListToModify=pulldown_25, NewListContents=panel_97, SelectedIndex=geometry_module_loaded_state_import_type_2)

# ----
# Heath window
launch_heath_4 = RemoteReceiver(launch_heath)
rec_19 = DataRecorder(launch_heath_4, DataLimit=-2, RecordData=True)
ma_13 = MassAddition(Input=rec_19)  # -> Result, PartialResults
entwine_95 = Entwine(Branch00=ma_13.Result, Branch01=heath_main, FlattenInputs=True)
rec_20 = DataRecorder(entwine_95, DataLimit=2, RecordData=True)
item_14 = ListItem(List=rec_20, Index=0, Wrap=True)  # -> Item2, Item1, Item
equals_31 = Equality(FirstNumber=item_14.Item2, SecondNumber=item_14.Item1)  # -> Equality, Inequality
bang_8 = ExplodeTree(Data=equals_31.Inequality)  # -> Branch0, Branch1
data_12 = Data(energy_simulations)
data_13 = Data(location_18)
data_14 = Data()
data_15 = Data(daylight_simulations_3)
data_16 = Data(daylight_simulations_2)
entwine_96 = Entwine(Branch00=stack_40, Branch01=preview, Branch02=location_16, FlattenInputs=True)  # -> flatten(Result)
entwine_97 = Entwine(Branch00=location_11, Branch01=location_12, FlattenInputs=True)  # -> flatten(Result)
entwine_98 = Entwine(Branch00=location_14, Branch01=location_19, Branch02=location_13, FlattenInputs=True)  # -> flatten(Result)
entwine_99 = Entwine(Branch00=stack_45, FlattenInputs=True)  # -> flatten(Result)
entwine_100 = Entwine(Branch00=entwine_35, FlattenInputs=True)  # -> flatten(Result)
entwine_101 = Entwine(
    Branch00=select_model_3,
    Branch01=data_12,
    Branch02=data_13,
    Branch03=data_15,
    Branch04=data_14,
    Branch05=data_16,
    FlattenInputs=True)  # -> flatten(Result)
py3_25 = Python3Script(x=bang_8.Branch0, y=bang_8.Branch1)  # -> a; same code as py3_6
event_45 = EventGate(Data=py3_25)  # -> Data, IsNew
freeze_gate_37 = StreamFreezeGate(Data=py3_25, PassingSwitch=event_45.IsNew)
panel_164 = Panel("""Geometry module
Program module
Construction module
Assembly module
Visualize module
Analysis module""")
event_46 = EventGate(Data=freeze_gate_37)  # -> Data, IsNew
launchwin_7 = LaunchWindow(
    Show=event_46.Data,
    Name="Heath",
    Width=Slider(390, range=0..1000),
    Height=Slider(520, range=0..1000),
    ChildStatus=1,
    EnableHorizScroll=False)
panel_165 = Panel(event_46.Data)
heath_is_active = RemoteSender(event_46.Data)
heath_window = RemoteSender(launchwin_7)
heath_window_location_2 = RemoteReceiver(heath_window_location)
winprops_7 = SetWindowProperties(
    Window=launchwin_7,
    StartingLocation=heath_window_location_2,
    Theme=0,
    AccentColor=heath_accent_color_5,
    ShowTitleBar=True,
    BackgroundColor=RGB(255, 255, 255),
    ScaleFactor=1)
true_button_18 = CreateTrueOnlyButton(ButtonName="Help!", ButtonStyle=0)
launch_heath_5 = RemoteReceiver(launch_heath)
py3_26 = Python3Script(window=launchwin_7, activate=launch_heath_5)  # same code as py3_7
winstat_7 = WindowStatus(Window=launchwin_7)
values_124 = ValueListener(Elements=true_button_18, SomeProperty=True)  # -> Values, Indices
help_button = RemoteSender(values_124.Values)
heath_status = RemoteSender(winstat_7)
format_30 = Format(Format="{0}, {1}, {2}, {3}", Culture=127, Data0=Slider(10, range=0..300))
adjustpos_110 = AdjustElementPositioning(
    ElementsToAdjust=true_button_18,
    Margin=format_30,
    AbsolutePositioning=invert(False),
    HorizontalAlignment=2,
    VerticalAlignment=2)

heath_status_2 = RemoteReceiver(heath_status)
expression_32 = Expression(x="Hidden", y=heath_status_2, Expression="x=y")
expire_7 = ExpireObject(ObjectToExpire=objbynn_7, Expire=expression_32)

stack_71 = CreateStack(UIElements=entwine_96, Horizontal=invert(True))
stack_72 = CreateStack(UIElements=entwine_98, Horizontal=invert(True))
stack_73 = CreateStack(UIElements=entwine_100, Horizontal=invert(True))
stack_74 = CreateStack(UIElements=entwine_97, Horizontal=invert(True))
concat_5 = Concatenate(FragmentA=heath_folder_3, FragmentB="heath/butterfly_heath_short.png")

# ---- group: Geometry module (continued)
heath_status_3 = RemoteReceiver(heath_status)
expression_33 = Expression(x="Hidden", y=heath_status_3, Expression="x=y")

# ----
heath_is_active_2 = RemoteReceiver(heath_is_active)

launchwin_8 = LaunchWindow(
    Show=invert(heath_is_active_2),
    Name="Heath",
    Width=number_slider_56,
    Height=number_slider_57,
    ChildStatus=1,
    EnableHorizScroll=False)
winprops_8 = SetWindowProperties(Window=launchwin_8, StartingLocation=pt_12, AccentColor=heath_accent_color_12, ShowTitleBar=True, ScaleFactor=1)

addelems_5 = AddElements(Window=launchwin_8, Elements=flatten(entwine_88), DoVLChecking=True)  # -> AddedElements, ElementNames
winstat_8 = WindowStatus(Window=launchwin_8)
heath_launch_status = RemoteSender(winstat_8)
heath_launch_elements = RemoteSender(addelems_5.AddedElements)

# ----
# Heath module help
help_button_2 = RemoteReceiver(help_button)
rec_21 = DataRecorder(help_button_2, DataLimit=-2, RecordData=True)
ma_14 = MassAddition(Input=rec_21)  # -> Result, PartialResults
entwine_102 = Entwine(Branch00=ma_14.Result, Branch01=heath_help, FlattenInputs=True)
rec_22 = DataRecorder(entwine_102, DataLimit=2, RecordData=True)
item_15 = ListItem(List=rec_22, Index=0, Wrap=True)  # -> Item2, Item1, Item
equals_32 = Equality(FirstNumber=item_15.Item2, SecondNumber=item_15.Item1)  # -> Equality, Inequality
bang_9 = ExplodeTree(Data=equals_32.Inequality)  # -> Branch0, Branch1
py3_27 = Python3Script(x=bang_9.Branch0, y=bang_9.Branch1)  # -> a; same code as py3_6
event_47 = EventGate(Data=py3_27)  # -> Data, IsNew
freeze_gate_38 = StreamFreezeGate(Data=py3_27, PassingSwitch=event_47.IsNew)
panel_166 = Panel("""1. Select the program for the building and room.

2. Use the sliders to set the cooling and heating setpoints.

3. Estimate how many persons will be in the room with the occupancy slider.""")
panel_167 = Panel("""1. Select base construction by climate and type of construction.

2. If required, create your own material or window. Materials can later be selected when creating custom constructions.

3. Constructions and windows make up the subset construction, which is used to modify the base construction.

4. Constructions can be loaded from a file, which contains all previously created constructions.""")
panel_168 = Panel("""1. Select geometry in Rhino.

2. Select geometry type under the import geometry heading.

3. Click "Save geometry".

4. Verify the assigned geometry by pressing the "Preview" checkbox.""")
panel_169 = Panel("""1. Make sure the geometry have been imported and that the program and constructions are in place, before creating a honeybee model.

2. If the model has been created, the "Bake model" button will be enabled along with boxes that lets you visualize the model.

3. Set the wall thickness and roof thickness.

4. Switch the WWR (window-to-wall-ratio) on, if you want to generate windows automatically.""")
panel_170 = Panel("""1. Verify that the honeybee model is correct by selecting attributes and clicking the checkboxes in the "Attributes visualization" segment.

2. Click the "Run weather visualization" button. If the model is set up correctly the "Direct sun hours" and "Incident radiation" should be displayed on the model.""")
panel_171 = Panel("""1. Pick which simulation you want to run.

2. If the simulation failed a red text will show up, go back and review the honeybee model and settings.

3. Otherwise, navigate through the expanded segment to select appropriate displays of the results.

4. It is possible to transfer the results to Rhino by clicking "Bake", or to an image file by clicking "Pop-up window".""")
heath_window_location_3 = RemoteReceiver(heath_window_location)
event_48 = EventGate(Data=freeze_gate_38)  # -> Data, IsNew
label_44 = CreateLabel(LabelText="Geometry module", LabelSize=18, Justification=0)
panel_172 = Panel(event_48.Data)
tb_23 = CreateTextBlock(Text="Geometry module", TextSize=12, Justification=0)
launchwin_9 = LaunchWindow(
    Show=event_48.Data,
    Name="Help!",
    Width=Slider(350, range=0..500),
    Height=Slider(290, range=0..500),
    ChildStatus=1,
    EnableHorizScroll=False)
pdecon_4 = Deconstruct(Point=heath_window_location_3)  # -> XComponent, YComponent, ZComponent
pt_13 = ConstructPoint(XCoordinate=Slider(460, range=0..1000), YCoordinate=pdecon_4.YComponent, ZCoordinate=0)
winprops_9 = SetWindowProperties(
    Window=launchwin_9,
    StartingLocation=pt_13,
    Theme=0,
    AccentColor=heath_accent_color_3,
    ShowTitleBar=True,
    BackgroundColor=RGB(255, 255, 255),
    ScaleFactor=1)
entwine_103 = Entwine(Branch00=label_44, Branch01=tb_23, FlattenInputs=True)  # -> flatten(Result)
winstat_9 = WindowStatus(Window=launchwin_9)
help_button_3 = RemoteReceiver(help_button)
heath_help_status = RemoteSender(winstat_9)
addelems_6 = AddElements(Window=launchwin_9, Elements=flatten(entwine_103), DoVLChecking=True)  # -> AddedElements, ElementNames
py3_28 = Python3Script(window=launchwin_9, activate=help_button_3)  # same code as py3_7

heath_help_status_2 = RemoteReceiver(heath_help_status)
expression_34 = Expression(x="Hidden", y=heath_help_status_2, Expression="x=y")
expire_8 = ExpireObject(ObjectToExpire=objbynn_6, Expire=expression_34)

filepicker_3 = CreateFilePicker(
    ButtonLabelText="Save constructions to file",
    DialogType=1,
    MustExist=True,
    Filter="Text file|*.txt",
    StartingPath=results_folder_3)
filepicker_4 = CreateFilePicker(
    ButtonLabelText="Load constructions from file",
    DialogType=0,
    MustExist=True,
    Filter="Text file|*.txt",
    StartingPath=results_folder_4)
values_125 = ValueListener(Elements=filepicker_3, SomeProperty=True)  # -> Values, Indices
values_126 = ValueListener(Elements=filepicker_4, SomeProperty=True)  # -> Values, Indices
bool_35 = Boolean(values_125.Values)
bool_36 = Boolean(values_126.Values)
null_25 = NullItem(Item=bool_35)  # -> NullFlags, InvalidFlags, Description
null_26 = NullItem(Item=bool_36)  # -> NullFlags, InvalidFlags, Description
save_constructions_file = RemoteSender(values_125.Values)
load_constructions_file = RemoteSender(values_126.Values)
hideshow_14 = HideShowElement(ElementToHideShow=button_34, Show=null_25.NullFlags, Collapse=True, Disable=False)
hideshow_15 = HideShowElement(ElementToHideShow=button_36, Show=null_26.NullFlags, Collapse=True, Disable=False)
entwine_104 = Entwine(Branch00=filepicker_3, Branch01=button_34, FlattenInputs=True)  # -> flatten(Result)
entwine_105 = Entwine(Branch00=filepicker_4, Branch01=button_36, FlattenInputs=True)  # -> flatten(Result)
stack_75 = CreateStack(UIElements=entwine_104, Horizontal=True)
adjustpos_111 = AdjustElementPositioning(
    ElementsToAdjust=filepicker_3,
    AbsolutePositioning=False,
    Width=Slider(180, range=0..300),
    Height=Slider(32, range=0..300),
    HorizontalAlignment=0)
stack_76 = CreateStack(UIElements=entwine_105, Horizontal=True)
adjustpos_112 = AdjustElementPositioning(
    ElementsToAdjust=filepicker_4,
    AbsolutePositioning=False,
    Width=Slider(180, range=0..300),
    Height=Slider(32, range=0..300),
    HorizontalAlignment=0)

entwine_106 = Entwine(
    Branch00=stack_59,
    Branch01=label_39,
    Branch02=label_38,
    Branch03=stack_60,
    Branch04=stack_75,
    Branch05=stack_76,
    FlattenInputs=True)  # -> flatten(Result)
addelems_7 = AddElements(Window=launchwin_4, Elements=flatten(entwine_106), DoVLChecking=True)  # -> AddedElements, ElementNames
construction_database_elements = RemoteSender(addelems_7.AddedElements)

# ----
# Save constructions
panel_173 = Panel("Heath constructions")
save_constructions_2 = RemoteReceiver(save_constructions)
getdocumentusertext_4 = Python3Script(run=save_constructions_2, key=panel_173)  # -> json_string; same code as getdocumentusertext
null_27 = NullItem(Item=getdocumentusertext_4)  # -> NullFlags, InvalidFlags, Description
save_constructions_file_2 = RemoteReceiver(save_constructions_file)
bool_37 = Boolean(invert(null_27.NullFlags))
filter_28 = StreamFilter(Gate=null_27.NullFlags, Stream0=save_constructions_2, Stream1=bool_37)
writetxt_2 = WriteToTextFile(Run=filter_28, TextToWrite=getdocumentusertext_4, FilePath=save_constructions_file_2, Append=False, NewOnly=False)

# ----
# Load constructions
load_constructions_2 = RemoteReceiver(load_constructions)
load_constructions_file_2 = RemoteReceiver(load_constructions_file)
gate_14 = StreamGate(Stream=load_constructions_file_2, Gate=load_constructions_2)  # -> Target0, Target1
getdocumentusertext_5 = Python3Script(run=load_constructions_2, key="Heath constructions")  # -> json_string; same code as getdocumentusertext
file_2 = ReadFile(File=gate_14.Target1, PerLineParse=False)
split_4 = TextSplit(Text=file_2, Separators="|")  # -> flatten(Result)
entwine_107 = Entwine(Branch00=getdocumentusertext_5, Branch01=file_2, FlattenInputs=True)  # -> flatten(Result)
strtoobj_2 = HBStringToObject(hb_str=split_4)  # -> hb_obj; plug-in component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
null_28 = NullItem(Item=strtoobj_2)  # -> NullFlags, InvalidFlags, Description
item_16 = ListItem(List=null_28.NullFlags, Index=0, Wrap=True)
filter_29 = StreamFilter(Gate=item_16, Stream0=entwine_107)
join_5 = TextJoin(Text=filter_29, Join="|")
freeze_gate_39 = StreamFreezeGate(Data=join_5, PassingSwitch=load_constructions_2, Freeze=False, Hold=False)

filepicker_5 = CreateFilePicker(
    ButtonLabelText="Save materials to file",
    DialogType=1,
    MustExist=True,
    Filter="Text file|*.txt",
    StartingPath=results_folder_5)
filepicker_6 = CreateFilePicker(
    ButtonLabelText="Load materials from file",
    DialogType=0,
    MustExist=True,
    Filter="Text file|*.txt",
    StartingPath=results_folder_6)
values_127 = ValueListener(Elements=filepicker_5, SomeProperty=True)  # -> Values, Indices
values_128 = ValueListener(Elements=filepicker_6, SomeProperty=True)  # -> Values, Indices
bool_38 = Boolean(values_127.Values)
bool_39 = Boolean(values_128.Values)
null_29 = NullItem(Item=bool_38)  # -> NullFlags, InvalidFlags, Description
save_materials_file = RemoteSender(values_127.Values)
null_30 = NullItem(Item=bool_39)  # -> NullFlags, InvalidFlags, Description
load_materials_file = RemoteSender(values_128.Values)
hideshow_16 = HideShowElement(ElementToHideShow=button_38, Show=null_29.NullFlags, Collapse=True, Disable=False)
hideshow_17 = HideShowElement(ElementToHideShow=button_39, Show=null_30.NullFlags, Collapse=True, Disable=False)
entwine_108 = Entwine(Branch00=filepicker_6, Branch01=button_39, FlattenInputs=True)  # -> flatten(Result)
entwine_109 = Entwine(Branch00=filepicker_5, Branch01=button_38, FlattenInputs=True)  # -> flatten(Result)
stack_77 = CreateStack(UIElements=entwine_108, Horizontal=True)
stack_78 = CreateStack(UIElements=entwine_109, Horizontal=True)
adjustpos_113 = AdjustElementPositioning(
    ElementsToAdjust=filepicker_5,
    AbsolutePositioning=False,
    Width=Slider(180, range=0..300),
    Height=Slider(32, range=0..300),
    HorizontalAlignment=0)
adjustpos_114 = AdjustElementPositioning(ElementsToAdjust=stack_78, Margin="5, 20, 0, 0", AbsolutePositioning=False, HorizontalAlignment=0)
adjustpos_115 = AdjustElementPositioning(ElementsToAdjust=stack_77, Margin="5, 10, 0, 0", AbsolutePositioning=False, HorizontalAlignment=0)
adjustpos_116 = AdjustElementPositioning(
    ElementsToAdjust=filepicker_6,
    AbsolutePositioning=False,
    Width=Slider(180, range=0..300),
    Height=Slider(32, range=0..300),
    HorizontalAlignment=0)

entwine_110 = Entwine(
    Branch00=stack_61,
    Branch01=label_7,
    Branch02=label_40,
    Branch03=stack_63,
    Branch04=stack_78,
    Branch05=stack_77,
    FlattenInputs=True)  # -> flatten(Result)
addelems_8 = AddElements(Window=launchwin_6, Elements=flatten(entwine_110), DoVLChecking=True)  # -> AddedElements, ElementNames
material_database_elements = RemoteSender(addelems_8.AddedElements)

# ----
# Save materials
panel_174 = Panel("Heath materials")
save_materials_2 = RemoteReceiver(save_materials)
getdocumentusertext_6 = Python3Script(run=save_materials_2, key=panel_174)  # -> json_string; same code as getdocumentusertext
null_31 = NullItem(Item=getdocumentusertext_6)  # -> NullFlags, InvalidFlags, Description
bool_40 = Boolean(invert(null_31.NullFlags))
save_materials_file_2 = RemoteReceiver(save_materials_file)
filter_30 = StreamFilter(Gate=null_31.NullFlags, Stream0=save_materials_2, Stream1=bool_40)
writetxt_3 = WriteToTextFile(Run=filter_30, TextToWrite=getdocumentusertext_6, FilePath=save_materials_file_2, Append=False, NewOnly=False)

# ----
# Load materials
load_materials_file_2 = RemoteReceiver(load_materials_file)
load_materials_2 = RemoteReceiver(load_materials)
gate_15 = StreamGate(Stream=load_materials_file_2, Gate=load_materials_2)  # -> Target0, Target1
getdocumentusertext_7 = Python3Script(run=load_materials_2, key="Heath materials")  # -> json_string; same code as getdocumentusertext
file_3 = ReadFile(File=gate_15.Target1, PerLineParse=False)
entwine_111 = Entwine(Branch00=getdocumentusertext_7, Branch01=file_3, FlattenInputs=True)  # -> flatten(Result)
split_5 = TextSplit(Text=file_3, Separators="|")  # -> flatten(Result)
strtoobj_3 = HBStringToObject(hb_str=split_5)  # -> hb_obj; plug-in component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
null_32 = NullItem(Item=strtoobj_3)  # -> NullFlags, InvalidFlags, Description
item_17 = ListItem(List=null_32.NullFlags, Index=0, Wrap=True)
filter_31 = StreamFilter(Gate=item_17, Stream0=entwine_111)
join_6 = TextJoin(Text=filter_31, Join="|")
freeze_gate_40 = StreamFreezeGate(Data=join_6, PassingSwitch=load_materials_2, Freeze=False, Hold=False)

filepicker_7 = CreateFilePicker(
    ButtonLabelText="Save windows to file",
    DialogType=1,
    MustExist=True,
    Filter="Text file|*.txt",
    StartingPath=results_folder_7)
filepicker_8 = CreateFilePicker(
    ButtonLabelText="Load windows from file",
    DialogType=0,
    MustExist=True,
    Filter="Text file|*.txt",
    StartingPath=results_folder_8)
values_129 = ValueListener(Elements=filepicker_7, SomeProperty=True)  # -> Values, Indices
values_130 = ValueListener(Elements=filepicker_8, SomeProperty=True)  # -> Values, Indices
bool_41 = Boolean(values_129.Values)
bool_42 = Boolean(values_130.Values)
null_33 = NullItem(Item=bool_41)  # -> NullFlags, InvalidFlags, Description
null_34 = NullItem(Item=bool_42)  # -> NullFlags, InvalidFlags, Description
save_windows_file = RemoteSender(values_129.Values)
load_windows_file = RemoteSender(values_130.Values)
hideshow_18 = HideShowElement(ElementToHideShow=button_42, Show=null_33.NullFlags, Collapse=True, Disable=False)
hideshow_19 = HideShowElement(ElementToHideShow=button_43, Show=null_34.NullFlags, Collapse=True, Disable=False)
entwine_112 = Entwine(Branch00=filepicker_7, Branch01=button_42, FlattenInputs=True)  # -> flatten(Result)
entwine_113 = Entwine(Branch00=filepicker_8, Branch01=button_43, FlattenInputs=True)  # -> flatten(Result)
adjustpos_117 = AdjustElementPositioning(
    ElementsToAdjust=filepicker_7,
    AbsolutePositioning=False,
    Width=Slider(180, range=0..300),
    Height=Slider(32, range=0..300),
    HorizontalAlignment=0)
stack_79 = CreateStack(UIElements=entwine_112, Horizontal=True)
stack_80 = CreateStack(UIElements=entwine_113, Horizontal=True)
adjustpos_118 = AdjustElementPositioning(
    ElementsToAdjust=filepicker_8,
    AbsolutePositioning=False,
    Width=Slider(180, range=0..300),
    Height=Slider(32, range=0..300),
    HorizontalAlignment=0)

entwine_114 = Entwine(
    Branch00=stack_65,
    Branch01=label_42,
    Branch02=label_43,
    Branch03=stack_64,
    Branch04=stack_79,
    Branch05=stack_80,
    FlattenInputs=True)  # -> flatten(Result)
addelems_9 = AddElements(Window=launchwin_5, Elements=flatten(entwine_114), DoVLChecking=True)  # -> AddedElements, ElementNames
window_database_elements = RemoteSender(addelems_9.AddedElements)

# ----
# Load windows
load_windows_file_2 = RemoteReceiver(load_windows_file)
load_windows_2 = RemoteReceiver(load_windows)
gate_16 = StreamGate(Stream=load_windows_file_2, Gate=load_windows_2)  # -> Target0, Target1
getdocumentusertext_8 = Python3Script(run=load_windows_2, key="Heath windows")  # -> json_string; same code as getdocumentusertext
file_4 = ReadFile(File=gate_16.Target1, PerLineParse=False)
entwine_115 = Entwine(Branch00=getdocumentusertext_8, Branch01=file_4, FlattenInputs=True)  # -> flatten(Result)
split_6 = TextSplit(Text=file_4, Separators="|")  # -> flatten(Result)
strtoobj_4 = HBStringToObject(hb_str=split_6)  # -> hb_obj; plug-in component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
null_35 = NullItem(Item=strtoobj_4)  # -> NullFlags, InvalidFlags, Description
item_18 = ListItem(List=null_35.NullFlags, Index=0, Wrap=True)
filter_32 = StreamFilter(Gate=item_18, Stream0=entwine_115)
join_7 = TextJoin(Text=filter_32, Join="|")
freeze_gate_41 = StreamFreezeGate(Data=join_7, PassingSwitch=load_windows_2, Freeze=False, Hold=False)

# ----
# Save windows
panel_175 = Panel("Heath windows")
save_windows_2 = RemoteReceiver(save_windows)
getdocumentusertext_9 = Python3Script(run=save_windows_2, key=panel_175)  # -> json_string; same code as getdocumentusertext
null_36 = NullItem(Item=getdocumentusertext_9)  # -> NullFlags, InvalidFlags, Description
bool_43 = Boolean(invert(null_36.NullFlags))
save_windows_file_2 = RemoteReceiver(save_windows_file)
filter_33 = StreamFilter(Gate=null_36.NullFlags, Stream0=save_windows_2, Stream1=bool_43)
writetxt_4 = WriteToTextFile(Run=filter_33, TextToWrite=getdocumentusertext_9, FilePath=save_windows_file_2, Append=False, NewOnly=False)

# ----
# Heath material info
number_slider_66 = Slider(1.15, range=0..10)
number_slider_67 = Slider(560, range=0..1000)
number_slider_68 = Slider(500, range=0..1000)
panel_176 = Panel("heath/Building physics from physical principles to international standards, Marko Pinteric_page-0001.jpg")
multiplication = Multiplication(A=number_slider_66, B=number_slider_67)
create_modal_location_2 = RemoteReceiver(create_modal_location)
heath_accent_color_14 = RemoteReceiver(heath_accent_color)
multiplication_2 = Multiplication(A=Slider(1.25, range=0..10), B=number_slider_68)
concat_6 = Concatenate(FragmentA=heath_folder_2, FragmentB=panel_176)
image_4 = CreateImage(ImageSource=concat, ImageWidth=multiplication_2, ImageHeight=number_slider_68)
setimg = SetImage(ImageToModify=image_4, NewImagePath=concat_6)

# ----
# Assemble Honeybee model
# # Assemble Honeybee model
# This cluster takes input geometry and geometric information and generates a valid Honeybee model which can be used in the following analysis steps.
# 
# ## Instructions
# Enter the relevant inputs to generate the Honeybee model. Windows can either be created using an input geometry or through auto-generation using a window-to-wall ratio.
# 
# ### Room geometry
# Each 3D Brep entered represents one room or thermal zone in the building with no air exchange between them. The Breps should be closed and 3D to generate valid rooms. The room geometries should represent the inner boundary of the external walls
# 
# ### Adjacent geometry
# Geometry of adjacent buildings represented by a surface where they contact the room geometry. Adiabatic boundary condition will be assumed at the contact surface.
# 
# ### Windows/apertures
# Windows can either be defined through a list of 2D surfaces which intersect with the room 3D geometries, or be auto-generated through the list of numeric outputs.
# 
# ### Wall/roof thicknesses
# Wall and roof thicknesses are supplied to generate a shading geometry representing the external surface thickness
# 
# ### Louvers
# If all related inputs are entered, shading louvers will be generated on each window according to the entered parameters.
# 
# ### Different directions
# All the above inputs will be the same for all rooms, however they can be optionally entered as a list which represents different values for different cardinal directions, in the order (N, E, S, W).
# 
# ## Inputs
# - `Model name` - text string representing the name of the analysis model
# - `Room geometry` - list of 3D closed Brep geometries representing each room/zone in the model
# - `Construction set` - text string representing the construction to be used for the rooms, can be retrieved using the HB Construction Set by Climate component
# - `Program` - Honeybee Program or list of which are applied to the rooms in the model. Can be defined using the HB Search Programs component
# - `Context geometry` - list of surrounding Brep geometries which shades the analysed Rooms
# - `Windows` - list of 2D Brep geometries which represent the openings in the building envelope. If not supplied, windows are instead generated through definition of window-to-wall ratios as defined below
# - `Skylights` - list of 2D Brep geometries which represent the openings in the building roof
# - `Window-to-wall ratio` - number representing the window-to-wall ratio on each exterior surface Used if no window geometries are supplied.
# - `Subdivide generated windows` - set to True if the window surface area should be divided into multiple windows on each exterior surface
# - `Window height` - number representing the target height of the auto-generated windows
# - `Sill height` - number representing how high the lower edge of the auto-generated windows should be from the room floor
# - `Horizontal separation` - number representing how far separated the auto-generated windows should be horizontally
# - `Vertical separation` - number representing if auto-generated windows should be split vertically and if so, what distance
# - `Wall thickness` - number representing the thickness of the exterior walls, used to generate shading geometry for windows
# - `Roof thickness` - number representing the thickness of the roof, used to generate shading geometry for skylights
# - `Louver depth` - number optionally representing the depth of louvers
# - `Number of louvers` - number optionally representing the amount of louvers on each window
# - `Distance between louvers ` - number optionally representing the distance between louvers on each window
# - `Louver angle` - number optionally representing if louvers should be tilted
# - `Vertical/horizontal louvers` - boolean, set to True if louvers should be vertical
# 
# ## Outputs
# - `Honeybee model` - valid Honeybee model for further analysis
# 
# ## Interpretation
# To be added...
pre_create_model_3 = RemoteReceiver(pre_create_model)
or_13 = GateOr(B=pre_create_model_3, C=Toggle(True))
panel_177 = Panel("""Room
Adjacent
Context
Window""")
gate_17 = StreamGate(Stream=heath_geometry_type_key_9, Gate=or_13)  # -> Target0, Target1
distance_between_louvers_2 = RemoteReceiver(distance_between_louvers)
number_of_louvers_5 = RemoteReceiver(number_of_louvers)
generate_wwr_2 = RemoteReceiver(generate_wwr)
pre_create_model_4 = RemoteReceiver(pre_create_model)
model_name_3 = RemoteReceiver(model_name)
data_17 = Data(programtype)
louver_depth_2 = RemoteReceiver(louver_depth)
louver_angle_2 = RemoteReceiver(louver_angle)
bool_44 = Boolean(number_of_louvers_5)
filter_34 = StreamFilter(Gate=bool_44, Stream0="0", Stream1=louver_depth_2)
filter_35 = StreamFilter(Gate=bool_44, Stream0="0", Stream1=distance_between_louvers_2)
filter_36 = StreamFilter(Gate=bool_44, Stream0="0", Stream1=louver_angle_2)
multiplication_3 = Multiplication(A=filter_34, B="0.01")
heatcool = HBHeatCoolHVACTemplates({"Baseboard electric": "ElectricBaseboard", "Baseboard gas boiler": "BoilerBaseboard", "Baseboard central air source heat pump": "ASHPBaseboard", "Baseboard district hot water": "DHWBaseboard", "Direct evap coolers with baseboard electric": "EvapCoolers_ElectricBaseboard", "Direct evap coolers with baseboard gas boiler": "EvapCoolers_BoilerBaseboard"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}, selected="Residential heat pump with no cooling": "ResidentialHPNoCool")
window_height = Number()
sill_height = Number(Slider(0.3, range=0..1))
horizontal_separation = Number()
vertical_separation = Number()
louver_depth_3 = Number(multiplication_3)
number_of_louvers_6 = Number(number_of_louvers_5)
louver_angle_3 = Number(filter_36)
vertical_horizontal_louvers = Boolean()
subdivide_generated_windows = Boolean(Toggle(True))
distance_between_louvers_3 = Number(filter_35)
py3_29 = Python3Script(
    depth=louver_depth_3,
    count=number_of_louvers_6,
    dist=distance_between_louvers_3,
    angle=louver_angle_3,
    direction=vertical_horizontal_louvers)  # -> out, louver_settings
# ---------- py3_29: Python ----------
"""Create louver Settings"""
from heath import LouverSettings

louver_settings = LouverSettings(depth, int(count), dist, angle, direction)
# ---------- end py3_29 ----------
py3_30 = Python3Script(x=pre_create_model_2)  # -> folder
# ---------- py3_30: Python ----------
import os
from Rhino import RhinoDoc

folder_path = ("\\").join(ghdoc.Path.split("\\")[:-1])
rhino_file_name = (RhinoDoc.ActiveDoc.Path).split("\\")[-1][:-4]
folder_name = 'Honeybee models'
full_path = folder_path + "\\heath_data\\" + rhino_file_name + "\\" + folder_name

try:
    os.mkdir(("\\").join(full_path.split("\\")[:-2]))
    os.mkdir(("\\").join(full_path.split("\\")[:-1]))
    os.mkdir(full_path)
except FileExistsError:
    # directory already exists
    pass

folder = full_path
# ---------- end py3_30 ----------
rename_current_model_name_4 = RemoteReceiver(rename_current_model_name)
pre_rename_current_model_3 = RemoteReceiver(pre_rename_current_model)
pre_remove_current_model_3 = RemoteReceiver(pre_remove_current_model)
show_honeybee_element_2 = RemoteReceiver(show_honeybee_element)
empty_10 = EmptyObjectToEmptyBranch()

merge_11 = Merge(Data1=panel_177, Data2=save_program)
panel_178 = Panel(pre_create_model_4)
panel_179 = Panel(pre_remove_current_model_3)

tabs = TabbedView(
    TabNames=panel_164,
    TabTextSize=Slider(13, range=0..100),
    Tab0=flatten(stack_71),
    Tab1=flatten(stack_74),
    Tab2=flatten(stack_72),
    Tab3=flatten(entwine_99),
    Tab4=flatten(stack_73),
    Tab5=flatten(entwine_101))
values_131 = ValueListener(Elements=tabs, SomeProperty=True)  # -> Values, Indices
adjustpos_119 = AdjustElementPositioning(
    ElementsToAdjust=[stack_71, stack_74, stack_72, stack_73, entwine_99, entwine_101],
    Margin="0, 5, 0, 0",
    AbsolutePositioning=False,
    HorizontalAlignment=0,
    VerticalAlignment=2)
adjustpos_120 = AdjustElementPositioning(ElementsToAdjust=tabs, AbsolutePositioning=False, Width=Slider(365, range=100..1500))
current_tab_index = RemoteSender(values_131.Indices)
image_5 = CreateImage(ImageSource=concat_5, ImageWidth=Slider(30, range=0..100), ImageHeight=Slider(19, range=0..100))
entwine_116 = Entwine(Branch00=image_5, Branch01=true_button_6, Branch02=true_button_18, FlattenInputs=True)  # -> flatten(Result)
stack_81 = CreateStack(UIElements=entwine_116, Horizontal=True)
stack_82 = CreateStack(UIElements=tabs, Horizontal=True)
entwine_117 = Entwine(Branch00=stack_81, Branch01=stack_82, FlattenInputs=True)  # -> flatten(Result)
addelems_10 = AddElements(Window=launchwin_7, Elements=flatten(entwine_117), DoVLChecking=True)  # -> AddedElements, ElementNames
heath_elements = RemoteSender(addelems_10.AddedElements)

current_tab_index_2 = RemoteReceiver(current_tab_index)
filter_37 = StreamFilter(
    Gate=current_tab_index_2,
    Stream0="Geometry module",
    Stream1="Program module",
    Stream2="Construction module",
    Stream3="Assembly module",
    Stream4="Visualize module",
    Stream5="Analysis module")
filter_38 = StreamFilter(
    Gate=current_tab_index_2,
    Stream0=panel_168,
    Stream1=panel_166,
    Stream2=panel_167,
    Stream3=panel_169,
    Stream4=panel_170,
    Stream5=panel_171)
settextblock_10 = SetTextBlockContents(TextBlockToModify=tb_23, NewTextBlockContents=filter_38)
setlabel_2 = SetLabelContents(LabelToModify=label_44, NewLabelContents=filter_37)

event_49 = EventGate(Data=values_131.Values)  # -> Data, IsNew

current_tab = RemoteSender(event_49.Data)

current_tab_2 = RemoteReceiver(current_tab)
expression_35 = Expression(x="Assembly module", y=current_tab_2, Expression="x≠y")
freeze_gate_42 = StreamFreezeGate(Data=expression_35, PassingSwitch=expression_35)
setchecklist = SetChecklistContents(ChecklistToModify=checklist, NewChecklistContents=panel_2, Selected=invert(freeze_gate_42))

current_tab_3 = RemoteReceiver(current_tab)  # disabled
expression_36 = Expression(x=panel_133, y=current_tab_3, Expression="x≠y")  # disabled
freeze_gate_43 = StreamFreezeGate(Data=expression_36, PassingSwitch=expression_36, Freeze=True)  # disabled
setexp = SetExpander(Expander=expander_2, ExpandedOpen=invert(freeze_gate_43))  # disabled

current_tab_4 = RemoteReceiver(current_tab)
expression_37 = Expression(x="Analysis module", y=current_tab_4, Expression="x≠y")
freeze_gate_44 = StreamFreezeGate(Data=expression_37, PassingSwitch=expression_37, Freeze=True)
setexp_2 = SetExpander(Expander=expander_3, ExpandedOpen=invert(freeze_gate_44))

current_tab_5 = RemoteReceiver(current_tab)
expression_38 = Expression(x="Analysis module", y=current_tab_5, Expression="x≠y")
freeze_gate_45 = StreamFreezeGate(Data=expression_38, PassingSwitch=expression_38, Freeze=True)
setexp_3 = SetExpander(Expander=expander_4, ExpandedOpen=invert(freeze_gate_45))

current_tab_6 = RemoteReceiver(current_tab)
expression_39 = Expression(x="Analysis module", y=current_tab_6, Expression="x≠y")
freeze_gate_46 = StreamFreezeGate(Data=expression_39, PassingSwitch=expression_39, Freeze=True)
setexp_4 = SetExpander(Expander=expander_5, ExpandedOpen=invert(freeze_gate_46))

current_tab_7 = RemoteReceiver(current_tab)
expression_40 = Expression(x="Analysis module", y=current_tab_7, Expression="x=y")

# ---- group: Assembly model (continued)
current_tab_8 = RemoteReceiver(current_tab)
expression_41 = Expression(x="Assembly module", y=current_tab_8, Expression="x=y")
and_11 = GateAnd(A=item.Item, B=expression_41)
current_tab_9 = RemoteReceiver(current_tab)
current_tab_10 = RemoteReceiver(current_tab)
current_tab_11 = RemoteReceiver(current_tab)
current_tab_12 = RemoteReceiver(current_tab)
current_tab_13 = RemoteReceiver(current_tab)
expression_42 = Expression(x="Assembly module", y=current_tab_9, Expression="x=y")
or_14 = GateOr(A=item.Item4, B=and_11)
expression_43 = Expression(x="Assembly module", y=current_tab_10, Expression="x=y")
or_15 = GateOr(A=item.Item1, B=and_11)
or_16 = GateOr(A=item.Item5, B=and_11)
or_17 = GateOr(A=item.Item2, B=and_11)
or_18 = GateOr(A=item.Item3, B=and_11)
or_19 = GateOr(A=item.Item6, B=and_11)
expression_44 = Expression(x="Assembly module", y=current_tab_11, Expression="x=y")
expression_45 = Expression(x="Assembly module", y=current_tab_12, Expression="x=y")
expression_46 = Expression(x="Assembly module", y=current_tab_13, Expression="x=y")
and_12 = GateAnd(A=event_17.Data, B=expression_42)
and_13 = GateAnd(A=or_18, B=expression_41)
and_14 = GateAnd(A=or_14, B=expression_41)
and_15 = GateAnd(A=or_15, B=expression_41)
and_16 = GateAnd(A=or_16, B=expression_41)
and_17 = GateAnd(A=or_17, B=expression_41)
and_18 = GateAnd(A=or_19, B=expression_41)
and_19 = GateAnd(A=event_18.Data, B=expression_43)
and_20 = GateAnd(A=event_19.Data, B=expression_44)
and_21 = GateAnd(A=event_20.Data, B=expression_45)
post_remove_current_model = RemoteSender(and_12)
and_22 = GateAnd(A=event_21.Data, B=expression_46)
show_honeybee_walls = RemoteSender(and_15)
show_honeybee_roof = RemoteSender(and_17)
show_honeybee_floors = RemoteSender(and_13)
show_honeybee_ground = RemoteSender(and_14)
show_honeybee_context = RemoteSender(and_18)
show_honeybee_windows = RemoteSender(and_16)
post_rename_current_model = RemoteSender(and_19)
bake_model = RemoteSender(and_20)
update_honeybee_model = RemoteSender(and_21)
create_model_2 = RemoteSender(and_22)

# ----
show_honeybee_windows_2 = RemoteReceiver(show_honeybee_windows)
show_honeybee_context_2 = RemoteReceiver(show_honeybee_context)
show_honeybee_ground_2 = RemoteReceiver(show_honeybee_ground)
show_honeybee_floors_2 = RemoteReceiver(show_honeybee_floors)
show_honeybee_walls_2 = RemoteReceiver(show_honeybee_walls)
show_honeybee_roof_2 = RemoteReceiver(show_honeybee_roof)

# ---- group: Geometry module (continued)
current_tab_14 = RemoteReceiver(current_tab)
expression_47 = Expression(x="Geometry module", y=current_tab_14, Expression="x=y")
current_tab_15 = RemoteReceiver(current_tab)
and_23 = GateAnd(A=bool_15, B=expression_47)
expression_48 = Expression(x="Geometry module", y=current_tab_15, Expression="x=y")
preview_2 = RemoteSender(and_23)
and_24 = GateAnd(A=equals_14.Inequality, B=expression_48)
current_tab_16 = RemoteReceiver(current_tab)
event_50 = EventGate(Data=and_24)  # -> Data, IsNew
expression_49 = Expression(x="Geometry module", y=current_tab_16, Expression="x=y")
savegeometry = RemoteSender(event_50.Data)
and_25 = GateAnd(A=equals_15.Inequality, B=expression_49, C=invert(expression_33), D=Toggle(False))
event_51 = EventGate(Data=and_25)  # -> Data, IsNew
create_test_model = RemoteSender(event_51.Data)

# ----
create_test_model_2 = RemoteReceiver(create_test_model)
gate_18 = StreamGate(Stream=panel_61, Gate=create_test_model_2)  # -> Target0, Target1
layers = CreateModifyLayers(LayerName=graft(gate_18.Target1), DeleteLayer=False, enableFullPath=True)  # -> LayerNames, LayerFullPath
createatts = CreateAttributes(LayerName=layers.LayerFullPath, UserDataKeys=repeat, UserDataValues=entwine_13, enableFullPath=True)
bake = BakeGeometry(Bake=create_test_model_2, Geometry=entwine_14, Attributes=createatts, DeleteOldBakes=False, PreserveTrees=False)

savegeometry_2 = RemoteReceiver(savegeometry)
create_test_model_3 = RemoteReceiver(create_test_model)
savegeometry_3 = RemoteReceiver(savegeometry)
create_test_model_4 = RemoteReceiver(create_test_model)
create_test_model_5 = RemoteReceiver(create_test_model)
create_test_model_6 = RemoteReceiver(create_test_model)
preview_3 = RemoteReceiver(preview_2)
savegeometry_4 = RemoteReceiver(savegeometry)
savegeometry_5 = RemoteReceiver(savegeometry)
savegeometry_6 = RemoteReceiver(savegeometry)
py3_31 = Python3Script(x=savegeometry_2)  # -> a
# ---------- py3_31: Python ----------
"""Grasshopper Script"""

import rhinoscriptsyntax as rs

if x:
    rs.Command("SelNone")
    a = True
# ---------- end py3_31 ----------
preview_4 = RemoteReceiver(preview_2)
preview_5 = RemoteReceiver(preview_2)
preview_6 = RemoteReceiver(preview_2)
savegeometry_7 = RemoteReceiver(savegeometry)
or_20 = GateOr(A=Toggle(True), B=py3_31)
or_21 = GateOr(A=savegeometry_3, B=preview_3, C=expression_9, D=create_test_model_3)
or_22 = GateOr(A=savegeometry_4, B=preview_4, C=expression_11, D=create_test_model_4)
or_23 = GateOr(A=savegeometry_6, B=preview_6, C=expression_15, D=create_test_model_5)
or_24 = GateOr(A=savegeometry_5, B=preview_5, C=expression_13, D=create_test_model_6)
preview_7 = RemoteReceiver(preview_2)
selobj_2 = ObjectsBySelection(Reset=or_20, LiveMode=True)
gate_19 = StreamGate(Stream=heath_geometry_type_key_3, Gate=or_23)  # -> Target0, Target1
gate_20 = StreamGate(Stream=heath_geometry_type_key_4, Gate=or_21)  # -> Target0, Target1
gate_21 = StreamGate(Stream=heath_geometry_type_key_6, Gate=or_22)  # -> Target0, Target1
gate_22 = StreamGate(Stream=heath_geometry_type_key_5, Gate=or_24)  # -> Target0, Target1
refkv = ReferenceByKeyValue(Key=gate_20.Target1, Val=gate_9.Target1, lightweight=False)
refkv_2 = ReferenceByKeyValue(Key=gate_19.Target1, Val=gate_7.Target1, lightweight=False)
refkv_3 = ReferenceByKeyValue(Key=gate_21.Target1, Val=gate_8.Target1, lightweight=False)
refkv_4 = ReferenceByKeyValue(Key=gate_22.Target1, Val=gate_10.Target1, lightweight=False)
seletedgeometry = RemoteSender(selobj_2)
seletedgeometry_2 = RemoteReceiver(seletedgeometry)
freeze_gate_47 = StreamFreezeGate(Data=seletedgeometry_2, PassingSwitch=presavegeometry_2, Hold=False)
seletedgeometry_3 = RemoteReceiver(seletedgeometry)
detatt = DetachAttributes(Geometry=seletedgeometry_3)  # -> Geometry, Attributes
filtertype = FilterByType(ObjectType="Extrusion", Geometry=freeze_gate_47, invertFilter=False, returnNulls=False)  # -> ExcludedGeometry, IncludedGeometry
filtertype_2 = FilterByType(ObjectType="Brep", Geometry=freeze_gate_47, invertFilter=False, returnNulls=False)  # -> ExcludedGeometry, IncludedGeometry
filtertype_3 = FilterByType(ObjectType="Surface", Geometry=freeze_gate_47, invertFilter=False, returnNulls=False)  # -> ExcludedGeometry, IncludedGeometry
filtertype_4 = FilterByType(ObjectType="Mesh", Geometry=freeze_gate_47, invertFilter=False, returnNulls=False)  # -> ExcludedGeometry, IncludedGeometry
filtertype_5 = FilterByType(ObjectType=panel_59, Geometry=freeze_gate_47, invertFilter=False, returnNulls=False)  # -> ExcludedGeometry, IncludedGeometry
ef_att = EleFrontAttributes(Attributes=detatt.Attributes, Keys="Construction", Values=constructiontype, maintainBakeName=False)
modratt = ModifyRhinoObjectAttributes(ReferencedObject=seletedgeometry_3, Attributes=ef_att, Activate=saveconstruction)
planar = IsPlanar(Surface=filtertype_3.IncludedGeometry, Interior=True)  # -> Planar, Plane
ispolysurfaceclosed = Python3Script(Ps=[filtertype.IncludedGeometry, filtertype_2.IncludedGeometry, filtertype_5.IncludedGeometry])  # -> C; inputs Ps: Brep
# ---------- ispolysurfaceclosed: Python ----------
if Ps:
    C = Ps.IsSolid
# ---------- end ispolysurfaceclosed ----------
panel_180 = Panel(modratt)
lng_11 = ListLength(List=freeze_gate_47)
preview_8 = RemoteReceiver(preview_2)
preview_9 = RemoteReceiver(preview_2)
preview_10 = RemoteReceiver(preview_2)
cull_9 = CullPattern(
    List=[filtertype.IncludedGeometry, filtertype_2.IncludedGeometry, filtertype_5.IncludedGeometry],
    CullPattern=ispolysurfaceclosed)
cull_10 = CullPattern(List=filtertype_3.IncludedGeometry, CullPattern=planar.Planar)
savegeometry_8 = RemoteReceiver(savegeometry)
preview_11 = RemoteReceiver(preview_2)
filter_39 = StreamFilter(
    Gate=geometrytype_validate_2,
    Stream0=cull_9,
    Stream1=cull_10,
    Stream2=[filtertype_5.IncludedGeometry, filtertype_3.IncludedGeometry],
    Stream3=[filtertype_4.IncludedGeometry, filtertype_3.IncludedGeometry, filtertype_5.IncludedGeometry, filtertype.IncludedGeometry, filtertype_2.IncludedGeometry],
    Stream4=freeze_gate_47)  # -> flatten(Stream)
id = Guid(filter_39)
txt_7 = Text(id)
cset_4 = CreateSet(List=txt_7)  # -> Set, Map
geo = Geometry(cset_4.Set)
detatt_2 = DetachAttributes(Geometry=geo)  # -> Geometry, Attributes
ef_att_2 = EleFrontAttributes(Attributes=detatt_2.Attributes, Keys=heath_geometry_type_key_2, Values=geometrytype_2, maintainBakeName=False)
modratt_2 = ModifyRhinoObjectAttributes(ReferencedObject=geo, Attributes=ef_att_2, Activate=savegeometry_7)
panel_181 = Panel(modratt_2)
lng_12 = ListLength(List=geo)
equals_33 = Equality(FirstNumber=lng_11, SecondNumber=lng_12)  # -> Equality, Inequality
freeze_gate_48 = StreamFreezeGate(Data=equals_33.Equality, PassingSwitch=savegeometry_8)
hasdata_6 = DataExists(Data=freeze_gate_48)
filter_40 = StreamFilter(Gate=hasdata_6, Stream0="1", Stream1=freeze_gate_48)
geometry_saved = RemoteSender(filter_40)

selected_geometry = RemoteSender(selobj_2)
cluster_3 = Cluster_7(id=refkv_2)
cluster_4 = Cluster_7(id=refkv_3)
filter_geometry_by_active_layer = Cluster_7(id=refkv)
cluster_5 = Cluster_7(id=refkv_4)
selected_geometry_2 = RemoteReceiver(selected_geometry)
getuv = GetUserValue(Geometry=selected_geometry_2, Key=heath_geometry_type_key_8)
py3_32 = Python3Script(x=getuv, y="Room")  # -> out, a
# ---------- py3_32: Python ----------
a = x == y
# ---------- end py3_32 ----------
room_is_selected = RemoteSender(py3_32.a)

# ---- group: Geometry module (continued)
seletedgeometry_4 = RemoteReceiver(seletedgeometry)
seletedgeometry_5 = RemoteReceiver(seletedgeometry)
lng_13 = ListLength(List=seletedgeometry_4)
seletedgeometry_6 = RemoteReceiver(seletedgeometry)
geometry_saved_2 = RemoteReceiver(geometry_saved)
bool_45 = Boolean(lng_13)
lng_14 = ListLength(List=seletedgeometry_5)
lng_15 = ListLength(List=seletedgeometry_6)
filter_41 = StreamFilter(Gate=bool_45, Stream0=Slider(500, range=0..1000), Stream1=Slider(1000000, range=0..1000000))
filter_42 = StreamFilter(Gate=bool_45, Stream0="First select the geometry in Rhino", Stream1=" ")
nor = GateNor(A=geometry_saved_2, B=lng_14)
hideshow_20 = HideShowElement(ElementToHideShow=button_28, Show=True, Collapse=True, Disable=invert(lng_15))
hideshow_21 = HideShowElement(ElementToHideShow=label_35, Show=nor, Collapse=True, Disable=False)
tooltip_8 = AttachTooltipToElement(ElementsToAttachTo=button_28, TooltipContent=filter_42, ShowDelay=filter_41, Duration=2000)

# ----
gate_23 = StreamGate(Stream=cluster_3, Gate=preview_8)  # -> Target0, Target1
gate_24 = StreamGate(Stream=cluster_4, Gate=preview_9)  # -> Target0, Target1
gate_25 = StreamGate(Stream=filter_geometry_by_active_layer, Gate=preview_10)  # -> Target0, Target1
preview_12 = CustomPreview(Geometry=gate_23.Target1, Material=ColourSwatch(SwatchColor=RGBA(0, 17, 128, 75)))
preview_13 = CustomPreview(Geometry=gate_24.Target1, Material=ColourSwatch(SwatchColor=RGBA(128, 125, 0, 75)))
preview_14 = CustomPreview(Geometry=gate_25.Target1, Material=ColourSwatch(SwatchColor=RGBA(4, 128, 0, 75)))
gate_26 = StreamGate(Stream=cluster_5, Gate=preview_11)  # -> Target0, Target1
preview_15 = CustomPreview(Geometry=gate_26.Target1, Material=ColourSwatch(SwatchColor=RGBA(128, 0, 102, 75)))

# ---- group: Visualize module (continued)
current_tab_17 = RemoteReceiver(current_tab)
expression_50 = Expression(x="Visualize module", y=current_tab_17, Expression="x≠y")
and_26 = GateAnd(A=values_49.Values, B=invert(expression_50))
freeze_gate_49 = StreamFreezeGate(Data=expression_50, PassingSwitch=expression_50, Freeze=True)
current_tab_18 = RemoteReceiver(current_tab)
current_tab_19 = RemoteReceiver(current_tab)
current_tab_20 = RemoteReceiver(current_tab)
current_tab_21 = RemoteReceiver(current_tab)
weather_visualization_show = RemoteSender(and_26)
setcheckbox = SetCheckBox(CheckBoxToModify=checkbox, NewValue=invert(freeze_gate_49))
expression_51 = Expression(x="Visualize module", y=current_tab_18, Expression="x≠y")
expression_52 = Expression(x="Visualize module", y=current_tab_20, Expression="x=y")
expression_53 = Expression(x="Visualize module", y=current_tab_21, Expression="x≠y")
expression_54 = Expression(x="Visualize module", y=current_tab_19, Expression="x=y")
and_27 = GateAnd(A=equals_9.Inequality, B=expression_52)
and_28 = GateAnd(A=equals_8.Inequality, B=expression_54)
and_29 = GateAnd(A=values_56.Values, B=invert(expression_51))
and_30 = GateAnd(A=values_51.Values, B=invert(expression_53))
and_31 = GateAnd(A=values_58.Values, B=invert(expression_51))
and_32 = GateAnd(A=values_55.Values, B=invert(expression_53))
event_52 = EventGate(Data=and_27)  # -> Data, IsNew
event_53 = EventGate(Data=and_28)  # -> Data, IsNew
face_attribute_visualize = RemoteSender(and_29)
room_energy_attribute_visualize = RemoteSender(and_30)
face_energy_attribute_visualize = RemoteSender(and_31)
room_attribute_visualize = RemoteSender(and_32)
weather_visualisation_bake = RemoteSender(event_52.Data)
run_weather_visualisation = RemoteSender(event_53.Data)

# ----
freeze_gate_50 = StreamFreezeGate(Data=expression_53, PassingSwitch=expression_53)
freeze_gate_51 = StreamFreezeGate(Data=expression_51, PassingSwitch=expression_51)
setcheckbox_2 = SetCheckBox(CheckBoxToModify=[checkbox_3, checkbox_2], NewValue=invert(freeze_gate_50))
setcheckbox_3 = SetCheckBox(CheckBoxToModify=[checkbox_4, checkbox_5], NewValue=invert(freeze_gate_51))
room_energy_attribute_visualize_2 = RemoteReceiver(room_energy_attribute_visualize)
face_energy_attribute_visualize_2 = RemoteReceiver(face_energy_attribute_visualize)
room_attribute_visualize_2 = RemoteReceiver(room_attribute_visualize)
face_attribute_visualize_2 = RemoteReceiver(face_attribute_visualize)
or_25 = GateOr(
    A=room_attribute_visualize_2,
    B=room_energy_attribute_visualize_2,
    C=face_attribute_visualize_2,
    D=face_energy_attribute_visualize_2)
event_54 = EventGate(Data=or_25)  # -> Data, IsNew

room_energy_attribute_visualize_3 = RemoteReceiver(room_energy_attribute_visualize)
face_energy_attribute_visualize_3 = RemoteReceiver(face_energy_attribute_visualize)
room_attribute_visualize_3 = RemoteReceiver(room_attribute_visualize)
face_attribute_visualize_3 = RemoteReceiver(face_attribute_visualize)

# ---- group: Analysis module (continued)
current_tab_22 = RemoteReceiver(current_tab)
current_tab_23 = RemoteReceiver(current_tab)
expression_55 = Expression(x="Analysis module", y=current_tab_22, Expression="x=y")
expression_56 = Expression(x="Analysis module", y=current_tab_23, Expression="x=y")
and_33 = GateAnd(A=equals_10.Inequality, B=expression_55)
and_34 = GateAnd(A=equals_11.Inequality, B=expression_56)
event_55 = EventGate(Data=and_33)  # -> Data, IsNew
event_56 = EventGate(Data=and_34)  # -> Data, IsNew
run_simple_energy_simulations = RemoteSender(event_55.Data)
run_daylight_simulations = RemoteSender(event_56.Data)

# ----
run_daylight_simulations_2 = RemoteReceiver(run_daylight_simulations)
run_daylight_simulations_3 = RemoteReceiver(run_daylight_simulations)

current_tab_24 = RemoteReceiver(current_tab)  # disabled
expression_57 = Expression(x=panel_108, y=current_tab_24, Expression="x=y")  # disabled
and_35 = GateAnd(A=equals_16.Inequality, B=expression_57)  # disabled
event_57 = EventGate(Data=and_35)  # -> Data, IsNew; disabled
calculate_glare_probability = RemoteSender(event_57.Data)  # disabled

current_tab_25 = RemoteReceiver(current_tab)  # disabled
expression_58 = Expression(x=panel_126, y=current_tab_25, Expression="x=y")  # disabled
and_36 = GateAnd(A=equals_17.Inequality, B=expression_58)  # disabled
event_58 = EventGate(Data=and_36)  # -> Data, IsNew; disabled
run_detailed_energy_simulations = RemoteSender(event_58.Data)  # disabled

refkv_5 = ReferenceByKeyValue(Key=gate_17.Target1, Val=graft(merge_11), lightweight=False, DisableAutoUpdate=True)
bang_10 = ExplodeTree(Data=refkv_5)  # -> Branch0, Branch1, Branch2, Branch3, Branch4
room = Geometry(bang_10.Branch0)
adjacent = Geometry(bang_10.Branch1)
context = Geometry(bang_10.Branch2)
windows = Geometry(bang_10.Branch3)
create_model_3 = RemoteReceiver(create_model_2)
py3_33 = Python3Script(update=create_model_3)  # -> timestamp
# ---------- py3_33: Python ----------
import datetime

timestamp = ' (' + str(datetime.datetime.now())[:-7] + ')'
timestamp = timestamp.replace(':', '.')
print(timestamp)
# ---------- end py3_33 ----------
post_rename_current_model_2 = RemoteReceiver(post_rename_current_model)
post_remove_current_model_2 = RemoteReceiver(post_remove_current_model)
update_honeybee_model_2 = RemoteReceiver(update_honeybee_model)
or_26 = GateOr(A=update_honeybee_model_2, B=post_remove_current_model_2, C=post_rename_current_model_2)
freeze_gate_52 = StreamFreezeGate(Data=py3_30, PassingSwitch=or_26)
py3_34 = Python3Script(folder=freeze_gate_52)  # -> model_names, files
# ---------- py3_34: Python ----------
import os

files = [str(folder + '\\' + f) for f in os.listdir(folder) if not os.path.isdir(os.path.join(folder, f))]

model_names = [f.split('\\')[-1][:-7] for f in files]
# ---------- end py3_34 ----------
cset_5 = CreateSet(List=py3_34.model_names)  # -> Set, Map
cset_6 = CreateSet(List=py3_34.files)  # -> Set, Map
current_all_created_models_names = RemoteSender(cset_5.Set)
null_37 = NullItem(Item=cset_6.Set)  # -> NullFlags, InvalidFlags, Description
item_19 = ListItem(List=null_37.NullFlags, Index=0, Wrap=True)
filter_43 = StreamFilter(Gate=item_19, Stream0=cset_6.Set, Stream1=empty_10)
show_honeybee_windows_3 = RemoteReceiver(show_honeybee_windows)
show_honeybee_context_3 = RemoteReceiver(show_honeybee_context)
show_honeybee_ground_3 = RemoteReceiver(show_honeybee_ground)
show_honeybee_floors_3 = RemoteReceiver(show_honeybee_floors)
show_honeybee_walls_3 = RemoteReceiver(show_honeybee_walls)
show_honeybee_roof_3 = RemoteReceiver(show_honeybee_roof)
lng_16 = ListLength(List=filter_43)
honeybee_model_exists = RemoteSender(lng_16)

honeybee_model_exists_2 = RemoteReceiver(honeybee_model_exists)
current_all_created_models_names_2 = RemoteReceiver(current_all_created_models_names)
current_all_created_models_names_3 = RemoteReceiver(current_all_created_models_names)
current_all_created_models_names_4 = RemoteReceiver(current_all_created_models_names)
mindex_5 = MemberIndex(Set=current_all_created_models_names_2, Member=rename_current_model_name_3)  # -> Index, Count
lng_17 = ListLength(List=current_all_created_models_names_3)
lng_18 = ListLength(List=current_all_created_models_names_4)
subtraction_12 = Subtraction(A=lng_17, B="1")
subtraction_13 = Subtraction(A=lng_18, B="1")
honeybee_model_exists_3 = RemoteReceiver(honeybee_model_exists)
honeybee_model_exists_4 = RemoteReceiver(honeybee_model_exists)
bool_46 = Boolean(invert(mindex_5.Count))
honeybee_model_exists_5 = RemoteReceiver(honeybee_model_exists)
filter_44 = StreamFilter(Gate=bool_46, Stream0=Slider(500, range=0..1000), Stream1=Slider(1000000, range=0..1000000))
filter_45 = StreamFilter(Gate=bool_46, Stream0="Model name already exists", Stream1=" ")
hideshow_22 = HideShowElement(ElementToHideShow=pulldown, Show=honeybee_model_exists_4, Collapse=True, Disable=False)
honeybee_model_exists_6 = RemoteReceiver(honeybee_model_exists)
honeybee_model_exists_7 = RemoteReceiver(honeybee_model_exists)
hideshow_23 = HideShowElement(ElementToHideShow=pulldown_3, Show=honeybee_model_exists_5, Collapse=True, Disable=False)
tooltip_9 = AttachTooltipToElement(ElementsToAttachTo=button_13, TooltipContent=filter_45, ShowDelay=filter_44, Duration=2000)
hideshow_24 = HideShowElement(ElementToHideShow=button_14, Show=honeybee_model_exists_7, Collapse=True, Disable=False)
hideshow_25 = HideShowElement(ElementToHideShow=button_13, Show=honeybee_model_exists_6, Collapse=True, Disable=mindex_5.Count)
room_geometries = RemoteSender(bang_10.Branch0)
cluster_6 = Cluster_7(id=windows)
cluster_7 = Cluster_7(id=context)
cluster_8 = Cluster_7(id=adjacent)
cluster_9 = Cluster_7(id=room)
freeze_gate_53 = StreamFreezeGate(Data=create_model_3, PassingSwitch=create_model_3)
py3_35 = Python3Script(files=py3_34.files)  # -> out, newest_index; inputs files: list
# ---------- py3_35: Python ----------
""" Checks which of the input files was modified last"""

import os

m = -1
for i, f in enumerate(files):
    t = os.path.getmtime(f)
    # print (f, t)
    if t > m:
        m = t
        newest_index = i
# ---------- end py3_35 ----------

# ----
# Models created in the
# the current folder
panel_182 = Panel(py3_34.model_names)

current_all_created_models_names_5 = RemoteReceiver(current_all_created_models_names)
current_all_created_models_names_6 = RemoteReceiver(current_all_created_models_names)

# ---- group: Assembly model (continued)
current_all_created_models_names_7 = RemoteReceiver(current_all_created_models_names)
lng_19 = ListLength(List=current_all_created_models_names_7)
subtraction_14 = Subtraction(A=lng_19, B="1")
honeybee_model_exists_8 = RemoteReceiver(honeybee_model_exists)
hideshow_26 = HideShowElement(ElementToHideShow=pulldown_4, Show=honeybee_model_exists_8, Collapse=invert(True), Disable=False)
honeybee_model_exists_9 = RemoteReceiver(honeybee_model_exists)
bool_47 = Boolean(honeybee_model_exists_9)
honeybee_model_exists_10 = RemoteReceiver(honeybee_model_exists)
honeybee_model_exists_11 = RemoteReceiver(honeybee_model_exists)
filter_46 = StreamFilter(Gate=bool_47, Stream0="Create model", Stream1="Create new model")
setbtn = SetButton(ButtonToModify=button_15, ButtonName=filter_46)
hideshow_27 = HideShowElement(ElementToHideShow=textbox_7, Show=honeybee_model_exists_10, Collapse=True, Disable=False)
hideshow_28 = HideShowElement(ElementToHideShow=border_4, Show=honeybee_model_exists_11, Collapse=invert(True), Disable=False)

# ----
number_slider_69 = Slider(10, range=0..10)  # disabled
number_slider_70 = Slider(10, range=0..10)  # disabled
py3_36 = Python3Script(x=number_slider_69, y=number_slider_70)  # -> out, a; inputs x: Int32, y: Int32; disabled
# ---------- py3_36: Python ----------
import Rhino.Geometry as rg

pts = []

for i in range (0,x):
    for j in range (0,y):
        pts.append(rg.Point2d(i,j))

a = pts
# ---------- end py3_36 ----------

# ----
# Heath module info
panel_183 = Panel("""Energy use intensity (EUI): EUI measures the total energy consumed by a building annually per unit of its floor area.
Annual energy balance: A yearly overview of energy consumption and generation broken into categories such as heating, cooling, lighting, and equipment loads.
Daily cooling/heating profile: Hourly cooling or heating energy usage over a typical day.
Cooling/heating balance: The cooling or heating energy demand broken down by contributing factors across different periods.""")
panel_184 = Panel("Adjust the Window-to-Wall Ratio (WWR) slider to define the proportion of walls occupied by windows in the model. This determines window placement automatically. If diabled, windows that are maunally imported in the geometry module will be used.")
panel_185 = Panel("""Room attribute: Choose a property of the room to visualize and toggle its visibility using the "Show" checkbox.
Room energy attribute: Select energy-related attributes for rooms.
Face attribute: Visualize specific attributes for individual faces.
Face energy attribute: Display energy-specific properties for faces.""")
panel_186 = Panel("""By climate: Choose a predefined climate zone to automatically adjust construction properties for environmental conditions.

By type: Select the construction type that represents the structural system of the building.""")
panel_187 = Panel("""Building Type: Choose the type of building that corresponds to your model.

Room Type: Select the specific room type within the chosen building category.""")
panel_188 = Panel("""This dropdown menu allows you to select the type of geometry you want to work with in the model.

Room: Represents enclosed spaces or areas in the model.
Window: Refers to transparent surfaces, such as glass panels or openings.
Adjacent: Defines surfaces or spaces that are directly connected or neighboring the selected geometry.
Context: Includes external elements like surrounding structures or objects.""")
panel_189 = Panel("""Sky Dome: A 3D view of the sky with solar paths and light distribution.
Sky Mask: Shows visible portions of the sky from a location.
Wind Rose: Visualizes wind direction and speed.
Dry bulb temperature line chart: This chart shows the average daily dry bulb temperature variation throughout the year.
Dry bulb temperature 2D chart: This heatmap provides a detailed view of temperature variations by time of day and month.
Direct Sun Hours: Displays the total number of hours a surface receives direct sunlight throughout the year.
Incident Radiation: Represents the amount of solar radiation (in kWh/m²) received by the surface over the year.""")
panel_190 = Panel("""Spatial daylight autonomy (sDA): Shows the percentage of space that meets the daylight autonomy criteria.
Illuminance [Lux]: The intensity of light falling on a surface, measured in lumens per square meter.
Useful daylight illuminance (UDI): The percentage of time daylight levels fall within a desirable range (e.g., 50–3000 lux).""")
panel_191 = Panel("Assesses the environmental impact by calculating global warming potential (GWP) and visualizing contributions by model elements.")
panel_192 = Panel("""Current location: Displays the project's location .
Set location: Copy and paste from the website that is opened with the "Get clmate data" button, to retrieve climate data relevant to your project.
Get climate data: This button opens this website 
https://www.ladybug.tools/epwmap/""")
panel_193 = Panel("""Create new model: Create a new Honeybee model from the current imported geometry. Click the "update" button to load it into the UI.
Update: Load all of the models corresponding to this file, this can include models from previous sessions.
Remove current model: Delete the currently selected model.
Rename: Rename the currently selected model.""")
panel_194 = Panel("""Cooling Setpoint: Set the temperature at which cooling systems activate.

Heating Setpoint: Set the temperature at which heating systems activate.

Occupancy: Specify the expected number of occupants per 100 square meters.""")
panel_195 = Panel("""Window database: Access a library of window types with predefined thermal and solar properties.

Material database: Browse and select building materials with specific physical and thermal characteristics.

Construction database: Explore various construction assemblies and details for walls, roofs, and other elements.""")
panel_196 = Panel("Customize specific construction elements such as floors, walls and roofs by selecting from a list of options with their respective properties.")
info_save_geometry_2 = RemoteReceiver(info_save_geometry)
panel_197 = Panel("""Use this button to save the imported geometry as part of the Honeybee 
model. This ensures the geometry data is correctly stored and can be utilized for further analysis or visualization within the Heath.""")
panel_198 = Panel("This button generates a predefined sample model to help you explore and understand the tools features. Use it to test workflows, visualize geometry types, and familiarize yourself with the simulation processes before working with your own data.")
rec_23 = DataRecorder(info_save_geometry_2, DataLimit=-2, RecordData=True)
ma_15 = MassAddition(Input=rec_23)  # -> Result, PartialResults
entwine_118 = Entwine(Branch00=panel_185, Branch01=panel_189, FlattenInputs=True)  # -> flatten(Result)
entwine_119 = Entwine(Branch00=panel_183, Branch01=panel_190, Branch02=panel_191, FlattenInputs=True)  # -> flatten(Result)
entwine_120 = Entwine(Branch00="Model Visualization", Branch01="Weather Visualization", FlattenInputs=True)  # -> flatten(Result)
entwine_121 = Entwine(Branch00="Energy simulation", Branch01="Daylight simulation", Branch02="LCA", FlattenInputs=True)  # -> flatten(Result)
entwine_122 = Entwine(Branch00=panel_184, Branch01=panel_192, Branch02=panel_193, FlattenInputs=True)  # -> flatten(Result)
entwine_123 = Entwine(Branch00="Generate Windows Using WWR", Branch01="Location", Branch02="Model actions", FlattenInputs=True)  # -> flatten(Result)
entwine_124 = Entwine(Branch00=panel_187, Branch01=panel_194, FlattenInputs=True)  # -> flatten(Result)
entwine_125 = Entwine(Branch00=panel_186, Branch01=panel_195, Branch02=panel_196, FlattenInputs=True)  # -> flatten(Result)
entwine_126 = Entwine(Branch00="Select program", Branch01="Program settings", FlattenInputs=True)  # -> flatten(Result)
entwine_127 = Entwine(Branch00="Select Base Construction", Branch01="Databases", Branch02="Select Subset Constructions", FlattenInputs=True)  # -> flatten(Result)
entwine_128 = Entwine(Branch00="Geometry type", Branch01="Save Geometry", Branch02="Create test model", FlattenInputs=True)  # -> flatten(Result)
entwine_129 = Entwine(Branch00=panel_188, Branch01=panel_197, Branch02=panel_198, FlattenInputs=True)  # -> flatten(Result)
tb_24 = CreateTextBlock(TextSize=12, Justification=0)
label_45 = CreateLabel(LabelSize=18, Justification=0)
tb_25 = CreateTextBlock(TextSize=12, Justification=0)
tb_26 = CreateTextBlock(TextSize=12, Justification=0)
label_46 = CreateLabel(LabelSize=18, Justification=0)
label_47 = CreateLabel(LabelSize=18, Justification=0)
current_tab_index_3 = RemoteReceiver(current_tab_index)
filter_47 = StreamFilter(
    Gate=current_tab_index_3,
    Stream0=entwine_128,
    Stream1=entwine_126,
    Stream2=entwine_127,
    Stream3=entwine_123,
    Stream4=entwine_120,
    Stream5=entwine_121)
filter_48 = StreamFilter(
    Gate=current_tab_index_3,
    Stream0=entwine_129,
    Stream1=entwine_124,
    Stream2=entwine_125,
    Stream3=entwine_122,
    Stream4=entwine_118,
    Stream5=entwine_119)
format_31 = Format(
    Format="{0}, {1}, {2}, {3}",
    Culture=127,
    Data0=Slider(10, range=-10..10),
    Data1=Slider(0, range=-10..10),
    Data2=Slider(0, range=-10..10),
    Data3=Slider(0, range=-10..10))
format_32 = Format(
    Format="{0}, {1}, {2}, {3}",
    Culture=127,
    Data0=Slider(0, range=-10..10),
    Data1=Slider(10, range=-10..10),
    Data2=Slider(0, range=-10..10),
    Data3=Slider(0, range=-10..10))
entwine_130 = Entwine(Branch00=label_46, Branch01=tb_25, FlattenInputs=True)  # -> flatten(Result)
entwine_131 = Entwine(Branch00=label_45, Branch01=tb_24, FlattenInputs=True)  # -> flatten(Result)
entwine_132 = Entwine(Branch00=label_47, Branch01=tb_26, FlattenInputs=True)  # -> flatten(Result)
adjustpos_121 = AdjustElementPositioning(ElementsToAdjust=[tb_24, tb_26, tb_25], Margin=format_31, AbsolutePositioning=False, HorizontalAlignment=0)
adjustpos_122 = AdjustElementPositioning(ElementsToAdjust=[label_47, label_46], Margin=format_32, AbsolutePositioning=False, HorizontalAlignment=0)
setlabel_3 = SetLabelContents(LabelToModify=[label_45, label_47, label_46], NewLabelContents=filter_47)
settextblock_11 = SetTextBlockContents(TextBlockToModify=[tb_24, tb_26, tb_25], NewTextBlockContents=filter_48)
stack_83 = CreateStack(UIElements=entwine_130, Horizontal=invert(True))
stack_84 = CreateStack(UIElements=entwine_131, Horizontal=invert(True))
stack_85 = CreateStack(UIElements=entwine_132, Horizontal=invert(True))
entwine_133 = Entwine(Branch00=stack_84, Branch01=stack_85, Branch02=stack_83, FlattenInputs=True)  # -> flatten(Result)
database_modal_location_8 = RemoteReceiver(database_modal_location)
heath_accent_color_15 = RemoteReceiver(heath_accent_color)
info_save_geometry_3 = RemoteReceiver(info_save_geometry)

# ----
# Recursion
panel_199 = Panel("Geometry info")
objbynn_12 = GetObjectByNickname(NickName=panel_199)
geometry_info = Python3Script()  # -> status; same code as lca_window_status

entwine_134 = Entwine(Branch00=ma_15.Result, Branch01=geometry_info, FlattenInputs=True)
rec_24 = DataRecorder(entwine_134, DataLimit=2, RecordData=True)
item_20 = ListItem(List=rec_24, Index=0, Wrap=True)  # -> Item2, Item1, Item
equals_34 = Equality(FirstNumber=item_20.Item2, SecondNumber=item_20.Item1)  # -> Equality, Inequality
bang_11 = ExplodeTree(Data=equals_34.Inequality)  # -> Branch0, Branch1
py3_37 = Python3Script(x=bang_11.Branch0, y=bang_11.Branch1)  # -> a; same code as py3_6
event_59 = EventGate(Data=py3_37)  # -> Data, IsNew
freeze_gate_54 = StreamFreezeGate(Data=py3_37, PassingSwitch=event_59.IsNew)
event_60 = EventGate(Data=freeze_gate_54)  # -> Data, IsNew
panel_200 = Panel(event_60.Data)
launchwin_10 = LaunchWindow(
    Show=event_60.Data,
    Name="Module information",
    Width=Slider(430, range=0..1200),
    Height=Slider(450, range=0..1000),
    ChildStatus=1,
    EnableHorizScroll=False)
winstat_10 = WindowStatus(Window=launchwin_10)
winprops_10 = SetWindowProperties(
    Window=launchwin_10,
    StartingLocation=database_modal_location_8,
    Theme=0,
    AccentColor=heath_accent_color_15,
    ShowTitleBar=True,
    BackgroundColor=RGB(255, 255, 255),
    ScaleFactor=1)
geometry_info_status = RemoteSender(winstat_10)
py3_38 = Python3Script(window=launchwin_10, activate=info_save_geometry_3)  # same code as py3_7
addelems_11 = AddElements(Window=launchwin_10, Elements=flatten(entwine_133), DoVLChecking=True)  # -> AddedElements, ElementNames

geometry_info_status_2 = RemoteReceiver(geometry_info_status)
expression_59 = Expression(x="Hidden", y=geometry_info_status_2, Expression="x=y")
expire_9 = ExpireObject(ObjectToExpire=objbynn_12, Expire=expression_59)

# ----
# Create material tooltip
panel_201 = Panel(":")

# ----
# Create construction tooltip
panel_202 = Panel(":")

# ----
# Backend data inside layers
panel_203 = Panel("0, 0, 0")
path = DataPath(panel_203)
path_2 = DataPath("0, 0, 0")

# ----
# Create window tooltip
number_slider_71 = Slider(0, range=0..100)
dom_4 = ConstructDomain(DomainStart=number_slider_71, DomainEnd=Slider(12, range=0..100))
dom_5 = ConstructDomain(DomainStart=Slider(0, range=0..100), DomainEnd=Slider(1, range=0..100))

# ----
# Remove material
pre_material_database_remove_material_2 = RemoteReceiver(pre_material_database_remove_material)
cull_11 = CullPattern(List=pre_material_database_remove_material_2, CullPattern=pre_material_database_remove_material_2)
lng_20 = ListLength(List=cull_11)
filter_49 = StreamFilter(Gate=lng_20, Stream0="False", Stream1=cull_11)
freeze_gate_55 = StreamFreezeGate(Data=pre_material_database_remove_material_2, PassingSwitch=filter_49, Freeze=True, Hold=False)
material_database_remove_material_2 = RemoteReceiver(material_database_remove_material)
getdocumentusertext_10 = Python3Script(run=material_database_remove_material_2, key="Heath materials")  # -> json_string; same code as getdocumentusertext
split_7 = TextSplit(Text=getdocumentusertext_10, Separators="|")
strtoobj_5 = HBStringToObject(hb_str=split_7)  # -> flatten(hb_obj); plug-in component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
decnstrmat_2 = HBDeconstructMaterial(mat=strtoobj_5)  # -> values, attr_names, r_val_si, r_val_ip; plug-in component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
item_21 = ListItem(List=decnstrmat_2.values, Index=0, Wrap=True)  # -> flatten(Item)
cset_7 = CreateSet(List=item_21)  # -> Set, Map
lng_21 = ListLength(List=cset_7.Set)
larger = LargerThan(FirstNumber=lng_21, SecondNumber="1")  # -> LargerThan, OrEqualTo
bool_48 = Boolean(larger.LargerThan)

# ----
# Backend visible layers
panel_204 = Panel("1")
neg = Negative(Value=panel_204)
starting_layers = Slider(1, range=0..6)

py3_39 = Python3Script(x=freeze_gate_53)  # -> folder; same code as py3_30

# ----
# Create construction
panel_205 = Panel("""Layer 1
Layer 2
Layer 3
Layer 4
Layer 5
Layer 6""")
textbox_10 = CreateTextBox(Label="Name", DefaultText="New construction", UpdateButton=invert(True), showLabel=True)
lng_22 = ListLength(List=panel_205)
values_132 = ValueListener(Elements=textbox_10, SomeProperty=True)  # -> Values, Indices
empty_11 = EmptyObjectToEmptyBranch()
label_48 = CreateLabel(LabelText="[Innermost layer]", LabelSize=12, Justification=0)
button_46 = CreateButton(ButtonName="+", ButtonStyle=3)
button_47 = CreateButton(ButtonName="Create construction", ButtonStyle=0)
label_49 = CreateLabel(LabelText="[Outermost layer]", LabelSize=12, Justification=0)
label_50 = CreateLabel(LabelText=panel_205, LabelSize=18, Justification=0)
empty_12 = EmptyObjectToEmptyBranch()
construction_maximum_layer_limit = RemoteSender(lng_22)
construction_maximum_layer_limit_2 = RemoteReceiver(construction_maximum_layer_limit)
subtraction_15 = Subtraction(A=construction_maximum_layer_limit_2, B="1")
repeat_12 = RepeatData(Data="Material", Length=construction_maximum_layer_limit_2)
repeat_13 = RepeatData(Data="X", Length=construction_maximum_layer_limit_2)
repeat_14 = RepeatData(Data="⇕", Length=subtraction_15)
repeat_15 = RepeatData(Data="Thickness [m]", Length=construction_maximum_layer_limit_2)
panel_206 = Panel(values_132.Values)
create_construction_name = RemoteSender(values_132.Values)
button_48 = CreateButton(ButtonName=repeat_13, ButtonStyle=3)
values_133 = ValueListener(Elements=button_46, SomeProperty=True)  # -> Values, Indices
values_134 = ValueListener(Elements=button_47, SomeProperty=True)  # -> Values, Indices
button_49 = CreateButton(ButtonName=repeat_14, ButtonStyle=3)
pulldown_27 = CreatePulldownMenu(Label=repeat_12, ListItems=empty_12, showLabel=True)
textbox_11 = CreateTextBox(Label=repeat_15, DefaultText=Slider(0.25, range=0.01..1), UpdateButton=invert(True), showLabel=True)
values_135 = ValueListener(Elements=button_48, SomeProperty=True)  # -> flatten(Values), Indices
cull_12 = CullPattern(List=values_135.Values, CullPattern=values_135.Values)
lng_23 = ListLength(List=cull_12)
filter_50 = StreamFilter(Gate=lng_23, Stream0="False", Stream1=cull_12)
add_layer = RemoteSender(values_133.Values)
values_136 = ValueListener(Elements=button_49, SomeProperty=True)  # -> flatten(Values), Indices
cull_13 = CullPattern(List=values_136.Values, CullPattern=values_136.Values)
lng_24 = ListLength(List=cull_13)
filter_51 = StreamFilter(Gate=lng_24, Stream0="False", Stream1=cull_13)
create_construction = RemoteSender(values_134.Values)
values_137 = ValueListener(Elements=pulldown_27, SomeProperty=True)  # -> Values, Indices
values_138 = ValueListener(Elements=textbox_11, SomeProperty=True)  # -> Values, Indices
freeze_gate_56 = StreamFreezeGate(Data=filter_51, PassingSwitch=invert(filter_51))
merge_12 = Merge(Data1=simplify(graft(label_50)), Data2=simplify(graft(button_48)))
merge_13 = Merge(Data1=simplify(graft(pulldown_27)), Data2=simplify(graft(textbox_11)))
freeze_gate_57 = StreamFreezeGate(Data=filter_50, PassingSwitch=invert(filter_50))
create_construction_materials = RemoteSender(values_137.Indices)
pre_switch_layer = RemoteSender(values_136.Values)
create_construction_thickness = RemoteSender(values_138.Values)
pre_remove_layer = RemoteSender(values_135.Values)
bool_49 = Boolean(invert(freeze_gate_56))
bool_50 = Boolean(invert(freeze_gate_57))
stack_86 = CreateStack(UIElements=merge_13, Horizontal=True)
stack_87 = CreateStack(UIElements=merge_12, Horizontal=True)
tap_19 = TapBuffer(Reset=False, Incremental=True, Valve=bool_49, Hold=True)
tap_20 = TapBuffer(Reset=False, Incremental=True, Valve=bool_50, Hold=True)
dam_24 = DataDam(DataA=tap_19, BufferDelay=2500000, BufferMode=2)
dam_25 = DataDam(DataA=tap_20, BufferDelay=2500000, BufferMode=2)
equals_35 = Equality(FirstNumber=tap_19, SecondNumber=dam_24)  # -> Equality, Inequality
equals_36 = Equality(FirstNumber=tap_20, SecondNumber=dam_25)  # -> Equality, Inequality
event_61 = EventGate(Data=equals_35.Inequality)  # -> Data, IsNew
event_62 = EventGate(Data=equals_36.Inequality)  # -> Data, IsNew
merge_14 = Merge(Data1=simplify(stack_87), Data2=simplify(stack_86), Data3=simplify(graft(button_49)))
entwine_135 = Entwine(Branch00=textbox_10, FlattenInputs=True)  # -> flatten(Result)
switch_layer = RemoteSender(event_61.Data)
adjustpos_123 = AdjustElementPositioning(
    ElementsToAdjust=textbox_10,
    Margin="0, 0, 0, 5",
    AbsolutePositioning=False,
    Width=Slider(190, range=0..300),
    HorizontalAlignment=0)
adjustpos_124 = AdjustElementPositioning(
    ElementsToAdjust=pulldown_27,
    AbsolutePositioning=False,
    Width=Slider(190, range=0..300),
    HorizontalAlignment=0,
    VerticalAlignment=2)
adjustpos_125 = AdjustElementPositioning(
    ElementsToAdjust=textbox_11,
    Margin="0, 5, 0, 0",
    AbsolutePositioning=False,
    Width=Slider(120, range=0..300),
    HorizontalAlignment=0,
    VerticalAlignment=2)
adjustpos_126 = AdjustElementPositioning(
    ElementsToAdjust=button_46,
    Margin="10, 5, 0, 0",
    AbsolutePositioning=False,
    Width=Slider(32, range=0..300),
    Height=Slider(32, range=0..300),
    HorizontalAlignment=0)
remove_layer = RemoteSender(event_62.Data)
adjustpos_127 = AdjustElementPositioning(
    ElementsToAdjust=button_49,
    Margin="5, 0, 0, 0",
    AbsolutePositioning=False,
    Width=Slider(26, range=0..300),
    Height=Slider(26, range=0..300),
    HorizontalAlignment=0,
    VerticalAlignment=2)
adjustelem_22 = AdjustElementAppearance(ElementsToAdjust=button_49, Foreground=ColourSwatch(SwatchColor=RGBA(38, 38, 38, 193)), FontSize=Slider(19, range=0..50))
adjustpos_128 = AdjustElementPositioning(
    ElementsToAdjust=button_48,
    AbsolutePositioning=False,
    Width=Slider(26, range=0..300),
    Height=Slider(26, range=0..300),
    HorizontalAlignment=0)
adjustelem_23 = AdjustElementAppearance(ElementsToAdjust=button_46, Foreground=ColourSwatch(SwatchColor=RGB(15, 178, 0)), FontSize=Slider(21, range=0..50))
adjustelem_24 = AdjustElementAppearance(ElementsToAdjust=button_48, Foreground=ColourSwatch(SwatchColor=RGB(255, 0, 0)), FontSize=Slider(12, range=0..50))
adjustpos_129 = AdjustElementPositioning(ElementsToAdjust=button_47, Margin="0, 10, 0, 0", AbsolutePositioning=False, HorizontalAlignment=1, VerticalAlignment=2)

pre_remove_layer_2 = RemoteReceiver(pre_remove_layer)
pre_switch_layer_2 = RemoteReceiver(pre_switch_layer)
create_construction_materials_2 = RemoteReceiver(flatten(create_construction_materials))
create_construction_thickness_2 = RemoteReceiver(flatten(create_construction_thickness))
cull_14 = CullPattern(List=pre_remove_layer_2, CullPattern=pre_remove_layer_2)
cull_15 = CullPattern(List=pre_switch_layer_2, CullPattern=pre_switch_layer_2)
add_layer_2 = RemoteReceiver(add_layer)
mindex_6 = MemberIndex(Set=pre_remove_layer_2, Member=cull_14)  # -> Index, Count
mindex_7 = MemberIndex(Set=pre_switch_layer_2, Member=cull_15)  # -> Index, Count
py3_40 = Python3Script(
    add_layer=add_layer_2,
    remove_layer=mindex_6.Index,
    switch_layer=mindex_7.Index,
    materials=create_construction_materials_2,
    thickness=create_construction_thickness_2)  # -> out_materials, out_thickness; inputs materials: list, thickness: list
# ---------- py3_40: Python ----------
def add_layers():
    thickness.append(0.25)
    out_thickness = thickness
    
def remove_layers():
    materials.pop(remove_layer)
    thickness.pop(remove_layer)

def switch_layers():
    temp_materials = materials[switch_layer]
    materials[switch_layer] = materials[switch_layer+1]
    materials[switch_layer+1] = temp_materials

    temp_thickness = thickness[switch_layer]
    thickness[switch_layer] = thickness[switch_layer+1]
    thickness[switch_layer+1] = temp_thickness
    

if add_layer:
    add_layers()

elif remove_layer is not None:
    remove_layers()
    out_materials = materials
    out_thickness = thickness

elif switch_layer is not None:
    switch_layers()
    out_materials = materials
    out_thickness = thickness
else:
    out_materials = None
    out_thickness = None
# ---------- end py3_40 ----------
branch = TreeBranch(Tree=py3_40.out_thickness, Path=path, MaintainPaths=True)
branch_2 = TreeBranch(Tree=py3_40.out_materials, Path=path_2, MaintainPaths=True)
lng_25 = ListLength(List=branch_2)
lng_26 = ListLength(List=branch)
bool_51 = Boolean(lng_26)
bool_52 = Boolean(lng_25)
gate_27 = StreamGate(Stream=branch, Gate=bool_51)  # -> Target0, Target1
gate_28 = StreamGate(Stream=branch_2, Gate=bool_52)  # -> Target0, Target1
hold_3 = HoldingGate(Data=gate_27.Target1)
hold_4 = HoldingGate(Data=gate_28.Target1)
hasdata_7 = DataExists(Data=hold_3)
hasdata_8 = DataExists(Data=hold_4)
timeshift = TimeShifter(Data=hold_3, Capacity="1")
timeshift_2 = TimeShifter(Data=hold_4, Capacity="1")
bool_53 = Boolean(hasdata_7)
bool_54 = Boolean(hasdata_8)
remove_layer_2 = RemoteReceiver(remove_layer)
switch_layer_2 = RemoteReceiver(switch_layer)
filter_52 = StreamFilter(Gate=bool_53, Stream0=timeshift, Stream1=hold_3)
filter_53 = StreamFilter(Gate=bool_54, Stream0=timeshift_2, Stream1=hold_4)
entwine_136 = Entwine(Branch00=filter_53, Branch01=filter_52, FlattenInputs=True)
or_27 = GateOr(A=switch_layer_2, B=remove_layer_2)
gate_29 = StreamGate(Stream=entwine_136, Gate=or_27)  # -> Target0, Target1
bang_12 = ExplodeTree(Data=gate_29.Target1)  # -> Branch0, Branch1

add_layer_3 = RemoteReceiver(add_layer)
remove_layer_3 = RemoteReceiver(flatten(remove_layer))
construction_maximum_layer_limit_3 = RemoteReceiver(construction_maximum_layer_limit)
gate_30 = StreamGate(Stream=panel_204, Gate=add_layer_3)  # -> Target0, Target1
gate_31 = StreamGate(Stream=neg, Gate=remove_layer_3)  # -> Target0, Target1
rec_25 = DataRecorder([gate_30.Target1, gate_31.Target1], DataLimit=-10, RecordData=True)
py3_41 = Python3Script(numbers=[starting_layers, rec_25], maximum_layers=construction_maximum_layer_limit_3)  # -> visible_layers_arrows, visible_layers; inputs numbers: list of Int32, maximum_layers: Int32
# ---------- py3_41: Python ----------
current_sum = 0

for number in numbers:
    if (number == 1) and (current_sum >= maximum_layers):
        continue
    if (number == -1) and (current_sum <= 1):
        continue
    else:
        current_sum += number

visible_layers = [True]*current_sum
visible_layers.extend([False]*(maximum_layers-current_sum))
visible_layers_arrows = visible_layers[1:]
# ---------- end py3_41 ----------
visible_layers = RemoteSender(simplify(graft(py3_41.visible_layers)))
visible_layers_arrows = RemoteSender(py3_41.visible_layers_arrows)

create_construction_name_2 = RemoteReceiver(create_construction_name)
create_construction_name_3 = RemoteReceiver(create_construction_name)
py3_42 = Python3Script(name=create_construction_name_3)  # -> not_valid; inputs name: String
# ---------- py3_42: Python ----------
if 'å' in name:
    not_valid = True
elif 'ä' in name:
    not_valid = True
elif 'ö' in name:
    not_valid = True
else:
    not_valid = False
# ---------- end py3_42 ----------
gate_32 = StreamGate(Stream="'å', 'ä' and 'ö' are not allowed", Gate=py3_42)  # -> Target0, Target1

# ----
# Add construction
create_construction_materials_3 = RemoteReceiver(create_construction_materials)
create_construction_thickness_3 = RemoteReceiver(create_construction_thickness)
visible_layers_2 = RemoteReceiver(visible_layers)
create_construction_name_4 = RemoteReceiver(create_construction_name)
repeat_16 = RepeatData(Data=create_construction_thickness_3, Length=visible_layers_2)  # -> flatten(Data)
create_construction_2 = RemoteReceiver(create_construction)
getdocumentusertext_11 = Python3Script(run=create_construction_2, key="Heath constructions")  # -> json_string; same code as getdocumentusertext

# ----
# Create material
number_slider_72 = Slider(3, range=0..10)
material_database_categories_7 = RemoteReceiver(material_database_categories_2)
textbox_12 = CreateTextBox(Label="Name", DefaultText="New material", UpdateButton=invert(True), showLabel=True)
textbox_13 = CreateTextBox(DefaultText=Slider(0.036, range=0..2), UpdateButton=invert(True), showLabel=False)
label_51 = CreateLabel(LabelText="Conductivity [W/m-K]", LabelSize=12, Justification=0)
pulldown_28 = CreatePulldownMenu(Label="Material category", ListItems=material_database_categories_7, SelectedIndex=number_slider_72, showLabel=True)
textbox_14 = CreateTextBox(DefaultText=Slider(28, range=0..1000), UpdateButton=invert(True), showLabel=False)
true_button_19 = CreateTrueOnlyButton(ButtonName="?", ButtonStyle=2)
button_50 = CreateButton(ButtonName="Create material", ButtonStyle=0)
textbox_15 = CreateTextBox(DefaultText=Slider(1500, range=0..10000), UpdateButton=invert(True), showLabel=False)
label_52 = CreateLabel(LabelText="A1-A3 [kg CO2eq/kg]", LabelSize=12, Justification=0)
label_53 = CreateLabel(LabelText="Specific heat [J/kg-K]", LabelSize=12, Justification=0)
label_54 = CreateLabel(LabelText="Density [kg/m3]", LabelSize=12, Justification=0)
values_139 = ValueListener(Elements=textbox_12, SomeProperty=True)  # -> Values, Indices
values_140 = ValueListener(Elements=true_button_19, SomeProperty=True)  # -> Values, Indices
values_141 = ValueListener(Elements=textbox_13, SomeProperty=True)  # -> Values, Indices
values_142 = ValueListener(Elements=button_50, SomeProperty=True)  # -> Values, Indices
values_143 = ValueListener(Elements=pulldown_28, SomeProperty=True)  # -> Values, Indices
values_144 = ValueListener(Elements=textbox_14, SomeProperty=True)  # -> Values, Indices
values_145 = ValueListener(Elements=textbox_15, SomeProperty=True)  # -> Values, Indices
create_material_name = RemoteSender(values_139.Values)
freeze_gate_58 = StreamFreezeGate(Data=values_142.Values, PassingSwitch=invert(values_142.Values))
create_material_conductivity = RemoteSender(values_141.Values)
info_create_material = RemoteSender(values_140.Values)
create_material_category = RemoteSender(values_143.Values)
entwine_137 = Entwine(Branch00=label_51, Branch01=textbox_13, FlattenInputs=True)  # -> flatten(Result)
create_material_density = RemoteSender(values_144.Values)
create_material_sprecific_heat = RemoteSender(values_145.Values)
entwine_138 = Entwine(Branch00=label_53, Branch01=textbox_15, FlattenInputs=True)  # -> flatten(Result)
entwine_139 = Entwine(Branch00=label_54, Branch01=textbox_14, FlattenInputs=True)  # -> flatten(Result)
bool_55 = Boolean(invert(freeze_gate_58))
stack_88 = CreateStack(UIElements=entwine_137, Horizontal=True)
entwine_140 = Entwine(Branch00=label_52, Branch01=textbox_3, FlattenInputs=True)  # -> flatten(Result)
tap_21 = TapBuffer(Reset=False, Incremental=True, Valve=bool_55, Hold=True)
dam_26 = DataDam(DataA=tap_21, BufferDelay=2500000, BufferMode=2)
create_material_modal_2 = RemoteReceiver(create_material_modal)
adjustelem_25 = AdjustElementAppearance(
    ElementsToAdjust=true_button_19,
    Foreground=ColourSwatch(SwatchColor=RGB(0, 0, 0)),
    Background=ColourSwatch(SwatchColor=RGB(230, 230, 230)),
    FontSize=Slider(12, range=0..300))
equals_37 = Equality(FirstNumber=tap_21, SecondNumber=dam_26)  # -> Equality, Inequality
and_37 = GateAnd(A=equals_37.Inequality, B=create_material_modal_2)
number_slider_73 = Slider(29, range=0..300)
event_63 = EventGate(Data=and_37)  # -> Data, IsNew
entwine_141 = Entwine(Branch00=textbox_12, Branch01=true_button_19, FlattenInputs=True)  # -> flatten(Result)
stack_89 = CreateStack(UIElements=entwine_139, Horizontal=True)
stack_90 = CreateStack(UIElements=entwine_138, Horizontal=True)
create_material = RemoteSender(event_63.Data)
stack_91 = CreateStack(UIElements=entwine_141, Horizontal=True)
adjustpos_130 = AdjustElementPositioning(
    ElementsToAdjust=textbox_12,
    Margin="0, 5, 0, 10",
    AbsolutePositioning=False,
    Width=Slider(185, range=0..300),
    HorizontalAlignment=0)
adjustpos_131 = AdjustElementPositioning(
    ElementsToAdjust=true_button_19,
    Margin="5, -5, 0, 0",
    AbsolutePositioning=False,
    Width=number_slider_73,
    Height=number_slider_73)
adjustpos_132 = AdjustElementPositioning(ElementsToAdjust=pulldown_28, AbsolutePositioning=False, Width=Slider(225, range=0..300), HorizontalAlignment=0)
adjustpos_133 = AdjustElementPositioning(
    ElementsToAdjust=[label_52, label_53, label_54, label_51, label_8, label_9],
    AbsolutePositioning=False,
    Width=Slider(150, range=0..300),
    HorizontalAlignment=0,
    VerticalAlignment=2)
adjustpos_134 = AdjustElementPositioning(
    ElementsToAdjust=[textbox_15, textbox_14, textbox_13, textbox_3, textbox, textbox_2],
    AbsolutePositioning=False,
    Width=Slider(50, range=0..300),
    HorizontalAlignment=0,
    VerticalAlignment=2)
adjustpos_135 = AdjustElementPositioning(ElementsToAdjust=button_50, Margin="0, 10, 0, 0", AbsolutePositioning=False, HorizontalAlignment=1, VerticalAlignment=2)

info_create_material_2 = RemoteReceiver(info_create_material)
rec_26 = DataRecorder(info_create_material_2, DataLimit=-2, RecordData=True)
ma_16 = MassAddition(Input=rec_26)  # -> Result, PartialResults
entwine_142 = Entwine(Branch00=ma_16.Result, Branch01=material_info, FlattenInputs=True)
rec_27 = DataRecorder(entwine_142, DataLimit=2, RecordData=True)
item_22 = ListItem(List=rec_27, Index=0, Wrap=True)  # -> Item2, Item1, Item
equals_38 = Equality(FirstNumber=item_22.Item2, SecondNumber=item_22.Item1)  # -> Equality, Inequality
bang_13 = ExplodeTree(Data=equals_38.Inequality)  # -> Branch0, Branch1
py3_43 = Python3Script(x=bang_13.Branch0, y=bang_13.Branch1)  # -> a; same code as py3_6
event_64 = EventGate(Data=py3_43)  # -> Data, IsNew
freeze_gate_59 = StreamFreezeGate(Data=py3_43, PassingSwitch=event_64.IsNew)
event_65 = EventGate(Data=freeze_gate_59)  # -> Data, IsNew
panel_207 = Panel(event_65.Data)
launchwin_11 = LaunchWindow(
    Show=event_65.Data,
    Name="Common materials",
    Width=multiplication,
    Height=number_slider_67,
    ChildStatus=1,
    EnableHorizScroll=False)
info_create_material_3 = RemoteReceiver(info_create_material)
winstat_11 = WindowStatus(Window=launchwin_11)
winprops_11 = SetWindowProperties(
    Window=launchwin_11,
    StartingLocation=create_modal_location_2,
    Theme=0,
    AccentColor=heath_accent_color_14,
    ShowTitleBar=True,
    BackgroundColor=RGB(255, 255, 255),
    ScaleFactor=1)
material_info_status = RemoteSender(winstat_11)
py3_44 = Python3Script(window=launchwin_11, activate=info_create_material_3)  # same code as py3_7
addelems_12 = AddElements(Window=launchwin_11, Elements=flatten(image_4), DoVLChecking=True)  # -> AddedElements, ElementNames

material_info_status_2 = RemoteReceiver(material_info_status)
expression_60 = Expression(x="Hidden", y=material_info_status_2, Expression="x=y")
expire_10 = ExpireObject(ObjectToExpire=objbynn_8, Expire=expression_60)

# ----
# A1-A3
stack_92 = CreateStack(UIElements=entwine_140, Horizontal=True)
data_18 = Data(stack_92)  # "A1-A3"

specific_heat = Data(stack_90)
density = Data(stack_89)

create_material_name_2 = RemoteReceiver(create_material_name)
create_material_name_3 = RemoteReceiver(create_material_name)
py3_45 = Python3Script(name=create_material_name_3)  # -> not_valid; inputs name: String; same code as py3_42
gate_33 = StreamGate(Stream="'å', 'ä' and 'ö' are not allowed", Gate=py3_45)  # -> Target0, Target1

# ----
# Add material
create_material_sprecific_heat_2 = RemoteReceiver(create_material_sprecific_heat)
create_material_conductivity_2 = RemoteReceiver(create_material_conductivity)
create_material_category_2 = RemoteReceiver(create_material_category)
create_material_density_2 = RemoteReceiver(create_material_density)
create_material_name_4 = RemoteReceiver(create_material_name)
opaquemat_3 = HBOpaqueMaterial(
    name=create_material_name_4,
    thickness="inf",
    conductivity=create_material_conductivity_2,
    density=create_material_density_2,
    spec_heat=create_material_sprecific_heat_2,
    category=create_material_category_2)  # -> out, mat; plug-in component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
create_material_a1_a3_kg_2 = RemoteReceiver(create_material_a1_a3_kg)
create_material_a5_1_kg_2 = RemoteReceiver(create_material_a5_1_kg)
create_material_a4_kg_2 = RemoteReceiver(create_material_a4_kg)
create_material_error = RemoteSender(opaquemat_3.out)
create_material_2 = RemoteReceiver(create_material)
getdocumentusertext_12 = Python3Script(run=create_material_2, key="Heath materials")  # -> json_string; same code as getdocumentusertext

add_life_cycle_info = BrimstoneAddLifeCycleInfoToHoneybeeMaterial(
    hb_material=opaquemat_3.mat,
    gwp_a1_a3=create_material_a1_a3_kg_2,
    gwp_a4=create_material_a4_kg_2,
    gwp_a5_1=create_material_a5_1_kg_2)  # -> mod_material
# ---------- add_life_cycle_info: Python ----------
"""
Adds GWP info to a Honeybee Material

    Args:
        hb_material: Honeybee EnergyMaterial to be updated
        gwp_a1_a3: GWP (A1-A3) [kg CO2eq/kg]
        gwp_a4: GWP (A4) [kg CO2eq/kg]
        gwp_a5_1: GWP (A5.1) [kg CO2eq/kg]

    Returns:
        mod_material: Updated Honeybee EnergyMaterial
"""

import scriptcontext
import brimstone
ghenv.Component.Message = brimstone.globals.version
import Grasshopper

ghenv.Component.Name = 'Brimstone - Add Life Cycle Info to Honeybee Material'
ghenv.Component.NickName = 'Add Life Cycle Info'

try:  # import the core honeybee dependencies
    from honeybee_energy.material.opaque import EnergyMaterial
except ImportError as e:
    raise ImportError('\nFailed to import honeybee:\n\t{}'.format(e))

def main(hb_material):
    if not isinstance(hb_material, EnergyMaterial):
        raise Exception("Input material must be a valid Honeybee material")
    mod_material = hb_material.duplicate()
    user_data = mod_material.user_data if mod_material.user_data else {}
    
    impact_data = {
        "gwp_a1_a3": gwp_a1_a3,
        "gwp_a4": gwp_a4,
        "gwp_a5_1": gwp_a5_1,
        "gwp_c1": gwp_c1,
        "gwp_c2": gwp_c2,
        "gwp_c3": gwp_c3,
    }
    
    for k, v in impact_data.items():
        if v is not None:
            user_data[k] = v

    mod_material.user_data = user_data
    
    return mod_material

if __name__ == "__main__":
    try:
        flying = scriptcontext.sticky["brimstone_flying"]
    except:
        raise Exception("The 'Brimstone - Fly' component needs to exist on the canvas")
    mod_material = main(hb_material)
# ---------- end add_life_cycle_info ----------

gate_34 = StreamGate(Stream=add_life_cycle_info, Gate=create_material_2)  # -> Target0, Target1
objtostr_2 = HBObjectToString(hb_obj=gate_34.Target1)  # -> hb_str; plug-in component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
entwine_143 = Entwine(Branch00=getdocumentusertext_12, Branch01=objtostr_2, FlattenInputs=True)  # -> flatten(Result)
join_8 = TextJoin(Text=entwine_143, Join="|")
freeze_gate_60 = StreamFreezeGate(Data=join_8, PassingSwitch=create_material_2, Freeze=False, Hold=False)

create_material_error_2 = RemoteReceiver(create_material_error)
panel_208 = Panel(create_material_error_2)
split_8 = TextSplit(Text=create_material_error_2, Separators=panel_201)
trim = TextTrim(Text=split_8, Start=True, End=True)
item_23 = ListItem(List=trim, Index=0, Wrap=True)  # -> Item, Item1
lng_27 = ListLength(List=split_8)
len_4 = TextLength(Text=item_23.Item1)
larger_2 = LargerThan(FirstNumber=lng_27, SecondNumber="1")  # -> LargerThan, OrEqualTo
subtraction_16 = Subtraction(A=len_4, B=Slider(11, range=0..20))
fragment_4 = TextFragment(Text=item_23.Item1, Start="0", Count=subtraction_16)
filter_54 = StreamFilter(Gate=larger_2.LargerThan, Stream0=create_material_error_2, Stream1=fragment_4)

# ----
# Create window
number_slider_74 = Slider(0.5, range=0..12)
button_51 = CreateButton(ButtonName="Create window", ButtonStyle=0)
textbox_16 = CreateTextBox(Label="Name", DefaultText="New window", UpdateButton=invert(True), showLabel=True)
textbox_17 = CreateTextBox(DefaultText=number_slider_74, UpdateButton=invert(True), showLabel=False)
label_55 = CreateLabel(LabelText="U-factor [W/m2-K]", LabelSize=12, Justification=0)
textbox_18 = CreateTextBox(DefaultText=Slider(0.3, range=0..1), UpdateButton=invert(True), showLabel=False)
label_56 = CreateLabel(LabelText="SHGC [-]", LabelSize=12, Justification=0)
values_146 = ValueListener(Elements=textbox_16, SomeProperty=True)  # -> Values, Indices
values_147 = ValueListener(Elements=textbox_17, SomeProperty=True)  # -> Values, Indices
values_148 = ValueListener(Elements=button_51, SomeProperty=True)  # -> Values, Indices
values_149 = ValueListener(Elements=textbox_18, SomeProperty=True)  # -> Values, Indices
freeze_gate_61 = StreamFreezeGate(Data=values_148.Values, PassingSwitch=invert(values_148.Values))
pre_create_window = RemoteSender(values_148.Values)
create_window_u_factor = RemoteSender(values_147.Values)
create_window_shgc = RemoteSender(values_149.Values)
panel_209 = Panel(values_146.Values)
create_window_name = RemoteSender(values_146.Values)
entwine_144 = Entwine(Branch00=label_55, Branch01=textbox_17, FlattenInputs=True)  # -> flatten(Result)
entwine_145 = Entwine(Branch00=label_56, Branch01=textbox_18, FlattenInputs=True)  # -> flatten(Result)
bool_56 = Boolean(invert(freeze_gate_61))
stack_93 = CreateStack(UIElements=entwine_144, Horizontal=True)
tap_22 = TapBuffer(Reset=False, Incremental=True, Valve=bool_56, Hold=True)
stack_94 = CreateStack(UIElements=entwine_145, Horizontal=True)
dam_27 = DataDam(DataA=tap_22, BufferDelay=2500000, BufferMode=2)
create_window_modal_2 = RemoteReceiver(create_window_modal)
equals_39 = Equality(FirstNumber=tap_22, SecondNumber=dam_27)  # -> Equality, Inequality
and_38 = GateAnd(A=equals_39.Inequality, B=create_window_modal_2)
event_66 = EventGate(Data=and_38)  # -> Data, IsNew
create_window = RemoteSender(event_66.Data)
adjustpos_136 = AdjustElementPositioning(
    ElementsToAdjust=[label_11, label_56, label_55, label_12, label_10],
    AbsolutePositioning=False,
    Width=Slider(150, range=0..300),
    HorizontalAlignment=0,
    VerticalAlignment=2)
adjustpos_137 = AdjustElementPositioning(
    ElementsToAdjust=[textbox_18, textbox_17, textbox_6, textbox_4, textbox_5],
    AbsolutePositioning=False,
    Width=Slider(50, range=0..300),
    HorizontalAlignment=0,
    VerticalAlignment=2)
adjustpos_138 = AdjustElementPositioning(ElementsToAdjust=button_51, Margin="0, 10, 0, 0", AbsolutePositioning=False, HorizontalAlignment=1, VerticalAlignment=2)

# ----
# Add window
create_window_u_factor_2 = RemoteReceiver(create_window_u_factor)
create_window_shgc_2 = RemoteReceiver(create_window_shgc)
create_window_name_2 = RemoteReceiver(create_window_name)
windowmat = HBWindowMaterial(name=create_window_name_2, u_factor=create_window_u_factor_2, shgc=create_window_shgc_2)  # -> out, mat; plug-in component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
create_window_conversion_value_2 = RemoteReceiver(create_window_conversion_value)
create_window_a1_a3_kg_2 = RemoteReceiver(create_window_a1_a3_kg)
create_window_a4_kg_2 = RemoteReceiver(create_window_a4_kg)
windowconstr = HBWindowConstruction(name=create_window_name_2, materials=windowmat.mat)  # -> constr; plug-in component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
create_window_error = RemoteSender(windowmat.out)
add_life_cycle_info_construction = BrimstoneAddLifeCycleInfoToHoneybeeConstruction(
    hb_construction=windowconstr,
    gwp_a1_a3=create_window_a1_a3_kg_2,
    gwp_a4=create_window_a4_kg_2,
    density=create_window_conversion_value_2)  # -> mod_construction
# ---------- add_life_cycle_info_construction: Python ----------
"""
Adds GWP info to a Honeybee Construction

    Args:
        hb_construction: Honeybee Construction to be updated
        gwp_a1_a3: GWP (A1-A3) [kg CO2eq/kg]
        gwp_a4: GWP (A4) [kg CO2eq/kg]
        density: GWP (A5.1) [kg/m2]

    Returns:
        mod_construction: Updated Honeybee Construction
"""

import scriptcontext
import brimstone
ghenv.Component.Message = brimstone.globals.version
import Grasshopper

ghenv.Component.Name = 'Brimstone - Add Life Cycle Info to Honeybee Construction'
ghenv.Component.NickName = 'Add Life Cycle Info (Construction)'

try:  # import the core honeybee dependencies
    from honeybee_energy.construction.window import WindowConstruction
    from honeybee_energy.construction.opaque import OpaqueConstruction
except ImportError as e:
    raise ImportError('\nFailed to import honeybee:\n\t{}'.format(e))

def main(hb_construction, gwp_a1_a3, gwp_a4, density):
    if not isinstance(hb_construction, WindowConstruction)\
        and not isinstance(hb_construction, OpaqueConstruction):
        raise Exception("Currently only Window and Opaque constructions are supported")
    mod_construction = hb_construction.duplicate()
    user_data = mod_construction.user_data if mod_construction.user_data else {}
    
    user_data["gwp_a1_a3"] = gwp_a1_a3
    user_data["gwp_a4"] = gwp_a4
    user_data["conv_value"] = density
    
    mod_construction.user_data = user_data

    return mod_construction

if __name__ == "__main__":
    try:
        flying = scriptcontext.sticky["brimstone_flying"]
    except:
        raise Exception("The 'Brimstone - Fly' component needs to exist on the canvas")
    mod_construction = main(hb_construction, gwp_a1_a3, gwp_a4, density)
# ---------- end add_life_cycle_info_construction ----------
create_window_2 = RemoteReceiver(create_window)
gate_35 = StreamGate(Stream=add_life_cycle_info_construction, Gate=create_window_2)  # -> Target0, Target1
getdocumentusertext_13 = Python3Script(run=create_window_2, key="Heath windows")  # -> json_string; same code as getdocumentusertext
objtostr_3 = HBObjectToString(hb_obj=gate_35.Target1)  # -> hb_str; plug-in component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
entwine_146 = Entwine(Branch00=getdocumentusertext_13, Branch01=objtostr_3, FlattenInputs=True)  # -> flatten(Result)
freeze_gate_62 = StreamFreezeGate(Data=entwine_146, PassingSwitch=create_window_2, Freeze=False, Hold=False)
join_9 = TextJoin(Text=freeze_gate_62, Join="|")

panel_210 = Panel(windowconstr)
panel_211 = Panel(add_life_cycle_info_construction)
entwine_147 = Entwine(Branch00=textbox_16, Branch01=true_button_7, FlattenInputs=True)  # -> flatten(Result)
stack_95 = CreateStack(UIElements=entwine_147, Horizontal=True)
adjustpos_139 = AdjustElementPositioning(
    ElementsToAdjust=textbox_16,
    Margin="0, 5, 0, 10",
    AbsolutePositioning=False,
    Width=Slider(185, range=0..300),
    HorizontalAlignment=0)

# ----
# Windows database
sync_window_database_2 = RemoteReceiver(sync_window_database)
setdocumentusertext_2 = Python3Script(
    key="Heath windows",
    load_value=freeze_gate_41,
    remove_value=freeze_gate_33,
    add_value=join_9,
    sync=sync_window_database_2)  # -> done
# ---------- setdocumentusertext_2: Python ----------
import Rhino
import rhinoscriptsyntax as rs
import scriptcontext as sc

def modify_value(value):
    sc.doc = Rhino.RhinoDoc.ActiveDoc

    return rs.SetDocumentUserText(key, value)

    sc.doc = ghdoc

if load_value:
    done = modify_value(load_value)

if add_value:
    done = modify_value(add_value)

if remove_value:
    done = modify_value(remove_value)

if remove_value == False:
    done = modify_value(None)

elif sync:
    done = True
# ---------- end setdocumentusertext_2 ----------
getdocumentusertext_14 = Python3Script(run=setdocumentusertext_2, key="Heath windows")  # -> json_string
# ---------- getdocumentusertext_14: Python ----------
import Rhino
import rhinoscriptsyntax as rs
import scriptcontext as sc

if run:
    sc.doc = Rhino.RhinoDoc.ActiveDoc

    json_string = rs.GetDocumentUserText(key)
    if json_string == None:
        json_string = False

    sc.doc = ghdoc
# ---------- end getdocumentusertext_14 ----------
split_9 = TextSplit(Text=getdocumentusertext_14, Separators="|")
hold_5 = HoldingGate(Data=split_9)
strtoobj_6 = HBStringToObject(hb_str=hold_5)  # -> flatten(hb_obj); plug-in component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
ipy2_2 = IronPython2Script(windows=strtoobj_6)  # -> unique_windows; inputs windows: list
# ---------- ipy2_2: IronPython ----------
"""Grasshopper Script"""

unique_windows = []

for i in range(len(windows)):
    if windows[i] not in unique_windows:
        unique_windows.append(windows[i])
# ---------- end ipy2_2 ----------
clean = CleanTree(RemoveNulls=True, RemoveInvalid=True, RemoveEmpty=False, Tree=ipy2_2)
lng_28 = ListLength(List=ipy2_2)
lng_29 = ListLength(List=strtoobj_6)
smaller = SmallerThan(FirstNumber=lng_28, SecondNumber=lng_29)  # -> SmallerThan, OrEqualTo
created_windows_database = RemoteSender(clean)
hasdata_9 = DataExists(Data=smaller.SmallerThan)
filter_55 = StreamFilter(Gate=hasdata_9, Stream0="False", Stream1=smaller.SmallerThan)
overlap_windows = RemoteSender(filter_55)

created_windows_database_2 = RemoteReceiver(created_windows_database)
decnstrconstr_3 = HBDeconstructConstruction(constr=created_windows_database_2)  # -> materials, layers, r_val_si, r_val_ip, u_fac_si, u_fac_ip, shgc, t_sol, t_vis; plug-in component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
decnstrmat_3 = HBDeconstructMaterial(mat=decnstrconstr_3.materials)  # -> values, attr_names, r_val_si, r_val_ip; plug-in component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
item_24 = ListItem(List=decnstrmat_3.values, Index=0, Wrap=True)  # -> flatten(Item), Item1, Item2
entwine_148 = Entwine(Branch00=generic_shgc, Branch01=item_24.Item2, FlattenInputs=True)  # -> flatten(Result)
entwine_149 = Entwine(Branch00=generic_u_value, Branch01=item_24.Item1, FlattenInputs=True)  # -> flatten(Result)
clean_2 = CleanTree(RemoveNulls=True, RemoveInvalid=True, RemoveEmpty=False, Tree=item_24.Item)
clean_3 = CleanTree(RemoveNulls=True, RemoveInvalid=True, RemoveEmpty=False, Tree=entwine_149)
clean_4 = CleanTree(RemoveNulls=True, RemoveInvalid=True, RemoveEmpty=False, Tree=entwine_148)
num_7 = Number(clean_4)
num_8 = Number(clean_3)
entwine_150 = Entwine(Branch00="Generic", Branch01=clean_2, FlattenInputs=True)  # -> flatten(Result)
expression_61 = Expression(x=num_7, Expression="Round(x, 2)")
expression_62 = Expression(x=num_8, Expression="Round(x, 2)")
create_window_names = RemoteSender(entwine_150)
format_33 = Format(Format="{0} (U-factor: {1}, SHGC: {2})", Culture=127, Data0=entwine_150, Data1=expression_62, Data2=expression_61)
panel_212 = Panel(format_33)
create_window_full_names = RemoteSender(format_33)

create_window_full_names_2 = RemoteReceiver(create_window_full_names)
created_windows_database_3 = RemoteReceiver(created_windows_database)

created_windows_database_4 = RemoteReceiver(created_windows_database)
entwine_151 = Entwine(Branch00=panel_135, Branch01=created_windows_database_3, FlattenInputs=True)  # -> flatten(Result)
entwine_152 = Entwine(Branch00="Generic", Branch01=created_windows_database_4, FlattenInputs=True)  # -> flatten(Result)
item_25 = ListItem(List=entwine_151, Index=subset_subface_window_2, Wrap=True)
item_26 = ListItem(List=entwine_152, Index=subset_subface_window_3, Wrap=True)
expression_63 = Expression(x="Generic", y=item_25, Expression="x=y")
expression_64 = Expression(x="Generic", y=item_26, Expression="x=y")
filter_56 = StreamFilter(Gate=expression_63, Stream0=item_25, Stream1=null_9)
filter_57 = StreamFilter(Gate=expression_64, Stream0=item_26, Stream1=null_10)
subfacesubset_2 = HBSubfaceSubset(window=filter_57, skylight=filter_56)  # -> subface_set; plug-in component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

create_window_full_names_3 = RemoteReceiver(create_window_full_names)
cull_i_3 = CullIndex(List=create_window_full_names_3, Indices="0", Wrap=invert(True))
concat_7 = Concatenate(FragmentA="- ", FragmentB=cull_i_3)
overlap_windows_2 = RemoteReceiver(overlap_windows)
lng_30 = ListLength(List=cull_i_3)
settextblock_12 = SetTextBlockContents(TextBlockToModify=tb_22, NewTextBlockContents=concat_7)
py3_46 = Python3Script(current_windows=lng_30, maximum_windows=number_slider_61)  # -> status; inputs current_windows: Int32, maximum_windows: Int32
# ---------- py3_46: Python ----------
status = [True]*current_windows
status.extend([False]*(maximum_windows-current_windows))
# ---------- end py3_46 ----------
hideshow_29 = HideShowElement(ElementToHideShow=label_42, Show=overlap_windows_2, Collapse=True, Disable=False)
hideshow_30 = HideShowElement(ElementToHideShow=simplify(merge_10), Show=simplify(graft(py3_46)), Collapse=True, Disable=False)

create_window_names_2 = RemoteReceiver(create_window_names)
create_window_name_3 = RemoteReceiver(create_window_name)
create_window_error_2 = RemoteReceiver(create_window_error)
create_window_u_factor_3 = RemoteReceiver(create_window_u_factor)
create_window_shgc_3 = RemoteReceiver(create_window_shgc)
create_window_name_4 = RemoteReceiver(create_window_name)
expression_65 = Expression(x=create_window_names_2, y=create_window_name_3, Expression="x=y")
len_5 = TextLength(Text=create_window_error_2)
py3_47 = Python3Script(name=create_window_name_4)  # -> not_valid; inputs name: String; same code as py3_42
inc = Includes(Value=create_window_shgc_3, Domain=dom_5)  # -> Includes, Deviation
inc_2 = Includes(Value=create_window_u_factor_3, Domain=dom_4)  # -> Includes, Deviation
cull_16 = CullPattern(List=expression_65, CullPattern=expression_65)
bool_57 = Boolean(len_5)
gate_36 = StreamGate(Stream="U-factor has to to between 0 and 12", Gate=inc_2.Includes)  # -> Target0, Target1
gate_37 = StreamGate(Stream="Window name contains no valid characters", Gate=bool_57)  # -> Target0, Target1
gate_38 = StreamGate(Stream="Window already exists", Gate=cull_16)  # -> Target0, Target1
gate_39 = StreamGate(Stream="'å', 'ä' and 'ö' are not allowed", Gate=py3_47)  # -> Target0, Target1
gate_40 = StreamGate(Stream="SHGC has to to between 0 and 1", Gate=inc.Includes)  # -> Target0, Target1
entwine_153 = Entwine(
    Branch00=gate_36.Target0,
    Branch01=gate_40.Target0,
    Branch02=gate_37.Target1,
    Branch03=gate_38.Target1,
    Branch04=gate_39.Target1,
    FlattenInputs=True)  # -> flatten(Result)
panel_213 = Panel(entwine_153)
item_27 = ListItem(List=entwine_153, Index=0, Wrap=True)
create_window_error_message = RemoteSender(item_27)

create_window_error_message_2 = RemoteReceiver(create_window_error_message)
null_38 = NullItem(Item=create_window_error_message_2)  # -> NullFlags, InvalidFlags, Description
filter_58 = StreamFilter(Gate=null_38.NullFlags, Stream0=create_window_error_message_2, Stream1=" ")
filter_59 = StreamFilter(Gate=null_38.NullFlags, Stream0=Slider(500, range=0..1000), Stream1=Slider(1000000, range=0..1000000))
hideshow_31 = HideShowElement(ElementToHideShow=button_51, Show=True, Collapse=True, Disable=invert(null_38.NullFlags))
tooltip_10 = AttachTooltipToElement(ElementsToAttachTo=button_51, TooltipContent=filter_58, ShowDelay=filter_59, Duration=2000)

panel_214 = Panel(hold_5)
panel_215 = Panel(split_9)
panel_216 = Panel(clean)

# ---- group: Construction module (continued)
setlist_3 = SetListContents(ListToModify=pulldown_13, NewListContents=create_window_full_names_2, SelectedIndex="0")
setlist_4 = SetListContents(ListToModify=pulldown_12, NewListContents=create_window_full_names_2, SelectedIndex="0")

# ----
# Determine which is the currently selected model, in the current tab
current_selected_model_assembly_module_2 = RemoteReceiver(current_selected_model_assembly_module)
current_selected_model_visualise_module_2 = RemoteReceiver(current_selected_model_visualise_module)
current_selected_model_analysis_module_2 = RemoteReceiver(current_selected_model_analysis_module)
current_tab_26 = RemoteReceiver(current_tab)
current_tab_27 = RemoteReceiver(current_tab)
current_tab_28 = RemoteReceiver(current_tab)
expression_66 = Expression(x="Visualize module", y=current_tab_27, Expression="x=y")
expression_67 = Expression(x="Assembly module", y=current_tab_26, Expression="x=y")
expression_68 = Expression(x="Analysis module", y=current_tab_28, Expression="x=y")
gate_41 = StreamGate(Stream=current_selected_model_assembly_module_2, Gate=expression_67)  # -> Target0, Target1
gate_42 = StreamGate(Stream=current_selected_model_analysis_module_2, Gate=expression_68)  # -> Target0, Target1
gate_43 = StreamGate(Stream=current_selected_model_visualise_module_2, Gate=expression_66)  # -> Target0, Target1
panel_217 = Panel(gate_43.Target1)
panel_218 = Panel(gate_41.Target1)
panel_219 = Panel(gate_42.Target1)

py3_48 = Python3Script(x1=gate_41.Target1, x2=gate_43.Target1, x3=gate_42.Target1, x4=py3_35.newest_index)  # -> out, a
# ---------- py3_48: Python ----------
""" Keeps track of the most recently updated value using stickycontext"""
""" Kind hacky tbh... but seems to work"""

import scriptcontext as sc

if not sc.sticky.get("current_model_index"):
    sc.sticky["current_model_index"] = (None, (None, None, None, None))

inputs = (x1, x2, x3, x4)
for i, (u, v) in enumerate(zip(inputs, sc.sticky["current_model_index"][1])):
    if u != v:
        sc.sticky["current_model_index"] = (i, inputs)
        break
a = inputs[sc.sticky["current_model_index"][0]]
# ---------- end py3_48 ----------

event_67 = EventGate(Data=py3_48.a)  # -> Data, IsNew
panel_220 = Panel(event_67.Data)
current_selected_model = RemoteSender(event_67.Data)

current_selected_model_2 = RemoteReceiver(current_selected_model)
current_selected_model_3 = RemoteReceiver(current_selected_model)
current_selected_model_4 = RemoteReceiver(current_selected_model)
setlist_5 = SetListContents(ListToModify=pulldown, NewListContents=current_all_created_models_names_3, SelectedIndex=current_selected_model_3)
setlist_6 = SetListContents(ListToModify=pulldown_3, NewListContents=current_all_created_models_names_4, SelectedIndex=current_selected_model_4)

# ---- group: Assembly model (continued)
setlist_7 = SetListContents(ListToModify=pulldown_4, NewListContents=current_all_created_models_names_7, SelectedIndex=current_selected_model_2)

# ----
# Construction inspection
pre_construction_database_visualize_cons_2 = RemoteReceiver(pre_construction_database_visualize_cons)  # "pre_construction_database_visualize_construction"
path_3 = DataPath(pre_construction_database_visualize_cons_2)
construction_maximum_layer_limit_4 = RemoteReceiver(construction_maximum_layer_limit)
construction_maximum_layer_limit_5 = RemoteReceiver(construction_maximum_layer_limit)
construction_maximum_layer_limit_6 = RemoteReceiver(construction_maximum_layer_limit)
panel_221 = Panel("Construction thickness: {0}")
repeat_17 = RepeatData(Data="0 m", Length=construction_maximum_layer_limit_4)
repeat_18 = RepeatData(Data="Material", Length=construction_maximum_layer_limit_5)
repeat_19 = RepeatData(Data=" ", Length=construction_maximum_layer_limit_6)
tb_27 = CreateTextBlock(Text=repeat_17, TextSize=12, Justification=1)
label_57 = CreateLabel(LabelText="Construction inspection", LabelSize=18, Justification=1)
label_58 = CreateLabel(LabelText="🌳", LabelSize=18, Justification=1)
label_59 = CreateLabel(LabelText="🏠", LabelSize=18, Justification=1)
label_60 = CreateLabel(LabelText=panel_221, LabelSize=18, Justification=1)
tb_28 = CreateTextBlock(Text=repeat_18, TextSize=16, Justification=Slider(1, range=0..10))
tb_29 = CreateTextBlock(Text=repeat_19, TextSize=16, Justification=Slider(1, range=0..10))
construction_maximum_layer_limit_7 = RemoteReceiver(construction_maximum_layer_limit)
settextblock_13 = SetTextBlockContents(TextBlockToModify=tb_29, NewTextBlockContents=" ")
suirify_8 = Suirify(tb_27)
suirify_9 = Suirify(tb_28)
merge_15 = Merge(Data1=graft(suirify_9), Data2=graft(suirify_8))
stack_96 = CreateStack(UIElements=merge_15, Horizontal=True)  # -> flatten(Stack)
material_database_categories_8 = RemoteReceiver(material_database_categories_2)
suirify_10 = Suirify(tb_29)
suirify_11 = Suirify(stack_96)
merge_16 = Merge(Data1=graft(suirify_10), Data2=graft(suirify_11))
number_slider_75 = Slider(250, range=0..1000)
entwine_154 = Entwine(
    Branch00=ColourSwatch(SwatchColor=RGB(204, 102, 51)),
    Branch01=ColourSwatch(SwatchColor=RGB(153, 102, 51)),
    Branch02=ColourSwatch(SwatchColor=RGB(128, 128, 128)),
    Branch03=ColourSwatch(SwatchColor=RGB(255, 204, 102)),
    Branch04=ColourSwatch(SwatchColor=RGB(102, 102, 153)),
    Branch05=ColourSwatch(SwatchColor=RGB(255, 153, 51)),
    Branch06=ColourSwatch(SwatchColor=RGB(102, 51, 0)),
    Branch07=ColourSwatch(SwatchColor=RGB(77, 77, 77)),
    Branch08=ColourSwatch(SwatchColor=RGB(0, 102, 204)),
    Branch09=ColourSwatch(SwatchColor=RGB(153, 153, 153)),
    FlattenInputs=True)  # -> flatten(Result)
stack_97 = CreateStack(UIElements=merge_16, Horizontal=invert(True))  # -> flatten(Stack)
entwine_155 = Entwine(Branch00=label_57, Branch01=label_60, Branch02=label_58, Branch03=stack_97, Branch04=label_59, FlattenInputs=True)  # -> flatten(Result)
swatch_11 = ColourSwatch(SwatchColor=RGB(0, 0, 0))
adjustpos_140 = AdjustElementPositioning(ElementsToAdjust=tb_27, Margin="8, 0, 0, 0", AbsolutePositioning=False, HorizontalAlignment=0)
adjustpos_141 = AdjustElementPositioning(ElementsToAdjust=stack_97, Margin="53, 0, 0, 0", AbsolutePositioning=False, HorizontalAlignment=0)

current_selected_model_5 = RemoteReceiver(current_selected_model)
item_28 = ListItem(List=cset_6.Set, Index=current_selected_model_5, Wrap=invert(True))
py3_49 = Python3Script(rename=pre_rename_current_model_3, rename_name=rename_current_model_name_4, file_path=item_28)  # -> name_dictionary
# ---------- py3_49: Python ----------
import os
from pathlib import Path
import time

if rename:
    rename_name = "\\".join(file_path.split("\\")[:-1]) + "\\" + rename_name
    
    if rename_name.endswith(".hbjson"):
        pass
    else:
        rename_name = rename_name + ".hbjson"

    if os.path.exists(file_path):
        os.rename(file_path, rename_name)
        current_time = time.time()
        os.utime(rename_name, (current_time, current_time))
    name_dictionary = (Path(file_path).stem, Path(rename_name).stem)
# ---------- end py3_49 ----------
py3_50 = Python3Script(remove=pre_remove_current_model_3, file_path=item_28)
# ---------- py3_50: Python ----------
import os
import shutil

if remove:
    print("hell oworld")
    if os.path.exists(file_path):
        print("hello")
        dir_path = os.path.dirname(file_path)
        new_dir = os.path.join(dir_path, "deleted")
        os.makedirs(new_dir, exist_ok = True)
        shutil.move(file_path, os.path.join(new_dir, os.path.basename(file_path)))
# ---------- end py3_50 ----------
py3_51 = Python3Script(file_name=item_28)  # -> model_name
# ---------- py3_51: Python ----------
model_name = file_name.split('\\')[-1][:-7]
# ---------- end py3_51 ----------
loadobjects = HBLoadObjects(hb_file=item_28, load=Toggle(True))  # -> report, flatten(hb_objs); plug-in component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
current_model_name = RemoteSender(py3_51)
hasdata_10 = DataExists(Data=loadobjects.hb_objs)
data_19 = Data(loadobjects.hb_objs)
gate_44 = StreamGate(Stream=loadobjects.hb_objs, Gate=show_honeybee_element_2)  # -> Target0, Target1
deconstructmodel = HBDeconstructModel(model=data_19)  # -> rooms, faces, apertures, doors, shades; plug-in component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
honeybee_model_ready = RemoteSender(hasdata_10)
vizbytype = HBVisualizeByType(hb_objs=gate_44.Target1)  # -> walls, interior_walls, roofs, ceilings, exterior_floors, interior_floors, air_walls, apertures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; plug-in component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
geoprop = HBGeometryProperties(rooms=flatten(deconstructmodel.rooms))  # -> ext_wall_area, ext_win_area, volume, floor_area, floor_ep_constr; plug-in component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
panel_222 = Panel(geoprop.floor_area)
gate_45 = StreamGate(Stream=[vizbytype.indoor_shades, vizbytype.outdoor_shades], Gate=show_honeybee_context_3)  # -> Target0, Target1
gate_46 = StreamGate(Stream=[vizbytype.apertures, vizbytype.interior_apertures], Gate=show_honeybee_windows_3)  # -> Target0, Target1
gate_47 = StreamGate(Stream=vizbytype.roofs, Gate=show_honeybee_roof_3)  # -> Target0, Target1
gate_48 = StreamGate(Stream=vizbytype.interior_floors, Gate=show_honeybee_floors_3)  # -> Target0, Target1
gate_49 = StreamGate(Stream=vizbytype.exterior_floors, Gate=show_honeybee_ground_3)  # -> Target0, Target1
gate_50 = StreamGate(Stream=[vizbytype.walls, vizbytype.interior_walls, vizbytype.air_walls], Gate=show_honeybee_walls_3)  # -> Target0, Target1
data_20 = Data(gate_47.Target1)
data_21 = Data(gate_46.Target1)
data_22 = Data(gate_50.Target1)
data_23 = Data(gate_48.Target1)
data_24 = Data(gate_49.Target1)
data_25 = Data(gate_45.Target1)

current_model_name_2 = RemoteReceiver(current_model_name)
current_model_name_3 = RemoteReceiver(current_model_name)
data_26 = Data(current_model_name)
honeybee_model_ready_2 = RemoteReceiver(honeybee_model_ready)
filter_60 = StreamFilter(Gate=honeybee_model_ready_2, Stream0=Slider(500, range=0..1000), Stream1=Slider(1000000, range=0..1000000))
filter_61 = StreamFilter(Gate=honeybee_model_ready_2, Stream0="Create a model before running the simulation", Stream1=" ")
tooltip_11 = AttachTooltipToElement(ElementsToAttachTo=button_4, TooltipContent=filter_61, ShowDelay=filter_60, Duration=2000)
honeybee_model_ready_3 = RemoteReceiver(honeybee_model_ready)
hideshow_32 = HideShowElement(ElementToHideShow=button_4, Show=True, Collapse=True, Disable=invert(honeybee_model_ready_3))
honeybee_model_ready_4 = RemoteReceiver(honeybee_model_ready)
panel_223 = Panel(item_28)
py3_52 = Python3Script(x=py3_49)  # -> out, a
# ---------- py3_52: Python ----------
a = x is not None
# ---------- end py3_52 ----------
gate_51 = StreamGate(Stream=py3_49, Gate=py3_52.a)  # -> Target0, Target1
rec_28 = DataRecorder(gate_51.Target1, DataLimit=-10, RecordData=True)
model_name_dictionary = RemoteSender(rec_28)

# ----
# Bake model
panel_224 = Panel("""Heath::honeybee model::walls
Heath::honeybee model::roof
Heath::honeybee model::floors
Heath::honeybee model::ground
Heath::honeybee model::windows
Heath::honeybee model::context""")
entwine_156 = Entwine(
    Branch00=data_22,
    Branch01=data_20,
    Branch02=data_23,
    Branch03=data_24,
    Branch04=data_21,
    Branch05=data_25,
    FlattenInputs=True)
bake_model_2 = RemoteReceiver(bake_model)
clean_5 = CleanTree(RemoveNulls=True, RemoveInvalid=True, RemoveEmpty=invert(False), Tree=entwine_156)
gate_52 = StreamGate(Stream=panel_224, Gate=bake_model_2)  # -> Target0, Target1
getbrn = GetMatchingBranches(PrimaryData=clean_5, SecondaryData1=graft(gate_52.Target1), removeEmpty=False)  # -> flatten(PrimaryData), flatten(SecondaryData1)
bbox_2 = BoundingBox(Content=clean_5, Plane=PlaneXY(0, 0, 0))  # -> Box, Box_2
null_39 = NullItem(Item=bbox_2.Box)  # -> flatten(NullFlags), InvalidFlags, Description
honeybee_model_bounding_box = RemoteSender(bbox_2.Box)
cull_17 = CullPattern(List=null_39.NullFlags, CullPattern=invert(null_39.NullFlags))
lng_31 = ListLength(List=cull_17)
honeybee_model_displayed = RemoteSender(lng_31)

honeybee_model_displayed_2 = RemoteReceiver(honeybee_model_displayed)
honeybee_model_displayed_3 = RemoteReceiver(honeybee_model_displayed)
hideshow_33 = HideShowElement(ElementToHideShow=button_3, Show=honeybee_model_exists_3, Collapse=True, Disable=invert(honeybee_model_displayed_2))

# ---- group: Assembly model (continued)
hideshow_34 = HideShowElement(ElementToHideShow=button_12, Show=True, Collapse=True, Disable=invert(honeybee_model_displayed_3))

# ----
geometry = Data(getbrn.PrimaryData)
clean_6 = CleanTree(RemoveNulls=True, RemoveInvalid=True, RemoveEmpty=False, Tree=geometry)
data_27 = Data(clean_6)
py3_53 = Python3Script(x=data_27)  # -> out, a; inputs x: list; same code as py3
cull_18 = CullPattern(List=data_27, CullPattern=invert(py3_53.a))
layers_2 = Data(getbrn.SecondaryData1)
bake_2 = Data(bake_model_2)
ef_layer = EleFrontLayer(Layer=layers_2, fullpath=True)
bklay = BakeLayers(Layers=ef_layer, Bake=Toggle(True))
ef_att_3 = EleFrontAttributes(Layer=ef_layer, maintainBakeName=False)
weave = Weave(Pattern=[0, 1], Stream0=cull_18, Stream1=text_entity.TextEntity, NullGaps=False)
py3_54 = Python3Script(geo=weave, layers=ef_att_3)  # -> out, geo, layers; inputs geo: list, layers: list; same code as py3_2
bake_3 = BakeObjects(Geometry=py3_54.geo, Attributes=py3_54.layers, Bake=bake_2, createGroups=False)  # -> Message, Ghosts

# ----
# Zoom honeybee model
honeybee_model_bounding_box_2 = RemoteReceiver(honeybee_model_bounding_box)
zoom_honeybee_model_2 = RemoteReceiver(zoom_honeybee_model)
zbb = ZoomBoundingBox(Box=flatten(honeybee_model_bounding_box_2), Run=zoom_honeybee_model_2)

current_model_name_4 = RemoteReceiver(current_model_name)
honeybee_model = Data(loadobjects.hb_objs)
honeybee_model_2 = Data(loadobjects.hb_objs)  # disabled
model_name_dictionary_2 = RemoteReceiver(model_name_dictionary)
model_name_dictionary_3 = RemoteReceiver(model_name_dictionary)

# ---- group: Analysis module (continued)
honeybee_model_ready_5 = RemoteReceiver(honeybee_model_ready)
honeybee_model_ready_6 = RemoteReceiver(honeybee_model_ready)
honeybee_model_ready_7 = RemoteReceiver(honeybee_model_ready)
filter_62 = StreamFilter(Gate=honeybee_model_ready_5, Stream0=Slider(500, range=0..1000), Stream1=Slider(1000000, range=0..1000000))
filter_63 = StreamFilter(Gate=honeybee_model_ready_5, Stream0="Create a model before running the simulation", Stream1=" ")
filter_64 = StreamFilter(Gate=honeybee_model_ready_6, Stream0=Slider(500, range=0..1000), Stream1=Slider(1000000, range=0..1000000))
filter_65 = StreamFilter(Gate=honeybee_model_ready_6, Stream0="Create a model before running the simulation", Stream1=" ")
hideshow_35 = HideShowElement(ElementToHideShow=button_24, Show=True, Collapse=True, Disable=invert(honeybee_model_ready_7))
tooltip_12 = AttachTooltipToElement(ElementsToAttachTo=button_24, TooltipContent=filter_63, ShowDelay=filter_62, Duration=2000)
tooltip_13 = AttachTooltipToElement(ElementsToAttachTo=button_26, TooltipContent=filter_65, ShowDelay=filter_64, Duration=2000)
honeybee_model_ready_8 = RemoteReceiver(honeybee_model_ready)
hideshow_36 = HideShowElement(ElementToHideShow=button_26, Show=True, Collapse=True, Disable=invert(honeybee_model_ready_8))
hideshow_37 = HideShowElement(ElementToHideShow=label_30, Show=invert(honeybee_model_ready_4), Collapse=True, Disable=False)

# ----
honeybee_model_ready_9 = RemoteReceiver(honeybee_model_ready)  # disabled
honeybee_model_ready_10 = RemoteReceiver(honeybee_model_ready)  # disabled
filter_66 = StreamFilter(Gate=honeybee_model_ready_9, Stream0=number_slider_35, Stream1=number_slider_36)  # disabled
filter_67 = StreamFilter(Gate=honeybee_model_ready_9, Stream0=panel_104, Stream1=panel_106)  # disabled
hideshow_38 = HideShowElement(ElementToHideShow=button_30, Show=True, Collapse=True, Disable=invert(honeybee_model_ready_10))  # disabled
tooltip_14 = AttachTooltipToElement(ElementsToAttachTo=button_30, TooltipContent=filter_67, ShowDelay=filter_66, Duration=2000)  # disabled

honeybee_model_ready_11 = RemoteReceiver(honeybee_model_ready)  # disabled
honeybee_model_ready_12 = RemoteReceiver(honeybee_model_ready)  # disabled
filter_68 = StreamFilter(Gate=honeybee_model_ready_11, Stream0=number_slider_41, Stream1=number_slider_42)  # disabled
filter_69 = StreamFilter(Gate=honeybee_model_ready_11, Stream0=panel_123, Stream1=panel_125)  # disabled
hideshow_39 = HideShowElement(ElementToHideShow=button_32, Show=True, Collapse=True, Disable=invert(honeybee_model_ready_12))  # disabled
tooltip_15 = AttachTooltipToElement(ElementsToAttachTo=button_32, TooltipContent=filter_69, ShowDelay=filter_68, Duration=2000)  # disabled

settextbox_2 = SetTextBoxContents(TextBoxToModify=textbox_11, NewTextBoxContents=bang_12.Branch1)
visible_layers_3 = RemoteReceiver(flatten(visible_layers))
visible_layers_arrows_2 = RemoteReceiver(visible_layers_arrows)
int_9 = Integer(visible_layers_3)
ma_17 = MassAddition(Input=int_9)  # -> Result, PartialResults
hideshow_40 = HideShowElement(ElementToHideShow=button_49, Show=visible_layers_arrows_2, Collapse=True, Disable=False)
larger_3 = LargerThan(FirstNumber=ma_17.Result, SecondNumber="1")  # -> LargerThan, OrEqualTo
visible_layers_4 = RemoteReceiver(visible_layers)
filter_70 = StreamFilter(Gate=larger_3.LargerThan, Stream0=larger_3.LargerThan, Stream1=visible_layers_3)
hideshow_41 = HideShowElement(ElementToHideShow=stack_86, Show=visible_layers_4, Collapse=True, Disable=False)
hideshow_42 = HideShowElement(ElementToHideShow=label_50, Show=visible_layers_3, Collapse=True, Disable=False)
hideshow_43 = HideShowElement(ElementToHideShow=button_48, Show=filter_70, Collapse=True, Disable=False)

# ----
# Construction inspection launch
construction_database_visualize_construc_2 = RemoteReceiver(construction_database_visualize_construc)  # "construction_database_visualize_construction"
construction_database_visualize_construc_3 = RemoteReceiver(construction_database_visualize_construc)  # "construction_database_visualize_construction"
create_modal_location_3 = RemoteReceiver(create_modal_location)

bool_58 = Boolean(construction_database_visualize_construc_2)

# ----
# Recursion
panel_225 = Panel("Construction visualization")
objbynn_13 = GetObjectByNickname(NickName=panel_225)
construction_visualization = Python3Script()  # -> status; same code as lca_window_status

rec_29 = DataRecorder(bool_58, DataLimit=-2, RecordData=True)
ma_18 = MassAddition(Input=rec_29)  # -> Result, PartialResults
entwine_157 = Entwine(Branch00=ma_18.Result, Branch01=construction_visualization, FlattenInputs=True)
rec_30 = DataRecorder(entwine_157, DataLimit=2, RecordData=True)
item_29 = ListItem(List=rec_30, Index=0, Wrap=True)  # -> Item2, Item1, Item
equals_40 = Equality(FirstNumber=item_29.Item2, SecondNumber=item_29.Item1)  # -> Equality, Inequality
bang_14 = ExplodeTree(Data=equals_40.Inequality)  # -> Branch0, Branch1
py3_55 = Python3Script(x=bang_14.Branch0, y=bang_14.Branch1)  # -> a; same code as py3_6
event_68 = EventGate(Data=py3_55)  # -> Data, IsNew
freeze_gate_63 = StreamFreezeGate(Data=py3_55, PassingSwitch=event_68.IsNew)
event_69 = EventGate(Data=freeze_gate_63)  # -> Data, IsNew
panel_226 = Panel(event_69.Data)
launchwin_12 = LaunchWindow(
    Show=event_69.Data,
    Name="Construction inspection",
    Width=Slider(380, range=0..1000),
    Height=Slider(580, range=0..1000),
    ChildStatus=1,
    EnableHorizScroll=False)
winprops_12 = SetWindowProperties(
    Window=launchwin_12,
    StartingLocation=create_modal_location_3,
    Theme=0,
    AccentColor=heath_accent_color_6,
    ShowTitleBar=True,
    BackgroundColor=RGB(255, 255, 255),
    ScaleFactor=1)
winstat_12 = WindowStatus(Window=launchwin_12)
addelems_13 = AddElements(Window=launchwin_12, Elements=flatten(entwine_155), DoVLChecking=True)  # -> AddedElements, ElementNames
py3_56 = Python3Script(window=launchwin_12, activate=construction_database_visualize_construc_3)  # same code as py3_7
panel_227 = Panel(winstat_12)
construction_visualization_status = RemoteSender(winstat_12)

construction_visualization_status_2 = RemoteReceiver(construction_visualization_status)
expression_69 = Expression(x="Hidden", y=construction_visualization_status_2, Expression="x=y")
expire_11 = ExpireObject(ObjectToExpire=objbynn_13, Expire=expression_69)

# ----
# Recursion
panel_228 = Panel("Construction modal")
create_construction_3 = RemoteReceiver(create_construction)
objbynn_14 = GetObjectByNickname(NickName=panel_228)
construction_modal = Python3Script()  # -> status; same code as lca_window_status

# ----
# Create construction launch
create_construction_modal_2 = RemoteReceiver(create_construction_modal)
rec_31 = DataRecorder(create_construction_modal_2, DataLimit=-2, RecordData=True)
ma_19 = MassAddition(Input=rec_31)  # -> Result, PartialResults
entwine_158 = Entwine(Branch00=ma_19.Result, Branch01=construction_modal, FlattenInputs=True)
rec_32 = DataRecorder(entwine_158, DataLimit=2, RecordData=True)
item_30 = ListItem(List=rec_32, Index=0, Wrap=True)  # -> Item2, Item1, Item
equals_41 = Equality(FirstNumber=item_30.Item2, SecondNumber=item_30.Item1)  # -> Equality, Inequality
bang_15 = ExplodeTree(Data=equals_41.Inequality)  # -> Branch0, Branch1
py3_57 = Python3Script(x=bang_15.Branch0, y=bang_15.Branch1)  # -> a; same code as py3_6
event_70 = EventGate(Data=py3_57)  # -> Data, IsNew
freeze_gate_64 = StreamFreezeGate(Data=py3_57, PassingSwitch=event_70.IsNew)
event_71 = EventGate(Data=freeze_gate_64)  # -> Data, IsNew
entwine_159 = Entwine(
    Branch00=entwine_135,
    Branch01=label_49,
    Branch02=merge_14,
    Branch03=label_48,
    Branch04=button_46,
    Branch05=button_47,
    FlattenInputs=True)  # -> flatten(Result)
launchwin_13 = LaunchWindow(
    Show=event_71.Data,
    Name="Create construction",
    Width=Slider(360, range=0..1000),
    Height=Slider(540, range=0..1000),
    ChildStatus=1,
    EnableHorizScroll=False)
panel_229 = Panel(event_71.Data)
create_construction_modal_3 = RemoteReceiver(create_construction_modal)
create_modal_location_4 = RemoteReceiver(create_modal_location)
addelems_14 = AddElements(Window=launchwin_13, Elements=flatten(entwine_159), DoVLChecking=True)  # -> AddedElements, ElementNames
winprops_13 = SetWindowProperties(
    Window=launchwin_13,
    StartingLocation=create_modal_location_4,
    Theme=0,
    AccentColor=heath_accent_color_8,
    ShowTitleBar=True,
    BackgroundColor=RGB(255, 255, 255),
    ScaleFactor=1)
winstat_13 = WindowStatus(Window=launchwin_13)
py3_58 = Python3Script(window=launchwin_13, activate=create_construction_modal_3)  # same code as py3_7
create_construction_modal_status = RemoteSender(winstat_13)
construction_elements = RemoteSender(addelems_14.AddedElements)

create_construction_modal_status_2 = RemoteReceiver(create_construction_modal_status)
expression_70 = Expression(x="Hidden", y=create_construction_modal_status_2, Expression="x=y")
or_28 = GateOr(A=expression_70, C=create_construction_3)
expire_12 = ExpireObject(ObjectToExpire=objbynn_14, Expire=or_28)

# ----
# Recursion
panel_230 = Panel("Window modal")
create_window_3 = RemoteReceiver(create_window)
objbynn_15 = GetObjectByNickname(NickName=panel_230)
window_modal = Python3Script()  # -> status; same code as lca_window_status

# ----
# Create window launch
create_window_modal_3 = RemoteReceiver(create_window_modal)
rec_33 = DataRecorder(create_window_modal_3, DataLimit=-2, RecordData=True)
ma_20 = MassAddition(Input=rec_33)  # -> Result, PartialResults
entwine_160 = Entwine(Branch00=ma_20.Result, Branch01=window_modal, FlattenInputs=True)
rec_34 = DataRecorder(entwine_160, DataLimit=2, RecordData=True)
item_31 = ListItem(List=rec_34, Index=0, Wrap=True)  # -> Item2, Item1, Item
equals_42 = Equality(FirstNumber=item_31.Item2, SecondNumber=item_31.Item1)  # -> Equality, Inequality
bang_16 = ExplodeTree(Data=equals_42.Inequality)  # -> Branch0, Branch1
py3_59 = Python3Script(x=bang_16.Branch0, y=bang_16.Branch1)  # -> a; same code as py3_6
event_72 = EventGate(Data=py3_59)  # -> Data, IsNew
freeze_gate_65 = StreamFreezeGate(Data=py3_59, PassingSwitch=event_72.IsNew)
event_73 = EventGate(Data=freeze_gate_65)  # -> Data, IsNew
panel_231 = Panel(event_73.Data)
entwine_161 = Entwine(
    Branch00=stack_95,
    Branch01=stack_93,
    Branch02=stack_94,
    Branch03=stack_7,
    Branch04=data_2,
    Branch05=a4,
    Branch06=button_51,
    FlattenInputs=True)  # -> flatten(Result)
launchwin_14 = LaunchWindow(
    Show=event_73.Data,
    Name="Create window",
    Width=Slider(235, range=0..1000),
    Height=Slider(305, range=0..1000),
    ChildStatus=1,
    EnableHorizScroll=False)
create_modal_location_5 = RemoteReceiver(create_modal_location)
create_window_modal_4 = RemoteReceiver(create_window_modal)
winstat_14 = WindowStatus(Window=launchwin_14)
addelems_15 = AddElements(Window=launchwin_14, Elements=flatten(entwine_161), DoVLChecking=True)  # -> AddedElements, ElementNames
py3_60 = Python3Script(window=launchwin_14, activate=create_window_modal_4)  # same code as py3_7
winprops_14 = SetWindowProperties(
    Window=launchwin_14,
    StartingLocation=create_modal_location_5,
    Theme=0,
    AccentColor=heath_accent_color_7,
    ShowTitleBar=True,
    BackgroundColor=RGB(255, 255, 255),
    ScaleFactor=1)
create_window_modal_status = RemoteSender(winstat_14)
window_elements = RemoteSender(addelems_15.AddedElements)

create_window_modal_status_2 = RemoteReceiver(create_window_modal_status)
expression_71 = Expression(x="Hidden", y=create_window_modal_status_2, Expression="x=y")
or_29 = GateOr(A=expression_71, C=create_window_3)
expire_13 = ExpireObject(ObjectToExpire=objbynn_15, Expire=or_29)

# ----
# Recursion
panel_232 = Panel("Material modal")
create_material_3 = RemoteReceiver(create_material)
objbynn_16 = GetObjectByNickname(NickName=panel_232)
material_modal = Python3Script()  # -> status; same code as lca_window_status

# ----
# Create material launch
create_material_modal_3 = RemoteReceiver(create_material_modal)
rec_35 = DataRecorder(create_material_modal_3, DataLimit=-2, RecordData=True)
ma_21 = MassAddition(Input=rec_35)  # -> Result, PartialResults
entwine_162 = Entwine(Branch00=ma_21.Result, Branch01=material_modal, FlattenInputs=True)
rec_36 = DataRecorder(entwine_162, DataLimit=2, RecordData=True)
item_32 = ListItem(List=rec_36, Index=0, Wrap=True)  # -> Item2, Item1, Item
equals_43 = Equality(FirstNumber=item_32.Item2, SecondNumber=item_32.Item1)  # -> Equality, Inequality
bang_17 = ExplodeTree(Data=equals_43.Inequality)  # -> Branch0, Branch1
py3_61 = Python3Script(x=bang_17.Branch0, y=bang_17.Branch1)  # -> a; same code as py3_6
event_74 = EventGate(Data=py3_61)  # -> Data, IsNew
freeze_gate_66 = StreamFreezeGate(Data=py3_61, PassingSwitch=event_74.IsNew)
event_75 = EventGate(Data=freeze_gate_66)  # -> Data, IsNew
entwine_163 = Entwine(
    Branch00=stack_91,
    Branch01=pulldown_28,
    Branch02=stack_88,
    Branch03=density,
    Branch04=specific_heat,
    Branch05=data_18,
    Branch06=a4_2,
    Branch07=data_3,
    Branch08=button_50,
    FlattenInputs=True)  # -> flatten(Result)
launchwin_15 = LaunchWindow(
    Show=event_75.Data,
    Name="Create material",
    Width=Slider(250, range=0..1000),
    Height=Slider(380, range=0..1000),
    ChildStatus=1,
    EnableHorizScroll=False)
panel_233 = Panel(event_75.Data)
create_modal_location_6 = RemoteReceiver(create_modal_location)
create_material_modal_4 = RemoteReceiver(create_material_modal)
heath_accent_color_16 = RemoteReceiver(heath_accent_color)
addelems_16 = AddElements(Window=launchwin_15, Elements=flatten(entwine_163), DoVLChecking=True)  # -> AddedElements, ElementNames
py3_62 = Python3Script(window=launchwin_15, activate=create_material_modal_4)  # same code as py3_7
winprops_15 = SetWindowProperties(
    Window=launchwin_15,
    StartingLocation=create_modal_location_6,
    Theme=0,
    AccentColor=heath_accent_color_16,
    ShowTitleBar=True,
    BackgroundColor=RGB(255, 255, 255),
    ScaleFactor=1)
winstat_15 = WindowStatus(Window=launchwin_15)
material_elements = RemoteSender(addelems_16.AddedElements)
create_material_modal_status = RemoteSender(winstat_15)

create_material_modal_status_2 = RemoteReceiver(create_material_modal_status)
expression_72 = Expression(x="Hidden", y=create_material_modal_status_2, Expression="x=y")
or_30 = GateOr(A=expression_72, C=create_material_3)
expire_14 = ExpireObject(ObjectToExpire=objbynn_16, Expire=or_30)

# ----
# Constructions database
panel_234 = Panel("Heath constructions")

# ----
# Materials database
panel_235 = Panel("Heath materials")

# ----
# Weather visualisation
# # Weather visualisation
# This cluster visualises weather data from a .epw file including solar radiation and temperature, as applied to a target geometry
# 
# ## Instructions
# Enter all the inputs and visualise wind, sky view and temperature,  set `Run direct sun hours study` and `Run incident radiation study` to visualise solar radiation
# 
# ## Inputs
# - `EPW file URL` - the URL for a EPW file which describes the location
# - `Target Geometry` - geometry on which to apply irradiation study
# - `Context Geometry` - geometry which shades the target geometry
# - `Run direct sun hours study` - set to True to run the direct sun hours study
# - `Run incident radiation study` - set to True to run the incident radiation study
# - `Sky mask centre point` - point at which to generate sky mask
# 
# ## Outputs
# - `Sky dome` - mesh visualising the directions where solar radiation comes from during the year at the location
# - `Sky mask - mesh visualising what portions of the sky are visible at the specified point
# - `Wind rose` - mesh visualising wind directions and velocities during the year
# - `Dry bulb temperature line chart` - mesh visualising dry bulb temperature during the year
# - `Dry bulb temperature 2D chart` - mesh visualising dry bulb temperature for each hour of the year
# - `Direct sun hours` - mesh visualising the number of direct sun hours on the target geometry
# - `Incident radiation` - mesh visualising the incident radiation [kWh/m2] on the target geometry
# 
# ## Interpretation
# To be added...
# Visualise properties
# # Visualise properties
# This cluster visualises room and face attributes of a Honeybee model
# 
# ## Instructions
# Input the Honeybee model to be visualised and select room/face attributes using the HB Room Attributes/HB Room Energy Attibrutes/HB Face Attributes/HB Face Energy Attributes dropdown components. Adjust precision of the attributes using the `Number of decimals` inputs
# 
# ## Inputs
# - `Honeybee model` - Honeybee model to be visualised
# - `Room attribute` - Honeybee Room  or Room Energy attribute to visualise
# - `Number of decimals (room)` - Precision of room attribute output
# - `Face attribute` - Honeybee Face  or Face Energy attribute to visualise
# - `Number of decimals (face)` - Precision of face attribute output
# 
# ## Outputs
# - `Visualised room attributes` - mesh representing the selected room attribute
# - `Visualised face attributes` - mesh representing the selected face attribute
# 
# ## Interpretation
# To be added...
run_weather_visualisation_2 = RemoteReceiver(run_weather_visualisation)
data_28 = Data(loadobjects.hb_objs)
entwine_164 = Entwine(Branch00=current_model_name_4, Branch01=data_28, FlattenInputs=True)
freeze_gate_67 = StreamFreezeGate(Data=entwine_164, PassingSwitch=run_weather_visualisation_2)
split_10 = SplitTree(Data=freeze_gate_67, Masks=flatten("{0;0}"))  # -> Positive, Negative
deconstructmodel_2 = HBDeconstructModel(model=split_10.Negative)  # -> rooms, faces, apertures, doors, shades; plug-in component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
current_weather_simulation_name = RemoteSender(split_10.Positive)
room_attribute_visualize_4 = RemoteReceiver(room_attribute_visualize)
room_energy_attribute_2 = RemoteReceiver(room_energy_attribute)
face_attribute_visualize_4 = RemoteReceiver(face_attribute_visualize)
face_energy_attribute_2 = RemoteReceiver(face_energy_attribute)
room_attribute_2 = RemoteReceiver(room_attribute)
face_attribute_2 = RemoteReceiver(face_attribute)
vizquick = HBVisualizeQuick(hb_objs=flatten(deconstructmodel_2.rooms))  # -> geo; plug-in component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
vizquick_2 = HBVisualizeQuick(hb_objs=flatten(deconstructmodel_2.shades))  # -> geo; plug-in component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
location_20 = RemoteReceiver(location_2)
pt_14 = ConstructPoint(XCoordinate=Slider(21, range=0..100), YCoordinate=Slider(15, range=0..100), ZCoordinate=0)
filter_71 = StreamFilter(Gate=room_attribute_visualize_4, Stream0=room_energy_attribute_2, Stream1=room_attribute_2)
filter_72 = StreamFilter(Gate=face_attribute_visualize_4, Stream0=face_energy_attribute_2, Stream1=face_attribute_2)
data_29 = Data(loadobjects.hb_objs)
pt_15 = Point(pt_14)
data_30 = Data(location_20)
run_weather_visualisation_3 = RemoteReceiver(run_weather_visualisation)
weather_visualization_type_2 = RemoteReceiver(weather_visualization_type)
weather_visualization_show_2 = RemoteReceiver(weather_visualization_show)
weather_visualization_show_3 = RemoteReceiver(weather_visualization_show)
equals_44 = Equality(FirstNumber="3", SecondNumber=weather_visualization_type_2)  # -> Equality, Inequality
equals_45 = Equality(FirstNumber="4", SecondNumber=weather_visualization_type_2)  # -> Equality, Inequality
equals_46 = Equality(FirstNumber="5", SecondNumber=weather_visualization_type_2)  # -> Equality, Inequality
equals_47 = Equality(FirstNumber="6", SecondNumber=weather_visualization_type_2)  # -> Equality, Inequality
nor_2 = GateNor(A=equals_44.Equality, B=equals_45.Equality)
or_31 = GateOr(A=equals_46.Equality, B=equals_47.Equality)
face_energy_attribute_visualize_4 = RemoteReceiver(face_energy_attribute_visualize)
room_energy_attribute_visualize_4 = RemoteReceiver(room_energy_attribute_visualize)
face_attribute_visualize_5 = RemoteReceiver(face_attribute_visualize)
room_attribute_visualize_5 = RemoteReceiver(room_attribute_visualize)
and_39 = GateAnd(A=weather_visualization_show_3, B=or_31)
weather_visualisation_wireframe = RemoteSender(and_39)
or_32 = GateOr(A=face_attribute_visualize_5, B=face_energy_attribute_visualize_4)
or_33 = GateOr(A=room_attribute_visualize_5, B=room_energy_attribute_visualize_4)
weather_visualization_show_4 = RemoteReceiver(weather_visualization_show)
swatch_12 = ColourSwatch(SwatchColor=RGB(84, 84, 84))
gate_53 = StreamGate(Stream=swatch_12, Gate=weather_visualization_show_4)  # -> Target0, Target1

current_weather_simulation_name_2 = RemoteReceiver(current_weather_simulation_name)
format_34 = Format(Format="Current simulation: {0}", Culture=127, Data0=current_weather_simulation_name_2)
settextblock_14 = SetTextBlockContents(TextBlockToModify=tb, NewTextBlockContents=format_34)
clean_7 = CleanTree(RemoveNulls=True, RemoveInvalid=True, RemoveEmpty=False, Tree=vizquick)
clean_8 = CleanTree(RemoveNulls=True, RemoveInvalid=True, RemoveEmpty=False, Tree=vizquick_2)
gate_54 = StreamGate(Stream=data_29, Gate=event_54.Data)  # -> Target0, Target1
gate_55 = StreamGate(Stream=filter_72, Gate=event_54.Data)  # -> Target0, Target1
gate_56 = StreamGate(Stream=filter_71, Gate=event_54.Data)  # -> Target0, Target1
face_attribute_3 = Text(gate_55.Target1)
number_of_decimals_room = Number(Slider(4, range=0..10))
honeybee_model_3 = Data(gate_54.Target1)
number_of_decimals_face = Number(Slider(4, range=0..10))
room_attribute_3 = Text(gate_56.Target1)
legendpar = LBLegendParameters(num_decimals=number_of_decimals_room)  # -> leg_par; plug-in component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
legendpar_2 = LBLegendParameters(num_decimals=number_of_decimals_face)  # -> leg_par; plug-in component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
colorroomattr = HBColorRoomAttributes(rooms_model=flatten(honeybee_model_3), attribute=room_attribute_3, legend_par=legendpar)  # -> mesh, legend, wire_frame, values, colors, vis_set; plug-in component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
colorfaceattr = HBColorFaceAttributes(hb_objs=flatten(honeybee_model_3), attribute=face_attribute_3, legend_par=legendpar_2)  # -> mesh, legend, wire_frame, values, colors, vis_set; plug-in component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
visualised_room_attributes = Data([colorroomattr.mesh, colorroomattr.legend, colorroomattr.wire_frame])
visualised_face_attributes = Data([colorfaceattr.mesh, colorfaceattr.legend, colorfaceattr.wire_frame])

weather_visualisation_wireframe_2 = RemoteReceiver(weather_visualisation_wireframe)

weather_visualisation = WeatherVisualisation(
    _1=data_30,
    run_weather_visualisation=run_weather_visualisation_2,
    target_geometry_2=clean_7,
    target_geometry=clean_8,
    sky_mask_centre_point=pt_15)  # -> sky_dome, sky_mask, wind_rose, dry_bulb_temperature_line_chart, dry_bulb_temperature_2d_chart, direct_sun_hours_2, incident_radiation
entwine_165 = Entwine(
    Branch00=weather_visualisation.sky_dome,
    Branch01=weather_visualisation.sky_mask,
    Branch02=weather_visualisation.wind_rose,
    Branch03=weather_visualisation.dry_bulb_temperature_line_chart,
    Branch04=weather_visualisation.dry_bulb_temperature_2d_chart,
    Branch05=weather_visualisation.direct_sun_hours_2,
    Branch06=weather_visualisation.incident_radiation,
    FlattenInputs=True)
freeze_gate_68 = StreamFreezeGate(Data=entwine_165, PassingSwitch=run_weather_visualisation_3, Hold=True)
null_40 = NullItem(Item=flatten(freeze_gate_68))  # -> NullFlags, InvalidFlags, Description
bang_18 = ExplodeTree(Data=freeze_gate_68)  # -> Branch0, Branch1, Branch2, Branch3, Branch4, Branch5, Branch6
cull_19 = CullPattern(List=null_40.NullFlags, CullPattern=invert(null_40.NullFlags))
filter_73 = StreamFilter(
    Gate=weather_visualization_type_2,
    Stream0=bang_18.Branch0,
    Stream1=bang_18.Branch1,
    Stream2=bang_18.Branch2,
    Stream3=bang_18.Branch3,
    Stream4=bang_18.Branch4,
    Stream5=bang_18.Branch5,
    Stream6=bang_18.Branch6)
lng_32 = ListLength(List=cull_19)
gate_57 = StreamGate(Stream=filter_73, Gate=weather_visualization_show_2)  # -> Target0, Target1
weather_visualisation_exists = RemoteSender(lng_32)
gate_58 = StreamGate(Stream=gate_57.Target1, Gate=nor_2)  # -> Target0, Target1
mesh = Mesh([gate_58.Target1, gate_58.Target0])
gate_59 = StreamGate(Stream=visualised_face_attributes, Gate=or_32)  # -> Target0, Target1
gate_60 = StreamGate(Stream=visualised_room_attributes, Gate=or_33)  # -> Target0, Target1
bbox_3 = BoundingBox(Content=mesh, Plane=PlaneXY(0, 0, 0), UnionBox=True)  # -> Box, Box_2
data_31 = Data(gate_59.Target1)
data_32 = Data(gate_60.Target1)
zoom_weather_visualization_bounding_box = RemoteSender(bbox_3.Box)
preview_16 = CustomPreview(Geometry=gate_58.Target1, Material=gate_53.Target1)

# ---- group: Visualize module (continued)
weather_visualisation_exists_2 = RemoteReceiver(weather_visualisation_exists)
weather_visualisation_exists_3 = RemoteReceiver(weather_visualisation_exists)
hideshow_44 = HideShowElement(ElementToHideShow=button_18, Show=True, Collapse=True, Disable=invert(weather_visualisation_exists_2))
hideshow_45 = HideShowElement(ElementToHideShow=button_19, Show=True, Collapse=True, Disable=invert(weather_visualisation_exists_2))
hideshow_46 = HideShowElement(ElementToHideShow=[stack_20, tb], Show=weather_visualisation_exists_3, Collapse=True, Disable=False)

# ----
py3_63 = Python3Script(rhino_objects=gate_58.Target0)  # -> out, crv, mesh, other; inputs rhino_objects: list
# ---------- py3_63: Python ----------
""" Replaces SortObjectsByType from human """

import rhinoscriptsyntax as rs
import Rhino.Geometry as rg
import System
crv, mesh, other = [], [], []
for o in rhino_objects:
    if type(o) == System.Guid:
        g = rs.coercegeometry(o)
        if type(g) in [rg.PolylineCurve, rg.LineCurve]:
            crv.append(g)
        elif type(g) in [rg.Mesh]:
            mesh.append(g)
        else:
            other.append(g)
# ---------- end py3_63 ----------

# ----
# Zoom weather visualization module
zoom_weather_visualization_bounding_box_2 = RemoteReceiver(zoom_weather_visualization_bounding_box)
zoom_weather_visualization_2 = RemoteReceiver(zoom_weather_visualization)
zbb_2 = ZoomBoundingBox(Box=zoom_weather_visualization_bounding_box_2, Run=zoom_weather_visualization_2)

line = Line(py3_63.crv)
null_41 = NullItem(Item=line)  # -> NullFlags, InvalidFlags, Description
data_33 = Data([py3_63.mesh, py3_63.other])
sift = SiftPattern(List=py3_63.crv, SiftPattern=null_41.NullFlags)  # -> Output0, Output1
preview_17 = CustomPreview(Geometry=[sift.Output1, data_33], Material=swatch_12)

# ----
# Bake weather visualization
merge_17 = Merge(Data1=sift.Output1, Data2=data_33, Data3=gate_58.Target1)
simple_energy_simulation_annual_energy_b = Data(merge_17)  # "simple_energy_simulation_Annual_energy_balance"
panel_236 = Panel("""Heath::weather::Sky dome
Heath::weather::Sky mask
Heath::weather::Wind rose
Heath::weather::Dry bulb temperature line chart
Heath::weather::Dry bulb temperature 2D chart
Heath::weather::Direct sun hours
Heath::weather::Incident radiation""")
weather_visualization_type_3 = RemoteReceiver(weather_visualization_type)
weather_visualisation_bake_2 = RemoteReceiver(weather_visualisation_bake)
clean_9 = CleanTree(RemoveNulls=True, RemoveInvalid=True, RemoveEmpty=False, Tree=simple_energy_simulation_annual_energy_b)
indices = ListIndices(Data=simple_energy_simulation_annual_energy_b)
index = ItemIndex(List=simple_energy_simulation_annual_energy_b, Item=clean_9)
item_33 = ListItem(List=panel_236, Index=weather_visualization_type_3, Wrap=invert(True))
exdiff = SetDifferenceS(SetA=indices, SetB=index)
item_34 = ListItem(List=simple_energy_simulation_annual_energy_b, Index=exdiff, Wrap=True)
gate_61 = StreamGate(Stream=item_33, Gate=weather_visualisation_bake_2)  # -> Target0, Target1
alignvert = AlignVertices(Mesh=item_34, Tolerance=0.01)  # -> Result, Count
clean_10 = CleanTree(RemoveNulls=True, RemoveInvalid=True, RemoveEmpty=False, Tree=alignvert.Result)
merge_18 = Merge(Data1=clean_9, Data2=clean_10)
connected = GetConnectedObjects(Objects=merge_18)

bake_geometries_to_layers = BakeGeometriesToLayers(geometry=merge_18, layers=gate_61.Target1, bake=weather_visualisation_bake_2)
panel_237 = Panel(merge_18)

# ---- group: Analyse performance
# Simple energy simulations
# # Simple energy simulations
# Streamlined energy simulations which calculate energy balance across the year, and peak loads on the design day, for the input Honeybee rooms.
# 
# ## Instructions
# Enter all inputs and set `Run Energy Balance` or `Run Peak Loads`to True to investigate energy use for the specified Honeybee rooms considering the specified Honeybee shade objects. Adjust the y axis of output graphs using the `Graph max` input.
# 
# ## Inputs
# - `EPW file URL` - the URL for a EPW file which describes the location
# - `Honeybee rooms` - the Honeybee rooms which shall be analysed
# - `Shading objects` - Honeybee shade objects which block solar radiation toward the simulated rooms
# - `Run Energy Balance` - set to True to run the energy balance simulation
# - `Run Peak Loads` - set to True to run the peak loads simulation
# - `Graph max` - max value for the y axis of output graphs
# 
# ## Outputs
# - `Annual energy balance` - mesh visualising energy balance of each month of the year broken down into energy sources/sinks
# - `Daily cooling profile` - mesh visualising the cooling need during the design day (hottest day of the year)
# - `Daily heating profile` - mesh visualising the heating need during the design day (coldest day of the year)
# - `Cooling balance (design day)` - mesh visualising the cooling sources and sinks during the design day (hottest day of the year)
# - `Heating balance (design day)` - mesh visualising the heating sources and sinks during the design day (coldest day of the year)
# 
# ## Interpretation
# To be added...
pre_run_simple_energy_simulations_3 = RemoteReceiver(pre_run_simple_energy_simulations)
location_21 = RemoteReceiver(location_2)
toggle_5 = BooleanToggle(True)
data_34 = Data(location_21)
honeybee_rooms = Data(deconstructmodel.rooms)
shades = Data(deconstructmodel.shades)
objbynn_17 = GetObjectByNickname(NickName="PeakLoads")
objbynn_18 = GetObjectByNickname(NickName="AnnualLoads")
current_model_name_5 = RemoteReceiver(current_model_name)
run_simple_energy_simulations_2 = RemoteReceiver(run_simple_energy_simulations)
simple_energy_simulation_height_2 = RemoteReceiver(simple_energy_simulation_height)
colrange_2 = LBColorRange(index=Slider(0, range=0..26))  # -> colors; plug-in component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
colrange_3 = LBColorRange(index=Slider(26, range=0..26))  # -> colors; plug-in component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
number_slider_76 = Slider(760000, range=0..1000000)
neg_2 = Negative(Value=Slider(100000, range=0..100000))
addition_3 = Addition(A=simple_energy_simulation_height_2, B=Slider(15, range=0..100))
Y = UnitY(Factor=addition_3)
simple_energy_simulation_base_point_2 = RemoteReceiver(simple_energy_simulation_base_point)
simple_energy_simulation_height_3 = RemoteReceiver(simple_energy_simulation_height)
simple_energy_simulation_width_2 = RemoteReceiver(simple_energy_simulation_width)
move = Move(Geometry=pt_4, Motion=Y)  # -> Geometry, Transform
simple_energy_simulation_base_point_comp = RemoteSender(move.Geometry)  # "simple_energy_simulation_base_point_compare"

# ----
entwine_166 = Entwine(
    Branch00=data_34,
    Branch01=honeybee_rooms,
    Branch02=shades,
    Branch03=pre_run_simple_energy_simulations_3,
    FlattenInputs=True)
panel_238 = Panel(pre_run_simple_energy_simulations_3)

# ----
# Detailed energy simulations
# https://energyplus-weather.s3.amazonaws.com/africa_wmo_region_1/LBY/LBY_Tripoli.620100_IWEC/LBY_Tripoli.620100_IWEC.zip
# # Detailed energy simulations
# This cluster simulates energy balance over a year and outputs the total energy use intensity (EUI), divided into end uses, and detailed graphs of the energy balance, peak cooling/heating, and cooling/heating load profiles
# 
# ## Instructions
# Enter all inputs and set `Run Energy Simulation` to true to run the energy simulation
# 
# ## Inputs
# - `EPW file URL` - the URL for a EPW file which describes the location
# - `Honeybee model` - the Honeybee model for analysis
# - `Run Energy Simulation` - set to True to run the energy simulation
# 
# ## Outputs
# - `Energy use intensity [kWh/m2a]` - A number representing the total energy use of the model
# - `Energy use intensity per end use [kWh/m2a]` - A list of values with the energy uses split into different end uses
# - `End uses` - A list of text strings representing the different end uses
# - `Annual hourly energy results` - various meshes representing different energy results over the hours of the year
# - `Monthly energy balance` - A monthly breakdown of the energy balance, with energy sources in the top and energy sinks in the bottom
# - `Peak cooling` - A number representing the peak cooling load in each zone
# - `Peak heating` - A number representing the peak heating load in each zone
# - `Cooling load profile` - A mesh representing the cooling load profile during the design day
# - `Heating load profile` - A mesh representing the heating load profile during the design day
# 
# ## Interpretation
# To be added...
run_detailed_energy_simulations_2 = RemoteReceiver(run_detailed_energy_simulations)  # disabled
data_35 = Data(location_6)  # disabled
data_36 = Data()  # disabled
toggle_6 = BooleanToggle(True)  # disabled
epw_file_url = Data(data_35)  # disabled
downloadepw_2 = LBDownloadWeather(weather_URL=epw_file_url)  # -> epw_file, stat_file, ddy_file; disabled; plug-in component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
number_slider_77 = Slider(50, range=0..100)  # disabled

freeze_gate_69 = StreamFreezeGate(Data=data_36, PassingSwitch=run_detailed_energy_simulations_2, Freeze=True)  # disabled

# ----
# Daylight (Illuminance, DA and UDI)
# # Daylight (Illuminance, DA and UDI)
# This cluster simulates illuminance for a specified hour of the year and daylight autonomy (DA) and useful daylight illuminance (UDI) for the entire year across an analysis surface.
# 
# ## Instructions
# Enter all inputs and set `Run Illuminance` or `Run Annual Daylight Simulation`to True to investigate daylight. The illuminance study covers a specified time step whereas the annual daylight simulation covers the full year. The `grid size` and `detail level` inputs can be used to improve the fidelity of the simulation at the cost of simulation time. The study can take several minutes, depending on the grid size and detail level.
# 
# ## Inputs
# - `EPW file URL` - the URL for a EPW file which describes the location
# - `Honeybee model` - the Honeybee model for analysis
# - `Grid size` - the resolution of the analysis grid in metres
# - `Detail level (0-2)` - level of detail for the daylight simulation, the higher value, the higher detail and the slower the simulation
# - `Month (illuminance)` - month of the analysis period  for the illuminance simulation (1-12)
# - `Day (illuminance)` - date of the analysis period for the illuminance simulation (1-31)
# - `Hour (illuminance)` - hour of the analysis period for the illuminance simulation (0-23)
# - `Run Illuminance` - set to True to run the illuminance analysis for the specified timestep
# - `Run Annual Daylight Simulation` - set to True to run the full year daylight simulation
# 
# ## Outputs
# - `Illuminance [Lux]` - a mesh visualising the amount of incident radiation which hits the analysis surface at the specified timestep
# - `Spatial Daylight Autonomy [-]` - the mean SDA for the entire analysis surface
# - `Daylight autonomy [%]` - a mesh visualising the value of DA across the analysis surface
# - `UDI [%]` - a mesh visualising the value of Useful Daylight Illuminance across the analysis surface
# - `UDI <50 [%]` - a mesh visualising the percentage of time that the lower treshold of illuminance is not achieved across the analysis surface
# - `UDI >3000 [%]` - a mesh visualising the percentage of time that the upper treshold of illuminance is exceeded across the analysis surface
# 
# ## Interpretation
# To be added...
toggle_7 = BooleanToggle(True)
data_37 = Data(location_7)
honeybee_model_4 = Data(honeybee_model)
panel_239 = Panel(run_daylight_simulations_2)
cluster_10 = Cluster_6()
number_slider_78 = Slider(0, range=0..400)  # disabled
number_slider_79 = Slider(1.2, range=0..5)  # disabled
X = UnitX(Factor=number_slider_78)  # disabled

entwine_167 = Entwine(Branch00=data_37, Branch01=honeybee_model_4, Branch02=run_daylight_simulations_2, FlattenInputs=True)
freeze_gate_70 = StreamFreezeGate(Data=entwine_167, PassingSwitch=run_daylight_simulations_2, Freeze=True)
bang_19 = ExplodeTree(Data=freeze_gate_70)  # -> Branch0, Branch1, Branch2

# ---- group: Set up sensor grids
# Alternatively create grid from surface
deconstructmodel_3 = HBDeconstructModel(model=bang_19.Branch1)  # -> rooms, faces, apertures, doors, shades; disabled; plug-in component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
decnstrobj = HBDeconstructObject(hb_obj=deconstructmodel_3.rooms)  # -> faces, apertures, doors, shades; disabled; plug-in component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
number_slider_80 = Slider(0, range=0..5)  # disabled
vizquick_3 = HBVisualizeQuick(hb_objs=decnstrobj.faces)  # -> geo; disabled; plug-in component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
number_slider_81 = Slider(0.7, range=0..5)  # disabled
number_slider_82 = Slider(1, range=0..5)  # disabled
area_2 = Area(Geometry=vizquick_3)  # -> Area, Centroid; disabled
pdecon_5 = Deconstruct(Point=area_2.Centroid)  # -> XComponent, YComponent, ZComponent; disabled
sort = SortList(Keys=pdecon_5.ZComponent, ValuesA=vizquick_3)  # -> Keys, ValuesA; disabled
srf = Surface(sort.ValuesA)  # disabled
item_35 = ListItem(List=srf, Index=number_slider_80, Wrap=True)  # disabled
flip = Flip(Surface=item_35)  # -> Surface, Result; disabled
genpts = LBGeneratePointGrid(geometry=flip.Surface, grid_size=number_slider_82, offset_dist=number_slider_81)  # -> points, vectors, face_areas, mesh; disabled; plug-in component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
sensorgrid = HBSensorGrid(positions=genpts.points, directions=genpts.vectors, mesh=genpts.mesh)  # -> grid; disabled; plug-in component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

# ----
null_42 = NullItem(Item=bang_19.Branch2)  # -> NullFlags, InvalidFlags, Description
filter_74 = StreamFilter(Gate=null_42.NullFlags, Stream0=bang_19.Branch2, Stream1="False")
bool_59 = Boolean(filter_74)

# ----
# Create analysis grid
number_slider_83 = Slider(1, range=0..10)
grid_size = Number(number_slider_83)
honeybee_model_5 = Data(bang_19.Branch1)
gridrooms = HBSensorGridFromRooms(rooms=honeybee_model_5, grid_size=grid_size, dist_floor=Slider(0.7, range=0..5))  # -> grid, points, mesh; plug-in component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
assigngridsviews = HBAssignGridsAndViews(model=honeybee_model_5, grids=flatten(gridrooms.grid))  # -> model; plug-in component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
grid_mesh = Data(gridrooms.mesh)
honeybee_model_6 = Data(assigngridsviews)

# ----
# Daylight Glare Probability (DGP)
# # Daylight Glare Probability
# This cluster calculates the DGP for a specific view.
# 
# ## Instructions
# Enter all inputs and set `Run Glare analysis`to True to investigate glare potential for the set viewport and time. For a simple model this simulation takes around 50-60s.
# 
# ## Inputs
# - `EPW file URL` - the URL for a EPW file which describes the location
# - `Honeybee model` - the Honeybee model for analysis
# - `Viewport name` - the string name of a viewport in the Rhino model which shall be analysed
# - `Month` - month of the analysis period (1-12)
# - `Day` - date of the analysis period (1-31)
# - `Hour` - hour of the analysis period (0-23)
# - `Run Glare analysis` - set to True to run the analysis
# 
# ## Outputs
# - `Daylight glare probability (DGP)` - a value for the probability of glare occuring in this view at this time [%]
# - `HDR image` - a HDR image which can be visualised using LB ImageViewer to show what areas cause glare
# - `HDR false color image` - a HDR image with modified colors to more clearly see causes of glare
# 
# ## Interpretation
# To be added...
panel_240 = Panel("Perspective")  # disabled
number_slider_84 = Slider(6, range=1..12)  # disabled
calculate_glare_probability_2 = RemoteReceiver(calculate_glare_probability)  # disabled
number_slider_85 = Slider(21, range=1..31)  # disabled
number_slider_86 = Slider(12, range=0..23)  # disabled
txt_8 = Text(panel_240)  # disabled
run_glare_analysis = Boolean(calculate_glare_probability_2)  # disabled
day = Number(number_slider_85)  # disabled
hour = Number(number_slider_86)  # disabled
month = Number(number_slider_84)  # disabled
panel_241 = Panel("1")  # disabled
# Here was once the Glare visualisations using Ladybug Image Viewer. Check old tool versions (<0.7.0) if this is to be implemented
num_9 = Number(calculate_glare_probability_2)  # disabled
num_10 = Number(calculate_glare_probability_2)  # disabled

freeze_gate_71 = StreamFreezeGate(Data=honeybee_model_2, PassingSwitch=calculate_glare_probability_2, Freeze=True)  # disabled
gate_62 = StreamGate(Stream=objbynn, Gate=run_glare_analysis)  # -> Target0, Target1; disabled
hold_6 = HoldingGate(Data=gate_62.Target1)  # disabled
msgs = GetRuntimeMessages(Objects=hold_6)  # -> Errors, Warnings; disabled
pitview_message_warning = RemoteSender(msgs.Warnings)  # disabled
pitview_message_error = RemoteSender(msgs.Errors)  # disabled

pitview_message_warning_2 = RemoteReceiver(pitview_message_warning)  # disabled
pitview_message_error_2 = RemoteReceiver(pitview_message_error)  # disabled
lng_33 = ListLength(List=pitview_message_error_2)  # disabled
lng_34 = ListLength(List=pitview_message_warning_2)  # disabled
ma_22 = MassAddition(Input=[lng_33, lng_34])  # -> Result, PartialResults; disabled
bool_60 = Boolean(ma_22.Result)  # disabled
hasdata_11 = DataExists(Data=bool_60)  # disabled
filter_75 = StreamFilter(Gate=hasdata_11, Stream0=panel_107, Stream1=bool_60)  # disabled
filter_76 = StreamFilter(Gate=lng_33, Stream0=panel_109, Stream1=panel_110)  # disabled
filter_77 = StreamFilter(Gate=lng_33, Stream0=swatch_7, Stream1=swatch_8)  # disabled
adjustelem_26 = AdjustElementAppearance(ElementsToAdjust=tb_13, Foreground=filter_77)  # disabled
settextblock_15 = SetTextBlockContents(TextBlockToModify=tb_13, NewTextBlockContents=filter_76)  # disabled
hideshow_47 = HideShowElement(ElementToHideShow=tb_13, Show=filter_75, Collapse=True, Disable=False)  # disabled

# ---- group: Analyse performance (continued)
freeze_gate_72 = StreamFreezeGate(Data=entwine_166, PassingSwitch=pre_run_simple_energy_simulations_3, Freeze=True)

# ----
bang_20 = ExplodeTree(Data=freeze_gate_72)  # -> Branch0, Branch1, Branch2, Branch3

# ---- group: Analyse performance (continued)
null_43 = NullItem(Item=bang_20.Branch3)  # -> NullFlags, InvalidFlags, Description
downloadepw_3 = LBDownloadWeather(weather_URL=bang_20.Branch0)  # -> epw_file, stat_file, ddy_file; plug-in component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
filter_78 = StreamFilter(Gate=null_43.NullFlags, Stream0=bang_20.Branch3, Stream1="False")
run_energy_balance = Boolean(filter_78)
data_38 = Data(bang_20.Branch1)
data_39 = Data(bang_20.Branch2)
data_40 = Data(downloadepw_3.epw_file)
run_peak_loads = Boolean(filter_78)
honeybee_rooms_2 = Data(bang_20.Branch1)
data_41 = Data(downloadepw_3.ddy_file)
shading_geometry = Data(bang_20.Branch2)
annualloads = HBAnnualLoads(rooms=flatten(data_38), epw_file=data_40, run_bal=run_energy_balance, run=run_energy_balance)  # -> report, total_load, cooling, heating, lighting, equip, process, hot_water, balance; plug-in component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
panel_242 = Panel(annualloads.report)
peakloads = HBPeakLoads(rooms=honeybee_rooms_2, ddy_file=data_41, run_bal=run_peak_loads, run=run_peak_loads)  # -> report, peak_cool, peak_heat, cooling, heating, cool_bal, heat_bal; plug-in component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
panel_243 = Panel(peakloads.report)
gate_63 = StreamGate(Stream=objbynn_17, Gate=run_peak_loads)  # -> Target0, Target1
gate_64 = StreamGate(Stream=objbynn_18, Gate=run_energy_balance)  # -> Target0, Target1
hold_7 = HoldingGate(Data=gate_63.Target1)
annual_energy_balance_data = Data(peakloads.cooling)
annual_energy_balance_data_2 = Data(peakloads.cool_bal)
hold_8 = HoldingGate(Data=gate_64.Target1)
annual_energy_balance_data_3 = Data(peakloads.heating)
annual_energy_balance_data_4 = Data(peakloads.heat_bal)
annual_energy_balance_data_5 = Data(annualloads.balance)
total_load_eui = Data(annualloads.total_load)
simple_energy_simulations_report = RemoteSender(peakloads.report)
msgs_2 = GetRuntimeMessages(Objects=hold_7)  # -> Errors, Warnings
simple_energy_simulations_report_2 = RemoteSender(annualloads.report)
msgs_3 = GetRuntimeMessages(Objects=hold_8)  # -> Errors, Warnings
entwine_168 = Entwine(
    Branch00=total_load_eui,
    Branch01=annual_energy_balance_data_5,
    Branch02=annual_energy_balance_data,
    Branch03=annual_energy_balance_data_3,
    Branch04=annual_energy_balance_data_2,
    Branch05=annual_energy_balance_data_4,
    FlattenInputs=True)
peakloads_message_error = RemoteSender(msgs_2.Errors)
peakloads_message_warning = RemoteSender(msgs_2.Warnings)
panel_244 = Panel(msgs_3.Warnings)
annualloads_message_error = RemoteSender(msgs_3.Errors)
annualloads_message_warning = RemoteSender(msgs_3.Warnings)
null_44 = NullItem(Item=flatten(entwine_168))  # -> NullFlags, InvalidFlags, Description
item_36 = ListItem(List=null_44.NullFlags, Index=0, Wrap=True)
gate_65 = StreamGate(Stream=entwine_168, Gate=item_36)  # -> Target0, Target1
entwine_169 = Entwine(Branch0X=gate_65.Target0, Branch1X=current_model_name_5, FlattenInputs=False)
freeze_gate_73 = StreamFreezeGate(Data=entwine_169, PassingSwitch=run_simple_energy_simulations_2, Freeze=True, Hold=False)
split_11 = SplitTree(Data=freeze_gate_73, Masks=flatten("{1;*}"))  # -> Positive, Negative
rec_37 = DataRecorder(split_11.Positive, DataLimit=-10, RecordData=True)
rec_38 = DataRecorder(graft(split_11.Negative), DataLimit=-10, RecordData=True)

# ----
py3_64 = Python3Script(all_simulated_models=rec_37, model_dictionary=model_name_dictionary_2)  # -> out, simulated_models_renamed; inputs all_simulated_models: list, model_dictionary: list
# ---------- py3_64: Python ----------
if model_dictionary and len(model_dictionary):
    mapping = {}
    for (key, value) in model_dictionary:
        mapping[key] = value

    # Resolve transitive mappings
    for key in list(mapping.keys()):
        while mapping.get(mapping[key], None):
            mapping[key] = mapping[mapping[key]]

    simulated_models_renamed = [mapping.get(x, x) for x in all_simulated_models]
else: simulated_models_renamed = all_simulated_models
# ---------- end py3_64 ----------
py3_65 = Python3Script(
    all_simulated_models=py3_64.simulated_models_renamed,
    existing_models=current_all_created_models_names_5,
    all_simulation_data=rec_38)  # -> out, filtered_simulated_models, filtered_simulation_data_pattern; inputs all_simulated_models: list, existing_models: list, all_simulation_data: tree
# ---------- py3_65: Python ----------
from ghpythonlib import treehelpers as th
import Grasshopper as gh

model_indexes = {}
for i, m in enumerate(all_simulated_models):
    if m in existing_models:
        # we make sure here to take the latest index with a unique name
        model_indexes[m] = i

filtered_simulation_data_pattern = gh.DataTree[object](all_simulation_data)
for i, branch in enumerate(filtered_simulation_data_pattern.Branches):
    for j in range(len(branch)):
        branch[j] = j in model_indexes.values()

filtered_simulated_models = list(model_indexes.keys())
#filtered_simulation_data = th.list_to_tree(filtered_simulation_data)
# ---------- end py3_65 ----------
cull_20 = CullPattern(List=rec_38, CullPattern=py3_65.filtered_simulation_data_pattern)
mindex_8 = MemberIndex(Set=py3_65.filtered_simulated_models, Member=current_selected_model_analysis_module_n_6)  # -> flatten(Index), Count
item_37 = ListItem(List=mindex_8.Index, Index="-1", Wrap=True)
null_45 = NullItem(Item=mindex_8.Count)  # -> NullFlags, InvalidFlags, Description
filter_79 = StreamFilter(Gate=null_45.NullFlags, Stream0=mindex_8.Count, Stream1="False")
simple_energy_data_exists = RemoteSender(filter_79)
simple_energy_data_exists_2 = RemoteReceiver(simple_energy_data_exists)
simple_energy_data_exists_3 = RemoteReceiver(simple_energy_data_exists)

# ----
# Reports
simple_energy_simulations_report_3 = RemoteReceiver([simple_energy_simulations_report, simple_energy_simulations_report_2])

# ---- group: Analysis module (continued)
annualloads_message_warning_2 = RemoteReceiver(annualloads_message_warning)
peakloads_message_warning_2 = RemoteReceiver(peakloads_message_warning)
annualloads_message_error_2 = RemoteReceiver(annualloads_message_error)
peakloads_message_error_2 = RemoteReceiver(peakloads_message_error)
simple_energy_data_exists_4 = RemoteReceiver(simple_energy_data_exists)
lng_35 = ListLength(List=[peakloads_message_error_2, annualloads_message_error_2])
lng_36 = ListLength(List=[peakloads_message_warning_2, annualloads_message_warning_2])
simple_energy_data_exists_5 = RemoteReceiver(simple_energy_data_exists)
simple_energy_data_exists_6 = RemoteReceiver(simple_energy_data_exists)
ma_23 = MassAddition(Input=[lng_36, lng_35])  # -> Result, PartialResults
bool_61 = Boolean(ma_23.Result)
hasdata_12 = DataExists(Data=bool_61)
hideshow_48 = HideShowElement(ElementToHideShow=button_23, Show=simple_energy_data_exists_5, Collapse=True, Disable=False)
hideshow_49 = HideShowElement(ElementToHideShow=button_22, Show=simple_energy_data_exists_6, Collapse=True, Disable=False)
filter_80 = StreamFilter(Gate=hasdata_12, Stream0="False", Stream1=bool_61)
simple_energy_data_exists_7 = RemoteReceiver(simple_energy_data_exists)
simple_energy_data_exists_8 = RemoteReceiver(simple_energy_data_exists)
hideshow_50 = HideShowElement(ElementToHideShow=tb_5, Show=filter_80, Collapse=True, Disable=False)
simple_energy_data_exists_9 = RemoteReceiver(simple_energy_data_exists)
hideshow_51 = HideShowElement(ElementToHideShow=tb_9, Show=simple_energy_data_exists_7, Collapse=True, Disable=False)
simple_energy_data_exists_10 = RemoteReceiver(simple_energy_data_exists)
bool_62 = Boolean(invert(simple_energy_data_exists_8))
hideshow_52 = HideShowElement(ElementToHideShow=tb_8, Show=bool_62, Collapse=simple_energy_data_exists_8, Disable=False)
hideshow_53 = HideShowElement(ElementToHideShow=entwine_50, Show=simple_energy_data_exists_9, Collapse=True, Disable=False)

# ----
bool_63 = Boolean(lng_35)

# ---- group: Analysis module (continued)
filter_81 = StreamFilter(Gate=bool_63, Stream0="Warning", Stream1="Error")
filter_82 = StreamFilter(Gate=bool_63, Stream0=ColourSwatch(SwatchColor=RGB(237, 185, 94)), Stream1=ColourSwatch(SwatchColor=RGB(226, 54, 54)))
adjustelem_27 = AdjustElementAppearance(ElementsToAdjust=tb_5, Foreground=filter_82)
settextblock_16 = SetTextBlockContents(TextBlockToModify=tb_5, NewTextBlockContents=filter_81)

# ----
# Revised LCA calculation
# # Life Cycle Assessment (LCA)
# This cluster calculates the embodied carbon for the input Honeybee model
# 
# ## Instructions
# Enter the inputs to calculate the GWP (Global Warming Potential), i.e. the embodied carbon, for the materials in the Honeybee model
# 
# ## Inputs
# - `Honeybee model` - the Honeybee model for analysis
# 
# ## Outputs
# - `Total GWP` - total GWP for the modules A1-A5.1 [kg CO2eq]
# - `GWP by element type` - GWP of each element type for the modules A1-A5.1 [kg CO2eq]
# - `Element types` - list of element types in the model
# 
# ## Interpretation
# To be added...
data_42 = Data(loadobjects.hb_objs)
bool_64 = Boolean(geoprop.floor_area)
get_resources = BrimstoneGetResources(json_data=get_categories.json_data, category="Energy and fuel")  # -> out, json_data, resources
# ---------- get_resources: Python ----------
"""Extracts resource names from a Klimatdatabas json object
    Inputs:
        json_data: dictionary with json data
        category: readable name of category to extract resources from
    Output:
        resources: List of resources in category"""

import scriptcontext

import brimstone
ghenv.Component.Message = brimstone.globals.version

ghenv.Component.Name = 'Brimstone - Get Resources'
ghenv.Component.NickName = 'Get Resources'

def main(json_data, category):
    resources = get_resources(json_data, category)
    return resources
    
def get_resources(json_data, category):
    pred = lambda v: v["Text"] == category
    resources = []
    for resource in json_data["Resources"]:
        if len(filter(pred, resource["Categories"])) > 0:
            resources.append(resource["Name"])
    return resources

if __name__ == "__main__":
    if not scriptcontext.sticky["brimstone_flying"]:
        raise Exception("The 'Brimstone - Fly' component needs to exist on the canvas")
    print json_data
    resources = main(json_data, category)
    
    json_data = [json_data]
# ---------- end get_resources ----------
list_11 = ItemSelector(get_resources.resources)
get_lca_data = BrimstoneGetLCAData(json_data=get_resources.json_data, resources="District heating, Swedish average")  # -> out, json_data, lca_data, indicators, values; inputs resources: list, addtl_indicators: list
#   port json_data: List of resources in category
# ---------- get_lca_data: Python ----------
"""Extracts LCA indicators and values from a Klimatdatabas json for a specific resource
    Inputs:
        json_data: dictionary with json data
        resources: list of readable names of resources
        addtl_indicators: list of additional keys to retrieve from resource
    Output:
        lca_data: list of dictionaries with LCA data for each resource
        indicators: list of indicators
        values: list of indicator values"""

import scriptcontext
import ghpythonlib.treehelpers as th
from collections import OrderedDict
import copy

import brimstone
ghenv.Component.Message = brimstone.globals.version

ghenv.Component.Name = 'Brimstone - Get LCA Data'
ghenv.Component.NickName = 'Get LCA Data'

# todo: magic string here - not good!
gwp_data_string = "Global Warming potential"

# keys: names in output dict, values: DataModuleCode in json db
gwp_data_entries = {
    "GWPA1A3Conservative": "A1-A3 Conservative",
    "GWPA1A3Typical": "A1-A3 Typical",
    "GWPA4": "A4",
    "GWPA5.1": "A5.1",
}

def main(json_data, resource, addtl_indicators):
    lca_data, indicators, values = [], [], []

    for i, resource in enumerate(resources):
        lca_data.append(get_lca_data(json_data, resource, addtl_indicators))
        resource_indicators, resource_values = get_indicator_values(lca_data[i], addtl_indicators)
        indicators.append(resource_indicators)
        values.append(resource_values)
    return lca_data, indicators, values
    
def get_lca_data(json_data, resource_name, addtl_indicators):
    resource_data = copy.deepcopy(
        find_obj_in_array(
            json_data["Resources"],
            "Name",
            resource_name
        )
    )
    
    if not resource_data:
        raise Exception(
            "Resource with name {resource_name} was not found in database."
            .format(resource_name = resource_name)
       )
    try:
        lca_data = extract_lca_data(resource_data, addtl_indicators)
    except KeyError:
        raise Exception("Format of JSON data is not supported.")
    return lca_data

def extract_lca_data(resource_data, addtl_indicators):
    lca_data = OrderedDict()
    resource_name = resource_data["Name"]
    
    lca_data["Name"] = resource_name
    
    if "Conversions" in resource_data:
        # can a resource have multiple conversions?
        lca_data["ConversionUnit"] = resource_data["Conversions"][0]["Unit"]
        lca_data["ConversionValue"] = resource_data["Conversions"][0]["Value"]
    
    if "InventoryUnit" in resource_data:
        lca_data["InventoryUnit"] = resource_data["InventoryUnit"]
    
    for data_prop in resource_data["DataItems"]:
        if data_prop["PropertyName"] == gwp_data_string:
            gwp_data = copy.deepcopy(data_prop)
            break
            
    if not gwp_data:
        raise Exception("GWP data not found for {resource_name}"
            .format(resource_name = resource_name))
    
    lca_data["GWPUnit"] = gwp_data["PropertyUnitCode"]
    for key in gwp_data_entries:
        value = find_obj_in_array(
            gwp_data["DataValueItems"],
            "DataModuleCode",
            gwp_data_entries[key]
        )
        if value is not None:
            lca_data[key] = value["Value"]
            
    for addtl_indicator in addtl_indicators:
        if addtl_indicator in resource_data:
            lca_data[addtl_indicator] = resource_data[addtl_indicator]
    
    return lca_data

def find_obj_in_array(array, key, value):
    return next((x for x in array if x[key] == value), None)

def get_indicator_values(lca_data, addtl_indicators):
    indicator_dict = OrderedDict([
        ("Name", "Name"),
        ("InventoryUnit", "Inventory unit"),
        ("ConversionUnit", "Conversion unit"),
        ("ConversionValue", "Conversion value"),
        ("GWPUnit", "GWP unit"),
        ("GWPA1A3Conservative", "GWP (A1-A3 Conservative)"),
        ("GWPA1A3Typical", "GWP (A1-A3 Typical)"),
        ("GWPA4", "GWP (A4)"),
        ("GWPA5.1", "GWP (A5.1)"),
    ])
    
    for addtl_indicator in addtl_indicators:
        indicator_dict[addtl_indicator] = addtl_indicator
    
    indicators, values = [], []
    
    for key, indicator_name in indicator_dict.items():
        indicator_value = lca_data[key] if key in lca_data else None
        if indicator_value:
            indicators.append(indicator_name)
            values.append(indicator_value)
    
    return indicators, values

if __name__ == "__main__":
    if not scriptcontext.sticky["brimstone_flying"]:
        raise Exception("The 'Brimstone - Fly' component needs to exist on the canvas")
    lca_data, indicators, values = main(json_data, resources, addtl_indicators)
    
    lca_data_treeable = []
    
    for resource_lca_data in lca_data:
        lca_data_treeable.append([resource_lca_data.keys(), resource_lca_data.values()])
    lca_data = th.list_to_tree(lca_data_treeable)
    indicators = th.list_to_tree(indicators)
    values = th.list_to_tree(values)
    json_data = [json_data]
# ---------- end get_lca_data ----------
area_m2 = Data(geoprop.floor_area)
panel_245 = Panel("kg CO2eq")
lca_total_gfa = RemoteSender(area_m2)

lca_total_gfa_2 = RemoteReceiver(lca_total_gfa)
calculate_honeybee_model = BrimstoneCalculateEmbodiedCarbonOfHoneybeeModel(hb_model=data_42, kdb_json_data=get_categories.json_data)  # -> tot_emb_carbon, elements, el_emb_carbon, elements_modules, el_emb_carbon_modules
# ---------- calculate_honeybee_model: Python ----------
"""
Calculates embodied carbon for the elements of a Honeybee model if data is available
This component was inspired by the 'HB Color Face Attributes' component of Ladybug Tools 1.6.0

    Args:
        hb_model: Honeybee model for analysis
        kdb_json_data: Optional json data object for materials which do not include impact data

    Returns:
        tot_emb_carbon: total embodied carbon of model
        elements: element types in the model
        el_emb_carbon: embodied carbon for each element type in the model
"""

import scriptcontext
import brimstone
ghenv.Component.Message = brimstone.globals.version
import Grasshopper
import os
import csv, codecs

ghenv.Component.Name = 'Brimstone - Calculate Embodied Carbon of Honeybee Model'
ghenv.Component.NickName = 'Calculate Honeybee Model'

try:  # import the core honeybee dependencies
    from honeybee_energy.construction.windowshade import WindowConstructionShade
    from honeybee_energy.construction.air import AirBoundaryConstruction
    from honeybee_energy.material.opaque import EnergyMaterialNoMass
    from honeybee.model import Model
    from honeybee.properties import FaceProperties
    from honeybee.typing import clean_ep_string
except ImportError as e:
    raise ImportError('\nFailed to import honeybee:\n\t{}'.format(e))
    

# todo: magic string here - not good!
gwp_data_string = "Global Warming potential"
gwp_data_points = {
    "gwp_a1_a3": "A1-A3 Conservative",
    "gwp_a4": "A4",
    "gwp_a5_1": "A5.1",
}

# Hack to fix default materials for ACE405 course
# From klimatdatabas 02.05.000
default_layers = {
    "Expanded polystyrene": {
        "gwp_a1_a3": 4,
        "gwp_a4": 0.0345,
        "gwp_a5_1": 0.282,
    },
    "Mineral wool": {
        "gwp_a1_a3": 1.6,
        "gwp_a4": 0.0345,
        "gwp_a5_1": 0.114,
    },
    "Timber": {
        "gwp_a1_a3": 0.08,
        "gwp_a4": 0.0158,
        "gwp_a5_1": 0.00958,
    },
    "Solid brick": {
        "gwp_a1_a3": 0.314,
        "gwp_a4": 0.0495,
        "gwp_a5_1": 0.0182,
    },
    "Gypsum plasterboard": {
        "gwp_a1_a3": 0.284,
        "gwp_a4": 0.0232,
        "gwp_a5_1": 0.0368,
    },
    "Medium density concrete": {
        "gwp_a1_a3": 0.0913,
        "gwp_a4": 0.0039,
        "gwp_a5_1": 0.00285,
    },
    "Ceramic and porcelain": {
        "gwp_a1_a3": 2.5,
        "gwp_a4": 0,
        "gwp_a5_1": 0,
    },
    "Steel": {
        "gwp_a1_a3": 3.15,
        "gwp_a4": 0.0795,
        "gwp_a5_1": 0.161,
    },
    "Crystalline stone": {
        "gwp_a1_a3": 0.5,
        "gwp_a4": 0.0,
        "gwp_a5_1": 0.0,
    },
    "Soil/sand/gravel": {
        "gwp_a1_a3": 0.02,
        "gwp_a4": 0,
        "gwp_a5_1": 0,
    },
}

# hack to fix ACE405 issues
# used if single layer aperture has no matching material
# source: klimatdatabas 02.005.000 aluminum window
# https://klimatdatabasen.boverket.se/detaljer/3/6000000225
default_aperture_density = 39.2# [kg/m2]
default_aperture_impact = { # value is kg CO2eq/m2
    "gwp_a1_a3": 3.83 * default_aperture_density,
    "gwp_a4": 0.0626 * default_aperture_density,
    "gwp_a5_1": 0.0 * default_aperture_density,
}

def main(hb_model):
    tot_emb_carbon = 0
    elements = []
    el_emb_carbon = []
    elements_modules = []
    el_emb_carbon_modules = []
    if not isinstance(hb_model, Model):
        raise Exception("hb_model input must be a valid honeybee model")
    faces = []
    apertures = []
    model_mats = []
    face_types = {}
    
    energy_properties = hb_model.properties.energy
    
    for material in energy_properties.materials:
        model_mats.append(material)
    for room in hb_model.rooms:
        faces.extend(room.faces)
        faces.extend(room.shades)
    faces.extend(hb_model.orphaned_faces)
    faces.extend(hb_model.orphaned_apertures)
    faces.extend(hb_model.orphaned_doors)
    faces.extend(hb_model.orphaned_shades)
    
    for face_obj in faces:
        
        if isinstance(face_obj.properties, FaceProperties):
            if isinstance(face_obj.properties.energy.construction, AirBoundaryConstruction):
                continue # skip if airboundary
                
            face_area = face_obj.area - face_obj.aperture_area
            face_type = face_obj.type
            
            face_impact = {}
            for lyr in face_obj.properties.energy.construction.layers:
                print face_type, lyr, face_area
                face_impact_per_module = get_face_impact(model_mats, lyr, face_area)
                for key in face_impact_per_module:
                    if key in face_impact:
                        face_impact[key] += face_impact_per_module[key]
                    else:
                         face_impact[key] = face_impact_per_module[key]
                """
                if lyr not in model_mats:
                    model_mats[lyr] = { area: face_area }
                else:
                    model_mats[lyr].area = model_mats[lyr].area + face_area
                """
                       
            if face_type not in face_types:
                face_types[face_type] = { "impact": face_impact }
            else:
                for key in face_impact:
                    if key in face_types[face_type]["impact"]:
                        face_types[face_type]["impact"][key] += face_impact[key]
                    else:
                        face_types[face_type]["impact"][key] = face_impact[key]
                
            for aperture in face_obj.apertures:
                aperture_impact = get_aperture_impact(aperture)
                if "Aperture" not in face_types:
                    face_types["Aperture"] = { "impact": aperture_impact }
                else:
                    for key in aperture_impact:
                        if key in face_types["Aperture"]["impact"]:
                            face_types["Aperture"]["impact"][key] += aperture_impact[key]
                        else:
                            face_types["Aperture"]["impact"][key] = aperture_impact[key]
                        
    for face_type in face_types.items():
        face_impact = sum(face_type[1]["impact"].values())
        tot_emb_carbon += face_impact
        elements.append(face_type[0])
        el_emb_carbon.append(face_impact)
        
        for key, value in face_type[1]["impact"].items():
            elements_modules.append(str(face_type[0]) + " " + key)
            el_emb_carbon_modules.append(value)
    return tot_emb_carbon, elements, el_emb_carbon, elements_modules, el_emb_carbon_modules

def get_face_impact(materials, layer_name, face_area):
    for material in materials:
        if material.identifier == layer_name:
            if type(material) == EnergyMaterialNoMass:
                brimstone.utils.warn(ghenv, "The calculation may be faulty as material " + layer_name + " is modelled as EnergyMaterialNoMass.")
                return {}
            abs_impact = {}
            gwp_data_keys = gwp_data_points.keys()
            
            if material.user_data and all(key in material.user_data.keys() for key in gwp_data_keys):
                for key, value in gwp_data_points.items():
                    abs_impact[value] = material.density*material.user_data[key]
            elif material.user_data and layer_name in default_layers:
                for key in gwp_data_keys:
                    material.user_data[key] = default_layers[layer_name][key]
            else:
                abs_impact = get_face_impact_from_material_name(material.identifier, material.density)
            impact = { key: material.thickness*abs_impact[key]*face_area for key in abs_impact }
            return impact
    brimstone.utils.warn(ghenv, "The calculation may be faulty as material " + layer_name + " was not found among the energy materials in the model.")
    return {}

# Gets material impact data from a honeybee material by referencing names in .csv file
def get_face_impact_from_material_name(material_name, density):
    csv_data_file = brimstone.globals.hb_kdb_csv_path
    csv_data_file_path = os.path.join(Grasshopper.Folders.UserObjectFolders[0], csv_data_file)
    if not os.path.exists(csv_data_file_path):
        raise Exception("Failed to open csv file, it should reside in [UserComponents folder]/brimstone_data/")
    kdb_name = check_name_in_kdb(material_name)
    if not kdb_name:
        with open(csv_data_file_path, 'r') as csv_file:
            file_reader = csv.DictReader(csv_file, delimiter=",")
            for row in file_reader:
                if row["HB Name"] == material_name:
                    kdb_name = clean_ep_string(row["Klimatdatabas name"])
                    if not kdb_name or kdb_name == "missing":
                        brimstone.utils.warn(ghenv, "The calculation may be faulty as impact data is missing for some of the materials in the model: " + material_name)
                        return {}
                    break
    if not kdb_name:
        brimstone.utils.warn(ghenv, "The calculation may be faulty as material " + material_name + " could not be matched to any material in the brimstone material database.")
        return {}
    
    return get_impact_from_json_data(kdb_name, density)

def check_name_in_kdb(material_name):
    if not kdb_json_data:
        brimstone.utils.warn(ghenv, "The calculation may be faulty as kdb_json_data is missing")
    else: 
        for resource in kdb_json_data["Resources"]:
            if clean_ep_string(resource["Name"]) == material_name:
                return material_name
    return ""
    
# TODO: currently only works for KDB windows
def get_aperture_impact(aperture):
    c = aperture.properties.energy.construction
    c = c.window_construction if type(c) == WindowConstructionShade else c
    if c.user_data and "conv_value" in c.user_data:
        impact = {}
        for key, value in gwp_data_points.items():
            if key in c.user_data:
                impact[value] = float(c.user_data[key]) * c.user_data["conv_value"] * aperture.area
        return impact
    if not len(c.layers) == 1:
        brimstone.utils.warn(ghenv, "The calculation may be faulty as only one layer window constructions can be calculated.")
        return {}
    
    window_material = c.layers[0]
    abs_impact = get_impact_from_json_data(window_material)
    
    # hack to fix ACE405 calculations
    if not len(abs_impact.keys()):
        abs_impact = default_aperture_impact
    
    impact = { key: abs_impact[key]*aperture.area for key in abs_impact }
    return impact

# density parameter is used as fallback if KDB data does not have density
def get_impact_from_json_data(kdb_name, density = 0):
    if not kdb_json_data:
        brimstone.utils.warn(ghenv, "The calculation may be faulty as kdb_json_data is missing")
        return {}
    for resource in kdb_json_data["Resources"]:
        if clean_ep_string(resource["Name"]) == kdb_name:
            if "Conversions" not in resource:
                brimstone.utils.warn(ghenv, "The calculation may be faulty as material " + kdb_name + " has no conversion value in kdb_json_data. Using HB material density")
                conv = density
            else:
                conv = resource["Conversions"][0]["Value"]
            
            for data_item in resource["DataItems"]:
                if data_item["PropertyName"] == gwp_data_string:
                    abs_impact = {}
                    for data_pt in gwp_data_points.values():
                        for data_val_item in data_item["DataValueItems"]:
                            if data_val_item["DataModuleCode"] == data_pt:
                                abs_impact[data_pt] = data_val_item["Value"]*conv
                    return abs_impact
            brimstone.utils.warn(ghenv, "The calculation may be faulty as material " + kdb_name + " has no GWP data in kdb_json_data")
            return {}
    brimstone.utils.warn(ghenv, "The calculation may be faulty as material " + kdb_name + " was not found in kdb_json_data")
    return {}

if __name__ == "__main__":
    try:
        flying = scriptcontext.sticky["brimstone_flying"]
    except:
        raise Exception("The 'Brimstone - Fly' component needs to exist on the canvas")
    tot_emb_carbon, elements, el_emb_carbon, elements_modules, el_emb_carbon_modules = main(hb_model)
# ---------- end calculate_honeybee_model ----------
calculate_honeybee_model_2 = BrimstoneCalculateEmbodiedCarbonOfHoneybeeModel(hb_model=data_42, kdb_json_data=get_categories.json_data)  # -> tot_emb_carbon, elements, el_emb_carbon, elements_modules, el_emb_carbon_modules, materials, material_amounts
# ---------- calculate_honeybee_model_2: Python ----------
"""
Calculates embodied carbon for the elements of a Honeybee model if data is available
This component was inspired by the 'HB Color Face Attributes' component of Ladybug Tools 1.6.0

    Args:
        hb_model: Honeybee model for analysis
        kdb_json_data: Optional json data object for materials which do not include impact data

    Returns:
        tot_emb_carbon: total embodied carbon of model
        elements: element types in the model
        el_emb_carbon: embodied carbon for each element type in the model
"""

import scriptcontext
import brimstone
ghenv.Component.Message = brimstone.globals.version
import Grasshopper
import os
import csv, codecs

ghenv.Component.Name = 'Brimstone - Calculate Embodied Carbon of Honeybee Model'
ghenv.Component.NickName = 'Calculate Honeybee Model'

try:  # import the core honeybee dependencies
    from honeybee_energy.construction.windowshade import WindowConstructionShade
    from honeybee_energy.construction.air import AirBoundaryConstruction
    from honeybee_energy.material.opaque import EnergyMaterialNoMass
    from honeybee.model import Model
    from honeybee.properties import FaceProperties
    from honeybee.typing import clean_ep_string
except ImportError as e:
    raise ImportError('\nFailed to import honeybee:\n\t{}'.format(e))
    

# todo: magic string here - not good!
gwp_data_string = "Global Warming potential"
gwp_data_points = {
    "gwp_a1_a3": "A1-A3 Conservative",
    "gwp_a4": "A4",
    "gwp_a5_1": "A5.1",
    "gwp_c1": "C1",
    "gwp_c2": "C2",
    "gwp_c3": "C3",
} 

def main(hb_model):
    tot_emb_carbon = 0
    elements = []
    el_emb_carbon = []
    elements_modules = []
    el_emb_carbon_modules = []
    if not isinstance(hb_model, Model):
        raise Exception("hb_model input must be a valid honeybee model")
    faces = []
    apertures = []
    model_mats = {}
    face_types = {}
    
    energy_properties = hb_model.properties.energy
    
    for material in energy_properties.materials:
        model_mats[material.identifier] = {
            "material": material,
            "amount": 0.0,
        }
    for room in hb_model.rooms:
        faces.extend(room.faces)
        faces.extend(room.shades)
    faces.extend(hb_model.orphaned_faces)
    faces.extend(hb_model.orphaned_apertures)
    faces.extend(hb_model.orphaned_doors)
    faces.extend(hb_model.orphaned_shades)
    
    for face_obj in faces:
        print face_obj
        if isinstance(face_obj.properties, FaceProperties):
            if isinstance(face_obj.properties.energy.construction, AirBoundaryConstruction):
                continue # skip if airboundary
                
            face_area = face_obj.area - face_obj.aperture_area
            face_type = face_obj.type
            
            face_impact = {}
            for lyr in face_obj.properties.energy.construction.layers:
                if lyr not in model_mats:
                    brimstone.utils.warn(ghenv, "Calculation may be faulty as material " + lyr + " does not exist in model.")
                else:
                    model_mats[lyr]["amount"] += face_area*model_mats[lyr]["material"].thickness
                face_impact_per_module = get_face_impact([mat["material"] for mat in model_mats.values()], lyr, face_area)
                for key in face_impact_per_module:
                    if key in face_impact:
                        face_impact[key] += face_impact_per_module[key]
                    else:
                         face_impact[key] = face_impact_per_module[key]
                """
                if lyr not in model_mats.keys():
                    model_mats[lyr] = { area: face_area }
                else:
                    model_mats[lyr].area = model_mats[lyr].area + face_area
                """
                       
            if face_type not in face_types:
                face_types[face_type] = { "impact": face_impact }
            else:
                for key in face_impact:
                    if key in face_types[face_type]["impact"]:
                        face_types[face_type]["impact"][key] += face_impact[key]
                    else:
                        face_types[face_type]["impact"][key] = face_impact[key]
                
            
            for aperture in face_obj.apertures:
                aperture_impact = get_aperture_impact(aperture)
                if "Aperture" not in face_types:
                    face_types["Aperture"] = { "impact": aperture_impact }
                else:
                    for key in face_impact:
                        if key in face_types["Aperture"]["impact"]:
                            face_types["Aperture"]["impact"][key] += face_impact[key]
                        else:
                            face_types["Aperture"]["impact"][key] = face_impact[key]
                        
    for face_type in face_types.items():
        face_impact = sum(face_type[1]["impact"].values())
        tot_emb_carbon += face_impact
        elements.append(face_type[0])
        el_emb_carbon.append(face_impact)
        
        for key, value in face_type[1]["impact"].items():
            elements_modules.append(str(face_type[0]) + " " + key)
            el_emb_carbon_modules.append(value)
    return tot_emb_carbon, elements, el_emb_carbon, elements_modules, el_emb_carbon_modules, model_mats.keys(), [mat["amount"] for mat in model_mats.values()]

def get_face_impact(materials, layer_name, face_area):
    for material in materials:
        if material.identifier == layer_name:
            if type(material) == EnergyMaterialNoMass:
                brimstone.utils.warn(ghenv, "The calculation may be faulty as material " + layer_name + " is modelled as EnergyMaterialNoMass.")
                return {}
            abs_impact = {}
            gwp_data_keys = gwp_data_points.keys()
            if material.user_data:
                for key, value in gwp_data_points.items():
                    if key in material.user_data:
                        abs_impact[value] = material.density*material.user_data[key]
            else:
                abs_impact = get_face_impact_from_material_name(material.identifier, material.density)
            impact = { key: material.thickness*abs_impact[key]*face_area for key in abs_impact }
            return impact
    brimstone.utils.warn(ghenv, "The calculation may be faulty as material " + layer_name + " was not found among the energy materials in the model.")
    return {}

# Gets material impact data from a honeybee material by referencing names in .csv file
def get_face_impact_from_material_name(material_name, density):
    csv_data_file = brimstone.globals.hb_kdb_csv_path
    csv_data_file_path = os.path.join(Grasshopper.Folders.UserObjectFolders[0], csv_data_file)
    if not os.path.exists(csv_data_file_path):
        raise Exception("Failed to open csv file, it should reside in [UserComponents folder]/brimstone_data/")
    kdb_name = check_name_in_kdb(material_name)
    if not kdb_name:
        with open(csv_data_file_path, 'r') as csv_file:
            file_reader = csv.DictReader(csv_file, delimiter=",")
            for row in file_reader:
                if row["HB Name"] == material_name:
                    kdb_name = clean_ep_string(row["Klimatdatabas name"])
                    if not kdb_name or kdb_name == "missing":
                        brimstone.utils.warn(ghenv, "The calculation may be faulty as impact data is missing for some of the materials in the model: " + material_name)
                        return {}
                    break
    if not kdb_name:
        brimstone.utils.warn(ghenv, "The calculation may be faulty as material " + material_name + " could not be matched to any material in the brimstone material database.")
        return {}
    
    return get_impact_from_json_data(kdb_name, density)

def check_name_in_kdb(material_name):
    if not kdb_json_data:
        brimstone.utils.warn(ghenv, "The calculation may be faulty as kdb_json_data is missing")
    else: 
        for resource in kdb_json_data["Resources"]:
            if clean_ep_string(resource["Name"]) == material_name:
                return material_name
    return ""
    
# TODO: currently only works for KDB windows
def get_aperture_impact(aperture):
    c = aperture.properties.energy.construction
    c = c.window_construction if type(c) == WindowConstructionShade else c
    if c.user_data and "conv_value" in c.user_data:
        impact = {}
        for key, value in gwp_data_points.items():
            if key in c.user_data:
                impact[value] = float(c.user_data[key]) * aperture.area
        return impact
    if not len(c.layers) == 1:
        brimstone.utils.warn(ghenv, "The calculation may be faulty as only one layer window constructions can be calculated.")
        return {}
    
    window_material = c.layers[0]
    abs_impact = get_impact_from_json_data(window_material)
    impact = { key: abs_impact[key]*aperture.area for key in abs_impact }
    return impact

# density parameter is used as fallback if KDB data does not have density
def get_impact_from_json_data(kdb_name, density = 0):
    if not kdb_json_data:
        brimstone.utils.warn(ghenv, "The calculation may be faulty as kdb_json_data is missing")
        return 0
    for resource in kdb_json_data["Resources"]:
        if clean_ep_string(resource["Name"]) == kdb_name:
            if "Conversions" not in resource:
                brimstone.utils.warn(ghenv, "The calculation may be faulty as material " + kdb_name + " has no conversion value in kdb_json_data. Using HB material density")
                conv = density
            else:
                conv = resource["Conversions"][0]["Value"]
            
            for data_item in resource["DataItems"]:
                if data_item["PropertyName"] == gwp_data_string:
                    abs_impact = {}
                    for data_pt in gwp_data_points.values():
                        for data_val_item in data_item["DataValueItems"]:
                            if data_val_item["DataModuleCode"] == data_pt:
                                abs_impact[data_pt] = data_val_item["Value"]*conv
                                break
                    return abs_impact
            brimstone.utils.warn(ghenv, "The calculation may be faulty as material " + kdb_name + " has no GWP data in kdb_json_data")
            return {}
    brimstone.utils.warn(ghenv, "The calculation may be faulty as material " + kdb_name + " was not found in kdb_json_data")
    return {}

if __name__ == "__main__":
    try:
        flying = scriptcontext.sticky["brimstone_flying"]
    except:
        raise Exception("The 'Brimstone - Fly' component needs to exist on the canvas")
    tot_emb_carbon, elements, el_emb_carbon, elements_modules, el_emb_carbon_modules, materials, material_amounts = main(hb_model)
# ---------- end calculate_honeybee_model_2 ----------
py3_66 = Python3Script(x=bool_64)  # -> out, a; inputs x: list
# ---------- py3_66: Python ----------
a = all(x)
# ---------- end py3_66 ----------
panel_248 = Panel(calculate_honeybee_model_2.materials)
panel_249 = Panel(calculate_honeybee_model_2.material_amounts)

# ---- group: Analysis module (continued)
lca_total_gfa_3 = RemoteReceiver(lca_total_gfa)

# ---- group: Glare analysis
epw_file_url_2 = Data(location_8)  # disabled
number_slider_87 = Slider(2, range=0..10)  # disabled
number_slider_88 = Slider(6, range=0..10)  # disabled
number_slider_89 = Slider(5, range=0..10)  # disabled
number_slider_90 = Slider(4, range=0..5)  # disabled
number_slider_91 = Slider(1.6, range=0..10)  # disabled
number_slider_92 = Slider(4, range=0..10)  # disabled
number_slider_93 = Slider(4, range=0..10)  # disabled
viewport_name = Data(txt_8)  # disabled
pt_16 = ConstructPoint(XCoordinate=number_slider_88, YCoordinate=number_slider_89, ZCoordinate=number_slider_87)  # disabled
viewport = HBViewFromViewport(name=viewport_name, viewport=viewport_name, view_type=number_slider_90)  # -> view; disabled; plug-in component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
pt_17 = ConstructPoint(XCoordinate=number_slider_92, YCoordinate=number_slider_93, ZCoordinate=number_slider_91)  # disabled
number_slider_94 = Slider(4, range=0..5)  # disabled
vec2pt = Vector2Pt(PointA=pt_17, PointB=pt_16, Unitize=False)  # -> Vector, Length; disabled
assigngridsviews_2 = HBAssignGridsAndViews(model=freeze_gate_71, views=flatten(viewport))  # -> model; disabled; plug-in component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
view = HBView(position=pt_17, direction=vec2pt.Vector, view_type=number_slider_94)  # -> view; disabled; plug-in component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
hoy = LBCalculateHOY(month=month, day=day, hour=hour)  # -> flatten(hoy), flatten(doy), flatten(date); disabled; plug-in component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
number_slider_95 = Slider(2300, range=0..10000)  # disabled
toggle_8 = BooleanToggle(True)  # disabled
toggle_9 = BooleanToggle(True)  # disabled
panel_250 = Panel("")  # disabled
falsecolor = HBFalseColor(max=number_slider_95, contour_lines=toggle_9)  # -> hdr; disabled; plug-in component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
hdr_false_color_image = Data(falsecolor)  # disabled

# ----
# Temporary data for developing UI
element_types_2 = Data(["Aperture", "Roof", "Wall", "Floor"])
gwp_by_element_type = Data(["50", "40", "75", "25"])
placeholder_data_2 = Panel(element_types_2)
placeholder_data_3 = Panel(gwp_by_element_type)

# ---- group: Analyse performance
# Chart title
current_selected_model_analysis_module_n_8 = RemoteReceiver(current_selected_model_analysis_module_n)  # "current_selected_model_analysis_module_name"

# ----
downloadepw_4 = LBDownloadWeather(weather_URL=epw_file_url_2)  # -> epw_file, stat_file, ddy_file; disabled; plug-in component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

# ---- group: Glare analysis (continued)
importloc = LBImportLocation(epw_file=downloadepw_4.epw_file)  # -> location; disabled; plug-in component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
ciesky = HBCIEStandardSky(location=importloc, month=month, day=day, hour=hour, type=0)  # -> sky; disabled; plug-in component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
pitview = HBPointInTimeViewBased(model=assigngridsviews_2, sky=ciesky, run=run_glare_analysis)  # -> report, results; disabled; plug-in component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
glare = HBGlarePostprocess(hdr=pitview.results)  # -> DGP, category, glare_indices, check_hdr; disabled; plug-in component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
merge_19 = Merge(Data1=hoy.date, Data2=glare.category, Data3=glare.DGP)  # disabled
daylight_glare_probability_dgp = Data(glare.DGP)  # disabled
join_10 = TextJoin(Text=merge_19, Join=panel_250)  # disabled
adjusthdr = HBAdjustHDR(adj_expos=toggle_8, label=join_10)  # -> hdr; disabled; plug-in component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
hdr_image = Data(adjusthdr)  # disabled

# ----
glare_report = RemoteSender(pitview.report)  # disabled
hdr_image_2 = Data(pitview.results)  # disabled
hdr_false_color_image_2 = Data(pitview.results)  # disabled
num_11 = Number(daylight_glare_probability_dgp)  # disabled

data_43 = Data(num_11)  # disabled
data_44 = Data(hdr_image)  # disabled
data_45 = Data(hdr_false_color_image)  # disabled
calculate_glare_probability_3 = RemoteReceiver(calculate_glare_probability)  # disabled
entwine_170 = Entwine(Branch00=data_43, FlattenInputs=True)  # disabled
freeze_gate_74 = StreamFreezeGate(Data=entwine_170, PassingSwitch=calculate_glare_probability_3, Hold=True)  # disabled
pitview_message_error_3 = RemoteReceiver(pitview_message_error)  # disabled
bang_21 = ExplodeTree(Data=freeze_gate_74)  # -> Branch0, Branch1, Branch2; disabled
hasdata_13 = DataExists(Data=bang_21.Branch0)  # disabled
lng_37 = ListLength(List=pitview_message_error_3)  # disabled
data_46 = Data()  # disabled
data_47 = Data()  # disabled
data_48 = Data(bang_21.Branch0)  # disabled
and_40 = GateAnd(A=invert(lng_37), B=hasdata_13)  # disabled
glare_daylight_probability = RemoteSender(data_48)  # disabled
glare_data_exists = RemoteSender(and_40)  # disabled

glare_daylight_probability_2 = RemoteReceiver(glare_daylight_probability)  # disabled
expression_73 = Expression(x=glare_daylight_probability_2, Expression="Round(x, 2)")  # disabled
glare_data_exists_2 = RemoteReceiver(glare_data_exists)  # disabled
format_35 = Format(Format=panel_101, Culture=127, Data0=expression_73)  # disabled
or_34 = GateOr(A=glare_data_exists_2, B=filter_17)  # disabled
rec_39 = DataRecorder(or_34, DataLimit=-10, RecordData=True)  # disabled
settextblock_17 = SetTextBlockContents(TextBlockToModify=tb_15, NewTextBlockContents=format_35)  # disabled
ma_24 = MassAddition(Input=flatten(rec_39))  # -> Result, PartialResults; disabled
glare_data_exists_3 = RemoteReceiver(glare_data_exists)  # disabled
mod_2 = Modulus(A=ma_24.Result, B=number_slider_37)  # disabled
bool_65 = Boolean(mod_2)  # disabled
hideshow_54 = HideShowElement(ElementToHideShow=tb_15, Show=glare_data_exists_3, Collapse=True, Disable=False)  # disabled
glare_data_exists_4 = RemoteReceiver(glare_data_exists)  # disabled
filter_83 = StreamFilter(Gate=bool_65, Stream0=panel_111, Stream1=panel_112)  # disabled
gate_66 = StreamGate(Stream=filter_83, Gate=freeze_gate_18)  # -> Target0, Target1; disabled
settextblock_18 = SetTextBlockContents(TextBlockToModify=tb_14, NewTextBlockContents=gate_66.Target1)  # disabled
bool_66 = Boolean(invert(glare_data_exists_4))  # disabled
hideshow_55 = HideShowElement(ElementToHideShow=tb_14, Show=bool_66, Collapse=glare_data_exists_4, Disable=False)  # disabled

glare_report_2 = RemoteReceiver(glare_report)

epw_file_url_3 = Data(bang_19.Branch0)
downloadepw_5 = LBDownloadWeather(weather_URL=epw_file_url_3)  # -> epw_file, stat_file, ddy_file; plug-in component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
run_annual_daylight_simulation = Boolean(bool_59)
honeybee_model_7 = Data(honeybee_model_6)
run_illuminance = Boolean(bool_59)

# ---- group: Daylight Factor
# Daylight Factor [%]
number_slider_96 = Slider(0, range=0..2)
number_slider_97 = Slider(0, range=0..2)  # disabled
falsestart = LBFalseStartToggle(False)  # disabled
detail_level_0_2 = Number(number_slider_96)
radpar = HBRadianceParameter(recipe_type=number_slider_97, detail_level=detail_level_0_2)  # -> rad_par; disabled; plug-in component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
run_daylight_factor = Data(falsestart)  # disabled
daylightfactor = HBDaylightFactor(model=honeybee_model_7, radiance_par=radpar, run=run_daylight_factor)  # -> report, results; disabled; plug-in component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
panel_251 = Panel("Daylight Factor [%]")  # disabled
cluster_11 = Cluster_6()  # disabled
median = GhPythonScript(list=daylightfactor.results)  # -> out, median; inputs list: list; disabled
# ---------- median: Python ----------
"""Provides a scripting component.
    Inputs:
        list: list of numeric values to retrieve median
    Output:
        median: median value in list

__author__ = "sawen"
__version__ = "2024.06.14"
"""

import statistics

def main(list):
    return statistics.median(list)

if __name__ == "__main__":
    if list:
        median = main(list)
# ---------- end median ----------
heatmap = LBSpatialHeatmap(values=flatten(daylightfactor.results), legend_par=cluster_11, legend_title=panel_251)  # -> mesh, legend, title, colors, legend_par, vis_set; disabled; plug-in component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
daylight_factor = Data(flatten([heatmap.mesh, heatmap.legend, heatmap.title]))  # disabled

# ----
gate_67 = StreamGate(Stream=objbynn_2, Gate=run_annual_daylight_simulation)  # -> Target0, Target1
hold_9 = HoldingGate(Data=gate_67.Target1)
msgs_4 = GetRuntimeMessages(Objects=hold_9)  # -> Errors, Warnings
annualdaylight_message_error = RemoteSender(msgs_4.Errors)
annualdaylight_message_warning = RemoteSender(msgs_4.Warnings)

# ---- group: Analysis module (continued)
annualdaylight_message_warning_2 = RemoteReceiver(annualdaylight_message_warning)
annualdaylight_message_error_2 = RemoteReceiver(annualdaylight_message_error)

# ----
honeybee_model_8 = Data(freeze_gate_69)  # disabled
data_49 = Data(honeybee_model_8)  # disabled

# ---- group: Simulate
run_energy_simulation = Boolean(run_detailed_energy_simulations_2)  # disabled
modeltoosm = HBModelToOSM(
    model=honeybee_model_8,
    epw_file=downloadepw_2.epw_file,
    sim_par=simpar,
    write=run_energy_simulation,
    run=run_energy_simulation)  # -> report, jsons, osw, osm, idf, sql, zsz, rdd, html; disabled; plug-in component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
eui = HBEndUseIntensity(sql=modeltoosm.sql)  # -> eui, eui_end_use, end_uses, gross_floor; disabled; plug-in component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
panel_252 = Panel(eui.eui)  # disabled
panel_253 = Panel(eui.end_uses)  # disabled
panel_254 = Panel(eui.eui_end_use)  # disabled

# ---- group: Peak loads
readhvac = HBReadHVACSizing(sql=modeltoosm.sql)  # -> zone_names, zone_peak_cool, zone_peak_heat, comp_types, comp_properties, comp_values; disabled; plug-in component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
readzsz = HBReadZoneSizing(zsz=modeltoosm.zsz)  # -> cooling_load, heating_load; disabled; plug-in component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
number_slider_98 = Slider(40, range=0..100)  # disabled
number_slider_99 = Slider(40, range=0..100)  # disabled
toggle_10 = BooleanToggle(True)  # disabled
toggle_11 = BooleanToggle(True)  # disabled
panel_255 = Panel([readhvac.zone_peak_heat, readhvac.zone_peak_cool])  # disabled
monthlychart = LBMonthlyChart(data=readzsz.heating_load, x_dim=number_slider_98, stack=toggle_10, time_marks=toggle_10)  # -> report, data_mesh, data_lines, col_lines, legend, borders, labels, y_title, title, vis_set; disabled; plug-in component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
monthlychart_2 = LBMonthlyChart(data=readzsz.cooling_load, x_dim=number_slider_99, stack=toggle_11, time_marks=toggle_11)  # -> report, data_mesh, data_lines, col_lines, legend, borders, labels, y_title, title, vis_set; disabled; plug-in component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
heating_load_profile = Data(flatten([monthlychart.data_mesh, monthlychart.data_lines, monthlychart.col_lines, monthlychart.legend, monthlychart.borders, monthlychart.labels, monthlychart.y_title, monthlychart.title]))  # disabled
cooling_load_profile = Data(flatten([monthlychart_2.data_mesh, monthlychart_2.data_lines, monthlychart_2.col_lines, monthlychart_2.legend, monthlychart_2.borders, monthlychart_2.labels, monthlychart_2.y_title, monthlychart_2.title]))  # disabled
peak_cooling = Data(readhvac.zone_peak_cool)  # disabled
zone_names = Data(readhvac.zone_names)  # disabled
peak_heating = Data(readhvac.zone_peak_heat)  # disabled

# ---- group: Load previous model
falsestart_2 = LBFalseStartToggle(False)  # disabled
item_38 = ListItem(List=modeltoosm.jsons, Index=0, Wrap=True)  # disabled
loadobjects_2 = HBLoadObjects(hb_file=item_38, load=falsestart_2)  # -> report, hb_objs; disabled; plug-in component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

# ---- group: extract and visualise data
roomenergyresult = HBReadRoomEnergyResult(sql=modeltoosm.sql)  # -> cooling, heating, lighting, electric_equip, gas_equip, process, hot_water, fan_electric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; disabled; plug-in component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
merge_20 = Merge(
    Data1=roomenergyresult.heating,
    Data2=roomenergyresult.cooling,
    Data3=roomenergyresult.lighting,
    Data4=roomenergyresult.electric_equip,
    Data5=roomenergyresult.hot_water,
    Data6=roomenergyresult.people_gain,
    Data7=roomenergyresult.solar_gain)  # disabled
hourlyplot = LBHourlyPlot(data=merge_20)  # -> report, mesh, legend, borders, labels, title, vis_set; disabled; plug-in component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
xdata = LBDeconstructData(data=roomenergyresult.cooling)  # -> header, values; disabled; plug-in component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

# ---- group: Energy balance
faceresult = HBReadFaceResult(sql=modeltoosm.sql)  # -> face_indoor_temp, face_outdoor_temp, face_energy_flow; disabled; plug-in component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
loadbalance = HBThermalLoadBalance(
    rooms_model=flatten(data_49),
    cooling=roomenergyresult.cooling,
    heating=roomenergyresult.heating,
    lighting=roomenergyresult.lighting,
    electric_equip=roomenergyresult.electric_equip,
    hot_water=roomenergyresult.hot_water,
    people_gain=roomenergyresult.people_gain,
    solar_gain=roomenergyresult.solar_gain,
    infiltration_load=roomenergyresult.infiltration_load,
    mech_vent_load=roomenergyresult.mech_vent_load,
    face_energy_flow=faceresult.face_energy_flow)  # -> report, balance, balance_stor, norm_bal, norm_bal_stor; disabled; plug-in component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
number_slider_100 = Slider(19, range=0..100)  # disabled
timeop = LBTimeIntervalOperation(data=loadbalance.norm_bal_stor)  # -> daily, monthly, mon_per_hr; disabled; plug-in component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
colrange_4 = LBColorRange(index=number_slider_100)  # -> colors; disabled; plug-in component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
toggle_12 = BooleanToggle(True)  # disabled
neg_3 = Negative(Value=number_slider_77)  # disabled
legendpar_3 = LBLegendParameters(min=neg_3, max=number_slider_77, colors=colrange_4)  # -> leg_par; disabled; plug-in component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
monthlychart_3 = LBMonthlyChart(data=timeop.monthly, stack=toggle_12, legend_par=legendpar_3)  # -> report, data_mesh, data_lines, col_lines, legend, borders, labels, y_title, title, vis_set; disabled; plug-in component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

# ----
detailed_energy_simulations_report = RemoteSender(modeltoosm.report)  # disabled
energy_use_intensity = Data(eui.eui)  # disabled
energy_use_intensity_per_end_use = Data(eui.eui_end_use)  # disabled
end_uses = Data(eui.end_uses)  # disabled
monthly_energy_balance = Data(flatten([monthlychart_3.data_mesh, monthlychart_3.data_lines, monthlychart_3.col_lines, monthlychart_3.legend, monthlychart_3.borders, monthlychart_3.labels, monthlychart_3.y_title, monthlychart_3.title]))  # disabled
annual_hourly_energy_results = Data(flatten([hourlyplot.mesh, hourlyplot.legend, hourlyplot.borders, hourlyplot.labels, hourlyplot.title]))  # disabled
cooling_load_profile_2 = Data(cooling_load_profile)  # disabled
monthly_energy_balance_2 = Data(monthly_energy_balance)  # disabled
energy_use_intensity_2 = Data(energy_use_intensity)  # disabled
peak_cooling_2 = Data(peak_cooling)  # disabled
heating_load_profile_2 = Data(heating_load_profile)  # disabled
energy_use_intensity_per_end_use_2 = Data(energy_use_intensity_per_end_use)  # disabled
end_uses_2 = Data(end_uses)  # disabled
peak_heating_2 = Data(peak_heating)  # disabled
annual_hourly_energy_results_2 = Data(annual_hourly_energy_results)  # disabled
peak_cooling_3 = Data(zone_names)  # disabled
panel_256 = Panel(peak_cooling_2)  # disabled
panel_257 = Panel(peak_heating_2)  # disabled
panel_258 = Panel(energy_use_intensity_per_end_use_2)  # disabled
panel_259 = Panel(energy_use_intensity_2)  # disabled
panel_260 = Panel(end_uses_2)  # disabled

detailed_energy_simulations_report_2 = RemoteReceiver(detailed_energy_simulations_report)

element_types_3 = Data(calculate_honeybee_model.elements)
total_gwp = Data(calculate_honeybee_model.tot_emb_carbon)
gwp_by_element_type_2 = Data(calculate_honeybee_model.el_emb_carbon)
connected_2 = GetConnectedObjects(Objects=calculate_honeybee_model.tot_emb_carbon)
gate_68 = StreamGate(Stream=connected_2, Gate=py3_66.a)  # -> Target0, Target1
hold_10 = HoldingGate(Data=gate_68.Target1)
panel_261 = Panel(element_types_3)
panel_262 = Panel(gwp_by_element_type_2)
panel_263 = Panel(total_gwp)
msgs_5 = GetRuntimeMessages(Objects=hold_10)  # -> Errors, Warnings
lca_errors = RemoteSender(msgs_5.Errors)
lca_warnings = RemoteSender(msgs_5.Warnings)

ma_25 = MassAddition(Input=gwp_by_element_type_2)  # -> Result, PartialResults
total_gwp_2 = Data(ma_25.Result)
lca_gwp_by_element_type = RemoteSender(gwp_by_element_type_2)
lca_element_types = RemoteSender(element_types_3)
lca_total_gwp = RemoteSender(total_gwp_2)

lca_element_types_2 = RemoteReceiver(lca_element_types)
hasdata_14 = DataExists(Data=lca_element_types_2)
filter_84 = StreamFilter(Gate=hasdata_14, Stream0=placeholder_data, Stream1=lca_element_types_2)
lng_38 = ListLength(List=filter_84)
multiplication_4 = Multiplication(A=lng, B=lng_38)
random = Random(Range=dom, Number=multiplication_4, Seed=2, Integers=True)
expression_74 = Expression(x=random, Expression="Round(x, 1)")
partition = PartitionList(List=flatten(expression_74), Size=lng_38)
lca_gwp_by_element_type_2 = RemoteReceiver(lca_gwp_by_element_type)
hasdata_15 = DataExists(Data=lca_gwp_by_element_type_2)
filter_85 = StreamFilter(Gate=hasdata_15, Stream0=partition, Stream1=lca_gwp_by_element_type_2)
ins = InsertItems(List=filter_85, Item=current_selected_model_analysis_module_n_7, Indices="0", Wrap=invert(True))
entwine_171 = Entwine(Branch00="Model name", Branch01=filter_84, FlattenInputs=True)  # -> flatten(Result)
trim_2 = TrimTree(Tree=ins, Depth=1)
save_lca = Python3Script(elements=entwine_171, data=trim_2, save=pre_calculate_lca_2)  # -> out, saved, file_path; inputs elements: list of String, data: list
# ---------- save_lca: Python ----------
import csv
import os

import ghpythonlib.treehelpers as th

from Rhino import RhinoDoc

folder_path = ("\\").join(ghdoc.Path.split("\\")[:-1])
rhino_file_name = (RhinoDoc.ActiveDoc.Path).split("\\")[-1][:-4]
full_path = folder_path + "\\heath_data\\" + rhino_file_name + "\\" + rhino_file_name + "_LCA.csv"

try:
    os.mkdir(("\\").join(full_path.split("\\")[:-2]))
    os.mkdir(("\\").join(full_path.split("\\")[:-1]))
    os.mkdir(full_path)
except FileExistsError:
    # directory already exists
    pass

file_path = full_path


# Ensure file path and data are provided
if file_path and data and save:
    try:
        # Ensure the directory exists
        directory = os.path.dirname(file_path)
        if not os.path.exists(directory):
            os.makedirs(directory)  # Create directory if it doesn't exist

        file_exists = os.path.isfile(file_path)
        existing_models = set()

        if file_exists:
            with open(file_path, 'r', newline='', encoding='utf-8') as csv_file:
                reader = csv.reader(csv_file)
                header = next(reader, None)
                for row in reader:
                    if row:
                        existing_models.add(row[0])
        else:
            header = elements

        # keeps track of the existing header vs the incoming elements
        column_dict = dict([(element, elements.index(element)) for element in header])
        # Open the file and append to its contents
        with open(file_path, 'a', newline='') as csv_file:
            writer = csv.writer(csv_file)
            if not file_exists:
                writer.writerow(header)
            
            # make sure the order is correct
            row = [data[column_dict[element]] for element in header]
            if data[0] not in existing_models:
                writer.writerow(row)
        saved = True

        print(f"File successfully created/appended at: {file_path}")
    except Exception as e:
        raise e
        print(f"Error: {str(e)}")
else:
    pass
    # print("Provide a valid file path and data.")
# ---------- end save_lca ----------
panel_264 = Panel(trim_2)
panel_265 = Panel(save_lca.file_path)
panel_266 = Panel(save_lca.out)

panel_267 = Panel(save_lca.saved)
py3_67 = Python3Script(
    rename=pre_rename_current_model_2,
    model_name=current_model_name_3,
    new_model_name=rename_current_model_name_2,
    csv_file_path=save_lca.file_path)  # -> out, a
# ---------- py3_67: Python ----------
import os
import csv

name_col = "Model name"
if rename and os.path.exists(csv_file_path):
    new_rows = []
    with open(csv_file_path, 'r', newline='') as csv_file:
        reader = csv.DictReader(csv_file)
        renamed_rows = list(reader)
        fieldnames = reader.fieldnames        
    
    for row in renamed_rows:
        if row[name_col] == model_name:
            row[name_col] = new_model_name

    with open(csv_file_path, 'w', newline ="") as csv_file:
        writer = csv.DictWriter(csv_file, fieldnames = reader.fieldnames)
        writer.writeheader()
        writer.writerows(renamed_rows)

    print(f"Successfully renamed {model_name} to {new_model_name} in {csv_file_path} csv")
# ---------- end py3_67 ----------
py3_68 = Python3Script(remove=pre_remove_current_model_2, model_name=current_model_name_3, csv_file_path=save_lca.file_path)  # -> out, a
# ---------- py3_68: Python ----------
import os
import csv

name_col = "Model name"
if remove and os.path.exists(csv_file_path):
    with open(csv_file_path, 'r', newline='') as csv_file:
        reader = csv.DictReader(csv_file)
        filtered_rows = [row for row in reader if row[name_col] != model_name]
    with open(csv_file_path, 'w', newline ="") as csv_file:
        writer = csv.DictWriter(csv_file, fieldnames = reader.fieldnames)
        writer.writeheader()
        writer.writerows(filtered_rows)

    print(f"Successfully removed {model_name} from {csv_file_path} csv")
# ---------- end py3_68 ----------
rec_40 = DataRecorder(py3_67.out, DataLimit=-10, RecordData=True)
panel_268 = Panel(py3_68.a)

freeze_gate_75 = StreamFreezeGate(Data=save_lca.file_path, PassingSwitch=save_lca.saved)
load_lca = Python3Script(file_path=freeze_gate_75)  # -> out, a
# ---------- load_lca: Python ----------
import csv
import ghpythonlib.treehelpers as th

# Initialize output list
output_data = []

# Ensure the file path is provided
if file_path:
    try:
        # Open and read the CSV file
        with open(file_path, 'r', encoding='utf-8') as csv_file:
            reader = csv.reader(csv_file)
            for row in reader:
                output_data.append(row)  # Append each row as a list
                
        a = output_data  # Output data to Grasshopper
        a = th.list_to_tree(a)
    except Exception as e:
        a = [f"Error: {str(e)}"]
else:
    a = ["Please provide a valid file path."]
# ---------- end load_lca ----------
split_12 = SplitList(List=load_lca.a, Index="1")  # -> flatten(ListA), ListB
split_13 = SplitTree(Data=split_12.ListB, Masks=flatten("{0;0;0}"))  # -> Positive, Negative
cull_i_4 = CullIndex(List=split_12.ListA, Indices="0", Wrap=invert(True))
cset_8 = CreateSet(List=cull_i_4)  # -> Set, Map
cull_21 = CullPattern(List=split_13.Negative, CullPattern=graft(values_31.Values))  # -> flatten(List)
cull_22 = CullPattern(List=cset_8.Set, CullPattern=values_31.Values)
setchecklist_2 = SetChecklistContents(ChecklistToModify=checklist_3, NewChecklistContents=cset_8.Set, Selected="True")
entwine_172 = Entwine(
    Branch00=nextfile_3,
    Branch01="GWP (kg CO2eq)",
    Branch02="GWP by model (kg CO2eq)",
    Branch03=cull_22,
    Branch04=split_13.Positive,
    Branch05=cull_21,
    Branch06=fragment_2,
    FlattenInputs=True)
freeze_gate_76 = StreamFreezeGate(Data=entwine_172, PassingSwitch=or_6)
bang_22 = ExplodeTree(Data=freeze_gate_76)  # -> Branch0, Branch1, Branch2, Branch3, Branch4, Branch5, Branch6
lng_39 = ListLength(List=flatten(bang_22.Branch4))
partition_2 = PartitionList(List=flatten(bang_22.Branch5), Size=lng_39)

py3_69 = Python3Script(
    file_location=bang_22.Branch0,
    y_label=bang_22.Branch1,
    title=bang_22.Branch2,
    labels=bang_22.Branch3,
    elements=bang_22.Branch4,
    values=partition_2,
    colors=bang_22.Branch6,
    img_width=bar_chart_img_width_2,
    img_height=bar_chart_img_height_2)  # -> file_location_out; inputs labels: list, elements: list, values: tree of Double, colors: list
# ---------- py3_69: Python ----------
# requirements: matplotlib
# requirements: numpy

import matplotlib.pyplot as plt
import numpy as np
import os
import ghpythonlib.treehelpers as th

if not os.path.exists(file_location):
    seperatedLabels = []
    for label in labels:
        if '(' in label:
            seperatedLabels.append(('\n(').join(label.split('(')))
        else:
            seperatedLabels.append(label)
    
    colors = colors[:len(elements)]
    for i in range(len(colors)):
        colors[i] = colors[i].split(',')
        colors[i] = tuple([float(j) for j in colors[i]])
    
    values_list = th.tree_to_list(values)

    px = 1/plt.rcParams['figure.dpi']  # pixel in inches
    fig, ax = plt.subplots(figsize=(img_width*px, img_height*px))

    # Add the stacked bars
    bottom = np.zeros(len(values_list))
    bar_width = 0.25
    for i in range(len(values_list)):
        for j in range(len(values_list[i])):
            ax.bar(seperatedLabels[i], values_list[i][j], color=colors[j], 
             bottom=bottom[i], align='center', width=bar_width, zorder=2)
            
            if values_list[i][j] > 0:
                ax.text(i, bottom[i] + values_list[i][j] / 2, f"{int(values_list[i][j])}",
                ha='center', va='center', fontsize=10, color='black', zorder=3)
            
            bottom[i] += values_list[i][j]
    
    y_range = max(bottom)*1.1
    interval = 10 ** (np.floor(np.log10(y_range)) - 1)  # Base interval as a power of 10
    while y_range / interval > 10:  # Adjust interval if too many ticks
        interval *= 2
    while y_range / interval < 5:  # Adjust interval if too few ticks
        interval /= 2

    # Ensure interval is a clean power of 10 or multiple thereof
    interval = round(interval, -int(np.floor(np.log10(interval))))

    # Set y-axis limits
    ax.set_ylim(0, y_range)

    # Generate tick positions
    yticks = list(range(0, int(y_range) + 1, int(interval)))

    # Add horizontal lines
    for y in yticks:
        ax.axhline(y=y, color='gray', linestyle='--', linewidth=0.4, zorder=1)

    # Set yticks to match the lines
    ax.set_yticks(yticks)

    ax.set_title(title)
    ax.set_ylabel(y_label)
    ax.set_xticks(range(len(seperatedLabels)))
    ax.set_xticklabels(seperatedLabels, rotation=35, ha='right', rotation_mode='anchor')
    
    plt.subplots_adjust(right=0.65)

    # Create the legend
    patches = [plt.Rectangle((0, 0), 1, 1, color=color) for color in colors[:len(elements)]]
    ax.legend(patches, elements, title="Elements", bbox_to_anchor=(1.0, 1), loc='upper left', reverse=True)

    plt.tight_layout()
    plt.savefig(file_location)
    file_location_out = file_location

    #plt.show()
# ---------- end py3_69 ----------

setimg_2 = SetImage(ImageToModify=image_2, NewImagePath=py3_69)

lca_warnings_2 = RemoteReceiver(lca_warnings)
lca_errors_2 = RemoteReceiver(lca_errors)

# ---- group: Analysis module (continued)
lca_total_gwp_2 = RemoteReceiver(lca_total_gwp)
lca_total_gwp_3 = RemoteReceiver(lca_total_gwp)
division_6 = Division(A=lca_total_gwp_2, B=lca_total_gfa_3)
lca_warnings_3 = RemoteReceiver(lca_warnings)
lca_errors_3 = RemoteReceiver(lca_errors)
expression_75 = Expression(x=division_6, Expression="Round(x, 1)")
expression_76 = Expression(x=lca_total_gwp_3, Expression="Round(x, 1)")
lng_40 = ListLength(List=lca_errors_3)
lng_41 = ListLength(List=lca_warnings_3)
format_36 = Format(Format=panel_90, Culture=127, Data0=expression_75)
format_37 = Format(Format=panel_91, Culture=127, Data0=expression_76)
ma_26 = MassAddition(Input=[lng_40, lng_41])  # -> Result, PartialResults
setlabel_4 = SetLabelContents(LabelToModify=label_29, NewLabelContents=format_36)
setlabel_5 = SetLabelContents(LabelToModify=label_31, NewLabelContents=format_37)
bool_67 = Boolean(ma_26.Result)
hasdata_16 = DataExists(Data=bool_67)
filter_86 = StreamFilter(Gate=hasdata_16, Stream0="False", Stream1=bool_67)
filter_87 = StreamFilter(Gate=lng_40, Stream0="Warning", Stream1="Error")
filter_88 = StreamFilter(Gate=lng_40, Stream0=ColourSwatch(SwatchColor=RGB(237, 185, 94)), Stream1=ColourSwatch(SwatchColor=RGB(226, 54, 54)))
adjustelem_28 = AdjustElementAppearance(ElementsToAdjust=tb_11, Foreground=filter_88)
settextblock_19 = SetTextBlockContents(TextBlockToModify=tb_11, NewTextBlockContents=filter_87)
hideshow_56 = HideShowElement(ElementToHideShow=tb_11, Show=filter_86, Collapse=True, Disable=False)

# ----
# Chart title
current_selected_simulation_simple_energ_2 = RemoteReceiver(current_selected_simulation_simple_energ)  # "current_selected_simulation_simple_energy_compare"

lca_gwp_by_element_type_3 = RemoteReceiver(lca_gwp_by_element_type)
lca_element_types_3 = RemoteReceiver(lca_element_types)
lca_total_gwp_4 = RemoteReceiver(lca_total_gwp)
honeybee_model_exists_12 = RemoteReceiver(honeybee_model_exists)
lca_errors_4 = RemoteReceiver(lca_errors)
lng_42 = ListLength(List=lca_errors_4)
lca_data_exists = RemoteSender(Toggle(True))

# ---- group: Analysis module (continued)
lca_data_exists_2 = RemoteReceiver(lca_data_exists)
and_41 = GateAnd(A=lca_data_exists_2, B=simple_energy_data_exists_10)
hideshow_57 = HideShowElement(ElementToHideShow=[label_32, label_33, label_6], Show=and_41, Collapse=True, Disable=False)
hideshow_58 = HideShowElement(ElementToHideShow=[label_31, true_button_10, label_29], Show=lca_data_exists_2, Collapse=True, Disable=False)

# ----
# Calculate operational emissions
list_12 = ValueList({"Conservative": "conservative", "Typical": "typical"}, selected="Conservative")
panel_269 = Panel("kg CO2eq/year")

# ----
# Simple energy simulations - Compare
current_selected_simulation_simple_energ_3 = RemoteReceiver(current_selected_simulation_simple_energ)  # "current_selected_simulation_simple_energy_compare"
number_slider_101 = Slider(760000, range=0..1000000)
colrange_5 = LBColorRange(index=Slider(26, range=0..26))  # -> colors; plug-in component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
colrange_6 = LBColorRange(index=Slider(0, range=0..26))  # -> colors; plug-in component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
neg_4 = Negative(Value=Slider(100000, range=0..100000))

equals_48 = Equality(FirstNumber=current_selected_simulation_simple_energ_3, SecondNumber="-1")  # -> Equality, Inequality

gate_69 = StreamGate(Stream=current_selected_simulation_simple_energ_3, Gate=equals_48.Inequality)  # -> Target0, Target1

# ---- group: Spatial climate based daylight
number_slider_102 = Slider(0, range=0..2)
panel_270 = Panel("-t 50 -lt 200 -ut 2000")
wea = HBWeaFromEPW(epw_file=downloadepw_5.epw_file)  # -> wea; plug-in component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
analysis_mesh = Mesh(grid_mesh)
mjoin = MeshJoin(Meshes=analysis_mesh)
cluster_12 = Cluster_6()
cluster_13 = Cluster_6()
cluster_14 = Cluster_6()
number_slider_103 = Slider(150, range=0..400)  # disabled
number_slider_104 = Slider(100, range=0..400)  # disabled
number_slider_105 = Slider(50, range=0..400)  # disabled
X_2 = UnitX(Factor=number_slider_103)  # disabled
X_3 = UnitX(Factor=number_slider_104)  # disabled
X_4 = UnitX(Factor=number_slider_105)  # disabled

# ---- group: Simulate illuminance
number_slider_106 = Slider(0, range=0..2)
importloc_2 = LBImportLocation(epw_file=downloadepw_5.epw_file)  # -> location; plug-in component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
day_illuminance = Number(Slider(21, range=1..31))
hour_illuminance = Number(Slider(12, range=0..23))
month_illuminance = Number(Slider(6, range=1..12))
ciesky_2 = HBCIEStandardSky(location=importloc_2, month=month_illuminance, day=day_illuminance, hour=hour_illuminance, type=0)  # -> sky; plug-in component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
mjoin_2 = MeshJoin(Meshes=grid_mesh)
number_slider_107 = Slider(2000, range=0..10000)
objbynn_19 = GetObjectByNickname(NickName="PITGrid")
gate_70 = StreamGate(Stream=objbynn_19, Gate=run_illuminance)  # -> Target0, Target1
hold_11 = HoldingGate(Data=gate_70.Target1)
msgs_6 = GetRuntimeMessages(Objects=hold_11)  # -> Errors, Warnings
pitgrid_message_error = RemoteSender(msgs_6.Errors)
pitgrid_message_warning = RemoteSender(msgs_6.Warnings)

# ---- group: Analysis module (continued)
pitgrid_message_warning_2 = RemoteReceiver(pitgrid_message_warning)
pitgrid_message_error_2 = RemoteReceiver(pitgrid_message_error)
lng_43 = ListLength(List=[annualdaylight_message_error_2, pitgrid_message_error_2])
lng_44 = ListLength(List=[annualdaylight_message_warning_2, pitgrid_message_warning_2])
ma_27 = MassAddition(Input=[lng_43, lng_44])  # -> Result, PartialResults
bool_68 = Boolean(ma_27.Result)
hasdata_17 = DataExists(Data=bool_68)
filter_89 = StreamFilter(Gate=hasdata_17, Stream0="False", Stream1=bool_68)
filter_90 = StreamFilter(Gate=lng_43, Stream0="Warning", Stream1="Error")
filter_91 = StreamFilter(Gate=lng_43, Stream0=ColourSwatch(SwatchColor=RGB(237, 185, 94)), Stream1=ColourSwatch(SwatchColor=RGB(226, 54, 54)))
adjustelem_29 = AdjustElementAppearance(ElementsToAdjust=tb_10, Foreground=filter_91)
settextblock_20 = SetTextBlockContents(TextBlockToModify=tb_10, NewTextBlockContents=filter_90)
hideshow_59 = HideShowElement(ElementToHideShow=tb_10, Show=filter_89, Collapse=True, Disable=False)

# ---- group: Analyse performance (continued)
current_all_simulation_models_simple_ene = RemoteSender(py3_65.filtered_simulated_models)  # "current_all_simulation_models_simple_energy"
current_all_simulations_simple_energy = RemoteSender(cull_20)
split_14 = SplitTree(Data=cull_20, Masks=flatten("{0;0;0;*}"))  # -> Positive, Negative
flip_2 = FlipMatrix(Data=split_14.Positive)
item_39 = ListItem(List=simplify(current_all_simulations_simple_energy), Index=item_37, Wrap=True)
total_load_eui_all_simulations = RemoteSender(flip_2)
pshift = ShiftPaths(Data=item_39, Offset=-1)
bang_23 = ExplodeTree(Data=pshift)  # -> Branch0, Branch1, Branch2, Branch3, Branch4, Branch5

# ----
total_load_eui_all_simulations_2 = RemoteReceiver(total_load_eui_all_simulations)
num_12 = Number(total_load_eui_all_simulations_2)
current_all_simulation_models_simple_ene_2 = RemoteReceiver(current_all_simulation_models_simple_ene)  # "current_all_simulation_models_simple_energy"
expression_77 = Expression(x=num_12, Expression="Round(x, 1)")
cset_9 = CreateSet(List=current_all_simulation_models_simple_ene_2)  # -> Set, Map
cull_23 = CullPattern(List=expression_77, CullPattern=graft(values_29.Values))  # -> flatten(List)
cull_24 = CullPattern(List=cset_9.Set, CullPattern=values_29.Values)
setchecklist_3 = SetChecklistContents(ChecklistToModify=checklist_2, NewChecklistContents=cset_9.Set, Selected="True")
entwine_173 = Entwine(
    Branch00=nextfile,
    Branch01="EUI (kWh/m2)",
    Branch02="EUI per model (kWh/m2)",
    Branch03=cull_24,
    Branch04=rev,
    Branch05=cull_23,
    Branch06=fragment,
    FlattenInputs=True)
freeze_gate_77 = StreamFreezeGate(Data=entwine_173, PassingSwitch=and)
bang_24 = ExplodeTree(Data=freeze_gate_77)  # -> Branch0, Branch1, Branch2, Branch3, Branch4, Branch5, Branch6
lng_45 = ListLength(List=flatten(bang_24.Branch4))
partition_3 = PartitionList(List=flatten(bang_24.Branch5), Size=lng_45)
py3_70 = Python3Script(
    file_location=bang_24.Branch0,
    y_label=bang_24.Branch1,
    title=bang_24.Branch2,
    labels=bang_24.Branch3,
    elements=bang_24.Branch4,
    values=partition_3,
    colors=bang_24.Branch6,
    img_width=bar_chart_img_width_3,
    img_height=bar_chart_img_height_3)  # -> file_location_out; inputs labels: list, elements: list, values: tree of Double, colors: list
# ---------- py3_70: Python ----------
# requirements: matplotlib
# requirements: numpy

import matplotlib.pyplot as plt
import numpy as np
import os
import ghpythonlib.treehelpers as th

if not os.path.exists(file_location):
    seperatedLabels = []
    for label in labels:
        if '(' in label:
            seperatedLabels.append(('\n(').join(label.split('(')))
        else:
            seperatedLabels.append(label)
    
    colors = colors[:len(elements)]
    for i in range(len(colors)):
        colors[i] = colors[i].split(',')
        colors[i] = tuple([float(j) for j in colors[i]])
    
    values_list = th.tree_to_list(values)

    px = 1/plt.rcParams['figure.dpi']  # pixel in inches
    fig, ax = plt.subplots(figsize=(img_width*px, img_height*px))

    # Add the stacked bars
    bottom = np.zeros(len(values_list))
    bar_width = 0.25
    for i in range(len(values_list)):
        for j in range(len(values_list[i])):
            ax.bar(seperatedLabels[i], values_list[i][j], color=colors[j], 
             bottom=bottom[i], align='center', width=bar_width, zorder=2)
            
            if values_list[i][j] > 0:
                ax.text(i, bottom[i] + values_list[i][j] / 2, f"{int(values_list[i][j])}",
                ha='center', va='center', fontsize=10, color='black', zorder=3)
            
            bottom[i] += values_list[i][j]
    
    y_range = max(bottom)*1.1
    interval = 10 ** (np.floor(np.log10(y_range)) - 1)  # Base interval as a power of 10
    while y_range / interval > 10:  # Adjust interval if too many ticks
        interval *= 2
    while y_range / interval < 5:  # Adjust interval if too few ticks
        interval /= 2

    # Ensure interval is a clean power of 10 or multiple thereof
    interval = round(interval, -int(np.floor(np.log10(interval))))

    # Set y-axis limits
    ax.set_ylim(0, y_range)

    # Generate tick positions
    yticks = list(range(0, int(y_range) + 1, int(interval)))

    # Add horizontal lines
    for y in yticks:
        ax.axhline(y=y, color='gray', linestyle='--', linewidth=0.4, zorder=1)

    # Set yticks to match the lines
    ax.set_yticks(yticks)
    ax.set_title(title)
    ax.set_ylabel(y_label)
    ax.set_xticks(range(len(seperatedLabels)))
    ax.set_xticklabels(seperatedLabels, rotation=35, ha='right', rotation_mode='anchor')
    
    plt.subplots_adjust(right=0.65)

    # Create the legend
    patches = [plt.Rectangle((0, 0), 1, 1, color=color) for color in colors[::-1][:len(elements)]]
    ax.legend(patches, elements, title="Elements", bbox_to_anchor=(1.0, 1), loc='upper left', reverse=False)

    plt.tight_layout()
    plt.savefig(file_location)
    file_location_out = file_location

    #plt.show()
# ---------- end py3_70 ----------
setimg_3 = SetImage(ImageToModify=image_3, NewImagePath=py3_70)

panel_271 = Panel(total_load_eui_all_simulations_2)
current_all_simulation_models_simple_ene_3 = RemoteReceiver(current_all_simulation_models_simple_ene)  # "current_all_simulation_models_simple_energy"
entwine_174 = Entwine(Branch00="None", Branch01=current_all_simulation_models_simple_ene_3, FlattenInputs=True)  # -> flatten(Result)
total_load_eui_all_simulations_3 = RemoteReceiver(total_load_eui_all_simulations)
setlist_8 = SetListContents(ListToModify=pulldown_2, NewListContents=entwine_174, SelectedIndex="0")
ma_28 = MassAddition(Input=total_load_eui_all_simulations_3)  # -> flatten(Result), PartialResults
hasdata_18 = DataExists(Data=ma_28.Result)
current_all_simulations_simple_energy_2 = RemoteReceiver(current_all_simulations_simple_energy)
filter_92 = StreamFilter(Gate=hasdata_18, Stream0="0", Stream1=ma_28.Result)
lng_46 = ListLength(List=filter_92)
larger_4 = LargerThan(FirstNumber=lng_46, SecondNumber="1")  # -> LargerThan, OrEqualTo
hasdata_19 = DataExists(Data=current_all_simulations_simple_energy_2)
hideshow_60 = HideShowElement(ElementToHideShow=tb_3, Show=hasdata_19, Collapse=True, Disable=False)
and_42 = GateAnd(A=simple_energy_data_exists_2, B=larger_4.LargerThan)

current_all_simulation_models_simple_ene_4 = RemoteReceiver(current_all_simulation_models_simple_ene)  # "current_all_simulation_models_simple_energy"
item_40 = ListItem(List=current_all_simulation_models_simple_ene_4, Index=current_selected_simulation_simple_energ_2, Wrap=invert(True))
current_selected_simulation_simple_energ_4 = RemoteSender(item_40)  # "current_selected_simulation_simple_energy_compare_title"

# ---- group: Analyse performance
xdata_2 = LBDeconstructData(data=bang_23.Branch2)  # -> header, values; plug-in component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
xdata_3 = LBDeconstructData(data=bang_23.Branch1)  # -> header, values; plug-in component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
xdata_4 = LBDeconstructData(data=bang_23.Branch3)  # -> header, values; plug-in component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
xdata_5 = LBDeconstructData(data=bang_23.Branch4)  # -> header, values; plug-in component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
xdata_6 = LBDeconstructData(data=bang_23.Branch5)  # -> header, values; plug-in component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
smaller_2 = SmallerThan(FirstNumber=xdata_4.values, SecondNumber="0")  # -> SmallerThan, OrEqualTo
smaller_3 = SmallerThan(FirstNumber=xdata_2.values, SecondNumber="0")  # -> SmallerThan, OrEqualTo
smaller_4 = SmallerThan(FirstNumber=xdata_3.values, SecondNumber="0")  # -> SmallerThan, OrEqualTo
smaller_5 = SmallerThan(FirstNumber=xdata_5.values, SecondNumber="0")  # -> SmallerThan, OrEqualTo
smaller_6 = SmallerThan(FirstNumber=xdata_6.values, SecondNumber="0")  # -> SmallerThan, OrEqualTo
sift_2 = SiftPattern(List=xdata_4.values, SiftPattern=smaller_2.OrEqualTo)  # -> Output0, Output1
sift_3 = SiftPattern(List=xdata_3.values, SiftPattern=smaller_4.OrEqualTo)  # -> Output0, Output1
sift_4 = SiftPattern(List=xdata_2.values, SiftPattern=smaller_3.OrEqualTo)  # -> Output0, Output1
sift_5 = SiftPattern(List=xdata_5.values, SiftPattern=smaller_5.OrEqualTo)  # -> Output0, Output1
sift_6 = SiftPattern(List=xdata_6.values, SiftPattern=smaller_6.OrEqualTo)  # -> Output0, Output1
flip_3 = FlipMatrix(Data=sift_4.Output0)
flip_4 = FlipMatrix(Data=sift_4.Output1)
flip_5 = FlipMatrix(Data=sift_2.Output0)
flip_6 = FlipMatrix(Data=sift_2.Output1)
flip_7 = FlipMatrix(Data=sift_6.Output0)
flip_8 = FlipMatrix(Data=sift_6.Output1)
flip_9 = FlipMatrix(Data=sift_3.Output0)
flip_10 = FlipMatrix(Data=sift_3.Output1)
flip_11 = FlipMatrix(Data=sift_5.Output0)
flip_12 = FlipMatrix(Data=sift_5.Output1)
ma_29 = MassAddition(Input=flip_4)  # -> Result, PartialResults
ma_30 = MassAddition(Input=flip_6)  # -> Result, PartialResults
ma_31 = MassAddition(Input=flip_3)  # -> Result, PartialResults
ma_32 = MassAddition(Input=flip_8)  # -> Result, PartialResults
ma_33 = MassAddition(Input=flip_10)  # -> Result, PartialResults
ma_34 = MassAddition(Input=flip_5)  # -> Result, PartialResults
ma_35 = MassAddition(Input=flip_12)  # -> Result, PartialResults
ma_36 = MassAddition(Input=flip_7)  # -> Result, PartialResults
ma_37 = MassAddition(Input=flip_9)  # -> Result, PartialResults
ma_38 = MassAddition(Input=flip_11)  # -> Result, PartialResults
extremes = MinMax(Number=flatten(ma_31.Result))  # -> Minimum, Maximum
extremes_2 = MinMax(Number=flatten(ma_29.Result))  # -> Minimum, Maximum
extremes_3 = MinMax(Number=flatten(ma_34.Result))  # -> Minimum, Maximum
extremes_4 = MinMax(Number=flatten(ma_30.Result))  # -> Minimum, Maximum
extremes_5 = MinMax(Number=flatten(ma_36.Result))  # -> Minimum, Maximum
extremes_6 = MinMax(Number=flatten(ma_37.Result))  # -> Minimum, Maximum
extremes_7 = MinMax(Number=flatten(ma_32.Result))  # -> Minimum, Maximum
extremes_8 = MinMax(Number=flatten(ma_33.Result))  # -> Minimum, Maximum
extremes_9 = MinMax(Number=flatten(ma_38.Result))  # -> Minimum, Maximum
extremes_10 = MinMax(Number=flatten(ma_35.Result))  # -> Minimum, Maximum
cooling_balance_min = RemoteSender(extremes_10.Minimum)
heating_balance_min = RemoteSender(extremes_7.Minimum)
cooling_balance_max = RemoteSender(extremes_9.Maximum)
heating_balance_max = RemoteSender(extremes_5.Maximum)
daily_heating_profile_min = RemoteSender(extremes_4.Minimum)
daily_cooling_profile_min = RemoteSender(extremes_2.Minimum)
daily_cooling_profile_max = RemoteSender(extremes.Maximum)
daily_heating_profile_max = RemoteSender(extremes_3.Maximum)
annual_energy_balance_max = RemoteSender(extremes_6.Maximum)
annual_energy_balance_min = RemoteSender(extremes_8.Minimum)

# ----
# Detailed data from energy simulation
data_50 = Data(flatten(bang_23.Branch1))

# ---- group: Analysis module (continued)
hideshow_61 = HideShowElement(ElementToHideShow=stack_6, Show=and_42, Collapse=True, Disable=False)

# ---- group: Analyse performance (continued)
current_all_simulation_models_simple_ene_5 = RemoteReceiver(current_all_simulation_models_simple_ene)  # "current_all_simulation_models_simple_energy"
mindex_9 = MemberIndex(Set=current_all_simulation_models_simple_ene_5, Member=current_selected_model_analysis_module_n_8)  # -> flatten(Index), Count

# ----
item_41 = ListItem(List=mindex_9.Index, Index="-1", Wrap=True)

# ---- group: Analyse performance (continued)
item_42 = ListItem(List=current_all_simulation_models_simple_ene_5, Index=item_41, Wrap=True)
current_selected_simulation_simple_energ_5 = RemoteSender(item_42)  # "current_selected_simulation_simple_energy_title"

# ----
current_all_simulations_simple_energy_3 = RemoteReceiver(current_all_simulations_simple_energy)
item_43 = ListItem(List=current_all_simulations_simple_energy_3, Index=gate_69.Target1, Wrap=invert(True))  # -> simplify(Item)
pshift_2 = ShiftPaths(Data=item_43, Offset=-1)
bang_25 = ExplodeTree(Data=pshift_2)  # -> Branch0, Branch1, Branch2, Branch3, Branch4, Branch5

xdata_7 = LBDeconstructData(data=bang_25.Branch2)  # -> header, values; plug-in component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
xdata_8 = LBDeconstructData(data=bang_25.Branch1)  # -> header, values; plug-in component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
xdata_9 = LBDeconstructData(data=bang_25.Branch3)  # -> header, values; plug-in component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
xdata_10 = LBDeconstructData(data=bang_25.Branch4)  # -> header, values; plug-in component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
xdata_11 = LBDeconstructData(data=bang_25.Branch5)  # -> header, values; plug-in component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
smaller_7 = SmallerThan(FirstNumber=xdata_9.values, SecondNumber="0")  # -> SmallerThan, OrEqualTo
smaller_8 = SmallerThan(FirstNumber=xdata_7.values, SecondNumber="0")  # -> SmallerThan, OrEqualTo
smaller_9 = SmallerThan(FirstNumber=xdata_8.values, SecondNumber="0")  # -> SmallerThan, OrEqualTo
smaller_10 = SmallerThan(FirstNumber=xdata_10.values, SecondNumber="0")  # -> SmallerThan, OrEqualTo
smaller_11 = SmallerThan(FirstNumber=xdata_11.values, SecondNumber="0")  # -> SmallerThan, OrEqualTo
sift_7 = SiftPattern(List=xdata_9.values, SiftPattern=smaller_7.OrEqualTo)  # -> Output0, Output1
sift_8 = SiftPattern(List=xdata_8.values, SiftPattern=smaller_9.OrEqualTo)  # -> Output0, Output1
sift_9 = SiftPattern(List=xdata_7.values, SiftPattern=smaller_8.OrEqualTo)  # -> Output0, Output1
sift_10 = SiftPattern(List=xdata_10.values, SiftPattern=smaller_10.OrEqualTo)  # -> Output0, Output1
sift_11 = SiftPattern(List=xdata_11.values, SiftPattern=smaller_11.OrEqualTo)  # -> Output0, Output1
flip_13 = FlipMatrix(Data=sift_9.Output0)
flip_14 = FlipMatrix(Data=sift_9.Output1)
flip_15 = FlipMatrix(Data=sift_7.Output0)
flip_16 = FlipMatrix(Data=sift_7.Output1)
flip_17 = FlipMatrix(Data=sift_11.Output0)
flip_18 = FlipMatrix(Data=sift_11.Output1)
flip_19 = FlipMatrix(Data=sift_8.Output0)
flip_20 = FlipMatrix(Data=sift_8.Output1)
flip_21 = FlipMatrix(Data=sift_10.Output0)
flip_22 = FlipMatrix(Data=sift_10.Output1)
ma_39 = MassAddition(Input=flip_14)  # -> Result, PartialResults
ma_40 = MassAddition(Input=flip_16)  # -> Result, PartialResults
ma_41 = MassAddition(Input=flip_13)  # -> Result, PartialResults
ma_42 = MassAddition(Input=flip_18)  # -> Result, PartialResults
ma_43 = MassAddition(Input=flip_20)  # -> Result, PartialResults
ma_44 = MassAddition(Input=flip_15)  # -> Result, PartialResults
ma_45 = MassAddition(Input=flip_22)  # -> Result, PartialResults
ma_46 = MassAddition(Input=flip_17)  # -> Result, PartialResults
ma_47 = MassAddition(Input=flip_19)  # -> Result, PartialResults
ma_48 = MassAddition(Input=flip_21)  # -> Result, PartialResults
extremes_11 = MinMax(Number=flatten(ma_41.Result))  # -> Minimum, Maximum
extremes_12 = MinMax(Number=flatten(ma_39.Result))  # -> Minimum, Maximum
extremes_13 = MinMax(Number=flatten(ma_44.Result))  # -> Minimum, Maximum
extremes_14 = MinMax(Number=flatten(ma_40.Result))  # -> Minimum, Maximum
extremes_15 = MinMax(Number=flatten(ma_46.Result))  # -> Minimum, Maximum
extremes_16 = MinMax(Number=flatten(ma_47.Result))  # -> Minimum, Maximum
extremes_17 = MinMax(Number=flatten(ma_42.Result))  # -> Minimum, Maximum
extremes_18 = MinMax(Number=flatten(ma_43.Result))  # -> Minimum, Maximum
extremes_19 = MinMax(Number=flatten(ma_48.Result))  # -> Minimum, Maximum
extremes_20 = MinMax(Number=flatten(ma_45.Result))  # -> Minimum, Maximum
cooling_balance_min_compare = RemoteSender(extremes_20.Minimum)
cooling_balance_max_compare = RemoteSender(extremes_19.Maximum)
heating_balance_max_compare = RemoteSender(extremes_15.Maximum)
heating_balance_min_compare = RemoteSender(extremes_17.Minimum)
annual_energy_balance_max_compare = RemoteSender(extremes_16.Maximum)
daily_heating_profile_min_compare = RemoteSender(extremes_14.Minimum)
daily_cooling_profile_min_compare = RemoteSender(extremes_12.Minimum)
daily_cooling_profile_max_compare = RemoteSender(extremes_11.Maximum)
daily_heating_profile_max_compare = RemoteSender(extremes_13.Maximum)
annual_energy_balance_min_compare = RemoteSender(extremes_18.Minimum)

annual_energy_balance_min_compare_2 = RemoteReceiver(annual_energy_balance_min_compare)
annual_energy_balance_max_compare_2 = RemoteReceiver(annual_energy_balance_max_compare)
cluster_15 = Cluster_5(x=annual_energy_balance_min_compare_2)
cluster_16 = Cluster_4(int=annual_energy_balance_max_compare_2)

daily_cooling_profile_max_compare_2 = RemoteReceiver(daily_cooling_profile_max_compare)
daily_cooling_profile_min_compare_2 = RemoteReceiver(daily_cooling_profile_min_compare)
daily_heating_profile_max_compare_2 = RemoteReceiver(daily_heating_profile_max_compare)
daily_heating_profile_min_compare_2 = RemoteReceiver(daily_heating_profile_min_compare)
cooling_balance_max_compare_2 = RemoteReceiver(cooling_balance_max_compare)
cooling_balance_min_compare_2 = RemoteReceiver(cooling_balance_min_compare)
heating_balance_max_compare_2 = RemoteReceiver(heating_balance_max_compare)
heating_balance_min_compare_2 = RemoteReceiver(heating_balance_min_compare)
cluster_17 = Cluster_4(int=heating_balance_max_compare_2)
cluster_18 = Cluster_5(x=daily_cooling_profile_min_compare_2)
cluster_19 = Cluster_4(int=daily_cooling_profile_max_compare_2)
cluster_20 = Cluster_4(int=cooling_balance_max_compare_2)
cluster_21 = Cluster_5(x=heating_balance_min_compare_2)
cluster_22 = Cluster_5(x=cooling_balance_min_compare_2)
cluster_23 = Cluster_5(x=daily_heating_profile_min_compare_2)
cluster_24 = Cluster_4(int=daily_heating_profile_max_compare_2)
legendpar_4 = LBLegendParameters(min=cluster_21, max=cluster_17)  # -> leg_par; plug-in component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
cluster_25 = Cluster_3(min=cluster_22, max=cluster_20, colors=colrange_6)
cluster_26 = Cluster_3(min=cluster_23, max=cluster_24, colors=colrange_5)

# ---- group: Simple peak loads
legendpar_5 = LBLegendParameters(min=cluster_18, max=cluster_19)  # -> leg_par; plug-in component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
current_selected_simulation_simple_energ_6 = RemoteReceiver(current_selected_simulation_simple_energ_4)  # "current_selected_simulation_simple_energy_compare_title"
current_selected_simulation_simple_energ_7 = RemoteReceiver(current_selected_simulation_simple_energ_4)  # "current_selected_simulation_simple_energy_compare_title"
current_selected_simulation_simple_energ_8 = RemoteReceiver(current_selected_simulation_simple_energ_4)  # "current_selected_simulation_simple_energy_compare_title"
current_selected_simulation_simple_energ_9 = RemoteReceiver(current_selected_simulation_simple_energ_4)  # "current_selected_simulation_simple_energy_compare_title"
simple_energy_simulation_base_point_comp_2 = RemoteReceiver(simple_energy_simulation_base_point_comp)  # "simple_energy_simulation_base_point_compare"
simple_energy_simulation_base_point_comp_3 = RemoteReceiver(simple_energy_simulation_base_point_comp)  # "simple_energy_simulation_base_point_compare"
simple_energy_simulation_base_point_comp_4 = RemoteReceiver(simple_energy_simulation_base_point_comp)  # "simple_energy_simulation_base_point_compare"
simple_energy_simulation_base_point_comp_5 = RemoteReceiver(simple_energy_simulation_base_point_comp)  # "simple_energy_simulation_base_point_compare"
simple_energy_simulation_height_4 = RemoteReceiver(simple_energy_simulation_height)
simple_energy_simulation_width_3 = RemoteReceiver(simple_energy_simulation_width)
simple_energy_simulation_height_5 = RemoteReceiver(simple_energy_simulation_height)
simple_energy_simulation_height_6 = RemoteReceiver(simple_energy_simulation_height)
simple_energy_simulation_width_4 = RemoteReceiver(simple_energy_simulation_width)
simple_energy_simulation_width_5 = RemoteReceiver(simple_energy_simulation_width)
simple_energy_simulation_height_7 = RemoteReceiver(simple_energy_simulation_height)
simple_energy_simulation_width_6 = RemoteReceiver(simple_energy_simulation_width)
toggle_13 = BooleanToggle(True)
toggle_14 = BooleanToggle(True)
toggle_15 = BooleanToggle(True)
toggle_16 = BooleanToggle(True)
monthlychart_4 = LBMonthlyChart(
    data=bang_25.Branch3,
    base_pt=simple_energy_simulation_base_point_comp_3,
    x_dim=simple_energy_simulation_width_4,
    y_dim=simple_energy_simulation_height_5,
    stack=toggle_13,
    time_marks=toggle_13,
    global_title=current_selected_simulation_simple_energ_7,
    legend_par=cluster_26)  # -> report, data_mesh, data_lines, col_lines, legend, borders, labels, y_title, title, vis_set; plug-in component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
monthlychart_5 = LBMonthlyChart(
    data=bang_25.Branch2,
    base_pt=simple_energy_simulation_base_point_comp_2,
    x_dim=simple_energy_simulation_width_3,
    y_dim=simple_energy_simulation_height_4,
    stack=toggle_14,
    time_marks=toggle_14,
    global_title=current_selected_simulation_simple_energ_9,
    legend_par=legendpar_5)  # -> report, data_mesh, data_lines, col_lines, legend, borders, labels, y_title, title, vis_set; plug-in component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
monthlychart_6 = LBMonthlyChart(
    data=bang_25.Branch4,
    base_pt=simple_energy_simulation_base_point_comp_4,
    x_dim=simple_energy_simulation_width_5,
    y_dim=simple_energy_simulation_height_6,
    stack=toggle_15,
    time_marks=toggle_15,
    global_title=current_selected_simulation_simple_energ_6,
    legend_par=cluster_25)  # -> report, data_mesh, data_lines, col_lines, legend, borders, labels, y_title, title, vis_set; plug-in component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
monthlychart_7 = LBMonthlyChart(
    data=bang_25.Branch5,
    base_pt=simple_energy_simulation_base_point_comp_5,
    x_dim=simple_energy_simulation_width_6,
    y_dim=simple_energy_simulation_height_7,
    stack=toggle_16,
    time_marks=toggle_16,
    global_title=current_selected_simulation_simple_energ_8,
    legend_par=legendpar_4)  # -> report, data_mesh, data_lines, col_lines, legend, borders, labels, y_title, title, vis_set; plug-in component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
daily_heating_profile = Data(flatten([monthlychart_4.data_mesh, monthlychart_4.data_lines, monthlychart_4.col_lines, monthlychart_4.legend, monthlychart_4.borders, monthlychart_4.labels, monthlychart_4.y_title, monthlychart_4.title]))
daily_cooling_profile = Data(flatten([monthlychart_5.data_mesh, monthlychart_5.data_lines, monthlychart_5.col_lines, monthlychart_5.legend, monthlychart_5.borders, monthlychart_5.labels, monthlychart_5.y_title, monthlychart_5.title]))
heating_balance_design_day = Data(flatten([monthlychart_7.data_mesh, monthlychart_7.data_lines, monthlychart_7.col_lines, monthlychart_7.legend, monthlychart_7.borders, monthlychart_7.labels, monthlychart_7.y_title, monthlychart_7.title]))
cooling_balance_design_day = Data(flatten([monthlychart_6.data_mesh, monthlychart_6.data_lines, monthlychart_6.col_lines, monthlychart_6.legend, monthlychart_6.borders, monthlychart_6.y_title, monthlychart_6.labels, monthlychart_6.title]))

# ----
daily_cooling_profile_2 = Data(flatten(daily_cooling_profile))
daily_cooling_profile_3 = Data(flatten(daily_heating_profile))
daily_cooling_profile_4 = Data(flatten(cooling_balance_design_day))
daily_cooling_profile_5 = Data(flatten(heating_balance_design_day))

# ---- group: Simple energy balance
current_selected_simulation_simple_energ_10 = RemoteReceiver(current_selected_simulation_simple_energ_4)  # "current_selected_simulation_simple_energy_compare_title"
colrange_7 = LBColorRange(index=Slider(19, range=0..100))  # -> colors; plug-in component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
simple_energy_simulation_base_point_comp_6 = RemoteReceiver(simple_energy_simulation_base_point_comp)  # "simple_energy_simulation_base_point_compare"
simple_energy_simulation_height_8 = RemoteReceiver(simple_energy_simulation_height)
simple_energy_simulation_width_7 = RemoteReceiver(simple_energy_simulation_width)

# ----
detail_level_0_2_2 = Number(number_slider_102)
detail_level_0_2_3 = Number(number_slider_106)

# ---- group: Analyse performance (continued)
annual_energy_balance_max_2 = RemoteReceiver(annual_energy_balance_max)
annual_energy_balance_min_2 = RemoteReceiver(annual_energy_balance_min)
cluster_27 = Cluster_5(x=annual_energy_balance_min_2)
cluster_28 = Cluster_4(int=annual_energy_balance_max_2)
daily_heating_profile_max_2 = RemoteReceiver(daily_heating_profile_max)
daily_heating_profile_min_2 = RemoteReceiver(daily_heating_profile_min)
daily_cooling_profile_max_2 = RemoteReceiver(daily_cooling_profile_max)
daily_cooling_profile_min_2 = RemoteReceiver(daily_cooling_profile_min)
heating_balance_max_2 = RemoteReceiver(heating_balance_max)
heating_balance_min_2 = RemoteReceiver(heating_balance_min)
cooling_balance_max_2 = RemoteReceiver(cooling_balance_max)
cooling_balance_min_2 = RemoteReceiver(cooling_balance_min)
cluster_29 = Cluster_4(int=heating_balance_max_2)
cluster_30 = Cluster_5(x=daily_cooling_profile_min_2)
cluster_31 = Cluster_4(int=daily_cooling_profile_max_2)
cluster_32 = Cluster_4(int=cooling_balance_max_2)
cluster_33 = Cluster_5(x=heating_balance_min_2)
cluster_34 = Cluster_5(x=cooling_balance_min_2)
cluster_35 = Cluster_5(x=daily_heating_profile_min_2)
cluster_36 = Cluster_4(int=daily_heating_profile_max_2)
legendpar_6 = LBLegendParameters(min=cluster_33, max=cluster_29)  # -> leg_par; plug-in component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
cluster_37 = Cluster_3(min=cluster_34, max=cluster_32, colors=colrange_2)
cluster_38 = Cluster_3(min=cluster_35, max=cluster_36, colors=colrange_3)

# ----
max = Maximum(A=cluster_16, B=cluster_28)
min = Minimum(A=cluster_27, B=cluster_15)

# ---- group: Simple energy balance (continued)
legendpar_7 = LBLegendParameters(min=min, max=max, colors=colrange_7)  # -> leg_par; plug-in component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
monthlychart_8 = LBMonthlyChart(
    data=bang_25.Branch1,
    base_pt=simple_energy_simulation_base_point_comp_6,
    x_dim=simple_energy_simulation_width_7,
    y_dim=simple_energy_simulation_height_8,
    stack=Toggle(True),
    global_title=current_selected_simulation_simple_energ_10,
    legend_par=legendpar_7)  # -> report, data_mesh, data_lines, col_lines, legend, borders, labels, y_title, title, vis_set; plug-in component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
annual_energy_balance = Data(flatten([monthlychart_8.data_mesh, monthlychart_8.data_lines, monthlychart_8.col_lines, monthlychart_8.legend, monthlychart_8.borders, monthlychart_8.labels, monthlychart_8.y_title, monthlychart_8.title]))

# ----
null_46 = NullItem(Item=max)  # -> NullFlags, InvalidFlags, Description
null_47 = NullItem(Item=min)  # -> NullFlags, InvalidFlags, Description
filter_93 = StreamFilter(Gate=null_47.NullFlags, Stream0=min, Stream1=cluster_27)
filter_94 = StreamFilter(Gate=null_46.NullFlags, Stream0=max, Stream1=cluster_28)

# ---- group: Analyse performance / Simple energy balance
colrange_8 = LBColorRange(index=Slider(19, range=0..100))  # -> colors; plug-in component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
current_selected_simulation_simple_energ_11 = RemoteReceiver(current_selected_simulation_simple_energ_5)  # "current_selected_simulation_simple_energy_title"
legendpar_8 = LBLegendParameters(min=filter_93, max=filter_94, colors=colrange_8)  # -> leg_par; plug-in component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
monthlychart_9 = LBMonthlyChart(
    data=bang_23.Branch1,
    base_pt=simple_energy_simulation_base_point_2,
    x_dim=simple_energy_simulation_width_2,
    y_dim=simple_energy_simulation_height_3,
    stack=Toggle(True),
    global_title=current_selected_simulation_simple_energ_11,
    legend_par=legendpar_8)  # -> report, data_mesh, data_lines, col_lines, legend, borders, labels, y_title, title, vis_set; plug-in component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

# ----
panel_272 = Panel(legendpar_7)

# ---- group: Analyse performance / Simple peak loads
legendpar_9 = LBLegendParameters(min=cluster_30, max=cluster_31)  # -> leg_par; plug-in component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
current_selected_simulation_simple_energ_12 = RemoteReceiver(current_selected_simulation_simple_energ_5)  # "current_selected_simulation_simple_energy_title"
current_selected_simulation_simple_energ_13 = RemoteReceiver(current_selected_simulation_simple_energ_5)  # "current_selected_simulation_simple_energy_title"
current_selected_simulation_simple_energ_14 = RemoteReceiver(current_selected_simulation_simple_energ_5)  # "current_selected_simulation_simple_energy_title"
current_selected_simulation_simple_energ_15 = RemoteReceiver(current_selected_simulation_simple_energ_5)  # "current_selected_simulation_simple_energy_title"
simple_energy_simulation_base_point_3 = RemoteReceiver(simple_energy_simulation_base_point)
simple_energy_simulation_base_point_4 = RemoteReceiver(simple_energy_simulation_base_point)
simple_energy_simulation_base_point_5 = RemoteReceiver(simple_energy_simulation_base_point)
simple_energy_simulation_base_point_6 = RemoteReceiver(simple_energy_simulation_base_point)
simple_energy_simulation_height_9 = RemoteReceiver(simple_energy_simulation_height)
simple_energy_simulation_width_8 = RemoteReceiver(simple_energy_simulation_width)
simple_energy_simulation_height_10 = RemoteReceiver(simple_energy_simulation_height)
simple_energy_simulation_height_11 = RemoteReceiver(simple_energy_simulation_height)
simple_energy_simulation_width_9 = RemoteReceiver(simple_energy_simulation_width)
simple_energy_simulation_width_10 = RemoteReceiver(simple_energy_simulation_width)
simple_energy_simulation_height_12 = RemoteReceiver(simple_energy_simulation_height)
simple_energy_simulation_width_11 = RemoteReceiver(simple_energy_simulation_width)
toggle_17 = BooleanToggle(True)
toggle_18 = BooleanToggle(True)
toggle_19 = BooleanToggle(True)
toggle_20 = BooleanToggle(True)
monthlychart_10 = LBMonthlyChart(
    data=bang_23.Branch3,
    base_pt=simple_energy_simulation_base_point_4,
    x_dim=simple_energy_simulation_width_9,
    y_dim=simple_energy_simulation_height_10,
    stack=toggle_17,
    time_marks=toggle_17,
    global_title=current_selected_simulation_simple_energ_12,
    legend_par=cluster_38)  # -> report, data_mesh, data_lines, col_lines, legend, borders, labels, y_title, title, vis_set; plug-in component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
monthlychart_11 = LBMonthlyChart(
    data=bang_23.Branch2,
    base_pt=simple_energy_simulation_base_point_3,
    x_dim=simple_energy_simulation_width_8,
    y_dim=simple_energy_simulation_height_9,
    stack=toggle_18,
    time_marks=toggle_18,
    global_title=current_selected_simulation_simple_energ_15,
    legend_par=legendpar_9)  # -> report, data_mesh, data_lines, col_lines, legend, borders, labels, y_title, title, vis_set; plug-in component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
monthlychart_12 = LBMonthlyChart(
    data=bang_23.Branch4,
    base_pt=simple_energy_simulation_base_point_5,
    x_dim=simple_energy_simulation_width_10,
    y_dim=simple_energy_simulation_height_11,
    stack=toggle_20,
    time_marks=toggle_20,
    global_title=current_selected_simulation_simple_energ_14,
    legend_par=cluster_37)  # -> report, data_mesh, data_lines, col_lines, legend, borders, labels, y_title, title, vis_set; plug-in component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
monthlychart_13 = LBMonthlyChart(
    data=bang_23.Branch5,
    base_pt=simple_energy_simulation_base_point_6,
    x_dim=simple_energy_simulation_width_11,
    y_dim=simple_energy_simulation_height_12,
    stack=toggle_19,
    time_marks=toggle_19,
    global_title=current_selected_simulation_simple_energ_13,
    legend_par=legendpar_6)  # -> report, data_mesh, data_lines, col_lines, legend, borders, labels, y_title, title, vis_set; plug-in component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
daily_heating_profile_2 = Data(flatten([monthlychart_10.data_mesh, monthlychart_10.data_lines, monthlychart_10.col_lines, monthlychart_10.legend, monthlychart_10.borders, monthlychart_10.labels, monthlychart_10.y_title, monthlychart_10.title]))
daily_cooling_profile_6 = Data(flatten([monthlychart_11.data_mesh, monthlychart_11.data_lines, monthlychart_11.col_lines, monthlychart_11.legend, monthlychart_11.borders, monthlychart_11.labels, monthlychart_11.y_title, monthlychart_11.title]))
heating_balance_design_day_2 = Data(flatten([monthlychart_13.data_mesh, monthlychart_13.data_lines, monthlychart_13.col_lines, monthlychart_13.legend, monthlychart_13.borders, monthlychart_13.labels, monthlychart_13.y_title, monthlychart_13.title]))
cooling_balance_design_day_2 = Data(flatten([monthlychart_12.data_mesh, monthlychart_12.data_lines, monthlychart_12.col_lines, monthlychart_12.legend, monthlychart_12.borders, monthlychart_12.y_title, monthlychart_12.labels, monthlychart_12.title]))

# ---- group: Analyse performance (continued)
panel_273 = Panel(legendpar_8)
annual_energy_balance_2 = Data(flatten([monthlychart_9.data_mesh, monthlychart_9.data_lines, monthlychart_9.col_lines, monthlychart_9.legend, monthlychart_9.borders, monthlychart_9.labels, monthlychart_9.y_title, monthlychart_9.title]))

# ----
daily_cooling_profile_7 = Data(flatten(annual_energy_balance))

# ---- group: Spatial climate based daylight (continued)
radpar_2 = HBRadianceParameter(recipe_type=Slider(2, range=0..2), detail_level=detail_level_0_2_2, additional_par="-ab 4")  # -> rad_par; plug-in component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
panel_274 = Panel(radpar_2)
annualdaylight = HBAnnualDaylight(
    model=honeybee_model_7,
    wea=wea,
    schedule="Generic Office Occupancy",
    radiance_par=radpar_2,
    run=run_annual_daylight_simulation)  # -> report, results, DA, cDA, UDI, UDI_low, UDI_up; plug-in component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
heatmap_2 = LBSpatialHeatmap(
    values=flatten(annualdaylight.UDI_up),
    mesh=mjoin,
    legend_par=cluster_13,
    legend_title="%",
    global_title="UDI > 3000 lux")  # -> mesh, legend, title, colors, legend_par, vis_set; plug-in component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
heatmap_3 = LBSpatialHeatmap(values=flatten(annualdaylight.UDI_low), mesh=mjoin, legend_par=cluster_12, legend_title="%")  # -> mesh, legend, title, colors, legend_par, vis_set; plug-in component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
heatmap_4 = LBSpatialHeatmap(
    values=flatten(annualdaylight.UDI),
    mesh=mjoin,
    legend_par=cluster_14,
    legend_title="%",
    global_title="Useful daylight illuminance")  # -> mesh, legend, title, colors, legend_par, vis_set; plug-in component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
sda = HBSpatialDaylightAutonomy(DA=flatten(annualdaylight.DA), mesh=mjoin)  # -> report, sDA, pass_fail; plug-in component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
heatmap_5 = LBSpatialHeatmap(values=flatten(annualdaylight.DA), mesh=mjoin, legend_par=cluster_10, legend_title="%", global_title="Daylight autonomy")  # -> mesh, legend, title, colors, legend_par, vis_set; plug-in component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
panel_275 = Panel(sda.sDA)

# ----
entwine_175 = Entwine(Branch00=heatmap_2.mesh, Branch01=heatmap_2.legend, Branch02=heatmap_2.title, FlattenInputs=True)  # -> flatten(Result)
entwine_176 = Entwine(Branch00=heatmap_3.mesh, Branch01=heatmap_3.legend, Branch02=heatmap_3.title, FlattenInputs=True)  # -> flatten(Result)
entwine_177 = Entwine(Branch00=heatmap_4.mesh, Branch01=heatmap_4.legend, Branch02=heatmap_4.title, FlattenInputs=True)  # -> flatten(Result)
entwine_178 = Entwine(Branch00=heatmap_5.mesh, Branch01=heatmap_5.legend, Branch02=heatmap_5.title, FlattenInputs=True)  # -> flatten(Result)
rec_41 = DataRecorder(annualdaylight.results, DataLimit=-10, RecordData=True)

# ---- group: Simulate illuminance (continued)
radpar_3 = HBRadianceParameter(recipe_type=Slider(0, range=0..2), detail_level=detail_level_0_2_3)  # -> rad_par; plug-in component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
pitgrid = HBPointInTimeGridBased(model=honeybee_model_6, sky=ciesky_2, radiance_par=radpar_3, run=run_illuminance)  # -> report, flatten(results); plug-in component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
daylight_report = RemoteSender(pitgrid.report)

# ----
daylight_report_2 = RemoteReceiver(daylight_report)

sort_2 = SortList(Keys=pitgrid.results)  # -> reverse(Keys), ValuesA
item_44 = ListItem(List=sort_2.Keys, Index=0, Wrap=True)
max_2 = Maximum(A=number_slider_107, B=item_44)

# ---- group: Simulate illuminance (continued)
legendpar_10 = LBLegendParameters(max=max_2)  # -> leg_par; plug-in component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
heatmap_6 = LBSpatialHeatmap(values=pitgrid.results, mesh=mjoin_2, legend_par=legendpar_10, legend_title="Lux", global_title="Illuminance")  # -> mesh, legend, title, colors, legend_par, vis_set; plug-in component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

# ----
txt_9 = Text(heatmap_6.title)
entwine_179 = Entwine(Branch00=heatmap_6.mesh, Branch01=heatmap_6.legend, Branch02=txt_9, FlattenInputs=True)  # -> flatten(Result)

# ---- group: Extract hourly data from annual results
facen = FaceNormals(Mesh=mjoin)  # -> Centers, Normals; disabled
pt_18 = Point(facen.Centers)  # disabled
number_slider_108 = Slider(581, range=0..1000)  # disabled
flatten = FlattenTree(Tree=pt_18, Path="{0}")  # disabled
item_45 = ListItem(List=flatten, Index=number_slider_108, Wrap=True)  # disabled
number_slider_109 = Slider(3000, range=0..3000)  # disabled
number_slider_110 = Slider(0.1, range=0..0.1)  # disabled
annualtodata = HBAnnualResultsToData(results=flatten(annualdaylight.results), sel_pts=flatten(item_45), all_pts=pt_18)  # -> report, data; disabled; plug-in component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
legendpar_11 = LBLegendParameters(max=number_slider_109)  # -> leg_par; disabled; plug-in component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
multiplication_5 = Multiplication(A=number_slider_110, B=4)  # disabled
pt_19 = Point(Point(0, 35, 0))  # disabled
sph = Sphere(Base=item_45, Radius=number_slider_79)  # disabled

# ----
hourlyplot_2 = LBHourlyPlot(data=annualtodata.data, base_pt=pt_19, x_dim=number_slider_110, y_dim=multiplication_5, legend_par=legendpar_11)  # -> report, mesh, legend, borders, labels, title, vis_set; disabled; plug-in component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
udi_3000 = Data(flatten(entwine_175))
udi = Data(flatten(entwine_177))
udi_50 = Data(flatten(entwine_176))
daylight_autonomy = Data(flatten(entwine_178))
move_2 = Move(Geometry=daylight_autonomy, Motion=X)  # -> Geometry, Transform; disabled
illuminance_lux = Data(entwine_179)
spatial_daylight_autonomy = Data(sda.sDA)

# ---- group: Spatial climate based daylight (continued)
move_3 = Move(Geometry=udi_3000, Motion=X_2)  # -> Geometry, Transform; disabled
move_4 = Move(Geometry=udi_50, Motion=X_3)  # -> Geometry, Transform; disabled
move_5 = Move(Geometry=udi, Motion=X_4)  # -> Geometry, Transform; disabled
merge_21 = Merge(Data1=move_2.Geometry, Data2=move_5.Geometry, Data3=move_4.Geometry, Data4=move_3.Geometry)  # disabled

# ---- group: Extract hourly data from annual results (continued)
merge_22 = Merge(Data1=sph, Data2=hourlyplot_2.mesh, Data3=hourlyplot_2.legend, Data4=hourlyplot_2.labels)  # -> flatten(Result); disabled

# ----
hourly_results_in_one_point = Data(merge_22)  # disabled
data_51 = Data(merge_21)  # disabled

run_detailed_energy_simulations_3 = RemoteReceiver(run_detailed_energy_simulations)  # disabled
entwine_180 = Entwine(
    Branch00=annual_hourly_energy_results_2,
    Branch01=monthly_energy_balance_2,
    Branch02=energy_use_intensity_2,
    Branch03=energy_use_intensity_per_end_use_2,
    Branch04=end_uses_2,
    Branch05=peak_cooling_3,
    Branch06=peak_cooling_2,
    Branch07=peak_heating_2,
    Branch08=cooling_load_profile_2,
    Branch09=heating_load_profile_2,
    FlattenInputs=True)  # disabled
panel_276 = Panel(entwine_180)  # disabled
detailed_energy_simulation_type_2 = RemoteReceiver(detailed_energy_simulation_type)  # disabled
panel_277 = Panel("Analysis module")  # disabled
current_tab_29 = RemoteReceiver(current_tab)  # disabled
expression_78 = Expression(x=panel_277, y=current_tab_29, Expression="x=y")  # disabled
panel_278 = Panel("False")  # disabled

# ----
# Here is the data stored from the simulation
freeze_gate_78 = StreamFreezeGate(Data=entwine_180, PassingSwitch=run_detailed_energy_simulations_3, Hold=True)  # disabled
bang_26 = ExplodeTree(Data=freeze_gate_78)  # -> Branch0, Branch1, Branch2, Branch3, Branch4, Branch5, Branch6, Branch7, Branch8, Branch9; disabled
peak_heating_3 = Data(bang_26.Branch7)  # disabled
zone_names_2 = Data(bang_26.Branch5)  # disabled
peak_cooling_4 = Data(bang_26.Branch6)  # disabled
annual_hourly_energy_results_3 = Data(bang_26.Branch0)  # disabled
monthly_energy_balance_3 = Data(bang_26.Branch1)  # disabled
cooling_load_profile_3 = Data(bang_26.Branch8)  # disabled
heating_load_profile_3 = Data(bang_26.Branch9)  # disabled
energy_use_intensity_per_end_use_3 = Data(bang_26.Branch3)  # disabled
end_uses_3 = Data(bang_26.Branch4)  # disabled
energy_use_intensity_3 = Data(bang_26.Branch2)  # disabled

filter_95 = StreamFilter(
    Gate=detailed_energy_simulation_type_2,
    Stream0=annual_hourly_energy_results_3,
    Stream1=monthly_energy_balance_3,
    Stream2=cooling_load_profile_3,
    Stream3=heating_load_profile_3)  # disabled
hasdata_20 = DataExists(Data=energy_use_intensity_3)  # disabled
filter_96 = StreamFilter(Gate=hasdata_20, Stream0=panel_278, Stream1=energy_use_intensity_3)  # disabled
gate_71 = StreamGate(Stream=filter_95, Gate=expression_78)  # -> Target0, Target1; disabled
data_52 = Data(gate_71.Target1)  # disabled
detailed_energy_data_exists = RemoteSender(filter_96)  # disabled
bbox_4 = BoundingBox(Content=data_52, Plane=PlaneXY(0, 0, 0), UnionBox=True)  # -> Box, Box_2; disabled
zoom_detailed_energy_simulation_bounding = RemoteSender(bbox_4.Box)  # "zoom_detailed_energy_simulation_bounding_box"; disabled

detailed_energy_data_exists_2 = RemoteReceiver(detailed_energy_data_exists)  # disabled
detailed_energy_data_exists_3 = RemoteReceiver(detailed_energy_data_exists)  # disabled
detailed_energy_data_exists_4 = RemoteReceiver(detailed_energy_data_exists)  # disabled
or_35 = GateOr(A=detailed_energy_data_exists_2, B=filter_18)  # disabled
rec_42 = DataRecorder(or_35, DataLimit=-10, RecordData=True)  # disabled
hideshow_62 = HideShowElement(ElementToHideShow=true_button_11, Show=detailed_energy_data_exists_3, Collapse=True, Disable=False)  # disabled
hideshow_63 = HideShowElement(ElementToHideShow=button_31, Show=detailed_energy_data_exists_4, Collapse=True, Disable=False)  # disabled
ma_49 = MassAddition(Input=flatten(rec_42))  # -> Result, PartialResults; disabled
mod_3 = Modulus(A=ma_49.Result, B=number_slider_43)  # disabled
bool_69 = Boolean(mod_3)  # disabled
detailed_energy_data_exists_5 = RemoteReceiver(detailed_energy_data_exists)  # disabled
detailed_energy_data_exists_6 = RemoteReceiver(detailed_energy_data_exists)  # disabled
filter_97 = StreamFilter(Gate=bool_69, Stream0=panel_127, Stream1=panel_128)  # disabled
gate_72 = StreamGate(Stream=filter_97, Gate=freeze_gate_20)  # -> Target0, Target1; disabled
bool_70 = Boolean(invert(detailed_energy_data_exists_5))  # disabled
hideshow_64 = HideShowElement(ElementToHideShow=stack_48, Show=detailed_energy_data_exists_6, Collapse=True, Disable=False)  # disabled
settextblock_21 = SetTextBlockContents(TextBlockToModify=tb_16, NewTextBlockContents=gate_72.Target1)  # disabled
hideshow_65 = HideShowElement(ElementToHideShow=tb_16, Show=bool_70, Collapse=detailed_energy_data_exists_5, Disable=False)  # disabled

# ----
# Zoom detailed energy
zoom_detailed_energy_simulation_bounding_2 = RemoteReceiver(zoom_detailed_energy_simulation_bounding)  # "zoom_detailed_energy_simulation_bounding_box"; disabled
zoom_detailed_energy_simulation_2 = RemoteReceiver(zoom_detailed_energy_simulation)  # disabled
zbb_3 = ZoomBoundingBox(Box=zoom_detailed_energy_simulation_bounding_2, Run=zoom_detailed_energy_simulation_2)  # disabled
panel_279 = Panel("Top")  # disabled

data_53 = Data(spatial_daylight_autonomy)
data_54 = Data(daylight_autonomy)
data_55 = Data(udi)
data_56 = Data(udi_50)
data_57 = Data(udi_3000)
data_58 = Data(illuminance_lux)
entwine_181 = Entwine(
    Branch00=data_53,
    Branch01=data_58,
    Branch02=data_54,
    Branch03=data_55,
    Branch04=data_56,
    Branch05=data_57,
    FlattenInputs=True)
current_model_name_6 = RemoteReceiver(current_model_name)
current_selected_model_analysis_module_n_9 = RemoteReceiver(current_selected_model_analysis_module_n)  # "current_selected_model_analysis_module_name"
daylight_simulation_type_3 = RemoteReceiver(daylight_simulation_type)
annualdaylight_message_error_3 = RemoteReceiver(annualdaylight_message_error)
pitgrid_message_error_3 = RemoteReceiver(pitgrid_message_error)
daylight_expander_is_open_5 = RemoteReceiver(daylight_expander_is_open)
lng_47 = ListLength(List=pitgrid_message_error_3)
lng_48 = ListLength(List=annualdaylight_message_error_3)
current_tab_30 = RemoteReceiver(current_tab)
or_36 = GateOr(A=lng_47, B=lng_48)
expression_79 = Expression(x="Analysis module", y=current_tab_30, Expression="x=y")

null_48 = NullItem(Item=flatten(entwine_181))  # -> NullFlags, InvalidFlags, Description
py3_71 = Python3Script(x=entwine_181)  # -> out, a; inputs x: tree
# ---------- py3_71: Python ----------
import time
if x:
    a = time.time()
    print(a)
# ---------- end py3_71 ----------
item_46 = ListItem(List=null_48.NullFlags, Index=0, Wrap=True)
event_76 = EventGate(Data=py3_71.a)  # -> Data, IsNew
gate_73 = StreamGate(Stream=entwine_181, Gate=item_46)  # -> Target0, Target1
entwine_182 = Entwine(Branch0X=gate_73.Target0, Branch1X=current_model_name_6, FlattenInputs=False)

simple_energy_simulation_type_2 = RemoteReceiver(simple_energy_simulation_type)
daily_cooling_profile_8 = Data(flatten(annual_energy_balance_2))
daily_cooling_profile_9 = Data(flatten(daily_heating_profile_2))
daily_cooling_profile_10 = Data(flatten(daily_cooling_profile_6))
daily_cooling_profile_11 = Data(flatten(cooling_balance_design_day_2))
daily_cooling_profile_12 = Data(flatten(heating_balance_design_day_2))
data_59 = Data(flatten(bang_23.Branch0))
annualloads_message_error_3 = RemoteReceiver(annualloads_message_error)
peakloads_message_error_3 = RemoteReceiver(peakloads_message_error)
ma_50 = MassAddition(Input=data_59)  # -> Result, PartialResults
total_load_eui_2 = RemoteSender(data_59)
simple_energy_expander_is_open_2 = RemoteReceiver(simple_energy_expander_is_open)
bool_71 = Boolean(ma_50.Result)
null_49 = NullItem(Item=bool_71)  # -> NullFlags, InvalidFlags, Description
current_tab_31 = RemoteReceiver(current_tab)
filter_98 = StreamFilter(Gate=null_49.NullFlags, Stream0=bool_71, Stream1="False")
expression_80 = Expression(x="Analysis module", y=current_tab_31, Expression="x=y")

total_load_eui_3 = RemoteReceiver(total_load_eui_2)
energy_use_intensity_kwh_m2 = Data(total_load_eui_3)

entwine_183 = Entwine(Branch00=daily_cooling_profile_3, Branch01=daily_cooling_profile_9, FlattenInputs=True)  # -> flatten(Result)
entwine_184 = Entwine(Branch00=daily_cooling_profile_7, Branch01=daily_cooling_profile_8, FlattenInputs=True)  # -> flatten(Result)
entwine_185 = Entwine(Branch00=daily_cooling_profile_2, Branch01=daily_cooling_profile_10, FlattenInputs=True)  # -> flatten(Result)
entwine_186 = Entwine(Branch00=daily_cooling_profile_4, Branch01=daily_cooling_profile_11, FlattenInputs=True)  # -> flatten(Result)
entwine_187 = Entwine(Branch00=daily_cooling_profile_5, Branch01=daily_cooling_profile_12, FlattenInputs=True)  # -> flatten(Result)
lng_49 = ListLength(List=annualloads_message_error_3)
lng_50 = ListLength(List=peakloads_message_error_3)
and_43 = GateAnd(A=expression_80, B=simple_energy_data_exists_3, C=simple_energy_expander_is_open_2)

# ---- group: Analysis module (continued)
total_load_eui_4 = RemoteReceiver(total_load_eui_2)
ma_51 = MassAddition(Input=total_load_eui_4)  # -> Result, PartialResults
expression_81 = Expression(x=ma_51.Result, Expression="Round(x, 1)")
format_38 = Format(Format=panel_89, Culture=127, Data0=expression_81)
settextblock_22 = SetTextBlockContents(TextBlockToModify=tb_9, NewTextBlockContents=format_38)

# ----
calculate_operational_emissions = BrimstoneCalculateOperationalEmissions(lca_data=get_lca_data.lca_data, eui=energy_use_intensity_kwh_m2, area=area_m2, mode=list_12)  # -> out, gwp_total; inputs lca_data: tree
# ---------- calculate_operational_emissions: Python ----------
"""Calculates operational emissions based on energy resource, EUI and floor area
    Inputs:
        lca_data: tree containing GWP information for the selected resource
        eui: energy use intensity of building in kWh/m2
        gfa: gross floor area of building
        mode: mode of GWP calculation ("typical" or "conservative")
        
    Output:
        gwp_total: total GWP for the selected space"""

import scriptcontext
import brimstone
reload(brimstone)
ghenv.Component.Message = brimstone.globals.version

ghenv.Component.Name = 'Brimstone - Calculate Operational Emissions'
ghenv.Component.NickName = 'Calculate Operational Emissions'

import rhinoscriptsyntax as rs
import ghpythonlib.treehelpers as th

from collections import OrderedDict

inv_unit_string = 'kWh'
gwp_unit_string = 'kg CO2 eq./kWh' # GWP

def main(lca_data, eui, area, mode):
    if not lca_data.BranchCount:
        brimstone.utils.warn(ghenv, "LCA data is missing")
        return
    if eui != 0 and not eui:
        brimstone.utils.warn(ghenv, "EUI is missing")
        return
    if area != 0 and not area:
        brimstone.utils.warn(ghenv, "Area is missing")
        return
    
    lca_data = th.tree_to_list(lca_data)
    lca_data = [OrderedDict(zip(l[0], l[1])) for l in lca_data]
    gwp_total =  []
    
    for resource_lca_data in lca_data:
        try:
            gwp_total.append(calculate_gwp_total(resource_lca_data, eui, area, mode))
        except KeyError as e:
            raise Exception("GWP value could not be calculated: {error}".format(error = e))
    
    return gwp_total
    
def calculate_gwp_total(lca_data, eui, area, mode):    
    inv_unit = lca_data["InventoryUnit"]
    
    if inv_unit != inv_unit_string:
        raise Exception("Wrong unit for calculation of operational energy")    
    
    gwp_unit = lca_data["GWPUnit"]
    if gwp_unit != gwp_unit_string:
        raise Exception("Wrong unit for GWP calculation")
    
    if mode == "conservative":
        gwp_a1_a3_str = "GWPA1A3Conservative"
    elif mode == "typical":
        gwp_a1_a3_str = "GWPA1A3Typical"
    else:
        raise Exception("Mode not recognised (must be conservative or typical)")
    
    gwp_impact = (
        float(lca_data[gwp_a1_a3_str])
    )
    
    gwp_total = (
        float(lca_data[gwp_a1_a3_str])
    ) * area * eui
        
    return gwp_total

if __name__ == "__main__":
    if not scriptcontext.sticky["brimstone_flying"]:
        raise Exception("The 'Brimstone - Fly' component needs to exist on the canvas")   
    gwp_total = main(lca_data, eui, area, mode)
    gwp_total = th.list_to_tree(gwp_total)
# ---------- end calculate_operational_emissions ----------
operational_gwp_total_kg_co2eq_year = Data(calculate_operational_emissions.gwp_total)
division_7 = Division(A=calculate_operational_emissions.gwp_total, B=area_m2)
panel_280 = Panel(operational_gwp_total_kg_co2eq_year)
ma_52 = MassAddition(Input=division_7)  # -> Result, PartialResults

ma_53 = MassAddition(Input=calculate_operational_emissions.gwp_total)  # -> Result, PartialResults
lca_operational_gwp_specific = RemoteSender(ma_53.Result)

lca_operational_gwp_total = RemoteSender(ma_53.Result)

# ----
# LCA operational GWP
lca_operational_gwp_total_2 = RemoteReceiver(lca_operational_gwp_total)

lca_operational_gwp_total_3 = RemoteReceiver(lca_operational_gwp_total)
division_8 = Division(A=lca_operational_gwp_total_3, B=lca_total_gfa_2)
expression_82 = Expression(x=division_8, Expression="Round(x, 1)")
format_39 = Format(Format=panel_7, Culture=127, Data0=expression_82)
setlabel_6 = SetLabelContents(LabelToModify=label_6, NewLabelContents=format_39)

lca_operational_gwp_total_4 = RemoteReceiver(lca_operational_gwp_total)
entwine_188 = Entwine(
    Branch00=lca_element_types_3,
    Branch01=lca_gwp_by_element_type_3,
    Branch02=lca_total_gwp_4,
    Branch03=lca_operational_gwp_total_4,
    FlattenInputs=True)  # -> flatten(Result)
hasdata_21 = DataExists(Data=entwine_188)
filter_99 = StreamFilter(Gate=hasdata_21, Stream0="False", Stream1=entwine_188)
lng_51 = ListLength(List=filter_99)
and_44 = GateAnd(A=honeybee_model_exists_12, B=lng_51)
and_45 = GateAnd(A=invert(lng_42), B=and_44)

# ---- group: Analysis module (continued)
lca_operational_gwp_total_5 = RemoteReceiver(lca_operational_gwp_total)
lca_operational_gwp_total_6 = RemoteReceiver(lca_operational_gwp_total)
multiplication_6 = Multiplication(A="50", B=lca_operational_gwp_total_5)
expression_83 = Expression(x=lca_operational_gwp_total_6, Expression="Round(x, 1)")
expression_84 = Expression(x=multiplication_6, Expression="Round(x, 1)")
format_40 = Format(Format=panel_93, Culture=127, Data0=expression_83)
format_41 = Format(Format=panel_94, Culture=127, Data0="50", Data1=expression_84)
setlabel_7 = SetLabelContents(LabelToModify=label_32, NewLabelContents=format_40)
setlabel_8 = SetLabelContents(LabelToModify=label_33, NewLabelContents=format_41)

# ----
filter_100 = StreamFilter(
    Gate=simple_energy_simulation_type_2,
    Stream0=entwine_184,
    Stream1=entwine_185,
    Stream2=entwine_183,
    Stream3=entwine_186,
    Stream4=entwine_187)
sortbytype = SortObjectsByType(RhinoObjects=filter_100)  # -> Points, Curves, Surfaces, Breps, Meshes, TextObjects, HatchObjects, LightObjects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
or_37 = GateOr(A=lng_49, B=lng_50)
line_2 = Line(sortbytype.Curves)
null_50 = NullItem(Item=line_2)  # -> NullFlags, InvalidFlags, Description
data_60 = Data([sortbytype.Other, sortbytype.Meshes])
bbox_5 = BoundingBox(Content=sortbytype.Meshes, Plane=PlaneXY(0, 0, 0), UnionBox=True)  # -> Box, Box_2
sift_12 = SiftPattern(List=sortbytype.Curves, SiftPattern=null_50.NullFlags)  # -> Output0, Output1
gate_74 = StreamGate(Stream=sift_12.Output1, Gate=and_43)  # -> Target0, Target1
gate_75 = StreamGate(Stream=data_60, Gate=and_43)  # -> Target0, Target1
gate_76 = StreamGate(Stream=bbox_5.Box, Gate=and_43)  # -> Target0, Target1
clean_11 = CleanTree(RemoveNulls=True, RemoveInvalid=True, RemoveEmpty=False, Tree=gate_75.Target1)
data_61 = Data(gate_75.Target1)
zoom_simple_energy_simulation_bounding_b = RemoteSender(gate_76.Target1)  # "zoom_simple_energy_simulation_bounding_box"
indices_2 = ListIndices(Data=gate_75.Target1)
index_2 = ItemIndex(List=gate_75.Target1, Item=clean_11)
preview_18 = CustomPreview(Geometry=gate_74.Target1, Material=ColourSwatch(SwatchColor=RGB(84, 84, 84)))
exdiff_2 = SetDifferenceS(SetA=indices_2, SetB=index_2)
item_47 = ListItem(List=gate_75.Target1, Index=exdiff_2, Wrap=True)

and_46 = GateAnd(A=invert(or_37), B=filter_98)
alignvert_2 = AlignVertices(Mesh=item_47, Tolerance=0.01)  # -> Result, Count

clean_12 = CleanTree(RemoveNulls=True, RemoveInvalid=True, RemoveEmpty=False, Tree=alignvert_2.Result)

# ----
# Bake simple energy simulation
panel_281 = Panel("""Heath::Energy simulation::Annual energy balance
Heath::Energy simulation::Daily cooling profile
Heath::Energy simulation::Daily heating profile
Heath::Energy simulation::Cooling balance
Heath::Energy simulation::Heating balance""")
merge_23 = Merge(Data1=clean_11, Data2=clean_12)
simple_energy_simulation_type_3 = RemoteReceiver(simple_energy_simulation_type)
bake_simple_energy_simulation_2 = RemoteReceiver(bake_simple_energy_simulation)
simple_energy_simulation_annual_energy_b_2 = Data(merge_23)  # "simple_energy_simulation_Annual_energy_balance"
item_48 = ListItem(List=panel_281, Index=simple_energy_simulation_type_3, Wrap=invert(True))
gate_77 = StreamGate(Stream=item_48, Gate=bake_simple_energy_simulation_2)  # -> Target0, Target1
layers_3 = CreateModifyLayers(LayerName=gate_77.Target1, DeleteLayer=False, enableFullPath=True)  # -> LayerNames, LayerFullPath
createatts_2 = CreateAttributes(LayerName=layers_3.LayerFullPath, enableFullPath=True)
connected_3 = GetConnectedObjects(Objects=simple_energy_simulation_annual_energy_b_2)
bake_4 = BakeObject(Objects=connected_3, ObjectAttributes=createatts_2, Bake=bake_simple_energy_simulation_2)

# ----
# Zoom simple energy
zoom_simple_energy_simulation_bounding_b_2 = RemoteReceiver(zoom_simple_energy_simulation_bounding_b)  # "zoom_simple_energy_simulation_bounding_box"
zoom_simple_energy_simulation_2 = RemoteReceiver(zoom_simple_energy_simulation)
zbb_4 = ZoomBoundingBox(Box=zoom_simple_energy_simulation_bounding_b_2, Run=zoom_simple_energy_simulation_2)
panel_282 = Panel(zoom_simple_energy_simulation_2)

freeze_gate_79 = StreamFreezeGate(Data=entwine_182, PassingSwitch=run_daylight_simulations_3, Freeze=True, Hold=False)
split_15 = SplitTree(Data=freeze_gate_79, Masks=flatten("{1;*}"))  # -> Positive, Negative

py3_72 = Python3Script(data=graft(split_15.Negative), enable=toggle_3, reset=button_7, t=py3_71.a)  # -> out, a; inputs data: tree
# ---------- py3_72: Python ----------
""" this component replaces Data recorder """
""" There was an issue where data was stored even after reset,
    possibly because of telepathy components downstream.
    this seems to work! """

from Grasshopper import DataTree
guid = str(ghenv.Component.InstanceGuid) + str(ghdoc.Path)
guid_t = str(ghenv.Component.InstanceGuid) + str(t)
from scriptcontext import sticky

empty_value = "Recorder has been initiated/reset."

if enable:
    if reset or guid not in sticky: sticky[guid] = empty_value
    elif sticky[guid] == empty_value:
        sticky[guid] = DataTree[object]()
    elif guid_t in sticky:
        pass
    else:
        sticky[guid_t] = True
        sticky[guid].MergeTree(data)

if sticky[guid] != empty_value:
    a = sticky[guid]
else:
    a = None
# ---------- end py3_72 ----------
py3_73 = Python3Script(data=graft(split_15.Positive), enable=toggle_3, reset=button_7, t=py3_71.a)  # -> out, a; inputs data: tree; same code as py3_72
panel_283 = Panel(py3_72.a)
py3_74 = Python3Script(all_simulated_models=py3_73.a, model_dictionary=model_name_dictionary_3)  # -> out, simulated_models_renamed; inputs all_simulated_models: list, model_dictionary: list; same code as py3_64
py3_75 = Python3Script(
    all_simulated_models=py3_74.simulated_models_renamed,
    existing_models=current_all_created_models_names_6,
    all_simulation_data=py3_72.a)  # -> out, filtered_simulated_models, filtered_simulation_data_pattern; inputs all_simulated_models: list, existing_models: list, all_simulation_data: tree
# ---------- py3_75: Python ----------
from ghpythonlib import treehelpers as th
import Grasshopper as gh

model_indexes = {}
for i, m in enumerate(all_simulated_models):
    if m in existing_models:
        # we make sure here to take the latest index with a unique name
        model_indexes[m] = i

print(model_indexes)

filtered_simulation_data_pattern = gh.DataTree[object](all_simulation_data)
for i, branch in enumerate(filtered_simulation_data_pattern.Branches):
    for j in range(len(branch)):
        branch[j] = j in model_indexes.values()

filtered_simulated_models = list(model_indexes.keys())
#filtered_simulation_data = th.list_to_tree(filtered_simulation_data)
# ---------- end py3_75 ----------
data_62 = Data(py3_75.filtered_simulated_models)
cull_25 = CullPattern(List=py3_72.a, CullPattern=py3_75.filtered_simulation_data_pattern)
current_all_simulation_models_daylight = RemoteSender(data_62)

current_all_simulation_models_daylight_2 = RemoteReceiver(current_all_simulation_models_daylight)
cset_10 = CreateSet(List=current_all_simulation_models_daylight_2)  # -> Set, Map
cull_26 = CullPattern(List=cset_10.Set, CullPattern=values_33.Values)
mindex_10 = MemberIndex(Set=current_all_simulation_models_daylight_2, Member=graft(cull_26))  # -> Index, Count
item_49 = ListItem(List=mindex_10.Index, Index="-1", Wrap=True)  # -> flatten(Item)
setchecklist_4 = SetChecklistContents(ChecklistToModify=checklist_4, NewChecklistContents=cset_10.Set, Selected="True")

# ---- group: Analysis module (continued)
current_all_simulation_models_daylight_3 = RemoteReceiver(current_all_simulation_models_daylight)
entwine_189 = Entwine(Branch00="None", Branch01=current_all_simulation_models_daylight_3, FlattenInputs=True)  # -> flatten(Result)
setlist_9 = SetListContents(ListToModify=pulldown_22, NewListContents=entwine_189, SelectedIndex="0")

# ----
mindex_11 = MemberIndex(Set=data_62, Member=current_selected_model_analysis_module_n_9)  # -> flatten(Index), Count
split_16 = SplitTree(Data=cull_25, Masks=flatten("{0;0;0;*}"))  # -> Positive, Negative
null_51 = NullItem(Item=mindex_11.Count)  # -> NullFlags, InvalidFlags, Description
flip_23 = FlipMatrix(Data=split_16.Positive)
item_50 = ListItem(List=mindex_11.Index, Index="-1", Wrap=True)
ma_54 = MassAddition(Input=flip_23)  # -> flatten(Result), PartialResults
item_51 = ListItem(List=simplify(cull_25), Index=item_50, Wrap=invert(True))
current_all_simulations_daylight = RemoteSender(py3_72.a)
spatialdaylightautonomy_all_simulations = RemoteSender(ma_54.Result)
pshift_3 = ShiftPaths(Data=item_51, Offset=-1)
filter_101 = StreamFilter(Gate=null_51.NullFlags, Stream0=mindex_11.Count, Stream1="False")
bang_27 = ExplodeTree(Data=pshift_3)  # -> Branch0, Branch1, Branch2, Branch3, Branch4, Branch5
daylight_data_exists = RemoteSender(filter_101)
data_63 = Data(bang_27.Branch1)
data_64 = Data(bang_27.Branch2)
data_65 = Data(bang_27.Branch3)
data_66 = Data(bang_27.Branch4)
data_67 = Data(bang_27.Branch0)
data_68 = Data(bang_27.Branch5)
spatialdaylightautonomy_current = RemoteSender(data_67)
spatialdaylightautonomy_current_2 = RemoteReceiver(spatialdaylightautonomy_current)
filter_102 = StreamFilter(Gate=daylight_simulation_type_3, Stream0=data_63, Stream1=data_64, Stream2=data_65, Stream3=data_66, Stream4=data_68)
null_52 = NullItem(Item=spatialdaylightautonomy_current_2)  # -> NullFlags, InvalidFlags, Description
bool_72 = Boolean(invert(null_52.NullFlags))
and_47 = GateAnd(A=expression_79, B=daylight_expander_is_open_5, C=bool_72)
and_48 = GateAnd(A=bool_72, B=invert(or_36))
data_69 = Data(filter_102)

daylight_data_exists_2 = RemoteReceiver(daylight_data_exists)
and_49 = GateAnd(A=equals_13.Inequality, B=daylight_data_exists_2, C=expression_40, D=daylight_expander_is_open_4)
or_38 = GateOr(
    A=preview_7,
    B=room_attribute_visualize_3,
    C=room_energy_attribute_visualize_3,
    D=face_attribute_visualize_3,
    E=face_energy_attribute_visualize_3,
    F=show_honeybee_walls_2,
    G=show_honeybee_roof_2,
    H=show_honeybee_floors_2,
    I=show_honeybee_ground_2,
    J=show_honeybee_windows_2,
    L=show_honeybee_context_2,
    M=weather_visualisation_wireframe_2,
    N=and_49)
filter_103 = StreamFilter(Gate=or_38, Stream0="Shaded", Stream1="Wireframe")
mod_viewport = ModifyViewport(DisplayMode=filter_103, AnimateRestore=False, RestoreFrames=10)

# ---- group: Analysis module (continued)
spatialdaylightautonomy_current_3 = RemoteReceiver(spatialdaylightautonomy_current)
expression_85 = Expression(x=spatialdaylightautonomy_current_3, Expression="Round(x*100, 1)")
daylight_data_exists_3 = RemoteReceiver(daylight_data_exists)
spatialdaylightautonomy_all_simulations_2 = RemoteReceiver(spatialdaylightautonomy_all_simulations)
format_42 = Format(Format=panel_88, Culture=127, Data0=expression_85)
daylight_data_exists_4 = RemoteReceiver(daylight_data_exists)
or_39 = GateOr(A=daylight_data_exists_3, B=filter_15)
rec_43 = DataRecorder(or_39, DataLimit=-10, RecordData=True)
settextblock_23 = SetTextBlockContents(TextBlockToModify=tb_7, NewTextBlockContents=format_42)
hideshow_66 = HideShowElement(ElementToHideShow=button_25, Show=daylight_data_exists_4, Collapse=True, Disable=False)
ma_55 = MassAddition(Input=flatten(rec_43))  # -> Result, PartialResults
daylight_data_exists_5 = RemoteReceiver(daylight_data_exists)
hasdata_22 = DataExists(Data=spatialdaylightautonomy_all_simulations_2)
mod_4 = Modulus(A=ma_55.Result, B=Slider(2, range=0..10))
filter_104 = StreamFilter(Gate=hasdata_22, Stream0="0", Stream1=spatialdaylightautonomy_all_simulations_2)
daylight_data_exists_6 = RemoteReceiver(daylight_data_exists)
daylight_data_exists_7 = RemoteReceiver(daylight_data_exists)
hideshow_67 = HideShowElement(ElementToHideShow=[pulldown_24, label_28], Show=daylight_data_exists_5, Collapse=True, Disable=False)
bool_73 = Boolean(mod_4)
lng_52 = ListLength(List=filter_104)
filter_105 = StreamFilter(Gate=bool_73, Stream0="Simulation failed...", Stream1="Daylight simulation is running...")
hideshow_68 = HideShowElement(ElementToHideShow=tb_7, Show=daylight_data_exists_6, Collapse=True, Disable=False)
bool_74 = Boolean(invert(daylight_data_exists_7))
larger_5 = LargerThan(FirstNumber=lng_52, SecondNumber="1")  # -> LargerThan, OrEqualTo
gate_78 = StreamGate(Stream=filter_105, Gate=freeze_gate_13)  # -> Target0, Target1
daylight_data_exists_8 = RemoteReceiver(daylight_data_exists)
hideshow_69 = HideShowElement(ElementToHideShow=tb_6, Show=bool_74, Collapse=daylight_data_exists_7, Disable=False)
and_50 = GateAnd(A=daylight_data_exists_8, B=larger_5.LargerThan)
hideshow_70 = HideShowElement(ElementToHideShow=stack_37, Show=and_50, Collapse=True, Disable=False)

# ----
daylight_data_exists_9 = RemoteReceiver(daylight_data_exists)
hideshow_71 = HideShowElement(ElementToHideShow=button_5, Show=daylight_data_exists_9, Collapse=True, Disable=False)
current_all_simulations_daylight_2 = RemoteReceiver(current_all_simulations_daylight)
hasdata_23 = DataExists(Data=current_all_simulations_daylight_2)
hideshow_72 = HideShowElement(ElementToHideShow=tb_2, Show=hasdata_23, Collapse=True, Disable=False)

spatialdaylightautonomy_all_simulations_3 = RemoteReceiver(spatialdaylightautonomy_all_simulations)
num_13 = Number(spatialdaylightautonomy_all_simulations_3)
expression_86 = Expression(x=num_13, Expression="Round(x, 2)")
item_52 = ListItem(List=expression_86, Index=item_49, Wrap=invert(True))
entwine_190 = Entwine(
    Branch00=nextfile_2,
    Branch01=panel_56,
    Branch02=panel_56,
    Branch03=cull_26,
    Branch04=item_52,
    Branch05=fragment_3,
    FlattenInputs=True)
freeze_gate_80 = StreamFreezeGate(Data=entwine_190, PassingSwitch=and_2)
bang_28 = ExplodeTree(Data=freeze_gate_80)  # -> Branch0, Branch1, Branch2, Branch3, Branch4, Branch5

multiplication_7 = Multiplication(A=bang_28.Branch4, B=Slider(100, range=0..100))

py3_76 = Python3Script(
    file_location=bang_28.Branch0,
    y_label=bang_28.Branch1,
    title=bang_28.Branch2,
    labels=bang_28.Branch3,
    values=multiplication_7,
    colors=bang_28.Branch5,
    img_width=bar_chart_img_width_4,
    img_height=bar_chart_img_height_4)  # -> file_location_out; inputs labels: list, values: list, colors: list
# ---------- py3_76: Python ----------
# requirements: matplotlib
# requirements: numpy

import matplotlib.pyplot as plt
import numpy as np

if file_location:
    seperatedLabels = []
    for label in labels:
        if '(' in label:
            seperatedLabels.append(('\n(').join(label.split('(')))
        else:
            seperatedLabels.append(label)

    for i in range(len(colors)):
        colors[i] = colors[i].split(',')
        colors[i] = tuple([float(j) for j in colors[i]])

    px = 1/plt.rcParams['figure.dpi']  # pixel in inches
    fig, ax = plt.subplots(figsize=(img_width*px, img_height*px))
    ax.bar(seperatedLabels, values, label=seperatedLabels, color=colors, align="center")

    ax.set_ylim(0, max(values)*1.1)
    ax.set_ylabel(y_label)
    ax.set_title(title)

    plt.subplots_adjust(right=0.65)

    # ax.legend(title=title, bbox_to_anchor=(1.0, 1), loc='upper left', reverse=False)

    plt.savefig(file_location)
    file_location_out = file_location

    #plt.show()
# ---------- end py3_76 ----------
setimg_4 = SetImage(ImageToModify=image, NewImagePath=py3_76)

current_selected_simulation_daylight_com_2 = RemoteReceiver(current_selected_simulation_daylight_com)  # "current_selected_simulation_daylight_compare"
item_53 = ListItem(List=simplify(cull_25), Index=current_selected_simulation_daylight_com_2, Wrap=invert(True))
pshift_4 = ShiftPaths(Data=item_53, Offset=-1)
bang_29 = ExplodeTree(Data=pshift_4)  # -> Branch0, Branch1, Branch2, Branch3, Branch4, Branch5
daylight_simulation_type_4 = RemoteReceiver(daylight_simulation_type)
data_70 = Data(bang_29.Branch1)
data_71 = Data(bang_29.Branch2)
data_72 = Data(bang_29.Branch3)
data_73 = Data(bang_29.Branch4)
data_74 = Data(bang_29.Branch5)
filter_106 = StreamFilter(Gate=daylight_simulation_type_4, Stream0=data_70, Stream1=data_71, Stream2=data_72, Stream3=data_73, Stream4=data_74)
daylight_expander_is_open_6 = RemoteReceiver(daylight_expander_is_open)
bbox_6 = BoundingBox(Content=data_69, Plane=PlaneXY(0, 0, 0), UnionBox=True)  # -> Box, Box_2
current_tab_32 = RemoteReceiver(current_tab)
debox = DeconstructBox(Box=bbox_6.Box)  # -> Plane, X, Y, Z
expression_87 = Expression(x="Analysis module", y=current_tab_32, Expression="x=y")
num_14 = Number(debox.Y)
addition_4 = Addition(A=num_14, B=Slider(15, range=0..100))
Y_2 = UnitY(Factor=addition_4)

expression_88 = Expression(x=current_selected_simulation_daylight_com_2, Expression="x>-1")

and_51 = GateAnd(A=expression_87, B=daylight_expander_is_open_6, C=expression_88)
gate_79 = StreamGate(Stream=filter_106, Gate=and_51)  # -> Target0, Target1
move_6 = Move(Geometry=gate_79.Target1, Motion=Y_2)  # -> Geometry, Transform

gate_80 = StreamGate(Stream=move_6.Geometry, Gate=expression_88)  # -> Target0, Target1

merge_24 = Merge(Data1=data_69, Data2=gate_80.Target1)
gate_81 = StreamGate(Stream=merge_24, Gate=and_47)  # -> Target0, Target1
bbox_7 = BoundingBox(Content=merge_24, Plane=PlaneXY(0, 0, 0), UnionBox=True)  # -> Box, Box_2
data_75 = Data(gate_81.Target1)

panel_284 = Panel(data_75)

# ----
# Bake daylight simulation
panel_285 = Panel("""Heath::Daylight simulation::Illuminance [Lux]
Heath::Daylight simulation::Daylight autonomy [%]
Heath::Daylight simulation::UDI [%]
Heath::Daylight simulation::UDI <50 [%]
Heath::Daylight simulation::UDI >3000 [%]""")
bake_daylight_simulation_2 = RemoteReceiver(bake_daylight_simulation)
daylight_simulation_type_5 = RemoteReceiver(daylight_simulation_type)
daylight_simulation = Data(data_75)
item_54 = ListItem(List=panel_285, Index=daylight_simulation_type_5, Wrap=invert(True))
gate_82 = StreamGate(Stream=item_54, Gate=bake_daylight_simulation_2)  # -> Target0, Target1

# ----
# Zoom daylight simulation
zoom_daylight_simulation_2 = RemoteReceiver(zoom_daylight_simulation)
zbb_5 = ZoomBoundingBox(Box=bbox_7.Box, Run=zoom_daylight_simulation_2)

bake_geometries_to_layers_2 = BakeGeometriesToLayers(geometry=daylight_simulation, layers=gate_82.Target1, bake=bake_daylight_simulation_2)

# ----
# Show label in Rhino
bbox_8 = BoundingBox(Content=gate_80.Target1, Plane=PlaneXY(0, 0, 0), UnionBox=True)  # -> Box, Box_2
debox_2 = DeconstructBox(Box=bbox_8.Box)  # -> Plane, X, Y, Z
dedomain = DeconstructDomain(Domain=debox_2.Z)  # -> Start, End
dedomain_2 = DeconstructDomain(Domain=debox_2.Y)  # -> Start, End
dedomain_3 = DeconstructDomain(Domain=debox_2.X)  # -> Start, End
current_selected_simulation_daylight_com_3 = RemoteReceiver(current_selected_simulation_daylight_com)  # "current_selected_simulation_daylight_compare"
addition_5 = Addition(A=dedomain_3.Start, B=dedomain_3.End)
addition_6 = Addition(A=Slider(2, range=0..100), B=dedomain_2.End)
current_all_simulation_models_daylight_4 = RemoteReceiver(current_all_simulation_models_daylight)
division_9 = Division(A=addition_5, B="2")
item_55 = ListItem(List=current_all_simulation_models_daylight_4, Index=current_selected_simulation_daylight_com_3, Wrap=invert(True))
pt_20 = ConstructPoint(XCoordinate=division_9, YCoordinate=addition_6, ZCoordinate=dedomain.Start)

gate_83 = StreamGate(Stream=item_55, Gate=daylight_expander_is_open_3)  # -> Target0, Target1

tag = TextTag3D(
    Location=pt_20,
    Text=gate_83.Target1,
    Size=Slider(1.5, range=0..5),
    Colour=ColourSwatch(SwatchColor=RGB(255, 255, 255)),
    Justification=8)

# ----
# Show label in Rhino
number_slider_111 = Slider(2, range=0..100)
dedomain_4 = DeconstructDomain(Domain=debox.Z)  # -> Start, End
dedomain_5 = DeconstructDomain(Domain=debox.Y)  # -> Start, End
dedomain_6 = DeconstructDomain(Domain=debox.X)  # -> Start, End
addition_7 = Addition(A=dedomain_6.Start, B=dedomain_6.End)
addition_8 = Addition(A=number_slider_111, B=dedomain_5.End)
current_selected_model_analysis_module_n_10 = RemoteReceiver(current_selected_model_analysis_module_n)  # "current_selected_model_analysis_module_name"
division_10 = Division(A=addition_7, B="2")
pt_21 = ConstructPoint(XCoordinate=division_10, YCoordinate=addition_8, ZCoordinate=dedomain_4.Start)

gate_84 = StreamGate(Stream=current_selected_model_analysis_module_n_10, Gate=daylight_expander_is_open_2)  # -> Target0, Target1

tag_2 = TextTag3D(
    Location=pt_21,
    Text=gate_84.Target1,
    Size=Slider(1.5, range=0..5),
    Colour=ColourSwatch(SwatchColor=RGB(255, 255, 255)),
    Justification=8)

created_constructions_database = RemoteReceiver(created_constructions_database_2)
decnstrconstr_4 = HBDeconstructConstruction(constr=created_constructions_database)  # -> name, materials, layers, r_val_si, r_val_ip, u_fac_si, u_fac_ip, shgc, t_sol, t_vis; plug-in component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
decnstrmat_4 = HBDeconstructMaterial(mat=decnstrconstr_4.materials)  # -> values, attr_names, r_val_si, r_val_ip; plug-in component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
expression_89 = Expression(x=decnstrconstr_4.u_fac_si, Expression="Round(x, 2)")
null_53 = NullItem(Item=created_constructions_database)  # -> NullFlags, InvalidFlags, Description
item_56 = ListItem(List=decnstrmat_4.values, Index=0, Wrap=True)  # -> Item, Item1
item_57 = ListItem(List=null_53.NullFlags, Index=0, Wrap=True)
shiftm = ShiftMatch(GuideTree=decnstrconstr_4.materials, SecondaryData1=item_56.Item, SecondaryData2=item_56.Item1, shiftFromStart=False)  # -> GuideTree, SecondaryData1, SecondaryData2
visualize_construction_thickness = RemoteSender(shiftm.SecondaryData2)
visualize_construction_materials = RemoteSender(shiftm.SecondaryData1)
format_43 = Format(Format="{0} (U-factor: {1})", Culture=127, Data0=decnstrconstr_4.name, Data1=expression_89)
format_44 = Format(Format="{0}, {1}m", Culture=127, Data0=shiftm.SecondaryData1, Data1=shiftm.SecondaryData2)
gate_85 = StreamGate(Stream=format_43, Gate=item_57)  # -> Target0, Target1
tstat = TreeStatistics(Tree=format_44)  # -> Paths, Length, Count
tstat_2 = TreeStatistics(Tree=format_44)  # -> Paths, Length, Count
repeat_20 = RepeatData(Data="[Innermost layer]", Length=tstat_2.Count)
repeat_21 = RepeatData(Data="[Outermost layer]", Length=tstat.Count)
entwine_191 = Entwine(Branch00=format_20, Branch01=gate_85.Target0, FlattenInputs=True)  # -> flatten(Result)
entwine_192 = Entwine(Branch00=format_22, Branch01=gate_85.Target0, FlattenInputs=True)  # -> flatten(Result)
entwine_193 = Entwine(Branch00=format_23, Branch01=gate_85.Target0, FlattenInputs=True)  # -> flatten(Result)
entwine_194 = Entwine(Branch00=format_21, Branch01=gate_85.Target0, FlattenInputs=True)  # -> flatten(Result)
entwine_195 = Entwine(Branch00=format_25, Branch01=gate_85.Target0, FlattenInputs=True)  # -> flatten(Result)
entwine_196 = Entwine(Branch00=format_24, Branch01=gate_85.Target0, FlattenInputs=True)  # -> flatten(Result)
concat_8 = Concatenate(FragmentA="- ", FragmentB=format_44)
tree = CreateTree(Data=repeat_21, Path=tstat.Paths)
tree_2 = CreateTree(Data=repeat_20, Path=tstat_2.Paths)
entwine_197 = Entwine(Branch00=panel_58, Branch01=decnstrconstr_4.name, FlattenInputs=True)  # -> flatten(Result)
entwine_198 = Entwine(Branch00=panel_58, Branch01=created_constructions_database, FlattenInputs=True)  # -> flatten(Result)
merge_25 = Merge(Data1=tree, Data2=concat_8, Data3=tree_2)
filter_107 = StreamFilter(Gate=item_57, Stream0=entwine_191, Stream1=format_20)
filter_108 = StreamFilter(Gate=item_57, Stream0=entwine_192, Stream1=format_22)
filter_109 = StreamFilter(Gate=item_57, Stream0=entwine_193, Stream1=format_23)
filter_110 = StreamFilter(Gate=item_57, Stream0=entwine_194, Stream1=format_21)
filter_111 = StreamFilter(Gate=item_57, Stream0=entwine_195, Stream1=format_25)
filter_112 = StreamFilter(Gate=item_57, Stream0=entwine_196, Stream1=format_24)
filter_113 = StreamFilter(Gate=item_57, Stream0=entwine_198, Stream1=panel_58)
filter_114 = StreamFilter(Gate=item_57, Stream0=entwine_197, Stream1=panel_58)
gate_86 = StreamGate(Stream=merge_25, Gate=item_57)  # -> Target0, Target1
panel_286 = Panel(merge_25)
all_construction_display_interior_walls = RemoteSender(filter_112)
all_construction_display_exterior_walls = RemoteSender(filter_111)
all_construction_display_interior_floors = RemoteSender(filter_109)
all_construction_display_exterior_roofs = RemoteSender(filter_108)
all_construction_display_exterior_floors = RemoteSender(filter_110)
all_construction_display_ground = RemoteSender(filter_107)
custom_constructions = RemoteSender(gate_85.Target0)
custom_constructions_info = RemoteSender(gate_86.Target0)
all_construction_names = RemoteSender(filter_114)
all_constructions = RemoteSender(filter_113)

# ---- group: Construction module (continued)
all_construction_display_exterior_floors_2 = RemoteReceiver(all_construction_display_exterior_floors)
all_construction_display_exterior_walls_2 = RemoteReceiver(all_construction_display_exterior_walls)
all_construction_display_ground_2 = RemoteReceiver(all_construction_display_ground)
all_construction_display_interior_walls_2 = RemoteReceiver(all_construction_display_interior_walls)
all_construction_display_interior_floors_2 = RemoteReceiver(all_construction_display_interior_floors)
all_construction_display_exterior_roofs_2 = RemoteReceiver(all_construction_display_exterior_roofs)
setlist_10 = SetListContents(ListToModify=pulldown_18, NewListContents=all_construction_display_exterior_roofs_2, SelectedIndex="0")
setlist_11 = SetListContents(ListToModify=pulldown_16, NewListContents=all_construction_display_interior_floors_2, SelectedIndex="0")
setlist_12 = SetListContents(ListToModify=pulldown_15, NewListContents=all_construction_display_ground_2, SelectedIndex="0")
setlist_13 = SetListContents(ListToModify=pulldown_17, NewListContents=all_construction_display_exterior_floors_2, SelectedIndex="0")
setlist_14 = SetListContents(ListToModify=pulldown_14, NewListContents=all_construction_display_exterior_walls_2, SelectedIndex="0")
setlist_15 = SetListContents(ListToModify=pulldown_19, NewListContents=all_construction_display_interior_walls_2, SelectedIndex="0")

# ----
all_constructions_2 = RemoteReceiver(all_constructions)
all_constructions_3 = RemoteReceiver(all_constructions)
all_constructions_4 = RemoteReceiver(all_constructions)
item_58 = ListItem(List=all_constructions_2, Index=subset_exterior_floor_2, Wrap=True)
item_59 = ListItem(List=all_constructions_3, Index=subset_exterior_wall_2, Wrap=True)
item_60 = ListItem(List=all_constructions_4, Index=subset_exterior_roof_2, Wrap=True)
expression_90 = Expression(x="Generic", y=item_58, Expression="x=y")
expression_91 = Expression(x="Generic", y=item_59, Expression="x=y")
expression_92 = Expression(x="Generic", y=item_60, Expression="x=y")
filter_115 = StreamFilter(Gate=expression_90, Stream0=item_58, Stream1=null_11)
filter_116 = StreamFilter(Gate=expression_91, Stream0=item_59, Stream1=null_12)
filter_117 = StreamFilter(Gate=expression_92, Stream0=item_60, Stream1=null_13)
exteriorsubset_2 = HBExteriorConstructionSubset(exterior_wall=filter_116, exterior_roof=filter_117, exposed_floor=filter_115)  # -> exterior_set; plug-in component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

all_constructions_5 = RemoteReceiver(all_constructions)
all_constructions_6 = RemoteReceiver(all_constructions)
item_61 = ListItem(List=all_constructions_5, Index=subset_interior_wall_2, Wrap=True)
item_62 = ListItem(List=all_constructions_6, Index=subset_interior_floor_2, Wrap=True)
expression_93 = Expression(x="Generic", y=item_61, Expression="x=y")
expression_94 = Expression(x="Generic", y=item_62, Expression="x=y")
filter_118 = StreamFilter(Gate=expression_93, Stream0=item_61, Stream1=null_14)
filter_119 = StreamFilter(Gate=expression_94, Stream0=item_62, Stream1=null_15)
interiorsubset_2 = HBInteriorConstructionSubset(interior_wall=filter_118, interior_floor=filter_119)  # -> interior_set; plug-in component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

all_constructions_7 = RemoteReceiver(all_constructions)
item_63 = ListItem(List=all_constructions_7, Index=subset_ground_floor_2, Wrap=True)
expression_95 = Expression(x="Generic", y=item_63, Expression="x=y")
filter_120 = StreamFilter(Gate=expression_95, Stream0=item_63, Stream1=null_16)
groundsubset_2 = HBGroundConstructionSubset(ground_floor=filter_120)  # -> ground_set; plug-in component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

constructionset_3 = HBConstructionSet(
    name=panel_142,
    base_constr_set=panel_83,
    exterior_subset=exteriorsubset_2,
    ground_subset=groundsubset_2,
    interior_subset=interiorsubset_2,
    subface_subset=subfacesubset_2)  # -> constr_set; plug-in component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
decnstrconstrset_3 = HBDeconstructConstructionSet(constr_set=constructionset_3)  # -> exterior_wall, exterior_roof, exposed_floor, ground_wall, ground_roof, ground_floor, window, skylight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; plug-in component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
panel_287 = Panel(decnstrconstrset_3.exterior_wall)
panel_288 = Panel(decnstrconstrset_3.window)
decnstrconstr_5 = HBDeconstructConstruction(constr=decnstrconstrset_3.exterior_roof)  # -> materials, layers, r_val_si, r_val_ip, u_fac_si, u_fac_ip, shgc, t_sol, t_vis; plug-in component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
decnstrconstr_6 = HBDeconstructConstruction(constr=decnstrconstrset_3.exterior_wall)  # -> materials, layers, r_val_si, r_val_ip, u_fac_si, u_fac_ip, shgc, t_sol, t_vis; plug-in component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
add_dynamic_shades = AddDynamicShades(base_construction_set=constructionset_3, setpoint=Slider(100, range=0..200))

decnstrconstr_7 = HBDeconstructConstruction(constr=decnstrconstrset_3.window)  # -> materials, layers, r_val_si, r_val_ip, u_fac_si, u_fac_ip, shgc, t_sol, t_vis; plug-in component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
calc_mat_thickness = HBDeconstructMaterial(mats=decnstrconstr_5.materials)  # -> out, t; inputs mats: list
#   port mats: A material to be deconstructed. This can also be text for a material to be looked up in the material library.
# ---------- calc_mat_thickness: Python ----------
from honeybee_energy.material.opaque import EnergyMaterial, EnergyMaterialNoMass
t = 0
lamb = 0.036
for mat in mats:
    print(mat.thickness, type(mat))
    if type(mat) == EnergyMaterial:
        t = t + mat.thickness
    elif type(mat) == EnergyMaterialNoMass:
        print (mat.r_value * lamb)
        t = t + (mat.r_value * lamb)
    else:
        pass
print ('total thickness:' + str(t))
# ---------- end calc_mat_thickness ----------
calc_mat_thickness_2 = HBDeconstructMaterial(mats=decnstrconstr_6.materials)  # -> out, t; inputs mats: list; same code as calc_mat_thickness
decnstrmat_5 = HBDeconstructMaterial(mat=decnstrconstr_7.materials)  # -> values, attr_names, r_val_si, r_val_ip; plug-in component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
python_3 = GhPythonScript(x=decnstrconstr_7.materials)  # -> out, a
# ---------- python_3: Python ----------
from honeybee_energy.material import glazing

if type(x) == glazing.EnergyWindowMaterialSimpleGlazSys:
    a = x.to_idf()
# ---------- end python_3 ----------

custom_constructions_info_2 = RemoteReceiver(custom_constructions_info)
join_11 = TextJoin(Text=custom_constructions_info_2)  # -> flatten(Result)
lng_53 = ListLength(List=join_11)
py3_77 = Python3Script(current_elements=lng_53, maximum_elements=number_slider_58)  # -> status; inputs current_elements: Int32, maximum_elements: Int32
# ---------- py3_77: Python ----------
status = [True]*current_elements
status.extend([False]*(maximum_elements-current_elements))
# ---------- end py3_77 ----------
settextblock_24 = SetTextBlockContents(TextBlockToModify=tb_20, NewTextBlockContents=join_11)
custom_constructions_2 = RemoteReceiver(custom_constructions)
setexp_5 = SetExpander(Expander=expander_6, Name=custom_constructions_2)
hideshow_73 = HideShowElement(ElementToHideShow=simplify(merge_7), Show=simplify(graft(py3_77)), Collapse=True, Disable=False)

data_76 = Data(add_dynamic_shades)
entwine_199 = Entwine(
    Branch00=cluster_9,
    Branch01=cluster_8,
    Branch02=cluster_7,
    Branch03=cluster_6,
    Branch04=data_17,
    Branch05=data_76,
    Branch06=model_name_3,
    Branch07=generate_wwr_2,
    Branch08=calc_mat_thickness_2.t,
    Branch09=calc_mat_thickness.t,
    FlattenInputs=True)
freeze_gate_81 = StreamFreezeGate(Data=entwine_199, PassingSwitch=pre_create_model_4, Hold=True)
bang_30 = ExplodeTree(Data=freeze_gate_81)  # -> Branch0, Branch1, Branch2, Branch3, Branch4, Branch5, Branch6, Branch7, Branch8, Branch9
construction = Data(bang_30.Branch5)
program = Data(bang_30.Branch4)
model_name_4 = Data(bang_30.Branch6)
roof_thickness = Data(bang_30.Branch9)
wall_thickness = Data(bang_30.Branch8)
wwr = Data(bang_30.Branch7)
python_4 = GhPythonScript(in_list=construction)  # -> out_list; inputs in_list: list
# ---------- python_4: Python ----------
"""Converts lists of HB objects to dicts for use with Py3.
    Inputs:
        in_list: List of HB objects
    Output:
        out_list: List of Python dictionaries representing HB objects"""

__author__ = "sawen"
__version__ = "2024.07.09"

out_list = list([x.to_dict() for x in in_list])
# ---------- end python_4 ----------
python_5 = GhPythonScript(in_list=program)  # -> out_list; inputs in_list: list; same code as python_4
model_name_5 = Text(model_name_4)
adjacent_geometry = Geometry(bang_30.Branch1)
windows_2 = Geometry(bang_30.Branch3)
window_to_wall_ratio = Number(wwr)
room_geometry = Geometry(bang_30.Branch0)
context_geometry = Geometry(bang_30.Branch2)
wall_thickness_2 = Number(wall_thickness)
py3_78 = Python3Script(
    window_wall_ratio=window_to_wall_ratio,
    window_height=window_height,
    sill_height=sill_height,
    horizontal_separation=horizontal_separation,
    wall_thickness=wall_thickness_2)  # -> out, window_settings
# ---------- py3_78: Python ----------
from heath import WindowSettings

"""Create Window Settings"""
window_settings = WindowSettings(window_wall_ratio, window_height, sill_height, horizontal_separation, wall_thickness)
# ---------- end py3_78 ----------

# ---- group: Filter window geometry if WWR option is active
bool_75 = Boolean(window_to_wall_ratio)
gate_87 = StreamGate(Stream=windows_2, Gate=bool_75)  # -> Target0, Target1

# ----
debrep = DeconstructBrep(Brep=room_geometry)  # -> Faces, Edges, Vertices; disabled
evalsrf = EvaluateSurface(Surface=graft(debrep.Faces), Point=py3_36.a)  # -> Point, Normal, UDirection, VDirection, Frame; disabled
pt_22 = Point(evalsrf.Point)  # disabled

py3_79 = Python3Script(
    model_name=model_name_5,
    room_geo=room_geometry,
    construction_sets=python_4,
    programs=python_5,
    energy_systems=heatcool,
    adjacent_surfaces=adjacent_geometry,
    window_geo=gate_87.Target0,
    window_settings=py3_78.window_settings,
    context_geo=context_geometry,
    jsonify=Toggle(True))  # -> out, hb_model; inputs room_geo: list of Brep, construction_sets: list, programs: list, energy_systems: list, adjacent_surfaces: list of Brep, window_geo: list of Surface, context_geo: list of GeometryBase
# ---------- py3_79: Python ----------
# Copyright (c) 2024, Heath.
# You should have received a copy of the GNU Affero General Public License
# along with Heath; If not, see <http://www.gnu.org/licenses/>.
# 
# @license AGPL-3.0-or-later <https://spdx.org/licenses/AGPL-3.0-or-later>

"""Grasshopper Script"""
        
from heath import create_hb_model, heath_globals, utils

import Rhino.Geometry as rg
import IronPython
import importlib
import honeybee_energy

from honeybee.room import Room
cs = honeybee_energy.constructionset.ConstructionSet
pt = honeybee_energy.programtype.ProgramType 

import scriptcontext

def dictify(d):
    if type(d) in [dict, IronPython.Runtime.PythonDictionary]:
        d = dict(d)
        for key in d:
            d[key] = dictify(d[key])
    elif type(d) in [list, IronPython.Runtime.List]:
        d = [dictify(value) for value in list(d)]
    return d

if __name__ == "__main__":
    if not scriptcontext.sticky["heath_flying"]:
        raise Exception("Heath - fly component must exist on the canvas")
    ghenv.Component.Message = heath_globals.version

    # SUPER HACK because Py3 does not retain the Honeybee types
    # https://discourse.ladybug.tools/t/ladybug-honeybee-datatypes-are-converted-when-input-to-py3-component/28216
    construction_sets = [cs.from_dict(dictify(c)) for c in construction_sets]
    
    programs_patched = []
    for p in programs:
        # hack to fix py2-py3 conversion of dicts
        p = pt.from_dict(dictify(p))
        programs_patched.append(p)

    hb_model = create_hb_model(ghenv, list(room_geo), construction_sets, programs_patched, adjacent_surfaces, energy_systems, window_geo, window_settings, louver_settings, context_geo, model_name)

    if jsonify:
        hb_model = utils.jsonify(hb_model.to_dict())
# ---------- end py3_79 ----------
strtoobj_7 = HBStringToObject(hb_str=py3_79.hb_model)  # -> hb_obj; plug-in component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
deconstructmodel_4 = HBDeconstructModel(model=strtoobj_7)  # -> rooms, faces, apertures, doors, shades; plug-in component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
lng_54 = ListLength(List=deconstructmodel_4.rooms)
bool_76 = Boolean(lng_54)
gate_88 = StreamGate(Stream=strtoobj_7, Gate=bool_76)  # -> Target0, Target1
entwine_200 = Entwine(Branch0X=gate_88.Target1, Branch1X=model_name_5, Branch2X=py3_33, FlattenInputs=False)
freeze_gate_82 = StreamFreezeGate(Data=entwine_200, PassingSwitch=create_model_3)
split_17 = SplitTree(Data=freeze_gate_82, Masks=flatten("{0;*}"))  # -> Positive, flatten(Negative)
join_12 = TextJoin(Text=split_17.Negative)
dumpobjects = HBDumpObjects(hb_objs=flatten(split_17.Positive), name=join_12, folder=py3_39, dump=Toggle(True))  # -> report, hb_file; plug-in component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

python_6 = GhPythonScript(x=deconstructmodel_4.rooms)  # -> out, a; inputs x: list
# ---------- python_6: Python ----------
a = []
for room in x:
    a.append(room.properties.radiance.modifier_set)
# ---------- end python_6 ----------
decnstrmodset = HBDeconstructModifierSet(mod_set=python_6.a)  # -> exterior_wall, exterior_roof, exposed_floor, window, skylight, operable, exterior_door, overhead_door, glass_door, exterior_shade; plug-in component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
decnstrmodset_2 = HBDeconstructModifierSet(mod_set=deconstructmodel_4.rooms)  # -> exterior_wall, exterior_roof, exposed_floor, window, skylight, operable, exterior_door, overhead_door, glass_door, exterior_shade; plug-in component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
colorroomattr_2 = HBColorRoomAttributes(rooms_model=flatten(deconstructmodel_4.rooms), attribute=roomradianceattr)  # -> mesh, legend, wire_frame, values, colors, vis_set; plug-in component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
data_77 = Data(decnstrmodset.exterior_wall)
panel_289 = Panel(data_77)
panel_290 = Panel(decnstrmodset.window)
panel_291 = Panel(dumpobjects.hb_file)
py3_80 = Python3Script(all_models=current_all_created_models_names, new_model_name=join_12)  # -> out, index; inputs all_models: list
# ---------- py3_80: Python ----------
index = -1
for i, model in enumerate(all_models):
    print(model, new_model_name)
    if new_model_name == model:
        index = i
        break
# ---------- end py3_80 ----------
data_78 = Data(py3_80.index)
event_77 = EventGate(Data=data_78)  # -> Data, IsNew
setlist_16 = SetListContents(ListToModify=pulldown_4, NewListContents=current_all_created_models_names_7, SelectedIndex=event_77.Data)  # disabled

all_construction_names_2 = RemoteReceiver(all_construction_names)
expression_96 = Expression(x=all_construction_names_2, y=create_construction_name_2, Expression="x=y")
cull_27 = CullPattern(List=expression_96, CullPattern=expression_96)
gate_89 = StreamGate(Stream="Material already exists", Gate=cull_27)  # -> Target0, Target1

visualize_construction_thickness_2 = RemoteReceiver(visualize_construction_thickness)
visualize_construction_materials_2 = RemoteReceiver(visualize_construction_materials)
tstat_3 = TreeStatistics(Tree=visualize_construction_materials_2)  # -> Paths, Length, Count
tstat_4 = TreeStatistics(Tree=visualize_construction_thickness_2)  # -> Paths, Length, Count
stack_98 = StackData(Data=tstat_3.Paths, Stack=tstat_3.Length)
stack_99 = StackData(Data=tstat_4.Paths, Stack=tstat_4.Length)
tree_3 = CreateTree(Data=flatten(visualize_construction_materials_2), Path=stack_98)
tree_4 = CreateTree(Data=flatten(visualize_construction_thickness_2), Path=stack_99)
custom_constructions_3 = RemoteReceiver(custom_constructions)
suirify_12 = Suirify(tree_3)
suirify_13 = Suirify(tree_4)
branch_3 = TreeBranch(Tree=suirify_12, Path=path_3, MaintainPaths=True)
branch_4 = TreeBranch(Tree=suirify_13, Path=path_3, MaintainPaths=True)
item_64 = ListItem(List=custom_constructions_3, Index=pre_construction_database_visualize_cons_2, Wrap=True)
ma_56 = MassAddition(Input=branch_4)  # -> Result, PartialResults
concat_9 = Concatenate(FragmentA=ma_56.Result, FragmentB=" m")
concat_10 = Concatenate(FragmentA=branch_4, FragmentB=" m")
multiplication_8 = Multiplication(A=Slider(400, range=0..1000), B=branch_4)
format_45 = Format(Format=panel_221, Culture=127, Data0=concat_9)
cull_i_5 = CullIndex(List=multiplication_8, Indices="-1", Wrap=True)
item_65 = ListItem(List=multiplication_8, Index="-1", Wrap=True)
lng_55 = ListLength(List=concat_10)
py3_81 = Python3Script(current_elements=lng_55, maximum_elements=construction_maximum_layer_limit_7)  # -> status; inputs current_elements: Int32, maximum_elements: Int32; same code as py3_77
setlabel_9 = SetLabelContents(LabelToModify=label_57, NewLabelContents=item_64)
setlabel_10 = SetLabelContents(LabelToModify=label_60, NewLabelContents=format_45)
settextblock_25 = SetTextBlockContents(TextBlockToModify=tb_28, NewTextBlockContents=branch_3)
settextblock_26 = SetTextBlockContents(TextBlockToModify=tb_27, NewTextBlockContents=concat_10)
entwine_201 = Entwine(Branch00=cull_i_5, Branch01=item_65, FlattenInputs=True)  # -> flatten(Result)
hideshow_74 = HideShowElement(ElementToHideShow=tb_27, Show=py3_81, Collapse=True, Disable=False)
hideshow_75 = HideShowElement(ElementToHideShow=tb_28, Show=py3_81, Collapse=True, Disable=False)
hideshow_76 = HideShowElement(ElementToHideShow=tb_29, Show=py3_81, Collapse=True, Disable=False)
py3_82 = Python3Script(layerHeight=entwine_201, textHeight=Slider(22, range=0..100))  # -> over_text, under_text; inputs layerHeight: list
# ---------- py3_82: Python ----------
over_text = []
under_text = []

for layer in layerHeight:
    if layer <= textHeight:
        over_text.append(0)
        under_text.append(layer)
    else:
        over_text.append((layer/2)-(textHeight/2))

        under_text.append((layer/2)+(textHeight/2))
# ---------- end py3_82 ----------
adjustpos_142 = AdjustElementPositioning(
    ElementsToAdjust=tb_29,
    Margin="0, 0, 0, -1",
    AbsolutePositioning=False,
    Width=number_slider_75,
    Height=py3_82.over_text,
    HorizontalAlignment=0,
    VerticalAlignment=1)
adjustpos_143 = AdjustElementPositioning(
    ElementsToAdjust=tb_28,
    AbsolutePositioning=False,
    Width=number_slider_75,
    Height=py3_82.under_text,
    HorizontalAlignment=0,
    VerticalAlignment=1)

created_materials_database = RemoteReceiver(created_materials_database_2)
panel_292 = Panel(created_materials_database)
decnstrmat_6 = HBDeconstructMaterial(mat=created_materials_database)  # -> category, values, attr_names, r_val_si, r_val_ip; plug-in component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
item_66 = ListItem(List=decnstrmat_6.values, Index=0, Wrap=True)  # -> flatten(Item), flatten(Item1), flatten(Item2), flatten(Item3), flatten(Item4)
create_material_categories = RemoteSender(decnstrmat_6.category)
clean_13 = CleanTree(RemoveNulls=True, RemoveInvalid=True, RemoveEmpty=False, Tree=item_66.Item)
clean_14 = CleanTree(RemoveNulls=True, RemoveInvalid=True, RemoveEmpty=False, Tree=item_66.Item2)
clean_15 = CleanTree(RemoveNulls=True, RemoveInvalid=True, RemoveEmpty=False, Tree=item_66.Item3)
clean_16 = CleanTree(RemoveNulls=True, RemoveInvalid=True, RemoveEmpty=False, Tree=item_66.Item4)
lng_56 = ListLength(List=clean_13)
num_15 = Number(clean_14)
create_material_names = RemoteSender(clean_13)
num_16 = Number(clean_15)
num_17 = Number(clean_16)
expression_97 = Expression(x=num_15, Expression="Round(x, 2)")
expression_98 = Expression(x=num_16, Expression="Round(x, 2)")
expression_99 = Expression(x=num_17, Expression="Round(x, 2)")
bool_77 = Boolean(lng_56)
gate_90 = StreamGate(Stream=panel_62, Gate=bool_77)  # -> Target0, Target1
format_46 = Format(Format=gate_90.Target1, Culture=127, Data0=clean_13, Data1=expression_97, Data2=expression_98, Data3=expression_99)
panel_293 = Panel(format_46)
database_materials = RemoteSender(format_46)

create_material_categories_2 = RemoteReceiver(create_material_categories)
create_material_names_2 = RemoteReceiver(create_material_names)
database_materials_2 = RemoteReceiver(database_materials)
mindex_12 = MemberIndex(Set=material_database_categories_3, Member=create_material_categories_2)  # -> simplify(Index), Count
getbrn_2 = GetMatchingBranches(
    PrimaryData=mindex_12.Index,
    SecondaryData1=simplify(graft(database_materials_2)),
    SecondaryData2=simplify(graft(create_material_names_2)),
    removeEmpty=True,
    ValueTable_removeEmpty=False)  # -> flatten(PrimaryData), flatten(SecondaryData1), flatten(SecondaryData2)
cull_28 = CullPattern(List=create_material_categories_2, CullPattern=mindex_12.Count)
database_materials_current = RemoteSender(getbrn_2.SecondaryData1)
create_material_names_current = RemoteSender(getbrn_2.SecondaryData2)
create_material_categories_current = RemoteSender(cull_28)
material_database_categories_current = RemoteSender(getbrn_2.PrimaryData)

material_database_categories_current_2 = RemoteReceiver(material_database_categories_current)
material_database_categories_current_3 = RemoteReceiver(material_database_categories_current)
create_material_names_current_2 = RemoteReceiver(create_material_names_current)
database_materials_current_2 = RemoteReceiver(database_materials_current)
create_material_names_current_3 = RemoteReceiver(create_material_names_current)

expression_100 = Expression(x=create_material_names_current_3, y=create_material_name_2, Expression="x=y")
cull_29 = CullPattern(List=expression_100, CullPattern=expression_100)
gate_91 = StreamGate(Stream="Material already exists", Gate=cull_29)  # -> Target0, Target1
entwine_202 = Entwine(Branch00=filter_54, Branch01=gate_91.Target1, Branch02=gate_33.Target1, FlattenInputs=True)  # -> flatten(Result)
item_67 = ListItem(List=entwine_202, Index=0, Wrap=True)
create_material_error_message = RemoteSender(item_67)

create_material_error_message_2 = RemoteReceiver(create_material_error_message)
null_54 = NullItem(Item=create_material_error_message_2)  # -> NullFlags, InvalidFlags, Description
filter_121 = StreamFilter(Gate=null_54.NullFlags, Stream0=create_material_error_message_2, Stream1=" ")
filter_122 = StreamFilter(Gate=null_54.NullFlags, Stream0=Slider(500, range=0..1000), Stream1=Slider(1000000, range=0..1000000))
hideshow_77 = HideShowElement(ElementToHideShow=button_50, Show=True, Collapse=True, Disable=invert(null_54.NullFlags))
tooltip_16 = AttachTooltipToElement(ElementsToAttachTo=button_50, TooltipContent=filter_121, ShowDelay=filter_122, Duration=Slider(5000, range=0..10000))

create_material_names_current_4 = RemoteReceiver(create_material_names_current)
create_material_categories_current_2 = RemoteReceiver(create_material_categories_current)

mindex_13 = MemberIndex(Set=create_material_names_current_4, Member=branch_3)  # -> flatten(Index), Count
item_68 = ListItem(List=create_material_categories_current_2, Index=mindex_13.Index, Wrap=True)
mindex_14 = MemberIndex(Set=material_database_categories_8, Member=item_68)  # -> flatten(Index), Count
item_69 = ListItem(List=entwine_154, Index=mindex_14.Index, Wrap=True)
adjustelem_30 = AdjustElementAppearance(ElementsToAdjust=tb_29, Foreground=swatch_11, Background=item_69)
adjustelem_31 = AdjustElementAppearance(ElementsToAdjust=tb_28, Foreground=swatch_11, Background=item_69)

sort_3 = SortList(
    Keys=material_database_categories_current_2,
    ValuesA=database_materials_current_2,
    ValuesB=create_material_names_current_2)  # -> Keys, ValuesA, ValuesB
py3_83 = Python3Script(maximum_elements=lng_8, current_elements=material_database_categories_current_3, maximum_buttons=number_slider_60)  # -> status; inputs current_elements: list, maximum_buttons: Int32
# ---------- py3_83: Python ----------
from collections import Counter
import ghpythonlib.treehelpers as th

c = Counter(current_elements)
status = []

for i in range(maximum_elements):
    current_category = [True]*c[i]
    current_category.extend([False]*(maximum_buttons-c[i]))
    status.append(current_category)

status = th.list_to_tree(status)
# ---------- end py3_83 ----------
create_material_names_sorted = RemoteSender(sort_3.ValuesB)
concat_11 = Concatenate(FragmentA="- ", FragmentB=sort_3.ValuesA)
cull_30 = CullPattern(List=tb_21, CullPattern=py3_83)  # -> flatten(List)
material_database_hideshow = RemoteSender(py3_83)
settextblock_27 = SetTextBlockContents(TextBlockToModify=cull_30, NewTextBlockContents=concat_11)
hideshow_78 = HideShowElement(ElementToHideShow=simplify(shfdep), Show=simplify(py3_83), Collapse=True, Disable=False)

material_database_hideshow_2 = RemoteReceiver(flatten(material_database_hideshow))
filter_123 = StreamFilter(Gate=lng_20, Stream0="False", Stream1=material_database_hideshow_2)
freeze_gate_83 = StreamFreezeGate(Data=filter_123, PassingSwitch=filter_49, Freeze=True, Hold=False)
cull_31 = CullPattern(List=freeze_gate_55, CullPattern=freeze_gate_83)
create_material_names_sorted_2 = RemoteReceiver(create_material_names_sorted)
cset_11 = CreateSet(List=cull_31)  # -> Set, Map
cull_32 = CullPattern(List=cset_11.Set, CullPattern=cset_11.Set)
mindex_15 = MemberIndex(Set=cull_31, Member=cull_32)  # -> Index, Count
freeze_gate_84 = StreamFreezeGate(Data=create_material_names_sorted_2, PassingSwitch=filter_49, Freeze=True, Hold=False)
hold_12 = HoldingGate(Data=mindex_15.Index)
item_70 = ListItem(List=freeze_gate_84, Index=hold_12, Wrap=True)
expression_101 = Expression(x=item_21, y=item_70, Expression="x≠y")
cull_33 = CullPattern(List=split_7, CullPattern=expression_101)
join_13 = TextJoin(Text=cull_33, Join="|")
filter_124 = StreamFilter(Gate=bool_48, Stream0=bool_48, Stream1=join_13)
freeze_gate_85 = StreamFreezeGate(Data=filter_124, PassingSwitch=material_database_remove_material_2, Freeze=False, Hold=False)

panel_294 = Panel(filter_124)
panel_295 = Panel(freeze_gate_85)
setdocumentusertext_3 = Python3Script(key=panel_235, load_value=freeze_gate_40, remove_value=freeze_gate_85, add_value=freeze_gate_60, sync=or_12)  # -> done
# ---------- setdocumentusertext_3: Python ----------
import Rhino
import rhinoscriptsyntax as rs
import scriptcontext as sc

def modify_value(value):
    sc.doc = Rhino.RhinoDoc.ActiveDoc

    return rs.SetDocumentUserText(key, value)

    sc.doc = ghdoc

if load_value:
    done = modify_value(load_value)

elif add_value:
    done = modify_value(add_value)

elif remove_value:
    done = modify_value(remove_value)
elif remove_value == False:
    done = modify_value(None)

elif sync:
    done = True
# ---------- end setdocumentusertext_3 ----------
getdocumentusertext_15 = Python3Script(run=setdocumentusertext_3, key="Heath materials")  # -> json_string; same code as getdocumentusertext_14
split_18 = TextSplit(Text=getdocumentusertext_15, Separators="|")
hold_13 = HoldingGate(Data=split_18)
strtoobj_8 = HBStringToObject(hb_str=hold_13)  # -> flatten(hb_obj); plug-in component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
ipy2_3 = IronPython2Script(materials=strtoobj_8)  # -> unique_materials; inputs materials: list; same code as ipy2
lng_57 = ListLength(List=ipy2_3)
lng_58 = ListLength(List=strtoobj_8)
clean_17 = CleanTree(RemoveNulls=True, RemoveInvalid=True, RemoveEmpty=False, Tree=ipy2_3)
smaller_12 = SmallerThan(FirstNumber=lng_57, SecondNumber=lng_58)  # -> SmallerThan, OrEqualTo
created_materials_database_2 = RemoteSender(clean_17)
hasdata_24 = DataExists(Data=smaller_12.SmallerThan)
filter_125 = StreamFilter(Gate=hasdata_24, Stream0="False", Stream1=smaller_12.SmallerThan)
overlap_materials = RemoteSender(filter_125)

overlap_materials_2 = RemoteReceiver(overlap_materials)
hideshow_79 = HideShowElement(ElementToHideShow=label_40, Show=overlap_materials_2, Collapse=True, Disable=False)

panel_296 = Panel(setdocumentusertext_3)
panel_297 = Panel(getdocumentusertext_15)
panel_298 = Panel(clean_17)

created_materials_database_3 = RemoteReceiver(created_materials_database_2)
cull_34 = CullPattern(List=created_materials_database_3, CullPattern=mindex_12.Count)
lng_59 = ListLength(List=created_materials_database_3)
lng_60 = ListLength(List=cull_34)
created_materials_database_current = RemoteSender(cull_34)

larger_6 = LargerThan(FirstNumber=lng_59, SecondNumber=lng_60)  # -> LargerThan, OrEqualTo

hasdata_25 = DataExists(Data=larger_6.LargerThan)
filter_126 = StreamFilter(Gate=hasdata_25, Stream0="False", Stream1=larger_6.LargerThan)
invalid_material_categories = RemoteSender(filter_126)

invalid_material_categories_2 = RemoteReceiver(invalid_material_categories)
hideshow_80 = HideShowElement(ElementToHideShow=label_7, Show=invalid_material_categories_2, Collapse=True, Disable=False)

created_materials_database_current_2 = RemoteReceiver(created_materials_database_current)

database_materials_current_3 = RemoteReceiver(database_materials_current)
lng_61 = ListLength(List=database_materials_current_3)
series = Series(Start=0, Step=1, Count=lng_61)
hasdata_26 = DataExists(Data=database_materials_current_3)
tsort = SortText(Keys=database_materials_current_3, Values=series, Culture=127)  # -> Keys, Values
filter_127 = StreamFilter(Gate=hasdata_26, Stream0=empty_11, Stream1=tsort.Keys)
create_construction_materials_sorted = RemoteSender(tsort.Values)
setlist_17 = SetListContents(ListToModify=pulldown_27, NewListContents=filter_127, SelectedIndex=bang_12.Branch0)

create_construction_materials_sorted_2 = RemoteReceiver(create_construction_materials_sorted)
item_71 = ListItem(List=created_materials_database_current_2, Index=create_construction_materials_sorted_2, Wrap=invert(True))
item_72 = ListItem(List=item_71, Index=create_construction_materials_3, Wrap=invert(True))
repeat_22 = RepeatData(Data=item_72, Length=visible_layers_2)  # -> flatten(Data)
cluster_39 = Cluster(materials=repeat_22, construction_name=create_construction_name_4, thicknesses=repeat_16)  # -> error_2, construction_2
create_construction_error = RemoteSender(cluster_39.error_2)
gate_92 = StreamGate(Stream=cluster_39.construction_2, Gate=create_construction_2)  # -> Target0, Target1
objtostr_4 = HBObjectToString(hb_obj=gate_92.Target1)  # -> hb_str; plug-in component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
entwine_203 = Entwine(Branch00=getdocumentusertext_11, Branch01=objtostr_4, FlattenInputs=True)  # -> flatten(Result)
freeze_gate_86 = StreamFreezeGate(Data=entwine_203, PassingSwitch=create_construction_2, Freeze=False, Hold=False)
join_14 = TextJoin(Text=freeze_gate_86, Join="|")

create_construction_error_2 = RemoteReceiver(create_construction_error)
panel_299 = Panel(create_construction_error_2)
split_19 = TextSplit(Text=create_construction_error_2, Separators=panel_202)
trim_3 = TextTrim(Text=split_19, Start=True, End=True)
item_73 = ListItem(List=trim_3, Index=0, Wrap=True)  # -> Item, Item1
lng_62 = ListLength(List=split_19)
len_6 = TextLength(Text=item_73.Item1)
larger_7 = LargerThan(FirstNumber=lng_62, SecondNumber="1")  # -> LargerThan, OrEqualTo
subtraction_17 = Subtraction(A=len_6, B=Slider(11, range=0..20))
fragment_5 = TextFragment(Text=item_73.Item1, Start="0", Count=subtraction_17)
filter_128 = StreamFilter(Gate=larger_7.LargerThan, Stream0=create_construction_error_2, Stream1=fragment_5)
entwine_204 = Entwine(Branch00=filter_128, Branch01=gate_89.Target1, Branch02=gate_32.Target1, FlattenInputs=True)  # -> flatten(Result)
panel_300 = Panel(filter_128)
item_74 = ListItem(List=entwine_204, Index=0, Wrap=True)
create_construction_error_message = RemoteSender(item_74)

create_construction_error_message_2 = RemoteReceiver(create_construction_error_message)
null_55 = NullItem(Item=create_construction_error_message_2)  # -> NullFlags, InvalidFlags, Description
filter_129 = StreamFilter(Gate=null_55.NullFlags, Stream0=create_construction_error_message_2, Stream1=" ")
filter_130 = StreamFilter(Gate=null_55.NullFlags, Stream0=Slider(500, range=0..1000), Stream1=Slider(1000000, range=0..1000000))
hideshow_81 = HideShowElement(ElementToHideShow=button_47, Show=True, Collapse=True, Disable=invert(null_55.NullFlags))
tooltip_17 = AttachTooltipToElement(ElementsToAttachTo=button_47, TooltipContent=filter_129, ShowDelay=filter_130, Duration=Slider(5000, range=0..10000))

setdocumentusertext_4 = Python3Script(
    key=panel_234,
    load_value=freeze_gate_39,
    remove_value=freeze_gate_26,
    add_value=join_14,
    sync=sync_construction_database_2)  # -> done
# ---------- setdocumentusertext_4: Python ----------
import Rhino
import rhinoscriptsyntax as rs
import scriptcontext as sc

def modify_value(value):
    sc.doc = Rhino.RhinoDoc.ActiveDoc

    done = rs.SetDocumentUserText(key, value)
    return done

    sc.doc = ghdoc

if load_value:
    done = modify_value(load_value)

if add_value:
    done = modify_value(add_value)

if remove_value:
    done = modify_value(remove_value)

if remove_value == False:
    done = modify_value(None)

elif sync:
    done = True
# ---------- end setdocumentusertext_4 ----------
getdocumentusertext_16 = Python3Script(run=setdocumentusertext_4, key="Heath constructions")  # -> json_string; same code as getdocumentusertext_14
split_20 = TextSplit(Text=getdocumentusertext_16, Separators="|")
hold_14 = HoldingGate(Data=split_20)
strtoobj_9 = HBStringToObject(hb_str=hold_14)  # -> flatten(hb_obj); plug-in component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
ipy2_4 = IronPython2Script(constructions=strtoobj_9)  # -> unique_constructions; inputs constructions: list
# ---------- ipy2_4: IronPython ----------
"""Grasshopper Script"""

unique_constructions = []

for i in range(len(constructions)):
    if constructions[i] not in unique_constructions:
        unique_constructions.append(constructions[i])
# ---------- end ipy2_4 ----------
lng_63 = ListLength(List=ipy2_4)
lng_64 = ListLength(List=strtoobj_9)
clean_18 = CleanTree(RemoveNulls=True, RemoveInvalid=True, RemoveEmpty=False, Tree=ipy2_4)
smaller_13 = SmallerThan(FirstNumber=lng_63, SecondNumber=lng_64)  # -> SmallerThan, OrEqualTo
created_constructions_database_2 = RemoteSender(clean_18)
hasdata_27 = DataExists(Data=smaller_13.SmallerThan)
filter_131 = StreamFilter(Gate=hasdata_27, Stream0="False", Stream1=smaller_13.SmallerThan)
overlap_constructions = RemoteSender(filter_131)

overlap_constructions_2 = RemoteReceiver(overlap_constructions)
hideshow_82 = HideShowElement(ElementToHideShow=label_39, Show=overlap_constructions_2, Collapse=True, Disable=False)

panel_301 = Panel(strtoobj_9)
panel_302 = Panel(clean_18)

# ==== cluster AddDynamicShades
base_construction_set = ClusterInput()
setpoint = ClusterInput()
base_construction_set_2 = Data(base_construction_set)
decnstrconstrset = HBDeconstructConstructionSet(constr_set=base_construction_set_2)  # -> exterior_wall, exterior_roof, exposed_floor, ground_wall, ground_roof, ground_floor, window, skylight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; plug-in component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
setpoint_2 = Data(setpoint)
python = GhPythonScript(x=decnstrconstrset.window)  # -> out, a
# ---------- python: Python ----------
a = x.display_name
# ---------- end python ----------
merge = Merge(Data1=flatten(python.a), Data2=flatten("_dynamic_shades"))
shademat = HBShadeMaterial(thickness=Slider(0.01, range=0..0.01), transmittance=Slider(0.4, range=0..1))  # -> mat; plug-in component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
panel = Panel("Simple Glazing Window")
join = TextJoin(Text=merge)
windowconstrshd = HBWindowConstructionShade(
    name=join,
    win_constr=decnstrconstrset.window,
    shd_material=shademat,
    shd_location="Exterior",
    control_type=Slider(1, range=0..8),
    setpoint=setpoint_2)  # -> constr; plug-in component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
subfacesubset = HBSubfaceSubset(window=windowconstrshd, operable=windowconstrshd)  # -> subface_set; plug-in component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
constructionset = HBConstructionSet(base_constr_set=base_construction_set_2, subface_subset=subfacesubset)  # -> constr_set; plug-in component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
construction_set = Data(constructionset)
construction_set_2 = ClusterOutput(construction_set)

# ==== cluster Cluster
materials = ClusterInput()
materials_2 = Data(materials)
opaqueconstr = HBOpaqueConstruction(materials=materials_2)  # -> constr; plug-in component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
thicknesses = ClusterInput()
decnstrconstr = HBDeconstructConstruction(constr=opaqueconstr)  # -> materials, layers, r_val_si, r_val_ip, u_fac_si, u_fac_ip, shgc, t_sol, t_vis; plug-in component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
thicknesses_2 = Number(thicknesses)
nullrep = ReplaceNulls(Items=thicknesses_2, Replacements="0")  # -> Items, Count
construction_name = ClusterInput()
modify_layer_thicknesses = BrimstoneModifyThicknessesOfHoneybeeMaterials(hb_materials=decnstrconstr.materials, thicknesses=nullrep.Items)  # -> out, mod_materials; inputs hb_materials: list, thicknesses: list
# ---------- modify_layer_thicknesses: Python ----------
"""
Calculates embodied carbon for the elements of a Honeybee model if data is available
This component was inspired by the 'HB Color Face Attributes' component of Ladybug Tools 1.6.0

    Args:
        hb_materials: List of Honeybee materials which should get new thickness
        thicknesses: List of new material thicknesses

    Returns:
        mod_materials: Modified Honeybee materials
"""

import scriptcontext
#import brimstone

ghenv.Component.Message = ""#brimstone.globals.version

ghenv.Component.Name = 'Brimstone - Modify thicknesses of Honeybee materials'
ghenv.Component.NickName = 'Modify layer thicknesses'

try:  # import the core honeybee dependencies
    from honeybee_energy.material.opaque import EnergyMaterial
    from honeybee_energy.material.opaque import EnergyMaterialNoMass
except ImportError as e:
    raise ImportError('\nFailed to import honeybee:\n\t{}'.format(e))

def main(hb_materials, thicknesses):
    mod_materials = []
    assert len(hb_materials) == len(thicknesses), "Materials and thickness list must be of the same length"
    for (i, material) in enumerate(hb_materials):
        if not isinstance(material, EnergyMaterial):
            if isinstance(material, EnergyMaterialNoMass):
                mod_material = material.duplicate()
                mod_materials.append(mod_material)
            else:
                raise Exception("All materials must be valid Honeybee Energy Materials or Energy Materials (No Mass)")
        else: # if material is EnergyMaterial
            mod_material = material.duplicate()
            mod_material.thickness = thicknesses[i]
            mod_materials.append(mod_material)
    return mod_materials

if __name__ == "__main__":
    try:
        pass#flying = scriptcontext.sticky["brimstone_flying"]
    except:
        raise Exception("The 'Brimstone - Fly' component needs to exist on the canvas")
    mod_materials = main(hb_materials, thicknesses)
# ---------- end modify_layer_thicknesses ----------
construction_name_2 = Text(construction_name)
opaqueconstr_2 = HBOpaqueConstruction(name=construction_name_2, materials=modify_layer_thicknesses.mod_materials)  # -> constr; plug-in component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
error = Data(modify_layer_thicknesses.out)
error_2 = ClusterOutput(error)
construction = Data(opaqueconstr_2)
construction_2 = ClusterOutput(construction)

# ==== cluster Cluster_2
window_construction = ClusterInput()
window_construction_2 = Data(window_construction)
fly = BrimstoneFly()
# ---------- fly: Python ----------
"""This component sets up global information for Brimstone
    Inputs:
    Output:
        """

import Grasshopper
import sys
sys.path.append(Grasshopper.Folders.UserObjectFolders[0])

import brimstone
reload(brimstone)

import scriptcontext

ghenv.Component.Name = 'Brimstone - Fly!'
ghenv.Component.NickName = 'Fly!'

scriptcontext.sticky["brimstone_flying"] = 'true'
ghenv.Component.Message = brimstone.globals.version
# ---------- end fly ----------
subfacesubset = HBSubfaceSubset(window=window_construction_2)  # -> subface_set; plug-in component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
panel = Panel(subfacesubset)
constructionset = HBConstructionSet(subface_subset=subfacesubset)  # -> constr_set; plug-in component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
density_kg_m2 = ClusterInput()
gwp_a1_a3 = ClusterInput()
gwp_a4 = ClusterInput()
decnstrconstrset = HBDeconstructConstructionSet(constr_set=constructionset)  # -> exterior_wall, exterior_roof, exposed_floor, ground_wall, ground_roof, ground_floor, window, skylight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; plug-in component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
gwp_a1_a3_2 = Data(gwp_a1_a3)
gwp_a4_2 = Data(gwp_a4)
density_kg_m2_2 = Data(density_kg_m2)
add_life_cycle_info_construction = BrimstoneAddLifeCycleInfoToHoneybeeConstruction(hb_construction=decnstrconstrset.window, gwp_a1_a3=gwp_a1_a3_2, gwp_a4=gwp_a4_2, density=density_kg_m2_2)  # -> mod_construction
# ---------- add_life_cycle_info_construction: Python ----------
"""
Adds GWP info to a Honeybee Construction

    Args:
        hb_construction: Honeybee Construction to be updated
        gwp_a1_a3: GWP (A1-A3) [kg CO2eq/m2]
        gwp_a4: GWP (A4) [kg CO2eq/m2]
        gwp_a5_1: GWP (A5.1) [kg CO2eq/m2]

    Returns:
        mod_construction: Updated Honeybee Construction
"""

import scriptcontext
import brimstone
ghenv.Component.Message = brimstone.globals.version
import Grasshopper

ghenv.Component.Name = 'Brimstone - Add Life Cycle Info to Honeybee Construction'
ghenv.Component.NickName = 'Add Life Cycle Info (Construction)'

try:  # import the core honeybee dependencies
    from honeybee_energy.construction.window import WindowConstruction
    from honeybee_energy.construction.opaque import OpaqueConstruction
except ImportError as e:
    raise ImportError('\nFailed to import honeybee:\n\t{}'.format(e))

def main(hb_construction, gwp_a1_a3, gwp_a4, density):
    if not isinstance(hb_construction, WindowConstruction)\
        and not isinstance(hb_construction, OpaqueConstruction):
        raise Exception("Currently only Window and Opaque constructions are supported")
    mod_construction = hb_construction.duplicate()
    user_data = mod_construction.user_data if mod_construction.user_data else {}
    
    user_data["gwp_a1_a3"] = gwp_a1_a3
    user_data["gwp_a4"] = gwp_a4
    user_data["conv_value"] = density
    
    mod_construction.user_data = user_data

    return mod_construction

if __name__ == "__main__":
    try:
        flying = scriptcontext.sticky["brimstone_flying"]
    except:
        raise Exception("The 'Brimstone - Fly' component needs to exist on the canvas")
    mod_construction = main(hb_construction, gwp_a1_a3, gwp_a4, density)
# ---------- end add_life_cycle_info_construction ----------
panel_2 = Panel(decnstrconstrset.window)
updated_construction = Data(add_life_cycle_info_construction)
panel_3 = Panel(add_life_cycle_info_construction)
updated_construction_2 = ClusterOutput(updated_construction)

# ==== cluster WeatherVisualisation
target_geometry = ClusterInput()
_1 = ClusterInput()
run_weather_visualisation = ClusterInput()
target_geometry_2 = ClusterInput()
sky_mask_centre_point = ClusterInput()
run_weather_visualisation_2 = Boolean(run_weather_visualisation)
filter = StreamFilter(Gate=run_weather_visualisation_2, Stream1=_1)
epw_file_url = Data(filter)

# ---- group: Get weather data
downloadepw = LBDownloadWeather(weather_URL=epw_file_url)  # -> epw_file, stat_file, ddy_file; plug-in component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
falsestart = LBFalseStartToggle(False)
epwtoddy = LBEPWToDDY(weather_file=downloadepw.epw_file, write=falsestart)  # -> ddy_file; plug-in component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
importloc = LBImportLocation(epw_file=downloadepw.epw_file)  # -> location; plug-in component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
importstat = LBImportSTAT(stat_file=downloadepw.stat_file)  # -> location, ashrae_zone, koppen_zone, clear_dir_norm_rad, clear_diff_horiz_rad, ann_heat_dday_996, ann_heat_dday_990, ann_cool_dday_004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; plug-in component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
constrloc = LBConstructLocation(elevation=0)  # -> location; plug-in component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
importepw = LBImportEPW(epw_file=downloadepw.epw_file)  # -> location, dry_bulb_temperature, dew_point_temperature, relative_humidity, wind_speed, wind_direction, direct_normal_rad, diffuse_horizontal_rad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; plug-in component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
importddy = LBImportDDY(ddy_file=downloadepw.ddy_file)  # -> location, design_days; plug-in component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

# ----
panel = Panel(importloc)

# ---- group: Sky matrix and incident radiation
analysisperiod = LBAnalysisPeriod(
    start_month=Slider(1, range=1..12),
    start_day=Slider(1, range=1..31),
    start_hour=Slider(0, range=0..23),
    end_month=Slider(12, range=1..12),
    end_day=Slider(31, range=1..31),
    end_hour=Slider(23, range=0..23))  # -> period, hoys, dates; plug-in component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
skymatrix = LBCumulativeSkyMatrix(
    location=importepw.location,
    direct_rad=importepw.direct_normal_rad,
    diffuse_rad=importepw.diffuse_horizontal_rad,
    hoys=analysisperiod.hoys,
    high_density=Toggle(False))  # -> report, sky_mtx; plug-in component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
context_geometry = Geometry(target_geometry)
target_geometry_3 = Geometry(target_geometry_2)
run_incident_radiation_study = Boolean(run_weather_visualisation_2)
incidentradiation = LBIncidentRadiation(
    sky_mtx=skymatrix.sky_mtx,
    geometry=flatten(target_geometry_3),
    context=flatten(context_geometry),
    grid_size=Slider(1, range=0..1),
    offset_dist=Slider(0.1, range=0..0.1),
    run=run_incident_radiation_study)  # -> report, points, results, total, mesh, legend, title, int_mtx; plug-in component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
skydome = LBSkyDome(sky_mtx=skymatrix.sky_mtx)  # -> report, mesh, compass, legend, title, patch_vecs, patch_values, mesh_values, vis_set; plug-in component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

# ---- group: Wind rose
analysisperiod_2 = LBAnalysisPeriod(
    start_month=Slider(1, range=1..12),
    start_day=Slider(1, range=1..31),
    start_hour=Slider(0, range=0..23),
    end_month=Slider(12, range=1..12),
    end_day=Slider(31, range=1..31),
    end_hour=Slider(23, range=0..23))  # -> period, hoys, dates; plug-in component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
windrose = LBWindRose(
    data=importepw.wind_speed,
    wind_direction=importepw.wind_direction,
    show_calm=Toggle(True),
    period=analysisperiod_2.period)  # -> report, mesh, compass, orient_line, freq_line, windrose_line, legend, title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; plug-in component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

# ---- group: Sun path
analysisperiod_3 = LBAnalysisPeriod(
    start_month=Slider(1, range=1..12),
    start_day=Slider(1, range=1..31),
    start_hour=Slider(0, range=0..23),
    end_month=Slider(12, range=1..12),
    end_day=Slider(31, range=1..31),
    end_hour=Slider(23, range=0..23))  # -> period, hoys, dates; plug-in component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
panel_2 = Panel("a>24")
sunpath = LBSunPath(location=importloc, hoys=analysisperiod_3.hoys, scale=1, data=importepw.dry_bulb_temperature)  # -> report, vectors, altitudes, azimuths, hoys, sun_pts, analemma, daily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; plug-in component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
msphere = MeshSphere(Base=sunpath.sun_pts, Radius=Slider(3, range=0..10), UCount=10, VCount=20)  # disabled

# ---- group: Graph data
timeop = LBTimeIntervalOperation(data=importepw.dry_bulb_temperature)  # -> daily, monthly, mon_per_hr; plug-in component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
legendpar = LBLegendParameters(
    min=Slider(-15, range=-15..30),
    max=Slider(25, range=0..100),
    num_decimals=Slider(0, range=0..100),
    larger_smaller=Toggle(True),
    vert_or_horiz=Toggle(False))  # -> leg_par; plug-in component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
monthlychart = LBMonthlyChart(data=timeop.daily)  # -> report, data_mesh, data_lines, col_lines, legend, borders, labels, y_title, title, vis_set; plug-in component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
hourlyplot = LBHourlyPlot(data=importepw.dry_bulb_temperature, z_dim=Slider(0, range=0..100), reverse_y=Toggle(True), legend_par=legendpar)  # -> report, mesh, legend, borders, labels, title, vis_set; plug-in component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

# ----
merge = Merge(
    Data1=windrose.mesh,
    Data2=windrose.compass,
    Data3=windrose.orient_line,
    Data4=windrose.freq_line,
    Data5=windrose.windrose_line,
    Data6=windrose.legend,
    Data7=windrose.title)

# ---- group: Direct sun hours
target_geometry_4 = Geometry(target_geometry_2)
context_geometry_2 = Geometry(target_geometry)
run_direct_sun_hours_study = Boolean(run_weather_visualisation_2)
directsunhours = LBDirectSunHours(
    vectors=flatten(sunpath.vectors),
    geometry=flatten(target_geometry_4),
    context=flatten(context_geometry_2),
    grid_size=Slider(1, range=0..10),
    offset_dist=Slider(0.1, range=0..1),
    run=run_direct_sun_hours_study)  # -> report, points, results, mesh, legend, title, int_mtx; plug-in component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

# ---- group: Sky mask
sky_mask_centre_point_2 = Point(sky_mask_centre_point)
symask = LBSkyMask(
    context=context_geometry_2,
    density=Slider(3, range=0..10),
    center=sky_mask_centre_point_2,
    scale=Slider(0.1, range=0..1))  # -> report, context_mask, orient_mask, strategy_mask, sky_mask, context_view, orient_view, strategy_view, sky_view; plug-in component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

# ----
hourlyplot_2 = LBHourlyPlot()  # -> report, mesh, legend, borders, labels, title, vis_set; plug-in component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
merge_2 = Merge(Data1=skydome.mesh, Data2=skydome.compass, Data3=skydome.legend, Data4=skydome.title)  # -> flatten(SkyDome)
merge_3 = Merge(
    Data1=monthlychart.data_mesh,
    Data2=monthlychart.legend,
    Data3=monthlychart.borders,
    Data4=monthlychart.labels,
    Data5=monthlychart.y_title,
    Data6=monthlychart.title)  # -> flatten(DryBulbTemperatureLineChart)
merge_4 = Merge(Data1=incidentradiation.mesh, Data2=incidentradiation.legend, Data3=incidentradiation.title)  # -> flatten(IncidentRadiation)
merge_5 = Merge(
    Data1=hourlyplot.mesh,
    Data2=hourlyplot.legend,
    Data3=hourlyplot.borders,
    Data4=hourlyplot.labels,
    Data5=hourlyplot.title)
sky_dome = ClusterOutput(merge_2)
wind_rose = ClusterOutput(merge)
dry_bulb_temperature_line_chart = ClusterOutput(merge_3)
dry_bulb_temperature_2d_chart = ClusterOutput(merge_5)
direct_sun_hours = Merge(Data1=directsunhours.mesh, Data2=directsunhours.legend, Data3=directsunhours.title)  # -> flatten(DirectSunHours)
direct_sun_hours_2 = ClusterOutput(direct_sun_hours)
incident_radiation = ClusterOutput(merge_4)
merge_6 = Merge(Data1=symask.context_mask, Data2=symask.sky_mask)
sky_mask = ClusterOutput(merge_6)

# ==== cluster Cluster_3
min = ClusterInput()
max = ClusterInput()
colors = ClusterInput()
legendpar = LBLegendParameters(min=min, max=max, colors=colors)  # -> leg_par; plug-in component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
leg_par = ClusterOutput(legendpar)

# ==== cluster Cluster_4
int = ClusterInput()
number_slider = Slider(2, range=0..10)
int_2 = Integer(int)
fragment = TextFragment(Text=int_2, Start="0", Count=number_slider)
fragment_2 = TextFragment(Text=int_2, Start=number_slider)
len = TextLength(Text=fragment_2)
addition = Addition(A=fragment, B="1")
equals = Equality(FirstNumber="0", SecondNumber=fragment)  # -> Equality, Inequality
filter = StreamFilter(Gate=equals.Equality, Stream0=addition, Stream1=fragment)
_10º = PowerOf10(Value=len)
multiplication = Multiplication(A=_10º, B=filter)
R = ClusterOutput(multiplication)

# ==== cluster Cluster_5
x = ClusterInput()
abs = Absolute(Value=x)
number_slider = Slider(2, range=0..10)
int = Integer(abs)
fragment = TextFragment(Text=int, Start="0", Count=number_slider)
fragment_2 = TextFragment(Text=int, Start=number_slider)
equals = Equality(FirstNumber="0", SecondNumber=fragment)  # -> Equality, Inequality
len = TextLength(Text=fragment_2)
addition = Addition(A=fragment, B="1")
filter = StreamFilter(Gate=equals.Equality, Stream0=addition, Stream1=fragment)
_10º = PowerOf10(Value=len)
multiplication = Multiplication(A=_10º, B=filter)
neg = Negative(Value=multiplication)
y = ClusterOutput(neg)

# ==== cluster Cluster_6
legendpar = LBLegendParameters(min=Slider(0, range=0..100), max=Slider(100, range=0..100), num_decimals=Slider(0, range=0..100))  # -> leg_par; plug-in component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
leg_par = ClusterOutput(legendpar)

# ==== cluster BakeGeometriesToLayers
geometry = ClusterInput()
geometry_2 = Data(geometry)
clean = CleanTree(RemoveNulls=True, RemoveInvalid=True, RemoveEmpty=False, Tree=geometry_2)
data = Data(clean)
py3 = Python3Script(x=data)  # -> out, a; inputs x: list
# ---------- py3: Python ----------
import rhinoscriptsyntax as rs
#import Rhino.Display.Text3d
import ladybug_rhino

a = []
for i in x:
    o_is_text = str(type(i)) == "<class 'IronPython.NewTypes.Grasshopper.Kernel.Types.GH_GeometricGoo`1#IGH_BakeAwareData#IGH_PreviewData_23$24'>"
    a.append(o_is_text)
    if o_is_text:
        print(dir(i))
# ---------- end py3 ----------
cull = CullPattern(List=data, CullPattern=invert(py3.a))
layers = ClusterInput()
bake = ClusterInput()
layers_2 = Data(layers)
bbox = BoundingBox(Content=<missing>, Plane=PlaneXY(0, 0, 0))  # -> Box, Box_2
txt = Text(<missing>)
bake_2 = Data(bake)
ef_layer = EleFrontLayer(Layer=layers_2, fullpath=True)
area = Area(Geometry=bbox.Box)  # -> Area, Centroid
bklay = BakeLayers(Layers=ef_layer, Bake=Toggle(True))
ef_att = EleFrontAttributes(Layer=ef_layer, maintainBakeName=False)
text_entity = TextEntity(Plane=area.Centroid, Text=txt)  # -> TextEntity, Plane, Text
weave = Weave(Pattern=[0, 1], Stream0=cull, Stream1=text_entity.TextEntity, NullGaps=False)
py3_2 = Python3Script(geo=weave, layers=ef_att)  # -> out, geo, layers; inputs geo: list, layers: list
# ---------- py3_2: Python ----------
if len(geo) == len(layers):
    pass
else:
    layers = [layers[0] for _ in range(len(geo))]
# ---------- end py3_2 ----------
bake_3 = BakeObjects(Geometry=py3_2.geo, Attributes=py3_2.layers, Bake=bake_2, createGroups=False)  # -> Message, Ghosts

# ==== cluster Cluster_7
id = ClusterInput()
id_2 = Guid(id)
filter_geometry_by_active_layer = Python3Script(geo=id_2)  # -> filtered_geo; inputs geo: list
# ---------- filter_geometry_by_active_layer: Python ----------
"""Filters geometry by active layer"""

import Rhino.Geometry as rg
import rhinoscriptsyntax as rs
import scriptcontext as sc
import Rhino

filtered_geo = []
sc.doc = Rhino.RhinoDoc.ActiveDoc
for g in geo:
    obj = sc.doc.Objects.Find(g)
    index = obj.Attributes.LayerIndex
    layer = sc.doc.Layers[index]
    if(layer.IsVisible):
        filtered_geo.append(g)
sc.doc = ghdoc
# ---------- end filter_geometry_by_active_layer ----------
rooms = Geometry(filter_geometry_by_active_layer)
rooms_2 = ClusterOutput(rooms)
