# Grasshopper definition heathUI_0.8.14-dev.gh (Grasshopper 1.0.8)
# plug-ins: Heteroptera, Human UI, Human, LadybugGrasshopper, MetaHopper, eleFront, Wombat, Telepathy, Cyclops

int = Integer("0")
bldgvintages = HBBuildingVintages({"ASHRAE 90.1 2019  |  IECC 2021": "2019", "ASHRAE 90.1 2016  |  IECC 2018": "2016", "ASHRAE 90.1 2013  |  IECC 2015": "2013", "ASHRAE 90.1 2010  |  IECC 2012": "2010", "ASHRAE 90.1 2007  |  IECC 2009": "2007", "ASHRAE 90.1 2004  |  IECC 2006": "2004", "1980-2004 (CBECS)": "1980_2004", "Pre-1980 (CBECS)": "pre_1980"}, selected="ASHRAE 90.1 2019  |  IECC 2021")

# ----
# Pop-up window dimensions
number_slider = Slider(525, range=0..1000)
number_slider_2 = Slider(1000, range=0..1200)
subtraction = Subtraction(A=number_slider_2, B=Slider(220, range=0..1000))
subtraction_2 = Subtraction(A=number_slider, B=Slider(100, range=0..100))
bar_chart_popup_win_width = RemoteSender(number_slider_2)
bar_chart_popup_win_height = RemoteSender(number_slider)
bar_chart_img_width = RemoteSender(subtraction)
bar_chart_img_height = RemoteSender(subtraction_2)

toggle = CreateToggle(Default=invert(False), OnLabel="Total GWP", OffLabel="GWP/m2")
values = ValueListener(Elements=toggle, SomeProperty=True)  # -> Values, Indices
bool = Boolean(invert(values.Values))

# ----
# Click here
# LICENSE/SUPPORT
# Copyright (c) 2024, Heath.
# 
# You should have received a copy of the GNU Affero General Public License along with Heath; If not, see <http://www.gnu.org/licenses/>.
# 
# @license AGPL-3.0-or-later <https://spdx.org/licenses/AGPL-3.0-or-later>
# Contact
# Github: github.com/sawenchalmers/heath
# 
# Author: Toivo Säwén, sawen@chalmers.se
# 
# Contributors: Isac Mjörnell, misac@chalmers.se, Jieming Yan, jieming@chalmers.se
button = Button()
restart_heath = RemoteSender(button)

# ----
# Sends signal when recompute
panel = Panel("recompute")
button_2 = CreateButton(ButtonName=panel, ButtonStyle=0)
values_2 = ValueListener(Elements=button_2, SomeProperty=True)  # -> Values, Indices
freeze_gate = StreamFreezeGate(Data=values_2.Values, PassingSwitch=invert(values_2.Values))
bool_2 = Boolean(invert(freeze_gate))
tap = TapBuffer(Reset=False, Incremental=True, Valve=bool_2, Hold=True)
dam = DataDam(DataA=tap, BufferDelay=2500000, BufferMode=2)
equals = Equality(FirstNumber=tap, SecondNumber=dam)  # -> Equality, Inequality
event = EventGate(Data=equals.Inequality)  # -> Data, IsNew
recompute = RemoteSender(event.Data)

bar_chart_popup_win_width_2 = RemoteReceiver(bar_chart_popup_win_width)
bar_chart_popup_win_height_2 = RemoteReceiver(bar_chart_popup_win_height)
bar_chart_img_height_2 = RemoteReceiver(bar_chart_img_height)
bar_chart_img_width_2 = RemoteReceiver(bar_chart_img_width)
bar_chart_popup_win_height_3 = RemoteReceiver(bar_chart_popup_win_height)
bar_chart_popup_win_width_3 = RemoteReceiver(bar_chart_popup_win_width)
bar_chart_img_height_3 = RemoteReceiver(bar_chart_img_height)
bar_chart_img_width_3 = RemoteReceiver(bar_chart_img_width)
bar_chart_popup_win_height_4 = RemoteReceiver(bar_chart_popup_win_height)
bar_chart_popup_win_width_4 = RemoteReceiver(bar_chart_popup_win_width)
bar_chart_img_height_4 = RemoteReceiver(bar_chart_img_height)
bar_chart_img_width_4 = RemoteReceiver(bar_chart_img_width)

# ----
# CLICK BUTTON
# TO RESTART
# HEATH
number_slider_3 = Slider(500, range=0..1000)
selobj = GetSelectedObjects()  # -> ComponentObjects, ParamObjects, OtherObjects
# Color codes
# UI module elements
# UI launch windows
# Front-end database
# Back-end database
setscribble = SetScribbleProperties(Scribble=selobj.OtherObjects, ScribbleSize=number_slider_3)

# ----
# SELECT LOCATION
panel_2 = Panel("https://energyplus-weather.s3.amazonaws.com/europe_wmo_region_6/SWE/SWE_Goteborg.Landvetter.025260_IWEC/SWE_Goteborg.Landvetter.025260_IWEC.zip")
label = CreateLabel(LabelText="Currently selected location: ", LabelSize=12, Justification=0)
label_2 = CreateLabel(LabelText="Location", LabelSize=18, Justification=0)
label_3 = CreateLabel(LabelText="Change location", LabelSize=18, Justification=0)
textbox = CreateTextBox(Label="Insert location", DefaultText=panel_2, UpdateButton=True, showLabel=True)
button_3 = CreateButton(ButtonName="Get climate data", ButtonStyle=0)
values_3 = ValueListener(Elements=button_3, SomeProperty=True)  # -> Values, Indices
panel_3 = Panel("https://energyplus-weather.s3.amazonaws.com/europe_wmo_region_6/SWE/SWE_Goteborg.Landvetter.025260_IWEC/SWE_Goteborg.Landvetter.025260_IWEC.zip")
values_4 = ValueListener(Elements=textbox, SomeProperty=True)  # -> Values, Indices
downloadepw = LBDownloadWeather(weather_URL=values_4.Values)  # -> epw_file, stat_file, ddy_file; plug-in component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
importloc = LBImportLocation(epw_file=downloadepw.epw_file)  # -> location; plug-in component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
decnstrloc = LBDeconstructLocation(location=importloc)  # -> name, latitude, longitude, time_zone, elevation; plug-in component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
getclimatedata = RemoteSender(values_3.Values)
null = NullItem(Item=decnstrloc.name)  # -> NullFlags, InvalidFlags, Description
filter = StreamFilter(Gate=null.NullFlags, Stream0=decnstrloc.name, Stream1="COULD NOT FIND LOCATION")
filter_2 = StreamFilter(Gate=null.NullFlags, Stream0=ColourSwatch(SwatchColor=RGB(0, 0, 0)), Stream1=ColourSwatch(SwatchColor=RGB(255, 0, 0)))
filter_3 = StreamFilter(Gate=null.NullFlags, Stream0=values_4.Values, Stream1=panel_3)
entwine = Entwine(Branch00=textbox, Branch01=button_3, FlattenInputs=True)  # -> flatten(Result)
location_weather_url = RemoteSender(filter_3)
format = Format(Format="Currently selected location: {0}", Culture=127, Data0=filter)
adjustpos = AdjustElementPositioning(
    ElementsToAdjust=textbox,
    Margin="0, 5, 0, 0",
    AbsolutePositioning=False,
    Width=Slider(325, range=0..1000),
    HorizontalAlignment=0)
adjustpos_2 = AdjustElementPositioning(
    ElementsToAdjust=button_3,
    Margin="0, 10, 0, 5",
    AbsolutePositioning=False,
    Width=Slider(200, range=0..1000),
    HorizontalAlignment=1)
stack = CreateStack(UIElements=entwine, Horizontal=invert(True))
adjustelem = AdjustElementAppearance(ElementsToAdjust=label, Foreground=filter_2)
setlabel = SetLabelContents(LabelToModify=label, NewLabelContents=format)
entwine_2 = Entwine(Branch00=label_2, Branch01=label, Branch02=label_3, Branch03=stack, FlattenInputs=True)  # -> flatten(Result)
adjustpos_3 = AdjustElementPositioning(ElementsToAdjust=label, Margin="0, 0, 0, 0", AbsolutePositioning=False, HorizontalAlignment=0)

label_4 = CreateLabel(LabelText="Currently selected location: ", LabelSize=12, Justification=0)
pulldown = CreatePulldownMenu(Label="Compare with", showLabel=True)
button_4 = CreateButton(ButtonName="Calculate LCA", ButtonStyle=0)
label_5 = CreateLabel(LabelText="Compare simulations", LabelSize=18, Justification=0)
true_button = CreateTrueOnlyButton(ButtonName="Compare simulations bar chart", ButtonStyle=0)
pulldown_2 = CreatePulldownMenu(Label="Select model", showLabel=True)
tb = CreateTextBlock(TextSize=16, Justification=0)
panel_4 = Panel("""Current simulation: 
{0}""")
relay = Relay()
tb_2 = CreateTextBlock(TextSize=16, Justification=0)
location_weather_url_2 = RemoteReceiver(location_weather_url)
button_5 = CreateButton(ButtonName="Bake", ButtonStyle=0)
panel_5 = Panel("""Current simulation: 
{0}""")
values_5 = ValueListener(Elements=pulldown, SomeProperty=True)  # -> Values, Indices
values_6 = ValueListener(Elements=button_4, SomeProperty=True)  # -> Values, Indices
values_7 = ValueListener(Elements=true_button, SomeProperty=True)  # -> Values, Indices
values_8 = ValueListener(Elements=pulldown_2, SomeProperty=True)  # -> Values, Indices
values_9 = ValueListener(Elements=button_5, SomeProperty=True)  # -> Values, Indices
tb_3 = CreateTextBlock(TextSize=16, Justification=0)
panel_6 = Panel("""Selected model: 
{0}""")
button_6 = CreateButton(ButtonName="?", ButtonStyle=2)
true_button_2 = CreateTrueOnlyButton(ButtonName="?", ButtonStyle=2)
simple_energy_simulation_compare_pop_up = RemoteSender(values_7.Values)
pre_calculate_lca = RemoteSender(values_6.Values)
event_2 = EventGate(Data=values_8.Indices)  # -> Data, IsNew
current_selected_model_analysis_module_n = RemoteSender(values_8.Values)  # "current_selected_model_analysis_module_name"
current_selected_model_analysis_module_n_2 = RemoteReceiver(current_selected_model_analysis_module_n)  # "current_selected_model_analysis_module_name"
current_selected_model_analysis_module_n_3 = RemoteReceiver(current_selected_model_analysis_module_n)  # "current_selected_model_analysis_module_name"
current_selected_model_analysis_module_n_4 = RemoteReceiver(current_selected_model_analysis_module_n)  # "current_selected_model_analysis_module_name"
subtraction_3 = Subtraction(A=values_5.Indices, B="1")
format_2 = Format(Format=panel_4, Culture=127, Data0=current_selected_model_analysis_module_n_2)
format_3 = Format(Format=panel_5, Culture=127, Data0=current_selected_model_analysis_module_n_3)
bake_daylight_simulation = RemoteSender(values_9.Values)
downloadepw_2 = LBDownloadWeather(weather_URL=location_weather_url_2)  # -> epw_file, stat_file, ddy_file; plug-in component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
current_selected_model_analysis_module = RemoteSender(event_2.Data)
current_selected_simulation_simple_energ = RemoteSender(subtraction_3)  # "current_selected_simulation_simple_energy_compare"
values_10 = ValueListener(Elements=button_6, SomeProperty=True)  # -> Values, Indices
settextblock = SetTextBlockContents(TextBlockToModify=tb, NewTextBlockContents=format_2)
format_4 = Format(Format=panel_6, Culture=127, Data0=current_selected_model_analysis_module_n_4)
settextblock_2 = SetTextBlockContents(TextBlockToModify=tb_2, NewTextBlockContents=format_3)
freeze_gate_2 = StreamFreezeGate(Data=values_10.Values, PassingSwitch=invert(values_10.Values))
importloc_2 = LBImportLocation(epw_file=downloadepw_2.epw_file)  # -> location; plug-in component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
settextblock_3 = SetTextBlockContents(TextBlockToModify=tb_3, NewTextBlockContents=format_4)
bool_3 = Boolean(invert(freeze_gate_2))
decnstrloc_2 = LBDeconstructLocation(location=importloc_2)  # -> name, latitude, longitude, time_zone, elevation; plug-in component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
rec = DataRecorder(bool_3, DataLimit=-10, RecordData=True)
current_selected_model_analysis_module_n_5 = RemoteReceiver(current_selected_model_analysis_module_n)  # "current_selected_model_analysis_module_name"
format_5 = Format(Format="{0}, {1}, 0, 0", Culture=127, Data0=Slider(5, range=-25..25), Data1=Slider(8, range=0..100))
int_2 = Integer(rec)
number_slider_4 = Slider(29, range=0..300)
adjustpos_4 = AdjustElementPositioning(
    ElementsToAdjust=pulldown_2,
    Margin=format_5,
    AbsolutePositioning=False,
    Width=Slider(300, range=0..400),
    HorizontalAlignment=0,
    VerticalAlignment=2)
null_2 = NullItem(Item=decnstrloc_2.name)  # -> NullFlags, InvalidFlags, Description
format_6 = Format(
    Format="{0}, {1}, 0, {2}",
    Culture=127,
    Data0=Slider(5, range=-25..25),
    Data1=Slider(10, range=0..100),
    Data2=Slider(5, range=0..100))
ma = MassAddition(Input=int_2)  # -> Result, PartialResults
format_7 = Format(
    Format="{0}, {1}, 0, {2}",
    Culture=127,
    Data0=Slider(5, range=-25..25),
    Data1=Slider(10, range=0..100),
    Data2=Slider(5, range=0..100))
format_8 = Format(
    Format="{0}, {1}, 0, {2}",
    Culture=127,
    Data0=Slider(5, range=-25..25),
    Data1=Slider(5, range=-15..15),
    Data2=Slider(5, range=0..100))
format_9 = Format(
    Format="{0}, {1}, 0, {2}",
    Culture=127,
    Data0=Slider(10, range=-25..25),
    Data1=Slider(5, range=-15..15),
    Data2=Slider(5, range=0..100))
adjustelem_2 = AdjustElementAppearance(
    ElementsToAdjust=button_6,
    Foreground=ColourSwatch(SwatchColor=RGB(0, 0, 0)),
    Background=ColourSwatch(SwatchColor=RGB(230, 230, 230)),
    FontSize=Slider(12, range=0..300))
event_3 = EventGate(Data=ma.Result)  # -> Data, IsNew
adjustpos_5 = AdjustElementPositioning(
    ElementsToAdjust=tb_2,
    Margin=format_6,
    AbsolutePositioning=False,
    Width=Slider(245, range=0..300),
    HorizontalAlignment=0,
    VerticalAlignment=2)
format_10 = Format(
    Format="{0}, {1}, {2}, {3}",
    Culture=127,
    Data0=Slider(0, range=-10..10),
    Data1=Slider(0, range=-10..10),
    Data2=Slider(0, range=-10..10),
    Data3=Slider(4.5, range=-10..10))
filter_4 = StreamFilter(Gate=null_2.NullFlags, Stream0=decnstrloc_2.name, Stream1="COULD NOT FIND LOCATION")
filter_5 = StreamFilter(Gate=null_2.NullFlags, Stream0=ColourSwatch(SwatchColor=RGB(0, 0, 0)), Stream1=ColourSwatch(SwatchColor=RGB(255, 0, 0)))
format_11 = Format(
    Format="{0}, {1}, {2}, {3}",
    Culture=127,
    Data0=Slider(0, range=-10..10),
    Data1=Slider(0, range=-10..10),
    Data2=Slider(4.5, range=-10..10),
    Data3=Slider(0, range=-10..10))
adjustpos_6 = AdjustElementPositioning(
    ElementsToAdjust=tb,
    Margin=format_7,
    AbsolutePositioning=False,
    Width=Slider(245, range=0..300),
    HorizontalAlignment=0,
    VerticalAlignment=2)
hasdata = DataExists(Data=current_selected_model_analysis_module_n_5)
dam_2 = DataDam(DataA=event_3.Data, BufferDelay=2500000, BufferMode=2)
adjustpos_7 = AdjustElementPositioning(ElementsToAdjust=button_6, AbsolutePositioning=False, Width=number_slider_4, Height=number_slider_4)
entwine_3 = Entwine(Branch00=label_5, Branch01=true_button, Branch02=pulldown, FlattenInputs=True)  # -> flatten(Result)
adjustpos_8 = AdjustElementPositioning(
    ElementsToAdjust=pulldown,
    Margin=format_8,
    AbsolutePositioning=False,
    Width=Slider(245, range=0..300),
    HorizontalAlignment=0,
    VerticalAlignment=2)
adjustpos_9 = AdjustElementPositioning(ElementsToAdjust=true_button, Margin=format_9, AbsolutePositioning=False, HorizontalAlignment=0, VerticalAlignment=2)
adjustpos_10 = AdjustElementPositioning(ElementsToAdjust=button_4, AbsolutePositioning=False, HorizontalAlignment=0)
format_12 = Format(Format="Currently selected location: {0}", Culture=127, Data0=filter_4)
hideshow = HideShowElement(ElementToHideShow=tb_3, Show=hasdata, Collapse=True, Disable=False)
equals_2 = Equality(FirstNumber=event_3.Data, SecondNumber=dam_2)  # -> Equality, Inequality

# ----
# Location
location = Data(entwine_2)

adjustelem_3 = AdjustElementAppearance(ElementsToAdjust=label_4, Foreground=filter_5)
stack_2 = CreateStack(UIElements=entwine_3, Horizontal=invert(True))
adjustpos_11 = AdjustElementPositioning(ElementsToAdjust=label_4, Margin="0, 0, 0, 0", AbsolutePositioning=False, HorizontalAlignment=0)
setlabel_2 = SetLabelContents(LabelToModify=label_4, NewLabelContents=format_12)

# ----
# Select model
select_model = Data(pulldown_2)

# ----
# LCA info
panel_7 = Panel("?")
true_button_3 = CreateTrueOnlyButton(ButtonName=panel_7, ButtonStyle=2)
values_11 = ValueListener(Elements=true_button_3, SomeProperty=True)  # -> Values, Indices
lca_info = RemoteSender(values_11.Values)
number_slider_5 = Slider(29, range=0..300)
adjustpos_12 = AdjustElementPositioning(
    ElementsToAdjust=true_button_3,
    Margin="5, 0, 0, 0",
    AbsolutePositioning=False,
    Width=number_slider_5,
    Height=number_slider_5)
adjustelem_4 = AdjustElementAppearance(
    ElementsToAdjust=true_button_3,
    Foreground=ColourSwatch(SwatchColor=RGB(0, 0, 0)),
    Background=ColourSwatch(SwatchColor=RGB(230, 230, 230)),
    FontSize=Slider(12, range=0..300))

# ----
# Daylight simulations info
panel_8 = Panel("?")
true_button_4 = CreateTrueOnlyButton(ButtonName=panel_8, ButtonStyle=2)
values_12 = ValueListener(Elements=true_button_4, SomeProperty=True)  # -> Values, Indices
daylight_info = RemoteSender(values_12.Values)
number_slider_6 = Slider(29, range=0..300)
adjustpos_13 = AdjustElementPositioning(
    ElementsToAdjust=true_button_4,
    Margin="5, 0, 0, 0",
    AbsolutePositioning=False,
    Width=number_slider_6,
    Height=number_slider_6)
adjustelem_5 = AdjustElementAppearance(
    ElementsToAdjust=true_button_4,
    Foreground=ColourSwatch(SwatchColor=RGB(0, 0, 0)),
    Background=ColourSwatch(SwatchColor=RGB(230, 230, 230)),
    FontSize=Slider(12, range=0..300))

# ----
# Energy simulations info
panel_9 = Panel("?")
true_button_5 = CreateTrueOnlyButton(ButtonName=panel_9, ButtonStyle=2)
values_13 = ValueListener(Elements=true_button_5, SomeProperty=True)  # -> Values, Indices
simple_energy_info = RemoteSender(values_13.Values)
number_slider_7 = Slider(29, range=0..300)
adjustpos_14 = AdjustElementPositioning(
    ElementsToAdjust=true_button_5,
    Margin="5, 0, 0, 0",
    AbsolutePositioning=False,
    Width=number_slider_7,
    Height=number_slider_7)
adjustelem_6 = AdjustElementAppearance(
    ElementsToAdjust=true_button_5,
    Foreground=ColourSwatch(SwatchColor=RGB(0, 0, 0)),
    Background=ColourSwatch(SwatchColor=RGB(230, 230, 230)),
    FontSize=Slider(12, range=0..300))

# ----
# Launch  LCA info
panel_10 = Panel("https://en.wikipedia.org/wiki/Life-cycle_assessment")
lca_info_2 = RemoteReceiver(lca_info)
py3 = Python3Script(url=panel_10, launch=lca_info_2)
# ---------- py3: Python ----------
"""Grasshopper Script"""
import webbrowser as wb
if launch == True:
    wb.open(url, 2, True)
# ---------- end py3 ----------

# ----
# Launch  daylight simulations info
panel_11 = Panel("https://www.ladybug.tools/honeybee.html#illuminance")
daylight_info_2 = RemoteReceiver(daylight_info)
py3_2 = Python3Script(url=panel_11, launch=daylight_info_2)  # same code as py3

# ----
# Launch energy simulations info
panel_12 = Panel("https://www.ladybug.tools/honeybee.html#energyBal")
simple_energy_info_2 = RemoteReceiver(simple_energy_info)
py3_3 = Python3Script(url=panel_12, launch=simple_energy_info_2)  # same code as py3

# ----
# Get climate data
# https://energyplus-weather.s3.amazonaws.com/europe_wmo_region_6/SWE/SWE_Goteborg.Landvetter.025260_IWEC/SWE_Goteborg.Landvetter.025260_IWEC.zip
getclimatedata_2 = RemoteReceiver(getclimatedata)
panel_13 = Panel(getclimatedata_2)
epwmap = LBEPWmap(epw_map=getclimatedata_2)  # -> report; plug-in component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

path = DataPath("0;0;0")

# ----
# Heath UI global settings
accent_colors = ValueList({"Amber", "Blue", "Brown", "Cobalt", "Crimson", "Cyan", "Emerald", "Green", "Indigo", "Lime", "Magenta", "Mauve", "Olive", "Orange", "Pink", "Purple", "Red", "Sienna", "Steel", "Taupe", "Teal", "Violet", "Yellow"}, selected="Brown")
heath_accent_color = RemoteSender(accent_colors)

panel_14 = Panel("Materials with an invalid category exists in the Rhino file")
select_model_2 = Data(select_model)
button_7 = CreateButton(ButtonName="Sync database", ButtonStyle=0)
label_6 = CreateLabel(LabelText=panel_14, LabelSize=12, Justification=0)
expander = CreateExpander(UIElements=location, Header="Set location", Open=invert(True))
values_14 = ValueListener(Elements=button_7, SomeProperty=True)  # -> Values, Indices
sync_window_database = RemoteSender(values_14.Values)
adjustelem_7 = AdjustElementAppearance(ElementsToAdjust=label_6, Foreground=ColourSwatch(SwatchColor=RGB(255, 0, 0)))
panel_15 = Panel("""Create model
Load/Inspect model
Simulate!""")

# ----
# Heath window
panel_16 = Panel("Create model")
tab_create_model = RemoteSender(panel_16)
tab_simulate = RemoteSender("Simulate!")
tab_load_inspect_model = RemoteSender("Load/Inspect model")

tab_create_model_2 = RemoteReceiver(tab_create_model)
tab_load_inspect_model_2 = RemoteReceiver(tab_load_inspect_model)
tab_load_inspect_model_3 = RemoteReceiver(tab_load_inspect_model)
tab_load_inspect_model_4 = RemoteReceiver(tab_load_inspect_model)
tab_simulate_2 = RemoteReceiver(tab_simulate)
tab_create_model_3 = RemoteReceiver(tab_create_model)
tab_simulate_3 = RemoteReceiver(tab_simulate)
tab_load_inspect_model_5 = RemoteReceiver(tab_load_inspect_model)
tab_load_inspect_model_6 = RemoteReceiver(tab_load_inspect_model)
tab_simulate_4 = RemoteReceiver(tab_simulate)
tab_simulate_5 = RemoteReceiver(tab_simulate)
tab_simulate_6 = RemoteReceiver(tab_simulate)
heath_accent_color_2 = RemoteReceiver(heath_accent_color)
heath_accent_color_3 = RemoteReceiver(heath_accent_color)
heath_accent_color_4 = RemoteReceiver(heath_accent_color)
heath_accent_color_5 = RemoteReceiver(heath_accent_color)
true_button_6 = CreateTrueOnlyButton(ButtonName="?", ButtonStyle=2)
values_15 = ValueListener(Elements=true_button_6, SomeProperty=True)  # -> Values, Indices
info_save_geometry = RemoteSender(values_15.Values)
number_slider_8 = Slider(29, range=0..300)
format_13 = Format(Format="{0}, {1}, {2}, {3}", Culture=127, Data0=Slider(225, range=100..300))
adjustelem_8 = AdjustElementAppearance(
    ElementsToAdjust=true_button_6,
    Foreground=ColourSwatch(SwatchColor=RGB(0, 0, 0)),
    Background=ColourSwatch(SwatchColor=RGB(230, 230, 230)),
    FontSize=Slider(12, range=0..300))
adjustpos_15 = AdjustElementPositioning(
    ElementsToAdjust=true_button_6,
    Margin=format_13,
    AbsolutePositioning=invert(False),
    HorizontalAlignment=2,
    VerticalAlignment=2)
adjustpos_16 = AdjustElementPositioning(ElementsToAdjust=true_button_6, AbsolutePositioning=False, Width=number_slider_8, Height=number_slider_8)

# ----
# Do we want to validate
#  the model before creating it?
#  It would validate the model
# every time the user changes something...
toggle_2 = BooleanToggle(True)
validatemodel = HBValidateModel(validate=toggle_2)  # -> report; plug-in component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

# ----
# Modal UI locations
number_slider_9 = Slider(180, range=0..1000)
pt = ConstructPoint(XCoordinate=Slider(460, range=0..1000), YCoordinate=number_slider_9, ZCoordinate=0)
pt_2 = ConstructPoint(XCoordinate=Slider(65, range=0..1000), YCoordinate=number_slider_9, ZCoordinate=0)
pt_3 = ConstructPoint(XCoordinate=Slider(845, range=0..1000), YCoordinate=number_slider_9, ZCoordinate=0)
heath_window_location = RemoteSender(pt_2)
database_modal_location = RemoteSender(pt)
create_modal_location = RemoteSender(pt_3)

textbox_2 = CreateTextBox(DefaultText=Slider(0.05, range=0..10), UpdateButton=invert(True), showLabel=False)
textbox_3 = CreateTextBox(DefaultText=Slider(0.02, range=0..10), UpdateButton=invert(True), showLabel=False)
textbox_4 = CreateTextBox(DefaultText=Slider(0.35, range=0..10), UpdateButton=invert(True), showLabel=False)
true_button_7 = CreateTrueOnlyButton(ButtonName="?", ButtonStyle=2)
label_7 = CreateLabel(LabelText="A4 [kg CO2eq/kg]", LabelSize=12, Justification=0)
label_8 = CreateLabel(LabelText="A5.1 [kg CO2eq/kg]", LabelSize=12, Justification=0)
textbox_5 = CreateTextBox(DefaultText=Slider(0.05, range=0..10), UpdateButton=invert(True), showLabel=False)
textbox_6 = CreateTextBox(DefaultText=Slider(0.35, range=0..10), UpdateButton=invert(True), showLabel=False)
textbox_7 = CreateTextBox(DefaultText=Slider(28, range=0..100), UpdateButton=invert(True), showLabel=False)
label_9 = CreateLabel(LabelText="A4 [kg CO2eq/kg]", LabelSize=12, Justification=0)
label_10 = CreateLabel(LabelText="Conversion value [kg/m2]", LabelSize=12, Justification=0)
label_11 = CreateLabel(LabelText="A1-A3 [kg CO2eq/kg]", LabelSize=12, Justification=0)
objbynn = GetObjectByNickname(NickName="Load models ping")
values_16 = ValueListener(Elements=true_button_7, SomeProperty=True)  # -> Values, Indices
values_17 = ValueListener(Elements=textbox_7, SomeProperty=True)  # -> Values, Indices
values_18 = ValueListener(Elements=textbox_4, SomeProperty=True)  # -> Values, Indices
values_19 = ValueListener(Elements=textbox_3, SomeProperty=True)  # -> Values, Indices
values_20 = ValueListener(Elements=textbox_2, SomeProperty=True)  # -> Values, Indices
values_21 = ValueListener(Elements=textbox_6, SomeProperty=True)  # -> Values, Indices
values_22 = ValueListener(Elements=textbox_5, SomeProperty=True)  # -> Values, Indices

# ----
# No link at the moment
info_create_window = RemoteSender(values_16.Values)

num = Number(values_18.Values)
num_2 = Number(values_19.Values)
num_3 = Number(values_20.Values)
num_4 = Number(values_17.Values)
num_5 = Number(values_21.Values)
num_6 = Number(values_22.Values)
recompute_2 = RemoteReceiver(recompute)
panel_17 = Panel("""False
True""")
entwine_4 = Entwine(Branch00=label_10, Branch01=textbox_7, FlattenInputs=True)  # -> flatten(Result)
null_3 = NullItem(Item=num)  # -> NullFlags, InvalidFlags, Description
null_4 = NullItem(Item=num_2)  # -> NullFlags, InvalidFlags, Description
null_5 = NullItem(Item=num_3)  # -> NullFlags, InvalidFlags, Description
null_6 = NullItem(Item=num_4)  # -> NullFlags, InvalidFlags, Description
null_7 = NullItem(Item=num_5)  # -> NullFlags, InvalidFlags, Description
null_8 = NullItem(Item=num_6)  # -> NullFlags, InvalidFlags, Description
entwine_5 = Entwine(Branch00=label_7, Branch01=textbox_2, FlattenInputs=True)  # -> flatten(Result)
entwine_6 = Entwine(Branch00=label_8, Branch01=textbox_3, FlattenInputs=True)  # -> flatten(Result)
entwine_7 = Entwine(Branch00=label_11, Branch01=textbox_6, FlattenInputs=True)  # -> flatten(Result)
entwine_8 = Entwine(Branch00=label_9, Branch01=textbox_5, FlattenInputs=True)  # -> flatten(Result)
filter_6 = StreamFilter(Gate=null_4.NullFlags, Stream0=num_2, Stream1="0")
filter_7 = StreamFilter(Gate=null_5.NullFlags, Stream0=num_3, Stream1="0")
filter_8 = StreamFilter(Gate=null_3.NullFlags, Stream0=num, Stream1="0")
filter_9 = StreamFilter(Gate=null_6.NullFlags, Stream0=num_4, Stream1="0")
filter_10 = StreamFilter(Gate=null_8.NullFlags, Stream0=num_6, Stream1="0")
filter_11 = StreamFilter(Gate=null_7.NullFlags, Stream0=num_5, Stream1="0")
stack_3 = CreateStack(UIElements=entwine_4, Horizontal=True)
create_material_a4_kg = RemoteSender(filter_7)
create_material_a5_1_kg = RemoteSender(filter_6)
create_window_conversion_value = RemoteSender(filter_9)
create_material_a1_a3_kg = RemoteSender(filter_8)
create_window_a4_kg = RemoteSender(filter_10)
create_window_a1_a3_kg = RemoteSender(filter_11)
adjustelem_9 = AdjustElementAppearance(
    ElementsToAdjust=true_button_7,
    Foreground=ColourSwatch(SwatchColor=RGB(0, 0, 0)),
    Background=ColourSwatch(SwatchColor=RGB(230, 230, 230)),
    FontSize=Slider(12, range=0..300))
number_slider_10 = Slider(29, range=0..300)

# ----
# A4
stack_4 = CreateStack(UIElements=entwine_8, Horizontal=True)
a4 = Data(stack_4)

number_slider_11 = Slider(35, range=25..50)

# ----
# A1-A3
stack_5 = CreateStack(UIElements=entwine_7, Horizontal=True)
data = Data(stack_5)  # "A1-A3"

# ----
# A4
stack_6 = CreateStack(UIElements=entwine_5, Horizontal=True)
a4_2 = Data(stack_6)

# ----
# A5.1
stack_7 = CreateStack(UIElements=entwine_6, Horizontal=True)
data_2 = Data(stack_7)

adjustpos_17 = AdjustElementPositioning(
    ElementsToAdjust=true_button_7,
    Margin="5, -5, 0, 0",
    AbsolutePositioning=False,
    Width=number_slider_10,
    Height=number_slider_10)
heath_accent_color_6 = RemoteReceiver(heath_accent_color)
heath_accent_color_7 = RemoteReceiver(heath_accent_color)
heath_accent_color_8 = RemoteReceiver(heath_accent_color)
do = DirectOnly(Samples=Slider(100, range=0..10000), version="1.2.0.60000")

roomenergyattr = HBRoomEnergyAttributes({"Program": "properties.energy.program_type.display_name", "Construction Set": "properties.energy.construction_set.display_name", "Is Conditioned": "properties.energy.is_conditioned", "People per Area [ppl/m2]": "properties.energy.people.people_per_area", "Area per Person [m2/ppl]": "properties.energy.people.area_per_person", "Lighting per Area [W/m2]": "properties.energy.lighting.watts_per_area"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}, selected="Program")
roomattr = HBRoomAttributes({"Display Name": "display_name", "Simulation Name (Identifier)": "identifier", "Multiplier": "multiplier", "Floor Area Excluded": "exclude_floor_area", "Story": "story", "Volume": "volume", "Gross Floor Area": "floor_area", "Exposed Area": "exposed_area", "Exterior Wall Area": "exterior_wall_area", "Exterior Aperture Area": "exterior_aperture_area", "Average Floor Elevation": "average_floor_height"}, selected="Exterior Aperture Area")

faceenergyattr = HBFaceEnergyAttributes({"Construction": "properties.energy.construction.display_name", "Materials": "properties.energy.construction.layers", "Thickness [m]": "properties.energy.construction.thickness", "Density [kg/m2]": "properties.energy.construction.mass_area_density", "Heat Capacity [J/K-m2]": "properties.energy.construction.area_heat_capacity", "Construction R-Value [m2-K/W]": "properties.energy.construction.r_value", "Construction U-Value [W/m2-K]": "properties.energy.construction.u_value", "Construction U-Factor [W/m2-K]": "properties.energy.construction.u_factor", "Construction SHGC [Unshaded]": "properties.energy.construction.shgc", "R-Factor [m2-K/W]": "properties.energy.r_factor", "U-Factor [W/m2-K]": "properties.energy.u_factor", "SHGC [Unshaded]": "properties.energy.shgc", "Solar Transmitance [Unshaded]": "properties.energy.construction.solar_transmittance", "Visible Transmitance [Unshaded]": "properties.energy.construction.visible_transmittance", "Solar Reflectance [Outside]": "properties.energy.construction.outside_solar_reflectance", "Solar Reflectance [Inside]": "properties.energy.construction.inside_solar_reflectance", "Fraction Area Operable": "properties.energy.vent_opening.fraction_area_operable", "Fraction Height Operable": "properties.energy.vent_opening.fraction_height_operable", "Discharge Coefficient": "properties.energy.vent_opening.discharge_coefficient"}, selected="Construction SHGC [Unshaded]")
faceattr = HBFaceAttributes({"Display Name": "display_name", "Simulation Name (Identifier)": "identifier", "Boundary Condition": "boundary_condition", "Has Parent": "has_parent", "Parent": "parent", "Azimuth": "azimuth", "Altitude": "altitude", "Area": "area", "Perimeter": "perimeter", "Face Type": "type", "Aperture Is Operable": "is_operable", "Door Is Glass": "is_glass"}, selected="Face Type")

number_slider_12 = Slider(0.6, range=0..10)
location_weather_url_3 = RemoteReceiver(location_weather_url)

# ----
# Get Klimatdatabas data
list = ValueList({"Swedish": "sv", "English": "en"}, selected="English")
list_2 = ValueList({"File": "file", "API": "api"}, selected="API")
get_categories = BrimstoneGetCategories(mode=list_2, language=list)  # -> out, json_data, categories, klimatdatabas_version
# ---------- get_categories: Python ----------
"""Gets Klimatdatabas from the Boverket API or a file, extracts json data, and resource category names
    Inputs:
        mode: api or file mode
        language: language of database to retrieve
        json_path: path to json file if file mode
    Output:
        json_data: json file as dictionary
        categories: Categories present in the database
        klimatdatabas_version: String representing the version of Klimatdatabas used"""

import scriptcontext
import brimstone
import Grasshopper
import os, io

ghenv.Component.Name = 'Brimstone - Get Categories'
ghenv.Component.NickName = 'Get Categories'
ver = brimstone.globals.version
ghenv.Component.Message = ver

import json

from System.Net import WebRequest
from System.IO import StreamReader
from System.Text import Encoding

def main(mode):    
    if mode == "file":
        json_file = brimstone.globals.kdb_json_path
        json_path = os.path.join(Grasshopper.Folders.UserObjectFolders[0], json_file)
        if not os.path.exists(json_path):
            raise Exception("Failed to open json file, it should reside in [UserComponents folder]/brimstone_data/")
        json_data = get_json_data_from_file(json_path)
    elif mode == "api":
        json_data = get_json_data_from_api()
    else:
        raise Exception("Mode {mode} not supported".format(mode = mode))
    
    categories = get_categories(json_data)
    version = json_data.get("Version") 
    
    return categories, json_data, version

def get_json_data_from_file(json_path):
    f = io.open(json_path, encoding='utf-8')
    json_data = json.load(f)
    return json_data
    
def get_json_data_from_api():
    version = "02.04.000"
    lng = language if language else "en"
    format = "json"

    url = "https://api.boverket.se/klimatdatabas/v2/get-all-resources/{version}/{language}/{format}".format(
        version=version, language=lng, format=format)
    
    request = WebRequest.Create(url)
    
    request.Method = "GET"
    request.Timeout = 5000
    #request.ContentType = "application/json"
    response = request.GetResponse()
    
    stream_reader = StreamReader(response.GetResponseStream())
    json_data = json.loads(stream_reader.ReadToEnd())
    return json_data
    
def get_categories(json_data):
    categories = []
    try:
        for metaCategory in json_data['Categories']:
            for cat in metaCategory["Children"]:
                categories.append(cat["Title"])
    except KeyError:
        raise Exception("Format of JSON data is not supported.")
    return categories

if __name__ == "__main__":
    if not scriptcontext.sticky["brimstone_flying"]:
        raise Exception("The 'Brimstone - Fly' component needs to exist on the canvas")
    categories, json_data, klimatdatabas_version = main(mode)
    json_data = [json_data] # need to put it in an array so GH understands it as a dictionary
# ---------- end get_categories ----------
list_3 = ItemSelector(get_categories.categories)
panel_18 = Panel(get_categories.klimatdatabas_version)

current_selected_model_analysis_module_n_6 = RemoteReceiver(current_selected_model_analysis_module_n)  # "current_selected_model_analysis_module_name"
objbynn_2 = GetObjectByNickname(NickName="AnnualDaylight")

# ---- group: Analyse performance
pt_4 = ConstructPoint(XCoordinate=Slider(80, range=0..100), YCoordinate=Slider(10, range=0..100), ZCoordinate=0)
simple_energy_simulation_base_point = RemoteSender(pt_4)

# ----
tab_simulate_7 = RemoteReceiver(tab_simulate)
toggle_3 = BooleanToggle(True)
button_8 = Button()
tab_simulate_8 = RemoteReceiver(tab_simulate)
tab_simulate_9 = RemoteReceiver(tab_simulate)

current_selected_model_analysis_module_n_7 = RemoteReceiver(current_selected_model_analysis_module_n)  # "current_selected_model_analysis_module_name"
pre_calculate_lca_2 = RemoteReceiver(pre_calculate_lca)

# ----
# EUI pop-up window
panel_19 = Panel("Update")
button_9 = CreateButton(ButtonName=panel_19, ButtonStyle=0)
adjustpos_18 = AdjustElementPositioning(ElementsToAdjust=button_9, AbsolutePositioning=False, Height=Slider(30, range=0..100), HorizontalAlignment=1)
categories = Panel("""Cooling
Heating
Lightning
Electrical equipment
Other""")
checklist = CreateChecklist(Selected=invert(False))
values_23 = ValueListener(Elements=button_9, SomeProperty=True)  # -> Values, Indices
simple_energy_simulation_compare_pop_up_2 = RemoteReceiver(simple_energy_simulation_compare_pop_up)
event_4 = EventGate(Data=values_23.Values)  # -> Data, IsNew
rev = ReverseList(List=categories)
simple_energy_simulation_compare_pop_up_3 = RemoteReceiver(simple_energy_simulation_compare_pop_up)
adjustpos_19 = AdjustElementPositioning(ElementsToAdjust=checklist, Margin="0, 40, -5, 0", AbsolutePositioning=False, Width=Slider(215, range=0..1000))
panel_20 = Panel("""80, 140, 220
245, 75, 65
254, 244, 1
255, 121, 0
166, 249, 86""")
rec_2 = DataRecorder(simple_energy_simulation_compare_pop_up_2, DataLimit=-2, RecordData=True)
txt = Text(panel_20)
values_24 = ValueListener(Elements=checklist, SomeProperty=True)  # -> Values, Indices
ma_2 = MassAddition(Input=rec_2)  # -> Result, PartialResults
pt_5 = Point(txt)
and = GateAnd(A=simple_energy_simulation_compare_pop_up_3, B=event_4.Data)
division = Division(A=pt_5, B="255")
py3_4 = Python3Script(get=and)  # -> mpl_folder
# ---------- py3_4: Python ----------
"""Grasshopper Script"""
import heath

if __name__ == "__main__":
    if get:
        print(ghdoc)
        mpl_folder = heath.get_results_folder(ghdoc)
# ---------- end py3_4 ----------
len = TextLength(Text=division)
subtraction_4 = Subtraction(A=len, B="2")
nextfile = NextAvailableFilename(Format="EUI{000}.png", FolderPath=py3_4, Trigger=and)
fragment = TextFragment(Text=division, Start="1", Count=subtraction_4)
database_modal_location_2 = RemoteReceiver(database_modal_location)
pdecon = Deconstruct(Point=database_modal_location_2)  # -> XComponent, YComponent, ZComponent
subtraction_5 = Subtraction(A=pdecon.XComponent, B=Slider(0, range=0..100))
heath_accent_color_9 = RemoteReceiver(heath_accent_color)
simple_energy_simulation_compare_pop_up_4 = RemoteReceiver(simple_energy_simulation_compare_pop_up)
pt_6 = ConstructPoint(XCoordinate=subtraction_5, YCoordinate=pdecon.YComponent, ZCoordinate=0)

# ----
# LCA pop-up window
panel_21 = Panel("Update")
button_10 = CreateButton(ButtonName=panel_21, ButtonStyle=0)
values_25 = ValueListener(Elements=button_10, SomeProperty=True)  # -> Values, Indices
adjustpos_20 = AdjustElementPositioning(ElementsToAdjust=button_10, AbsolutePositioning=False, Height=Slider(30, range=0..100), HorizontalAlignment=1)
event_5 = EventGate(Data=values_25.Values)  # -> Data, IsNew
checklist_2 = CreateChecklist(Selected=invert(False))
panel_22 = Panel("""166, 249, 86
255, 121, 0
254, 244, 1
80, 140, 220
97, 209, 246
255, 58, 49""")
values_26 = ValueListener(Elements=checklist_2, SomeProperty=True)  # -> Values, Indices
txt_2 = Text(panel_22)
pt_7 = Point(txt_2)
division_2 = Division(A=pt_7, B="255")
len_2 = TextLength(Text=division_2)
subtraction_6 = Subtraction(A=len_2, B="2")
format_14 = Format(Format="{0}, {1}, {2}, {3}", Culture=127, Data1=Slider(20, range=0..100), Data2=Slider(-5, range=-10..10))
fragment_2 = TextFragment(Text=division_2, Start="1", Count=subtraction_6)
adjustpos_21 = AdjustElementPositioning(ElementsToAdjust=checklist_2, Margin=format_14, AbsolutePositioning=False, Width=Slider(215, range=0..1000))
database_modal_location_3 = RemoteReceiver(database_modal_location)
pdecon_2 = Deconstruct(Point=database_modal_location_3)  # -> XComponent, YComponent, ZComponent
subtraction_7 = Subtraction(A=pdecon_2.XComponent, B=Slider(0, range=0..100))
heath_accent_color_10 = RemoteReceiver(heath_accent_color)
pt_8 = ConstructPoint(XCoordinate=subtraction_7, YCoordinate=pdecon_2.YComponent, ZCoordinate=0)

entwine_9 = Entwine(Branch00=toggle, Branch01=button_10, FlattenInputs=True)  # -> flatten(Result)
filter_12 = StreamFilter(Gate=bool, Stream0="GWP (kg CO2eq)", Stream1="GWP (kg CO2eq/m2)")
filter_13 = StreamFilter(Gate=bool, Stream0="GWP by model (kg CO2eq)", Stream1="GWP by model (kg CO2eq/m2)")
stack_8 = CreateStack(UIElements=entwine_9, Horizontal=True)
adjustpos_22 = AdjustElementPositioning(ElementsToAdjust=stack_8, AbsolutePositioning=False, HorizontalAlignment=1)

# ----
# Recursion
panel_23 = Panel("LCA window status")
objbynn_3 = GetObjectByNickname(NickName=panel_23)
lca_window_status = Python3Script()  # -> status
# ---------- lca_window_status: Python ----------
status = False
# ---------- end lca_window_status ----------

# ----
# Recursion
panel_24 = Panel("LCA window status")
objbynn_4 = GetObjectByNickname(NickName=panel_24)
lca_window_status_2 = Python3Script()  # -> status; same code as lca_window_status

# ----
# Recursion
panel_25 = Panel("SDA window status")
objbynn_5 = GetObjectByNickname(NickName=panel_25)
sda_window_status = Python3Script()  # -> status; same code as lca_window_status

# ----
# Spatial daylight autonomy pop-up window
panel_26 = Panel("Update")
button_11 = CreateButton(ButtonName=panel_26, ButtonStyle=0)
values_27 = ValueListener(Elements=button_11, SomeProperty=True)  # -> Values, Indices
adjustpos_23 = AdjustElementPositioning(ElementsToAdjust=button_11, AbsolutePositioning=False, Height=Slider(30, range=0..100), HorizontalAlignment=1)
event_6 = EventGate(Data=values_27.Values)  # -> Data, IsNew
panel_27 = Panel(values_27.Values)
checklist_3 = CreateChecklist(Selected=invert(False))
colrange = LBColorRange(index=Slider(3, range=0..100))  # -> colors; plug-in component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
shuffle = Python3Script(x=colrange)  # -> x; inputs x: list of Color
# ---------- shuffle: Python ----------
import random

random.shuffle(x)
# ---------- end shuffle ----------
txt_3 = Text(shuffle)
pt_9 = Point(txt_3)
values_28 = ValueListener(Elements=checklist_3, SomeProperty=True)  # -> Values, Indices
division_3 = Division(A=pt_9, B="255")
len_3 = TextLength(Text=division_3)
panel_28 = Panel("Spatial daylight autonomy (%)")
subtraction_8 = Subtraction(A=len_3, B=Slider(2, range=0..10))
fragment_3 = TextFragment(Text=division_3, Start="1", Count=subtraction_8)
database_modal_location_4 = RemoteReceiver(database_modal_location)
pdecon_3 = Deconstruct(Point=database_modal_location_4)  # -> XComponent, YComponent, ZComponent
subtraction_9 = Subtraction(A=pdecon_3.XComponent, B=Slider(0, range=0..100))
heath_accent_color_11 = RemoteReceiver(heath_accent_color)
adjustpos_24 = AdjustElementPositioning(ElementsToAdjust=checklist_3, Margin="0, 40, -5, 0", AbsolutePositioning=False, Width=Slider(215, range=0..1000))
pt_10 = ConstructPoint(XCoordinate=subtraction_9, YCoordinate=pdecon_3.YComponent, ZCoordinate=0)

entwine_10 = Entwine(Branch00=ma_2.Result, Branch01=lca_window_status_2, FlattenInputs=True)
rec_3 = DataRecorder(entwine_10, DataLimit=2, RecordData=True)
item = ListItem(List=rec_3, Index=0, Wrap=True)  # -> Item2, Item1, Item
equals_3 = Equality(FirstNumber=item.Item2, SecondNumber=item.Item1)  # -> Equality, Inequality
bang = ExplodeTree(Data=equals_3.Inequality)  # -> Branch0, Branch1
py3_5 = Python3Script(x=bang.Branch0, y=bang.Branch1)  # -> a
# ---------- py3_5: Python ----------
if x:
    a = True
elif y:
    a = False
else:
    a = False
# ---------- end py3_5 ----------
event_7 = EventGate(Data=py3_5)  # -> Data, IsNew
freeze_gate_3 = StreamFreezeGate(Data=py3_5, PassingSwitch=event_7.IsNew)
event_8 = EventGate(Data=freeze_gate_3)  # -> Data, IsNew
panel_29 = Panel(event_8.Data)
launchwin = LaunchWindow(
    Show=event_8.Data,
    Name="EUI visualisations",
    Width=bar_chart_popup_win_width_3,
    Height=bar_chart_popup_win_height_3,
    ChildStatus=1,
    EnableHorizScroll=False)
winprops = SetWindowProperties(
    Window=launchwin,
    StartingLocation=pt_6,
    Theme=0,
    AccentColor=heath_accent_color_9,
    ShowTitleBar=True,
    BackgroundColor=RGB(255, 255, 255),
    ScaleFactor=1)
winstat = WindowStatus(Window=launchwin)
eui_status = RemoteSender(winstat)
py3_6 = Python3Script(window=launchwin, activate=simple_energy_simulation_compare_pop_up_4)
# ---------- py3_6: Python ----------
import System

if activate and (str(window.WindowState) == "Minimized"):
    window.set_WindowState(System.Windows.WindowState(0))
# ---------- end py3_6 ----------

eui_status_2 = RemoteReceiver(eui_status)
expression = Expression(x="Hidden", y=eui_status_2, Expression="x=y")
expire = ExpireObject(ObjectToExpire=objbynn_4, Expire=expression)

# ----
# Database constructions
panel_30 = Panel("Generic")

# ----
# Geometry module interface
# Attribute modification
# Preview geometry
# Geometry visibility settings
panel_31 = Panel("Sky component analysis")
tab_simulate_10 = RemoteReceiver(tab_simulate)
constructiontype = RemoteReceiver()
heath_geometry_type_key = RemoteSender("Heath geometry type")
heath_geometry_type_key_2 = RemoteReceiver(heath_geometry_type_key)
heath_geometry_type_key_3 = RemoteReceiver(heath_geometry_type_key)
heath_geometry_type_key_4 = RemoteReceiver(heath_geometry_type_key)
heath_geometry_type_key_5 = RemoteReceiver(heath_geometry_type_key)
heath_geometry_type_key_6 = RemoteReceiver(heath_geometry_type_key)
saveconstruction = RemoteReceiver()
panel_32 = Panel("1")  # disabled

# ----
# Database windows
generic_u_value = Data(1.687787378)
generic_shgc = Data(0.4240807069)

# ----
# Database materials
panel_33 = Panel("{0} (conductivity: {1}, density: {2}, specific heat: {3})")

# ----
# Reports
detailed_energy_simulations_report = RemoteReceiver()
glare_report = RemoteReceiver()

# ----
# Inspect model
# Model attributes
panel_34 = Panel("Bake model")
panel_35 = Panel("""Walls
Roof
Floors
Ground
Windows
Context""")
tab_load_inspect_model_7 = RemoteReceiver(tab_load_inspect_model)
button_12 = CreateButton(ButtonName="Zoom", ButtonStyle=0)
checklist_4 = CreateChecklist(ChecklistItems=panel_35, Selected=False)
button_13 = CreateButton(ButtonName=panel_34, ButtonStyle=0)
label_12 = CreateLabel(LabelText="Display model components", LabelSize=18, Justification=0)
label_13 = CreateLabel(LabelText="Load and select a model", LabelSize=18, Justification=1)
panel_36 = Panel("""properties.energy.construction.display_name
properties.energy.construction.layers
properties.energy.construction.thickness
area
properties.energy.construction.mass_area_density
properties.energy.construction.area_heat_capacity
properties.energy.construction.r_value
properties.energy.construction.u_value
properties.energy.construction.u_factor
properties.energy.construction.shgc
properties.energy.r_factor
properties.energy.u_factor""")
panel_37 = Panel("""properties.energy.program_type.display_name
properties.energy.people.area_per_person
properties.energy.lighting.watts_per_area
properties.energy.electric_equipment.watts_per_area
properties.energy.gas_equipment.watts_per_area
properties.energy.service_hot_water.flow_per_area
volume
floor_area
exposed_area
exterior_wall_area
exterior_aperture_area
average_floor_height""")
values_29 = ValueListener(Elements=button_12, SomeProperty=True)  # -> Values, Indices
values_30 = ValueListener(Elements=checklist_4, SomeProperty=True)  # -> Values, Indices
panel_38 = Panel("""Program
Area per Person [m2/ppl]
Lighting per Area [W/m2]
Electric Equipment per Area [W/m2]
Gas Equipment per Area [W/m2]
Hot Water per Area [L/h-m2]
Volume [m3]
Gross Floor Area [m2]
Exposed Area [m2]
Exterior Wall Area [m2]
Exterior Aperture Area [m2]
Average Floor Elevation [m]""")
values_31 = ValueListener(Elements=button_13, SomeProperty=True)  # -> Values, Indices
panel_39 = Panel("""Construction
Materials
Thickness [m]
Area [m2]
Density [kg/m2]
Heat Capacity [J/K-m2]
Construction R-Value [m2-K/W]
Construction U-Value [W/m2-K]
Construction U-Factor [W/m2-K]
Construction SHGC [Unshaded]
R-Factor [m2-K/W]
U-Factor [W/m2-K]""")
zoom_honeybee_model = RemoteSender(values_29.Values)
item_2 = ListItem(List=values_30.Values, Index=0, Wrap=invert(True))  # -> Item, Item1, Item2, Item3, Item4, Item5
cull = CullPattern(List=values_30.Values, CullPattern=values_30.Values)
rec_4 = DataRecorder(values_31.Values, DataLimit=-10, RecordData=True)
ma_3 = MassAddition(Input=cull)  # -> Result, PartialResults
int_3 = Integer(rec_4)
null_9 = NullItem(Item=ma_3.Result)  # -> NullFlags, InvalidFlags, Description
ma_4 = MassAddition(Input=int_3)  # -> Result, PartialResults
tab_load_inspect_model_8 = RemoteReceiver(tab_load_inspect_model)
event_9 = EventGate(Data=ma_4.Result)  # -> Data, IsNew
filter_14 = StreamFilter(Gate=null_9.NullFlags, Stream0=cull, Stream1="False")
tab_load_inspect_model_9 = RemoteReceiver(tab_load_inspect_model)
pulldown_3 = CreatePulldownMenu(Label="Program", ListItems=panel_38, showLabel=True)
checkbox = CreateCheckbox(Label="Show", StartingValue=False)
label_14 = CreateLabel(LabelText="Model attributes", LabelSize=18, Justification=0)
pulldown_4 = CreatePulldownMenu(Label="Constructions", ListItems=panel_39, showLabel=True)
checkbox_2 = CreateCheckbox(Label="Show", StartingValue=False)
event_10 = EventGate(Data=filter_14)  # -> Data, IsNew
dam_3 = DataDam(DataA=event_9.Data, BufferDelay=2500000, BufferMode=2)
show_honeybee_element = RemoteSender(event_10.Data)
equals_4 = Equality(FirstNumber=event_9.Data, SecondNumber=dam_3)  # -> Equality, Inequality
entwine_11 = Entwine(Branch00=pulldown_3, Branch01=checkbox, FlattenInputs=True)  # -> flatten(Result)
values_32 = ValueListener(Elements=pulldown_3, SomeProperty=True)  # -> Values, Indices
values_33 = ValueListener(Elements=checkbox, SomeProperty=True)  # -> Values, Indices
values_34 = ValueListener(Elements=pulldown_4, SomeProperty=True)  # -> Values, Indices
values_35 = ValueListener(Elements=checkbox_2, SomeProperty=True)  # -> Values, Indices
event_11 = EventGate(Data=equals_4.Inequality)  # -> Data, IsNew
item_3 = ListItem(List=panel_37, Index=values_32.Indices, Wrap=invert(True))
stack_9 = CreateStack(UIElements=entwine_11, Horizontal=True)
item_4 = ListItem(List=panel_36, Index=values_34.Indices, Wrap=invert(True))
format_15 = Format(
    Format="{0}, {1}, {2}, {3}",
    Culture=127,
    Data0=Slider(0, range=-25..25),
    Data1=Slider(5, range=0..100),
    Data2=Slider(5, range=0..100),
    Data3=Slider(0, range=-25..25))
entwine_12 = Entwine(Branch00=pulldown_4, Branch01=checkbox_2, FlattenInputs=True)  # -> flatten(Result)
face_attribute = RemoteSender(item_4)
room_attribute = RemoteSender(item_3)
entwine_13 = Entwine(Branch00=button_12, Branch01=button_13, FlattenInputs=True)  # -> flatten(Result)
stack_10 = CreateStack(UIElements=entwine_12, Horizontal=True)
adjustpos_25 = AdjustElementPositioning(
    ElementsToAdjust=[button_12, button_13],
    Margin=format_15,
    AbsolutePositioning=False,
    HorizontalAlignment=1,
    VerticalAlignment=1)
stack_11 = CreateStack(UIElements=entwine_13, Horizontal=True)
entwine_14 = Entwine(Branch00=label_14, Branch01=stack_9, Branch02=stack_10, FlattenInputs=True)  # -> flatten(Result)
stack_12 = CreateStack(UIElements=entwine_14, Horizontal=invert(True))
entwine_15 = Entwine(Branch00=label_14, Branch01=stack_12, FlattenInputs=True)  # -> flatten(Result)
entwine_16 = Entwine(Branch00=label_12, Branch01=checklist_4, Branch02=stack_11, Branch03=entwine_15, FlattenInputs=True)  # -> flatten(Result)
entwine_17 = Entwine(Branch00=label_13, Branch01=entwine_16, FlattenInputs=True)  # -> flatten(Result)
adjustpos_26 = AdjustElementPositioning(ElementsToAdjust=[checkbox, checkbox_2], Margin="0, 0, 10, 0", AbsolutePositioning=False)
adjustpos_27 = AdjustElementPositioning(
    ElementsToAdjust=[pulldown_3, pulldown_4],
    AbsolutePositioning=False,
    Width=Slider(239, range=0..400),
    HorizontalAlignment=0)

expander_2 = CreateExpander(UIElements=entwine_17, Header="Inspect model", Open=invert(True))

show_honeybee_element_2 = RemoteReceiver(show_honeybee_element)

# ----
# Inspect context environment
panel_40 = Panel("""Hemishere visualisation
Wind rose
Temperature line chart
Temperature 2D chart""")
pulldown_5 = CreatePulldownMenu(ListItems=panel_40, SelectedIndex="0", showLabel=False)
button_14 = CreateButton(ButtonName="Zoom", ButtonStyle=0)
button_15 = CreateButton(ButtonName="Bake", ButtonStyle=0)
values_36 = ValueListener(Elements=button_15, SomeProperty=True)  # -> Values, Indices
label_15 = CreateLabel(LabelText="Select environment visualisation", LabelSize=18, Justification=0)
freeze_gate_4 = StreamFreezeGate(Data=values_36.Values, PassingSwitch=invert(values_36.Values))
values_37 = ValueListener(Elements=pulldown_5, SomeProperty=True)  # -> Values, Indices
values_38 = ValueListener(Elements=button_14, SomeProperty=True)  # -> Values, Indices
bool_4 = Boolean(invert(freeze_gate_4))
weather_visualization_type = RemoteSender(values_37.Indices)
zoom_weather_visualization = RemoteSender(values_38.Values)
rec_5 = DataRecorder(bool_4, DataLimit=-10, RecordData=True)
int_4 = Integer(rec_5)
ma_5 = MassAddition(Input=int_4)  # -> Result, PartialResults
event_12 = EventGate(Data=ma_5.Result)  # -> Data, IsNew
entwine_18 = Entwine(Branch00=pulldown_5, Branch01=button_14, Branch02=button_15, FlattenInputs=True)  # -> flatten(Result)
dam_4 = DataDam(DataA=event_12.Data, BufferDelay=2500000, BufferMode=2)
stack_13 = CreateStack(UIElements=entwine_18, Horizontal=True)
equals_5 = Equality(FirstNumber=event_12.Data, SecondNumber=dam_4)  # -> Equality, Inequality
event_13 = EventGate(Data=equals_5.Inequality)  # -> Data, IsNew
adjustpos_28 = AdjustElementPositioning(ElementsToAdjust=pulldown_5, Margin="0, 0, 0, 0", AbsolutePositioning=False, Width=Slider(200, range=0..400))
entwine_19 = Entwine(Branch00=label_4, Branch01=label_15, Branch02=stack_13, FlattenInputs=True)  # -> flatten(Result)

expander_3 = CreateExpander(UIElements=entwine_19, Header="Inspect location environment", Open=invert(True))
values_39 = ValueListener(Elements=expander_3, SomeProperty=True)  # -> Values, Indices
expander_inspect_location_environment = RemoteSender(values_39.Values)

# ---- group: Visualize module
# Load/Inspect model
panel_41 = Panel("Rename model")
label_16 = CreateLabel(LabelText="Model overview", LabelSize=18, Justification=0)
button_16 = CreateButton(ButtonName="Load models", ButtonStyle=0)
values_40 = ValueListener(Elements=button_16, SomeProperty=True)  # -> Values, Indices
textbox_8 = CreateTextBox(Label=panel_41, DefaultText="Renamed model", UpdateButton=invert(True), showLabel=True)
pulldown_6 = CreatePulldownMenu(Label="Select model", showLabel=True)
button_17 = CreateButton(ButtonName="Rename", ButtonStyle=0)
button_18 = CreateButton(ButtonName="Remove", ButtonStyle=0)
values_41 = ValueListener(Elements=button_18, SomeProperty=True)  # -> Values, Indices
freeze_gate_5 = StreamFreezeGate(Data=values_41.Values, PassingSwitch=invert(values_41.Values))
pre_remove_current_model = RemoteSender(values_41.Values)
freeze_gate_6 = StreamFreezeGate(Data=values_40.Values, PassingSwitch=invert(values_40.Values))
pre_update_honeybee_model = RemoteSender(values_40.Values)
bool_5 = Boolean(invert(freeze_gate_5))
values_42 = ValueListener(Elements=button_17, SomeProperty=True)  # -> Values, Indices
freeze_gate_7 = StreamFreezeGate(Data=values_42.Values, PassingSwitch=invert(values_42.Values))
values_43 = ValueListener(Elements=textbox_8, SomeProperty=True)  # -> Values, Indices
values_44 = ValueListener(Elements=pulldown_6, SomeProperty=True)  # -> Values, Indices
bool_6 = Boolean(invert(freeze_gate_6))
bool_7 = Boolean(invert(freeze_gate_7))
rec_6 = DataRecorder(bool_5, DataLimit=-10, RecordData=True)
pre_rename_current_model = RemoteSender(values_42.Values)
event_14 = EventGate(Data=values_44.Indices)  # -> Data, IsNew
current_selected_model_visualise_module = RemoteSender(values_44.Values)  # "current_selected_model_visualise_module_name"
current_selected_model_visualise_module_2 = RemoteReceiver(current_selected_model_visualise_module)  # "current_selected_model_visualise_module_name"
rec_7 = DataRecorder(bool_6, DataLimit=-10, RecordData=True)
rec_8 = DataRecorder(bool_7, DataLimit=-10, RecordData=True)
rename_current_model_name = RemoteSender(values_43.Values)
rename_current_model_name_2 = RemoteReceiver(rename_current_model_name)
panel_42 = Panel(values_43.Values)
int_5 = Integer(rec_6)
current_selected_model_visualise_module_3 = RemoteSender(event_14.Data)
ma_6 = MassAddition(Input=int_5)  # -> Result, PartialResults
int_6 = Integer(rec_7)
int_7 = Integer(rec_8)
ma_7 = MassAddition(Input=int_6)  # -> Result, PartialResults
ma_8 = MassAddition(Input=int_7)  # -> Result, PartialResults
event_15 = EventGate(Data=ma_6.Result)  # -> Data, IsNew
settextbox = SetTextBoxContents(TextBoxToModify=textbox_8, NewTextBoxContents=current_selected_model_visualise_module_2)
event_16 = EventGate(Data=ma_7.Result)  # -> Data, IsNew
event_17 = EventGate(Data=ma_8.Result)  # -> Data, IsNew
dam_5 = DataDam(DataA=event_15.Data, BufferDelay=2500000, BufferMode=2)
dam_6 = DataDam(DataA=event_16.Data, BufferDelay=2500000, BufferMode=2)
dam_7 = DataDam(DataA=event_17.Data, BufferDelay=2500000, BufferMode=2)
equals_6 = Equality(FirstNumber=event_15.Data, SecondNumber=dam_5)  # -> Equality, Inequality
equals_7 = Equality(FirstNumber=event_16.Data, SecondNumber=dam_6)  # -> Equality, Inequality
equals_8 = Equality(FirstNumber=event_17.Data, SecondNumber=dam_7)  # -> Equality, Inequality
entwine_20 = Entwine(Branch00=pulldown_6, Branch01=button_18, FlattenInputs=True)  # -> flatten(Result)
adjustpos_29 = AdjustElementPositioning(
    ElementsToAdjust=button_16,
    AbsolutePositioning=False,
    Width=Slider(125, range=50..250),
    Height=Slider(30, range=20..50),
    HorizontalAlignment=1)
entwine_21 = Entwine(Branch00=textbox_8, Branch01=button_17, FlattenInputs=True)  # -> flatten(Result)
stack_14 = CreateStack(UIElements=entwine_20, Horizontal=True)
stack_15 = CreateStack(UIElements=entwine_21, Horizontal=True)
format_16 = Format(Format="{0}, {1}, 0, 0", Culture=127, Data0=Slider(0, range=-25..25), Data1=Slider(0, range=0..100))
select_model_3 = Data(stack_14)
format_17 = Format(Format="{0}, {1}, 0, 0", Culture=127, Data0=Slider(0, range=-25..25), Data1=Slider(5, range=0..100))
format_18 = Format(Format="{0}, {1}, 0, 0", Culture=127, Data0=Slider(8, range=-25..25), Data1=Slider(4, range=0..100))
adjustpos_30 = AdjustElementPositioning(ElementsToAdjust=button_18, AbsolutePositioning=False, Height=Slider(28, range=0..100))
adjustpos_31 = AdjustElementPositioning(
    ElementsToAdjust=pulldown_6,
    Margin=format_16,
    AbsolutePositioning=False,
    Width=Slider(280, range=0..400),
    Height=Slider(35, range=0..100),
    HorizontalAlignment=0,
    VerticalAlignment=2)
adjustpos_32 = AdjustElementPositioning(
    ElementsToAdjust=button_17,
    Margin=format_18,
    AbsolutePositioning=False,
    Height=Slider(29, range=0..100),
    HorizontalAlignment=0)
adjustpos_33 = AdjustElementPositioning(
    ElementsToAdjust=textbox_8,
    Margin=format_17,
    AbsolutePositioning=False,
    Width=Slider(276, range=0..350),
    Height=Slider(28, range=0..100),
    HorizontalAlignment=0)

# ----
entwine_22 = Entwine(Branch00=label_16, Branch01=button_16, Branch02=select_model_3, Branch03=stack_15, FlattenInputs=True)  # -> flatten(Result)
current_selected_model_visualise_module_4 = RemoteReceiver(current_selected_model_visualise_module_3)

rename_current_model_name_3 = RemoteReceiver(rename_current_model_name)
pre_rename_current_model_2 = RemoteReceiver(pre_rename_current_model)
pre_remove_current_model_2 = RemoteReceiver(pre_remove_current_model)

# ---- group: Program module
# SELECT PROGRAM
panel_43 = Panel("""LargeOffice
MediumOffice
SmallOffice
MidriseApartment
HighriseApartment
Retail
StripMall
PrimarySchool
SecondarySchool
SmallHotel
LargeHotel
Hospital
Outpatient
Laboratory
Warehouse
SuperMarket
FullServiceRestaurant
QuickServiceRestaurant
Courthouse
LargeDataCenterHighITE
LargeDataCenterLowITE
SmallDataCenterHighITE
SmallDataCenterLowITE""")
cooling_setpoint_ºc = Slider(27, range=10..40)
heating_setpoint_ºc = Slider(21, range=10..40)
empty = EmptyObjectToEmptyBranch()
pulldown_7 = CreatePulldownMenu(Label="Room type", ListItems=empty, showLabel=True)
label_17 = CreateLabel(LabelText="Select type of room", LabelSize=18, Justification=0)
label_18 = CreateLabel(LabelText="Indoor conditions", LabelSize=18, Justification=0)
pulldown_8 = CreatePulldownMenu(Label="Building type", ListItems=panel_43, SelectedIndex="3", showLabel=True)
slider = CreateSlider(Slider=cooling_setpoint_ºc, ShowBounds=False, ShowTicks=True, ShowTooltip=True, ShowValLabel=True, showLabel=False)
label_19 = CreateLabel(LabelText="Cooling setpoint [ºC]", LabelSize=12, Justification=0)
slider_2 = CreateSlider(Slider=heating_setpoint_ºc, ShowBounds=False, ShowTicks=True, ShowTooltip=False, ShowValLabel=True, showLabel=False)
label_20 = CreateLabel(LabelText="Heating setpoint [ºC]", LabelSize=12, Justification=0)
label_21 = CreateLabel(LabelText="Occupancy [persons/100 m2]", LabelSize=12, Justification=0)
slider_3 = CreateSlider(Slider=Slider(3, range=0..20), ShowBounds=False, ShowTicks=True, ShowTooltip=True, ShowValLabel=True, showLabel=False)
values_45 = ValueListener(Elements=pulldown_8, SomeProperty=True)  # -> Values, Indices
values_46 = ValueListener(Elements=pulldown_7, SomeProperty=True)  # -> Values, Indices
values_47 = ValueListener(Elements=slider_2, SomeProperty=True)  # -> Values, Indices
values_48 = ValueListener(Elements=slider, SomeProperty=True)  # -> Values, Indices
tooltip = AttachTooltipToElement(ElementsToAttachTo=slider_2, TooltipContent="Doubleclick to input value", ShowDelay=500, Duration=2000)
values_49 = ValueListener(Elements=slider_3, SomeProperty=True)  # -> Values, Indices
tooltip_2 = AttachTooltipToElement(ElementsToAttachTo=slider_3, TooltipContent="Doubleclick to input value", ShowDelay=500, Duration=2000)
tooltip_3 = AttachTooltipToElement(ElementsToAttachTo=slider, TooltipContent="Doubleclick to input value", ShowDelay=500, Duration=2000)
selected_building = RemoteSender(values_45.Values)
selected_room = RemoteSender(values_46.Values)
cooling_setpoint = RemoteSender(values_48.Values)
cooling_setpoint_2 = RemoteReceiver(cooling_setpoint)
subtraction_10 = Subtraction(A=cooling_setpoint_2, B="1")
dom = ConstructDomain(DomainStart=Slider(10, range=0..100), DomainEnd=subtraction_10)
setslider = SetSlider(UISlider=slider_2, Range=dom)
heating_setpoint = RemoteSender(values_47.Values)
heating_setpoint_2 = RemoteReceiver(heating_setpoint)
addition = Addition(A=heating_setpoint_2, B="1")
dom_2 = ConstructDomain(DomainStart=addition, DomainEnd=Slider(40, range=0..100))
setslider_2 = SetSlider(UISlider=slider, Range=dom_2)
entwine_23 = Entwine(Branch00=label_19, Branch01=slider, FlattenInputs=True)  # -> flatten(Result)
entwine_24 = Entwine(Branch00=label_20, Branch01=slider_2, FlattenInputs=True)  # -> flatten(Result)
entwine_25 = Entwine(Branch00=label_21, Branch01=slider_3, FlattenInputs=True)  # -> flatten(Result)
number_slider_13 = Slider(255, range=0..350)
stack_16 = CreateStack(UIElements=entwine_24, Horizontal=invert(True))
stack_17 = CreateStack(UIElements=entwine_23, Horizontal=invert(True))
stack_18 = CreateStack(UIElements=entwine_25, Horizontal=invert(True))
format_19 = Format(Format="{0}, {1}, 0, 0", Culture=127, Data0=Slider(10, range=0..25), Data1=Slider(0, range=0..50))
entwine_26 = Entwine(Branch00=label_17, Branch01=pulldown_8, Branch02=pulldown_7, FlattenInputs=True)  # -> flatten(Result)
entwine_27 = Entwine(Branch00=label_18, Branch01=stack_17, Branch02=stack_16, Branch03=stack_18, FlattenInputs=True)  # -> flatten(Result)
adjustpos_34 = AdjustElementPositioning(ElementsToAdjust=pulldown_8, AbsolutePositioning=False, Width=number_slider_13, HorizontalAlignment=0)
adjustpos_35 = AdjustElementPositioning(ElementsToAdjust=pulldown_7, AbsolutePositioning=False, Width=number_slider_13, HorizontalAlignment=0)
adjustpos_36 = AdjustElementPositioning(
    ElementsToAdjust=[slider_3, slider_2, slider],
    Margin=format_19,
    AbsolutePositioning=False,
    Width=Slider(200, range=0..300),
    HorizontalAlignment=0)

# ----
division_4 = Division(A=values_49.Values, B="100")
location_2 = Data(entwine_26)
location_3 = Data(entwine_27)
selected_room_2 = RemoteReceiver(selected_room)
cooling_setpoint_3 = RemoteReceiver(cooling_setpoint)
heating_setpoint_3 = RemoteReceiver(heating_setpoint)

# ---- group: Construction module
# SELECT CONSTRUCTION
number_slider_14 = Slider(5, range=0..7)
panel_44 = Panel("🛠")
panel_45 = Panel("""Very Hot
Hot
Warm
Mixed
Cool
Cold
Very Cold
Subarctic""")
panel_46 = Panel("""SteelFramed
WoodFramed
Mass
Metal Building""")
panel_47 = Panel("Skylights")  # disabled
empty_2 = EmptyObjectToEmptyBranch()
empty_3 = EmptyObjectToEmptyBranch()  # disabled
empty_4 = EmptyObjectToEmptyBranch()
panel_48 = Panel("Exterior floor")  # disabled
panel_49 = Panel("Interior walls")  # disabled
empty_5 = EmptyObjectToEmptyBranch()
empty_6 = EmptyObjectToEmptyBranch()
empty_7 = EmptyObjectToEmptyBranch()  # disabled
empty_8 = EmptyObjectToEmptyBranch()
empty_9 = EmptyObjectToEmptyBranch()  # disabled
pulldown_9 = CreatePulldownMenu(Label=panel_47, ListItems=empty_3, showLabel=True)  # disabled
pulldown_10 = CreatePulldownMenu(Label="Windows", ListItems=empty_2, showLabel=True)
pulldown_11 = CreatePulldownMenu(Label="Walls", ListItems=empty_5, showLabel=True)
pulldown_12 = CreatePulldownMenu(Label="Ground", ListItems=empty_4, showLabel=True)
pulldown_13 = CreatePulldownMenu(Label="Floors", ListItems=empty_8, showLabel=True)
pulldown_14 = CreatePulldownMenu(Label=panel_48, ListItems=empty_7, showLabel=True)  # disabled
true_button_8 = CreateTrueOnlyButton(ButtonName="🛠", ButtonStyle=0)
pulldown_15 = CreatePulldownMenu(Label="Roof", ListItems=empty_6, showLabel=True)
pulldown_16 = CreatePulldownMenu(Label=panel_49, ListItems=empty_9, showLabel=True)  # disabled
label_22 = CreateLabel(LabelText="Select subset construction", LabelSize=18, Justification=0)
pulldown_17 = CreatePulldownMenu(Label="By climate", ListItems=panel_45, SelectedIndex=number_slider_14, showLabel=True)
label_23 = CreateLabel(LabelText="Select base construction", LabelSize=18, Justification=0)
pulldown_18 = CreatePulldownMenu(Label="By type", ListItems=panel_46, SelectedIndex=Slider(1, range=0..3), showLabel=True)
values_50 = ValueListener(Elements=pulldown_9, SomeProperty=True)  # -> Values, Indices; disabled
values_51 = ValueListener(Elements=pulldown_10, SomeProperty=True)  # -> Values, Indices
values_52 = ValueListener(Elements=pulldown_16, SomeProperty=True)  # -> Values, Indices; disabled
values_53 = ValueListener(Elements=pulldown_13, SomeProperty=True)  # -> Values, Indices
values_54 = ValueListener(Elements=pulldown_14, SomeProperty=True)  # -> Values, Indices; disabled
values_55 = ValueListener(Elements=pulldown_12, SomeProperty=True)  # -> Values, Indices
values_56 = ValueListener(Elements=true_button_8, SomeProperty=True)  # -> Values, Indices
values_57 = ValueListener(Elements=pulldown_15, SomeProperty=True)  # -> Values, Indices
values_58 = ValueListener(Elements=pulldown_11, SomeProperty=True)  # -> Values, Indices
values_59 = ValueListener(Elements=pulldown_18, SomeProperty=True)  # -> Values, Indices
panel_50 = Panel("0")  # disabled
panel_51 = Panel("0")  # disabled
subset_interior_wall = RemoteSender(values_52.Indices)  # disabled
subset_interior_floor = RemoteSender(values_53.Indices)
subset_exterior_floor = RemoteSender(values_54.Indices)  # disabled
subset_ground_floor = RemoteSender(values_55.Indices)
subset_subface_skylight = RemoteSender(values_50.Indices)  # disabled
subset_subface_window = RemoteSender(values_51.Indices)
panel_52 = Panel("0")  # disabled
subset_exterior_roof = RemoteSender(values_57.Indices)
values_60 = ValueListener(Elements=pulldown_17, SomeProperty=True)  # -> Values, Indices
subset_exterior_wall = RemoteSender(values_58.Indices)
panel_53 = Panel(values_56.Values)
open_window_database = RemoteSender(values_56.Values)
base_type = RemoteSender(values_59.Values)
addition_2 = Addition(A=values_60.Indices, B="1")
recompute_3 = RemoteReceiver(recompute)
panel_54 = Panel("""False
True""")
entwine_28 = Entwine(Branch00=pulldown_17, Branch01=pulldown_18, FlattenInputs=True)  # -> flatten(Result)
base_climate = RemoteSender(addition_2)
entwine_29 = Entwine(Branch00=pulldown_10, Branch01=true_button_8, FlattenInputs=True)  # -> flatten(Result)
stack_19 = CreateStack(UIElements=entwine_28, Horizontal=invert(True))
stack_20 = CreateStack(UIElements=entwine_29, Horizontal=True)
entwine_30 = Entwine(Branch00=label_23, Branch01=stack_19, FlattenInputs=True)  # -> flatten(Result)
number_slider_15 = Slider(35, range=25..50)
stack_21 = CreateStack(UIElements=entwine_30, Horizontal=invert(True))
tooltip_4 = AttachTooltipToElement(ElementsToAttachTo=pulldown_18, TooltipContent="Select type of construction", ShowDelay=500, Duration=2000)
adjustpos_37 = AdjustElementPositioning(ElementsToAdjust=pulldown_18, AbsolutePositioning=False, Width=Slider(170, range=0..300), HorizontalAlignment=0)
adjustpos_38 = AdjustElementPositioning(ElementsToAdjust=pulldown_17, AbsolutePositioning=False, Width=Slider(160, range=0..300), HorizontalAlignment=0)
tooltip_5 = AttachTooltipToElement(ElementsToAttachTo=pulldown_17, TooltipContent="Select climate", ShowDelay=500, Duration=2000)
adjustpos_39 = AdjustElementPositioning(
    ElementsToAdjust=[pulldown_13, pulldown_12, pulldown_14, pulldown_15, pulldown_16, pulldown_11, pulldown_9, pulldown_10],
    AbsolutePositioning=False,
    Width=Slider(290, range=0..300),
    HorizontalAlignment=0)

# ----
base_climate_2 = RemoteReceiver(base_climate)
base_type_2 = RemoteReceiver(base_type)
constrsetclimate = HBConstructionSetByClimate(climate_zone=base_climate_2, vintage=bldgvintages, constr_type=base_type_2)  # -> constr_set; plug-in component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
panel_55 = Panel(constrsetclimate)
constructionset = HBConstructionSet(base_constr_set=panel_55)  # -> constr_set; plug-in component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
decnstrconstrset = HBDeconstructConstructionSet(constr_set=constructionset)  # -> exterior_wall, exterior_roof, exposed_floor, ground_wall, ground_roof, ground_floor, window, skylight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; plug-in component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
decnstrconstrsetint = HBDeconstructConstructionSetInterior(constr_set=constructionset)  # -> interior_wall, ceiling, interior_floor, interior_window, interior_door, int_glass_door; plug-in component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
entwine_31 = Entwine(
    Branch00=decnstrconstrset.exterior_wall,
    Branch01=decnstrconstrsetint.interior_wall,
    Branch02=decnstrconstrset.exterior_roof,
    Branch03=decnstrconstrsetint.interior_floor,
    Branch04=decnstrconstrset.exposed_floor,
    Branch05=decnstrconstrset.ground_floor,
    FlattenInputs=True)
decnstrconstr = HBDeconstructConstruction(constr=entwine_31)  # -> materials, layers, r_val_si, r_val_ip, u_fac_si, u_fac_ip, shgc, t_sol, t_vis; plug-in component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
bang_2 = ExplodeTree(Data=decnstrconstr.u_fac_si)  # -> Branch0, Branch1, Branch2, Branch3, Branch4, Branch5
repeat = RepeatData(Data=panel_44, Length="4")

# ----
# Construction by climate and type
location_4 = Data(stack_21)

# ----
# Select subset construction
location_5 = Data(label_22)

subset_interior_floor_2 = RemoteReceiver(subset_interior_floor)
subset_exterior_wall_2 = RemoteReceiver(subset_exterior_wall)

bldgvintages_2 = HBBuildingVintages({"ASHRAE 90.1 2019  |  IECC 2021": "2019", "ASHRAE 90.1 2016  |  IECC 2018": "2016", "ASHRAE 90.1 2013  |  IECC 2015": "2013", "ASHRAE 90.1 2010  |  IECC 2012": "2010", "ASHRAE 90.1 2007  |  IECC 2009": "2007", "ASHRAE 90.1 2004  |  IECC 2006": "2004", "1980-2004 (CBECS)": "1980_2004", "Pre-1980 (CBECS)": "pre_1980"}, selected="ASHRAE 90.1 2019  |  IECC 2021")
base_climate_3 = RemoteReceiver(base_climate)
base_type_3 = RemoteReceiver(base_type)
constrsetclimate_2 = HBConstructionSetByClimate(climate_zone=base_climate_3, vintage=bldgvintages_2, constr_type=base_type_3)  # -> constr_set; plug-in component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
panel_56 = Panel(constrsetclimate_2)

exterior_wall = Data(bang_2.Branch0)
exterior_roof = Data(bang_2.Branch2)
interior_floor = Data(bang_2.Branch3)
exterior_floor = Data(bang_2.Branch4)
ground = Data(bang_2.Branch5)
interior_wall = Data(bang_2.Branch1)
expression_2 = Expression(x=ground, Expression="Round(x, 2)")
expression_3 = Expression(x=exterior_floor, Expression="Round(x, 2)")
expression_4 = Expression(x=exterior_roof, Expression="Round(x, 2)")
expression_5 = Expression(x=interior_floor, Expression="Round(x, 2)")
expression_6 = Expression(x=interior_wall, Expression="Round(x, 2)")
expression_7 = Expression(x=exterior_wall, Expression="Round(x, 2)")
format_20 = Format(Format="{0} (U-factor: {1})", Culture=127, Data0=panel_30, Data1=expression_2)
format_21 = Format(Format="{0} (U-factor: {1})", Culture=127, Data0=panel_30, Data1=expression_3)
format_22 = Format(Format="{0} (U-factor: {1})", Culture=127, Data0=panel_30, Data1=expression_4)
format_23 = Format(Format="{0} (U-factor: {1})", Culture=127, Data0=panel_30, Data1=expression_5)
format_24 = Format(Format="{0} (U-factor: {1})", Culture=127, Data0=panel_30, Data1=expression_6)
format_25 = Format(Format="{0} (U-factor: {1})", Culture=127, Data0=panel_30, Data1=expression_7)

# ---- group: Prepare model
button_19 = CreateButton(ButtonName="Save model", ButtonStyle=0)
values_61 = ValueListener(Elements=button_19, SomeProperty=True)  # -> Values, Indices
textbox_9 = CreateTextBox(Label="Name", DefaultText="My model", UpdateButton=invert(True), showLabel=True)
freeze_gate_8 = StreamFreezeGate(Data=values_61.Values, PassingSwitch=invert(values_61.Values))
event_18 = EventGate(Data=values_61.Values)  # -> Data, IsNew
label_24 = CreateLabel(LabelText="Create new model", LabelSize=18, Justification=0)
pre_create_model = RemoteSender(event_18.Data)
bool_8 = Boolean(invert(freeze_gate_8))
rec_9 = DataRecorder(bool_8, DataLimit=-10, RecordData=True)
values_62 = ValueListener(Elements=textbox_9, SomeProperty=True)  # -> Values, Indices
model_name = RemoteSender(values_62.Values)
panel_57 = Panel(values_62.Values)
int_8 = Integer(rec_9)
ma_9 = MassAddition(Input=int_8)  # -> Result, PartialResults
event_19 = EventGate(Data=ma_9.Result)  # -> Data, IsNew
dam_8 = DataDam(DataA=event_19.Data, BufferDelay=2500000, BufferMode=2)
equals_9 = Equality(FirstNumber=event_19.Data, SecondNumber=dam_8)  # -> Equality, Inequality
number_slider_16 = Slider(210, range=0..300)
entwine_32 = Entwine(Branch00=label_24, Branch01=textbox_9, FlattenInputs=True)  # -> flatten(Result)
stack_22 = CreateStack(UIElements=entwine_32, Horizontal=invert(True))
adjustpos_40 = AdjustElementPositioning(ElementsToAdjust=textbox_9, AbsolutePositioning=False, HorizontalAlignment=0)
adjustpos_41 = AdjustElementPositioning(
    ElementsToAdjust=button_19,
    Margin="0, 10, 0, 0",
    AbsolutePositioning=False,
    Width=Slider(125, range=0..300),
    Height=Slider(30, range=0..100),
    HorizontalAlignment=1)

# ----
model_name_2 = RemoteReceiver(model_name)

# ----
# Create model
create_model = Data(button_19)

# ----
# Model name
model_name_3 = Data(stack_22)

# ---- group: Analysis module
# Energy simulation
# Daylight simulation
# LCA calculations
panel_58 = Panel("Compare with")
panel_59 = Panel("""Illuminance [Lux]
Daylight autonomy [%]
UDI [%]
UDI <50 [%]
UDI >3000 [%]
None""")
panel_60 = Panel("""Annual energy balance
Daily cooling profile
Daily heating profile
Cooling balance
Heating balance
None""")
panel_61 = Panel("Spatial daylight autonomy: {0}%")
height = Slider(40, range=1..100)
width = Slider(5, range=1..100)
panel_62 = Panel("Total load EUI: {0} (kWh/m2)")
panel_63 = Panel("Total embodied GWP per area: {0} kg CO2eq/m2")
panel_64 = Panel("Total embodied GWP: {0} kg CO2eq")
panel_65 = Panel("Operational GWP per area: {0} kg CO2eq/m2,year")
pulldown_19 = CreatePulldownMenu(Label=panel_58, showLabel=True)
panel_66 = Panel("Operational GWP total: {0} kg CO2eq/year")
panel_67 = Panel("Op. GWP total ({0} years): {1} kg CO2eq")
label_25 = CreateLabel(LabelText="Compare simulations", LabelSize=18, Justification=0)
true_button_9 = CreateTrueOnlyButton(ButtonName="Compare simulations bar chart", ButtonStyle=0)
button_20 = CreateButton(ButtonName="Bake", ButtonStyle=0)
button_21 = CreateButton(ButtonName="Zoom", ButtonStyle=0)
button_22 = CreateButton(ButtonName="Run energy simulation", ButtonStyle=0)
tb_4 = CreateTextBlock(TextSize=16, Justification=0)
label_26 = CreateLabel(LabelText="Display settings", LabelSize=18, Justification=0)
tb_5 = CreateTextBlock(Text="Simulations can take a few minutes...", TextSize=12, Justification=0)
values_63 = ValueListener(Elements=pulldown_19, SomeProperty=True)  # -> Values, Indices
pulldown_20 = CreatePulldownMenu(Label="Display type", ListItems=panel_60, showLabel=True)
slider_4 = CreateSlider(
    Slider=width,
    SnapValue=Slider(2, range=0..10),
    ShowBounds=False,
    ShowTicks=True,
    ShowTooltip=False,
    ShowValLabel=False,
    showLabel=True)
slider_5 = CreateSlider(
    Slider=height,
    SnapValue=Slider(2, range=0..10),
    ShowBounds=False,
    ShowTicks=True,
    ShowTooltip=False,
    ShowValLabel=False,
    showLabel=True)
pulldown_21 = CreatePulldownMenu(Label="Display type", ListItems=panel_59, SelectedIndex="0", showLabel=True)
tb_6 = CreateTextBlock(Text=panel_61, TextSize=16, Justification=0)
tb_7 = CreateTextBlock(Text="Simulations can take a few minutes...", TextSize=12, Justification=0)
label_27 = CreateLabel(LabelText="Display settings", LabelSize=18, Justification=0)
values_64 = ValueListener(Elements=true_button_9, SomeProperty=True)  # -> Values, Indices
tb_8 = CreateTextBlock(Text=panel_62, TextSize=16, Justification=0)
button_23 = CreateButton(ButtonName="Zoom", ButtonStyle=0)
button_24 = CreateButton(ButtonName="Run daylight simulation", ButtonStyle=0)
tb_9 = CreateTextBlock(TextSize=16, Justification=0)
true_button_10 = CreateTrueOnlyButton(ButtonName="Visualize GWP by model", ButtonStyle=0)
tb_10 = CreateTextBlock(TextSize=16, Justification=0)
values_65 = ValueListener(Elements=button_21, SomeProperty=True)  # -> Values, Indices
values_66 = ValueListener(Elements=button_20, SomeProperty=True)  # -> Values, Indices
hasdata_2 = DataExists(Data=relay)
values_67 = ValueListener(Elements=button_22, SomeProperty=True)  # -> Values, Indices
values_68 = ValueListener(Elements=button_24, SomeProperty=True)  # -> Values, Indices
values_69 = ValueListener(Elements=pulldown_20, SomeProperty=True)  # -> Values, Indices
daylight_simulation_compare_pop_up = RemoteSender(values_64.Values)
values_70 = ValueListener(Elements=pulldown_21, SomeProperty=True)  # -> Values, Indices
values_71 = ValueListener(Elements=slider_5, SomeProperty=True)  # -> Values, Indices
label_28 = CreateLabel(LabelText=panel_63, LabelSize=12, Justification=0)
label_29 = CreateLabel(LabelText="Create a model in the assembly module to get a LCA", LabelSize=12, Justification=0)
label_30 = CreateLabel(LabelText=panel_64, LabelSize=12, Justification=0)
values_72 = ValueListener(Elements=slider_4, SomeProperty=True)  # -> Values, Indices
subtraction_11 = Subtraction(A=values_63.Indices, B="1")
filter_15 = StreamFilter(Gate=hasdata_2, Stream0="0", Stream1=relay)
values_73 = ValueListener(Elements=button_23, SomeProperty=True)  # -> Values, Indices
values_74 = ValueListener(Elements=true_button_10, SomeProperty=True)  # -> Values, Indices
zoom_simple_energy_simulation = RemoteSender(values_65.Values)
label_31 = CreateLabel(LabelText=panel_65, LabelSize=12, Justification=0)
label_32 = CreateLabel(LabelText=panel_66, LabelSize=12, Justification=0)
bake_simple_energy_simulation = RemoteSender(values_66.Values)
freeze_gate_9 = StreamFreezeGate(Data=values_67.Values, PassingSwitch=invert(values_67.Values))
label_33 = CreateLabel(LabelText=panel_67, LabelSize=12, Justification=0)
pre_run_simple_energy_simulations = RemoteSender(values_67.Values)
pre_run_simple_energy_simulations_2 = RemoteReceiver(pre_run_simple_energy_simulations)
freeze_gate_10 = StreamFreezeGate(Data=pre_run_simple_energy_simulations_2, PassingSwitch=pre_run_simple_energy_simulations_2)
freeze_gate_11 = StreamFreezeGate(Data=values_68.Values, PassingSwitch=invert(values_68.Values))
simple_energy_simulation_type = RemoteSender(values_69.Indices)
daylight_simulation_type = RemoteSender(values_70.Indices)
simple_energy_simulation_height = RemoteSender(values_71.Values)
simple_energy_simulation_width = RemoteSender(values_72.Values)
current_selected_simulation_daylight_com = RemoteSender(subtraction_11)  # "current_selected_simulation_daylight_compare"
visualize_lca_gwp_by_element = RemoteSender(values_74.Values)
pre_run_daylight_simulations = RemoteSender(values_68.Values)
pre_run_daylight_simulations_2 = RemoteReceiver(pre_run_daylight_simulations)
freeze_gate_12 = StreamFreezeGate(Data=pre_run_daylight_simulations_2, PassingSwitch=pre_run_daylight_simulations_2)
hasdata_3 = DataExists(Data=freeze_gate_12)
filter_16 = StreamFilter(Gate=hasdata_3, Stream0="0", Stream1=freeze_gate_12)
or = GateOr(B=filter_15)
zoom_daylight_simulation = RemoteSender(values_73.Values)
bool_9 = Boolean(invert(freeze_gate_9))
bool_10 = Boolean(invert(freeze_gate_11))
entwine_33 = Entwine(Branch00=slider_5, Branch01=slider_4, FlattenInputs=True)  # -> flatten(Result)
entwine_34 = Entwine(Branch00=button_22, Branch01=button_21, Branch02=button_20, FlattenInputs=True)  # -> flatten(Result)
rec_10 = DataRecorder(or, DataLimit=-10, RecordData=True)
tap_2 = TapBuffer(Reset=False, Incremental=True, Valve=bool_9, Hold=True)
tap_3 = TapBuffer(Reset=False, Incremental=True, Valve=bool_10, Hold=True)
ma_10 = MassAddition(Input=flatten(rec_10))  # -> Result, PartialResults
dam_9 = DataDam(DataA=tap_2, BufferDelay=2500000, BufferMode=2)
dam_10 = DataDam(DataA=tap_3, BufferDelay=2500000, BufferMode=2)
entwine_35 = Entwine(Branch00=pulldown_20, Branch01=entwine_33, FlattenInputs=True)  # -> flatten(Result)
mod = Modulus(A=ma_10.Result, B=Slider(2, range=0..10))
equals_10 = Equality(FirstNumber=tap_2, SecondNumber=dam_9)  # -> Equality, Inequality
equals_11 = Equality(FirstNumber=tap_3, SecondNumber=dam_10)  # -> Equality, Inequality
stack_23 = CreateStack(UIElements=entwine_34, Horizontal=True)
bool_11 = Boolean(mod)
entwine_36 = Entwine(Branch00=label_27, Branch01=pulldown_21, FlattenInputs=True)  # -> flatten(Result)
stack_24 = CreateStack(UIElements=entwine_35, Horizontal=invert(True))
adjustelem_10 = AdjustElementAppearance(ElementsToAdjust=tb_6, Foreground=ColourSwatch(SwatchColor=RGB(0, 0, 0)), FontSize=Slider(14, range=0..100))
adjustelem_11 = AdjustElementAppearance(ElementsToAdjust=tb_8, Foreground=ColourSwatch(SwatchColor=RGB(0, 0, 0)), FontSize=Slider(14, range=0..100))
filter_17 = StreamFilter(Gate=bool_11, Stream0="Simulation failed...", Stream1="Energy simulation is running...")
format_26 = Format(
    Format="{0}, {1}, 0, {2}",
    Culture=127,
    Data0=Slider(5, range=-25..25),
    Data1=Slider(5, range=-15..15),
    Data2=Slider(5, range=0..100))
stack_25 = CreateStack(UIElements=entwine_36, Horizontal=invert(True))
format_27 = Format(
    Format="{0}, {1}, 0, {2}",
    Culture=127,
    Data0=Slider(10, range=-25..25),
    Data1=Slider(5, range=-15..15),
    Data2=Slider(5, range=0..100))
entwine_37 = Entwine(Branch00=button_24, Branch01=button_23, Branch02=button_5, FlattenInputs=True)  # -> flatten(Result)
entwine_38 = Entwine(Branch00=label_26, Branch01=stack_24, FlattenInputs=True)  # -> flatten(Result)
gate = StreamGate(Stream=filter_17, Gate=freeze_gate_10)  # -> Target0, Target1
format_28 = Format(
    Format="{0}, {1}, 0, {2}",
    Culture=127,
    Data0=Slider(5, range=-25..25),
    Data1=Slider(10, range=0..100),
    Data2=Slider(5, range=0..100))
adjustpos_42 = AdjustElementPositioning(ElementsToAdjust=tb_4, Margin="10, 0, 0, 5", AbsolutePositioning=False, HorizontalAlignment=0)
adjustpos_43 = AdjustElementPositioning(
    ElementsToAdjust=pulldown_20,
    AbsolutePositioning=False,
    Width=Slider(245, range=0..1000),
    Height=Slider(35, range=0..100),
    HorizontalAlignment=0)
adjustpos_44 = AdjustElementPositioning(
    ElementsToAdjust=[slider_5, slider_4],
    Margin="5, 5, 10, 0",
    AbsolutePositioning=False,
    Width=Slider(240, range=0..1000),
    HorizontalAlignment=0)
stack_26 = CreateStack(UIElements=entwine_37, Horizontal=True)
adjustpos_45 = AdjustElementPositioning(ElementsToAdjust=[button_24, button_23, button_5], Margin="5, 5, 0, 0", AbsolutePositioning=False, HorizontalAlignment=0)
entwine_39 = Entwine(Branch00=tb_6, Branch01=stack_25, FlattenInputs=True)  # -> flatten(Result)
entwine_40 = Entwine(Branch00=label_25, Branch01=true_button_9, Branch02=pulldown_19, FlattenInputs=True)  # -> flatten(Result)
adjustpos_46 = AdjustElementPositioning(ElementsToAdjust=tb_6, Margin="5, 10, 0, 5", AbsolutePositioning=False, HorizontalAlignment=0)
adjustpos_47 = AdjustElementPositioning(ElementsToAdjust=tb_8, Margin="10, 5, 0, 10", AbsolutePositioning=False, HorizontalAlignment=0)
adjustpos_48 = AdjustElementPositioning(
    ElementsToAdjust=pulldown_19,
    Margin=format_26,
    AbsolutePositioning=False,
    Width=Slider(245, range=0..300),
    HorizontalAlignment=0,
    VerticalAlignment=2)
adjustpos_49 = AdjustElementPositioning(
    ElementsToAdjust=pulldown_21,
    AbsolutePositioning=False,
    Width=Slider(245, range=0..1000),
    Height=Slider(35, range=0..100),
    HorizontalAlignment=0)
adjustpos_50 = AdjustElementPositioning(ElementsToAdjust=tb_9, Margin="10, 0, 0, 5", AbsolutePositioning=False, HorizontalAlignment=0)
adjustpos_51 = AdjustElementPositioning(ElementsToAdjust=true_button_9, Margin=format_27, AbsolutePositioning=False, HorizontalAlignment=0, VerticalAlignment=2)
adjustpos_52 = AdjustElementPositioning(ElementsToAdjust=tb_10, Margin="10, 0, 0, 5", AbsolutePositioning=False, HorizontalAlignment=0)
adjustpos_53 = AdjustElementPositioning(
    ElementsToAdjust=[button_20, button_21, button_22],
    Margin="5, 5, 0, 0",
    AbsolutePositioning=False,
    HorizontalAlignment=0)
adjustpos_54 = AdjustElementPositioning(ElementsToAdjust=tb_7, Margin="5, 0, 0, 5", AbsolutePositioning=False, HorizontalAlignment=0)
adjustpos_55 = AdjustElementPositioning(
    ElementsToAdjust=tb_3,
    Margin=format_28,
    AbsolutePositioning=False,
    Width=Slider(245, range=0..300),
    HorizontalAlignment=0,
    VerticalAlignment=2)
stack_27 = CreateStack(UIElements=entwine_40, Horizontal=invert(True))
adjustpos_56 = AdjustElementPositioning(ElementsToAdjust=true_button_10, AbsolutePositioning=False, HorizontalAlignment=0)

# ----
gate_2 = StreamGate(Stream="No available simulation for this model.", Gate=freeze_gate_12)  # -> Target0, Target1
gate_3 = StreamGate(Stream="No available simulation for this model.", Gate=freeze_gate_10)  # -> Target0, Target1
adjustpos_57 = AdjustElementPositioning(ElementsToAdjust=tb_5, Margin="5, 0, 0, 5", AbsolutePositioning=False, HorizontalAlignment=0)

visualize_lca_gwp_by_element_2 = RemoteReceiver(visualize_lca_gwp_by_element)
rec_11 = DataRecorder(visualize_lca_gwp_by_element_2, DataLimit=-2, RecordData=True)
ma_11 = MassAddition(Input=rec_11)  # -> Result, PartialResults
visualize_lca_gwp_by_element_3 = RemoteReceiver(visualize_lca_gwp_by_element)
entwine_41 = Entwine(Branch00=ma_11.Result, Branch01=lca_window_status, FlattenInputs=True)
rec_12 = DataRecorder(entwine_41, DataLimit=2, RecordData=True)
or_2 = GateOr(A=visualize_lca_gwp_by_element_3, B=event_5.Data)
item_5 = ListItem(List=rec_12, Index=0, Wrap=True)  # -> Item2, Item1, Item
py3_7 = Python3Script(get=or_2)  # -> mpl_folder; same code as py3_4
equals_12 = Equality(FirstNumber=item_5.Item2, SecondNumber=item_5.Item1)  # -> Equality, Inequality
bang_3 = ExplodeTree(Data=equals_12.Inequality)  # -> Branch0, Branch1
nextfile_2 = NextAvailableFilename(Format="LCA{000}.png", FolderPath=py3_7, Trigger=or_2)
py3_8 = Python3Script(x=bang_3.Branch0, y=bang_3.Branch1)  # -> a; same code as py3_5
event_20 = EventGate(Data=py3_8)  # -> Data, IsNew
freeze_gate_13 = StreamFreezeGate(Data=py3_8, PassingSwitch=event_20.IsNew)
event_21 = EventGate(Data=freeze_gate_13)  # -> Data, IsNew
launchwin_2 = LaunchWindow(
    Show=event_21.Data,
    Name="LCA visualisations",
    Width=bar_chart_popup_win_width_2,
    Height=bar_chart_popup_win_height_2,
    ChildStatus=1,
    EnableHorizScroll=False)
panel_68 = Panel(event_21.Data)
visualize_lca_gwp_by_element_4 = RemoteReceiver(visualize_lca_gwp_by_element)
winstat_2 = WindowStatus(Window=launchwin_2)
lca_status = RemoteSender(winstat_2)
py3_9 = Python3Script(window=launchwin_2, activate=visualize_lca_gwp_by_element_4)  # same code as py3_6
winprops_2 = SetWindowProperties(
    Window=launchwin_2,
    StartingLocation=pt_8,
    Theme=0,
    AccentColor=heath_accent_color_10,
    ShowTitleBar=True,
    BackgroundColor=RGB(255, 255, 255),
    ScaleFactor=1)

lca_status_2 = RemoteReceiver(lca_status)
expression_8 = Expression(x="Hidden", y=lca_status_2, Expression="x=y")
expire_2 = ExpireObject(ObjectToExpire=objbynn_3, Expire=expression_8)

daylight_simulation_compare_pop_up_2 = RemoteReceiver(daylight_simulation_compare_pop_up)
rec_13 = DataRecorder(daylight_simulation_compare_pop_up_2, DataLimit=-2, RecordData=True)
ma_12 = MassAddition(Input=rec_13)  # -> Result, PartialResults
daylight_simulation_compare_pop_up_3 = RemoteReceiver(daylight_simulation_compare_pop_up)
entwine_42 = Entwine(Branch00=ma_12.Result, Branch01=sda_window_status, FlattenInputs=True)
rec_14 = DataRecorder(entwine_42, DataLimit=2, RecordData=True)
item_6 = ListItem(List=rec_14, Index=0, Wrap=True)  # -> Item2, Item1, Item
and_2 = GateAnd(A=daylight_simulation_compare_pop_up_3, B=event_6.Data)
equals_13 = Equality(FirstNumber=item_6.Item2, SecondNumber=item_6.Item1)  # -> Equality, Inequality
py3_10 = Python3Script(get=and_2)  # -> mpl_folder; same code as py3_4
bang_4 = ExplodeTree(Data=equals_13.Inequality)  # -> Branch0, Branch1
py3_11 = Python3Script(x=bang_4.Branch0, y=bang_4.Branch1)  # -> a; same code as py3_5
nextfile_3 = NextAvailableFilename(Format="SDA{000}.png", FolderPath=py3_10, Trigger=and_2)
event_22 = EventGate(Data=py3_11)  # -> Data, IsNew
freeze_gate_14 = StreamFreezeGate(Data=py3_11, PassingSwitch=event_22.IsNew)
event_23 = EventGate(Data=freeze_gate_14)  # -> Data, IsNew
panel_69 = Panel(event_23.Data)
launchwin_3 = LaunchWindow(
    Show=event_23.Data,
    Name="Spatial daylight autonomy",
    Width=bar_chart_popup_win_width_4,
    Height=bar_chart_popup_win_height_4,
    ChildStatus=1,
    EnableHorizScroll=False)
daylight_simulation_compare_pop_up_4 = RemoteReceiver(daylight_simulation_compare_pop_up)
winstat_3 = WindowStatus(Window=launchwin_3)
spacial_daylight_autonomy_status = RemoteSender(winstat_3)
winprops_3 = SetWindowProperties(
    Window=launchwin_3,
    StartingLocation=pt_10,
    Theme=0,
    AccentColor=heath_accent_color_11,
    ShowTitleBar=True,
    BackgroundColor=RGB(255, 255, 255),
    ScaleFactor=1)
py3_12 = Python3Script(window=launchwin_3, activate=daylight_simulation_compare_pop_up_4)  # same code as py3_6

spacial_daylight_autonomy_status_2 = RemoteReceiver(spacial_daylight_autonomy_status)
expression_9 = Expression(x="Hidden", y=spacial_daylight_autonomy_status_2, Expression="x=y")
expire_3 = ExpireObject(ObjectToExpire=objbynn_5, Expire=expression_9)

daylight_simulation_type_2 = RemoteReceiver(daylight_simulation_type)
equals_14 = Equality(FirstNumber="5", SecondNumber=daylight_simulation_type_2)  # -> Equality, Inequality

# ---- group: Geometry module
# IMPORT GEOMETRY
panel_70 = Panel("""This document is currently in {0}.
Honeybee models require models in meters.""")
panel_71 = Panel("""Room
Window
Adjacent
Context
None""")
panel_72 = Panel("""None
Room
Window
Adjacent
Context
All""")
panel_73 = Panel("""Could not save geometry. 
It was not of the correct type.""")  # disabled
number_slider_17 = Slider(10, range=0..10)
number_slider_18 = Slider(30, range=5..95)
button_25 = CreateButton(ButtonName="Change document units", ButtonStyle=0)
tb_11 = CreateTextBlock(TextSize=12, Justification=0)
label_34 = CreateLabel(LabelText="Import geometry", LabelSize=18, Justification=0)
listbox = CreateListBox(ListItems=panel_72, SelectedIndex=0, Height=100)
pulldown_22 = CreatePulldownMenu(Label="Geometry type", ListItems=panel_71, showLabel=True)
button_26 = CreateButton(ButtonName="Save geometry", ButtonStyle=0)
values_75 = ValueListener(Elements=button_26, SomeProperty=True)  # -> Values, Indices
label_35 = CreateLabel(LabelText=panel_73, LabelSize=12, Justification=0)  # disabled
presavegeometry = RemoteSender(values_75.Values)
label_36 = CreateLabel(LabelText="Preview geometry", LabelSize=18, Justification=0)
rectangle = Rectangle(Plane=PlaneXY(0, 0, 0), XSize=number_slider_17, YSize=number_slider_17, Radius=0)  # -> Rectangle, Length
checkbox_3 = CreateCheckbox(Label="Window generation from window-wall-ratio [%]", StartingValue=False)
label_37 = CreateLabel(LabelText="Automatically generate windows", LabelSize=18, Justification=0)
number_slider_19 = Slider(15, range=0..20)
slider_6 = CreateSlider(
    Slider=number_slider_18,
    SnapValue=Slider(5, range=0..10),
    ShowBounds=True,
    ShowTicks=True,
    ShowTooltip=True,
    ShowValLabel=True,
    showLabel=True)
values_76 = ValueListener(Elements=listbox, SomeProperty=True)  # -> Values, Indices
values_77 = ValueListener(Elements=button_25, SomeProperty=True)  # -> Values, Indices
values_78 = ValueListener(Elements=pulldown_22, SomeProperty=True)  # -> Values, Indices
pt_11 = ConstructPoint(XCoordinate=Slider(10, range=0..10), YCoordinate=Slider(-20, range=-100..0), ZCoordinate=0)
previewtype = RemoteSender(values_76.Values)
change_document_units = RemoteSender(values_77.Values)
bool_12 = Boolean(values_76.Indices)
geometrytype_validate = RemoteSender(values_78.Indices)
geometrytype = RemoteSender(values_78.Values)
adjustelem_12 = AdjustElementAppearance(ElementsToAdjust=tb_11, Foreground=ColourSwatch(SwatchColor=RGB(0, 0, 0)))
shapes = CreateShapes(Shapes=rectangle.Rectangle, StrokeColor=RGB(0, 0, 0), Scale=1, ClickMode=3)  # -> flatten(Shape)
values_79 = ValueListener(Elements=slider_6, SomeProperty=True)  # -> Values, Indices
rectangle_2 = Rectangle(Plane=pt_11, XSize=number_slider_19, YSize=number_slider_19, Radius=0)  # -> Rectangle, Length
tooltip_6 = AttachTooltipToElement(ElementsToAttachTo=slider_6, TooltipContent="Doubleclick to input value", ShowDelay=500, Duration=2000)
setlist = SetListContents(ListToModify=pulldown_22, NewListContents=panel_71)
values_80 = ValueListener(Elements=checkbox_3, SomeProperty=True)  # -> Values, Indices
entwine_43 = Entwine(Branch00=checkbox_3, Branch01=slider_6, FlattenInputs=True)  # -> flatten(Result)
filter_18 = StreamFilter(Gate=values_80.Values, Stream0="0", Stream1=values_79.Values)
entwine_44 = Entwine(Branch00=tb_11, Branch01=button_25, FlattenInputs=True)  # -> flatten(Result)
division_5 = Division(A=filter_18, B="100")
stack_28 = CreateStack(UIElements=entwine_43, Horizontal=invert(True))
stack_29 = CreateStack(UIElements=entwine_44, Horizontal=invert(True))
generate_wwr = RemoteSender(division_5)
hideshow_2 = HideShowElement(ElementToHideShow=slider_6, Show=values_80.Values, Collapse=True, Disable=False)
entwine_45 = Entwine(Branch00=label_37, Branch01=stack_28, FlattenInputs=True)  # -> flatten(Result)
adjustpos_58 = AdjustElementPositioning(
    ElementsToAdjust=listbox,
    AbsolutePositioning=False,
    Width=Slider(150, range=0..300),
    Height=Slider(150, range=0..300),
    HorizontalAlignment=0)
# FLY!
# Simulations
# Metahopper recursions
# Launch website
entwine_46 = Entwine(Branch00=label_34, Branch01=pulldown_22, Branch02=button_26, FlattenInputs=True)  # -> flatten(Result)
adjustpos_59 = AdjustElementPositioning(
    ElementsToAdjust=stack_29,
    Margin="0, 5, 0, 5",
    AbsolutePositioning=False,
    Width=Slider(250, range=0..800),
    HorizontalAlignment=1)
swatch = ColourSwatch(SwatchColor=RGB(255, 0, 0))  # disabled
swatch_2 = ColourSwatch(SwatchColor=RGBA(128, 0, 102, 100))
stack_30 = CreateStack(UIElements=entwine_45, Horizontal=invert(True))
swatch_3 = ColourSwatch(SwatchColor=RGBA(4, 128, 0, 100))
swatch_4 = ColourSwatch(SwatchColor=RGBA(0, 17, 128, 100))
swatch_5 = ColourSwatch(SwatchColor=RGBA(128, 125, 0, 100))
border = CreateBorder(
    UIElement=stack_29,
    BorderThickness=Slider(1, range=0..10),
    BorderColor=ColourSwatch(SwatchColor=RGB(255, 0, 0)),
    CornerRadius=Slider(0, range=0..10))
adjustpos_60 = AdjustElementPositioning(ElementsToAdjust=slider_6, Margin="0, 10, 0, 0", AbsolutePositioning=False, HorizontalAlignment=0, VerticalAlignment=2)
stack_31 = CreateStack(UIElements=entwine_46, Horizontal=invert(True))
adjustpos_61 = AdjustElementPositioning(
    ElementsToAdjust=[button_26, pulldown_22],
    AbsolutePositioning=False,
    Width=Slider(180, range=0..300),
    HorizontalAlignment=0)
adjustelem_13 = AdjustElementAppearance(ElementsToAdjust=label_35, Foreground=swatch)  # disabled
setshapes = SetShapes(
    ShapeToModify=shapes,
    ShapeCurves=rectangle_2.Rectangle,
    FillColors=ColourSwatch(SwatchColor=RGB(180, 180, 180)),
    StrokeColors=ColourSwatch(SwatchColor=RGB(255, 255, 255)),
    Scale=1)

# ----
shapes_2 = CreateShapes(Shapes=rectangle.Rectangle, StrokeColor=RGB(0, 0, 0), Scale=1, ClickMode=3)  # -> flatten(Shape)
shapes_3 = CreateShapes(Shapes=rectangle.Rectangle, StrokeColor=RGB(0, 0, 0), Scale=1, ClickMode=3)  # -> flatten(Shape)
shapes_4 = CreateShapes(Shapes=rectangle.Rectangle, StrokeColor=RGB(0, 0, 0), Scale=1, ClickMode=3)  # -> flatten(Shape)
shapes_5 = CreateShapes(Shapes=rectangle.Rectangle, StrokeColor=RGB(0, 0, 0), Scale=1, ClickMode=3)  # -> flatten(Shape)
shapes_6 = CreateShapes(Shapes=rectangle.Rectangle, StrokeColor=RGB(0, 0, 0), Scale=1, ClickMode=3)  # -> flatten(Shape)

# ---- group: Geometry module
# Document units
doc_units = DocumentUnits()
change_document_units_2 = RemoteReceiver(change_document_units)
document_units = RemoteSender(doc_units)
gate_4 = StreamGate(Stream="4", Gate=change_document_units_2)  # -> Target0, Target1
unit_warning = UnitWarning(UnitSystem=gate_4.Target1)

# ----
entwine_47 = Entwine(
    Branch00=shapes,
    Branch01=shapes_2,
    Branch02=shapes_3,
    Branch03=shapes_6,
    Branch04=shapes_4,
    Branch05=shapes_5,
    FlattenInputs=True)  # -> flatten(Result)
adjustpos_62 = AdjustElementPositioning(ElementsToAdjust=button_25, AbsolutePositioning=False, HorizontalAlignment=1)
setshapes_2 = SetShapes(
    ShapeToModify=shapes_2,
    ShapeCurves=rectangle_2.Rectangle,
    FillColors=swatch_3,
    StrokeColors=ColourSwatch(SwatchColor=RGB(255, 255, 255)),
    Scale=1)
setshapes_3 = SetShapes(
    ShapeToModify=shapes_3,
    ShapeCurves=rectangle_2.Rectangle,
    FillColors=swatch_2,
    StrokeColors=ColourSwatch(SwatchColor=RGB(255, 255, 255)),
    Scale=1)
setshapes_4 = SetShapes(
    ShapeToModify=shapes_6,
    ShapeCurves=rectangle_2.Rectangle,
    FillColors=swatch_4,
    StrokeColors=ColourSwatch(SwatchColor=RGB(255, 255, 255)),
    Scale=1)
setshapes_5 = SetShapes(
    ShapeToModify=shapes_4,
    ShapeCurves=rectangle_2.Rectangle,
    FillColors=swatch_5,
    StrokeColors=ColourSwatch(SwatchColor=RGB(255, 255, 255)),
    Scale=1)
setshapes_6 = SetShapes(
    ShapeToModify=shapes_5,
    ShapeCurves=rectangle_2.Rectangle,
    FillColors=ColourSwatch(SwatchColor=RGB(230, 230, 230)),
    StrokeColors=ColourSwatch(SwatchColor=RGB(255, 255, 255)),
    Scale=1)

# ----
# Document unit warning text
location_6 = Data(border)

# ----
# Generate using WWR
location_7 = Data(stack_30)

# ----
# Model visualization
# Model creation
# Zoom and bake geometry
# Geometry handling
# Assign type
assign_type = Data(stack_31)

entwine_48 = Entwine(Branch00=location_6, Branch01=assign_type, FlattenInputs=True)  # -> flatten(Result)
stack_32 = CreateStack(UIElements=entwine_48, Horizontal=invert(True))

presavegeometry_2 = RemoteReceiver(presavegeometry)
document_units_2 = RemoteReceiver(document_units)
previewtype_2 = RemoteReceiver(previewtype)
document_units_3 = RemoteReceiver(document_units)
document_units_4 = RemoteReceiver(document_units)
document_units_5 = RemoteReceiver(document_units)
previewtype_3 = RemoteReceiver(previewtype)
previewtype_4 = RemoteReceiver(previewtype)
previewtype_5 = RemoteReceiver(previewtype)
expression_10 = Expression(x="Room", y=previewtype_2, Expression="x=y")
expression_11 = Expression(x=document_units_2, y="Meters", Expression="x=y")
expression_12 = Expression(x=previewtype_2, y="All", Expression="x=y")
expression_13 = Expression(x=document_units_3, y="Meters", Expression="x=y")
expression_14 = Expression(x=document_units_4, y="Meters", Expression="x=y")
expression_15 = Expression(x=document_units_5, y="Meters", Expression="x=y")
expression_16 = Expression(x="Window", y=previewtype_5, Expression="x=y")
expression_17 = Expression(x=previewtype_5, y="All", Expression="x=y")
expression_18 = Expression(x="Adjacent", y=previewtype_3, Expression="x=y")
expression_19 = Expression(x=previewtype_3, y="All", Expression="x=y")
expression_20 = Expression(x=previewtype_4, y="All", Expression="x=y")
expression_21 = Expression(x="Context", y=previewtype_4, Expression="x=y")
geometrytype_2 = RemoteReceiver(geometrytype)
or_3 = GateOr(A=expression_10, B=expression_12)
or_4 = GateOr(A=expression_16, B=expression_17)
or_5 = GateOr(A=expression_21, B=expression_20)
or_6 = GateOr(A=expression_18, B=expression_19)
gate_5 = StreamGate(Stream="Room", Gate=or_3)  # -> Target0, Target1
gate_6 = StreamGate(Stream="Adjacent", Gate=or_6)  # -> Target0, Target1
gate_7 = StreamGate(Stream="Window", Gate=or_4)  # -> Target0, Target1
gate_8 = StreamGate(Stream="Context", Gate=or_5)  # -> Target0, Target1
geometrytype_validate_2 = RemoteReceiver(geometrytype_validate)

# ---- group: Geometry module (continued)
document_units_6 = RemoteReceiver(document_units)
case = TextCase(Text=document_units_6, Culture=127)  # -> UpperCase, LowerCase
format_29 = Format(Format=panel_70, Culture=127, Data0=case.LowerCase)
settextblock_4 = SetTextBlockContents(TextBlockToModify=tb_11, NewTextBlockContents=format_29)
stack_33 = CreateStack(UIElements=entwine_47, Horizontal=invert(True))
document_units_7 = RemoteReceiver(document_units)
entwine_49 = Entwine(Branch00=stack_33, Branch01=listbox, FlattenInputs=True)  # -> flatten(Result)
stack_34 = CreateStack(UIElements=entwine_49, Horizontal=True)
expression_22 = Expression(x=document_units_7, y="Meters", Expression="x=y")
entwine_50 = Entwine(Branch00=label_36, Branch01=stack_34, FlattenInputs=True)  # -> flatten(Result)
adjustpos_63 = AdjustElementPositioning(
    ElementsToAdjust=[shapes_5, shapes_4, shapes_6, shapes_3, shapes_2, shapes],
    Margin=format_10,
    AbsolutePositioning=False,
    HorizontalAlignment=0)
hideshow_3 = HideShowElement(ElementToHideShow=border, Show=invert(expression_22), Collapse=True, Disable=False)
adjustpos_64 = AdjustElementPositioning(ElementsToAdjust=stack_33, Margin=format_11, AbsolutePositioning=False, HorizontalAlignment=0)

# ----
# Preview
preview = Data(entwine_50)

# ----
# Cyclops
panel_74 = Panel("""Sunlight hour analysis
Sky component analysis
Culmulative radiation
Daylight factor
Useful daylight illuminance
Daylight autonomy
Daylight metrics""")
panel_75 = Panel("""10000
500
60000""")
panel_76 = Panel("""From selected model
Live from Rhino import""")
opacity = Slider(30, range=0..255)
number_slider_20 = Slider(30, range=5..95)
dom_3 = ConstructDomain(DomainStart=0, DomainEnd="1200")
dom_4 = ConstructDomain(DomainStart=0, DomainEnd="20")
dom_5 = ConstructDomain(DomainStart=0, DomainEnd="100")
dom_6 = ConstructDomain(DomainStart=0, DomainEnd="10")
panel_77 = Panel("""Average
Minimum
Maximum""")
radiobtn = CreateRadioButton(RadioButtonName=panel_76, RadioButtonGroup="0", InitiallySelected=invert(False))
checkbox_4 = CreateCheckbox(Label="Window generation from window-wall-ratio [%]", StartingValue=False)
label_38 = CreateLabel(LabelText="Automatically generate windows", LabelSize=18, Justification=0)
button_27 = CreateButton(ButtonName="Zoom", ButtonStyle=0)
pulldown_23 = CreatePulldownMenu(Label="Select simulation", ListItems=panel_74, SelectedIndex="0", showLabel=False)
button_28 = CreateButton(ButtonName="Bake", ButtonStyle=0)
values_81 = ValueListener(Elements=button_28, SomeProperty=True)  # -> Values, Indices
label_39 = CreateLabel(LabelText="Select input geometry", LabelSize=18, Justification=0)
label_40 = CreateLabel(LabelText="No model selected...", LabelSize=12, Justification=1)
label_41 = CreateLabel(LabelText="Select daylight simulation", LabelSize=18, Justification=0)
label_42 = CreateLabel(LabelText="Preview geometry", LabelSize=18, Justification=0)
slider_7 = CreateSlider(
    Slider=opacity,
    SnapValue=Slider(5, range=0..10),
    ShowBounds=False,
    ShowTicks=False,
    ShowTooltip=True,
    ShowValLabel=False,
    showLabel=True)
slider_8 = CreateSlider(
    Slider=number_slider_20,
    SnapValue=Slider(5, range=0..10),
    ShowBounds=True,
    ShowTicks=True,
    ShowTooltip=True,
    ShowValLabel=True,
    showLabel=True)
freeze_gate_15 = StreamFreezeGate(Data=values_81.Values, PassingSwitch=invert(values_81.Values))
checkbox_5 = CreateCheckbox(Label="Filter results below a certain threshold", StartingValue=False)
slider_9 = CreateSlider(Slider=Slider(0, range=0..2000), ShowBounds=False, ShowTicks=False, ShowTooltip=True, ShowValLabel=True, showLabel=False)
pulldown_24 = CreatePulldownMenu(Label="Illuminance", ListItems=panel_77, showLabel=True)
label_43 = CreateLabel(LabelText="Amount of geometry above the threshold: %", LabelSize=12, Justification=0)
values_82 = ValueListener(Elements=button_27, SomeProperty=True)  # -> Values, Indices
bool_13 = Boolean(invert(freeze_gate_15))
values_83 = ValueListener(Elements=pulldown_23, SomeProperty=True)  # -> Values, Indices
stack_35 = CreateStack(UIElements=radiobtn, Horizontal=invert(True))
values_84 = ValueListener(Elements=radiobtn, SomeProperty=True)  # -> flatten(Values), Indices
zoom_cyclops_visualization = RemoteSender(values_82.Values)
values_85 = ValueListener(Elements=slider_7, SomeProperty=True)  # -> Values, Indices
values_86 = ValueListener(Elements=slider_8, SomeProperty=True)  # -> Values, Indices
tooltip_7 = AttachTooltipToElement(ElementsToAttachTo=slider_7, TooltipContent="Doubleclick to input value", ShowDelay=500, Duration=2000)
rec_15 = DataRecorder(bool_13, DataLimit=-10, RecordData=True)
tooltip_8 = AttachTooltipToElement(ElementsToAttachTo=slider_8, TooltipContent="Doubleclick to input value", ShowDelay=500, Duration=2000)
values_87 = ValueListener(Elements=pulldown_24, SomeProperty=True)  # -> Values, Indices
values_88 = ValueListener(Elements=checkbox_5, SomeProperty=True)  # -> Values, Indices
cyclops_select_simulation_index = RemoteSender(values_83.Indices)
cyclops_select_simulation_index_2 = RemoteReceiver(cyclops_select_simulation_index)
cyclops_select_simulation_index_3 = RemoteReceiver(cyclops_select_simulation_index)
larger = LargerThan(FirstNumber=cyclops_select_simulation_index_3, SecondNumber="2")  # -> LargerThan, OrEqualTo
filter_19 = StreamFilter(
    Gate=cyclops_select_simulation_index_2,
    Stream0=Slider(6, range=0..10),
    Stream1="27",
    Stream2=Slider(700, range=0..1000),
    Stream3="1",
    Stream4="0",
    Stream5="0",
    Stream6="0")
cyclops_select_simulation = RemoteSender(values_83.Values)
values_89 = ValueListener(Elements=checkbox_4, SomeProperty=True)  # -> Values, Indices
cull_2 = CullPattern(List=values_84.Values, CullPattern=values_84.Values)
cyclops_preview_opacity = RemoteSender(values_85.Values)
cyclops_select_simulation_2 = RemoteReceiver(cyclops_select_simulation)
cyclops_filter_checkbox = RemoteSender(values_88.Values)
entwine_51 = Entwine(Branch00=stack_35, Branch01=label_40, FlattenInputs=True)  # -> flatten(Result)
cyclops_metric_option = RemoteSender(values_87.Indices)
cyclops_metric_option_2 = RemoteReceiver(cyclops_metric_option)
item_7 = ListItem(List=panel_75, Index=cyclops_metric_option_2, Wrap=True)
dom_7 = ConstructDomain(DomainStart=0, DomainEnd=item_7)
filter_20 = StreamFilter(
    Gate=cyclops_select_simulation_index_2,
    Stream0=dom_6,
    Stream1=dom_5,
    Stream2=dom_3,
    Stream3=dom_4,
    Stream4=dom_5,
    Stream5=dom_5,
    Stream6=dom_7)
setslider_3 = SetSlider(UISlider=slider_9, Value=filter_19, Range=filter_20)
int_9 = Integer(rec_15)
entwine_52 = Entwine(Branch00=checkbox_4, Branch01=slider_8, FlattenInputs=True)  # -> flatten(Result)
filter_21 = StreamFilter(Gate=values_89.Values, Stream0="0", Stream1=values_86.Values)
entwine_53 = Entwine(Branch00=pulldown_23, Branch01=button_27, Branch02=button_28, FlattenInputs=True)  # -> flatten(Result)
index = ItemIndex(List=values_84.Values, Item=cull_2)
cyclops_filter_checkbox_2 = RemoteReceiver(cyclops_filter_checkbox)
ma_13 = MassAddition(Input=int_9)  # -> Result, PartialResults
values_90 = ValueListener(Elements=slider_9, SomeProperty=True)  # -> Values, Indices
adjustelem_14 = AdjustElementAppearance(ElementsToAdjust=label_40, Foreground=ColourSwatch(SwatchColor=RGB(255, 0, 0)), FontSize=Slider(10, range=5..25))
stack_36 = CreateStack(UIElements=entwine_51, Horizontal=True)
division_6 = Division(A=filter_21, B="100")
cyclops_select_geometry = RemoteSender(index)
stack_37 = CreateStack(UIElements=entwine_52, Horizontal=invert(True))
event_24 = EventGate(Data=ma_13.Result)  # -> Data, IsNew
stack_38 = CreateStack(UIElements=entwine_53, Horizontal=True)
cyclops_slider_value = RemoteSender(values_90.Values)
expression_23 = Expression(x="Daylight metrics", y=cyclops_select_simulation_2, Expression="x=y")
cyclops_generate_wwr = RemoteSender(division_6)
tab_load_inspect_model_10 = RemoteReceiver(tab_load_inspect_model)
dam_11 = DataDam(DataA=event_24.Data, BufferDelay=2500000, BufferMode=2)
hideshow_4 = HideShowElement(ElementToHideShow=[label_43, slider_9], Show=cyclops_filter_checkbox_2, Collapse=True, Disable=False)
tooltip_9 = AttachTooltipToElement(ElementsToAttachTo=slider_9, TooltipContent="Doubleclick to input value", ShowDelay=500, Duration=2000)
hideshow_5 = HideShowElement(ElementToHideShow=pulldown_24, Show=expression_23, Collapse=True, Disable=False)
equals_15 = Equality(FirstNumber=event_24.Data, SecondNumber=dam_11)  # -> Equality, Inequality
entwine_54 = Entwine(Branch00=label_42, Branch01=slider_7, FlattenInputs=True)  # -> flatten(Result)
entwine_55 = Entwine(Branch00=label_38, Branch01=stack_37, FlattenInputs=True)  # -> flatten(Result)
entwine_56 = Entwine(Branch00=pulldown_24, Branch01=checkbox_5, Branch02=slider_9, Branch03=label_43, FlattenInputs=True)  # -> flatten(Result)
adjustpos_65 = AdjustElementPositioning(ElementsToAdjust=slider_7, Margin="0, 10, 0, 0", AbsolutePositioning=False, HorizontalAlignment=0, VerticalAlignment=2)
adjustpos_66 = AdjustElementPositioning(ElementsToAdjust=slider_8, Margin="0, 10, 0, 0", AbsolutePositioning=False, HorizontalAlignment=0, VerticalAlignment=2)
hideshow_6 = HideShowElement(ElementToHideShow=slider_8, Show=values_89.Values, Collapse=True, Disable=False)
event_25 = EventGate(Data=equals_15.Inequality)  # -> Data, IsNew
adjustpos_67 = AdjustElementPositioning(
    ElementsToAdjust=pulldown_23,
    Margin="0, 0, 0, 0",
    AbsolutePositioning=False,
    Width=Slider(200, range=0..350),
    Height=Slider(38, range=0..100),
    HorizontalAlignment=0)
stack_39 = CreateStack(UIElements=entwine_54, Horizontal=invert(True))
stack_40 = CreateStack(UIElements=entwine_55, Horizontal=invert(True))
adjustpos_68 = AdjustElementPositioning(
    ElementsToAdjust=pulldown_24,
    Margin="0, 0, 0, 0",
    AbsolutePositioning=False,
    Width=Slider(200, range=0..1000),
    HorizontalAlignment=0)
stack_41 = CreateStack(UIElements=entwine_56, Horizontal=invert(True))
adjustpos_69 = AdjustElementPositioning(
    ElementsToAdjust=slider_9,
    Margin="0, 5, 0, -5",
    AbsolutePositioning=False,
    Width=Slider(300, range=0..1000),
    HorizontalAlignment=0)

entwine_57 = Entwine(Branch00=label_41, Branch01=button_6, FlattenInputs=True)  # -> flatten(Result)
stack_42 = CreateStack(UIElements=entwine_57, Horizontal=True)

# ----
# Live from Rhino
cyclops_select_geometry_2 = RemoteReceiver(cyclops_select_geometry)
windows = Curve([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])
windows_2 = Curve([<curve referenced from the Rhino model> x3])
context = Geometry(<extrusion referenced from the Rhino model>)
rooms = Geometry(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)
rooms_2 = Geometry(<extrusion referenced from the Rhino model>)
merge = Merge(Data1=rooms, Data2=rooms_2)
merge_2 = Merge(Data1=windows, Data2=windows_2)

cyclops_metric_option_3 = RemoteReceiver(cyclops_metric_option)
cyclops_slider_value_2 = RemoteReceiver(cyclops_slider_value)
cyclops_slider_value_3 = RemoteReceiver(cyclops_slider_value)
cyclops_slider_value_4 = RemoteReceiver(cyclops_slider_value)
cyclops_slider_value_5 = RemoteReceiver(cyclops_slider_value)
division_7 = Division(A=cyclops_slider_value_2, B="100")
cyclops_filter_checkbox_3 = RemoteReceiver(cyclops_filter_checkbox)
cyclops_filter_checkbox_4 = RemoteReceiver(cyclops_filter_checkbox)
division_8 = Division(A=cyclops_slider_value_3, B="100")
cyclops_filter_checkbox_5 = RemoteReceiver(cyclops_filter_checkbox)
division_9 = Division(A=cyclops_slider_value_4, B="100")
cyclops_select_simulation_index_4 = RemoteReceiver(cyclops_select_simulation_index)

cyclops_select_simulation_3 = RemoteReceiver(cyclops_select_simulation)
expression_24 = Expression(x=panel_31, y=cyclops_select_simulation_3, Expression="x=y")
expression_25 = Expression(x=cyclops_select_simulation_3, y="Sunlight hour analysis", Expression="x=y")
expression_26 = Expression(x=cyclops_select_simulation_3, y="Culmulative radiation", Expression="x=y")
or_7 = GateOr(A=expression_24, B=expression_25, C=expression_26)
not = GateNot(A=or_7)

# ---- group: Construction module (continued)
button_29 = CreateButton(ButtonName=repeat, ButtonStyle=0)
values_91 = ValueListener(Elements=button_29, SomeProperty=True)  # -> flatten(Values), Indices
adjustelem_15 = AdjustElementAppearance(
    ElementsToAdjust=[true_button_8, button_29],
    Foreground=ColourSwatch(SwatchColor=RGB(102, 51, 0)),
    FontSize=Slider(14, range=10..25))
adjustpos_70 = AdjustElementPositioning(
    ElementsToAdjust=[true_button_8, button_29],
    Margin="0, 0, 0, 0",
    AbsolutePositioning=False,
    Width=number_slider_15,
    Height=number_slider_15,
    HorizontalAlignment=0)

# ----
ma_14 = MassAddition(Input=values_91.Values)  # -> Result, PartialResults
bool_14 = Boolean(ma_14.Result)
item_8 = ListItem(List=button_29, Index=0, Wrap=True)  # -> Item, Item1, Item2, Item3
entwine_58 = Entwine(Branch00=pulldown_11, Branch01=item_8.Item, FlattenInputs=True)  # -> flatten(Result)
entwine_59 = Entwine(Branch00=pulldown_15, Branch01=item_8.Item1, FlattenInputs=True)  # -> flatten(Result)
entwine_60 = Entwine(Branch00=pulldown_13, Branch01=item_8.Item2, FlattenInputs=True)  # -> flatten(Result)
entwine_61 = Entwine(Branch00=pulldown_12, Branch01=item_8.Item3, FlattenInputs=True)  # -> flatten(Result)
stack_43 = CreateStack(UIElements=entwine_58, Horizontal=True)
stack_44 = CreateStack(UIElements=entwine_59, Horizontal=True)
stack_45 = CreateStack(UIElements=entwine_60, Horizontal=True)
stack_46 = CreateStack(UIElements=entwine_61, Horizontal=True)

freeze_gate_16 = StreamFreezeGate(Data=values_75.Values, PassingSwitch=invert(values_75.Values))
bool_15 = Boolean(invert(freeze_gate_16))
tap_4 = TapBuffer(Reset=False, Incremental=True, Valve=bool_15, Hold=True)
tab_create_model_4 = RemoteReceiver(tab_create_model)
dam_12 = DataDam(DataA=tap_4, BufferDelay=2500000, BufferMode=2)
equals_16 = Equality(FirstNumber=tap_4, SecondNumber=dam_12)  # -> Equality, Inequality

# ---- group: Construction module (continued)
freeze_gate_17 = StreamFreezeGate(Data=bool_14, PassingSwitch=bool_14)
load_construction_database = RemoteSender(bool_14)
bool_16 = Boolean(invert(freeze_gate_17))
ping_open_construction_database = RemoteSender(bool_16)
oilcan = OilCan(DataList=panel_54, Reset=recompute_3, Drop=bool_14, DropMode=3)
event_26 = EventGate(Data=oilcan)  # -> Data, IsNew
open_construction_database = RemoteSender(event_26.Data)

# ---- group: Program module (continued)
occupancy = RemoteSender(division_4)

# ----
occupancy_2 = RemoteReceiver(occupancy)

# ---- group: Analysis module (continued)
settextblock_5 = SetTextBlockContents(TextBlockToModify=tb_5, NewTextBlockContents=gate_2.Target1)
settextblock_6 = SetTextBlockContents(TextBlockToModify=tb_7, NewTextBlockContents=gate_3.Target1)

# ----
# Select subset construction
data_3 = Data(pulldown_9)
data_4 = Data(stack_43)
data_5 = Data(stack_20)
data_6 = Data(pulldown_16)
data_7 = Data(stack_45)
data_8 = Data(pulldown_14)
data_9 = Data(stack_44)
data_10 = Data(stack_46)
entwine_62 = Entwine(Branch00=data_5, Branch02=data_4, Branch04=data_9, Branch05=data_7, Branch07=data_10, FlattenInputs=True)  # -> flatten(Result)

stack_47 = CreateStack(UIElements=entwine_62, Horizontal=invert(True))

location_8 = Data(stack_47)

# ----
# Calculare LCA
entwine_63 = Entwine(
    Branch00=button_4,
    Branch01=tb_3,
    Branch02=label_29,
    Branch03=label_30,
    Branch04=label_28,
    Branch05=label_32,
    Branch06=label_31,
    Branch07=label_33,
    Branch08=true_button_10,
    Branch09=tb_10,
    FlattenInputs=True)  # -> flatten(Result)
stack_48 = CreateStack(UIElements=entwine_63, Horizontal=invert(True))
expander_4 = CreateExpander(UIElements=stack_48, Header="LCA calculation", Open=invert(True))
adjustpos_71 = AdjustElementPositioning(ElementsToAdjust=expander_4, AbsolutePositioning=False, Width=Slider(300, range=100..500), HorizontalAlignment=0)

entwine_64 = Entwine(Branch00=expander_4, Branch01=true_button_3, FlattenInputs=True)  # -> flatten(Result)
stack_49 = CreateStack(UIElements=entwine_64, Horizontal=True)
daylight_simulations = Data(stack_49)

# ----
# Run daylight simulations
entwine_65 = Entwine(Branch00=stack_26, Branch01=tb, Branch02=tb_5, Branch03=entwine_39, Branch04=tb_9, Branch05=stack_27, FlattenInputs=True)  # -> flatten(Result)
stack_50 = CreateStack(UIElements=entwine_65, Horizontal=invert(True))
expander_5 = CreateExpander(UIElements=stack_50, Header="Daylight simulation", Open=invert(True))
values_92 = ValueListener(Elements=expander_5, SomeProperty=True)  # -> Values, Indices
adjustpos_72 = AdjustElementPositioning(ElementsToAdjust=expander_5, AbsolutePositioning=False, Width=Slider(300, range=100..500), HorizontalAlignment=0)
daylight_expander_is_open = RemoteSender(values_92.Values)

entwine_66 = Entwine(Branch00=expander_5, Branch01=true_button_4, FlattenInputs=True)  # -> flatten(Result)
stack_51 = CreateStack(UIElements=entwine_66, Horizontal=True)
daylight_simulations_2 = Data(stack_51)

daylight_expander_is_open_2 = RemoteReceiver(daylight_expander_is_open)
daylight_expander_is_open_3 = RemoteReceiver(daylight_expander_is_open)

entwine_67 = Entwine(
    Branch00=label_39,
    Branch01=stack_36,
    Branch02=label_42,
    Branch03=stack_39,
    Branch04=stack_40,
    Branch05=stack_42,
    Branch06=stack_38,
    Branch07=stack_41,
    FlattenInputs=True)  # -> flatten(Result)
stack_52 = CreateStack(UIElements=entwine_67, Horizontal=invert(True))

expander_6 = CreateExpander(UIElements=stack_52, Header="Cyclops", Open=invert(True))
values_93 = ValueListener(Elements=expander_6, SomeProperty=True)  # -> Values, Indices
expander_cyclops_daylight_approximation = RemoteSender(values_93.Values)
expander_cyclops_daylight_approximation_2 = RemoteReceiver(expander_cyclops_daylight_approximation)

# ----
# Run energy simulations
entwine_68 = Entwine(
    Branch00=stack_23,
    Branch01=tb_2,
    Branch02=tb_7,
    Branch03=tb_8,
    Branch05=entwine_38,
    Branch06=tb_4,
    Branch07=stack_2,
    FlattenInputs=True)  # -> flatten(Result)
stack_53 = CreateStack(UIElements=entwine_68, Horizontal=invert(True))
expander_7 = CreateExpander(UIElements=stack_53, Header="Energy simulation", Open=invert(True))
values_94 = ValueListener(Elements=expander_7, SomeProperty=True)  # -> Values, Indices
adjustpos_73 = AdjustElementPositioning(ElementsToAdjust=expander_7, AbsolutePositioning=False, Width=Slider(300, range=100..500), HorizontalAlignment=0)
simple_energy_expander_is_open = RemoteSender(values_94.Values)

entwine_69 = Entwine(Branch00=expander_7, Branch01=true_button_5, FlattenInputs=True)  # -> flatten(Result)
stack_54 = CreateStack(UIElements=entwine_69, Horizontal=True)
energy_simulations = Data(stack_54)

# ----
# Launch cyclops info
panel_78 = Panel("""https://docs.cyclops.fosterandpartners.com/Analyse/Environment/SunlightHour
https://docs.cyclops.fosterandpartners.com/Analyse/Environment/SkyComponent
https://docs.cyclops.fosterandpartners.com/Analyse/Environment/Radiation/#cumulative-radiation
https://docs.cyclops.fosterandpartners.com/Analyse/Environment/Daylight/#daylight-factor
https://docs.cyclops.fosterandpartners.com/Analyse/Environment/Daylight/#useful-daylight-illuminance
https://docs.cyclops.fosterandpartners.com/Analyse/Environment/Daylight/#daylight-autonomy
https://docs.cyclops.fosterandpartners.com/Analyse/Environment/Daylight/#daylight-metrics""")
cyclops_select_simulation_index_5 = RemoteReceiver(cyclops_select_simulation_index)
item_9 = ListItem(List=panel_78, Index=cyclops_select_simulation_index_5, Wrap=True)

# ----
# Heath FLY!
panel_79 = Panel("""0.7.0
0.7.1
0.8.0""")

# ----
# Material database categories
material_database_categories = Panel("""Blocks and tiles
Building boards
Concrete
Insulation
Mineral materials
Paints and sealants
Solid woods
Steel and other metals
Waterproofing
Other""")
material_database_categories_2 = RemoteSender(material_database_categories)
material_database_categories_3 = RemoteReceiver(material_database_categories_2)

material_database_categories_4 = RemoteReceiver(material_database_categories_2)

# ----
# Basic material database
number_slider_21 = Slider(0.035, range=0.001..1)
basic_material_database_does_not_allow_c = Panel("""Expanded polystyrene
Mineral wool
Timber
Solid brick
Gypsum plasterboard
Medium density concrete
Ceramic and porcelain
Steel
Crystalline stone
Soil/sand/gravel""")  # "Basic material database, (does not allow comma)"
entwine_70 = Entwine(
    Branch00=Slider(0.035, range=0.001..1),
    Branch01=number_slider_21,
    Branch02=Slider(0.13, range=0.001..1),
    Branch03=Slider(0.8, range=0.001..1),
    Branch04=Slider(0.21, range=0.001..1),
    Branch05=Slider(1.65, range=0.001..5),
    Branch06=Slider(1.3, range=0.001..5),
    Branch07=Slider(50, range=0.001..100),
    Branch08=Slider(3.5, range=0.001..5),
    Branch09=Slider(2, range=0.001..5),
    FlattenInputs=True)  # -> flatten(Result)
entwine_71 = Entwine(
    Branch00=Slider(30, range=1..10000),
    Branch01=Slider(100, range=1..10000),
    Branch02=Slider(500, range=1..10000),
    Branch03=Slider(1800, range=1..10000),
    Branch04=Slider(700, range=1..10000),
    Branch05=Slider(2200, range=1..10000),
    Branch06=Slider(2300, range=1..10000),
    Branch07=Slider(7800, range=1..10000),
    Branch08=Slider(2800, range=1..10000),
    Branch09=Slider(1950, range=1..10000),
    FlattenInputs=True)  # -> flatten(Result)
entwine_72 = Entwine(
    Branch00=Slider(1450, range=1..10000),
    Branch01=Slider(1030, range=1..10000),
    Branch02=Slider(1600, range=1..10000),
    Branch03=Slider(1000, range=1..10000),
    Branch04=Slider(1000, range=1..10000),
    Branch05=Slider(1000, range=1..10000),
    Branch06=Slider(840, range=1..10000),
    Branch07=Slider(450, range=1..10000),
    Branch08=Slider(1000, range=1..10000),
    Branch09=Slider(1050, range=1..10000),
    FlattenInputs=True)  # -> flatten(Result)
entwine_73 = Entwine(
    Branch00=Slider(3, range=1..9),
    Branch01=Slider(3, range=1..9),
    Branch02=Slider(6, range=1..9),
    Branch03=Slider(0, range=0..9),
    Branch04=Slider(1, range=1..9),
    Branch05=Slider(2, range=1..9),
    Branch06=Slider(0, range=0..9),
    Branch07=Slider(7, range=1..9),
    Branch08=Slider(4, range=1..9),
    Branch09=Slider(9, range=1..9),
    FlattenInputs=True)  # -> flatten(Result)
material_database_categories_5 = RemoteReceiver(material_database_categories_2)
lng = ListLength(List=basic_material_database_does_not_allow_c)
item_10 = ListItem(List=material_database_categories_5, Index=entwine_73, Wrap=True)
repeat_2 = RepeatData(Data="inf", Length=lng)
opaquemat = HBOpaqueMaterial(
    name=basic_material_database_does_not_allow_c,
    thickness=repeat_2,
    conductivity=entwine_70,
    density=entwine_71,
    spec_heat=entwine_72,
    category=item_10)  # -> mat; plug-in component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
objtostr = HBObjectToString(hb_obj=opaquemat)  # -> hb_str; plug-in component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
lng_2 = ListLength(List=objtostr)
bool_17 = Boolean(lng_2)
getdocumentusertext = Python3Script(run=bool_17, key="Heath materials")  # -> json_string
# ---------- getdocumentusertext: Python ----------
import Rhino
import rhinoscriptsyntax as rs
import scriptcontext as sc

if run:
    sc.doc = Rhino.RhinoDoc.ActiveDoc

    json_string = rs.GetDocumentUserText(key)

    sc.doc = ghdoc
# ---------- end getdocumentusertext ----------
split = TextSplit(Text=getdocumentusertext, Separators="|")
strtoobj = HBStringToObject(hb_str=split)  # -> flatten(hb_obj); plug-in component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
decnstrmat = HBDeconstructMaterial(mat=strtoobj)  # -> values, attr_names, r_val_si, r_val_ip; plug-in component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
item_11 = ListItem(List=decnstrmat.values, Index=0, Wrap=True)  # -> flatten(Item)
mindex = MemberIndex(Set=item_11, Member=basic_material_database_does_not_allow_c)  # -> Index, Count
cull_3 = CullPattern(List=objtostr, CullPattern=invert(mindex.Count))
entwine_74 = Entwine(Branch00=cull_3, Branch01=split, FlattenInputs=True)  # -> flatten(Result)
ipy2 = IronPython2Script(materials=entwine_74)  # -> unique_materials; inputs materials: list
# ---------- ipy2: IronPython ----------
"""Grasshopper Script"""

unique_materials = []

for i in range(len(materials)):
    if materials[i] not in unique_materials:
        unique_materials.append(materials[i])
# ---------- end ipy2 ----------
join = TextJoin(Text=ipy2, Join="|")
setdocumentusertext = Python3Script(key="Heath materials", value=join)
# ---------- setdocumentusertext: Python ----------
import Rhino
import rhinoscriptsyntax as rs
import scriptcontext as sc

def modify_value(value):
    sc.doc = Rhino.RhinoDoc.ActiveDoc

    test = rs.SetDocumentUserText(key, value)

    sc.doc = ghdoc
    
if value:
    done = modify_value(value)
# ---------- end setdocumentusertext ----------

# ----
# Define program
selected_building_2 = RemoteReceiver(selected_building)
searchprog = HBSearchPrograms(bldg_prog=selected_building_2)  # -> room_prog; plug-in component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
constantschedule = HBConstantSchedule(values=Slider(1, range=0..1))  # -> report, schedule, idf_text; plug-in component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
constantschedule_2 = HBConstantSchedule(values=Slider(1, range=0..1))  # -> report, schedule, idf_text; plug-in component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
python = GhPythonScript(power_density=Slider(2.6, range=0..10), schedule=constantschedule.schedule)  # -> out, hot_water
# ---------- python: Python ----------
__author__ = "sawen"
__version__ = "2024.05.24"

import rhinoscriptsyntax as rs
from honeybee_energy.load.hotwater import ServiceHotWater as shw

if not name:
    name = "Domestic Hot Water"
    

hot_water = shw.from_watts_per_area(name, power_density, schedule)
# ---------- end python ----------
equipment = HBEquipment(watts_per_area=Slider(3.4, range=0..10), schedule=constantschedule_2.schedule, lost_fract=Slider(0.3, range=0..1))  # -> equip; plug-in component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

split_2 = TextSplit(Text=searchprog, Separators="::")
item_12 = ListItem(List=split_2, Index=0, Wrap=True)  # -> flatten(Item1), Item, Item1_2, Item2
merge_3 = Merge(Data1=item_12.Item, Data2=item_12.Item2)
branch = TreeBranch(Tree=merge_3, Path=path, MaintainPaths=True)
entwine_75 = Entwine(Branch00=branch, Branch01=selected_room_2, FlattenInputs=True)  # -> flatten(Result)
join_2 = TextJoin(Text=entwine_75, Join="::")

# ----
# Select window construction
subset_subface_window_2 = RemoteReceiver(subset_subface_window)
subset_subface_window_3 = RemoteReceiver(subset_subface_window)
null_10 = NullObject()
null_11 = NullObject()

# ----
# Select exterior construction
subset_exterior_roof_2 = RemoteReceiver(subset_exterior_roof)
subset_exterior_wall_3 = RemoteReceiver(subset_exterior_wall)
null_12 = NullObject()
null_13 = NullObject()
null_14 = NullObject()

# ----
# Select interior construction
subset_interior_floor_3 = RemoteReceiver(subset_interior_floor)
null_15 = NullObject()
null_16 = NullObject()

# ----
# Select ground construction
subset_ground_floor_2 = RemoteReceiver(subset_ground_floor)
null_17 = NullObject()

room_programs = RemoteSender(item_12.Item1)
applyloadvals = HBApplyLoadValues(room_or_program=flatten(join_2), people_per_floor=occupancy_2, infilt_per_exterior=Slider(0.0001, range=0..0.001))  # -> report, mod_obj; plug-in component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
applysetpointvals = HBApplySetpointValues(room_or_program=flatten(applyloadvals.mod_obj), cooling_setpt=cooling_setpoint_3, heating_setpt=heating_setpoint_3)  # -> report, mod_obj; plug-in component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

# ---- group: Program module (continued)
room_programs_2 = RemoteReceiver(room_programs)
setlist_2 = SetListContents(ListToModify=pulldown_7, NewListContents=room_programs_2, SelectedIndex="0")

# ----
txt_4 = Text(applysetpointvals.mod_obj)

programtype = HBProgramType(name=txt_4, base_program=applysetpointvals.mod_obj, electric_equip=equipment, hot_water=python.hot_water)  # -> program; plug-in component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

# ----
# Heath launch window
number_slider_22 = Slider(142, range=0..1000)
heath_accent_color_12 = RemoteReceiver(heath_accent_color)
pt_12 = ConstructPoint(XCoordinate=number_slider_22, YCoordinate=Slider(193, range=0..1000), ZCoordinate=0)
restart_heath_2 = RemoteReceiver(restart_heath)
panel_80 = Panel("Heath provides a user interface for life cycle building performance assessment in the Rhino environment.")
gate_9 = StreamGate(Stream="Start", Gate=restart_heath_2)  # -> Target0, Target1
true_button_11 = CreateTrueOnlyButton(ButtonName="Github Heath", ButtonStyle=0)
true_button_12 = CreateTrueOnlyButton(ButtonName=gate_9.Target0, ButtonStyle=0)
tb_12 = CreateTextBlock(TextSize=16, Justification=1)
tb_13 = CreateTextBlock(TextSize=12, Justification=0)
values_95 = ValueListener(Elements=true_button_11, SomeProperty=True)  # -> Values, Indices
values_96 = ValueListener(Elements=true_button_12, SomeProperty=True)  # -> Values, Indices
settextblock_7 = SetTextBlockContents(TextBlockToModify=tb_12, NewTextBlockContents="Email: sawen@chalmers.se")
settextblock_8 = SetTextBlockContents(TextBlockToModify=tb_13, NewTextBlockContents=panel_80)
github_heath = RemoteSender(values_95.Values)
adjustpos_74 = AdjustElementPositioning(ElementsToAdjust=tb_13, AbsolutePositioning=False, Height=Slider(60, range=0..100))
adjustpos_75 = AdjustElementPositioning(ElementsToAdjust=tb_12, Margin="0, 8, 0, 0", AbsolutePositioning=False, Height=Slider(20, range=0..100))

check_if_heath_can_be_launched = Python3Script(trigger_launch_heath=values_96.Values)  # -> out, launch_heath, e
# ---------- check_if_heath_can_be_launched: Python ----------
import Rhino

def check_launch_possible():
    e = []
    if not Rhino.RhinoDoc.ActiveDoc.Path:
        e.append("Please save the Rhino file before launching Heath.")
    return e

if __name__ == "__main__":
    e = check_launch_possible()
    launch_heath = trigger_launch_heath and not e
# ---------- end check_if_heath_can_be_launched ----------
merge_4 = Merge(Data1=flatten("Could not launch Heath:"), Data2=flatten(check_if_heath_can_be_launched.e))
join_3 = TextJoin(Text=merge_4, Join=" ")
lng_3 = ListLength(List=check_if_heath_can_be_launched.e)
tb_14 = CreateTextBlock(Text=join_3, TextSize=12, Justification=1)
and_3 = GateAnd(A=values_96.Values, B=lng_3)
settextblock_9 = SetTextBlockContents(TextBlockToModify=tb_14, NewTextBlockContents=join_3)
hideshow_7 = HideShowElement(ElementToHideShow=tb_14, Show=and_3, Collapse=True, Disable=False)

# ----
# Heath github
panel_81 = Panel("https://github.com/sawenchalmers/heath")
github_heath_2 = RemoteReceiver(github_heath)
py3_13 = Python3Script(url=panel_81, launch=github_heath_2)  # same code as py3

# ----
# Construction database launch
ping_open_construction_database_2 = RemoteReceiver(ping_open_construction_database)
open_construction_database_2 = RemoteReceiver(open_construction_database)
or_8 = GateOr(A=ping_open_construction_database_2, B=open_construction_database_2)
database_modal_location_5 = RemoteReceiver(database_modal_location)
ping_open_construction_database_3 = RemoteReceiver(ping_open_construction_database)
open_construction_database_3 = RemoteReceiver(open_construction_database)
or_9 = GateOr(A=ping_open_construction_database_3, B=open_construction_database_3)

null_18 = NullItem(Item=or_8)  # -> NullFlags, InvalidFlags, Description
filter_22 = StreamFilter(Gate=null_18.NullFlags, Stream0=or_8, Stream1="False")

# ----
# Construction database
number_slider_23 = Slider(20, range=0..100)
repeat_3 = RepeatData(Data="🔍", Length=number_slider_23)
repeat_4 = RepeatData(Data="- ", Length=number_slider_23)
repeat_5 = RepeatData(Data="X", Length=number_slider_23)
button_30 = CreateButton(ButtonName="Sync database", ButtonStyle=0)
true_button_13 = CreateTrueOnlyButton(ButtonName="Create new construction", ButtonStyle=0)
label_44 = CreateLabel(LabelText="Constructions", LabelSize=18, Justification=0)
label_45 = CreateLabel(LabelText="Duplicate instances of constructions have been loaded", LabelSize=12, Justification=0)
true_button_14 = CreateTrueOnlyButton(ButtonName=repeat_3, ButtonStyle=3)
button_31 = CreateButton(ButtonName="Save constructions", ButtonStyle=0)
button_32 = CreateButton(ButtonName=repeat_5, ButtonStyle=3)
button_33 = CreateButton(ButtonName="Load constructions", ButtonStyle=0)
tb_15 = CreateTextBlock(Text=repeat_4, TextSize=12, Justification=0)
values_97 = ValueListener(Elements=button_31, SomeProperty=True)  # -> Values, Indices
values_98 = ValueListener(Elements=true_button_14, SomeProperty=True)  # -> flatten(Values), Indices
values_99 = ValueListener(Elements=button_30, SomeProperty=True)  # -> Values, Indices
values_100 = ValueListener(Elements=true_button_13, SomeProperty=True)  # -> Values, Indices
values_101 = ValueListener(Elements=button_33, SomeProperty=True)  # -> Values, Indices
values_102 = ValueListener(Elements=button_32, SomeProperty=True)  # -> flatten(Values), Indices
cull_4 = CullPattern(List=values_102.Values, CullPattern=values_102.Values)
lng_4 = ListLength(List=cull_4)
filter_23 = StreamFilter(Gate=lng_4, Stream0="False", Stream1=cull_4)
freeze_gate_18 = StreamFreezeGate(Data=filter_23, PassingSwitch=invert(filter_23))
bool_18 = Boolean(invert(freeze_gate_18))
freeze_gate_19 = StreamFreezeGate(Data=values_97.Values, PassingSwitch=invert(values_97.Values))
freeze_gate_20 = StreamFreezeGate(Data=values_101.Values, PassingSwitch=invert(values_101.Values))
cset = CreateSet(List=values_98.Values)  # -> Set, Map
sync_construction_database = RemoteSender(values_99.Values)
tap_5 = TapBuffer(Reset=False, Incremental=True, Valve=bool_18, Hold=True)
create_construction_modal = RemoteSender(values_100.Values)
pre_construction_database_remove_constru = RemoteSender(values_102.Values)  # "pre_construction_database_remove_construction"
cull_5 = CullPattern(List=cset.Set, CullPattern=cset.Set)
bool_19 = Boolean(invert(freeze_gate_19))
bool_20 = Boolean(invert(freeze_gate_20))
expander_8 = CreateExpander(UIElements=simplify(graft(tb_15)), Header=simplify(graft(repeat_4)), Open=invert(True))  # -> flatten(Expander)
entwine_76 = Entwine(Branch00=true_button_13, Branch01=button_30, FlattenInputs=True)  # -> flatten(Result)
dam_13 = DataDam(DataA=tap_5, BufferDelay=2500000, BufferMode=2)
tap_6 = TapBuffer(Reset=False, Incremental=True, Valve=bool_19, Hold=True)
mindex_2 = MemberIndex(Set=values_98.Values, Member=cull_5)  # -> Index, Count
tap_7 = TapBuffer(Reset=False, Incremental=True, Valve=bool_20, Hold=True)
equals_17 = Equality(FirstNumber=tap_5, SecondNumber=dam_13)  # -> Equality, Inequality
stack_55 = CreateStack(UIElements=entwine_76, Horizontal=True)
dam_14 = DataDam(DataA=tap_6, BufferDelay=2500000, BufferMode=2)
bool_21 = Boolean(mindex_2.Count)
dam_15 = DataDam(DataA=tap_7, BufferDelay=2500000, BufferMode=2)
event_27 = EventGate(Data=equals_17.Inequality)  # -> Data, IsNew
suirify = Suirify(true_button_14)
suirify_2 = Suirify(expander_8)
suirify_3 = Suirify(button_32)
null_19 = NullItem(Item=bool_21)  # -> NullFlags, InvalidFlags, Description
equals_18 = Equality(FirstNumber=tap_6, SecondNumber=dam_14)  # -> Equality, Inequality
equals_19 = Equality(FirstNumber=tap_7, SecondNumber=dam_15)  # -> Equality, Inequality
construction_database_remove_constructio = RemoteSender(event_27.Data)  # "construction_database_remove_construction"
merge_5 = Merge(Data1=graft(suirify_2), Data2=graft(suirify_3), Data3=graft(suirify))
adjustelem_16 = AdjustElementAppearance(ElementsToAdjust=label_45, Foreground=ColourSwatch(SwatchColor=RGB(255, 0, 0)))
filter_24 = StreamFilter(Gate=null_19.NullFlags, Stream0=bool_21, Stream1="False")
number_slider_24 = Slider(26, range=0..300)
pre_construction_database_visualize_cons = RemoteSender(mindex_2.Index)  # "pre_construction_database_visualize_construction"
construction_database_visualize_construc = RemoteSender(filter_24)  # "construction_database_visualize_construction"
stack_56 = CreateStack(UIElements=merge_5, Horizontal=True)  # -> flatten(Stack)
adjustpos_76 = AdjustElementPositioning(ElementsToAdjust=button_31, AbsolutePositioning=False, Height=Slider(32, range=0..300), HorizontalAlignment=0)
adjustpos_77 = AdjustElementPositioning(
    ElementsToAdjust=true_button_14,
    AbsolutePositioning=False,
    Width=number_slider_24,
    Height=number_slider_24,
    HorizontalAlignment=2,
    VerticalAlignment=1)
adjustelem_17 = AdjustElementAppearance(
    ElementsToAdjust=true_button_14,
    Foreground=ColourSwatch(SwatchColor=RGBA(0, 0, 0, 205)),
    Background=ColourSwatch(SwatchColor=RGBA(245, 245, 245, 205)),
    FontSize=Slider(18, range=0..50))
adjustpos_78 = AdjustElementPositioning(ElementsToAdjust=button_33, AbsolutePositioning=False, Height=Slider(32, range=0..300), HorizontalAlignment=0)
adjustpos_79 = AdjustElementPositioning(
    ElementsToAdjust=button_32,
    AbsolutePositioning=False,
    Width=Slider(26, range=0..300),
    Height=Slider(26, range=0..300),
    HorizontalAlignment=2,
    VerticalAlignment=1)
adjustelem_18 = AdjustElementAppearance(ElementsToAdjust=button_32, Foreground=ColourSwatch(SwatchColor=RGB(255, 0, 0)), FontSize=Slider(12, range=0..50))
adjustpos_80 = AdjustElementPositioning(
    ElementsToAdjust=expander_8,
    Margin="0, 0, 0, 5",
    AbsolutePositioning=False,
    Width=Slider(285, range=100..500),
    HorizontalAlignment=0)
adjustpos_81 = AdjustElementPositioning(ElementsToAdjust=stack_56, Margin="5, 0, 0, 0", AbsolutePositioning=False, HorizontalAlignment=0)

# ----
# Remove constructions
pre_construction_database_remove_constru_2 = RemoteReceiver(pre_construction_database_remove_constru)  # "pre_construction_database_remove_construction"
construction_database_remove_constructio_2 = RemoteReceiver(construction_database_remove_constructio)  # "construction_database_remove_construction"
cset_2 = CreateSet(List=pre_construction_database_remove_constru_2)  # -> Set, Map
getdocumentusertext_2 = Python3Script(run=construction_database_remove_constructio_2, key="Heath constructions")  # -> json_string; same code as getdocumentusertext
cull_6 = CullPattern(List=cset_2.Set, CullPattern=cset_2.Set)
mindex_3 = MemberIndex(Set=pre_construction_database_remove_constru_2, Member=cull_6)  # -> Index, Count
split_3 = TextSplit(Text=getdocumentusertext_2, Separators="|")
hold = HoldingGate(Data=mindex_3.Index)
cull_i = CullIndex(List=split_3, Indices=hold, Wrap=True)
join_4 = TextJoin(Text=cull_i, Join="|")
nulls_in_empty = NullsInEmptyBranches(DataWithEmptyBranches=join_4)
null_20 = NullItem(Item=nulls_in_empty)  # -> NullFlags, InvalidFlags, Description
bool_22 = Boolean("False")
filter_25 = StreamFilter(Gate=null_20.NullFlags, Stream0=join_4, Stream1=bool_22)
freeze_gate_21 = StreamFreezeGate(Data=filter_25, PassingSwitch=construction_database_remove_constructio_2, Freeze=False, Hold=False)

sync_construction_database_2 = RemoteReceiver(sync_construction_database)

# ----
# Material database
number_slider_25 = Slider(10, range=0..100)
material_database_categories_6 = RemoteReceiver(material_database_categories_2)
lng_5 = ListLength(List=material_database_categories_4)
repeat_6 = RepeatData(Data="X", Length=number_slider_25)  # -> graft(Data)
repeat_7 = RepeatData(Data="- ", Length=number_slider_25)  # -> graft(Data)
lng_6 = ListLength(List=material_database_categories_4)
repeat_8 = RepeatData(Data=simplify(repeat_6), Length=lng_5)
repeat_9 = RepeatData(Data=simplify(repeat_7), Length=lng_5)
button_34 = CreateButton(ButtonName="Sync database", ButtonStyle=0)
true_button_15 = CreateTrueOnlyButton(ButtonName="Create material", ButtonStyle=0)
button_35 = CreateButton(ButtonName="Save materials", ButtonStyle=0)
label_46 = CreateLabel(LabelText="Duplicate instances of materials have been loaded", LabelSize=12, Justification=0)
label_47 = CreateLabel(LabelText=material_database_categories_6, LabelSize=18, Justification=0)
button_36 = CreateButton(ButtonName="Load materials", ButtonStyle=0)
values_103 = ValueListener(Elements=button_35, SomeProperty=True)  # -> Values, Indices
button_37 = CreateButton(ButtonName=repeat_8, ButtonStyle=3)
tb_16 = CreateTextBlock(Text=repeat_9, TextSize=12, Justification=0)
values_104 = ValueListener(Elements=button_36, SomeProperty=True)  # -> Values, Indices
freeze_gate_22 = StreamFreezeGate(Data=values_103.Values, PassingSwitch=invert(values_103.Values))
values_105 = ValueListener(Elements=flatten(button_37), SomeProperty=True)  # -> flatten(Values), Indices
cull_7 = CullPattern(List=values_105.Values, CullPattern=values_105.Values)  # -> flatten(List)
lng_7 = ListLength(List=cull_7)
filter_26 = StreamFilter(Gate=lng_7, Stream0="False", Stream1=cull_7)
freeze_gate_23 = StreamFreezeGate(Data=filter_26, PassingSwitch=invert(filter_26))
values_106 = ValueListener(Elements=true_button_15, SomeProperty=True)  # -> Values, Indices
values_107 = ValueListener(Elements=button_34, SomeProperty=True)  # -> Values, Indices
freeze_gate_24 = StreamFreezeGate(Data=values_104.Values, PassingSwitch=invert(values_104.Values))
bool_23 = Boolean(invert(freeze_gate_23))
bool_24 = Boolean(invert(freeze_gate_22))
tap_8 = TapBuffer(Reset=False, Incremental=True, Valve=bool_23, Hold=True)
pre_material_database_remove_material = RemoteSender(values_105.Values)
bool_25 = Boolean(invert(freeze_gate_24))
create_material_modal = RemoteSender(values_106.Values)
entwine_77 = Entwine(Branch00=true_button_15, Branch01=button_34, FlattenInputs=True)  # -> flatten(Result)
tap_9 = TapBuffer(Reset=False, Incremental=True, Valve=bool_24, Hold=True)
dam_16 = DataDam(DataA=tap_8, BufferDelay=2500000, BufferMode=2)
tap_10 = TapBuffer(Reset=False, Incremental=True, Valve=bool_25, Hold=True)
suirify_4 = Suirify(tb_16)
suirify_5 = Suirify(button_37)
dam_17 = DataDam(DataA=tap_9, BufferDelay=2500000, BufferMode=2)
dam_18 = DataDam(DataA=tap_10, BufferDelay=2500000, BufferMode=2)
equals_20 = Equality(FirstNumber=tap_8, SecondNumber=dam_16)  # -> Equality, Inequality
adjustelem_19 = AdjustElementAppearance(ElementsToAdjust=label_46, Foreground=ColourSwatch(SwatchColor=RGB(255, 0, 0)))
merge_6 = Merge(Data1=graft(suirify_4), Data2=graft(suirify_5))
equals_21 = Equality(FirstNumber=tap_9, SecondNumber=dam_17)  # -> Equality, Inequality
stack_57 = CreateStack(UIElements=entwine_77, Horizontal=True)
equals_22 = Equality(FirstNumber=tap_10, SecondNumber=dam_18)  # -> Equality, Inequality
event_28 = EventGate(Data=equals_20.Inequality)  # -> Data, IsNew
stack_58 = CreateStack(UIElements=merge_6, Horizontal=True)
material_database_remove_material = RemoteSender(event_28.Data)
shfdep = ShiftToDepth(Tree=stack_58, Depth=Slider(1, range=0..100), shiftFromStart=False)
merge_7 = Merge(Data1=simplify(graft(label_47)), Data2=shfdep)
stack_59 = CreateStack(UIElements=merge_7, Horizontal=invert(True))  # -> flatten(Stack)
adjustpos_82 = AdjustElementPositioning(ElementsToAdjust=label_47, Margin="0, 5, 0, 0", AbsolutePositioning=False)
adjustpos_83 = AdjustElementPositioning(
    ElementsToAdjust=tb_16,
    Margin="0, 0, 0, 10",
    AbsolutePositioning=False,
    Width=Slider(300, range=0..500),
    Height=Slider(29, range=0..300),
    HorizontalAlignment=0,
    VerticalAlignment=1)
adjustpos_84 = AdjustElementPositioning(ElementsToAdjust=stack_58, Margin="5, 0, 0, 0", AbsolutePositioning=False, HorizontalAlignment=0)
adjustpos_85 = AdjustElementPositioning(
    ElementsToAdjust=button_37,
    Margin="5, 0, 0, 10",
    AbsolutePositioning=False,
    Width=Slider(26, range=0..300),
    Height=Slider(26, range=0..300),
    HorizontalAlignment=1,
    VerticalAlignment=1)
adjustelem_20 = AdjustElementAppearance(ElementsToAdjust=button_37, Foreground=ColourSwatch(SwatchColor=RGB(255, 0, 0)), FontSize=Slider(12, range=0..50))
adjustpos_86 = AdjustElementPositioning(ElementsToAdjust=button_35, AbsolutePositioning=False, Height=Slider(32, range=0..300), HorizontalAlignment=0)
adjustpos_87 = AdjustElementPositioning(ElementsToAdjust=button_36, AbsolutePositioning=False, Height=Slider(32, range=0..300), HorizontalAlignment=0)

sync_material_database = RemoteSender(values_107.Values)

# ----
# Window database
panel_82 = Panel("Duplicate instances of windows have been loaded")
number_slider_26 = Slider(20, range=0..100)
true_button_16 = CreateTrueOnlyButton(ButtonName="Create window", ButtonStyle=0)
label_48 = CreateLabel(LabelText=panel_82, LabelSize=12, Justification=0)
label_49 = CreateLabel(LabelText="Windows", LabelSize=18, Justification=0)
repeat_10 = RepeatData(Data="X", Length=number_slider_26)
repeat_11 = RepeatData(Data="- ", Length=number_slider_26)
values_108 = ValueListener(Elements=true_button_16, SomeProperty=True)  # -> Values, Indices
button_38 = CreateButton(ButtonName=repeat_10, ButtonStyle=3)
button_39 = CreateButton(ButtonName="Save windows", ButtonStyle=0)
tb_17 = CreateTextBlock(Text=repeat_11, TextSize=12, Justification=0)
button_40 = CreateButton(ButtonName="Load windows", ButtonStyle=0)
values_109 = ValueListener(Elements=button_39, SomeProperty=True)  # -> Values, Indices
values_110 = ValueListener(Elements=button_40, SomeProperty=True)  # -> Values, Indices
values_111 = ValueListener(Elements=button_38, SomeProperty=True)  # -> flatten(Values), Indices
cull_8 = CullPattern(List=values_111.Values, CullPattern=values_111.Values)
lng_8 = ListLength(List=cull_8)
filter_27 = StreamFilter(Gate=lng_8, Stream0="False", Stream1=cull_8)
freeze_gate_25 = StreamFreezeGate(Data=filter_27, PassingSwitch=invert(filter_27))
create_window_modal = RemoteSender(values_108.Values)
bool_26 = Boolean(invert(freeze_gate_25))
freeze_gate_26 = StreamFreezeGate(Data=values_109.Values, PassingSwitch=invert(values_109.Values))
freeze_gate_27 = StreamFreezeGate(Data=values_110.Values, PassingSwitch=invert(values_110.Values))
tap_11 = TapBuffer(Reset=False, Incremental=True, Valve=bool_26, Hold=True)
pre_window_database_remove_window = RemoteSender(values_111.Values)
bool_27 = Boolean(invert(freeze_gate_26))
bool_28 = Boolean(invert(freeze_gate_27))
suirify_6 = Suirify(tb_17)
suirify_7 = Suirify(button_38)
dam_19 = DataDam(DataA=tap_11, BufferDelay=2500000, BufferMode=2)
tap_12 = TapBuffer(Reset=False, Incremental=True, Valve=bool_27, Hold=True)
merge_8 = Merge(Data1=graft(suirify_6), Data2=graft(suirify_7))
tap_13 = TapBuffer(Reset=False, Incremental=True, Valve=bool_28, Hold=True)
equals_23 = Equality(FirstNumber=tap_11, SecondNumber=dam_19)  # -> Equality, Inequality
adjustelem_21 = AdjustElementAppearance(ElementsToAdjust=label_48, Foreground=ColourSwatch(SwatchColor=RGB(255, 0, 0)))
dam_20 = DataDam(DataA=tap_12, BufferDelay=2500000, BufferMode=2)
dam_21 = DataDam(DataA=tap_13, BufferDelay=2500000, BufferMode=2)
event_29 = EventGate(Data=equals_23.Inequality)  # -> Data, IsNew
equals_24 = Equality(FirstNumber=tap_12, SecondNumber=dam_20)  # -> Equality, Inequality
equals_25 = Equality(FirstNumber=tap_13, SecondNumber=dam_21)  # -> Equality, Inequality
window_database_remove_window = RemoteSender(event_29.Data)
stack_60 = CreateStack(UIElements=merge_8, Horizontal=True)  # -> flatten(Stack)
adjustpos_88 = AdjustElementPositioning(ElementsToAdjust=label_49, Margin="0, 0, 0, -10", AbsolutePositioning=False)
adjustpos_89 = AdjustElementPositioning(ElementsToAdjust=button_39, AbsolutePositioning=False, Height=Slider(32, range=0..300), HorizontalAlignment=0)
adjustpos_90 = AdjustElementPositioning(
    ElementsToAdjust=tb_17,
    Margin="0, 10, 0, 0",
    AbsolutePositioning=False,
    Width=Slider(300, range=0..300),
    Height=Slider(29, range=0..300),
    HorizontalAlignment=0,
    VerticalAlignment=1)
adjustpos_91 = AdjustElementPositioning(ElementsToAdjust=stack_60, Margin="5, 0, 0, 0", AbsolutePositioning=False, HorizontalAlignment=0)
adjustpos_92 = AdjustElementPositioning(
    ElementsToAdjust=button_38,
    Margin="5, 0, 0, 0",
    AbsolutePositioning=False,
    Width=Slider(26, range=0..300),
    Height=Slider(26, range=0..300),
    HorizontalAlignment=1,
    VerticalAlignment=1)
adjustelem_22 = AdjustElementAppearance(ElementsToAdjust=button_38, Foreground=ColourSwatch(SwatchColor=RGB(255, 0, 0)), FontSize=Slider(12, range=0..50))
adjustpos_93 = AdjustElementPositioning(ElementsToAdjust=button_40, AbsolutePositioning=False, Height=Slider(32, range=0..300), HorizontalAlignment=0)

entwine_78 = Entwine(Branch00=true_button_16, Branch01=button_7, FlattenInputs=True)  # -> flatten(Result)
stack_61 = CreateStack(UIElements=entwine_78, Horizontal=True)

# ----
# Remove window
pre_window_database_remove_window_2 = RemoteReceiver(pre_window_database_remove_window)
window_database_remove_window_2 = RemoteReceiver(window_database_remove_window)
cset_3 = CreateSet(List=pre_window_database_remove_window_2)  # -> Set, Map
getdocumentusertext_3 = Python3Script(run=window_database_remove_window_2, key="Heath windows")  # -> json_string; same code as getdocumentusertext
cull_9 = CullPattern(List=cset_3.Set, CullPattern=cset_3.Set)
mindex_4 = MemberIndex(Set=pre_window_database_remove_window_2, Member=cull_9)  # -> Index, Count
split_4 = TextSplit(Text=getdocumentusertext_3, Separators="|")
hold_2 = HoldingGate(Data=mindex_4.Index)
cull_i_2 = CullIndex(List=split_4, Indices=hold_2, Wrap=True)
join_5 = TextJoin(Text=cull_i_2, Join="|")
nulls_in_empty_2 = NullsInEmptyBranches(DataWithEmptyBranches=join_5)
null_21 = NullItem(Item=nulls_in_empty_2)  # -> NullFlags, InvalidFlags, Description
bool_29 = Boolean("False")
filter_28 = StreamFilter(Gate=null_21.NullFlags, Stream0=join_5, Stream1=bool_29)
freeze_gate_28 = StreamFreezeGate(Data=filter_28, PassingSwitch=window_database_remove_window_2, Freeze=False, Hold=False)

# ----
# Recursion
panel_83 = Panel("Heath help")
objbynn_6 = GetObjectByNickname(NickName=panel_83)
heath_help = Python3Script()  # -> status; same code as lca_window_status

# ----
# Heath window
entwine_79 = Entwine(Branch00=location_4, Branch01=location_5, Branch02=location_8, FlattenInputs=True)  # -> flatten(Result)
entwine_80 = Entwine(Branch00=location_2, Branch01=location_3, FlattenInputs=True)  # -> flatten(Result)
entwine_81 = Entwine(Branch00=stack_32, Branch01=preview, Branch02=location_7, FlattenInputs=True)  # -> flatten(Result)
data_11 = Data()
data_12 = Data(energy_simulations)
data_13 = Data(daylight_simulations_2)
data_14 = Data()
data_15 = Data(daylight_simulations)
entwine_82 = Entwine(
    Branch00=select_model_2,
    Branch01=data_12,
    Branch02=data_11,
    Branch03=data_13,
    Branch04=data_14,
    Branch05=data_15,
    FlattenInputs=True)  # -> flatten(Result)
entwine_83 = Entwine(Branch00=entwine_22, Branch01=expander_2, Branch02=expander_3, Branch03=expander_6, FlattenInputs=True)  # -> flatten(Result)
heath_window_location_2 = RemoteReceiver(heath_window_location)
true_button_17 = CreateTrueOnlyButton(ButtonName="Help!", ButtonStyle=0)
values_112 = ValueListener(Elements=true_button_17, SomeProperty=True)  # -> Values, Indices
help_button = RemoteSender(values_112.Values)
format_30 = Format(Format="{0}, {1}, {2}, {3}", Culture=127, Data0=Slider(10, range=0..300))
adjustpos_94 = AdjustElementPositioning(
    ElementsToAdjust=true_button_17,
    Margin=format_30,
    AbsolutePositioning=invert(False),
    HorizontalAlignment=2,
    VerticalAlignment=2)

stack_62 = CreateStack(UIElements=entwine_79, Horizontal=invert(True))
stack_63 = CreateStack(UIElements=entwine_80, Horizontal=invert(True))
stack_64 = CreateStack(UIElements=entwine_81, Horizontal=invert(True))
expander_9 = CreateExpander(UIElements=stack_64, Header="Import geometry from Rhino", Open=invert(True))
expander_10 = CreateExpander(UIElements=stack_63, Header="Select program for room", Open=invert(True))
expander_11 = CreateExpander(UIElements=stack_62, Header="Select construction for room", Open=invert(True))
stack_65 = CreateStack(UIElements=entwine_83, Horizontal=invert(True))

# ----
# Recursion
panel_84 = Panel("Heath main")
objbynn_7 = GetObjectByNickname(NickName=panel_84)
heath_main = Python3Script()  # -> status; same code as lca_window_status

# ----
# Define construction
# # Define program and construction
# To be added...
# 
# ## Instructions
# To be added...
# 
# ## Inputs
# - ...
# 
# ## Outputs
# - ...
# 
# ## Interpretation
# To be added...
panel_85 = Panel("My construction")

# ----
# Recursion
panel_86 = Panel("Material info")
objbynn_8 = GetObjectByNickname(NickName=panel_86)
material_info = Python3Script()  # -> status; same code as lca_window_status

# ----
# Recursion
panel_87 = Panel("Window database")
objbynn_9 = GetObjectByNickname(NickName=panel_87)
window_database = Python3Script()  # -> status; same code as lca_window_status

# ----
# Window database launch
open_window_database_2 = RemoteReceiver(open_window_database)
rec_16 = DataRecorder(open_window_database_2, DataLimit=-2, RecordData=True)
database_modal_location_6 = RemoteReceiver(database_modal_location)
open_window_database_3 = RemoteReceiver(open_window_database)

int_10 = Integer(rec_16)

# ----
# Recursion
panel_88 = Panel("Material database")
objbynn_10 = GetObjectByNickname(NickName=panel_88)
material_database = Python3Script()  # -> status; same code as lca_window_status

# ----
# Material database launch
panel_89 = Panel("False")
database_modal_location_7 = RemoteReceiver(database_modal_location)
heath_accent_color_13 = RemoteReceiver(heath_accent_color)

# ----
# Heath module help
help_button_2 = RemoteReceiver(help_button)
rec_17 = DataRecorder(help_button_2, DataLimit=-2, RecordData=True)
ma_15 = MassAddition(Input=rec_17)  # -> Result, PartialResults
entwine_84 = Entwine(Branch00=ma_15.Result, Branch01=heath_help, FlattenInputs=True)
rec_18 = DataRecorder(entwine_84, DataLimit=2, RecordData=True)
item_13 = ListItem(List=rec_18, Index=0, Wrap=True)  # -> Item2, Item1, Item
equals_26 = Equality(FirstNumber=item_13.Item2, SecondNumber=item_13.Item1)  # -> Equality, Inequality
bang_5 = ExplodeTree(Data=equals_26.Inequality)  # -> Branch0, Branch1
py3_14 = Python3Script(x=bang_5.Branch0, y=bang_5.Branch1)  # -> a; same code as py3_5
event_30 = EventGate(Data=py3_14)  # -> Data, IsNew
freeze_gate_29 = StreamFreezeGate(Data=py3_14, PassingSwitch=event_30.IsNew)
panel_90 = Panel("""1. Select the program for the building and room.

2. Use the sliders to set the cooling and heating setpoints.

3. Estimate how many persons will be in the room with the occupancy slider.""")
panel_91 = Panel("""1. Select base construction by climate and type of construction.

2. If required, create your own material or window. Materials can later be selected when creating custom constructions.

3. Constructions and windows make up the subset construction, which is used to modify the base construction.

4. Constructions can be loaded from a file, which contains all previously created constructions.""")
panel_92 = Panel("""1. Select geometry in Rhino.

2. Select geometry type under the import geometry heading.

3. Click "Save geometry".

4. Verify the assigned geometry by pressing the "Preview" checkbox.""")
panel_93 = Panel("""1. Make sure the geometry have been imported and that the program and constructions are in place, before creating a honeybee model.

2. If the model has been created, the "Bake model" button will be enabled along with boxes that lets you visualize the model.

3. Set the wall thickness and roof thickness.

4. Switch the WWR (window-to-wall-ratio) on, if you want to generate windows automatically.""")
panel_94 = Panel("""1. Verify that the honeybee model is correct by selecting attributes and clicking the checkboxes in the "Attributes visualization" segment.

2. Click the "Run weather visualization" button. If the model is set up correctly the "Direct sun hours" and "Incident radiation" should be displayed on the model.""")
panel_95 = Panel("""1. Pick which simulation you want to run.

2. If the simulation failed a red text will show up, go back and review the honeybee model and settings.

3. Otherwise, navigate through the expanded segment to select appropriate displays of the results.

4. It is possible to transfer the results to Rhino by clicking "Bake", or to an image file by clicking "Pop-up window".""")
heath_window_location_3 = RemoteReceiver(heath_window_location)
event_31 = EventGate(Data=freeze_gate_29)  # -> Data, IsNew
label_50 = CreateLabel(LabelText="Geometry module", LabelSize=18, Justification=0)
panel_96 = Panel(event_31.Data)
tb_18 = CreateTextBlock(Text="Geometry module", TextSize=12, Justification=0)
launchwin_4 = LaunchWindow(
    Show=event_31.Data,
    Name="Help!",
    Width=Slider(350, range=0..500),
    Height=Slider(290, range=0..500),
    ChildStatus=1,
    EnableHorizScroll=False)
pdecon_4 = Deconstruct(Point=heath_window_location_3)  # -> XComponent, YComponent, ZComponent
pt_13 = ConstructPoint(XCoordinate=Slider(460, range=0..1000), YCoordinate=pdecon_4.YComponent, ZCoordinate=0)
winprops_4 = SetWindowProperties(
    Window=launchwin_4,
    StartingLocation=pt_13,
    Theme=0,
    AccentColor=heath_accent_color_3,
    ShowTitleBar=True,
    BackgroundColor=RGB(255, 255, 255),
    ScaleFactor=1)
entwine_85 = Entwine(Branch00=label_50, Branch01=tb_18, FlattenInputs=True)  # -> flatten(Result)
winstat_4 = WindowStatus(Window=launchwin_4)
help_button_3 = RemoteReceiver(help_button)
heath_help_status = RemoteSender(winstat_4)
addelems = AddElements(Window=launchwin_4, Elements=flatten(entwine_85), DoVLChecking=True)  # -> AddedElements, ElementNames
py3_15 = Python3Script(window=launchwin_4, activate=help_button_3)  # same code as py3_6

heath_help_status_2 = RemoteReceiver(heath_help_status)
expression_27 = Expression(x="Hidden", y=heath_help_status_2, Expression="x=y")
expire_4 = ExpireObject(ObjectToExpire=objbynn_6, Expire=expression_27)

# ----
# Recursion
panel_97 = Panel("Construction database")
objbynn_11 = GetObjectByNickname(NickName=panel_97)
construction_database = Python3Script()  # -> status; same code as lca_window_status

rec_19 = DataRecorder(filter_22, DataLimit=-2, RecordData=True)
int_11 = Integer(rec_19)
ma_16 = MassAddition(Input=int_11)  # -> Result, PartialResults
entwine_86 = Entwine(Branch00=ma_16.Result, Branch01=construction_database, FlattenInputs=True)
rec_20 = DataRecorder(entwine_86, DataLimit=2, RecordData=True)
item_14 = ListItem(List=rec_20, Index=0, Wrap=True)  # -> Item2, Item1, Item
equals_27 = Equality(FirstNumber=item_14.Item2, SecondNumber=item_14.Item1)  # -> Equality, Inequality
bang_6 = ExplodeTree(Data=equals_27.Inequality)  # -> Branch0, Branch1
py3_16 = Python3Script(x=bang_6.Branch0, y=bang_6.Branch1)  # -> a; same code as py3_5
event_32 = EventGate(Data=py3_16)  # -> Data, IsNew
freeze_gate_30 = StreamFreezeGate(Data=py3_16, PassingSwitch=event_32.IsNew)
event_33 = EventGate(Data=freeze_gate_30)  # -> Data, IsNew
panel_98 = Panel(event_33.Data)
launchwin_5 = LaunchWindow(
    Show=event_33.Data,
    Name="Construction database",
    Width=Slider(380, range=0..1000),
    Height=Slider(580, range=0..1000),
    ChildStatus=1,
    EnableHorizScroll=False)
winprops_5 = SetWindowProperties(
    Window=launchwin_5,
    StartingLocation=database_modal_location_5,
    Theme=0,
    AccentColor=heath_accent_color_4,
    ShowTitleBar=True,
    BackgroundColor=RGB(255, 255, 255),
    ScaleFactor=1)
winstat_5 = WindowStatus(Window=launchwin_5)
py3_17 = Python3Script(window=launchwin_5, activate=or_9)  # same code as py3_6
panel_99 = Panel(winstat_5)
construction_database_status = RemoteSender(winstat_5)

construction_database_status_2 = RemoteReceiver(construction_database_status)
expression_28 = Expression(x="Hidden", y=construction_database_status_2, Expression="x=y")
expire_5 = ExpireObject(ObjectToExpire=objbynn_11, Expire=expression_28)

ma_17 = MassAddition(Input=int_10)  # -> Result, PartialResults
entwine_87 = Entwine(Branch00=ma_17.Result, Branch01=window_database, FlattenInputs=True)
rec_21 = DataRecorder(entwine_87, DataLimit=2, RecordData=True)
item_15 = ListItem(List=rec_21, Index=0, Wrap=True)  # -> Item2, Item1, Item
equals_28 = Equality(FirstNumber=item_15.Item2, SecondNumber=item_15.Item1)  # -> Equality, Inequality
bang_7 = ExplodeTree(Data=equals_28.Inequality)  # -> Branch0, Branch1
py3_18 = Python3Script(x=bang_7.Branch0, y=bang_7.Branch1)  # -> a; same code as py3_5
event_34 = EventGate(Data=py3_18)  # -> Data, IsNew
freeze_gate_31 = StreamFreezeGate(Data=py3_18, PassingSwitch=event_34.IsNew)
event_35 = EventGate(Data=freeze_gate_31)  # -> Data, IsNew
panel_100 = Panel(event_35.Data)
launchwin_6 = LaunchWindow(
    Show=event_35.Data,
    Name="Window database",
    Width=Slider(380, range=0..1000),
    Height=Slider(580, range=0..1000),
    ChildStatus=1,
    EnableHorizScroll=False)
winprops_6 = SetWindowProperties(
    Window=launchwin_6,
    StartingLocation=database_modal_location_6,
    Theme=0,
    AccentColor=heath_accent_color_2,
    ShowTitleBar=True,
    BackgroundColor=RGB(255, 255, 255),
    ScaleFactor=1)
winstat_6 = WindowStatus(Window=launchwin_6)
py3_19 = Python3Script(window=launchwin_6, activate=open_window_database_3)  # same code as py3_6
window_database_status = RemoteSender(winstat_6)

window_database_status_2 = RemoteReceiver(window_database_status)
expression_29 = Expression(x="Hidden", y=window_database_status_2, Expression="x=y")
expire_6 = ExpireObject(ObjectToExpire=objbynn_9, Expire=expression_29)

construction_database_status_3 = RemoteReceiver(construction_database_status)
construction_database_status_4 = RemoteReceiver(construction_database_status)
expression_30 = Expression(x="Normal", y=construction_database_status_3, Expression="x=y")
expression_31 = Expression(x="Normal", y=construction_database_status_4, Expression="x=y")
and_4 = GateAnd(A=equals_18.Inequality, B=expression_30)
and_5 = GateAnd(A=equals_19.Inequality, B=expression_31)
event_36 = EventGate(Data=and_4)  # -> Data, IsNew
event_37 = EventGate(Data=and_5)  # -> Data, IsNew
save_constructions = RemoteSender(event_36.Data)
panel_101 = Panel(event_36.Data)
load_constructions = RemoteSender(event_37.Data)
panel_102 = Panel(event_37.Data)

window_database_status_3 = RemoteReceiver(window_database_status)
window_database_status_4 = RemoteReceiver(window_database_status)
expression_32 = Expression(x="Normal", y=window_database_status_3, Expression="x=y")
expression_33 = Expression(x="Normal", y=window_database_status_4, Expression="x=y")
and_6 = GateAnd(A=equals_24.Inequality, B=expression_32)
and_7 = GateAnd(A=equals_25.Inequality, B=expression_33)
event_38 = EventGate(Data=and_6)  # -> Data, IsNew
event_39 = EventGate(Data=and_7)  # -> Data, IsNew
panel_103 = Panel(event_38.Data)
save_windows = RemoteSender(event_38.Data)
panel_104 = Panel(event_39.Data)
load_windows = RemoteSender(event_39.Data)

entwine_88 = Entwine(Branch00=tb_13, Branch01=true_button_11, Branch02=true_button_12, Branch03=tb_14, Branch04=tb_12, FlattenInputs=True)  # -> flatten(Result)
launch_heath = RemoteSender(check_if_heath_can_be_launched.launch_heath)

# ----
# Needs work...
# Under development
# Global parameters
launch_heath_2 = RemoteReceiver(launch_heath)
fly = HeathFly(launch_heath=launch_heath_2, current_gh_versions=panel_79)  # -> flying, errors; inputs current_gh_versions: list
# ---------- fly: Python ----------
# Copyright (c) 2024, Heath.
# You should have received a copy of the GNU Affero General Public License
# along with Heath; If not, see <http://www.gnu.org/licenses/>.
# 
# @license AGPL-3.0-or-later <https://spdx.org/licenses/AGPL-3.0-or-later>

import Grasshopper, scriptcontext, Rhino
import os, sys, importlib

def main(gh_version):
    sys.path.append(Grasshopper.Folders.UserObjectFolders[0])
    heath_path = os.path.join(Grasshopper.Folders.UserObjectFolders[0], "heath")
    sys.path.append(heath_path)

    # make sure we can import ladybug tools
    ladybug_tools_path = "ladybug_tools\\python\\Lib\\site-packages\\"
    program_files_dir = os.path.dirname(f"{os.environ['ProgramFiles']}\\{ladybug_tools_path}")
    if os.path.isdir(program_files_dir):
        sys.path.append(program_files_dir)
    else:
        user_folder_dir = os.path.dirname(f"{os.path.expanduser('~')}\\{ladybug_tools_path}")
        if os.path.isdir(user_folder_dir):
            sys.path.append(user_folder_dir)
        else:
            raise Exception("Couldn't find Ladybug tools python module path")

    try:
        import heath
        import heath_ui
        importlib.reload(heath)
        importlib.reload(heath_ui)
        if not heath.__file__:
            raise Exception("Wrong module version imported")
    except Exception as e:
        # hack to allow the module to reside in the repo
        sys.path.append(os.path.join(os.path.dirname(ghdoc.Path), '..\src'))
        import heath
        import heath_ui
        importlib.reload(heath)
        importlib.reload(heath_ui)
    version = heath.heath_globals.version
    if not check_version(gh_version, version):
        raise Exception(f"Version mismatch: {gh_version} (gh), {version} (py)")

    ghenv.Component.Name = 'Heath - Fly!'
    ghenv.Component.NickName = 'Fly!'

    scriptcontext.sticky["heath_flying"] = 'true'
    ghenv.Component.Message = heath.heath_globals.version
    return True

def check_version(gh_ver, py_ver):
    return py_ver in gh_ver

if __name__ == "__main__":
    if not Rhino.RhinoDoc.ActiveDoc.Path:
        flying = False
    else:
        try:
            flying = main(current_gh_versions) if launch_heath else False
        except Exception as e:
            errors = e
            print(e)
            elvl = Grasshopper.Kernel.GH_RuntimeMessageLevel.Error
            ghenv.Component.AddRuntimeMessage(elvl, str(e))
            flying = False
# ---------- end fly ----------
py3_20 = Python3Script(get=fly.flying)  # -> results_folder, heath_folder
# ---------- py3_20: Python ----------
"""Grasshopper Script"""
import heath
import Grasshopper

if __name__ == "__main__":
    if get:
        print(ghdoc)
        results_folder = heath.get_results_folder(ghdoc)
        heath_folder = Grasshopper.Folders.UserObjectFolders[0]
        print(results_folder)
        print(heath_folder)
# ---------- end py3_20 ----------
panel_105 = Panel(fly.flying)
heath_flying = RemoteSender(fly.flying)
results_folder = RemoteSender(py3_20.results_folder)
heath_folder = RemoteSender(py3_20.heath_folder)

# ----
# For user to interact with
# Brimstone FLY!
launch_heath_3 = RemoteReceiver(launch_heath)
fly_2 = BrimstoneFly(x=launch_heath_3)
# ---------- fly_2: Python ----------
"""This component sets up global information for Brimstone
    Inputs:
    Output:
        """

import Grasshopper
import sys
import os

sys.path.append(Grasshopper.Folders.UserObjectFolders[0])

import brimstone
reload(brimstone)

import scriptcontext

ghenv.Component.Name = 'Brimstone - Fly!'
ghenv.Component.NickName = 'Fly!'

scriptcontext.sticky["brimstone_flying"] = 'true'
scriptcontext.sticky["brimstone_kdb_hb_json"] = 'brimstone_data/230721klimatdatabas_hb_materials.json' # json which adds honeybee material info to klimatdatabas materials
scriptcontext.sticky["brimstone_hb_kdb_csv"] = 'brimstone_data/230728_HBKlimatdatabas.csv' # csv file which translates honeybee material names to klimatdatabas material names
ghenv.Component.Message = brimstone.globals.version
# ---------- end fly_2 ----------

results_folder_2 = RemoteReceiver(results_folder)
results_folder_3 = RemoteReceiver(results_folder)
results_folder_4 = RemoteReceiver(results_folder)
results_folder_5 = RemoteReceiver(results_folder)
results_folder_6 = RemoteReceiver(results_folder)
results_folder_7 = RemoteReceiver(results_folder)
heath_folder_2 = RemoteReceiver(heath_folder)
concat = Concatenate(FragmentA=heath_folder_2, FragmentB="heath/butterfly_heath.png")
heath_folder_3 = RemoteReceiver(heath_folder)
concat_2 = Concatenate(FragmentA=heath_folder_3, FragmentB="heath/butterfly_heath_short.png")

heath_folder_4 = RemoteReceiver(heath_folder)
concat_3 = Concatenate(FragmentA=heath_folder_4, FragmentB="heath/butterfly_heath.png")
image = CreateImage(ImageSource=concat_3, ImageWidth=bar_chart_img_width_2, ImageHeight=bar_chart_img_height_2)
entwine_89 = Entwine(Branch00=checklist_2, Branch01=image, FlattenInputs=True)  # -> flatten(Result)
stack_66 = CreateStack(UIElements=entwine_89, Horizontal=True)
entwine_90 = Entwine(Branch00=stack_8, Branch01=stack_66, FlattenInputs=True)  # -> flatten(Result)

stack_67 = CreateStack(UIElements=entwine_90, Horizontal=invert(True))

heath_folder_5 = RemoteReceiver(heath_folder)
concat_4 = Concatenate(FragmentA=heath_folder_5, FragmentB="heath/butterfly_heath.png")
image_2 = CreateImage(ImageSource=concat_4, ImageWidth=bar_chart_img_width_3, ImageHeight=bar_chart_img_height_3)
entwine_91 = Entwine(Branch00=checklist, Branch01=image_2, FlattenInputs=True)  # -> flatten(Result)
stack_68 = CreateStack(UIElements=entwine_91, Horizontal=True)
entwine_92 = Entwine(Branch00=button_9, Branch01=stack_68, FlattenInputs=True)  # -> flatten(Result)
stack_69 = CreateStack(UIElements=entwine_92, Horizontal=invert(True))
addelems_2 = AddElements(Window=launchwin, Elements=flatten(stack_69), DoVLChecking=True)  # -> AddedElements, ElementNames

heath_folder_6 = RemoteReceiver(heath_folder)
concat_5 = Concatenate(FragmentA=heath_folder_6, FragmentB="heath/butterfly_heath.png")
image_3 = CreateImage(ImageSource=concat_5, ImageWidth=bar_chart_img_width_4, ImageHeight=bar_chart_img_height_4)
entwine_93 = Entwine(Branch00=checklist_3, Branch01=image_3, FlattenInputs=True)  # -> flatten(Result)
stack_70 = CreateStack(UIElements=entwine_93, Horizontal=True)
entwine_94 = Entwine(Branch00=button_11, Branch01=stack_70, FlattenInputs=True)  # -> flatten(Result)
stack_71 = CreateStack(UIElements=entwine_94, Horizontal=invert(True))
addelems_3 = AddElements(Window=launchwin_3, Elements=flatten(stack_71), DoVLChecking=True)  # -> AddedElements, ElementNames

addelems_4 = AddElements(Window=launchwin_2, Elements=flatten(stack_67), DoVLChecking=True)  # -> AddedElements, ElementNames

launch_heath_4 = RemoteReceiver(launch_heath)
rec_22 = DataRecorder(launch_heath_4, DataLimit=-2, RecordData=True)
ma_18 = MassAddition(Input=rec_22)  # -> Result, PartialResults
entwine_95 = Entwine(Branch00=ma_18.Result, Branch01=heath_main, FlattenInputs=True)
rec_23 = DataRecorder(entwine_95, DataLimit=2, RecordData=True)
item_16 = ListItem(List=rec_23, Index=0, Wrap=True)  # -> Item2, Item1, Item
equals_29 = Equality(FirstNumber=item_16.Item2, SecondNumber=item_16.Item1)  # -> Equality, Inequality
entwine_96 = Entwine(
    Branch00=model_name_3,
    Branch01=expander_9,
    Branch02=expander_10,
    Branch03=expander_11,
    Branch04=expander,
    Branch05=create_model,
    FlattenInputs=True)  # -> flatten(Result)
bang_8 = ExplodeTree(Data=equals_29.Inequality)  # -> Branch0, Branch1
py3_21 = Python3Script(x=bang_8.Branch0, y=bang_8.Branch1)  # -> a; same code as py3_5
event_40 = EventGate(Data=py3_21)  # -> Data, IsNew
freeze_gate_32 = StreamFreezeGate(Data=py3_21, PassingSwitch=event_40.IsNew)
event_41 = EventGate(Data=freeze_gate_32)  # -> Data, IsNew
launchwin_7 = LaunchWindow(
    Show=event_41.Data,
    Name="Heath",
    Width=Slider(390, range=0..1000),
    Height=Slider(520, range=0..1000),
    ChildStatus=1,
    EnableHorizScroll=False)
panel_106 = Panel(event_41.Data)
heath_is_active = RemoteSender(event_41.Data)
heath_window = RemoteSender(launchwin_7)
winprops_7 = SetWindowProperties(
    Window=launchwin_7,
    StartingLocation=heath_window_location_2,
    Theme=0,
    AccentColor=heath_accent_color_5,
    ShowTitleBar=True,
    BackgroundColor=RGB(255, 255, 255),
    ScaleFactor=1)
launch_heath_5 = RemoteReceiver(launch_heath)
image_4 = CreateImage(ImageSource=concat_2, ImageWidth=Slider(30, range=0..100), ImageHeight=Slider(19, range=0..100))
py3_22 = Python3Script(window=launchwin_7, activate=launch_heath_5)  # same code as py3_6
winstat_7 = WindowStatus(Window=launchwin_7)
entwine_97 = Entwine(Branch00=image_4, Branch01=true_button_6, Branch02=true_button_17, FlattenInputs=True)  # -> flatten(Result)
heath_status = RemoteSender(winstat_7)
stack_72 = CreateStack(UIElements=entwine_97, Horizontal=True)

heath_status_2 = RemoteReceiver(heath_status)
expression_34 = Expression(x="Hidden", y=heath_status_2, Expression="x=y")
expire_7 = ExpireObject(ObjectToExpire=objbynn_7, Expire=expression_34)

stack_73 = CreateStack(UIElements=entwine_96, Horizontal=invert(True))

heath_is_active_2 = RemoteReceiver(heath_is_active)

launchwin_8 = LaunchWindow(
    Show=invert(heath_is_active_2),
    Name="Heath",
    Width=Slider(275, range=0..1000),
    Height=Slider(250, range=0..1000),
    ChildStatus=1,
    EnableHorizScroll=False)
winprops_8 = SetWindowProperties(Window=launchwin_8, StartingLocation=pt_12, AccentColor=heath_accent_color_12, ShowTitleBar=True, ScaleFactor=1)

addelems_5 = AddElements(Window=launchwin_8, Elements=flatten(entwine_88), DoVLChecking=True)  # -> AddedElements, ElementNames
winstat_8 = WindowStatus(Window=launchwin_8)
heath_launch_status = RemoteSender(winstat_8)
heath_launch_elements = RemoteSender(addelems_5.AddedElements)

filepicker = CreateFilePicker(
    ButtonLabelText="Save constructions to file",
    DialogType=1,
    MustExist=True,
    Filter="Text file|*.txt",
    StartingPath=results_folder_2)
filepicker_2 = CreateFilePicker(
    ButtonLabelText="Load constructions from file",
    DialogType=0,
    MustExist=True,
    Filter="Text file|*.txt",
    StartingPath=results_folder_3)
values_113 = ValueListener(Elements=filepicker, SomeProperty=True)  # -> Values, Indices
values_114 = ValueListener(Elements=filepicker_2, SomeProperty=True)  # -> Values, Indices
bool_30 = Boolean(values_113.Values)
bool_31 = Boolean(values_114.Values)
null_22 = NullItem(Item=bool_30)  # -> NullFlags, InvalidFlags, Description
save_constructions_file = RemoteSender(values_113.Values)
load_constructions_file = RemoteSender(values_114.Values)
null_23 = NullItem(Item=bool_31)  # -> NullFlags, InvalidFlags, Description
hideshow_8 = HideShowElement(ElementToHideShow=button_31, Show=null_22.NullFlags, Collapse=True, Disable=False)
hideshow_9 = HideShowElement(ElementToHideShow=button_33, Show=null_23.NullFlags, Collapse=True, Disable=False)
entwine_98 = Entwine(Branch00=filepicker, Branch01=button_31, FlattenInputs=True)  # -> flatten(Result)
entwine_99 = Entwine(Branch00=filepicker_2, Branch01=button_33, FlattenInputs=True)  # -> flatten(Result)
stack_74 = CreateStack(UIElements=entwine_98, Horizontal=True)
adjustpos_95 = AdjustElementPositioning(
    ElementsToAdjust=filepicker,
    AbsolutePositioning=False,
    Width=Slider(180, range=0..300),
    Height=Slider(32, range=0..300),
    HorizontalAlignment=0)
stack_75 = CreateStack(UIElements=entwine_99, Horizontal=True)
adjustpos_96 = AdjustElementPositioning(
    ElementsToAdjust=filepicker_2,
    AbsolutePositioning=False,
    Width=Slider(180, range=0..300),
    Height=Slider(32, range=0..300),
    HorizontalAlignment=0)

entwine_100 = Entwine(
    Branch00=stack_55,
    Branch01=label_45,
    Branch02=label_44,
    Branch03=stack_56,
    Branch04=stack_74,
    Branch05=stack_75,
    FlattenInputs=True)  # -> flatten(Result)
addelems_6 = AddElements(Window=launchwin_5, Elements=flatten(entwine_100), DoVLChecking=True)  # -> AddedElements, ElementNames
construction_database_elements = RemoteSender(addelems_6.AddedElements)

# ----
# Load constructions
load_constructions_2 = RemoteReceiver(load_constructions)
load_constructions_file_2 = RemoteReceiver(load_constructions_file)
gate_10 = StreamGate(Stream=load_constructions_file_2, Gate=load_constructions_2)  # -> Target0, Target1
getdocumentusertext_4 = Python3Script(run=load_constructions_2, key="Heath constructions")  # -> json_string; same code as getdocumentusertext
file = ReadFile(File=gate_10.Target1, PerLineParse=False)
split_5 = TextSplit(Text=file, Separators="|")  # -> flatten(Result)
entwine_101 = Entwine(Branch00=getdocumentusertext_4, Branch01=file, FlattenInputs=True)  # -> flatten(Result)
strtoobj_2 = HBStringToObject(hb_str=split_5)  # -> hb_obj; plug-in component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
null_24 = NullItem(Item=strtoobj_2)  # -> NullFlags, InvalidFlags, Description
item_17 = ListItem(List=null_24.NullFlags, Index=0, Wrap=True)
filter_29 = StreamFilter(Gate=item_17, Stream0=entwine_101)
join_6 = TextJoin(Text=filter_29, Join="|")
freeze_gate_33 = StreamFreezeGate(Data=join_6, PassingSwitch=load_constructions_2, Freeze=False, Hold=False)

# ----
# Save constructions
save_constructions_2 = RemoteReceiver(save_constructions)
getdocumentusertext_5 = Python3Script(run=save_constructions_2, key="Heath constructions")  # -> json_string; same code as getdocumentusertext
null_25 = NullItem(Item=getdocumentusertext_5)  # -> NullFlags, InvalidFlags, Description
save_constructions_file_2 = RemoteReceiver(save_constructions_file)
bool_32 = Boolean(invert(null_25.NullFlags))
filter_30 = StreamFilter(Gate=null_25.NullFlags, Stream0=save_constructions_2, Stream1=bool_32)
writetxt = WriteToTextFile(Run=filter_30, TextToWrite=getdocumentusertext_5, FilePath=save_constructions_file_2, Append=False, NewOnly=False)

filepicker_3 = CreateFilePicker(
    ButtonLabelText="Save materials to file",
    DialogType=1,
    MustExist=True,
    Filter="Text file|*.txt",
    StartingPath=results_folder_4)
filepicker_4 = CreateFilePicker(
    ButtonLabelText="Load materials from file",
    DialogType=0,
    MustExist=True,
    Filter="Text file|*.txt",
    StartingPath=results_folder_5)
values_115 = ValueListener(Elements=filepicker_3, SomeProperty=True)  # -> Values, Indices
values_116 = ValueListener(Elements=filepicker_4, SomeProperty=True)  # -> Values, Indices
bool_33 = Boolean(values_115.Values)
bool_34 = Boolean(values_116.Values)
null_26 = NullItem(Item=bool_33)  # -> NullFlags, InvalidFlags, Description
save_materials_file = RemoteSender(values_115.Values)
null_27 = NullItem(Item=bool_34)  # -> NullFlags, InvalidFlags, Description
load_materials_file = RemoteSender(values_116.Values)
hideshow_10 = HideShowElement(ElementToHideShow=button_35, Show=null_26.NullFlags, Collapse=True, Disable=False)
hideshow_11 = HideShowElement(ElementToHideShow=button_36, Show=null_27.NullFlags, Collapse=True, Disable=False)
entwine_102 = Entwine(Branch00=filepicker_4, Branch01=button_36, FlattenInputs=True)  # -> flatten(Result)
entwine_103 = Entwine(Branch00=filepicker_3, Branch01=button_35, FlattenInputs=True)  # -> flatten(Result)
stack_76 = CreateStack(UIElements=entwine_102, Horizontal=True)
stack_77 = CreateStack(UIElements=entwine_103, Horizontal=True)
adjustpos_97 = AdjustElementPositioning(
    ElementsToAdjust=filepicker_3,
    AbsolutePositioning=False,
    Width=Slider(180, range=0..300),
    Height=Slider(32, range=0..300),
    HorizontalAlignment=0)
adjustpos_98 = AdjustElementPositioning(ElementsToAdjust=stack_77, Margin="5, 20, 0, 0", AbsolutePositioning=False, HorizontalAlignment=0)
adjustpos_99 = AdjustElementPositioning(ElementsToAdjust=stack_76, Margin="5, 10, 0, 0", AbsolutePositioning=False, HorizontalAlignment=0)
adjustpos_100 = AdjustElementPositioning(
    ElementsToAdjust=filepicker_4,
    AbsolutePositioning=False,
    Width=Slider(180, range=0..300),
    Height=Slider(32, range=0..300),
    HorizontalAlignment=0)

filepicker_5 = CreateFilePicker(
    ButtonLabelText="Save windows to file",
    DialogType=1,
    MustExist=True,
    Filter="Text file|*.txt",
    StartingPath=results_folder_6)
filepicker_6 = CreateFilePicker(
    ButtonLabelText="Load windows from file",
    DialogType=0,
    MustExist=True,
    Filter="Text file|*.txt",
    StartingPath=results_folder_7)
values_117 = ValueListener(Elements=filepicker_5, SomeProperty=True)  # -> Values, Indices
values_118 = ValueListener(Elements=filepicker_6, SomeProperty=True)  # -> Values, Indices
bool_35 = Boolean(values_117.Values)
bool_36 = Boolean(values_118.Values)
null_28 = NullItem(Item=bool_35)  # -> NullFlags, InvalidFlags, Description
save_windows_file = RemoteSender(values_117.Values)
null_29 = NullItem(Item=bool_36)  # -> NullFlags, InvalidFlags, Description
load_windows_file = RemoteSender(values_118.Values)
hideshow_12 = HideShowElement(ElementToHideShow=button_39, Show=null_28.NullFlags, Collapse=True, Disable=False)
hideshow_13 = HideShowElement(ElementToHideShow=button_40, Show=null_29.NullFlags, Collapse=True, Disable=False)
entwine_104 = Entwine(Branch00=filepicker_5, Branch01=button_39, FlattenInputs=True)  # -> flatten(Result)
entwine_105 = Entwine(Branch00=filepicker_6, Branch01=button_40, FlattenInputs=True)  # -> flatten(Result)
adjustpos_101 = AdjustElementPositioning(
    ElementsToAdjust=filepicker_5,
    AbsolutePositioning=False,
    Width=Slider(180, range=0..300),
    Height=Slider(32, range=0..300),
    HorizontalAlignment=0)
stack_78 = CreateStack(UIElements=entwine_104, Horizontal=True)
stack_79 = CreateStack(UIElements=entwine_105, Horizontal=True)
adjustpos_102 = AdjustElementPositioning(
    ElementsToAdjust=filepicker_6,
    AbsolutePositioning=False,
    Width=Slider(180, range=0..300),
    Height=Slider(32, range=0..300),
    HorizontalAlignment=0)

entwine_106 = Entwine(
    Branch00=stack_61,
    Branch01=label_48,
    Branch02=label_49,
    Branch03=stack_60,
    Branch04=stack_78,
    Branch05=stack_79,
    FlattenInputs=True)  # -> flatten(Result)
addelems_7 = AddElements(Window=launchwin_6, Elements=flatten(entwine_106), DoVLChecking=True)  # -> AddedElements, ElementNames
window_database_elements = RemoteSender(addelems_7.AddedElements)

# ----
# Load windows
load_windows_file_2 = RemoteReceiver(load_windows_file)
load_windows_2 = RemoteReceiver(load_windows)
gate_11 = StreamGate(Stream=load_windows_file_2, Gate=load_windows_2)  # -> Target0, Target1
getdocumentusertext_6 = Python3Script(run=load_windows_2, key="Heath windows")  # -> json_string; same code as getdocumentusertext
file_2 = ReadFile(File=gate_11.Target1, PerLineParse=False)
entwine_107 = Entwine(Branch00=getdocumentusertext_6, Branch01=file_2, FlattenInputs=True)  # -> flatten(Result)
split_6 = TextSplit(Text=file_2, Separators="|")  # -> flatten(Result)
strtoobj_3 = HBStringToObject(hb_str=split_6)  # -> hb_obj; plug-in component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
null_30 = NullItem(Item=strtoobj_3)  # -> NullFlags, InvalidFlags, Description
item_18 = ListItem(List=null_30.NullFlags, Index=0, Wrap=True)
filter_31 = StreamFilter(Gate=item_18, Stream0=entwine_107)
join_7 = TextJoin(Text=filter_31, Join="|")
freeze_gate_34 = StreamFreezeGate(Data=join_7, PassingSwitch=load_windows_2, Freeze=False, Hold=False)

# ----
# Save windows
save_windows_2 = RemoteReceiver(save_windows)
getdocumentusertext_7 = Python3Script(run=save_windows_2, key="Heath windows")  # -> json_string; same code as getdocumentusertext
null_31 = NullItem(Item=getdocumentusertext_7)  # -> NullFlags, InvalidFlags, Description
bool_37 = Boolean(invert(null_31.NullFlags))
save_windows_file_2 = RemoteReceiver(save_windows_file)
filter_32 = StreamFilter(Gate=null_31.NullFlags, Stream0=save_windows_2, Stream1=bool_37)
writetxt_2 = WriteToTextFile(Run=filter_32, TextToWrite=getdocumentusertext_7, FilePath=save_windows_file_2, Append=False, NewOnly=False)

# ----
# Heath material info
number_slider_27 = Slider(1.15, range=0..10)
number_slider_28 = Slider(560, range=0..1000)
number_slider_29 = Slider(500, range=0..1000)
panel_107 = Panel("heath/Building physics from physical principles to international standards, Marko Pinteric_page-0001.jpg")
multiplication = Multiplication(A=number_slider_27, B=number_slider_28)
create_modal_location_2 = RemoteReceiver(create_modal_location)
heath_accent_color_14 = RemoteReceiver(heath_accent_color)
multiplication_2 = Multiplication(A=Slider(1.25, range=0..10), B=number_slider_29)
concat_6 = Concatenate(FragmentA=heath_folder_2, FragmentB=panel_107)
image_5 = CreateImage(ImageSource=concat, ImageWidth=multiplication_2, ImageHeight=number_slider_29)
setimg = SetImage(ImageToModify=image_5, NewImagePath=concat_6)

# ----
# Assemble Honeybee model
# # Assemble Honeybee model
# This cluster takes input geometry and geometric information and generates a valid Honeybee model which can be used in the following analysis steps.
# 
# ## Instructions
# Enter the relevant inputs to generate the Honeybee model. Windows can either be created using an input geometry or through auto-generation using a window-to-wall ratio.
# 
# ### Room geometry
# Each 3D Brep entered represents one room or thermal zone in the building with no air exchange between them. The Breps should be closed and 3D to generate valid rooms. The room geometries should represent the inner boundary of the external walls
# 
# ### Adjacent geometry
# Geometry of adjacent buildings represented by a surface where they contact the room geometry. Adiabatic boundary condition will be assumed at the contact surface.
# 
# ### Windows/apertures
# Windows can either be defined through a list of 2D surfaces which intersect with the room 3D geometries, or be auto-generated through the list of numeric outputs.
# 
# ### Wall/roof thicknesses
# Wall and roof thicknesses are supplied to generate a shading geometry representing the external surface thickness
# 
# ### Louvers
# If all related inputs are entered, shading louvers will be generated on each window according to the entered parameters.
# 
# ### Different directions
# All the above inputs will be the same for all rooms, however they can be optionally entered as a list which represents different values for different cardinal directions, in the order (N, E, S, W).
# 
# ## Inputs
# - `Model name` - text string representing the name of the analysis model
# - `Room geometry` - list of 3D closed Brep geometries representing each room/zone in the model
# - `Construction set` - text string representing the construction to be used for the rooms, can be retrieved using the HB Construction Set by Climate component
# - `Program` - Honeybee Program or list of which are applied to the rooms in the model. Can be defined using the HB Search Programs component
# - `Context geometry` - list of surrounding Brep geometries which shades the analysed Rooms
# - `Windows` - list of 2D Brep geometries which represent the openings in the building envelope. If not supplied, windows are instead generated through definition of window-to-wall ratios as defined below
# - `Skylights` - list of 2D Brep geometries which represent the openings in the building roof
# - `Window-to-wall ratio` - number representing the window-to-wall ratio on each exterior surface Used if no window geometries are supplied.
# - `Subdivide generated windows` - set to True if the window surface area should be divided into multiple windows on each exterior surface
# - `Window height` - number representing the target height of the auto-generated windows
# - `Sill height` - number representing how high the lower edge of the auto-generated windows should be from the room floor
# - `Horizontal separation` - number representing how far separated the auto-generated windows should be horizontally
# - `Vertical separation` - number representing if auto-generated windows should be split vertically and if so, what distance
# - `Wall thickness` - number representing the thickness of the exterior walls, used to generate shading geometry for windows
# - `Roof thickness` - number representing the thickness of the roof, used to generate shading geometry for skylights
# - `Louver depth` - number optionally representing the depth of louvers
# - `Number of louvers` - number optionally representing the amount of louvers on each window
# - `Distance between louvers ` - number optionally representing the distance between louvers on each window
# - `Louver angle` - number optionally representing if louvers should be tilted
# - `Vertical/horizontal louvers` - boolean, set to True if louvers should be vertical
# 
# ## Outputs
# - `Honeybee model` - valid Honeybee model for further analysis
# 
# ## Interpretation
# To be added...
heath_geometry_type_key_7 = RemoteReceiver(heath_geometry_type_key)
pre_create_model_2 = RemoteReceiver(pre_create_model)
panel_108 = Panel("""Room
Adjacent
Context
Window""")
or_10 = GateOr(B=pre_create_model_2, C=Toggle(True))
gate_12 = StreamGate(Stream=heath_geometry_type_key_7, Gate=or_10)  # -> Target0, Target1
refkv = ReferenceByKeyValue(Key=gate_12.Target1, Val=graft(panel_108), lightweight=False, DisableAutoUpdate=True)
generate_wwr_2 = RemoteReceiver(generate_wwr)
pre_create_model_3 = RemoteReceiver(pre_create_model)
model_name_4 = RemoteReceiver(model_name)
data_16 = Data(programtype)
bang_9 = ExplodeTree(Data=refkv)  # -> Branch0, Branch1, Branch2, Branch3, Branch4
room = Geometry(bang_9.Branch0)
adjacent = Geometry(bang_9.Branch1)
context_2 = Geometry(bang_9.Branch2)
windows_3 = Geometry(bang_9.Branch3)
panel_109 = Panel(pre_create_model_3)
cluster = Cluster_6(id=room)
cluster_2 = Cluster_6(id=adjacent)
cluster_3 = Cluster_6(id=context_2)
cluster_4 = Cluster_6(id=windows_3)
heatcool = HBHeatCoolHVACTemplates({"Baseboard electric": "ElectricBaseboard", "Baseboard gas boiler": "BoilerBaseboard", "Baseboard central air source heat pump": "ASHPBaseboard", "Baseboard district hot water": "DHWBaseboard", "Direct evap coolers with baseboard electric": "EvapCoolers_ElectricBaseboard", "Direct evap coolers with baseboard gas boiler": "EvapCoolers_BoilerBaseboard"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}, selected="Residential heat pump with no cooling": "ResidentialHPNoCool")
window_height = Number()
sill_height = Number(Slider(0.3, range=0..1))
horizontal_separation = Number()
vertical_separation = Number()
subdivide_generated_windows = Boolean(Toggle(True))
load_models_ping = Python3Script()  # -> folder
# ---------- load_models_ping: Python ----------
import os
from Rhino import RhinoDoc

folder_path = ("\\").join(ghdoc.Path.split("\\")[:-1])
rhino_file_name = (RhinoDoc.ActiveDoc.Path).split("\\")[-1][:-4]
folder_name = 'Honeybee models'
full_path = folder_path + "\\heath_data\\" + rhino_file_name + "\\" + folder_name

try:
    os.mkdir(("\\").join(full_path.split("\\")[:-2]))
    os.mkdir(("\\").join(full_path.split("\\")[:-1]))
    os.mkdir(full_path)
except FileExistsError:
    # directory already exists
    pass

folder = full_path
# ---------- end load_models_ping ----------
py3_23 = Python3Script(folder=load_models_ping)  # -> model_names, files
# ---------- py3_23: Python ----------
import os

files = [str(folder + '\\' + f) for f in os.listdir(folder) if not os.path.isdir(os.path.join(folder, f))]

model_names = [f.split('\\')[-1][:-7] for f in files]
# ---------- end py3_23 ----------
cset_4 = CreateSet(List=py3_23.model_names)  # -> Set, Map
cset_5 = CreateSet(List=py3_23.files)  # -> Set, Map
item_19 = ListItem(List=cset_5.Set, Index=current_selected_model_visualise_module_4, Wrap=invert(True))
rename_current_model_name_4 = RemoteReceiver(rename_current_model_name)
pre_remove_current_model_3 = RemoteReceiver(pre_remove_current_model)
pre_rename_current_model_3 = RemoteReceiver(pre_rename_current_model)
current_all_created_models_names = RemoteSender(cset_4.Set)
loadobjects = HBLoadObjects(hb_file=item_19, load=Toggle(True))  # -> report, flatten(hb_objs); plug-in component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
show_honeybee_element_3 = RemoteReceiver(show_honeybee_element)
py3_24 = Python3Script(rename=pre_rename_current_model_3, rename_name=rename_current_model_name_4, file_path=item_19)  # -> name_dictionary
# ---------- py3_24: Python ----------
import os
from pathlib import Path
import time

if rename:
    rename_name = "\\".join(file_path.split("\\")[:-1]) + "\\" + rename_name
    
    if rename_name.endswith(".hbjson"):
        pass
    else:
        rename_name = rename_name + ".hbjson"

    if os.path.exists(file_path):
        os.rename(file_path, rename_name)
        current_time = time.time()
        os.utime(rename_name, (current_time, current_time))
    name_dictionary = (Path(file_path).stem, Path(rename_name).stem)
# ---------- end py3_24 ----------
py3_25 = Python3Script(remove=pre_remove_current_model_3, file_path=item_19)
# ---------- py3_25: Python ----------
import os
import shutil

if remove:
    print("hell oworld")
    if os.path.exists(file_path):
        print("hello")
        dir_path = os.path.dirname(file_path)
        new_dir = os.path.join(dir_path, "deleted")
        os.makedirs(new_dir, exist_ok = True)
        shutil.move(file_path, os.path.join(new_dir, os.path.basename(file_path)))
# ---------- end py3_25 ----------
data_17 = Data(loadobjects.hb_objs)
panel_110 = Panel(item_19)
panel_111 = Panel(pre_remove_current_model_3)
hasdata_4 = DataExists(Data=loadobjects.hb_objs)
gate_13 = StreamGate(Stream=loadobjects.hb_objs, Gate=show_honeybee_element_3)  # -> Target0, Target1
deconstructmodel = HBDeconstructModel(model=data_17)  # -> rooms, faces, apertures, doors, shades; plug-in component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
py3_26 = Python3Script(x=py3_24)  # -> out, a
# ---------- py3_26: Python ----------
a = x is not None
# ---------- end py3_26 ----------
honeybee_model_ready = RemoteSender(hasdata_4)
vizbytype = HBVisualizeByType(hb_objs=gate_13.Target1)  # -> walls, interior_walls, roofs, ceilings, exterior_floors, interior_floors, air_walls, apertures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; plug-in component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
gate_14 = StreamGate(Stream=py3_24, Gate=py3_26.a)  # -> Target0, Target1
geoprop = HBGeometryProperties(rooms=flatten(deconstructmodel.rooms))  # -> ext_wall_area, ext_win_area, volume, floor_area, floor_ep_constr; plug-in component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
rec_24 = DataRecorder(gate_14.Target1, DataLimit=-10, RecordData=True)
model_name_dictionary = RemoteSender(rec_24)
panel_112 = Panel(geoprop.floor_area)

current_all_created_models_names_2 = RemoteReceiver(current_all_created_models_names)
honeybee_model_ready_2 = RemoteReceiver(honeybee_model_ready)
lng_9 = ListLength(List=current_all_created_models_names_2)
subtraction_12 = Subtraction(A=lng_9, B="1")
current_all_created_models_names_3 = RemoteReceiver(current_all_created_models_names)
filter_33 = StreamFilter(Gate=honeybee_model_ready_2, Stream0=Slider(500, range=0..1000), Stream1=Slider(1000000, range=0..1000000))
filter_34 = StreamFilter(Gate=honeybee_model_ready_2, Stream0="Create a model before running the simulation", Stream1=" ")
tooltip_10 = AttachTooltipToElement(ElementsToAttachTo=button_4, TooltipContent=filter_34, ShowDelay=filter_33, Duration=2000)
expression_35 = Expression(x=model_name_2, y=current_all_created_models_names_3, Expression="x=y")
honeybee_model_ready_3 = RemoteReceiver(honeybee_model_ready)
ma_19 = MassAddition(Input=expression_35)  # -> Result, PartialResults
hideshow_14 = HideShowElement(ElementToHideShow=button_4, Show=True, Collapse=True, Disable=invert(honeybee_model_ready_3))

# ----
# Models created in the
# the current folder
panel_113 = Panel(py3_23.model_names)

nulls_in_empty_3 = NullsInEmptyBranches(DataWithEmptyBranches=cset_5.Set)
null_32 = NullItem(Item=nulls_in_empty_3)  # -> NullFlags, InvalidFlags, Description
item_20 = ListItem(List=cset_4.Set, Index=current_selected_model_visualise_module_4, Wrap=invert(True))
bool_38 = Boolean(invert(null_32.NullFlags))
honeybee_model_exists = RemoteSender(bool_38)
honeybee_model_exists_2 = RemoteReceiver(honeybee_model_exists)
hideshow_15 = HideShowElement(ElementToHideShow=pulldown_2, Show=honeybee_model_exists_2, Collapse=True, Disable=False)
honeybee_model = Data(loadobjects.hb_objs)
model_name_dictionary_2 = RemoteReceiver(model_name_dictionary)
current_all_created_models_names_4 = RemoteReceiver(current_all_created_models_names)
current_all_created_models_names_5 = RemoteReceiver(current_all_created_models_names)
model_name_dictionary_3 = RemoteReceiver(model_name_dictionary)

# ---- group: Visualize module (continued)
current_all_created_models_names_6 = RemoteReceiver(current_all_created_models_names)
current_all_created_models_names_7 = RemoteReceiver(current_all_created_models_names)
mindex_5 = MemberIndex(Set=current_all_created_models_names_6, Member=rename_current_model_name_2)  # -> Index, Count
lng_10 = ListLength(List=current_all_created_models_names_7)
subtraction_13 = Subtraction(A=lng_10, B="1")
bool_39 = Boolean(invert(mindex_5.Count))
filter_35 = StreamFilter(Gate=bool_39, Stream0=Slider(500, range=0..1000), Stream1=Slider(1000000, range=0..1000000))
filter_36 = StreamFilter(Gate=bool_39, Stream0="Model name already exists", Stream1=" ")
tooltip_11 = AttachTooltipToElement(ElementsToAttachTo=button_17, TooltipContent=filter_36, ShowDelay=filter_35, Duration=2000)
honeybee_model_exists_3 = RemoteReceiver(honeybee_model_exists)
honeybee_model_exists_4 = RemoteReceiver(honeybee_model_exists)
honeybee_model_exists_5 = RemoteReceiver(honeybee_model_exists)
hideshow_16 = HideShowElement(ElementToHideShow=[pulldown_6, button_18], Show=honeybee_model_exists_3, Collapse=True, Disable=False)
hideshow_17 = HideShowElement(ElementToHideShow=button_17, Show=honeybee_model_exists_4, Collapse=True, Disable=mindex_5.Count)
hideshow_18 = HideShowElement(ElementToHideShow=textbox_8, Show=honeybee_model_exists_5, Collapse=True, Disable=False)

# ---- group: Analysis module (continued)
honeybee_model_ready_4 = RemoteReceiver(honeybee_model_ready)
honeybee_model_ready_5 = RemoteReceiver(honeybee_model_ready)
honeybee_model_ready_6 = RemoteReceiver(honeybee_model_ready)
filter_37 = StreamFilter(Gate=honeybee_model_ready_4, Stream0=Slider(500, range=0..1000), Stream1=Slider(1000000, range=0..1000000))
filter_38 = StreamFilter(Gate=honeybee_model_ready_4, Stream0="Create a model before running the simulation", Stream1=" ")
filter_39 = StreamFilter(Gate=honeybee_model_ready_5, Stream0=Slider(500, range=0..1000), Stream1=Slider(1000000, range=0..1000000))
filter_40 = StreamFilter(Gate=honeybee_model_ready_5, Stream0="Create a model before running the simulation", Stream1=" ")
hideshow_19 = HideShowElement(ElementToHideShow=button_22, Show=True, Collapse=True, Disable=invert(honeybee_model_ready_6))
tooltip_12 = AttachTooltipToElement(ElementsToAttachTo=button_22, TooltipContent=filter_38, ShowDelay=filter_37, Duration=2000)
tooltip_13 = AttachTooltipToElement(ElementsToAttachTo=button_24, TooltipContent=filter_40, ShowDelay=filter_39, Duration=2000)
honeybee_model_ready_7 = RemoteReceiver(honeybee_model_ready)
hideshow_20 = HideShowElement(ElementToHideShow=button_24, Show=True, Collapse=True, Disable=invert(honeybee_model_ready_7))
honeybee_model_ready_8 = RemoteReceiver(honeybee_model_ready)
hideshow_21 = HideShowElement(ElementToHideShow=label_29, Show=invert(honeybee_model_ready_8), Collapse=True, Disable=False)

# ----
honeybee_model_exists_6 = RemoteReceiver(honeybee_model_exists)
honeybee_model_exists_7 = RemoteReceiver(honeybee_model_exists)
honeybee_model_exists_8 = RemoteReceiver(honeybee_model_exists)
hideshow_22 = HideShowElement(ElementToHideShow=label_13, Show=invert(honeybee_model_exists_7), Collapse=True, Disable=False)
hideshow_23 = HideShowElement(ElementToHideShow=entwine_16, Show=honeybee_model_exists_8, Collapse=True, Disable=False)

honeybee_model_exists_9 = RemoteReceiver(honeybee_model_exists)
hideshow_24 = HideShowElement(ElementToHideShow=label_40, Show=invert(honeybee_model_exists_9), Collapse=True, Disable=False)

# ---- group: Prepare model (continued)
bool_40 = Boolean(ma_19.Result)
filter_41 = StreamFilter(Gate=bool_40, Stream0="Save model", Stream1="Update model")
setbtn = SetButton(ButtonToModify=button_19, ButtonName=filter_41)

# ----
tabs = TabbedView(
    TabNames=panel_15,
    TabTextSize=Slider(14, range=0..100),
    Tab0=flatten(stack_73),
    Tab1=flatten(stack_65),
    Tab2=flatten(entwine_82))
values_119 = ValueListener(Elements=tabs, SomeProperty=True)  # -> Values, Indices
current_tab_index = RemoteSender(values_119.Indices)
stack_80 = CreateStack(UIElements=tabs, Horizontal=True)
entwine_108 = Entwine(Branch00=stack_72, Branch01=stack_80, FlattenInputs=True)  # -> flatten(Result)
addelems_8 = AddElements(Window=launchwin_7, Elements=flatten(entwine_108), DoVLChecking=True)  # -> AddedElements, ElementNames
heath_elements = RemoteSender(addelems_8.AddedElements)

current_tab_index_2 = RemoteReceiver(current_tab_index)
filter_42 = StreamFilter(
    Gate=current_tab_index_2,
    Stream0="Geometry module",
    Stream1="Program module",
    Stream2="Construction module",
    Stream3="Assembly module",
    Stream4="Visualize module",
    Stream5="Analysis module")
filter_43 = StreamFilter(
    Gate=current_tab_index_2,
    Stream0=panel_92,
    Stream1=panel_90,
    Stream2=panel_91,
    Stream3=panel_93,
    Stream4=panel_94,
    Stream5=panel_95)
settextblock_10 = SetTextBlockContents(TextBlockToModify=tb_18, NewTextBlockContents=filter_43)
setlabel_3 = SetLabelContents(LabelToModify=label_50, NewLabelContents=filter_42)

event_42 = EventGate(Data=values_119.Values)  # -> Data, IsNew

current_tab = RemoteSender(event_42.Data)

current_tab_2 = RemoteReceiver(current_tab)
expression_36 = Expression(x=tab_create_model_4, y=current_tab_2, Expression="x=y")
and_8 = GateAnd(A=equals_16.Inequality, B=expression_36)
event_43 = EventGate(Data=and_8)  # -> Data, IsNew

# ---- group: Prepare model (continued)
current_tab_3 = RemoteReceiver(current_tab)
expression_37 = Expression(x=tab_create_model_3, y=current_tab_3, Expression="x=y")
and_9 = GateAnd(A=equals_9.Inequality, B=expression_37)
event_44 = EventGate(Data=and_9)  # -> Data, IsNew
create_model_2 = RemoteSender(event_44.Data)

# ----
current_tab_4 = RemoteReceiver(current_tab)
expression_38 = Expression(x=tab_load_inspect_model_6, y=current_tab_4, Expression="x=y")
and_10 = GateAnd(A=equals_2.Inequality, B=expression_38)
event_45 = EventGate(Data=and_10)  # -> Data, IsNew
cyclops_info_url = RemoteSender(event_45.Data)

current_tab_5 = RemoteReceiver(current_tab)
expression_39 = Expression(x=tab_simulate_4, y=current_tab_5, Expression="x≠y")
freeze_gate_35 = StreamFreezeGate(Data=expression_39, PassingSwitch=expression_39, Freeze=True)
setexp = SetExpander(Expander=expander_4, ExpandedOpen=invert(freeze_gate_35))

current_tab_6 = RemoteReceiver(current_tab)
expression_40 = Expression(x=tab_simulate_5, y=current_tab_6, Expression="x≠y")
freeze_gate_36 = StreamFreezeGate(Data=expression_40, PassingSwitch=expression_40, Freeze=True)
setexp_2 = SetExpander(Expander=expander_5, ExpandedOpen=invert(freeze_gate_36))

current_tab_7 = RemoteReceiver(current_tab)
expression_41 = Expression(x=tab_simulate_6, y=current_tab_7, Expression="x≠y")
freeze_gate_37 = StreamFreezeGate(Data=expression_41, PassingSwitch=expression_41, Freeze=True)
setexp_3 = SetExpander(Expander=expander_7, ExpandedOpen=invert(freeze_gate_37))

cyclops_info_url_2 = RemoteReceiver(cyclops_info_url)
py3_27 = Python3Script(url=item_9, launch=cyclops_info_url_2)  # same code as py3

# ----
# Determine which is the currently selected model, in the current tab
tab_load_inspect_model_11 = RemoteReceiver(tab_load_inspect_model)
current_selected_model_visualise_module_5 = RemoteReceiver(current_selected_model_visualise_module_3)
current_selected_model_analysis_module_2 = RemoteReceiver(current_selected_model_analysis_module)
tab_simulate_11 = RemoteReceiver(tab_simulate)
current_tab_8 = RemoteReceiver(current_tab)
current_tab_9 = RemoteReceiver(current_tab)
expression_42 = Expression(x=tab_load_inspect_model_11, y=current_tab_8, Expression="x=y")
expression_43 = Expression(x=tab_simulate_11, y=current_tab_9, Expression="x=y")
gate_15 = StreamGate(Stream=current_selected_model_analysis_module_2, Gate=expression_43)  # -> Target0, Target1
gate_16 = StreamGate(Stream=current_selected_model_visualise_module_5, Gate=expression_42)  # -> Target0, Target1
py3_28 = Python3Script()  # -> out, newest_index; inputs files: list
# ---------- py3_28: Python ----------
""" Checks which of the input files was modified last"""

import os

m = -1
for i, f in enumerate(files):
    t = os.path.getmtime(f)
    # print (f, t)
    if t > m:
        m = t
        newest_index = i
# ---------- end py3_28 ----------
panel_114 = Panel(gate_16.Target1)
panel_115 = Panel(gate_15.Target1)
py3_29 = Python3Script(x2=gate_16.Target1, x3=gate_15.Target1, x4=py3_28.newest_index)  # -> out, a
# ---------- py3_29: Python ----------
""" Keeps track of the most recently updated value using stickycontext"""
""" Kind hacky tbh... but seems to work"""

import scriptcontext as sc

if not sc.sticky.get("current_model_index"):
    sc.sticky["current_model_index"] = (None, (None, None, None))

inputs = (x2, x3, x4)
for i, (u, v) in enumerate(zip(inputs, sc.sticky["current_model_index"][1])):
    if u != v:
        sc.sticky["current_model_index"] = (i, inputs)
        break
a = inputs[sc.sticky["current_model_index"][0]]
# ---------- end py3_29 ----------
event_46 = EventGate(Data=py3_29.a)  # -> Data, IsNew
current_selected_model = RemoteSender()
panel_116 = Panel(event_46.Data)

# ---- group: Visualize module (continued)
current_selected_model_2 = RemoteReceiver(current_selected_model)
setlist_3 = SetListContents(ListToModify=pulldown_6, NewListContents=current_all_created_models_names_7, SelectedIndex=current_selected_model_2)
current_tab_10 = RemoteReceiver(current_tab)
current_tab_11 = RemoteReceiver(current_tab)
current_tab_12 = RemoteReceiver(current_tab)
expression_44 = Expression(x=tab_load_inspect_model_2, y=current_tab_10, Expression="x=y")
expression_45 = Expression(x=tab_load_inspect_model_3, y=current_tab_11, Expression="x=y")
expression_46 = Expression(x=tab_load_inspect_model_4, y=current_tab_12, Expression="x=y")
and_11 = GateAnd(A=equals_6.Inequality, B=expression_44)
and_12 = GateAnd(A=equals_7.Inequality, B=expression_45)
and_13 = GateAnd(A=equals_8.Inequality, B=expression_46)
event_47 = EventGate(Data=and_11)  # -> Data, IsNew
event_48 = EventGate(Data=and_12)  # -> Data, IsNew
event_49 = EventGate(Data=and_13)  # -> Data, IsNew
post_remove_current_model = RemoteSender(event_47.Data)
load_honeybee_model = RemoteSender(event_48.Data)
post_rename_current_model = RemoteSender(event_49.Data)

# ----
current_selected_model_3 = RemoteReceiver(current_selected_model)
setlist_4 = SetListContents(ListToModify=pulldown_2, NewListContents=current_all_created_models_names_2, SelectedIndex=current_selected_model_3)

current_tab_13 = RemoteReceiver(current_tab)
expression_47 = Expression(x=tab_simulate_10, y=current_tab_13, Expression="x=y")
and_14 = GateAnd(A=equals_14.Inequality, B=expression_47)

current_tab_14 = RemoteReceiver(current_tab)
expression_48 = Expression(x=tab_load_inspect_model_7, y=current_tab_14, Expression="x=y")
current_tab_15 = RemoteReceiver(current_tab)
current_tab_16 = RemoteReceiver(current_tab)
expression_49 = Expression(x=tab_load_inspect_model_8, y=current_tab_15, Expression="x=y")
expression_50 = Expression(x=tab_load_inspect_model_9, y=current_tab_16, Expression="x=y")
and_15 = GateAnd(A=expression_49, B=values_35.Values)
and_16 = GateAnd(A=values_33.Values, B=expression_49)
and_17 = GateAnd(A=item_2.Item2, B=expression_48)
and_18 = GateAnd(A=item_2.Item3, B=expression_48)
and_19 = GateAnd(A=item_2.Item, B=expression_48)
and_20 = GateAnd(A=item_2.Item4, B=expression_48)
and_21 = GateAnd(A=item_2.Item1, B=expression_48)
and_22 = GateAnd(A=item_2.Item5, B=expression_48)
and_23 = GateAnd(A=event_11.Data, B=expression_50)
face_attribute_visualize = RemoteSender(and_15)
room_attribute_visualize = RemoteSender(and_16)
show_honeybee_windows = RemoteSender(and_20)
show_honeybee_walls = RemoteSender(and_19)
show_honeybee_roof = RemoteSender(and_21)
show_honeybee_floors = RemoteSender(and_17)
show_honeybee_context = RemoteSender(and_22)
show_honeybee_ground = RemoteSender(and_18)
bake_model = RemoteSender(and_23)

# ----
# Visualise properties
# # Visualise properties
# This cluster visualises room and face attributes of a Honeybee model
# 
# ## Instructions
# Input the Honeybee model to be visualised and select room/face attributes using the HB Room Attributes/HB Room Energy Attibrutes/HB Face Attributes/HB Face Energy Attributes dropdown components. Adjust precision of the attributes using the `Number of decimals` inputs
# 
# ## Inputs
# - `Honeybee model` - Honeybee model to be visualised
# - `Room attribute` - Honeybee Room  or Room Energy attribute to visualise
# - `Number of decimals (room)` - Precision of room attribute output
# - `Face attribute` - Honeybee Face  or Face Energy attribute to visualise
# - `Number of decimals (face)` - Precision of face attribute output
# 
# ## Outputs
# - `Visualised room attributes` - mesh representing the selected room attribute
# - `Visualised face attributes` - mesh representing the selected face attribute
# 
# ## Interpretation
# To be added...
room_attribute_visualize_2 = RemoteReceiver(room_attribute_visualize)
face_attribute_visualize_2 = RemoteReceiver(face_attribute_visualize)
room_attribute_2 = RemoteReceiver(room_attribute)
face_attribute_2 = RemoteReceiver(face_attribute)
gate_17 = StreamGate(Stream=face_attribute_2, Gate=face_attribute_visualize_2)  # -> Target0, Target1
gate_18 = StreamGate(Stream=room_attribute_2, Gate=room_attribute_visualize_2)  # -> Target0, Target1
face_attribute_3 = Text(gate_17.Target1)
data_18 = Data(loadobjects.hb_objs)
room_attribute_3 = Text(gate_18.Target1)
number_of_decimals_room = Number(Slider(4, range=0..10))
legendpar = LBLegendParameters(num_decimals=number_of_decimals_room)  # -> leg_par; plug-in component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
legendpar_2 = LBLegendParameters(num_decimals=number_of_decimals_room)  # -> leg_par; plug-in component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
colorroomattr = HBColorRoomAttributes(rooms_model=flatten(data_18), attribute=room_attribute_3, legend_par=legendpar)  # -> mesh, legend, wire_frame, values, colors, vis_set; plug-in component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
colorfaceattr = HBColorFaceAttributes(hb_objs=flatten(data_18), attribute=face_attribute_3, legend_par=legendpar_2)  # -> mesh, legend, wire_frame, values, colors, vis_set; plug-in component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
room_attribute_visualize_3 = RemoteReceiver(room_attribute_visualize)
face_attribute_visualize_3 = RemoteReceiver(face_attribute_visualize)
merge_9 = Merge(Data1=colorfaceattr.mesh, Data2=colorfaceattr.legend, Data3=colorfaceattr.wire_frame)
merge_10 = Merge(Data1=colorroomattr.mesh, Data2=colorroomattr.legend, Data3=colorroomattr.wire_frame)
gate_19 = StreamGate(Stream=merge_9, Gate=face_attribute_visualize_3)  # -> Target0, Target1
gate_20 = StreamGate(Stream=merge_10, Gate=room_attribute_visualize_3)  # -> Target0, Target1
preview_2 = CustomPreview(Geometry=gate_20.Target1, Material=ColourSwatch(SwatchColor=RGB(84, 84, 84)))
preview_3 = CustomPreview(Geometry=gate_19.Target1, Material=ColourSwatch(SwatchColor=RGB(84, 84, 84)))

room_attribute_visualize_4 = RemoteReceiver(room_attribute_visualize)
face_attribute_visualize_4 = RemoteReceiver(face_attribute_visualize)

# ---- group: Geometry module (continued)
current_tab_17 = RemoteReceiver(current_tab)
expression_51 = Expression(x=tab_create_model_2, y=current_tab_17, Expression="x=y")
and_24 = GateAnd(A=bool_12, B=expression_51)
preview_4 = RemoteSender(and_24)
savegeometry = RemoteSender(event_43.Data)

# ----
savegeometry_2 = RemoteReceiver(savegeometry)
savegeometry_3 = RemoteReceiver(savegeometry)
savegeometry_4 = RemoteReceiver(savegeometry)
preview_5 = RemoteReceiver(preview_4)
savegeometry_5 = RemoteReceiver(savegeometry)
savegeometry_6 = RemoteReceiver(savegeometry)
preview_6 = RemoteReceiver(preview_4)
preview_7 = RemoteReceiver(preview_4)
preview_8 = RemoteReceiver(preview_4)
py3_30 = Python3Script(x=savegeometry_2)  # -> a
# ---------- py3_30: Python ----------
"""Grasshopper Script"""

import rhinoscriptsyntax as rs

if x:
    rs.Command("SelNone")
    a = True
# ---------- end py3_30 ----------
or_11 = GateOr(A=savegeometry_3, B=preview_5, C=expression_11)
or_12 = GateOr(A=savegeometry_4, B=preview_6, C=expression_13)
or_13 = GateOr(A=savegeometry_6, B=preview_8, C=expression_15)
preview_9 = RemoteReceiver(preview_4)
or_14 = GateOr(A=Toggle(True), B=py3_30)
or_15 = GateOr(A=savegeometry_5, B=preview_7, C=expression_14)
savegeometry_7 = RemoteReceiver(savegeometry)
gate_21 = StreamGate(Stream=heath_geometry_type_key_6, Gate=or_13)  # -> Target0, Target1
gate_22 = StreamGate(Stream=heath_geometry_type_key_3, Gate=or_11)  # -> Target0, Target1
gate_23 = StreamGate(Stream=heath_geometry_type_key_5, Gate=or_12)  # -> Target0, Target1
selobj_2 = ObjectsBySelection(Reset=or_14, LiveMode=True)
gate_24 = StreamGate(Stream=heath_geometry_type_key_4, Gate=or_15)  # -> Target0, Target1
seletedgeometry = RemoteSender(selobj_2)
seletedgeometry_2 = RemoteReceiver(seletedgeometry)
freeze_gate_38 = StreamFreezeGate(Data=seletedgeometry_2, PassingSwitch=presavegeometry_2, Hold=False)
seletedgeometry_3 = RemoteReceiver(seletedgeometry)
detatt = DetachAttributes(Geometry=seletedgeometry_3)  # -> Geometry, Attributes
filtertype = FilterByType(ObjectType="Extrusion", Geometry=freeze_gate_38, invertFilter=False, returnNulls=False)  # -> ExcludedGeometry, IncludedGeometry
filtertype_2 = FilterByType(ObjectType="Brep", Geometry=freeze_gate_38, invertFilter=False, returnNulls=False)  # -> ExcludedGeometry, IncludedGeometry
filtertype_3 = FilterByType(ObjectType="Surface", Geometry=freeze_gate_38, invertFilter=False, returnNulls=False)  # -> ExcludedGeometry, IncludedGeometry
filtertype_4 = FilterByType(ObjectType="Mesh", Geometry=freeze_gate_38, invertFilter=False, returnNulls=False)  # -> ExcludedGeometry, IncludedGeometry
filtertype_5 = FilterByType(ObjectType="Polysurface", Geometry=freeze_gate_38, invertFilter=False, returnNulls=False)  # -> ExcludedGeometry, IncludedGeometry
ef_att = EleFrontAttributes(Attributes=detatt.Attributes, Keys="Construction", Values=constructiontype, maintainBakeName=False)
modratt = ModifyRhinoObjectAttributes(ReferencedObject=seletedgeometry_3, Attributes=ef_att, Activate=saveconstruction)
or_16 = GateOr(A=preview_9, B=room_attribute_visualize_4, C=face_attribute_visualize_4, D=show_honeybee_element_2, E=and_14, F=not)
refkv_2 = ReferenceByKeyValue(Key=gate_22.Target1, Val=gate_5.Target1, lightweight=False)
refkv_3 = ReferenceByKeyValue(Key=gate_21.Target1, Val=gate_6.Target1, lightweight=False)
refkv_4 = ReferenceByKeyValue(Key=gate_23.Target1, Val=gate_8.Target1, lightweight=False)
planar = IsPlanar(Surface=filtertype_3.IncludedGeometry, Interior=True)  # -> Planar, Plane
refkv_5 = ReferenceByKeyValue(Key=gate_24.Target1, Val=gate_7.Target1, lightweight=False)
ispolysurfaceclosed = Python3Script(Ps=[filtertype.IncludedGeometry, filtertype_2.IncludedGeometry, filtertype_5.IncludedGeometry])  # -> C; inputs Ps: Brep
# ---------- ispolysurfaceclosed: Python ----------
if Ps:
    C = Ps.IsSolid
# ---------- end ispolysurfaceclosed ----------
panel_117 = Panel(modratt)
lng_11 = ListLength(List=freeze_gate_38)  # disabled
cluster_5 = Cluster_6(id=refkv_5)
filter_geometry_by_active_layer = Cluster_6(id=refkv_2)
cluster_6 = Cluster_6(id=refkv_3)
cluster_7 = Cluster_6(id=refkv_4)
cull_10 = CullPattern(
    List=[filtertype.IncludedGeometry, filtertype_2.IncludedGeometry, filtertype_5.IncludedGeometry],
    CullPattern=ispolysurfaceclosed)
cull_11 = CullPattern(List=filtertype_3.IncludedGeometry, CullPattern=planar.Planar)
savegeometry_8 = RemoteReceiver(savegeometry)  # disabled
filter_44 = StreamFilter(Gate=or_16, Stream0="Shaded", Stream1="Wireframe")
preview_10 = RemoteReceiver(preview_4)
preview_11 = RemoteReceiver(preview_4)
preview_12 = RemoteReceiver(preview_4)
preview_13 = RemoteReceiver(preview_4)
filter_45 = StreamFilter(
    Gate=geometrytype_validate_2,
    Stream0=cull_10,
    Stream1=cull_11,
    Stream2=[filtertype_5.IncludedGeometry, filtertype_3.IncludedGeometry],
    Stream3=[filtertype_4.IncludedGeometry, filtertype_3.IncludedGeometry, filtertype_5.IncludedGeometry, filtertype.IncludedGeometry, filtertype_2.IncludedGeometry],
    Stream4=freeze_gate_38)  # -> flatten(Stream)
id = Guid(filter_45)
txt_5 = Text(id)
cset_6 = CreateSet(List=txt_5)  # -> Set, Map
geo = Geometry(cset_6.Set)
detatt_2 = DetachAttributes(Geometry=geo)  # -> Geometry, Attributes
ef_att_2 = EleFrontAttributes(Attributes=detatt_2.Attributes, Keys=heath_geometry_type_key_2, Values=geometrytype_2, maintainBakeName=False)
modratt_2 = ModifyRhinoObjectAttributes(ReferencedObject=geo, Attributes=ef_att_2, Activate=savegeometry_7)
panel_118 = Panel(modratt_2)
lng_12 = ListLength(List=geo)  # disabled
equals_30 = Equality(FirstNumber=lng_11, SecondNumber=lng_12)  # -> Equality, Inequality; disabled
py3_31 = Python3Script(v=filter_44)
# ---------- py3_31: Python ----------
import Rhino
import scriptcontext as sc

if v:
    view = sc.doc.Views.ActiveView
    dm = Rhino.Display.DisplayModeDescription.FindByName(v)
    if dm:
        view.ActiveViewport.DisplayMode = dm
        view.Redraw()
# ---------- end py3_31 ----------
freeze_gate_39 = StreamFreezeGate(Data=equals_30.Equality, PassingSwitch=savegeometry_8)  # disabled
gate_25 = StreamGate(Stream=cluster_7, Gate=preview_11)  # -> Target0, Target1
gate_26 = StreamGate(Stream=cluster_6, Gate=preview_12)  # -> Target0, Target1
gate_27 = StreamGate(Stream=cluster_5, Gate=preview_10)  # -> Target0, Target1
gate_28 = StreamGate(Stream=filter_geometry_by_active_layer, Gate=preview_13)  # -> Target0, Target1
hasdata_5 = DataExists(Data=freeze_gate_39)  # disabled
preview_14 = CustomPreview(Geometry=gate_25.Target1, Material=ColourSwatch(SwatchColor=RGBA(128, 125, 0, 75)))
preview_15 = CustomPreview(Geometry=gate_26.Target1, Material=ColourSwatch(SwatchColor=RGBA(0, 17, 128, 75)))
preview_16 = CustomPreview(Geometry=gate_27.Target1, Material=ColourSwatch(SwatchColor=RGBA(128, 0, 102, 75)))
preview_17 = CustomPreview(Geometry=gate_28.Target1, Material=ColourSwatch(SwatchColor=RGBA(4, 128, 0, 75)))
filter_46 = StreamFilter(Gate=hasdata_5, Stream0=panel_32, Stream1=freeze_gate_39)  # disabled
geometry_saved = RemoteSender(filter_46)  # disabled

# ---- group: Geometry module (continued)
seletedgeometry_4 = RemoteReceiver(seletedgeometry)
seletedgeometry_5 = RemoteReceiver(seletedgeometry)  # disabled
lng_13 = ListLength(List=seletedgeometry_4)
seletedgeometry_6 = RemoteReceiver(seletedgeometry)
geometry_saved_2 = RemoteReceiver(geometry_saved)  # disabled
bool_41 = Boolean(lng_13)
lng_14 = ListLength(List=seletedgeometry_5)  # disabled
lng_15 = ListLength(List=seletedgeometry_6)
filter_47 = StreamFilter(Gate=bool_41, Stream0=Slider(500, range=0..1000), Stream1=Slider(1000000, range=0..1000000))
filter_48 = StreamFilter(Gate=bool_41, Stream0="First select the geometry in Rhino", Stream1=" ")
nor = GateNor(A=geometry_saved_2, B=lng_14)  # disabled
hideshow_25 = HideShowElement(ElementToHideShow=button_26, Show=True, Collapse=True, Disable=invert(lng_15))
hideshow_26 = HideShowElement(ElementToHideShow=label_35, Show=nor, Collapse=True, Disable=False)  # disabled
tooltip_14 = AttachTooltipToElement(ElementsToAttachTo=button_26, TooltipContent=filter_48, ShowDelay=filter_47, Duration=2000)

# ---- group: Analysis module (continued)
current_tab_18 = RemoteReceiver(current_tab)
current_tab_19 = RemoteReceiver(current_tab)
expression_52 = Expression(x=tab_simulate_2, y=current_tab_18, Expression="x=y")
expression_53 = Expression(x=tab_simulate_3, y=current_tab_19, Expression="x=y")
and_25 = GateAnd(A=equals_10.Inequality, B=expression_52)
and_26 = GateAnd(A=equals_11.Inequality, B=expression_53)
event_50 = EventGate(Data=and_25)  # -> Data, IsNew
event_51 = EventGate(Data=and_26)  # -> Data, IsNew
run_simple_energy_simulations = RemoteSender(event_50.Data)
run_daylight_simulations = RemoteSender(event_51.Data)

# ----
run_daylight_simulations_2 = RemoteReceiver(run_daylight_simulations)
run_daylight_simulations_3 = RemoteReceiver(run_daylight_simulations)

current_tab_20 = RemoteReceiver(current_tab)
expression_54 = Expression(x=tab_load_inspect_model_5, y=current_tab_20, Expression="x=y")
and_27 = GateAnd(A=event_13.Data, B=expression_54)
weather_visualisation_bake = RemoteSender(and_27)
panel_119 = Panel(and_27)

current_tab_21 = RemoteReceiver(current_tab)
expression_55 = Expression(x=tab_load_inspect_model_10, y=current_tab_21, Expression="x=y")
and_28 = GateAnd(A=event_25.Data, B=expression_55)
cyclops_visualisation_bake = RemoteSender(and_28)

entwine_109 = Entwine(
    Branch00=stack_57,
    Branch01=label_6,
    Branch02=label_46,
    Branch03=stack_59,
    Branch04=stack_77,
    Branch05=stack_76,
    FlattenInputs=True)  # -> flatten(Result)

# ----
# Heath module info
panel_120 = Panel("""Energy use intensity (EUI): EUI measures the total energy consumed by a building annually per unit of its floor area.
Annual energy balance: A yearly overview of energy consumption and generation broken into categories such as heating, cooling, lighting, and equipment loads.
Daily cooling/heating profile: Hourly cooling or heating energy usage over a typical day.
Cooling/heating balance: The cooling or heating energy demand broken down by contributing factors across different periods.""")
panel_121 = Panel("Adjust the Window-to-Wall Ratio (WWR) slider to define the proportion of walls occupied by windows in the model. This determines window placement automatically. If diabled, windows that are maunally imported in the geometry module will be used.")
panel_122 = Panel("""Room attribute: Choose a property of the room to visualize and toggle its visibility using the "Show" checkbox.
Room energy attribute: Select energy-related attributes for rooms.
Face attribute: Visualize specific attributes for individual faces.
Face energy attribute: Display energy-specific properties for faces.""")
panel_123 = Panel("""By climate: Choose a predefined climate zone to automatically adjust construction properties for environmental conditions.

By type: Select the construction type that represents the structural system of the building.""")
panel_124 = Panel("""Building Type: Choose the type of building that corresponds to your model.

Room Type: Select the specific room type within the chosen building category.""")
panel_125 = Panel("""This dropdown menu allows you to select the type of geometry you want to work with in the model.

Room: Represents enclosed spaces or areas in the model.
Window: Refers to transparent surfaces, such as glass panels or openings.
Adjacent: Defines surfaces or spaces that are directly connected or neighboring the selected geometry.
Context: Includes external elements like surrounding structures or objects.""")
panel_126 = Panel("""Sky Dome: A 3D view of the sky with solar paths and light distribution.
Sky Mask: Shows visible portions of the sky from a location.
Wind Rose: Visualizes wind direction and speed.
Dry bulb temperature line chart: This chart shows the average daily dry bulb temperature variation throughout the year.
Dry bulb temperature 2D chart: This heatmap provides a detailed view of temperature variations by time of day and month.
Direct Sun Hours: Displays the total number of hours a surface receives direct sunlight throughout the year.
Incident Radiation: Represents the amount of solar radiation (in kWh/m²) received by the surface over the year.""")
panel_127 = Panel("""Spatial daylight autonomy (sDA): Shows the percentage of space that meets the daylight autonomy criteria.
Illuminance [Lux]: The intensity of light falling on a surface, measured in lumens per square meter.
Useful daylight illuminance (UDI): The percentage of time daylight levels fall within a desirable range (e.g., 50–3000 lux).""")
panel_128 = Panel("Assesses the environmental impact by calculating global warming potential (GWP) and visualizing contributions by model elements.")
panel_129 = Panel("""Current location: Displays the project's location .
Set location: Copy and paste from the website that is opened with the "Get clmate data" button, to retrieve climate data relevant to your project.
Get climate data: This button opens this website 
https://www.ladybug.tools/epwmap/""")
panel_130 = Panel("""Create new model: Create a new Honeybee model from the current imported geometry. Click the "update" button to load it into the UI.
Update: Load all of the models corresponding to this file, this can include models from previous sessions.
Remove current model: Delete the currently selected model.
Rename: Rename the currently selected model.""")
panel_131 = Panel("""Cooling Setpoint: Set the temperature at which cooling systems activate.

Heating Setpoint: Set the temperature at which heating systems activate.

Occupancy: Specify the expected number of occupants per 100 square meters.""")
panel_132 = Panel("""Window database: Access a library of window types with predefined thermal and solar properties.

Material database: Browse and select building materials with specific physical and thermal characteristics.

Construction database: Explore various construction assemblies and details for walls, roofs, and other elements.""")
panel_133 = Panel("Customize specific construction elements such as floors, walls and roofs by selecting from a list of options with their respective properties.")
info_save_geometry_2 = RemoteReceiver(info_save_geometry)
panel_134 = Panel("""Use this button to save the imported geometry as part of the Honeybee 
model. This ensures the geometry data is correctly stored and can be utilized for further analysis or visualization within the Heath.""")
panel_135 = Panel("This button generates a predefined sample model to help you explore and understand the tools features. Use it to test workflows, visualize geometry types, and familiarize yourself with the simulation processes before working with your own data.")
rec_25 = DataRecorder(info_save_geometry_2, DataLimit=-2, RecordData=True)
ma_20 = MassAddition(Input=rec_25)  # -> Result, PartialResults
entwine_110 = Entwine(Branch00=panel_122, Branch01=panel_126, FlattenInputs=True)  # -> flatten(Result)
entwine_111 = Entwine(Branch00=panel_120, Branch01=panel_127, Branch02=panel_128, FlattenInputs=True)  # -> flatten(Result)
entwine_112 = Entwine(Branch00="Model Visualization", Branch01="Weather Visualization", FlattenInputs=True)  # -> flatten(Result)
entwine_113 = Entwine(Branch00="Energy simulation", Branch01="Daylight simulation", Branch02="LCA", FlattenInputs=True)  # -> flatten(Result)
entwine_114 = Entwine(Branch00=panel_121, Branch01=panel_129, Branch02=panel_130, FlattenInputs=True)  # -> flatten(Result)
entwine_115 = Entwine(Branch00="Generate Windows Using WWR", Branch01="Location", Branch02="Model actions", FlattenInputs=True)  # -> flatten(Result)
entwine_116 = Entwine(Branch00=panel_124, Branch01=panel_131, FlattenInputs=True)  # -> flatten(Result)
entwine_117 = Entwine(Branch00=panel_123, Branch01=panel_132, Branch02=panel_133, FlattenInputs=True)  # -> flatten(Result)
entwine_118 = Entwine(Branch00="Select program", Branch01="Program settings", FlattenInputs=True)  # -> flatten(Result)
entwine_119 = Entwine(Branch00="Select Base Construction", Branch01="Databases", Branch02="Select Subset Constructions", FlattenInputs=True)  # -> flatten(Result)
entwine_120 = Entwine(Branch00="Geometry type", Branch01="Save Geometry", Branch02="Create test model", FlattenInputs=True)  # -> flatten(Result)
entwine_121 = Entwine(Branch00=panel_125, Branch01=panel_134, Branch02=panel_135, FlattenInputs=True)  # -> flatten(Result)
tb_19 = CreateTextBlock(TextSize=12, Justification=0)
label_51 = CreateLabel(LabelSize=18, Justification=0)
tb_20 = CreateTextBlock(TextSize=12, Justification=0)
tb_21 = CreateTextBlock(TextSize=12, Justification=0)
label_52 = CreateLabel(LabelSize=18, Justification=0)
label_53 = CreateLabel(LabelSize=18, Justification=0)
current_tab_index_3 = RemoteReceiver(current_tab_index)
filter_49 = StreamFilter(
    Gate=current_tab_index_3,
    Stream0=entwine_120,
    Stream1=entwine_118,
    Stream2=entwine_119,
    Stream3=entwine_115,
    Stream4=entwine_112,
    Stream5=entwine_113)
filter_50 = StreamFilter(
    Gate=current_tab_index_3,
    Stream0=entwine_121,
    Stream1=entwine_116,
    Stream2=entwine_117,
    Stream3=entwine_114,
    Stream4=entwine_110,
    Stream5=entwine_111)
format_31 = Format(
    Format="{0}, {1}, {2}, {3}",
    Culture=127,
    Data0=Slider(10, range=-10..10),
    Data1=Slider(0, range=-10..10),
    Data2=Slider(0, range=-10..10),
    Data3=Slider(0, range=-10..10))
format_32 = Format(
    Format="{0}, {1}, {2}, {3}",
    Culture=127,
    Data0=Slider(0, range=-10..10),
    Data1=Slider(10, range=-10..10),
    Data2=Slider(0, range=-10..10),
    Data3=Slider(0, range=-10..10))
entwine_122 = Entwine(Branch00=label_52, Branch01=tb_20, FlattenInputs=True)  # -> flatten(Result)
entwine_123 = Entwine(Branch00=label_51, Branch01=tb_19, FlattenInputs=True)  # -> flatten(Result)
entwine_124 = Entwine(Branch00=label_53, Branch01=tb_21, FlattenInputs=True)  # -> flatten(Result)
adjustpos_103 = AdjustElementPositioning(ElementsToAdjust=[tb_19, tb_21, tb_20], Margin=format_31, AbsolutePositioning=False, HorizontalAlignment=0)
adjustpos_104 = AdjustElementPositioning(ElementsToAdjust=[label_53, label_52], Margin=format_32, AbsolutePositioning=False, HorizontalAlignment=0)
setlabel_4 = SetLabelContents(LabelToModify=[label_51, label_53, label_52], NewLabelContents=filter_49)
settextblock_11 = SetTextBlockContents(TextBlockToModify=[tb_19, tb_21, tb_20], NewTextBlockContents=filter_50)
stack_81 = CreateStack(UIElements=entwine_122, Horizontal=invert(True))
stack_82 = CreateStack(UIElements=entwine_123, Horizontal=invert(True))
stack_83 = CreateStack(UIElements=entwine_124, Horizontal=invert(True))
entwine_125 = Entwine(Branch00=stack_82, Branch01=stack_83, Branch02=stack_81, FlattenInputs=True)  # -> flatten(Result)
database_modal_location_8 = RemoteReceiver(database_modal_location)
heath_accent_color_15 = RemoteReceiver(heath_accent_color)
info_save_geometry_3 = RemoteReceiver(info_save_geometry)

# ----
# Recursion
panel_136 = Panel("Geometry info")
objbynn_12 = GetObjectByNickname(NickName=panel_136)
geometry_info = Python3Script()  # -> status; same code as lca_window_status

entwine_126 = Entwine(Branch00=ma_20.Result, Branch01=geometry_info, FlattenInputs=True)
rec_26 = DataRecorder(entwine_126, DataLimit=2, RecordData=True)
item_21 = ListItem(List=rec_26, Index=0, Wrap=True)  # -> Item2, Item1, Item
equals_31 = Equality(FirstNumber=item_21.Item2, SecondNumber=item_21.Item1)  # -> Equality, Inequality
bang_10 = ExplodeTree(Data=equals_31.Inequality)  # -> Branch0, Branch1
py3_32 = Python3Script(x=bang_10.Branch0, y=bang_10.Branch1)  # -> a; same code as py3_5
event_52 = EventGate(Data=py3_32)  # -> Data, IsNew
freeze_gate_40 = StreamFreezeGate(Data=py3_32, PassingSwitch=event_52.IsNew)
event_53 = EventGate(Data=freeze_gate_40)  # -> Data, IsNew
panel_137 = Panel(event_53.Data)
launchwin_9 = LaunchWindow(
    Show=event_53.Data,
    Name="Module information",
    Width=Slider(430, range=0..1200),
    Height=Slider(450, range=0..1000),
    ChildStatus=1,
    EnableHorizScroll=False)
winstat_9 = WindowStatus(Window=launchwin_9)
winprops_9 = SetWindowProperties(
    Window=launchwin_9,
    StartingLocation=database_modal_location_8,
    Theme=0,
    AccentColor=heath_accent_color_15,
    ShowTitleBar=True,
    BackgroundColor=RGB(255, 255, 255),
    ScaleFactor=1)
geometry_info_status = RemoteSender(winstat_9)
py3_33 = Python3Script(window=launchwin_9, activate=info_save_geometry_3)  # same code as py3_6
addelems_9 = AddElements(Window=launchwin_9, Elements=flatten(entwine_125), DoVLChecking=True)  # -> AddedElements, ElementNames

geometry_info_status_2 = RemoteReceiver(geometry_info_status)
expression_56 = Expression(x="Hidden", y=geometry_info_status_2, Expression="x=y")
expire_8 = ExpireObject(ObjectToExpire=objbynn_12, Expire=expression_56)

# ----
# Create material tooltip
panel_138 = Panel(":")

# ----
# Create construction tooltip
panel_139 = Panel(":")

# ----
# Backend data inside layers
panel_140 = Panel("0, 0, 0")
path_2 = DataPath(panel_140)
path_3 = DataPath("0, 0, 0")

# ----
# Create window tooltip
number_slider_30 = Slider(0, range=0..100)
dom_8 = ConstructDomain(DomainStart=number_slider_30, DomainEnd=Slider(12, range=0..100))
dom_9 = ConstructDomain(DomainStart=Slider(0, range=0..100), DomainEnd=Slider(1, range=0..100))

# ----
# Remove material
pre_material_database_remove_material_2 = RemoteReceiver(pre_material_database_remove_material)
cull_12 = CullPattern(List=pre_material_database_remove_material_2, CullPattern=pre_material_database_remove_material_2)
lng_16 = ListLength(List=cull_12)
filter_51 = StreamFilter(Gate=lng_16, Stream0="False", Stream1=cull_12)
freeze_gate_41 = StreamFreezeGate(Data=pre_material_database_remove_material_2, PassingSwitch=filter_51, Freeze=True, Hold=False)
material_database_remove_material_2 = RemoteReceiver(material_database_remove_material)
getdocumentusertext_8 = Python3Script(run=material_database_remove_material_2, key="Heath materials")  # -> json_string; same code as getdocumentusertext
split_7 = TextSplit(Text=getdocumentusertext_8, Separators="|")
strtoobj_4 = HBStringToObject(hb_str=split_7)  # -> flatten(hb_obj); plug-in component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
decnstrmat_2 = HBDeconstructMaterial(mat=strtoobj_4)  # -> values, attr_names, r_val_si, r_val_ip; plug-in component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
item_22 = ListItem(List=decnstrmat_2.values, Index=0, Wrap=True)  # -> flatten(Item)
cset_7 = CreateSet(List=item_22)  # -> Set, Map
lng_17 = ListLength(List=cset_7.Set)
larger_2 = LargerThan(FirstNumber=lng_17, SecondNumber="1")  # -> LargerThan, OrEqualTo
bool_42 = Boolean(larger_2.LargerThan)

# ----
# Backend visible layers
panel_141 = Panel("1")
neg = Negative(Value=panel_141)
starting_layers = Slider(1, range=0..6)

create_model_3 = RemoteReceiver(create_model_2)
panel_142 = Panel(create_model_3)
py3_34 = Python3Script(x=create_model_3)  # -> folder; same code as load_models_ping
post_remove_current_model_2 = RemoteReceiver(post_remove_current_model)
post_rename_current_model_2 = RemoteReceiver(post_rename_current_model)
load_honeybee_model_2 = RemoteReceiver(load_honeybee_model)
or_17 = GateOr(A=load_honeybee_model_2, B=post_remove_current_model_2, C=post_rename_current_model_2)
current_model_name = RemoteSender(item_20)
show_honeybee_windows_2 = RemoteReceiver(show_honeybee_windows)
show_honeybee_context_2 = RemoteReceiver(show_honeybee_context)
show_honeybee_ground_2 = RemoteReceiver(show_honeybee_ground)
show_honeybee_floors_2 = RemoteReceiver(show_honeybee_floors)
show_honeybee_walls_2 = RemoteReceiver(show_honeybee_walls)
show_honeybee_roof_2 = RemoteReceiver(show_honeybee_roof)
gate_29 = StreamGate(Stream=[vizbytype.indoor_shades, vizbytype.outdoor_shades], Gate=show_honeybee_context_2)  # -> Target0, Target1
gate_30 = StreamGate(Stream=[vizbytype.apertures, vizbytype.interior_apertures], Gate=show_honeybee_windows_2)  # -> Target0, Target1
gate_31 = StreamGate(Stream=vizbytype.roofs, Gate=show_honeybee_roof_2)  # -> Target0, Target1
gate_32 = StreamGate(Stream=vizbytype.interior_floors, Gate=show_honeybee_floors_2)  # -> Target0, Target1
gate_33 = StreamGate(Stream=vizbytype.exterior_floors, Gate=show_honeybee_ground_2)  # -> Target0, Target1
gate_34 = StreamGate(Stream=[vizbytype.walls, vizbytype.interior_walls, vizbytype.air_walls], Gate=show_honeybee_walls_2)  # -> Target0, Target1
data_19 = Data(gate_31.Target1)
data_20 = Data(gate_30.Target1)
data_21 = Data(gate_34.Target1)
data_22 = Data(gate_32.Target1)
data_23 = Data(gate_33.Target1)
data_24 = Data(gate_29.Target1)

event_54 = EventGate(Data=or_17)  # -> Data, IsNew
expire_9 = ExpireObject(ObjectToExpire=objbynn, Expire=event_54.Data, AllObjects_Object=load_models_ping)

current_model_name_2 = RemoteReceiver(current_model_name)
current_model_name_3 = RemoteReceiver(current_model_name)

# ----
# Create material
material_database_categories_7 = RemoteReceiver(material_database_categories_2)
textbox_10 = CreateTextBox(Label="Name", DefaultText="New material", UpdateButton=invert(True), showLabel=True)
textbox_11 = CreateTextBox(DefaultText=Slider(0.036, range=0..2), UpdateButton=invert(True), showLabel=False)
label_54 = CreateLabel(LabelText="Conductivity [W/m-K]", LabelSize=12, Justification=0)
pulldown_25 = CreatePulldownMenu(
    Label="Material category",
    ListItems=material_database_categories_7,
    SelectedIndex=Slider(3, range=0..10),
    showLabel=True)
textbox_12 = CreateTextBox(DefaultText=Slider(28, range=0..1000), UpdateButton=invert(True), showLabel=False)
true_button_18 = CreateTrueOnlyButton(ButtonName="?", ButtonStyle=2)
button_41 = CreateButton(ButtonName="Create material", ButtonStyle=0)
textbox_13 = CreateTextBox(DefaultText=Slider(1500, range=0..10000), UpdateButton=invert(True), showLabel=False)
label_55 = CreateLabel(LabelText="A1-A3 [kg CO2eq/kg]", LabelSize=12, Justification=0)
label_56 = CreateLabel(LabelText="Specific heat [J/kg-K]", LabelSize=12, Justification=0)
label_57 = CreateLabel(LabelText="Density [kg/m3]", LabelSize=12, Justification=0)
values_120 = ValueListener(Elements=textbox_10, SomeProperty=True)  # -> Values, Indices
values_121 = ValueListener(Elements=true_button_18, SomeProperty=True)  # -> Values, Indices
values_122 = ValueListener(Elements=textbox_11, SomeProperty=True)  # -> Values, Indices
values_123 = ValueListener(Elements=button_41, SomeProperty=True)  # -> Values, Indices
values_124 = ValueListener(Elements=pulldown_25, SomeProperty=True)  # -> Values, Indices
values_125 = ValueListener(Elements=textbox_12, SomeProperty=True)  # -> Values, Indices
values_126 = ValueListener(Elements=textbox_13, SomeProperty=True)  # -> Values, Indices
create_material_name = RemoteSender(values_120.Values)
create_material_conductivity = RemoteSender(values_122.Values)
info_create_material = RemoteSender(values_121.Values)
freeze_gate_42 = StreamFreezeGate(Data=values_123.Values, PassingSwitch=invert(values_123.Values))
create_material_category = RemoteSender(values_124.Values)
create_material_sprecific_heat = RemoteSender(values_126.Values)
create_material_density = RemoteSender(values_125.Values)
entwine_127 = Entwine(Branch00=label_54, Branch01=textbox_11, FlattenInputs=True)  # -> flatten(Result)
entwine_128 = Entwine(Branch00=label_56, Branch01=textbox_13, FlattenInputs=True)  # -> flatten(Result)
entwine_129 = Entwine(Branch00=label_57, Branch01=textbox_12, FlattenInputs=True)  # -> flatten(Result)
bool_43 = Boolean(invert(freeze_gate_42))
stack_84 = CreateStack(UIElements=entwine_127, Horizontal=True)
entwine_130 = Entwine(Branch00=label_55, Branch01=textbox_4, FlattenInputs=True)  # -> flatten(Result)
tap_14 = TapBuffer(Reset=False, Incremental=True, Valve=bool_43, Hold=True)
create_material_modal_2 = RemoteReceiver(create_material_modal)
dam_22 = DataDam(DataA=tap_14, BufferDelay=2500000, BufferMode=2)
adjustelem_23 = AdjustElementAppearance(
    ElementsToAdjust=true_button_18,
    Foreground=ColourSwatch(SwatchColor=RGB(0, 0, 0)),
    Background=ColourSwatch(SwatchColor=RGB(230, 230, 230)),
    FontSize=Slider(12, range=0..300))
equals_32 = Equality(FirstNumber=tap_14, SecondNumber=dam_22)  # -> Equality, Inequality
and_29 = GateAnd(A=equals_32.Inequality, B=create_material_modal_2)
number_slider_31 = Slider(29, range=0..300)
event_55 = EventGate(Data=and_29)  # -> Data, IsNew
entwine_131 = Entwine(Branch00=textbox_10, Branch01=true_button_18, FlattenInputs=True)  # -> flatten(Result)
stack_85 = CreateStack(UIElements=entwine_129, Horizontal=True)
stack_86 = CreateStack(UIElements=entwine_128, Horizontal=True)
create_material = RemoteSender(event_55.Data)
stack_87 = CreateStack(UIElements=entwine_131, Horizontal=True)
adjustpos_105 = AdjustElementPositioning(
    ElementsToAdjust=textbox_10,
    Margin="0, 5, 0, 10",
    AbsolutePositioning=False,
    Width=Slider(185, range=0..300),
    HorizontalAlignment=0)
adjustpos_106 = AdjustElementPositioning(
    ElementsToAdjust=true_button_18,
    Margin="5, -5, 0, 0",
    AbsolutePositioning=False,
    Width=number_slider_31,
    Height=number_slider_31)
adjustpos_107 = AdjustElementPositioning(ElementsToAdjust=pulldown_25, AbsolutePositioning=False, Width=Slider(225, range=0..300), HorizontalAlignment=0)
adjustpos_108 = AdjustElementPositioning(
    ElementsToAdjust=[label_55, label_56, label_57, label_54, label_7, label_8],
    AbsolutePositioning=False,
    Width=Slider(150, range=0..300),
    HorizontalAlignment=0,
    VerticalAlignment=2)
adjustpos_109 = AdjustElementPositioning(
    ElementsToAdjust=[textbox_13, textbox_12, textbox_11, textbox_4, textbox_2, textbox_3],
    AbsolutePositioning=False,
    Width=Slider(50, range=0..300),
    HorizontalAlignment=0,
    VerticalAlignment=2)
adjustpos_110 = AdjustElementPositioning(ElementsToAdjust=button_41, Margin="0, 10, 0, 0", AbsolutePositioning=False, HorizontalAlignment=1, VerticalAlignment=2)

info_create_material_2 = RemoteReceiver(info_create_material)
rec_27 = DataRecorder(info_create_material_2, DataLimit=-2, RecordData=True)
ma_21 = MassAddition(Input=rec_27)  # -> Result, PartialResults
entwine_132 = Entwine(Branch00=ma_21.Result, Branch01=material_info, FlattenInputs=True)
rec_28 = DataRecorder(entwine_132, DataLimit=2, RecordData=True)
item_23 = ListItem(List=rec_28, Index=0, Wrap=True)  # -> Item2, Item1, Item
equals_33 = Equality(FirstNumber=item_23.Item2, SecondNumber=item_23.Item1)  # -> Equality, Inequality
bang_11 = ExplodeTree(Data=equals_33.Inequality)  # -> Branch0, Branch1
py3_35 = Python3Script(x=bang_11.Branch0, y=bang_11.Branch1)  # -> a; same code as py3_5
event_56 = EventGate(Data=py3_35)  # -> Data, IsNew
freeze_gate_43 = StreamFreezeGate(Data=py3_35, PassingSwitch=event_56.IsNew)
event_57 = EventGate(Data=freeze_gate_43)  # -> Data, IsNew
panel_143 = Panel(event_57.Data)
launchwin_10 = LaunchWindow(
    Show=event_57.Data,
    Name="Common materials",
    Width=multiplication,
    Height=number_slider_28,
    ChildStatus=1,
    EnableHorizScroll=False)
info_create_material_3 = RemoteReceiver(info_create_material)
winstat_10 = WindowStatus(Window=launchwin_10)
winprops_10 = SetWindowProperties(
    Window=launchwin_10,
    StartingLocation=create_modal_location_2,
    Theme=0,
    AccentColor=heath_accent_color_14,
    ShowTitleBar=True,
    BackgroundColor=RGB(255, 255, 255),
    ScaleFactor=1)
material_info_status = RemoteSender(winstat_10)
py3_36 = Python3Script(window=launchwin_10, activate=info_create_material_3)  # same code as py3_6
addelems_10 = AddElements(Window=launchwin_10, Elements=flatten(image_5), DoVLChecking=True)  # -> AddedElements, ElementNames

material_info_status_2 = RemoteReceiver(material_info_status)
expression_57 = Expression(x="Hidden", y=material_info_status_2, Expression="x=y")
expire_10 = ExpireObject(ObjectToExpire=objbynn_8, Expire=expression_57)

# ----
# A1-A3
stack_88 = CreateStack(UIElements=entwine_130, Horizontal=True)
data_25 = Data(stack_88)  # "A1-A3"

specific_heat = Data(stack_86)
density = Data(stack_85)

create_material_name_2 = RemoteReceiver(create_material_name)
create_material_name_3 = RemoteReceiver(create_material_name)
py3_37 = Python3Script(name=create_material_name_3)  # -> not_valid; inputs name: String
# ---------- py3_37: Python ----------
if 'å' in name:
    not_valid = True
elif 'ä' in name:
    not_valid = True
elif 'ö' in name:
    not_valid = True
else:
    not_valid = False
# ---------- end py3_37 ----------
gate_35 = StreamGate(Stream="'å', 'ä' and 'ö' are not allowed", Gate=py3_37)  # -> Target0, Target1

# ----
# Add material
create_material_sprecific_heat_2 = RemoteReceiver(create_material_sprecific_heat)
create_material_conductivity_2 = RemoteReceiver(create_material_conductivity)
create_material_category_2 = RemoteReceiver(create_material_category)
create_material_density_2 = RemoteReceiver(create_material_density)
create_material_name_4 = RemoteReceiver(create_material_name)
opaquemat_2 = HBOpaqueMaterial(
    name=create_material_name_4,
    thickness="inf",
    conductivity=create_material_conductivity_2,
    density=create_material_density_2,
    spec_heat=create_material_sprecific_heat_2,
    category=create_material_category_2)  # -> out, mat; plug-in component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
create_material_a1_a3_kg_2 = RemoteReceiver(create_material_a1_a3_kg)
create_material_a5_1_kg_2 = RemoteReceiver(create_material_a5_1_kg)
create_material_a4_kg_2 = RemoteReceiver(create_material_a4_kg)
create_material_error = RemoteSender(opaquemat_2.out)
create_material_2 = RemoteReceiver(create_material)
getdocumentusertext_9 = Python3Script(run=create_material_2, key="Heath materials")  # -> json_string; same code as getdocumentusertext

add_life_cycle_info = BrimstoneAddLifeCycleInfoToHoneybeeMaterial(
    hb_material=opaquemat_2.mat,
    gwp_a1_a3=create_material_a1_a3_kg_2,
    gwp_a4=create_material_a4_kg_2,
    gwp_a5_1=create_material_a5_1_kg_2)  # -> mod_material
# ---------- add_life_cycle_info: Python ----------
"""
Adds GWP info to a Honeybee Material

    Args:
        hb_material: Honeybee EnergyMaterial to be updated
        gwp_a1_a3: GWP (A1-A3) [kg CO2eq/kg]
        gwp_a4: GWP (A4) [kg CO2eq/kg]
        gwp_a5_1: GWP (A5.1) [kg CO2eq/kg]

    Returns:
        mod_material: Updated Honeybee EnergyMaterial
"""

import scriptcontext
import brimstone
ghenv.Component.Message = brimstone.globals.version
import Grasshopper

ghenv.Component.Name = 'Brimstone - Add Life Cycle Info to Honeybee Material'
ghenv.Component.NickName = 'Add Life Cycle Info'

try:  # import the core honeybee dependencies
    from honeybee_energy.material.opaque import EnergyMaterial
except ImportError as e:
    raise ImportError('\nFailed to import honeybee:\n\t{}'.format(e))

def main(hb_material):
    if not isinstance(hb_material, EnergyMaterial):
        raise Exception("Input material must be a valid Honeybee material")
    mod_material = hb_material.duplicate()
    user_data = mod_material.user_data if mod_material.user_data else {}
    
    impact_data = {
        "gwp_a1_a3": gwp_a1_a3,
        "gwp_a4": gwp_a4,
        "gwp_a5_1": gwp_a5_1,
        "gwp_c1": gwp_c1,
        "gwp_c2": gwp_c2,
        "gwp_c3": gwp_c3,
    }
    
    for k, v in impact_data.items():
        if v is not None:
            user_data[k] = v

    mod_material.user_data = user_data
    
    return mod_material

if __name__ == "__main__":
    try:
        flying = scriptcontext.sticky["brimstone_flying"]
    except:
        raise Exception("The 'Brimstone - Fly' component needs to exist on the canvas")
    mod_material = main(hb_material)
# ---------- end add_life_cycle_info ----------

gate_36 = StreamGate(Stream=add_life_cycle_info, Gate=create_material_2)  # -> Target0, Target1
objtostr_2 = HBObjectToString(hb_obj=gate_36.Target1)  # -> hb_str; plug-in component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
entwine_133 = Entwine(Branch00=getdocumentusertext_9, Branch01=objtostr_2, FlattenInputs=True)  # -> flatten(Result)
join_8 = TextJoin(Text=entwine_133, Join="|")
freeze_gate_44 = StreamFreezeGate(Data=join_8, PassingSwitch=create_material_2, Freeze=False, Hold=False)

create_material_error_2 = RemoteReceiver(create_material_error)
panel_144 = Panel(create_material_error_2)
split_8 = TextSplit(Text=create_material_error_2, Separators=panel_138)
trim = TextTrim(Text=split_8, Start=True, End=True)
item_24 = ListItem(List=trim, Index=0, Wrap=True)  # -> Item, Item1
lng_18 = ListLength(List=split_8)
len_4 = TextLength(Text=item_24.Item1)
larger_3 = LargerThan(FirstNumber=lng_18, SecondNumber="1")  # -> LargerThan, OrEqualTo
subtraction_14 = Subtraction(A=len_4, B=Slider(11, range=0..20))
fragment_4 = TextFragment(Text=item_24.Item1, Start="0", Count=subtraction_14)
filter_52 = StreamFilter(Gate=larger_3.LargerThan, Stream0=create_material_error_2, Stream1=fragment_4)

# ----
# Create construction
panel_145 = Panel("""Layer 1
Layer 2
Layer 3
Layer 4
Layer 5
Layer 6""")
panel_146 = Panel("""     Outdoors
------------------""")
panel_147 = Panel("""------------------
      Indoors""")
textbox_14 = CreateTextBox(Label="Name", DefaultText="New construction", UpdateButton=invert(True), showLabel=True)
lng_19 = ListLength(List=panel_145)
values_127 = ValueListener(Elements=textbox_14, SomeProperty=True)  # -> Values, Indices
empty_10 = EmptyObjectToEmptyBranch()
button_42 = CreateButton(ButtonName="+", ButtonStyle=3)
label_58 = CreateLabel(LabelText=panel_147, LabelSize=18, Justification=1)
button_43 = CreateButton(ButtonName="Create construction", ButtonStyle=0)
label_59 = CreateLabel(LabelText=panel_146, LabelSize=18, Justification=1)
label_60 = CreateLabel(LabelText=panel_145, LabelSize=18, Justification=0)
empty_11 = EmptyObjectToEmptyBranch()
construction_maximum_layer_limit = RemoteSender(lng_19)
construction_maximum_layer_limit_2 = RemoteReceiver(construction_maximum_layer_limit)
subtraction_15 = Subtraction(A=construction_maximum_layer_limit_2, B="1")
repeat_12 = RepeatData(Data="Material", Length=construction_maximum_layer_limit_2)
repeat_13 = RepeatData(Data="X", Length=construction_maximum_layer_limit_2)
repeat_14 = RepeatData(Data="⇕", Length=subtraction_15)
repeat_15 = RepeatData(Data="Thickness [m]", Length=construction_maximum_layer_limit_2)
create_construction_name = RemoteSender(values_127.Values)
panel_148 = Panel(values_127.Values)
button_44 = CreateButton(ButtonName=repeat_13, ButtonStyle=3)
values_128 = ValueListener(Elements=button_42, SomeProperty=True)  # -> Values, Indices
values_129 = ValueListener(Elements=button_43, SomeProperty=True)  # -> Values, Indices
button_45 = CreateButton(ButtonName=repeat_14, ButtonStyle=3)
pulldown_26 = CreatePulldownMenu(Label=repeat_12, ListItems=empty_11, showLabel=True)
textbox_15 = CreateTextBox(Label=repeat_15, DefaultText=Slider(0.25, range=0.01..1), UpdateButton=invert(True), showLabel=True)
add_layer = RemoteSender(values_128.Values)
values_130 = ValueListener(Elements=button_44, SomeProperty=True)  # -> flatten(Values), Indices
cull_13 = CullPattern(List=values_130.Values, CullPattern=values_130.Values)
lng_20 = ListLength(List=cull_13)
filter_53 = StreamFilter(Gate=lng_20, Stream0="False", Stream1=cull_13)
create_construction = RemoteSender(values_129.Values)
values_131 = ValueListener(Elements=button_45, SomeProperty=True)  # -> flatten(Values), Indices
cull_14 = CullPattern(List=values_131.Values, CullPattern=values_131.Values)
lng_21 = ListLength(List=cull_14)
filter_54 = StreamFilter(Gate=lng_21, Stream0="False", Stream1=cull_14)
values_132 = ValueListener(Elements=pulldown_26, SomeProperty=True)  # -> Values, Indices
values_133 = ValueListener(Elements=textbox_15, SomeProperty=True)  # -> Values, Indices
freeze_gate_45 = StreamFreezeGate(Data=filter_54, PassingSwitch=invert(filter_54))
merge_11 = Merge(Data1=simplify(graft(label_60)), Data2=simplify(graft(button_44)))
freeze_gate_46 = StreamFreezeGate(Data=filter_53, PassingSwitch=invert(filter_53))
create_construction_materials = RemoteSender(values_132.Indices)
create_construction_thickness = RemoteSender(values_133.Values)
pre_switch_layer = RemoteSender(values_131.Values)
pre_remove_layer = RemoteSender(values_130.Values)
bool_44 = Boolean(invert(freeze_gate_45))
bool_45 = Boolean(invert(freeze_gate_46))
stack_89 = CreateStack(UIElements=merge_11, Horizontal=True)
tap_15 = TapBuffer(Reset=False, Incremental=True, Valve=bool_44, Hold=True)
tap_16 = TapBuffer(Reset=False, Incremental=True, Valve=bool_45, Hold=True)
dam_23 = DataDam(DataA=tap_15, BufferDelay=2500000, BufferMode=2)
dam_24 = DataDam(DataA=tap_16, BufferDelay=2500000, BufferMode=2)
equals_34 = Equality(FirstNumber=tap_15, SecondNumber=dam_23)  # -> Equality, Inequality
equals_35 = Equality(FirstNumber=tap_16, SecondNumber=dam_24)  # -> Equality, Inequality
event_58 = EventGate(Data=equals_34.Inequality)  # -> Data, IsNew
event_59 = EventGate(Data=equals_35.Inequality)  # -> Data, IsNew
entwine_134 = Entwine(Branch00=textbox_14, FlattenInputs=True)  # -> flatten(Result)
switch_layer = RemoteSender(event_58.Data)
adjustpos_111 = AdjustElementPositioning(
    ElementsToAdjust=textbox_14,
    Margin="0, 0, 0, 5",
    AbsolutePositioning=False,
    Width=Slider(190, range=0..300),
    HorizontalAlignment=0)
remove_layer = RemoteSender(event_59.Data)
adjustpos_112 = AdjustElementPositioning(
    ElementsToAdjust=pulldown_26,
    Margin="0, 0, 0, 0",
    AbsolutePositioning=False,
    Width=Slider(290, range=0..300),
    HorizontalAlignment=0,
    VerticalAlignment=2)
adjustpos_113 = AdjustElementPositioning(
    ElementsToAdjust=textbox_15,
    Margin="0, 2, 0, 0",
    AbsolutePositioning=False,
    Width=Slider(130, range=0..300),
    HorizontalAlignment=0,
    VerticalAlignment=2)
adjustpos_114 = AdjustElementPositioning(
    ElementsToAdjust=button_42,
    Margin="10, 5, 0, 0",
    AbsolutePositioning=False,
    Width=Slider(32, range=0..300),
    Height=Slider(32, range=0..300),
    HorizontalAlignment=0)
adjustpos_115 = AdjustElementPositioning(
    ElementsToAdjust=button_45,
    Margin="5, 0, 0, 0",
    AbsolutePositioning=False,
    Width=Slider(26, range=0..300),
    Height=Slider(26, range=0..300),
    HorizontalAlignment=0,
    VerticalAlignment=2)
adjustelem_24 = AdjustElementAppearance(ElementsToAdjust=button_45, Foreground=ColourSwatch(SwatchColor=RGBA(38, 38, 38, 193)), FontSize=Slider(19, range=0..50))
adjustpos_116 = AdjustElementPositioning(
    ElementsToAdjust=button_44,
    AbsolutePositioning=False,
    Width=Slider(26, range=0..300),
    Height=Slider(26, range=0..300),
    HorizontalAlignment=0)
adjustelem_25 = AdjustElementAppearance(ElementsToAdjust=button_42, Foreground=ColourSwatch(SwatchColor=RGB(15, 178, 0)), FontSize=Slider(21, range=0..50))
adjustelem_26 = AdjustElementAppearance(ElementsToAdjust=button_44, Foreground=ColourSwatch(SwatchColor=RGB(255, 0, 0)), FontSize=Slider(12, range=0..50))
adjustpos_117 = AdjustElementPositioning(ElementsToAdjust=button_43, Margin="0, 10, 0, 0", AbsolutePositioning=False, HorizontalAlignment=1, VerticalAlignment=2)

pre_remove_layer_2 = RemoteReceiver(pre_remove_layer)
pre_switch_layer_2 = RemoteReceiver(pre_switch_layer)
create_construction_materials_2 = RemoteReceiver(flatten(create_construction_materials))
create_construction_thickness_2 = RemoteReceiver(flatten(create_construction_thickness))
cull_15 = CullPattern(List=pre_remove_layer_2, CullPattern=pre_remove_layer_2)
cull_16 = CullPattern(List=pre_switch_layer_2, CullPattern=pre_switch_layer_2)
add_layer_2 = RemoteReceiver(add_layer)
mindex_6 = MemberIndex(Set=pre_remove_layer_2, Member=cull_15)  # -> Index, Count
mindex_7 = MemberIndex(Set=pre_switch_layer_2, Member=cull_16)  # -> Index, Count
py3_38 = Python3Script(
    add_layer=add_layer_2,
    remove_layer=mindex_6.Index,
    switch_layer=mindex_7.Index,
    materials=create_construction_materials_2,
    thickness=create_construction_thickness_2)  # -> out_materials, out_thickness; inputs materials: list, thickness: list
# ---------- py3_38: Python ----------
def add_layers():
    thickness.append(0.25)
    out_thickness = thickness
    
def remove_layers():
    materials.pop(remove_layer)
    thickness.pop(remove_layer)

def switch_layers():
    temp_materials = materials[switch_layer]
    materials[switch_layer] = materials[switch_layer+1]
    materials[switch_layer+1] = temp_materials

    temp_thickness = thickness[switch_layer]
    thickness[switch_layer] = thickness[switch_layer+1]
    thickness[switch_layer+1] = temp_thickness
    

if add_layer:
    add_layers()

elif remove_layer is not None:
    remove_layers()
    out_materials = materials
    out_thickness = thickness

elif switch_layer is not None:
    switch_layers()
    out_materials = materials
    out_thickness = thickness
else:
    out_materials = None
    out_thickness = None
# ---------- end py3_38 ----------
branch_2 = TreeBranch(Tree=py3_38.out_thickness, Path=path_2, MaintainPaths=True)
branch_3 = TreeBranch(Tree=py3_38.out_materials, Path=path_3, MaintainPaths=True)
lng_22 = ListLength(List=branch_3)
lng_23 = ListLength(List=branch_2)
bool_46 = Boolean(lng_23)
bool_47 = Boolean(lng_22)
gate_37 = StreamGate(Stream=branch_2, Gate=bool_46)  # -> Target0, Target1
gate_38 = StreamGate(Stream=branch_3, Gate=bool_47)  # -> Target0, Target1
hold_3 = HoldingGate(Data=gate_37.Target1)
hold_4 = HoldingGate(Data=gate_38.Target1)
hasdata_6 = DataExists(Data=hold_3)
hasdata_7 = DataExists(Data=hold_4)
timeshift = TimeShifter(Data=hold_3, Capacity="1")
timeshift_2 = TimeShifter(Data=hold_4, Capacity="1")
bool_48 = Boolean(hasdata_6)
bool_49 = Boolean(hasdata_7)
remove_layer_2 = RemoteReceiver(remove_layer)
switch_layer_2 = RemoteReceiver(switch_layer)
filter_55 = StreamFilter(Gate=bool_48, Stream0=timeshift, Stream1=hold_3)
filter_56 = StreamFilter(Gate=bool_49, Stream0=timeshift_2, Stream1=hold_4)
entwine_135 = Entwine(Branch00=filter_56, Branch01=filter_55, FlattenInputs=True)
or_18 = GateOr(A=switch_layer_2, B=remove_layer_2)
gate_39 = StreamGate(Stream=entwine_135, Gate=or_18)  # -> Target0, Target1
bang_12 = ExplodeTree(Data=gate_39.Target1)  # -> Branch0, Branch1

remove_layer_3 = RemoteReceiver(flatten(remove_layer))
add_layer_3 = RemoteReceiver(add_layer)
construction_maximum_layer_limit_3 = RemoteReceiver(construction_maximum_layer_limit)
gate_40 = StreamGate(Stream=panel_141, Gate=add_layer_3)  # -> Target0, Target1
gate_41 = StreamGate(Stream=neg, Gate=remove_layer_3)  # -> Target0, Target1
rec_29 = DataRecorder([gate_40.Target1, gate_41.Target1], DataLimit=-10, RecordData=True)
py3_39 = Python3Script(numbers=[starting_layers, rec_29], maximum_layers=construction_maximum_layer_limit_3)  # -> visible_layers_arrows, visible_layers; inputs numbers: list of Int32, maximum_layers: Int32
# ---------- py3_39: Python ----------
current_sum = 0

for number in numbers:
    if (number == 1) and (current_sum >= maximum_layers):
        continue
    if (number == -1) and (current_sum <= 1):
        continue
    else:
        current_sum += number

visible_layers = [True]*current_sum
visible_layers.extend([False]*(maximum_layers-current_sum))
visible_layers_arrows = visible_layers[1:]
# ---------- end py3_39 ----------
visible_layers_arrows = RemoteSender(py3_39.visible_layers_arrows)
visible_layers = RemoteSender(simplify(graft(py3_39.visible_layers)))

repeat_16 = RepeatData(Data="🛠", Length=construction_maximum_layer_limit_2)
button_46 = CreateButton(ButtonName=repeat_16, ButtonStyle=0)
values_134 = ValueListener(Elements=button_46, SomeProperty=True)  # -> flatten(Values), Indices
ma_22 = MassAddition(Input=values_134.Values)  # -> Result, PartialResults
bool_50 = Boolean(ma_22.Result)
load_material_database = RemoteSender(bool_50)

# ----
# Sync when opening the database, recompute and sync
load_construction_database_2 = RemoteReceiver(load_construction_database)
load_material_database_2 = RemoteReceiver(load_material_database)
recompute_4 = RemoteReceiver(recompute)
panel_149 = Panel("""False
True""")
or_19 = GateOr(A=load_material_database_2, B=load_construction_database_2)
oilcan_2 = OilCan(DataList=panel_149, Reset=recompute_4, Drop=or_19, DropMode=3)
event_60 = EventGate(Data=oilcan_2)  # -> Data, IsNew
and_30 = GateAnd(A=oilcan_2, B=event_60.IsNew)
null_33 = NullItem(Item=and_30)  # -> NullFlags, InvalidFlags, Description
filter_57 = StreamFilter(Gate=null_33.NullFlags, Stream0=and_30, Stream1="False")
sync_material_database_2 = RemoteReceiver(sync_material_database)
event_61 = EventGate(Data=filter_57)  # -> Data, IsNew
or_20 = GateOr(A=sync_material_database_2, B=event_61.Data)

freeze_gate_47 = StreamFreezeGate(Data=bool_50, PassingSwitch=bool_50)
bool_51 = Boolean(invert(freeze_gate_47))
merge_12 = Merge(Data1=simplify(graft(pulldown_26)), Data2=simplify(graft(button_46)))
oilcan_3 = OilCan(DataList=panel_17, Reset=recompute_2, Drop=bool_50, DropMode=3)
ping_open_material_database = RemoteSender(bool_51)
event_62 = EventGate(Data=oilcan_3)  # -> Data, IsNew
stack_90 = CreateStack(UIElements=merge_12, Horizontal=True)
open_material_database = RemoteSender(event_62.Data)

ping_open_material_database_2 = RemoteReceiver(ping_open_material_database)
open_material_database_2 = RemoteReceiver(open_material_database)
or_21 = GateOr(A=ping_open_material_database_2, B=open_material_database_2)
null_34 = NullItem(Item=or_21)  # -> NullFlags, InvalidFlags, Description
filter_58 = StreamFilter(Gate=null_34.NullFlags, Stream0=or_21, Stream1=panel_89)
rec_30 = DataRecorder(filter_58, DataLimit=-2, RecordData=True)
int_12 = Integer(rec_30)
ma_23 = MassAddition(Input=int_12)  # -> Result, PartialResults
entwine_136 = Entwine(Branch00=ma_23.Result, Branch01=material_database, FlattenInputs=True)
rec_31 = DataRecorder(entwine_136, DataLimit=2, RecordData=True)
item_25 = ListItem(List=rec_31, Index=0, Wrap=True)  # -> Item2, Item1, Item
equals_36 = Equality(FirstNumber=item_25.Item2, SecondNumber=item_25.Item1)  # -> Equality, Inequality
bang_13 = ExplodeTree(Data=equals_36.Inequality)  # -> Branch0, Branch1
py3_40 = Python3Script(x=bang_13.Branch0, y=bang_13.Branch1)  # -> a; same code as py3_5
event_63 = EventGate(Data=py3_40)  # -> Data, IsNew
freeze_gate_48 = StreamFreezeGate(Data=py3_40, PassingSwitch=event_63.IsNew)
event_64 = EventGate(Data=freeze_gate_48)  # -> Data, IsNew
ping_open_material_database_3 = RemoteReceiver(ping_open_material_database)
panel_150 = Panel(event_64.Data)
launchwin_11 = LaunchWindow(
    Show=event_64.Data,
    Name="Material database",
    Width=Slider(380, range=0..1000),
    Height=Slider(580, range=0..1000),
    ChildStatus=1,
    EnableHorizScroll=False)
open_material_database_3 = RemoteReceiver(open_material_database)
or_22 = GateOr(A=ping_open_material_database_3, B=open_material_database_3)
winprops_11 = SetWindowProperties(
    Window=launchwin_11,
    StartingLocation=database_modal_location_7,
    Theme=0,
    AccentColor=heath_accent_color_13,
    ShowTitleBar=True,
    BackgroundColor=RGB(255, 255, 255),
    ScaleFactor=1)
winstat_11 = WindowStatus(Window=launchwin_11)
addelems_11 = AddElements(Window=launchwin_11, Elements=flatten(entwine_109), DoVLChecking=True)  # -> AddedElements, ElementNames
py3_41 = Python3Script(window=launchwin_11, activate=or_22)  # same code as py3_6
material_database_elements = RemoteSender(addelems_11.AddedElements)
material_database_status = RemoteSender(winstat_11)

material_database_status_2 = RemoteReceiver(material_database_status)
expression_58 = Expression(x="Hidden", y=material_database_status_2, Expression="x=y")
expire_11 = ExpireObject(ObjectToExpire=objbynn_10, Expire=expression_58)

adjustelem_27 = AdjustElementAppearance(ElementsToAdjust=button_46, Foreground=ColourSwatch(SwatchColor=RGB(102, 51, 0)), FontSize=Slider(14, range=10..25))
adjustpos_118 = AdjustElementPositioning(
    ElementsToAdjust=button_46,
    Margin="0, 0, 0, 0",
    AbsolutePositioning=False,
    Width=number_slider_11,
    Height=number_slider_11,
    HorizontalAlignment=0)

material_database_status_3 = RemoteReceiver(material_database_status)
material_database_status_4 = RemoteReceiver(material_database_status)
expression_59 = Expression(x="Normal", y=material_database_status_3, Expression="x=y")
expression_60 = Expression(x="Normal", y=material_database_status_4, Expression="x=y")
and_31 = GateAnd(A=equals_21.Inequality, B=expression_59)
and_32 = GateAnd(A=equals_22.Inequality, B=expression_60)
event_65 = EventGate(Data=and_31)  # -> Data, IsNew
event_66 = EventGate(Data=and_32)  # -> Data, IsNew
panel_151 = Panel(event_65.Data)
save_materials = RemoteSender(event_65.Data)
panel_152 = Panel(event_66.Data)
load_materials = RemoteSender(event_66.Data)

# ----
# Save materials
panel_153 = Panel("Heath materials")
save_materials_2 = RemoteReceiver(save_materials)
getdocumentusertext_10 = Python3Script(run=save_materials_2, key=panel_153)  # -> json_string; same code as getdocumentusertext
null_35 = NullItem(Item=getdocumentusertext_10)  # -> NullFlags, InvalidFlags, Description
bool_52 = Boolean(invert(null_35.NullFlags))
save_materials_file_2 = RemoteReceiver(save_materials_file)
filter_59 = StreamFilter(Gate=null_35.NullFlags, Stream0=save_materials_2, Stream1=bool_52)
writetxt_3 = WriteToTextFile(Run=filter_59, TextToWrite=getdocumentusertext_10, FilePath=save_materials_file_2, Append=False, NewOnly=False)

# ----
# Load materials
load_materials_file_2 = RemoteReceiver(load_materials_file)
load_materials_2 = RemoteReceiver(load_materials)
gate_42 = StreamGate(Stream=load_materials_file_2, Gate=load_materials_2)  # -> Target0, Target1
getdocumentusertext_11 = Python3Script(run=load_materials_2, key="Heath materials")  # -> json_string; same code as getdocumentusertext
file_3 = ReadFile(File=gate_42.Target1, PerLineParse=False)
entwine_137 = Entwine(Branch00=getdocumentusertext_11, Branch01=file_3, FlattenInputs=True)  # -> flatten(Result)
split_9 = TextSplit(Text=file_3, Separators="|")  # -> flatten(Result)
strtoobj_5 = HBStringToObject(hb_str=split_9)  # -> hb_obj; plug-in component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
null_36 = NullItem(Item=strtoobj_5)  # -> NullFlags, InvalidFlags, Description
item_26 = ListItem(List=null_36.NullFlags, Index=0, Wrap=True)
filter_60 = StreamFilter(Gate=item_26, Stream0=entwine_137)
join_9 = TextJoin(Text=filter_60, Join="|")
freeze_gate_49 = StreamFreezeGate(Data=join_9, PassingSwitch=load_materials_2, Freeze=False, Hold=False)

create_construction_name_2 = RemoteReceiver(create_construction_name)
create_construction_name_3 = RemoteReceiver(create_construction_name)
py3_42 = Python3Script(name=create_construction_name_3)  # -> not_valid; inputs name: String; same code as py3_37
gate_43 = StreamGate(Stream="'å', 'ä' and 'ö' are not allowed", Gate=py3_42)  # -> Target0, Target1

# ----
# Add construction
create_construction_materials_3 = RemoteReceiver(create_construction_materials)
create_construction_thickness_3 = RemoteReceiver(create_construction_thickness)
visible_layers_2 = RemoteReceiver(visible_layers)
create_construction_name_4 = RemoteReceiver(create_construction_name)
repeat_17 = RepeatData(Data=create_construction_thickness_3, Length=visible_layers_2)  # -> flatten(Data)
create_construction_2 = RemoteReceiver(create_construction)
getdocumentusertext_12 = Python3Script(run=create_construction_2, key="Heath constructions")  # -> json_string; same code as getdocumentusertext

# ----
# Create window
number_slider_32 = Slider(0.5, range=0..12)
button_47 = CreateButton(ButtonName="Create window", ButtonStyle=0)
textbox_16 = CreateTextBox(Label="Name", DefaultText="New window", UpdateButton=invert(True), showLabel=True)
textbox_17 = CreateTextBox(DefaultText=number_slider_32, UpdateButton=invert(True), showLabel=False)
label_61 = CreateLabel(LabelText="U-factor [W/m2-K]", LabelSize=12, Justification=0)
textbox_18 = CreateTextBox(DefaultText=Slider(0.3, range=0..1), UpdateButton=invert(True), showLabel=False)
label_62 = CreateLabel(LabelText="SHGC [-]", LabelSize=12, Justification=0)
values_135 = ValueListener(Elements=textbox_16, SomeProperty=True)  # -> Values, Indices
values_136 = ValueListener(Elements=textbox_17, SomeProperty=True)  # -> Values, Indices
values_137 = ValueListener(Elements=button_47, SomeProperty=True)  # -> Values, Indices
values_138 = ValueListener(Elements=textbox_18, SomeProperty=True)  # -> Values, Indices
pre_create_window = RemoteSender(values_137.Values)
create_window_u_factor = RemoteSender(values_136.Values)
freeze_gate_50 = StreamFreezeGate(Data=values_137.Values, PassingSwitch=invert(values_137.Values))
create_window_shgc = RemoteSender(values_138.Values)
create_window_name = RemoteSender(values_135.Values)
panel_154 = Panel(values_135.Values)
entwine_138 = Entwine(Branch00=label_61, Branch01=textbox_17, FlattenInputs=True)  # -> flatten(Result)
entwine_139 = Entwine(Branch00=label_62, Branch01=textbox_18, FlattenInputs=True)  # -> flatten(Result)
bool_53 = Boolean(invert(freeze_gate_50))
stack_91 = CreateStack(UIElements=entwine_138, Horizontal=True)
tap_17 = TapBuffer(Reset=False, Incremental=True, Valve=bool_53, Hold=True)
stack_92 = CreateStack(UIElements=entwine_139, Horizontal=True)
create_window_modal_2 = RemoteReceiver(create_window_modal)
dam_25 = DataDam(DataA=tap_17, BufferDelay=2500000, BufferMode=2)
equals_37 = Equality(FirstNumber=tap_17, SecondNumber=dam_25)  # -> Equality, Inequality
and_33 = GateAnd(A=equals_37.Inequality, B=create_window_modal_2)
event_67 = EventGate(Data=and_33)  # -> Data, IsNew
create_window = RemoteSender(event_67.Data)
adjustpos_119 = AdjustElementPositioning(
    ElementsToAdjust=[label_10, label_62, label_61, label_11, label_9],
    AbsolutePositioning=False,
    Width=Slider(150, range=0..300),
    HorizontalAlignment=0,
    VerticalAlignment=2)
adjustpos_120 = AdjustElementPositioning(
    ElementsToAdjust=[textbox_18, textbox_17, textbox_7, textbox_5, textbox_6],
    AbsolutePositioning=False,
    Width=Slider(50, range=0..300),
    HorizontalAlignment=0,
    VerticalAlignment=2)
adjustpos_121 = AdjustElementPositioning(ElementsToAdjust=button_47, Margin="0, 10, 0, 0", AbsolutePositioning=False, HorizontalAlignment=1, VerticalAlignment=2)

# ----
# Add window
create_window_u_factor_2 = RemoteReceiver(create_window_u_factor)
create_window_name_2 = RemoteReceiver(create_window_name)
create_window_shgc_2 = RemoteReceiver(create_window_shgc)
windowmat = HBWindowMaterial(name=create_window_name_2, u_factor=create_window_u_factor_2, shgc=create_window_shgc_2)  # -> out, mat; plug-in component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
create_window_conversion_value_2 = RemoteReceiver(create_window_conversion_value)
create_window_a1_a3_kg_2 = RemoteReceiver(create_window_a1_a3_kg)
create_window_a4_kg_2 = RemoteReceiver(create_window_a4_kg)
windowconstr = HBWindowConstruction(name=create_window_name_2, materials=windowmat.mat)  # -> constr; plug-in component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
create_window_error = RemoteSender(windowmat.out)
add_life_cycle_info_construction = BrimstoneAddLifeCycleInfoToHoneybeeConstruction(
    hb_construction=windowconstr,
    gwp_a1_a3=create_window_a1_a3_kg_2,
    gwp_a4=create_window_a4_kg_2,
    density=create_window_conversion_value_2)  # -> mod_construction
# ---------- add_life_cycle_info_construction: Python ----------
"""
Adds GWP info to a Honeybee Construction

    Args:
        hb_construction: Honeybee Construction to be updated
        gwp_a1_a3: GWP (A1-A3) [kg CO2eq/kg]
        gwp_a4: GWP (A4) [kg CO2eq/kg]
        density: GWP (A5.1) [kg/m2]

    Returns:
        mod_construction: Updated Honeybee Construction
"""

import scriptcontext
import brimstone
ghenv.Component.Message = brimstone.globals.version
import Grasshopper

ghenv.Component.Name = 'Brimstone - Add Life Cycle Info to Honeybee Construction'
ghenv.Component.NickName = 'Add Life Cycle Info (Construction)'

try:  # import the core honeybee dependencies
    from honeybee_energy.construction.window import WindowConstruction
    from honeybee_energy.construction.opaque import OpaqueConstruction
except ImportError as e:
    raise ImportError('\nFailed to import honeybee:\n\t{}'.format(e))

def main(hb_construction, gwp_a1_a3, gwp_a4, density):
    if not isinstance(hb_construction, WindowConstruction)\
        and not isinstance(hb_construction, OpaqueConstruction):
        raise Exception("Currently only Window and Opaque constructions are supported")
    mod_construction = hb_construction.duplicate()
    user_data = mod_construction.user_data if mod_construction.user_data else {}
    
    user_data["gwp_a1_a3"] = gwp_a1_a3
    user_data["gwp_a4"] = gwp_a4
    user_data["conv_value"] = density
    
    mod_construction.user_data = user_data

    return mod_construction

if __name__ == "__main__":
    try:
        flying = scriptcontext.sticky["brimstone_flying"]
    except:
        raise Exception("The 'Brimstone - Fly' component needs to exist on the canvas")
    mod_construction = main(hb_construction, gwp_a1_a3, gwp_a4, density)
# ---------- end add_life_cycle_info_construction ----------
create_window_2 = RemoteReceiver(create_window)
gate_44 = StreamGate(Stream=add_life_cycle_info_construction, Gate=create_window_2)  # -> Target0, Target1
getdocumentusertext_13 = Python3Script(run=create_window_2, key="Heath windows")  # -> json_string; same code as getdocumentusertext
objtostr_3 = HBObjectToString(hb_obj=gate_44.Target1)  # -> hb_str; plug-in component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
entwine_140 = Entwine(Branch00=getdocumentusertext_13, Branch01=objtostr_3, FlattenInputs=True)  # -> flatten(Result)
freeze_gate_51 = StreamFreezeGate(Data=entwine_140, PassingSwitch=create_window_2, Freeze=False, Hold=False)
join_10 = TextJoin(Text=freeze_gate_51, Join="|")

panel_155 = Panel(windowconstr)
panel_156 = Panel(add_life_cycle_info_construction)
entwine_141 = Entwine(Branch00=textbox_16, Branch01=true_button_7, FlattenInputs=True)  # -> flatten(Result)
stack_93 = CreateStack(UIElements=entwine_141, Horizontal=True)
adjustpos_122 = AdjustElementPositioning(
    ElementsToAdjust=textbox_16,
    Margin="0, 5, 0, 10",
    AbsolutePositioning=False,
    Width=Slider(185, range=0..300),
    HorizontalAlignment=0)

# ----
# Windows database
sync_window_database_2 = RemoteReceiver(sync_window_database)
setdocumentusertext_2 = Python3Script(
    key="Heath windows",
    load_value=freeze_gate_34,
    remove_value=freeze_gate_28,
    add_value=join_10,
    sync=sync_window_database_2)  # -> done
# ---------- setdocumentusertext_2: Python ----------
import Rhino
import rhinoscriptsyntax as rs
import scriptcontext as sc

def modify_value(value):
    sc.doc = Rhino.RhinoDoc.ActiveDoc

    return rs.SetDocumentUserText(key, value)

    sc.doc = ghdoc

if load_value:
    done = modify_value(load_value)

if add_value:
    done = modify_value(add_value)

if remove_value:
    done = modify_value(remove_value)

if remove_value == False:
    done = modify_value(None)

elif sync:
    done = True
# ---------- end setdocumentusertext_2 ----------
getdocumentusertext_14 = Python3Script(run=setdocumentusertext_2, key="Heath windows")  # -> json_string
# ---------- getdocumentusertext_14: Python ----------
import Rhino
import rhinoscriptsyntax as rs
import scriptcontext as sc

if run:
    sc.doc = Rhino.RhinoDoc.ActiveDoc

    json_string = rs.GetDocumentUserText(key)
    if json_string == None:
        json_string = False

    sc.doc = ghdoc
# ---------- end getdocumentusertext_14 ----------
split_10 = TextSplit(Text=getdocumentusertext_14, Separators="|")
hold_5 = HoldingGate(Data=split_10)
strtoobj_6 = HBStringToObject(hb_str=hold_5)  # -> flatten(hb_obj); plug-in component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
ipy2_2 = IronPython2Script(windows=strtoobj_6)  # -> unique_windows; inputs windows: list
# ---------- ipy2_2: IronPython ----------
"""Grasshopper Script"""

unique_windows = []

for i in range(len(windows)):
    if windows[i] not in unique_windows:
        unique_windows.append(windows[i])
# ---------- end ipy2_2 ----------
clean = CleanTree(RemoveNulls=True, RemoveInvalid=True, RemoveEmpty=False, Tree=ipy2_2)
lng_24 = ListLength(List=ipy2_2)
lng_25 = ListLength(List=strtoobj_6)
smaller = SmallerThan(FirstNumber=lng_24, SecondNumber=lng_25)  # -> SmallerThan, OrEqualTo
created_windows_database = RemoteSender(clean)
hasdata_8 = DataExists(Data=smaller.SmallerThan)
filter_61 = StreamFilter(Gate=hasdata_8, Stream0="False", Stream1=smaller.SmallerThan)
overlap_windows = RemoteSender(filter_61)

created_windows_database_2 = RemoteReceiver(created_windows_database)
decnstrconstr_2 = HBDeconstructConstruction(constr=created_windows_database_2)  # -> materials, layers, r_val_si, r_val_ip, u_fac_si, u_fac_ip, shgc, t_sol, t_vis; plug-in component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
decnstrmat_3 = HBDeconstructMaterial(mat=decnstrconstr_2.materials)  # -> values, attr_names, r_val_si, r_val_ip; plug-in component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
item_27 = ListItem(List=decnstrmat_3.values, Index=0, Wrap=True)  # -> flatten(Item), Item1, Item2
entwine_142 = Entwine(Branch00=generic_shgc, Branch01=item_27.Item2, FlattenInputs=True)  # -> flatten(Result)
entwine_143 = Entwine(Branch00=generic_u_value, Branch01=item_27.Item1, FlattenInputs=True)  # -> flatten(Result)
clean_2 = CleanTree(RemoveNulls=True, RemoveInvalid=True, RemoveEmpty=False, Tree=item_27.Item)
clean_3 = CleanTree(RemoveNulls=True, RemoveInvalid=True, RemoveEmpty=False, Tree=entwine_143)
clean_4 = CleanTree(RemoveNulls=True, RemoveInvalid=True, RemoveEmpty=False, Tree=entwine_142)
num_7 = Number(clean_4)
num_8 = Number(clean_3)
entwine_144 = Entwine(Branch00="Generic", Branch01=clean_2, FlattenInputs=True)  # -> flatten(Result)
expression_61 = Expression(x=num_7, Expression="Round(x, 2)")
expression_62 = Expression(x=num_8, Expression="Round(x, 2)")
create_window_names = RemoteSender(entwine_144)
format_33 = Format(Format="{0} (U-factor: {1}, SHGC: {2})", Culture=127, Data0=entwine_144, Data1=expression_62, Data2=expression_61)
panel_157 = Panel(format_33)
create_window_full_names = RemoteSender(format_33)

created_windows_database_3 = RemoteReceiver(created_windows_database)

created_windows_database_4 = RemoteReceiver(created_windows_database)
entwine_145 = Entwine(Branch00="Generic", Branch01=created_windows_database_3, FlattenInputs=True)  # -> flatten(Result)
entwine_146 = Entwine(Branch00="Generic", Branch01=created_windows_database_4, FlattenInputs=True)  # -> flatten(Result)
item_28 = ListItem(List=entwine_145, Index=subset_subface_window_2, Wrap=True)
item_29 = ListItem(List=entwine_146, Index=subset_subface_window_3, Wrap=True)
expression_63 = Expression(x="Generic", y=item_28, Expression="x=y")
expression_64 = Expression(x="Generic", y=item_29, Expression="x=y")
filter_62 = StreamFilter(Gate=expression_63, Stream0=item_28, Stream1=null_10)
filter_63 = StreamFilter(Gate=expression_64, Stream0=item_29, Stream1=null_11)
subfacesubset = HBSubfaceSubset(window=filter_63, skylight=filter_62)  # -> subface_set; plug-in component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

create_window_full_names_2 = RemoteReceiver(create_window_full_names)
cull_i_3 = CullIndex(List=create_window_full_names_2, Indices="0", Wrap=invert(True))
concat_7 = Concatenate(FragmentA="- ", FragmentB=cull_i_3)
overlap_windows_2 = RemoteReceiver(overlap_windows)
lng_26 = ListLength(List=cull_i_3)
settextblock_12 = SetTextBlockContents(TextBlockToModify=tb_17, NewTextBlockContents=concat_7)
py3_43 = Python3Script(current_windows=lng_26, maximum_windows=number_slider_26)  # -> status; inputs current_windows: Int32, maximum_windows: Int32
# ---------- py3_43: Python ----------
status = [True]*current_windows
status.extend([False]*(maximum_windows-current_windows))
# ---------- end py3_43 ----------
hideshow_27 = HideShowElement(ElementToHideShow=label_48, Show=overlap_windows_2, Collapse=True, Disable=False)
hideshow_28 = HideShowElement(ElementToHideShow=simplify(merge_8), Show=simplify(graft(py3_43)), Collapse=True, Disable=False)

create_window_names_2 = RemoteReceiver(create_window_names)
create_window_name_3 = RemoteReceiver(create_window_name)
create_window_error_2 = RemoteReceiver(create_window_error)
create_window_u_factor_3 = RemoteReceiver(create_window_u_factor)
create_window_shgc_3 = RemoteReceiver(create_window_shgc)
create_window_name_4 = RemoteReceiver(create_window_name)
expression_65 = Expression(x=create_window_names_2, y=create_window_name_3, Expression="x=y")
len_5 = TextLength(Text=create_window_error_2)
py3_44 = Python3Script(name=create_window_name_4)  # -> not_valid; inputs name: String; same code as py3_37
inc = Includes(Value=create_window_shgc_3, Domain=dom_9)  # -> Includes, Deviation
inc_2 = Includes(Value=create_window_u_factor_3, Domain=dom_8)  # -> Includes, Deviation
cull_17 = CullPattern(List=expression_65, CullPattern=expression_65)
bool_54 = Boolean(len_5)
gate_45 = StreamGate(Stream="U-factor has to to between 0 and 12", Gate=inc_2.Includes)  # -> Target0, Target1
gate_46 = StreamGate(Stream="Window name contains no valid characters", Gate=bool_54)  # -> Target0, Target1
gate_47 = StreamGate(Stream="Window already exists", Gate=cull_17)  # -> Target0, Target1
gate_48 = StreamGate(Stream="'å', 'ä' and 'ö' are not allowed", Gate=py3_44)  # -> Target0, Target1
gate_49 = StreamGate(Stream="SHGC has to to between 0 and 1", Gate=inc.Includes)  # -> Target0, Target1
entwine_147 = Entwine(
    Branch00=gate_45.Target0,
    Branch01=gate_49.Target0,
    Branch02=gate_46.Target1,
    Branch03=gate_47.Target1,
    Branch04=gate_48.Target1,
    FlattenInputs=True)  # -> flatten(Result)
panel_158 = Panel(entwine_147)
item_30 = ListItem(List=entwine_147, Index=0, Wrap=True)
create_window_error_message = RemoteSender(item_30)

create_window_error_message_2 = RemoteReceiver(create_window_error_message)
null_37 = NullItem(Item=create_window_error_message_2)  # -> NullFlags, InvalidFlags, Description
filter_64 = StreamFilter(Gate=null_37.NullFlags, Stream0=create_window_error_message_2, Stream1=" ")
filter_65 = StreamFilter(Gate=null_37.NullFlags, Stream0=Slider(500, range=0..1000), Stream1=Slider(1000000, range=0..1000000))
hideshow_29 = HideShowElement(ElementToHideShow=button_47, Show=True, Collapse=True, Disable=invert(null_37.NullFlags))
tooltip_15 = AttachTooltipToElement(ElementsToAttachTo=button_47, TooltipContent=filter_64, ShowDelay=filter_65, Duration=2000)

panel_159 = Panel(hold_5)
panel_160 = Panel(split_10)
panel_161 = Panel(clean)

# ---- group: Construction module (continued)
create_window_full_names_3 = RemoteReceiver(create_window_full_names)
create_window_full_names_4 = RemoteReceiver(create_window_full_names)
setlist_5 = SetListContents(ListToModify=pulldown_10, NewListContents=create_window_full_names_3, SelectedIndex="0")
setlist_6 = SetListContents(ListToModify=pulldown_9, NewListContents=create_window_full_names_4, SelectedIndex=panel_52)  # disabled

# ----
# Construction inspection
pre_construction_database_visualize_cons_2 = RemoteReceiver(pre_construction_database_visualize_cons)  # "pre_construction_database_visualize_construction"
path_4 = DataPath(pre_construction_database_visualize_cons_2)
construction_maximum_layer_limit_4 = RemoteReceiver(construction_maximum_layer_limit)
construction_maximum_layer_limit_5 = RemoteReceiver(construction_maximum_layer_limit)
construction_maximum_layer_limit_6 = RemoteReceiver(construction_maximum_layer_limit)
panel_162 = Panel("Construction thickness: {0}")
repeat_18 = RepeatData(Data="0 m", Length=construction_maximum_layer_limit_4)
repeat_19 = RepeatData(Data="Material", Length=construction_maximum_layer_limit_5)
repeat_20 = RepeatData(Data=" ", Length=construction_maximum_layer_limit_6)
tb_22 = CreateTextBlock(Text=repeat_18, TextSize=12, Justification=1)
label_63 = CreateLabel(LabelText="Construction inspection", LabelSize=18, Justification=1)
label_64 = CreateLabel(LabelText="🌳", LabelSize=18, Justification=1)
label_65 = CreateLabel(LabelText="🏠", LabelSize=18, Justification=1)
label_66 = CreateLabel(LabelText=panel_162, LabelSize=18, Justification=1)
tb_23 = CreateTextBlock(Text=repeat_19, TextSize=16, Justification=Slider(1, range=0..10))
tb_24 = CreateTextBlock(Text=repeat_20, TextSize=16, Justification=Slider(1, range=0..10))
construction_maximum_layer_limit_7 = RemoteReceiver(construction_maximum_layer_limit)
settextblock_13 = SetTextBlockContents(TextBlockToModify=tb_24, NewTextBlockContents=" ")
suirify_8 = Suirify(tb_22)
suirify_9 = Suirify(tb_23)
merge_13 = Merge(Data1=graft(suirify_9), Data2=graft(suirify_8))
stack_94 = CreateStack(UIElements=merge_13, Horizontal=True)  # -> flatten(Stack)
material_database_categories_8 = RemoteReceiver(material_database_categories_2)
suirify_10 = Suirify(tb_24)
suirify_11 = Suirify(stack_94)
merge_14 = Merge(Data1=graft(suirify_10), Data2=graft(suirify_11))
number_slider_33 = Slider(250, range=0..1000)
entwine_148 = Entwine(
    Branch00=ColourSwatch(SwatchColor=RGB(204, 102, 51)),
    Branch01=ColourSwatch(SwatchColor=RGB(153, 102, 51)),
    Branch02=ColourSwatch(SwatchColor=RGB(128, 128, 128)),
    Branch03=ColourSwatch(SwatchColor=RGB(255, 204, 102)),
    Branch04=ColourSwatch(SwatchColor=RGB(102, 102, 153)),
    Branch05=ColourSwatch(SwatchColor=RGB(255, 153, 51)),
    Branch06=ColourSwatch(SwatchColor=RGB(102, 51, 0)),
    Branch07=ColourSwatch(SwatchColor=RGB(77, 77, 77)),
    Branch08=ColourSwatch(SwatchColor=RGB(0, 102, 204)),
    Branch09=ColourSwatch(SwatchColor=RGB(153, 153, 153)),
    FlattenInputs=True)  # -> flatten(Result)
stack_95 = CreateStack(UIElements=merge_14, Horizontal=invert(True))  # -> flatten(Stack)
entwine_149 = Entwine(Branch00=label_63, Branch01=label_66, Branch02=label_64, Branch03=stack_95, Branch04=label_65, FlattenInputs=True)  # -> flatten(Result)
swatch_6 = ColourSwatch(SwatchColor=RGB(0, 0, 0))
adjustpos_123 = AdjustElementPositioning(ElementsToAdjust=tb_22, Margin="8, 0, 0, 0", AbsolutePositioning=False, HorizontalAlignment=0)
adjustpos_124 = AdjustElementPositioning(ElementsToAdjust=stack_95, Margin="53, 0, 0, 0", AbsolutePositioning=False, HorizontalAlignment=0)

# ----
# Construction inspection launch
construction_database_visualize_construc_2 = RemoteReceiver(construction_database_visualize_construc)  # "construction_database_visualize_construction"
construction_database_visualize_construc_3 = RemoteReceiver(construction_database_visualize_construc)  # "construction_database_visualize_construction"
create_modal_location_3 = RemoteReceiver(create_modal_location)

bool_55 = Boolean(construction_database_visualize_construc_2)

settextbox_2 = SetTextBoxContents(TextBoxToModify=textbox_15, NewTextBoxContents=bang_12.Branch1)
visible_layers_3 = RemoteReceiver(flatten(visible_layers))
visible_layers_arrows_2 = RemoteReceiver(visible_layers_arrows)
int_13 = Integer(visible_layers_3)
merge_15 = Merge(Data1=simplify(graft(stack_90)), Data2=simplify(graft(textbox_15)))
ma_24 = MassAddition(Input=int_13)  # -> Result, PartialResults
hideshow_30 = HideShowElement(ElementToHideShow=button_45, Show=visible_layers_arrows_2, Collapse=True, Disable=False)
larger_4 = LargerThan(FirstNumber=ma_24.Result, SecondNumber="1")  # -> LargerThan, OrEqualTo
stack_96 = CreateStack(UIElements=merge_15, Horizontal=invert(True))
visible_layers_4 = RemoteReceiver(visible_layers)
filter_66 = StreamFilter(Gate=larger_4.LargerThan, Stream0=larger_4.LargerThan, Stream1=visible_layers_3)
merge_16 = Merge(Data1=simplify(stack_89), Data2=simplify(stack_96), Data3=simplify(graft(button_45)))
hideshow_31 = HideShowElement(ElementToHideShow=stack_96, Show=visible_layers_4, Collapse=True, Disable=False)
hideshow_32 = HideShowElement(ElementToHideShow=label_60, Show=visible_layers_3, Collapse=True, Disable=False)
hideshow_33 = HideShowElement(ElementToHideShow=button_44, Show=filter_66, Collapse=True, Disable=False)

# ----
# Recursion
panel_163 = Panel("Construction visualization")
objbynn_13 = GetObjectByNickname(NickName=panel_163)
construction_visualization = Python3Script()  # -> status; same code as lca_window_status

rec_32 = DataRecorder(bool_55, DataLimit=-2, RecordData=True)
ma_25 = MassAddition(Input=rec_32)  # -> Result, PartialResults
entwine_150 = Entwine(Branch00=ma_25.Result, Branch01=construction_visualization, FlattenInputs=True)
rec_33 = DataRecorder(entwine_150, DataLimit=2, RecordData=True)
item_31 = ListItem(List=rec_33, Index=0, Wrap=True)  # -> Item2, Item1, Item
equals_38 = Equality(FirstNumber=item_31.Item2, SecondNumber=item_31.Item1)  # -> Equality, Inequality
bang_14 = ExplodeTree(Data=equals_38.Inequality)  # -> Branch0, Branch1
py3_45 = Python3Script(x=bang_14.Branch0, y=bang_14.Branch1)  # -> a; same code as py3_5
event_68 = EventGate(Data=py3_45)  # -> Data, IsNew
freeze_gate_52 = StreamFreezeGate(Data=py3_45, PassingSwitch=event_68.IsNew)
event_69 = EventGate(Data=freeze_gate_52)  # -> Data, IsNew
panel_164 = Panel(event_69.Data)
launchwin_12 = LaunchWindow(
    Show=event_69.Data,
    Name="Construction inspection",
    Width=Slider(380, range=0..1000),
    Height=Slider(580, range=0..1000),
    ChildStatus=1,
    EnableHorizScroll=False)
winprops_12 = SetWindowProperties(
    Window=launchwin_12,
    StartingLocation=create_modal_location_3,
    Theme=0,
    AccentColor=heath_accent_color_6,
    ShowTitleBar=True,
    BackgroundColor=RGB(255, 255, 255),
    ScaleFactor=1)
winstat_12 = WindowStatus(Window=launchwin_12)
addelems_12 = AddElements(Window=launchwin_12, Elements=flatten(entwine_149), DoVLChecking=True)  # -> AddedElements, ElementNames
py3_46 = Python3Script(window=launchwin_12, activate=construction_database_visualize_construc_3)  # same code as py3_6
panel_165 = Panel(winstat_12)
construction_visualization_status = RemoteSender(winstat_12)

construction_visualization_status_2 = RemoteReceiver(construction_visualization_status)
expression_66 = Expression(x="Hidden", y=construction_visualization_status_2, Expression="x=y")
expire_12 = ExpireObject(ObjectToExpire=objbynn_13, Expire=expression_66)

# ----
# Recursion
panel_166 = Panel("Construction modal")
create_construction_3 = RemoteReceiver(create_construction)
objbynn_14 = GetObjectByNickname(NickName=panel_166)
construction_modal = Python3Script()  # -> status; same code as lca_window_status

# ----
# Create construction launch
create_construction_modal_2 = RemoteReceiver(create_construction_modal)
rec_34 = DataRecorder(create_construction_modal_2, DataLimit=-2, RecordData=True)
ma_26 = MassAddition(Input=rec_34)  # -> Result, PartialResults
entwine_151 = Entwine(Branch00=ma_26.Result, Branch01=construction_modal, FlattenInputs=True)
rec_35 = DataRecorder(entwine_151, DataLimit=2, RecordData=True)
item_32 = ListItem(List=rec_35, Index=0, Wrap=True)  # -> Item2, Item1, Item
equals_39 = Equality(FirstNumber=item_32.Item2, SecondNumber=item_32.Item1)  # -> Equality, Inequality
bang_15 = ExplodeTree(Data=equals_39.Inequality)  # -> Branch0, Branch1
py3_47 = Python3Script(x=bang_15.Branch0, y=bang_15.Branch1)  # -> a; same code as py3_5
event_70 = EventGate(Data=py3_47)  # -> Data, IsNew
freeze_gate_53 = StreamFreezeGate(Data=py3_47, PassingSwitch=event_70.IsNew)
event_71 = EventGate(Data=freeze_gate_53)  # -> Data, IsNew
entwine_152 = Entwine(
    Branch00=entwine_134,
    Branch01=label_59,
    Branch02=merge_16,
    Branch03=button_42,
    Branch04=label_58,
    Branch05=button_43,
    FlattenInputs=True)  # -> flatten(Result)
launchwin_13 = LaunchWindow(
    Show=event_71.Data,
    Name="Create construction",
    Width=Slider(360, range=0..1000),
    Height=Slider(540, range=0..1000),
    ChildStatus=1,
    EnableHorizScroll=False)
panel_167 = Panel(event_71.Data)
create_construction_modal_3 = RemoteReceiver(create_construction_modal)
create_modal_location_4 = RemoteReceiver(create_modal_location)
addelems_13 = AddElements(Window=launchwin_13, Elements=flatten(entwine_152), DoVLChecking=True)  # -> AddedElements, ElementNames
winprops_13 = SetWindowProperties(
    Window=launchwin_13,
    StartingLocation=create_modal_location_4,
    Theme=0,
    AccentColor=heath_accent_color_8,
    ShowTitleBar=True,
    BackgroundColor=RGB(255, 255, 255),
    ScaleFactor=1)
winstat_13 = WindowStatus(Window=launchwin_13)
py3_48 = Python3Script(window=launchwin_13, activate=create_construction_modal_3)  # same code as py3_6
create_construction_modal_status = RemoteSender(winstat_13)
construction_elements = RemoteSender(addelems_13.AddedElements)

create_construction_modal_status_2 = RemoteReceiver(create_construction_modal_status)
expression_67 = Expression(x="Hidden", y=create_construction_modal_status_2, Expression="x=y")
or_23 = GateOr(A=expression_67, C=create_construction_3)
expire_13 = ExpireObject(ObjectToExpire=objbynn_14, Expire=or_23)

# ----
# Recursion
panel_168 = Panel("Window modal")
create_window_3 = RemoteReceiver(create_window)
objbynn_15 = GetObjectByNickname(NickName=panel_168)
window_modal = Python3Script()  # -> status; same code as lca_window_status

# ----
# Create window launch
create_window_modal_3 = RemoteReceiver(create_window_modal)
rec_36 = DataRecorder(create_window_modal_3, DataLimit=-2, RecordData=True)
ma_27 = MassAddition(Input=rec_36)  # -> Result, PartialResults
entwine_153 = Entwine(Branch00=ma_27.Result, Branch01=window_modal, FlattenInputs=True)
rec_37 = DataRecorder(entwine_153, DataLimit=2, RecordData=True)
item_33 = ListItem(List=rec_37, Index=0, Wrap=True)  # -> Item2, Item1, Item
equals_40 = Equality(FirstNumber=item_33.Item2, SecondNumber=item_33.Item1)  # -> Equality, Inequality
bang_16 = ExplodeTree(Data=equals_40.Inequality)  # -> Branch0, Branch1
py3_49 = Python3Script(x=bang_16.Branch0, y=bang_16.Branch1)  # -> a; same code as py3_5
event_72 = EventGate(Data=py3_49)  # -> Data, IsNew
freeze_gate_54 = StreamFreezeGate(Data=py3_49, PassingSwitch=event_72.IsNew)
event_73 = EventGate(Data=freeze_gate_54)  # -> Data, IsNew
panel_169 = Panel(event_73.Data)
entwine_154 = Entwine(
    Branch00=stack_93,
    Branch01=stack_91,
    Branch02=stack_92,
    Branch03=stack_3,
    Branch04=data,
    Branch05=a4,
    Branch06=button_47,
    FlattenInputs=True)  # -> flatten(Result)
launchwin_14 = LaunchWindow(
    Show=event_73.Data,
    Name="Create window",
    Width=Slider(235, range=0..1000),
    Height=Slider(305, range=0..1000),
    ChildStatus=1,
    EnableHorizScroll=False)
create_modal_location_5 = RemoteReceiver(create_modal_location)
create_window_modal_4 = RemoteReceiver(create_window_modal)
winstat_14 = WindowStatus(Window=launchwin_14)
addelems_14 = AddElements(Window=launchwin_14, Elements=flatten(entwine_154), DoVLChecking=True)  # -> AddedElements, ElementNames
py3_50 = Python3Script(window=launchwin_14, activate=create_window_modal_4)  # same code as py3_6
winprops_14 = SetWindowProperties(
    Window=launchwin_14,
    StartingLocation=create_modal_location_5,
    Theme=0,
    AccentColor=heath_accent_color_7,
    ShowTitleBar=True,
    BackgroundColor=RGB(255, 255, 255),
    ScaleFactor=1)
create_window_modal_status = RemoteSender(winstat_14)
window_elements = RemoteSender(addelems_14.AddedElements)

create_window_modal_status_2 = RemoteReceiver(create_window_modal_status)
expression_68 = Expression(x="Hidden", y=create_window_modal_status_2, Expression="x=y")
or_24 = GateOr(A=expression_68, C=create_window_3)
expire_14 = ExpireObject(ObjectToExpire=objbynn_15, Expire=or_24)

# ----
# Recursion
panel_170 = Panel("Material modal")
create_material_3 = RemoteReceiver(create_material)
objbynn_16 = GetObjectByNickname(NickName=panel_170)
material_modal = Python3Script()  # -> status; same code as lca_window_status

# ----
# Create material launch
create_material_modal_3 = RemoteReceiver(create_material_modal)
rec_38 = DataRecorder(create_material_modal_3, DataLimit=-2, RecordData=True)
ma_28 = MassAddition(Input=rec_38)  # -> Result, PartialResults
entwine_155 = Entwine(Branch00=ma_28.Result, Branch01=material_modal, FlattenInputs=True)
rec_39 = DataRecorder(entwine_155, DataLimit=2, RecordData=True)
item_34 = ListItem(List=rec_39, Index=0, Wrap=True)  # -> Item2, Item1, Item
equals_41 = Equality(FirstNumber=item_34.Item2, SecondNumber=item_34.Item1)  # -> Equality, Inequality
bang_17 = ExplodeTree(Data=equals_41.Inequality)  # -> Branch0, Branch1
py3_51 = Python3Script(x=bang_17.Branch0, y=bang_17.Branch1)  # -> a; same code as py3_5
event_74 = EventGate(Data=py3_51)  # -> Data, IsNew
freeze_gate_55 = StreamFreezeGate(Data=py3_51, PassingSwitch=event_74.IsNew)
event_75 = EventGate(Data=freeze_gate_55)  # -> Data, IsNew
entwine_156 = Entwine(
    Branch00=stack_87,
    Branch01=pulldown_25,
    Branch02=stack_84,
    Branch03=density,
    Branch04=specific_heat,
    Branch05=data_25,
    Branch06=a4_2,
    Branch07=data_2,
    Branch08=button_41,
    FlattenInputs=True)  # -> flatten(Result)
launchwin_15 = LaunchWindow(
    Show=event_75.Data,
    Name="Create material",
    Width=Slider(250, range=0..1000),
    Height=Slider(380, range=0..1000),
    ChildStatus=1,
    EnableHorizScroll=False)
panel_171 = Panel(event_75.Data)
create_modal_location_6 = RemoteReceiver(create_modal_location)
create_material_modal_4 = RemoteReceiver(create_material_modal)
heath_accent_color_16 = RemoteReceiver(heath_accent_color)
addelems_15 = AddElements(Window=launchwin_15, Elements=flatten(entwine_156), DoVLChecking=True)  # -> AddedElements, ElementNames
py3_52 = Python3Script(window=launchwin_15, activate=create_material_modal_4)  # same code as py3_6
winprops_15 = SetWindowProperties(
    Window=launchwin_15,
    StartingLocation=create_modal_location_6,
    Theme=0,
    AccentColor=heath_accent_color_16,
    ShowTitleBar=True,
    BackgroundColor=RGB(255, 255, 255),
    ScaleFactor=1)
winstat_15 = WindowStatus(Window=launchwin_15)
create_material_modal_status = RemoteSender(winstat_15)
material_elements = RemoteSender(addelems_15.AddedElements)

create_material_modal_status_2 = RemoteReceiver(create_material_modal_status)
expression_69 = Expression(x="Hidden", y=create_material_modal_status_2, Expression="x=y")
or_25 = GateOr(A=expression_69, C=create_material_3)
expire_15 = ExpireObject(ObjectToExpire=objbynn_16, Expire=or_25)

# ----
# Constructions database
panel_172 = Panel("Heath constructions")

# ----
# Materials database
panel_173 = Panel("Heath materials")

# ----
# Bake model
panel_174 = Panel("""Heath::honeybee model::walls
Heath::honeybee model::roof
Heath::honeybee model::floors
Heath::honeybee model::ground
Heath::honeybee model::windows
Heath::honeybee model::context""")
entwine_157 = Entwine(
    Branch00=data_21,
    Branch01=data_19,
    Branch02=data_22,
    Branch03=data_23,
    Branch04=data_20,
    Branch05=data_24,
    FlattenInputs=True)
bake_model_2 = RemoteReceiver(bake_model)
clean_5 = CleanTree(RemoveNulls=True, RemoveInvalid=True, RemoveEmpty=invert(False), Tree=entwine_157)
bbox = BoundingBox(Content=clean_5, Plane=PlaneXY(0, 0, 0))  # -> Box, Box_2
getbrn = GetMatchingBranches(PrimaryData=clean_5, SecondaryData1=graft(panel_174), removeEmpty=False)  # -> flatten(PrimaryData), flatten(SecondaryData1)
null_38 = NullItem(Item=bbox.Box)  # -> flatten(NullFlags), InvalidFlags, Description
honeybee_model_bounding_box = RemoteSender(bbox.Box)
cull_18 = CullPattern(List=null_38.NullFlags, CullPattern=invert(null_38.NullFlags))
lng_27 = ListLength(List=cull_18)
honeybee_model_displayed = RemoteSender(lng_27)

honeybee_model_displayed_2 = RemoteReceiver(honeybee_model_displayed)
hideshow_34 = HideShowElement(
    ElementToHideShow=[button_13, button_12],
    Show=honeybee_model_exists_6,
    Collapse=True,
    Disable=invert(honeybee_model_displayed_2))

ef_layer = EleFrontLayer(Layer=getbrn.SecondaryData1, fullpath=True)
ef_att_3 = EleFrontAttributes(Layer=ef_layer, maintainBakeName=False)
hasdata_9 = DataExists(Data=getbrn.PrimaryData)

gate_50 = StreamGate(Stream=ef_att_3, Gate=hasdata_9)  # -> Target0, Target1

bake = BakeObjects(Geometry=getbrn.PrimaryData, Attributes=gate_50.Target1, Bake=bake_model_2, createGroups=False)  # -> Message, Ghosts

# ----
# Zoom honeybee model
honeybee_model_bounding_box_2 = RemoteReceiver(honeybee_model_bounding_box)
zoom_honeybee_model_2 = RemoteReceiver(zoom_honeybee_model)
zbb = ZoomBoundingBox(Box=flatten(honeybee_model_bounding_box_2), Run=zoom_honeybee_model_2)

# ----
# CYCLOPS
cyclops_generate_wwr_2 = RemoteReceiver(cyclops_generate_wwr)
facesbytype = HBFacesByType(hb_objs=loadobjects.hb_objs)  # -> walls, interior_walls, roofs, ceilings, exterior_floors, interior_floors, air_walls, apertures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; plug-in component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
deconstructmodel_2 = HBDeconstructModel(model=loadobjects.hb_objs)  # -> rooms, faces, apertures, doors, shades; plug-in component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
cyclops_generate_wwr_3 = RemoteReceiver(cyclops_generate_wwr)
round = Round(Number=cyclops_generate_wwr_3)  # -> Nearest, Floor, Ceiling
vizquick = HBVisualizeQuick(hb_objs=flatten(deconstructmodel_2.rooms))  # -> geo; plug-in component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
vizquick_2 = HBVisualizeQuick(hb_objs=flatten(facesbytype.apertures))  # -> geo; plug-in component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
vizquick_3 = HBVisualizeQuick(hb_objs=flatten(facesbytype.outdoor_shades))  # -> geo; plug-in component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
clean_6 = CleanTree(RemoveNulls=True, RemoveInvalid=True, RemoveEmpty=False, Tree=vizquick_3)
clean_7 = CleanTree(RemoveNulls=True, RemoveInvalid=True, RemoveEmpty=False, Tree=vizquick)
clean_8 = CleanTree(RemoveNulls=True, RemoveInvalid=True, RemoveEmpty=False, Tree=vizquick_2)
cyclops_generate_wwr_4 = RemoteReceiver(cyclops_generate_wwr)
filter_67 = StreamFilter(Gate=cyclops_select_geometry_2, Stream0=clean_6, Stream1=context)
filter_68 = StreamFilter(Gate=cyclops_select_geometry_2, Stream0=clean_7, Stream1=merge)
filter_69 = StreamFilter(Gate=cyclops_select_geometry_2, Stream0=clean_8, Stream1=merge_2)
round_2 = Round(Number=cyclops_generate_wwr_4)  # -> Nearest, Floor, Ceiling
cyclops_preview_opacity_2 = RemoteReceiver(cyclops_preview_opacity)
expander_cyclops_daylight_approximation_3 = RemoteReceiver(expander_cyclops_daylight_approximation)
cyclops_preview_opacity_3 = RemoteReceiver(cyclops_preview_opacity)
bool_56 = Boolean(cyclops_preview_opacity_3)
debrep = DeconstructBrep(Brep=filter_67)  # -> Faces, Edges, Vertices
and_34 = GateAnd(A=expander_cyclops_daylight_approximation_3, B=bool_56)
obstruction_surface = Geometry(debrep.Faces)
md_slider = MDSlider(SliderMode=0, slider_value=Point(0.5, 0.5, 0.5), x_domain=Domain(0, 1), y_domain=Domain(0, 1), z_domain=Domain(0, 1))
location_weather_url_4 = RemoteReceiver(location_weather_url)
srf = Surface(obstruction_surface)
downloadepw_3 = LBDownloadWeather(weather_URL=location_weather_url_4)  # -> epw_file, stat_file, ddy_file; plug-in component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
Z = UnitZ(Factor=Slider(0.01, range=0..0.01))
glass_transmittance = Slider(0.8, range=0..1)
importloc_3 = LBImportLocation(epw_file=downloadepw_3.epw_file)  # -> location; plug-in component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
decnstrloc_3 = LBDeconstructLocation(location=importloc_3)  # -> name, latitude, longitude, time_zone, elevation; plug-in component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
material_name = Panel("Glass")
material_name_2 = Panel("Plaster")
hsv = ColourHSV(Alpha=1, Hue=0, Saturation=0, Value=glass_transmittance)
hours = Series(Start=0, Step=1, Count="24")
C = LocationFromCoordinates(Latitude=decnstrloc_3.latitude, Longitude=decnstrloc_3.longitude, method="Location From Coordinates", version="1.0.0.0")
tp = FromSchedule(Months="3", Days="21", Hours=hours, TimeStep=1, method="From Schedule", version="0.0.0.DevBuild")
M = PlasticMaterial(
    Name=material_name_2,
    BaseColor=ColourSwatch(SwatchColor=RGB(210, 205, 182)),
    Specularity="0.0057",
    Roughness="0.2",
    method="Plastic Material",
    version="1.0.0.0")
M_2 = GlassMaterial(Name=material_name, Transmittance=hsv, RefractiveIndex=1.52, method="Glass Material", version="0.0.0.DevBuild")
intersection_type = IntersectionType(CyclopsValueList="Target", version="1.2.0.60000")
R = SunRig(NorthVector=Vector(0, 1, 0), Location=C, TimePattern=tp, CutOffElevation=0, method="Sun Rig", version="1.0.0.0")
subdivision = Subdivision(CyclopsValueList="EqualAreaAspectSubdivision", version="1.0.0.0")
cell_count = Slider(128, range=0..1000)
H = Hemisphere(CellCount=cell_count, Subdivision=subdivision, method="Hemisphere", version="0.0.0.DevBuild")
cyclops_select_simulation_4 = RemoteReceiver(cyclops_select_simulation)
luminous_efficacy_model = LuminousEfficacyModel(CyclopsValueList="Measured Illuminance", version="1.2.0.60000")
cyclops_select_simulation_5 = RemoteReceiver(cyclops_select_simulation)
hemisphere = Data(H)
months = Series(Start=Slider(1, range=1..12), Step=1, Count=Slider(12, range=1..12))
days = Series(Start=Slider(1, range=1..31), Step=1, Count=Slider(31, range=1..31))
hours_2 = Series(Start=Slider(8, range=0..23), Step=1, Count=Slider(10, range=0..23))
luminance_distribution_model = LuminanceDistributionModel(CyclopsValueList="CIE Standard Sky Model", version="1.2.0.60000")
analysis_quality = AnalysisQuality(CyclopsValueList="Medium", version="1.2.0.60000")
hemisphere_2 = Data(H)
hemisphere_3 = Data(H)
tp_2 = FromSchedule(Months=months, Days=days, Hours=hours_2, TimeStep=1, method="From Schedule", version="0.0.0.DevBuild")
W = Weather(
    Path=downloadepw_3.epw_file,
    NorthVector=Vector(0, 1, 0),
    LuminousEfficacyModel=luminous_efficacy_model,
    version="1.2.0.60000")
aps = PresetAnalysisSettings(AnalysisQuality=analysis_quality, version="1.2.0.60000")
ss = SkySeries(
    Weather=W,
    Hemisphere=hemisphere,
    TimePattern=tp_2,
    LuminanceDistributionModel=luminance_distribution_model,
    version="1.2.0.60000")
sky_type = SkyType(CyclopsValueList="S01_CIEStandardOvercastSky", version="1.0.0.0")
cyclops_select_simulation_6 = RemoteReceiver(cyclops_select_simulation)
cyclops_select_simulation_7 = RemoteReceiver(cyclops_select_simulation)
cyclops_select_simulation_8 = RemoteReceiver(cyclops_select_simulation)
cyclops_select_simulation_9 = RemoteReceiver(cyclops_select_simulation)
cyclops_select_simulation_10 = RemoteReceiver(cyclops_select_simulation)
sky_type_2 = SkyType(CyclopsValueList="S01_CIEStandardOvercastSky", version="1.2.0.60000")
cyclops_select_simulation_11 = RemoteReceiver(cyclops_select_simulation)
threshold = Slider(300, range=0..1000)
threshold_2 = Slider(300, range=0..1000)
properties = Properties(CyclopsValueList="Hemisphere", version="1.2.0.60000")
sun_rig = CyclopsObject(R, version="1.2.0.60000")
dom_10 = ConstructDomain(DomainStart=threshold, DomainEnd=Slider(2000, range=0..10000))
properties_2 = Properties(CyclopsValueList="Cumulative Sky", version="1.2.0.60000")
gpv = GetPropertyValue(Object=ss, Property=properties, version="1.2.0.60000")
gpv_2 = GetPropertyValue(Object=ss, Property=properties_2, version="1.2.0.60000")
properties_3 = Properties(CyclopsValueList="Luminance Cells", version="1.2.0.60000")
panel_175 = Panel("""10000
500
60000""")
gpv_3 = GetPropertyValue(Object=gpv_2, Property=properties_3, version="1.2.0.60000")
item_35 = ListItem(List=panel_175, Index=cyclops_metric_option_3, Wrap=True)
properties_4 = Properties(CyclopsValueList="Total Luminance", version="1.2.0.60000")
cyclops_slider_value_6 = RemoteReceiver(cyclops_slider_value)
cyclops_slider_value_7 = RemoteReceiver(cyclops_slider_value)
cyclops_slider_value_8 = RemoteReceiver(cyclops_slider_value)
gpv_4 = GetPropertyValue(Object=gpv_3, Property=properties_4, version="1.2.0.60000")  # -> flatten(Value)
cyclops_filter_checkbox_6 = RemoteReceiver(cyclops_filter_checkbox)
cyclops_filter_checkbox_7 = RemoteReceiver(cyclops_filter_checkbox)
cyclops_filter_checkbox_8 = RemoteReceiver(cyclops_filter_checkbox)
cyclops_filter_checkbox_9 = RemoteReceiver(cyclops_filter_checkbox)
bnd = Bounds(Numbers=gpv_4)
hemisphere_projection = HemisphereProjection(CyclopsValueList="Spherical", version="1.2.0.60000")
interactive_gradient = InteractiveGradient(
    Domain=bnd,
    version="0.0.0.DevBuild",
    CyclopsGradient_Linear=False,
    CyclopsGradient_Grip0_Factor=0,
    CyclopsGradient_Grip1_Factor=0.25,
    CyclopsGradient_Grip2_Factor=0.5,
    CyclopsGradient_Grip3_Factor=0.75,
    CyclopsGradient_Grip4_Factor=1)
D = HemisphereMesh(
    Hemisphere=gpv,
    Position=Point(0, 0, 0),
    Scale=Slider(10, range=0..100),
    HemisphereProjection=hemisphere_projection,
    Parameters=gpv_4,
    Gradient=interactive_gradient,
    method="Hemisphere Mesh",
    version="1.2.0.60000")
hemishere_visualisation = Mesh(D)
expander_cyclops_daylight_approximation_4 = RemoteReceiver(expander_cyclops_daylight_approximation)

clean_9 = CleanTree(RemoveNulls=True, RemoveInvalid=True, RemoveEmpty=False, Tree=filter_68)
clean_10 = CleanTree(RemoveNulls=True, RemoveInvalid=True, RemoveEmpty=False, Tree=filter_69)
gate_51 = StreamGate(Stream=filter_67, Gate=expander_cyclops_daylight_approximation_2)  # -> Target0, Target1
preview_18 = CustomPreview(Geometry=gate_51.Target1, Material=ColourSwatch(SwatchColor=RGB(136, 86, 33)))
expression_70 = Expression(x="Daylight metrics", y=cyclops_select_simulation_4, Expression="x=y")
expression_71 = Expression(x="Useful daylight illuminance", y=cyclops_select_simulation_4, Expression="x=y")
expression_72 = Expression(x="Daylight autonomy", y=cyclops_select_simulation_4, Expression="x=y")
expression_73 = Expression(x="Daylight factor", y=cyclops_select_simulation_4, Expression="x=y")
expression_74 = Expression(x="Culmulative radiation", y=cyclops_select_simulation_5, Expression="x=y")
expression_75 = Expression(x="Daylight factor", y=cyclops_select_simulation_6, Expression="x=y")
expression_76 = Expression(x="Sunlight hour analysis", y=cyclops_select_simulation_7, Expression="x=y")
expression_77 = Expression(x="Useful daylight illuminance", y=cyclops_select_simulation_9, Expression="x=y")
expression_78 = Expression(x="Daylight autonomy", y=cyclops_select_simulation_8, Expression="x=y")
expression_79 = Expression(x="Daylight metrics", y=cyclops_select_simulation_10, Expression="x=y")
expression_80 = Expression(x="Sky component analysis", y=cyclops_select_simulation_11, Expression="x=y")

# ----
# Weather visualisation
# # Weather visualisation
# This cluster visualises weather data from a .epw file including solar radiation and temperature, as applied to a target geometry
# 
# ## Instructions
# Enter all the inputs and visualise wind, sky view and temperature,  set `Run direct sun hours study` and `Run incident radiation study` to visualise solar radiation
# 
# ## Inputs
# - `EPW file URL` - the URL for a EPW file which describes the location
# - `Target Geometry` - geometry on which to apply irradiation study
# - `Context Geometry` - geometry which shades the target geometry
# - `Run direct sun hours study` - set to True to run the direct sun hours study
# - `Run incident radiation study` - set to True to run the incident radiation study
# - `Sky mask centre point` - point at which to generate sky mask
# 
# ## Outputs
# - `Sky dome` - mesh visualising the directions where solar radiation comes from during the year at the location
# - `Sky mask - mesh visualising what portions of the sky are visible at the specified point
# - `Wind rose` - mesh visualising wind directions and velocities during the year
# - `Dry bulb temperature line chart` - mesh visualising dry bulb temperature during the year
# - `Dry bulb temperature 2D chart` - mesh visualising dry bulb temperature for each hour of the year
# - `Direct sun hours` - mesh visualising the number of direct sun hours on the target geometry
# - `Incident radiation` - mesh visualising the incident radiation [kWh/m2] on the target geometry
# 
# ## Interpretation
# To be added...
location_weather_url_5 = RemoteReceiver(location_weather_url)
data_26 = Data(location_weather_url_5)
downloadepw_4 = LBDownloadWeather(weather_URL=data_26)  # -> epw_file, stat_file, ddy_file; plug-in component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
importepw = LBImportEPW(epw_file=downloadepw_4.epw_file)  # -> location, dry_bulb_temperature, dew_point_temperature, relative_humidity, wind_speed, wind_direction, direct_normal_rad, diffuse_horizontal_rad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; plug-in component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
timeop = LBTimeIntervalOperation(data=importepw.dry_bulb_temperature)  # -> daily, monthly, mon_per_hr; plug-in component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
analysisperiod = LBAnalysisPeriod(
    start_month=Slider(1, range=1..12),
    start_day=Slider(1, range=1..31),
    start_hour=Slider(0, range=0..23),
    end_month=Slider(12, range=1..12),
    end_day=Slider(31, range=1..31),
    end_hour=Slider(23, range=0..23))  # -> period, hoys, dates; plug-in component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
legendpar_3 = LBLegendParameters(
    min=Slider(-15, range=-15..30),
    max=Slider(25, range=0..100),
    num_decimals=Slider(0, range=0..100),
    larger_smaller=Toggle(True),
    vert_or_horiz=Toggle(False))  # -> leg_par; plug-in component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
monthlychart = LBMonthlyChart(data=timeop.daily)  # -> report, data_mesh, data_lines, col_lines, legend, borders, labels, y_title, title, vis_set; plug-in component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
windrose = LBWindRose(data=importepw.wind_speed, wind_direction=importepw.wind_direction, show_calm=Toggle(True), period=analysisperiod.period)  # -> report, mesh, compass, orient_line, freq_line, windrose_line, legend, title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; plug-in component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
hourlyplot = LBHourlyPlot(data=importepw.dry_bulb_temperature, z_dim=Slider(0, range=0..100), reverse_y=Toggle(True), legend_par=legendpar_3)  # -> report, mesh, legend, borders, labels, title, vis_set; plug-in component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
merge_17 = Merge(Data1=hourlyplot.mesh, Data2=hourlyplot.legend, Data4=hourlyplot.labels, Data5=hourlyplot.title)
merge_18 = Merge(
    Data1=monthlychart.data_mesh,
    Data2=monthlychart.legend,
    Data4=monthlychart.labels,
    Data5=monthlychart.y_title,
    Data6=monthlychart.title)  # -> flatten(DryBulbTemperatureLineChart)
merge_19 = Merge(
    Data1=windrose.mesh,
    Data2=windrose.compass,
    Data3=windrose.orient_line,
    Data4=windrose.freq_line,
    Data6=windrose.legend,
    Data7=windrose.title)
weather_visualization_type_2 = RemoteReceiver(weather_visualization_type)
filter_70 = StreamFilter(Gate=weather_visualization_type_2, Stream0=hemishere_visualisation, Stream1=merge_19, Stream2=merge_18, Stream3=merge_17)
null_39 = NullItem(Item=filter_70)  # -> NullFlags, InvalidFlags, Description
cull_19 = CullPattern(List=null_39.NullFlags, CullPattern=invert(null_39.NullFlags))
clean_11 = CleanTree(RemoveNulls=True, RemoveInvalid=True, RemoveEmpty=False, Tree=filter_70)
lng_28 = ListLength(List=cull_19)
indices = ListIndices(Data=filter_70)
index_2 = ItemIndex(List=filter_70, Item=clean_11)
weather_visualisation_exists = RemoteSender(lng_28)
exdiff = SetDifferenceS(SetA=indices, SetB=index_2)
item_36 = ListItem(List=filter_70, Index=exdiff, Wrap=True)
alignvert = AlignVertices(Mesh=item_36, Tolerance=0.01)  # -> Result, Count
expander_inspect_location_environment_2 = RemoteReceiver(expander_inspect_location_environment)
clean_12 = CleanTree(RemoveNulls=True, RemoveInvalid=True, RemoveEmpty=False, Tree=alignvert.Result)
merge_20 = Merge(Data1=clean_11, Data2=clean_12)
gate_52 = StreamGate(Stream=merge_20, Gate=expander_inspect_location_environment_2)  # -> Target0, Target1
preview_19 = CustomPreview(Geometry=gate_52.Target1, Material=ColourSwatch(SwatchColor=RGB(84, 84, 84)))

weather_visualisation_exists_2 = RemoteReceiver(weather_visualisation_exists)
hideshow_35 = HideShowElement(ElementToHideShow=[button_14, button_15], Show=weather_visualisation_exists_2, Collapse=True, Disable=False)

division_10 = Division(A=cyclops_slider_value_6, B="100")

# ----
# Bake weather visualization
panel_176 = Panel("""Heath::weather::Hemishere visualisation
Heath::weather::Wind rose
Heath::weather::Temperature line chart
Heath::weather::Temperature 2D chart""")
weather_visualization_type_3 = RemoteReceiver(weather_visualization_type)
weather_visualisation_bake_2 = RemoteReceiver(weather_visualisation_bake)
item_37 = ListItem(List=panel_176, Index=weather_visualization_type_3, Wrap=invert(True))
gate_53 = StreamGate(Stream=item_37, Gate=weather_visualisation_bake_2)  # -> Target0, Target1
connected = GetConnectedObjects(Objects=gate_52.Target1)
layers = CreateModifyLayers(LayerName=gate_53.Target1, DeleteLayer=False, enableFullPath=True)  # -> LayerNames, LayerFullPath
createatts = CreateAttributes(LayerName=layers.LayerFullPath, enableFullPath=True)
bake_2 = BakeObject(Objects=connected, ObjectAttributes=createatts, Bake=weather_visualisation_bake_2)

# ----
# Zoom weather visualization
zoom_weather_visualization_2 = RemoteReceiver(zoom_weather_visualization)
mesh = Mesh(gate_52.Target1)
bbox_2 = BoundingBox(Content=mesh, Plane=PlaneXY(0, 0, 0), UnionBox=True)  # -> Box, Box_2
zbb_2 = ZoomBoundingBox(Box=bbox_2.Box, Run=zoom_weather_visualization_2)

srf_2 = Surface(clean_10)
roomsolid = HBRoomFromSolid(geo=flatten(clean_9), conditioned=True)  # -> report, rooms; plug-in component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
aperture = HBAperture(geo=srf_2)  # -> report, apertures; plug-in component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
gate_54 = StreamGate(Stream=roomsolid.rooms, Gate=round.Ceiling)  # -> Target0, Target1
aperturesbyratio = HBAperturesByRatio(hb_objs=flatten(gate_54.Target1), ratio=cyclops_generate_wwr_2)  # -> report, hb_objs; plug-in component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
addsubface = HBAddSubface(hb_obj=flatten(gate_54.Target0), sub_faces=flatten(aperture.apertures))  # -> hb_obj; plug-in component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
filter_71 = StreamFilter(Gate=round.Ceiling, Stream0=addsubface, Stream1=aperturesbyratio.hb_objs)
vizbytype_2 = HBVisualizeByType(hb_objs=filter_71)  # -> walls, interior_walls, roofs, ceilings, exterior_floors, interior_floors, air_walls, apertures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; plug-in component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
medges = MeshEdges(Mesh=vizbytype_2.apertures)  # -> NakedEdges, InteriorEdges, NonManifoldEdges
clean_13 = CleanTree(
    RemoveNulls=True,
    RemoveInvalid=True,
    RemoveEmpty=False,
    Tree=[vizbytype_2.walls, vizbytype_2.roofs, vizbytype_2.apertures, vizbytype_2.ceilings, vizbytype_2.exterior_floors, vizbytype_2.interior_floors])
join_11 = JoinCurves(Curves=medges.NakedEdges, Preserve=False)
demesh = DeconstructMesh(Mesh=clean_13)  # -> Vertices, Faces, Colours, Normals
filter_72 = StreamFilter(Gate=round_2.Ceiling, Stream0=clean_10, Stream1=join_11)
argb = SplitARGB(Colour=demesh.Colours, IntegerChannels=True)  # -> Alpha, Red, Green, Blue
rgb = ColourRGB(Alpha=cyclops_preview_opacity_2, Red=argb.Red, Green=argb.Green, Blue=argb.Blue)
conmesh = ConstructMesh(Vertices=demesh.Vertices, Faces=demesh.Faces, Colours=rgb)
fbd = BrepFacesByDirection(Brep=clean_9, Tolerance=0.9)  # -> Top, Bottom, Sides
windows_4 = Geometry(filter_72)
gate_55 = StreamGate(Stream=conmesh, Gate=and_34)  # -> Target0, Target1
roof = Geometry(fbd.Top)
floor = Geometry(fbd.Bottom)
facade = Geometry(fbd.Sides)
mjoin = MeshJoin(Meshes=flatten(gate_55.Target1))
area = Area(Geometry=windows_4, UseTasks=True)  # -> Area, Centroid
srf_cp = SurfaceClosestPoint(Point=flatten(area.Centroid), Surface=graft(facade))  # -> Point, UVPoint, Distance
smaller_2 = SmallerThan(FirstNumber=srf_cp.Distance, SecondNumber=Slider(0.05, range=0..0.1))  # -> SmallerThan, OrEqualTo
equals_42 = Equality(FirstNumber=srf_cp.Distance, SecondNumber=srf_cp.Distance)  # -> Equality, Inequality
and_35 = GateAnd(A=equals_42.Equality, B=smaller_2.SmallerThan)
cull_20 = CullPattern(List=and_35, CullPattern=and_35)
crv = Curve(graft(facade))
index_3 = ItemIndex(List=and_35, Item=cull_20)
item_38 = ListItem(List=windows_4, Index=index_3, Wrap=True)
lng_29 = ListLength(List=item_38)
dispatch = Dispatch(List=crv, DispatchPattern=invert(lng_29))  # -> ListA, ListB
merge_21 = Merge(Data1=dispatch.ListA, Data2=dispatch.ListB, Data3=item_38)
evalsrf = EvaluateSurface(Surface=reparameterize(facade), Point=md_slider)  # -> Point, Normal, UDirection, VDirection, Frame
boundary = BoundarySurfaces(Edges=merge_21)
srf_3 = Surface(boundary)
srf_4 = Surface(roof)
srf_5 = Surface(floor)
srf_6 = Surface(windows_4)
multiplication_3 = Multiplication(A=Slider(0.01, range=0..0.01), B=evalsrf.Normal)
move = Move(Geometry=srf_5, Motion=Z)  # -> Geometry, Transform
move_2 = Move(Geometry=facade, Motion=multiplication_3)  # -> Geometry, Transform
dim = Dimensions(Surface=move.Geometry)  # -> UDimension, VDimension
dim_2 = Dimensions(Surface=move_2.Geometry)  # -> UDimension, VDimension
mesh_uv = MeshSurface(Surface=move.Geometry, UCount=dim.UDimension, VCount=dim.VDimension, Overhang=True, Equalize=False)
mesh_uv_2 = MeshSurface(Surface=move_2.Geometry, UCount=dim_2.UDimension, VCount=dim_2.VDimension, Overhang=True, Equalize=False)
merge_22 = Merge(Data1=srf, Data2=srf_4, Data3=srf_5, Data4=srf_3)  # -> flatten(Result)
glass = Geometry(srf_6)
mjoin_2 = MeshJoin(Meshes=flatten(mesh_uv))
mjoin_3 = MeshJoin(Meshes=flatten(mesh_uv_2))
demesh_2 = DeconstructMesh(Mesh=mjoin_2)  # -> Vertices, Faces, Colours, Normals
G = Geometry(Mesh=merge_22, MaterialName=material_name_2, Parameter=0, method="Geometry", version="0.0.0.DevBuild")
G_2 = Geometry(Mesh=glass, MaterialName=material_name, Parameter=0, method="Geometry", version="0.0.0.DevBuild")
facen = FaceNormals(Mesh=mjoin_2)  # -> Centers, Normals
preview_20 = CustomPreview(Geometry=merge_22, Material=ColourSwatch(SwatchColor=RGBA(167, 128, 26, 12)))
demesh_3 = DeconstructMesh(Mesh=mjoin_3)  # -> Vertices, Faces, Colours, Normals
facen_2 = FaceNormals(Mesh=mjoin_3)  # -> Centers, Normals
abs = Absolute(Value=facen.Normals)
deface = DeconstructFace(Face=demesh_2.Faces)  # -> CornerA, CornerB, CornerC, CornerD
deface_2 = DeconstructFace(Face=demesh_3.Faces)  # -> CornerA, CornerB, CornerC, CornerD
A = AnalysisPoint(Position=facen_2.Centers, Direction=facen_2.Normals, method="Analysis Point", version="1.0.0.0")
A_2 = AnalysisPoint(Position=facen.Centers, Direction=abs, method="Analysis Point", version="1.0.0.0")
merge_23 = Merge(Data1=graft(deface.CornerA), Data2=graft(deface.CornerB), Data3=graft(deface.CornerC), Data4=graft(deface.CornerD))
merge_24 = Merge(Data1=G, Data2=G_2)  # -> flatten(Result)
merge_25 = Merge(
    Data1=graft(deface_2.CornerA),
    Data2=graft(deface_2.CornerB),
    Data3=graft(deface_2.CornerC),
    Data4=graft(deface_2.CornerD))
item_39 = ListItem(List=demesh_2.Vertices, Index=merge_23, Wrap=True)
G_3 = GeometryGroup(
    Name="Default Geometry Group",
    Geometry=merge_24,
    VisibilityMask="""{
  "Mask1": true,
  "Mask2": true,
  "Mask3": true,
  "Mask4": true,
  "Mask5": true,
  "Mask6": true,
  "Mask7": true,
  "Mask8": true,
  "BitMap": [
    true,
    true,
    true,
    true,
    true,
    true,
    true,
    true
  ]
}""",
    Transforms={TransformCount=1, Name="Generic", m00=1, m01=0, m02=0, m03=0, m10=0, m11=1, m12=0, m13=0, m20=0, m21=0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},
    IntersectionType=intersection_type,
    method="Geometry Group",
    version="1.0.0.0")
item_40 = ListItem(List=demesh_3.Vertices, Index=merge_25, Wrap=True)
conmesh_2 = ConstructMesh(Vertices=item_39, Faces={A=0, B=1, C=2, D=3})
conmesh_3 = ConstructMesh(Vertices=item_40, Faces={A=0, B=1, C=2, D=3})
scene_objects = Merge(Data1=G_3, Data2=M, Data3=M_2)  # -> flatten(Result)
analysis_points = CyclopsObject(A_2, version="0.0.0.DevBuild")
scene_objects_2 = CyclopsObject(scene_objects, version="0.0.0.DevBuild")
analysis_points_2 = CyclopsObject(A, version="0.0.0.DevBuild")
scene_objects_3 = CyclopsObject(scene_objects, version="0.0.0.DevBuild")
or_26 = GateOr(A=expression_73, B=expression_71, C=expression_72, D=expression_70)
sma = ShadingMaskAnalysis(
    Run=expression_74,
    SceneObjects=scene_objects_3,
    AnalysisPoints=analysis_points_2,
    Hemisphere=hemisphere_3,
    SamplingSettings=do,
    VisibilityMask="""{
  "Mask1": true,
  "Mask2": true,
  "Mask3": true,
  "Mask4": true,
  "Mask5": true,
  "Mask6": true,
  "Mask7": true,
  "Mask8": true,
  "BitMap": [
    true,
    true,
    true,
    true,
    true,
    true,
    true,
    true
  ]
}""",
    version="1.2.0.60000")  # -> Scene, ShadingMasks
sma_2 = ShadingMaskAnalysis(
    Run=or_26,
    SceneObjects=scene_objects_2,
    AnalysisPoints=analysis_points,
    Hemisphere=hemisphere_2,
    SamplingSettings=aps,
    VisibilityMask="""{
  "Mask1": true,
  "Mask2": true,
  "Mask3": true,
  "Mask4": true,
  "Mask5": true,
  "Mask6": true,
  "Mask7": true,
  "Mask8": true,
  "BitMap": [
    true,
    true,
    true,
    true,
    true,
    true,
    true,
    true
  ]
}""",
    version="1.2.0.60000")  # -> Scene, ShadingMasks
analysis_points_3 = CyclopsObject(A, version="0.0.0.DevBuild")
scene_objects_4 = CyclopsObject(scene_objects, version="0.0.0.DevBuild")
analysis_points_4 = CyclopsObject(A, version="1.2.0.60000")
scene_objects_5 = CyclopsObject(scene_objects, version="1.2.0.60000")
gate_56 = StreamGate(Stream=sma_2.ShadingMasks, Gate=expression_75)  # -> Target0, Target1
gate_57 = StreamGate(Stream=sma_2.ShadingMasks, Gate=expression_77)  # -> Target0, Target1
gate_58 = StreamGate(Stream=sma_2.ShadingMasks, Gate=expression_78)  # -> Target0, Target1
gate_59 = StreamGate(Stream=sma_2.ShadingMasks, Gate=expression_79)  # -> Target0, Target1
sha = SunlightHourAnalysis(
    Run=expression_76,
    SceneObjects=scene_objects_5,
    SunRig=sun_rig,
    AnalysisPoints=analysis_points_4,
    VisibilityMask="""{
  "Mask1": true,
  "Mask2": true,
  "Mask3": true,
  "Mask4": true,
  "Mask5": true,
  "Mask6": true,
  "Mask7": true,
  "Mask8": true,
  "BitMap": [
    true,
    true,
    true,
    true,
    true,
    true,
    true,
    true
  ]
}""",
    method="Sunlight Hour Analysis",
    version="1.0.0.0")  # -> Scene, SunlightHours
udi = UsefulDaylightIlluminance(
    ShadingMasks=gate_57.Target1,
    SkySeries=ss,
    IlluminanceInterval=dom_10,
    method="Useful Daylight Illuminance",
    version="1.0.0.0")  # -> UDI, UDILow, UDIHigh
ra = CumulativeRadiation(ShadingMasks=sma.ShadingMasks, SkySeries=ss, method="Cumulative Radiation", version="0.0.0.DevBuild")  # -> CumulativeRadiation, AverageIrradiance
df = DaylightFactor(ShadingMasks=gate_56.Target1, SkyType=sky_type_2, version="1.2.0.60000")
da = DaylightAutonomy(
    ShadingMasks=gate_58.Target1,
    SkySeries=ss,
    IlluminanceThreshold=threshold_2,
    method="Daylight Autonomy",
    version="0.0.0.DevBuild")  # -> DA, CDA
sca = SkyComponentAnalysis(
    Run=expression_80,
    SceneObjects=scene_objects_4,
    AnalysisPoints=analysis_points_3,
    SkyType=sky_type,
    VisibilityMask="""{
  "Mask1": true,
  "Mask2": true,
  "Mask3": true,
  "Mask4": true,
  "Mask5": true,
  "Mask6": true,
  "Mask7": true,
  "Mask8": true,
  "BitMap": [
    true,
    true,
    true,
    true,
    true,
    true,
    true,
    true
  ]
}""",
    method="Sky Component Analysis",
    version="1.0.0.0")  # -> Scene, SkyComponent
dm = DaylightMetrics(ShadingMasks=gate_59.Target1, SkySeries=ss, method="Daylight Metrics", version="1.0.0.0")  # -> Average, Min, Max
filter_73 = StreamFilter(Gate=cyclops_metric_option_3, Stream0=dm.Average, Stream1=dm.Min, Stream2=dm.Max)
facade_panels = Geometry(conmesh_3)
analysis_results = Number(sca.SkyComponent)
analysis_results_2 = Number(sha.SunlightHours)
facade_panels_2 = Geometry(conmesh_3)
facade_panels_3 = Geometry(conmesh_3)
floor_panels = Geometry(conmesh_2)
analysis_results_3 = Number(da.DA)
analysis_results_4 = Number(ra.CumulativeRadiation)
analysis_results_5 = Number(df)
analysis_results_6 = Number(udi.UDI)
floor_panels_2 = Geometry(conmesh_2)
floor_panels_3 = Geometry(conmesh_2)
floor_panels_4 = Geometry(conmesh_2)
larger_5 = LargerThan(FirstNumber=analysis_results_2, SecondNumber=cyclops_slider_value_8)  # -> LargerThan, OrEqualTo
larger_6 = LargerThan(FirstNumber=analysis_results, SecondNumber=division_10)  # -> LargerThan, OrEqualTo
gradient = Gradient(
    LowerLimit=0,
    UpperLimit=Slider(10, range=0..10),
    Parameter=analysis_results_2,
    stops=[0: RGB(64, 64, 0), 0.494: RGB(255, 255, 0), 1: RGB(255, 255, 255)])
gradient_2 = Gradient(
    LowerLimit=0,
    UpperLimit="0.5",
    Parameter=analysis_results,
    stops=[0: RGB(0, 0, 64), 0.495: RGB(173, 203, 249), 1: RGB(255, 255, 255)])
gradient_3 = Gradient(
    LowerLimit=0,
    UpperLimit=Slider(1200, range=0..1200),
    Parameter=analysis_results_4,
    stops=[0: RGB(75, 107, 169), 0.25: RGB(173, 203, 249), 0.5: RGB(254, 244, 84), 0.75: RGB(234, 126, 0), 1: RGB(234, 38, 0)])
gradient_4 = Gradient(
    LowerLimit=0,
    UpperLimit="1",
    Parameter=analysis_results_6,
    stops=[0: RGB(34, 34, 34), 0.327: RGB(0, 79, 127), 0.658: RGB(46, 156, 240), 1: RGB(255, 255, 255)])
gradient_5 = Gradient(
    LowerLimit=0,
    UpperLimit="1",
    Parameter=analysis_results_3,
    stops=[0: RGB(34, 34, 34), 0.327: RGB(0, 79, 127), 0.658: RGB(46, 156, 240), 1: RGB(255, 255, 255)])
larger_7 = LargerThan(FirstNumber=analysis_results_4, SecondNumber=cyclops_slider_value_7)  # -> LargerThan, OrEqualTo
larger_8 = LargerThan(FirstNumber=analysis_results_5, SecondNumber=division_9)  # -> LargerThan, OrEqualTo
gradient_6 = Gradient(
    LowerLimit=0,
    UpperLimit="0.2",
    Parameter=analysis_results_5,
    stops=[0: RGB(34, 34, 34), 0.327: RGB(0, 79, 127), 0.658: RGB(46, 156, 240), 1: RGB(255, 255, 255)])
filter_74 = StreamFilter(Gate=cyclops_filter_checkbox_6, Stream0="True", Stream1=larger_5.OrEqualTo)
filter_75 = StreamFilter(Gate=cyclops_filter_checkbox_7, Stream0="True", Stream1=larger_6.OrEqualTo)
filter_76 = StreamFilter(Gate=cyclops_filter_checkbox_8, Stream0="True", Stream1=larger_7.OrEqualTo)
filter_77 = StreamFilter(Gate=cyclops_filter_checkbox_9, Stream0="True", Stream1=larger_8.OrEqualTo)
cull_21 = CullPattern(List=facade_panels, CullPattern=graft(filter_74))
cull_22 = CullPattern(List=facade_panels_3, CullPattern=graft(filter_75))
cull_23 = CullPattern(List=facade_panels_2, CullPattern=graft(filter_76))
cull_24 = CullPattern(List=floor_panels_2, CullPattern=graft(filter_77))
mcol = MeshColours(Mesh=graft(cull_21), Colours=graft(gradient))
mcol_2 = MeshColours(Mesh=graft(cull_22), Colours=graft(gradient_2))
mcol_3 = MeshColours(Mesh=graft(cull_23), Colours=graft(gradient_3))
mcol_4 = MeshColours(Mesh=graft(cull_24), Colours=graft(gradient_6))
culmulative_radiation = Mesh(mcol_3)
sunlight_hour_analysis = Mesh(mcol)
daylight_factor = Mesh(mcol_4)
sky_component_analysis = Mesh(mcol_2)

gate_60 = StreamGate(Stream=conmesh, Gate=expander_cyclops_daylight_approximation_3)  # -> Target0, Target1
cyclopsdisplaybbox = RemoteSender(gate_60.Target1)
merge_26 = Merge(Data1=mjoin, Data2=gate_51.Target1)
lng_30 = ListLength(List=flatten(conmesh_2))
lng_31 = ListLength(List=flatten(conmesh_3))
cyclopsallfloorpanelamount = RemoteSender(lng_30)
cyclopsallfacadepanelamount = RemoteSender(lng_31)
analysis_results_7 = Number(filter_73)
larger_9 = LargerThan(FirstNumber=analysis_results_7, SecondNumber=cyclops_slider_value_5)  # -> LargerThan, OrEqualTo
larger_10 = LargerThan(FirstNumber=analysis_results_3, SecondNumber=division_7)  # -> LargerThan, OrEqualTo
larger_11 = LargerThan(FirstNumber=analysis_results_6, SecondNumber=division_8)  # -> LargerThan, OrEqualTo
filter_78 = StreamFilter(Gate=cyclops_filter_checkbox_3, Stream0="True", Stream1=larger_9.OrEqualTo)
filter_79 = StreamFilter(Gate=cyclops_filter_checkbox_4, Stream0="True", Stream1=larger_10.OrEqualTo)
filter_80 = StreamFilter(Gate=cyclops_filter_checkbox_5, Stream0="True", Stream1=larger_11.OrEqualTo)
cull_25 = CullPattern(List=floor_panels_4, CullPattern=graft(filter_78))
cull_26 = CullPattern(List=floor_panels_3, CullPattern=graft(filter_79))
cull_27 = CullPattern(List=floor_panels, CullPattern=graft(filter_80))

displaymesh = Mesh(flatten(merge_26))
gradient_7 = Gradient(
    LowerLimit=0,
    UpperLimit=item_35,
    Parameter=analysis_results_7,
    stops=[0: RGB(34, 34, 34), 0.327: RGB(0, 79, 127), 0.658: RGB(46, 156, 240), 1: RGB(255, 255, 255)])
mcol_5 = MeshColours(Mesh=graft(cull_27), Colours=graft(gradient_4))
mcol_6 = MeshColours(Mesh=graft(cull_26), Colours=graft(gradient_5))
mcol_7 = MeshColours(Mesh=graft(cull_25), Colours=graft(gradient_7))
useful_daylight_illuminance = Mesh(mcol_5)
daylight_autonomy = Mesh(mcol_6)
daylight_metrics = Mesh(mcol_7)
filter_81 = StreamFilter(
    Gate=cyclops_select_simulation_index_4,
    Stream0=sunlight_hour_analysis,
    Stream1=sky_component_analysis,
    Stream2=culmulative_radiation,
    Stream3=daylight_factor,
    Stream4=useful_daylight_illuminance,
    Stream5=daylight_autonomy,
    Stream6=daylight_metrics)  # -> flatten(Stream)
gate_61 = StreamGate(Stream=filter_81, Gate=expander_cyclops_daylight_approximation_4)  # -> Target0, Target1
mjoin_4 = MeshJoin(Meshes=gate_61.Target1)
null_40 = NullItem(Item=gate_61.Target1)  # -> NullFlags, InvalidFlags, Description
cull_28 = CullPattern(List=null_40.NullFlags, CullPattern=invert(null_40.NullFlags))
displaymesh_2 = Mesh(mjoin_4)
lng_32 = ListLength(List=cull_28)
cyclops_visualisation_exists = RemoteSender(lng_32)

lng_33 = ListLength(List=flatten(filter_81))
cyclopspassedpanelamount = RemoteSender(lng_33)

cyclopsallfacadepanelamount_2 = RemoteReceiver(cyclopsallfacadepanelamount)
cyclopsallfloorpanelamount_2 = RemoteReceiver(cyclopsallfloorpanelamount)
cyclopspassedpanelamount_2 = RemoteReceiver(cyclopspassedpanelamount)
filter_82 = StreamFilter(Gate=larger.LargerThan, Stream0=cyclopsallfacadepanelamount_2, Stream1=cyclopsallfloorpanelamount_2)
division_11 = Division(A=cyclopspassedpanelamount_2, B=filter_82)
multiplication_4 = Multiplication(A=division_11, B="100")
round_3 = Round(Number=multiplication_4)  # -> Nearest, Floor, Ceiling
cyclops_visualisation_exists_2 = RemoteReceiver(cyclops_visualisation_exists)
format_34 = Format(Format="Amount of geometry above the threshold: {0}%", Culture=127, Data0=round_3.Floor)
setlabel_5 = SetLabelContents(LabelToModify=label_43, NewLabelContents=format_34)
hideshow_36 = HideShowElement(ElementToHideShow=[button_27, button_28], Show=cyclops_visualisation_exists_2, Collapse=True, Disable=False)

# ----
# Bake Cyclops
cyclops_select_simulation_12 = RemoteReceiver(cyclops_select_simulation)
cyclops_visualisation_bake_2 = RemoteReceiver(cyclops_visualisation_bake)
concat_8 = Concatenate(FragmentA="Heath::Cyclops::", FragmentB=cyclops_select_simulation_12)
gate_62 = StreamGate(Stream=concat_8, Gate=cyclops_visualisation_bake_2)  # -> Target0, Target1
layers_2 = CreateModifyLayers(LayerName=gate_62.Target1, DeleteLayer=False, enableFullPath=True)  # -> LayerNames, LayerFullPath
createatts_2 = CreateAttributes(LayerName=layers_2.LayerFullPath, enableFullPath=True)
connected_2 = GetConnectedObjects(Objects=displaymesh_2)
bake_3 = BakeObject(Objects=connected_2, ObjectAttributes=createatts_2, Bake=cyclops_visualisation_bake_2)

# ----
# Zoom Cyclops
zoom_cyclops_visualization_2 = RemoteReceiver(zoom_cyclops_visualization)
mesh_2 = Mesh(displaymesh_2)
bbox_3 = BoundingBox(Content=mesh_2, Plane=PlaneXY(0, 0, 0), UnionBox=True)  # -> Box, Box_2
zbb_3 = ZoomBoundingBox(Box=bbox_3.Box, Run=zoom_cyclops_visualization_2)

# ----
# Legend Cyclops
cyclopsdisplaybbox_2 = RemoteReceiver(cyclopsdisplaybbox)
mesh_3 = Mesh(cyclopsdisplaybbox_2)
bbox_4 = BoundingBox(Content=mesh_3, Plane=PlaneXY(0, 0, 0), UnionBox=True)  # -> Box, Box_2
debox = DeconstructBox(Box=bbox_4.Box)  # -> Plane, X, Y, Z
cyclops_metric_option_4 = RemoteReceiver(cyclops_metric_option)
num_9 = Number(debox.Y)
cyclops_select_simulation_index_6 = RemoteReceiver(cyclops_select_simulation_index)
dedomain = DeconstructDomain(Domain=debox.X)  # -> Start, End
division_12 = Division(A=num_9, B=Slider(25, range=0..100))
panel_177 = Panel("""10000
500
60000""")
range = Range(Domain=debox.Y, Steps=10)
addition_3 = Addition(A="1", B=dedomain.End)
min = Minimum(A=division_12, B="2.5")
item_41 = ListItem(List=panel_177, Index=cyclops_metric_option_4, Wrap=True)
multiplication_5 = Multiplication(A="0.2", B="100")
multiplication_6 = Multiplication(A="1", B="100")
sort = SortList(Keys=range)  # -> Keys, ValuesA
addition_4 = Addition(A=min, B=addition_3)
filter_83 = StreamFilter(
    Gate=cyclops_select_simulation_index_6,
    Stream0=Slider(10, range=0..10),
    Stream1=multiplication_6,
    Stream2=Slider(1200, range=0..1500),
    Stream3=multiplication_5,
    Stream4=multiplication_6,
    Stream5=multiplication_6,
    Stream6=item_41)
cyclops_select_simulation_index_7 = RemoteReceiver(cyclops_select_simulation_index)
pt_14 = ConstructPoint(XCoordinate=addition_4, YCoordinate=sort.Keys, ZCoordinate=0)
pt_15 = ConstructPoint(XCoordinate=addition_3, YCoordinate=sort.Keys, ZCoordinate=0)
dom_11 = ConstructDomain(DomainStart=0, DomainEnd=filter_83)
item_42 = ListItem(List=pt_15, Index=0, Wrap=True)  # -> Item1, Item
range_2 = Range(Domain=dom_11, Steps=10)
shift = ShiftList(List=pt_14, Shift=1, Wrap=invert(True))
shift_2 = ShiftList(List=pt_15, Shift=1, Wrap=invert(True))
cull_i_4 = CullIndex(List=pt_14, Indices="-1", Wrap=True)
cull_i_5 = CullIndex(List=pt_15, Indices="-1", Wrap=True)
filter_84 = StreamFilter(
    Gate=cyclops_select_simulation_index_7,
    Stream0="Hours",
    Stream1="%",
    Stream2="kWh/m²",
    Stream3="%",
    Stream4="%",
    Stream5="%",
    Stream6="Lux")
gradient_8 = Gradient(
    LowerLimit=0,
    UpperLimit=filter_83,
    Parameter=range_2,
    stops=[0: RGB(64, 64, 0), 0.494: RGB(255, 255, 0), 1: RGB(255, 255, 255)])
gradient_9 = Gradient(
    LowerLimit=0,
    UpperLimit=filter_83,
    Parameter=range_2,
    stops=[0: RGB(0, 0, 64), 0.495: RGB(173, 203, 249), 1: RGB(255, 255, 255)])
gradient_10 = Gradient(
    LowerLimit=0,
    UpperLimit=filter_83,
    Parameter=range_2,
    stops=[0: RGB(75, 107, 169), 0.25: RGB(173, 203, 249), 0.5: RGB(254, 244, 84), 0.75: RGB(234, 126, 0), 1: RGB(234, 38, 0)])
gradient_11 = Gradient(
    LowerLimit=0,
    UpperLimit=filter_83,
    Parameter=range_2,
    stops=[0: RGB(34, 34, 34), 0.327: RGB(0, 79, 127), 0.658: RGB(46, 156, 240), 1: RGB(255, 255, 255)])
srf4pt = _4PointSurface(CornerA=shift, CornerB=cull_i_4, CornerC=cull_i_5, CornerD=shift_2)
filter_85 = StreamFilter(
    Gate=cyclops_select_simulation_index_6,
    Stream0=gradient_8,
    Stream1=gradient_9,
    Stream2=gradient_10,
    Stream3=gradient_11,
    Stream4=gradient_11,
    Stream5=gradient_11,
    Stream6=gradient_11)
swatch_7 = ColourSwatch(SwatchColor=RGB(0, 0, 0))
preview_21 = CustomPreview(Geometry=srf4pt, Material=filter_85)

division_13 = Division(A=division_12, B=Slider(2, range=0..10))
multiplication_7 = Multiplication(A="1.4", B=division_13)
multiplication_8 = Multiplication(A=division_13, B="1")

Y = UnitY(Factor=multiplication_7)
move_3 = Move(Geometry=item_42.Item1, Motion=Y)  # -> Geometry, Transform
X = UnitX(Factor=multiplication_8)
move_4 = Move(Geometry=pt_14, Motion=X)  # -> Geometry, Transform
tag = TextTag3D(Location=move_3.Geometry, Text=filter_84, Size=division_13, Colour=swatch_7, Justification=7)
tag_2 = TextTag3D(Location=move_4.Geometry, Text=range_2, Size=division_13, Colour=swatch_7, Justification=4)

# ---- group: Analyse performance
# Simple energy simulations
# # Simple energy simulations
# Streamlined energy simulations which calculate energy balance across the year, and peak loads on the design day, for the input Honeybee rooms.
# 
# ## Instructions
# Enter all inputs and set `Run Energy Balance` or `Run Peak Loads`to True to investigate energy use for the specified Honeybee rooms considering the specified Honeybee shade objects. Adjust the y axis of output graphs using the `Graph max` input.
# 
# ## Inputs
# - `EPW file URL` - the URL for a EPW file which describes the location
# - `Honeybee rooms` - the Honeybee rooms which shall be analysed
# - `Shading objects` - Honeybee shade objects which block solar radiation toward the simulated rooms
# - `Run Energy Balance` - set to True to run the energy balance simulation
# - `Run Peak Loads` - set to True to run the peak loads simulation
# - `Graph max` - max value for the y axis of output graphs
# 
# ## Outputs
# - `Annual energy balance` - mesh visualising energy balance of each month of the year broken down into energy sources/sinks
# - `Daily cooling profile` - mesh visualising the cooling need during the design day (hottest day of the year)
# - `Daily heating profile` - mesh visualising the heating need during the design day (coldest day of the year)
# - `Cooling balance (design day)` - mesh visualising the cooling sources and sinks during the design day (hottest day of the year)
# - `Heating balance (design day)` - mesh visualising the heating sources and sinks during the design day (coldest day of the year)
# 
# ## Interpretation
# To be added...
location_weather_url_6 = RemoteReceiver(location_weather_url)
pre_run_simple_energy_simulations_3 = RemoteReceiver(pre_run_simple_energy_simulations)
toggle_4 = BooleanToggle(True)
data_27 = Data(location_weather_url_6)
honeybee_rooms = Data(deconstructmodel.rooms)
shades = Data(deconstructmodel.shades)
objbynn_17 = GetObjectByNickname(NickName="PeakLoads")
objbynn_18 = GetObjectByNickname(NickName="AnnualLoads")
current_model_name_4 = RemoteReceiver(current_model_name)
run_simple_energy_simulations_2 = RemoteReceiver(run_simple_energy_simulations)
simple_energy_simulation_height_2 = RemoteReceiver(simple_energy_simulation_height)
number_slider_34 = Slider(760000, range=0..1000000)
colrange_2 = LBColorRange(index=Slider(0, range=0..26))  # -> colors; plug-in component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
colrange_3 = LBColorRange(index=Slider(26, range=0..26))  # -> colors; plug-in component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
neg_2 = Negative(Value=Slider(100000, range=0..100000))
addition_5 = Addition(A=simple_energy_simulation_height_2, B=Slider(15, range=0..100))
Y_2 = UnitY(Factor=addition_5)
simple_energy_simulation_base_point_2 = RemoteReceiver(simple_energy_simulation_base_point)
simple_energy_simulation_height_3 = RemoteReceiver(simple_energy_simulation_height)
simple_energy_simulation_width_2 = RemoteReceiver(simple_energy_simulation_width)
move_5 = Move(Geometry=pt_4, Motion=Y_2)  # -> Geometry, Transform
simple_energy_simulation_base_point_comp = RemoteSender(move_5.Geometry)  # "simple_energy_simulation_base_point_compare"

# ----
entwine_158 = Entwine(
    Branch00=data_27,
    Branch01=honeybee_rooms,
    Branch02=shades,
    Branch03=pre_run_simple_energy_simulations_3,
    FlattenInputs=True)
panel_178 = Panel(pre_run_simple_energy_simulations_3)

# ----
# Daylight (Illuminance, DA and UDI)
# # Daylight (Illuminance, DA and UDI)
# This cluster simulates illuminance for a specified hour of the year and daylight autonomy (DA) and useful daylight illuminance (UDI) for the entire year across an analysis surface.
# 
# ## Instructions
# Enter all inputs and set `Run Illuminance` or `Run Annual Daylight Simulation`to True to investigate daylight. The illuminance study covers a specified time step whereas the annual daylight simulation covers the full year. The `grid size` and `detail level` inputs can be used to improve the fidelity of the simulation at the cost of simulation time. The study can take several minutes, depending on the grid size and detail level.
# 
# ## Inputs
# - `EPW file URL` - the URL for a EPW file which describes the location
# - `Honeybee model` - the Honeybee model for analysis
# - `Grid size` - the resolution of the analysis grid in metres
# - `Detail level (0-2)` - level of detail for the daylight simulation, the higher value, the higher detail and the slower the simulation
# - `Month (illuminance)` - month of the analysis period  for the illuminance simulation (1-12)
# - `Day (illuminance)` - date of the analysis period for the illuminance simulation (1-31)
# - `Hour (illuminance)` - hour of the analysis period for the illuminance simulation (0-23)
# - `Run Illuminance` - set to True to run the illuminance analysis for the specified timestep
# - `Run Annual Daylight Simulation` - set to True to run the full year daylight simulation
# 
# ## Outputs
# - `Illuminance [Lux]` - a mesh visualising the amount of incident radiation which hits the analysis surface at the specified timestep
# - `Spatial Daylight Autonomy [-]` - the mean SDA for the entire analysis surface
# - `Daylight autonomy [%]` - a mesh visualising the value of DA across the analysis surface
# - `UDI [%]` - a mesh visualising the value of Useful Daylight Illuminance across the analysis surface
# - `UDI <50 [%]` - a mesh visualising the percentage of time that the lower treshold of illuminance is not achieved across the analysis surface
# - `UDI >3000 [%]` - a mesh visualising the percentage of time that the upper treshold of illuminance is exceeded across the analysis surface
# 
# ## Interpretation
# To be added...
toggle_5 = BooleanToggle(True)
data_28 = Data(location_weather_url_3)
honeybee_model_2 = Data(honeybee_model)
panel_179 = Panel(run_daylight_simulations_2)

entwine_159 = Entwine(Branch00=data_28, Branch01=honeybee_model_2, Branch02=run_daylight_simulations_2, FlattenInputs=True)
freeze_gate_56 = StreamFreezeGate(Data=entwine_159, PassingSwitch=run_daylight_simulations_2, Freeze=True)
bang_18 = ExplodeTree(Data=freeze_gate_56)  # -> Branch0, Branch1, Branch2
null_41 = NullItem(Item=bang_18.Branch2)  # -> NullFlags, InvalidFlags, Description
filter_86 = StreamFilter(Gate=null_41.NullFlags, Stream0=bang_18.Branch2, Stream1="False")
bool_57 = Boolean(filter_86)

# ----
# Create analysis grid
number_slider_35 = Slider(1, range=0..10)
grid_size = Number(number_slider_35)
honeybee_model_3 = Data(bang_18.Branch1)
gridrooms = HBSensorGridFromRooms(rooms=honeybee_model_3, grid_size=grid_size, dist_floor=Slider(0.7, range=0..5))  # -> grid, points, mesh; plug-in component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
assigngridsviews = HBAssignGridsAndViews(model=honeybee_model_3, grids=flatten(gridrooms.grid))  # -> model; plug-in component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
grid_mesh = Data(gridrooms.mesh)
honeybee_model_4 = Data(assigngridsviews)

# ---- group: Analyse performance (continued)
freeze_gate_57 = StreamFreezeGate(Data=entwine_158, PassingSwitch=pre_run_simple_energy_simulations_3, Freeze=True)

# ----
bang_19 = ExplodeTree(Data=freeze_gate_57)  # -> Branch0, Branch1, Branch2, Branch3

# ---- group: Analyse performance (continued)
null_42 = NullItem(Item=bang_19.Branch3)  # -> NullFlags, InvalidFlags, Description
downloadepw_5 = LBDownloadWeather(weather_URL=bang_19.Branch0)  # -> epw_file, stat_file, ddy_file; plug-in component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
filter_87 = StreamFilter(Gate=null_42.NullFlags, Stream0=bang_19.Branch3, Stream1="False")
run_energy_balance = Boolean(filter_87)
data_29 = Data(bang_19.Branch1)
data_30 = Data(bang_19.Branch2)
data_31 = Data(downloadepw_5.epw_file)
run_peak_loads = Boolean(filter_87)
honeybee_rooms_2 = Data(bang_19.Branch1)
data_32 = Data(downloadepw_5.ddy_file)
shading_geometry = Data(bang_19.Branch2)
annualloads = HBAnnualLoads(rooms=flatten(data_29), epw_file=data_31, run_bal=run_energy_balance, run=run_energy_balance)  # -> report, total_load, cooling, heating, lighting, equip, process, hot_water, balance; plug-in component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
panel_180 = Panel(annualloads.report)
peakloads = HBPeakLoads(rooms=honeybee_rooms_2, ddy_file=data_32, run_bal=run_peak_loads, run=run_peak_loads)  # -> report, peak_cool, peak_heat, cooling, heating, cool_bal, heat_bal; plug-in component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
panel_181 = Panel(peakloads.report)
gate_63 = StreamGate(Stream=objbynn_17, Gate=run_peak_loads)  # -> Target0, Target1
gate_64 = StreamGate(Stream=objbynn_18, Gate=run_energy_balance)  # -> Target0, Target1
hold_6 = HoldingGate(Data=gate_63.Target1)
annual_energy_balance_data = Data(peakloads.cooling)
annual_energy_balance_data_2 = Data(peakloads.cool_bal)
hold_7 = HoldingGate(Data=gate_64.Target1)
annual_energy_balance_data_3 = Data(peakloads.heating)
annual_energy_balance_data_4 = Data(peakloads.heat_bal)
simple_energy_simulations_report = RemoteSender(peakloads.report)
annual_energy_balance_data_5 = Data(annualloads.balance)
simple_energy_simulations_report_2 = RemoteSender(annualloads.report)
total_load_eui = Data(annualloads.total_load)
msgs = GetRuntimeMessages(Objects=hold_6)  # -> Errors, Warnings
msgs_2 = GetRuntimeMessages(Objects=hold_7)  # -> Errors, Warnings
entwine_160 = Entwine(
    Branch00=total_load_eui,
    Branch01=annual_energy_balance_data_5,
    Branch02=annual_energy_balance_data,
    Branch03=annual_energy_balance_data_3,
    Branch04=annual_energy_balance_data_2,
    Branch05=annual_energy_balance_data_4,
    FlattenInputs=True)
peakloads_message_warning = RemoteSender(msgs.Warnings)
peakloads_message_error = RemoteSender(msgs.Errors)
panel_182 = Panel(msgs_2.Warnings)
annualloads_message_error = RemoteSender(msgs_2.Errors)
annualloads_message_warning = RemoteSender(msgs_2.Warnings)
null_43 = NullItem(Item=flatten(entwine_160))  # -> NullFlags, InvalidFlags, Description
item_43 = ListItem(List=null_43.NullFlags, Index=0, Wrap=True)
gate_65 = StreamGate(Stream=entwine_160, Gate=item_43)  # -> Target0, Target1
entwine_161 = Entwine(Branch0X=gate_65.Target0, Branch1X=current_model_name_4, FlattenInputs=False)
freeze_gate_58 = StreamFreezeGate(Data=entwine_161, PassingSwitch=run_simple_energy_simulations_2, Freeze=True, Hold=False)
split_11 = SplitTree(Data=freeze_gate_58, Masks=flatten("{1;*}"))  # -> Positive, Negative
rec_40 = DataRecorder(split_11.Positive, DataLimit=-10, RecordData=True)
rec_41 = DataRecorder(graft(split_11.Negative), DataLimit=-10, RecordData=True)

# ----
py3_53 = Python3Script(all_simulated_models=rec_40, model_dictionary=model_name_dictionary_2)  # -> out, simulated_models_renamed; inputs all_simulated_models: list, model_dictionary: list
# ---------- py3_53: Python ----------
if model_dictionary and len(model_dictionary):
    mapping = {}
    for (key, value) in model_dictionary:
        mapping[key] = value

    # Resolve transitive mappings
    for key in list(mapping.keys()):
        while mapping.get(mapping[key], None):
            mapping[key] = mapping[mapping[key]]

    simulated_models_renamed = [mapping.get(x, x) for x in all_simulated_models]
else: simulated_models_renamed = all_simulated_models
# ---------- end py3_53 ----------
py3_54 = Python3Script(
    all_simulated_models=py3_53.simulated_models_renamed,
    existing_models=current_all_created_models_names_4,
    all_simulation_data=rec_41)  # -> out, filtered_simulated_models, filtered_simulation_data_pattern; inputs all_simulated_models: list, existing_models: list, all_simulation_data: tree
# ---------- py3_54: Python ----------
from ghpythonlib import treehelpers as th
import Grasshopper as gh

model_indexes = {}
for i, m in enumerate(all_simulated_models):
    if m in existing_models:
        # we make sure here to take the latest index with a unique name
        model_indexes[m] = i

filtered_simulation_data_pattern = gh.DataTree[object](all_simulation_data)
for i, branch in enumerate(filtered_simulation_data_pattern.Branches):
    for j in range(len(branch)):
        branch[j] = j in model_indexes.values()

filtered_simulated_models = list(model_indexes.keys())
#filtered_simulation_data = th.list_to_tree(filtered_simulation_data)
# ---------- end py3_54 ----------
cull_29 = CullPattern(List=rec_41, CullPattern=py3_54.filtered_simulation_data_pattern)
mindex_8 = MemberIndex(Set=py3_54.filtered_simulated_models, Member=current_selected_model_analysis_module_n_6)  # -> flatten(Index), Count
item_44 = ListItem(List=mindex_8.Index, Index="-1", Wrap=True)
null_44 = NullItem(Item=mindex_8.Count)  # -> NullFlags, InvalidFlags, Description
filter_88 = StreamFilter(Gate=null_44.NullFlags, Stream0=mindex_8.Count, Stream1="False")
simple_energy_data_exists = RemoteSender(filter_88)
simple_energy_data_exists_2 = RemoteReceiver(simple_energy_data_exists)
simple_energy_data_exists_3 = RemoteReceiver(simple_energy_data_exists)

simple_energy_simulations_report_3 = RemoteReceiver([simple_energy_simulations_report, simple_energy_simulations_report_2])

# ---- group: Analysis module (continued)
annualloads_message_warning_2 = RemoteReceiver(annualloads_message_warning)
peakloads_message_warning_2 = RemoteReceiver(peakloads_message_warning)
annualloads_message_error_2 = RemoteReceiver(annualloads_message_error)
peakloads_message_error_2 = RemoteReceiver(peakloads_message_error)
simple_energy_data_exists_4 = RemoteReceiver(simple_energy_data_exists)
lng_34 = ListLength(List=[peakloads_message_error_2, annualloads_message_error_2])
lng_35 = ListLength(List=[peakloads_message_warning_2, annualloads_message_warning_2])
simple_energy_data_exists_5 = RemoteReceiver(simple_energy_data_exists)
simple_energy_data_exists_6 = RemoteReceiver(simple_energy_data_exists)
ma_29 = MassAddition(Input=[lng_35, lng_34])  # -> Result, PartialResults
bool_58 = Boolean(ma_29.Result)
hasdata_10 = DataExists(Data=bool_58)
hideshow_37 = HideShowElement(ElementToHideShow=button_21, Show=simple_energy_data_exists_5, Collapse=True, Disable=False)
hideshow_38 = HideShowElement(ElementToHideShow=button_20, Show=simple_energy_data_exists_6, Collapse=True, Disable=False)
filter_89 = StreamFilter(Gate=hasdata_10, Stream0="False", Stream1=bool_58)
simple_energy_data_exists_7 = RemoteReceiver(simple_energy_data_exists)
simple_energy_data_exists_8 = RemoteReceiver(simple_energy_data_exists)
hideshow_39 = HideShowElement(ElementToHideShow=tb_4, Show=filter_89, Collapse=True, Disable=False)
simple_energy_data_exists_9 = RemoteReceiver(simple_energy_data_exists)
hideshow_40 = HideShowElement(ElementToHideShow=tb_8, Show=simple_energy_data_exists_7, Collapse=True, Disable=False)
simple_energy_data_exists_10 = RemoteReceiver(simple_energy_data_exists)
bool_59 = Boolean(invert(simple_energy_data_exists_8))
hideshow_41 = HideShowElement(ElementToHideShow=tb_7, Show=bool_59, Collapse=simple_energy_data_exists_8, Disable=False)
hideshow_42 = HideShowElement(ElementToHideShow=entwine_38, Show=simple_energy_data_exists_9, Collapse=True, Disable=False)

# ----
bool_60 = Boolean(lng_34)

# ---- group: Analysis module (continued)
filter_90 = StreamFilter(Gate=bool_60, Stream0="Warning", Stream1="Error")
filter_91 = StreamFilter(Gate=bool_60, Stream0=ColourSwatch(SwatchColor=RGB(237, 185, 94)), Stream1=ColourSwatch(SwatchColor=RGB(226, 54, 54)))
adjustelem_28 = AdjustElementAppearance(ElementsToAdjust=tb_4, Foreground=filter_91)
settextblock_14 = SetTextBlockContents(TextBlockToModify=tb_4, NewTextBlockContents=filter_90)

# ----
# Revised LCA calculation
# # Life Cycle Assessment (LCA)
# This cluster calculates the embodied carbon for the input Honeybee model
# 
# ## Instructions
# Enter the inputs to calculate the GWP (Global Warming Potential), i.e. the embodied carbon, for the materials in the Honeybee model
# 
# ## Inputs
# - `Honeybee model` - the Honeybee model for analysis
# 
# ## Outputs
# - `Total GWP` - total GWP for the modules A1-A5.1 [kg CO2eq]
# - `GWP by element type` - GWP of each element type for the modules A1-A5.1 [kg CO2eq]
# - `Element types` - list of element types in the model
# 
# ## Interpretation
# To be added...
data_33 = Data(loadobjects.hb_objs)
get_resources = BrimstoneGetResources(json_data=get_categories.json_data, category="Energy and fuel")  # -> out, json_data, resources
# ---------- get_resources: Python ----------
"""Extracts resource names from a Klimatdatabas json object
    Inputs:
        json_data: dictionary with json data
        category: readable name of category to extract resources from
    Output:
        resources: List of resources in category"""

import scriptcontext

import brimstone
ghenv.Component.Message = brimstone.globals.version

ghenv.Component.Name = 'Brimstone - Get Resources'
ghenv.Component.NickName = 'Get Resources'

def main(json_data, category):
    resources = get_resources(json_data, category)
    return resources
    
def get_resources(json_data, category):
    pred = lambda v: v["Text"] == category
    resources = []
    for resource in json_data["Resources"]:
        if len(filter(pred, resource["Categories"])) > 0:
            resources.append(resource["Name"])
    return resources

if __name__ == "__main__":
    if not scriptcontext.sticky["brimstone_flying"]:
        raise Exception("The 'Brimstone - Fly' component needs to exist on the canvas")
    print json_data
    resources = main(json_data, category)
    
    json_data = [json_data]
# ---------- end get_resources ----------
list_4 = ItemSelector(get_resources.resources)
get_lca_data = BrimstoneGetLCAData(json_data=get_resources.json_data, resources="District heating, Swedish average")  # -> out, json_data, lca_data, indicators, values; inputs resources: list, addtl_indicators: list
#   port json_data: List of resources in category
# ---------- get_lca_data: Python ----------
"""Extracts LCA indicators and values from a Klimatdatabas json for a specific resource
    Inputs:
        json_data: dictionary with json data
        resources: list of readable names of resources
        addtl_indicators: list of additional keys to retrieve from resource
    Output:
        lca_data: list of dictionaries with LCA data for each resource
        indicators: list of indicators
        values: list of indicator values"""

import scriptcontext
import ghpythonlib.treehelpers as th
from collections import OrderedDict
import copy

import brimstone
ghenv.Component.Message = brimstone.globals.version

ghenv.Component.Name = 'Brimstone - Get LCA Data'
ghenv.Component.NickName = 'Get LCA Data'

# todo: magic string here - not good!
gwp_data_string = "Global Warming potential"

# keys: names in output dict, values: DataModuleCode in json db
gwp_data_entries = {
    "GWPA1A3Conservative": "A1-A3 Conservative",
    "GWPA1A3Typical": "A1-A3 Typical",
    "GWPA4": "A4",
    "GWPA5.1": "A5.1",
}

def main(json_data, resource, addtl_indicators):
    lca_data, indicators, values = [], [], []

    for i, resource in enumerate(resources):
        lca_data.append(get_lca_data(json_data, resource, addtl_indicators))
        resource_indicators, resource_values = get_indicator_values(lca_data[i], addtl_indicators)
        indicators.append(resource_indicators)
        values.append(resource_values)
    return lca_data, indicators, values
    
def get_lca_data(json_data, resource_name, addtl_indicators):
    resource_data = copy.deepcopy(
        find_obj_in_array(
            json_data["Resources"],
            "Name",
            resource_name
        )
    )
    
    if not resource_data:
        raise Exception(
            "Resource with name {resource_name} was not found in database."
            .format(resource_name = resource_name)
       )
    try:
        lca_data = extract_lca_data(resource_data, addtl_indicators)
    except KeyError:
        raise Exception("Format of JSON data is not supported.")
    return lca_data

def extract_lca_data(resource_data, addtl_indicators):
    lca_data = OrderedDict()
    resource_name = resource_data["Name"]
    
    lca_data["Name"] = resource_name
    
    if "Conversions" in resource_data:
        # can a resource have multiple conversions?
        lca_data["ConversionUnit"] = resource_data["Conversions"][0]["Unit"]
        lca_data["ConversionValue"] = resource_data["Conversions"][0]["Value"]
    
    if "InventoryUnit" in resource_data:
        lca_data["InventoryUnit"] = resource_data["InventoryUnit"]
    
    for data_prop in resource_data["DataItems"]:
        if data_prop["PropertyName"] == gwp_data_string:
            gwp_data = copy.deepcopy(data_prop)
            break
            
    if not gwp_data:
        raise Exception("GWP data not found for {resource_name}"
            .format(resource_name = resource_name))
    
    lca_data["GWPUnit"] = gwp_data["PropertyUnitCode"]
    for key in gwp_data_entries:
        value = find_obj_in_array(
            gwp_data["DataValueItems"],
            "DataModuleCode",
            gwp_data_entries[key]
        )
        if value is not None:
            lca_data[key] = value["Value"]
            
    for addtl_indicator in addtl_indicators:
        if addtl_indicator in resource_data:
            lca_data[addtl_indicator] = resource_data[addtl_indicator]
    
    return lca_data

def find_obj_in_array(array, key, value):
    return next((x for x in array if x[key] == value), None)

def get_indicator_values(lca_data, addtl_indicators):
    indicator_dict = OrderedDict([
        ("Name", "Name"),
        ("InventoryUnit", "Inventory unit"),
        ("ConversionUnit", "Conversion unit"),
        ("ConversionValue", "Conversion value"),
        ("GWPUnit", "GWP unit"),
        ("GWPA1A3Conservative", "GWP (A1-A3 Conservative)"),
        ("GWPA1A3Typical", "GWP (A1-A3 Typical)"),
        ("GWPA4", "GWP (A4)"),
        ("GWPA5.1", "GWP (A5.1)"),
    ])
    
    for addtl_indicator in addtl_indicators:
        indicator_dict[addtl_indicator] = addtl_indicator
    
    indicators, values = [], []
    
    for key, indicator_name in indicator_dict.items():
        indicator_value = lca_data[key] if key in lca_data else None
        if indicator_value:
            indicators.append(indicator_name)
            values.append(indicator_value)
    
    return indicators, values

if __name__ == "__main__":
    if not scriptcontext.sticky["brimstone_flying"]:
        raise Exception("The 'Brimstone - Fly' component needs to exist on the canvas")
    lca_data, indicators, values = main(json_data, resources, addtl_indicators)
    
    lca_data_treeable = []
    
    for resource_lca_data in lca_data:
        lca_data_treeable.append([resource_lca_data.keys(), resource_lca_data.values()])
    lca_data = th.list_to_tree(lca_data_treeable)
    indicators = th.list_to_tree(indicators)
    values = th.list_to_tree(values)
    json_data = [json_data]
# ---------- end get_lca_data ----------
area_m2 = Data(geoprop.floor_area)
panel_183 = Panel("kg CO2eq")
lca_total_gfa = RemoteSender(area_m2)
honeybee_model_exists_10 = RemoteReceiver(honeybee_model_exists)

calculate_honeybee_model = BrimstoneCalculateEmbodiedCarbonOfHoneybeeModel(hb_model=data_33, kdb_json_data=get_categories.json_data)  # -> tot_emb_carbon, elements, el_emb_carbon, elements_modules, el_emb_carbon_modules
# ---------- calculate_honeybee_model: Python ----------
"""
Calculates embodied carbon for the elements of a Honeybee model if data is available
This component was inspired by the 'HB Color Face Attributes' component of Ladybug Tools 1.6.0

    Args:
        hb_model: Honeybee model for analysis
        kdb_json_data: Optional json data object for materials which do not include impact data

    Returns:
        tot_emb_carbon: total embodied carbon of model
        elements: element types in the model
        el_emb_carbon: embodied carbon for each element type in the model
"""

import scriptcontext
import brimstone
ghenv.Component.Message = brimstone.globals.version
import Grasshopper
import os
import csv, codecs

ghenv.Component.Name = 'Brimstone - Calculate Embodied Carbon of Honeybee Model'
ghenv.Component.NickName = 'Calculate Honeybee Model'

try:  # import the core honeybee dependencies
    from honeybee_energy.construction.windowshade import WindowConstructionShade
    from honeybee_energy.construction.air import AirBoundaryConstruction
    from honeybee_energy.material.opaque import EnergyMaterialNoMass
    from honeybee.model import Model
    from honeybee.properties import FaceProperties
    from honeybee.typing import clean_ep_string
except ImportError as e:
    raise ImportError('\nFailed to import honeybee:\n\t{}'.format(e))
    

# todo: magic string here - not good!
gwp_data_string = "Global Warming potential"
gwp_data_points = {
    "gwp_a1_a3": "A1-A3 Conservative",
    "gwp_a4": "A4",
    "gwp_a5_1": "A5.1",
}

# Hack to fix default materials for ACE405 course
# From klimatdatabas 02.05.000
default_layers = {
    "Expanded polystyrene": {
        "gwp_a1_a3": 4,
        "gwp_a4": 0.0345,
        "gwp_a5_1": 0.282,
    },
    "Mineral wool": {
        "gwp_a1_a3": 1.6,
        "gwp_a4": 0.0345,
        "gwp_a5_1": 0.114,
    },
    "Timber": {
        "gwp_a1_a3": 0.08,
        "gwp_a4": 0.0158,
        "gwp_a5_1": 0.00958,
    },
    "Solid brick": {
        "gwp_a1_a3": 0.314,
        "gwp_a4": 0.0495,
        "gwp_a5_1": 0.0182,
    },
    "Gypsum plasterboard": {
        "gwp_a1_a3": 0.284,
        "gwp_a4": 0.0232,
        "gwp_a5_1": 0.0368,
    },
    "Medium density concrete": {
        "gwp_a1_a3": 0.0913,
        "gwp_a4": 0.0039,
        "gwp_a5_1": 0.00285,
    },
    "Ceramic and porcelain": {
        "gwp_a1_a3": 2.5,
        "gwp_a4": 0,
        "gwp_a5_1": 0,
    },
    "Steel": {
        "gwp_a1_a3": 3.15,
        "gwp_a4": 0.0795,
        "gwp_a5_1": 0.161,
    },
    "Crystalline stone": {
        "gwp_a1_a3": 0.5,
        "gwp_a4": 0.0,
        "gwp_a5_1": 0.0,
    },
    "Soil/sand/gravel": {
        "gwp_a1_a3": 0.02,
        "gwp_a4": 0,
        "gwp_a5_1": 0,
    },
}

# hack to fix ACE405 issues
# used if single layer aperture has no matching material
# source: klimatdatabas 02.005.000 aluminum window
# https://klimatdatabasen.boverket.se/detaljer/3/6000000225
default_aperture_density = 39.2# [kg/m2]
default_aperture_impact = { # value is kg CO2eq/m2
    "gwp_a1_a3": 3.83 * default_aperture_density,
    "gwp_a4": 0.0626 * default_aperture_density,
    "gwp_a5_1": 0.0 * default_aperture_density,
}

def main(hb_model):
    tot_emb_carbon = 0
    elements = []
    el_emb_carbon = []
    elements_modules = []
    el_emb_carbon_modules = []
    if not isinstance(hb_model, Model):
        raise Exception("hb_model input must be a valid honeybee model")
    faces = []
    apertures = []
    model_mats = []
    face_types = {}
    
    energy_properties = hb_model.properties.energy
    
    for material in energy_properties.materials:
        model_mats.append(material)
    for room in hb_model.rooms:
        faces.extend(room.faces)
        faces.extend(room.shades)
    faces.extend(hb_model.orphaned_faces)
    faces.extend(hb_model.orphaned_apertures)
    faces.extend(hb_model.orphaned_doors)
    faces.extend(hb_model.orphaned_shades)
    
    for face_obj in faces:
        
        if isinstance(face_obj.properties, FaceProperties):
            if isinstance(face_obj.properties.energy.construction, AirBoundaryConstruction):
                continue # skip if airboundary
                
            face_area = face_obj.area - face_obj.aperture_area
            face_type = face_obj.type
            
            face_impact = {}
            for lyr in face_obj.properties.energy.construction.layers:
                print face_type, lyr, face_area
                face_impact_per_module = get_face_impact(model_mats, lyr, face_area)
                for key in face_impact_per_module:
                    if key in face_impact:
                        face_impact[key] += face_impact_per_module[key]
                    else:
                         face_impact[key] = face_impact_per_module[key]
                """
                if lyr not in model_mats:
                    model_mats[lyr] = { area: face_area }
                else:
                    model_mats[lyr].area = model_mats[lyr].area + face_area
                """
                       
            if face_type not in face_types:
                face_types[face_type] = { "impact": face_impact }
            else:
                for key in face_impact:
                    if key in face_types[face_type]["impact"]:
                        face_types[face_type]["impact"][key] += face_impact[key]
                    else:
                        face_types[face_type]["impact"][key] = face_impact[key]
                
            for aperture in face_obj.apertures:
                aperture_impact = get_aperture_impact(aperture)
                if "Aperture" not in face_types:
                    face_types["Aperture"] = { "impact": aperture_impact }
                else:
                    for key in aperture_impact:
                        if key in face_types["Aperture"]["impact"]:
                            face_types["Aperture"]["impact"][key] += aperture_impact[key]
                        else:
                            face_types["Aperture"]["impact"][key] = aperture_impact[key]
                        
    for face_type in face_types.items():
        face_impact = sum(face_type[1]["impact"].values())
        tot_emb_carbon += face_impact
        elements.append(face_type[0])
        el_emb_carbon.append(face_impact)
        
        for key, value in face_type[1]["impact"].items():
            elements_modules.append(str(face_type[0]) + " " + key)
            el_emb_carbon_modules.append(value)
    return tot_emb_carbon, elements, el_emb_carbon, elements_modules, el_emb_carbon_modules

def get_face_impact(materials, layer_name, face_area):
    for material in materials:
        if material.identifier == layer_name:
            if type(material) == EnergyMaterialNoMass:
                brimstone.utils.warn(ghenv, "The calculation may be faulty as material " + layer_name + " is modelled as EnergyMaterialNoMass.")
                return {}
            abs_impact = {}
            gwp_data_keys = gwp_data_points.keys()
            
            if material.user_data and all(key in material.user_data.keys() for key in gwp_data_keys):
                for key, value in gwp_data_points.items():
                    abs_impact[value] = material.density*material.user_data[key]
            elif material.user_data and layer_name in default_layers:
                for key in gwp_data_keys:
                    material.user_data[key] = default_layers[layer_name][key]
            else:
                abs_impact = get_face_impact_from_material_name(material.identifier, material.density)
            impact = { key: material.thickness*abs_impact[key]*face_area for key in abs_impact }
            return impact
    brimstone.utils.warn(ghenv, "The calculation may be faulty as material " + layer_name + " was not found among the energy materials in the model.")
    return {}

# Gets material impact data from a honeybee material by referencing names in .csv file
def get_face_impact_from_material_name(material_name, density):
    csv_data_file = brimstone.globals.hb_kdb_csv_path
    csv_data_file_path = os.path.join(Grasshopper.Folders.UserObjectFolders[0], csv_data_file)
    if not os.path.exists(csv_data_file_path):
        raise Exception("Failed to open csv file, it should reside in [UserComponents folder]/brimstone_data/")
    kdb_name = check_name_in_kdb(material_name)
    if not kdb_name:
        with open(csv_data_file_path, 'r') as csv_file:
            file_reader = csv.DictReader(csv_file, delimiter=",")
            for row in file_reader:
                if row["HB Name"] == material_name:
                    kdb_name = clean_ep_string(row["Klimatdatabas name"])
                    if not kdb_name or kdb_name == "missing":
                        brimstone.utils.warn(ghenv, "The calculation may be faulty as impact data is missing for some of the materials in the model: " + material_name)
                        return {}
                    break
    if not kdb_name:
        brimstone.utils.warn(ghenv, "The calculation may be faulty as material " + material_name + " could not be matched to any material in the brimstone material database.")
        return {}
    
    return get_impact_from_json_data(kdb_name, density)

def check_name_in_kdb(material_name):
    if not kdb_json_data:
        brimstone.utils.warn(ghenv, "The calculation may be faulty as kdb_json_data is missing")
    else: 
        for resource in kdb_json_data["Resources"]:
            if clean_ep_string(resource["Name"]) == material_name:
                return material_name
    return ""
    
# TODO: currently only works for KDB windows
def get_aperture_impact(aperture):
    c = aperture.properties.energy.construction
    c = c.window_construction if type(c) == WindowConstructionShade else c
    if c.user_data and "conv_value" in c.user_data:
        impact = {}
        for key, value in gwp_data_points.items():
            if key in c.user_data:
                impact[value] = float(c.user_data[key]) * c.user_data["conv_value"] * aperture.area
        return impact
    if not len(c.layers) == 1:
        brimstone.utils.warn(ghenv, "The calculation may be faulty as only one layer window constructions can be calculated.")
        return {}
    
    window_material = c.layers[0]
    abs_impact = get_impact_from_json_data(window_material)
    
    # hack to fix ACE405 calculations
    if not len(abs_impact.keys()):
        abs_impact = default_aperture_impact
    
    impact = { key: abs_impact[key]*aperture.area for key in abs_impact }
    return impact

# density parameter is used as fallback if KDB data does not have density
def get_impact_from_json_data(kdb_name, density = 0):
    if not kdb_json_data:
        brimstone.utils.warn(ghenv, "The calculation may be faulty as kdb_json_data is missing")
        return {}
    for resource in kdb_json_data["Resources"]:
        if clean_ep_string(resource["Name"]) == kdb_name:
            if "Conversions" not in resource:
                brimstone.utils.warn(ghenv, "The calculation may be faulty as material " + kdb_name + " has no conversion value in kdb_json_data. Using HB material density")
                conv = density
            else:
                conv = resource["Conversions"][0]["Value"]
            
            for data_item in resource["DataItems"]:
                if data_item["PropertyName"] == gwp_data_string:
                    abs_impact = {}
                    for data_pt in gwp_data_points.values():
                        for data_val_item in data_item["DataValueItems"]:
                            if data_val_item["DataModuleCode"] == data_pt:
                                abs_impact[data_pt] = data_val_item["Value"]*conv
                    return abs_impact
            brimstone.utils.warn(ghenv, "The calculation may be faulty as material " + kdb_name + " has no GWP data in kdb_json_data")
            return {}
    brimstone.utils.warn(ghenv, "The calculation may be faulty as material " + kdb_name + " was not found in kdb_json_data")
    return {}

if __name__ == "__main__":
    try:
        flying = scriptcontext.sticky["brimstone_flying"]
    except:
        raise Exception("The 'Brimstone - Fly' component needs to exist on the canvas")
    tot_emb_carbon, elements, el_emb_carbon, elements_modules, el_emb_carbon_modules = main(hb_model)
# ---------- end calculate_honeybee_model ----------

lca_total_gfa_2 = RemoteReceiver(lca_total_gfa)

# ---- group: Analysis module (continued)
lca_total_gfa_3 = RemoteReceiver(lca_total_gfa)
lca_total_gfa_4 = RemoteReceiver(lca_total_gfa)

# ---- group: Analyse performance
# Chart title
current_selected_model_analysis_module_n_8 = RemoteReceiver(current_selected_model_analysis_module_n)  # "current_selected_model_analysis_module_name"

# ----
epw_file_url = Data(bang_18.Branch0)
downloadepw_6 = LBDownloadWeather(weather_URL=epw_file_url)  # -> epw_file, stat_file, ddy_file; plug-in component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
run_annual_daylight_simulation = Boolean(bool_57)
honeybee_model_5 = Data(honeybee_model_4)

# ---- group: Daylight Factor
# Daylight Factor [%]
number_slider_36 = Slider(0, range=0..2)
number_slider_37 = Slider(0, range=0..2)  # disabled
falsestart = LBFalseStartToggle(False)  # disabled
detail_level_0_2 = Number(number_slider_36)
radpar = HBRadianceParameter(recipe_type=number_slider_37, detail_level=detail_level_0_2)  # -> rad_par; disabled; plug-in component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
run_daylight_factor = Data(falsestart)  # disabled
daylightfactor = HBDaylightFactor(model=honeybee_model_5, radiance_par=radpar, run=run_daylight_factor)  # -> report, results; disabled; plug-in component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
panel_186 = Panel("Daylight Factor [%]")  # disabled
cluster_8 = Cluster_5()  # disabled
median = GhPythonScript(list=daylightfactor.results)  # -> out, median; inputs list: list; disabled
# ---------- median: Python ----------
"""Provides a scripting component.
    Inputs:
        list: list of numeric values to retrieve median
    Output:
        median: median value in list

__author__ = "sawen"
__version__ = "2024.06.14"
"""

import statistics

def main(list):
    return statistics.median(list)

if __name__ == "__main__":
    if list:
        median = main(list)
# ---------- end median ----------
heatmap = LBSpatialHeatmap(values=flatten(daylightfactor.results), legend_par=cluster_8, legend_title=panel_186)  # -> mesh, legend, title, colors, legend_par, vis_set; disabled; plug-in component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
daylight_factor_2 = Data(flatten([heatmap.mesh, heatmap.legend, heatmap.title]))  # disabled

# ---- group: Simulate illuminance
importloc_4 = LBImportLocation(epw_file=downloadepw_6.epw_file)  # -> location; plug-in component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
detail_level_0_2_2 = Number(Slider(0, range=0..2))
day_illuminance = Number(Slider(21, range=1..31))
hour_illuminance = Number(Slider(12, range=0..23))
month_illuminance = Number(Slider(6, range=1..12))
radpar_2 = HBRadianceParameter(recipe_type=Slider(0, range=0..2), detail_level=detail_level_0_2_2)  # -> rad_par; plug-in component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
run_illuminance = Boolean(bool_57)
ciesky = HBCIEStandardSky(location=importloc_4, month=month_illuminance, day=day_illuminance, hour=hour_illuminance, type=0)  # -> sky; plug-in component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
mjoin_5 = MeshJoin(Meshes=grid_mesh)
pitgrid = HBPointInTimeGridBased(model=honeybee_model_4, sky=ciesky, radiance_par=radpar_2, run=run_illuminance)  # -> report, flatten(results); plug-in component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
sort_2 = SortList(Keys=pitgrid.results)  # -> reverse(Keys), ValuesA
objbynn_19 = GetObjectByNickname(NickName="PITGrid")
item_45 = ListItem(List=sort_2.Keys, Index=0, Wrap=True)
gate_66 = StreamGate(Stream=objbynn_19, Gate=run_illuminance)  # -> Target0, Target1
daylight_report = RemoteSender(pitgrid.report)
max = Maximum(A=Slider(2000, range=0..10000), B=item_45)
hold_8 = HoldingGate(Data=gate_66.Target1)
legendpar_4 = LBLegendParameters(max=max)  # -> leg_par; plug-in component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
msgs_3 = GetRuntimeMessages(Objects=hold_8)  # -> Errors, Warnings
pitgrid_message_error = RemoteSender(msgs_3.Errors)
pitgrid_message_warning = RemoteSender(msgs_3.Warnings)
heatmap_2 = LBSpatialHeatmap(values=pitgrid.results, mesh=mjoin_5, legend_par=legendpar_4, legend_title="Lux", global_title="Illuminance")  # -> mesh, legend, title, colors, legend_par, vis_set; plug-in component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
txt_6 = Text(heatmap_2.title)
entwine_162 = Entwine(Branch00=heatmap_2.mesh, Branch01=heatmap_2.legend, Branch02=txt_6, FlattenInputs=True)  # -> flatten(Result)
illuminance_lux = Data(entwine_162)

# ----
gate_67 = StreamGate(Stream=objbynn_2, Gate=run_annual_daylight_simulation)  # -> Target0, Target1
hold_9 = HoldingGate(Data=gate_67.Target1)
msgs_4 = GetRuntimeMessages(Objects=hold_9)  # -> Errors, Warnings
annualdaylight_message_warning = RemoteSender(msgs_4.Warnings)
annualdaylight_message_error = RemoteSender(msgs_4.Errors)

daylight_report_2 = RemoteReceiver(daylight_report)

# ---- group: Analysis module (continued)
annualdaylight_message_warning_2 = RemoteReceiver(annualdaylight_message_warning)
annualdaylight_message_error_2 = RemoteReceiver(annualdaylight_message_error)
pitgrid_message_warning_2 = RemoteReceiver(pitgrid_message_warning)
pitgrid_message_error_2 = RemoteReceiver(pitgrid_message_error)
lng_36 = ListLength(List=[annualdaylight_message_error_2, pitgrid_message_error_2])
lng_37 = ListLength(List=[annualdaylight_message_warning_2, pitgrid_message_warning_2])
ma_30 = MassAddition(Input=[lng_36, lng_37])  # -> Result, PartialResults
bool_61 = Boolean(ma_30.Result)
hasdata_11 = DataExists(Data=bool_61)
filter_92 = StreamFilter(Gate=hasdata_11, Stream0="False", Stream1=bool_61)
filter_93 = StreamFilter(Gate=lng_36, Stream0="Warning", Stream1="Error")
filter_94 = StreamFilter(Gate=lng_36, Stream0=ColourSwatch(SwatchColor=RGB(237, 185, 94)), Stream1=ColourSwatch(SwatchColor=RGB(226, 54, 54)))
adjustelem_29 = AdjustElementAppearance(ElementsToAdjust=tb_9, Foreground=filter_94)
settextblock_15 = SetTextBlockContents(TextBlockToModify=tb_9, NewTextBlockContents=filter_93)
hideshow_43 = HideShowElement(ElementToHideShow=tb_9, Show=filter_92, Collapse=True, Disable=False)

# ----
element_types = Data(calculate_honeybee_model.elements)
total_gwp = Data(calculate_honeybee_model.tot_emb_carbon)
gwp_by_element_type = Data(calculate_honeybee_model.el_emb_carbon)
connected_3 = GetConnectedObjects(Objects=calculate_honeybee_model.tot_emb_carbon)
panel_187 = Panel(gwp_by_element_type)
gate_68 = StreamGate(Stream=connected_3, Gate=Toggle(False))  # -> Target0, Target1
ma_31 = MassAddition(Input=gwp_by_element_type)  # -> Result, PartialResults
panel_188 = Panel(total_gwp)
panel_189 = Panel(element_types)
lca_element_types = RemoteSender(element_types)
lca_total_gwp = RemoteSender(ma_31.Result)
lca_gwp_by_element_type = RemoteSender(gwp_by_element_type)
msgs_5 = GetRuntimeMessages(Objects=gate_68.Target1)  # -> Errors, Warnings
lca_gwp_by_element_type_2 = RemoteReceiver(lca_gwp_by_element_type)
lca_warnings = RemoteSender(msgs_5.Warnings)
lca_errors = RemoteSender(msgs_5.Errors)
lca_element_types_2 = RemoteReceiver(lca_element_types)
lca_total_gwp_2 = RemoteReceiver(lca_total_gwp)
lca_errors_2 = RemoteReceiver(lca_errors)
lng_38 = ListLength(List=lca_errors_2)

lca_warnings_2 = RemoteReceiver(lca_warnings)
lca_errors_3 = RemoteReceiver(lca_errors)

lca_gwp_by_element_type_3 = RemoteReceiver(lca_gwp_by_element_type)
lca_element_types_3 = RemoteReceiver(lca_element_types)
entwine_163 = Entwine(
    Branch00="Model name",
    Branch01=lca_element_types_3,
    Branch02="Operational emissions",
    Branch03="GFA",
    FlattenInputs=True)  # -> flatten(Result)
panel_190 = Panel(entwine_163)

# ---- group: Analysis module (continued)
lca_total_gwp_3 = RemoteReceiver(lca_total_gwp)
lca_total_gwp_4 = RemoteReceiver(lca_total_gwp)
division_14 = Division(A=lca_total_gwp_3, B=lca_total_gfa_3)
lca_warnings_3 = RemoteReceiver(lca_warnings)
lca_errors_4 = RemoteReceiver(lca_errors)
expression_81 = Expression(x=division_14, Expression="Round(x, 1)")
expression_82 = Expression(x=lca_total_gwp_4, Expression="Round(x, 1)")
lng_39 = ListLength(List=lca_errors_4)
lng_40 = ListLength(List=lca_warnings_3)
format_35 = Format(Format=panel_63, Culture=127, Data0=expression_81)
format_36 = Format(Format=panel_64, Culture=127, Data0=expression_82)
ma_32 = MassAddition(Input=[lng_39, lng_40])  # -> Result, PartialResults
setlabel_6 = SetLabelContents(LabelToModify=label_28, NewLabelContents=format_35)
setlabel_7 = SetLabelContents(LabelToModify=label_30, NewLabelContents=format_36)
bool_62 = Boolean(ma_32.Result)
hasdata_12 = DataExists(Data=bool_62)
filter_95 = StreamFilter(Gate=hasdata_12, Stream0="False", Stream1=bool_62)
filter_96 = StreamFilter(Gate=lng_39, Stream0="Warning", Stream1="Error")
filter_97 = StreamFilter(Gate=lng_39, Stream0=ColourSwatch(SwatchColor=RGB(237, 185, 94)), Stream1=ColourSwatch(SwatchColor=RGB(226, 54, 54)))
adjustelem_30 = AdjustElementAppearance(ElementsToAdjust=tb_10, Foreground=filter_97)
settextblock_16 = SetTextBlockContents(TextBlockToModify=tb_10, NewTextBlockContents=filter_96)
hideshow_44 = HideShowElement(ElementToHideShow=tb_10, Show=filter_95, Collapse=True, Disable=False)

# ----
# Chart title
current_selected_simulation_simple_energ_2 = RemoteReceiver(current_selected_simulation_simple_energ)  # "current_selected_simulation_simple_energy_compare"

# ----
# Simple energy simulations - Compare
current_selected_simulation_simple_energ_3 = RemoteReceiver(current_selected_simulation_simple_energ)  # "current_selected_simulation_simple_energy_compare"
number_slider_38 = Slider(760000, range=0..1000000)
colrange_4 = LBColorRange(index=Slider(26, range=0..26))  # -> colors; plug-in component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
colrange_5 = LBColorRange(index=Slider(0, range=0..26))  # -> colors; plug-in component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
neg_3 = Negative(Value=Slider(100000, range=0..100000))

equals_43 = Equality(FirstNumber=current_selected_simulation_simple_energ_3, SecondNumber="-1")  # -> Equality, Inequality

# ----
# Calculate operational emissions
list_5 = ValueList({"Conservative": "conservative", "Typical": "typical"}, selected="Conservative")
panel_191 = Panel("kg CO2eq/year")

gate_69 = StreamGate(Stream=current_selected_simulation_simple_energ_3, Gate=equals_43.Inequality)  # -> Target0, Target1

# ---- group: Spatial climate based daylight
number_slider_39 = Slider(0, range=0..2)
panel_192 = Panel("-t 50 -lt 200 -ut 2000")
wea = HBWeaFromEPW(epw_file=downloadepw_6.epw_file)  # -> wea; plug-in component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
analysis_mesh = Mesh(grid_mesh)
mjoin_6 = MeshJoin(Meshes=analysis_mesh)
cluster_9 = Cluster_5()
cluster_10 = Cluster_5()
cluster_11 = Cluster_5()
cluster_12 = Cluster_5()

# ----
detail_level_0_2_3 = Number(number_slider_39)

# ---- group: Spatial climate based daylight (continued)
radpar_3 = HBRadianceParameter(recipe_type=Slider(2, range=0..2), detail_level=detail_level_0_2_3, additional_par="-ab 4")  # -> rad_par; plug-in component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
panel_193 = Panel(radpar_3)
annualdaylight = HBAnnualDaylight(
    model=honeybee_model_5,
    wea=wea,
    schedule="Generic Office Occupancy",
    radiance_par=radpar_3,
    run=run_annual_daylight_simulation)  # -> report, results, DA, cDA, UDI, UDI_low, UDI_up; plug-in component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
heatmap_3 = LBSpatialHeatmap(
    values=flatten(annualdaylight.UDI_up),
    mesh=mjoin_6,
    legend_par=cluster_10,
    legend_title="%",
    global_title="UDI > 3000 lux")  # -> mesh, legend, title, colors, legend_par, vis_set; plug-in component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
heatmap_4 = LBSpatialHeatmap(
    values=flatten(annualdaylight.UDI_low),
    mesh=mjoin_6,
    legend_par=cluster_9,
    legend_title="%",
    global_title="UDI < 50 lux")  # -> mesh, legend, title, colors, legend_par, vis_set; plug-in component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
heatmap_5 = LBSpatialHeatmap(
    values=flatten(annualdaylight.UDI),
    mesh=mjoin_6,
    legend_par=cluster_11,
    legend_title="%",
    global_title="Useful daylight illuminance")  # -> mesh, legend, title, colors, legend_par, vis_set; plug-in component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
sda = HBSpatialDaylightAutonomy(DA=flatten(annualdaylight.DA), mesh=mjoin_6)  # -> report, sDA, pass_fail; plug-in component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
heatmap_6 = LBSpatialHeatmap(
    values=flatten(annualdaylight.DA),
    mesh=mjoin_6,
    legend_par=cluster_12,
    legend_title="%",
    global_title="Daylight autonomy")  # -> mesh, legend, title, colors, legend_par, vis_set; plug-in component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
entwine_164 = Entwine(Branch00=heatmap_3.mesh, Branch01=heatmap_3.legend, Branch02=heatmap_3.title, FlattenInputs=True)  # -> flatten(Result)
entwine_165 = Entwine(Branch00=heatmap_4.mesh, Branch01=heatmap_4.legend, Branch02=heatmap_4.title, FlattenInputs=True)  # -> flatten(Result)
entwine_166 = Entwine(Branch00=heatmap_5.mesh, Branch01=heatmap_5.legend, Branch02=heatmap_5.title, FlattenInputs=True)  # -> flatten(Result)
entwine_167 = Entwine(Branch00=heatmap_6.mesh, Branch01=heatmap_6.legend, Branch02=heatmap_6.title, FlattenInputs=True)  # -> flatten(Result)
panel_194 = Panel(sda.sDA)
udi_3000 = Data(flatten(entwine_164))
udi_50 = Data(flatten(entwine_165))
udi_2 = Data(flatten(entwine_166))
daylight_autonomy_2 = Data(flatten(entwine_167))
spatial_daylight_autonomy = Data(sda.sDA)

# ---- group: Analyse performance (continued)
current_all_simulation_models_simple_ene = RemoteSender(py3_54.filtered_simulated_models)  # "current_all_simulation_models_simple_energy"
current_all_simulations_simple_energy = RemoteSender(cull_29)
split_12 = SplitTree(Data=cull_29, Masks=flatten("{0;0;0;*}"))  # -> Positive, Negative
flip = FlipMatrix(Data=split_12.Positive)
item_46 = ListItem(List=simplify(current_all_simulations_simple_energy), Index=item_44, Wrap=True)
total_load_eui_all_simulations = RemoteSender(flip)
pshift = ShiftPaths(Data=item_46, Offset=-1)
bang_20 = ExplodeTree(Data=pshift)  # -> Branch0, Branch1, Branch2, Branch3, Branch4, Branch5

# ----
total_load_eui_all_simulations_2 = RemoteReceiver(total_load_eui_all_simulations)
num_10 = Number(total_load_eui_all_simulations_2)
current_all_simulation_models_simple_ene_2 = RemoteReceiver(current_all_simulation_models_simple_ene)  # "current_all_simulation_models_simple_energy"
expression_83 = Expression(x=num_10, Expression="Round(x, 1)")
cset_8 = CreateSet(List=current_all_simulation_models_simple_ene_2)  # -> Set, Map
cull_30 = CullPattern(List=expression_83, CullPattern=graft(values_24.Values))  # -> flatten(List)
cull_31 = CullPattern(List=cset_8.Set, CullPattern=values_24.Values)
setchecklist = SetChecklistContents(ChecklistToModify=checklist, NewChecklistContents=cset_8.Set, Selected="True")
entwine_168 = Entwine(
    Branch00=nextfile,
    Branch01="EUI (kWh/m2)",
    Branch02="EUI per model (kWh/m2)",
    Branch03=cull_31,
    Branch04=rev,
    Branch05=cull_30,
    Branch06=fragment,
    FlattenInputs=True)
freeze_gate_59 = StreamFreezeGate(Data=entwine_168, PassingSwitch=and)
bang_21 = ExplodeTree(Data=freeze_gate_59)  # -> Branch0, Branch1, Branch2, Branch3, Branch4, Branch5, Branch6
lng_41 = ListLength(List=flatten(bang_21.Branch4))
partition = PartitionList(List=flatten(bang_21.Branch5), Size=lng_41)
py3_55 = Python3Script(
    file_location=bang_21.Branch0,
    y_label=bang_21.Branch1,
    title=bang_21.Branch2,
    labels=bang_21.Branch3,
    elements=bang_21.Branch4,
    values=partition,
    colors=bang_21.Branch6,
    img_width=bar_chart_img_width_3,
    img_height=bar_chart_img_height_3)  # -> file_location_out; inputs labels: list, elements: list, values: tree of Double, colors: list
# ---------- py3_55: Python ----------
# requirements: matplotlib
# requirements: numpy

import matplotlib.pyplot as plt
import numpy as np
import os
import ghpythonlib.treehelpers as th

if not os.path.exists(file_location):
    seperatedLabels = []
    for label in labels:
        if '(' in label:
            seperatedLabels.append(('\n(').join(label.split('(')))
        else:
            seperatedLabels.append(label)
    
    colors = colors[:len(elements)]
    for i in range(len(colors)):
        colors[i] = colors[i].split(',')
        colors[i] = tuple([float(j) for j in colors[i]])
    
    values_list = th.tree_to_list(values)

    px = 1/plt.rcParams['figure.dpi']  # pixel in inches
    fig, ax = plt.subplots(figsize=(img_width*px, img_height*px))

    # Add the stacked bars
    bottom = np.zeros(len(values_list))
    bar_width = 0.25
    for i in range(len(values_list)):
        for j in range(len(values_list[i])):
            ax.bar(seperatedLabels[i], values_list[i][j], color=colors[j], 
             bottom=bottom[i], align='center', width=bar_width, zorder=2)
            
            if values_list[i][j] > 0:
                ax.text(i, bottom[i] + values_list[i][j] / 2, f"{int(values_list[i][j])}",
                ha='center', va='center', fontsize=10, color='black', zorder=3)
            
            bottom[i] += values_list[i][j]
    
    y_range = max(bottom)*1.1
    interval = 10 ** (np.floor(np.log10(y_range)) - 1)  # Base interval as a power of 10
    while y_range / interval > 10:  # Adjust interval if too many ticks
        interval *= 2
    while y_range / interval < 5:  # Adjust interval if too few ticks
        interval /= 2

    # Ensure interval is a clean power of 10 or multiple thereof
    interval = round(interval, -int(np.floor(np.log10(interval))))

    # Set y-axis limits
    ax.set_ylim(0, y_range)

    # Generate tick positions
    yticks = list(range(0, int(y_range) + 1, int(interval)))

    # Add horizontal lines
    for y in yticks:
        ax.axhline(y=y, color='gray', linestyle='--', linewidth=0.4, zorder=1)

    # Set yticks to match the lines
    ax.set_yticks(yticks)
    ax.set_title(title)
    ax.set_ylabel(y_label)
    ax.set_xticks(range(len(seperatedLabels)))
    ax.set_xticklabels(seperatedLabels, rotation=35, ha='right', rotation_mode='anchor')
    
    plt.subplots_adjust(right=0.65)

    # Create the legend
    patches = [plt.Rectangle((0, 0), 1, 1, color=color) for color in colors[::-1][:len(elements)]]
    ax.legend(patches, elements, title="Elements", bbox_to_anchor=(1.0, 1), loc='upper left', reverse=False)

    plt.tight_layout()
    plt.savefig(file_location)
    file_location_out = file_location

    #plt.show()
# ---------- end py3_55 ----------
setimg_2 = SetImage(ImageToModify=image_2, NewImagePath=py3_55)

panel_195 = Panel(total_load_eui_all_simulations_2)
current_all_simulation_models_simple_ene_3 = RemoteReceiver(current_all_simulation_models_simple_ene)  # "current_all_simulation_models_simple_energy"
entwine_169 = Entwine(Branch00="None", Branch01=current_all_simulation_models_simple_ene_3, FlattenInputs=True)  # -> flatten(Result)
total_load_eui_all_simulations_3 = RemoteReceiver(total_load_eui_all_simulations)
setlist_7 = SetListContents(ListToModify=pulldown, NewListContents=entwine_169, SelectedIndex="0")
ma_33 = MassAddition(Input=total_load_eui_all_simulations_3)  # -> flatten(Result), PartialResults
hasdata_13 = DataExists(Data=ma_33.Result)
current_all_simulations_simple_energy_2 = RemoteReceiver(current_all_simulations_simple_energy)
filter_98 = StreamFilter(Gate=hasdata_13, Stream0="0", Stream1=ma_33.Result)
lng_42 = ListLength(List=filter_98)
larger_12 = LargerThan(FirstNumber=lng_42, SecondNumber="1")  # -> LargerThan, OrEqualTo
hasdata_14 = DataExists(Data=current_all_simulations_simple_energy_2)
hideshow_45 = HideShowElement(ElementToHideShow=tb_2, Show=hasdata_14, Collapse=True, Disable=False)
and_36 = GateAnd(A=simple_energy_data_exists_2, B=larger_12.LargerThan)

current_all_simulation_models_simple_ene_4 = RemoteReceiver(current_all_simulation_models_simple_ene)  # "current_all_simulation_models_simple_energy"
item_47 = ListItem(List=current_all_simulation_models_simple_ene_4, Index=current_selected_simulation_simple_energ_2, Wrap=invert(True))
current_selected_simulation_simple_energ_4 = RemoteSender(item_47)  # "current_selected_simulation_simple_energy_compare_title"

# ---- group: Analyse performance
xdata = LBDeconstructData(data=bang_20.Branch2)  # -> header, values; plug-in component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
xdata_2 = LBDeconstructData(data=bang_20.Branch1)  # -> header, values; plug-in component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
xdata_3 = LBDeconstructData(data=bang_20.Branch3)  # -> header, values; plug-in component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
xdata_4 = LBDeconstructData(data=bang_20.Branch4)  # -> header, values; plug-in component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
xdata_5 = LBDeconstructData(data=bang_20.Branch5)  # -> header, values; plug-in component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
smaller_3 = SmallerThan(FirstNumber=xdata_3.values, SecondNumber="0")  # -> SmallerThan, OrEqualTo
smaller_4 = SmallerThan(FirstNumber=xdata.values, SecondNumber="0")  # -> SmallerThan, OrEqualTo
smaller_5 = SmallerThan(FirstNumber=xdata_2.values, SecondNumber="0")  # -> SmallerThan, OrEqualTo
smaller_6 = SmallerThan(FirstNumber=xdata_4.values, SecondNumber="0")  # -> SmallerThan, OrEqualTo
smaller_7 = SmallerThan(FirstNumber=xdata_5.values, SecondNumber="0")  # -> SmallerThan, OrEqualTo
sift = SiftPattern(List=xdata_3.values, SiftPattern=smaller_3.OrEqualTo)  # -> Output0, Output1
sift_2 = SiftPattern(List=xdata_2.values, SiftPattern=smaller_5.OrEqualTo)  # -> Output0, Output1
sift_3 = SiftPattern(List=xdata.values, SiftPattern=smaller_4.OrEqualTo)  # -> Output0, Output1
sift_4 = SiftPattern(List=xdata_4.values, SiftPattern=smaller_6.OrEqualTo)  # -> Output0, Output1
sift_5 = SiftPattern(List=xdata_5.values, SiftPattern=smaller_7.OrEqualTo)  # -> Output0, Output1
flip_2 = FlipMatrix(Data=sift_3.Output0)
flip_3 = FlipMatrix(Data=sift_3.Output1)
flip_4 = FlipMatrix(Data=sift.Output0)
flip_5 = FlipMatrix(Data=sift.Output1)
flip_6 = FlipMatrix(Data=sift_5.Output0)
flip_7 = FlipMatrix(Data=sift_5.Output1)
flip_8 = FlipMatrix(Data=sift_2.Output0)
flip_9 = FlipMatrix(Data=sift_2.Output1)
flip_10 = FlipMatrix(Data=sift_4.Output0)
flip_11 = FlipMatrix(Data=sift_4.Output1)
ma_34 = MassAddition(Input=flip_3)  # -> Result, PartialResults
ma_35 = MassAddition(Input=flip_5)  # -> Result, PartialResults
ma_36 = MassAddition(Input=flip_2)  # -> Result, PartialResults
ma_37 = MassAddition(Input=flip_7)  # -> Result, PartialResults
ma_38 = MassAddition(Input=flip_9)  # -> Result, PartialResults
ma_39 = MassAddition(Input=flip_4)  # -> Result, PartialResults
ma_40 = MassAddition(Input=flip_11)  # -> Result, PartialResults
ma_41 = MassAddition(Input=flip_6)  # -> Result, PartialResults
ma_42 = MassAddition(Input=flip_8)  # -> Result, PartialResults
ma_43 = MassAddition(Input=flip_10)  # -> Result, PartialResults
extremes = MinMax(Number=flatten(ma_36.Result))  # -> Minimum, Maximum
extremes_2 = MinMax(Number=flatten(ma_34.Result))  # -> Minimum, Maximum
extremes_3 = MinMax(Number=flatten(ma_39.Result))  # -> Minimum, Maximum
extremes_4 = MinMax(Number=flatten(ma_35.Result))  # -> Minimum, Maximum
extremes_5 = MinMax(Number=flatten(ma_41.Result))  # -> Minimum, Maximum
extremes_6 = MinMax(Number=flatten(ma_42.Result))  # -> Minimum, Maximum
extremes_7 = MinMax(Number=flatten(ma_37.Result))  # -> Minimum, Maximum
extremes_8 = MinMax(Number=flatten(ma_38.Result))  # -> Minimum, Maximum
extremes_9 = MinMax(Number=flatten(ma_43.Result))  # -> Minimum, Maximum
extremes_10 = MinMax(Number=flatten(ma_40.Result))  # -> Minimum, Maximum
cooling_balance_min = RemoteSender(extremes_10.Minimum)
cooling_balance_max = RemoteSender(extremes_9.Maximum)
heating_balance_min = RemoteSender(extremes_7.Minimum)
daily_cooling_profile_min = RemoteSender(extremes_2.Minimum)
daily_heating_profile_min = RemoteSender(extremes_4.Minimum)
heating_balance_max = RemoteSender(extremes_5.Maximum)
annual_energy_balance_max = RemoteSender(extremes_6.Maximum)
daily_cooling_profile_max = RemoteSender(extremes.Maximum)
daily_heating_profile_max = RemoteSender(extremes_3.Maximum)
annual_energy_balance_min = RemoteSender(extremes_8.Minimum)

# ----
# Detailed data from energy simulation
data_34 = Data(flatten(bang_20.Branch1))

# ---- group: Analysis module (continued)
hideshow_46 = HideShowElement(ElementToHideShow=stack_2, Show=and_36, Collapse=True, Disable=False)

# ---- group: Analyse performance (continued)
current_all_simulation_models_simple_ene_5 = RemoteReceiver(current_all_simulation_models_simple_ene)  # "current_all_simulation_models_simple_energy"
mindex_9 = MemberIndex(Set=current_all_simulation_models_simple_ene_5, Member=current_selected_model_analysis_module_n_8)  # -> flatten(Index), Count

# ----
item_48 = ListItem(List=mindex_9.Index, Index="-1", Wrap=True)

# ---- group: Analyse performance (continued)
item_49 = ListItem(List=current_all_simulation_models_simple_ene_5, Index=item_48, Wrap=True)
current_selected_simulation_simple_energ_5 = RemoteSender(item_49)  # "current_selected_simulation_simple_energy_title"

# ----
current_all_simulations_simple_energy_3 = RemoteReceiver(current_all_simulations_simple_energy)
item_50 = ListItem(List=current_all_simulations_simple_energy_3, Index=gate_69.Target1, Wrap=invert(True))  # -> simplify(Item)
pshift_2 = ShiftPaths(Data=item_50, Offset=-1)
bang_22 = ExplodeTree(Data=pshift_2)  # -> Branch0, Branch1, Branch2, Branch3, Branch4, Branch5

xdata_6 = LBDeconstructData(data=bang_22.Branch2)  # -> header, values; plug-in component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
xdata_7 = LBDeconstructData(data=bang_22.Branch1)  # -> header, values; plug-in component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
xdata_8 = LBDeconstructData(data=bang_22.Branch3)  # -> header, values; plug-in component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
xdata_9 = LBDeconstructData(data=bang_22.Branch4)  # -> header, values; plug-in component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
xdata_10 = LBDeconstructData(data=bang_22.Branch5)  # -> header, values; plug-in component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
smaller_8 = SmallerThan(FirstNumber=xdata_8.values, SecondNumber="0")  # -> SmallerThan, OrEqualTo
smaller_9 = SmallerThan(FirstNumber=xdata_6.values, SecondNumber="0")  # -> SmallerThan, OrEqualTo
smaller_10 = SmallerThan(FirstNumber=xdata_7.values, SecondNumber="0")  # -> SmallerThan, OrEqualTo
smaller_11 = SmallerThan(FirstNumber=xdata_9.values, SecondNumber="0")  # -> SmallerThan, OrEqualTo
smaller_12 = SmallerThan(FirstNumber=xdata_10.values, SecondNumber="0")  # -> SmallerThan, OrEqualTo
sift_6 = SiftPattern(List=xdata_8.values, SiftPattern=smaller_8.OrEqualTo)  # -> Output0, Output1
sift_7 = SiftPattern(List=xdata_7.values, SiftPattern=smaller_10.OrEqualTo)  # -> Output0, Output1
sift_8 = SiftPattern(List=xdata_6.values, SiftPattern=smaller_9.OrEqualTo)  # -> Output0, Output1
sift_9 = SiftPattern(List=xdata_9.values, SiftPattern=smaller_11.OrEqualTo)  # -> Output0, Output1
sift_10 = SiftPattern(List=xdata_10.values, SiftPattern=smaller_12.OrEqualTo)  # -> Output0, Output1
flip_12 = FlipMatrix(Data=sift_8.Output0)
flip_13 = FlipMatrix(Data=sift_8.Output1)
flip_14 = FlipMatrix(Data=sift_6.Output0)
flip_15 = FlipMatrix(Data=sift_6.Output1)
flip_16 = FlipMatrix(Data=sift_10.Output0)
flip_17 = FlipMatrix(Data=sift_10.Output1)
flip_18 = FlipMatrix(Data=sift_7.Output0)
flip_19 = FlipMatrix(Data=sift_7.Output1)
flip_20 = FlipMatrix(Data=sift_9.Output0)
flip_21 = FlipMatrix(Data=sift_9.Output1)
ma_44 = MassAddition(Input=flip_13)  # -> Result, PartialResults
ma_45 = MassAddition(Input=flip_15)  # -> Result, PartialResults
ma_46 = MassAddition(Input=flip_12)  # -> Result, PartialResults
ma_47 = MassAddition(Input=flip_17)  # -> Result, PartialResults
ma_48 = MassAddition(Input=flip_19)  # -> Result, PartialResults
ma_49 = MassAddition(Input=flip_14)  # -> Result, PartialResults
ma_50 = MassAddition(Input=flip_21)  # -> Result, PartialResults
ma_51 = MassAddition(Input=flip_16)  # -> Result, PartialResults
ma_52 = MassAddition(Input=flip_18)  # -> Result, PartialResults
ma_53 = MassAddition(Input=flip_20)  # -> Result, PartialResults
extremes_11 = MinMax(Number=flatten(ma_46.Result))  # -> Minimum, Maximum
extremes_12 = MinMax(Number=flatten(ma_44.Result))  # -> Minimum, Maximum
extremes_13 = MinMax(Number=flatten(ma_49.Result))  # -> Minimum, Maximum
extremes_14 = MinMax(Number=flatten(ma_45.Result))  # -> Minimum, Maximum
extremes_15 = MinMax(Number=flatten(ma_51.Result))  # -> Minimum, Maximum
extremes_16 = MinMax(Number=flatten(ma_52.Result))  # -> Minimum, Maximum
extremes_17 = MinMax(Number=flatten(ma_47.Result))  # -> Minimum, Maximum
extremes_18 = MinMax(Number=flatten(ma_48.Result))  # -> Minimum, Maximum
extremes_19 = MinMax(Number=flatten(ma_53.Result))  # -> Minimum, Maximum
extremes_20 = MinMax(Number=flatten(ma_50.Result))  # -> Minimum, Maximum
annual_energy_balance_max_compare = RemoteSender(extremes_16.Maximum)
cooling_balance_min_compare = RemoteSender(extremes_20.Minimum)
cooling_balance_max_compare = RemoteSender(extremes_19.Maximum)
daily_cooling_profile_min_compare = RemoteSender(extremes_12.Minimum)
daily_heating_profile_min_compare = RemoteSender(extremes_14.Minimum)
heating_balance_max_compare = RemoteSender(extremes_15.Maximum)
annual_energy_balance_min_compare = RemoteSender(extremes_18.Minimum)
daily_cooling_profile_max_compare = RemoteSender(extremes_11.Maximum)
daily_heating_profile_max_compare = RemoteSender(extremes_13.Maximum)
heating_balance_min_compare = RemoteSender(extremes_17.Minimum)

annual_energy_balance_min_compare_2 = RemoteReceiver(annual_energy_balance_min_compare)
annual_energy_balance_max_compare_2 = RemoteReceiver(annual_energy_balance_max_compare)
cluster_13 = Cluster_4(x=annual_energy_balance_min_compare_2)
cluster_14 = Cluster_3(int=annual_energy_balance_max_compare_2)

daily_cooling_profile_max_compare_2 = RemoteReceiver(daily_cooling_profile_max_compare)
daily_cooling_profile_min_compare_2 = RemoteReceiver(daily_cooling_profile_min_compare)
daily_heating_profile_max_compare_2 = RemoteReceiver(daily_heating_profile_max_compare)
daily_heating_profile_min_compare_2 = RemoteReceiver(daily_heating_profile_min_compare)
cooling_balance_max_compare_2 = RemoteReceiver(cooling_balance_max_compare)
cooling_balance_min_compare_2 = RemoteReceiver(cooling_balance_min_compare)
heating_balance_max_compare_2 = RemoteReceiver(heating_balance_max_compare)
heating_balance_min_compare_2 = RemoteReceiver(heating_balance_min_compare)
cluster_15 = Cluster_3(int=heating_balance_max_compare_2)
cluster_16 = Cluster_4(x=daily_cooling_profile_min_compare_2)
cluster_17 = Cluster_3(int=daily_cooling_profile_max_compare_2)
cluster_18 = Cluster_3(int=cooling_balance_max_compare_2)
cluster_19 = Cluster_4(x=heating_balance_min_compare_2)
cluster_20 = Cluster_4(x=cooling_balance_min_compare_2)
cluster_21 = Cluster_4(x=daily_heating_profile_min_compare_2)
cluster_22 = Cluster_3(int=daily_heating_profile_max_compare_2)
legendpar_5 = LBLegendParameters(min=cluster_19, max=cluster_15)  # -> leg_par; plug-in component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
cluster_23 = Cluster_2(min=cluster_20, max=cluster_18, colors=colrange_5)
cluster_24 = Cluster_2(min=cluster_21, max=cluster_22, colors=colrange_4)

# ---- group: Simple peak loads
legendpar_6 = LBLegendParameters(min=cluster_16, max=cluster_17)  # -> leg_par; plug-in component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
current_selected_simulation_simple_energ_6 = RemoteReceiver(current_selected_simulation_simple_energ_4)  # "current_selected_simulation_simple_energy_compare_title"
current_selected_simulation_simple_energ_7 = RemoteReceiver(current_selected_simulation_simple_energ_4)  # "current_selected_simulation_simple_energy_compare_title"
current_selected_simulation_simple_energ_8 = RemoteReceiver(current_selected_simulation_simple_energ_4)  # "current_selected_simulation_simple_energy_compare_title"
current_selected_simulation_simple_energ_9 = RemoteReceiver(current_selected_simulation_simple_energ_4)  # "current_selected_simulation_simple_energy_compare_title"
simple_energy_simulation_base_point_comp_2 = RemoteReceiver(simple_energy_simulation_base_point_comp)  # "simple_energy_simulation_base_point_compare"
simple_energy_simulation_base_point_comp_3 = RemoteReceiver(simple_energy_simulation_base_point_comp)  # "simple_energy_simulation_base_point_compare"
simple_energy_simulation_base_point_comp_4 = RemoteReceiver(simple_energy_simulation_base_point_comp)  # "simple_energy_simulation_base_point_compare"
simple_energy_simulation_base_point_comp_5 = RemoteReceiver(simple_energy_simulation_base_point_comp)  # "simple_energy_simulation_base_point_compare"
simple_energy_simulation_height_4 = RemoteReceiver(simple_energy_simulation_height)
simple_energy_simulation_width_3 = RemoteReceiver(simple_energy_simulation_width)
simple_energy_simulation_height_5 = RemoteReceiver(simple_energy_simulation_height)
simple_energy_simulation_height_6 = RemoteReceiver(simple_energy_simulation_height)
simple_energy_simulation_width_4 = RemoteReceiver(simple_energy_simulation_width)
simple_energy_simulation_width_5 = RemoteReceiver(simple_energy_simulation_width)
simple_energy_simulation_height_7 = RemoteReceiver(simple_energy_simulation_height)
simple_energy_simulation_width_6 = RemoteReceiver(simple_energy_simulation_width)
toggle_6 = BooleanToggle(True)
toggle_7 = BooleanToggle(True)
toggle_8 = BooleanToggle(True)
toggle_9 = BooleanToggle(True)
monthlychart_2 = LBMonthlyChart(
    data=bang_22.Branch3,
    base_pt=simple_energy_simulation_base_point_comp_3,
    x_dim=simple_energy_simulation_width_4,
    y_dim=simple_energy_simulation_height_5,
    stack=toggle_6,
    time_marks=toggle_6,
    global_title=current_selected_simulation_simple_energ_7,
    legend_par=cluster_24)  # -> report, data_mesh, data_lines, col_lines, legend, borders, labels, y_title, title, vis_set; plug-in component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
monthlychart_3 = LBMonthlyChart(
    data=bang_22.Branch2,
    base_pt=simple_energy_simulation_base_point_comp_2,
    x_dim=simple_energy_simulation_width_3,
    y_dim=simple_energy_simulation_height_4,
    stack=toggle_7,
    time_marks=toggle_7,
    global_title=current_selected_simulation_simple_energ_9,
    legend_par=legendpar_6)  # -> report, data_mesh, data_lines, col_lines, legend, borders, labels, y_title, title, vis_set; plug-in component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
monthlychart_4 = LBMonthlyChart(
    data=bang_22.Branch4,
    base_pt=simple_energy_simulation_base_point_comp_4,
    x_dim=simple_energy_simulation_width_5,
    y_dim=simple_energy_simulation_height_6,
    stack=toggle_8,
    time_marks=toggle_8,
    global_title=current_selected_simulation_simple_energ_6,
    legend_par=cluster_23)  # -> report, data_mesh, data_lines, col_lines, legend, borders, labels, y_title, title, vis_set; plug-in component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
monthlychart_5 = LBMonthlyChart(
    data=bang_22.Branch5,
    base_pt=simple_energy_simulation_base_point_comp_5,
    x_dim=simple_energy_simulation_width_6,
    y_dim=simple_energy_simulation_height_7,
    stack=toggle_9,
    time_marks=toggle_9,
    global_title=current_selected_simulation_simple_energ_8,
    legend_par=legendpar_5)  # -> report, data_mesh, data_lines, col_lines, legend, borders, labels, y_title, title, vis_set; plug-in component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
daily_heating_profile = Data(flatten([monthlychart_2.data_mesh, monthlychart_2.data_lines, monthlychart_2.col_lines, monthlychart_2.legend, monthlychart_2.borders, monthlychart_2.labels, monthlychart_2.y_title, monthlychart_2.title]))
daily_cooling_profile = Data(flatten([monthlychart_3.data_mesh, monthlychart_3.data_lines, monthlychart_3.col_lines, monthlychart_3.legend, monthlychart_3.borders, monthlychart_3.labels, monthlychart_3.y_title, monthlychart_3.title]))
heating_balance_design_day = Data(flatten([monthlychart_5.data_mesh, monthlychart_5.data_lines, monthlychart_5.col_lines, monthlychart_5.legend, monthlychart_5.borders, monthlychart_5.labels, monthlychart_5.y_title, monthlychart_5.title]))
cooling_balance_design_day = Data(flatten([monthlychart_4.data_mesh, monthlychart_4.data_lines, monthlychart_4.col_lines, monthlychart_4.legend, monthlychart_4.borders, monthlychart_4.y_title, monthlychart_4.labels, monthlychart_4.title]))

# ----
daily_cooling_profile_2 = Data(flatten(daily_cooling_profile))
daily_cooling_profile_3 = Data(flatten(daily_heating_profile))
daily_cooling_profile_4 = Data(flatten(cooling_balance_design_day))
daily_cooling_profile_5 = Data(flatten(heating_balance_design_day))

# ---- group: Simple energy balance
current_selected_simulation_simple_energ_10 = RemoteReceiver(current_selected_simulation_simple_energ_4)  # "current_selected_simulation_simple_energy_compare_title"
colrange_6 = LBColorRange(index=Slider(19, range=0..100))  # -> colors; plug-in component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
simple_energy_simulation_base_point_comp_6 = RemoteReceiver(simple_energy_simulation_base_point_comp)  # "simple_energy_simulation_base_point_compare"
simple_energy_simulation_height_8 = RemoteReceiver(simple_energy_simulation_height)
simple_energy_simulation_width_7 = RemoteReceiver(simple_energy_simulation_width)

# ---- group: Analyse performance (continued)
annual_energy_balance_max_2 = RemoteReceiver(annual_energy_balance_max)
annual_energy_balance_min_2 = RemoteReceiver(annual_energy_balance_min)
daily_heating_profile_max_2 = RemoteReceiver(daily_heating_profile_max)
daily_heating_profile_min_2 = RemoteReceiver(daily_heating_profile_min)
daily_cooling_profile_max_2 = RemoteReceiver(daily_cooling_profile_max)
daily_cooling_profile_min_2 = RemoteReceiver(daily_cooling_profile_min)
heating_balance_max_2 = RemoteReceiver(heating_balance_max)
heating_balance_min_2 = RemoteReceiver(heating_balance_min)
cooling_balance_max_2 = RemoteReceiver(cooling_balance_max)
cooling_balance_min_2 = RemoteReceiver(cooling_balance_min)
cluster_25 = Cluster_3(int=heating_balance_max_2)
cluster_26 = Cluster_4(x=daily_cooling_profile_min_2)
cluster_27 = Cluster_3(int=daily_cooling_profile_max_2)
cluster_28 = Cluster_3(int=cooling_balance_max_2)
cluster_29 = Cluster_4(x=heating_balance_min_2)
cluster_30 = Cluster_4(x=cooling_balance_min_2)
cluster_31 = Cluster_4(x=daily_heating_profile_min_2)
cluster_32 = Cluster_3(int=daily_heating_profile_max_2)
legendpar_7 = LBLegendParameters(min=cluster_29, max=cluster_25)  # -> leg_par; plug-in component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
cluster_33 = Cluster_2(min=cluster_30, max=cluster_28, colors=colrange_2)
cluster_34 = Cluster_2(min=cluster_31, max=cluster_32, colors=colrange_3)

# ----
cluster_35 = Cluster_4(x=annual_energy_balance_min_2)
cluster_36 = Cluster_3(int=annual_energy_balance_max_2)
max_2 = Maximum(A=cluster_14, B=cluster_36)
min_2 = Minimum(A=cluster_35, B=cluster_13)
null_45 = NullItem(Item=max_2)  # -> NullFlags, InvalidFlags, Description
null_46 = NullItem(Item=min_2)  # -> NullFlags, InvalidFlags, Description
filter_99 = StreamFilter(Gate=null_46.NullFlags, Stream0=min_2, Stream1=cluster_35)
filter_100 = StreamFilter(Gate=null_45.NullFlags, Stream0=max_2, Stream1=cluster_36)

# ---- group: Simple energy balance (continued)
legendpar_8 = LBLegendParameters(min=min_2, max=max_2, colors=colrange_6)  # -> leg_par; plug-in component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
monthlychart_6 = LBMonthlyChart(
    data=bang_22.Branch1,
    base_pt=simple_energy_simulation_base_point_comp_6,
    x_dim=simple_energy_simulation_width_7,
    y_dim=simple_energy_simulation_height_8,
    stack=Toggle(True),
    global_title=current_selected_simulation_simple_energ_10,
    legend_par=legendpar_8)  # -> report, data_mesh, data_lines, col_lines, legend, borders, labels, y_title, title, vis_set; plug-in component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
annual_energy_balance = Data(flatten([monthlychart_6.data_mesh, monthlychart_6.data_lines, monthlychart_6.col_lines, monthlychart_6.legend, monthlychart_6.borders, monthlychart_6.labels, monthlychart_6.y_title, monthlychart_6.title]))

# ---- group: Analyse performance / Simple energy balance
colrange_7 = LBColorRange(index=Slider(19, range=0..100))  # -> colors; plug-in component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
current_selected_simulation_simple_energ_11 = RemoteReceiver(current_selected_simulation_simple_energ_5)  # "current_selected_simulation_simple_energy_title"
legendpar_9 = LBLegendParameters(min=filter_99, max=filter_100, colors=colrange_7)  # -> leg_par; plug-in component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
monthlychart_7 = LBMonthlyChart(
    data=bang_20.Branch1,
    base_pt=simple_energy_simulation_base_point_2,
    x_dim=simple_energy_simulation_width_2,
    y_dim=simple_energy_simulation_height_3,
    stack=Toggle(True),
    global_title=current_selected_simulation_simple_energ_11,
    legend_par=legendpar_9)  # -> report, data_mesh, data_lines, col_lines, legend, borders, labels, y_title, title, vis_set; plug-in component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

# ----
panel_196 = Panel(legendpar_8)

# ---- group: Analyse performance / Simple peak loads
legendpar_10 = LBLegendParameters(min=cluster_26, max=cluster_27)  # -> leg_par; plug-in component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
current_selected_simulation_simple_energ_12 = RemoteReceiver(current_selected_simulation_simple_energ_5)  # "current_selected_simulation_simple_energy_title"
current_selected_simulation_simple_energ_13 = RemoteReceiver(current_selected_simulation_simple_energ_5)  # "current_selected_simulation_simple_energy_title"
current_selected_simulation_simple_energ_14 = RemoteReceiver(current_selected_simulation_simple_energ_5)  # "current_selected_simulation_simple_energy_title"
current_selected_simulation_simple_energ_15 = RemoteReceiver(current_selected_simulation_simple_energ_5)  # "current_selected_simulation_simple_energy_title"
simple_energy_simulation_base_point_3 = RemoteReceiver(simple_energy_simulation_base_point)
simple_energy_simulation_base_point_4 = RemoteReceiver(simple_energy_simulation_base_point)
simple_energy_simulation_base_point_5 = RemoteReceiver(simple_energy_simulation_base_point)
simple_energy_simulation_base_point_6 = RemoteReceiver(simple_energy_simulation_base_point)
simple_energy_simulation_height_9 = RemoteReceiver(simple_energy_simulation_height)
simple_energy_simulation_width_8 = RemoteReceiver(simple_energy_simulation_width)
simple_energy_simulation_height_10 = RemoteReceiver(simple_energy_simulation_height)
simple_energy_simulation_height_11 = RemoteReceiver(simple_energy_simulation_height)
simple_energy_simulation_width_9 = RemoteReceiver(simple_energy_simulation_width)
simple_energy_simulation_width_10 = RemoteReceiver(simple_energy_simulation_width)
simple_energy_simulation_height_12 = RemoteReceiver(simple_energy_simulation_height)
simple_energy_simulation_width_11 = RemoteReceiver(simple_energy_simulation_width)
toggle_10 = BooleanToggle(True)
toggle_11 = BooleanToggle(True)
toggle_12 = BooleanToggle(True)
toggle_13 = BooleanToggle(True)
monthlychart_8 = LBMonthlyChart(
    data=bang_20.Branch3,
    base_pt=simple_energy_simulation_base_point_4,
    x_dim=simple_energy_simulation_width_9,
    y_dim=simple_energy_simulation_height_10,
    stack=toggle_10,
    time_marks=toggle_10,
    global_title=current_selected_simulation_simple_energ_12,
    legend_par=cluster_34)  # -> report, data_mesh, data_lines, col_lines, legend, borders, labels, y_title, title, vis_set; plug-in component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
monthlychart_9 = LBMonthlyChart(
    data=bang_20.Branch2,
    base_pt=simple_energy_simulation_base_point_3,
    x_dim=simple_energy_simulation_width_8,
    y_dim=simple_energy_simulation_height_9,
    stack=toggle_11,
    time_marks=toggle_11,
    global_title=current_selected_simulation_simple_energ_15,
    legend_par=legendpar_10)  # -> report, data_mesh, data_lines, col_lines, legend, borders, labels, y_title, title, vis_set; plug-in component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
monthlychart_10 = LBMonthlyChart(
    data=bang_20.Branch4,
    base_pt=simple_energy_simulation_base_point_5,
    x_dim=simple_energy_simulation_width_10,
    y_dim=simple_energy_simulation_height_11,
    stack=toggle_13,
    time_marks=toggle_13,
    global_title=current_selected_simulation_simple_energ_14,
    legend_par=cluster_33)  # -> report, data_mesh, data_lines, col_lines, legend, borders, labels, y_title, title, vis_set; plug-in component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
monthlychart_11 = LBMonthlyChart(
    data=bang_20.Branch5,
    base_pt=simple_energy_simulation_base_point_6,
    x_dim=simple_energy_simulation_width_11,
    y_dim=simple_energy_simulation_height_12,
    stack=toggle_12,
    time_marks=toggle_12,
    global_title=current_selected_simulation_simple_energ_13,
    legend_par=legendpar_7)  # -> report, data_mesh, data_lines, col_lines, legend, borders, labels, y_title, title, vis_set; plug-in component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
daily_heating_profile_2 = Data(flatten([monthlychart_8.data_mesh, monthlychart_8.data_lines, monthlychart_8.col_lines, monthlychart_8.legend, monthlychart_8.borders, monthlychart_8.labels, monthlychart_8.y_title, monthlychart_8.title]))
daily_cooling_profile_6 = Data(flatten([monthlychart_9.data_mesh, monthlychart_9.data_lines, monthlychart_9.col_lines, monthlychart_9.legend, monthlychart_9.borders, monthlychart_9.labels, monthlychart_9.y_title, monthlychart_9.title]))
heating_balance_design_day_2 = Data(flatten([monthlychart_11.data_mesh, monthlychart_11.data_lines, monthlychart_11.col_lines, monthlychart_11.legend, monthlychart_11.borders, monthlychart_11.labels, monthlychart_11.y_title, monthlychart_11.title]))
cooling_balance_design_day_2 = Data(flatten([monthlychart_10.data_mesh, monthlychart_10.data_lines, monthlychart_10.col_lines, monthlychart_10.legend, monthlychart_10.borders, monthlychart_10.y_title, monthlychart_10.labels, monthlychart_10.title]))

# ---- group: Analyse performance (continued)
panel_197 = Panel(legendpar_9)
annual_energy_balance_2 = Data(flatten([monthlychart_7.data_mesh, monthlychart_7.data_lines, monthlychart_7.col_lines, monthlychart_7.legend, monthlychart_7.borders, monthlychart_7.labels, monthlychart_7.y_title, monthlychart_7.title]))

# ----
daily_cooling_profile_7 = Data(flatten(annual_energy_balance))

data_35 = Data(spatial_daylight_autonomy)
data_36 = Data(daylight_autonomy_2)
data_37 = Data(udi_2)
data_38 = Data(udi_50)
data_39 = Data(udi_3000)
data_40 = Data(illuminance_lux)
entwine_170 = Entwine(
    Branch00=data_35,
    Branch01=data_40,
    Branch02=data_36,
    Branch03=data_37,
    Branch04=data_38,
    Branch05=data_39,
    FlattenInputs=True)
current_model_name_5 = RemoteReceiver(current_model_name)
current_selected_model_analysis_module_n_9 = RemoteReceiver(current_selected_model_analysis_module_n)  # "current_selected_model_analysis_module_name"
daylight_simulation_type_3 = RemoteReceiver(daylight_simulation_type)
annualdaylight_message_error_3 = RemoteReceiver(annualdaylight_message_error)
pitgrid_message_error_3 = RemoteReceiver(pitgrid_message_error)
daylight_expander_is_open_4 = RemoteReceiver(daylight_expander_is_open)
lng_43 = ListLength(List=pitgrid_message_error_3)
lng_44 = ListLength(List=annualdaylight_message_error_3)
current_tab_22 = RemoteReceiver(current_tab)
or_27 = GateOr(A=lng_43, B=lng_44)
expression_84 = Expression(x=tab_simulate_8, y=current_tab_22, Expression="x=y")

null_47 = NullItem(Item=flatten(entwine_170))  # -> NullFlags, InvalidFlags, Description
py3_56 = Python3Script(x=entwine_170)  # -> out, a; inputs x: tree
# ---------- py3_56: Python ----------
import time
if x:
    a = time.time()
    print(a)
# ---------- end py3_56 ----------
item_51 = ListItem(List=null_47.NullFlags, Index=0, Wrap=True)
gate_70 = StreamGate(Stream=entwine_170, Gate=item_51)  # -> Target0, Target1
entwine_171 = Entwine(Branch0X=gate_70.Target0, Branch1X=current_model_name_5, FlattenInputs=False)

simple_energy_simulation_type_2 = RemoteReceiver(simple_energy_simulation_type)
daily_cooling_profile_8 = Data(flatten(annual_energy_balance_2))
daily_cooling_profile_9 = Data(flatten(daily_heating_profile_2))
daily_cooling_profile_10 = Data(flatten(daily_cooling_profile_6))
daily_cooling_profile_11 = Data(flatten(cooling_balance_design_day_2))
daily_cooling_profile_12 = Data(flatten(heating_balance_design_day_2))
data_41 = Data(flatten(bang_20.Branch0))
annualloads_message_error_3 = RemoteReceiver(annualloads_message_error)
peakloads_message_error_3 = RemoteReceiver(peakloads_message_error)
ma_54 = MassAddition(Input=data_41)  # -> Result, PartialResults
total_load_eui_2 = RemoteSender(data_41)
simple_energy_expander_is_open_2 = RemoteReceiver(simple_energy_expander_is_open)
bool_63 = Boolean(ma_54.Result)
current_tab_23 = RemoteReceiver(current_tab)
null_48 = NullItem(Item=bool_63)  # -> NullFlags, InvalidFlags, Description
filter_101 = StreamFilter(Gate=null_48.NullFlags, Stream0=bool_63, Stream1="False")
expression_85 = Expression(x=tab_simulate_7, y=current_tab_23, Expression="x=y")

entwine_172 = Entwine(Branch00=daily_cooling_profile_3, Branch01=daily_cooling_profile_9, FlattenInputs=True)  # -> flatten(Result)
entwine_173 = Entwine(Branch00=daily_cooling_profile_7, Branch01=daily_cooling_profile_8, FlattenInputs=True)  # -> flatten(Result)
entwine_174 = Entwine(Branch00=daily_cooling_profile_2, Branch01=daily_cooling_profile_10, FlattenInputs=True)  # -> flatten(Result)
entwine_175 = Entwine(Branch00=daily_cooling_profile_4, Branch01=daily_cooling_profile_11, FlattenInputs=True)  # -> flatten(Result)
entwine_176 = Entwine(Branch00=daily_cooling_profile_5, Branch01=daily_cooling_profile_12, FlattenInputs=True)  # -> flatten(Result)
lng_45 = ListLength(List=annualloads_message_error_3)
lng_46 = ListLength(List=peakloads_message_error_3)
and_37 = GateAnd(A=expression_85, B=simple_energy_data_exists_3, C=simple_energy_expander_is_open_2)

# ---- group: Analysis module (continued)
total_load_eui_3 = RemoteReceiver(total_load_eui_2)
ma_55 = MassAddition(Input=total_load_eui_3)  # -> Result, PartialResults
expression_86 = Expression(x=ma_55.Result, Expression="Round(x, 1)")
format_37 = Format(Format=panel_62, Culture=127, Data0=expression_86)
settextblock_17 = SetTextBlockContents(TextBlockToModify=tb_8, NewTextBlockContents=format_37)

# ----
total_load_eui_4 = RemoteReceiver(total_load_eui_2)
energy_use_intensity_kwh_m2 = Data(total_load_eui_4)

calculate_operational_emissions = BrimstoneCalculateOperationalEmissions(lca_data=get_lca_data.lca_data, eui=energy_use_intensity_kwh_m2, area=area_m2, mode=list_5)  # -> out, gwp_total; inputs lca_data: tree
# ---------- calculate_operational_emissions: Python ----------
"""Calculates operational emissions based on energy resource, EUI and floor area
    Inputs:
        lca_data: tree containing GWP information for the selected resource
        eui: energy use intensity of building in kWh/m2
        gfa: gross floor area of building
        mode: mode of GWP calculation ("typical" or "conservative")
        
    Output:
        gwp_total: total GWP for the selected space"""

import scriptcontext
import brimstone
reload(brimstone)
ghenv.Component.Message = brimstone.globals.version

ghenv.Component.Name = 'Brimstone - Calculate Operational Emissions'
ghenv.Component.NickName = 'Calculate Operational Emissions'

import rhinoscriptsyntax as rs
import ghpythonlib.treehelpers as th

from collections import OrderedDict

inv_unit_string = 'kWh'
gwp_unit_string = 'kg CO2 eq./kWh' # GWP

def main(lca_data, eui, area, mode):
    if not lca_data.BranchCount:
        brimstone.utils.warn(ghenv, "LCA data is missing")
        return
    if eui != 0 and not eui:
        brimstone.utils.warn(ghenv, "EUI is missing")
        return
    if area != 0 and not area:
        brimstone.utils.warn(ghenv, "Area is missing")
        return
    
    lca_data = th.tree_to_list(lca_data)
    lca_data = [OrderedDict(zip(l[0], l[1])) for l in lca_data]
    gwp_total =  []
    
    for resource_lca_data in lca_data:
        try:
            gwp_total.append(calculate_gwp_total(resource_lca_data, eui, area, mode))
        except KeyError as e:
            raise Exception("GWP value could not be calculated: {error}".format(error = e))
    
    return gwp_total
    
def calculate_gwp_total(lca_data, eui, area, mode):    
    inv_unit = lca_data["InventoryUnit"]
    
    if inv_unit != inv_unit_string:
        raise Exception("Wrong unit for calculation of operational energy")    
    
    gwp_unit = lca_data["GWPUnit"]
    if gwp_unit != gwp_unit_string:
        raise Exception("Wrong unit for GWP calculation")
    
    if mode == "conservative":
        gwp_a1_a3_str = "GWPA1A3Conservative"
    elif mode == "typical":
        gwp_a1_a3_str = "GWPA1A3Typical"
    else:
        raise Exception("Mode not recognised (must be conservative or typical)")
    
    gwp_impact = (
        float(lca_data[gwp_a1_a3_str])
    )
    
    gwp_total = (
        float(lca_data[gwp_a1_a3_str])
    ) * area * eui
        
    return gwp_total

if __name__ == "__main__":
    if not scriptcontext.sticky["brimstone_flying"]:
        raise Exception("The 'Brimstone - Fly' component needs to exist on the canvas")   
    gwp_total = main(lca_data, eui, area, mode)
    gwp_total = th.list_to_tree(gwp_total)
# ---------- end calculate_operational_emissions ----------
operational_gwp_total_kg_co2eq_year = Data(calculate_operational_emissions.gwp_total)
panel_198 = Panel(operational_gwp_total_kg_co2eq_year)
ma_56 = MassAddition(Input=calculate_operational_emissions.gwp_total)  # -> Result, PartialResults
lca_operational_gwp_total = RemoteSender(ma_56.Result)

lca_operational_gwp_total_2 = RemoteReceiver(lca_operational_gwp_total)
entwine_177 = Entwine(
    Branch00=lca_element_types_2,
    Branch01=lca_gwp_by_element_type_2,
    Branch02=lca_total_gwp_2,
    Branch03=lca_operational_gwp_total_2,
    FlattenInputs=True)  # -> flatten(Result)
hasdata_15 = DataExists(Data=entwine_177)
filter_102 = StreamFilter(Gate=hasdata_15, Stream0="False", Stream1=entwine_177)
lng_47 = ListLength(List=filter_102)
and_38 = GateAnd(A=honeybee_model_exists_10, B=lng_47)
and_39 = GateAnd(A=invert(lng_38), B=and_38)
lca_data_exists = RemoteSender(and_39)

lca_operational_gwp_total_3 = RemoteReceiver(lca_operational_gwp_total)

nullrep = ReplaceNulls(Items=lca_operational_gwp_total_3, Replacements=int)  # -> Items, Count

entwine_178 = Entwine(
    Branch00=current_selected_model_analysis_module_n_7,
    Branch01=lca_gwp_by_element_type_3,
    Branch02=nullrep.Items,
    Branch03=lca_total_gfa_2,
    FlattenInputs=True)  # -> flatten(Result)
panel_199 = Panel(entwine_178)
save_lca = Python3Script(elements=entwine_163, data=entwine_178, save=pre_calculate_lca_2)  # -> out, file_path, saved; inputs elements: list of String, data: list
# ---------- save_lca: Python ----------
import csv
import os

import ghpythonlib.treehelpers as th

from Rhino import RhinoDoc

folder_path = ("\\").join(ghdoc.Path.split("\\")[:-1])
rhino_file_name = (RhinoDoc.ActiveDoc.Path).split("\\")[-1][:-4]
full_path = folder_path + "\\heath_data\\" + rhino_file_name + "\\" + rhino_file_name + "_LCA.csv"

try:
    os.mkdir(("\\").join(full_path.split("\\")[:-2]))
    os.mkdir(("\\").join(full_path.split("\\")[:-1]))
    os.mkdir(full_path)
except FileExistsError:
    # directory already exists
    pass

file_path = full_path


# Ensure file path and data are provided
if file_path and data and save:
    try:
        # Ensure the directory exists
        directory = os.path.dirname(file_path)
        if not os.path.exists(directory):
            os.makedirs(directory)  # Create directory if it doesn't exist

        file_exists = os.path.isfile(file_path)
        existing_models = set()

        if file_exists:
            with open(file_path, 'r', newline='', encoding='utf-8') as csv_file:
                reader = csv.reader(csv_file)
                header = next(reader, None)
                for row in reader:
                    if row:
                        existing_models.add(row[0])
        else:
            header = elements

        # keeps track of the existing header vs the incoming elements
        column_dict = dict([(element, elements.index(element)) for element in header])
        # Open the file and append to its contents
        with open(file_path, 'a', newline='') as csv_file:
            writer = csv.writer(csv_file)
            if not file_exists:
                writer.writerow(header)
            
            # make sure the order is correct
            row = [data[column_dict[element]] for element in header]
            if data[0] not in existing_models:
                writer.writerow(row)
        saved = True

        print(f"File successfully created/appended at: {file_path}")
    except Exception as e:
        raise e
        print(f"Error: {str(e)}")
else:
    pass
    # print("Provide a valid file path and data.")
# ---------- end save_lca ----------
panel_200 = Panel(save_lca.file_path)
py3_57 = Python3Script(
    rename=pre_rename_current_model_2,
    model_name=current_model_name_2,
    new_model_name=rename_current_model_name_3,
    csv_file_path=save_lca.file_path)  # -> out, a
# ---------- py3_57: Python ----------
import os
import csv

name_col = "Model name"
if rename and os.path.exists(csv_file_path):
    new_rows = []
    with open(csv_file_path, 'r', newline='') as csv_file:
        reader = csv.DictReader(csv_file)
        renamed_rows = list(reader)
        fieldnames = reader.fieldnames        
    
    for row in renamed_rows:
        if row[name_col] == model_name:
            row[name_col] = new_model_name

    with open(csv_file_path, 'w', newline ="") as csv_file:
        writer = csv.DictWriter(csv_file, fieldnames = reader.fieldnames)
        writer.writeheader()
        writer.writerows(renamed_rows)

    print(f"Successfully renamed {model_name} to {new_model_name} in {csv_file_path} csv")
# ---------- end py3_57 ----------
py3_58 = Python3Script(remove=pre_remove_current_model_2, model_name=current_model_name_3, csv_file_path=save_lca.file_path)  # -> out, a
# ---------- py3_58: Python ----------
import os
import csv

name_col = "Model name"
if remove and os.path.exists(csv_file_path):
    with open(csv_file_path, 'r', newline='') as csv_file:
        reader = csv.DictReader(csv_file)
        filtered_rows = [row for row in reader if row[name_col] != model_name]
    with open(csv_file_path, 'w', newline ="") as csv_file:
        writer = csv.DictWriter(csv_file, fieldnames = reader.fieldnames)
        writer.writeheader()
        writer.writerows(filtered_rows)

    print(f"Successfully removed {model_name} from {csv_file_path} csv")
# ---------- end py3_58 ----------
freeze_gate_60 = StreamFreezeGate(Data=save_lca.file_path, PassingSwitch=save_lca.saved)

panel_201 = Panel(save_lca.out)

load_lca = Python3Script(file_path=freeze_gate_60)  # -> error, a
# ---------- load_lca: Python ----------
import csv
import ghpythonlib.treehelpers as th

# Initialize output list
output_data = []

error = False
# Ensure the file path is provided
if file_path:
    try:
        # Open and read the CSV file
        with open(file_path, 'r', encoding='utf-8') as csv_file:
            reader = csv.reader(csv_file)
            for row in reader:
                output_data.append(row)  # Append each row as a list
                
        a = output_data  # Output data to Grasshopper
        a = th.list_to_tree(a)
    except Exception as e:
        error = True
        a = [f"Error: {str(e)}"]
else:
    a = ["Please provide a valid file path."]
# ---------- end load_lca ----------
split_13 = SplitList(List=load_lca.a, Index="1")  # -> flatten(ListA), ListB
split_14 = SplitList(List=split_13.ListB, Index="5")  # -> ListA, flatten(ListB)
split_15 = SplitTree(Data=split_14.ListA, Masks=flatten("{0;0;0;0}"))  # -> Positive, Negative
cull_i_6 = CullIndex(List=split_13.ListA, Indices="0", Wrap=invert(True))
cset_9 = CreateSet(List=cull_i_6)  # -> Set, Map
cull_32 = CullPattern(List=split_15.Negative, CullPattern=graft(values_26.Values))  # -> flatten(List)
cull_33 = CullPattern(List=cset_9.Set, CullPattern=values_26.Values)
setchecklist_2 = SetChecklistContents(ChecklistToModify=checklist_2, NewChecklistContents=cset_9.Set, Selected="True")

bool_64 = Boolean(invert(load_lca.error))
visualize_lca_is_possible = RemoteSender(bool_64)
cull_i_7 = CullIndex(List=split_14.ListB, Indices="0", Wrap=True)
visualize_lca_is_possible_2 = RemoteReceiver(visualize_lca_is_possible)

entwine_179 = Entwine(
    Branch00=nextfile_2,
    Branch01=cull_33,
    Branch02=split_15.Positive,
    Branch03=cull_32,
    Branch04=cull_i_7,
    Branch05=fragment_2,
    FlattenInputs=True)
freeze_gate_61 = StreamFreezeGate(Data=entwine_179, PassingSwitch=or_2)
bang_23 = ExplodeTree(Data=freeze_gate_61)  # -> Branch0, Branch1, Branch2, Branch3, Branch4, Branch5

lng_48 = ListLength(List=flatten(bang_23.Branch2))
partition_2 = PartitionList(List=flatten(bang_23.Branch3), Size=lng_48)
py3_59 = Python3Script(
    file_location=bang_23.Branch0,
    y_label=filter_12,
    title=filter_13,
    labels=bang_23.Branch1,
    elements=bang_23.Branch2,
    values=partition_2,
    GFA=bang_23.Branch4,
    colors=bang_23.Branch5,
    perGFA=bool,
    img_width=bar_chart_img_width_2,
    img_height=bar_chart_img_height_2)  # -> out, file_location_out; inputs labels: list, elements: list, values: tree of Double, GFA: list of Double, colors: list
# ---------- py3_59: Python ----------
# requirements: matplotlib
# requirements: numpy
title
import matplotlib.pyplot as plt
import numpy as np
import os
import ghpythonlib.treehelpers as th

if not os.path.exists(file_location):
    seperatedLabels = []
    for label in labels:
        if '(' in label:
            seperatedLabels.append(('\n(').join(label.split('(')))
        else:
            seperatedLabels.append(label)
    
    colors = colors[:len(elements)]
    for i in range(len(colors)):
        colors[i] = colors[i].split(',')
        colors[i] = tuple([float(j) for j in colors[i]])
    
    values_list = th.tree_to_list(values)
    if perGFA:
        for i in range(len(values_list)):
            for j in range(len(values_list[i])):
                values_list[i][j] = values_list[i][j]/GFA[i]

    px = 1/plt.rcParams['figure.dpi']  # pixel in inches
    fig, ax = plt.subplots(figsize=(img_width*px, img_height*px))

    # Add the stacked bars
    bottom = np.zeros(len(values_list))
    bar_width = 0.25
    for i in range(len(values_list)):
        for j in range(len(values_list[i])):
            ax.bar(seperatedLabels[i], values_list[i][j], color=colors[j], 
             bottom=bottom[i], align='center', width=bar_width, zorder=2)
            
            if values_list[i][j] > 0:
                ax.text(i, bottom[i] + values_list[i][j] / 2, f"{int(values_list[i][j])}",
                ha='center', va='center', fontsize=10, color='black', zorder=3)
            
            bottom[i] += values_list[i][j]
    
    y_range = max(bottom)*1.1
    interval = 10 ** (np.floor(np.log10(y_range)) - 1)  # Base interval as a power of 10
    while y_range / interval > 10:  # Adjust interval if too many ticks
        interval *= 2
    while y_range / interval < 5:  # Adjust interval if too few ticks
        interval /= 2

    # Ensure interval is a clean power of 10 or multiple thereof
    interval = round(interval, -int(np.floor(np.log10(interval))))

    # Set y-axis limits
    ax.set_ylim(0, y_range)

    # Generate tick positions
    yticks = list(range(0, int(y_range) + 1, int(interval)))

    # Add horizontal lines
    for y in yticks:
        ax.axhline(y=y, color='gray', linestyle='--', linewidth=0.4, zorder=1)

    # Set yticks to match the lines
    ax.set_yticks(yticks)

    ax.set_title(title)
    ax.set_ylabel(y_label)
    ax.set_xticks(range(len(seperatedLabels)))
    ax.set_xticklabels(seperatedLabels, rotation=35, ha='right', rotation_mode='anchor')
    
    plt.subplots_adjust(right=0.65)

    # Create the legend
    patches = [plt.Rectangle((0, 0), 1, 1, color=color) for color in colors[:len(elements)]]
    ax.legend(patches, elements, title="Elements", bbox_to_anchor=(1.0, 1), loc='upper left', reverse=True)

    plt.tight_layout()
    plt.savefig(file_location)
    file_location_out = file_location

    #plt.show()
# ---------- end py3_59 ----------

setimg_3 = SetImage(ImageToModify=image, NewImagePath=py3_59.file_location_out)

# ---- group: Analysis module (continued)
lca_operational_gwp_total_4 = RemoteReceiver(lca_operational_gwp_total)
lca_operational_gwp_total_5 = RemoteReceiver(lca_operational_gwp_total)
lca_operational_gwp_total_6 = RemoteReceiver(lca_operational_gwp_total)
division_15 = Division(A=lca_operational_gwp_total_4, B=lca_total_gfa_4)
multiplication_9 = Multiplication(A="50", B=lca_operational_gwp_total_5)
expression_87 = Expression(x=division_15, Expression="Round(x, 1)")
expression_88 = Expression(x=lca_operational_gwp_total_6, Expression="Round(x, 1)")
expression_89 = Expression(x=multiplication_9, Expression="Round(x, 1)")
format_38 = Format(Format=panel_65, Culture=127, Data0=expression_87)
format_39 = Format(Format=panel_66, Culture=127, Data0=expression_88)
format_40 = Format(Format=panel_67, Culture=127, Data0="50", Data1=expression_89)
setlabel_8 = SetLabelContents(LabelToModify=label_31, NewLabelContents=format_38)
setlabel_9 = SetLabelContents(LabelToModify=label_32, NewLabelContents=format_39)
setlabel_10 = SetLabelContents(LabelToModify=label_33, NewLabelContents=format_40)
lca_data_exists_2 = RemoteReceiver(lca_data_exists)
and_40 = GateAnd(A=lca_data_exists_2, B=simple_energy_data_exists_10)
hideshow_47 = HideShowElement(ElementToHideShow=true_button_10, Show=True, Collapse=True, Disable=invert(visualize_lca_is_possible_2))
hideshow_48 = HideShowElement(ElementToHideShow=[label_32, label_33, label_31], Show=and_40, Collapse=True, Disable=False)
hideshow_49 = HideShowElement(ElementToHideShow=[label_30, true_button_10, label_28], Show=lca_data_exists_2, Collapse=True, Disable=False)

# ----
filter_103 = StreamFilter(
    Gate=simple_energy_simulation_type_2,
    Stream0=entwine_173,
    Stream1=entwine_174,
    Stream2=entwine_172,
    Stream3=entwine_175,
    Stream4=entwine_176)
sortbytype = SortObjectsByType(RhinoObjects=filter_103)  # -> Points, Curves, Surfaces, Breps, Meshes, TextObjects, HatchObjects, LightObjects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
or_28 = GateOr(A=lng_45, B=lng_46)
line = Line(sortbytype.Curves)
null_49 = NullItem(Item=line)  # -> NullFlags, InvalidFlags, Description
data_42 = Data([sortbytype.Other, sortbytype.Meshes])
bbox_5 = BoundingBox(Content=sortbytype.Meshes, Plane=PlaneXY(0, 0, 0), UnionBox=True)  # -> Box, Box_2
sift_11 = SiftPattern(List=sortbytype.Curves, SiftPattern=null_49.NullFlags)  # -> Output0, Output1
gate_71 = StreamGate(Stream=sift_11.Output1, Gate=and_37)  # -> Target0, Target1
gate_72 = StreamGate(Stream=data_42, Gate=and_37)  # -> Target0, Target1
gate_73 = StreamGate(Stream=bbox_5.Box, Gate=and_37)  # -> Target0, Target1
zoom_simple_energy_simulation_bounding_b = RemoteSender(gate_73.Target1)  # "zoom_simple_energy_simulation_bounding_box"
clean_14 = CleanTree(RemoveNulls=True, RemoveInvalid=True, RemoveEmpty=False, Tree=gate_72.Target1)
data_43 = Data(gate_72.Target1)
indices_2 = ListIndices(Data=gate_72.Target1)
index_4 = ItemIndex(List=gate_72.Target1, Item=clean_14)
preview_22 = CustomPreview(Geometry=gate_71.Target1, Material=ColourSwatch(SwatchColor=RGB(84, 84, 84)))
exdiff_2 = SetDifferenceS(SetA=indices_2, SetB=index_4)
item_52 = ListItem(List=gate_72.Target1, Index=exdiff_2, Wrap=True)

and_41 = GateAnd(A=invert(or_28), B=filter_101)
alignvert_2 = AlignVertices(Mesh=item_52, Tolerance=0.01)  # -> Result, Count

clean_15 = CleanTree(RemoveNulls=True, RemoveInvalid=True, RemoveEmpty=False, Tree=alignvert_2.Result)

# ----
# Bake simple energy simulation
panel_202 = Panel("""Heath::Energy simulation::Annual energy balance
Heath::Energy simulation::Daily cooling profile
Heath::Energy simulation::Daily heating profile
Heath::Energy simulation::Cooling balance
Heath::Energy simulation::Heating balance""")
simple_energy_simulation_type_3 = RemoteReceiver(simple_energy_simulation_type)
merge_27 = Merge(Data1=clean_14, Data2=clean_15)
bake_simple_energy_simulation_2 = RemoteReceiver(bake_simple_energy_simulation)
simple_energy_simulation_annual_energy_b = Data(merge_27)  # "simple_energy_simulation_Annual_energy_balance"
item_53 = ListItem(List=panel_202, Index=simple_energy_simulation_type_3, Wrap=invert(True))
gate_74 = StreamGate(Stream=item_53, Gate=bake_simple_energy_simulation_2)  # -> Target0, Target1
layers_3 = CreateModifyLayers(LayerName=gate_74.Target1, DeleteLayer=False, enableFullPath=True)  # -> LayerNames, LayerFullPath
createatts_3 = CreateAttributes(LayerName=layers_3.LayerFullPath, enableFullPath=True)
connected_4 = GetConnectedObjects(Objects=simple_energy_simulation_annual_energy_b)
bake_4 = BakeObject(Objects=connected_4, ObjectAttributes=createatts_3, Bake=bake_simple_energy_simulation_2)

# ----
# Zoom simple energy
zoom_simple_energy_simulation_bounding_b_2 = RemoteReceiver(zoom_simple_energy_simulation_bounding_b)  # "zoom_simple_energy_simulation_bounding_box"
zoom_simple_energy_simulation_2 = RemoteReceiver(zoom_simple_energy_simulation)
zbb_4 = ZoomBoundingBox(Box=zoom_simple_energy_simulation_bounding_b_2, Run=zoom_simple_energy_simulation_2)
panel_203 = Panel(zoom_simple_energy_simulation_2)

panel_204 = Panel(createatts_3)

freeze_gate_62 = StreamFreezeGate(Data=entwine_171, PassingSwitch=run_daylight_simulations_3, Freeze=True, Hold=False)
split_16 = SplitTree(Data=freeze_gate_62, Masks=flatten("{1;*}"))  # -> Positive, Negative

py3_60 = Python3Script(data=graft(split_16.Negative), enable=toggle_3, reset=button_8, t=py3_56.a)  # -> out, a; inputs data: tree
# ---------- py3_60: Python ----------
""" this component replaces Data recorder """
""" There was an issue where data was stored even after reset,
    possibly because of telepathy components downstream.
    this seems to work! """

from Grasshopper import DataTree
guid = str(ghenv.Component.InstanceGuid) + str(ghdoc.Path)
guid_t = str(ghenv.Component.InstanceGuid) + str(t)
from scriptcontext import sticky

empty_value = "Recorder has been initiated/reset."

if enable:
    if reset or guid not in sticky: sticky[guid] = empty_value
    elif sticky[guid] == empty_value:
        sticky[guid] = DataTree[object]()
    elif guid_t in sticky:
        pass
    else:
        sticky[guid_t] = True
        sticky[guid].MergeTree(data)

if sticky[guid] != empty_value:
    a = sticky[guid]
else:
    a = None
# ---------- end py3_60 ----------
py3_61 = Python3Script(data=graft(split_16.Positive), enable=toggle_3, reset=button_8, t=py3_56.a)  # -> out, a; inputs data: tree; same code as py3_60

panel_205 = Panel(py3_60.a)
py3_62 = Python3Script(all_simulated_models=py3_61.a, model_dictionary=model_name_dictionary_3)  # -> out, simulated_models_renamed; inputs all_simulated_models: list, model_dictionary: list; same code as py3_53
py3_63 = Python3Script(
    all_simulated_models=py3_62.simulated_models_renamed,
    existing_models=current_all_created_models_names_5,
    all_simulation_data=py3_60.a)  # -> out, filtered_simulated_models, filtered_simulation_data_pattern; inputs all_simulated_models: list, existing_models: list, all_simulation_data: tree
# ---------- py3_63: Python ----------
from ghpythonlib import treehelpers as th
import Grasshopper as gh

model_indexes = {}
for i, m in enumerate(all_simulated_models):
    if m in existing_models:
        # we make sure here to take the latest index with a unique name
        model_indexes[m] = i

print(model_indexes)

filtered_simulation_data_pattern = gh.DataTree[object](all_simulation_data)
for i, branch in enumerate(filtered_simulation_data_pattern.Branches):
    for j in range(len(branch)):
        branch[j] = j in model_indexes.values()

filtered_simulated_models = list(model_indexes.keys())
#filtered_simulation_data = th.list_to_tree(filtered_simulation_data)
# ---------- end py3_63 ----------
data_44 = Data(py3_63.filtered_simulated_models)
cull_34 = CullPattern(List=py3_60.a, CullPattern=py3_63.filtered_simulation_data_pattern)
current_all_simulation_models_daylight = RemoteSender(data_44)

current_all_simulation_models_daylight_2 = RemoteReceiver(current_all_simulation_models_daylight)
cset_10 = CreateSet(List=current_all_simulation_models_daylight_2)  # -> Set, Map
cull_35 = CullPattern(List=cset_10.Set, CullPattern=values_28.Values)
mindex_10 = MemberIndex(Set=current_all_simulation_models_daylight_2, Member=graft(cull_35))  # -> Index, Count
item_54 = ListItem(List=mindex_10.Index, Index="-1", Wrap=True)  # -> flatten(Item)
setchecklist_3 = SetChecklistContents(ChecklistToModify=checklist_3, NewChecklistContents=cset_10.Set, Selected="True")

# ---- group: Analysis module (continued)
current_all_simulation_models_daylight_3 = RemoteReceiver(current_all_simulation_models_daylight)
entwine_180 = Entwine(Branch00="None", Branch01=current_all_simulation_models_daylight_3, FlattenInputs=True)  # -> flatten(Result)
setlist_8 = SetListContents(ListToModify=pulldown_19, NewListContents=entwine_180, SelectedIndex="0")

# ----
mindex_11 = MemberIndex(Set=data_44, Member=current_selected_model_analysis_module_n_9)  # -> flatten(Index), Count
split_17 = SplitTree(Data=cull_34, Masks=flatten("{0;0;0;*}"))  # -> Positive, Negative
null_50 = NullItem(Item=mindex_11.Count)  # -> NullFlags, InvalidFlags, Description
flip_22 = FlipMatrix(Data=split_17.Positive)
item_55 = ListItem(List=mindex_11.Index, Index="-1", Wrap=True)
ma_57 = MassAddition(Input=flip_22)  # -> flatten(Result), PartialResults
item_56 = ListItem(List=simplify(cull_34), Index=item_55, Wrap=invert(True))
current_all_simulations_daylight = RemoteSender(py3_60.a)
spatialdaylightautonomy_all_simulations = RemoteSender(ma_57.Result)
pshift_3 = ShiftPaths(Data=item_56, Offset=-1)
filter_104 = StreamFilter(Gate=null_50.NullFlags, Stream0=mindex_11.Count, Stream1="False")
bang_24 = ExplodeTree(Data=pshift_3)  # -> Branch0, Branch1, Branch2, Branch3, Branch4, Branch5
daylight_data_exists = RemoteSender(filter_104)
data_45 = Data(bang_24.Branch1)
data_46 = Data(bang_24.Branch2)
data_47 = Data(bang_24.Branch3)
data_48 = Data(bang_24.Branch4)
data_49 = Data(bang_24.Branch0)
data_50 = Data(bang_24.Branch5)
spatialdaylightautonomy_current = RemoteSender(data_49)
spatialdaylightautonomy_current_2 = RemoteReceiver(spatialdaylightautonomy_current)
filter_105 = StreamFilter(Gate=daylight_simulation_type_3, Stream0=data_45, Stream1=data_46, Stream2=data_47, Stream3=data_48, Stream4=data_50)
null_51 = NullItem(Item=spatialdaylightautonomy_current_2)  # -> NullFlags, InvalidFlags, Description
bool_65 = Boolean(invert(null_51.NullFlags))
and_42 = GateAnd(A=expression_84, B=daylight_expander_is_open_4, C=bool_65)
and_43 = GateAnd(A=bool_65, B=invert(or_27))
data_51 = Data(filter_105)

# ---- group: Analysis module (continued)
spatialdaylightautonomy_current_3 = RemoteReceiver(spatialdaylightautonomy_current)
expression_90 = Expression(x=spatialdaylightautonomy_current_3, Expression="Round(x*100, 1)")
daylight_data_exists_2 = RemoteReceiver(daylight_data_exists)
spatialdaylightautonomy_all_simulations_2 = RemoteReceiver(spatialdaylightautonomy_all_simulations)
format_41 = Format(Format=panel_61, Culture=127, Data0=expression_90)
daylight_data_exists_3 = RemoteReceiver(daylight_data_exists)
or_29 = GateOr(A=daylight_data_exists_2, B=filter_16)
rec_42 = DataRecorder(or_29, DataLimit=-10, RecordData=True)
settextblock_18 = SetTextBlockContents(TextBlockToModify=tb_6, NewTextBlockContents=format_41)
hideshow_50 = HideShowElement(ElementToHideShow=button_23, Show=daylight_data_exists_3, Collapse=True, Disable=False)
ma_58 = MassAddition(Input=flatten(rec_42))  # -> Result, PartialResults
daylight_data_exists_4 = RemoteReceiver(daylight_data_exists)
hasdata_16 = DataExists(Data=spatialdaylightautonomy_all_simulations_2)
mod_2 = Modulus(A=ma_58.Result, B=Slider(2, range=0..10))
daylight_data_exists_5 = RemoteReceiver(daylight_data_exists)
filter_106 = StreamFilter(Gate=hasdata_16, Stream0="0", Stream1=spatialdaylightautonomy_all_simulations_2)
daylight_data_exists_6 = RemoteReceiver(daylight_data_exists)
hideshow_51 = HideShowElement(ElementToHideShow=[pulldown_21, label_27], Show=daylight_data_exists_4, Collapse=True, Disable=False)
bool_66 = Boolean(mod_2)
lng_49 = ListLength(List=filter_106)
filter_107 = StreamFilter(Gate=bool_66, Stream0="Simulation failed...", Stream1="Daylight simulation is running...")
hideshow_52 = HideShowElement(ElementToHideShow=tb_6, Show=daylight_data_exists_5, Collapse=True, Disable=False)
bool_67 = Boolean(invert(daylight_data_exists_6))
larger_13 = LargerThan(FirstNumber=lng_49, SecondNumber="1")  # -> LargerThan, OrEqualTo
daylight_data_exists_7 = RemoteReceiver(daylight_data_exists)
gate_75 = StreamGate(Stream=filter_107, Gate=freeze_gate_12)  # -> Target0, Target1
hideshow_53 = HideShowElement(ElementToHideShow=tb_5, Show=bool_67, Collapse=daylight_data_exists_6, Disable=False)
and_44 = GateAnd(A=daylight_data_exists_7, B=larger_13.LargerThan)
hideshow_54 = HideShowElement(ElementToHideShow=stack_27, Show=and_44, Collapse=True, Disable=False)

# ----
daylight_data_exists_8 = RemoteReceiver(daylight_data_exists)
hideshow_55 = HideShowElement(ElementToHideShow=button_5, Show=daylight_data_exists_8, Collapse=True, Disable=False)
current_all_simulations_daylight_2 = RemoteReceiver(current_all_simulations_daylight)
hasdata_17 = DataExists(Data=current_all_simulations_daylight_2)
hideshow_56 = HideShowElement(ElementToHideShow=tb, Show=hasdata_17, Collapse=True, Disable=False)

spatialdaylightautonomy_all_simulations_3 = RemoteReceiver(spatialdaylightautonomy_all_simulations)
num_11 = Number(spatialdaylightautonomy_all_simulations_3)
expression_91 = Expression(x=num_11, Expression="Round(x, 2)")
item_57 = ListItem(List=expression_91, Index=item_54, Wrap=invert(True))
entwine_181 = Entwine(
    Branch00=nextfile_3,
    Branch01=panel_28,
    Branch02=panel_28,
    Branch03=cull_35,
    Branch04=item_57,
    Branch05=fragment_3,
    FlattenInputs=True)
freeze_gate_63 = StreamFreezeGate(Data=entwine_181, PassingSwitch=and_2)
bang_25 = ExplodeTree(Data=freeze_gate_63)  # -> Branch0, Branch1, Branch2, Branch3, Branch4, Branch5

multiplication_10 = Multiplication(A=bang_25.Branch4, B=Slider(100, range=0..100))

py3_64 = Python3Script(
    file_location=bang_25.Branch0,
    y_label=bang_25.Branch1,
    title=bang_25.Branch2,
    labels=bang_25.Branch3,
    values=multiplication_10,
    colors=bang_25.Branch5,
    img_width=bar_chart_img_width_4,
    img_height=bar_chart_img_height_4)  # -> file_location_out; inputs labels: list, values: list, colors: list
# ---------- py3_64: Python ----------
# requirements: matplotlib
# requirements: numpy

import matplotlib.pyplot as plt
import numpy as np

if file_location:
    seperatedLabels = []
    for label in labels:
        if '(' in label:
            seperatedLabels.append(('\n(').join(label.split('(')))
        else:
            seperatedLabels.append(label)

    for i in range(len(colors)):
        colors[i] = colors[i].split(',')
        colors[i] = tuple([float(j) for j in colors[i]])

    px = 1/plt.rcParams['figure.dpi']  # pixel in inches
    fig, ax = plt.subplots(figsize=(img_width*px, img_height*px))
    ax.bar(seperatedLabels, values, label=seperatedLabels, color=colors, align="center")

    ax.set_ylim(0, max(values)*1.1)
    ax.set_ylabel(y_label)
    ax.set_title(title)

    plt.subplots_adjust(right=0.65)

    # ax.legend(title=title, bbox_to_anchor=(1.0, 1), loc='upper left', reverse=False)

    plt.savefig(file_location)
    file_location_out = file_location

    #plt.show()
# ---------- end py3_64 ----------
setimg_4 = SetImage(ImageToModify=image_3, NewImagePath=py3_64)

current_selected_simulation_daylight_com_2 = RemoteReceiver(current_selected_simulation_daylight_com)  # "current_selected_simulation_daylight_compare"
item_58 = ListItem(List=simplify(cull_34), Index=current_selected_simulation_daylight_com_2, Wrap=invert(True))
pshift_4 = ShiftPaths(Data=item_58, Offset=-1)
daylight_simulation_type_4 = RemoteReceiver(daylight_simulation_type)
bang_26 = ExplodeTree(Data=pshift_4)  # -> Branch0, Branch1, Branch2, Branch3, Branch4, Branch5
data_52 = Data(bang_26.Branch1)
data_53 = Data(bang_26.Branch2)
data_54 = Data(bang_26.Branch3)
data_55 = Data(bang_26.Branch4)
data_56 = Data(bang_26.Branch5)
filter_108 = StreamFilter(Gate=daylight_simulation_type_4, Stream0=data_52, Stream1=data_53, Stream2=data_54, Stream3=data_55, Stream4=data_56)
daylight_expander_is_open_5 = RemoteReceiver(daylight_expander_is_open)
bbox_6 = BoundingBox(Content=data_51, Plane=PlaneXY(0, 0, 0), UnionBox=True)  # -> Box, Box_2
current_tab_24 = RemoteReceiver(current_tab)
debox_2 = DeconstructBox(Box=bbox_6.Box)  # -> Plane, X, Y, Z
expression_92 = Expression(x=tab_simulate_9, y=current_tab_24, Expression="x=y")
num_12 = Number(debox_2.Y)
addition_6 = Addition(A=num_12, B=Slider(15, range=0..100))
Y_3 = UnitY(Factor=addition_6)

expression_93 = Expression(x=current_selected_simulation_daylight_com_2, Expression="x>-1")

and_45 = GateAnd(A=expression_92, B=daylight_expander_is_open_5, C=expression_93)
gate_76 = StreamGate(Stream=filter_108, Gate=and_45)  # -> Target0, Target1
move_6 = Move(Geometry=gate_76.Target1, Motion=Y_3)  # -> Geometry, Transform

gate_77 = StreamGate(Stream=move_6.Geometry, Gate=expression_93)  # -> Target0, Target1

merge_28 = Merge(Data1=data_51, Data2=gate_77.Target1)
gate_78 = StreamGate(Stream=merge_28, Gate=and_42)  # -> Target0, Target1
bbox_7 = BoundingBox(Content=merge_28, Plane=PlaneXY(0, 0, 0), UnionBox=True)  # -> Box, Box_2
data_57 = Data(gate_78.Target1)

panel_206 = Panel(data_57)

# ----
# Bake daylight simulation
panel_207 = Panel("""Heath::Daylight simulation::Illuminance [Lux]
Heath::Daylight simulation::Daylight autonomy [%]
Heath::Daylight simulation::UDI [%]
Heath::Daylight simulation::UDI <50 [%]
Heath::Daylight simulation::UDI >3000 [%]""")
bake_daylight_simulation_2 = RemoteReceiver(bake_daylight_simulation)
daylight_simulation_type_5 = RemoteReceiver(daylight_simulation_type)
daylight_simulation = Data(data_57)
item_59 = ListItem(List=panel_207, Index=daylight_simulation_type_5, Wrap=invert(True))
gate_79 = StreamGate(Stream=item_59, Gate=bake_daylight_simulation_2)  # -> Target0, Target1

# ----
# Zoom daylight simulation
zoom_daylight_simulation_2 = RemoteReceiver(zoom_daylight_simulation)
zbb_5 = ZoomBoundingBox(Box=bbox_7.Box, Run=zoom_daylight_simulation_2)

bake_geometries_to_layers = BakeGeometriesToLayers(geometry=daylight_simulation, layers=gate_79.Target1, bake=bake_daylight_simulation_2)

# ----
# Show label in Rhino
bbox_8 = BoundingBox(Content=gate_77.Target1, Plane=PlaneXY(0, 0, 0), UnionBox=True)  # -> Box, Box_2
debox_3 = DeconstructBox(Box=bbox_8.Box)  # -> Plane, X, Y, Z
dedomain_2 = DeconstructDomain(Domain=debox_3.Z)  # -> Start, End
dedomain_3 = DeconstructDomain(Domain=debox_3.Y)  # -> Start, End
dedomain_4 = DeconstructDomain(Domain=debox_3.X)  # -> Start, End
current_selected_simulation_daylight_com_3 = RemoteReceiver(current_selected_simulation_daylight_com)  # "current_selected_simulation_daylight_compare"
current_all_simulation_models_daylight_4 = RemoteReceiver(current_all_simulation_models_daylight)
addition_7 = Addition(A=dedomain_4.Start, B=dedomain_4.End)
addition_8 = Addition(A=Slider(2, range=0..100), B=dedomain_3.End)
division_16 = Division(A=addition_7, B="2")
item_60 = ListItem(List=current_all_simulation_models_daylight_4, Index=current_selected_simulation_daylight_com_3, Wrap=invert(True))
pt_16 = ConstructPoint(XCoordinate=division_16, YCoordinate=addition_8, ZCoordinate=dedomain_2.Start)

gate_80 = StreamGate(Stream=item_60, Gate=daylight_expander_is_open_3)  # -> Target0, Target1

tag_3 = TextTag3D(
    Location=pt_16,
    Text=gate_80.Target1,
    Size=Slider(1.5, range=0..5),
    Colour=ColourSwatch(SwatchColor=RGB(255, 255, 255)),
    Justification=8)

# ----
# Show label in Rhino
number_slider_40 = Slider(2, range=0..100)
dedomain_5 = DeconstructDomain(Domain=debox_2.Z)  # -> Start, End
dedomain_6 = DeconstructDomain(Domain=debox_2.Y)  # -> Start, End
dedomain_7 = DeconstructDomain(Domain=debox_2.X)  # -> Start, End
addition_9 = Addition(A=dedomain_7.Start, B=dedomain_7.End)
addition_10 = Addition(A=number_slider_40, B=dedomain_6.End)
current_selected_model_analysis_module_n_10 = RemoteReceiver(current_selected_model_analysis_module_n)  # "current_selected_model_analysis_module_name"
division_17 = Division(A=addition_9, B="2")
pt_17 = ConstructPoint(XCoordinate=division_17, YCoordinate=addition_10, ZCoordinate=dedomain_5.Start)

gate_81 = StreamGate(Stream=current_selected_model_analysis_module_n_10, Gate=daylight_expander_is_open_2)  # -> Target0, Target1

tag_4 = TextTag3D(
    Location=pt_17,
    Text=gate_81.Target1,
    Size=Slider(1.5, range=0..5),
    Colour=ColourSwatch(SwatchColor=RGB(255, 255, 255)),
    Justification=8)

created_constructions_database = RemoteReceiver(created_constructions_database_2)
decnstrconstr_3 = HBDeconstructConstruction(constr=created_constructions_database)  # -> name, materials, layers, r_val_si, r_val_ip, u_fac_si, u_fac_ip, shgc, t_sol, t_vis; plug-in component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
decnstrmat_4 = HBDeconstructMaterial(mat=decnstrconstr_3.materials)  # -> values, attr_names, r_val_si, r_val_ip; plug-in component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
expression_94 = Expression(x=decnstrconstr_3.u_fac_si, Expression="Round(x, 2)")
null_52 = NullItem(Item=created_constructions_database)  # -> NullFlags, InvalidFlags, Description
item_61 = ListItem(List=decnstrmat_4.values, Index=0, Wrap=True)  # -> Item, Item1
item_62 = ListItem(List=null_52.NullFlags, Index=0, Wrap=True)
shiftm = ShiftMatch(GuideTree=decnstrconstr_3.materials, SecondaryData1=item_61.Item, SecondaryData2=item_61.Item1, shiftFromStart=False)  # -> GuideTree, SecondaryData1, SecondaryData2
visualize_construction_materials = RemoteSender(shiftm.SecondaryData1)
visualize_construction_thickness = RemoteSender(shiftm.SecondaryData2)
format_42 = Format(Format="{0} (U-factor: {1})", Culture=127, Data0=decnstrconstr_3.name, Data1=expression_94)
format_43 = Format(Format="{0}, {1}m", Culture=127, Data0=shiftm.SecondaryData1, Data1=shiftm.SecondaryData2)
gate_82 = StreamGate(Stream=format_42, Gate=item_62)  # -> Target0, Target1
tstat = TreeStatistics(Tree=format_43)  # -> Paths, Length, Count
tstat_2 = TreeStatistics(Tree=format_43)  # -> Paths, Length, Count
repeat_21 = RepeatData(Data="Indoors", Length=tstat_2.Count)
repeat_22 = RepeatData(Data="Outdoors", Length=tstat.Count)
entwine_182 = Entwine(Branch00=format_20, Branch01=gate_82.Target0, FlattenInputs=True)  # -> flatten(Result)
entwine_183 = Entwine(Branch00=format_22, Branch01=gate_82.Target0, FlattenInputs=True)  # -> flatten(Result)
entwine_184 = Entwine(Branch00=format_23, Branch01=gate_82.Target0, FlattenInputs=True)  # -> flatten(Result)
entwine_185 = Entwine(Branch00=format_21, Branch01=gate_82.Target0, FlattenInputs=True)  # -> flatten(Result)
entwine_186 = Entwine(Branch00=format_25, Branch01=gate_82.Target0, FlattenInputs=True)  # -> flatten(Result)
entwine_187 = Entwine(Branch00=format_24, Branch01=gate_82.Target0, FlattenInputs=True)  # -> flatten(Result)
concat_9 = Concatenate(FragmentA="- ", FragmentB=format_43)
tree = CreateTree(Data=repeat_22, Path=tstat.Paths)
tree_2 = CreateTree(Data=repeat_21, Path=tstat_2.Paths)
entwine_188 = Entwine(Branch00=panel_30, Branch01=decnstrconstr_3.name, FlattenInputs=True)  # -> flatten(Result)
entwine_189 = Entwine(Branch00=panel_30, Branch01=created_constructions_database, FlattenInputs=True)  # -> flatten(Result)
merge_29 = Merge(Data1=tree, Data2=concat_9, Data3=tree_2)
filter_109 = StreamFilter(Gate=item_62, Stream0=entwine_182, Stream1=format_20)
filter_110 = StreamFilter(Gate=item_62, Stream0=entwine_183, Stream1=format_22)
filter_111 = StreamFilter(Gate=item_62, Stream0=entwine_184, Stream1=format_23)
filter_112 = StreamFilter(Gate=item_62, Stream0=entwine_185, Stream1=format_21)
filter_113 = StreamFilter(Gate=item_62, Stream0=entwine_186, Stream1=format_25)
filter_114 = StreamFilter(Gate=item_62, Stream0=entwine_187, Stream1=format_24)
filter_115 = StreamFilter(Gate=item_62, Stream0=entwine_189, Stream1=panel_30)
filter_116 = StreamFilter(Gate=item_62, Stream0=entwine_188, Stream1=panel_30)
gate_83 = StreamGate(Stream=merge_29, Gate=item_62)  # -> Target0, Target1
all_construction_display_interior_walls = RemoteSender(filter_114)
all_construction_display_exterior_walls = RemoteSender(filter_113)
panel_208 = Panel(merge_29)
all_construction_display_exterior_roofs = RemoteSender(filter_110)
all_construction_display_interior_floors = RemoteSender(filter_111)
all_construction_display_exterior_floors = RemoteSender(filter_112)
all_construction_display_ground = RemoteSender(filter_109)
custom_constructions = RemoteSender(gate_82.Target0)
custom_constructions_info = RemoteSender(gate_83.Target0)
all_construction_names = RemoteSender(filter_116)
all_constructions = RemoteSender(filter_115)

# ---- group: Construction module (continued)
all_construction_display_exterior_floors_2 = RemoteReceiver(all_construction_display_exterior_floors)  # disabled
all_construction_display_exterior_walls_2 = RemoteReceiver(all_construction_display_exterior_walls)
all_construction_display_interior_walls_2 = RemoteReceiver(all_construction_display_interior_walls)  # disabled
all_construction_display_interior_floors_2 = RemoteReceiver(all_construction_display_interior_floors)
all_construction_display_exterior_roofs_2 = RemoteReceiver(all_construction_display_exterior_roofs)
all_construction_display_ground_2 = RemoteReceiver(all_construction_display_ground)
setlist_9 = SetListContents(ListToModify=pulldown_12, NewListContents=all_construction_display_ground_2, SelectedIndex="0")
setlist_10 = SetListContents(ListToModify=pulldown_14, NewListContents=all_construction_display_exterior_floors_2, SelectedIndex=panel_50)  # disabled
setlist_11 = SetListContents(ListToModify=pulldown_11, NewListContents=all_construction_display_exterior_walls_2, SelectedIndex="0")
setlist_12 = SetListContents(ListToModify=pulldown_16, NewListContents=all_construction_display_interior_walls_2, SelectedIndex=panel_51)  # disabled
setlist_13 = SetListContents(ListToModify=pulldown_15, NewListContents=all_construction_display_exterior_roofs_2, SelectedIndex="0")
setlist_14 = SetListContents(ListToModify=pulldown_13, NewListContents=all_construction_display_interior_floors_2, SelectedIndex="0")

# ----
all_constructions_2 = RemoteReceiver(all_constructions)
all_constructions_3 = RemoteReceiver(all_constructions)
all_constructions_4 = RemoteReceiver(all_constructions)
item_63 = ListItem(List=all_constructions_2, Index=subset_interior_floor_2, Wrap=True)
item_64 = ListItem(List=all_constructions_3, Index=subset_exterior_wall_3, Wrap=True)
item_65 = ListItem(List=all_constructions_4, Index=subset_exterior_roof_2, Wrap=True)
expression_95 = Expression(x="Generic", y=item_63, Expression="x=y")
expression_96 = Expression(x="Generic", y=item_64, Expression="x=y")
expression_97 = Expression(x="Generic", y=item_65, Expression="x=y")
filter_117 = StreamFilter(Gate=expression_95, Stream0=item_63, Stream1=null_12)
filter_118 = StreamFilter(Gate=expression_96, Stream0=item_64, Stream1=null_13)
filter_119 = StreamFilter(Gate=expression_97, Stream0=item_65, Stream1=null_14)
exteriorsubset = HBExteriorConstructionSubset(exterior_wall=filter_118, exterior_roof=filter_119, exposed_floor=filter_117)  # -> exterior_set; plug-in component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

all_constructions_5 = RemoteReceiver(all_constructions)
all_constructions_6 = RemoteReceiver(all_constructions)
item_66 = ListItem(List=all_constructions_5, Index=subset_exterior_wall_2, Wrap=True)
item_67 = ListItem(List=all_constructions_6, Index=subset_interior_floor_3, Wrap=True)
expression_98 = Expression(x="Generic", y=item_66, Expression="x=y")
expression_99 = Expression(x="Generic", y=item_67, Expression="x=y")
filter_120 = StreamFilter(Gate=expression_98, Stream0=item_66, Stream1=null_15)
filter_121 = StreamFilter(Gate=expression_99, Stream0=item_67, Stream1=null_16)
interiorsubset = HBInteriorConstructionSubset(interior_wall=filter_120, interior_floor=filter_121)  # -> interior_set; plug-in component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

all_constructions_7 = RemoteReceiver(all_constructions)
item_68 = ListItem(List=all_constructions_7, Index=subset_ground_floor_2, Wrap=True)
expression_100 = Expression(x="Generic", y=item_68, Expression="x=y")
filter_122 = StreamFilter(Gate=expression_100, Stream0=item_68, Stream1=null_17)
groundsubset = HBGroundConstructionSubset(ground_floor=filter_122)  # -> ground_set; plug-in component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

constructionset_2 = HBConstructionSet(
    name=panel_85,
    base_constr_set=panel_56,
    exterior_subset=exteriorsubset,
    ground_subset=groundsubset,
    interior_subset=interiorsubset,
    subface_subset=subfacesubset)  # -> constr_set; plug-in component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
decnstrconstrset_2 = HBDeconstructConstructionSet(constr_set=constructionset_2)  # -> exterior_wall, exterior_roof, exposed_floor, ground_wall, ground_roof, ground_floor, window, skylight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; plug-in component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
panel_209 = Panel(decnstrconstrset_2.exterior_wall)
decnstrconstr_4 = HBDeconstructConstruction(constr=decnstrconstrset_2.exterior_roof)  # -> materials, layers, r_val_si, r_val_ip, u_fac_si, u_fac_ip, shgc, t_sol, t_vis; plug-in component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
decnstrconstr_5 = HBDeconstructConstruction(constr=decnstrconstrset_2.exterior_wall)  # -> materials, layers, r_val_si, r_val_ip, u_fac_si, u_fac_ip, shgc, t_sol, t_vis; plug-in component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
add_dynamic_shades = AddDynamicShades(base_construction_set=constructionset_2, setpoint=Slider(100, range=0..200))

calc_mat_thickness = HBDeconstructMaterial(mats=decnstrconstr_4.materials)  # -> out, t; inputs mats: list
#   port mats: A material to be deconstructed. This can also be text for a material to be looked up in the material library.
# ---------- calc_mat_thickness: Python ----------
from honeybee_energy.material.opaque import EnergyMaterial, EnergyMaterialNoMass
t = 0
lamb = 0.036
for mat in mats:
    print(mat.thickness, type(mat))
    if type(mat) == EnergyMaterial:
        t = t + mat.thickness
    elif type(mat) == EnergyMaterialNoMass:
        print (mat.r_value * lamb)
        t = t + (mat.r_value * lamb)
    else:
        pass
print ('total thickness:' + str(t))
# ---------- end calc_mat_thickness ----------
calc_mat_thickness_2 = HBDeconstructMaterial(mats=decnstrconstr_5.materials)  # -> out, t; inputs mats: list; same code as calc_mat_thickness

custom_constructions_info_2 = RemoteReceiver(custom_constructions_info)
join_12 = TextJoin(Text=custom_constructions_info_2)  # -> flatten(Result)
lng_50 = ListLength(List=join_12)
py3_65 = Python3Script(current_elements=lng_50, maximum_elements=number_slider_23)  # -> status; inputs current_elements: Int32, maximum_elements: Int32
# ---------- py3_65: Python ----------
if current_elements:
    status = [True]*current_elements
    status.extend([False]*(maximum_elements-current_elements))
else:
    status = False
# ---------- end py3_65 ----------
settextblock_19 = SetTextBlockContents(TextBlockToModify=tb_15, NewTextBlockContents=join_12)
custom_constructions_2 = RemoteReceiver(custom_constructions)
setexp_4 = SetExpander(Expander=expander_8, Name=custom_constructions_2)
hideshow_57 = HideShowElement(ElementToHideShow=simplify(merge_5), Show=simplify(graft(py3_65)), Collapse=True, Disable=False)

panel_210 = Panel(lng_50)

data_58 = Data(add_dynamic_shades)
entwine_190 = Entwine(
    Branch00=cluster,
    Branch01=cluster_2,
    Branch02=cluster_3,
    Branch03=cluster_4,
    Branch04=data_16,
    Branch05=data_58,
    Branch06=model_name_4,
    Branch07=generate_wwr_2,
    Branch08=calc_mat_thickness_2.t,
    Branch09=calc_mat_thickness.t,
    FlattenInputs=True)
freeze_gate_64 = StreamFreezeGate(Data=entwine_190, PassingSwitch=pre_create_model_3, Hold=True)
bang_27 = ExplodeTree(Data=freeze_gate_64)  # -> Branch0, Branch1, Branch2, Branch3, Branch4, Branch5, Branch6, Branch7, Branch8, Branch9
construction = Data(bang_27.Branch5)
program = Data(bang_27.Branch4)
model_name_5 = Data(bang_27.Branch6)
roof_thickness = Data(bang_27.Branch9)
wall_thickness = Data(bang_27.Branch8)
wwr = Data(bang_27.Branch7)
python_2 = GhPythonScript(in_list=construction)  # -> out_list; inputs in_list: list
# ---------- python_2: Python ----------
"""Converts lists of HB objects to dicts for use with Py3.
    Inputs:
        in_list: List of HB objects
    Output:
        out_list: List of Python dictionaries representing HB objects"""

__author__ = "sawen"
__version__ = "2024.07.09"

out_list = list([x.to_dict() for x in in_list])
# ---------- end python_2 ----------
python_3 = GhPythonScript(in_list=program)  # -> out_list; inputs in_list: list; same code as python_2
model_name_6 = Text(model_name_5)
adjacent_geometry = Geometry(bang_27.Branch1)
windows_5 = Geometry(bang_27.Branch3)
window_to_wall_ratio = Number(wwr)
room_geometry = Geometry(bang_27.Branch0)
context_geometry = Geometry(bang_27.Branch2)
wall_thickness_2 = Number(wall_thickness)
py3_66 = Python3Script(
    window_wall_ratio=window_to_wall_ratio,
    window_height=window_height,
    sill_height=sill_height,
    horizontal_separation=horizontal_separation,
    wall_thickness=wall_thickness_2)  # -> out, window_settings
# ---------- py3_66: Python ----------
from heath import WindowSettings

"""Create Window Settings"""
window_settings = WindowSettings(window_wall_ratio, window_height, sill_height, horizontal_separation, wall_thickness)
# ---------- end py3_66 ----------

# ---- group: Filter window geometry if WWR option is active
bool_68 = Boolean(window_to_wall_ratio)
gate_84 = StreamGate(Stream=windows_5, Gate=bool_68)  # -> Target0, Target1

# ----
py3_67 = Python3Script(
    model_name=model_name_6,
    room_geo=room_geometry,
    construction_sets=python_2,
    programs=python_3,
    energy_systems=heatcool,
    adjacent_surfaces=adjacent_geometry,
    window_geo=gate_84.Target0,
    window_settings=py3_66.window_settings,
    context_geo=context_geometry,
    jsonify=Toggle(True))  # -> out, hb_model; inputs room_geo: list of Brep, construction_sets: list, programs: list, energy_systems: list, adjacent_surfaces: list of Brep, window_geo: list of Surface, context_geo: list of GeometryBase
# ---------- py3_67: Python ----------
# Copyright (c) 2024, Heath.
# You should have received a copy of the GNU Affero General Public License
# along with Heath; If not, see <http://www.gnu.org/licenses/>.
# 
# @license AGPL-3.0-or-later <https://spdx.org/licenses/AGPL-3.0-or-later>

"""Grasshopper Script"""
        
from heath import create_hb_model, heath_globals, utils

import Rhino.Geometry as rg
import IronPython
import importlib
import honeybee_energy

from honeybee.room import Room
cs = honeybee_energy.constructionset.ConstructionSet
pt = honeybee_energy.programtype.ProgramType 

import scriptcontext

def dictify(d):
    if type(d) in [dict, IronPython.Runtime.PythonDictionary]:
        d = dict(d)
        for key in d:
            d[key] = dictify(d[key])
    elif type(d) in [list, IronPython.Runtime.List]:
        d = [dictify(value) for value in list(d)]
    return d

if __name__ == "__main__":
    if not scriptcontext.sticky["heath_flying"]:
        raise Exception("Heath - fly component must exist on the canvas")
    ghenv.Component.Message = heath_globals.version

    # SUPER HACK because Py3 does not retain the Honeybee types
    # https://discourse.ladybug.tools/t/ladybug-honeybee-datatypes-are-converted-when-input-to-py3-component/28216
    construction_sets = [cs.from_dict(dictify(c)) for c in construction_sets]
    
    programs_patched = []
    for p in programs:
        # hack to fix py2-py3 conversion of dicts
        p = pt.from_dict(dictify(p))
        programs_patched.append(p)

    hb_model = create_hb_model(ghenv, list(room_geo), construction_sets, programs_patched, adjacent_surfaces, energy_systems, window_geo, window_settings, louver_settings, context_geo, model_name)

    if jsonify:
        hb_model = utils.jsonify(hb_model.to_dict())
# ---------- end py3_67 ----------
strtoobj_7 = HBStringToObject(hb_str=py3_67.hb_model)  # -> hb_obj; plug-in component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
lng_51 = ListLength(List=strtoobj_7)
bool_69 = Boolean(lng_51)
py3_68 = Python3Script(update=bool_69)  # -> timestamp
# ---------- py3_68: Python ----------
import datetime

if update:
    timestamp = ' (' + str(datetime.datetime.now())[:-7] + ')'
    timestamp = timestamp.replace(':', '.')
# ---------- end py3_68 ----------
entwine_191 = Entwine(Branch0X=strtoobj_7, Branch1X=model_name_6, Branch2X=py3_68, FlattenInputs=False)
split_18 = SplitTree(Data=entwine_191, Masks=flatten("{0;*}"))  # -> Positive, flatten(Negative)
join_13 = TextJoin(Text=split_18.Negative)
dumpobjects = HBDumpObjects(hb_objs=flatten(split_18.Positive), name=join_13, folder=py3_34, dump=create_model_3)  # -> report, hb_file; plug-in component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
null_53 = NullItem(Item=dumpobjects.hb_file)  # -> NullFlags, InvalidFlags, Description
panel_211 = Panel(dumpobjects.hb_file)

all_construction_names_2 = RemoteReceiver(all_construction_names)
expression_101 = Expression(x=all_construction_names_2, y=create_construction_name_2, Expression="x=y")
cull_36 = CullPattern(List=expression_101, CullPattern=expression_101)
gate_85 = StreamGate(Stream="Material already exists", Gate=cull_36)  # -> Target0, Target1

visualize_construction_thickness_2 = RemoteReceiver(visualize_construction_thickness)
visualize_construction_materials_2 = RemoteReceiver(visualize_construction_materials)
tstat_3 = TreeStatistics(Tree=visualize_construction_materials_2)  # -> Paths, Length, Count
tstat_4 = TreeStatistics(Tree=visualize_construction_thickness_2)  # -> Paths, Length, Count
stack_97 = StackData(Data=tstat_3.Paths, Stack=tstat_3.Length)
stack_98 = StackData(Data=tstat_4.Paths, Stack=tstat_4.Length)
tree_3 = CreateTree(Data=flatten(visualize_construction_materials_2), Path=stack_97)
tree_4 = CreateTree(Data=flatten(visualize_construction_thickness_2), Path=stack_98)
custom_constructions_3 = RemoteReceiver(custom_constructions)
suirify_12 = Suirify(tree_3)
suirify_13 = Suirify(tree_4)
branch_4 = TreeBranch(Tree=suirify_12, Path=path_4, MaintainPaths=True)
branch_5 = TreeBranch(Tree=suirify_13, Path=path_4, MaintainPaths=True)
item_69 = ListItem(List=custom_constructions_3, Index=pre_construction_database_visualize_cons_2, Wrap=True)
ma_59 = MassAddition(Input=branch_5)  # -> Result, PartialResults
concat_10 = Concatenate(FragmentA=ma_59.Result, FragmentB=" m")
concat_11 = Concatenate(FragmentA=branch_5, FragmentB=" m")
multiplication_11 = Multiplication(A=Slider(400, range=0..1000), B=branch_5)
format_44 = Format(Format=panel_162, Culture=127, Data0=concat_10)
cull_i_8 = CullIndex(List=multiplication_11, Indices="-1", Wrap=True)
item_70 = ListItem(List=multiplication_11, Index="-1", Wrap=True)
lng_52 = ListLength(List=concat_11)
py3_69 = Python3Script(current_elements=lng_52, maximum_elements=construction_maximum_layer_limit_7)  # -> status; inputs current_elements: Int32, maximum_elements: Int32
# ---------- py3_69: Python ----------
status = [True]*current_elements
status.extend([False]*(maximum_elements-current_elements))
# ---------- end py3_69 ----------
setlabel_11 = SetLabelContents(LabelToModify=label_63, NewLabelContents=item_69)
setlabel_12 = SetLabelContents(LabelToModify=label_66, NewLabelContents=format_44)
settextblock_20 = SetTextBlockContents(TextBlockToModify=tb_23, NewTextBlockContents=branch_4)
settextblock_21 = SetTextBlockContents(TextBlockToModify=tb_22, NewTextBlockContents=concat_11)
entwine_192 = Entwine(Branch00=cull_i_8, Branch01=item_70, FlattenInputs=True)  # -> flatten(Result)
hideshow_58 = HideShowElement(ElementToHideShow=tb_22, Show=py3_69, Collapse=True, Disable=False)
hideshow_59 = HideShowElement(ElementToHideShow=tb_23, Show=py3_69, Collapse=True, Disable=False)
hideshow_60 = HideShowElement(ElementToHideShow=tb_24, Show=py3_69, Collapse=True, Disable=False)
py3_70 = Python3Script(layerHeight=entwine_192, textHeight=Slider(22, range=0..100))  # -> over_text, under_text; inputs layerHeight: list
# ---------- py3_70: Python ----------
over_text = []
under_text = []

for layer in layerHeight:
    if layer <= textHeight:
        over_text.append(0)
        under_text.append(layer)
    else:
        over_text.append((layer/2)-(textHeight/2))

        under_text.append((layer/2)+(textHeight/2))
# ---------- end py3_70 ----------
adjustpos_125 = AdjustElementPositioning(
    ElementsToAdjust=tb_24,
    Margin="0, 0, 0, -1",
    AbsolutePositioning=False,
    Width=number_slider_33,
    Height=py3_70.over_text,
    HorizontalAlignment=0,
    VerticalAlignment=1)
adjustpos_126 = AdjustElementPositioning(
    ElementsToAdjust=tb_23,
    AbsolutePositioning=False,
    Width=number_slider_33,
    Height=py3_70.under_text,
    HorizontalAlignment=0,
    VerticalAlignment=1)

created_materials_database = RemoteReceiver(created_materials_database_2)
panel_212 = Panel(created_materials_database)
decnstrmat_5 = HBDeconstructMaterial(mat=created_materials_database)  # -> category, values, attr_names, r_val_si, r_val_ip; plug-in component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
create_material_categories = RemoteSender(decnstrmat_5.category)
item_71 = ListItem(List=decnstrmat_5.values, Index=0, Wrap=True)  # -> flatten(Item), flatten(Item1), flatten(Item2), flatten(Item3), flatten(Item4)
clean_16 = CleanTree(RemoveNulls=True, RemoveInvalid=True, RemoveEmpty=False, Tree=item_71.Item)
clean_17 = CleanTree(RemoveNulls=True, RemoveInvalid=True, RemoveEmpty=False, Tree=item_71.Item2)
clean_18 = CleanTree(RemoveNulls=True, RemoveInvalid=True, RemoveEmpty=False, Tree=item_71.Item3)
clean_19 = CleanTree(RemoveNulls=True, RemoveInvalid=True, RemoveEmpty=False, Tree=item_71.Item4)
lng_53 = ListLength(List=clean_16)
create_material_names = RemoteSender(clean_16)
num_13 = Number(clean_17)
num_14 = Number(clean_18)
num_15 = Number(clean_19)
expression_102 = Expression(x=num_13, Expression="Round(x, 2)")
expression_103 = Expression(x=num_14, Expression="Round(x, 2)")
expression_104 = Expression(x=num_15, Expression="Round(x, 2)")
bool_70 = Boolean(lng_53)
gate_86 = StreamGate(Stream=panel_33, Gate=bool_70)  # -> Target0, Target1
format_45 = Format(Format=gate_86.Target1, Culture=127, Data0=clean_16, Data1=expression_102, Data2=expression_103, Data3=expression_104)
database_materials = RemoteSender(format_45)
panel_213 = Panel(format_45)

create_material_categories_2 = RemoteReceiver(create_material_categories)
create_material_names_2 = RemoteReceiver(create_material_names)
database_materials_2 = RemoteReceiver(database_materials)
mindex_12 = MemberIndex(Set=material_database_categories_3, Member=create_material_categories_2)  # -> simplify(Index), Count
getbrn_2 = GetMatchingBranches(
    PrimaryData=mindex_12.Index,
    SecondaryData1=simplify(graft(database_materials_2)),
    SecondaryData2=simplify(graft(create_material_names_2)),
    removeEmpty=True,
    ValueTable_removeEmpty=False)  # -> flatten(PrimaryData), flatten(SecondaryData1), flatten(SecondaryData2)
cull_37 = CullPattern(List=create_material_categories_2, CullPattern=mindex_12.Count)
create_material_categories_current = RemoteSender(cull_37)
material_database_categories_current = RemoteSender(getbrn_2.PrimaryData)
database_materials_current = RemoteSender(getbrn_2.SecondaryData1)
create_material_names_current = RemoteSender(getbrn_2.SecondaryData2)

material_database_categories_current_2 = RemoteReceiver(material_database_categories_current)
material_database_categories_current_3 = RemoteReceiver(material_database_categories_current)
create_material_names_current_2 = RemoteReceiver(create_material_names_current)
database_materials_current_2 = RemoteReceiver(database_materials_current)
create_material_names_current_3 = RemoteReceiver(create_material_names_current)

expression_105 = Expression(x=create_material_names_current_3, y=create_material_name_2, Expression="x=y")
cull_38 = CullPattern(List=expression_105, CullPattern=expression_105)
gate_87 = StreamGate(Stream="Material already exists", Gate=cull_38)  # -> Target0, Target1
entwine_193 = Entwine(Branch00=filter_52, Branch01=gate_87.Target1, Branch02=gate_35.Target1, FlattenInputs=True)  # -> flatten(Result)
item_72 = ListItem(List=entwine_193, Index=0, Wrap=True)
create_material_error_message = RemoteSender(item_72)

create_material_error_message_2 = RemoteReceiver(create_material_error_message)
null_54 = NullItem(Item=create_material_error_message_2)  # -> NullFlags, InvalidFlags, Description
filter_123 = StreamFilter(Gate=null_54.NullFlags, Stream0=create_material_error_message_2, Stream1=" ")
filter_124 = StreamFilter(Gate=null_54.NullFlags, Stream0=Slider(500, range=0..1000), Stream1=Slider(1000000, range=0..1000000))
hideshow_61 = HideShowElement(ElementToHideShow=button_41, Show=True, Collapse=True, Disable=invert(null_54.NullFlags))
tooltip_16 = AttachTooltipToElement(ElementsToAttachTo=button_41, TooltipContent=filter_123, ShowDelay=filter_124, Duration=Slider(5000, range=0..10000))

create_material_names_current_4 = RemoteReceiver(create_material_names_current)
create_material_categories_current_2 = RemoteReceiver(create_material_categories_current)

mindex_13 = MemberIndex(Set=create_material_names_current_4, Member=branch_4)  # -> flatten(Index), Count
item_73 = ListItem(List=create_material_categories_current_2, Index=mindex_13.Index, Wrap=True)
mindex_14 = MemberIndex(Set=material_database_categories_8, Member=item_73)  # -> flatten(Index), Count
item_74 = ListItem(List=entwine_148, Index=mindex_14.Index, Wrap=True)
adjustelem_31 = AdjustElementAppearance(ElementsToAdjust=tb_24, Foreground=swatch_6, Background=item_74)
adjustelem_32 = AdjustElementAppearance(ElementsToAdjust=tb_23, Foreground=swatch_6, Background=item_74)

sort_3 = SortList(
    Keys=material_database_categories_current_2,
    ValuesA=database_materials_current_2,
    ValuesB=create_material_names_current_2)  # -> Keys, ValuesA, ValuesB
py3_71 = Python3Script(maximum_elements=lng_6, current_elements=material_database_categories_current_3, maximum_buttons=number_slider_25)  # -> status; inputs current_elements: list, maximum_buttons: Int32
# ---------- py3_71: Python ----------
from collections import Counter
import ghpythonlib.treehelpers as th

c = Counter(current_elements)
status = []

for i in range(maximum_elements):
    current_category = [True]*c[i]
    current_category.extend([False]*(maximum_buttons-c[i]))
    status.append(current_category)

status = th.list_to_tree(status)
# ---------- end py3_71 ----------
create_material_names_sorted = RemoteSender(sort_3.ValuesB)
concat_12 = Concatenate(FragmentA="- ", FragmentB=sort_3.ValuesA)
material_database_hideshow = RemoteSender(py3_71)
cull_39 = CullPattern(List=tb_16, CullPattern=py3_71)  # -> flatten(List)
settextblock_22 = SetTextBlockContents(TextBlockToModify=cull_39, NewTextBlockContents=concat_12)
hideshow_62 = HideShowElement(ElementToHideShow=simplify(shfdep), Show=simplify(py3_71), Collapse=True, Disable=False)

material_database_hideshow_2 = RemoteReceiver(flatten(material_database_hideshow))
filter_125 = StreamFilter(Gate=lng_16, Stream0="False", Stream1=material_database_hideshow_2)
freeze_gate_65 = StreamFreezeGate(Data=filter_125, PassingSwitch=filter_51, Freeze=True, Hold=False)
cull_40 = CullPattern(List=freeze_gate_41, CullPattern=freeze_gate_65)
create_material_names_sorted_2 = RemoteReceiver(create_material_names_sorted)
cset_11 = CreateSet(List=cull_40)  # -> Set, Map
cull_41 = CullPattern(List=cset_11.Set, CullPattern=cset_11.Set)
mindex_15 = MemberIndex(Set=cull_40, Member=cull_41)  # -> Index, Count
freeze_gate_66 = StreamFreezeGate(Data=create_material_names_sorted_2, PassingSwitch=filter_51, Freeze=True, Hold=False)
hold_10 = HoldingGate(Data=mindex_15.Index)
item_75 = ListItem(List=freeze_gate_66, Index=hold_10, Wrap=True)
expression_106 = Expression(x=item_22, y=item_75, Expression="x≠y")
cull_42 = CullPattern(List=split_7, CullPattern=expression_106)
join_14 = TextJoin(Text=cull_42, Join="|")
filter_126 = StreamFilter(Gate=bool_42, Stream0=bool_42, Stream1=join_14)
freeze_gate_67 = StreamFreezeGate(Data=filter_126, PassingSwitch=material_database_remove_material_2, Freeze=False, Hold=False)

panel_214 = Panel(filter_126)
panel_215 = Panel(freeze_gate_67)
setdocumentusertext_3 = Python3Script(key=panel_173, load_value=freeze_gate_49, remove_value=freeze_gate_67, add_value=freeze_gate_44, sync=or_20)  # -> done
# ---------- setdocumentusertext_3: Python ----------
import Rhino
import rhinoscriptsyntax as rs
import scriptcontext as sc

def modify_value(value):
    sc.doc = Rhino.RhinoDoc.ActiveDoc

    return rs.SetDocumentUserText(key, value)

    sc.doc = ghdoc

if load_value:
    done = modify_value(load_value)

elif add_value:
    done = modify_value(add_value)

elif remove_value:
    done = modify_value(remove_value)
elif remove_value == False:
    done = modify_value(None)

elif sync:
    done = True
# ---------- end setdocumentusertext_3 ----------
getdocumentusertext_15 = Python3Script(run=setdocumentusertext_3, key="Heath materials")  # -> json_string; same code as getdocumentusertext_14
split_19 = TextSplit(Text=getdocumentusertext_15, Separators="|")
hold_11 = HoldingGate(Data=split_19)
strtoobj_8 = HBStringToObject(hb_str=hold_11)  # -> flatten(hb_obj); plug-in component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
ipy2_3 = IronPython2Script(materials=strtoobj_8)  # -> unique_materials; inputs materials: list; same code as ipy2
lng_54 = ListLength(List=ipy2_3)
lng_55 = ListLength(List=strtoobj_8)
clean_20 = CleanTree(RemoveNulls=True, RemoveInvalid=True, RemoveEmpty=False, Tree=ipy2_3)
smaller_13 = SmallerThan(FirstNumber=lng_54, SecondNumber=lng_55)  # -> SmallerThan, OrEqualTo
created_materials_database_2 = RemoteSender(clean_20)
hasdata_18 = DataExists(Data=smaller_13.SmallerThan)
filter_127 = StreamFilter(Gate=hasdata_18, Stream0="False", Stream1=smaller_13.SmallerThan)
overlap_materials = RemoteSender(filter_127)

overlap_materials_2 = RemoteReceiver(overlap_materials)
hideshow_63 = HideShowElement(ElementToHideShow=label_46, Show=overlap_materials_2, Collapse=True, Disable=False)

panel_216 = Panel(setdocumentusertext_3)
panel_217 = Panel(getdocumentusertext_15)
panel_218 = Panel(clean_20)

created_materials_database_3 = RemoteReceiver(created_materials_database_2)
cull_43 = CullPattern(List=created_materials_database_3, CullPattern=mindex_12.Count)
lng_56 = ListLength(List=created_materials_database_3)
lng_57 = ListLength(List=cull_43)
created_materials_database_current = RemoteSender(cull_43)

larger_14 = LargerThan(FirstNumber=lng_56, SecondNumber=lng_57)  # -> LargerThan, OrEqualTo

hasdata_19 = DataExists(Data=larger_14.LargerThan)
filter_128 = StreamFilter(Gate=hasdata_19, Stream0="False", Stream1=larger_14.LargerThan)
invalid_material_categories = RemoteSender(filter_128)

invalid_material_categories_2 = RemoteReceiver(invalid_material_categories)
hideshow_64 = HideShowElement(ElementToHideShow=label_6, Show=invalid_material_categories_2, Collapse=True, Disable=False)

created_materials_database_current_2 = RemoteReceiver(created_materials_database_current)

database_materials_current_3 = RemoteReceiver(database_materials_current)
lng_58 = ListLength(List=database_materials_current_3)
series = Series(Start=0, Step=1, Count=lng_58)
hasdata_20 = DataExists(Data=database_materials_current_3)
tsort = SortText(Keys=database_materials_current_3, Values=series, Culture=127)  # -> Keys, Values
create_construction_materials_sorted = RemoteSender(tsort.Values)
filter_129 = StreamFilter(Gate=hasdata_20, Stream0=empty_10, Stream1=tsort.Keys)
setlist_15 = SetListContents(ListToModify=pulldown_26, NewListContents=filter_129, SelectedIndex=bang_12.Branch0)

create_construction_materials_sorted_2 = RemoteReceiver(create_construction_materials_sorted)
item_76 = ListItem(List=created_materials_database_current_2, Index=create_construction_materials_sorted_2, Wrap=invert(True))
item_77 = ListItem(List=item_76, Index=create_construction_materials_3, Wrap=invert(True))
repeat_23 = RepeatData(Data=item_77, Length=visible_layers_2)  # -> flatten(Data)
cluster_37 = Cluster(materials=repeat_23, construction_name=create_construction_name_4, thicknesses=repeat_17)  # -> error_2, construction_2
create_construction_error = RemoteSender(cluster_37.error_2)
gate_88 = StreamGate(Stream=cluster_37.construction_2, Gate=create_construction_2)  # -> Target0, Target1
objtostr_4 = HBObjectToString(hb_obj=gate_88.Target1)  # -> hb_str; plug-in component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
entwine_194 = Entwine(Branch00=getdocumentusertext_12, Branch01=objtostr_4, FlattenInputs=True)  # -> flatten(Result)
freeze_gate_68 = StreamFreezeGate(Data=entwine_194, PassingSwitch=create_construction_2, Freeze=False, Hold=False)
join_15 = TextJoin(Text=freeze_gate_68, Join="|")

create_construction_error_2 = RemoteReceiver(create_construction_error)
panel_219 = Panel(create_construction_error_2)
split_20 = TextSplit(Text=create_construction_error_2, Separators=panel_139)
trim_2 = TextTrim(Text=split_20, Start=True, End=True)
item_78 = ListItem(List=trim_2, Index=0, Wrap=True)  # -> Item, Item1
lng_59 = ListLength(List=split_20)
len_6 = TextLength(Text=item_78.Item1)
larger_15 = LargerThan(FirstNumber=lng_59, SecondNumber="1")  # -> LargerThan, OrEqualTo
subtraction_16 = Subtraction(A=len_6, B=Slider(11, range=0..20))
fragment_5 = TextFragment(Text=item_78.Item1, Start="0", Count=subtraction_16)
filter_130 = StreamFilter(Gate=larger_15.LargerThan, Stream0=create_construction_error_2, Stream1=fragment_5)
entwine_195 = Entwine(Branch00=filter_130, Branch01=gate_85.Target1, Branch02=gate_43.Target1, FlattenInputs=True)  # -> flatten(Result)
panel_220 = Panel(filter_130)
item_79 = ListItem(List=entwine_195, Index=0, Wrap=True)
create_construction_error_message = RemoteSender(item_79)

create_construction_error_message_2 = RemoteReceiver(create_construction_error_message)
null_55 = NullItem(Item=create_construction_error_message_2)  # -> NullFlags, InvalidFlags, Description
filter_131 = StreamFilter(Gate=null_55.NullFlags, Stream0=create_construction_error_message_2, Stream1=" ")
filter_132 = StreamFilter(Gate=null_55.NullFlags, Stream0=Slider(500, range=0..1000), Stream1=Slider(1000000, range=0..1000000))
hideshow_65 = HideShowElement(ElementToHideShow=button_43, Show=True, Collapse=True, Disable=invert(null_55.NullFlags))
tooltip_17 = AttachTooltipToElement(ElementsToAttachTo=button_43, TooltipContent=filter_131, ShowDelay=filter_132, Duration=Slider(5000, range=0..10000))

setdocumentusertext_4 = Python3Script(
    key=panel_172,
    load_value=freeze_gate_33,
    remove_value=freeze_gate_21,
    add_value=join_15,
    sync=sync_construction_database_2)  # -> done
# ---------- setdocumentusertext_4: Python ----------
import Rhino
import rhinoscriptsyntax as rs
import scriptcontext as sc

def modify_value(value):
    sc.doc = Rhino.RhinoDoc.ActiveDoc

    done = rs.SetDocumentUserText(key, value)
    return done

    sc.doc = ghdoc

if load_value:
    done = modify_value(load_value)

if add_value:
    done = modify_value(add_value)

if remove_value:
    done = modify_value(remove_value)

if remove_value == False:
    done = modify_value(None)

elif sync:
    done = True
# ---------- end setdocumentusertext_4 ----------
getdocumentusertext_16 = Python3Script(run=setdocumentusertext_4, key="Heath constructions")  # -> json_string; same code as getdocumentusertext_14
split_21 = TextSplit(Text=getdocumentusertext_16, Separators="|")
hold_12 = HoldingGate(Data=split_21)
strtoobj_9 = HBStringToObject(hb_str=hold_12)  # -> flatten(hb_obj); plug-in component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
ipy2_4 = IronPython2Script(constructions=strtoobj_9)  # -> unique_constructions; inputs constructions: list
# ---------- ipy2_4: IronPython ----------
"""Grasshopper Script"""

unique_constructions = []

for i in range(len(constructions)):
    if constructions[i] not in unique_constructions:
        unique_constructions.append(constructions[i])
# ---------- end ipy2_4 ----------
lng_60 = ListLength(List=ipy2_4)
lng_61 = ListLength(List=strtoobj_9)
clean_21 = CleanTree(RemoveNulls=True, RemoveInvalid=True, RemoveEmpty=False, Tree=ipy2_4)
smaller_14 = SmallerThan(FirstNumber=lng_60, SecondNumber=lng_61)  # -> SmallerThan, OrEqualTo
created_constructions_database_2 = RemoteSender(clean_21)
hasdata_21 = DataExists(Data=smaller_14.SmallerThan)
filter_133 = StreamFilter(Gate=hasdata_21, Stream0="False", Stream1=smaller_14.SmallerThan)
overlap_constructions = RemoteSender(filter_133)

overlap_constructions_2 = RemoteReceiver(overlap_constructions)
hideshow_66 = HideShowElement(ElementToHideShow=label_45, Show=overlap_constructions_2, Collapse=True, Disable=False)

panel_221 = Panel(strtoobj_9)
panel_222 = Panel(clean_21)

# ==== cluster AddDynamicShades
base_construction_set = ClusterInput()
setpoint = ClusterInput()
base_construction_set_2 = Data(base_construction_set)
decnstrconstrset = HBDeconstructConstructionSet(constr_set=base_construction_set_2)  # -> exterior_wall, exterior_roof, exposed_floor, ground_wall, ground_roof, ground_floor, window, skylight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; plug-in component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
setpoint_2 = Data(setpoint)
python = GhPythonScript(x=decnstrconstrset.window)  # -> out, a
# ---------- python: Python ----------
a = x.display_name
# ---------- end python ----------
merge = Merge(Data1=flatten(python.a), Data2=flatten("_dynamic_shades"))
shademat = HBShadeMaterial(thickness=Slider(0.01, range=0..0.01), transmittance=Slider(0.4, range=0..1))  # -> mat; plug-in component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
panel = Panel("Simple Glazing Window")
join = TextJoin(Text=merge)
windowconstrshd = HBWindowConstructionShade(
    name=join,
    win_constr=decnstrconstrset.window,
    shd_material=shademat,
    shd_location="Exterior",
    control_type=Slider(1, range=0..8),
    setpoint=setpoint_2)  # -> constr; plug-in component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
subfacesubset = HBSubfaceSubset(window=windowconstrshd, operable=windowconstrshd)  # -> subface_set; plug-in component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
constructionset = HBConstructionSet(base_constr_set=base_construction_set_2, subface_subset=subfacesubset)  # -> constr_set; plug-in component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
construction_set = Data(constructionset)
construction_set_2 = ClusterOutput(construction_set)

# ==== cluster Cluster
materials = ClusterInput()
materials_2 = Data(materials)
opaqueconstr = HBOpaqueConstruction(materials=materials_2)  # -> constr; plug-in component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
thicknesses = ClusterInput()
decnstrconstr = HBDeconstructConstruction(constr=opaqueconstr)  # -> materials, layers, r_val_si, r_val_ip, u_fac_si, u_fac_ip, shgc, t_sol, t_vis; plug-in component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
thicknesses_2 = Number(thicknesses)
nullrep = ReplaceNulls(Items=thicknesses_2, Replacements="0")  # -> Items, Count
construction_name = ClusterInput()
modify_layer_thicknesses = BrimstoneModifyThicknessesOfHoneybeeMaterials(hb_materials=decnstrconstr.materials, thicknesses=nullrep.Items)  # -> out, mod_materials; inputs hb_materials: list, thicknesses: list
# ---------- modify_layer_thicknesses: Python ----------
"""
Calculates embodied carbon for the elements of a Honeybee model if data is available
This component was inspired by the 'HB Color Face Attributes' component of Ladybug Tools 1.6.0

    Args:
        hb_materials: List of Honeybee materials which should get new thickness
        thicknesses: List of new material thicknesses

    Returns:
        mod_materials: Modified Honeybee materials
"""

import scriptcontext
#import brimstone

ghenv.Component.Message = ""#brimstone.globals.version

ghenv.Component.Name = 'Brimstone - Modify thicknesses of Honeybee materials'
ghenv.Component.NickName = 'Modify layer thicknesses'

try:  # import the core honeybee dependencies
    from honeybee_energy.material.opaque import EnergyMaterial
    from honeybee_energy.material.opaque import EnergyMaterialNoMass
except ImportError as e:
    raise ImportError('\nFailed to import honeybee:\n\t{}'.format(e))

def main(hb_materials, thicknesses):
    mod_materials = []
    assert len(hb_materials) == len(thicknesses), "Materials and thickness list must be of the same length"
    for (i, material) in enumerate(hb_materials):
        if not isinstance(material, EnergyMaterial):
            if isinstance(material, EnergyMaterialNoMass):
                mod_material = material.duplicate()
                mod_materials.append(mod_material)
            else:
                raise Exception("All materials must be valid Honeybee Energy Materials or Energy Materials (No Mass)")
        else: # if material is EnergyMaterial
            mod_material = material.duplicate()
            mod_material.thickness = thicknesses[i]
            mod_materials.append(mod_material)
    return mod_materials

if __name__ == "__main__":
    try:
        pass#flying = scriptcontext.sticky["brimstone_flying"]
    except:
        raise Exception("The 'Brimstone - Fly' component needs to exist on the canvas")
    mod_materials = main(hb_materials, thicknesses)
# ---------- end modify_layer_thicknesses ----------
construction_name_2 = Text(construction_name)
opaqueconstr_2 = HBOpaqueConstruction(name=construction_name_2, materials=modify_layer_thicknesses.mod_materials)  # -> constr; plug-in component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
error = Data(modify_layer_thicknesses.out)
error_2 = ClusterOutput(error)
construction = Data(opaqueconstr_2)
construction_2 = ClusterOutput(construction)

# ==== cluster Cluster_2
min = ClusterInput()
max = ClusterInput()
colors = ClusterInput()
legendpar = LBLegendParameters(min=min, max=max, colors=colors)  # -> leg_par; plug-in component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
leg_par = ClusterOutput(legendpar)

# ==== cluster Cluster_3
int = ClusterInput()
number_slider = Slider(2, range=0..10)
int_2 = Integer(int)
fragment = TextFragment(Text=int_2, Start="0", Count=number_slider)
fragment_2 = TextFragment(Text=int_2, Start=number_slider)
len = TextLength(Text=fragment_2)
addition = Addition(A=fragment, B="1")
equals = Equality(FirstNumber="0", SecondNumber=fragment)  # -> Equality, Inequality
filter = StreamFilter(Gate=equals.Equality, Stream0=addition, Stream1=fragment)
_10º = PowerOf10(Value=len)
multiplication = Multiplication(A=_10º, B=filter)
R = ClusterOutput(multiplication)

# ==== cluster Cluster_4
x = ClusterInput()
abs = Absolute(Value=x)
number_slider = Slider(2, range=0..10)
int = Integer(abs)
fragment = TextFragment(Text=int, Start="0", Count=number_slider)
fragment_2 = TextFragment(Text=int, Start=number_slider)
equals = Equality(FirstNumber="0", SecondNumber=fragment)  # -> Equality, Inequality
len = TextLength(Text=fragment_2)
addition = Addition(A=fragment, B="1")
filter = StreamFilter(Gate=equals.Equality, Stream0=addition, Stream1=fragment)
_10º = PowerOf10(Value=len)
multiplication = Multiplication(A=_10º, B=filter)
neg = Negative(Value=multiplication)
y = ClusterOutput(neg)

# ==== cluster Cluster_5
legendpar = LBLegendParameters(min=Slider(0, range=0..100), max=Slider(100, range=0..100), num_decimals=Slider(0, range=0..100))  # -> leg_par; plug-in component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
leg_par = ClusterOutput(legendpar)

# ==== cluster BakeGeometriesToLayers
geometry = ClusterInput()
geometry_2 = Data(geometry)
clean = CleanTree(RemoveNulls=True, RemoveInvalid=True, RemoveEmpty=False, Tree=geometry_2)
data = Data(clean)
py3 = Python3Script(x=data)  # -> out, a; inputs x: list
# ---------- py3: Python ----------
import rhinoscriptsyntax as rs
#import Rhino.Display.Text3d
import ladybug_rhino

a = []
for i in x:
    o_is_text = str(type(i)) == "<class 'IronPython.NewTypes.Grasshopper.Kernel.Types.GH_GeometricGoo`1#IGH_BakeAwareData#IGH_PreviewData_23$24'>"
    a.append(o_is_text)
    if o_is_text:
        print(dir(i))
# ---------- end py3 ----------
cull = CullPattern(List=data, CullPattern=invert(py3.a))
layers = ClusterInput()
bake = ClusterInput()
layers_2 = Data(layers)
bbox = BoundingBox(Content=<missing>, Plane=PlaneXY(0, 0, 0))  # -> Box, Box_2
txt = Text(<missing>)
bake_2 = Data(bake)
ef_layer = EleFrontLayer(Layer=layers_2, fullpath=True)
area = Area(Geometry=bbox.Box)  # -> Area, Centroid
bklay = BakeLayers(Layers=ef_layer, Bake=Toggle(True))
ef_att = EleFrontAttributes(Layer=ef_layer, maintainBakeName=False)
text_entity = TextEntity(Plane=area.Centroid, Text=txt)  # -> TextEntity, Plane, Text
weave = Weave(Pattern=[0, 1], Stream0=cull, Stream1=text_entity.TextEntity, NullGaps=False)
py3_2 = Python3Script(geo=weave, layers=ef_att)  # -> out, geo, layers; inputs geo: list, layers: list
# ---------- py3_2: Python ----------
if len(geo) == len(layers):
    pass
else:
    layers = [layers[0] for _ in range(len(geo))]
# ---------- end py3_2 ----------
bake_3 = BakeObjects(Geometry=py3_2.geo, Attributes=py3_2.layers, Bake=bake_2, createGroups=False)  # -> Message, Ghosts

# ==== cluster Cluster_6
id = ClusterInput()
id_2 = Guid(id)
filter_geometry_by_active_layer = Python3Script(geo=id_2)  # -> filtered_geo; inputs geo: list
# ---------- filter_geometry_by_active_layer: Python ----------
"""Filters geometry by active layer"""

import Rhino.Geometry as rg
import rhinoscriptsyntax as rs
import scriptcontext as sc
import Rhino

filtered_geo = []
sc.doc = Rhino.RhinoDoc.ActiveDoc
for g in geo:
    obj = sc.doc.Objects.Find(g)
    index = obj.Attributes.LayerIndex
    layer = sc.doc.Layers[index]
    if(layer.IsVisible):
        filtered_geo.append(g)
sc.doc = ghdoc
# ---------- end filter_geometry_by_active_layer ----------
rooms = Geometry(filter_geometry_by_active_layer)
rooms_2 = ClusterOutput(rooms)
